# Grasshopper definition G1-BUBBLE DIAGRAM.gh (Grasshopper 1.0.7)
# plug-ins: SpaceSyntaxDesign_GH

# ---- group: INPUTS
# Select the points following the order of the names
# 
# Select the curves suitable for the diagram: connectivity or adjecency
panel = Panel("""60
60
40
40
150
350
250
50
350
150
350
20
25
30
10
20
20
20
10
80
15
40""")
mass_addition = MassAddition(Input=panel)  # -> Result, PartialResults
panel_2 = Panel("""Type A
Type B
Type C
Computer Room
Workshop Area
Courtyard 1
Library
Childcare / Creche
Amphitheater
Multipurpose Hall
Courtyard 2
Entry Foyer
Office
Meeting Room
Counseling Room
Toilet1
Toilet2
Toilet3
Pantry
Storage1
Cleaning Room
Storage3""")
total_area_m2 = Panel(mass_addition.Result)
points = Points([<points referenced from the Rhino model> x22])
curves = Curve([<curve referenced from the Rhino model> x32])

# ---- group: Position of Diagrams
point = Point(Point(0.1416615595, -0.5371190109, 0))
xy_plane = XYPlane(Origin=point)
bp = BasePlane(xy_plane)

# ---- group: Bubble Diagram
graphfromnodes_links = GraphFromNodesLinks(Points=points, Links=curves, Labels=panel_2, Areas=panel, TotalArea=total_area_m2)  # -> Graph, GraphVertices, Attributes
forcedirecteddrawing = ForceDirectedDrawing(
    Graph=graphfromnodes_links.Graph,
    Vertices=graphfromnodes_links.GraphVertices,
    Attributes=graphfromnodes_links.Attributes,
    AttractionStrength=Slider(0.05, range=0..1),
    RepulsionStrength=Slider(0.5, range=0..1),
    ConvergenceTolearnce=0.0001,
    MaximumIterations=4000,
    Active=Toggle(True))  # -> NewGraphVertices, IterationCount
diskographdrawing = DiskoGraphDrawing(
    Plane=PlaneXY(188.5933988, -14.27494593, 0),
    Graph=graphfromnodes_links.Graph,
    Vertices=forcedirecteddrawing.NewGraphVertices,
    Attributes=graphfromnodes_links.Attributes,
    Thickness=2)
data = Data(forcedirecteddrawing.NewGraphVertices)
panel_3 = Panel(graphfromnodes_links.GraphVertices)

# ----
programme = Programme(Attributes=graphfromnodes_links.Attributes)  # -> Tags, Areas, Colors, Legends
legend = Legend(
    Colour=programme.Colors,
    Tags=programme.Legends,
    Rectangle={Plane=PlaneXY(-7.231523162, 51.54212847, 0), Size=Domain2(u=0..11.18919631, v=0..16.33622662)},
    LegendType=1)

# ---- group: NSWE Bubble diagram
graphfromnodes_linkswithnews = GraphFromNodesLinksWithNEWS(Points=points, Links=curves, Labels=panel_2, Areas=panel, TotalArea=total_area_m2)  # -> Graph, GraphVertices, Attributes
graphedges = GraphEdges(Graph=graphfromnodes_linkswithnews.Graph, Vertices=graphfromnodes_linkswithnews.GraphVertices)
tutteconvexdrawing = TutteConvexDrawing(
    BasePlane=bp,
    Graph=graphfromnodes_linkswithnews.Graph,
    Vertices=graphfromnodes_linkswithnews.GraphVertices,
    Attributes=graphfromnodes_linkswithnews.Attributes)  # -> NewGraphVertices, ConvexFaceBorders, SubGraph, SubVertices, SubAttributes
diskographdrawing_2 = DiskoGraphDrawing(
    Plane=bp,
    Graph=graphfromnodes_linkswithnews.Graph,
    Vertices=tutteconvexdrawing.NewGraphVertices,
    Attributes=graphfromnodes_linkswithnews.Attributes,
    Thickness=2)
panel_4 = Panel(tutteconvexdrawing.NewGraphVertices)

# ----
graph = Data(graphfromnodes_links.Graph)
att = Data(graphfromnodes_links.Attributes)

# ---- group: Depth Diagram
integration_analysis = IntegrationAnalysis(Graph=graph, Attributes=att)  # -> DepthTable, DepthMap, RelativeASymetry, Integration, IntegrationRelativeColors, IntegrationTags
justifiedgraphdrawing = JustifiedGraphDrawing(
    ViewPointIndex=Slider(11, range=0..22),
    Plane=PlaneXY(440.548283, -31.9967441, 0),
    Size=50,
    Thickness=2,
    Graph=graphfromnodes_links.Graph,
    Attributes=graphfromnodes_links.Attributes,
    DepthTable=integration_analysis.DepthTable)

# ----
diskographdrawing_3 = DiskoGraphDrawing(
    Plane=bp,
    Graph=graphfromnodes_linkswithnews.Graph,
    Vertices=tutteconvexdrawing.NewGraphVertices,
    Attributes=graphfromnodes_linkswithnews.Attributes,
    Thickness=2)

graph_2 = Integer(graph)
att_2 = Data(att)

# ---- group: Legends
entropy_analysis = EntropyAnalysis(Graph=graph_2, Attributes=att_2, DepthTable=integration_analysis.DepthTable, DepthMap=integration_analysis.DepthMap)  # -> Entropy, EntropyRelativeColors, EntropyTags
control_analysis = ControlAnalysis(Graph=graph_2, Attributes=att_2)  # -> Control, ControlRelativeColors, ControlTags
differencefactor = DifferenceFactor(RelativeAsymetries=integration_analysis.RelativeASymetry)
choice_analysis = ChoiceAnalysis(Graph=graph_2, Attributes=att_2)  # -> ShortestPaths, ChoiceBetweenness, ChoiceRelativeColors, ChoiceTags
sort_list = SortList(
    Keys=control_analysis.Control,
    ValuesValuesA=control_analysis.ControlRelativeColors,
    ValuesB=control_analysis.ControlTags)  # -> Keys, ValuesValuesA, ValuesB
sort_list_2 = SortList(
    Keys=entropy_analysis.Entropy,
    ValuesValuesA=entropy_analysis.EntropyRelativeColors,
    ValuesB=entropy_analysis.EntropyTags)  # -> Keys, ValuesValuesA, ValuesB
sort_list_3 = SortList(
    Keys=choice_analysis.ChoiceBetweenness,
    ValuesValuesA=choice_analysis.ChoiceRelativeColors,
    ValuesB=choice_analysis.ChoiceTags)  # -> Keys, ValuesValuesA, ValuesB
sort_list_4 = SortList(
    Keys=integration_analysis.Integration,
    ValuesValuesA=integration_analysis.IntegrationRelativeColors,
    ValuesB=integration_analysis.IntegrationTags)  # -> Keys, ValuesValuesA, ValuesB
panel_5 = Panel(differencefactor)
legend_2 = Legend(
    Colour=sort_list.ValuesValuesA,
    Tags=sort_list.ValuesB,
    Rectangle={Plane=PlaneXY(32.76847684, 51.54212847, 0), Size=Domain2(u=0..11.18919631, v=0..16.33622662)},
    LegendType=1)
legend_3 = Legend(
    Colour=sort_list_2.ValuesValuesA,
    Tags=sort_list_2.ValuesB,
    Rectangle={Plane=PlaneXY(72.76847684, 51.54212847, 0), Size=Domain2(u=0..11.18919631, v=0..16.33622662)},
    LegendType=1)
legend_4 = Legend(
    Colour=sort_list_4.ValuesValuesA,
    Tags=sort_list_4.ValuesB,
    Rectangle={Plane=PlaneXY(12.76847684, 51.54212847, 0), Size=Domain2(u=0..11.18919631, v=0..16.33622662)},
    LegendType=1)
legend_5 = Legend(
    Colour=sort_list_3.ValuesValuesA,
    Tags=sort_list_3.ValuesB,
    Rectangle={Plane=PlaneXY(52.76847684, 51.54212847, 0), Size=Domain2(u=0..11.18919631, v=0..16.33622662)},
    LegendType=1)
