# Grasshopper definition G1-LOWER GROUND FLOOR _kangaroo, karamba.gh (Grasshopper 1.0.7)
# plug-ins: Karamba, MeshEdit Components, Weaverbird, Kangaroo2 Components

# ---- group: INPUTS
# 1. Select the curves accordingly to the spaces (Library or Multipurpose Hall)
# 
# A - space mesh: 3D regular grid of the rooms
# A - wall mesh: 3D regular grid  of the walls
# A - wall boundaries: boundaries curves that define the walls contours
a_space_mesh = Curve()
a_wall_mesh = Curve()
a_wall_boundaries = Curve()

# 0.These are background parameters:
# they ensure that the resulted geometry is related to the dimension of the brick and its mecahnical properties.
unit_mm = Slider(75, range=0..100)
adobe_density_kg_m3 = Panel("1900")
gravity_m_s2 = Panel("10")
youngs_module_mpa = Panel("80")

# ----
expression = Expression(E=youngs_module_mpa, Expression="E*1000000")

# ---- group: Brick formation
expression_2 = Expression(mm=unit_mm, Expression="mm*0.001")
expression_3 = Expression(u=expression_2, Expression="u*2")
expression_4 = Expression(u=expression_2, Expression="u*4")
brick_size_mm = DomainBox(Base=PlaneXY(0, 0, 0), Width=expression_3, Length=expression_4, Height=expression_2)

# ---- group: Set up the model
a_space_mesh_2 = Mesh([a_wall_mesh, a_space_mesh])
walls = Curve(a_wall_boundaries)
mesh_join = MeshJoin(Meshes=flatten(a_space_mesh_2))
deconstruct_mesh = DeconstructMesh(Mesh=mesh_join)  # -> Vertices, Faces, Colours, Normals
mesh = Mesh(mesh_join)

# ---- group: Anchors
point = Point(flatten(deconstruct_mesh.Vertices))
point_in_curves = PointInCurves(Point=point, Curves=walls)  # -> Relationship, Index, Point
cull_pattern = CullPattern(List=point, CullPattern=point_in_curves.Relationship)
deconstruct_vector = DeconstructVector(Vector=cull_pattern)  # -> XComponent, YComponent, ZComponent
smaller_than = SmallerThan(FirstNumber=deconstruct_vector.ZComponent, SecondNumber=Slider(0.3, range=0..1))  # -> SmallerThan, OrEqualTo
cull_pattern_2 = CullPattern(List=cull_pattern, CullPattern=smaller_than.OrEqualTo)
point_2 = Point(cull_pattern_2)

# ---- group: Kangaroo INPUTS Parameters
number_slider = Slider(0.95, range=0..1)
mesh_2 = Mesh(mesh)
supports = Point(flatten(point_2))
strength_anchor = Slider(5000, range=1000..10000)

# ----
reset_solver = Button()
n_of_bricks_for_the_thickness = Slider(4, range=0..10)  # disabled

# ---- group: Option 2) use these parameters to related the resulted geometry to the real mechanical properties of the brick
module_grid_m = Panel("0.015")  # disabled
multiplication = Multiplication(BrickUnitM=expression_2, B=n_of_bricks_for_the_thickness)  # disabled
square = Square(Value=module_grid_m)  # disabled
original_area_m2 = Panel(square)  # disabled
thickness_m = Panel(multiplication)  # disabled
expression_5 = Expression(E=expression, t=thickness_m, Expression="(E*t)/1000")  # disabled
expression_6 = Expression(S=original_area_m2, t=thickness_m, d=adobe_density_kg_m3, g=gravity_m_s2, Expression="(S*t*d*g)")  # disabled
spring_strength_n_m = Number(flatten(expression_5))  # disabled
force_n = Number(flatten(expression_6))  # disabled

# ---- group: Option 1) Play with these value to reache the desired height
# Chose between the 2 options:
# 
# Option1). Not realistic values to play
#  with the geometry
# 
# Option 2). Realistic values releted
#  to the mechanical and physical
# properties of Adobe brick
strength_springs = Slider(90, range=1..100)
force = Slider(0.2, range=0..1)

# ----
edgelengths = EdgeLengths(Mesh=mesh_2, LengthFactor=1, Strength=strength_springs)

# ---- group: KANGAROO PROCESS
deconstruct_mesh_2 = DeconstructMesh(Mesh=mesh_2)  # -> Vertices, Faces, Colours, Normals
removeduplicatepts = RemoveDuplicatePts(Points=deconstruct_mesh_2.Vertices, Tolerance=0.01)
closest_point = ClosestPoint(Point=supports, Cloud=removeduplicatepts)  # -> ClosestPoint, CPIndex, Distance
unit_z = UnitZ(Factor=force)
supports_2 = Point(flatten(closest_point.ClosestPoint))
particles = Point(removeduplicatepts)
load = Load(Point=particles, ForceVector=unit_z)
anchor = Anchor(Point=supports_2, Strength=expr("x*10", strength_anchor))
show = Show(G=particles)
show_2 = Show(G=mesh_2)
merge = Merge(Data1=show_2, Data2=show, Data3=edgelengths, Data4=load, Data5=anchor)
bouncysolver = BouncySolver(
    GoalObjects=merge,
    Reset=reset_solver,
    Threshold=1e-15,
    Tolerance=0.01,
    Damping=number_slider,
    Iterations=10,
    On=Toggle(False))  # -> I, V, O
clean_tree = CleanTree(RemoveNulls=True, RemoveInvalid=True, RemoveEmpty=False, Tree=bouncysolver.O)  # -> simplify(Tree)
list_item = ListItem(List=clean_tree, Index=0, Wrap=True)

# ----
clear_height_m = Slider(3, range=0..10)
# if the mesh meets the spatial requirements -->
# Internalise the data to structurally analyse the mesh
resulted_mesh = Mesh(list_item)

# ---- group: Check Height
xy_plane = XYPlane(Origin=Point(0, 0, 0))
plane_surface = PlaneSurface(Plane=xy_plane, XSize="20", YSize="20")
vector_xyz = VectorXYZ(XComponent=expr("x/2", "20"), YComponent=expr("x/2", "20"), ZComponent=clear_height_m)  # -> Vector, Length
move = Move(Geometry=plane_surface, Motion=vector_xyz.Vector)  # -> Geometry, Transform

# ----
shape_gf = Data()

# ---- group: Karamba parameters
mesh_3 = Mesh(shape_gf)
walls_2 = Curve([<curve referenced from the Rhino model> x18])

# ---- group: Smooth mesh
mesh_join_2 = MeshJoin(Meshes=mesh_3)
unim = UnifyMesh(Mesh=mesh_join_2)  # -> Result, Count
weaverbird_s_laplacian_smoothing = WeaverbirdsLaplacianSmoothing(MeshCurves=unim.Result, Level=Slider(15, range=0..200), SmoothNakedEdges=0, Thin=1)

# ----
mesh_4 = Mesh(weaverbird_s_laplacian_smoothing)
n_of_bricks_of_thickness = Slider(1, range=0..10)

# ---- group: find the First Floor
deconstruct_mesh_3 = DeconstructMesh(Mesh=mesh_4)  # -> Vertices, Faces, Colours, Normals
deconstruct = Deconstruct(Point=deconstruct_mesh_3.Vertices)  # -> XComponent, YComponent, ZComponent
sort_list = SortList(Keys=deconstruct.ZComponent, ValuesValuesA=deconstruct_mesh_3.Vertices)  # -> reverse(Keys), reverse(ValuesValuesA)
list_item_2 = ListItem(List=sort_list.ValuesValuesA, Index=0, Wrap=True)
list_item_3 = ListItem(List=sort_list.Keys, Index=0, Wrap=True)
height_shell_m = Panel(list_item_3)
point_3 = Point(list_item_2)
unit_z_2 = UnitZ(Factor=height_shell_m)
xy_plane_2 = XYPlane(Origin=Point(0, 0, 0))
move_2 = Move(Geometry=xy_plane_2, Motion=unit_z_2)  # -> Geometry, Transform

# ---- group: Define Material and Cross sections
expression_7 = Expression(E=expression, Expression="E*0.0000001")
expression_8 = Expression(d=adobe_density_kg_m3, Expression="d*0.01")
panel = Panel(expression_7)
panel_2 = Panel(expression_8)
multiplication_2 = Multiplication(BrickUnitM=expression_2, B=n_of_bricks_of_thickness, _100=100)
material_properties_karamba3d = MaterialPropertiesKaramba3D(
    FamilyOfMaterial="Adobe",
    Name="Adobe v.1",
    YoungsModulus_kN_cm2=panel,
    InPlaneShearModulus_kN_cm2=expr("x/2.5", panel),
    TransverseShearModulus_kN_cm2=8076,
    SpecificWeight_kN_m3=panel_2,
    CoefficientOfThermalExpansion_1_C=1e-05,
    YieldStrength_kN_cm2="0.05",
    mode="Isotrop")
thickness_cm = Panel(multiplication_2)
cross_section_karamba3d = CrossSectionKaramba3D(
    FamilyNameOfCrossSection="S",
    NameOfCrossSection=flatten(""),
    Material=material_properties_karamba3d,
    Height_cm=flatten(thickness_cm),
    mode="Shell - Const")

# ----
height_supports_m = Panel("3")
expression_9 = Expression(t=simplify(thickness_cm), h=simplify(height_shell_m), Expression="(t/100)+h")
expression_10 = Expression(hs=simplify(height_supports_m), h=simplify(height_shell_m), Expression="h-hs")
netto_height_m = Panel(expression_10)
tot_height_m = Panel(expression_9)

area = MeshArea(Mesh=mesh_4)  # -> Area, Centroid

# ---- group: Self Weight
loads_karamba3d = LoadsKaramba3D(LCase="0", mode="Gravity")

# ----
max_span = Panel("300")
division = Division(A=max_span, B="400")

# ---- group: OFFSET MESH
# the parameters need to be TRUE in
# order to prove and verify the structure.
# 
# TRUE: the parameters meet the
# requirements
# FALSE: the parameters do not meet
# the requirements
boolean_toggle = BooleanToggle(True)
# IF STRUCTURAL TEST RESULTS ARE SATISFYING
# ENABLE THIS COMPONENT FOR OFFSETING
mesh_5 = Mesh(weaverbird_s_laplacian_smoothing)  # disabled
mesh_offset_extrude = MeshOffsetExtrude(M=mesh_5, B=False, E=boolean_toggle, C0=boolean_toggle, C1=True, D=thickness_cm)  # -> out, A; inputs M: Mesh, V: list of Vector3d, D: list
# ---------- mesh_offset_extrude: VB ----------
    Component.Params.Input(0).Name = "Mesh"
    Component.Params.Input(0).Description = "Open or closed mesh"
    Component.Params.Input(1).Name = "Both Sides"
    Component.Params.Input(1).Description = "If true the mesh is offset in both directions along the vertex normals"
    Component.Params.Input(2).Name = "Edges"
    Component.Params.Input(2).Description = "If true the mesh will contain faces on the edges between the two offset mesh faces"
    Component.Params.Input(3).Name = "Closed Bottom"
    Component.Params.Input(3).Description = "If true the mesh will be closed on the origin face"
    Component.Params.Input(4).Name = "Closed Top"
    Component.Params.Input(4).Description = "If true the mesh will be closed on the offset face"
    Component.Params.Input(5).Name = "Vector [Vertex]"
    Component.Params.Input(5).Description = "An optional vector that sets the direction of extrusion, if empty, the new mesh will be offset along the vertex normals"
    Component.Params.Input(6).Name = "Distance [Vertex, Rh Units]"
    Component.Params.Input(6).Description = "A single number or list of numbers corresponding to each vertex of a mesh which sets the Rhino unit based distance that the new geometry is offset from each mesh face"

    Component.Params.Output(1).Name = "Mesh"
    Component.Params.Output(1).Description = "If successful, a valid mesh"

    If m IsNot Nothing Then

      Dim mf As Rhino.Geometry.Collections.MeshFaceList = Nothing
      Dim mv As Rhino.Geometry.Collections.MeshVertexList = Nothing
      Dim mtv As Rhino.Geometry.Collections.MeshTopologyVertexList = Nothing
      Dim mte As Rhino.Geometry.Collections.MeshTopologyEdgeList = Nothing
      Dim mn As Rhino.Geometry.Collections.MeshVertexNormalList = Nothing
      Dim mc As Rhino.Geometry.Collections.MeshVertexColorList = Nothing

      mf = m.Faces
      mv = m.Vertices
      mtv = m.TopologyVertices
      mte = m.TopologyEdges
      mn = m.Normals
      mc = m.VertexColors

      Dim clrB As Boolean = False
      If mc.count() > 0 Then clrB = True

      Dim i,cv,cf,u(1),hd As Integer
      Dim blnV As Boolean
      Dim vec As vector3d
      Dim ova, ovb As New list(Of point3d)
      Dim vf As New list(Of Vector3f)
      Dim ofc As New list(Of MeshFace)
      If b Then hd = 2 Else hd = 1
      
      cv = mv.count()
      cf = mf.count()

      If (D.count() - 1) < cv Then D = matchDbl(D, cv)

      If v.count() > 0 Then
        blnV = True
        If (V.count() - 1) < cv Then V = matchVec(V, cv)
      End If

      'Define Base Vertices
      For i = 0 To cv - 1 Step 1
        If blnV Then vec = V(i) Else vec = mn(i)
        vec.Unitize()
        vec *= (D(i) / hd)

        ovb.add(New point3d(mv(i)) + vec)
        If Not b Then vec *= 0
        vec.Reverse()
        ova.add(New point3d(mv(i)) + vec)
      Next

      If (c0 Or (((Not c0) And (Not e)) And c1)) Then ofc = mf.ToList()

      If ((e or c0) And c1) Then
        For i = 0 To cf - 1 Step 1
          If mf(i).isquad() Then
            ofc.add(New meshface(mf(i).A + cv, mf(i).B + cv, mf(i).C + cv, mf(i).D + cv))
          Else
            ofc.add(New meshface(mf(i).A + cv, mf(i).B + cv, mf(i).C + cv))
          End If
        Next
      End If

      If e Then
        For i = 0 To mte.count() - 1 Step 1

          u(0) = mtv.MeshVertexIndices(mte.GetTopologyVertices(i).I)(0)
          u(1) = mtv.MeshVertexIndices(mte.GetTopologyVertices(i).J)(0)

          If uBound(mte.GetConnectedFaces(i)) < 1 Then
            ofc.add(New meshface(u(0), u(1), u(1) + cv, u(0) + cv))
          End If
        Next
      End If

      Dim mo As New mesh

      If (c0 Or e) Then
        mo.Vertices.AddVertices(ova.toarray())
        If clrB Then mo.VertexColors.AppendColors(mc.ToArray())
      End If
      If (c1 Or e) Then
        mo.Vertices.AddVertices(ovb.toarray())
        If clrB Then mo.VertexColors.AppendColors(mc.ToArray())
      End If

      mo.Faces.AddFaces(ofc)

      A = mo
    End If
# ---------- mesh_offset_extrude: VB additional code ----------
  Private Function matchDbl(ByVal a As list(Of Double), ByVal t As Integer)
    Dim i,k As Integer
    k = a.count()
    For i = 0 To ((t + 1) - k) - 1 Step 1
      a.add(a.item(k - 1))
    Next
    Return a
  End Function

  Private Function matchVec(ByVal a As list(Of vector3d), ByVal t As Integer)
    Dim i,k As Integer
    k = a.count()
    For i = 0 To ((t + 1) - k) - 1 Step 1
      a.add(a.item(k - 1))
    Next
    Return a
  End Function
# ---------- end mesh_offset_extrude ----------
mesh_unifynormals = MeshUnifyNormals(Mesh=mesh_offset_extrude.A)

# ---- group: OUTPUT
shape_gf_2 = Mesh(mesh_unifynormals)

# ---- group: Point load - Filling
module_grid_m_2 = Panel("0.15")
density_compressedhay_kg_m3 = Panel("150")
square_2 = Square(Value=module_grid_m_2)
original_area_m2_2 = Panel(square_2)

# ---- group: Assembly model
mesh_to_shell_karamba3d = MeshToShellKaramba3D(Mesh=weaverbird_s_laplacian_smoothing, CrossSection=cross_section_karamba3d, LimitDistance_m=0.005)  # -> Element, Points, Info

# ---- group: Anchors
point_4 = Point(flatten(mesh_to_shell_karamba3d.Points))
point_in_curves_2 = PointInCurves(Point=point_4, Curves=walls_2)  # -> Relationship, Index, Point
dispatch = Dispatch(List=point_4, DispatchPattern=point_in_curves_2.Relationship)  # -> ListA, ListB
supports_3 = Point(dispatch.ListA)
point_5 = Point(dispatch.ListB)
remove_duplicate_points_karamba3d = RemoveDuplicatePointsKaramba3D(Point=supports_3, LimitDistance=0.005)  # -> OutPoint, Info, Indexes

# ----
point_6 = Point(point_5)

# ---- group: Live Load
unit_z_3 = UnitZ(Factor=Slider(-5, range=-10..-1))
loads_karamba3d_2 = LoadsKaramba3D(
    Vector=unit_z_3,
    Mesh=weaverbird_s_laplacian_smoothing,
    Pos=mesh_to_shell_karamba3d.Points,
    LCase="1",
    mode="MeshLoad -Const.",
    menu=[buttons(off, on, off), buttons(on, on)])

# ---- group: Point load - Filling (continued)
project = Project(Geometry=point_6, Plane=move_2.Geometry)  # -> Geometry, Transform
line = Line(StartPoint=point_6, EndPoint=project.Geometry)
length = Length(Curve=line)
expression_11 = Expression(S=original_area_m2_2, L=length, d=density_compressedhay_kg_m3, g=gravity_m_s2, Expression="(S*L*d*g)/1000")

# ----
mass_addition = MassAddition(Input=expression_11)  # -> Result, PartialResults
division_2 = Division(A=mass_addition.Result, B=area.Area)
distributed_mesh_load0_kn_m2 = Panel(division_2)

# ---- group: Point load - Filling (continued)
negative = Negative(Value=distributed_mesh_load0_kn_m2)
unit_z_4 = UnitZ(Factor=negative)
loads_karamba3d_3 = LoadsKaramba3D(
    Vector=unit_z_4,
    Mesh=weaverbird_s_laplacian_smoothing,
    Pos=mesh_to_shell_karamba3d.Points,
    LCase="2",
    mode="MeshLoad -Const.",
    menu=[buttons(off, on, off), buttons(on, on)])

# ----
loads = LoadKaramba3D(flatten([loads_karamba3d, loads_karamba3d_2, loads_karamba3d_3]))

# ---- group: Assembly model (continued)
support_karamba3d = SupportKaramba3D(PosInd=remove_duplicate_points_karamba3d.OutPoint, menu=[buttons(on, on, on, off, off, off)])
assemble_model_karamba3d = AssembleModelKaramba3D(
    Point=mesh_to_shell_karamba3d.Points,
    Elem=mesh_to_shell_karamba3d.Element,
    Support=support_karamba3d,
    Load=flatten(loads),
    LimitDistance_m=0.005)  # -> Model, Info, Mass_kg, CenterOfGravity

# ---- group: Karamba analysis
analyze_karamba3d = AnalyzeKaramba3D(Model=assemble_model_karamba3d.Model)  # -> CalculatedModel, MaximumDisplacement_cm, ResultingForceOfGravity_kN, ElasticEnergy_kNm
model_view_karamba3d = ModelViewKaramba3D(
    Model=analyze_karamba3d.CalculatedModel,
    ResultFactors=1,
    ResultCase=-1,
    ListOfColorsForColoringPlots=[ColourSwatch(SwatchColor=RGB(191, 191, 191)), ColourSwatch(SwatchColor=RGB(235, 38, 0)), ColourSwatch(SwatchColor=RGB(230, 230, 230)), ColourSwatch(SwatchColor=RGB(61, 83, 130)), ColourSwatch(SwatchColor=RGB(61, 83, 130))])  # -> Model, DeformedMesh, DeformedAxes, DeformedModel
shell_view_karamba3d = ShellViewKaramba3D(Model=model_view_karamba3d.Model, IndexOfLayer=0)  # -> Model, MeshesOfRenderedShells, LegendColors, LegendTags

# ----
# Keep the view analysis to considere the maximu stress in both directions.
shell_view_karamba3d_2 = ShellViewKaramba3D(Model=model_view_karamba3d.Model, IndexOfLayer=0)  # -> Model, MeshesOfRenderedShells, LegendColors, LegendTags

# ---- group: Karamba analysis (continued)
legend = Legend(Colour=shell_view_karamba3d_2.LegendColors, Tags=shell_view_karamba3d_2.LegendTags, LegendType=1)
legend_2 = Legend(Colour=shell_view_karamba3d_2.LegendColors, Tags=shell_view_karamba3d.LegendTags, LegendType=1)

# ---- group: Princ. Stress 1
reverse_list = ReverseList(List=shell_view_karamba3d_2.LegendTags)
list_item_4 = ListItem(List=reverse_list, Index="1", Wrap=True)
list_item_5 = ListItem(List=shell_view_karamba3d_2.LegendTags, Index="1", Wrap=True)
u_direction = Data(list_item_5)
u_direction_2 = Data(list_item_4)
u_max_tensile_kn_cm2 = Panel(u_direction_2)
u_max_comp_kn_cm2 = Panel(u_direction)

# ---- group: Princ. Stress 2
reverse_list_2 = ReverseList(List=shell_view_karamba3d.LegendTags)
list_item_6 = ListItem(List=reverse_list_2, Index="1", Wrap=True)
list_item_7 = ListItem(List=shell_view_karamba3d.LegendTags, Index="1", Wrap=True)
v_direction = Data(list_item_6)
v_direction_2 = Data(list_item_7)
v_max_tensile_kn_cm2 = Panel(v_direction)
v_max_comp_kn_cm2 = Panel(v_direction_2)

# ----
max_d = Data(analyze_karamba3d.MaximumDisplacement_cm)
max_displacement_cm = Panel(max_d)

# ---- group: Find max values
minimum = Minimum(A=u_max_comp_kn_cm2, B=v_max_comp_kn_cm2)
absolute = Absolute(Value=minimum)
maximum = Maximum(A=u_max_tensile_kn_cm2, B=v_max_tensile_kn_cm2)
expression_12 = Expression(x=absolute, Expression="x*10")
max_comp_mpa = Panel(expression_12)

# ----
expression_13 = Expression(x=maximum, Expression="x*10")

# ---- group: Find max values (continued)
max_tensile_mpa = Panel(expression_13)

# ---- group: CHECKS
max_displacment_allowable_cm = Panel(division)
compressive_strenght_mpa = Panel("1")

# ----
expression_14 = Expression(x=compressive_strenght_mpa, Expression="x/10")

# ---- group: CHECKS (continued)
tensile_strenght_mpa = Panel(expression_14)

# ----
smaller_than_2 = SmallerThan(FirstNumber=max_displacement_cm, SecondNumber=max_displacment_allowable_cm)  # -> SmallerThan, OrEqualTo
smaller_than_3 = SmallerThan(FirstNumber=max_tensile_mpa, SecondNumber=tensile_strenght_mpa)  # -> SmallerThan, OrEqualTo
smaller_than_4 = SmallerThan(FirstNumber=max_comp_mpa, SecondNumber=compressive_strenght_mpa)  # -> SmallerThan, OrEqualTo

# ---- group: THESE VALUES MUST BE TRUE TO PASS
panel_3 = Panel(smaller_than_4.SmallerThan)
panel_4 = Panel(smaller_than_2.SmallerThan)
panel_5 = Panel(smaller_than_3.SmallerThan)
