# Grasshopper definition G1-LOWER GROUND FLOOR _regular mesh.gh (Grasshopper 1.0.7)

# ---- group: INPUTS
doors_horizontal = Curve([<curve referenced from the Rhino model> x18])
space_curves_gf = Curve([<curve referenced from the Rhino model> x9])
# 1. Select the curves accordingly to
# the spaces (Library or Multipurpose Hall)
# 
# space curves GF: rectangles defining the rooms
# doors horizontal: doors along the x-axis
# doors vertical: door along the y-axis
doors_vertical = Curve([<curve referenced from the Rhino model> x11])

# ----
number_slider = Slider(0.3, range=0..1)

# ---- group: create surfaces
neg = Negative(Value=number_slider)
offset = OffsetCurve(Curve=space_curves_gf, Distance=number_slider, Plane=PlaneXY(0, 0, 0), Corners=1)
srf = Surface(offset)
sunion = SolidUnion(Breps=flatten(srf))  # -> flatten(Result)
offset_2 = OffsetCurve(Curve=space_curves_gf, Distance=neg, Plane=PlaneXY(0, 0, 0), Corners=1)
edges = BrepEdges(Brep=sunion)  # -> Naked, Interior, NonManifold
boundary = BoundarySurfaces(Edges=offset_2)
boundary_2 = BoundarySurfaces(Edges=edges.Naked)
sdiff = SolidDifference(BrepsA=flatten(boundary_2), BrepsB=flatten(boundary))

# ----
walls = Surface(sdiff)
rooms = Surface(boundary)

X = UnitX(Factor=1)
Y = UnitY(Factor=1)
number_slider_2 = Slider(0.15, range=0..1)
line = LineSDL(Start="0.15,0.15,0", Direction=X, Length="35")
line_2 = LineSDL(Start="0.15,0.15,0", Direction=Y, Length="20")
series = Series(Start=0, Step=number_slider_2, Count="150")
series_2 = Series(Start=0, Step=number_slider_2, Count="220")
X_2 = UnitX(Factor=series_2)
Y_2 = UnitY(Factor=series)
move = Move(Geometry=line, Motion=Y_2)  # -> Geometry, Transform
move_2 = Move(Geometry=line_2, Motion=X_2)  # -> Geometry, Transform

sdiff_2 = SolidDifference(BrepsA=walls, BrepsB=[doors_horizontal, doors_vertical])
panel = Panel("""1
3
4""")
panel_2 = Panel("""2
5
4""")
panel_3 = Panel("""2
4
5""")
grid = Curve(simplify([move.Geometry, move_2.Geometry]))

# ---- group: Create mesh for the walls
srfsplit = SurfaceSplit(Surface=sdiff_2, Curves=grid)
debrep = DeconstructBrep(Brep=srfsplit)  # -> Faces, Edges, Vertices
join = JoinCurves(Curves=debrep.Edges, Preserve=False)
boundary_3 = BoundarySurfaces(Edges=join)  # -> graft(Surfaces)

# ---- group: Create the boundaries of the walls
srf_2 = Surface(sdiff_2)
debrep_2 = DeconstructBrep(Brep=srf_2)  # -> Faces, Edges, Vertices
join_2 = JoinCurves(Curves=debrep_2.Edges, Preserve=False)

# ----
number_slider_3 = Slider(0.15, range=0..1)

# ---- group: Create Regular grid for the rooms
Z = UnitZ(Factor="1.5")
extr = Extrude(Base=rooms, Direction=Z)
debrep_3 = DeconstructBrep(Brep=graft(extr))  # -> Faces, Edges, Vertices
number_slider_4 = Slider(4, range=0..10)
cull_i = CullIndex(List=debrep_3.Faces, Indices=0, Wrap=True)
cull_i_2 = CullIndex(List=cull_i, Indices=number_slider_4, Wrap=True)
item = ListItem(List=cull_i, Index=number_slider_4, Wrap=True)
debrep_4 = DeconstructBrep(Brep=item)  # -> Faces, Edges, Vertices
debrep_5 = DeconstructBrep(Brep=cull_i_2)  # -> Faces, Edges, Vertices
len = Length(Curve=debrep_4.Edges)
len_2 = Length(Curve=debrep_5.Edges)
division = Division(A=len, B=number_slider_3)
division_2 = Division(A=len_2, B=number_slider_3)
dispatch = Dispatch(List=division, DispatchPattern=[True, True, False, False])  # -> ListA, ListB
dispatch_2 = Dispatch(List=division_2, DispatchPattern=[True, True, False, False])  # -> ListA, ListB
dispatch_3 = Dispatch(List=dispatch_2.ListA, DispatchPattern=[True, False])  # -> ListA, ListB
dispatch_4 = Dispatch(List=dispatch.ListA, DispatchPattern=[True, False])  # -> ListA, ListB
divide = DivideDomain²(Domain=debrep_4.Faces, UCount=graft(dispatch_4.ListA), VCount=graft(dispatch_4.ListB))
divide_2 = DivideDomain²(Domain=debrep_5.Faces, UCount=graft(dispatch_3.ListB), VCount=graft(dispatch_3.ListA))
subsrf = Isotrim(Surface=debrep_4.Faces, Domain=divide)
subsrf_2 = Isotrim(Surface=debrep_5.Faces, Domain=divide_2)
join_3 = JoinCurves(Curves=subsrf_2, Preserve=False)
join_4 = JoinCurves(Curves=subsrf, Preserve=False)

# ----
number_slider_5 = Slider(0.15, range=0..1)

# ---- group: Create Regular grid for the doors
Z_2 = UnitZ(Factor="1.5")
srf_3 = Surface(doors_vertical)
extr_2 = Extrude(Base=srf_3, Direction=Z_2)
debrep_6 = DeconstructBrep(Brep=graft(extr_2))  # -> Faces, Edges, Vertices
cull_i_3 = CullIndex(List=debrep_6.Faces, Indices=0, Wrap=True)
item_2 = ListItem(List=cull_i_3, Index=Slider(4, range=0..10), Wrap=True)
cull_i_4 = CullIndex(List=cull_i_3, Indices=panel, Wrap=True)
debrep_7 = DeconstructBrep(Brep=item_2)  # -> Faces, Edges, Vertices
debrep_8 = DeconstructBrep(Brep=cull_i_4)  # -> Faces, Edges, Vertices
len_3 = Length(Curve=debrep_7.Edges)
len_4 = Length(Curve=debrep_8.Edges)
division_3 = Division(A=len_3, B=number_slider_5)
division_4 = Division(A=len_4, B=number_slider_5)
dispatch_5 = Dispatch(List=division_3, DispatchPattern=[True, True, False, False])  # -> ListA, ListB
dispatch_6 = Dispatch(List=division_4, DispatchPattern=[True, True, False, False])  # -> ListA, ListB
dispatch_7 = Dispatch(List=dispatch_6.ListA, DispatchPattern=[True, False])  # -> ListA, ListB
dispatch_8 = Dispatch(List=dispatch_5.ListA, DispatchPattern=[True, False])  # -> ListA, ListB
divide_3 = DivideDomain²(Domain=debrep_7.Faces, UCount=graft(dispatch_8.ListA), VCount=graft(dispatch_8.ListB))
divide_4 = DivideDomain²(Domain=debrep_8.Faces, UCount=graft(dispatch_7.ListB), VCount=graft(dispatch_7.ListA))
subsrf_3 = Isotrim(Surface=debrep_7.Faces, Domain=divide_3)
subsrf_4 = Isotrim(Surface=debrep_8.Faces, Domain=divide_4)
debrep_9 = DeconstructBrep(Brep=graft(subsrf_3))  # -> Faces, Edges, Vertices
debrep_10 = DeconstructBrep(Brep=graft(subsrf_4))  # -> Faces, Edges, Vertices
join_5 = JoinCurves(Curves=debrep_9.Edges, Preserve=False)
join_6 = JoinCurves(Curves=debrep_10.Edges, Preserve=False)

# ----
number_slider_6 = Slider(0.15, range=0..1)

# ---- group: Create Regular grid for the doors
Z_3 = UnitZ(Factor="1.5")
srf_4 = Surface(doors_horizontal)
extr_3 = Extrude(Base=srf_4, Direction=Z_3)
debrep_11 = DeconstructBrep(Brep=graft(extr_3))  # -> Faces, Edges, Vertices
cull_i_5 = CullIndex(List=debrep_11.Faces, Indices=0, Wrap=True)
cull_i_6 = CullIndex(List=cull_i_5, Indices=panel_3, Wrap=True)
item_3 = ListItem(List=cull_i_5, Index=Slider(4, range=0..10), Wrap=True)
debrep_12 = DeconstructBrep(Brep=item_3)  # -> Faces, Edges, Vertices
debrep_13 = DeconstructBrep(Brep=cull_i_6)  # -> Faces, Edges, Vertices
len_5 = Length(Curve=debrep_12.Edges)
len_6 = Length(Curve=debrep_13.Edges)
division_5 = Division(A=len_5, B=number_slider_6)
division_6 = Division(A=len_6, B=number_slider_6)
dispatch_9 = Dispatch(List=division_5, DispatchPattern=[True, True, False, False])  # -> ListA, ListB
dispatch_10 = Dispatch(List=division_6, DispatchPattern=[True, True, False, False])  # -> ListA, ListB
dispatch_11 = Dispatch(List=dispatch_10.ListA, DispatchPattern=[True, False])  # -> ListA, ListB
dispatch_12 = Dispatch(List=dispatch_9.ListA, DispatchPattern=[True, False])  # -> ListA, ListB
divide_5 = DivideDomain²(Domain=debrep_12.Faces, UCount=graft(dispatch_12.ListA), VCount=graft(dispatch_12.ListB))
divide_6 = DivideDomain²(Domain=debrep_13.Faces, UCount=graft(dispatch_11.ListB), VCount=graft(dispatch_11.ListA))
subsrf_5 = Isotrim(Surface=debrep_12.Faces, Domain=divide_5)
subsrf_6 = Isotrim(Surface=debrep_13.Faces, Domain=divide_6)
debrep_14 = DeconstructBrep(Brep=graft(subsrf_5))  # -> Faces, Edges, Vertices
debrep_15 = DeconstructBrep(Brep=graft(subsrf_6))  # -> Faces, Edges, Vertices
join_7 = JoinCurves(Curves=debrep_14.Edges, Preserve=False)
join_8 = JoinCurves(Curves=debrep_15.Edges, Preserve=False)

# ---- group: doors SRF
item_4 = ListItem(List=cull_i_5, Index=Slider(5, range=0..10), Wrap=True)
item_5 = ListItem(List=cull_i_3, Index=Slider(3, range=0..10), Wrap=True)
srf_5 = Surface([item_4, item_5])

# ----
entwine = Entwine(Branch00=join_4, Branch01=join_3, Branch02=join_7, Branch03=join_8, Branch04=join_5, Branch05=join_6, FlattenInputs=True)

# ---- group: OUTPUTS
a_wall_boundaries = Curve(join_2)
a_wall_mesh = Curve(boundary_3)
space_mesh = Curve(entwine)
