# Grasshopper definition G1-SPACE LAYOUT.gh (Grasshopper 1.0.7)
# plug-ins: LunchBox, Kangaroo2 Components

# ---- group: SIZE, PROPORTIONS AND POSITION OF AMFITHEATER. USE SLIDER
amfitheater_starting_point = Point(<point referenced from the Rhino model>)
construct_plane = ConstructPlane(Origin=amfitheater_starting_point, XAxis=Vector(1, 0, 0), YAxis=Vector(0, 1, 0))
predefined_angle = Slider(29, range=0..180)
rotate_plane = RotatePlane(Plane=construct_plane, Angle=degrees(predefined_angle))
amfitheater_width_half = Slider(5, range=0..50)
amfitheater_length_half = Slider(7, range=0..50)
deconstruct_plane = DeconstructPlane(Plane=rotate_plane)  # -> Origin, XAxis, YAxis, ZAxis
position_of_amfitheater = Slider(0, range=-15..15)
vector = Vector(deconstruct_plane.YAxis)
construct_domain = ConstructDomain(DomainStart=amfitheater_length_half, DomainEnd=expr("-x", amfitheater_length_half))
construct_domain_2 = ConstructDomain(DomainStart=amfitheater_width_half, DomainEnd=expr("-x", amfitheater_width_half))
multiplication = Multiplication(A=vector, B=position_of_amfitheater)
move = Move(Geometry=rotate_plane, Motion=multiplication)  # -> Geometry, Transform
amfitheater_crv = Rectangle(Plane=move.Geometry, XSize=construct_domain, YSize=construct_domain_2, Radius=0)  # -> Rectangle, Length

# ---- group: SIZE AND PROPORTION OF COURTYARD 1
courtyard_1_size = Slider(16, range=10..50)
expression = Expression(x=courtyard_1_size, Expression="(x-3.6)/3.3")
expression_2 = Expression(x=courtyard_1_size, l=expression, Expression="(x/2)-l")
division = Division(A=expression, B=1.2)
division_2 = Division(A=expression_2, B=1.2)
round = Round(Number=[division_2, division])  # -> Nearest, Floor, Ceiling
multiplication_2 = Multiplication(A=round.Ceiling, B=1.2)
starting_point_for_courtyard_2 = Point(<point referenced from the Rhino model>)
list_item = ListItem(List=multiplication_2, Index=0, Wrap=True)  # -> Item, Item1
construct_plane_2 = ConstructPlane(Origin=starting_point_for_courtyard_2, XAxis=Vector(1, 0, 0), YAxis=Vector(0, 1, 0))
construct_domain_3 = ConstructDomain(DomainStart=list_item.Item, DomainEnd=expr("-x", list_item.Item))
construct_domain_4 = ConstructDomain(DomainStart=list_item.Item1, DomainEnd=expr("-x", list_item.Item1))
rotate_plane_2 = RotatePlane(Plane=construct_plane_2, Angle=degrees(Slider(29, range=0..180)))
rectangle = Rectangle(Plane=rotate_plane_2, XSize=construct_domain_3, YSize=construct_domain_4, Radius=0)  # -> Rectangle, Length

# ---- group: SIZE AND PROPORTION OF COURTYARD 2
size_of_courtard_2 = Slider(15, range=10..50)
expression_3 = Expression(x=size_of_courtard_2, Expression="(x-3.6)/3.3")
expression_4 = Expression(x=size_of_courtard_2, l=expression_3, Expression="(x/2)-l")
division_3 = Division(A=expression_3, B=1.2)
division_4 = Division(A=expression_4, B=1.2)
round_2 = Round(Number=[division_4, division_3])  # -> Nearest, Floor, Ceiling
multiplication_3 = Multiplication(A=round_2.Ceiling, B=1.2)
starting_point_for_courtyard_2_2 = Point(<point referenced from the Rhino model>)
list_item_2 = ListItem(List=multiplication_3, Index=0, Wrap=True)  # -> Item, Item1
construct_plane_3 = ConstructPlane(Origin=starting_point_for_courtyard_2_2, XAxis=Vector(1, 0, 0), YAxis=Vector(0, 1, 0))
construct_domain_5 = ConstructDomain(DomainStart=list_item_2.Item, DomainEnd=expr("-x", list_item_2.Item))
construct_domain_6 = ConstructDomain(DomainStart=list_item_2.Item1, DomainEnd=expr("-x", list_item_2.Item1))
rotate_plane_3 = RotatePlane(Plane=construct_plane_3, Angle=degrees(Slider(29, range=0..180)))
rectangle_2 = Rectangle(Plane=rotate_plane_3, XSize=construct_domain_5, YSize=construct_domain_6, Radius=0)  # -> Rectangle, Length

# ---- group: READING SPACES FROM EXCEL / Excel INPUT
# You need to have excel file opened on your machine to read data.
# Name of the excel file is G1-SPACE LAYOUT
boolean_toggle = BooleanToggle(True)
panel = Panel("""1
2
3
4""")
excel_reader_legacy = ExcelReaderLEGACY(ReadToggle=boolean_toggle, Worksheet="1", Column=panel, RowStart="2", RowEnd="19")  # -> Exceptions, ExcelData

# ----
public_square = Curve(<curve referenced from the Rhino model>)

# ---- group: READING SPACES FROM EXCEL
# Spaces which are broken into multiple
# modules. (Eg, Multipurpose Hall & Library)
# have to be broken in Excel only and
# change the respective values
# in 'Read Excel' component
explode_tree = ExplodeTree(Data=excel_reader_legacy.ExcelData)  # -> Branch0, Branch1, Branch2, Branch3
spaces = Panel(explode_tree.Branch0)
direction_of_spaces = Panel(explode_tree.Branch1)
length_of_spaces_modules = Panel(explode_tree.Branch2)
width_of_spaces_modules = Panel(explode_tree.Branch3)

# ---- group: Count how many rooms per region
ghpython_script = GhPythonScript(x=direction_of_spaces)  # -> n, s, w, e; inputs x: list
# ---------- ghpython_script: Python ----------
__author__ = "ronwi"
__version__ = "2019.09.24"

import rhinoscriptsyntax as rs
n = 0
s = 0
e = 0
w = 0
for i in x:
    if i =='N':
        n = n+1
    if i =='S':
        s = s+1
    if i =='E':
        e = e+1
    if i =='W':
        w = w+1
print(n,s,e,w)
# ---------- end ghpython_script ----------

# ---- group: Space curves
rectangle_3 = Rectangle(Plane=PlaneXY(0, 0, 0), XSize=length_of_spaces_modules, YSize=width_of_spaces_modules, Radius=0)  # -> Rectangle, Length

# ---- group: After running solver, move courtyard towards its final position (for most efficient packing). USE SLIDER
position_of_court_1 = Slider(0, range=0..50)
vector_2pt = Vector2Pt(PointA=amfitheater_starting_point, PointB=starting_point_for_courtyard_2, Unitize=True)  # -> Vector, Length
multiplication_4 = Multiplication(A=vector_2pt.Vector, B=position_of_court_1)
courtyard_1_crv = Move(Geometry=rectangle.Rectangle, Motion=expr("-x", multiplication_4))  # -> Geometry, Transform

position_of_court_2 = Slider(0, range=0..50)
vector_2pt_2 = Vector2Pt(PointA=amfitheater_starting_point, PointB=starting_point_for_courtyard_2_2, Unitize=True)  # -> Vector, Length
multiplication_5 = Multiplication(A=vector_2pt_2.Vector, B=position_of_court_2)
courtyard_2_crv = Move(Geometry=rectangle_2.Rectangle, Motion=expr("-x", multiplication_5))  # -> Geometry, Transform

# ----
north_direction_crv = Curve(<curve referenced from the Rhino model>)
# Site Curve
site = Curve(<curve referenced from the Rhino model>)
area = Area(Geometry=site)  # -> Area, Centroid

# ---- group: Create regions around site (N,S,W,E) to populate rooms there
end_points = EndPoints(Curve=north_direction_crv)  # -> Start, End
distance_from_site_s_center_point = Slider(50, range=0..100)
xy_plane = XYPlane(Origin=Point(0, 0, 0))
vector_2pt_3 = Vector2Pt(PointA=end_points.End, PointB=end_points.Start, Unitize=False)  # -> Vector, Length
rotate = Rotate(Geometry=vector_2pt_3.Vector, Angle=degrees(Slider(90, range=0..100)), Plane=xy_plane)  # -> Geometry, Transform
multiplication_6 = Multiplication(A=vector_2pt_3.Vector, B=distance_from_site_s_center_point)
multiplication_7 = Multiplication(A=rotate.Geometry, B=distance_from_site_s_center_point)
move_2 = Move(Geometry=area.Centroid, Motion=expr("-x", multiplication_7))  # -> Geometry, Transform
move_3 = Move(Geometry=area.Centroid, Motion=expr("-x", multiplication_6))  # -> Geometry, Transform
move_4 = Move(Geometry=area.Centroid, Motion=multiplication_6)  # -> Geometry, Transform
move_5 = Move(Geometry=area.Centroid, Motion=multiplication_7)  # -> Geometry, Transform
size_of_the_region = Slider(50, range=0..100)
north_region = Rectangle(Plane=move_4.Geometry, XSize=size_of_the_region, YSize=size_of_the_region, Radius=0)  # -> Rectangle, Length
south_region = Rectangle(Plane=move_3.Geometry, XSize=size_of_the_region, YSize=size_of_the_region, Radius=0)  # -> Rectangle, Length
west_region = Rectangle(Plane=move_5.Geometry, XSize=size_of_the_region, YSize=size_of_the_region, Radius=0)  # -> Rectangle, Length
east_region = Rectangle(Plane=move_2.Geometry, XSize=size_of_the_region, YSize=size_of_the_region, Radius=0)  # -> Rectangle, Length

# ----
populate_2d_n = Populate2D(Region=north_region.Rectangle, Count=ghpython_script.n, Seed=1)
populate_2d_s = Populate2D(Region=south_region.Rectangle, Count=ghpython_script.s, Seed=1)
populate_2d_w = Populate2D(Region=west_region.Rectangle, Count=ghpython_script.w, Seed=1)
populate_2d_e = Populate2D(Region=east_region.Rectangle, Count=ghpython_script.e, Seed=1)

# ---- group: Move rooms to assigned region
ghpython_script_2 = GhPythonScript(
    x=flatten(rectangle_3.Rectangle),
    y=direction_of_spaces,
    Region_N=populate_2d_n,
    Region_S=populate_2d_s,
    Region_W=populate_2d_w,
    Region_E=populate_2d_e)  # -> out, a; inputs x: list of Brep, y: list, Region_N: list of Point3d, Region_S: list of Point3d, Region_W: list of Point3d, Region_E: list of Point3d
# ---------- ghpython_script_2: Python ----------
__author__ = "ronwi"
__version__ = "2019.09.24"

import rhinoscriptsyntax as rs
import Grasshopper as gh
from Grasshopper import DataTree as DT
import ghpythonlib as th
import Rhino.Geometry as rh

newPoints = []
new_Centroid = []
print(y)
point = rh.Point3d(0,0,0)
point_temp = rh.Point3d(0,0,0)
count_N = 0
count_S = 0
count_E = 0
count_W = 0
print(Region_N)
for i in range(len(x)):
    if y[i] =='N':
        point = rh.AreaMassProperties.Compute(x[i]).Centroid
        point_temp = Region_N[count_N]
        vect = rh.Vector3d(point_temp - point)
        x[i].Translate(vect)
        count_N = count_N+1
    if y[i] =='S':
        point = rh.AreaMassProperties.Compute(x[i]).Centroid
        point_temp = Region_S[count_S]
        vect = rh.Vector3d(point_temp - point)
        x[i].Translate(vect)
        count_S = count_S+1
    if y[i] =='E':
        point = rh.AreaMassProperties.Compute(x[i]).Centroid
        point_temp = Region_E[count_E]
        vect = rh.Vector3d(point_temp - point)
        x[i].Translate(vect)
        count_E = count_E+1
    if y[i] =='W':
        point = rh.AreaMassProperties.Compute(x[i]).Centroid
        point_temp = Region_W[count_W]
        vect = rh.Vector3d(point_temp - point)
        x[i].Translate(vect)
        count_W = count_W+1
        
a = x
# ---------- end ghpython_script_2 ----------

# ----
curve = Curve(ghpython_script_2.a)
boundary_surfaces = BoundarySurfaces(Edges=curve)

# ---- group: GOALS
# Strong Connectivity - For spaces broken into multiple modules. Eg, Multipurpose Hall & Library
# Weak Connectivity - For spaces that are adjacent to each other.
# # Strength of weak connectivity can be increased and decreased to see better configuration
geometry_list = ListItem(List=curve, Index=0, Wrap=True)  # -> Item, Item1, Item2, Item3, Item4, Item5, Item6, Item7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
area_2 = Area(Geometry=curve)  # -> Area, Centroid
range_for_strong_connection = Slider(1000, range=0..1000)
strength_strong_connection = Slider(114, range=0..500)
strength_weak_connection = Slider(56, range=0..200)
curve_2 = Curve([geometry_list.Item8, geometry_list.Item, geometry_list.Item4, geometry_list.Item5, geometry_list.Item6, geometry_list.Item7])
curve_3 = Curve([geometry_list.Item1, geometry_list.Item2, geometry_list.Item16, geometry_list.Item3, geometry_list.Item13, geometry_list.Item14, geometry_list.Item17, geometry_list.Item15])
curve_4 = Curve([geometry_list.Item10, geometry_list.Item9, geometry_list.Item11, geometry_list.Item12])
point_list = ListItem(List=area_2.Centroid, Index=0, Wrap=True)  # -> Item, Item1, Item2, Item3, Item4, Item5, Item6, Item7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

# ---- group: GOALS / Goals to put spaces on Courtyard 1
courtyard_1 = Curve(courtyard_1_crv.Geometry)
area_3 = Area(Geometry=curve_3)  # -> Area, Centroid
oncurve = OnCurve(Points=area_3.Centroid, Curve=courtyard_1, Strength=Slider(200, range=0..200))
onplane = OnPlane(Points=area_3.Centroid, Plane=PlaneXY(0, 0, 0), Strength=10000)

# ---- group: GOALS / Goals to put spaces on Amphitheater
amphitheater = Curve(amfitheater_crv.Rectangle)
area_4 = Area(Geometry=curve_2)  # -> Area, Centroid
onplane_2 = OnPlane(Points=area_4.Centroid, Plane=PlaneXY(0, 0, 0), Strength=10000)
oncurve_2 = OnCurve(Points=area_4.Centroid, SPACES=amphitheater, Strength=Slider(200, range=0..200))

# ---- group: GOALS / Goals to put spaces on Courtyard 2
area_5 = Area(Geometry=curve_4)  # -> Area, Centroid
courtyard_2 = Curve(courtyard_2_crv.Geometry)
onplane_3 = OnPlane(Points=area_5.Centroid, Plane=PlaneXY(0, 0, 0), Strength=10000)
oncurve_3 = OnCurve(Points=area_5.Centroid, Curve=courtyard_2, Strength=Slider(197, range=0..500))

# ---- group: GOALS / Prevent curves to overlap
curvecollide = CurveCollide(
    Curves=flatten(curve),
    PassiveCurves=flatten([public_square, courtyard_2, courtyard_1, amphitheater]),
    BasePlane=PlaneXY(0, 0, 0),
    Strength=Slider(100000, range=0..100000))  # -> Goal, Frames

# ---- group: GOALS / weak relation
magnetsnap = MagnetSnap(Points=[point_list.Item13, point_list.Item17], Range=100, Strength=strength_weak_connection)
magnetsnap_2 = MagnetSnap(Points=[point_list.Item10, point_list.Item11], Range=100, Strength=strength_weak_connection)
magnetsnap_3 = MagnetSnap(Points=[point_list.Item16, point_list.Item2], Range=100, Strength=strength_weak_connection)
magnetsnap_4 = MagnetSnap(Points=[point_list.Item5, point_list.Item6], Range=100, Strength=strength_weak_connection)
magnetsnap_5 = MagnetSnap(Points=[point_list.Item15, point_list.Item17, point_list.Item3], Range=100, Strength=strength_weak_connection)
magnetsnap_6 = MagnetSnap(Points=[point_list.Item16, point_list.Item2], Range=100, Strength=strength_weak_connection)
magnetsnap_7 = MagnetSnap(Points=[point_list.Item13, point_list.Item15], Range=100, Strength=strength_weak_connection)
magnetsnap_8 = MagnetSnap(Points=[point_list.Item15, point_list.Item14], Range=100, Strength=strength_weak_connection)
magnetsnap_9 = MagnetSnap(Points=[point_list.Item14, point_list.Item16], Range=100, Strength=strength_weak_connection)

# ---- group: GOALS / stron relation
library_strong = MagnetSnap(Points=[point_list.Item11, point_list.Item12], Range=range_for_strong_connection, Strength=strength_strong_connection)
mp_strong = MagnetSnap(Points=[point_list.Item4, point_list.Item5], Range=range_for_strong_connection, Strength=strength_strong_connection)
mp_strong_2 = MagnetSnap(Points=[point_list.Item6, point_list.Item7], Range=range_for_strong_connection, Strength=strength_strong_connection)
library_strong_2 = MagnetSnap(Points=[point_list.Item9, point_list.Item10], Range=range_for_strong_connection, Strength=strength_strong_connection)

# ---- group: READING SPACES FROM EXCEL / Excel INPUT
# You need to have excel file opened on your machine to read data.
# Name of the excel file is G1-SPACE LAYOUT
panel_2 = Panel("""10
11
12""")
excel_reader_legacy_2 = ExcelReaderLEGACY(ReadToggle=Toggle(True), Worksheet="1", Column=panel_2, RowStart="2", RowEnd="19")  # -> Exceptions, ExcelData

# ---- group: SOLVER
# Change to 'True' to run the solver
# # Damping value can be changed
# in range of 0.92-0.99 for better results.
boolean_toggle_2 = BooleanToggle(False)
bouncysolver = BouncySolver(
    GoalObjects=flatten([library_strong_2, onplane_2, oncurve_2, onplane, oncurve, onplane_3, oncurve_3, magnetsnap_7, curvecollide.Goal, mp_strong, magnetsnap, magnetsnap_5, magnetsnap_8, magnetsnap_9, magnetsnap_3, magnetsnap_6, library_strong, magnetsnap_2, magnetsnap_4, mp_strong_2]),
    Reset=Button(),
    Threshold=1e-15,
    Tolerance=0.01,
    Damping=0.99,
    Iterations=10,
    On=boolean_toggle_2)  # -> I, V, O
clean_tree = CleanTree(RemoveNulls=True, RemoveInvalid=True, RemoveEmpty=False, Tree=bouncysolver.O)
c_script = CSharpScript(x=clean_tree)  # -> out, A
# ---------- c_script: C# ----------
    A = x as Curve[];
# ---------- end c_script ----------
curve_5 = Curve(c_script.A)

# ---- group: READING SPACES FROM EXCEL
# Spaces which are broken into multiple
# modules. (Eg, Multipurpose Hall & Library)
# have to be broken in Excel only and
# change the respective values
# in 'Read Excel' component
explode_tree_2 = ExplodeTree(Data=excel_reader_legacy_2.ExcelData)  # -> Branch0, Branch1, Branch2
spaces_3 = Panel(explode_tree_2.Branch0)
direction_of_spaces_2 = Panel(explode_tree_2.Branch1)
length_of_spaces_modules_2 = Panel(explode_tree_2.Branch2)
colour_rgb = ColourRGB(Alpha=255, Red=spaces_3, Green=direction_of_spaces_2, Blue=length_of_spaces_modules_2)
area_6 = Area(Geometry=curve_5)  # -> Area, flatten(Centroid)
boundary_surfaces_2 = BoundarySurfaces(Edges=curve_5)
point_list_2 = PointList(Points=area_6.Centroid, Size=2)
custom_preview = CustomPreview(Geometry=boundary_surfaces_2, Material=colour_rgb)

# ----
custom_preview_2 = CustomPreview(Geometry=boundary_surfaces, Material=colour_rgb)
