# Grasshopper definition G1-BRICK CONSTRUCTION ENGLISH BOND.gh (Grasshopper 1.0.7)

negative = Negative(Value="0.15")
# Lunette vault Bricks
curve = Curve(<curve referenced from the Rhino model>)
number_slider = Slider(0.08, range=0..0.1)
offset_curve = OffsetCurve(Curve=curve, Distance=negative, Plane=PlaneXY(0, 0, 0), Corners=1)  # -> flatten(Curve)
unit_x = UnitX(Factor=1)
number_slider_2 = Slider(1.5, range=0..10)
divide_distance = DivideDistance(Curve=offset_curve, Distance=number_slider)  # -> Points, Tangents, Parameters
divide_distance_2 = DivideDistance(Curve=curve, Distance=number_slider)  # -> Points, Tangents, Parameters
negative_2 = Negative(Value=unit_x)
line_sdl = LineSDL(Start=divide_distance.Points, Direction=negative_2, Length=number_slider_2)
line_sdl_2 = LineSDL(Start=divide_distance_2.Points, Direction=negative_2, Length=number_slider_2)
length = Length(Curve=line_sdl)
length_2 = Length(Curve=line_sdl_2)
division = Division(A=length, B=Slider(0.15, range=0..1))
division_2 = Division(A=length_2, B=Slider(0.15, range=0..1))
round = Round(Number=division)  # -> Nearest, Floor, Ceiling
round_2 = Round(Number=division_2)  # -> Nearest, Floor, Ceiling
divide_curve = DivideCurve(Curve=line_sdl, Count=expr("x", round.Nearest), Kinks=False)  # -> simplify(Points), simplify(Tangents), Parameters
divide_curve_2 = DivideCurve(Curve=line_sdl_2, Count=expr("x", round_2.Nearest), Kinks=False)  # -> simplify(Points), simplify(Tangents), Parameters
yz_plane = YZPlane(Origin=divide_curve.Points)
yz_plane_2 = YZPlane(Origin=divide_curve_2.Points)
curve_2 = Curve(<curve referenced from the Rhino model>)
curve_3 = Curve(<curve referenced from the Rhino model>)
align_plane = AlignPlane(Plane=yz_plane, Direction=graft(divide_distance.Tangents))  # -> Plane, Angle
curve_closest_point = CurveClosestPoint(Point=divide_curve.Points, Curve=curve_2)  # -> Point, Parameter, Distance
curve_closest_point_2 = CurveClosestPoint(Point=divide_curve_2.Points, Curve=curve_3)  # -> Point, Parameter, Distance
align_plane_2 = AlignPlane(Plane=yz_plane_2, Direction=graft(divide_distance_2.Tangents))  # -> Plane, Angle
vector_2pt = Vector2Pt(PointA=align_plane_2.Plane, PointB=curve_closest_point_2.Point, Unitize=False)  # -> Vector, Length
vector_2pt_2 = Vector2Pt(PointA=align_plane.Plane, PointB=curve_closest_point.Point, Unitize=False)  # -> Vector, Length
vector_display = VectorDisplay(Anchor=divide_curve_2.Points, Vector=vector_2pt.Vector)
dispatch = Dispatch(List=align_plane_2.Plane, DispatchPattern=[True, False])  # -> ListA, ListB
dispatch_2 = Dispatch(List=align_plane.Plane, DispatchPattern=[True, False])  # -> ListA, ListB
vector_display_2 = VectorDisplay(Anchor=divide_curve.Points, Vector=vector_2pt_2.Vector)
flip_matrix = FlipMatrix(Data=dispatch.ListB)
flip_matrix_2 = FlipMatrix(Data=dispatch.ListA)
flip_matrix_3 = FlipMatrix(Data=dispatch_2.ListB)
flip_matrix_4 = FlipMatrix(Data=dispatch_2.ListA)
dispatch_3 = Dispatch(List=flip_matrix, DispatchPattern=[True, False])  # -> ListA, ListB
dispatch_4 = Dispatch(List=flip_matrix_2, DispatchPattern=[True, False])  # -> ListA, ListB
dispatch_5 = Dispatch(List=flip_matrix_3, DispatchPattern=[True, False])  # -> ListA, ListB
dispatch_6 = Dispatch(List=flip_matrix_4, DispatchPattern=[True, False])  # -> ListA, ListB
number_slider_3 = Slider(0.29, range=0..1)
data = Data([dispatch_4.ListA, dispatch_3.ListB])
number_slider_4 = Slider(0.29, range=0..1)
data_2 = Data([dispatch_6.ListB, dispatch_5.ListA])
number_slider_5 = Slider(0.15, range=0..1)
number_slider_6 = Slider(0.065, range=0..0.1)
number_slider_7 = Slider(0.15, range=0..1)
number_slider_8 = Slider(0.065, range=0..0.1)
construct_domain = ConstructDomain(DomainStart=expr("-x/2", number_slider_4), DomainEnd=expr("x/2", number_slider_4))
construct_domain_2 = ConstructDomain(DomainStart=expr("-x/2", number_slider_8), DomainEnd=expr("x/2", number_slider_8))
construct_domain_3 = ConstructDomain(DomainStart=expr("-2*x/3", number_slider_7), DomainEnd=expr("x/3", number_slider_7))
construct_domain_4 = ConstructDomain(DomainStart=expr("-x/2", number_slider_3), DomainEnd=expr("x/2", number_slider_3))
construct_domain_5 = ConstructDomain(DomainStart=expr("-x/2", number_slider_6), DomainEnd=expr("x/2", number_slider_6))
construct_domain_6 = ConstructDomain(DomainStart=expr("-2*x/3", number_slider_5), DomainEnd=expr("x/3", number_slider_5))
domain_box = DomainBox(Base=data_2, X=construct_domain_2, Y=construct_domain_3, Z=construct_domain)
domain_box_2 = DomainBox(Base=data, X=construct_domain_5, Y=construct_domain_6, Z=construct_domain_4)
brep = Brep([<brep referenced from the Rhino model> x4])
solid_difference = SolidDifference(BrepsA=[domain_box, domain_box_2], BrepsB=brep)
lunette_vault_bricks = Brep(solid_difference)

surface = Surface(<surface referenced from the Rhino model>)
surface_2 = Surface(<surface referenced from the Rhino model>)
# Pavilion Vault Rib
deconstruct_brep = DeconstructBrep(Brep=surface_2)  # -> Faces, Edges, Vertices
deconstruct_brep_2 = DeconstructBrep(Brep=surface)  # -> Faces, Edges, Vertices
panel = Panel("""1
2""")
panel_2 = Panel("""1
2""")
list_item = ListItem(List=deconstruct_brep.Edges, Index=panel, Wrap=True)
list_item_2 = ListItem(List=deconstruct_brep_2.Edges, Index=panel_2, Wrap=True)
divide_distance_3 = DivideDistance(Curve=list_item_2, Distance=Slider(0.08, range=0..0.1))  # -> Points, Tangents, Parameters
divide_distance_4 = DivideDistance(Curve=list_item, Distance=Slider(0.08, range=0..0.1))  # -> Points, Tangents, Parameters
align_plane_3 = AlignPlane(Plane=divide_distance_3.Points, Direction=divide_distance_3.Tangents)  # -> Plane, Angle
align_plane_4 = AlignPlane(Plane=divide_distance_4.Points, Direction=divide_distance_4.Tangents)  # -> Plane, Angle
point = Point(<point referenced from the Rhino model>)
point_2 = Point(<point referenced from the Rhino model>)
vector_2pt_3 = Vector2Pt(PointA=point, PointB=align_plane_3.Plane, Unitize=False)  # -> Vector, Length
vector_2pt_4 = Vector2Pt(PointA=point_2, PointB=align_plane_4.Plane, Unitize=False)  # -> Vector, Length
adjust_plane = AdjustPlane(Plane=align_plane_3.Plane, Normal=vector_2pt_3.Vector)
vector_display_3 = VectorDisplay(Anchor=divide_distance_3.Points, Vector=vector_2pt_3.Vector)
adjust_plane_2 = AdjustPlane(Plane=align_plane_4.Plane, Normal=vector_2pt_4.Vector)
vector_display_4 = VectorDisplay(Anchor=divide_distance_4.Points, Vector=vector_2pt_4.Vector)
dispatch_7 = Dispatch(List=adjust_plane, DispatchPattern=[True, False])  # -> ListA, ListB
dispatch_8 = Dispatch(List=adjust_plane_2, DispatchPattern=[True, False])  # -> ListA, ListB
data_3 = Data([dispatch_7.ListA, dispatch_8.ListA])
data_4 = Data([dispatch_8.ListB, dispatch_7.ListB])
number_slider_9 = Slider(0.15, range=0..1)
number_slider_10 = Slider(0.29, range=0..1)
number_slider_11 = Slider(0.15, range=0..1)
number_slider_12 = Slider(0.3, range=0..1)
number_slider_13 = Slider(0.0725, range=0..0.1)
construct_domain_7 = ConstructDomain(DomainStart=expr("-x/2", number_slider_10), DomainEnd=expr("x/2", number_slider_10))
construct_domain_8 = ConstructDomain(DomainStart=expr("11*x/30", number_slider_9), DomainEnd=expr("4*x/3", number_slider_9))
construct_domain_9 = ConstructDomain(DomainStart=expr("-x/2", number_slider_10), DomainEnd=expr("x/2", number_slider_10))
construct_domain_10 = ConstructDomain(DomainStart=expr("-2*x/3", number_slider_9), DomainEnd=expr("9*x/30", number_slider_9))
construct_domain_11 = ConstructDomain(DomainStart=expr("x/30", number_slider_11), DomainEnd=expr("x", number_slider_11))
construct_domain_12 = ConstructDomain(DomainStart=expr("-2*x/6", number_slider_12), DomainEnd=expr("4*x/6", number_slider_12))
negative_3 = Negative(Value=construct_domain_11)
domain_box_3 = DomainBox(Base=data_3, X=number_slider_13, Y=construct_domain_7, Z=construct_domain_8)
domain_box_4 = DomainBox(Base=data_3, X=number_slider_13, Y=construct_domain_9, Z=construct_domain_10)
domain_box_5 = DomainBox(Base=data_4, X=Slider(0.065, range=0..0.1), Y=construct_domain_11, Z=construct_domain_12)
domain_box_6 = DomainBox(Base=data_4, X=Slider(0.065, range=0..0.1), Y=negative_3, Z=construct_domain_12)
pavilion_vault_rib = Brep([domain_box_6, domain_box_5, domain_box_4, domain_box_3])

# ----
# Catenary Vault Rib
curve_4 = Curve(<curve referenced from the Rhino model>)
divide_distance_5 = DivideDistance(Curve=curve_4, Distance=Slider(0.08, range=0..0.1))  # -> Points, Tangents, Parameters
align_plane_5 = AlignPlane(Plane=divide_distance_5.Points, Direction=divide_distance_5.Tangents)  # -> Plane, Angle
point_3 = Point(<point referenced from the Rhino model>)
vector_2pt_5 = Vector2Pt(PointA=point_3, PointB=align_plane_5.Plane, Unitize=False)  # -> Vector, Length
adjust_plane_3 = AdjustPlane(Plane=align_plane_5.Plane, Normal=vector_2pt_5.Vector)
vector_display_5 = VectorDisplay(Anchor=divide_distance_5.Points, Vector=vector_2pt_5.Vector)
dispatch_9 = Dispatch(List=adjust_plane_3, DispatchPattern=[True, False])  # -> ListA, ListB
data_5 = Data(dispatch_9.ListB)
data_6 = Data(dispatch_9.ListA)
number_slider_14 = Slider(0.29, range=0..1)
number_slider_15 = Slider(0.15, range=0..1)
number_slider_16 = Slider(0.15, range=0..1)
number_slider_17 = Slider(0.0725, range=0..0.1)
construct_domain_13 = ConstructDomain(DomainStart=expr("x/30", number_slider_16), DomainEnd=expr("x", number_slider_16))
construct_domain_14 = ConstructDomain(DomainStart=expr("-x/2", number_slider_14), DomainEnd=expr("x/2", number_slider_14))
construct_domain_15 = ConstructDomain(DomainStart=expr("-x/2", number_slider_14), DomainEnd=expr("x/2", number_slider_14))
construct_domain_16 = ConstructDomain(DomainStart=expr("15*x/30", number_slider_15), DomainEnd=expr("45*x/30", number_slider_15))
deconstruct_domain = DeconstructDomain(Domain=construct_domain_16)  # -> Start, End
construct_domain_17 = ConstructDomain(DomainStart=expr("-16*x/30", number_slider_15), DomainEnd=expr("13*x/30", number_slider_15))
deconstruct_domain_2 = DeconstructDomain(Domain=construct_domain_17)  # -> Start, End
construct_domain_18 = ConstructDomain(DomainStart=deconstruct_domain_2.Start, DomainEnd=deconstruct_domain.End)
negative_4 = Negative(Value=construct_domain_13)
domain_box_7 = DomainBox(Base=data_6, X=number_slider_17, Y=construct_domain_15, Z=construct_domain_16)
domain_box_8 = DomainBox(Base=data_5, X=Slider(0.065, range=0..0.1), Y=construct_domain_13, Z=construct_domain_18)
domain_box_9 = DomainBox(Base=data_5, X=Slider(0.065, range=0..0.1), Y=negative_4, Z=construct_domain_18)
domain_box_10 = DomainBox(Base=data_6, X=number_slider_17, Y=construct_domain_14, Z=construct_domain_17)
catenary_vault_rib = Brep([domain_box_7, domain_box_10, domain_box_9, domain_box_8])

unit_y = UnitY(Factor=1)
curve_5 = Curve(<curve referenced from the Rhino model>)
brep_2 = Brep(<brep referenced from the Rhino model>)

surface_3 = Surface([<surface referenced from the Rhino model> x2])
# Catenary Vault Bricks
deconstruct_brep_3 = DeconstructBrep(Brep=surface_3)  # -> Faces, Edges, Vertices
list_item_3 = ListItem(List=deconstruct_brep_3.Edges, Index="0", Wrap=True)  # -> flatten(Item)
negative_5 = Negative(Value="0.15")
number_slider_18 = Slider(0.08, range=0..0.1)
offset_curve_2 = OffsetCurve(Curve=list_item_3, Distance="0.15", Plane=PlaneXY(0, 0, 0), Corners=1)  # -> flatten(Curve)
unit_x_2 = UnitX(Factor=1)
divide_distance_6 = DivideDistance(Curve=offset_curve_2, Distance=Slider(0.072, range=0..0.1))  # -> Points, Tangents, Parameters
negative_6 = Negative(Value=unit_x_2)
line_sdl_3 = LineSDL(Start=divide_distance_6.Points, Direction=unit_y, Length=Slider(4, range=0..10))
trim_with_brep = TrimWithBrep(Curve=line_sdl_3, Brep=graft(brep_2))  # -> Inside, Outside
curve_6 = Curve(flatten(trim_with_brep.Outside))
length_3 = Length(Curve=line_sdl_3)
division_3 = Division(A=length_3, B=Slider(0.15, range=0..1))
round_3 = Round(Number=division_3)  # -> Nearest, Floor, Ceiling
divide_curve_3 = DivideCurve(Curve=line_sdl_3, Count=expr("x", round_3.Nearest), Kinks=False)  # -> simplify(Points), simplify(Tangents), Parameters
curve_7 = Curve(<curve referenced from the Rhino model>)
curve_closest_point_3 = CurveClosestPoint(Point=divide_curve_3.Points, Curve=curve_7)  # -> Point, Parameter, Distance
align_plane_6 = AlignPlane(Plane=divide_curve_3.Points, Direction=divide_curve_3.Tangents)  # -> Plane, Angle
vector_2pt_6 = Vector2Pt(PointA=align_plane_6.Plane, PointB=curve_closest_point_3.Point, Unitize=False)  # -> Vector, Length
adjust_plane_4 = AdjustPlane(Plane=align_plane_6.Plane, Normal=vector_2pt_6.Vector)
vector_display_6 = VectorDisplay(Anchor=divide_curve_3.Points, Vector=vector_2pt_6.Vector)
dispatch_10 = Dispatch(List=adjust_plane_4, DispatchPattern=[True, False])  # -> ListA, ListB
flip_matrix_5 = FlipMatrix(Data=dispatch_10.ListB)
flip_matrix_6 = FlipMatrix(Data=dispatch_10.ListA)
dispatch_11 = Dispatch(List=flip_matrix_5, DispatchPattern=[True, False])  # -> ListA, ListB
dispatch_12 = Dispatch(List=flip_matrix_6, DispatchPattern=[True, False])  # -> ListA, ListB
number_slider_19 = Slider(0.28, range=0..1)
data_7 = Data([dispatch_12.ListA, dispatch_11.ListB])
number_slider_20 = Slider(0.15, range=0..1)
construct_domain_19 = ConstructDomain(DomainStart=expr("-x/2", number_slider_19), DomainEnd=expr("x/2", number_slider_19))
construct_domain_20 = ConstructDomain(DomainStart=expr("-2*x/3", number_slider_20), DomainEnd=expr("x/3", number_slider_20))
domain_box_11 = DomainBox(Base=data_7, X=construct_domain_19, Y=Slider(0.065, range=0..0.1), Z=construct_domain_20)
brep_3 = Brep([<brep referenced from the Rhino model> x7])
solid_difference_2 = SolidDifference(BrepsA=domain_box_11, BrepsB=brep_3)
catenary_vault_bricks = Brep(solid_difference_2)

brep_4 = Brep(<brep referenced from the Rhino model>)
brep_5 = Brep([<brep referenced from the Rhino model> x2])

surface_4 = Surface(<surface referenced from the Rhino model>)
# Catenary Vault Bricks
deconstruct_brep_4 = DeconstructBrep(Brep=surface_4)  # -> Faces, Edges, Vertices
list_item_4 = ListItem(List=deconstruct_brep_4.Edges, Index="1", Wrap=True)  # -> flatten(Item)
negative_7 = Negative(Value="0.15")
offset_curve_3 = OffsetCurve(Curve=list_item_4, Distance="0.15", Plane=PlaneXY(0, 0, 0), Corners=1)  # -> flatten(Curve)
unit_x_3 = UnitX(Factor=1)
divide_distance_7 = DivideDistance(Curve=curve_5, Distance=Slider(0.07, range=0..0.1))  # -> Points, Tangents, Parameters
negative_8 = Negative(Value=unit_x_3)
line_sdl_4 = LineSDL(Start=divide_distance_7.Points, Direction=negative_8, Length=Slider(1, range=0..10))
trim_with_brep_2 = TrimWithBrep(Curve=line_sdl_4, Brep=graft(brep_4))  # -> Inside, Outside
curve_8 = Curve(flatten(trim_with_brep_2.Outside))
length_4 = Length(Curve=line_sdl_4)
division_4 = Division(A=length_4, B=Slider(0.15, range=0..1))
round_4 = Round(Number=division_4)  # -> Nearest, Floor, Ceiling
divide_curve_4 = DivideCurve(Curve=line_sdl_4, Count=expr("x", round_4.Nearest), Kinks=False)  # -> simplify(Points), simplify(Tangents), Parameters
curve_9 = Curve(<curve referenced from the Rhino model>)
align_plane_7 = AlignPlane(Plane=divide_curve_4.Points, Direction=divide_curve_4.Tangents)  # -> Plane, Angle
curve_closest_point_4 = CurveClosestPoint(Point=divide_curve_4.Points, Curve=curve_9)  # -> Point, Parameter, Distance
vector_2pt_7 = Vector2Pt(PointA=align_plane_7.Plane, PointB=curve_closest_point_4.Point, Unitize=False)  # -> Vector, Length
adjust_plane_5 = AdjustPlane(Plane=align_plane_7.Plane, Normal=vector_2pt_7.Vector)
vector_display_7 = VectorDisplay(Anchor=divide_curve_4.Points, Vector=vector_2pt_7.Vector)
dispatch_13 = Dispatch(List=align_plane_7.Plane, DispatchPattern=[True, False])  # -> ListA, ListB
flip_matrix_7 = FlipMatrix(Data=dispatch_13.ListB)
flip_matrix_8 = FlipMatrix(Data=dispatch_13.ListA)
dispatch_14 = Dispatch(List=flip_matrix_7, DispatchPattern=[True, False])  # -> ListA, ListB
dispatch_15 = Dispatch(List=flip_matrix_8, DispatchPattern=[True, False])  # -> ListA, ListB
number_slider_21 = Slider(0.28, range=0..1)
data_8 = Data([dispatch_15.ListA, dispatch_14.ListB])
number_slider_22 = Slider(0.15, range=0..1)
construct_domain_21 = ConstructDomain(DomainStart=expr("-x/2", number_slider_21), DomainEnd=expr("x/2", number_slider_21))
construct_domain_22 = ConstructDomain(DomainStart=expr("-x/2", number_slider_22), DomainEnd=expr("x/2", number_slider_22))
domain_box_12 = DomainBox(Base=data_8, X=construct_domain_21, Y=construct_domain_22, Z=Slider(0.065, range=0..0.1))
brep_6 = Brep([<brep referenced from the Rhino model> x6])
solid_difference_3 = SolidDifference(BrepsA=domain_box_12, BrepsB=brep_5)
catenary_vault_bricks_2 = Brep(solid_difference_3)

negative_9 = Negative(Value="0.15")
# opening vault Bricks
curve_10 = Curve(<curve referenced from the Rhino model>)
number_slider_23 = Slider(0.08, range=0..0.1)
offset_curve_4 = OffsetCurve(Curve=curve_10, Distance=negative_9, Plane=PlaneXY(0, 0, 0), Corners=1)  # -> flatten(Curve)
unit_x_4 = UnitX(Factor=1)
number_slider_24 = Slider(2, range=0..10)
divide_distance_8 = DivideDistance(Curve=offset_curve_4, Distance=number_slider_23)  # -> Points, Tangents, Parameters
divide_distance_9 = DivideDistance(Curve=curve_10, Distance=number_slider_23)  # -> Points, Tangents, Parameters
negative_10 = Negative(Value=unit_x_4)
line_sdl_5 = LineSDL(Start=divide_distance_8.Points, Direction=negative_10, Length=number_slider_24)
line_sdl_6 = LineSDL(Start=divide_distance_9.Points, Direction=negative_10, Length=number_slider_24)
length_5 = Length(Curve=line_sdl_6)
length_6 = Length(Curve=line_sdl_5)
division_5 = Division(A=length_5, B=Slider(0.15, range=0..1))
division_6 = Division(A=length_6, B=Slider(0.15, range=0..1))
round_5 = Round(Number=division_5)  # -> Nearest, Floor, Ceiling
round_6 = Round(Number=division_6)  # -> Nearest, Floor, Ceiling
divide_curve_5 = DivideCurve(Curve=line_sdl_5, Count=expr("x", round_6.Nearest), Kinks=False)  # -> simplify(Points), simplify(Tangents), Parameters
divide_curve_6 = DivideCurve(Curve=line_sdl_6, Count=expr("x", round_5.Nearest), Kinks=False)  # -> simplify(Points), simplify(Tangents), Parameters
curve_11 = Curve(<curve referenced from the Rhino model>)
curve_closest_point_5 = CurveClosestPoint(Point=divide_curve_5.Points, Curve=curve_11)  # -> Point, Parameter, Distance
yz_plane_3 = YZPlane(Origin=divide_curve_5.Points)
yz_plane_4 = YZPlane(Origin=divide_curve_6.Points)
curve_12 = Curve(<curve referenced from the Rhino model>)
align_plane_8 = AlignPlane(Plane=yz_plane_4, Direction=graft(divide_distance_9.Tangents))  # -> Plane, Angle
curve_closest_point_6 = CurveClosestPoint(Point=divide_curve_6.Points, Curve=curve_12)  # -> Point, Parameter, Distance
align_plane_9 = AlignPlane(Plane=yz_plane_3, Direction=graft(divide_distance_8.Tangents))  # -> Plane, Angle
vector_2pt_8 = Vector2Pt(PointA=align_plane_8.Plane, PointB=curve_closest_point_6.Point, Unitize=False)  # -> Vector, Length
vector_2pt_9 = Vector2Pt(PointA=align_plane_9.Plane, PointB=curve_closest_point_5.Point, Unitize=False)  # -> Vector, Length
dispatch_16 = Dispatch(List=align_plane_8.Plane, DispatchPattern=[True, False])  # -> ListA, ListB
vector_display_8 = VectorDisplay(Anchor=divide_curve_6.Points, Vector=vector_2pt_8.Vector)
dispatch_17 = Dispatch(List=align_plane_9.Plane, DispatchPattern=[True, False])  # -> ListA, ListB
vector_display_9 = VectorDisplay(Anchor=divide_curve_5.Points, Vector=vector_2pt_9.Vector)
flip_matrix_9 = FlipMatrix(Data=dispatch_16.ListB)
flip_matrix_10 = FlipMatrix(Data=dispatch_16.ListA)
flip_matrix_11 = FlipMatrix(Data=dispatch_17.ListB)
flip_matrix_12 = FlipMatrix(Data=dispatch_17.ListA)
dispatch_18 = Dispatch(List=flip_matrix_9, DispatchPattern=[True, False])  # -> ListA, ListB
dispatch_19 = Dispatch(List=flip_matrix_10, DispatchPattern=[True, False])  # -> ListA, ListB
dispatch_20 = Dispatch(List=flip_matrix_11, DispatchPattern=[True, False])  # -> ListA, ListB
dispatch_21 = Dispatch(List=flip_matrix_12, DispatchPattern=[True, False])  # -> ListA, ListB
number_slider_25 = Slider(0.29, range=0..1)
data_9 = Data([dispatch_19.ListA, dispatch_18.ListB])
number_slider_26 = Slider(0.15, range=0..1)
number_slider_27 = Slider(0.065, range=0..0.1)
number_slider_28 = Slider(0.29, range=0..1)
data_10 = Data([dispatch_21.ListB, dispatch_20.ListA])
number_slider_29 = Slider(0.15, range=0..1)
number_slider_30 = Slider(0.065, range=0..0.1)
construct_domain_23 = ConstructDomain(DomainStart=expr("-x/2", number_slider_27), DomainEnd=expr("x/2", number_slider_27))
construct_domain_24 = ConstructDomain(DomainStart=expr("-x/2", number_slider_25), DomainEnd=expr("x/2", number_slider_25))
construct_domain_25 = ConstructDomain(DomainStart=expr("-2*x/3", number_slider_26), DomainEnd=expr("x/3", number_slider_26))
construct_domain_26 = ConstructDomain(DomainStart=expr("-x/2", number_slider_30), DomainEnd=expr("x/2", number_slider_30))
construct_domain_27 = ConstructDomain(DomainStart=expr("-x/2", number_slider_28), DomainEnd=expr("x/2", number_slider_28))
construct_domain_28 = ConstructDomain(DomainStart=expr("-2*x/3", number_slider_29), DomainEnd=expr("x/3", number_slider_29))
domain_box_13 = DomainBox(Base=data_9, X=construct_domain_23, Y=construct_domain_25, Z=construct_domain_24)
domain_box_14 = DomainBox(Base=data_10, X=construct_domain_26, Y=construct_domain_28, Z=construct_domain_27)
brep_7 = Brep([<brep referenced from the Rhino model> x5])
solid_difference_4 = SolidDifference(BrepsA=[domain_box_14, domain_box_13], BrepsB=brep_7)
lunette_vault_bricks_2 = Brep(solid_difference_4)

negative_11 = Negative(Value="0.15")
# Pavilion Vault Bricks
surface_5 = Surface([<surface referenced from the Rhino model> x2])
offset_surface = OffsetSurface(Surface=surface_5, Distance=negative_11, Retrim=True)
deconstruct_brep_5 = DeconstructBrep(Brep=[offset_surface, surface_5])  # -> Faces, Edges, Vertices
list_item_5 = ListItem(List=deconstruct_brep_5.Edges, Index="1", Wrap=True)
divide_distance_10 = DivideDistance(Curve=list_item_5, Distance=Slider(0.08, range=0..0.1))  # -> Points, Tangents, Parameters
unit_y_2 = UnitY(Factor=1)
negative_12 = Negative(Value=unit_y_2)
line_sdl_7 = LineSDL(Start=divide_distance_10.Points, Direction=negative_12, Length=Slider(7, range=0..10))
trim_with_region = TrimWithRegion(Curve=line_sdl_7, Region=deconstruct_brep_5.Faces)  # -> Inside, Outside
curve_13 = Curve(flatten(trim_with_region.Inside))
length_7 = Length(Curve=curve_13)
division_7 = Division(A=length_7, B=Slider(0.15, range=0..1))
round_7 = Round(Number=division_7)  # -> Nearest, Floor, Ceiling
divide_curve_7 = DivideCurve(Curve=curve_13, Count=expr("x", round_7.Nearest), Kinks=False)  # -> simplify(Points), simplify(Tangents), Parameters
curve_14 = Curve(<curve referenced from the Rhino model>)
curve_closest_point_7 = CurveClosestPoint(Point=divide_curve_7.Points, Curve=curve_14)  # -> Point, Parameter, Distance
align_plane_10 = AlignPlane(Plane=divide_curve_7.Points, Direction=divide_curve_7.Tangents)  # -> Plane, Angle
vector_2pt_10 = Vector2Pt(PointA=align_plane_10.Plane, PointB=curve_closest_point_7.Point, Unitize=False)  # -> Vector, Length
adjust_plane_6 = AdjustPlane(Plane=align_plane_10.Plane, Normal=vector_2pt_10.Vector)
dispatch_22 = Dispatch(List=adjust_plane_6, DispatchPattern=[True, False])  # -> ListA, ListB
vector_display_10 = VectorDisplay(Anchor=divide_curve_7.Points, Vector=vector_2pt_10.Vector)
flip_matrix_13 = FlipMatrix(Data=dispatch_22.ListA)
flip_matrix_14 = FlipMatrix(Data=dispatch_22.ListB)
dispatch_23 = Dispatch(List=flip_matrix_13, DispatchPattern=[True, False])  # -> ListA, ListB
dispatch_24 = Dispatch(List=flip_matrix_14, DispatchPattern=[True, False])  # -> ListA, ListB
data_11 = Data([dispatch_23.ListA, dispatch_24.ListB])
number_slider_31 = Slider(0.15, range=0..1)
number_slider_32 = Slider(0.29, range=0..1)
construct_domain_29 = ConstructDomain(DomainStart=expr("-x/2", number_slider_31), DomainEnd=expr("x/2", number_slider_31))
construct_domain_30 = ConstructDomain(DomainStart=expr("-x/2", number_slider_32), DomainEnd=expr("x/2", number_slider_32))
domain_box_15 = DomainBox(Base=data_11, X=construct_domain_30, Y=Slider(0.065, range=0..0.1), Z=construct_domain_29)

solid_difference_5 = SolidDifference(BrepsA=domain_box_15, BrepsB=brep_3)

pavilion_vault_bricks = Brep(solid_difference_5)
