# Grasshopper definition G1-BRICK CONSTRUCTION MASHARBIA PATTERNS.gh (Grasshopper 1.0.7)

number_slider = Slider(0.3, range=0..1)
surface = Surface(<surface referenced from the Rhino model>)
negative = Negative(Value=number_slider)

# ---- group: brick spacing
addition = Addition(A=Slider(0.065, range=0..0.1), B=Slider(0.01, range=0..0.1))

# ----
offset_surface = OffsetSurface(Surface=graft(surface), Distance=[number_slider, negative], Retrim=True)
xy_plane = XYPlane(Origin=Point(0, 0, 0))
deconstruct_brep = DeconstructBrep(Brep=offset_surface)  # -> Faces, Edges, Vertices
deconstruct_brep_2 = DeconstructBrep(Brep=surface)  # -> Faces, Edges, Vertices
join_curves = JoinCurves(Curves=deconstruct_brep.Edges, Preserve=False)
contour = Contour(Shape=surface, Point=xy_plane, Direction=Vector(0, 0, 1), Distance=addition)  # -> flatten(Contours)
curve_middle = CurveMiddle(Curve=deconstruct_brep_2.Edges)
loft = Loft(
    Curves=flatten(join_curves),
    Options={Adjust=False, Closed=False, LoftEnds=0, LoftSimp=0, LoftType=0, Rebuild=10, Refit=0.01})
deconstruct = Deconstruct(Point=curve_middle)  # -> XComponent, YComponent, ZComponent
list_length = ListLength(List=contour)
brep_join = BrepJoin(Breps=flatten([offset_surface, loft]))  # -> Breps, Closed
series = Series(Start=0, Step=addition, Count=list_length)
sort_list = SortList(Keys=deconstruct.ZComponent, ValuesValuesA=deconstruct_brep_2.Edges)  # -> Keys, ValuesValuesA
unit_z = UnitZ(Factor=series)
list_item = ListItem(List=sort_list.ValuesValuesA, Index=0, Wrap=True)
curve = Curve(<curve referenced from the Rhino model>)
move = Move(Geometry=list_item, Motion=unit_z)  # -> Geometry, Transform
number_slider_2 = Slider(0.15, range=0..1)
length = Length(Curve=move.Geometry)
division = Division(A=length, B=Slider(0.075, range=0..0.1))
round = Round(Number=division)  # -> Nearest, Floor, Ceiling
divide_curve = DivideCurve(Curve=move.Geometry, Count=expr("x", round.Nearest), Kinks=False)  # -> simplify(Points), simplify(Tangents), Parameters
flip_matrix = FlipMatrix(Data=divide_curve.Points)
dispatch = Dispatch(List=flip_matrix, DispatchPattern=[True, False])  # -> ListA, ListB
flip_matrix_2 = FlipMatrix(Data=dispatch.ListB)
flip_matrix_3 = FlipMatrix(Data=dispatch.ListA)
dispatch_2 = Dispatch(List=flip_matrix_3, DispatchPattern=[True, False, False, False, False, False])  # -> ListA, ListB
dispatch_3 = Dispatch(List=flip_matrix_2, DispatchPattern=[False, False, False, True, False, False])  # -> ListA, ListB
number_slider_3 = Slider(0.15, range=0..1)
data = Data([dispatch_3.ListA, dispatch_2.ListA])
construct_domain = ConstructDomain(DomainStart=expr("-x/2", number_slider_3), DomainEnd=expr("x/2", number_slider_3))
domain_box = DomainBox(Base=data, X=Slider(0.29, range=0..1), Y=construct_domain, Z=Slider(0.075, range=0..0.1))
solid_intersection = SolidIntersection(BrepsA=domain_box, BrepsB=brep_join.Breps)
solid_difference = SolidDifference(BrepsA=domain_box, BrepsB=brep_join.Breps)
jaali = Brep(solid_intersection)
