# Grasshopper definition G1-GROUND LEVEL_meshing,kangaroo, karamba.gh (Grasshopper 1.0.7)
# Copyright: Arup
# plug-ins: MeshEdit Components, Weaverbird, Kangaroo2 Components, karambaGH

# walls: horizontal mesh representing supports
# rooms: horizontal mesh representing all rooms and corridors
# verticals: vertical mesh (1m) conecting walls and rooms
walls = Surface([<surface referenced from the Rhino model> x193])  # disabled
verticals = Surface([<surface referenced from the Rhino model> x317])  # disabled
rooms = Surface([<surface referenced from the Rhino model> x380])  # disabled

# ---- group: SUBDIVIDE MESH. LEVELS RANGE IS FROM 1 TO 3
simple_mesh = SimpleMesh(Brep=walls)
simple_mesh_2 = SimpleMesh(Brep=[rooms, verticals])
weld_mesh = WeldMesh(Mesh=[simple_mesh, simple_mesh_2], Angle=3.141592654)
weld_mesh_2 = WeldMesh(Mesh=walls, Angle=3.141592654)
number_slider = Slider(1, range=1..3)
weaverbird_s_constant_quads_split_subdiv = WeaverbirdsConstantQuadsSplitSubdivision(MeshCurves=weld_mesh, Level=number_slider, SmoothNakedEdges=0)
weaverbird_s_constant_quads_split_subdiv_2 = WeaverbirdsConstantQuadsSplitSubdivision(MeshCurves=weld_mesh_2, Level=number_slider, SmoothNakedEdges=0)
deconstruct_mesh = DeconstructMesh(Mesh=weaverbird_s_constant_quads_split_subdiv_2)  # -> Vertices, Faces, Colours, Normals

# ---- group: GOALS
edgelengths = EdgeLengths(Mesh=weaverbird_s_constant_quads_split_subdiv, LengthFactor=1, Strength=Slider(10, range=0..10))
vertexloads = VertexLoads(Mesh=weaverbird_s_constant_quads_split_subdiv, Strength=Slider(0.04, range=0..1))
anchor = Anchor(Point=deconstruct_mesh.Vertices, Strength=Slider(10, range=0..100))
show = Show(G=weaverbird_s_constant_quads_split_subdiv)

# ---- group: SOLVER
# SET BOOLEAN TOGGLE TO TRUE TO RUN THE SOLVER
boolean_toggle = BooleanToggle(False)
bouncysolver = BouncySolver(
    GoalObjects=[vertexloads, anchor, edgelengths, show],
    Reset=Button(),
    Threshold=1e-15,
    Tolerance=0.01,
    Damping=Slider(0.8, range=0..1),
    Iterations=10,
    On=boolean_toggle)  # -> I, V, O
data = Data(bouncysolver.O)
mesh = Mesh(data)

# ---- group: Brick height
unit_mm = Slider(75, range=0..100)

# ----
youngs_module_mpa = Panel("80")
adobe_density_kg_m3 = Panel("1200")

# ---- group: Brick size
expression = Expression(mm=unit_mm, Expression="mm*0.001")
expression_2 = Expression(u=expression, Expression="u*2")
expression_3 = Expression(u=expression, Expression="u*4")
brick_size_mm = DomainBox(Base=PlaneXY(0, 0, 0), Width=expression_2, Length=expression_3, Height=expression)

# ----
# WHEN SOLVER IS FINISHED (SET TO FALSE)
# ENABLE THIS COMPONENT
# FOR FURTHER STRUCTURAL TESTING
clean_tree = CleanTree(RemoveNulls=True, RemoveInvalid=True, RemoveEmpty=False, Tree=mesh)  # disabled

# ---- group: Self Weight
loads_karamba3d = LoadsKaramba3D(LCase="0", mode="Gravity")

# ---- group: THICKNESS OF SHELL
number_of_bricks_in_shell_thickness = Slider(3, range=0..10)
multiplication = Multiplication(BrickUnitM=expression, B=number_of_bricks_in_shell_thickness, _100=100)
thickness_cm = Panel(multiplication)

# ---- group: Material properties
expression_4 = Expression(E=youngs_module_mpa, Expression="E*1000000")
expression_5 = Expression(d=adobe_density_kg_m3, Expression="d*0.01")
expression_6 = Expression(E=expression_4, Expression="E*0.0000001")
panel = Panel(expression_6)
panel_2 = Panel(expression_5)

# ---- group: Sand Load
unit_z = UnitZ(Factor=Slider(-1.5, range=-2..2))

# ---- group: STRUCTURAL ANALYSIS
mesh_join = MeshJoin(Meshes=clean_tree)
panel_3 = Panel("shell01")
mesh_2 = Mesh(mesh_join)

# ---- group: Material properties (continued)
material_properties_karamba3d = MaterialPropertiesKaramba3D(
    FamilyOfMaterial="Adobe",
    Name="Adobe v.1",
    ElementIdentifier=panel_3,
    YoungsModulus_kN_cm2=panel,
    InPlaneShearModulus_kN_cm2=expr("x/2.5", panel),
    TransverseShearModulus_kN_cm2=8076,
    SpecificWeight_kN_m3=panel_2,
    CoefficientOfThermalExpansion_1_C=1e-05,
    YieldStrength_kN_cm2="0.1",
    mode="Isotrop")

# ---- group: Smooth mesh
mesh_join_2 = MeshJoin(Meshes=mesh_2)
mesh_unifynormals = MeshUnifyNormals(Mesh=mesh_join_2)
weaverbird_s_laplacian_smoothing = WeaverbirdsLaplacianSmoothing(MeshCurves=mesh_unifynormals, Level=Slider(15, range=0..200), SmoothNakedEdges=0, Thin=1)

# ----
cross_section_karamba3d = CrossSectionKaramba3D(
    FamilyNameOfCrossSection="DefaultCroSec",
    ElementIdentifier=panel_3,
    Material=material_properties_karamba3d,
    Height_cm=thickness_cm,
    mode="Shell - Const")
# IF STRUCTURAL TEST RESULT ARE SATISFYING
# ENABLE THIS COMPONENT FOR OFFSETING
mesh_3 = Mesh(weaverbird_s_laplacian_smoothing)  # disabled

# ---- group: OFFSET MESH
boolean_toggle_2 = BooleanToggle(True)
panel_4 = Panel(thickness_cm)
mesh_offset_extrude = MeshOffsetExtrude(M=mesh_3, B=False, E=boolean_toggle_2, C0=boolean_toggle_2, C1=True, D=panel_4)  # -> out, A; inputs M: Mesh, V: list of Vector3d, D: list
# ---------- mesh_offset_extrude: VB ----------
    Component.Params.Input(0).Name = "Mesh"
    Component.Params.Input(0).Description = "Open or closed mesh"
    Component.Params.Input(1).Name = "Both Sides"
    Component.Params.Input(1).Description = "If true the mesh is offset in both directions along the vertex normals"
    Component.Params.Input(2).Name = "Edges"
    Component.Params.Input(2).Description = "If true the mesh will contain faces on the edges between the two offset mesh faces"
    Component.Params.Input(3).Name = "Closed Bottom"
    Component.Params.Input(3).Description = "If true the mesh will be closed on the origin face"
    Component.Params.Input(4).Name = "Closed Top"
    Component.Params.Input(4).Description = "If true the mesh will be closed on the offset face"
    Component.Params.Input(5).Name = "Vector [Vertex]"
    Component.Params.Input(5).Description = "An optional vector that sets the direction of extrusion, if empty, the new mesh will be offset along the vertex normals"
    Component.Params.Input(6).Name = "Distance [Vertex, Rh Units]"
    Component.Params.Input(6).Description = "A single number or list of numbers corresponding to each vertex of a mesh which sets the Rhino unit based distance that the new geometry is offset from each mesh face"

    Component.Params.Output(1).Name = "Mesh"
    Component.Params.Output(1).Description = "If successful, a valid mesh"

    If m IsNot Nothing Then

      Dim mf As Rhino.Geometry.Collections.MeshFaceList = Nothing
      Dim mv As Rhino.Geometry.Collections.MeshVertexList = Nothing
      Dim mtv As Rhino.Geometry.Collections.MeshTopologyVertexList = Nothing
      Dim mte As Rhino.Geometry.Collections.MeshTopologyEdgeList = Nothing
      Dim mn As Rhino.Geometry.Collections.MeshVertexNormalList = Nothing
      Dim mc As Rhino.Geometry.Collections.MeshVertexColorList = Nothing

      mf = m.Faces
      mv = m.Vertices
      mtv = m.TopologyVertices
      mte = m.TopologyEdges
      mn = m.Normals
      mc = m.VertexColors

      Dim clrB As Boolean = False
      If mc.count() > 0 Then clrB = True

      Dim i,cv,cf,u(1),hd As Integer
      Dim blnV As Boolean
      Dim vec As vector3d
      Dim ova, ovb As New list(Of point3d)
      Dim vf As New list(Of Vector3f)
      Dim ofc As New list(Of MeshFace)
      If b Then hd = 2 Else hd = 1
      
      cv = mv.count()
      cf = mf.count()

      If (D.count() - 1) < cv Then D = matchDbl(D, cv)

      If v.count() > 0 Then
        blnV = True
        If (V.count() - 1) < cv Then V = matchVec(V, cv)
      End If

      'Define Base Vertices
      For i = 0 To cv - 1 Step 1
        If blnV Then vec = V(i) Else vec = mn(i)
        vec.Unitize()
        vec *= (D(i) / hd)

        ovb.add(New point3d(mv(i)) + vec)
        If Not b Then vec *= 0
        vec.Reverse()
        ova.add(New point3d(mv(i)) + vec)
      Next

      If (c0 Or (((Not c0) And (Not e)) And c1)) Then ofc = mf.ToList()

      If ((e or c0) And c1) Then
        For i = 0 To cf - 1 Step 1
          If mf(i).isquad() Then
            ofc.add(New meshface(mf(i).A + cv, mf(i).B + cv, mf(i).C + cv, mf(i).D + cv))
          Else
            ofc.add(New meshface(mf(i).A + cv, mf(i).B + cv, mf(i).C + cv))
          End If
        Next
      End If

      If e Then
        For i = 0 To mte.count() - 1 Step 1

          u(0) = mtv.MeshVertexIndices(mte.GetTopologyVertices(i).I)(0)
          u(1) = mtv.MeshVertexIndices(mte.GetTopologyVertices(i).J)(0)

          If uBound(mte.GetConnectedFaces(i)) < 1 Then
            ofc.add(New meshface(u(0), u(1), u(1) + cv, u(0) + cv))
          End If
        Next
      End If

      Dim mo As New mesh

      If (c0 Or e) Then
        mo.Vertices.AddVertices(ova.toarray())
        If clrB Then mo.VertexColors.AppendColors(mc.ToArray())
      End If
      If (c1 Or e) Then
        mo.Vertices.AddVertices(ovb.toarray())
        If clrB Then mo.VertexColors.AppendColors(mc.ToArray())
      End If

      mo.Faces.AddFaces(ofc)

      A = mo
    End If
# ---------- mesh_offset_extrude: VB additional code ----------
  Private Function matchDbl(ByVal a As list(Of Double), ByVal t As Integer)
    Dim i,k As Integer
    k = a.count()
    For i = 0 To ((t + 1) - k) - 1 Step 1
      a.add(a.item(k - 1))
    Next
    Return a
  End Function

  Private Function matchVec(ByVal a As list(Of vector3d), ByVal t As Integer)
    Dim i,k As Integer
    k = a.count()
    For i = 0 To ((t + 1) - k) - 1 Step 1
      a.add(a.item(k - 1))
    Next
    Return a
  End Function
# ---------- end mesh_offset_extrude ----------
mesh_4 = Mesh(mesh_offset_extrude.A)
mesh_unifynormals_2 = MeshUnifyNormals(Mesh=mesh_4)

# ---- group: STRUCTURAL ANALYSIS (continued)
meshtoshell = MeshToShellKaramba3D(Mesh=weaverbird_s_laplacian_smoothing, Identifier=panel_3, CrossSection=cross_section_karamba3d, LimitDistance_m=0.005)  # -> Element, Points, Info
closest_point = ClosestPoint(Point=deconstruct_mesh.Vertices, Cloud=meshtoshell.Points)  # -> ClosestPoint, CPIndex, Distance
remove_duplicate_points_karamba3d = RemoveDuplicatePointsKaramba3D(Point=flatten(closest_point.ClosestPoint), LimitDistance=0.005)  # -> OutPoint, Info, Indexes
supp = SupportKaramba3D(PosInd=remove_duplicate_points_karamba3d.OutPoint, menu=[buttons(on, on, on, on, on, on)])  # -> flatten(Support)

# ---- group: Sand Load (continued)
loads_karamba3d_2 = LoadsKaramba3D(
    Vector=unit_z,
    Mesh=weaverbird_s_laplacian_smoothing,
    Pos=meshtoshell.Points,
    LCase="1",
    mode="MeshLoad -Const.",
    menu=[buttons(off, on, off), buttons(on, on)])

# ----
load_karamba3d = LoadKaramba3D(flatten([loads_karamba3d_2, loads_karamba3d]))

# ---- group: STRUCTURAL ANALYSIS (continued)
assemble = AssembleModelKaramba3D(
    Elem=meshtoshell.Element,
    Support=supp,
    Load=load_karamba3d,
    CrossSection=cross_section_karamba3d,
    Material=material_properties_karamba3d,
    LimitDistance_m=0.005)  # -> Model, Info, Mass_kg, CenterOfGravity

# ----
analyze = AnalyzeKaramba3D(Model=assemble.Model)  # -> CalculatedModel, MaximumDisplacement_cm, ResultingForceOfGravity_kN, ElasticEnergy_kNm

# ---- group: STRUCTURAL RESULTS
modelview = ModelViewKaramba3D(Model=analyze.CalculatedModel, ResultFactors=1, ResultCase=-1)  # -> Model, DeformedMesh, DeformedAxes, DeformedModel
shellview = ShellViewKaramba3D(Model=modelview.Model, IndexOfLayer=0)  # -> Model, MeshesOfRenderedShells, LegendColors, LegendTags
legend = Legend(Colour=shellview.LegendColors, Tags=shellview.LegendTags, LegendType=1)
