# Grasshopper definition G1-RIB CONSTRUCTION POINTS.gh (Grasshopper 1.0.7)

# Side Rib Indexes
number_slider = Slider(5, range=0..5)
panel = Panel("""8
10
1
2""")
# Catenary Rib Indexes
panel_2 = Panel("""5
9""")

# ---- group: Tessellation Curves
curve = Curve([<curve referenced from the Rhino model> x11])

# ---- group: Shape Brep
surface = Surface(<surface referenced from the Rhino model>)

# ---- group: Solving for Catenary Intersections
unit_z = UnitZ(Factor=number_slider)
list_item = ListItem(List=curve, Index=panel, Wrap=True)
extrude = Extrude(Base=list_item, Direction=unit_z)
surface_2 = Surface(extrude)
brep = Brep(surface_2)
brep_brep = BrepBrep(BrepA=brep, BrepB=surface)  # -> Curves, Points
# The approximated Curves have to be 2 degree
# curves for the ease of bending and construction
divide_curve = DivideCurve(Curve=brep_brep.Curves, Count=Slider(4, range=0..4), Kinks=False)  # -> Points, Tangents, Parameters
nurbs_curve = NurbsCurve(Vertices=divide_curve.Points, Degree=2, Periodic=False)  # -> Curve, Length, Domain
divide_curve_2 = DivideCurve(Curve=nurbs_curve.Curve, Count=Slider(4, range=0..12), Kinks=False)  # -> Points, Tangents, Parameters

# ---- group: Solving for Side Rib Intersections
unit_z_2 = UnitZ(Factor=number_slider)
list_item_2 = ListItem(List=curve, Index=panel_2, Wrap=True)
extrude_2 = Extrude(Base=list_item_2, Direction=unit_z_2)
surface_3 = Surface(extrude_2)
brep_2 = Brep(surface_3)
brep_brep_2 = BrepBrep(BrepA=brep_2, BrepB=surface)  # -> Curves, Points
divide_curve_3 = DivideCurve(Curve=brep_brep_2.Curves, Count=Slider(6, range=0..12), Kinks=False)  # -> Points, Tangents, Parameters

# ----
point = Point(divide_curve_3.Points)
point_2 = Point(divide_curve_2.Points)
