# Grasshopper definition Bubble_Diagrams_Scenario_3.gh (Grasshopper 1.0.7)
# plug-ins: SpaceSyntaxDesign_GH

panel = Panel("""Walkway Junction
Persian Restaurant Seating
Persian Resturant
Backstreet
Outdoor Seating
Tea House
Backstreet
Outdoor Seating
Snack Shop
Backstreet
Public Benches
Fountain
Walkway Street North
Exhibition Space
Delicate Fabric
Backstreet
Exhibition Space
General Fabrics
Backstreet
Walkway Street East
Exhibition Space
Vegetable Store
Backstreet
Butcher Shop
Backstreet
Walkway Square Workshop
Coppersmith
Shoemaker
Furniture Store
Bike Store
Blacksmith
Pottery Shop
Exhibition Square
Walkway Street West
Exhibition Space
Dry Fruit Shop
Backstreet
Exhibition Space
Herb Shop
Backstreet
Mosque
Walkway Street South
Exhibition Space
Pharmacy
Backstreet
Exhibition Space
Bookstore
Backstreet""")
pt = Point([<point referenced from the Rhino model> x48])

# ---- group: WORKSHOP
genes = GenePool(
    Decimals=2,
    Maximum=30,
    Minimum=1,
    Value=[29.52983466, 23.30759389, 7.850620562, 14.3302814, 10.38824799, 1.551196887, 26.7588673, 8.792840978, 13.02479096, 26.68022309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])
crv = Curve([<curve referenced from the Rhino model> x47])
points = PointList(Points=pt, Size=Slider(1, range=0..10))
nodelinkgraph = GraphFromNodesLinks(Points=pt, Links=crv, Labels=panel, Areas=genes, TotalArea=Slider(27325, range=0..50000))  # -> Graph, GraphVertices, Attributes
forcedirecteddrawing = ForceDirectedDrawing(
    Graph=nodelinkgraph.Graph,
    Vertices=nodelinkgraph.GraphVertices,
    Attributes=nodelinkgraph.Attributes,
    AttractionStrength=0.25,
    RepulsionStrength=1.4,
    ConvergenceTolearnce=0.001,
    MaximumIterations=4000,
    Active=Toggle(False))  # -> NewGraphVertices, IterationCount
# WORKSHOP
number_slider = Slider(1, range=0..100)
att = Data(nodelinkgraph.Attributes)
graph = Data(nodelinkgraph.Graph)
diskograph = DiskoGraphDrawing(
    Plane=PlaneXY(-597.1836284, 25.00829307, 0),
    Graph=nodelinkgraph.Graph,
    Vertices=forcedirecteddrawing.NewGraphVertices,
    Attributes=nodelinkgraph.Attributes,
    Thickness=number_slider)
control = ControlAnalysis(Graph=graph, Attributes=att)  # -> Control, ControlRelativeColors, ControlTags
choice = ChoiceAnalysis(Graph=graph, Attributes=att)  # -> ShortestPaths, ChoiceBetweenness, ChoiceRelativeColors, ChoiceTags
integration = IntegrationAnalysis(Graph=graph, Attributes=att)  # -> DepthTable, DepthMap, RelativeASymetry, Integration, IntegrationRelativeColors, IntegrationTags
sort = SortList(Keys=control.Control, ValuesA=control.ControlRelativeColors, ValuesB=control.ControlTags)  # -> Keys, ValuesA, ValuesB
sort_2 = SortList(Keys=choice.ChoiceBetweenness, ValuesA=choice.ChoiceRelativeColors, ValuesB=choice.ChoiceTags)  # -> Keys, ValuesA, ValuesB
entropy = EntropyAnalysis(Graph=graph, Attributes=att, DepthTable=integration.DepthTable, DepthMap=integration.DepthMap)  # -> Entropy, EntropyRelativeColors, EntropyTags
sort_3 = SortList(Keys=integration.Integration, ValuesA=integration.IntegrationRelativeColors, ValuesB=integration.IntegrationTags)  # -> Keys, ValuesA, ValuesB
diff = DifferenceFactor()
legend = Legend(
    Colour=sort_2.ValuesA,
    Tags=sort_2.ValuesB,
    Rectangle={Plane=PlaneXY(38.98196872, -34.70554393, 0), Size=Domain2(u=-5.422100731..5.422100731, v=-8.643928702..8.643928702)},
    LegendType=1)
sort_4 = SortList(Keys=entropy.Entropy, ValuesA=entropy.EntropyRelativeColors, ValuesB=entropy.EntropyTags)  # -> Keys, ValuesA, ValuesB
panel_2 = Panel(diff)
legend_2 = Legend(
    Colour=sort.ValuesA,
    Tags=sort.ValuesB,
    Rectangle={Plane=PlaneXY(5.913848207, -34.70554393, 0), Size=Domain2(u=-5.422100731..5.422100731, v=-8.643928702..8.643928702)},
    LegendType=1)
legend_3 = Legend(
    Colour=sort_3.ValuesA,
    Tags=sort_3.ValuesB,
    Rectangle={Plane=PlaneXY(-11.68833388, -34.70554393, 0), Size=Domain2(u=-5.422100731..5.422100731, v=-8.643928702..8.643928702)},
    LegendType=1)
legend_4 = Legend(
    Colour=sort_4.ValuesA,
    Tags=sort_4.ValuesB,
    Rectangle={Plane=PlaneXY(22.10156923, -34.70554393, 0), Size=Domain2(u=-5.422100731..5.422100731, v=-8.643928702..8.643928702)},
    LegendType=1)
panel_3 = Panel("""Walkway
Exhibition
Workshop / Factory
Exhibition
Workshop / Factory""")
justifiedgraph = JustifiedGraphDrawing(
    ViewPointIndex=Slider(8, range=0..10),
    Plane=PlaneXY(138.4592751, -37.73829052, 0),
    Size=Slider(50, range=0..50),
    Thickness=Slider(1, range=0..10),
    Graph=graph,
    Attributes=att,
    DepthTable=integration.DepthTable)

# ----
prgm = Programme()  # -> Tags, Areas, Colors, Legends
lol = LOL()
