# Grasshopper definition 3D_conf_rooms.gh (Grasshopper 1.0.7)

# ---- group: Square + Shops
crv = Curve(<curve referenced from the Rhino model>)
crv_2 = Curve([<curve referenced from the Rhino model> x8])
merge = Merge(Data1=crv, Data2=crv_2)
Z = UnitZ(Factor=Slider(3.5, range=0..5))
extr = Extrude(Base=merge, Direction=Z)

# ---- group: Fountain (Junction)
crv_3 = Curve(<curve referenced from the Rhino model>)
crv_4 = Curve(<curve referenced from the Rhino model>)
Z_2 = UnitZ(Factor=Slider(1.5, range=0..5))
Z_3 = UnitZ(Factor=Slider(0.3, range=0..5))
extr_2 = Extrude(Base=crv_3, Direction=Z_2)
extr_3 = Extrude(Base=crv_4, Direction=Z_3)
cap = CapHoles(Brep=extr_2)
cap_2 = CapHoles(Brep=extr_3)

# ---- group: Junction + Community
crv_5 = Curve([<curve referenced from the Rhino model> x3])
# Scenario 1
crv_6 = Curve(<curve referenced from the Rhino model>)
merge_2 = Merge(Data1=crv_6, Data2=crv_5)
Z_4 = UnitZ(Factor=Slider(5, range=0..5))
boundary = BoundarySurfaces(Edges=crv_6)
extr_4 = Extrude(Base=merge_2, Direction=Z_4)

# ---- group: Walkways + Shops
crv_7 = Curve([<curve referenced from the Rhino model> x8])
crv_8 = Curve([<curve referenced from the Rhino model> x4])
merge_3 = Merge(Data1=crv_8, Data2=crv_7)
Z_5 = UnitZ(Factor=Slider(2.7, range=0..5))
extr_5 = Extrude(Base=merge_3, Direction=Z_5)
boundary_2 = BoundarySurfaces(Edges=crv_8)

# ----
boundary_3 = BoundarySurfaces(Edges=crv)
geo = Geometry([cap_2, cap, extr_4, boundary, extr_5, boundary_2, extr, boundary_3])  # disabled

# ---- group: Fountain (Junction)
crv_9 = Curve(<curve referenced from the Rhino model>)
crv_10 = Curve(<curve referenced from the Rhino model>)
Z_6 = UnitZ(Factor=Slider(1.5, range=0..5))
Z_7 = UnitZ(Factor=Slider(0.3, range=0..5))
extr_6 = Extrude(Base=crv_9, Direction=Z_6)
extr_7 = Extrude(Base=crv_10, Direction=Z_7)
cap_3 = CapHoles(Brep=extr_6)
cap_4 = CapHoles(Brep=extr_7)

# ---- group: Junction + Community
# Scenario 2
crv_11 = Curve(<curve referenced from the Rhino model>)
Z_8 = UnitZ(Factor=Slider(5, range=0..5))
extr_8 = Extrude(Base=crv_11, Direction=Z_8)
boundary_4 = BoundarySurfaces(Edges=crv_11)

# ---- group: Walkways + Shops
crv_12 = Curve([<curve referenced from the Rhino model> x8])
crv_13 = Curve([<curve referenced from the Rhino model> x4])
merge_4 = Merge(Data1=crv_13, Data2=crv_12)
Z_9 = UnitZ(Factor=Slider(2.7, range=0..5))
extr_9 = Extrude(Base=merge_4, Direction=Z_9)
boundary_5 = BoundarySurfaces(Edges=crv_13)

# ----
geo_2 = Geometry([cap_4, cap_3, extr_8, boundary_4, extr_9, boundary_5])  # disabled

# ---- group: Square + Shops
crv_14 = Curve(<curve referenced from the Rhino model>)
crv_15 = Curve([<curve referenced from the Rhino model> x6])
merge_5 = Merge(Data1=crv_14, Data2=crv_15)
Z_10 = UnitZ(Factor=Slider(3.5, range=0..5))
extr_10 = Extrude(Base=merge_5, Direction=Z_10)
boundary_6 = BoundarySurfaces(Edges=crv_14)

# ---- group: Fountain (Junction)
crv_16 = Curve(<curve referenced from the Rhino model>)
crv_17 = Curve(<curve referenced from the Rhino model>)
Z_11 = UnitZ(Factor=Slider(1.5, range=0..5))
Z_12 = UnitZ(Factor=Slider(0.3, range=0..5))
extr_11 = Extrude(Base=crv_16, Direction=Z_11)
extr_12 = Extrude(Base=crv_17, Direction=Z_12)
cap_5 = CapHoles(Brep=extr_11)
cap_6 = CapHoles(Brep=extr_12)

# ---- group: Junction + Community
crv_18 = Curve([<curve referenced from the Rhino model> x3])
# Scenario 3
crv_19 = Curve(<curve referenced from the Rhino model>)
merge_6 = Merge(Data1=crv_19, Data2=crv_18)
Z_13 = UnitZ(Factor=Slider(5, range=0..5))
boundary_7 = BoundarySurfaces(Edges=crv_19)
extr_13 = Extrude(Base=merge_6, Direction=Z_13)

# ---- group: Walkways + Shops
crv_20 = Curve([<curve referenced from the Rhino model> x8])
crv_21 = Curve([<curve referenced from the Rhino model> x4])
merge_7 = Merge(Data1=crv_21, Data2=crv_20)
Z_14 = UnitZ(Factor=Slider(2.7, range=0..5))
extr_14 = Extrude(Base=merge_7, Direction=Z_14)
boundary_8 = BoundarySurfaces(Edges=crv_21)

# ----
geo_3 = Geometry([cap_6, cap_5, extr_13, boundary_7, extr_14, boundary_8, extr_10, boundary_6])  # disabled
