# Grasshopper definition Growth_different_size_shops.gh (Grasshopper 1.0.7)
# plug-ins: Kangaroo2 Components

# ---- group: Square + Shops
crv = Curve(<curve referenced from the Rhino model>)
crv_2 = Curve([<curve referenced from the Rhino model> x8])
merge = Merge(Data1=crv, Data2=crv_2)
Z = UnitZ(Factor=Slider(3.5, range=0..5))
extr = Extrude(Base=merge, Direction=Z)

# ---- group: Fountain (Junction)
crv_3 = Curve(<curve referenced from the Rhino model>)
crv_4 = Curve(<curve referenced from the Rhino model>)
Z_2 = UnitZ(Factor=Slider(1.5, range=0..5))
Z_3 = UnitZ(Factor=Slider(0.3, range=0..5))
extr_2 = Extrude(Base=crv_3, Direction=Z_2)
extr_3 = Extrude(Base=crv_4, Direction=Z_3)
cap = CapHoles(Brep=extr_2)
cap_2 = CapHoles(Brep=extr_3)

# ---- group: Junction + Community
crv_5 = Curve([<curve referenced from the Rhino model> x3])
# Scenario 1
crv_6 = Curve(<curve referenced from the Rhino model>)
merge_2 = Merge(Data1=crv_6, Data2=crv_5)
Z_4 = UnitZ(Factor=Slider(5, range=0..5))
boundary = BoundarySurfaces(Edges=crv_6)
extr_4 = Extrude(Base=merge_2, Direction=Z_4)

# ---- group: Walkways + Shops
crv_7 = Curve([<curve referenced from the Rhino model> x8])
crv_8 = Curve([<curve referenced from the Rhino model> x4])
merge_3 = Merge(Data1=crv_8, Data2=crv_7)
Z_5 = UnitZ(Factor=Slider(2.7, range=0..5))
extr_5 = Extrude(Base=merge_3, Direction=Z_5)
boundary_2 = BoundarySurfaces(Edges=crv_8)

# ----
boundary_3 = BoundarySurfaces(Edges=crv)
geo = Geometry([cap_2, cap, extr_4, boundary, extr_5, boundary_2, extr, boundary_3])  # disabled

crv_9 = Curve(<curve referenced from the Rhino model>)

# ---- group: Fountain (Junction)
crv_10 = Curve(<curve referenced from the Rhino model>)
crv_11 = Curve(<curve referenced from the Rhino model>)
Z_6 = UnitZ(Factor=Slider(1.5, range=0..5))
Z_7 = UnitZ(Factor=Slider(0.3, range=0..5))
extr_6 = Extrude(Base=crv_10, Direction=Z_6)
extr_7 = Extrude(Base=crv_11, Direction=Z_7)
cap_3 = CapHoles(Brep=extr_6)
cap_4 = CapHoles(Brep=extr_7)

# ---- group: Junction + Community
# Scenario 2
crv_12 = Curve(<curve referenced from the Rhino model>)
Z_8 = UnitZ(Factor=Slider(5, range=0..5))
extr_8 = Extrude(Base=crv_12, Direction=Z_8)
boundary_4 = BoundarySurfaces(Edges=crv_12)

# ---- group: Walkways + Shops
crv_13 = Curve([<curve referenced from the Rhino model> x8])
crv_14 = Curve([<curve referenced from the Rhino model> x4])
merge_4 = Merge(Data1=crv_14, Data2=crv_13)
Z_9 = UnitZ(Factor=Slider(2.7, range=0..5))
extr_9 = Extrude(Base=merge_4, Direction=Z_9)
boundary_5 = BoundarySurfaces(Edges=crv_14)

# ----
boundary_6 = BoundarySurfaces(Edges=crv_9)
join = BrepJoin(Breps=boundary_6)  # -> Breps, Closed
crv_15 = Curve(<curve referenced from the Rhino model>)
srf = Surface(join.Breps)
boundary_7 = BoundarySurfaces(Edges=crv_15)
toggle = BooleanToggle(True)
debrep = DeconstructBrep(Brep=srf)  # -> Faces, Edges, Vertices
join_2 = BrepJoin(Breps=boundary_7)  # -> Breps, Closed
item = ListItem(List=debrep.Edges, Index=0, Wrap=True)  # -> Item, Item1, Item2, Item3
custom_mesh_settings = SettingsCustom(
    StitchSeams=toggle,
    SimplePlanes=False,
    Refine=toggle,
    MinCount="1600",
    MaxCount="1600",
    AspectRatio=20,
    MaxDistance=0,
    MaxAngle=20,
    MinEdge="0",
    MaxEdge="0")
crv_16 = Curve(<curve referenced from the Rhino model>)
relay = Relay([item.Item1, item.Item, item.Item2, item.Item3])
join_3 = JoinCurves(Curves=relay, Preserve=False)
srf_2 = Surface(join_2.Breps)
mesh = MeshBrep(Brep=srf, Settings=custom_mesh_settings)
boundary_8 = BoundarySurfaces(Edges=crv_16)
toggle_2 = BooleanToggle(True)
debrep_2 = DeconstructBrep(Brep=srf_2)  # -> Faces, Edges, Vertices

# ----
# Selfmade mesh
# Selfmade mesh
# Support
# Support
# Selfmade mesh
# Selfmade mesh
# Support
# Support
# Selfmade mesh
# Selfmade mesh
crv_17 = Curve(<curve referenced from the Rhino model>)
boundary_9 = BoundarySurfaces(Edges=crv_17)
crv_18 = Curve(<curve referenced from the Rhino model>)
join_4 = BrepJoin(Breps=boundary_9)  # -> Breps, Closed
boundary_10 = BoundarySurfaces(Edges=crv_18)
srf_3 = Surface(join_4.Breps)
join_5 = BrepJoin(Breps=boundary_10)  # -> Breps, Closed
toggle_3 = BooleanToggle(True)
debrep_3 = DeconstructBrep(Brep=srf_3)  # -> Faces, Edges, Vertices
srf_4 = Surface(join_5.Breps)
item_2 = ListItem(List=debrep_3.Edges, Index=0, Wrap=True)  # -> Item, Item1, Item2, Item3
custom_mesh_settings_2 = SettingsCustom(
    StitchSeams=toggle_3,
    SimplePlanes=False,
    Refine=toggle_3,
    MinCount="1600",
    MaxCount="1600",
    AspectRatio=20,
    MaxDistance=0,
    MaxAngle=20,
    MinEdge="0",
    MaxEdge="0")
toggle_4 = BooleanToggle(True)
debrep_4 = DeconstructBrep(Brep=srf_4)  # -> Faces, Edges, Vertices
relay_2 = Relay([item_2.Item1, item_2.Item, item_2.Item2, item_2.Item3])
join_6 = JoinCurves(Curves=relay_2, Preserve=False)
mesh_2 = MeshBrep(Brep=srf_3, Settings=custom_mesh_settings_2)
item_3 = ListItem(List=debrep_4.Edges, Index=0, Wrap=True)  # -> Item, Item1, Item2, Item3
custom_mesh_settings_3 = SettingsCustom(
    StitchSeams=toggle_4,
    SimplePlanes=False,
    Refine=toggle_4,
    MinCount="1600",
    MaxCount="1600",
    AspectRatio=20,
    MaxDistance=0,
    MaxAngle=20,
    MinEdge="0",
    MaxEdge="0")
relay_3 = Relay([item_3.Item1, item_3.Item, item_3.Item2, item_3.Item3])
join_7 = JoinCurves(Curves=relay_3, Preserve=False)
mesh_3 = MeshBrep(Brep=srf_4, Settings=custom_mesh_settings_3)
density = Slider(20, range=0..100)
mesh_plane = MeshPlane(Boundary={Plane=PlaneXY(0, 0, 0), Size=Domain2(u=-10..10, v=-10..10)}, WidthCount=density, HeightCount=density)  # -> Mesh, Area
density_2 = Slider(20, range=0..100)
force = Slider(0.71, range=0.1..5)
mesh_edges = MeshEdges(Mesh=mesh_2)  # -> NakedEdges, InteriorEdges, NonManifoldEdges
deconstruct_mesh = DeconstructMesh(Mesh=mesh_2)  # -> Vertices, Faces, Colours, Normals
mesh_plane_2 = MeshPlane(Boundary={Plane=PlaneXY(0, 0, 0), Size=Domain2(u=-10..10, v=-10..10)}, WidthCount=density_2, HeightCount=density_2)  # -> Mesh, Area
mesh_4 = Mesh(mesh_2)
meshcorners = MeshCorners(Mesh=mesh_4, Angle=2.35619449)
negative = Negative(Value=force)
force_2 = Slider(0.5, range=0.1..5)
mesh_edges_2 = MeshEdges(Mesh=mesh_3)  # -> NakedEdges, InteriorEdges, NonManifoldEdges
deconstruct_mesh_2 = DeconstructMesh(Mesh=mesh_3)  # -> Vertices, Faces, Colours, Normals
curve = Curve(mesh_edges.NakedEdges)
curve_2 = Curve(mesh_edges.InteriorEdges)
point = Point(deconstruct_mesh.Vertices)
crv_cp = CurveClosestPoint(Point=point, Curve=join_6)  # -> Point, Parameter, Distance
mesh_5 = Mesh(mesh_3)
unit_z = UnitZ(Factor=force)
reposition_support = Slider(0, range=0..10)
meshcorners_2 = MeshCorners(Mesh=mesh_5, Angle=2.35619449)
negative_2 = Negative(Value=force_2)
eval = Evaluate(F="If(x<0.1, 1, 0)", x=crv_cp.Distance)
list_item = ListItem(List=meshcorners, Index=0, Wrap=True)  # -> Item, Item1, Item2, Item3
curve_3 = Curve(mesh_edges_2.NakedEdges)
curve_4 = Curve(mesh_edges_2.InteriorEdges)
point_2 = Point(deconstruct_mesh_2.Vertices)
cull = CullPattern(List=point, CullPattern=eval)
crv_cp_2 = CurveClosestPoint(Point=point_2, Curve=join_7)  # -> Point, Parameter, Distance
unit_z_2 = UnitZ(Factor=force_2)
point_3 = Point(list_item.Item)
point_4 = Point(list_item.Item1)
point_5 = Point(list_item.Item2)
point_6 = Point(list_item.Item3)
reposition_support_2 = Slider(0, range=0..10)
strength_external = Slider(29.9, range=5..40)
fixed_length = Panel("0")
strength_internal = Slider(14.6, range=5..20)
unit_z_3 = UnitZ(Factor=reposition_support)
eval_2 = Evaluate(F="If(x<0.1, 1, 0)", x=crv_cp_2.Distance)
list_item_2 = ListItem(List=meshcorners_2, Index=0, Wrap=True)  # -> Item, Item1, Item2, Item3
cull_2 = CullPattern(List=point_2, CullPattern=eval_2)
point_7 = Point(list_item_2.Item)
point_8 = Point(list_item_2.Item1)
point_9 = Point(list_item_2.Item2)
point_10 = Point(list_item_2.Item3)
move = Move(Geometry=point_3, Motion=unit_z_3)  # -> Geometry, Transform
move_2 = Move(Geometry=point_5, Motion=unit_z_3)  # -> Geometry, Transform
strength_external_2 = Slider(29.9, range=5..40)
fixed_length_2 = Panel("0")
strength_internal_2 = Slider(14.6, range=5..20)
unit_z_4 = UnitZ(Factor=reposition_support_2)
move_3 = Move(Geometry=point_7, Motion=unit_z_4)  # -> Geometry, Transform
move_4 = Move(Geometry=point_9, Motion=unit_z_4)  # -> Geometry, Transform
merge_5 = Merge(Data1=move.Geometry, Data2=point_4, Data3=move_2.Geometry, Data4=point_6)
merge_6 = Merge(Data1=meshcorners, Data2=cull)
merge_7 = Merge(Data1=move_3.Geometry, Data2=point_8, Data3=move_4.Geometry, Data4=point_10)
mesh_point = Point(deconstruct_mesh.Vertices)
point_11 = Point(point_3)
point_12 = Point(point_5)
point_13 = Point(move.Geometry)
point_14 = Point(move_2.Geometry)
line = Line(StartPoint=point_11, EndPoint=point_12)
length_line = LengthLine(Line=curve, Length=fixed_length, Strength=strength_external)
load = Load(Point=point, ForceVector=unit_z, Weighting=1)
anchor = Anchor(Point=merge_6, Target=merge_6, Strength=10000)
length_line_2 = LengthLine(Line=curve_2, Length=fixed_length, Strength=strength_internal)
distance = Distance(PointA=point_13, PointB=point_14)
merge_8 = Merge(Data1=meshcorners_2, Data2=cull_2)
mesh_point_2 = Point(deconstruct_mesh_2.Vertices)
point_15 = Point(point_7)
point_16 = Point(point_9)
point_17 = Point(move_3.Geometry)
point_18 = Point(move_4.Geometry)
unit_z_5 = UnitZ(Factor=1)
line_2 = Line(StartPoint=point_15, EndPoint=point_16)
multiplication = Multiplication(A=distance, B=Slider(1.49, range=1..2))
length_line_3 = LengthLine(Line=curve_3, Length=fixed_length_2, Strength=strength_external_2)
load_2 = Load(Point=point_2, ForceVector=unit_z_2, Weighting=1)
anchor_2 = Anchor(Point=merge_8, Target=merge_8, Strength=10000)
length_line_4 = LengthLine(Line=curve_4, Length=fixed_length_2, Strength=strength_internal_2)
distance_2 = Distance(PointA=point_17, PointB=point_18)
show = Show(G=mesh_4)
catenary = Catenary(PointA=point_13, PointB=point_14, Length=multiplication, Gravity=unit_z_5)
unit_z_6 = UnitZ(Factor=1)
curve_closest_point = CurveClosestPoint(Point=mesh_point, Curve=line)  # -> Point, Parameter, Distance
multiplication_2 = Multiplication(A=distance_2, B=Slider(1.49, range=1..2))
show_2 = Show(G=mesh_5)
reset_button = Button()
activate = BooleanToggle(True)
entwine = Entwine(Branch00=show, Branch01=anchor, Branch02=length_line, Branch03=length_line_2, Branch04=load, FlattenInputs=True)
catenary_2 = Catenary(PointA=point_17, PointB=point_18, Length=multiplication_2, Gravity=unit_z_6)
curve_closest_point_2 = CurveClosestPoint(Point=mesh_point_2, Curve=line_2)  # -> Point, Parameter, Distance
larger_than = LargerThan(FirstNumber=curve_closest_point.Distance, SecondNumber="0.1")  # -> LargerThan, OrEqualTo
dispatch = Dispatch(List=mesh_point, DispatchPattern=larger_than.LargerThan)  # -> ListA, ListB
reset_button_2 = Button()
activate_2 = BooleanToggle(True)
solver = Solver(GoalObjects=flatten(entwine), Reset=reset_button, Threshold=1e-15, Tolerance=0.01, On=activate)  # -> I, V, O
entwine_2 = Entwine(Branch00=show_2, Branch01=anchor_2, Branch02=length_line_3, Branch03=length_line_4, Branch04=load_2, FlattenInputs=True)
point_19 = Point(dispatch.ListB)
point_20 = Point(dispatch.ListA)
larger_than_2 = LargerThan(FirstNumber=curve_closest_point_2.Distance, SecondNumber="0.1")  # -> LargerThan, OrEqualTo
dispatch_2 = Dispatch(List=mesh_point_2, DispatchPattern=larger_than_2.LargerThan)  # -> ListA, ListB
solver_2 = Solver(GoalObjects=flatten(entwine_2), Reset=reset_button_2, Threshold=1e-15, Tolerance=0.01, On=activate_2)  # -> I, V, O
point_21 = Point(dispatch_2.ListB)
point_22 = Point(dispatch_2.ListA)
oncurve = OnCurve(Points=point_19, Curve=catenary, Strength=Slider(50, range=1..50))
oncurve_2 = OnCurve(Points=point_21, Curve=catenary_2, Strength=Slider(50, range=1..50))
list_item_3 = ListItem(List=solver.O, Index=0, Wrap=True)
list_item_4 = ListItem(List=solver_2.O, Index=0, Wrap=True)
crv_19 = Curve(<curve referenced from the Rhino model>)
boundary_11 = BoundarySurfaces(Edges=crv_19)
crv_20 = Curve(<curve referenced from the Rhino model>)
join_8 = BrepJoin(Breps=boundary_11)  # -> Breps, Closed
boundary_12 = BoundarySurfaces(Edges=crv_20)
srf_5 = Surface(join_8.Breps)
toggle_5 = BooleanToggle(True)
debrep_5 = DeconstructBrep(Brep=srf_5)  # -> Faces, Edges, Vertices
join_9 = BrepJoin(Breps=boundary_12)  # -> Breps, Closed
crv_21 = Curve(<curve referenced from the Rhino model>)
item_4 = ListItem(List=debrep_5.Edges, Index=0, Wrap=True)  # -> Item, Item1, Item2, Item3
custom_mesh_settings_4 = SettingsCustom(
    StitchSeams=toggle_5,
    SimplePlanes=False,
    Refine=toggle_5,
    MinCount="1600",
    MaxCount="1600",
    AspectRatio=20,
    MaxDistance=0,
    MaxAngle=20,
    MinEdge="0",
    MaxEdge="0")
srf_6 = Surface(join_9.Breps)
boundary_13 = BoundarySurfaces(Edges=crv_21)
relay_4 = Relay([item_4.Item1, item_4.Item, item_4.Item2, item_4.Item3])
join_10 = JoinCurves(Curves=relay_4, Preserve=False)
toggle_6 = BooleanToggle(True)
debrep_6 = DeconstructBrep(Brep=srf_6)  # -> Faces, Edges, Vertices
mesh_6 = MeshBrep(Brep=srf_5, Settings=custom_mesh_settings_4)
join_11 = BrepJoin(Breps=boundary_13)  # -> Breps, Closed
item_5 = ListItem(List=debrep_6.Edges, Index=0, Wrap=True)  # -> Item, Item1, Item2, Item3
custom_mesh_settings_5 = SettingsCustom(
    StitchSeams=toggle_6,
    SimplePlanes=False,
    Refine=toggle_6,
    MinCount="1600",
    MaxCount="1600",
    AspectRatio=20,
    MaxDistance=0,
    MaxAngle=20,
    MinEdge="0",
    MaxEdge="0")
crv_22 = Curve(<curve referenced from the Rhino model>)
relay_5 = Relay([item_5.Item1, item_5.Item, item_5.Item2, item_5.Item3])
join_12 = JoinCurves(Curves=relay_5, Preserve=False)
srf_7 = Surface(join_11.Breps)
mesh_7 = MeshBrep(Brep=srf_6, Settings=custom_mesh_settings_5)
boundary_14 = BoundarySurfaces(Edges=crv_22)
toggle_7 = BooleanToggle(True)
debrep_7 = DeconstructBrep(Brep=srf_7)  # -> Faces, Edges, Vertices
join_13 = BrepJoin(Breps=boundary_14)  # -> Breps, Closed
item_6 = ListItem(List=debrep_7.Edges, Index=0, Wrap=True)  # -> Item, Item1, Item2, Item3
custom_mesh_settings_6 = SettingsCustom(
    StitchSeams=toggle_7,
    SimplePlanes=False,
    Refine=toggle_7,
    MinCount="1600",
    MaxCount="1600",
    AspectRatio=20,
    MaxDistance=0,
    MaxAngle=20,
    MinEdge="0",
    MaxEdge="0")
srf_8 = Surface(join_13.Breps)
relay_6 = Relay([item_6.Item1, item_6.Item, item_6.Item2, item_6.Item3])
join_14 = JoinCurves(Curves=relay_6, Preserve=False)
mesh_8 = MeshBrep(Brep=srf_7, Settings=custom_mesh_settings_6)
density_3 = Slider(20, range=0..100)
toggle_8 = BooleanToggle(True)
debrep_8 = DeconstructBrep(Brep=srf_8)  # -> Faces, Edges, Vertices
item_7 = ListItem(List=debrep_8.Edges, Index=0, Wrap=True)  # -> Item, Item1, Item2, Item3
custom_mesh_settings_7 = SettingsCustom(
    StitchSeams=toggle_8,
    SimplePlanes=False,
    Refine=toggle_8,
    MinCount="1600",
    MaxCount="1600",
    AspectRatio=20,
    MaxDistance=0,
    MaxAngle=20,
    MinEdge="0",
    MaxEdge="0")
mesh_plane_3 = MeshPlane(Boundary={Plane=PlaneXY(0, 0, 0), Size=Domain2(u=-10..10, v=-10..10)}, WidthCount=density_3, HeightCount=density_3)  # -> Mesh, Area
relay_7 = Relay([item_7.Item1, item_7.Item, item_7.Item2, item_7.Item3])
join_15 = JoinCurves(Curves=relay_7, Preserve=False)
density_4 = Slider(20, range=0..100)
mesh_9 = MeshBrep(Brep=srf_8, Settings=custom_mesh_settings_7)
force_3 = Slider(0.3, range=0.1..5)
mesh_edges_3 = MeshEdges(Mesh=mesh_6)  # -> NakedEdges, InteriorEdges, NonManifoldEdges
deconstruct_mesh_3 = DeconstructMesh(Mesh=mesh_6)  # -> Vertices, Faces, Colours, Normals
mesh_10 = Mesh(mesh_6)
mesh_plane_4 = MeshPlane(Boundary={Plane=PlaneXY(0, 0, 0), Size=Domain2(u=-10..10, v=-10..10)}, WidthCount=density_4, HeightCount=density_4)  # -> Mesh, Area
meshcorners_3 = MeshCorners(Mesh=mesh_10, Angle=2.35619449)
negative_3 = Negative(Value=force_3)
curve_5 = Curve(mesh_edges_3.NakedEdges)
curve_6 = Curve(mesh_edges_3.InteriorEdges)
point_23 = Point(deconstruct_mesh_3.Vertices)
density_5 = Slider(20, range=0..100)
force_4 = Slider(0.3, range=0.1..5)
crv_cp_3 = CurveClosestPoint(Point=point_23, Curve=join_10)  # -> Point, Parameter, Distance
mesh_edges_4 = MeshEdges(Mesh=mesh_7)  # -> NakedEdges, InteriorEdges, NonManifoldEdges
deconstruct_mesh_4 = DeconstructMesh(Mesh=mesh_7)  # -> Vertices, Faces, Colours, Normals
unit_z_7 = UnitZ(Factor=force_3)
mesh_11 = Mesh(mesh_7)
reposition_support_3 = Slider(0, range=0..10)
eval_3 = Evaluate(F="If(x<0.1, 1, 0)", x=crv_cp_3.Distance)
list_item_5 = ListItem(List=meshcorners_3, Index=0, Wrap=True)  # -> Item, Item1, Item2, Item3
mesh_plane_5 = MeshPlane(Boundary={Plane=PlaneXY(0, 0, 0), Size=Domain2(u=-10..10, v=-10..10)}, WidthCount=density_5, HeightCount=density_5)  # -> Mesh, Area
# Support
cull_3 = CullPattern(List=point_23, CullPattern=eval_3)
meshcorners_4 = MeshCorners(Mesh=mesh_11, Angle=2.35619449)
negative_4 = Negative(Value=force_4)
curve_7 = Curve(mesh_edges_4.NakedEdges)
curve_8 = Curve(mesh_edges_4.InteriorEdges)
point_24 = Point(deconstruct_mesh_4.Vertices)
crv_cp_4 = CurveClosestPoint(Point=point_24, Curve=join_12)  # -> Point, Parameter, Distance
point_25 = Point(list_item_5.Item)
point_26 = Point(list_item_5.Item1)
point_27 = Point(list_item_5.Item2)
point_28 = Point(list_item_5.Item3)
density_6 = Slider(20, range=0..100)
unit_z_8 = UnitZ(Factor=force_4)
strength_external_3 = Slider(29.9, range=5..40)
fixed_length_3 = Panel("0")
strength_internal_3 = Slider(14.6, range=5..20)
force_5 = Slider(0.3, range=0.1..5)
unit_z_9 = UnitZ(Factor=reposition_support_3)
mesh_edges_5 = MeshEdges(Mesh=mesh_8)  # -> NakedEdges, InteriorEdges, NonManifoldEdges
deconstruct_mesh_5 = DeconstructMesh(Mesh=mesh_8)  # -> Vertices, Faces, Colours, Normals
reposition_support_4 = Slider(0, range=0..10)
mesh_12 = Mesh(mesh_8)
eval_4 = Evaluate(F="If(x<0.1, 1, 0)", x=crv_cp_4.Distance)
list_item_6 = ListItem(List=meshcorners_4, Index=0, Wrap=True)  # -> Item, Item1, Item2, Item3
# Support
cull_4 = CullPattern(List=point_24, CullPattern=eval_4)
mesh_plane_6 = MeshPlane(Boundary={Plane=PlaneXY(0, 0, 0), Size=Domain2(u=-10..10, v=-10..10)}, WidthCount=density_6, HeightCount=density_6)  # -> Mesh, Area
move_5 = Move(Geometry=point_25, Motion=unit_z_9)  # -> Geometry, Transform
move_6 = Move(Geometry=point_27, Motion=unit_z_9)  # -> Geometry, Transform
meshcorners_5 = MeshCorners(Mesh=mesh_12, Angle=2.35619449)
point_29 = Point(list_item_6.Item)
point_30 = Point(list_item_6.Item2)
point_31 = Point(list_item_6.Item3)
negative_5 = Negative(Value=force_5)
point_32 = Point(list_item_6.Item1)
curve_9 = Curve(mesh_edges_5.NakedEdges)
curve_10 = Curve(mesh_edges_5.InteriorEdges)
point_33 = Point(deconstruct_mesh_5.Vertices)
strength_external_4 = Slider(29.9, range=5..40)
fixed_length_4 = Panel("0")
strength_internal_4 = Slider(14.6, range=5..20)
crv_cp_5 = CurveClosestPoint(Point=point_33, Curve=join_14)  # -> Point, Parameter, Distance
unit_z_10 = UnitZ(Factor=reposition_support_4)
force_6 = Slider(0.3, range=0.1..5)
unit_z_11 = UnitZ(Factor=force_5)
mesh_edges_6 = MeshEdges(Mesh=mesh_9)  # -> NakedEdges, InteriorEdges, NonManifoldEdges
deconstruct_mesh_6 = DeconstructMesh(Mesh=mesh_9)  # -> Vertices, Faces, Colours, Normals
reposition_support_5 = Slider(0, range=0..10)
mesh_13 = Mesh(mesh_9)
move_7 = Move(Geometry=point_29, Motion=unit_z_10)  # -> Geometry, Transform
move_8 = Move(Geometry=point_30, Motion=unit_z_10)  # -> Geometry, Transform
eval_5 = Evaluate(F="If(x<0.1, 1, 0)", x=crv_cp_5.Distance)
list_item_7 = ListItem(List=meshcorners_5, Index=0, Wrap=True)  # -> Item, Item1, Item2, Item3
merge_9 = Merge(Data1=move_5.Geometry, Data2=point_26, Data3=move_6.Geometry, Data4=point_28)
# Support
cull_5 = CullPattern(List=point_33, CullPattern=eval_5)
meshcorners_6 = MeshCorners(Mesh=mesh_13, Angle=2.35619449)
negative_6 = Negative(Value=force_6)
curve_11 = Curve(mesh_edges_6.NakedEdges)
curve_12 = Curve(mesh_edges_6.InteriorEdges)
point_34 = Point(deconstruct_mesh_6.Vertices)
point_35 = Point(list_item_7.Item)
point_36 = Point(list_item_7.Item2)
point_37 = Point(list_item_7.Item3)
point_38 = Point(list_item_7.Item1)
merge_10 = Merge(Data1=meshcorners_3, Data2=cull_3)
crv_cp_6 = CurveClosestPoint(Point=point_34, Curve=join_15)  # -> Point, Parameter, Distance
strength_external_5 = Slider(29.9, range=5..40)
fixed_length_5 = Panel("0")
strength_internal_5 = Slider(14.6, range=5..20)
unit_z_12 = UnitZ(Factor=reposition_support_5)
unit_z_13 = UnitZ(Factor=force_6)
mesh_point_3 = Point(deconstruct_mesh_3.Vertices)
point_39 = Point(point_25)
point_40 = Point(point_27)
point_41 = Point(move_5.Geometry)
point_42 = Point(move_6.Geometry)
reposition_support_6 = Slider(0, range=0..10)
merge_11 = Merge(Data1=move_7.Geometry, Data2=point_32, Data3=move_8.Geometry, Data4=point_31)
eval_6 = Evaluate(F="If(x<0.1, 1, 0)", x=crv_cp_6.Distance)
list_item_8 = ListItem(List=meshcorners_6, Index=0, Wrap=True)  # -> Item, Item1, Item2, Item3
line_3 = Line(StartPoint=point_39, EndPoint=point_40)
move_9 = Move(Geometry=point_35, Motion=unit_z_12)  # -> Geometry, Transform
length_line_5 = LengthLine(Line=curve_5, Length=fixed_length_3, Strength=strength_external_3)
load_3 = Load(Point=point_23, ForceVector=unit_z_7, Weighting=1)
anchor_3 = Anchor(Point=merge_10, Target=merge_10, Strength=10000)
# Support
cull_6 = CullPattern(List=point_34, CullPattern=eval_6)
length_line_6 = LengthLine(Line=curve_6, Length=fixed_length_3, Strength=strength_internal_3)
move_10 = Move(Geometry=point_36, Motion=unit_z_12)  # -> Geometry, Transform
distance_3 = Distance(PointA=point_41, PointB=point_42)
merge_12 = Merge(Data1=meshcorners_4, Data2=cull_4)
point_43 = Point(list_item_8.Item)
point_44 = Point(list_item_8.Item2)
point_45 = Point(list_item_8.Item3)
point_46 = Point(list_item_8.Item1)
strength_external_6 = Slider(29.9, range=5..40)
fixed_length_6 = Panel("0")
strength_internal_6 = Slider(14.6, range=5..20)
unit_z_14 = UnitZ(Factor=1)
mesh_point_4 = Point(deconstruct_mesh_4.Vertices)
point_47 = Point(point_29)
point_48 = Point(point_30)
unit_z_15 = UnitZ(Factor=reposition_support_6)
point_49 = Point(move_7.Geometry)
point_50 = Point(move_8.Geometry)
multiplication_3 = Multiplication(A=distance_3, B=Slider(1.49, range=1..2))
show_3 = Show(G=mesh_10)
line_4 = Line(StartPoint=point_47, EndPoint=point_48)
length_line_7 = LengthLine(Line=curve_7, Length=fixed_length_4, Strength=strength_external_4)
load_4 = Load(Point=point_24, ForceVector=unit_z_8, Weighting=1)
anchor_4 = Anchor(Point=merge_12, Target=merge_12, Strength=10000)
length_line_8 = LengthLine(Line=curve_8, Length=fixed_length_4, Strength=strength_internal_4)
distance_4 = Distance(PointA=point_49, PointB=point_50)
merge_13 = Merge(Data1=move_9.Geometry, Data2=point_38, Data3=move_10.Geometry, Data4=point_37)
move_11 = Move(Geometry=point_43, Motion=unit_z_15)  # -> Geometry, Transform
catenary_3 = Catenary(PointA=point_41, PointB=point_42, Length=multiplication_3, Gravity=unit_z_14)
move_12 = Move(Geometry=point_44, Motion=unit_z_15)  # -> Geometry, Transform
curve_closest_point_3 = CurveClosestPoint(Point=mesh_point_3, Curve=line_3)  # -> Point, Parameter, Distance
unit_z_16 = UnitZ(Factor=1)
merge_14 = Merge(Data1=meshcorners_5, Data2=cull_5)
multiplication_4 = Multiplication(A=distance_4, B=Slider(1.49, range=1..2))
reset_button_3 = Button()
activate_3 = BooleanToggle(True)
show_4 = Show(G=mesh_11)
entwine_3 = Entwine(Branch00=show_3, Branch01=anchor_3, Branch02=length_line_5, Branch03=length_line_6, Branch04=load_3, FlattenInputs=True)
mesh_point_5 = Point(deconstruct_mesh_5.Vertices)
point_51 = Point(point_35)
point_52 = Point(point_36)
point_53 = Point(move_9.Geometry)
point_54 = Point(move_10.Geometry)
catenary_4 = Catenary(PointA=point_49, PointB=point_50, Length=multiplication_4, Gravity=unit_z_16)
merge_15 = Merge(Data1=move_11.Geometry, Data2=point_46, Data3=move_12.Geometry, Data4=point_45)
line_5 = Line(StartPoint=point_51, EndPoint=point_52)
length_line_9 = LengthLine(Line=curve_9, Length=fixed_length_5, Strength=strength_external_5)
load_5 = Load(Point=point_33, ForceVector=unit_z_11, Weighting=1)
anchor_5 = Anchor(Point=merge_14, Target=merge_14, Strength=10000)
larger_than_3 = LargerThan(FirstNumber=curve_closest_point_3.Distance, SecondNumber="0.1")  # -> LargerThan, OrEqualTo
dispatch_3 = Dispatch(List=mesh_point_3, DispatchPattern=larger_than_3.LargerThan)  # -> ListA, ListB
length_line_10 = LengthLine(Line=curve_10, Length=fixed_length_5, Strength=strength_internal_5)
distance_5 = Distance(PointA=point_53, PointB=point_54)
curve_closest_point_4 = CurveClosestPoint(Point=mesh_point_4, Curve=line_4)  # -> Point, Parameter, Distance
solver_3 = Solver(GoalObjects=flatten(entwine_3), Reset=reset_button_3, Threshold=1e-15, Tolerance=0.01, On=activate_3)  # -> I, V, O
reset_button_4 = Button()
activate_4 = BooleanToggle(True)
merge_16 = Merge(Data1=meshcorners_6, Data2=cull_6)
unit_z_17 = UnitZ(Factor=1)
entwine_4 = Entwine(Branch00=show_4, Branch01=anchor_4, Branch02=length_line_7, Branch03=length_line_8, Branch04=load_4, FlattenInputs=True)
point_55 = Point(dispatch_3.ListB)
point_56 = Point(dispatch_3.ListA)
multiplication_5 = Multiplication(A=distance_5, B=Slider(1.49, range=1..2))
mesh_point_6 = Point(deconstruct_mesh_6.Vertices)
point_57 = Point(point_43)
point_58 = Point(point_44)
point_59 = Point(move_11.Geometry)
point_60 = Point(move_12.Geometry)
show_5 = Show(G=mesh_12)
larger_than_4 = LargerThan(FirstNumber=curve_closest_point_4.Distance, SecondNumber="0.1")  # -> LargerThan, OrEqualTo
dispatch_4 = Dispatch(List=mesh_point_4, DispatchPattern=larger_than_4.LargerThan)  # -> ListA, ListB
line_6 = Line(StartPoint=point_57, EndPoint=point_58)
length_line_11 = LengthLine(Line=curve_11, Length=fixed_length_6, Strength=strength_external_6)
load_6 = Load(Point=point_34, ForceVector=unit_z_13, Weighting=1)
anchor_6 = Anchor(Point=merge_16, Target=merge_16, Strength=10000)
catenary_5 = Catenary(PointA=point_53, PointB=point_54, Length=multiplication_5, Gravity=unit_z_17)
length_line_12 = LengthLine(Line=curve_12, Length=fixed_length_6, Strength=strength_internal_6)
distance_6 = Distance(PointA=point_59, PointB=point_60)
solver_4 = Solver(GoalObjects=flatten(entwine_4), Reset=reset_button_4, Threshold=1e-15, Tolerance=0.01, On=activate_4)  # -> I, V, O
curve_closest_point_5 = CurveClosestPoint(Point=mesh_point_5, Curve=line_5)  # -> Point, Parameter, Distance
oncurve_3 = OnCurve(Points=point_55, Curve=catenary_3, Strength=Slider(50, range=1..50))
point_61 = Point(dispatch_4.ListB)
point_62 = Point(dispatch_4.ListA)
unit_z_18 = UnitZ(Factor=1)
reset_button_5 = Button()
activate_5 = BooleanToggle(True)
entwine_5 = Entwine(Branch00=show_5, Branch01=anchor_5, Branch02=length_line_9, Branch03=length_line_10, Branch04=load_5, FlattenInputs=True)
multiplication_6 = Multiplication(A=distance_6, B=Slider(1.49, range=1..2))
show_6 = Show(G=mesh_13)
larger_than_5 = LargerThan(FirstNumber=curve_closest_point_5.Distance, SecondNumber="0.1")  # -> LargerThan, OrEqualTo
dispatch_5 = Dispatch(List=mesh_point_5, DispatchPattern=larger_than_5.LargerThan)  # -> ListA, ListB
catenary_6 = Catenary(PointA=point_59, PointB=point_60, Length=multiplication_6, Gravity=unit_z_18)
oncurve_4 = OnCurve(Points=point_61, Curve=catenary_4, Strength=Slider(50, range=1..50))
solver_5 = Solver(GoalObjects=flatten(entwine_5), Reset=reset_button_5, Threshold=1e-15, Tolerance=0.01, On=activate_5)  # -> I, V, O
curve_closest_point_6 = CurveClosestPoint(Point=mesh_point_6, Curve=line_6)  # -> Point, Parameter, Distance
reset_button_6 = Button()
activate_6 = BooleanToggle(True)
point_63 = Point(dispatch_5.ListB)
point_64 = Point(dispatch_5.ListA)
entwine_6 = Entwine(
    Branch00=show_6,
    Branch01=anchor_6,
    Branch02=length_line_11,
    Branch03=length_line_12,
    Branch04=load_6,
    FlattenInputs=True)
larger_than_6 = LargerThan(FirstNumber=curve_closest_point_6.Distance, SecondNumber="0.1")  # -> LargerThan, OrEqualTo
dispatch_6 = Dispatch(List=mesh_point_6, DispatchPattern=larger_than_6.LargerThan)  # -> ListA, ListB
list_item_9 = ListItem(List=solver_3.O, Index=0, Wrap=True)
solver_6 = Solver(GoalObjects=flatten(entwine_6), Reset=reset_button_6, Threshold=1e-15, Tolerance=0.01, On=activate_6)  # -> I, V, O
oncurve_5 = OnCurve(Points=point_63, Curve=catenary_5, Strength=Slider(50, range=1..50))
point_65 = Point(dispatch_6.ListB)
point_66 = Point(dispatch_6.ListA)
list_item_10 = ListItem(List=solver_4.O, Index=0, Wrap=True)
oncurve_6 = OnCurve(Points=point_65, Curve=catenary_6, Strength=Slider(50, range=1..50))
list_item_11 = ListItem(List=solver_5.O, Index=0, Wrap=True)
list_item_12 = ListItem(List=solver_6.O, Index=0, Wrap=True)

join_16 = BrepJoin(Breps=boundary_8)  # -> Breps, Closed
item_8 = ListItem(List=debrep_2.Edges, Index=0, Wrap=True)  # -> Item, Item1, Item2, Item3
custom_mesh_settings_8 = SettingsCustom(
    StitchSeams=toggle_2,
    SimplePlanes=False,
    Refine=toggle_2,
    MinCount="1600",
    MaxCount="1600",
    AspectRatio=20,
    MaxDistance=0,
    MaxAngle=20,
    MinEdge="0",
    MaxEdge="0")
crv_23 = Curve(<curve referenced from the Rhino model>)
relay_8 = Relay([item_8.Item1, item_8.Item, item_8.Item2, item_8.Item3])
join_17 = JoinCurves(Curves=relay_8, Preserve=False)
srf_9 = Surface(join_16.Breps)

geo_2 = Geometry([cap_4, cap_3, extr_8, boundary_4, extr_9, boundary_5])  # disabled

mesh_14 = MeshBrep(Brep=srf_2, Settings=custom_mesh_settings_8)
boundary_15 = BoundarySurfaces(Edges=crv_23)
toggle_9 = BooleanToggle(True)
debrep_9 = DeconstructBrep(Brep=srf_9)  # -> Faces, Edges, Vertices
item_9 = ListItem(List=debrep_9.Edges, Index=0, Wrap=True)  # -> Item, Item1, Item2, Item3
custom_mesh_settings_9 = SettingsCustom(
    StitchSeams=toggle_9,
    SimplePlanes=False,
    Refine=toggle_9,
    MinCount="1600",
    MaxCount="1600",
    AspectRatio=20,
    MaxDistance=0,
    MaxAngle=20,
    MinEdge="0",
    MaxEdge="0")
join_18 = BrepJoin(Breps=boundary_15)  # -> Breps, Closed
density_7 = Slider(20, range=0..100)
relay_9 = Relay([item_9.Item1, item_9.Item, item_9.Item2, item_9.Item3])
join_19 = JoinCurves(Curves=relay_9, Preserve=False)
srf_10 = Surface(join_18.Breps)
mesh_15 = MeshBrep(Brep=srf_9, Settings=custom_mesh_settings_9)
toggle_10 = BooleanToggle(True)
debrep_10 = DeconstructBrep(Brep=srf_10)  # -> Faces, Edges, Vertices
mesh_plane_7 = MeshPlane(Boundary={Plane=PlaneXY(0, 0, 0), Size=Domain2(u=-10..10, v=-10..10)}, WidthCount=density_7, HeightCount=density_7)  # -> Mesh, Area
item_10 = ListItem(List=debrep_10.Edges, Index=0, Wrap=True)  # -> Item, Item1, Item2, Item3
custom_mesh_settings_10 = SettingsCustom(
    StitchSeams=toggle_10,
    SimplePlanes=False,
    Refine=toggle_10,
    MinCount="1600",
    MaxCount="1600",
    AspectRatio=20,
    MaxDistance=0,
    MaxAngle=20,
    MinEdge="0",
    MaxEdge="0")
force_7 = Slider(0.15, range=0.1..5)
density_8 = Slider(20, range=0..100)
mesh_edges_7 = MeshEdges(Mesh=mesh)  # -> NakedEdges, InteriorEdges, NonManifoldEdges
deconstruct_mesh_7 = DeconstructMesh(Mesh=mesh)  # -> Vertices, Faces, Colours, Normals
relay_10 = Relay([item_10.Item1, item_10.Item, item_10.Item2, item_10.Item3])
join_20 = JoinCurves(Curves=relay_10, Preserve=False)
mesh_16 = Mesh(mesh)
mesh_17 = MeshBrep(Brep=srf_10, Settings=custom_mesh_settings_10)
mesh_plane_8 = MeshPlane(Boundary={Plane=PlaneXY(0, 0, 0), Size=Domain2(u=-10..10, v=-10..10)}, WidthCount=density_8, HeightCount=density_8)  # -> Mesh, Area
# Selfmade mesh
meshcorners_7 = MeshCorners(Mesh=mesh_16, Angle=2.35619449)

# ---- group: Hanging
negative_7 = Negative(Value=force_7)

# ----
# Support
curve_13 = Curve(mesh_edges_7.NakedEdges)
curve_14 = Curve(mesh_edges_7.InteriorEdges)
point_67 = Point(deconstruct_mesh_7.Vertices)
crv_cp_7 = CurveClosestPoint(Point=point_67, Curve=join_3)  # -> Point, Parameter, Distance

# ---- group: Standing
unit_z_19 = UnitZ(Factor=force_7)

# ----
density_9 = Slider(20, range=0..100)
mesh_edges_8 = MeshEdges(Mesh=mesh_14)  # -> NakedEdges, InteriorEdges, NonManifoldEdges
deconstruct_mesh_8 = DeconstructMesh(Mesh=mesh_14)  # -> Vertices, Faces, Colours, Normals

# ----
# Support
reposition_support_7 = Slider(0, range=0..10)
list_item_13 = ListItem(List=meshcorners_7, Index=0, Wrap=True)  # -> Item, Item1, Item2, Item3
point_68 = Point(list_item_13.Item)
point_69 = Point(list_item_13.Item2)
point_70 = Point(list_item_13.Item3)
point_71 = Point(list_item_13.Item1)
unit_z_20 = UnitZ(Factor=reposition_support_7)
# Support
move_13 = Move(Geometry=point_68, Motion=unit_z_20)  # -> Geometry, Transform
# Spring strength
move_14 = Move(Geometry=point_69, Motion=unit_z_20)  # -> Geometry, Transform
merge_17 = Merge(Data1=move_13.Geometry, Data2=point_71, Data3=move_14.Geometry, Data4=point_70)

force_8 = Slider(0.15, range=0.1..5)

# ---- group: Square + Shops
crv_24 = Curve(<curve referenced from the Rhino model>)
crv_25 = Curve([<curve referenced from the Rhino model> x6])
merge_18 = Merge(Data1=crv_24, Data2=crv_25)
Z_10 = UnitZ(Factor=Slider(3.5, range=0..5))
extr_10 = Extrude(Base=merge_18, Direction=Z_10)
boundary_16 = BoundarySurfaces(Edges=crv_24)

# ---- group: Fountain (Junction)
crv_26 = Curve(<curve referenced from the Rhino model>)
crv_27 = Curve(<curve referenced from the Rhino model>)
Z_11 = UnitZ(Factor=Slider(1.5, range=0..5))
Z_12 = UnitZ(Factor=Slider(0.3, range=0..5))
extr_11 = Extrude(Base=crv_26, Direction=Z_11)
extr_12 = Extrude(Base=crv_27, Direction=Z_12)
cap_5 = CapHoles(Brep=extr_11)
cap_6 = CapHoles(Brep=extr_12)

# ---- group: Junction + Community
crv_28 = Curve([<curve referenced from the Rhino model> x3])
# Scenario 3
crv_29 = Curve(<curve referenced from the Rhino model>)
merge_19 = Merge(Data1=crv_29, Data2=crv_28)
Z_13 = UnitZ(Factor=Slider(5, range=0..5))
boundary_17 = BoundarySurfaces(Edges=crv_29)
extr_13 = Extrude(Base=merge_19, Direction=Z_13)

# ---- group: Walkways + Shops
crv_30 = Curve([<curve referenced from the Rhino model> x8])
crv_31 = Curve([<curve referenced from the Rhino model> x4])
merge_20 = Merge(Data1=crv_31, Data2=crv_30)
Z_14 = UnitZ(Factor=Slider(2.7, range=0..5))
extr_14 = Extrude(Base=merge_20, Direction=Z_14)
boundary_18 = BoundarySurfaces(Edges=crv_31)

# ----
mesh_18 = Mesh(mesh_14)
eval_7 = Evaluate(F="If(x<0.1, 1, 0)", x=crv_cp_7.Distance)
cull_7 = CullPattern(List=point_67, CullPattern=eval_7)
mesh_plane_9 = MeshPlane(Boundary={Plane=PlaneXY(0, 0, 0), Size=Domain2(u=-10..10, v=-10..10)}, WidthCount=density_9, HeightCount=density_9)  # -> Mesh, Area
# Selfmade mesh
meshcorners_8 = MeshCorners(Mesh=mesh_18, Angle=2.35619449)
negative_8 = Negative(Value=force_8)
# Support
curve_15 = Curve(mesh_edges_8.NakedEdges)
curve_16 = Curve(mesh_edges_8.InteriorEdges)
point_72 = Point(deconstruct_mesh_8.Vertices)

# ----
# Spring strength
strength_external_7 = Slider(31.9, range=5..40)
fixed_length_7 = Panel("0")
# Spring strength
strength_internal_7 = Slider(10, range=5..20)

crv_cp_8 = CurveClosestPoint(Point=point_72, Curve=join_17)  # -> Point, Parameter, Distance
unit_z_21 = UnitZ(Factor=force_8)
force_9 = Slider(0.15, range=0.1..5)
density_10 = Slider(20, range=0..100)
mesh_edges_9 = MeshEdges(Mesh=mesh_15)  # -> NakedEdges, InteriorEdges, NonManifoldEdges
deconstruct_mesh_9 = DeconstructMesh(Mesh=mesh_15)  # -> Vertices, Faces, Colours, Normals
reposition_support_8 = Slider(0, range=0..10)
mesh_19 = Mesh(mesh_15)
eval_8 = Evaluate(F="If(x<0.1, 1, 0)", x=crv_cp_8.Distance)
# Support
list_item_14 = ListItem(List=meshcorners_8, Index=0, Wrap=True)  # -> Item, Item1, Item2, Item3
cull_8 = CullPattern(List=point_72, CullPattern=eval_8)
mesh_plane_10 = MeshPlane(Boundary={Plane=PlaneXY(0, 0, 0), Size=Domain2(u=-10..10, v=-10..10)}, WidthCount=density_10, HeightCount=density_10)  # -> Mesh, Area
# Selfmade mesh
meshcorners_9 = MeshCorners(Mesh=mesh_19, Angle=2.35619449)
point_73 = Point(list_item_14.Item)
point_74 = Point(list_item_14.Item2)
point_75 = Point(list_item_14.Item3)
point_76 = Point(list_item_14.Item1)
negative_9 = Negative(Value=force_9)
# Support
curve_17 = Curve(mesh_edges_9.NakedEdges)
curve_18 = Curve(mesh_edges_9.InteriorEdges)
point_77 = Point(deconstruct_mesh_9.Vertices)
# Spring strength
strength_external_8 = Slider(31.9, range=5..40)
fixed_length_8 = Panel("0")
# Spring strength
strength_internal_8 = Slider(10, range=5..20)
crv_cp_9 = CurveClosestPoint(Point=point_77, Curve=join_19)  # -> Point, Parameter, Distance
unit_z_22 = UnitZ(Factor=reposition_support_8)
unit_z_23 = UnitZ(Factor=force_9)
force_10 = Slider(0.15, range=0.1..5)
reposition_support_9 = Slider(0, range=0..10)
mesh_edges_10 = MeshEdges(Mesh=mesh_17)  # -> NakedEdges, InteriorEdges, NonManifoldEdges
deconstruct_mesh_10 = DeconstructMesh(Mesh=mesh_17)  # -> Vertices, Faces, Colours, Normals
move_15 = Move(Geometry=point_73, Motion=unit_z_22)  # -> Geometry, Transform
# Spring strength
move_16 = Move(Geometry=point_74, Motion=unit_z_22)  # -> Geometry, Transform
eval_9 = Evaluate(F="If(x<0.1, 1, 0)", x=crv_cp_9.Distance)
# Support
# Support
# Support
list_item_15 = ListItem(List=meshcorners_9, Index=0, Wrap=True)  # -> Item, Item1, Item2, Item3
mesh_20 = Mesh(mesh_17)
cull_9 = CullPattern(List=point_77, CullPattern=eval_9)
merge_21 = Merge(Data1=meshcorners_7, Data2=cull_7)
point_78 = Point(list_item_15.Item)
point_79 = Point(list_item_15.Item2)
point_80 = Point(list_item_15.Item3)
point_81 = Point(list_item_15.Item1)
# Selfmade mesh
meshcorners_10 = MeshCorners(Mesh=mesh_20, Angle=2.35619449)
negative_10 = Negative(Value=force_10)

# ----
# Create 'beam'
# Create 'beam'
mesh_point_7 = Point(deconstruct_mesh_7.Vertices)
point_82 = Point(point_68)
point_83 = Point(point_69)
point_84 = Point(move_13.Geometry)
point_85 = Point(move_14.Geometry)
line_7 = Line(StartPoint=point_82, EndPoint=point_83)
distance_7 = Distance(PointA=point_84, PointB=point_85)
unit_z_24 = UnitZ(Factor=1)
# Create 'beam'
multiplication_7 = Multiplication(A=distance_7, B=Slider(1.49, range=1..2))
catenary_7 = Catenary(PointA=point_84, PointB=point_85, Length=multiplication_7, Gravity=unit_z_24)
curve_closest_point_7 = CurveClosestPoint(Point=mesh_point_7, Curve=line_7)  # -> Point, Parameter, Distance
larger_than_7 = LargerThan(FirstNumber=curve_closest_point_7.Distance, SecondNumber="0.1")  # -> LargerThan, OrEqualTo
# Create 'beam'
dispatch_7 = Dispatch(List=mesh_point_7, DispatchPattern=larger_than_7.LargerThan)  # -> ListA, ListB
point_86 = Point(dispatch_7.ListB)
point_87 = Point(dispatch_7.ListA)
oncurve_7 = OnCurve(Points=point_86, Curve=catenary_7, Strength=Slider(50, range=1..50))

curve_19 = Curve(mesh_edges_10.NakedEdges)
curve_20 = Curve(mesh_edges_10.InteriorEdges)
point_88 = Point(deconstruct_mesh_10.Vertices)
strength_external_9 = Slider(31.9, range=5..40)
fixed_length_9 = Panel("0")
strength_internal_9 = Slider(10, range=5..20)
unit_z_25 = UnitZ(Factor=reposition_support_9)
crv_cp_10 = CurveClosestPoint(Point=point_88, Curve=join_20)  # -> Point, Parameter, Distance

# ----
# Forces
length_line_13 = LengthLine(Line=curve_13, Length=fixed_length_7, Strength=strength_external_7)
# Tutorial: https://www.youtube.com/watch?v=SW_xQx1x_5g
load_7 = Load(Point=point_67, ForceVector=unit_z_19, Weighting=1)
anchor_7 = Anchor(Point=merge_21, Target=merge_21, Strength=10000)
# Forces
length_line_14 = LengthLine(Line=curve_14, Length=fixed_length_7, Strength=strength_internal_7)

unit_z_26 = UnitZ(Factor=force_10)

geo_3 = Geometry([cap_6, cap_5, extr_13, boundary_17, extr_14, boundary_18, extr_10, boundary_16])  # disabled

merge_22 = Merge(Data1=move_15.Geometry, Data2=point_76, Data3=move_16.Geometry, Data4=point_75)
reposition_support_10 = Slider(0, range=0..10)
move_17 = Move(Geometry=point_78, Motion=unit_z_25)  # -> Geometry, Transform
move_18 = Move(Geometry=point_79, Motion=unit_z_25)  # -> Geometry, Transform
eval_10 = Evaluate(F="If(x<0.1, 1, 0)", x=crv_cp_10.Distance)
# Support
list_item_16 = ListItem(List=meshcorners_10, Index=0, Wrap=True)  # -> Item, Item1, Item2, Item3
# Support
cull_10 = CullPattern(List=point_88, CullPattern=eval_10)
merge_23 = Merge(Data1=meshcorners_8, Data2=cull_8)
# Forces
show_7 = Show(G=mesh_16)
point_89 = Point(list_item_16.Item)
point_90 = Point(list_item_16.Item3)
point_91 = Point(list_item_16.Item1)
point_92 = Point(list_item_16.Item2)
mesh_point_8 = Point(deconstruct_mesh_8.Vertices)
point_93 = Point(point_73)
point_94 = Point(point_74)
point_95 = Point(move_15.Geometry)
point_96 = Point(move_16.Geometry)
strength_external_10 = Slider(31.9, range=5..40)
fixed_length_10 = Panel("0")
strength_internal_10 = Slider(10, range=5..20)
unit_z_27 = UnitZ(Factor=reposition_support_10)
line_8 = Line(StartPoint=point_93, EndPoint=point_94)
length_line_15 = LengthLine(Line=curve_15, Length=fixed_length_8, Strength=strength_external_8)
# Tutorial: https://www.youtube.com/watch?v=SW_xQx1x_5g
load_8 = Load(Point=point_72, ForceVector=unit_z_21, Weighting=1)
# Forces
anchor_8 = Anchor(Point=merge_23, Target=merge_23, Strength=10000)
# Forces
length_line_16 = LengthLine(Line=curve_16, Length=fixed_length_8, Strength=strength_internal_8)
distance_8 = Distance(PointA=point_95, PointB=point_96)
merge_24 = Merge(Data1=move_17.Geometry, Data2=point_81, Data3=move_18.Geometry, Data4=point_80)
move_19 = Move(Geometry=point_89, Motion=unit_z_27)  # -> Geometry, Transform
move_20 = Move(Geometry=point_92, Motion=unit_z_27)  # -> Geometry, Transform
reset_button_7 = Button()
# Tutorial: https://www.youtube.com/watch?v=SW_xQx1x_5g
activate_7 = BooleanToggle(True)
entwine_7 = Entwine(
    Branch00=show_7,
    Branch01=anchor_7,
    Branch02=length_line_13,
    Branch03=length_line_14,
    Branch04=load_7,
    FlattenInputs=True)
unit_z_28 = UnitZ(Factor=1)
merge_25 = Merge(Data1=meshcorners_9, Data2=cull_9)
multiplication_8 = Multiplication(A=distance_8, B=Slider(1.49, range=1..2))
# Forces
show_8 = Show(G=mesh_18)
mesh_point_9 = Point(deconstruct_mesh_9.Vertices)
point_97 = Point(point_78)
point_98 = Point(point_79)
point_99 = Point(move_17.Geometry)
point_100 = Point(move_18.Geometry)
catenary_8 = Catenary(PointA=point_95, PointB=point_96, Length=multiplication_8, Gravity=unit_z_28)
# Tutorial: https://www.youtube.com/watch?v=SW_xQx1x_5g
number_slider = Slider(1.49, range=1..2)
line_9 = Line(StartPoint=point_97, EndPoint=point_98)
length_line_17 = LengthLine(Line=curve_17, Length=fixed_length_9, Strength=strength_external_9)
load_9 = Load(Point=point_77, ForceVector=unit_z_23, Weighting=1)
anchor_9 = Anchor(Point=merge_25, Target=merge_25, Strength=10000)
length_line_18 = LengthLine(Line=curve_18, Length=fixed_length_9, Strength=strength_internal_9)
# Tutorial: https://www.youtube.com/watch?v=SW_xQx1x_5g
solver_7 = Solver(GoalObjects=flatten(entwine_7), Reset=reset_button_7, Threshold=1e-15, Tolerance=0.01, On=activate_7)  # -> I, V, O
distance_9 = Distance(PointA=point_99, PointB=point_100)
merge_26 = Merge(Data1=move_19.Geometry, Data2=point_91, Data3=move_20.Geometry, Data4=point_90)
# Create 'beam'
curve_closest_point_8 = CurveClosestPoint(Point=mesh_point_8, Curve=line_8)  # -> Point, Parameter, Distance
reset_button_8 = Button()
# Tutorial: https://www.youtube.com/watch?v=SW_xQx1x_5g
activate_8 = BooleanToggle(True)
unit_z_29 = UnitZ(Factor=1)
entwine_8 = Entwine(
    Branch00=show_8,
    Branch01=anchor_8,
    Branch02=length_line_15,
    Branch03=length_line_16,
    Branch04=load_8,
    FlattenInputs=True)
merge_27 = Merge(Data1=meshcorners_10, Data2=cull_10)
# Tutorial: https://www.youtube.com/watch?v=SW_xQx1x_5g
multiplication_9 = Multiplication(A=distance_9, B=number_slider)
show_9 = Show(G=mesh_19)
larger_than_8 = LargerThan(FirstNumber=curve_closest_point_8.Distance, SecondNumber="0.1")  # -> LargerThan, OrEqualTo
dispatch_8 = Dispatch(List=mesh_point_8, DispatchPattern=larger_than_8.LargerThan)  # -> ListA, ListB
mesh_point_10 = Point(deconstruct_mesh_10.Vertices)
point_101 = Point(point_89)
point_102 = Point(point_92)
point_103 = Point(move_19.Geometry)
point_104 = Point(move_20.Geometry)
catenary_9 = Catenary(PointA=point_99, PointB=point_100, Length=multiplication_9, Gravity=unit_z_29)
line_10 = Line(StartPoint=point_101, EndPoint=point_102)
solver_8 = Solver(GoalObjects=flatten(entwine_8), Reset=reset_button_8, Threshold=1e-15, Tolerance=0.01, On=activate_8)  # -> I, V, O
length_line_19 = LengthLine(Line=curve_19, Length=fixed_length_10, Strength=strength_external_10)
load_10 = Load(Point=point_88, ForceVector=unit_z_26, Weighting=1)
anchor_10 = Anchor(Point=merge_27, Target=merge_27, Strength=10000)
length_line_20 = LengthLine(Line=curve_20, Length=fixed_length_10, Strength=strength_internal_10)
distance_10 = Distance(PointA=point_103, PointB=point_104)
# Tutorial: https://www.youtube.com/watch?v=SW_xQx1x_5g
curve_closest_point_9 = CurveClosestPoint(Point=mesh_point_9, Curve=line_9)  # -> Point, Parameter, Distance
point_105 = Point(dispatch_8.ListB)
point_106 = Point(dispatch_8.ListA)
reset_button_9 = Button()
activate_9 = BooleanToggle(True)
entwine_9 = Entwine(
    Branch00=show_9,
    Branch01=anchor_9,
    Branch02=length_line_17,
    Branch03=length_line_18,
    Branch04=load_9,
    FlattenInputs=True)
unit_z_30 = UnitZ(Factor=1)
multiplication_10 = Multiplication(A=distance_10, B=Slider(1.49, range=1..2))
show_10 = Show(G=mesh_20)
larger_than_9 = LargerThan(FirstNumber=curve_closest_point_9.Distance, SecondNumber="0.1")  # -> LargerThan, OrEqualTo
dispatch_9 = Dispatch(List=mesh_point_9, DispatchPattern=larger_than_9.LargerThan)  # -> ListA, ListB
catenary_10 = Catenary(PointA=point_103, PointB=point_104, Length=multiplication_10, Gravity=unit_z_30)
oncurve_8 = OnCurve(Points=point_105, Curve=catenary_8, Strength=Slider(50, range=1..50))
solver_9 = Solver(GoalObjects=flatten(entwine_9), Reset=reset_button_9, Threshold=1e-15, Tolerance=0.01, On=activate_9)  # -> I, V, O
curve_closest_point_10 = CurveClosestPoint(Point=mesh_point_10, Curve=line_10)  # -> Point, Parameter, Distance
point_107 = Point(dispatch_9.ListB)
point_108 = Point(dispatch_9.ListA)
reset_button_10 = Button()
activate_10 = BooleanToggle(True)
entwine_10 = Entwine(
    Branch00=show_10,
    Branch01=anchor_10,
    Branch02=length_line_19,
    Branch03=length_line_20,
    Branch04=load_10,
    FlattenInputs=True)
list_item_17 = ListItem(List=solver_7.O, Index=0, Wrap=True)
larger_than_10 = LargerThan(FirstNumber=curve_closest_point_10.Distance, SecondNumber="0.1")  # -> LargerThan, OrEqualTo
dispatch_10 = Dispatch(List=mesh_point_10, DispatchPattern=larger_than_10.LargerThan)  # -> ListA, ListB
oncurve_9 = OnCurve(Points=point_107, Curve=catenary_9, Strength=Slider(50, range=1..50))
solver_10 = Solver(GoalObjects=flatten(entwine_10), Reset=reset_button_10, Threshold=1e-15, Tolerance=0.01, On=activate_10)  # -> I, V, O
point_109 = Point(dispatch_10.ListB)
point_110 = Point(dispatch_10.ListA)
list_item_18 = ListItem(List=solver_8.O, Index=0, Wrap=True)
oncurve_10 = OnCurve(Points=point_109, Curve=catenary_10, Strength=Slider(50, range=1..50))
list_item_19 = ListItem(List=solver_9.O, Index=0, Wrap=True)
list_item_20 = ListItem(List=solver_10.O, Index=0, Wrap=True)
crv_32 = Curve(<curve referenced from the Rhino model>)
boundary_19 = BoundarySurfaces(Edges=crv_32)
crv_33 = Curve(<curve referenced from the Rhino model>)
join_21 = BrepJoin(Breps=boundary_19)  # -> Breps, Closed
boundary_20 = BoundarySurfaces(Edges=crv_33)
srf_11 = Surface(join_21.Breps)
crv_34 = Curve(<curve referenced from the Rhino model>)
toggle_11 = BooleanToggle(True)
debrep_11 = DeconstructBrep(Brep=srf_11)  # -> Faces, Edges, Vertices
join_22 = BrepJoin(Breps=boundary_20)  # -> Breps, Closed
item_11 = ListItem(List=debrep_11.Edges, Index=0, Wrap=True)  # -> Item, Item1, Item2, Item3
boundary_21 = BoundarySurfaces(Edges=crv_34)
custom_mesh_settings_11 = SettingsCustom(
    StitchSeams=toggle_11,
    SimplePlanes=False,
    Refine=toggle_11,
    MinCount="1600",
    MaxCount="1600",
    AspectRatio=20,
    MaxDistance=0,
    MaxAngle=20,
    MinEdge="0",
    MaxEdge="0")
srf_12 = Surface(join_22.Breps)
relay_11 = Relay([item_11.Item1, item_11.Item, item_11.Item2, item_11.Item3])
join_23 = JoinCurves(Curves=relay_11, Preserve=False)
toggle_12 = BooleanToggle(True)
debrep_12 = DeconstructBrep(Brep=srf_12)  # -> Faces, Edges, Vertices
join_24 = BrepJoin(Breps=boundary_21)  # -> Breps, Closed
mesh_21 = MeshBrep(Brep=srf_11, Settings=custom_mesh_settings_11)
crv_35 = Curve(<curve referenced from the Rhino model>)
item_12 = ListItem(List=debrep_12.Edges, Index=0, Wrap=True)  # -> Item, Item1, Item2, Item3
custom_mesh_settings_12 = SettingsCustom(
    StitchSeams=toggle_12,
    SimplePlanes=False,
    Refine=toggle_12,
    MinCount="1600",
    MaxCount="1600",
    AspectRatio=20,
    MaxDistance=0,
    MaxAngle=20,
    MinEdge="0",
    MaxEdge="0")
srf_13 = Surface(join_24.Breps)
toggle_13 = BooleanToggle(True)
debrep_13 = DeconstructBrep(Brep=srf_13)  # -> Faces, Edges, Vertices
relay_12 = Relay([item_12.Item1, item_12.Item, item_12.Item2, item_12.Item3])
join_25 = JoinCurves(Curves=relay_12, Preserve=False)
boundary_22 = BoundarySurfaces(Edges=crv_35)
mesh_22 = MeshBrep(Brep=srf_12, Settings=custom_mesh_settings_12)
crv_36 = Curve(<curve referenced from the Rhino model>)
item_13 = ListItem(List=debrep_13.Edges, Index=0, Wrap=True)  # -> Item, Item1, Item2, Item3
custom_mesh_settings_13 = SettingsCustom(
    StitchSeams=toggle_13,
    SimplePlanes=False,
    Refine=toggle_13,
    MinCount="1600",
    MaxCount="1600",
    AspectRatio=20,
    MaxDistance=0,
    MaxAngle=20,
    MinEdge="0",
    MaxEdge="0")
join_26 = BrepJoin(Breps=boundary_22)  # -> Breps, Closed
relay_13 = Relay([item_13.Item1, item_13.Item, item_13.Item2, item_13.Item3])
join_27 = JoinCurves(Curves=relay_13, Preserve=False)
boundary_23 = BoundarySurfaces(Edges=crv_36)
mesh_23 = MeshBrep(Brep=srf_13, Settings=custom_mesh_settings_13)
srf_14 = Surface(join_26.Breps)
join_28 = BrepJoin(Breps=boundary_23)  # -> Breps, Closed
density_11 = Slider(20, range=0..100)
toggle_14 = BooleanToggle(True)
debrep_14 = DeconstructBrep(Brep=srf_14)  # -> Faces, Edges, Vertices
srf_15 = Surface(join_28.Breps)
item_14 = ListItem(List=debrep_14.Edges, Index=0, Wrap=True)  # -> Item, Item1, Item2, Item3
custom_mesh_settings_14 = SettingsCustom(
    StitchSeams=toggle_14,
    SimplePlanes=False,
    Refine=toggle_14,
    MinCount="1600",
    MaxCount="1600",
    AspectRatio=20,
    MaxDistance=0,
    MaxAngle=20,
    MinEdge="0",
    MaxEdge="0")
mesh_plane_11 = MeshPlane(Boundary={Plane=PlaneXY(0, 0, 0), Size=Domain2(u=-10..10, v=-10..10)}, WidthCount=density_11, HeightCount=density_11)  # -> Mesh, Area
toggle_15 = BooleanToggle(True)
debrep_15 = DeconstructBrep(Brep=srf_15)  # -> Faces, Edges, Vertices
relay_14 = Relay([item_14.Item1, item_14.Item, item_14.Item2, item_14.Item3])
join_29 = JoinCurves(Curves=relay_14, Preserve=False)
density_12 = Slider(20, range=0..100)
mesh_24 = MeshBrep(Brep=srf_14, Settings=custom_mesh_settings_14)
force_11 = Slider(0.15, range=0.1..5)
item_15 = ListItem(List=debrep_15.Edges, Index=0, Wrap=True)  # -> Item, Item1, Item2, Item3
custom_mesh_settings_15 = SettingsCustom(
    StitchSeams=toggle_15,
    SimplePlanes=False,
    Refine=toggle_15,
    MinCount="1600",
    MaxCount="1600",
    AspectRatio=20,
    MaxDistance=0,
    MaxAngle=20,
    MinEdge="0",
    MaxEdge="0")
mesh_edges_11 = MeshEdges(Mesh=mesh_21)  # -> NakedEdges, InteriorEdges, NonManifoldEdges
deconstruct_mesh_11 = DeconstructMesh(Mesh=mesh_21)  # -> Vertices, Faces, Colours, Normals
mesh_25 = Mesh(mesh_21)
mesh_plane_12 = MeshPlane(Boundary={Plane=PlaneXY(0, 0, 0), Size=Domain2(u=-10..10, v=-10..10)}, WidthCount=density_12, HeightCount=density_12)  # -> Mesh, Area
relay_15 = Relay([item_15.Item1, item_15.Item, item_15.Item2, item_15.Item3])
join_30 = JoinCurves(Curves=relay_15, Preserve=False)
mesh_26 = MeshBrep(Brep=srf_15, Settings=custom_mesh_settings_15)
density_13 = Slider(20, range=0..100)
# Selfmade mesh
meshcorners_11 = MeshCorners(Mesh=mesh_25, Angle=2.35619449)
negative_11 = Negative(Value=force_11)
# Support
curve_21 = Curve(mesh_edges_11.NakedEdges)
curve_22 = Curve(mesh_edges_11.InteriorEdges)
point_111 = Point(deconstruct_mesh_11.Vertices)
force_12 = Slider(0.15, range=0.1..5)
crv_cp_11 = CurveClosestPoint(Point=point_111, Curve=join_23)  # -> Point, Parameter, Distance
mesh_edges_12 = MeshEdges(Mesh=mesh_22)  # -> NakedEdges, InteriorEdges, NonManifoldEdges
deconstruct_mesh_12 = DeconstructMesh(Mesh=mesh_22)  # -> Vertices, Faces, Colours, Normals
unit_z_31 = UnitZ(Factor=force_11)
mesh_plane_13 = MeshPlane(Boundary={Plane=PlaneXY(0, 0, 0), Size=Domain2(u=-10..10, v=-10..10)}, WidthCount=density_13, HeightCount=density_13)  # -> Mesh, Area
mesh_27 = Mesh(mesh_22)
reposition_support_11 = Slider(0, range=0..10)
eval_11 = Evaluate(F="If(x<0.1, 1, 0)", x=crv_cp_11.Distance)
# Support
list_item_21 = ListItem(List=meshcorners_11, Index=0, Wrap=True)  # -> Item, Item1, Item2, Item3
cull_11 = CullPattern(List=point_111, CullPattern=eval_11)
# Selfmade mesh
meshcorners_12 = MeshCorners(Mesh=mesh_27, Angle=2.35619449)
negative_12 = Negative(Value=force_12)
force_13 = Slider(0.15, range=0.1..5)
# Support
curve_23 = Curve(mesh_edges_12.NakedEdges)
curve_24 = Curve(mesh_edges_12.InteriorEdges)
point_112 = Point(deconstruct_mesh_12.Vertices)
mesh_edges_13 = MeshEdges(Mesh=mesh_23)  # -> NakedEdges, InteriorEdges, NonManifoldEdges
deconstruct_mesh_13 = DeconstructMesh(Mesh=mesh_23)  # -> Vertices, Faces, Colours, Normals
crv_cp_12 = CurveClosestPoint(Point=point_112, Curve=join_25)  # -> Point, Parameter, Distance
point_113 = Point(list_item_21.Item)
point_114 = Point(list_item_21.Item2)
point_115 = Point(list_item_21.Item3)
point_116 = Point(list_item_21.Item1)
density_14 = Slider(20, range=0..100)
mesh_28 = Mesh(mesh_23)
unit_z_32 = UnitZ(Factor=force_12)
# Spring strength
strength_external_11 = Slider(31.9, range=5..40)
fixed_length_11 = Panel("0")
# Spring strength
strength_internal_11 = Slider(10, range=5..20)
unit_z_33 = UnitZ(Factor=reposition_support_11)
reposition_support_12 = Slider(0, range=0..10)
eval_12 = Evaluate(F="If(x<0.1, 1, 0)", x=crv_cp_12.Distance)
# Support
list_item_22 = ListItem(List=meshcorners_12, Index=0, Wrap=True)  # -> Item, Item1, Item2, Item3
# Selfmade mesh
meshcorners_13 = MeshCorners(Mesh=mesh_28, Angle=2.35619449)
negative_13 = Negative(Value=force_13)
cull_12 = CullPattern(List=point_112, CullPattern=eval_12)
curve_25 = Curve(mesh_edges_13.NakedEdges)
curve_26 = Curve(mesh_edges_13.InteriorEdges)
point_117 = Point(deconstruct_mesh_13.Vertices)
mesh_plane_14 = MeshPlane(Boundary={Plane=PlaneXY(0, 0, 0), Size=Domain2(u=-10..10, v=-10..10)}, WidthCount=density_14, HeightCount=density_14)  # -> Mesh, Area
# Support
move_21 = Move(Geometry=point_113, Motion=unit_z_33)  # -> Geometry, Transform
# Spring strength
move_22 = Move(Geometry=point_114, Motion=unit_z_33)  # -> Geometry, Transform
crv_cp_13 = CurveClosestPoint(Point=point_117, Curve=join_27)  # -> Point, Parameter, Distance
density_15 = Slider(20, range=0..100)
point_118 = Point(list_item_22.Item)
point_119 = Point(list_item_22.Item2)
point_120 = Point(list_item_22.Item3)
point_121 = Point(list_item_22.Item1)
unit_z_34 = UnitZ(Factor=force_13)
# Spring strength
strength_external_12 = Slider(31.9, range=5..40)
fixed_length_12 = Panel("0")
# Spring strength
strength_internal_12 = Slider(10, range=5..20)
reposition_support_13 = Slider(0, range=0..10)
unit_z_35 = UnitZ(Factor=reposition_support_12)
force_14 = Slider(0.15, range=0.1..5)
eval_13 = Evaluate(F="If(x<0.1, 1, 0)", x=crv_cp_13.Distance)
mesh_edges_14 = MeshEdges(Mesh=mesh_24)  # -> NakedEdges, InteriorEdges, NonManifoldEdges
deconstruct_mesh_14 = DeconstructMesh(Mesh=mesh_24)  # -> Vertices, Faces, Colours, Normals
list_item_23 = ListItem(List=meshcorners_13, Index=0, Wrap=True)  # -> Item, Item1, Item2, Item3
mesh_plane_15 = MeshPlane(Boundary={Plane=PlaneXY(0, 0, 0), Size=Domain2(u=-10..10, v=-10..10)}, WidthCount=density_15, HeightCount=density_15)  # -> Mesh, Area
cull_13 = CullPattern(List=point_117, CullPattern=eval_13)
mesh_29 = Mesh(mesh_24)
# Support
move_23 = Move(Geometry=point_118, Motion=unit_z_35)  # -> Geometry, Transform
# Spring strength
move_24 = Move(Geometry=point_119, Motion=unit_z_35)  # -> Geometry, Transform
merge_28 = Merge(Data1=move_21.Geometry, Data2=point_116, Data3=move_22.Geometry, Data4=point_115)
point_122 = Point(list_item_23.Item)
point_123 = Point(list_item_23.Item1)
point_124 = Point(list_item_23.Item2)
point_125 = Point(list_item_23.Item3)
strength_external_13 = Slider(31.9, range=5..40)
fixed_length_13 = Panel("0")
strength_internal_13 = Slider(10, range=5..20)
# Selfmade mesh
meshcorners_14 = MeshCorners(Mesh=mesh_29, Angle=2.35619449)
negative_14 = Negative(Value=force_14)
force_15 = Slider(0.15, range=0.1..5)
unit_z_36 = UnitZ(Factor=reposition_support_13)
mesh_edges_15 = MeshEdges(Mesh=mesh_26)  # -> NakedEdges, InteriorEdges, NonManifoldEdges
deconstruct_mesh_15 = DeconstructMesh(Mesh=mesh_26)  # -> Vertices, Faces, Colours, Normals
curve_27 = Curve(mesh_edges_14.NakedEdges)
curve_28 = Curve(mesh_edges_14.InteriorEdges)
point_126 = Point(deconstruct_mesh_14.Vertices)
crv_cp_14 = CurveClosestPoint(Point=point_126, Curve=join_29)  # -> Point, Parameter, Distance
merge_29 = Merge(Data1=meshcorners_11, Data2=cull_11)
mesh_30 = Mesh(mesh_26)
unit_z_37 = UnitZ(Factor=force_14)
move_25 = Move(Geometry=point_122, Motion=unit_z_36)  # -> Geometry, Transform
move_26 = Move(Geometry=point_124, Motion=unit_z_36)  # -> Geometry, Transform
mesh_point_11 = Point(deconstruct_mesh_11.Vertices)
point_127 = Point(point_113)
point_128 = Point(point_114)
point_129 = Point(move_21.Geometry)
point_130 = Point(move_22.Geometry)
reposition_support_14 = Slider(0, range=0..10)
merge_30 = Merge(Data1=move_23.Geometry, Data2=point_121, Data3=move_24.Geometry, Data4=point_120)
# Selfmade mesh
meshcorners_15 = MeshCorners(Mesh=mesh_30, Angle=2.35619449)
negative_15 = Negative(Value=force_15)
eval_14 = Evaluate(F="If(x<0.1, 1, 0)", x=crv_cp_14.Distance)
list_item_24 = ListItem(List=meshcorners_14, Index=0, Wrap=True)  # -> Item, Item1, Item2, Item3
curve_29 = Curve(mesh_edges_15.NakedEdges)
curve_30 = Curve(mesh_edges_15.InteriorEdges)
point_131 = Point(deconstruct_mesh_15.Vertices)
line_11 = Line(StartPoint=point_127, EndPoint=point_128)
cull_14 = CullPattern(List=point_126, CullPattern=eval_14)
length_line_21 = LengthLine(Line=curve_21, Length=fixed_length_11, Strength=strength_external_11)
# Tutorial: https://www.youtube.com/watch?v=SW_xQx1x_5g
load_11 = Load(Point=point_111, ForceVector=unit_z_31, Weighting=1)
# Forces
anchor_11 = Anchor(Point=merge_29, Target=merge_29, Strength=10000)
# Forces
length_line_22 = LengthLine(Line=curve_22, Length=fixed_length_11, Strength=strength_internal_11)
distance_11 = Distance(PointA=point_129, PointB=point_130)
crv_cp_15 = CurveClosestPoint(Point=point_131, Curve=join_30)  # -> Point, Parameter, Distance
unit_z_38 = UnitZ(Factor=force_15)
merge_31 = Merge(Data1=meshcorners_12, Data2=cull_12)
point_132 = Point(list_item_24.Item)
point_133 = Point(list_item_24.Item2)
point_134 = Point(list_item_24.Item3)
point_135 = Point(list_item_24.Item1)
reposition_support_15 = Slider(0, range=0..10)
strength_external_14 = Slider(31.9, range=5..40)
fixed_length_14 = Panel("0")
strength_internal_14 = Slider(10, range=5..20)
unit_z_39 = UnitZ(Factor=1)
unit_z_40 = UnitZ(Factor=reposition_support_14)
merge_32 = Merge(Data1=move_25.Geometry, Data2=point_123, Data3=move_26.Geometry, Data4=point_125)
eval_15 = Evaluate(F="If(x<0.1, 1, 0)", x=crv_cp_15.Distance)
mesh_point_12 = Point(deconstruct_mesh_12.Vertices)
point_136 = Point(point_118)
point_137 = Point(point_119)
list_item_25 = ListItem(List=meshcorners_15, Index=0, Wrap=True)  # -> Item, Item1, Item2, Item3
point_138 = Point(move_23.Geometry)
point_139 = Point(move_24.Geometry)
multiplication_11 = Multiplication(A=distance_11, B=Slider(1.49, range=1..2))
cull_15 = CullPattern(List=point_131, CullPattern=eval_15)
# Forces
show_11 = Show(G=mesh_25)
line_12 = Line(StartPoint=point_136, EndPoint=point_137)
length_line_23 = LengthLine(Line=curve_23, Length=fixed_length_12, Strength=strength_external_12)
load_12 = Load(Point=point_112, ForceVector=unit_z_32, Weighting=1)
# Forces
anchor_12 = Anchor(Point=merge_31, Target=merge_31, Strength=10000)
# Forces
length_line_24 = LengthLine(Line=curve_24, Length=fixed_length_12, Strength=strength_internal_12)
distance_12 = Distance(PointA=point_138, PointB=point_139)
move_27 = Move(Geometry=point_132, Motion=unit_z_40)  # -> Geometry, Transform
point_140 = Point(list_item_25.Item)
point_141 = Point(list_item_25.Item2)
point_142 = Point(list_item_25.Item3)
point_143 = Point(list_item_25.Item1)
move_28 = Move(Geometry=point_133, Motion=unit_z_40)  # -> Geometry, Transform
merge_33 = Merge(Data1=meshcorners_13, Data2=cull_13)
catenary_11 = Catenary(PointA=point_129, PointB=point_130, Length=multiplication_11, Gravity=unit_z_39)
strength_external_15 = Slider(31.9, range=5..40)
fixed_length_15 = Panel("0")
strength_internal_15 = Slider(10, range=5..20)
unit_z_41 = UnitZ(Factor=reposition_support_15)
# Create 'beam'
curve_closest_point_11 = CurveClosestPoint(Point=mesh_point_11, Curve=line_11)  # -> Point, Parameter, Distance
mesh_point_13 = Point(deconstruct_mesh_13.Vertices)
point_144 = Point(point_122)
point_145 = Point(point_124)
point_146 = Point(move_25.Geometry)
point_147 = Point(move_26.Geometry)
unit_z_42 = UnitZ(Factor=1)
multiplication_12 = Multiplication(A=distance_12, B=Slider(1.49, range=1..2))
reset_button_11 = Button()
# Tutorial: https://www.youtube.com/watch?v=SW_xQx1x_5g
activate_11 = BooleanToggle(True)
line_13 = Line(StartPoint=point_144, EndPoint=point_145)
# Forces
show_12 = Show(G=mesh_27)
length_line_25 = LengthLine(Line=curve_25, Length=fixed_length_13, Strength=strength_external_13)
load_13 = Load(Point=point_117, ForceVector=unit_z_34, Weighting=1)
entwine_11 = Entwine(
    Branch00=show_11,
    Branch01=anchor_11,
    Branch02=length_line_21,
    Branch03=length_line_22,
    Branch04=load_11,
    FlattenInputs=True)
anchor_13 = Anchor(Point=merge_33, Target=merge_33, Strength=10000)
length_line_26 = LengthLine(Line=curve_26, Length=fixed_length_13, Strength=strength_internal_13)
move_29 = Move(Geometry=point_140, Motion=unit_z_41)  # -> Geometry, Transform
distance_13 = Distance(PointA=point_146, PointB=point_147)
move_30 = Move(Geometry=point_141, Motion=unit_z_41)  # -> Geometry, Transform
merge_34 = Merge(Data1=move_27.Geometry, Data2=point_135, Data3=move_28.Geometry, Data4=point_134)
catenary_12 = Catenary(PointA=point_138, PointB=point_139, Length=multiplication_12, Gravity=unit_z_42)
larger_than_11 = LargerThan(FirstNumber=curve_closest_point_11.Distance, SecondNumber="0.1")  # -> LargerThan, OrEqualTo
dispatch_11 = Dispatch(List=mesh_point_11, DispatchPattern=larger_than_11.LargerThan)  # -> ListA, ListB
unit_z_43 = UnitZ(Factor=1)
curve_closest_point_12 = CurveClosestPoint(Point=mesh_point_12, Curve=line_12)  # -> Point, Parameter, Distance
multiplication_13 = Multiplication(A=distance_13, B=Slider(1.49, range=1..2))
solver_11 = Solver(GoalObjects=flatten(entwine_11), Reset=reset_button_11, Threshold=1e-15, Tolerance=0.01, On=activate_11)  # -> I, V, O
merge_35 = Merge(Data1=meshcorners_14, Data2=cull_14)
show_13 = Show(G=mesh_28)
reset_button_12 = Button()
# Tutorial: https://www.youtube.com/watch?v=SW_xQx1x_5g
activate_12 = BooleanToggle(True)
entwine_12 = Entwine(
    Branch00=show_12,
    Branch01=anchor_12,
    Branch02=length_line_23,
    Branch03=length_line_24,
    Branch04=load_12,
    FlattenInputs=True)
merge_36 = Merge(Data1=move_29.Geometry, Data2=point_143, Data3=move_30.Geometry, Data4=point_142)
point_148 = Point(dispatch_11.ListB)
point_149 = Point(dispatch_11.ListA)
mesh_point_14 = Point(deconstruct_mesh_14.Vertices)
point_150 = Point(point_132)
point_151 = Point(point_133)
catenary_13 = Catenary(PointA=point_146, PointB=point_147, Length=multiplication_13, Gravity=unit_z_43)
point_152 = Point(move_27.Geometry)
point_153 = Point(move_28.Geometry)
larger_than_12 = LargerThan(FirstNumber=curve_closest_point_12.Distance, SecondNumber="0.1")  # -> LargerThan, OrEqualTo
dispatch_12 = Dispatch(List=mesh_point_12, DispatchPattern=larger_than_12.LargerThan)  # -> ListA, ListB
# Tutorial: https://www.youtube.com/watch?v=SW_xQx1x_5g
curve_closest_point_13 = CurveClosestPoint(Point=mesh_point_13, Curve=line_13)  # -> Point, Parameter, Distance
line_14 = Line(StartPoint=point_150, EndPoint=point_151)
length_line_27 = LengthLine(Line=curve_27, Length=fixed_length_14, Strength=strength_external_14)
load_14 = Load(Point=point_126, ForceVector=unit_z_37, Weighting=1)
anchor_14 = Anchor(Point=merge_35, Target=merge_35, Strength=10000)
length_line_28 = LengthLine(Line=curve_28, Length=fixed_length_14, Strength=strength_internal_14)
distance_14 = Distance(PointA=point_152, PointB=point_153)
merge_37 = Merge(Data1=meshcorners_15, Data2=cull_15)
solver_12 = Solver(GoalObjects=flatten(entwine_12), Reset=reset_button_12, Threshold=1e-15, Tolerance=0.01, On=activate_12)  # -> I, V, O
reset_button_13 = Button()
activate_13 = BooleanToggle(True)
entwine_13 = Entwine(
    Branch00=show_13,
    Branch01=anchor_13,
    Branch02=length_line_25,
    Branch03=length_line_26,
    Branch04=load_13,
    FlattenInputs=True)
mesh_point_15 = Point(deconstruct_mesh_15.Vertices)
point_154 = Point(point_140)
point_155 = Point(point_141)
point_156 = Point(move_29.Geometry)
point_157 = Point(move_30.Geometry)
oncurve_11 = OnCurve(Points=point_148, Curve=catenary_11, Strength=Slider(50, range=1..50))
unit_z_44 = UnitZ(Factor=1)
point_158 = Point(dispatch_12.ListB)
point_159 = Point(dispatch_12.ListA)
larger_than_13 = LargerThan(FirstNumber=curve_closest_point_13.Distance, SecondNumber="0.1")  # -> LargerThan, OrEqualTo
dispatch_13 = Dispatch(List=mesh_point_13, DispatchPattern=larger_than_13.LargerThan)  # -> ListA, ListB
multiplication_14 = Multiplication(A=distance_14, B=Slider(1.49, range=1..2))
line_15 = Line(StartPoint=point_154, EndPoint=point_155)
length_line_29 = LengthLine(Line=curve_29, Length=fixed_length_15, Strength=strength_external_15)
load_15 = Load(Point=point_131, ForceVector=unit_z_38, Weighting=1)
anchor_15 = Anchor(Point=merge_37, Target=merge_37, Strength=10000)
length_line_30 = LengthLine(Line=curve_30, Length=fixed_length_15, Strength=strength_internal_15)
distance_15 = Distance(PointA=point_156, PointB=point_157)
show_14 = Show(G=mesh_29)
solver_13 = Solver(GoalObjects=flatten(entwine_13), Reset=reset_button_13, Threshold=1e-15, Tolerance=0.01, On=activate_13)  # -> I, V, O
catenary_14 = Catenary(PointA=point_152, PointB=point_153, Length=multiplication_14, Gravity=unit_z_44)
unit_z_45 = UnitZ(Factor=1)
point_160 = Point(dispatch_13.ListB)
curve_closest_point_14 = CurveClosestPoint(Point=mesh_point_14, Curve=line_14)  # -> Point, Parameter, Distance
point_161 = Point(dispatch_13.ListA)
oncurve_12 = OnCurve(Points=point_158, Curve=catenary_12, Strength=Slider(50, range=1..50))
multiplication_15 = Multiplication(A=distance_15, B=Slider(1.49, range=1..2))
show_15 = Show(G=mesh_30)
reset_button_14 = Button()
activate_14 = BooleanToggle(True)
entwine_14 = Entwine(
    Branch00=show_14,
    Branch01=anchor_14,
    Branch02=length_line_27,
    Branch03=length_line_28,
    Branch04=load_14,
    FlattenInputs=True)
catenary_15 = Catenary(PointA=point_156, PointB=point_157, Length=multiplication_15, Gravity=unit_z_45)
curve_closest_point_15 = CurveClosestPoint(Point=mesh_point_15, Curve=line_15)  # -> Point, Parameter, Distance
larger_than_14 = LargerThan(FirstNumber=curve_closest_point_14.Distance, SecondNumber="0.1")  # -> LargerThan, OrEqualTo
dispatch_14 = Dispatch(List=mesh_point_14, DispatchPattern=larger_than_14.LargerThan)  # -> ListA, ListB
oncurve_13 = OnCurve(Points=point_160, Curve=catenary_13, Strength=Slider(50, range=1..50))
list_item_26 = ListItem(List=solver_11.O, Index=0, Wrap=True)
reset_button_15 = Button()
activate_15 = BooleanToggle(True)
solver_14 = Solver(GoalObjects=flatten(entwine_14), Reset=reset_button_14, Threshold=1e-15, Tolerance=0.01, On=activate_14)  # -> I, V, O
entwine_15 = Entwine(
    Branch00=show_15,
    Branch01=anchor_15,
    Branch02=length_line_29,
    Branch03=length_line_30,
    Branch04=load_15,
    FlattenInputs=True)
point_162 = Point(dispatch_14.ListB)
point_163 = Point(dispatch_14.ListA)
larger_than_15 = LargerThan(FirstNumber=curve_closest_point_15.Distance, SecondNumber="0.1")  # -> LargerThan, OrEqualTo
dispatch_15 = Dispatch(List=mesh_point_15, DispatchPattern=larger_than_15.LargerThan)  # -> ListA, ListB
solver_15 = Solver(GoalObjects=flatten(entwine_15), Reset=reset_button_15, Threshold=1e-15, Tolerance=0.01, On=activate_15)  # -> I, V, O
list_item_27 = ListItem(List=solver_12.O, Index=0, Wrap=True)
point_164 = Point(dispatch_15.ListB)
point_165 = Point(dispatch_15.ListA)
oncurve_14 = OnCurve(Points=point_162, Curve=catenary_14, Strength=Slider(50, range=1..50))
list_item_28 = ListItem(List=solver_13.O, Index=0, Wrap=True)
oncurve_15 = OnCurve(Points=point_164, Curve=catenary_15, Strength=Slider(50, range=1..50))
list_item_29 = ListItem(List=solver_14.O, Index=0, Wrap=True)
list_item_30 = ListItem(List=solver_15.O, Index=0, Wrap=True)
crv_37 = Curve(<curve referenced from the Rhino model>)
boundary_24 = BoundarySurfaces(Edges=crv_37)
crv_38 = Curve(<curve referenced from the Rhino model>)
join_31 = BrepJoin(Breps=boundary_24)  # -> Breps, Closed
boundary_25 = BoundarySurfaces(Edges=crv_38)
srf_16 = Surface(join_31.Breps)
join_32 = BrepJoin(Breps=boundary_25)  # -> Breps, Closed
toggle_16 = BooleanToggle(True)
debrep_16 = DeconstructBrep(Brep=srf_16)  # -> Faces, Edges, Vertices
crv_39 = Curve(<curve referenced from the Rhino model>)
srf_17 = Surface(join_32.Breps)
item_16 = ListItem(List=debrep_16.Edges, Index=0, Wrap=True)  # -> Item, Item1, Item2, Item3
custom_mesh_settings_16 = SettingsCustom(
    StitchSeams=toggle_16,
    SimplePlanes=False,
    Refine=toggle_16,
    MinCount="1600",
    MaxCount="1600",
    AspectRatio=20,
    MaxDistance=0,
    MaxAngle=20,
    MinEdge="0",
    MaxEdge="0")
boundary_26 = BoundarySurfaces(Edges=crv_39)
toggle_17 = BooleanToggle(True)
debrep_17 = DeconstructBrep(Brep=srf_17)  # -> Faces, Edges, Vertices
relay_16 = Relay([item_16.Item1, item_16.Item, item_16.Item2, item_16.Item3])
join_33 = JoinCurves(Curves=relay_16, Preserve=False)
join_34 = BrepJoin(Breps=boundary_26)  # -> Breps, Closed
mesh_31 = MeshBrep(Brep=srf_16, Settings=custom_mesh_settings_16)
item_17 = ListItem(List=debrep_17.Edges, Index=0, Wrap=True)  # -> Item, Item1, Item2, Item3
custom_mesh_settings_17 = SettingsCustom(
    StitchSeams=toggle_17,
    SimplePlanes=False,
    Refine=toggle_17,
    MinCount="1600",
    MaxCount="1600",
    AspectRatio=20,
    MaxDistance=0,
    MaxAngle=20,
    MinEdge="0",
    MaxEdge="0")
srf_18 = Surface(join_34.Breps)
relay_17 = Relay([item_17.Item1, item_17.Item, item_17.Item2, item_17.Item3])
join_35 = JoinCurves(Curves=relay_17, Preserve=False)
mesh_32 = MeshBrep(Brep=srf_17, Settings=custom_mesh_settings_17)
toggle_18 = BooleanToggle(True)
debrep_18 = DeconstructBrep(Brep=srf_18)  # -> Faces, Edges, Vertices
item_18 = ListItem(List=debrep_18.Edges, Index=0, Wrap=True)  # -> Item, Item1, Item2, Item3
custom_mesh_settings_18 = SettingsCustom(
    StitchSeams=toggle_18,
    SimplePlanes=False,
    Refine=toggle_18,
    MinCount="1600",
    MaxCount="1600",
    AspectRatio=20,
    MaxDistance=0,
    MaxAngle=20,
    MinEdge="0",
    MaxEdge="0")
relay_18 = Relay([item_18.Item1, item_18.Item, item_18.Item2, item_18.Item3])
join_36 = JoinCurves(Curves=relay_18, Preserve=False)
mesh_33 = MeshBrep(Brep=srf_18, Settings=custom_mesh_settings_18)
density_16 = Slider(20, range=0..100)
mesh_plane_16 = MeshPlane(Boundary={Plane=PlaneXY(0, 0, 0), Size=Domain2(u=-10..10, v=-10..10)}, WidthCount=density_16, HeightCount=density_16)  # -> Mesh, Area
density_17 = Slider(20, range=0..100)
force_16 = Slider(0.28, range=0.1..5)
mesh_edges_16 = MeshEdges(Mesh=mesh_31)  # -> NakedEdges, InteriorEdges, NonManifoldEdges
deconstruct_mesh_16 = DeconstructMesh(Mesh=mesh_31)  # -> Vertices, Faces, Colours, Normals
mesh_plane_17 = MeshPlane(Boundary={Plane=PlaneXY(0, 0, 0), Size=Domain2(u=-10..10, v=-10..10)}, WidthCount=density_17, HeightCount=density_17)  # -> Mesh, Area
mesh_34 = Mesh(mesh_31)
density_18 = Slider(20, range=0..100)
force_17 = Slider(0.23, range=0.1..5)
# Selfmade mesh
meshcorners_16 = MeshCorners(Mesh=mesh_34, Angle=2.35619449)
negative_16 = Negative(Value=force_16)
mesh_edges_17 = MeshEdges(Mesh=mesh_32)  # -> NakedEdges, InteriorEdges, NonManifoldEdges
deconstruct_mesh_17 = DeconstructMesh(Mesh=mesh_32)  # -> Vertices, Faces, Colours, Normals
# Support
curve_31 = Curve(mesh_edges_16.NakedEdges)
curve_32 = Curve(mesh_edges_16.InteriorEdges)
point_166 = Point(deconstruct_mesh_16.Vertices)
crv_cp_16 = CurveClosestPoint(Point=point_166, Curve=join_33)  # -> Point, Parameter, Distance
mesh_35 = Mesh(mesh_32)
unit_z_46 = UnitZ(Factor=force_16)
mesh_plane_18 = MeshPlane(Boundary={Plane=PlaneXY(0, 0, 0), Size=Domain2(u=-10..10, v=-10..10)}, WidthCount=density_18, HeightCount=density_18)  # -> Mesh, Area
reposition_support_16 = Slider(0, range=0..10)
# Selfmade mesh
meshcorners_17 = MeshCorners(Mesh=mesh_35, Angle=2.35619449)
negative_17 = Negative(Value=force_17)
eval_16 = Evaluate(F="If(x<0.1, 1, 0)", x=crv_cp_16.Distance)
# Support
curve_33 = Curve(mesh_edges_17.NakedEdges)
curve_34 = Curve(mesh_edges_17.InteriorEdges)
point_167 = Point(deconstruct_mesh_17.Vertices)
# Support
list_item_31 = ListItem(List=meshcorners_16, Index=0, Wrap=True)  # -> Item, Item1, Item2, Item3
cull_16 = CullPattern(List=point_166, CullPattern=eval_16)
crv_cp_17 = CurveClosestPoint(Point=point_167, Curve=join_35)  # -> Point, Parameter, Distance
force_18 = Slider(0.23, range=0.1..5)
unit_z_47 = UnitZ(Factor=force_17)
mesh_edges_18 = MeshEdges(Mesh=mesh_33)  # -> NakedEdges, InteriorEdges, NonManifoldEdges
deconstruct_mesh_18 = DeconstructMesh(Mesh=mesh_33)  # -> Vertices, Faces, Colours, Normals
point_168 = Point(list_item_31.Item)
point_169 = Point(list_item_31.Item1)
point_170 = Point(list_item_31.Item2)
point_171 = Point(list_item_31.Item3)
reposition_support_17 = Slider(0, range=0..10)
mesh_36 = Mesh(mesh_33)
# Spring strength
strength_external_16 = Slider(31.9, range=5..40)
fixed_length_16 = Panel("0")
# Spring strength
strength_internal_16 = Slider(10, range=5..20)
unit_z_48 = UnitZ(Factor=reposition_support_16)
eval_17 = Evaluate(F="If(x<0.1, 1, 0)", x=crv_cp_17.Distance)
# Support
list_item_32 = ListItem(List=meshcorners_17, Index=0, Wrap=True)  # -> Item, Item1, Item2, Item3
cull_17 = CullPattern(List=point_167, CullPattern=eval_17)
# Selfmade mesh
meshcorners_18 = MeshCorners(Mesh=mesh_36, Angle=2.35619449)
negative_18 = Negative(Value=force_18)
curve_35 = Curve(mesh_edges_18.NakedEdges)
curve_36 = Curve(mesh_edges_18.InteriorEdges)
point_172 = Point(deconstruct_mesh_18.Vertices)
point_173 = Point(list_item_32.Item)
point_174 = Point(list_item_32.Item1)
point_175 = Point(list_item_32.Item2)
point_176 = Point(list_item_32.Item3)
# Support
move_31 = Move(Geometry=point_168, Motion=unit_z_48)  # -> Geometry, Transform
move_32 = Move(Geometry=point_170, Motion=unit_z_48)  # -> Geometry, Transform
crv_cp_18 = CurveClosestPoint(Point=point_172, Curve=join_36)  # -> Point, Parameter, Distance
# Spring strength
strength_external_17 = Slider(31.9, range=5..40)
fixed_length_17 = Panel("0")
# Spring strength
strength_internal_17 = Slider(10, range=5..20)
unit_z_49 = UnitZ(Factor=reposition_support_17)
unit_z_50 = UnitZ(Factor=force_18)
reposition_support_18 = Slider(0, range=0..10)
eval_18 = Evaluate(F="If(x<0.1, 1, 0)", x=crv_cp_18.Distance)
list_item_33 = ListItem(List=meshcorners_18, Index=0, Wrap=True)  # -> Item, Item1, Item2, Item3
# Support
move_33 = Move(Geometry=point_173, Motion=unit_z_49)  # -> Geometry, Transform
cull_18 = CullPattern(List=point_172, CullPattern=eval_18)
move_34 = Move(Geometry=point_175, Motion=unit_z_49)  # -> Geometry, Transform
merge_38 = Merge(Data1=move_31.Geometry, Data2=point_169, Data3=move_32.Geometry, Data4=point_171)
point_177 = Point(list_item_33.Item)
point_178 = Point(list_item_33.Item2)
point_179 = Point(list_item_33.Item3)
point_180 = Point(list_item_33.Item1)
strength_external_18 = Slider(31.9, range=5..40)
fixed_length_18 = Panel("0")
strength_internal_18 = Slider(12.9, range=5..20)
unit_z_51 = UnitZ(Factor=reposition_support_18)
merge_39 = Merge(Data1=meshcorners_16, Data2=cull_16)
merge_40 = Merge(Data1=move_33.Geometry, Data2=point_174, Data3=move_34.Geometry, Data4=point_176)
move_35 = Move(Geometry=point_177, Motion=unit_z_51)  # -> Geometry, Transform
move_36 = Move(Geometry=point_178, Motion=unit_z_51)  # -> Geometry, Transform
mesh_point_16 = Point(deconstruct_mesh_16.Vertices)
point_181 = Point(point_168)
point_182 = Point(point_170)
point_183 = Point(move_31.Geometry)
point_184 = Point(move_32.Geometry)
line_16 = Line(StartPoint=point_181, EndPoint=point_182)
length_line_31 = LengthLine(Line=curve_31, Length=fixed_length_16, Strength=strength_external_16)
load_16 = Load(Point=point_166, ForceVector=unit_z_46, Weighting=1)
anchor_16 = Anchor(Point=merge_39, Target=merge_39, Strength=10000)
length_line_32 = LengthLine(Line=curve_32, Length=fixed_length_16, Strength=strength_internal_16)
distance_16 = Distance(PointA=point_183, PointB=point_184)
merge_41 = Merge(Data1=meshcorners_17, Data2=cull_17)
mesh_point_17 = Point(deconstruct_mesh_17.Vertices)
point_185 = Point(point_173)
point_186 = Point(point_175)
point_187 = Point(move_33.Geometry)
point_188 = Point(move_34.Geometry)
unit_z_52 = UnitZ(Factor=1)
merge_42 = Merge(Data1=move_35.Geometry, Data2=point_180, Data3=move_36.Geometry, Data4=point_179)
line_17 = Line(StartPoint=point_185, EndPoint=point_186)
length_line_33 = LengthLine(Line=curve_33, Length=fixed_length_17, Strength=strength_external_17)
load_17 = Load(Point=point_167, ForceVector=unit_z_47, Weighting=1)
anchor_17 = Anchor(Point=merge_41, Target=merge_41, Strength=10000)
multiplication_16 = Multiplication(A=distance_16, B=Slider(1.49, range=1..2))
length_line_34 = LengthLine(Line=curve_34, Length=fixed_length_17, Strength=strength_internal_17)
distance_17 = Distance(PointA=point_187, PointB=point_188)
show_16 = Show(G=mesh_34)
merge_43 = Merge(Data1=meshcorners_18, Data2=cull_18)
mesh_point_18 = Point(deconstruct_mesh_18.Vertices)
point_189 = Point(point_177)
point_190 = Point(point_178)
catenary_16 = Catenary(PointA=point_183, PointB=point_184, Length=multiplication_16, Gravity=unit_z_52)
point_191 = Point(move_35.Geometry)
point_192 = Point(move_36.Geometry)
unit_z_53 = UnitZ(Factor=1)
curve_closest_point_16 = CurveClosestPoint(Point=mesh_point_16, Curve=line_16)  # -> Point, Parameter, Distance
multiplication_17 = Multiplication(A=distance_17, B=Slider(1.49, range=1..2))
show_17 = Show(G=mesh_35)
line_18 = Line(StartPoint=point_189, EndPoint=point_190)
length_line_35 = LengthLine(Line=curve_35, Length=fixed_length_18, Strength=strength_external_18)
load_18 = Load(Point=point_172, ForceVector=unit_z_50, Weighting=1)
anchor_18 = Anchor(Point=merge_43, Target=merge_43, Strength=10000)
length_line_36 = LengthLine(Line=curve_36, Length=fixed_length_18, Strength=strength_internal_18)
distance_18 = Distance(PointA=point_191, PointB=point_192)
reset_button_16 = Button()
activate_16 = BooleanToggle(True)
entwine_16 = Entwine(
    Branch00=show_16,
    Branch01=anchor_16,
    Branch02=length_line_31,
    Branch03=length_line_32,
    Branch04=load_16,
    FlattenInputs=True)
catenary_17 = Catenary(PointA=point_187, PointB=point_188, Length=multiplication_17, Gravity=unit_z_53)
curve_closest_point_17 = CurveClosestPoint(Point=mesh_point_17, Curve=line_17)  # -> Point, Parameter, Distance
larger_than_16 = LargerThan(FirstNumber=curve_closest_point_16.Distance, SecondNumber="0.1")  # -> LargerThan, OrEqualTo
dispatch_16 = Dispatch(List=mesh_point_16, DispatchPattern=larger_than_16.LargerThan)  # -> ListA, ListB
unit_z_54 = UnitZ(Factor=1)
reset_button_17 = Button()
activate_17 = BooleanToggle(True)
entwine_17 = Entwine(
    Branch00=show_17,
    Branch01=anchor_17,
    Branch02=length_line_33,
    Branch03=length_line_34,
    Branch04=load_17,
    FlattenInputs=True)
solver_16 = Solver(GoalObjects=flatten(entwine_16), Reset=reset_button_16, Threshold=1e-15, Tolerance=0.01, On=activate_16)  # -> I, V, O
multiplication_18 = Multiplication(A=distance_18, B=Slider(1.49, range=1..2))
show_18 = Show(G=mesh_36)
point_193 = Point(dispatch_16.ListB)
point_194 = Point(dispatch_16.ListA)
larger_than_17 = LargerThan(FirstNumber=curve_closest_point_17.Distance, SecondNumber="0.1")  # -> LargerThan, OrEqualTo
dispatch_17 = Dispatch(List=mesh_point_17, DispatchPattern=larger_than_17.LargerThan)  # -> ListA, ListB
catenary_18 = Catenary(PointA=point_191, PointB=point_192, Length=multiplication_18, Gravity=unit_z_54)
curve_closest_point_18 = CurveClosestPoint(Point=mesh_point_18, Curve=line_18)  # -> Point, Parameter, Distance
solver_17 = Solver(GoalObjects=flatten(entwine_17), Reset=reset_button_17, Threshold=1e-15, Tolerance=0.01, On=activate_17)  # -> I, V, O
reset_button_18 = Button()
activate_18 = BooleanToggle(True)
point_195 = Point(dispatch_17.ListB)
entwine_18 = Entwine(
    Branch00=show_18,
    Branch01=anchor_18,
    Branch02=length_line_35,
    Branch03=length_line_36,
    Branch04=load_18,
    FlattenInputs=True)
point_196 = Point(dispatch_17.ListA)
oncurve_16 = OnCurve(Points=point_193, Curve=catenary_16, Strength=Slider(50, range=1..50))
larger_than_18 = LargerThan(FirstNumber=curve_closest_point_18.Distance, SecondNumber="0.1")  # -> LargerThan, OrEqualTo
dispatch_18 = Dispatch(List=mesh_point_18, DispatchPattern=larger_than_18.LargerThan)  # -> ListA, ListB
solver_18 = Solver(GoalObjects=flatten(entwine_18), Reset=reset_button_18, Threshold=1e-15, Tolerance=0.01, On=activate_18)  # -> I, V, O
oncurve_17 = OnCurve(Points=point_195, Curve=catenary_17, Strength=Slider(50, range=1..50))
point_197 = Point(dispatch_18.ListB)
point_198 = Point(dispatch_18.ListA)
oncurve_18 = OnCurve(Points=point_197, Curve=catenary_18, Strength=Slider(50, range=1..50))
list_item_34 = ListItem(List=solver_16.O, Index=0, Wrap=True)
list_item_35 = ListItem(List=solver_17.O, Index=0, Wrap=True)
list_item_36 = ListItem(List=solver_18.O, Index=0, Wrap=True)
