# Grasshopper definition FullVault02.gh (Grasshopper 1.0.7)
# plug-ins: Kangaroo2 Components

curve = Curve(<curve referenced from the Rhino model>)
boundary = BoundarySurfaces(Edges=curve)
curve_2 = Curve(<curve referenced from the Rhino model>)
join = BrepJoin(Breps=boundary)  # -> Breps, Closed
boundary_2 = BoundarySurfaces(Edges=curve_2)
srf = Surface(join.Breps)
join_2 = BrepJoin(Breps=boundary_2)  # -> Breps, Closed
toggle = BooleanToggle(True)
debrep = DeconstructBrep(Brep=srf)  # -> Faces, Edges, Vertices
srf_2 = Surface(join_2.Breps)
item = ListItem(List=debrep.Edges, Index=0, Wrap=True)  # -> Item, Item1, Item2, Item3
custom_mesh_settings = SettingsCustom(
    StitchSeams=toggle,
    SimplePlanes=False,
    Refine=toggle,
    MinCount="1600",
    MaxCount="1600",
    AspectRatio=20,
    MaxDistance=0,
    MaxAngle=20,
    MinEdge="0",
    MaxEdge="0")
toggle_2 = BooleanToggle(True)
debrep_2 = DeconstructBrep(Brep=srf_2)  # -> Faces, Edges, Vertices
relay = Relay([item.Item1, item.Item, item.Item2, item.Item3])
join_3 = JoinCurves(Curves=relay, Preserve=False)
mesh = MeshBrep(Brep=srf, Settings=custom_mesh_settings)
item_2 = ListItem(List=debrep_2.Edges, Index=0, Wrap=True)  # -> Item, Item1, Item2, Item3
custom_mesh_settings_2 = SettingsCustom(
    StitchSeams=toggle_2,
    SimplePlanes=False,
    Refine=toggle_2,
    MinCount="1600",
    MaxCount="1600",
    AspectRatio=20,
    MaxDistance=0,
    MaxAngle=20,
    MinEdge="0",
    MaxEdge="0")
relay_2 = Relay([item_2.Item1, item_2.Item, item_2.Item2, item_2.Item3])
join_4 = JoinCurves(Curves=relay_2, Preserve=False)
mesh_2 = MeshBrep(Brep=srf_2, Settings=custom_mesh_settings_2)
density = Slider(20, range=0..100)
mesh_plane = MeshPlane(Boundary={Plane=PlaneXY(0, 0, 0), Size=Domain2(u=-10..10, v=-10..10)}, WidthCount=density, HeightCount=density)  # -> Mesh, Area
density_2 = Slider(20, range=0..100)
mesh_edges = MeshEdges(Mesh=mesh)  # -> NakedEdges, InteriorEdges, NonManifoldEdges
deconstruct_mesh = DeconstructMesh(Mesh=mesh)  # -> Vertices, Faces, Colours, Normals
force = Slider(2.5, range=0..5)
mesh_plane_2 = MeshPlane(Boundary={Plane=PlaneXY(0, 0, 0), Size=Domain2(u=-10..10, v=-10..10)}, WidthCount=density_2, HeightCount=density_2)  # -> Mesh, Area
mesh_3 = Mesh(mesh)
# Selfmade mesh
meshcorners = MeshCorners(Mesh=mesh_3, Angle=2.35619449)
# Create 'beam'
negative = Negative(Value=force)
mesh_edges_2 = MeshEdges(Mesh=mesh_2)  # -> NakedEdges, InteriorEdges, NonManifoldEdges
deconstruct_mesh_2 = DeconstructMesh(Mesh=mesh_2)  # -> Vertices, Faces, Colours, Normals
curve_3 = Curve(mesh_edges.NakedEdges)
force_2 = Slider(2.5, range=0..5)
curve_4 = Curve(mesh_edges.InteriorEdges)
point = Point(deconstruct_mesh.Vertices)
crv_cp = CurveClosestPoint(Point=point, Curve=join_3)  # -> Point, Parameter, Distance
mesh_4 = Mesh(mesh_2)
unit_z = UnitZ(Factor=force)
reposition_support = Slider(0, range=0..10)
# Selfmade mesh
meshcorners_2 = MeshCorners(Mesh=mesh_4, Angle=2.35619449)

# ---- group: Hanging
# Support
negative_2 = Negative(Value=force_2)

# ----
eval = Evaluate(F="If(x<0.1, 1, 0)", x=crv_cp.Distance)
curve_5 = Curve(mesh_edges_2.NakedEdges)
curve_6 = Curve(mesh_edges_2.InteriorEdges)
point_2 = Point(deconstruct_mesh_2.Vertices)
# Support
list_item = ListItem(List=meshcorners, Index=0, Wrap=True)  # -> Item, Item1, Item2, Item3
cull = CullPattern(List=point, CullPattern=eval)
crv_cp_2 = CurveClosestPoint(Point=point_2, Curve=join_4)  # -> Point, Parameter, Distance

# ---- group: Standing
unit_z_2 = UnitZ(Factor=force_2)

# ----
point_3 = Point(list_item.Item)
point_4 = Point(list_item.Item2)
point_5 = Point(list_item.Item3)
point_6 = Point(list_item.Item1)

# ----
# Support
reposition_support_2 = Slider(0, range=0..10)
list_item_2 = ListItem(List=meshcorners_2, Index=0, Wrap=True)  # -> Item, Item1, Item2, Item3
point_7 = Point(list_item_2.Item)
point_8 = Point(list_item_2.Item2)
point_9 = Point(list_item_2.Item3)
point_10 = Point(list_item_2.Item1)
unit_z_3 = UnitZ(Factor=reposition_support_2)
move = Move(Geometry=point_7, Motion=unit_z_3)  # -> Geometry, Transform
move_2 = Move(Geometry=point_8, Motion=unit_z_3)  # -> Geometry, Transform
merge = Merge(Data1=move.Geometry, Data2=point_10, Data3=move_2.Geometry, Data4=point_9)

# ----
# Spring strength
strength_external = Slider(100, range=5..100)
fixed_length = Panel("0")
strength_internal = Slider(31.6, range=5..50)
unit_z_4 = UnitZ(Factor=reposition_support)
eval_2 = Evaluate(F="If(x<0.1, 1, 0)", x=crv_cp_2.Distance)
cull_2 = CullPattern(List=point_2, CullPattern=eval_2)

# ----
# Spring strength
strength_external_2 = Slider(100, range=5..100)
fixed_length_2 = Panel("0")
strength_internal_2 = Slider(31.6, range=5..50)

move_3 = Move(Geometry=point_3, Motion=unit_z_4)  # -> Geometry, Transform
move_4 = Move(Geometry=point_4, Motion=unit_z_4)  # -> Geometry, Transform
merge_2 = Merge(Data1=move_3.Geometry, Data2=point_6, Data3=move_4.Geometry, Data4=point_5)
merge_3 = Merge(Data1=meshcorners, Data2=cull)
mesh_point = Point(deconstruct_mesh.Vertices)
point_11 = Point(point_3)
point_12 = Point(point_4)
point_13 = Point(move_3.Geometry)
point_14 = Point(move_4.Geometry)
line = Line(StartPoint=point_11, EndPoint=point_12)
length_line = LengthLine(Line=curve_3, Length=fixed_length, Strength=strength_external)
load = Load(Point=point, ForceVector=unit_z, Weighting=1)
# Support
# Forces
anchor = Anchor(Point=merge_3, Target=merge_3, Strength=10000)
# Spring strength
length_line_2 = LengthLine(Line=curve_4, Length=fixed_length, Strength=strength_internal)
distance = Distance(PointA=point_13, PointB=point_14)
merge_4 = Merge(Data1=meshcorners_2, Data2=cull_2)
mesh_point_2 = Point(deconstruct_mesh_2.Vertices)
point_15 = Point(point_7)
point_16 = Point(point_8)
point_17 = Point(move.Geometry)
point_18 = Point(move_2.Geometry)
unit_z_5 = UnitZ(Factor=1)
line_2 = Line(StartPoint=point_15, EndPoint=point_16)

# ----
# Forces
length_line_3 = LengthLine(Line=curve_5, Length=fixed_length_2, Strength=strength_external_2)
load_2 = Load(Point=point_2, ForceVector=unit_z_2, Weighting=1)
anchor_2 = Anchor(Point=merge_4, Target=merge_4, Strength=10000)
length_line_4 = LengthLine(Line=curve_6, Length=fixed_length_2, Strength=strength_internal_2)

multiplication = Multiplication(A=distance, B=Slider(1.49, range=1..2))
distance_2 = Distance(PointA=point_17, PointB=point_18)
show = Show(G=mesh_3)
catenary = Catenary(PointA=point_13, PointB=point_14, Length=multiplication, Gravity=unit_z_5)
unit_z_6 = UnitZ(Factor=1)
# Forces
curve_closest_point = CurveClosestPoint(Point=mesh_point, Curve=line)  # -> Point, Parameter, Distance
multiplication_2 = Multiplication(A=distance_2, B=Slider(1.49, range=1..2))
show_2 = Show(G=mesh_4)
reset_button = Button()
# Tutorial: https://www.youtube.com/watch?v=SW_xQx1x_5g
activate = BooleanToggle(True)
entwine = Entwine(Branch00=show, Branch01=anchor, Branch02=length_line, Branch03=length_line_2, Branch04=load, FlattenInputs=True)
catenary_2 = Catenary(PointA=point_17, PointB=point_18, Length=multiplication_2, Gravity=unit_z_6)
curve_closest_point_2 = CurveClosestPoint(Point=mesh_point_2, Curve=line_2)  # -> Point, Parameter, Distance
larger_than = LargerThan(FirstNumber=curve_closest_point.Distance, SecondNumber="0.1")  # -> LargerThan, OrEqualTo
dispatch = Dispatch(List=mesh_point, DispatchPattern=larger_than.LargerThan)  # -> ListA, ListB
reset_button_2 = Button()
# Tutorial: https://www.youtube.com/watch?v=SW_xQx1x_5g
activate_2 = BooleanToggle(True)
# Forces
solver = Solver(GoalObjects=flatten(entwine), Reset=reset_button, Threshold=1e-15, Tolerance=0.01, On=activate)  # -> I, V, O
entwine_2 = Entwine(Branch00=show_2, Branch01=anchor_2, Branch02=length_line_3, Branch03=length_line_4, Branch04=load_2, FlattenInputs=True)
point_19 = Point(dispatch.ListB)
point_20 = Point(dispatch.ListA)
larger_than_2 = LargerThan(FirstNumber=curve_closest_point_2.Distance, SecondNumber="0.1")  # -> LargerThan, OrEqualTo
dispatch_2 = Dispatch(List=mesh_point_2, DispatchPattern=larger_than_2.LargerThan)  # -> ListA, ListB
solver_2 = Solver(GoalObjects=flatten(entwine_2), Reset=reset_button_2, Threshold=1e-15, Tolerance=0.01, On=activate_2)  # -> I, V, O
point_21 = Point(dispatch_2.ListB)
point_22 = Point(dispatch_2.ListA)
oncurve = OnCurve(Points=point_19, Curve=catenary, Strength=Slider(50, range=1..50))
oncurve_2 = OnCurve(Points=point_21, Curve=catenary_2, Strength=Slider(50, range=1..50))
# Output
list_item_3 = ListItem(List=solver.O, Index=0, Wrap=True)  # -> Item, Item1
# Output
list_item_4 = ListItem(List=solver_2.O, Index=0, Wrap=True)  # -> Item, Item1
