# Grasshopper definition 00JunctionFormFinding01.gh (Grasshopper 1.0.7)
# plug-ins: Karamba, Kangaroo2 Components

curve = Curve()
boundary = BoundarySurfaces(Edges=curve)
join = BrepJoin(Breps=boundary)  # -> Breps, Closed
srf = Surface(join.Breps)
toggle = BooleanToggle(True)
debrep = DeconstructBrep(Brep=srf)  # -> Faces, Edges, Vertices
item = ListItem(List=debrep.Edges, Index=0, Wrap=True)  # -> Item, Item1, Item2, Item3
custom_mesh_settings = SettingsCustom(
    StitchSeams=toggle,
    SimplePlanes=False,
    Refine=toggle,
    MinCount="1600",
    MaxCount="1600",
    AspectRatio=20,
    MaxDistance=0,
    MaxAngle=20,
    MinEdge="0",
    MaxEdge="0")
relay = Relay([item.Item1, item.Item, item.Item2, item.Item3])
join_2 = JoinCurves(Curves=relay, Preserve=False)
mesh = MeshBrep(Brep=srf, Settings=custom_mesh_settings)
density = Slider(20, range=0..100)
mesh_plane = MeshPlane(Boundary={Plane=PlaneXY(0, 0, 0), Size=Domain2(u=-10..10, v=-10..10)}, WidthCount=density, HeightCount=density)  # -> Mesh, Area
mesh_edges = MeshEdges(Mesh=mesh)  # -> NakedEdges, InteriorEdges, NonManifoldEdges
deconstruct_mesh = DeconstructMesh(Mesh=mesh)  # -> Vertices, Faces, Colours, Normals
force = Slider(2.5, range=0..5)
mesh_2 = Mesh(mesh)
# Selfmade mesh
meshcorners = MeshCorners(Mesh=mesh_2, Angle=2.35619449)
negative = Negative(Value=force)
curve_2 = Curve(mesh_edges.NakedEdges)
curve_3 = Curve(mesh_edges.InteriorEdges)
point = Point(deconstruct_mesh.Vertices)
crv_cp = CurveClosestPoint(Point=point, Curve=join_2)  # -> Point, Parameter, Distance
unit_z = UnitZ(Factor=force)
reposition_support = Slider(0, range=0..10)
eval = Evaluate(F="If(x<0.1, 1, 0)", x=crv_cp.Distance)
list_item = ListItem(List=meshcorners, Index=0, Wrap=True)  # -> Item, Item1, Item2, Item3
cull = CullPattern(List=point, CullPattern=eval)
point_2 = Point(list_item.Item)
point_3 = Point(list_item.Item2)
point_4 = Point(list_item.Item3)
point_5 = Point(list_item.Item1)
strength_external = Slider(100, range=5..100)
fixed_length = Panel("0")
strength_internal = Slider(31.6, range=5..50)
unit_z_2 = UnitZ(Factor=reposition_support)
move = Move(Geometry=point_2, Motion=unit_z_2)  # -> Geometry, Transform
move_2 = Move(Geometry=point_3, Motion=unit_z_2)  # -> Geometry, Transform
merge = Merge(Data1=move.Geometry, Data2=point_5, Data3=move_2.Geometry, Data4=point_4)
merge_2 = Merge(Data1=meshcorners, Data2=cull)
mesh_point = Point(deconstruct_mesh.Vertices)
point_6 = Point(point_2)
point_7 = Point(point_3)
point_8 = Point(move.Geometry)
point_9 = Point(move_2.Geometry)
line = Line(StartPoint=point_6, EndPoint=point_7)
length_line = LengthLine(Line=curve_2, Length=fixed_length, Strength=strength_external)
load = Load(Point=point, ForceVector=unit_z, Weighting=1)
anchor = Anchor(Point=merge_2, Target=merge_2, Strength=10000)
length_line_2 = LengthLine(Line=curve_3, Length=fixed_length, Strength=strength_internal)
distance = Distance(PointA=point_8, PointB=point_9)
unit_z_3 = UnitZ(Factor=1)
multiplication = Multiplication(A=distance, B=Slider(1.49, range=1..2))
show = Show(G=mesh_2)
catenary = Catenary(PointA=point_8, PointB=point_9, Length=multiplication, Gravity=unit_z_3)
curve_closest_point = CurveClosestPoint(Point=mesh_point, Curve=line)  # -> Point, Parameter, Distance
reset_button = Button()
activate = BooleanToggle(True)
entwine = Entwine(Branch00=show, Branch01=anchor, Branch02=length_line, Branch03=length_line_2, Branch04=load, FlattenInputs=True)
larger_than = LargerThan(FirstNumber=curve_closest_point.Distance, SecondNumber="0.1")  # -> LargerThan, OrEqualTo
# Create 'beam'
dispatch = Dispatch(List=mesh_point, DispatchPattern=larger_than.LargerThan)  # -> ListA, ListB
solver = Solver(GoalObjects=flatten(entwine), Reset=reset_button, Threshold=1e-15, Tolerance=0.01, On=activate)  # -> I, V, O
point_10 = Point(dispatch.ListB)
point_11 = Point(dispatch.ListA)
oncurve = OnCurve(Points=point_10, Curve=catenary, Strength=Slider(50, range=1..50))

negative_2 = Negative(Value=Slider(2.5, range=0..2.5))
unit_z_4 = UnitZ(Factor=negative_2)
force_2 = Slider(0.5, range=0.5..50)
crv = Curve([<curve referenced from the Rhino model> x2])
number_slider = Slider(1.3, range=1.1..2.1)
negative_3 = Negative(Value=force_2)
division = Division(A=number_slider, B=3.6)
move_3 = Move(Geometry=crv, Motion=unit_z_4)  # -> Geometry, Transform
len = Length(Curve=move_3.Geometry)
multiplication_2 = Multiplication(A=len, B=number_slider)
unit_z_5 = UnitZ(Factor=force_2)
end = EndPoints(Curve=move_3.Geometry)  # -> Start, End
cat = Catenary(PointA=end.Start, PointB=end.End, Length=multiplication_2, Gravity="0,0,1")
item_2 = ListItem(List=cat, Index="0", Wrap=True)  # -> Item, Item1
item_3 = ListItem(List=move_3.Geometry, Index="0", Wrap=True)  # -> Item, Item1

list_item_2 = ListItem(List=solver.O, Index=0, Wrap=True)  # -> Item, Item1
negative_4 = Negative(Value=Slider(1.5, range=0..10))
negative_5 = Negative(Value=Slider(1, range=0..1))
negative_6 = Negative(Value=Slider(1, range=0..1))
negative_7 = Negative(Value=Slider(1.5, range=0..10))
boundary_surfaces = BoundarySurfaces(Edges=[item_3.Item, item_3.Item1, item_2.Item, item_2.Item1])
unit_z_6 = UnitZ(Factor=negative_4)
unit_z_7 = UnitZ(Factor=negative_5)
unit_z_8 = UnitZ(Factor=negative_6)
force_3 = Slider(1, range=0.5..50)
force_4 = Slider(1, range=0.5..50)
crv_2 = Curve([<curve referenced from the Rhino model> x2])
number_slider_2 = Slider(1.3, range=1.1..2.1)
crv_3 = Curve([<curve referenced from the Rhino model> x2])
unit_z_9 = UnitZ(Factor=negative_7)
number_slider_3 = Slider(1.3, range=1.1..2.1)
unit_z_10 = UnitZ(Factor=1)
unit_z_11 = UnitZ(Factor=1)

# ---- group: Extrution Wall
negative_8 = Negative(Value=Slider(2.5, range=0..10))
curve_4 = Curve([<curve referenced from the Rhino model> x9])
unit_z_12 = UnitZ(Factor=negative_8)
extrude = Extrude(Base=curve_4, Direction=unit_z_12)

# ---- group: Hanging
negative_9 = Negative(Value=force_3)

# ----
negative_10 = Negative(Value=force_4)
division_2 = Division(A=number_slider_2, B=3.6)
division_3 = Division(A=number_slider_3, B=3.6)
move_4 = Move(Geometry=crv_2, Motion=unit_z_7)  # -> Geometry, Transform
len_2 = Length(Curve=move_4.Geometry)
multiplication_3 = Multiplication(A=len_2, B=number_slider_2)
move_5 = Move(Geometry=crv_3, Motion=unit_z_8)  # -> Geometry, Transform
len_3 = Length(Curve=move_5.Geometry)
multiplication_4 = Multiplication(A=len_3, B=number_slider_3)

# ---- group: Standing
unit_z_13 = UnitZ(Factor=force_3)

# ----
unit_z_14 = UnitZ(Factor=force_4)
end_2 = EndPoints(Curve=move_4.Geometry)  # -> Start, End
end_3 = EndPoints(Curve=move_5.Geometry)  # -> Start, End
negative_11 = Negative(Value=Slider(1.5, range=0..10))
negative_12 = Negative(Value=Slider(1.5, range=0..10))
cat_2 = Catenary(PointA=end_2.Start, PointB=end_2.End, Length=multiplication_3, Gravity="0,0,1")
cat_3 = Catenary(PointA=end_3.Start, PointB=end_3.End, Length=multiplication_4, Gravity="0,0,1")
end_points = EndPoints(Curve=move_4.Geometry)  # -> Start, End
end_points_2 = EndPoints(Curve=move_5.Geometry)  # -> Start, End
item_4 = ListItem(List=cat_2, Index="0", Wrap=True)  # -> Item, Item1
item_5 = ListItem(List=move_4.Geometry, Index="0", Wrap=True)  # -> Item, Item1
item_6 = ListItem(List=cat_3, Index="0", Wrap=True)  # -> Item, Item1
item_7 = ListItem(List=move_5.Geometry, Index="0", Wrap=True)  # -> Item, Item1

negative_13 = Negative(Value=Slider(2.5, range=0..2.5))
unit_z_15 = UnitZ(Factor=negative_13)
force_5 = Slider(0.5, range=0.5..50)
crv_4 = Curve([<curve referenced from the Rhino model> x2])
number_slider_4 = Slider(1.3, range=1.1..2.1)
negative_14 = Negative(Value=force_5)
division_4 = Division(A=number_slider_4, B=3.6)
move_6 = Move(Geometry=crv_4, Motion=unit_z_15)  # -> Geometry, Transform
len_4 = Length(Curve=move_6.Geometry)
multiplication_5 = Multiplication(A=len_4, B=number_slider_4)
unit_z_16 = UnitZ(Factor=force_5)
end_4 = EndPoints(Curve=move_6.Geometry)  # -> Start, End
cat_4 = Catenary(PointA=end_4.Start, PointB=end_4.End, Length=multiplication_5, Gravity="0,0,1")
item_8 = ListItem(List=move_6.Geometry, Index="0", Wrap=True)  # -> Item, Item1
item_9 = ListItem(List=cat_4, Index="0", Wrap=True)  # -> Item, Item1

move_7 = Move(Geometry=move_5.Geometry, Motion=unit_z_6)  # -> Geometry, Transform
move_8 = Move(Geometry=move_4.Geometry, Motion=unit_z_9)  # -> Geometry, Transform
line_sdl = LineSDL(Start=end_points.Start, Direction=unit_z_10, Length=negative_11)
line_sdl_2 = LineSDL(Start=end_points_2.Start, Direction=unit_z_11, Length=negative_12)
line_sdl_3 = LineSDL(Start=end_points.End, Direction=unit_z_10, Length=negative_11)
panel = Panel("10")
line_sdl_4 = LineSDL(Start=end_points_2.End, Direction=unit_z_11, Length=negative_12)

# ---- group: Dome North
# Selfmade mesh
# Support
# Forces
# Output
# Spring strength
# Tutorial: https://www.youtube.com/watch?v=SW_xQx1x_5g
curve_5 = Curve([<curve referenced from the Rhino model> x2])
boundary_2 = BoundarySurfaces(Edges=curve_5)
join_3 = BrepJoin(Breps=boundary_2)  # -> Breps, Closed
srf_2 = Surface(join_3.Breps)
toggle_2 = BooleanToggle(True)
debrep_2 = DeconstructBrep(Brep=srf_2)  # -> Faces, Edges, Vertices
item_10 = ListItem(List=debrep_2.Edges, Index=0, Wrap=True)  # -> Item, Item1, Item2, Item3
custom_mesh_settings_2 = SettingsCustom(
    StitchSeams=toggle_2,
    SimplePlanes=False,
    Refine=toggle_2,
    MinCount="1600",
    MaxCount="1600",
    AspectRatio=20,
    MaxDistance=0,
    MaxAngle=20,
    MinEdge="0",
    MaxEdge="0")
relay_2 = Relay([item_10.Item1, item_10.Item, item_10.Item2, item_10.Item3])
# support curves
join_4 = JoinCurves(Curves=relay_2, Preserve=False)
mesh_3 = MeshBrep(Brep=srf_2, Settings=custom_mesh_settings_2)
density_2 = Slider(20, range=0..100)
mesh_plane_2 = MeshPlane(Boundary={Plane=PlaneXY(0, 0, 0), Size=Domain2(u=-10..10, v=-10..10)}, WidthCount=density_2, HeightCount=density_2)  # -> Mesh, Area
mesh_edges_2 = MeshEdges(Mesh=mesh_3)  # -> NakedEdges, InteriorEdges, NonManifoldEdges
deconstruct_mesh_2 = DeconstructMesh(Mesh=mesh_3)  # -> Vertices, Faces, Colours, Normals
force_6 = Slider(0.6, range=0..5)
mesh_4 = Mesh(mesh_3)
meshcorners_2 = MeshCorners(Mesh=mesh_4, Angle=2.35619449)
negative_15 = Negative(Value=force_6)
curve_6 = Curve(mesh_edges_2.NakedEdges)
curve_7 = Curve(mesh_edges_2.InteriorEdges)
point_12 = Point(deconstruct_mesh_2.Vertices)
crv_cp_2 = CurveClosestPoint(Point=point_12, Curve=join_4)  # -> Point, Parameter, Distance
unit_z_17 = UnitZ(Factor=force_6)
reposition_support_2 = Slider(0, range=0..10)
eval_2 = Evaluate(F="If(x<0.1, 1, 0)", x=crv_cp_2.Distance)
list_item_3 = ListItem(List=meshcorners_2, Index=0, Wrap=True)  # -> Item, Item1, Item2, Item3
cull_2 = CullPattern(List=point_12, CullPattern=eval_2)
point_13 = Point(list_item_3.Item)
point_14 = Point(list_item_3.Item2)
point_15 = Point(list_item_3.Item3)
point_16 = Point(list_item_3.Item1)
strength_external_2 = Slider(100, range=5..100)
fixed_length_2 = Panel("0")
strength_internal_2 = Slider(31.6, range=5..50)
unit_z_18 = UnitZ(Factor=reposition_support_2)
move_9 = Move(Geometry=point_13, Motion=unit_z_18)  # -> Geometry, Transform
move_10 = Move(Geometry=point_14, Motion=unit_z_18)  # -> Geometry, Transform
merge_3 = Merge(Data1=move_9.Geometry, Data2=point_16, Data3=move_10.Geometry, Data4=point_15)
merge_4 = Merge(Data1=meshcorners_2, Data2=cull_2)
mesh_point_2 = Point(deconstruct_mesh_2.Vertices)
point_17 = Point(point_13)
point_18 = Point(point_14)
point_19 = Point(move_9.Geometry)
point_20 = Point(move_10.Geometry)
line_2 = Line(StartPoint=point_17, EndPoint=point_18)
length_line_3 = LengthLine(Line=curve_6, Length=fixed_length_2, Strength=strength_external_2)
load_2 = Load(Point=point_12, ForceVector=unit_z_17, Weighting=1)
anchor_2 = Anchor(Point=merge_4, Target=merge_4, Strength=10000)
length_line_4 = LengthLine(Line=curve_7, Length=fixed_length_2, Strength=strength_internal_2)
distance_2 = Distance(PointA=point_19, PointB=point_20)
unit_z_19 = UnitZ(Factor=1)
multiplication_6 = Multiplication(A=distance_2, B=Slider(1.49, range=1..2))
show_2 = Show(G=mesh_4)
catenary_2 = Catenary(PointA=point_19, PointB=point_20, Length=multiplication_6, Gravity=unit_z_19)
curve_closest_point_2 = CurveClosestPoint(Point=mesh_point_2, Curve=line_2)  # -> Point, Parameter, Distance
reset_button_2 = Button()
activate_2 = BooleanToggle(True)
entwine_2 = Entwine(Branch00=show_2, Branch01=anchor_2, Branch02=length_line_3, Branch03=length_line_4, Branch04=load_2, FlattenInputs=True)
larger_than_2 = LargerThan(FirstNumber=curve_closest_point_2.Distance, SecondNumber="0.1")  # -> LargerThan, OrEqualTo
dispatch_2 = Dispatch(List=mesh_point_2, DispatchPattern=larger_than_2.LargerThan)  # -> ListA, ListB
# Spring strength
solver_2 = Solver(GoalObjects=flatten(entwine_2), Reset=reset_button_2, Threshold=1e-15, Tolerance=0.01, On=activate_2)  # -> I, V, O
point_21 = Point(dispatch_2.ListB)
point_22 = Point(dispatch_2.ListA)
# Support
number_slider_5 = Slider(50, range=1..50)
oncurve_2 = OnCurve(Points=point_21, Curve=catenary_2, Strength=number_slider_5)
# Forces
list_item_4 = ListItem(List=solver_2.O, Index=0, Wrap=True)  # -> Item, Item1

# ----
brep_join = BrepJoin(Breps=extrude)  # -> Breps, Closed
geometry = Geometry([line_sdl_2, line_sdl_4, cat_3, move_7.Geometry])
list_item_5 = ListItem(List=brep_join.Breps, Index=0, Wrap=True)  # -> Item, Item1, Item2, Item3, Item4
geometry_2 = Geometry([line_sdl, line_sdl_3, cat_2, move_8.Geometry])
boundary_surfaces_2 = BoundarySurfaces(Edges=geometry_2)
deconstruct_brep = DeconstructBrep(Brep=list_item_5.Item)  # -> Faces, Edges, Vertices
boundary_surfaces_3 = BoundarySurfaces(Edges=geometry)
list_item_6 = ListItem(List=deconstruct_brep.Faces, Index=0, Wrap=True)  # -> Item, Item1, Item2, Item3
deconstruct_brep_2 = DeconstructBrep(Brep=[list_item_5.Item1, list_item_5.Item2, list_item_5.Item3, list_item_5.Item4])  # -> graft(Faces), Edges, Vertices
surface = Surface([boundary_surfaces_2, boundary_surfaces_3])
boundary_surfaces_4 = BoundarySurfaces(Edges=[item_9.Item, item_9.Item1, item_8.Item, item_8.Item1])
list_item_7 = ListItem(List=surface, Index=0, Wrap=True)  # -> Item, Item1, Item2, Item3, Item4

negative_16 = Negative(Value=Slider(2.5, range=0..2.5))
unit_z_20 = UnitZ(Factor=negative_16)
force_7 = Slider(0.5, range=0.5..50)
crv_5 = Curve([<curve referenced from the Rhino model> x2])
number_slider_6 = Slider(1.3, range=1.1..2.1)
negative_17 = Negative(Value=force_7)
division_5 = Division(A=number_slider_6, B=3.6)
move_11 = Move(Geometry=crv_5, Motion=unit_z_20)  # -> Geometry, Transform
len_5 = Length(Curve=move_11.Geometry)
multiplication_7 = Multiplication(A=len_5, B=number_slider_6)
unit_z_21 = UnitZ(Factor=force_7)
end_5 = EndPoints(Curve=move_11.Geometry)  # -> Start, End
cat_5 = Catenary(PointA=end_5.Start, PointB=end_5.End, Length=multiplication_7, Gravity="0,0,1")
item_11 = ListItem(List=cat_5, Index="0", Wrap=True)  # -> Item, Item1
item_12 = ListItem(List=move_11.Geometry, Index="0", Wrap=True)  # -> Item, Item1

brep_wireframe = BrepWireframe(Brep=list_item_6.Item, Density=-1)
brep_wireframe_2 = BrepWireframe(Brep=list_item_7.Item4, Density=-1)
brep_wireframe_3 = BrepWireframe(Brep=list_item_6.Item2, Density=-1)
# catenary curves
brep_wireframe_4 = BrepWireframe(Brep=list_item_7.Item2, Density=-1)
brep_wireframe_5 = BrepWireframe(Brep=list_item_6.Item1, Density=-1)
brep_wireframe_6 = BrepWireframe(Brep=list_item_7.Item3, Density=-1)
brep_wireframe_7 = BrepWireframe(Brep=list_item_6.Item3, Density=-1)
brep_wireframe_8 = BrepWireframe(Brep=list_item_7.Item1, Density=-1)
brep_wireframe_9 = BrepWireframe(Brep=flatten(deconstruct_brep_2.Faces), Density=-1)
join_curves = JoinCurves(Curves=brep_wireframe, Preserve=False)
join_curves_2 = JoinCurves(Curves=brep_wireframe_8, Preserve=False)
join_curves_3 = JoinCurves(Curves=brep_wireframe_3, Preserve=False)
join_curves_4 = JoinCurves(Curves=brep_wireframe_5, Preserve=False)
join_curves_5 = JoinCurves(Curves=brep_wireframe_2, Preserve=False)
join_curves_6 = JoinCurves(Curves=brep_wireframe_7, Preserve=False)
join_curves_7 = JoinCurves(Curves=brep_wireframe_6, Preserve=False)
join_curves_8 = JoinCurves(Curves=brep_wireframe_4, Preserve=False)
join_curves_9 = JoinCurves(Curves=brep_wireframe_9, Preserve=False)

# ---- group: Dome South
# Spring strength
strength_external_3 = Slider(100, range=5..100)
fixed_length_3 = Panel("0")
strength_internal_3 = Slider(31.6, range=5..50)

# ----
region_difference = RegionDifference(CurvesA=join_curves_4, CurvesB=join_curves_7)
region_difference_2 = RegionDifference(CurvesA=join_curves_3, CurvesB=join_curves_5)
region_difference_3 = RegionDifference(CurvesA=join_curves, CurvesB=join_curves_2)
region_difference_4 = RegionDifference(CurvesA=join_curves_6, CurvesB=join_curves_8)

shift_list = ShiftList(List=flatten(join_curves_9), Shift=Slider(2, range=0..10), Wrap=True)
number_slider_7 = Slider(4, range=0..10)
reverse_list = ReverseList(List=shift_list)
panel_3 = Panel("2")
list_item_8 = ListItem(List=flatten(reverse_list), Index=number_slider_7, Wrap=True)
boundary_surfaces_5 = BoundarySurfaces(Edges=[item_11.Item1, item_12.Item1])
boundary_surfaces_6 = BoundarySurfaces(Edges=[item_12.Item, item_11.Item])
relay_3 = Relay([region_difference, region_difference_3, region_difference_2, region_difference_4])
surface_2 = Surface([boundary_surfaces_6, boundary_surfaces_5])
panel_4 = Panel("""0
2
4
6
9
11
13
15""")

negative_18 = Negative(Value=Slider(2.5, range=0..2.5))
unit_z_22 = UnitZ(Factor=negative_18)
force_8 = Slider(0.5, range=0.5..50)
crv_6 = Curve([<curve referenced from the Rhino model> x2])
number_slider_8 = Slider(1.3, range=1.1..2.1)
negative_19 = Negative(Value=force_8)
division_6 = Division(A=number_slider_8, B=3.6)
move_12 = Move(Geometry=crv_6, Motion=unit_z_22)  # -> Geometry, Transform
len_6 = Length(Curve=move_12.Geometry)
multiplication_8 = Multiplication(A=len_6, B=number_slider_8)
unit_z_23 = UnitZ(Factor=force_8)
end_6 = EndPoints(Curve=move_12.Geometry)  # -> Start, End
cat_6 = Catenary(PointA=end_6.Start, PointB=end_6.End, Length=multiplication_8, Gravity="0,0,1")
item_13 = ListItem(List=cat_6, Index="0", Wrap=True)  # -> Item, Item1
item_14 = ListItem(List=move_12.Geometry, Index="0", Wrap=True)  # -> Item, Item1

boundary_surfaces_7 = BoundarySurfaces(Edges=[item_14.Item1, item_13.Item1])
boundary_surfaces_8 = BoundarySurfaces(Edges=[item_14.Item, item_13.Item])
surface_3 = Surface([boundary_surfaces_7, boundary_surfaces_8])
brep_wireframe_10 = BrepWireframe(Brep=[boundary_surfaces, surface_2, boundary_surfaces_4, surface_3], Density=-1)
join_curves_10 = JoinCurves(Curves=brep_wireframe_10, Preserve=False)
list_item_9 = ListItem(List=join_curves_10, Index=0, Wrap=True)  # -> Item, Item1, Item2, Item3, Item4, Item5
brep = Brep(list_item_9.Item5)
list_item_10 = ListItem(List=flatten(brep), Index=number_slider_7, Wrap=True)
region_difference_5 = RegionDifference(CurvesA=reverse_list, CurvesB=list_item_9.Item5)
panel_5 = Panel(region_difference_5)
boundary_surfaces_9 = BoundarySurfaces(Edges=region_difference_5)
flatten_tree = FlattenTree(Tree=region_difference_5, Path="{0}")
cull_pattern = CullPattern(
    List=flatten_tree,
    CullPattern=[True, True, True, True, True, True, True, True, False, False, False, False, False, False, False, False])
list_item_11 = ListItem(List=flatten_tree, Index=panel_4, Wrap=True)

# ---- group: CenterLeft&Right
# Selfmade mesh
curve_8 = Curve([<curve referenced from the Rhino model> x2])
boundary_3 = BoundarySurfaces(Edges=curve_8)
join_5 = BrepJoin(Breps=boundary_3)  # -> Breps, Closed
srf_3 = Surface(join_5.Breps)
toggle_3 = BooleanToggle(True)
debrep_3 = DeconstructBrep(Brep=srf_3)  # -> Faces, Edges, Vertices
item_15 = ListItem(List=debrep_3.Edges, Index=0, Wrap=True)  # -> Item, Item1, Item2, Item3
custom_mesh_settings_3 = SettingsCustom(
    StitchSeams=toggle_3,
    SimplePlanes=False,
    Refine=toggle_3,
    MinCount="1600",
    MaxCount="1600",
    AspectRatio=20,
    MaxDistance=0,
    MaxAngle=20,
    MinEdge="0",
    MaxEdge="0")
relay_4 = Relay([item_15.Item1, item_15.Item, item_15.Item2, item_15.Item3])
# support curves
join_6 = JoinCurves(Curves=relay_4, Preserve=False)
mesh_5 = MeshBrep(Brep=srf_3, Settings=custom_mesh_settings_3)
density_3 = Slider(20, range=0..100)
mesh_plane_3 = MeshPlane(Boundary={Plane=PlaneXY(0, 0, 0), Size=Domain2(u=-10..10, v=-10..10)}, WidthCount=density_3, HeightCount=density_3)  # -> Mesh, Area
mesh_edges_3 = MeshEdges(Mesh=mesh_5)  # -> NakedEdges, InteriorEdges, NonManifoldEdges
deconstruct_mesh_3 = DeconstructMesh(Mesh=mesh_5)  # -> Vertices, Faces, Colours, Normals
force_9 = Slider(0.5, range=0..5)
mesh_6 = Mesh(mesh_5)
meshcorners_3 = MeshCorners(Mesh=mesh_6, Angle=2.35619449)
negative_20 = Negative(Value=force_9)
curve_9 = Curve(mesh_edges_3.NakedEdges)
curve_10 = Curve(mesh_edges_3.InteriorEdges)
point_23 = Point(deconstruct_mesh_3.Vertices)
crv_cp_3 = CurveClosestPoint(Point=point_23, Curve=join_6)  # -> Point, Parameter, Distance
unit_z_24 = UnitZ(Factor=force_9)
reposition_support_3 = Slider(0, range=0..10)
eval_3 = Evaluate(F="If(x<0.1, 1, 0)", x=crv_cp_3.Distance)
list_item_12 = ListItem(List=meshcorners_3, Index=0, Wrap=True)  # -> Item, Item1, Item2, Item3
cull_3 = CullPattern(List=point_23, CullPattern=eval_3)
point_24 = Point(list_item_12.Item)
point_25 = Point(list_item_12.Item1)
point_26 = Point(list_item_12.Item2)
point_27 = Point(list_item_12.Item3)
strength_external_4 = Slider(100, range=5..100)
fixed_length_4 = Panel("0")
strength_internal_4 = Slider(31.6, range=5..50)
unit_z_25 = UnitZ(Factor=reposition_support_3)
move_13 = Move(Geometry=point_24, Motion=unit_z_25)  # -> Geometry, Transform
move_14 = Move(Geometry=point_26, Motion=unit_z_25)  # -> Geometry, Transform
merge_5 = Merge(Data1=move_13.Geometry, Data2=point_25, Data3=move_14.Geometry, Data4=point_27)
merge_6 = Merge(Data1=meshcorners_3, Data2=cull_3)
mesh_point_3 = Point(deconstruct_mesh_3.Vertices)
point_28 = Point(point_24)
point_29 = Point(point_26)
point_30 = Point(move_13.Geometry)
point_31 = Point(move_14.Geometry)
line_3 = Line(StartPoint=point_28, EndPoint=point_29)
length_line_5 = LengthLine(Line=curve_9, Length=fixed_length_4, Strength=strength_external_4)
load_3 = Load(Point=point_23, ForceVector=unit_z_24, Weighting=1)
anchor_3 = Anchor(Point=merge_6, Target=merge_6, Strength=10000)
length_line_6 = LengthLine(Line=curve_10, Length=fixed_length_4, Strength=strength_internal_4)
distance_3 = Distance(PointA=point_30, PointB=point_31)
unit_z_26 = UnitZ(Factor=1)
multiplication_9 = Multiplication(A=distance_3, B=Slider(1.49, range=1..2))
show_3 = Show(G=mesh_6)
catenary_3 = Catenary(PointA=point_30, PointB=point_31, Length=multiplication_9, Gravity=unit_z_26)
curve_closest_point_3 = CurveClosestPoint(Point=mesh_point_3, Curve=line_3)  # -> Point, Parameter, Distance
reset_button_3 = Button()
# Tutorial: https://www.youtube.com/watch?v=SW_xQx1x_5g
activate_3 = BooleanToggle(True)
entwine_3 = Entwine(Branch00=show_3, Branch01=anchor_3, Branch02=length_line_5, Branch03=length_line_6, Branch04=load_3, FlattenInputs=True)
larger_than_3 = LargerThan(FirstNumber=curve_closest_point_3.Distance, SecondNumber="0.1")  # -> LargerThan, OrEqualTo
dispatch_3 = Dispatch(List=mesh_point_3, DispatchPattern=larger_than_3.LargerThan)  # -> ListA, ListB
solver_3 = Solver(GoalObjects=flatten(entwine_3), Reset=reset_button_3, Threshold=1e-15, Tolerance=0.01, On=activate_3)  # -> I, V, O
point_32 = Point(dispatch_3.ListB)
point_33 = Point(dispatch_3.ListA)
oncurve_3 = OnCurve(Points=point_32, Curve=catenary_3, Strength=Slider(50, range=1..50))
list_item_13 = ListItem(List=solver_3.O, Index=0, Wrap=True)  # -> Item, Item1

# ---- group: CenterTop&Bottom
# Selfmade mesh
# Support
# Forces
# Output
# Spring strength
curve_11 = Curve([<curve referenced from the Rhino model> x2])
boundary_4 = BoundarySurfaces(Edges=curve_11)
join_7 = BrepJoin(Breps=boundary_4)  # -> Breps, Closed
srf_4 = Surface(join_7.Breps)
toggle_4 = BooleanToggle(True)
debrep_4 = DeconstructBrep(Brep=srf_4)  # -> Faces, Edges, Vertices
item_16 = ListItem(List=debrep_4.Edges, Index=0, Wrap=True)  # -> Item, Item1, Item2, Item3
custom_mesh_settings_4 = SettingsCustom(
    StitchSeams=toggle_4,
    SimplePlanes=False,
    Refine=toggle_4,
    MinCount="1600",
    MaxCount="1600",
    AspectRatio=20,
    MaxDistance=0,
    MaxAngle=20,
    MinEdge="0",
    MaxEdge="0")
relay_5 = Relay([item_16.Item1, item_16.Item, item_16.Item2, item_16.Item3])
# support curves
join_8 = JoinCurves(Curves=relay_5, Preserve=False)
mesh_7 = MeshBrep(Brep=srf_4, Settings=custom_mesh_settings_4)
density_4 = Slider(20, range=0..100)
mesh_plane_4 = MeshPlane(Boundary={Plane=PlaneXY(0, 0, 0), Size=Domain2(u=-10..10, v=-10..10)}, WidthCount=density_4, HeightCount=density_4)  # -> Mesh, Area
mesh_edges_4 = MeshEdges(Mesh=mesh_7)  # -> NakedEdges, InteriorEdges, NonManifoldEdges
deconstruct_mesh_4 = DeconstructMesh(Mesh=mesh_7)  # -> Vertices, Faces, Colours, Normals
force_10 = Slider(0.5, range=0..5)
mesh_8 = Mesh(mesh_7)
meshcorners_4 = MeshCorners(Mesh=mesh_8, Angle=2.35619449)
negative_21 = Negative(Value=force_10)
curve_12 = Curve(mesh_edges_4.NakedEdges)
curve_13 = Curve(mesh_edges_4.InteriorEdges)
point_34 = Point(deconstruct_mesh_4.Vertices)
crv_cp_4 = CurveClosestPoint(Point=point_34, Curve=join_8)  # -> Point, Parameter, Distance
unit_z_27 = UnitZ(Factor=force_10)
reposition_support_4 = Slider(0, range=0..10)
eval_4 = Evaluate(F="If(x<0.1, 1, 0)", x=crv_cp_4.Distance)
list_item_14 = ListItem(List=meshcorners_4, Index=0, Wrap=True)  # -> Item, Item1, Item2, Item3
cull_4 = CullPattern(List=point_34, CullPattern=eval_4)
point_35 = Point(list_item_14.Item)
point_36 = Point(list_item_14.Item1)
point_37 = Point(list_item_14.Item2)
point_38 = Point(list_item_14.Item3)
strength_external_5 = Slider(100, range=5..100)
fixed_length_5 = Panel("0")
strength_internal_5 = Slider(31.6, range=5..50)
unit_z_28 = UnitZ(Factor=reposition_support_4)
move_15 = Move(Geometry=point_35, Motion=unit_z_28)  # -> Geometry, Transform
move_16 = Move(Geometry=point_37, Motion=unit_z_28)  # -> Geometry, Transform
merge_7 = Merge(Data1=move_15.Geometry, Data2=point_36, Data3=move_16.Geometry, Data4=point_38)
merge_8 = Merge(Data1=meshcorners_4, Data2=cull_4)
mesh_point_4 = Point(deconstruct_mesh_4.Vertices)
point_39 = Point(point_35)
point_40 = Point(point_37)
point_41 = Point(move_15.Geometry)
point_42 = Point(move_16.Geometry)
line_4 = Line(StartPoint=point_39, EndPoint=point_40)
length_line_7 = LengthLine(Line=curve_12, Length=fixed_length_5, Strength=strength_external_5)
load_4 = Load(Point=point_34, ForceVector=unit_z_27, Weighting=1)
anchor_4 = Anchor(Point=merge_8, Target=merge_8, Strength=10000)
length_line_8 = LengthLine(Line=curve_13, Length=fixed_length_5, Strength=strength_internal_5)
distance_4 = Distance(PointA=point_41, PointB=point_42)
unit_z_29 = UnitZ(Factor=1)
multiplication_10 = Multiplication(A=distance_4, B=Slider(1.49, range=1..2))
show_4 = Show(G=mesh_8)
catenary_4 = Catenary(PointA=point_41, PointB=point_42, Length=multiplication_10, Gravity=unit_z_29)
curve_closest_point_4 = CurveClosestPoint(Point=mesh_point_4, Curve=line_4)  # -> Point, Parameter, Distance
reset_button_4 = Button()
activate_4 = BooleanToggle(True)
entwine_4 = Entwine(Branch00=show_4, Branch01=anchor_4, Branch02=length_line_7, Branch03=length_line_8, Branch04=load_4, FlattenInputs=True)
larger_than_4 = LargerThan(FirstNumber=curve_closest_point_4.Distance, SecondNumber="0.1")  # -> LargerThan, OrEqualTo
dispatch_4 = Dispatch(List=mesh_point_4, DispatchPattern=larger_than_4.LargerThan)  # -> ListA, ListB
solver_4 = Solver(GoalObjects=flatten(entwine_4), Reset=reset_button_4, Threshold=1e-15, Tolerance=0.01, On=activate_4)  # -> I, V, O
point_43 = Point(dispatch_4.ListB)
point_44 = Point(dispatch_4.ListA)
oncurve_4 = OnCurve(Points=point_43, Curve=catenary_4, Strength=Slider(50, range=1..50))
list_item_15 = ListItem(List=solver_4.O, Index=0, Wrap=True)  # -> Item, Item1

# ----
mesh_9 = Mesh(<mesh referenced from the Rhino model>)
meshtoshell = MeshToShellKaramba3D(Mesh=mesh_9, Identifier="shell", LimitDistance_m=0.005)  # -> Element, Points, Info
license = LicenseKaramba3D()
mc = MeshCorners(Mesh=mesh_9, Angle=2.35619449)
xy = XYPlane(Origin=Point(0, 0, 0))
xy_2 = XYPlane(Origin=Point(0, 0, 0))
matselect = MaterialSelectionKaramba3D(menu=[dropdown(3), dropdown(6)])
pt = Point(meshtoshell.Points)
cp = PlaneClosestPoint(Point=mc, Plane=xy)  # -> Point, UVPoint, Distance
panel_6 = Panel(license)
eval_5 = Evaluate(F="If(x=2.5, 1, 0)", x=cp.Distance)
cross_section = CrossSectionKaramba3D(
    FamilyNameOfCrossSection="DefaultCroSec",
    NameOfCrossSection="shell",
    Material=matselect,
    Height_cm="10",
    mode="Shell - Const")
loads = LoadsKaramba3D(Vector=Vector(0, 0, -1), LCase="0", mode="Gravity")
cull_5 = CullPattern(List=mc, CullPattern=eval_5)
supp = SupportKaramba3D(PosInd=cull_5, PlaneOfReference=xy_2, menu=[buttons(on, on, on, off, off, off)])
assemble = AssembleModelKaramba3D(
    Point=meshtoshell.Points,
    Elem=meshtoshell.Element,
    Support=supp,
    Load=loads,
    CrossSection=cross_section,
    Material=matselect,
    LimitDistance_m=0.005)  # -> Model, Info, Mass_kg, CenterOfGravity
analyze = AnalyzeKaramba3D(Model=assemble.Model)  # -> CalculatedModel, MaximumDisplacement_cm, ResultingForceOfGravity_kN, ElasticEnergy_kNm
modelview = ModelViewKaramba3D(Model=analyze.CalculatedModel, LoadCaseFactorsForLinearSuperposition=1, IndexOfVisibleLoadcase=-1)  # -> Model, DeformedMesh, DeformedAxes, DeformedModel
shellview = ShellViewKaramba3D(Model=modelview.Model, IndexOfLayer=0)  # -> Model, MeshesOfRenderedShells, LegendColors, LegendTags
legend = Legend(Colour=shellview.LegendColors, Tags=shellview.LegendTags, LegendType=1)

# ----
# Selfmade mesh
# Output
curve_14 = Curve(<curve referenced from the Rhino model>)
boundary_5 = BoundarySurfaces(Edges=curve_14)
join_9 = BrepJoin(Breps=boundary_5)  # -> Breps, Closed
srf_5 = Surface(join_9.Breps)
toggle_5 = BooleanToggle(True)
debrep_5 = DeconstructBrep(Brep=srf_5)  # -> Faces, Edges, Vertices
item_17 = ListItem(List=debrep_5.Edges, Index=0, Wrap=True)  # -> Item, Item1, Item2, Item3
custom_mesh_settings_5 = SettingsCustom(
    StitchSeams=toggle_5,
    SimplePlanes=False,
    Refine=toggle_5,
    MinCount="1600",
    MaxCount="1600",
    AspectRatio=20,
    MaxDistance=0,
    MaxAngle=20,
    MinEdge="0",
    MaxEdge="0")
relay_6 = Relay([item_17.Item1, item_17.Item, item_17.Item2, item_17.Item3])
join_10 = JoinCurves(Curves=relay_6, Preserve=False)
mesh_10 = MeshBrep(Brep=srf_5, Settings=custom_mesh_settings_5)
density_5 = Slider(20, range=0..100)
mesh_plane_5 = MeshPlane(Boundary={Plane=PlaneXY(0, 0, 0), Size=Domain2(u=-10..10, v=-10..10)}, WidthCount=density_5, HeightCount=density_5)  # -> Mesh, Area
mesh_edges_5 = MeshEdges(Mesh=mesh_10)  # -> NakedEdges, InteriorEdges, NonManifoldEdges
deconstruct_mesh_5 = DeconstructMesh(Mesh=mesh_10)  # -> Vertices, Faces, Colours, Normals
force_11 = Slider(0.6, range=0..5)
mesh_11 = Mesh(mesh_10)
meshcorners_5 = MeshCorners(Mesh=mesh_11, Angle=2.35619449)
negative_22 = Negative(Value=force_11)
curve_15 = Curve(mesh_edges_5.NakedEdges)
curve_16 = Curve(mesh_edges_5.InteriorEdges)
point_45 = Point(deconstruct_mesh_5.Vertices)
crv_cp_5 = CurveClosestPoint(Point=point_45, Curve=join_10)  # -> Point, Parameter, Distance
unit_z_30 = UnitZ(Factor=force_11)
reposition_support_5 = Slider(0, range=0..10)
eval_6 = Evaluate(F="If(x<0.1, 1, 0)", x=crv_cp_5.Distance)
list_item_16 = ListItem(List=meshcorners_5, Index=0, Wrap=True)  # -> Item, Item1, Item2, Item3
cull_6 = CullPattern(List=point_45, CullPattern=eval_6)
point_46 = Point(list_item_16.Item)
point_47 = Point(list_item_16.Item1)
point_48 = Point(list_item_16.Item2)
point_49 = Point(list_item_16.Item3)
strength_external_6 = Slider(100, range=5..100)
fixed_length_6 = Panel("0")
strength_internal_6 = Slider(21, range=5..50)
unit_z_31 = UnitZ(Factor=reposition_support_5)
move_17 = Move(Geometry=point_46, Motion=unit_z_31)  # -> Geometry, Transform
move_18 = Move(Geometry=point_48, Motion=unit_z_31)  # -> Geometry, Transform
merge_9 = Merge(Data1=move_17.Geometry, Data2=point_47, Data3=move_18.Geometry, Data4=point_49)
merge_10 = Merge(Data1=meshcorners_5, Data2=cull_6)
mesh_point_5 = Point(deconstruct_mesh_5.Vertices)
point_50 = Point(point_46)
point_51 = Point(point_48)
point_52 = Point(move_17.Geometry)
point_53 = Point(move_18.Geometry)
line_5 = Line(StartPoint=point_50, EndPoint=point_51)
length_line_9 = LengthLine(Line=curve_15, Length=fixed_length_6, Strength=strength_external_6)
load_5 = Load(Point=point_45, ForceVector=unit_z_30, Weighting=1)
anchor_5 = Anchor(Point=merge_10, Target=merge_10, Strength=10000)
length_line_10 = LengthLine(Line=curve_16, Length=fixed_length_6, Strength=strength_internal_6)
distance_5 = Distance(PointA=point_52, PointB=point_53)
unit_z_32 = UnitZ(Factor=1)
multiplication_11 = Multiplication(A=distance_5, B=Slider(1.49, range=1..2))
show_5 = Show(G=mesh_11)
catenary_5 = Catenary(PointA=point_52, PointB=point_53, Length=multiplication_11, Gravity=unit_z_32)
curve_closest_point_5 = CurveClosestPoint(Point=mesh_point_5, Curve=line_5)  # -> Point, Parameter, Distance
reset_button_5 = Button()
activate_5 = BooleanToggle(True)
entwine_5 = Entwine(Branch00=show_5, Branch01=anchor_5, Branch02=length_line_9, Branch03=length_line_10, Branch04=load_5, FlattenInputs=True)
larger_than_5 = LargerThan(FirstNumber=curve_closest_point_5.Distance, SecondNumber="0.1")  # -> LargerThan, OrEqualTo
dispatch_5 = Dispatch(List=mesh_point_5, DispatchPattern=larger_than_5.LargerThan)  # -> ListA, ListB
solver_5 = Solver(GoalObjects=flatten(entwine_5), Reset=reset_button_5, Threshold=1e-15, Tolerance=0.01, On=activate_5)  # -> I, V, O
point_54 = Point(dispatch_5.ListB)
point_55 = Point(dispatch_5.ListA)
oncurve_5 = OnCurve(Points=point_54, Curve=catenary_5, Strength=Slider(50, range=1..50))
list_item_17 = ListItem(List=solver_5.O, Index=0, Wrap=True)  # -> Item, Item1

number_slider_9 = Slider(100, range=0..100)
mesh_join = MeshJoin(Meshes=list_item_11)
mesh_join_2 = MeshJoin(Meshes=relay_3)
settings_custom = SettingsCustom(
    StitchSeams=True,
    SimplePlanes=False,
    Refine=True,
    MinCount="300",
    MaxCount="300",
    AspectRatio=20,
    MaxDistance=0,
    MaxAngle=20,
    MinEdge=0,
    MaxEdge=0)
surface_4 = Surface(<surface referenced from the Rhino model>)
mesh_brep = MeshBrep(Brep=surface_4, Settings=settings_custom)
deconstruct_mesh_6 = DeconstructMesh(Mesh=mesh_brep)  # -> Vertices, Faces, Colours, Normals
curve_17 = Curve(<curve referenced from the Rhino model>)
number_slider_10 = Slider(9, range=0..10)
deconstruct_brep_3 = DeconstructBrep(Brep=curve_17)  # -> Faces, Edges, Vertices
list_item_18 = ListItem(List=deconstruct_brep_3.Vertices, Index=Slider(3, range=0..3), Wrap=True)
closest_points = ClosestPoints(Point=list_item_18, Cloud=deconstruct_mesh_6.Vertices, Count=number_slider_10)  # -> ClosestPoint, CPIndex, Distance
division_7 = Division(A="300", B=number_slider_10)
unit_z_33 = UnitZ(Factor=division_7)
loads_karamba3d = LoadsKaramba3D(ForceVector=unit_z_33, Local=False, PosInd=closest_points.ClosestPoint, LCase=0, mode="Point")

# ---- group: Dome South
# Selfmade mesh
# Output
# Tutorial: https://www.youtube.com/watch?v=SW_xQx1x_5g
# Support
# Forces
# Support
# Support
# Forces
# Forces
# Spring strength
# Spring strength
# Tutorial: https://www.youtube.com/watch?v=SW_xQx1x_5g
curve_18 = Curve([<curve referenced from the Rhino model> x2])
boundary_6 = BoundarySurfaces(Edges=curve_18)
join_11 = BrepJoin(Breps=boundary_6)  # -> Breps, Closed
srf_6 = Surface(join_11.Breps)
toggle_6 = BooleanToggle(True)
debrep_6 = DeconstructBrep(Brep=srf_6)  # -> Faces, Edges, Vertices
# Output
panel_7 = Panel("0")
item_18 = ListItem(List=debrep_6.Edges, Index=0, Wrap=True)  # -> Item, Item1, Item2, Item3
custom_mesh_settings_6 = SettingsCustom(
    StitchSeams=toggle_6,
    SimplePlanes=False,
    Refine=toggle_6,
    MinCount="1600",
    MaxCount="1600",
    AspectRatio=20,
    MaxDistance=0,
    MaxAngle=20,
    MinEdge=panel_7,
    MaxEdge=panel_7)
relay_7 = Relay([item_18.Item1, item_18.Item, item_18.Item2, item_18.Item3])
# support curves
join_12 = JoinCurves(Curves=relay_7, Preserve=False)
mesh_12 = MeshBrep(Brep=srf_6, Settings=custom_mesh_settings_6)
density_6 = Slider(20, range=0..100)
mesh_plane_6 = MeshPlane(Boundary={Plane=PlaneXY(0, 0, 0), Size=Domain2(u=-10..10, v=-10..10)}, WidthCount=density_6, HeightCount=density_6)  # -> Mesh, Area
force_12 = Slider(0.6, range=0..5)
mesh_edges_6 = MeshEdges(Mesh=mesh_12)  # -> NakedEdges, InteriorEdges, NonManifoldEdges
deconstruct_mesh_7 = DeconstructMesh(Mesh=mesh_12)  # -> Vertices, Faces, Colours, Normals
mesh_13 = Mesh(mesh_12)
meshcorners_6 = MeshCorners(Mesh=mesh_13, Angle=2.35619449)
curve_19 = Curve(mesh_edges_6.NakedEdges)
curve_20 = Curve(mesh_edges_6.InteriorEdges)
point_56 = Point(deconstruct_mesh_7.Vertices)
crv_cp_6 = CurveClosestPoint(Point=point_56, Curve=join_12)  # -> Point, Parameter, Distance
eval_7 = Evaluate(F="If(x<0.1, 1, 0)", x=crv_cp_6.Distance)
cull_7 = CullPattern(List=point_56, CullPattern=eval_7)
merge_11 = Merge(Data1=meshcorners_6, Data2=cull_7)
mesh_point_6 = Point(deconstruct_mesh_7.Vertices)
unit_z_34 = UnitZ(Factor=1)
show_6 = Show(G=mesh_13)
reset_button_6 = Button()
activate_6 = BooleanToggle(True)

# ---- group: Dome South / Hanging
negative_23 = Negative(Value=force_12)

# ---- group: Dome South / Standing
unit_z_35 = UnitZ(Factor=force_12)

# ---- group: Dome South
# Support
reposition_support_6 = Slider(0, range=0..10)
list_item_19 = ListItem(List=meshcorners_6, Index=0, Wrap=True)  # -> Item, Item1, Item2, Item3
point_57 = Point(list_item_19.Item)
point_58 = Point(list_item_19.Item2)
point_59 = Point(list_item_19.Item3)
point_60 = Point(list_item_19.Item1)
unit_z_36 = UnitZ(Factor=reposition_support_6)
move_19 = Move(Geometry=point_57, Motion=unit_z_36)  # -> Geometry, Transform
move_20 = Move(Geometry=point_58, Motion=unit_z_36)  # -> Geometry, Transform
merge_12 = Merge(Data1=move_19.Geometry, Data2=point_60, Data3=move_20.Geometry, Data4=point_59)

# Forces
length_line_11 = LengthLine(Line=curve_19, Length=fixed_length_3, Strength=strength_external_3)
load_6 = Load(Point=point_56, ForceVector=unit_z_35, Weighting=1)
anchor_6 = Anchor(Point=merge_11, Target=merge_11, Strength=10000)
length_line_12 = LengthLine(Line=curve_20, Length=fixed_length_3, Strength=strength_internal_3)

point_61 = Point(point_57)
point_62 = Point(point_58)
point_63 = Point(move_19.Geometry)
point_64 = Point(move_20.Geometry)
line_6 = Line(StartPoint=point_61, EndPoint=point_62)
distance_6 = Distance(PointA=point_63, PointB=point_64)
multiplication_12 = Multiplication(A=distance_6, B=Slider(1.49, range=1..2))
catenary_6 = Catenary(PointA=point_63, PointB=point_64, Length=multiplication_12, Gravity=unit_z_34)
curve_closest_point_6 = CurveClosestPoint(Point=mesh_point_6, Curve=line_6)  # -> Point, Parameter, Distance
entwine_6 = Entwine(
    Branch00=show_6,
    Branch01=anchor_6,
    Branch02=length_line_11,
    Branch03=length_line_12,
    Branch04=load_6,
    FlattenInputs=True)
larger_than_6 = LargerThan(FirstNumber=curve_closest_point_6.Distance, SecondNumber="0.1")  # -> LargerThan, OrEqualTo
dispatch_6 = Dispatch(List=mesh_point_6, DispatchPattern=larger_than_6.LargerThan)  # -> ListA, ListB
solver_6 = Solver(GoalObjects=flatten(entwine_6), Reset=reset_button_6, Threshold=1e-15, Tolerance=0.01, On=activate_6)  # -> I, V, O
point_65 = Point(dispatch_6.ListB)
point_66 = Point(dispatch_6.ListA)
oncurve_6 = OnCurve(Points=point_65, Curve=catenary_6, Strength=Slider(50, range=1..50))
list_item_20 = ListItem(List=solver_6.O, Index=0, Wrap=True)  # -> Item, Item1

# ----
merge_13 = Merge(
    Data1=mesh_join,
    Data2=mesh_join_2,
    Data3=list_item_4.Item,
    Data4=list_item_4.Item1,
    Data5=list_item_20.Item1,
    Data6=list_item_20.Item,
    Data7=list_item_13.Item,
    Data8=list_item_13.Item1,
    Data9=list_item_15.Item,
    Data10=list_item_15.Item1,
    Data11=list_item_17.Item)  # -> flatten(Result)
mesh_join_3 = MeshJoin(Meshes=merge_13)  # -> flatten(Mesh)

mesh_14 = Mesh(mesh_join_3)  # disabled
meshtoshell_2 = MeshToShellKaramba3D(Mesh=mesh_14, Identifier="shell", LimitDistance_m=0.005)  # -> Element, Points, Info
license_2 = LicenseKaramba3D()
xy_3 = XYPlane(Origin=Point(0, 0, 0))
mc_2 = MeshCorners(Mesh=mesh_14, Angle=2.35619449)
matselect_2 = MaterialSelectionKaramba3D(menu=[dropdown(3), dropdown(6)])
panel_8 = Panel(license_2)
cross_section_2 = CrossSectionKaramba3D(
    FamilyNameOfCrossSection="DefaultCroSec",
    NameOfCrossSection="shell",
    Material=matselect_2,
    Height_cm="10",
    mode="Shell - Const")
supp_2 = SupportKaramba3D(PosInd=mc_2, PlaneOfReference=xy_3, menu=[buttons(on, on, on, off, off, off)])
loads_2 = LoadsKaramba3D(Vector=Vector(0, 0, -1), LCase="0", mode="Gravity")
assemble_2 = AssembleModelKaramba3D(
    Point=meshtoshell_2.Points,
    Elem=meshtoshell_2.Element,
    Support=supp_2,
    Load=loads_2,
    CrossSection=cross_section_2,
    Material=matselect_2,
    LimitDistance_m=0.005)  # -> Model, Info, Mass_kg, CenterOfGravity; disabled
analyze_2 = AnalyzeKaramba3D(Model=assemble_2.Model)  # -> CalculatedModel, MaximumDisplacement_cm, ResultingForceOfGravity_kN, ElasticEnergy_kNm
modelview_2 = ModelViewKaramba3D(Model=analyze_2.CalculatedModel, LoadCaseFactorsForLinearSuperposition=1, IndexOfVisibleLoadcase=-1)  # -> Model, DeformedMesh, DeformedAxes, DeformedModel
shellview_2 = ShellViewKaramba3D(Model=modelview_2.Model, IndexOfLayer=0)  # -> Model, MeshesOfRenderedShells, LegendColors, LegendTags
legend_2 = Legend(Colour=shellview_2.LegendColors, Tags=shellview_2.LegendTags, LegendType=1)
