# Grasshopper definition 01JunctionFormFinding01ScriptVariantWithoutCatenaryBigDome.gh (Grasshopper 1.0.7)
# plug-ins: Karamba, MeshEdit Components, Kangaroo2 Components

negative = Negative(Value=Slider(2.5, range=0..2.5))
unit_z = UnitZ(Factor=negative)
crv = Curve([<curve referenced from the Rhino model> x2])
number_slider = Slider(1.3, range=1.1..2.1)
division = Division(A=number_slider, B=3.6)
move = Move(Geometry=crv, Motion=unit_z)  # -> Geometry, Transform
len = Length(Curve=move.Geometry)
multiplication = Multiplication(A=len, B=number_slider)
end = EndPoints(Curve=move.Geometry)  # -> Start, End
cat = Catenary(PointA=end.Start, PointB=end.End, Length=multiplication, Gravity="0,0,1")
item = ListItem(List=cat, Index="0", Wrap=True)  # -> Item, Item1
item_2 = ListItem(List=move.Geometry, Index="0", Wrap=True)  # -> Item, Item1

negative_2 = Negative(Value=Slider(1.5, range=0..10))
negative_3 = Negative(Value=Slider(1, range=0..1))
negative_4 = Negative(Value=Slider(1, range=0..1))
negative_5 = Negative(Value=Slider(1.5, range=0..10))
boundary_surfaces = BoundarySurfaces(Edges=[item_2.Item, item_2.Item1, item.Item, item.Item1])
unit_z_2 = UnitZ(Factor=negative_2)
unit_z_3 = UnitZ(Factor=negative_3)
unit_z_4 = UnitZ(Factor=negative_4)
force = Slider(1, range=0.5..50)
force_2 = Slider(1, range=0.5..50)
crv_2 = Curve([<curve referenced from the Rhino model> x2])
number_slider_2 = Slider(1.3, range=1.1..2.1)
crv_3 = Curve([<curve referenced from the Rhino model> x2])
unit_z_5 = UnitZ(Factor=negative_5)
number_slider_3 = Slider(1.3, range=1.1..2.1)
unit_z_6 = UnitZ(Factor=1)
unit_z_7 = UnitZ(Factor=1)

# ---- group: Extrution Wall
negative_6 = Negative(Value=Slider(2.5, range=0..10))
curve = Curve([<curve referenced from the Rhino model> x9])
unit_z_8 = UnitZ(Factor=negative_6)
extrude = Extrude(Base=curve, Direction=unit_z_8)

# ---- group: Hanging
negative_7 = Negative(Value=force)

# ----
negative_8 = Negative(Value=force_2)
division_2 = Division(A=number_slider_2, B=3.6)
division_3 = Division(A=number_slider_3, B=3.6)
move_2 = Move(Geometry=crv_2, Motion=unit_z_3)  # -> Geometry, Transform
len_2 = Length(Curve=move_2.Geometry)
multiplication_2 = Multiplication(A=len_2, B=number_slider_2)
move_3 = Move(Geometry=crv_3, Motion=unit_z_4)  # -> Geometry, Transform
len_3 = Length(Curve=move_3.Geometry)
multiplication_3 = Multiplication(A=len_3, B=number_slider_3)

# ---- group: Standing
unit_z_9 = UnitZ(Factor=force)

# ----
unit_z_10 = UnitZ(Factor=force_2)
end_2 = EndPoints(Curve=move_2.Geometry)  # -> Start, End
end_3 = EndPoints(Curve=move_3.Geometry)  # -> Start, End
negative_9 = Negative(Value=Slider(1.5, range=0..10))
negative_10 = Negative(Value=Slider(1.5, range=0..10))
cat_2 = Catenary(PointA=end_2.Start, PointB=end_2.End, Length=multiplication_2, Gravity="0,0,1")
cat_3 = Catenary(PointA=end_3.Start, PointB=end_3.End, Length=multiplication_3, Gravity="0,0,1")
end_points = EndPoints(Curve=move_2.Geometry)  # -> Start, End
end_points_2 = EndPoints(Curve=move_3.Geometry)  # -> Start, End
item_3 = ListItem(List=cat_2, Index="0", Wrap=True)  # -> Item, Item1
item_4 = ListItem(List=cat_3, Index="0", Wrap=True)  # -> Item, Item1
item_5 = ListItem(List=move_3.Geometry, Index="0", Wrap=True)  # -> Item, Item1
item_6 = ListItem(List=move_2.Geometry, Index="0", Wrap=True)  # -> Item, Item1

negative_11 = Negative(Value=Slider(2.5, range=0..2.5))
unit_z_11 = UnitZ(Factor=negative_11)
crv_4 = Curve([<curve referenced from the Rhino model> x2])
number_slider_4 = Slider(1.3, range=1.1..2.1)
division_4 = Division(A=number_slider_4, B=3.6)
move_4 = Move(Geometry=crv_4, Motion=unit_z_11)  # -> Geometry, Transform
len_4 = Length(Curve=move_4.Geometry)
multiplication_4 = Multiplication(A=len_4, B=number_slider_4)
end_4 = EndPoints(Curve=move_4.Geometry)  # -> Start, End
cat_4 = Catenary(PointA=end_4.Start, PointB=end_4.End, Length=multiplication_4, Gravity="0,0,1")
item_7 = ListItem(List=move_4.Geometry, Index="0", Wrap=True)  # -> Item, Item1
item_8 = ListItem(List=cat_4, Index="0", Wrap=True)  # -> Item, Item1

move_5 = Move(Geometry=move_3.Geometry, Motion=unit_z_2)  # -> Geometry, Transform
move_6 = Move(Geometry=move_2.Geometry, Motion=unit_z_5)  # -> Geometry, Transform
line_sdl = LineSDL(Start=end_points.Start, Direction=unit_z_6, Length=negative_9)
line_sdl_2 = LineSDL(Start=end_points_2.Start, Direction=unit_z_7, Length=negative_10)
line_sdl_3 = LineSDL(Start=end_points.End, Direction=unit_z_6, Length=negative_9)
panel = Panel("10")
line_sdl_4 = LineSDL(Start=end_points_2.End, Direction=unit_z_7, Length=negative_10)

# ---- group: Dome North
# Selfmade mesh
# Support
# Forces
# Output
# Spring strength
# Tutorial: https://www.youtube.com/watch?v=SW_xQx1x_5g
# Support
# Forces
# Support
# Support
# Spring strength
# Create 'beam'
curve_2 = Curve([<curve referenced from the Rhino model> x4])
boundary = BoundarySurfaces(Edges=curve_2)
join = BrepJoin(Breps=boundary)  # -> Breps, Closed
srf = Surface(join.Breps)
toggle = BooleanToggle(True)
debrep = DeconstructBrep(Brep=srf)  # -> Faces, Edges, Vertices
# Forces
# Forces
# Output
# Spring strength
# Tutorial: https://www.youtube.com/watch?v=SW_xQx1x_5g
# Selfmade mesh
panel_3 = Panel("0")
item_9 = ListItem(List=debrep.Edges, Index=0, Wrap=True)  # -> Item, Item1, Item2, Item3
custom_mesh_settings = SettingsCustom(
    StitchSeams=toggle,
    SimplePlanes=False,
    Refine=toggle,
    MinCount="1600",
    MaxCount="1600",
    AspectRatio=20,
    MaxDistance=0,
    MaxAngle=20,
    MinEdge=panel_3,
    MaxEdge=panel_3)
relay = Relay([item_9.Item1, item_9.Item, item_9.Item2, item_9.Item3])
# support curves
join_2 = JoinCurves(Curves=relay, Preserve=False)
mesh = MeshBrep(Brep=srf, Settings=custom_mesh_settings)
mesh_edges = MeshEdges(Mesh=mesh)  # -> NakedEdges, InteriorEdges, NonManifoldEdges
deconstruct_mesh = DeconstructMesh(Mesh=mesh)  # -> Vertices, Faces, Colours, Normals
force_3 = Slider(0.6, range=0..5)
mesh_2 = Mesh(mesh)
meshcorners = MeshCorners(Mesh=mesh_2, Angle=2.35619449)
negative_12 = Negative(Value=force_3)
curve_3 = Curve(mesh_edges.NakedEdges)
curve_4 = Curve(mesh_edges.InteriorEdges)
point = Point(deconstruct_mesh.Vertices)
crv_cp = CurveClosestPoint(Point=point, Curve=join_2)  # -> Point, Parameter, Distance
unit_z_12 = UnitZ(Factor=force_3)
reposition_support = Slider(0, range=0..10)
eval = Evaluate(F="If(x<0.1, 1, 0)", x=crv_cp.Distance)
list_item = ListItem(List=meshcorners, Index=0, Wrap=True)  # -> Item, Item1, Item2, Item3
cull = CullPattern(List=point, CullPattern=eval)
point_2 = Point(list_item.Item)
point_3 = Point(list_item.Item2)
point_4 = Point(list_item.Item3)
point_5 = Point(list_item.Item1)
strength_external = Slider(100, range=5..100)
fixed_length = Panel("0")
strength_internal = Slider(31.6, range=5..50)
unit_z_13 = UnitZ(Factor=reposition_support)
move_7 = Move(Geometry=point_2, Motion=unit_z_13)  # -> Geometry, Transform
move_8 = Move(Geometry=point_3, Motion=unit_z_13)  # -> Geometry, Transform
merge = Merge(Data1=move_7.Geometry, Data2=point_5, Data3=move_8.Geometry, Data4=point_4)
merge_2 = Merge(Data1=meshcorners, Data2=cull)
mesh_point = Point(deconstruct_mesh.Vertices)
point_6 = Point(point_2)
point_7 = Point(point_3)
point_8 = Point(move_7.Geometry)
point_9 = Point(move_8.Geometry)
line = Line(StartPoint=point_6, EndPoint=point_7)
length_line = LengthLine(Line=curve_3, Length=fixed_length, Strength=strength_external)
load = Load(Point=point, ForceVector=unit_z_12, Weighting=1)
anchor = Anchor(Point=merge_2, Target=merge_2, Strength=10000)
length_line_2 = LengthLine(Line=curve_4, Length=fixed_length, Strength=strength_internal)
distance = Distance(PointA=point_8, PointB=point_9)
unit_z_14 = UnitZ(Factor=1)
multiplication_5 = Multiplication(A=distance, B=Slider(1.49, range=1..2))
show = Show(G=mesh_2)
catenary = Catenary(PointA=point_8, PointB=point_9, Length=multiplication_5, Gravity=unit_z_14)
curve_closest_point = CurveClosestPoint(Point=mesh_point, Curve=line)  # -> Point, Parameter, Distance
reset_button = Button()
activate = BooleanToggle(True)
entwine = Entwine(Branch00=show, Branch01=anchor, Branch02=length_line, Branch03=length_line_2, Branch04=load, FlattenInputs=True)
larger_than = LargerThan(FirstNumber=curve_closest_point.Distance, SecondNumber="0.1")  # -> LargerThan, OrEqualTo
dispatch = Dispatch(List=mesh_point, DispatchPattern=larger_than.LargerThan)  # -> ListA, ListB
# Spring strength
solver = Solver(GoalObjects=flatten(entwine), Reset=reset_button, Threshold=1e-15, Tolerance=0.01, On=activate)  # -> I, V, O
point_10 = Point(dispatch.ListB)
point_11 = Point(dispatch.ListA)
# Support
number_slider_5 = Slider(50, range=1..50)
oncurve = OnCurve(Points=point_10, Curve=catenary, Strength=number_slider_5)
# Forces
list_item_2 = ListItem(List=solver.O, Index=0, Wrap=True)  # -> Item, Item1, Item2, Item3

# ----
brep_join = BrepJoin(Breps=extrude)  # -> Breps, Closed
geometry = Geometry([line_sdl_2, line_sdl_4, cat_3, move_5.Geometry])
list_item_3 = ListItem(List=brep_join.Breps, Index=0, Wrap=True)  # -> Item, Item1, Item2, Item3, Item4
geometry_2 = Geometry([line_sdl, line_sdl_3, cat_2, move_6.Geometry])
boundary_surfaces_2 = BoundarySurfaces(Edges=geometry_2)
deconstruct_brep = DeconstructBrep(Brep=list_item_3.Item)  # -> Faces, Edges, Vertices
boundary_surfaces_3 = BoundarySurfaces(Edges=geometry)
list_item_4 = ListItem(List=deconstruct_brep.Faces, Index=0, Wrap=True)  # -> Item, Item1, Item2, Item3
deconstruct_brep_2 = DeconstructBrep(Brep=[list_item_3.Item1, list_item_3.Item2, list_item_3.Item3, list_item_3.Item4])  # -> graft(Faces), Edges, Vertices
surface = Surface([boundary_surfaces_2, boundary_surfaces_3])
boundary_surfaces_4 = BoundarySurfaces(Edges=[item_8.Item, item_8.Item1, item_7.Item, item_7.Item1])
list_item_5 = ListItem(List=surface, Index=0, Wrap=True)  # -> Item, Item1, Item2, Item3, Item4

negative_13 = Negative(Value=Slider(2.5, range=0..2.5))
unit_z_15 = UnitZ(Factor=negative_13)
crv_5 = Curve([<curve referenced from the Rhino model> x2])
number_slider_6 = Slider(1.3, range=1.1..2.1)
division_5 = Division(A=number_slider_6, B=3.6)
move_9 = Move(Geometry=crv_5, Motion=unit_z_15)  # -> Geometry, Transform
len_5 = Length(Curve=move_9.Geometry)
multiplication_6 = Multiplication(A=len_5, B=number_slider_6)
end_5 = EndPoints(Curve=move_9.Geometry)  # -> Start, End
cat_5 = Catenary(PointA=end_5.Start, PointB=end_5.End, Length=multiplication_6, Gravity="0,0,1")
item_10 = ListItem(List=cat_5, Index="0", Wrap=True)  # -> Item, Item1
item_11 = ListItem(List=move_9.Geometry, Index="0", Wrap=True)  # -> Item, Item1

brep_wireframe = BrepWireframe(Brep=list_item_4.Item, Density=-1)
brep_wireframe_2 = BrepWireframe(Brep=list_item_5.Item4, Density=-1)
brep_wireframe_3 = BrepWireframe(Brep=list_item_4.Item2, Density=-1)
# catenary curves
brep_wireframe_4 = BrepWireframe(Brep=list_item_5.Item2, Density=-1)
brep_wireframe_5 = BrepWireframe(Brep=list_item_4.Item1, Density=-1)
brep_wireframe_6 = BrepWireframe(Brep=list_item_5.Item3, Density=-1)
brep_wireframe_7 = BrepWireframe(Brep=list_item_4.Item3, Density=-1)
brep_wireframe_8 = BrepWireframe(Brep=list_item_5.Item1, Density=-1)
brep_wireframe_9 = BrepWireframe(Brep=flatten(deconstruct_brep_2.Faces), Density=-1)
join_curves = JoinCurves(Curves=brep_wireframe, Preserve=False)
join_curves_2 = JoinCurves(Curves=brep_wireframe_8, Preserve=False)
join_curves_3 = JoinCurves(Curves=brep_wireframe_3, Preserve=False)
join_curves_4 = JoinCurves(Curves=brep_wireframe_5, Preserve=False)
join_curves_5 = JoinCurves(Curves=brep_wireframe_2, Preserve=False)
join_curves_6 = JoinCurves(Curves=brep_wireframe_7, Preserve=False)
join_curves_7 = JoinCurves(Curves=brep_wireframe_6, Preserve=False)
join_curves_8 = JoinCurves(Curves=brep_wireframe_4, Preserve=False)
join_curves_9 = JoinCurves(Curves=brep_wireframe_9, Preserve=False)

region_difference = RegionDifference(CurvesA=join_curves_4, CurvesB=join_curves_7)
region_difference_2 = RegionDifference(CurvesA=join_curves_3, CurvesB=join_curves_5)
region_difference_3 = RegionDifference(CurvesA=join_curves, CurvesB=join_curves_2)
region_difference_4 = RegionDifference(CurvesA=join_curves_6, CurvesB=join_curves_8)

shift_list = ShiftList(List=flatten(join_curves_9), Shift=Slider(2, range=0..10), Wrap=True)
number_slider_7 = Slider(4, range=0..10)
reverse_list = ReverseList(List=shift_list)
panel_4 = Panel("2")
list_item_6 = ListItem(List=flatten(reverse_list), Index=number_slider_7, Wrap=True)
boundary_surfaces_5 = BoundarySurfaces(Edges=[item_10.Item1, item_11.Item1])
boundary_surfaces_6 = BoundarySurfaces(Edges=[item_11.Item, item_10.Item])
relay_2 = Relay([region_difference, region_difference_3, region_difference_2, region_difference_4])
surface_2 = Surface([boundary_surfaces_6, boundary_surfaces_5])
panel_5 = Panel("""0
2
4
6
9
11
13
15""")

negative_14 = Negative(Value=Slider(2.5, range=0..2.5))
unit_z_16 = UnitZ(Factor=negative_14)
crv_6 = Curve([<curve referenced from the Rhino model> x2])
number_slider_8 = Slider(1.3, range=1.1..2.1)
division_6 = Division(A=number_slider_8, B=3.6)
move_10 = Move(Geometry=crv_6, Motion=unit_z_16)  # -> Geometry, Transform
len_6 = Length(Curve=move_10.Geometry)
multiplication_7 = Multiplication(A=len_6, B=number_slider_8)
end_6 = EndPoints(Curve=move_10.Geometry)  # -> Start, End
cat_6 = Catenary(PointA=end_6.Start, PointB=end_6.End, Length=multiplication_7, Gravity="0,0,1")
item_12 = ListItem(List=cat_6, Index="0", Wrap=True)  # -> Item, Item1
item_13 = ListItem(List=move_10.Geometry, Index="0", Wrap=True)  # -> Item, Item1

boundary_surfaces_7 = BoundarySurfaces(Edges=[item_13.Item1, item_12.Item1])
boundary_surfaces_8 = BoundarySurfaces(Edges=[item_13.Item, item_12.Item])
surface_3 = Surface([boundary_surfaces_7, boundary_surfaces_8])
brep_wireframe_10 = BrepWireframe(Brep=[boundary_surfaces, surface_2, boundary_surfaces_4, surface_3], Density=-1)
join_curves_10 = JoinCurves(Curves=brep_wireframe_10, Preserve=False)
list_item_7 = ListItem(List=join_curves_10, Index=0, Wrap=True)  # -> Item, Item1, Item2, Item3, Item4, Item5
brep = Brep(list_item_7.Item5)
list_item_8 = ListItem(List=flatten(brep), Index=number_slider_7, Wrap=True)
region_difference_5 = RegionDifference(CurvesA=reverse_list, CurvesB=list_item_7.Item5)
panel_6 = Panel(region_difference_5)
boundary_surfaces_9 = BoundarySurfaces(Edges=region_difference_5)
flatten_tree = FlattenTree(Tree=region_difference_5, Path="{0}")
cull_pattern = CullPattern(
    List=flatten_tree,
    CullPattern=[True, True, True, True, True, True, True, True, False, False, False, False, False, False, False, False])
list_item_9 = ListItem(List=flatten_tree, Index=panel_5, Wrap=True)

# ---- group: CenterLeft&Right
# Selfmade mesh
curve_5 = Curve([<curve referenced from the Rhino model> x4])
boundary_2 = BoundarySurfaces(Edges=curve_5)
join_3 = BrepJoin(Breps=boundary_2)  # -> Breps, Closed
srf_2 = Surface(join_3.Breps)
toggle_2 = BooleanToggle(True)
debrep_2 = DeconstructBrep(Brep=srf_2)  # -> Faces, Edges, Vertices
item_14 = ListItem(List=debrep_2.Edges, Index=0, Wrap=True)  # -> Item, Item1, Item2, Item3
custom_mesh_settings_2 = SettingsCustom(
    StitchSeams=toggle_2,
    SimplePlanes=False,
    Refine=toggle_2,
    MinCount="1600",
    MaxCount="1600",
    AspectRatio=20,
    MaxDistance=0,
    MaxAngle=20,
    MinEdge="0",
    MaxEdge="0")
relay_3 = Relay([item_14.Item1, item_14.Item, item_14.Item2, item_14.Item3])
# support curves
join_4 = JoinCurves(Curves=relay_3, Preserve=False)
mesh_3 = MeshBrep(Brep=srf_2, Settings=custom_mesh_settings_2)
density = Slider(20, range=0..100)
mesh_plane = MeshPlane(Boundary={Plane=PlaneXY(0, 0, 0), Size=Domain2(u=-10..10, v=-10..10)}, WidthCount=density, HeightCount=density)  # -> Mesh, Area
mesh_edges_2 = MeshEdges(Mesh=mesh_3)  # -> NakedEdges, InteriorEdges, NonManifoldEdges
deconstruct_mesh_2 = DeconstructMesh(Mesh=mesh_3)  # -> Vertices, Faces, Colours, Normals
force_4 = Slider(0.5, range=0..5)
mesh_4 = Mesh(mesh_3)
meshcorners_2 = MeshCorners(Mesh=mesh_4, Angle=2.35619449)
negative_15 = Negative(Value=force_4)
curve_6 = Curve(mesh_edges_2.NakedEdges)
curve_7 = Curve(mesh_edges_2.InteriorEdges)
point_12 = Point(deconstruct_mesh_2.Vertices)
crv_cp_2 = CurveClosestPoint(Point=point_12, Curve=join_4)  # -> Point, Parameter, Distance
unit_z_17 = UnitZ(Factor=force_4)
reposition_support_2 = Slider(0, range=0..10)
eval_2 = Evaluate(F="If(x<0.1, 1, 0)", x=crv_cp_2.Distance)
list_item_10 = ListItem(List=meshcorners_2, Index=0, Wrap=True)  # -> Item, Item1, Item2, Item3
cull_2 = CullPattern(List=point_12, CullPattern=eval_2)
point_13 = Point(list_item_10.Item)
point_14 = Point(list_item_10.Item1)
point_15 = Point(list_item_10.Item2)
point_16 = Point(list_item_10.Item3)
strength_external_2 = Slider(100, range=5..100)
fixed_length_2 = Panel("0")
strength_internal_2 = Slider(31.6, range=5..50)
unit_z_18 = UnitZ(Factor=reposition_support_2)
move_11 = Move(Geometry=point_13, Motion=unit_z_18)  # -> Geometry, Transform
move_12 = Move(Geometry=point_15, Motion=unit_z_18)  # -> Geometry, Transform
merge_3 = Merge(Data1=move_11.Geometry, Data2=point_14, Data3=move_12.Geometry, Data4=point_16)
merge_4 = Merge(Data1=meshcorners_2, Data2=cull_2)
mesh_point_2 = Point(deconstruct_mesh_2.Vertices)
point_17 = Point(point_13)
point_18 = Point(point_15)
point_19 = Point(move_11.Geometry)
point_20 = Point(move_12.Geometry)
line_2 = Line(StartPoint=point_17, EndPoint=point_18)
length_line_3 = LengthLine(Line=curve_6, Length=fixed_length_2, Strength=strength_external_2)
load_2 = Load(Point=point_12, ForceVector=unit_z_17, Weighting=1)
anchor_2 = Anchor(Point=merge_4, Target=merge_4, Strength=10000)
length_line_4 = LengthLine(Line=curve_7, Length=fixed_length_2, Strength=strength_internal_2)
distance_2 = Distance(PointA=point_19, PointB=point_20)
unit_z_19 = UnitZ(Factor=1)
multiplication_8 = Multiplication(A=distance_2, B=Slider(1.49, range=1..2))
show_2 = Show(G=mesh_4)
catenary_2 = Catenary(PointA=point_19, PointB=point_20, Length=multiplication_8, Gravity=unit_z_19)
curve_closest_point_2 = CurveClosestPoint(Point=mesh_point_2, Curve=line_2)  # -> Point, Parameter, Distance
reset_button_2 = Button()
# Tutorial: https://www.youtube.com/watch?v=SW_xQx1x_5g
activate_2 = BooleanToggle(True)
entwine_2 = Entwine(Branch00=show_2, Branch01=anchor_2, Branch02=length_line_3, Branch03=length_line_4, Branch04=load_2, FlattenInputs=True)
larger_than_2 = LargerThan(FirstNumber=curve_closest_point_2.Distance, SecondNumber="0.1")  # -> LargerThan, OrEqualTo
dispatch_2 = Dispatch(List=mesh_point_2, DispatchPattern=larger_than_2.LargerThan)  # -> ListA, ListB
solver_2 = Solver(GoalObjects=flatten(entwine_2), Reset=reset_button_2, Threshold=1e-15, Tolerance=0.01, On=activate_2)  # -> I, V, O
point_21 = Point(dispatch_2.ListB)
point_22 = Point(dispatch_2.ListA)
oncurve_2 = OnCurve(Points=point_21, Curve=catenary_2, Strength=Slider(50, range=1..50))
list_item_11 = ListItem(List=solver_2.O, Index=0, Wrap=True)  # -> Item, Item1, Item2, Item3

# ----
mesh_5 = Mesh(<mesh referenced from the Rhino model>)
meshtoshell = MeshToShellKaramba3D(Mesh=mesh_5, Identifier="shell", LimitDistance_m=0.005)  # -> Element, Points, Info
license = LicenseKaramba3D()
mc = MeshCorners(Mesh=mesh_5, Angle=2.35619449)
xy = XYPlane(Origin=Point(0, 0, 0))
xy_2 = XYPlane(Origin=Point(0, 0, 0))
matselect = MaterialSelectionKaramba3D(menu=[dropdown(3), dropdown(6)])
pt = Point(meshtoshell.Points)
cp = PlaneClosestPoint(Point=mc, Plane=xy)  # -> Point, UVPoint, Distance
panel_7 = Panel(license)
eval_3 = Evaluate(F="If(x=2.5, 1, 0)", x=cp.Distance)
cross_section = CrossSectionKaramba3D(
    FamilyNameOfCrossSection="DefaultCroSec",
    NameOfCrossSection="shell",
    Material=matselect,
    Height_cm="10",
    mode="Shell - Const")
loads = LoadsKaramba3D(Vector=Vector(0, 0, -1), LCase="0", mode="Gravity")
cull_3 = CullPattern(List=mc, CullPattern=eval_3)
supp = SupportKaramba3D(PosInd=cull_3, PlaneOfReference=xy_2, menu=[buttons(on, on, on, off, off, off)])
assemble = AssembleModelKaramba3D(
    Point=meshtoshell.Points,
    Elem=meshtoshell.Element,
    Support=supp,
    Load=loads,
    CrossSection=cross_section,
    Material=matselect,
    LimitDistance_m=0.005)  # -> Model, Info, Mass_kg, CenterOfGravity
analyze = AnalyzeKaramba3D(Model=assemble.Model)  # -> CalculatedModel, MaximumDisplacement_cm, ResultingForceOfGravity_kN, ElasticEnergy_kNm
modelview = ModelViewKaramba3D(Model=analyze.CalculatedModel, LoadCaseFactorsForLinearSuperposition=1, IndexOfVisibleLoadcase=-1)  # -> Model, DeformedMesh, DeformedAxes, DeformedModel
shellview = ShellViewKaramba3D(Model=modelview.Model, IndexOfLayer=0)  # -> Model, MeshesOfRenderedShells, LegendColors, LegendTags
legend = Legend(Colour=shellview.LegendColors, Tags=shellview.LegendTags, LegendType=1)
crv_7 = Curve([<curve referenced from the Rhino model> x2])
crv_8 = Curve([<curve referenced from the Rhino model> x2])
number_slider_9 = Slider(1.3, range=1.1..2.1)
number_slider_10 = Slider(1.3, range=1.1..2.1)
len_7 = Length(Curve=crv_7)
len_8 = Length(Curve=crv_8)
division_7 = Division(A=number_slider_9, B=3.6)
division_8 = Division(A=number_slider_10, B=3.6)
multiplication_9 = Multiplication(A=len_7, B=number_slider_9)
multiplication_10 = Multiplication(A=len_8, B=number_slider_10)
end_7 = EndPoints(Curve=crv_7)  # -> Start, End
end_8 = EndPoints(Curve=crv_8)  # -> Start, End
cat_7 = Catenary(PointA=end_7.Start, PointB=end_7.End, Length=multiplication_9, Gravity="0,0,1")
cat_8 = Catenary(PointA=end_8.Start, PointB=end_8.End, Length=multiplication_10, Gravity="0,0,1")
item_15 = ListItem(List=cat_7, Index="0", Wrap=True)  # -> Item, Item1
item_16 = ListItem(List=crv_7, Index="0", Wrap=True)  # -> Item, Item1
item_17 = ListItem(List=cat_8, Index="0", Wrap=True)  # -> Item, Item1
item_18 = ListItem(List=crv_8, Index="0", Wrap=True)  # -> Item, Item1
mesh_6 = Mesh([list_item_2.Item, list_item_2.Item1, list_item_2.Item2, list_item_2.Item3])
face_normals = FaceNormals(Mesh=mesh_6)  # -> Centers, Normals
unit_x = UnitX(Factor=1)
unit_y = UnitY(Factor=1)

curve_8 = Curve()  # disabled
boundary_3 = BoundarySurfaces(Edges=curve_8)  # disabled
join_5 = BrepJoin(Breps=boundary_3)  # -> Breps, Closed; disabled
srf_3 = Surface(join_5.Breps)  # disabled
toggle_3 = BooleanToggle(True)  # disabled
debrep_3 = DeconstructBrep(Brep=srf_3)  # -> Faces, Edges, Vertices; disabled
panel_8 = Panel("0")  # disabled
panel_9 = Panel("1600")  # disabled
item_19 = ListItem(List=debrep_3.Edges, Index=0, Wrap=True)  # -> Item, Item1, Item2, Item3; disabled
custom_mesh_settings_3 = SettingsCustom(
    StitchSeams=toggle_3,
    SimplePlanes=False,
    Refine=toggle_3,
    MinCount=panel_9,
    MaxCount=panel_9,
    AspectRatio=20,
    MaxDistance=0,
    MaxAngle=20,
    MinEdge=panel_8,
    MaxEdge=panel_8)  # disabled
relay_4 = Relay([item_19.Item1, item_19.Item, item_19.Item2, item_19.Item3])  # disabled
join_6 = JoinCurves(Curves=relay_4, Preserve=False)  # disabled
mesh_7 = MeshBrep(Brep=srf_3, Settings=custom_mesh_settings_3)  # disabled
density_2 = Slider(20, range=0..100)  # disabled
mesh_plane_2 = MeshPlane(Boundary={Plane=PlaneXY(0, 0, 0), Size=Domain2(u=-10..10, v=-10..10)}, WidthCount=density_2, HeightCount=density_2)  # -> Mesh, Area; disabled
mesh_edges_3 = MeshEdges(Mesh=mesh_7)  # -> NakedEdges, InteriorEdges, NonManifoldEdges; disabled
deconstruct_mesh_3 = DeconstructMesh(Mesh=mesh_7)  # -> Vertices, Faces, Colours, Normals; disabled
force_5 = Slider(2.5, range=0..5)  # disabled
mesh_8 = Mesh(mesh_7)  # disabled
meshcorners_3 = MeshCorners(Mesh=mesh_8, Angle=2.35619449)  # disabled
negative_16 = Negative(Value=force_5)  # disabled
curve_9 = Curve(mesh_edges_3.NakedEdges)  # disabled
curve_10 = Curve(mesh_edges_3.InteriorEdges)  # disabled
point_23 = Point(deconstruct_mesh_3.Vertices)  # disabled
crv_cp_3 = CurveClosestPoint(Point=point_23, Curve=join_6)  # -> Point, Parameter, Distance; disabled
unit_z_20 = UnitZ(Factor=force_5)  # disabled
reposition_support_3 = Slider(0, range=0..10)  # disabled
eval_4 = Evaluate(F="If(x<0.1, 1, 0)", x=crv_cp_3.Distance)  # disabled
list_item_12 = ListItem(List=meshcorners_3, Index=0, Wrap=True)  # -> Item, Item1, Item2, Item3; disabled
cull_4 = CullPattern(List=point_23, CullPattern=eval_4)  # disabled
point_24 = Point(list_item_12.Item)  # disabled
point_25 = Point(list_item_12.Item3)  # disabled
point_26 = Point(list_item_12.Item1)  # disabled
point_27 = Point(list_item_12.Item2)  # disabled
strength_external_3 = Slider(100, range=5..100)  # disabled
fixed_length_3 = Panel("0")  # disabled
strength_internal_3 = Slider(31.6, range=5..50)  # disabled
unit_z_21 = UnitZ(Factor=reposition_support_3)  # disabled
move_13 = Move(Geometry=point_24, Motion=unit_z_21)  # -> Geometry, Transform; disabled
move_14 = Move(Geometry=point_27, Motion=unit_z_21)  # -> Geometry, Transform; disabled
merge_5 = Merge(Data1=move_13.Geometry, Data2=point_26, Data3=move_14.Geometry, Data4=point_25)  # disabled
merge_6 = Merge(Data1=meshcorners_3, Data2=cull_4)  # disabled
mesh_point_3 = Point(deconstruct_mesh_3.Vertices)  # disabled
point_28 = Point(point_24)  # disabled
point_29 = Point(point_27)  # disabled
point_30 = Point(move_13.Geometry)  # disabled
point_31 = Point(move_14.Geometry)  # disabled
number_slider_11 = Slider(1.49, range=1..2)  # disabled
line_3 = Line(StartPoint=point_28, EndPoint=point_29)  # disabled
length_line_5 = LengthLine(Line=curve_9, Length=fixed_length_3, Strength=strength_external_3)  # disabled
load_3 = Load(Point=point_23, ForceVector=unit_z_20, Weighting=1)  # disabled
anchor_3 = Anchor(Point=merge_6, Target=merge_6, Strength=10000)  # disabled
length_line_6 = LengthLine(Line=curve_10, Length=fixed_length_3, Strength=strength_internal_3)  # disabled
distance_3 = Distance(PointA=point_30, PointB=point_31)  # disabled
unit_z_22 = UnitZ(Factor=1)  # disabled
multiplication_11 = Multiplication(A=distance_3, B=number_slider_11)  # disabled
show_3 = Show(G=mesh_8)  # disabled
catenary_3 = Catenary(PointA=point_30, PointB=point_31, Length=multiplication_11, Gravity=unit_z_22)  # disabled
curve_closest_point_3 = CurveClosestPoint(Point=mesh_point_3, Curve=line_3)  # -> Point, Parameter, Distance; disabled
reset_button_3 = Button()  # disabled
activate_3 = BooleanToggle(True)  # disabled
entwine_3 = Entwine(Branch00=show_3, Branch01=anchor_3, Branch02=length_line_5, Branch03=length_line_6, Branch04=load_3, FlattenInputs=True)  # disabled
panel_10 = Panel("0.1")  # disabled
larger_than_3 = LargerThan(FirstNumber=curve_closest_point_3.Distance, SecondNumber=panel_10)  # -> LargerThan, OrEqualTo; disabled
dispatch_3 = Dispatch(List=mesh_point_3, DispatchPattern=larger_than_3.LargerThan)  # -> ListA, ListB; disabled
solver_3 = Solver(GoalObjects=flatten(entwine_3), Reset=reset_button_3, Threshold=1e-15, Tolerance=0.01, On=activate_3)  # -> I, V, O; disabled
point_32 = Point(dispatch_3.ListB)  # disabled
point_33 = Point(dispatch_3.ListA)  # disabled
number_slider_12 = Slider(50, range=1..50)  # disabled
oncurve_3 = OnCurve(Points=point_32, Curve=catenary_3, Strength=number_slider_12)  # disabled
list_item_13 = ListItem(List=solver_3.O, Index=0, Wrap=True)  # -> Item, Item1; disabled

mesh_join = MeshJoin(Meshes=list_item_9)
mesh_join_2 = MeshJoin(Meshes=relay_2)
relay_5 = Relay()
relay_6 = Relay()
relay_7 = Relay()
relay_8 = Relay()
number_slider_13 = Slider(100, range=0..100)  # disabled
panel_11 = Panel("300")  # disabled
settings_custom = SettingsCustom(
    StitchSeams=True,
    SimplePlanes=False,
    Refine=True,
    MinCount=panel_11,
    MaxCount=panel_11,
    AspectRatio=20,
    MaxDistance=0,
    MaxAngle=20,
    MinEdge=0,
    MaxEdge=0)  # disabled
surface_4 = Surface(<surface referenced from the Rhino model>)  # disabled
mesh_brep = MeshBrep(Brep=surface_4, Settings=settings_custom)  # disabled
deconstruct_mesh_4 = DeconstructMesh(Mesh=mesh_brep)  # -> Vertices, Faces, Colours, Normals; disabled
number_slider_14 = Slider(9, range=0..10)  # disabled
curve_11 = Curve(<curve referenced from the Rhino model>)  # disabled
amplitude = Amplitude(Amplitude=1)  # disabled
number_slider_15 = Slider(3, range=0..3)  # disabled
deconstruct_brep_3 = DeconstructBrep(Brep=curve_11)  # -> Faces, Edges, Vertices; disabled
list_item_14 = ListItem(List=deconstruct_brep_3.Vertices, Index=number_slider_15, Wrap=True)  # disabled
closest_points = ClosestPoints(Point=list_item_14, Cloud=deconstruct_mesh_4.Vertices, Count=number_slider_14)  # -> ClosestPoint, CPIndex, Distance; disabled
panel_12 = Panel("300")  # disabled
division_9 = Division(A=panel_12, B=number_slider_14)  # disabled
unit_z_23 = UnitZ(Factor=division_9)  # disabled
loads_karamba3d = LoadsKaramba3D(ForceVector=unit_z_23, Local=False, PosInd=closest_points.ClosestPoint, LCase=0, mode="Point")  # disabled
toggle_4 = BooleanToggle(True)
surface_5 = Surface(<surface referenced from the Rhino model>)
custom_mesh_settings_4 = SettingsCustom(
    StitchSeams=toggle_4,
    SimplePlanes=False,
    Refine=toggle_4,
    MinCount="1600",
    MaxCount="1600",
    AspectRatio=20,
    MaxDistance=0,
    MaxAngle=20,
    MinEdge="0",
    MaxEdge="0")
mesh_brep_2 = MeshBrep(Brep=surface_5, Settings=custom_mesh_settings_4)

# ----
# Young's Modulus [N/mm2]: https://dspace.cvut.cz/bitstream/handle/10467/69500/F1-BP-2017-Gubasheva-Samal-priloha-ADOBE%20AS%20A%20BUILDING%20MATERIAL.%20pdf.pdf?sequence=3&isAllowed=y
young_s_modulus_n_mm2 = Panel("211")
poisson_ratio = Panel("0.3")
name = Panel("Shell Cross section")
ghpython_script = GhPythonScript(e_modulus=young_s_modulus_n_mm2, poission_ratio=poisson_ratio)  # -> shear_modulus; inputs e_modulus: Int32, poission_ratio: Int32
# ---------- ghpython_script: Python ----------
__author__ = "kees_"
__version__ = "2019.10.08"

import rhinoscriptsyntax as rs

# 4.	calculation of shear modulus according to [Landau LD, Lifshitz EM. Theory of Elasticity, vol. 7. Course of Theoretical Physics. (2nd Ed) Pergamon: Oxford 1970 p13]

a = int(poission_ratio)
b = int(e_modulus)

shear_modulus = b/(2*(1+a))
# ---------- end ghpython_script ----------
name_2 = Panel("adobe sucrum test")
compressive_strenght_n_mm2 = Panel("0.970")
thickness_cm = Panel("10")
material_properties_karamba3d = MaterialPropertiesKaramba3D(
    FamilyOfMaterial=name_2,
    Name=name_2,
    YoungsModulus_kN_cm2=expr("x*0.1", young_s_modulus_n_mm2),
    InPlaneShearModulus_kN_cm2=expr("x*0.1", ghpython_script),
    TransverseShearModulus_kN_cm2=expr("x*0.1", ghpython_script),
    SpecificWeight_kN_m3="15.07",
    CoefficientOfThermalExpansion_1_C=1e-05,
    YieldStrength_kN_cm2=expr("x*0.1", compressive_strenght_n_mm2),
    mode="Isotrop")
cross_section_karamba3d = CrossSectionKaramba3D(FamilyNameOfCrossSection=name, NameOfCrossSection=name, Height_cm=thickness_cm, mode="Shell - Const")

# ----
# Selfmade mesh
# Output
curve_12 = Curve([<curve referenced from the Rhino model> x4])
boundary_4 = BoundarySurfaces(Edges=curve_12)
join_7 = BrepJoin(Breps=boundary_4)  # -> Breps, Closed
srf_4 = Surface(join_7.Breps)
toggle_5 = BooleanToggle(True)
debrep_4 = DeconstructBrep(Brep=srf_4)  # -> Faces, Edges, Vertices
item_20 = ListItem(List=debrep_4.Edges, Index=0, Wrap=True)  # -> Item, Item1, Item2, Item3
custom_mesh_settings_5 = SettingsCustom(
    StitchSeams=toggle_5,
    SimplePlanes=False,
    Refine=toggle_5,
    MinCount="1600",
    MaxCount="1600",
    AspectRatio=20,
    MaxDistance=0,
    MaxAngle=20,
    MinEdge="0",
    MaxEdge="0")
relay_9 = Relay([item_20.Item1, item_20.Item, item_20.Item2, item_20.Item3])
join_8 = JoinCurves(Curves=relay_9, Preserve=False)
mesh_9 = MeshBrep(Brep=srf_4, Settings=custom_mesh_settings_5)
density_3 = Slider(20, range=0..100)
mesh_plane_3 = MeshPlane(Boundary={Plane=PlaneXY(0, 0, 0), Size=Domain2(u=-10..10, v=-10..10)}, WidthCount=density_3, HeightCount=density_3)  # -> Mesh, Area
mesh_edges_4 = MeshEdges(Mesh=mesh_9)  # -> NakedEdges, InteriorEdges, NonManifoldEdges
deconstruct_mesh_5 = DeconstructMesh(Mesh=mesh_9)  # -> Vertices, Faces, Colours, Normals
force_6 = Slider(0.2, range=0..5)
mesh_10 = Mesh(mesh_9)
meshcorners_4 = MeshCorners(Mesh=mesh_10, Angle=2.35619449)
negative_17 = Negative(Value=force_6)
curve_13 = Curve(mesh_edges_4.NakedEdges)
curve_14 = Curve(mesh_edges_4.InteriorEdges)
point_34 = Point(deconstruct_mesh_5.Vertices)
crv_cp_4 = CurveClosestPoint(Point=point_34, Curve=join_8)  # -> Point, Parameter, Distance
unit_z_24 = UnitZ(Factor=force_6)
reposition_support_4 = Slider(0, range=0..10)
eval_5 = Evaluate(F="If(x<0.1, 1, 0)", x=crv_cp_4.Distance)
list_item_15 = ListItem(List=meshcorners_4, Index=0, Wrap=True)  # -> Item, Item1, Item2, Item3
cull_5 = CullPattern(List=point_34, CullPattern=eval_5)
point_35 = Point(list_item_15.Item)
point_36 = Point(list_item_15.Item1)
point_37 = Point(list_item_15.Item2)
point_38 = Point(list_item_15.Item3)
strength_external_4 = Slider(100, range=5..100)
fixed_length_4 = Panel("0")
strength_internal_4 = Slider(12.1, range=5..50)
unit_z_25 = UnitZ(Factor=reposition_support_4)
move_15 = Move(Geometry=point_35, Motion=unit_z_25)  # -> Geometry, Transform
move_16 = Move(Geometry=point_37, Motion=unit_z_25)  # -> Geometry, Transform
merge_7 = Merge(Data1=move_15.Geometry, Data2=point_36, Data3=move_16.Geometry, Data4=point_38)
mesh_point_4 = Point(deconstruct_mesh_5.Vertices)
point_39 = Point(point_35)
point_40 = Point(point_37)
point_41 = Point(move_15.Geometry)
point_42 = Point(move_16.Geometry)
line_4 = Line(StartPoint=point_39, EndPoint=point_40)
length_line_7 = LengthLine(Line=curve_13, Length=fixed_length_4, Strength=strength_external_4)
load_4 = Load(Point=point_34, ForceVector=unit_z_24, Weighting=1)
length_line_8 = LengthLine(Line=curve_14, Length=fixed_length_4, Strength=strength_internal_4)
distance_4 = Distance(PointA=point_41, PointB=point_42)
unit_z_26 = UnitZ(Factor=1)
multiplication_12 = Multiplication(A=distance_4, B=Slider(1.49, range=1..2))
show_4 = Show(G=mesh_10)
catenary_4 = Catenary(PointA=point_41, PointB=point_42, Length=multiplication_12, Gravity=unit_z_26)
curve_closest_point_4 = CurveClosestPoint(Point=mesh_point_4, Curve=line_4)  # -> Point, Parameter, Distance
reset_button_4 = Button()
activate_4 = BooleanToggle(True)
larger_than_4 = LargerThan(FirstNumber=curve_closest_point_4.Distance, SecondNumber="0.1")  # -> LargerThan, OrEqualTo
dispatch_4 = Dispatch(List=mesh_point_4, DispatchPattern=larger_than_4.LargerThan)  # -> ListA, ListB
point_43 = Point(dispatch_4.ListB)
point_44 = Point(dispatch_4.ListA)
oncurve_4 = OnCurve(Points=point_43, Curve=catenary_4, Strength=Slider(50, range=1..50))

crv_cp_5 = CurveClosestPoint(Point=deconstruct_mesh_5.Vertices, Curve=item_16.Item1)  # -> Point, Parameter, Distance
crv_cp_6 = CurveClosestPoint(Point=deconstruct_mesh_5.Vertices, Curve=item_16.Item)  # -> Point, Parameter, Distance
crv_cp_7 = CurveClosestPoint(Point=deconstruct_mesh_5.Vertices, Curve=item_18.Item1)  # -> Point, Parameter, Distance
crv_cp_8 = CurveClosestPoint(Point=deconstruct_mesh_5.Vertices, Curve=item_18.Item)  # -> Point, Parameter, Distance
larger_than_5 = LargerThan(FirstNumber=crv_cp_6.Distance, SecondNumber="10")  # -> LargerThan, OrEqualTo
larger_than_6 = LargerThan(FirstNumber=crv_cp_5.Distance, SecondNumber="10")  # -> LargerThan, OrEqualTo
larger_than_7 = LargerThan(FirstNumber=crv_cp_8.Distance, SecondNumber="10")  # -> LargerThan, OrEqualTo
larger_than_8 = LargerThan(FirstNumber=crv_cp_7.Distance, SecondNumber="10")  # -> LargerThan, OrEqualTo
dispatch_5 = Dispatch(List=crv_cp_6.Point, DispatchPattern=larger_than_5.LargerThan)  # -> ListA, ListB
dispatch_6 = Dispatch(List=crv_cp_8.Point, DispatchPattern=larger_than_7.LargerThan)  # -> ListA, ListB
dispatch_7 = Dispatch(List=crv_cp_5.Point, DispatchPattern=larger_than_6.LargerThan)  # -> ListA, ListB
dispatch_8 = Dispatch(List=crv_cp_7.Point, DispatchPattern=larger_than_8.LargerThan)  # -> ListA, ListB
meshcorners_5 = MeshCorners(Mesh=mesh_10, Angle=2.35619449)
oncurve_5 = OnCurve(Points=dispatch_5.ListB, Curve=item_15.Item, Strength="100")
oncurve_6 = OnCurve(Points=dispatch_7.ListB, Curve=item_15.Item1, Strength="100")
oncurve_7 = OnCurve(Points=dispatch_6.ListB, Curve=item_17.Item, Strength="100")
oncurve_8 = OnCurve(Points=dispatch_8.ListB, Curve=item_17.Item1, Strength="100")

merge_8 = Merge(Data1=meshcorners_5)
anchor_4 = Anchor(Point=merge_8, Target=merge_8, Strength=10000)
entwine_4 = Entwine(
    Branch00=show_4,
    Branch01=anchor_4,
    Branch02=length_line_7,
    Branch03=length_line_8,
    Branch04=load_4,
    Branch05=oncurve_7,
    Branch06=oncurve_8,
    Branch07=oncurve_5,
    Branch08=oncurve_6,
    FlattenInputs=True)
solver_4 = Solver(GoalObjects=flatten(entwine_4), Reset=reset_button_4, Threshold=1e-15, Tolerance=0.01, On=activate_4)  # -> I, V, O
list_item_16 = ListItem(List=solver_4.O, Index=0, Wrap=True)  # -> Item, Item1

mesh_11 = Mesh(list_item_16.Item)
mesh_area = MeshArea(Mesh=mesh_11)  # -> Area, Centroid
deconstruct_mesh_6 = DeconstructMesh(Mesh=mesh_11)  # -> Vertices, Faces, Colours, Normals; disabled
meshcorners_6 = MeshCorners(Mesh=mesh_11, Angle=2.35619449)
panel_13 = Panel(mesh_area.Area)
mesh_face = MeshFace(deconstruct_mesh_6.Faces)
face_normals_2 = FaceNormals(Mesh=mesh_11)  # -> Centers, Normals
closest_point = ClosestPoint(Point=meshcorners_6, Cloud=face_normals_2.Centers)  # -> ClosestPoint, CPIndex, Distance
list_item_17 = ListItem(List=meshcorners_6, Index=Slider(2, range=0..3), Wrap=True)
list_item_18 = ListItem(List=face_normals_2.Centers, Index=0, Wrap=True)
list_item_19 = ListItem(List=face_normals_2.Normals, Index=0, Wrap=True)
list_item_20 = ListItem(List=face_normals_2.Centers, Index=0, Wrap=True)
line_5 = Line(StartPoint=list_item_20, EndPoint=list_item_17)
vector = Vector(list_item_19)
negative_18 = Negative(Value=vector)
addition = Addition(A=unit_x, B=unit_y, C=negative_18)
closest_points_2 = ClosestPoints(Point=closest_point.ClosestPoint, Cloud=flatten(face_normals.Centers), Count=Slider(9, range=0..10))  # -> flatten(ClosestPoint), CPIndex, Distance
rotate = Rotate(Vector=list_item_19, Axis=line_5, Angle="0.5*pi")
line_sdl_5 = LineSDL(Start=list_item_18, Direction=addition, Length=1)  # disabled
rotate_2 = Rotate(Vector=rotate, Axis=list_item_19, Angle="0.5*pi")
line_sdl_6 = LineSDL(Start=list_item_18, Direction=rotate_2, Length=1)
amplitude_2 = Amplitude(Vector=line_sdl_6, Amplitude=1)
merge_9 = Merge(
    Data1=mesh_join,
    Data2=mesh_join_2,
    Data3=list_item_2.Item,
    Data4=list_item_2.Item1,
    Data5=relay_5,
    Data6=relay_6,
    Data7=list_item_11.Item,
    Data8=list_item_11.Item1,
    Data9=relay_7,
    Data10=relay_8,
    Data11=list_item_16.Item)  # -> flatten(Result)
mesh_join_3 = MeshJoin(Meshes=merge_9)  # -> flatten(Mesh)

mesh_12 = Mesh(mesh_11)
meshtoshell_2 = MeshToShellKaramba3D(Mesh=mesh_12, Identifier="shell", LimitDistance_m=0.005)  # -> Element, Points, Info
license_2 = LicenseKaramba3D()
xy_3 = XYPlane(Origin=Point(0, 0, 0))
matselect_2 = MaterialSelectionKaramba3D(menu=[dropdown(1), dropdown(6)])
mc_2 = MeshCorners(Mesh=mesh_12, Angle=2.35619449)
panel_14 = Panel(license_2)
supp_2 = SupportKaramba3D(PosInd=mc_2, PlaneOfReference=xy_3, menu=[buttons(on, on, on, off, off, off)])
loads_2 = LoadsKaramba3D(Vector=Vector(0, 0, -1), LCase="0", mode="Gravity")
cross_section_2 = CrossSectionKaramba3D(
    FamilyNameOfCrossSection="DefaultCroSec",
    NameOfCrossSection="shell",
    Material=material_properties_karamba3d,
    Height_cm="50",
    mode="Shell - Const")
assemble_2 = AssembleModelKaramba3D(
    Point=meshtoshell_2.Points,
    Elem=meshtoshell_2.Element,
    Support=supp_2,
    Load=loads_2,
    CrossSection=cross_section_2,
    Material=material_properties_karamba3d,
    LimitDistance_m=0.005)  # -> Model, Info, Mass_kg, CenterOfGravity
analyze_2 = AnalyzeKaramba3D(Model=assemble_2.Model)  # -> CalculatedModel, MaximumDisplacement_cm, ResultingForceOfGravity_kN, ElasticEnergy_kNm
modelview_2 = ModelViewKaramba3D(Model=analyze_2.CalculatedModel, LoadCaseFactorsForLinearSuperposition=1, IndexOfVisibleLoadcase=-1)  # -> Model, DeformedMesh, DeformedAxes, DeformedModel
shellview_2 = ShellViewKaramba3D(Model=modelview_2.Model, IndexOfLayer=0)  # -> Model, MeshesOfRenderedShells, LegendColors, LegendTags
legend_2 = Legend(Colour=shellview_2.LegendColors, Tags=shellview_2.LegendTags, LegendType=1)
