# Grasshopper definition 01JunctionFormFinding01ScriptVariantWithoutCatenaryBigDomeCatenarySupportRoundCorner.gh (Grasshopper 1.0.7)
# plug-ins: Karamba, MeshEdit Components, Kangaroo2 Components

negative = Negative(Value=Slider(2.5, range=0..2.5))
unit_z = UnitZ(Factor=negative)
crv = Curve([<curve referenced from the Rhino model> x2])
number_slider = Slider(1.3, range=1.1..2.1)
division = Division(A=number_slider, B=3.6)
move = Move(Geometry=crv, Motion=unit_z)  # -> Geometry, Transform
len = Length(Curve=move.Geometry)
multiplication = Multiplication(A=len, B=number_slider)
end = EndPoints(Curve=move.Geometry)  # -> Start, End
cat = Catenary(PointA=end.Start, PointB=end.End, Length=multiplication, Gravity="0,0,1")
item = ListItem(List=cat, Index="0", Wrap=True)  # -> Item, Item1
item_2 = ListItem(List=move.Geometry, Index="0", Wrap=True)  # -> Item, Item1

# ---- group: Extrution Wall
negative_2 = Negative(Value=Slider(2.5, range=0..10))
curve = Curve([<curve referenced from the Rhino model> x9])
unit_z_2 = UnitZ(Factor=negative_2)
extrude = Extrude(Base=curve, Direction=unit_z_2)

# ----
negative_3 = Negative(Value=Slider(2.5, range=0..2.5))
unit_z_3 = UnitZ(Factor=negative_3)
crv_2 = Curve([<curve referenced from the Rhino model> x2])
number_slider_2 = Slider(1.3, range=1.1..2.1)
division_2 = Division(A=number_slider_2, B=3.6)
move_2 = Move(Geometry=crv_2, Motion=unit_z_3)  # -> Geometry, Transform
len_2 = Length(Curve=move_2.Geometry)
multiplication_2 = Multiplication(A=len_2, B=number_slider_2)
end_2 = EndPoints(Curve=move_2.Geometry)  # -> Start, End
cat_2 = Catenary(PointA=end_2.Start, PointB=end_2.End, Length=multiplication_2, Gravity="0,0,1")
item_3 = ListItem(List=move_2.Geometry, Index="0", Wrap=True)  # -> Item, Item1
item_4 = ListItem(List=cat_2, Index="0", Wrap=True)  # -> Item, Item1

unit_x = UnitX(Factor=1)
unit_y = UnitY(Factor=1)

# ---- group: CenterLeft&Right
# Selfmade mesh
# Tutorial: https://www.youtube.com/watch?v=SW_xQx1x_5g
curve_2 = Curve([<curve referenced from the Rhino model> x4])
boundary = BoundarySurfaces(Edges=curve_2)
join = BrepJoin(Breps=boundary)  # -> Breps, Closed
srf = Surface(join.Breps)
toggle = BooleanToggle(True)
debrep = DeconstructBrep(Brep=srf)  # -> Faces, Edges, Vertices
item_5 = ListItem(List=debrep.Edges, Index=0, Wrap=True)  # -> Item, Item1, Item2, Item3
custom_mesh_settings = SettingsCustom(
    StitchSeams=toggle,
    SimplePlanes=False,
    Refine=toggle,
    MinCount="1600",
    MaxCount="1600",
    AspectRatio=20,
    MaxDistance=0,
    MaxAngle=20,
    MinEdge="0",
    MaxEdge="0")
relay = Relay([item_5.Item1, item_5.Item, item_5.Item2, item_5.Item3])
join_2 = JoinCurves(Curves=relay, Preserve=False)
mesh = MeshBrep(Brep=srf, Settings=custom_mesh_settings)
density = Slider(20, range=0..100)
mesh_plane = MeshPlane(Boundary={Plane=PlaneXY(0, 0, 0), Size=Domain2(u=-10..10, v=-10..10)}, WidthCount=density, HeightCount=density)  # -> Mesh, Area
mesh_edges = MeshEdges(Mesh=mesh)  # -> NakedEdges, InteriorEdges, NonManifoldEdges
deconstruct_mesh = DeconstructMesh(Mesh=mesh)  # -> Vertices, Faces, Colours, Normals
force = Slider(0.5, range=0..5)
mesh_2 = Mesh(mesh)
meshcorners = MeshCorners(Mesh=mesh_2, Angle=2.35619449)
negative_4 = Negative(Value=force)
curve_3 = Curve(mesh_edges.NakedEdges)
curve_4 = Curve(mesh_edges.InteriorEdges)
point = Point(deconstruct_mesh.Vertices)
crv_cp = CurveClosestPoint(Point=point, Curve=join_2)  # -> Point, Parameter, Distance
unit_z_4 = UnitZ(Factor=force)
reposition_support = Slider(0, range=0..10)
eval = Evaluate(F="If(x<0.1, 1, 0)", x=crv_cp.Distance)
list_item = ListItem(List=meshcorners, Index=0, Wrap=True)  # -> Item, Item1, Item2, Item3
cull = CullPattern(List=point, CullPattern=eval)
point_2 = Point(list_item.Item)
point_3 = Point(list_item.Item1)
point_4 = Point(list_item.Item2)
point_5 = Point(list_item.Item3)
strength_external = Slider(100, range=5..100)
fixed_length = Panel("0")
strength_internal = Slider(31.6, range=5..50)
unit_z_5 = UnitZ(Factor=reposition_support)
move_3 = Move(Geometry=point_2, Motion=unit_z_5)  # -> Geometry, Transform
move_4 = Move(Geometry=point_4, Motion=unit_z_5)  # -> Geometry, Transform
merge = Merge(Data1=meshcorners, Data2=cull)
merge_2 = Merge(Data1=move_3.Geometry, Data2=point_3, Data3=move_4.Geometry, Data4=point_5)
# Small middle Domes
mesh_point = Point(deconstruct_mesh.Vertices)
point_6 = Point(point_2)
point_7 = Point(point_4)
point_8 = Point(move_3.Geometry)
point_9 = Point(move_4.Geometry)
line = Line(StartPoint=point_6, EndPoint=point_7)
length_line = LengthLine(Line=curve_3, Length=fixed_length, Strength=strength_external)
load = Load(Point=point, ForceVector=unit_z_4, Weighting=1)
anchor = Anchor(Point=merge, Target=merge, Strength=10000)
length_line_2 = LengthLine(Line=curve_4, Length=fixed_length, Strength=strength_internal)
distance = Distance(PointA=point_8, PointB=point_9)
unit_z_6 = UnitZ(Factor=1)
multiplication_3 = Multiplication(A=distance, B=Slider(1.49, range=1..2))
show = Show(G=mesh_2)
catenary = Catenary(PointA=point_8, PointB=point_9, Length=multiplication_3, Gravity=unit_z_6)
curve_closest_point = CurveClosestPoint(Point=mesh_point, Curve=line)  # -> Point, Parameter, Distance
reset_button = Button()
activate = BooleanToggle(True)
entwine = Entwine(Branch00=show, Branch01=anchor, Branch02=length_line, Branch03=length_line_2, Branch04=load, FlattenInputs=True)
larger_than = LargerThan(FirstNumber=curve_closest_point.Distance, SecondNumber="0.1")  # -> LargerThan, OrEqualTo
dispatch = Dispatch(List=mesh_point, DispatchPattern=larger_than.LargerThan)  # -> ListA, ListB
solver = Solver(GoalObjects=flatten(entwine), Reset=reset_button, Threshold=1e-15, Tolerance=0.01, On=activate)  # -> I, V, O
point_10 = Point(dispatch.ListB)
point_11 = Point(dispatch.ListA)
oncurve = OnCurve(Points=point_10, Curve=catenary, Strength=Slider(50, range=1..50))
list_item_2 = ListItem(List=solver.O, Index=0, Wrap=True)  # -> Item, Item1, Item2, Item3

# ----
# Wall Extrusion
negative_5 = Negative(Value=Slider(2.5, range=0..2.5))
unit_z_7 = UnitZ(Factor=negative_5)
crv_3 = Curve([<curve referenced from the Rhino model> x2])
number_slider_3 = Slider(1.3, range=1.1..2.1)
division_3 = Division(A=number_slider_3, B=3.6)
move_5 = Move(Geometry=crv_3, Motion=unit_z_7)  # -> Geometry, Transform
len_3 = Length(Curve=move_5.Geometry)
multiplication_4 = Multiplication(A=len_3, B=number_slider_3)
end_3 = EndPoints(Curve=move_5.Geometry)  # -> Start, End
cat_3 = Catenary(PointA=end_3.Start, PointB=end_3.End, Length=multiplication_4, Gravity="0,0,1")
item_6 = ListItem(List=cat_3, Index="0", Wrap=True)  # -> Item, Item1
item_7 = ListItem(List=move_5.Geometry, Index="0", Wrap=True)  # -> Item, Item1

unit_z_8 = UnitZ(Factor=Slider(1.6, range=0..10))

negative_6 = Negative(Value=Slider(2.5, range=0..2.5))
unit_z_9 = UnitZ(Factor=negative_6)
crv_4 = Curve([<curve referenced from the Rhino model> x2])
number_slider_4 = Slider(1.3, range=1.1..2.1)
division_4 = Division(A=number_slider_4, B=3.6)
move_6 = Move(Geometry=crv_4, Motion=unit_z_9)  # -> Geometry, Transform
len_4 = Length(Curve=move_6.Geometry)
multiplication_5 = Multiplication(A=len_4, B=number_slider_4)
end_4 = EndPoints(Curve=move_6.Geometry)  # -> Start, End
cat_4 = Catenary(PointA=end_4.Start, PointB=end_4.End, Length=multiplication_5, Gravity="0,0,1")
item_8 = ListItem(List=cat_4, Index="0", Wrap=True)  # -> Item, Item1
item_9 = ListItem(List=move_6.Geometry, Index="0", Wrap=True)  # -> Item, Item1

boolean_toggle = BooleanToggle(True)
load_2 = Load(ForceVector=Vector(0, 0, 1), Weighting=1)
load_3 = Load(ForceVector=Vector(0, 0, 1), Weighting=1)
# nr cps = 20
# force = .93/4
# nr cps = 50
# force = .93/10
mesh_3 = Mesh(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)
mesh_4 = Mesh(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)
relay_2 = Relay()
relay_3 = Relay()
relay_4 = Relay()
relay_5 = Relay()
# Material Property
panel = Panel("15.07")

# ----
# Young's Modulus [N/mm2]: https://dspace.cvut.cz/bitstream/handle/10467/69500/F1-BP-2017-Gubasheva-Samal-priloha-ADOBE%20AS%20A%20BUILDING%20MATERIAL.%20pdf.pdf?sequence=3&isAllowed=y
young_s_modulus_n_mm2 = Panel("211")
poisson_ratio = Panel("0.3")
name = Panel("Shell Cross section")
ghpython_script = GhPythonScript(e_modulus=young_s_modulus_n_mm2, poission_ratio=poisson_ratio)  # -> shear_modulus; inputs e_modulus: Int32, poission_ratio: Int32
# ---------- ghpython_script: Python ----------
__author__ = "kees_"
__version__ = "2019.10.08"

import rhinoscriptsyntax as rs

# 4.	calculation of shear modulus according to [Landau LD, Lifshitz EM. Theory of Elasticity, vol. 7. Course of Theoretical Physics. (2nd Ed) Pergamon: Oxford 1970 p13]

a = int(poission_ratio)
b = int(e_modulus)

shear_modulus = b/(2*(1+a))
# ---------- end ghpython_script ----------
name_2 = Panel("adobe sucrum test")
compressive_strenght_n_mm2 = Panel("0.970")
thickness_cm = Panel("10")
material_properties_karamba3d = MaterialPropertiesKaramba3D(
    FamilyOfMaterial=name_2,
    Name=name_2,
    YoungsModulus_kN_cm2=expr("x*0.1", young_s_modulus_n_mm2),
    InPlaneShearModulus_kN_cm2=expr("x*0.1", ghpython_script),
    TransverseShearModulus_kN_cm2=expr("x*0.1", ghpython_script),
    SpecificWeight_kN_m3=panel,
    CoefficientOfThermalExpansion_1_C=1e-05,
    YieldStrength_kN_cm2=expr("x*0.1", compressive_strenght_n_mm2),
    mode="Isotrop")
cross_section_karamba3d = CrossSectionKaramba3D(FamilyNameOfCrossSection=name, NameOfCrossSection=name, Height_cm=thickness_cm, mode="Shell - Const")

negative_7 = Negative(Value=Slider(1, range=0..1))
negative_8 = Negative(Value=Slider(1.5, range=0..10))
unit_z_10 = UnitZ(Factor=negative_7)
force_2 = Slider(1, range=0.5..50)
negative_9 = Negative(Value=Slider(1.5, range=0..10))
crv_5 = Curve([<curve referenced from the Rhino model> x2])
number_slider_5 = Slider(1.3, range=1.1..2.1)
unit_z_11 = UnitZ(Factor=negative_8)
negative_10 = Negative(Value=Slider(1, range=0..1))
unit_z_12 = UnitZ(Factor=1)
division_5 = Division(A=number_slider_5, B=3.6)
unit_z_13 = UnitZ(Factor=negative_9)
move_7 = Move(Geometry=crv_5, Motion=unit_z_10)  # -> Geometry, Transform
len_5 = Length(Curve=move_7.Geometry)
multiplication_6 = Multiplication(A=len_5, B=number_slider_5)
unit_z_14 = UnitZ(Factor=negative_10)
force_3 = Slider(1, range=0.5..50)
crv_6 = Curve([<curve referenced from the Rhino model> x2])
number_slider_6 = Slider(1.3, range=1.1..2.1)
end_5 = EndPoints(Curve=move_7.Geometry)  # -> Start, End
negative_11 = Negative(Value=Slider(1.5, range=0..10))
cat_5 = Catenary(PointA=end_5.Start, PointB=end_5.End, Length=multiplication_6, Gravity="0,0,1")
unit_z_15 = UnitZ(Factor=1)
negative_12 = Negative(Value=force_3)
end_points = EndPoints(Curve=move_7.Geometry)  # -> Start, End
division_6 = Division(A=number_slider_6, B=3.6)
boundary_surfaces = BoundarySurfaces(Edges=[item_2.Item, item_2.Item1, item.Item, item.Item1])
item_10 = ListItem(List=cat_5, Index="0", Wrap=True)  # -> Item, Item1
move_8 = Move(Geometry=crv_6, Motion=unit_z_14)  # -> Geometry, Transform
len_6 = Length(Curve=move_8.Geometry)
multiplication_7 = Multiplication(A=len_6, B=number_slider_6)
unit_z_16 = UnitZ(Factor=force_3)
item_11 = ListItem(List=move_7.Geometry, Index="0", Wrap=True)  # -> Item, Item1
end_6 = EndPoints(Curve=move_8.Geometry)  # -> Start, End
negative_13 = Negative(Value=Slider(1.5, range=0..10))
cat_6 = Catenary(PointA=end_6.Start, PointB=end_6.End, Length=multiplication_7, Gravity="0,0,1")
move_9 = Move(Geometry=move_7.Geometry, Motion=unit_z_11)  # -> Geometry, Transform
line_sdl = LineSDL(Start=end_points.Start, Direction=unit_z_12, Length=negative_11)
line_sdl_2 = LineSDL(Start=end_points.End, Direction=unit_z_12, Length=negative_11)
panel_2 = Panel("10")
end_points_2 = EndPoints(Curve=move_8.Geometry)  # -> Start, End
item_12 = ListItem(List=cat_6, Index="0", Wrap=True)  # -> Item, Item1
item_13 = ListItem(List=move_8.Geometry, Index="0", Wrap=True)  # -> Item, Item1
move_10 = Move(Geometry=move_8.Geometry, Motion=unit_z_13)  # -> Geometry, Transform
line_sdl_3 = LineSDL(Start=end_points_2.Start, Direction=unit_z_15, Length=negative_13)
line_sdl_4 = LineSDL(Start=end_points_2.End, Direction=unit_z_15, Length=negative_13)
brep_join = BrepJoin(Breps=extrude)  # -> Breps, Closed
# catenary curves
geometry = Geometry([line_sdl, line_sdl_2, cat_5, move_9.Geometry])
geometry_2 = Geometry([line_sdl_3, line_sdl_4, cat_6, move_10.Geometry])
list_item_3 = ListItem(List=brep_join.Breps, Index=0, Wrap=True)  # -> Item, Item1, Item2, Item3, Item4
boundary_surfaces_2 = BoundarySurfaces(Edges=geometry)
deconstruct_brep = DeconstructBrep(Brep=list_item_3.Item)  # -> Faces, Edges, Vertices
boundary_surfaces_3 = BoundarySurfaces(Edges=geometry_2)
list_item_4 = ListItem(List=deconstruct_brep.Faces, Index=0, Wrap=True)  # -> Item, Item1, Item2, Item3
deconstruct_brep_2 = DeconstructBrep(Brep=[list_item_3.Item1, list_item_3.Item2, list_item_3.Item3, list_item_3.Item4])  # -> graft(Faces), Edges, Vertices
surface = Surface([boundary_surfaces_2, boundary_surfaces_3])
boundary_surfaces_4 = BoundarySurfaces(Edges=[item_4.Item, item_4.Item1, item_3.Item, item_3.Item1])
list_item_5 = ListItem(List=surface, Index=0, Wrap=True)  # -> Item, Item1, Item2, Item3, Item4
brep_wireframe = BrepWireframe(Brep=list_item_4.Item, Density=-1)
brep_wireframe_2 = BrepWireframe(Brep=list_item_5.Item4, Density=-1)
brep_wireframe_3 = BrepWireframe(Brep=list_item_4.Item2, Density=-1)
brep_wireframe_4 = BrepWireframe(Brep=list_item_5.Item2, Density=-1)
brep_wireframe_5 = BrepWireframe(Brep=list_item_4.Item1, Density=-1)
brep_wireframe_6 = BrepWireframe(Brep=list_item_5.Item3, Density=-1)
brep_wireframe_7 = BrepWireframe(Brep=list_item_4.Item3, Density=-1)
brep_wireframe_8 = BrepWireframe(Brep=list_item_5.Item1, Density=-1)
brep_wireframe_9 = BrepWireframe(Brep=flatten(deconstruct_brep_2.Faces), Density=-1)
join_curves = JoinCurves(Curves=brep_wireframe, Preserve=False)
join_curves_2 = JoinCurves(Curves=brep_wireframe_8, Preserve=False)
join_curves_3 = JoinCurves(Curves=brep_wireframe_3, Preserve=False)
join_curves_4 = JoinCurves(Curves=brep_wireframe_5, Preserve=False)
join_curves_5 = JoinCurves(Curves=brep_wireframe_2, Preserve=False)
join_curves_6 = JoinCurves(Curves=brep_wireframe_7, Preserve=False)
join_curves_7 = JoinCurves(Curves=brep_wireframe_6, Preserve=False)
join_curves_8 = JoinCurves(Curves=brep_wireframe_4, Preserve=False)
join_curves_9 = JoinCurves(Curves=brep_wireframe_9, Preserve=False)
shift_list = ShiftList(List=flatten(join_curves_9), Shift=Slider(2, range=0..10), Wrap=True)
panel_4 = Panel("2")
number_slider_7 = Slider(4, range=0..10)
boundary_surfaces_5 = BoundarySurfaces(Edges=[item_6.Item1, item_7.Item1])
boundary_surfaces_6 = BoundarySurfaces(Edges=[item_7.Item, item_6.Item])
reverse_list = ReverseList(List=shift_list)
list_item_6 = ListItem(List=flatten(reverse_list), Index=number_slider_7, Wrap=True)
surface_2 = Surface([boundary_surfaces_6, boundary_surfaces_5])
boundary_surfaces_7 = BoundarySurfaces(Edges=[item_9.Item1, item_8.Item1])
boundary_surfaces_8 = BoundarySurfaces(Edges=[item_9.Item, item_8.Item])
panel_5 = Panel("""0
2
4
6
9
11
13
15""")
surface_3 = Surface([boundary_surfaces_7, boundary_surfaces_8])
brep_wireframe_10 = BrepWireframe(Brep=[boundary_surfaces, surface_2, boundary_surfaces_4, surface_3], Density=-1)
join_curves_10 = JoinCurves(Curves=brep_wireframe_10, Preserve=False)
list_item_7 = ListItem(List=join_curves_10, Index=0, Wrap=True)  # -> Item, Item1, Item2, Item3, Item4, Item5
brep = Brep(list_item_7.Item5)
list_item_8 = ListItem(List=flatten(brep), Index=number_slider_7, Wrap=True)
region_difference = RegionDifference(CurvesA=reverse_list, CurvesB=list_item_7.Item5)
panel_6 = Panel(region_difference)
boundary_surfaces_9 = BoundarySurfaces(Edges=region_difference)
flatten_tree = FlattenTree(Tree=region_difference, Path="{0}")
cull_pattern = CullPattern(
    List=flatten_tree,
    CullPattern=[True, True, True, True, True, True, True, True, False, False, False, False, False, False, False, False])
list_item_9 = ListItem(List=flatten_tree, Index=panel_5, Wrap=True)

# ---- group: Hanging
negative_14 = Negative(Value=force_2)

# ---- group: Standing
unit_z_17 = UnitZ(Factor=force_2)

# ----
region_difference_2 = RegionDifference(CurvesA=join_curves_4, CurvesB=join_curves_7)
region_difference_3 = RegionDifference(CurvesA=join_curves_3, CurvesB=join_curves_5)
region_difference_4 = RegionDifference(CurvesA=join_curves, CurvesB=join_curves_2)
region_difference_5 = RegionDifference(CurvesA=join_curves_6, CurvesB=join_curves_8)

relay_6 = Relay([region_difference_2, region_difference_4, region_difference_3, region_difference_5])

relay_7 = Relay([list_item_9, relay_6])
mesh_join = MeshJoin(Meshes=relay_7)
mesh_join_2 = MeshJoin(Meshes=relay_7)

# ----
# Support
# Forces
# Support
# Support
# Forces
# Forces
# Output
# Spring strength
# Spring strength
# Selfmade mesh
# Tutorial: https://www.youtube.com/watch?v=SW_xQx1x_5g
# Create 'beam'
# Selfmade mesh
curve_5 = Curve(<curve referenced from the Rhino model>)
boundary_2 = BoundarySurfaces(Edges=curve_5)
join_3 = BrepJoin(Breps=boundary_2)  # -> Breps, Closed
srf_2 = Surface(join_3.Breps)
toggle_2 = BooleanToggle(True)
debrep_2 = DeconstructBrep(Brep=srf_2)  # -> Faces, Edges, Vertices
item_14 = ListItem(List=debrep_2.Edges, Index=0, Wrap=True)  # -> Item, Item1, Item2, Item3
custom_mesh_settings_2 = SettingsCustom(
    StitchSeams=toggle_2,
    SimplePlanes=False,
    Refine=toggle_2,
    MinCount="1600",
    MaxCount="1600",
    AspectRatio=20,
    MaxDistance=0,
    MaxAngle=20,
    MinEdge="0",
    MaxEdge="0")
relay_8 = Relay([item_14.Item1, item_14.Item, item_14.Item2, item_14.Item3])
mesh_5 = MeshBrep(Brep=srf_2, Settings=custom_mesh_settings_2)
join_4 = JoinCurves(Curves=relay_8, Preserve=False)
mesh_6 = Mesh(mesh_5)
mesh_edges_2 = MeshEdges(Mesh=mesh_5)  # -> NakedEdges, InteriorEdges, NonManifoldEdges
deconstruct_mesh_2 = DeconstructMesh(Mesh=mesh_5)  # -> Vertices, Faces, Colours, Normals
curve_6 = Curve(mesh_edges_2.NakedEdges)
curve_7 = Curve(mesh_edges_2.InteriorEdges)
meshcorners_2 = MeshCorners(Mesh=mesh_6, Angle=2.35619449)
point_12 = Point(deconstruct_mesh_2.Vertices)
crv_cp_2 = CurveClosestPoint(Point=point_12, Curve=join_4)  # -> Point, Parameter, Distance
reposition_support_2 = Slider(0, range=0..10)
eval_2 = Evaluate(F="If(x<0.1, 1, 0)", x=crv_cp_2.Distance)
list_item_10 = ListItem(List=meshcorners_2, Index=0, Wrap=True)  # -> Item, Item1, Item2, Item3
cull_2 = CullPattern(List=point_12, CullPattern=eval_2)
point_13 = Point(list_item_10.Item)
point_14 = Point(list_item_10.Item1)
point_15 = Point(list_item_10.Item2)
point_16 = Point(list_item_10.Item3)
# ROUND CATENARY SUPPORT
force_4 = Slider(0.1, range=0..5)
strength_external_2 = Slider(100, range=5..100)
fixed_length_2 = Panel("0")
strength_internal_2 = Slider(6, range=5..50)
unit_z_18 = UnitZ(Factor=reposition_support_2)
unit_z_19 = UnitZ(Factor=force_4)
move_11 = Move(Geometry=point_13, Motion=unit_z_18)  # -> Geometry, Transform
move_12 = Move(Geometry=point_15, Motion=unit_z_18)  # -> Geometry, Transform
# BIG DOME
merge_3 = Merge(Data1=move_11.Geometry, Data2=point_14, Data3=move_12.Geometry, Data4=point_16)
length_line_3 = LengthLine(Line=curve_6, Length=fixed_length_2, Strength=strength_external_2)
load_4 = Load(Point=point_12, ForceVector=unit_z_19, Weighting=1)
length_line_4 = LengthLine(Line=curve_7, Length=fixed_length_2, Strength=strength_internal_2)
show_2 = Show(G=mesh_6)
reset_button_2 = Button()
activate_2 = BooleanToggle(True)

area = Area(Geometry=mesh_5)  # -> Area, Centroid
meshcorners_3 = MeshCorners(Mesh=mesh_5, Angle=2.35619449)
meshcorners_4 = MeshCorners(Mesh=mesh_6, Angle=2.35619449)

# ---- group: CatenaryRoundSupport
number_slider_8 = Slider(1.2, range=1.1..2.1)
curve_8 = Curve([<curve referenced from the Rhino model> x4])
len_7 = Length(Curve=curve_8)
division_7 = Division(A=number_slider_8, B=3.6)
multiplication_8 = Multiplication(A=len_7, B=number_slider_8)
end_points_3 = EndPoints(Curve=curve_8)  # -> Start, End
shift_list_2 = ShiftList(List=end_points_3.Start, Shift=-1, Wrap=True)
shift_list_3 = ShiftList(List=end_points_3.End, Shift=-1, Wrap=True)
curve_middle = CurveMiddle(Curve=curve_8)
shift_list_4 = ShiftList(List=curve_middle, Shift=-1, Wrap=True)
panel_7 = Panel("90")
vector_2pt = Vector2Pt(PointA=shift_list_4, PointB=meshcorners_3, Unitize=False)  # -> Vector, Length
list_item_11 = ListItem(List=meshcorners_3, Index=0, Wrap=True)
list_item_12 = ListItem(List=vector_2pt.Vector, Index=0, Wrap=True)  # -> Item, Item1, Item2, Item3
negative_15 = Negative(Value=list_item_12.Item3)
negative_16 = Negative(Value=list_item_12.Item1)
merge_4 = Merge(Data1=list_item_12.Item, Data2=negative_16, Data3=list_item_12.Item2, Data4=negative_15)
catenary_2 = Catenary(PointA=shift_list_2, PointB=shift_list_3, Length=multiplication_8, Gravity=merge_4)

# ----
# support curves
crv_7 = Curve(catenary_2)
join_5 = JoinCurves(Curves=crv_7, Preserve=False)
item_15 = ListItem(List=join_5, Index=0, Wrap=True)  # -> Item, Item1, Item2, Item3

# ---- group: supports
crv_cp_3 = CurveClosestPoint(Point=deconstruct_mesh_2.Vertices, Curve=flatten(item_15.Item3))  # -> Point, Parameter, Distance
crv_cp_4 = CurveClosestPoint(Point=deconstruct_mesh_2.Vertices, Curve=flatten(item_15.Item2))  # -> Point, Parameter, Distance
crv_cp_5 = CurveClosestPoint(Point=deconstruct_mesh_2.Vertices, Curve=flatten(item_15.Item1))  # -> Point, Parameter, Distance
crv_cp_6 = CurveClosestPoint(Point=deconstruct_mesh_2.Vertices, Curve=flatten(item_15.Item))  # -> Point, Parameter, Distance
eval_3 = Evaluate(F="If(x<0.1, 1, 0)", x=crv_cp_3.Distance)
eval_4 = Evaluate(F="If(x<0.1, 1, 0)", x=crv_cp_4.Distance)
eval_5 = Evaluate(F="If(x<0.1, 1, 0)", x=crv_cp_5.Distance)
eval_6 = Evaluate(F="If(x<0.1, 1, 0)", x=crv_cp_6.Distance)
cull_3 = CullPattern(List=deconstruct_mesh_2.Vertices, CullPattern=eval_3)
cull_4 = CullPattern(List=deconstruct_mesh_2.Vertices, CullPattern=eval_4)
cull_5 = CullPattern(List=deconstruct_mesh_2.Vertices, CullPattern=eval_5)
cull_6 = CullPattern(List=deconstruct_mesh_2.Vertices, CullPattern=eval_6)

# ----
merge_5 = Merge(Data1=cull_6, Data2=cull_5, Data3=cull_4, Data4=cull_3)
anchor_2 = Anchor(Point=merge_5, Target=merge_5, Strength=10000)
entwine_2 = Entwine(Branch00=show_2, Branch01=anchor_2, Branch02=length_line_3, Branch03=length_line_4, Branch04=load_4, FlattenInputs=True)
solver_2 = Solver(GoalObjects=flatten(entwine_2), Reset=reset_button_2, Threshold=1e-15, Tolerance=0.01, On=activate_2)  # -> I, V, O
list_item_13 = ListItem(List=solver_2.O, Index=0, Wrap=True)  # -> Item, Item1

list_item_14 = ListItem(List=catenary_2, Index=Slider(0, range=0..10), Wrap=True)
shatter = Shatter(Curve=list_item_14, Parameters=Slider(10, range=0..10))
divide_curve = DivideCurve(Curve=list_item_14, Count=Slider(9, range=0..10), Kinks=False)  # -> flatten(Points), Tangents, Parameters
mesh_7 = Mesh(list_item_13.Item)
mesh_area = MeshArea(Mesh=mesh_7)  # -> Area, Centroid
face_normals = FaceNormals(Mesh=mesh_7)  # -> Centers, Normals
panel_8 = Panel(mesh_area.Area)
closest_points = ClosestPoints(Point=divide_curve.Points, Cloud=face_normals.Centers, Count=Slider(48, range=0..100))  # -> flatten(ClosestPoint), CPIndex, Distance
list_item_15 = ListItem(List=closest_points.ClosestPoint, Index=Slider(55, range=0..100), Wrap=True)
list_item_16 = ListItem(List=closest_points.ClosestPoint, Index=Slider(58, range=0..100), Wrap=True)
line_2 = Line(StartPoint=list_item_16, EndPoint=list_item_15)
end_points_4 = EndPoints(Curve=line_2)  # -> Start, End
line_3 = Line(StartPoint=end_points_4.Start, EndPoint=end_points_4.End)
vector_2pt_2 = Vector2Pt(PointA=end_points_4.Start, PointB=end_points_4.End, Unitize=False)  # -> Vector, Length
amplitude = Amplitude(Vector=vector_2pt_2.Vector, Amplitude=".93/10")
# Closest Points Near Curve Support
reverse = Reverse(Vector=amplitude)
yz_plane = YZPlane(Origin=area.Centroid)
xz_plane = XZPlane(Origin=area.Centroid)
mirror = Mirror(Geometry=mesh_3, Plane=yz_plane)  # -> Geometry, Transform
move_13 = Move(Geometry=mesh_7, Motion=unit_z_8)  # -> Geometry, Transform
mirror_2 = Mirror(Geometry=[mesh_3, mirror.Geometry], Plane=xz_plane)  # -> Geometry, Transform
mesh_join_3 = MeshJoin(Meshes=[move_13.Geometry, mirror_2.Geometry, mirror.Geometry, mesh_3])

# ----
# Karamba
mesh_8 = Mesh(mesh_join_3)
meshtoshell = MeshToShellKaramba3D(Mesh=mesh_8, Identifier="shell", LimitDistance_m=0.005)  # -> Element, Points, Info
license = LicenseKaramba3D()
xy = XYPlane(Origin=Point(0, 0, 0))
matselect = MaterialSelectionKaramba3D(menu=[dropdown(1), dropdown(6)])
mc = MeshCorners(Mesh=mesh_8, Angle=Slider(3, range=0..10))
panel_9 = Panel(license)
supp = SupportKaramba3D(PosInd=mc, PlaneOfReference=xy, menu=[buttons(on, on, on, off, off, off)])
loads = LoadsKaramba3D(Vector=Vector(0, 0, -1), LCase="0", mode="Gravity")
cross_section = CrossSectionKaramba3D(
    FamilyNameOfCrossSection="DefaultCroSec",
    NameOfCrossSection="shell",
    Material=material_properties_karamba3d,
    Height_cm="50",
    mode="Shell - Const")
assemble = AssembleModelKaramba3D(
    Point=meshtoshell.Points,
    Elem=meshtoshell.Element,
    Support=supp,
    Load=loads,
    CrossSection=cross_section,
    Material=material_properties_karamba3d,
    LimitDistance_m=0.005)  # -> Model, Info, Mass_kg, CenterOfGravity
analyze = AnalyzeKaramba3D(Model=assemble.Model)  # -> CalculatedModel, MaximumDisplacement_cm, ResultingForceOfGravity_kN, ElasticEnergy_kNm
modelview = ModelViewKaramba3D(Model=analyze.CalculatedModel, LoadCaseFactorsForLinearSuperposition=1, IndexOfVisibleLoadcase=-1)  # -> Model, DeformedMesh, DeformedAxes, DeformedModel
shellview = ShellViewKaramba3D(Model=modelview.Model, IndexOfLayer=0)  # -> Model, MeshesOfRenderedShells, LegendColors, LegendTags
legend = Legend(Colour=shellview.LegendColors, Tags=shellview.LegendTags, LegendType=1)

# ---- group: Dome North
# Selfmade mesh
# Support
# Forces
# Output
# Spring strength
# Tutorial: https://www.youtube.com/watch?v=SW_xQx1x_5g
curve_9 = Curve(<curve referenced from the Rhino model>)
boundary_3 = BoundarySurfaces(Edges=curve_9)
join_6 = BrepJoin(Breps=boundary_3)  # -> Breps, Closed
srf_3 = Surface(join_6.Breps)
toggle_3 = BooleanToggle(True)
debrep_3 = DeconstructBrep(Brep=srf_3)  # -> Faces, Edges, Vertices
item_16 = ListItem(List=debrep_3.Edges, Index=0, Wrap=True)  # -> Item, Item1, Item2, Item3
custom_mesh_settings_3 = SettingsCustom(
    StitchSeams=toggle_3,
    SimplePlanes=False,
    Refine=toggle_3,
    MinCount="1600",
    MaxCount="1600",
    AspectRatio=20,
    MaxDistance=0,
    MaxAngle=20,
    MinEdge="0",
    MaxEdge="0")
relay_9 = Relay([item_16.Item1, item_16.Item, item_16.Item2, item_16.Item3])
join_7 = JoinCurves(Curves=relay_9, Preserve=False)
mesh_9 = MeshBrep(Brep=srf_3, Settings=custom_mesh_settings_3)
mesh_edges_3 = MeshEdges(Mesh=mesh_9)  # -> NakedEdges, InteriorEdges, NonManifoldEdges
deconstruct_mesh_3 = DeconstructMesh(Mesh=mesh_9)  # -> Vertices, Faces, Colours, Normals
# support curves
force_5 = Slider(0.6, range=0..5)
# Output
mesh_10 = Mesh(mesh_9)
meshcorners_5 = MeshCorners(Mesh=mesh_10, Angle=2.35619449)
curve_10 = Curve(mesh_edges_3.NakedEdges)
curve_11 = Curve(mesh_edges_3.InteriorEdges)
point_17 = Point(deconstruct_mesh_3.Vertices)
crv_cp_7 = CurveClosestPoint(Point=point_17, Curve=join_7)  # -> Point, Parameter, Distance
unit_z_20 = UnitZ(Factor=force_5)
reposition_support_3 = Slider(0, range=0..10)
eval_7 = Evaluate(F="If(x<0.1, 1, 0)", x=crv_cp_7.Distance)
list_item_17 = ListItem(List=meshcorners_5, Index=0, Wrap=True)  # -> Item, Item1, Item2, Item3
cull_7 = CullPattern(List=point_17, CullPattern=eval_7)
point_18 = Point(list_item_17.Item)
point_19 = Point(list_item_17.Item2)
point_20 = Point(list_item_17.Item3)
point_21 = Point(list_item_17.Item1)
strength_external_3 = Slider(100, range=5..100)
fixed_length_3 = Panel("0")
strength_internal_3 = Slider(31.6, range=5..50)
unit_z_21 = UnitZ(Factor=reposition_support_3)
move_14 = Move(Geometry=point_18, Motion=unit_z_21)  # -> Geometry, Transform
move_15 = Move(Geometry=point_19, Motion=unit_z_21)  # -> Geometry, Transform
# Corner Domes Holding Big dome
merge_6 = Merge(Data1=move_14.Geometry, Data2=point_21, Data3=move_15.Geometry, Data4=point_20)
merge_7 = Merge(Data1=meshcorners_5, Data2=cull_7)
length_line_5 = LengthLine(Line=curve_10, Length=fixed_length_3, Strength=strength_external_3)
load_5 = Load(Point=point_17, ForceVector=unit_z_20, Weighting=1)
length_line_6 = LengthLine(Line=curve_11, Length=fixed_length_3, Strength=strength_internal_3)
anchor_3 = Anchor(Point=merge_7, Target=merge_7, Strength=10000)
show_3 = Show(G=mesh_10)
reset_button_3 = Button()
activate_3 = BooleanToggle(True)

# ----
face_normals_2 = FaceNormals(Mesh=mesh_10)  # -> Centers, Normals
closest_points_2 = ClosestPoints(Point=divide_curve.Points, Cloud=flatten(deconstruct_mesh_3.Vertices), Count=Slider(50, range=0..50))  # -> ClosestPoint, CPIndex, Distance

load_6 = Load(Point=flatten(closest_points_2.ClosestPoint), ForceVector=reverse, Weighting=1)
panel_10 = Panel(load_6)

# ---- group: Dome North (continued)
entwine_3 = Entwine(
    Branch00=show_3,
    Branch01=anchor_3,
    Branch02=length_line_5,
    Branch03=length_line_6,
    Branch04=load_5,
    Branch05=flatten(load_6),
    FlattenInputs=True)
solver_3 = Solver(GoalObjects=flatten(entwine_3), Reset=reset_button_3, Threshold=1e-15, Tolerance=0.01, On=activate_3)  # -> I, V, O
list_item_18 = ListItem(List=solver_3.O, Index=0, Wrap=True)  # -> Item, Item1, Item2, Item3

# ----
mesh_11 = Mesh(list_item_18.Item)
face_normals_3 = FaceNormals(Mesh=mesh_11)  # -> Centers, Normals
closest_points_3 = ClosestPoints(Point=divide_curve.Points, Cloud=face_normals_3.Centers, Count=Slider(100, range=0..100))  # -> ClosestPoint, CPIndex, Distance
merge_8 = Merge(
    Data1=mesh_join,
    Data2=mesh_join_2,
    Data3=list_item_18.Item,
    Data4=list_item_18.Item1,
    Data5=relay_2,
    Data6=relay_3,
    Data7=list_item_2.Item,
    Data8=list_item_2.Item1,
    Data9=relay_4,
    Data10=relay_5,
    Data11=list_item_13.Item)  # -> flatten(Result)
mesh_join_4 = MeshJoin(Meshes=merge_8)  # -> flatten(Mesh)
