# Grasshopper definition 01_Form_finding_Karamba__start_.gh (Grasshopper 1.0.7)
# plug-ins: Karamba

# ----
# Starting surface
number_slider = Slider(10, range=0..10)
construct_point = ConstructPoint(XCoordinate=0, YCoordinate=0, ZCoordinate=0)
construct_point_2 = ConstructPoint(XCoordinate=number_slider, YCoordinate=number_slider, ZCoordinate=0)
rectangle_2pt = Rectangle2Pt(Plane=PlaneXY(0, 0, 0), PointA=construct_point, PointB=construct_point_2, Radius=0)  # -> Rectangle, Length
boundary_surfaces = BoundarySurfaces(Edges=rectangle_2pt.Rectangle)

number_slider_2 = Slider(5, range=0..100)

# ---- group: Controls resulutions
mesh_surface = MeshSurface(Surface=boundary_surfaces, UCount=number_slider_2, VCount=number_slider_2, Overhang=True, Equalize=False)

# ----
# Supports
md_slider = MDSlider(SliderMode=0, slider_value=Point(0, 0, 0.5), x_domain=Domain(0, 1), y_domain=Domain(0, 1), z_domain=Domain(0, 1))
md_slider_2 = MDSlider(SliderMode=0, slider_value=Point(1, 1, 0.5), x_domain=Domain(0, 1), y_domain=Domain(0, 1), z_domain=Domain(0, 1))
md_slider_3 = MDSlider(SliderMode=0, slider_value=Point(0, 1, 0.5), x_domain=Domain(0, 1), y_domain=Domain(0, 1), z_domain=Domain(0, 1))
md_slider_4 = MDSlider(SliderMode=0, slider_value=Point(1, 0, 0.5), x_domain=Domain(0, 1), y_domain=Domain(0, 1), z_domain=Domain(0, 1))
evaluate_surface = EvaluateSurface(Surface=reparameterize(boundary_surfaces), Point=md_slider)  # -> Point, Normal, UDirection, VDirection, Frame
evaluate_surface_2 = EvaluateSurface(Surface=reparameterize(boundary_surfaces), Point=md_slider_2)  # -> Point, Normal, UDirection, VDirection, Frame
evaluate_surface_3 = EvaluateSurface(Surface=reparameterize(boundary_surfaces), Point=md_slider_3)  # -> Point, Normal, UDirection, VDirection, Frame
evaluate_surface_4 = EvaluateSurface(Surface=reparameterize(boundary_surfaces), Point=md_slider_4)  # -> Point, Normal, UDirection, VDirection, Frame
support_karamba3d = SupportKaramba3D(PosInd=evaluate_surface.Point, menu=[buttons(on, on, on, on, on, on)])
support_karamba3d_2 = SupportKaramba3D(PosInd=evaluate_surface_2.Point, menu=[buttons(on, on, on, on, on, on)])
support_karamba3d_3 = SupportKaramba3D(PosInd=evaluate_surface_3.Point, menu=[buttons(on, on, on, on, on, on)])
support_karamba3d_4 = SupportKaramba3D(PosInd=evaluate_surface_4.Point, menu=[buttons(on, on, on, on, on, on)])

# ----
# Structure
mesh_to_shell_karamba3d = MeshToShellKaramba3D(Mesh=mesh_surface, LimitDistance_m=0.005)  # -> Element, Points, Info

# ----
# Point loads
md_slider_5 = MDSlider(
    SliderMode=0,
    slider_value=Point(0.678190494, 0.6476920523, 0.5),
    x_domain=Domain(0, 1),
    y_domain=Domain(0, 1),
    z_domain=Domain(0, 1))
md_slider_6 = MDSlider(
    SliderMode=0,
    slider_value=Point(0.4960528162, 0.02493472216, 0.5),
    x_domain=Domain(0, 1),
    y_domain=Domain(0, 1),
    z_domain=Domain(0, 1))
evaluate_surface_5 = EvaluateSurface(Surface=reparameterize(boundary_surfaces), Point=md_slider_6)  # -> Point, Normal, UDirection, VDirection, Frame
evaluate_surface_6 = EvaluateSurface(Surface=reparameterize(boundary_surfaces), Point=md_slider_5)  # -> Point, Normal, UDirection, VDirection, Frame
unit_z = UnitZ(Factor=Slider(0.6, range=0..10))
unit_z_2 = UnitZ(Factor=Slider(1.458, range=0..10))
closest_point = ClosestPoint(Point=evaluate_surface_5.Point, Cloud=mesh_to_shell_karamba3d.Points)  # -> ClosestPoint, CPIndex, Distance
closest_point_2 = ClosestPoint(Point=evaluate_surface_6.Point, Cloud=mesh_to_shell_karamba3d.Points)  # -> ClosestPoint, CPIndex, Distance
line_sdl = LineSDL(Start=closest_point.ClosestPoint, Direction=Vector(0, 0, 1), Length=Slider(5, range=0..10))
loads_karamba3d = LoadsKaramba3D(ForceVector=unit_z, Local=False, PosInd=closest_point.ClosestPoint, LCase=0, mode="Point")
# Tutorial:
# https://www.youtube.com/watch?v=E4Bkeh57B88&feature=youtu.be
line_sdl_2 = LineSDL(Start=closest_point_2.ClosestPoint, Direction=Vector(0, 0, 1), Length=Slider(3, range=0..10))
loads_karamba3d_2 = LoadsKaramba3D(ForceVector=unit_z_2, Local=False, PosInd=closest_point_2.ClosestPoint, LCase=0, mode="Point")

assemble_model_karamba3d = AssembleModelKaramba3D(
    Point=mesh_to_shell_karamba3d.Points,
    Elem=mesh_to_shell_karamba3d.Element,
    Support=[support_karamba3d, support_karamba3d_4, support_karamba3d_2, support_karamba3d_3],
    Load=[loads_karamba3d_2, loads_karamba3d],
    LimitDistance_m=0.005)  # -> Model, Info, Mass_kg, CenterOfGravity
# Issue with capacity of the trail version. Cannot increase the resolution of the structure greater than 5
analyze_karamba3d = AnalyzeKaramba3D(Model=assemble_model_karamba3d.Model)  # -> CalculatedModel, MaximumDisplacement_cm, ResultingForceOfGravity_kN, ElasticEnergy_kNm
model_view_karamba3d = ModelViewKaramba3D(Model=analyze_karamba3d.CalculatedModel, LoadCaseFactorsForLinearSuperposition=1, IndexOfVisibleLoadcase=-1)  # -> Model, DeformedMesh, DeformedAxes, DeformedModel
shell_view_karamba3d = ShellViewKaramba3D(Model=model_view_karamba3d.Model, IndexOfLayer=0)  # -> Model, MeshesOfRenderedShells, LegendColors, LegendTags
