# Grasshopper definition 02_Form_Finding_Base_Script.gh (Grasshopper 1.0.7)
# plug-ins: Karamba, Kangaroo2 Components

# ---- group: boundary_box_for_meshing
# all curves
crv = Curve([<curve referenced from the Rhino model> x5])
group = Group(Objects=crv)
bbox = BoundingBox(Content=group, Plane=PlaneXY(0, 0, 0))  # -> Box, Box_2
wires = BrepWireframe(Brep=bbox.Box_2, Density=-1)
boundary = BoundarySurfaces(Edges=wires)
join = BrepJoin(Breps=boundary)  # -> Breps, Closed
srf = Surface(join.Breps)

# ----
# all curves
crv_2 = Curve([<curve referenced from the Rhino model> x7])

# ---- group: boundary_box_for_meshing
group_2 = Group(Objects=crv_2)
bbox_2 = BoundingBox(Content=group_2, Plane=PlaneXY(0, 0, 0))  # -> Box, Box_2
wires_2 = BrepWireframe(Brep=bbox_2.Box_2, Density=-1)
boundary_2 = BoundarySurfaces(Edges=wires_2)
join_2 = BrepJoin(Breps=boundary_2)  # -> Breps, Closed
srf_2 = Surface(join_2.Breps)

# ----
toggle = BooleanToggle(True)
toggle_2 = BooleanToggle(True)
custom_mesh_settings = SettingsCustom(
    StitchSeams=toggle,
    SimplePlanes=False,
    Refine=toggle,
    MinCount="1600",
    MaxCount="1600",
    AspectRatio=20,
    MaxDistance=0,
    MaxAngle=20,
    MinEdge="0",
    MaxEdge="0")
custom_mesh_settings_2 = SettingsCustom(
    StitchSeams=toggle_2,
    SimplePlanes=False,
    Refine=toggle_2,
    MinCount="1600",
    MaxCount="1600",
    AspectRatio=20,
    MaxDistance=0,
    MaxAngle=20,
    MinEdge="0",
    MaxEdge="0")
# catenary curves
crv_3 = Curve()
# catenary curves
crv_4 = Curve()
# catenary curves
crv_5 = Curve([<curve referenced from the Rhino model> x2])
force = Slider(36.6, range=0.5..50)
force_2 = Slider(19.3, range=0.5..50)

# ---- group: mesh
mesh = MeshBrep(Brep=srf_2, Settings=custom_mesh_settings)
mesh_2 = Mesh(mesh)

mesh_3 = MeshBrep(Brep=srf, Settings=custom_mesh_settings_2)
mesh_4 = Mesh(mesh_3)

# ---- group: Hanging
negative = Negative(Value=force)

negative_2 = Negative(Value=force_2)

# ---- group: Standing
unit_z = UnitZ(Factor=force)

unit_z_2 = UnitZ(Factor=force_2)

# ----
# support curves
crv_6 = Curve([<curve referenced from the Rhino model> x5])
# support curves
crv_7 = Curve([<curve referenced from the Rhino model> x3])
deconstruct_mesh = DeconstructMesh(Mesh=mesh_3)  # -> Vertices, Faces, Colours, Normals

# ---- group: catenary curves
# catenary curves
crv_8 = Curve([<curve referenced from the Rhino model> x2])
number_slider = Slider(1.3, range=1.1..2.1)
len = Length(Curve=crv_8)
multiplication = Multiplication(A=len, B=number_slider)
end = EndPoints(Curve=crv_8)  # -> Start, End
cat = Catenary(PointA=end.Start, PointB=end.End, Length=multiplication, Gravity="0,0,1")
item = ListItem(List=cat, Index="0", Wrap=True)  # -> Item, Item1
item_2 = ListItem(List=crv_8, Index="0", Wrap=True)  # -> Item, Item1
crv_cp = CurveClosestPoint(Point=deconstruct_mesh.Vertices, Curve=item_2.Item)  # -> Point, Parameter, Distance
crv_cp_2 = CurveClosestPoint(Point=deconstruct_mesh.Vertices, Curve=item_2.Item1)  # -> Point, Parameter, Distance
larger_than = LargerThan(FirstNumber=crv_cp.Distance, SecondNumber="10")  # -> LargerThan, OrEqualTo
larger_than_2 = LargerThan(FirstNumber=crv_cp_2.Distance, SecondNumber="10")  # -> LargerThan, OrEqualTo
dispatch = Dispatch(List=crv_cp.Point, DispatchPattern=larger_than.LargerThan)  # -> ListA, ListB
dispatch_2 = Dispatch(List=crv_cp_2.Point, DispatchPattern=larger_than_2.LargerThan)  # -> ListA, ListB
panel = Panel("100")

# ----
division = Division(A=number_slider, B=3.6)
deconstruct_mesh_2 = DeconstructMesh(Mesh=mesh)  # -> Vertices, Faces, Colours, Normals

# ---- group: catenary curves
number_slider_2 = Slider(2.1, range=1.1..2.1)
len_2 = Length(Curve=crv_3)
multiplication_2 = Multiplication(A=len_2, B=number_slider_2)
end_2 = EndPoints(Curve=crv_3)  # -> Start, End
cat_2 = Catenary(PointA=end_2.Start, PointB=end_2.End, Length=multiplication_2, Gravity="0,0,1")
item_3 = ListItem(List=cat_2, Index="0", Wrap=True)  # -> Item, Item1
item_4 = ListItem(List=crv_3, Index="0", Wrap=True)  # -> Item, Item1
crv_cp_3 = CurveClosestPoint(Point=deconstruct_mesh_2.Vertices, Curve=item_4.Item1)  # -> Point, Parameter, Distance
crv_cp_4 = CurveClosestPoint(Point=deconstruct_mesh_2.Vertices, Curve=item_4.Item)  # -> Point, Parameter, Distance
larger_than_3 = LargerThan(FirstNumber=crv_cp_4.Distance, SecondNumber="10")  # -> LargerThan, OrEqualTo
larger_than_4 = LargerThan(FirstNumber=crv_cp_3.Distance, SecondNumber="10")  # -> LargerThan, OrEqualTo
dispatch_3 = Dispatch(List=crv_cp_4.Point, DispatchPattern=larger_than_3.LargerThan)  # -> ListA, ListB
dispatch_4 = Dispatch(List=crv_cp_3.Point, DispatchPattern=larger_than_4.LargerThan)  # -> ListA, ListB
panel_2 = Panel("100")

number_slider_3 = Slider(2.1, range=1.1..2.1)
len_3 = Length(Curve=crv_4)
multiplication_3 = Multiplication(A=len_3, B=number_slider_3)
end_3 = EndPoints(Curve=crv_4)  # -> Start, End
cat_3 = Catenary(PointA=end_3.Start, PointB=end_3.End, Length=multiplication_3, Gravity="0,0,1")
item_5 = ListItem(List=cat_3, Index="0", Wrap=True)  # -> Item, Item1
item_6 = ListItem(List=crv_4, Index="0", Wrap=True)  # -> Item, Item1
crv_cp_5 = CurveClosestPoint(Point=deconstruct_mesh_2.Vertices, Curve=item_6.Item1)  # -> Point, Parameter, Distance
crv_cp_6 = CurveClosestPoint(Point=deconstruct_mesh_2.Vertices, Curve=item_6.Item)  # -> Point, Parameter, Distance
larger_than_5 = LargerThan(FirstNumber=crv_cp_6.Distance, SecondNumber="10")  # -> LargerThan, OrEqualTo
larger_than_6 = LargerThan(FirstNumber=crv_cp_5.Distance, SecondNumber="10")  # -> LargerThan, OrEqualTo
dispatch_5 = Dispatch(List=crv_cp_6.Point, DispatchPattern=larger_than_5.LargerThan)  # -> ListA, ListB
dispatch_6 = Dispatch(List=crv_cp_5.Point, DispatchPattern=larger_than_6.LargerThan)  # -> ListA, ListB
panel_3 = Panel("100")

number_slider_4 = Slider(1.3, range=1.1..2.1)
len_4 = Length(Curve=crv_5)
multiplication_4 = Multiplication(A=len_4, B=number_slider_4)
end_4 = EndPoints(Curve=crv_5)  # -> Start, End
cat_4 = Catenary(PointA=end_4.Start, PointB=end_4.End, Length=multiplication_4, Gravity="0,0,1")
item_7 = ListItem(List=cat_4, Index="0", Wrap=True)  # -> Item, Item1
item_8 = ListItem(List=crv_5, Index="0", Wrap=True)  # -> Item, Item1
crv_cp_7 = CurveClosestPoint(Point=deconstruct_mesh_2.Vertices, Curve=item_8.Item1)  # -> Point, Parameter, Distance
crv_cp_8 = CurveClosestPoint(Point=deconstruct_mesh_2.Vertices, Curve=item_8.Item)  # -> Point, Parameter, Distance
larger_than_7 = LargerThan(FirstNumber=crv_cp_8.Distance, SecondNumber="10")  # -> LargerThan, OrEqualTo
larger_than_8 = LargerThan(FirstNumber=crv_cp_7.Distance, SecondNumber="10")  # -> LargerThan, OrEqualTo
dispatch_7 = Dispatch(List=crv_cp_8.Point, DispatchPattern=larger_than_7.LargerThan)  # -> ListA, ListB
dispatch_8 = Dispatch(List=crv_cp_7.Point, DispatchPattern=larger_than_8.LargerThan)  # -> ListA, ListB
panel_4 = Panel("100")

# ----
division_2 = Division(A=number_slider_2, B=3.6)
division_3 = Division(A=number_slider_3, B=3.6)
division_4 = Division(A=number_slider_4, B=3.6)
join_3 = JoinCurves(Curves=crv_6, Preserve=False)
join_4 = JoinCurves(Curves=crv_7, Preserve=False)
item_9 = ListItem(List=join_3, Index=0, Wrap=True)  # -> Item, Item1, Item2, Item3
item_10 = ListItem(List=join_4, Index=0, Wrap=True)  # -> Item, Item1, Item2, Item3
point = Point(deconstruct_mesh_2.Vertices)
point_2 = Point(deconstruct_mesh.Vertices)

# ---- group: supports
crv_cp_9 = CurveClosestPoint(Point=point, Curve=flatten(item_9.Item3))  # -> Point, Parameter, Distance
crv_cp_10 = CurveClosestPoint(Point=point, Curve=flatten(item_9.Item2))  # -> Point, Parameter, Distance
crv_cp_11 = CurveClosestPoint(Point=point, Curve=flatten(item_9.Item1))  # -> Point, Parameter, Distance
crv_cp_12 = CurveClosestPoint(Point=point, Curve=flatten(item_9.Item))  # -> Point, Parameter, Distance
eval = Evaluate(F="If(x<0.1, 1, 0)", x=crv_cp_9.Distance)
eval_2 = Evaluate(F="If(x<0.1, 1, 0)", x=crv_cp_10.Distance)
eval_3 = Evaluate(F="If(x<0.1, 1, 0)", x=crv_cp_11.Distance)
eval_4 = Evaluate(F="If(x<0.1, 1, 0)", x=crv_cp_12.Distance)
cull = CullPattern(List=point, CullPattern=eval)
cull_2 = CullPattern(List=point, CullPattern=eval_2)
cull_3 = CullPattern(List=point, CullPattern=eval_3)
cull_4 = CullPattern(List=point, CullPattern=eval_4)

crv_cp_13 = CurveClosestPoint(Point=point_2, Curve=flatten(item_10.Item3))  # -> Point, Parameter, Distance
crv_cp_14 = CurveClosestPoint(Point=point_2, Curve=flatten(item_10.Item2))  # -> Point, Parameter, Distance
crv_cp_15 = CurveClosestPoint(Point=point_2, Curve=flatten(item_10.Item1))  # -> Point, Parameter, Distance
crv_cp_16 = CurveClosestPoint(Point=point_2, Curve=flatten(item_10.Item))  # -> Point, Parameter, Distance
eval_5 = Evaluate(F="If(x<0.1, 1, 0)", x=crv_cp_13.Distance)
eval_6 = Evaluate(F="If(x<0.1, 1, 0)", x=crv_cp_14.Distance)
eval_7 = Evaluate(F="If(x<0.1, 1, 0)", x=crv_cp_15.Distance)
eval_8 = Evaluate(F="If(x<0.1, 1, 0)", x=crv_cp_16.Distance)
cull_5 = CullPattern(List=point_2, CullPattern=eval_5)
cull_6 = CullPattern(List=point_2, CullPattern=eval_6)
cull_7 = CullPattern(List=point_2, CullPattern=eval_7)
cull_8 = CullPattern(List=point_2, CullPattern=eval_8)

# ----
mesh_edges = MeshEdges(Mesh=mesh)  # -> NakedEdges, InteriorEdges, NonManifoldEdges
mesh_edges_2 = MeshEdges(Mesh=mesh_3)  # -> NakedEdges, InteriorEdges, NonManifoldEdges

# ----
# Spring strength
strength_external = Slider(30, range=5..40)
fixed_length = Panel("0")
strength_internal = Slider(10.6, range=5..20)

# ----
# Spring strength
strength_external_2 = Slider(30, range=5..40)
fixed_length_2 = Panel("0")
strength_internal_2 = Slider(10.6, range=5..20)

curve = Curve(mesh_edges.NakedEdges)
curve_2 = Curve(mesh_edges.InteriorEdges)
curve_3 = Curve(mesh_edges_2.NakedEdges)
curve_4 = Curve(mesh_edges_2.InteriorEdges)
merge = Merge(Data2=cull_4, Data3=cull_3, Data4=cull_2, Data5=cull)
merge_2 = Merge(Data2=cull_8, Data3=cull_7, Data4=cull_6, Data5=cull_5)

# ----
# Forces
load = Load(Point=point, ForceVector=unit_z, Weighting=1)
oncurve = OnCurve(Points=dispatch_3.ListB, Curve=item_3.Item, Strength=panel_2)
oncurve_2 = OnCurve(Points=dispatch_4.ListB, Curve=item_3.Item1, Strength=panel_2)
length_line = LengthLine(Line=curve, Length=fixed_length, Strength=strength_external)
anchor = Anchor(Point=merge, Target=merge, Strength=10000)
length_line_2 = LengthLine(Line=curve_2, Length=fixed_length, Strength=strength_internal)
show = Show(G=mesh_2)
oncurve_3 = OnCurve(Points=dispatch_7.ListB, Curve=item_7.Item, Strength=panel_4)
oncurve_4 = OnCurve(Points=dispatch_8.ListB, Curve=item_7.Item1, Strength=panel_4)

oncurve_5 = OnCurve(Points=dispatch_5.ListB, Curve=item_5.Item, Strength=panel_3)
oncurve_6 = OnCurve(Points=dispatch_6.ListB, Curve=item_5.Item1, Strength=panel_3)

# ----
# Forces
load_2 = Load(Point=point_2, ForceVector=unit_z_2, Weighting=1)
length_line_3 = LengthLine(Line=curve_3, Length=fixed_length_2, Strength=strength_external_2)
anchor_2 = Anchor(Point=merge_2, Target=merge_2, Strength=10000)
length_line_4 = LengthLine(Line=curve_4, Length=fixed_length_2, Strength=strength_internal_2)
oncurve_7 = OnCurve(Points=dispatch.ListB, Curve=item.Item, Strength=panel)
oncurve_8 = OnCurve(Points=dispatch_2.ListB, Curve=item.Item1, Strength=panel)

show_2 = Show(G=mesh_4)
reset_button = Button()
# Tutorial: https://www.youtube.com/watch?v=SW_xQx1x_5g
activate = BooleanToggle(False)
reset_button_2 = Button()
# Tutorial: https://www.youtube.com/watch?v=SW_xQx1x_5g
activate_2 = BooleanToggle(True)
entwine = Entwine(
    Branch00=show,
    Branch01=anchor,
    Branch02=length_line,
    Branch03=length_line_2,
    Branch04=load,
    Branch05=oncurve_3,
    Branch06=oncurve_4,
    FlattenInputs=True)
entwine_2 = Entwine(
    Branch00=show_2,
    Branch01=anchor_2,
    Branch02=length_line_3,
    Branch03=length_line_4,
    Branch04=load_2,
    Branch05=oncurve_7,
    Branch06=oncurve_8,
    FlattenInputs=True)
solver = Solver(GoalObjects=flatten(entwine), Reset=reset_button, Threshold=1e-15, Tolerance=0.01, On=activate)  # -> I, V, O
solver_2 = Solver(GoalObjects=flatten(entwine_2), Reset=reset_button_2, Threshold=1e-15, Tolerance=0.01, On=activate_2)  # -> I, V, O
# Output
list_item = ListItem(List=solver.O, Index=0, Wrap=True)
# Output
list_item_2 = ListItem(List=solver_2.O, Index=0, Wrap=True)
mesh_5 = Mesh(list_item)
meshtoshell = MeshToShellKaramba3D(Mesh=mesh_5, Identifier="shell", LimitDistance_m=0.005)  # -> Element, Points, Info
license = LicenseKaramba3D()
xy = XYPlane(Origin=Point(0, 0, 0))
mc = MeshCorners(Mesh=mesh_5, Angle=2.35619449)
matselect = MaterialSelectionKaramba3D(menu=[dropdown(3), dropdown(6)])
panel_5 = Panel(license)
cross_section = CrossSectionKaramba3D(
    FamilyNameOfCrossSection="DefaultCroSec",
    NameOfCrossSection="shell",
    Material=matselect,
    Height_cm="10",
    mode="Shell - Const")
supp = SupportKaramba3D(PosInd=mc, PlaneOfReference=xy, menu=[buttons(on, on, on, off, off, off)])
loads = LoadsKaramba3D(Vector=Vector(0, 0, -1), LCase="0", mode="Gravity")
assemble = AssembleModelKaramba3D(
    Point=meshtoshell.Points,
    Elem=meshtoshell.Element,
    Support=supp,
    Load=loads,
    CrossSection=cross_section,
    Material=matselect,
    LimitDistance_m=0.005)  # -> Model, Info, Mass_kg, CenterOfGravity
analyze = AnalyzeKaramba3D(Model=assemble.Model)  # -> CalculatedModel, MaximumDisplacement_cm, ResultingForceOfGravity_kN, ElasticEnergy_kNm
modelview = ModelViewKaramba3D(Model=analyze.CalculatedModel, LoadCaseFactorsForLinearSuperposition=1, IndexOfVisibleLoadcase=-1)  # -> Model, DeformedMesh, DeformedAxes, DeformedModel
shellview = ShellViewKaramba3D(Model=modelview.Model, IndexOfLayer=0)  # -> Model, MeshesOfRenderedShells, LegendColors, LegendTags
legend = Legend(Colour=shellview.LegendColors, Tags=shellview.LegendTags, LegendType=1)
