# Grasshopper definition Optimalisation_algorithm_Big_Oculus_Dome_Dome_vaults_02v5.gh (Grasshopper 1.0.7)
# plug-ins: Karamba, Pufferfish, Weaverbird, Kangaroo2 Components, Opossum2_0_Proto_A

imput_shopsize = Panel("s")
imput_shop_hallway = Panel("shop")

data = Data(imput_shopsize)
data_2 = Data(imput_shop_hallway)

# ----
# 2D Tesselation generation
panel = Panel("8.4")
imput_shopsize_2 = Panel("s")  # disabled
imput_shop_hallway_2 = Panel("shop")  # disabled

# ----
# Rectengular grid
# Feature point at support
ghpython_script = GhPythonScript(shop_size=data)  # -> width_of_shop
# ---------- ghpython_script: Python ----------
__author__ = "kees_"
__version__ = "2019.10.09"

sizes = {'s':2.4, 'm':4.80, 'l':9.60}
width_of_shop = sizes.get(shop_size)
# ---------- end ghpython_script ----------
ghpython_script_2 = GhPythonScript(width=data_2)  # -> width_of_shop
# ---------- ghpython_script_2: Python ----------
__author__ = "kees_"
__version__ = "2019.10.09"

sizes = {'hallway':2.4, 'shop':3.6}
width_of_shop = sizes.get(width)
# ---------- end ghpython_script_2 ----------
rectangle = Rectangle(Plane=PlaneXY(0, 0, 0), XSize=panel, YSize="8.4", Radius=0)  # -> Rectangle, Length
relay = Relay([panel, "8.4"])
explode = Explode(Curve=rectangle.Rectangle, Recursive=True)  # -> Segments, Vertices
data_3 = Data(rectangle.Rectangle)
data_4 = Data(rectangle.Rectangle)
box_corners = BoxCorners(Box=rectangle.Rectangle)  # -> CornerA, CornerB, CornerC, CornerD, CornerE, CornerF, CornerG, CornerH
area = Area(Geometry=rectangle.Rectangle)  # -> Area, Centroid
curve_middle = CurveMiddle(Curve=explode.Segments)  # -> graft(Midpoint)
merge = Merge(Data1=box_corners.CornerA, Data2=box_corners.CornerB, Data3=box_corners.CornerC, Data4=box_corners.CornerD)  # -> graft(Result)
# 2D Tesselation generation
# Feature point at support
equality = Equality(FirstNumber=relay, SecondNumber=2.4)  # -> Equality, Inequality
explode_tree = ExplodeTree(Data=graft(equality.Equality))  # -> Branch0, Branch1
point = Point(merge)
# Rectengular grid
gate_or = GateOr(A=explode_tree.Branch0, B=explode_tree.Branch1)
replace_members = ReplaceMembers(Set=gate_or, Find=[True, False], Replace=[5, 6])
explode_tree_2 = ExplodeTree(Data=curve_middle)  # -> Branch0, Branch1, Branch2, Branch3
line_count = Slider(20, range=0..20)
line = Line(StartPoint=explode_tree_2.Branch0, EndPoint=box_corners.CornerA)  # -> flatten(Line)
line_2 = Line(StartPoint=explode_tree_2.Branch3, EndPoint=box_corners.CornerA)  # -> flatten(Line)
line_3 = Line(StartPoint=box_corners.CornerA, EndPoint=area.Centroid)  # -> flatten(Line)
line_4 = Line(StartPoint=explode_tree_2.Branch0, EndPoint=box_corners.CornerB)  # -> flatten(Line)
line_5 = Line(StartPoint=explode_tree_2.Branch1, EndPoint=box_corners.CornerB)  # -> flatten(Line)
line_6 = Line(StartPoint=box_corners.CornerB, EndPoint=area.Centroid)  # -> flatten(Line)
line_7 = Line(StartPoint=explode_tree_2.Branch1, EndPoint=box_corners.CornerC)  # -> flatten(Line)
line_8 = Line(StartPoint=box_corners.CornerC, EndPoint=explode_tree_2.Branch2)  # -> flatten(Line)
line_9 = Line(StartPoint=box_corners.CornerC, EndPoint=area.Centroid)  # -> flatten(Line)
line_10 = Line(StartPoint=explode_tree_2.Branch2, EndPoint=box_corners.CornerD)  # -> flatten(Line)
line_11 = Line(StartPoint=box_corners.CornerD, EndPoint=explode_tree_2.Branch3)  # -> flatten(Line)
line_12 = Line(StartPoint=box_corners.CornerD, EndPoint=area.Centroid)  # -> flatten(Line)
divide_curve = DivideCurve(Curve=[line, line_2, line_3], Count=line_count, Kinks=False)  # -> Points, Tangents, Parameters
divide_curve_2 = DivideCurve(Curve=[line_4, line_5, line_6], Count=line_count, Kinks=False)  # -> Points, Tangents, Parameters
divide_curve_3 = DivideCurve(Curve=[line_7, line_8, line_9], Count=line_count, Kinks=False)  # -> Points, Tangents, Parameters
divide_curve_4 = DivideCurve(Curve=[line_10, line_11, line_12], Count=line_count, Kinks=False)  # -> Points, Tangents, Parameters
explode_tree_3 = ExplodeTree(Data=divide_curve.Points)  # -> Branch0, Branch1, Branch2
explode_tree_4 = ExplodeTree(Data=divide_curve_2.Points)  # -> Branch0, Branch1, Branch2
explode_tree_5 = ExplodeTree(Data=divide_curve_3.Points)  # -> Branch0, Branch1, Branch2
explode_tree_6 = ExplodeTree(Data=divide_curve_4.Points)  # -> Branch0, Branch1, Branch2
line_13 = Line(StartPoint=explode_tree_3.Branch0, EndPoint=reverse(explode_tree_3.Branch2))  # -> flatten(Line)
line_14 = Line(StartPoint=explode_tree_3.Branch1, EndPoint=reverse(explode_tree_3.Branch2))  # -> flatten(Line)
line_15 = Line(StartPoint=explode_tree_4.Branch0, EndPoint=reverse(explode_tree_4.Branch2))  # -> flatten(Line)
line_16 = Line(StartPoint=explode_tree_4.Branch1, EndPoint=reverse(explode_tree_4.Branch2))  # -> flatten(Line)
line_17 = Line(StartPoint=explode_tree_5.Branch0, EndPoint=reverse(explode_tree_5.Branch2))  # -> flatten(Line)
line_18 = Line(StartPoint=explode_tree_6.Branch0, EndPoint=reverse(explode_tree_6.Branch2))  # -> flatten(Line)
line_19 = Line(StartPoint=explode_tree_5.Branch1, EndPoint=explode_tree_5.Branch2)  # -> flatten(Line)
line_20 = Line(StartPoint=explode_tree_6.Branch1, EndPoint=explode_tree_6.Branch2)  # -> flatten(Line)
point_2 = Point(explode_tree_3.Branch0)
point_3 = Point(explode_tree_3.Branch1)
point_4 = Point(explode_tree_4.Branch0)
point_5 = Point(explode_tree_4.Branch1)
point_6 = Point(explode_tree_5.Branch1)
point_7 = Point(explode_tree_5.Branch0)
point_8 = Point(explode_tree_6.Branch0)
point_9 = Point(explode_tree_6.Branch1)
# 11/22/2019
line_21 = Line([line_20, line_18, line_13, line_14, line_15, line_16, line_17, line_19])

curve = Curve(<curve referenced from the Rhino model>)
data_5 = Data(imput_shopsize_2)  # disabled
data_6 = Data(imput_shop_hallway_2)  # disabled
ghpython_script_3 = GhPythonScript(shop_size=data_5)  # -> width_of_shop; disabled; same code as ghpython_script
ghpython_script_4 = GhPythonScript(width=data_6)  # -> width_of_shop; disabled; same code as ghpython_script_2
relay_2 = Relay([ghpython_script_4, ghpython_script_3])  # disabled
rectangle_2 = Rectangle(Plane=PlaneXY(0, 0, 0), XSize=ghpython_script_3, YSize=ghpython_script_4, Radius=0)  # -> Rectangle, Length; disabled
curve_2 = Curve(<curve referenced from the Rhino model>)  # disabled

line_22 = Line(StartPoint=curve_middle, EndPoint=area.Centroid)  # -> flatten(Line)
flip_matrix = FlipMatrix(Data=line_22)
explode_tree_7 = ExplodeTree(Data=flip_matrix)  # -> Branch0, Branch1, Branch2, Branch3
explode_tree_8 = ExplodeTree(Data=merge)  # -> Branch0, Branch1, Branch2, Branch3
divide_curve_5 = DivideCurve(Curve=explode_tree_7.Branch0, Count=replace_members, Kinks=False)  # -> Points, Tangents, Parameters
divide_curve_6 = DivideCurve(Curve=explode_tree_7.Branch1, Count=replace_members, Kinks=False)  # -> Points, Tangents, Parameters
divide_curve_7 = DivideCurve(Curve=explode_tree_7.Branch2, Count=replace_members, Kinks=False)  # -> Points, Tangents, Parameters
divide_curve_8 = DivideCurve(Curve=explode_tree_7.Branch3, Count=replace_members, Kinks=False)  # -> Points, Tangents, Parameters
merge_2 = Merge(Data1=divide_curve_5.Points, Data2=divide_curve_8.Points)  # -> flatten(Result)
merge_3 = Merge(Data1=divide_curve_5.Points, Data2=divide_curve_6.Points)  # -> flatten(Result)
merge_4 = Merge(Data1=divide_curve_7.Points, Data2=divide_curve_6.Points)  # -> flatten(Result)
# 11/22/2019
# Kangeroo form finding
# Definition of springs / mesh
# Definition of 1 way constrains
# Use if required by 2d topology
merge_5 = Merge(Data1=divide_curve_7.Points, Data2=divide_curve_8.Points)  # -> flatten(Result)
line_23 = Line(StartPoint=explode_tree_8.Branch0, EndPoint=merge_2)
line_24 = Line(StartPoint=explode_tree_8.Branch1, EndPoint=merge_3)
line_25 = Line(StartPoint=explode_tree_8.Branch2, EndPoint=merge_4)
line_26 = Line(StartPoint=explode_tree_8.Branch3, EndPoint=merge_5)

explode_2 = Explode(Curve=rectangle_2.Rectangle, Recursive=True)  # -> Segments, Vertices; disabled
box_corners_2 = BoxCorners(Box=rectangle_2.Rectangle)  # -> CornerA, CornerB, CornerC, CornerD, CornerE, CornerF, CornerG, CornerH; disabled
data_7 = Data(rectangle_2.Rectangle)  # disabled
data_8 = Data(ghpython_script_3)  # disabled
area_2 = Area(Geometry=rectangle_2.Rectangle)  # -> Area, Centroid; disabled
curve_middle_2 = CurveMiddle(Curve=explode_2.Segments)  # -> graft(Midpoint); disabled
merge_6 = Merge(Data1=box_corners_2.CornerA, Data2=box_corners_2.CornerB, Data3=box_corners_2.CornerC, Data4=box_corners_2.CornerD)  # -> graft(Result); disabled
equality_2 = Equality(FirstNumber=relay_2, SecondNumber=2.4)  # -> Equality, Inequality; disabled
line_27 = Line(StartPoint=curve_middle_2, EndPoint=area_2.Centroid)  # -> flatten(Line); disabled
explode_tree_9 = ExplodeTree(Data=graft(equality_2.Equality))  # -> Branch0, Branch1; disabled
point_10 = Point(merge_6)  # disabled
flip_matrix_2 = FlipMatrix(Data=line_27)  # disabled
gate_or_2 = GateOr(A=explode_tree_9.Branch0, B=explode_tree_9.Branch1)  # disabled
replace_members_2 = ReplaceMembers(Set=gate_or_2, Find=[True, False], Replace=[5, 6])  # disabled
explode_tree_10 = ExplodeTree(Data=flip_matrix_2)  # -> Branch0, Branch1, Branch2, Branch3; disabled
explode_tree_11 = ExplodeTree(Data=merge_6)  # -> Branch0, Branch1, Branch2, Branch3; disabled
explode_tree_12 = ExplodeTree(Data=curve_middle_2)  # -> Branch0, Branch1, Branch2, Branch3; disabled
line_count_2 = Slider(20, range=0..20)  # disabled
line_28 = Line(StartPoint=explode_tree_12.Branch0, EndPoint=box_corners_2.CornerA)  # -> flatten(Line); disabled
line_29 = Line(StartPoint=explode_tree_12.Branch3, EndPoint=box_corners_2.CornerA)  # -> flatten(Line); disabled
line_30 = Line(StartPoint=box_corners_2.CornerA, EndPoint=area_2.Centroid)  # -> flatten(Line); disabled
line_31 = Line(StartPoint=explode_tree_12.Branch0, EndPoint=box_corners_2.CornerB)  # -> flatten(Line); disabled
line_32 = Line(StartPoint=explode_tree_12.Branch1, EndPoint=box_corners_2.CornerB)  # -> flatten(Line); disabled
line_33 = Line(StartPoint=box_corners_2.CornerB, EndPoint=area_2.Centroid)  # -> flatten(Line); disabled
line_34 = Line(StartPoint=explode_tree_12.Branch1, EndPoint=box_corners_2.CornerC)  # -> flatten(Line); disabled
line_35 = Line(StartPoint=box_corners_2.CornerC, EndPoint=explode_tree_12.Branch2)  # -> flatten(Line); disabled
line_36 = Line(StartPoint=box_corners_2.CornerC, EndPoint=area_2.Centroid)  # -> flatten(Line); disabled
line_37 = Line(StartPoint=explode_tree_12.Branch2, EndPoint=box_corners_2.CornerD)  # -> flatten(Line); disabled
line_38 = Line(StartPoint=box_corners_2.CornerD, EndPoint=explode_tree_12.Branch3)  # -> flatten(Line); disabled
line_39 = Line(StartPoint=box_corners_2.CornerD, EndPoint=area_2.Centroid)  # -> flatten(Line); disabled
divide_curve_9 = DivideCurve(Curve=explode_tree_10.Branch0, Count=replace_members_2, Kinks=False)  # -> Points, Tangents, Parameters; disabled
divide_curve_10 = DivideCurve(Curve=explode_tree_10.Branch1, Count=replace_members_2, Kinks=False)  # -> Points, Tangents, Parameters; disabled
divide_curve_11 = DivideCurve(Curve=explode_tree_10.Branch2, Count=replace_members_2, Kinks=False)  # -> Points, Tangents, Parameters; disabled
divide_curve_12 = DivideCurve(Curve=explode_tree_10.Branch3, Count=replace_members_2, Kinks=False)  # -> Points, Tangents, Parameters; disabled
merge_7 = Merge(Data1=divide_curve_9.Points, Data2=divide_curve_12.Points)  # -> flatten(Result); disabled
merge_8 = Merge(Data1=divide_curve_9.Points, Data2=divide_curve_10.Points)  # -> flatten(Result); disabled
merge_9 = Merge(Data1=divide_curve_11.Points, Data2=divide_curve_10.Points)  # -> flatten(Result); disabled
merge_10 = Merge(Data1=divide_curve_11.Points, Data2=divide_curve_12.Points)  # -> flatten(Result); disabled
divide_curve_13 = DivideCurve(Curve=[line_28, line_29, line_30], Count=line_count_2, Kinks=False)  # -> Points, Tangents, Parameters; disabled
divide_curve_14 = DivideCurve(Curve=[line_31, line_32, line_33], Count=line_count_2, Kinks=False)  # -> Points, Tangents, Parameters; disabled
divide_curve_15 = DivideCurve(Curve=[line_34, line_35, line_36], Count=line_count_2, Kinks=False)  # -> Points, Tangents, Parameters; disabled
divide_curve_16 = DivideCurve(Curve=[line_37, line_38, line_39], Count=line_count_2, Kinks=False)  # -> Points, Tangents, Parameters; disabled

connection_point_support = Relay([line_23, line_24, line_25, line_26])
connection_vault_x = Relay([point_2, point_4, point_6, point_8])
connection_vault_y = Relay([point_3, point_5, point_7, point_9])
point_11 = Point(connection_vault_x)
point_12 = Point(connection_vault_y)
# Definition of support
line_40 = Line(connection_point_support)
point_13 = Point(point)
line_41 = Line(line_21)

explode_tree_13 = ExplodeTree(Data=divide_curve_13.Points)  # -> Branch0, Branch1, Branch2; disabled
explode_tree_14 = ExplodeTree(Data=divide_curve_14.Points)  # -> Branch0, Branch1, Branch2; disabled
explode_tree_15 = ExplodeTree(Data=divide_curve_15.Points)  # -> Branch0, Branch1, Branch2; disabled
explode_tree_16 = ExplodeTree(Data=divide_curve_16.Points)  # -> Branch0, Branch1, Branch2; disabled
line_42 = Line(StartPoint=explode_tree_13.Branch0, EndPoint=reverse(explode_tree_13.Branch2))  # -> flatten(Line); disabled
line_43 = Line(StartPoint=explode_tree_13.Branch1, EndPoint=reverse(explode_tree_13.Branch2))  # -> flatten(Line); disabled
line_44 = Line(StartPoint=explode_tree_14.Branch0, EndPoint=reverse(explode_tree_14.Branch2))  # -> flatten(Line); disabled
line_45 = Line(StartPoint=explode_tree_14.Branch1, EndPoint=reverse(explode_tree_14.Branch2))  # -> flatten(Line); disabled
line_46 = Line(StartPoint=explode_tree_15.Branch0, EndPoint=reverse(explode_tree_15.Branch2))  # -> flatten(Line); disabled
line_47 = Line(StartPoint=explode_tree_16.Branch0, EndPoint=reverse(explode_tree_16.Branch2))  # -> flatten(Line); disabled
line_48 = Line(StartPoint=explode_tree_11.Branch0, EndPoint=merge_7)  # disabled
line_49 = Line(StartPoint=explode_tree_11.Branch1, EndPoint=merge_8)  # disabled
line_50 = Line(StartPoint=explode_tree_11.Branch2, EndPoint=merge_9)  # disabled
line_51 = Line(StartPoint=explode_tree_11.Branch3, EndPoint=merge_10)  # disabled
line_52 = Line(StartPoint=explode_tree_15.Branch1, EndPoint=explode_tree_15.Branch2)  # -> flatten(Line); disabled
line_53 = Line(StartPoint=explode_tree_16.Branch1, EndPoint=explode_tree_16.Branch2)  # -> flatten(Line); disabled
point_14 = Point(explode_tree_13.Branch1)  # disabled
point_15 = Point(explode_tree_14.Branch0)  # disabled
point_16 = Point(explode_tree_15.Branch1)  # disabled
point_17 = Point(explode_tree_16.Branch0)  # disabled
point_18 = Point(explode_tree_16.Branch1)  # disabled
point_19 = Point(explode_tree_13.Branch0)  # disabled
point_20 = Point(explode_tree_14.Branch1)  # disabled
point_21 = Point(explode_tree_15.Branch0)  # disabled

data_9 = Data([line_40, line_41])
data_10 = Data(point_11)
data_11 = Data(point_12)
# Kangeroo form finding
data_12 = Data(point_13)

line_54 = Line([line_53, line_47, line_42, line_43, line_44, line_45, line_46, line_52])  # disabled
connection_point_support_2 = Relay([line_48, line_49, line_50, line_51])  # disabled
connection_vault_x_2 = Relay([point_19, point_15, point_16, point_17])  # disabled
connection_vault_y_2 = Relay([point_14, point_20, point_21, point_18])  # disabled
point_22 = Point(connection_vault_x_2)  # disabled
line_55 = Line(connection_point_support_2)  # disabled
point_23 = Point(point_10)  # disabled
line_56 = Line(line_54)  # disabled
point_24 = Point(connection_vault_y_2)  # disabled
crv = Curve([<curve referenced from the Rhino model> x824])
data_13 = Data([line_55, line_56])  # disabled
data_14 = Data(point_23)  # disabled
data_15 = Data(point_22)  # disabled
data_16 = Data(point_24)  # disabled
gene_pool = GenePool(Decimals=0, Maximum=50, Minimum=1, Value=3)
weaverbird_s_mesh_from_lines_weave_back = WeaverbirdsMeshFromLinesWeaveBack(Lines=crv, MaximumValence=7)
line_line_intersection_karamba3d = LineLineIntersectionKaramba3D(Line=flatten(data_13), LengthTolerance=0.01)  # -> IntersectionPoints, flatten(LineSubSegements); disabled
division = Division(A=4, B=gene_pool)
mc = MeshCorners(Mesh=weaverbird_s_mesh_from_lines_weave_back, Angle="2")
remove_duplicate_lines_karamba3d = RemoveDuplicateLinesKaramba3D(Line=line_line_intersection_karamba3d.LineSubSegements, LimitDistance=0.005)  # -> OutLine, Info, Indexes; disabled
weaverbird_s_mesh_from_lines_weave_back_2 = WeaverbirdsMeshFromLinesWeaveBack(Lines=remove_duplicate_lines_karamba3d.OutLine, MaximumValence=4)  # disabled
anchorxyz = AnchorXYZ(Point=flatten(data_15), X=False, Y=True, Z=False, Strength=1000)  # disabled
anchorxyz_2 = AnchorXYZ(Point=flatten(data_16), X=True, Y=False, Z=False, Strength=1000)  # disabled
anchor = Anchor(Point=data_14, Strength=100000)  # disabled
vertexloads = VertexLoads(Mesh=weaverbird_s_mesh_from_lines_weave_back_2, Strength=0.1)  # disabled
point_25 = Point(data_14)  # disabled
data_17 = Data(point_25)  # disabled
xy_plane = XYPlane(Origin=Point(0, 0, 0))  # disabled

young_modulus_n_mm2 = Panel("211")
poisson_ratio = Panel("0.3")
specific_weight_kg_m3 = Panel("1452")
compressive_strenght_n_mm2 = Panel("3")
material_adobe = Panel("adobe sucrum test")

point_26 = Point(data_17)  # disabled
data_18 = Data(data_17)  # disabled
maximal_shell_thickness_cm = Slider(200, range=0..200)  # disabled
height_of_bricks_cm = Slider(9, range=0..10)  # disabled
shell_cross_section_name = Panel("Shell Cross section")  # disabled
# Young Modulus research paper: https://dspace.cvut.cz/bitstream/handle/10467/69500/F1-BP-2017-Gubasheva-Samal-priloha-ADOBE%20AS%20A%20BUILDING%20MATERIAL.%20pdf.pdf?sequence=3&isAllowed=y
distributed_vertical_load_kn_m2 = Panel("2.25")  # disabled
young_modulus_n_mm2_2 = Panel("211")  # disabled
poisson_ratio_2 = Panel("0.3")  # disabled
specific_weight_kg_m3_2 = Panel("1452")  # disabled
compressive_strenght_n_mm2_2 = Panel("3")  # disabled
material_adobe_2 = Panel("adobe sucrum test")  # disabled
name = Panel("shell")  # disabled
point_27 = Point(data_18)  # disabled
data_19 = Data(shell_cross_section_name)  # disabled
data_20 = Data(maximal_shell_thickness_cm)  # disabled
data_21 = Data(height_of_bricks_cm)  # disabled
data_22 = Data(name)  # disabled
data_23 = Data(young_modulus_n_mm2_2)  # disabled
data_24 = Data(compressive_strenght_n_mm2_2)  # disabled
data_25 = Data(distributed_vertical_load_kn_m2)  # disabled
data_26 = Data(name)  # disabled
data_27 = Data(material_adobe_2)  # disabled
data_28 = Data(poisson_ratio_2)  # disabled
data_29 = Data(specific_weight_kg_m3_2)  # disabled
data_30 = Data(point_27)  # disabled
data_31 = Data(specific_weight_kg_m3_2)  # disabled
ghpython_script_5 = GhPythonScript(e_modulus=data_23, poission_ratio=data_28)  # -> shear_modulus; inputs e_modulus: Int32, poission_ratio: Int32; disabled
# ---------- ghpython_script_5: Python ----------
__author__ = "kees_"
__version__ = "2019.10.08"

import rhinoscriptsyntax as rs

# 4.	calculation of shear modulus according to [Landau LD, Lifshitz EM. Theory of Elasticity, vol. 7. Course of Theoretical Physics. (2nd Ed) Pergamon: Oxford 1970 p13]

a = int(poission_ratio)
b = int(e_modulus)

shear_modulus = b/(2*(1+a))
# ---------- end ghpython_script_5 ----------
division_2 = Division(A=data_31, B=100)  # disabled
material_properties_karamba3d = MaterialPropertiesKaramba3D(
    FamilyOfMaterial=data_27,
    Name=data_27,
    ElementIdentifier=data_22,
    YoungsModulus_kN_cm2=expr("x*0.1", data_23),
    InPlaneShearModulus_kN_cm2=expr("x*0.1", ghpython_script_5),
    TransverseShearModulus_kN_cm2=expr("x*0.1", ghpython_script_5),
    SpecificWeight_kN_m3=expr("x*0.012", data_29),
    CoefficientOfThermalExpansion_1_C=1e-05,
    YieldStrength_kN_cm2=expr("x*0.1", data_24),
    mode="Isotrop")  # disabled
supp = SupportKaramba(PosInd=data_30, PlaneOfReference=PlaneXY(0, 0, 0), menu=[buttons(on, on, on, off, off, off)])  # -> flatten(Support); disabled
Z = UnitZ(Factor=expr("x*1.5", -1))  # disabled
loads_karamba3d = LoadsKaramba3D(Vector=Z, LCase=0, mode="Gravity")  # disabled
data_32 = Data(supp)  # disabled
data_33 = Data(loads_karamba3d)  # disabled
data_34 = Data(material_properties_karamba3d)  # disabled
data_35 = Data(data_34)  # disabled
data_36 = Data(name)  # disabled
panel_2 = Panel("""L S (house addition)(6,6)
2,11 parameters

L S  (Shop)(6,6)
4,37 parameters

L H (hallway)(5,5)
3,10 parameters
2,11 parameters
3,46 parameters
4,60 parameters


M S (Shop}(6,6)
2,16 parameters
2,22 parameters

M H (hallway) (5,5)
2,15 parameters
1,24 parameters

S S (Shop)(5,5)
1,52 parameters
2,17 parameters

S H {hallway}(5,5)
1,16 parameters
1,52 parameters""")  # disabled
dome_dimension_m = Panel(data_7)  # disabled
dome_width_m = Panel(data_8)  # disabled
max_deflection_m = Panel("1/200")  # disabled
data_37 = Data(dome_width_m)  # disabled
data_38 = Data(max_deflection_m)  # disabled
data_39 = Data(data_37)  # disabled
data_40 = Data(data_38)  # disabled
number = Number(expr("x*1000", data_39))  # disabled
number_2 = Number(data_40)  # disabled
multiplication = Multiplication(A=number, B=number_2)  # disabled
data_41 = Data(multiplication)  # disabled
data_42 = Data(data_41)  # disabled
number_3 = Number(compressive_strenght_n_mm2_2)  # disabled

# ----
# 11/23/2019
min_number_of_stacked_bricks = Slider(2, range=1..8)
# Optimalisation values
spring_stiffness = Slider(25, range=10..100)

data_43 = Data(spring_stiffness)

# ----
# Definition of support
# Definition of springs / mesh
# Definition of 1 way constrains
# Use if required by 2d topology
line_line_intersection_karamba3d_2 = LineLineIntersectionKaramba3D(Line=flatten(data_9), LengthTolerance=0.01)  # -> IntersectionPoints, flatten(LineSubSegements)
remove_duplicate_lines_karamba3d_2 = RemoveDuplicateLinesKaramba3D(Line=line_line_intersection_karamba3d_2.LineSubSegements, LimitDistance=0.005)  # -> OutLine, Info, Indexes
weaverbird_s_mesh_from_lines_weave_back_3 = WeaverbirdsMeshFromLinesWeaveBack(Lines=remove_duplicate_lines_karamba3d_2.OutLine, MaximumValence=4)
edgelengths = EdgeLengths(Mesh=weaverbird_s_mesh_from_lines_weave_back_3, LengthFactor=1, Strength=expr("x/2", data_43))
anchorxyz_3 = AnchorXYZ(Point=flatten(data_10), X=False, Y=True, Z=False, Strength=1000)  # disabled
anchorxyz_4 = AnchorXYZ(Point=flatten(data_11), X=True, Y=False, Z=False, Strength=1000)  # disabled
anchor_2 = Anchor(Point=data_12, Strength=100000)
vertexloads_2 = VertexLoads(Mesh=weaverbird_s_mesh_from_lines_weave_back_3, Strength=0.1)
zombiesolver = ZombieSolver(
    GoalObjects=flatten([anchor_2, anchorxyz_3, anchorxyz_4, edgelengths, vertexloads_2]),
    Threshold=1e-10,
    Tolerance=0.01,
    MaxIterations=50000)  # -> I, V, O; disabled
null_item = NullItem()  # -> NullFlags, InvalidFlags, Description
dispatch = Dispatch(DispatchPattern=null_item.NullFlags)  # -> ListA, ListB
weaverbird_s_mesh_from_lines_weave_back_4 = WeaverbirdsMeshFromLinesWeaveBack(Lines=dispatch.ListB, MaximumValence=4)

edgelengths_2 = EdgeLengths(Mesh=weaverbird_s_mesh_from_lines_weave_back, LengthFactor=1, Strength=spring_stiffness)
anchor_3 = Anchor(Point=mc, Strength=100000)
vertexloads_3 = VertexLoads(Mesh=weaverbird_s_mesh_from_lines_weave_back, Strength=division)

zombiesolver_2 = ZombieSolver(GoalObjects=flatten([anchor_3, edgelengths_2, vertexloads_3]), Threshold=1e-10, Tolerance=0.01, MaxIterations=50000)  # -> I, V, O
null_item_2 = NullItem(Item=zombiesolver_2.O)  # -> NullFlags, InvalidFlags, Description
dispatch_2 = Dispatch(List=zombiesolver_2.O, DispatchPattern=null_item_2.NullFlags)  # -> ListA, ListB
# Definition of shell
# Material properties from test
# Supports
# Loads
weaverbird_s_mesh_from_lines_weave_back_5 = WeaverbirdsMeshFromLinesWeaveBack(Lines=dispatch_2.ListB, MaximumValence=4)
# 11/22/2019
# Definition of Forces
mesh_edges = MeshEdges(Mesh=weaverbird_s_mesh_from_lines_weave_back_4)  # -> NakedEdges, InteriorEdges, NonManifoldEdges
weaverbird_s_catmull_clark_subdivision = WeaverbirdsCatmullClarkSubdivision(MeshCurves=weaverbird_s_mesh_from_lines_weave_back_5, Level=1, SmoothNakedEdges=0)  # disabled
# 11/22/2019
meshcorners = MeshCorners(Mesh=weaverbird_s_catmull_clark_subdivision, Angle=2)

data_44 = Data(weaverbird_s_catmull_clark_subdivision)
point_28 = Point(meshcorners)

# ----
# Definition of Forces
data_45 = Data(point_28)
data_46 = Data(data_44)

# ----
# Vertical loading
deconstruct_mesh = DeconstructMesh(Mesh=data_46)  # -> Vertices, Faces, Colours, Normals
remove_duplicate_points_karamba3d = RemoveDuplicatePointsKaramba3D(Point=deconstruct_mesh.Vertices, LimitDistance=0.005)  # -> OutPoint, Info, Indexes
# Roof loading
# (added soil)
evaluate_box = EvaluateBox(Box=data_46, UParameter=0.5, VParameter=0.5, WParameter=1)  # -> Plane, Point, Include
xy_plane_2 = XYPlane(Origin=Point(0, 0, 0))
convex_hull = ConvexHull(Points=remove_duplicate_points_karamba3d.OutPoint, Plane=PlaneXY(0, 0, 0))  # -> Hull, HullZ, Indices
deconstruct = Deconstruct(Point=remove_duplicate_points_karamba3d.OutPoint)  # -> XComponent, YComponent, ZComponent
deconstruct_2 = Deconstruct(Point=evaluate_box.Point)  # -> XComponent, YComponent, ZComponent
voronoi = Voronoi(Points=remove_duplicate_points_karamba3d.OutPoint, Boundary=convex_hull.Hull, Plane=xy_plane_2, BruteForceOverride=False)
construct_point = ConstructPoint(XCoordinate=0, YCoordinate=0, ZCoordinate=deconstruct.ZComponent)
construct_point_2 = ConstructPoint(XCoordinate=0, YCoordinate=0, ZCoordinate=deconstruct_2.ZComponent)
area_3 = Area(Geometry=voronoi)  # -> Area, Centroid
# 11/22/2019
replace_nulls = ReplaceNulls(Items=area_3.Area, Replacements=0)  # -> Items, Count
distance = Distance(PointA=construct_point, PointB=construct_point_2)  # -> expr("x/2", Distance)

point_29 = Point(data_45)
number_4 = Number(distance)
number_5 = Number(replace_nulls.Items)
data_47 = Data(data_46)
point_30 = Point(remove_duplicate_points_karamba3d.OutPoint)

mesh_edges_2 = MeshEdges(Mesh=data_47)  # -> NakedEdges, InteriorEdges, NonManifoldEdges

# ----
# Young Modulus research paper: https://dspace.cvut.cz/bitstream/handle/10467/69500/F1-BP-2017-Gubasheva-Samal-priloha-ADOBE%20AS%20A%20BUILDING%20MATERIAL.%20pdf.pdf?sequence=3&isAllowed=y
data_48 = Data(min_number_of_stacked_bricks)
maximal_shell_thickness_cm_2 = Slider(200, range=0..200)
height_of_bricks_cm_2 = Slider(9, range=0..10)
min_number_of_stacked_bricks_2 = Panel(data_48)
shell_cross_section_name_2 = Panel("Shell Cross section")
# Vertical loading
distributed_vertical_load_kn_m2_2 = Panel("2.25")
name_2 = Panel("shell")

data_49 = Data(name_2)
data_50 = Data(young_modulus_n_mm2)
data_51 = Data(specific_weight_kg_m3)
data_52 = Data(compressive_strenght_n_mm2)
data_53 = Data(material_adobe)
data_54 = Data(poisson_ratio)
ghpython_script_6 = GhPythonScript(e_modulus=data_50, poission_ratio=data_54)  # -> shear_modulus; inputs e_modulus: Int32, poission_ratio: Int32; same code as ghpython_script_5
material_properties_karamba3d_2 = MaterialPropertiesKaramba3D(
    FamilyOfMaterial=data_53,
    Name=data_53,
    ElementIdentifier=data_49,
    YoungsModulus_kN_cm2=expr("x*0.1", data_50),
    InPlaneShearModulus_kN_cm2=expr("x*0.1", ghpython_script_6),
    TransverseShearModulus_kN_cm2=expr("x*0.1", ghpython_script_6),
    SpecificWeight_kN_m3=expr("x*0.012", data_51),
    CoefficientOfThermalExpansion_1_C=1e-05,
    YieldStrength_kN_cm2=expr("x*0.1", data_52),
    mode="Isotrop")

min_number_of_stacked_bricks_3 = Slider(2, range=1..4)  # disabled
data_55 = Data(min_number_of_stacked_bricks_3)  # disabled
min_number_of_stacked_bricks_4 = Panel(data_55)  # disabled
data_56 = Data(min_number_of_stacked_bricks_4)  # disabled
multiplication_2 = Multiplication(A=data_56, B=data_21)  # disabled
construct_domain = ConstructDomain(DomainStart=multiplication_2, DomainEnd=data_20)  # disabled
range = Range(Domain=construct_domain, Steps=data_21)  # disabled
expression = Expression(x=data_19, y=range, Expression="x&\" \"&y")  # disabled
cross_section_karamba3d = CrossSectionKaramba3D(
    FamilyNameOfCrossSection=data_19,
    NameOfCrossSection=flatten(expression),
    ElementIdentifier=data_26,
    Material=data_35,
    Height_cm=flatten(range),
    mode="Shell - Const")  # disabled
data_57 = Data(cross_section_karamba3d)  # disabled
spring_stiffness_2 = Slider(17, range=10..60)  # disabled
data_58 = Data(spring_stiffness_2)  # disabled
edgelengths_3 = EdgeLengths(Mesh=weaverbird_s_mesh_from_lines_weave_back_2, LengthFactor=1, Strength=expr("x/2", data_58))  # disabled
zombiesolver_3 = ZombieSolver(
    GoalObjects=flatten([anchor, anchorxyz, anchorxyz_2, edgelengths_3, vertexloads]),
    Threshold=1e-10,
    Tolerance=0.01,
    MaxIterations=50000)  # -> I, V, O; disabled
null_item_3 = NullItem(Item=zombiesolver_3.O)  # -> NullFlags, InvalidFlags, Description; disabled
dispatch_3 = Dispatch(List=zombiesolver_3.O, DispatchPattern=null_item_3.NullFlags)  # -> ListA, ListB; disabled
weaverbird_s_mesh_from_lines_weave_back_6 = WeaverbirdsMeshFromLinesWeaveBack(Lines=dispatch_3.ListB, MaximumValence=4)  # disabled
weaverbird_s_catmull_clark_subdivision_2 = WeaverbirdsCatmullClarkSubdivision(MeshCurves=weaverbird_s_mesh_from_lines_weave_back_6, Level=1, SmoothNakedEdges=0)  # disabled
mesh_edges_3 = MeshEdges(Mesh=weaverbird_s_mesh_from_lines_weave_back_6)  # -> NakedEdges, InteriorEdges, NonManifoldEdges; disabled
data_59 = Data(weaverbird_s_catmull_clark_subdivision_2)  # disabled
data_60 = Data(data_59)  # disabled
deconstruct_mesh_2 = DeconstructMesh(Mesh=data_60)  # -> Vertices, Faces, Colours, Normals; disabled
remove_duplicate_points_karamba3d_2 = RemoveDuplicatePointsKaramba3D(Point=deconstruct_mesh_2.Vertices, LimitDistance=0.005)  # -> OutPoint, Info, Indexes; disabled
evaluate_box_2 = EvaluateBox(Box=data_60, UParameter=0.5, VParameter=0.5, WParameter=1)  # -> Plane, Point, Include; disabled
convex_hull_2 = ConvexHull(Points=remove_duplicate_points_karamba3d_2.OutPoint, Plane=PlaneXY(0, 0, 0))  # -> Hull, HullZ, Indices; disabled
deconstruct_3 = Deconstruct(Point=remove_duplicate_points_karamba3d_2.OutPoint)  # -> XComponent, YComponent, ZComponent; disabled
deconstruct_4 = Deconstruct(Point=evaluate_box_2.Point)  # -> XComponent, YComponent, ZComponent; disabled
voronoi_2 = Voronoi(
    Points=remove_duplicate_points_karamba3d_2.OutPoint,
    Boundary=convex_hull_2.Hull,
    Plane=xy_plane,
    BruteForceOverride=False)  # disabled
construct_point_3 = ConstructPoint(XCoordinate=0, YCoordinate=0, ZCoordinate=deconstruct_3.ZComponent)  # disabled
construct_point_4 = ConstructPoint(XCoordinate=0, YCoordinate=0, ZCoordinate=deconstruct_4.ZComponent)  # disabled
area_4 = Area(Geometry=voronoi_2)  # -> Area, Centroid; disabled
replace_nulls_2 = ReplaceNulls(Items=area_4.Area, Replacements=0)  # -> Items, Count; disabled
distance_2 = Distance(PointA=construct_point_3, PointB=construct_point_4)  # -> expr("x/2", Distance); disabled
number_6 = Number(distance_2)  # disabled
number_7 = Number(replace_nulls_2.Items)  # disabled
data_61 = Data(data_60)  # disabled
point_31 = Point(remove_duplicate_points_karamba3d_2.OutPoint)  # disabled
mesh_edges_4 = MeshEdges(Mesh=data_61)  # -> NakedEdges, InteriorEdges, NonManifoldEdges; disabled
data_62 = Data(data_60)  # disabled
data_63 = Data(point_31)  # disabled
data_64 = Data(number_6)  # disabled
data_65 = Data(number_7)  # disabled
number_8 = Number(data_65)  # disabled
number_9 = Number(data_64)  # disabled
point_32 = Point(data_63)  # disabled
mesh = Mesh(data_62)  # disabled
data_66 = Data(point_32)  # disabled
data_67 = Data(mesh)  # disabled
data_68 = Data(number_8)  # disabled
data_69 = Data(number_9)  # disabled
multiplication_3 = Multiplication(A=data_68, B=data_25)  # disabled
multiplication_4 = Multiplication(A=data_68, B=data_69)  # disabled
multiplication_5 = Multiplication(A=multiplication_4, B=division_2)  # disabled
addition = Addition(A=multiplication_3, B=multiplication_5)  # disabled
unit_z = UnitZ(Factor=addition)  # disabled
loads_karamba3d_2 = LoadsKaramba3D(ForceVector=unit_z, Local=False, PosInd=data_66, LCase=0, mode="Point")  # disabled
# Assembly of model
meshtoshell = MeshToShellKaramba(Mesh=data_67, Identifier=data_26, CrossSection=cross_section_karamba3d, LimitDistance_m=0.005)  # -> Element, Points, Info; disabled
data_70 = Data(meshtoshell.Element)  # disabled
data_71 = Data(loads_karamba3d_2)  # disabled
# Optimalisation of shell thickness
assemble = AssembleModelKaramba(Elem=data_70, Support=flatten(data_32), Load=flatten([data_33, data_71]), LimitDistance_m=0.005)  # -> Model, Info, Mass_kg, CenterOfGravity; disabled
# Karamba magic
optimize_cross_section_karamba3d = OptimizeCrossSectionKaramba3D(
    Model=assemble.Model,
    ElemIdentifiers=data_36,
    CrossSections=data_57,
    MaximumUtilization=1,
    MaximumDisplacement_cm=data_42,
    UltimateLimitStateIterations=5,
    DisplacementIterations=5,
    NumberOfSamplePoints=3,
    ElasticDesign=True,
    GammaM0=1,
    GammaM1=1)  # -> ModelWithOptimizedCrossSections, Info, Mass_kg, MaximumDisplacement_cm, ElasticEnergy_kNm; disabled
analyze_karamba3d = AnalyzeKaramba3D(Model=optimize_cross_section_karamba3d.ModelWithOptimizedCrossSections)  # -> CalculatedModel, MaximumDisplacement_cm, ResultingForceOfGravity_kN, ElasticEnergy_kNm; disabled
data_72 = Data(analyze_karamba3d.CalculatedModel)  # disabled
data_73 = Data(data_72)  # disabled
# Resulting utilisation and cross section
model_view_karamba3d = ModelViewKaramba3D(Model=data_73, LoadCaseFactorsForLinearSuperposition=1, IndexOfVisibleLoadcase=-1)  # -> Model, DeformedMesh, DeformedAxes, DeformedModel; disabled
shellview = ShellViewKaramba(Model=model_view_karamba3d.Model, IndexOfLayer=0)  # -> Model, MeshesOfRenderedShells, LegendColors, LegendTags; disabled
shellview_2 = ShellViewKaramba(Model=model_view_karamba3d.Model, IndexOfLayer=0)  # -> Model, MeshesOfRenderedShells, LegendColors, LegendTags; disabled
shellview_3 = ShellViewKaramba(Model=model_view_karamba3d.Model, IndexOfLayer=0)  # -> Model, MeshesOfRenderedShells, LegendColors, LegendTags; disabled
reaction_forces_karamba3d = ReactionForcesKaramba3D(AnalyzedModel=model_view_karamba3d.Model, LoadCase=0)  # -> AnalyzedModel, ReactionForces_kN, ReactionMoments_kNm, SupportPosition, SumOfReactionForces_kN, SumOfReactionMoments_kNm; disabled
shellview_4 = ShellViewKaramba(Model=model_view_karamba3d.Model, IndexOfLayer=0)  # -> Model, MeshesOfRenderedShells, LegendColors, LegendTags; disabled
nodedisp = NodalDisplacementsKaramba(AnalyzedModel=model_view_karamba3d.Model, LoadCase=0)  # -> AnalyzedModel, NodalTranslations_m, NodalRotations_rad; disabled
last_index = LastIndex(List=shellview.LegendTags)  # disabled
last_index_2 = LastIndex(List=shellview_2.LegendTags)  # disabled
mesh_2 = Mesh(shellview.MeshesOfRenderedShells)  # disabled
last_index_3 = LastIndex(List=shellview_3.LegendTags)  # disabled
pdecon = Deconstruct(Point=nodedisp.NodalTranslations_m)  # -> XComponent, YComponent, expr("x*1000", ZComponent); disabled
mesh_3 = Mesh(shellview_2.MeshesOfRenderedShells)  # disabled
multiplication_6 = Multiplication(A=shellview.LegendTags, B=10)  # disabled
multiplication_7 = Multiplication(A=shellview_2.LegendTags, B=10)  # disabled
multiplication_8 = Multiplication(A=shellview_3.LegendTags, B=10)  # disabled
cull_index = CullIndex(List=multiplication_6, Indices=flatten(last_index), Wrap=True)  # disabled
cull_index_2 = CullIndex(List=multiplication_7, Indices=flatten(last_index_2), Wrap=True)  # disabled
cull_index_3 = CullIndex(List=multiplication_8, Indices=flatten(last_index_3), Wrap=True)  # disabled
absolute = Absolute(Value=pdecon.ZComponent)  # disabled
shellview_5 = ShellViewKaramba(Model=shellview_4.Model, IndexOfLayer=0)  # -> Model, MeshesOfRenderedShells, LegendColors, LegendTags; disabled
split_list = SplitList(List=cull_index, Index=1)  # -> ListA, ListB; disabled
split_list_2 = SplitList(List=cull_index_2, Index=1)  # -> ListA, ListB; disabled
split_list_3 = SplitList(List=cull_index_3, Index=1)  # -> ListA, ListB; disabled
list_item = ListItem(List=reaction_forces_karamba3d.ReactionForces_kN, Index=0, Wrap=True)  # disabled
bounds = Bounds(Numbers=split_list.ListB)  # disabled
bounds_2 = Bounds(Numbers=absolute)  # disabled
bounds_3 = Bounds(Numbers=split_list_2.ListB)  # disabled
bounds_4 = Bounds(Numbers=split_list_3.ListB)  # disabled
shellview_6 = ShellViewKaramba(Model=shellview_5.Model, IndexOfLayer=0)  # -> Model, MeshesOfRenderedShells, LegendColors, LegendTags; disabled
deconstruct_5 = Deconstruct(Point=list_item)  # -> XComponent, YComponent, ZComponent; disabled
deconstruct_domain = DeconstructDomain(Domain=bounds)  # -> Start, End; disabled
deconstruct_domain_2 = DeconstructDomain(Domain=bounds_2)  # -> Start, End; disabled
deconstruct_domain_3 = DeconstructDomain(Domain=bounds_3)  # -> Start, End; disabled
deconstruct_domain_4 = DeconstructDomain(Domain=bounds_4)  # -> Start, End; disabled
data_74 = Data(flatten(deconstruct_5.XComponent))  # disabled
data_75 = Data(flatten(deconstruct_5.YComponent))  # disabled
data_76 = Data(flatten(deconstruct_domain_2.End))  # disabled
data_77 = Data(flatten(deconstruct_domain_3.Start))  # disabled
data_78 = Data(flatten(deconstruct_domain_3.End))  # disabled
data_79 = Data(flatten(deconstruct_domain.Start))  # disabled
data_80 = Data(flatten(deconstruct_domain.End))  # disabled
data_81 = Data(flatten(deconstruct_domain_4.End))  # disabled
data_82 = Data(flatten(deconstruct_5.ZComponent))  # disabled
data_83 = Data(flatten(shellview_6.LegendColors))  # disabled
data_84 = Data(flatten(shellview_6.LegendTags))  # disabled
data_85 = Data(flatten(shellview_5.LegendColors))  # disabled
data_86 = Data(flatten(shellview_5.LegendTags))  # disabled
data_87 = Data(flatten(shellview_4.LegendColors))  # disabled
data_88 = Data(flatten(shellview_4.LegendTags))  # disabled
# Definition of shell
# Material properties from test
# Supports
# Loads
data_89 = Data(flatten(shellview_4.MeshesOfRenderedShells))  # disabled
legend = Legend(Colour=data_83, Tags=data_84, LegendType=1)  # disabled
legend_2 = Legend(Colour=data_85, Tags=data_86, LegendType=1)  # disabled
legend_3 = Legend(Colour=data_87, Tags=data_88, LegendType=1)  # disabled
x_horizontal_resultant_force_kn = Panel(data_74)  # disabled
y_horizontal_resultant_force_kn = Panel(data_75)  # disabled
z_vertical_resultant_force_kn = Panel(data_82)  # disabled
max_compression_stress_p1_n_mm2 = Panel(data_77)  # disabled
max_tensile_stress_p1_n_mm2 = Panel(data_78)  # disabled
max_compression_stress_p2_n_mm2 = Panel(data_79)  # disabled
max_tensile_stress_p2_n_mm2 = Panel(data_80)  # disabled
max_displacement_mm = Panel(data_76)  # disabled
data_90 = Data(max_displacement_mm)  # disabled
data_91 = Data(max_compression_stress_p1_n_mm2)  # disabled
data_92 = Data(max_tensile_stress_p1_n_mm2)  # disabled
data_93 = Data(max_compression_stress_p2_n_mm2)  # disabled
data_94 = Data(max_tensile_stress_p2_n_mm2)  # disabled
data_95 = Data(data_91)  # disabled
data_96 = Data(data_93)  # disabled
data_97 = Data(data_94)  # disabled
data_98 = Data(data_90)  # disabled
data_99 = Data(data_92)  # disabled
absolute_2 = Absolute(Value=[data_95, data_96])  # disabled
absolute_3 = Absolute(Value=[data_99, data_97])  # disabled
number_10 = Number(data_98)  # disabled
sort_list = SortList(Keys=absolute_2)  # -> Keys, ValuesValuesA; disabled
sort_list_2 = SortList(Keys=absolute_3)  # -> Keys, ValuesValuesA; disabled
list_item_2 = ListItem(List=sort_list.Keys, Index=1, Wrap=True)  # disabled
list_item_3 = ListItem(List=sort_list_2.Keys, Index=1, Wrap=True)  # disabled
number_11 = Number(list_item_3)  # disabled
expression_2 = Expression(x=number_11, y=number_3, Expression="x>y/10")  # disabled
expression_3 = Expression(x=list_item_2, y=number_3, Expression="x<-y")  # disabled
expression_4 = Expression(x=multiplication, y=number_10, Expression="x<y")  # disabled
merge_11 = Merge(Data1=expression_4, Data2=expression_3, Data3=expression_2)  # disabled
mass_addition = MassAddition(Input=merge_11)  # -> Result, PartialResults; disabled
addition_2 = Addition(A=mass_addition.Result, B=list_item_3)  # disabled
maximum_compression_n_mm2 = Number(list_item_2)  # disabled
maximal_tension_n_mm2 = Number(number_11)  # disabled
maximal_deflection_mm = Number(number_10)  # disabled
opossum = Opossum(OpossumData_NumberOfObjectives=0, OpossumData_OptimizationType=0, OpossumData_ResultSerializationStatus=0)  # disabled

imput_shopsize_3 = Panel("l")  # disabled
imput_shopsize_4 = Panel("shop")  # disabled
ghpython_script_7 = GhPythonScript(shop_size=imput_shopsize_3)  # -> width_of_shop; disabled; same code as ghpython_script
ghpython_script_8 = GhPythonScript(width=imput_shopsize_4)  # -> width_of_shop; disabled; same code as ghpython_script_2
rectangle_3 = Rectangle(Plane=PlaneXY(0, 0, 0), XSize=ghpython_script_7, YSize=ghpython_script_8, Radius=0)  # -> Rectangle, Length; disabled
explode_3 = Explode(Curve=rectangle_3.Rectangle, Recursive=True)  # -> Segments, Vertices; disabled
area_5 = Area(Geometry=rectangle_3.Rectangle)  # -> Area, Centroid; disabled
curve_middle_3 = CurveMiddle(Curve=explode_3.Segments)  # -> graft(Midpoint); disabled
box_corners_3 = BoxCorners(Box=rectangle_3.Rectangle)  # -> CornerA, CornerB, CornerC, CornerD, CornerE, CornerF, CornerG, CornerH; disabled
point_33 = Point([box_corners_3.CornerA, box_corners_3.CornerB, box_corners_3.CornerC, box_corners_3.CornerD])  # disabled
explode_tree_17 = ExplodeTree(Data=curve_middle_3)  # -> Branch0, Branch1, Branch2, Branch3; disabled
number_slider = Slider(15, range=0..15)  # disabled
line_57 = Line(StartPoint=box_corners_3.CornerD, EndPoint=explode_tree_17.Branch2)  # -> flatten(Line); disabled
line_58 = Line(StartPoint=box_corners_3.CornerD, EndPoint=explode_tree_17.Branch3)  # -> flatten(Line); disabled
line_59 = Line(StartPoint=box_corners_3.CornerD, EndPoint=area_5.Centroid)  # -> flatten(Line); disabled
line_60 = Line(StartPoint=curve_middle_3, EndPoint=area_5.Centroid)  # -> flatten(Line); disabled
divide_curve_17 = DivideCurve(Curve=[line_57, line_58, line_59], Count=number_slider, Kinks=False)  # -> Points, Tangents, Parameters; disabled
flip_matrix_3 = FlipMatrix(Data=line_60)  # disabled
gene_pool_2 = GenePool(Decimals=0, Maximum=10, Minimum=1, Value=[6, 6])  # disabled
explode_tree_18 = ExplodeTree(Data=flip_matrix_3)  # -> Branch0, Branch1, Branch2, Branch3; disabled
list_item_4 = ListItem(List=divide_curve_17.Points, Index=number_slider, Wrap=True)  # disabled
list_item_5 = ListItem(List=divide_curve_17.Points, Index=1, Wrap=True)  # disabled
explode_tree_19 = ExplodeTree(Data=graft(gene_pool_2))  # -> Branch0, Branch1; disabled
flip_curve = FlipCurve(Curve=explode_tree_18.Branch2)  # -> Curve, Flag; disabled
construct_domain_2 = ConstructDomain(DomainStart=1, DomainEnd=expr("x-1", explode_tree_19.Branch1))  # disabled
construct_domain_3 = ConstructDomain(DomainStart=1, DomainEnd=explode_tree_19.Branch0)  # disabled
divide_curve_18 = DivideCurve(Curve=flip_curve.Curve, Count=explode_tree_19.Branch1, Kinks=False)  # -> Points, Tangents, Parameters; disabled
divide_curve_19 = DivideCurve(Curve=explode_tree_18.Branch3, Count=explode_tree_19.Branch0, Kinks=False)  # -> Points, Tangents, Parameters; disabled
explode_tree_20 = ExplodeTree(Data=list_item_5)  # -> Branch0, Branch1, Branch2; disabled
merge_12 = Merge(Data1=flatten(explode_tree_20.Branch1), Data2=flatten(explode_tree_20.Branch2), Data3=flatten(explode_tree_20.Branch0))  # -> flatten(Result); disabled
sub_list = SubList(List=divide_curve_18.Points, Domain=construct_domain_2, Wrap=True)  # -> List, Index; disabled
sub_list_2 = SubList(List=divide_curve_19.Points, Domain=construct_domain_3, Wrap=True)  # -> List, Index; disabled
mass_addition_2 = MassAddition(Input=gene_pool_2)  # -> Result, PartialResults; disabled
nurbs_curve = NurbsCurve(Vertices=merge_12, Degree=2, Periodic=False)  # -> Curve, Length, Domain; disabled
construct_domain_4 = ConstructDomain(DomainStart=1, DomainEnd=expr("x-1", mass_addition_2.Result))  # disabled
divide_curve_20 = DivideCurve(Curve=nurbs_curve.Curve, Count=expr("x", mass_addition_2.Result), Kinks=False)  # -> Points, Tangents, Parameters; disabled
merge_13 = Merge(Data1=sub_list.List, Data2=sub_list_2.List)  # -> flatten(Result); disabled
polyline = PolyLine(Vertices=divide_curve_20.Points, Closed=False)  # disabled
sub_list_3 = SubList(List=divide_curve_20.Points, Domain=construct_domain_4, Wrap=True)  # -> List, Index; disabled
explode_4 = Explode(Curve=polyline, Recursive=True)  # -> Segments, Vertices; disabled
line_61 = Line(StartPoint=sub_list_3.List, EndPoint=merge_13)  # disabled
line_62 = Line(StartPoint=list_item_4, EndPoint=list_item_5)  # disabled
list_item_6 = ListItem(List=line_61, Index=expr("x/2-1", mass_addition_2.Result), Wrap=True)  # disabled
explode_tree_21 = ExplodeTree(Data=line_62)  # -> Branch0, Branch1, Branch2; disabled
line_63 = Line(flatten([explode_tree_21.Branch0, explode_tree_21.Branch1]))  # disabled
divide_curve_21 = DivideCurve(Curve=[explode_tree_21.Branch0, explode_tree_21.Branch1], Count=expr("x", number_slider), Kinks=False)  # -> reverse(Points), Tangents, Parameters; disabled
divide_curve_22 = DivideCurve(Curve=list_item_6, Count=expr("x", number_slider), Kinks=False)  # -> Points, Tangents, Parameters; disabled
end_points = EndPoints(Curve=list_item_6)  # -> Start, End; disabled
split_list_4 = SplitList(List=divide_curve_22.Points, Index=1)  # -> ListA, ListB; disabled
split_list_5 = SplitList(List=divide_curve_21.Points, Index=1)  # -> ListA, ListB; disabled
line_64 = Line(StartPoint=split_list_4.ListB, EndPoint=split_list_5.ListB)  # -> flatten(Line); disabled
merge_14 = Merge(Data1=line_63, Data2=line_64, Data3=line_61, Data4=explode_4.Segments)  # -> flatten(Result); disabled
xz_plane = XZPlane(Origin=end_points.End)  # disabled
yz_plane = YZPlane(Origin=end_points.End)  # disabled
merge_15 = Merge(Data1=merge_14, Data2=explode_4.Vertices)  # disabled
mirror = Mirror(Geometry=merge_15, Plane=xz_plane)  # -> Geometry, Transform; disabled
mirror_2 = Mirror(Geometry=[merge_15, mirror.Geometry], Plane=yz_plane)  # -> Geometry, Transform; disabled
data_100 = Data([merge_15, mirror.Geometry, mirror_2.Geometry])  # disabled
explode_tree_22 = ExplodeTree(Data=data_100)  # -> Branch0, Branch1; disabled
point_34 = Point(explode_tree_22.Branch1)  # disabled
remove_duplicate_lines_karamba3d_3 = RemoveDuplicateLinesKaramba3D(Line=explode_tree_22.Branch0, LimitDistance=0.005)  # -> OutLine, Info, Indexes; disabled
line_line_intersection_karamba3d_3 = LineLineIntersectionKaramba3D(Line=flatten(remove_duplicate_lines_karamba3d_3.OutLine), LengthTolerance=0.001)  # -> IntersectionPoints, flatten(LineSubSegements); disabled
remove_duplicate_lines_karamba3d_4 = RemoveDuplicateLinesKaramba3D(Line=line_line_intersection_karamba3d_3.LineSubSegements, LimitDistance=0.0005)  # -> OutLine, Info, Indexes; disabled
weaverbird_s_mesh_from_lines_weave_back_7 = WeaverbirdsMeshFromLinesWeaveBack(Lines=remove_duplicate_lines_karamba3d_4.OutLine, MaximumValence=10)  # disabled
gene_pool_3 = GenePool(Decimals=0, Maximum=100, Minimum=1, Value=40)  # disabled
number_slider_2 = Slider(2.6, range=0..10)  # disabled
division_3 = Division(A=gene_pool_3, B=2)  # disabled
anchor_4 = Anchor(Point=explode_tree_22.Branch1, Strength=100000)  # disabled
number_slider_3 = Slider(0, range=0..100)  # disabled

size = Panel(rectangle_3.Rectangle)

edgelengths_4 = EdgeLengths(Mesh=weaverbird_s_mesh_from_lines_weave_back_7, LengthFactor=1, Strength=division_3)  # disabled
vertexloads_4 = VertexLoads(Mesh=weaverbird_s_mesh_from_lines_weave_back_7, Strength=0.1)  # disabled

zombiesolver_4 = ZombieSolver(GoalObjects=flatten([anchor_4, edgelengths_4, vertexloads_4]), Threshold=1e-10, Tolerance=0.01, MaxIterations=50000)  # -> I, V, O; disabled
null_item_4 = NullItem(Item=zombiesolver_4.O)  # -> NullFlags, InvalidFlags, Description; disabled
dispatch_4 = Dispatch(List=zombiesolver_4.O, DispatchPattern=null_item_4.NullFlags)  # -> ListA, ListB; disabled
weaverbird_s_mesh_from_lines_weave_back_8 = WeaverbirdsMeshFromLinesWeaveBack(Lines=dispatch_4.ListB, MaximumValence=4)  # disabled
mesh_edges_5 = MeshEdges(Mesh=weaverbird_s_mesh_from_lines_weave_back_8)  # -> NakedEdges, InteriorEdges, NonManifoldEdges; disabled
weaverbird_s_catmull_clark_subdivision_3 = WeaverbirdsCatmullClarkSubdivision(MeshCurves=weaverbird_s_mesh_from_lines_weave_back_8, Level=1, SmoothNakedEdges=number_slider_3)  # disabled

# ----
# Shape input
# Definition of Mesh and range of thickness
# Definition of formfinding parameters
# Definition of support points
# Definition of forces
data_101 = Data(data_46)

data_102 = Data(point_30)
data_103 = Data(number_4)
data_104 = Data(number_5)
# Calculation FEM using karamba
data_105 = Data(data_45)
number_12 = Number(data_104)
number_13 = Number(data_103)
point_35 = Point(data_102)
point_36 = Point(data_105)
mesh_4 = Mesh(data_101)

data_106 = Data(point_36)
supp_2 = SupportKaramba(PosInd=data_106, PlaneOfReference=PlaneXY(0, 0, 0), menu=[buttons(on, on, on, off, off, off)])  # -> flatten(Support)

data_107 = Data(number_12)
data_108 = Data(distributed_vertical_load_kn_m2_2)
# Calculation FEM using karamba
# 11/22/2019
# Shape input
# Definition of Mesh and range of thickness
# Definition of Material properties
# Roof loading
# (added soil)
# Definition of formfinding parameters
# Definition of support points
# Definition of forces
data_109 = Data(point_35)
data_110 = Data(number_13)
data_111 = Data(specific_weight_kg_m3)
multiplication_9 = Multiplication(A=data_107, B=data_108)
multiplication_10 = Multiplication(A=data_107, B=data_110)
division_4 = Division(A=data_111, B=100)
multiplication_11 = Multiplication(A=multiplication_10, B=division_4)
addition_3 = Addition(A=multiplication_9, B=multiplication_11)
unit_z_2 = UnitZ(Factor=addition_3)
Z_2 = UnitZ(Factor=expr("x*1.5", -1))

# ----
# Assembly of model
# Optimalisation of shell thickness
loads_karamba3d_3 = LoadsKaramba3D(Vector=Z_2, LCase=0, mode="Gravity")
loads_karamba3d_4 = LoadsKaramba3D(ForceVector=expr("X*-1.5", unit_z_2), Local=False, PosInd=data_109, LCase=0, mode="Point")

# ----
# Definition of Material properties
data_112 = Data(mesh_4)
data_113 = Data(shell_cross_section_name_2)
data_114 = Data(maximal_shell_thickness_cm_2)
data_115 = Data(height_of_bricks_cm_2)
data_116 = Data(name_2)
data_117 = Data(min_number_of_stacked_bricks_2)

multiplication_12 = Multiplication(A=data_117, B=data_115)
construct_domain_5 = ConstructDomain(DomainStart=multiplication_12, DomainEnd=data_114)
range_2 = Range(Domain=construct_domain_5, Steps=data_115)
expression_5 = Expression(x=data_113, y=range_2, Expression="x&\" \"&y")

data_118 = Data(supp_2)
data_119 = Data(loads_karamba3d_3)
data_120 = Data(loads_karamba3d_4)
data_121 = Data(material_properties_karamba3d_2)

data_122 = Data(data_121)

cross_section_karamba3d_2 = CrossSectionKaramba3D(
    FamilyNameOfCrossSection=data_113,
    NameOfCrossSection=flatten(expression_5),
    ElementIdentifier=data_116,
    Material=data_122,
    Height_cm=flatten(range_2),
    mode="Shell - Const")
meshtoshell_2 = MeshToShellKaramba(Mesh=data_112, Identifier=data_116, CrossSection=cross_section_karamba3d_2, LimitDistance_m=0.005)  # -> Element, Points, Info

data_123 = Data(meshtoshell_2.Element)
assemble_2 = AssembleModelKaramba(Elem=data_123, Support=flatten(data_118), Load=flatten([data_119, data_120]), LimitDistance_m=0.005)  # -> Model, Info, Mass_kg, CenterOfGravity

# ----
# Assembly of model
# Optimalisation of shell thickness
data_124 = Data(cross_section_karamba3d_2)
data_125 = Data(name_2)

# ----
# 11/23/2019
dome_dimension_m_2 = Panel(data_3)
dome_width_m_2 = Panel(data_4)
max_deflection_m_2 = Panel("1/200")

# ----
# Resulting displacement
# Results FEM
# Resulting principle stresses D1
# Resulting principle stresses D2
# Resulting von Mises yield criterion
# Resulting utilisation and cross section
panel_3 = Panel("""L S (house addition)(6,6)
2,11 parameters

L S  (Shop)(6,6)
4,37 parameters

L H (hallway)(5,5)
3,10 parameters
2,11 parameters
3,46 parameters
4,60 parameters


M S (Shop}(6,6)
2,16 parameters
2,22 parameters

M H (hallway) (5,5)
2,15 parameters
1,24 parameters

S S (Shop)(5,5)
1,52 parameters
2,17 parameters

S H {hallway}(5,5)
1,16 parameters
1,52 parameters""")

data_126 = Data(max_deflection_m_2)
data_127 = Data(dome_width_m_2)

# ----
# Optimalisation
data_128 = Data(data_127)
data_129 = Data(data_126)

number_14 = Number(expr("x*1000", data_128))
number_15 = Number(data_129)
multiplication_13 = Multiplication(A=number_14, B=number_15)
number_16 = Number(compressive_strenght_n_mm2)
opossum_2 = Opossum(
    OpossumData_NumberOfObjectives=1,
    OpossumData_OptimizationType=0,
    OpossumData_ResultSerializationStatus=0,
    OpossumData_ObjectiveValue=[2.394, 2.494, 2.362, 2.502, 2.327, 2.334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],
    OpossumData_ParameterList=["1,87", "7,13", "4,55", "8,100", "1,34", "1,45", "1,39", "1,35", "1,71", "1,23"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],
    OpossumData_objective=addition_4,
    OpossumData_variable=[min_number_of_stacked_bricks, spring_stiffness])

# ----
# UC checks of structure
# Surrogate model optimalisation solver, output: best solution
# Output: 3-axis pareto front
data_130 = Data(multiplication_13)

data_131 = Data(data_130)

optimize_cross_section_karamba3d_2 = OptimizeCrossSectionKaramba3D(
    Model=assemble_2.Model,
    ElemIdentifiers=data_125,
    CrossSections=data_124,
    MaximumUtilization=1,
    MaximumDisplacement_cm=data_131,
    UltimateLimitStateIterations=5,
    DisplacementIterations=5,
    NumberOfSamplePoints=3,
    ElasticDesign=True,
    GammaM0=1,
    GammaM1=1)  # -> ModelWithOptimizedCrossSections, Info, Mass_kg, MaximumDisplacement_cm, ElasticEnergy_kNm

# ----
# 11/22/2019
# Karamba magic
analyze_karamba3d_2 = AnalyzeKaramba3D(Model=optimize_cross_section_karamba3d_2.ModelWithOptimizedCrossSections)  # -> CalculatedModel, MaximumDisplacement_cm, ResultingForceOfGravity_kN, ElasticEnergy_kNm; disabled

data_132 = Data(analyze_karamba3d_2.CalculatedModel)

# ----
# Results generation FEM
data_133 = Data(data_132)

model_view_karamba3d_2 = ModelViewKaramba3D(Model=data_133, LoadCaseFactorsForLinearSuperposition=1, IndexOfVisibleLoadcase=-1)  # -> Model, DeformedMesh, DeformedAxes, DeformedModel
shellview_7 = ShellViewKaramba(Model=model_view_karamba3d_2.Model, IndexOfLayer=0)  # -> Model, MeshesOfRenderedShells, LegendColors, LegendTags
shellview_8 = ShellViewKaramba(Model=model_view_karamba3d_2.Model, IndexOfLayer=0)  # -> Model, MeshesOfRenderedShells, LegendColors, LegendTags
shellview_9 = ShellViewKaramba(Model=model_view_karamba3d_2.Model, IndexOfLayer=0)  # -> Model, MeshesOfRenderedShells, LegendColors, LegendTags
reaction_forces_karamba3d_2 = ReactionForcesKaramba3D(AnalyzedModel=model_view_karamba3d_2.Model, LoadCase=0)  # -> AnalyzedModel, ReactionForces_kN, ReactionMoments_kNm, SupportPosition, SumOfReactionForces_kN, SumOfReactionMoments_kNm
# 11/22/2019
# Results generation FEM
# Karamba magic
shellview_10 = ShellViewKaramba(Model=model_view_karamba3d_2.Model, IndexOfLayer=0)  # -> Model, MeshesOfRenderedShells, LegendColors, LegendTags
nodedisp_2 = NodalDisplacementsKaramba(AnalyzedModel=model_view_karamba3d_2.Model, LoadCase=0)  # -> AnalyzedModel, NodalTranslations_m, NodalRotations_rad
last_index_4 = LastIndex(List=shellview_7.LegendTags)
last_index_5 = LastIndex(List=shellview_8.LegendTags)
last_index_6 = LastIndex(List=shellview_9.LegendTags)
pdecon_2 = Deconstruct(Point=nodedisp_2.NodalTranslations_m)  # -> XComponent, YComponent, expr("x*1000", ZComponent)
multiplication_14 = Multiplication(A=shellview_7.LegendTags, B=10)
multiplication_15 = Multiplication(A=shellview_8.LegendTags, B=10)
multiplication_16 = Multiplication(A=shellview_9.LegendTags, B=10)
cull_index_4 = CullIndex(List=multiplication_14, Indices=flatten(last_index_4), Wrap=True)
cull_index_5 = CullIndex(List=multiplication_15, Indices=flatten(last_index_5), Wrap=True)
cull_index_6 = CullIndex(List=multiplication_16, Indices=flatten(last_index_6), Wrap=True)
absolute_4 = Absolute(Value=pdecon_2.ZComponent)
shellview_11 = ShellViewKaramba(Model=shellview_10.Model, IndexOfLayer=0)  # -> Model, MeshesOfRenderedShells, LegendColors, LegendTags
split_list_6 = SplitList(List=cull_index_4, Index=1)  # -> ListA, ListB
split_list_7 = SplitList(List=cull_index_5, Index=1)  # -> ListA, ListB
split_list_8 = SplitList(List=cull_index_6, Index=1)  # -> ListA, ListB
bounds_5 = Bounds(Numbers=split_list_6.ListB)
bounds_6 = Bounds(Numbers=absolute_4)
bounds_7 = Bounds(Numbers=split_list_7.ListB)
bounds_8 = Bounds(Numbers=split_list_8.ListB)
shellview_12 = ShellViewKaramba(Model=shellview_11.Model, IndexOfLayer=0)  # -> Model, MeshesOfRenderedShells, LegendColors, LegendTags
deconstruct_domain_5 = DeconstructDomain(Domain=bounds_5)  # -> Start, End
deconstruct_domain_6 = DeconstructDomain(Domain=bounds_6)  # -> Start, End
deconstruct_domain_7 = DeconstructDomain(Domain=bounds_7)  # -> Start, End
deconstruct_domain_8 = DeconstructDomain(Domain=bounds_8)  # -> Start, End

mesh_5 = Mesh(shellview_7.MeshesOfRenderedShells)
mesh_6 = Mesh(shellview_8.MeshesOfRenderedShells)
list_item_7 = ListItem(List=reaction_forces_karamba3d_2.ReactionForces_kN, Index=0, Wrap=True)
deconstruct_6 = Deconstruct(Point=list_item_7)  # -> XComponent, YComponent, ZComponent

data_134 = Data(flatten(deconstruct_6.XComponent))

data_135 = Data(flatten(deconstruct_6.YComponent))

data_136 = Data(flatten(deconstruct_domain_5.End))
data_137 = Data(flatten(deconstruct_domain_8.End))
data_138 = Data(flatten(shellview_12.LegendColors))
data_139 = Data(flatten(shellview_12.LegendTags))
data_140 = Data(flatten(shellview_11.LegendColors))
data_141 = Data(flatten(shellview_11.LegendTags))
data_142 = Data(flatten(shellview_10.LegendTags))
# 11/23/2019
# Optimalisation
# Resulting displacement
# Results FEM
# UC checks of structure
# Surrogate model optimalisation solver, output: best solution
# Resulting principle stresses D1
# Resulting principle stresses D2
# Resulting von Mises yield criterion
data_143 = Data(flatten(shellview_10.MeshesOfRenderedShells))
data_144 = Data(flatten(deconstruct_domain_6.End))
data_145 = Data(flatten(deconstruct_domain_7.Start))
data_146 = Data(flatten(deconstruct_domain_7.End))
data_147 = Data(flatten(deconstruct_domain_5.Start))
data_148 = Data(flatten(shellview_10.LegendColors))

data_149 = Data(flatten(deconstruct_6.ZComponent))

legend_4 = Legend(Colour=data_140, Tags=data_141, LegendType=1)
legend_5 = Legend(Colour=data_138, Tags=data_139, LegendType=1)
legend_6 = Legend(Colour=data_148, Tags=data_142, LegendType=1)
z_vertical_resultant_force_kn_2 = Panel(data_149)
x_horizontal_resultant_force_kn_2 = Panel(data_134)
y_horizontal_resultant_force_kn_2 = Panel(data_135)
max_compression_stress_p2_n_mm2_2 = Panel(data_147)
max_compression_stress_p1_n_mm2_2 = Panel(data_145)
max_tensile_stress_p1_n_mm2_2 = Panel(data_146)
max_tensile_stress_p2_n_mm2_2 = Panel(data_136)
max_displacement_mm_2 = Panel(data_144)

data_150 = Data(max_displacement_mm_2)
data_151 = Data(max_tensile_stress_p1_n_mm2_2)
data_152 = Data(max_compression_stress_p1_n_mm2_2)
data_153 = Data(max_compression_stress_p2_n_mm2_2)
data_154 = Data(max_tensile_stress_p2_n_mm2_2)

data_155 = Data(data_152)
data_156 = Data(data_153)
data_157 = Data(data_154)
data_158 = Data(data_150)
data_159 = Data(data_151)

absolute_5 = Absolute(Value=[data_155, data_156])
absolute_6 = Absolute(Value=[data_159, data_157])
number_17 = Number(data_158)
sort_list_3 = SortList(Keys=absolute_5)  # -> Keys, ValuesValuesA
sort_list_4 = SortList(Keys=absolute_6)  # -> Keys, ValuesValuesA
list_item_8 = ListItem(List=sort_list_3.Keys, Index=1, Wrap=True)
list_item_9 = ListItem(List=sort_list_4.Keys, Index=1, Wrap=True)
number_18 = Number(list_item_9)
expression_6 = Expression(x=number_18, y=number_16, Expression="x>y/10")
expression_7 = Expression(x=list_item_8, y=number_16, Expression="x<-y")
expression_8 = Expression(x=multiplication_13, y=number_17, Expression="x<y")
merge_16 = Merge(Data1=expression_8, Data2=expression_7, Data3=expression_6)
mass_addition_3 = MassAddition(Input=merge_16)  # -> Result, PartialResults
addition_4 = Addition(A=mass_addition_3.Result, B=list_item_9)

panel_4 = Panel(addition_4)

maximum_compression_n_mm2_2 = Number(list_item_8)
maximal_tension_n_mm2_2 = Number(number_18)
# 11/23/2019
# Optimalisation values
# Output: 3-axis pareto front
maximal_deflection_mm_2 = Number(number_17)
