# Grasshopper definition Optimalisation_algorithm_Side_Dome_vaults_v5.gh (Grasshopper 1.0.7)
# plug-ins: Karamba, Pufferfish, Weaverbird, Kangaroo2 Components, Opossum2_0_Proto_A

imput_shopsize = Panel("s")
imput_shop_hallway = Panel("shop")

# ----
# Resulting displacement
# Resulting principle stresses D1
# Resulting principle stresses D2
# Optimalisation
# 11/23/2019
# 11/22/2019
# Kangeroo form finding
# 11/22/2019
# Definition of Forces
# 11/22/2019
# Calculation FEM using karamba
# Results generation FEM
# 11/23/2019
# 11/22/2019
# Resulting von Mises yield criterion
# Resulting displacement
# Optimalisation values
# Results FEM
# UC checks of structure
# Surrogate model optimalisation solver, output: best solution
# Resulting principle stresses D1
# Output: 3-axis pareto front
# Resulting utilisation and cross section
# Resulting principle stresses D2
# Resulting von Mises yield criterion
# Young Modulus research paper: https://dspace.cvut.cz/bitstream/handle/10467/69500/F1-BP-2017-Gubasheva-Samal-priloha-ADOBE%20AS%20A%20BUILDING%20MATERIAL.%20pdf.pdf?sequence=3&isAllowed=y
# Resulting utilisation and cross section
imput_shopsize_2 = Panel("s")
imput_shop_hallway_2 = Panel("shop")
data = Data(imput_shopsize_2)
data_2 = Data(imput_shop_hallway_2)
ghpython_script = GhPythonScript(shop_size=data)  # -> width_of_shop
# ---------- ghpython_script: Python ----------
__author__ = "kees_"
__version__ = "2019.10.09"

sizes = {'s':2.4, 'm':4.80, 'l':9.60}
width_of_shop = sizes.get(shop_size)
# ---------- end ghpython_script ----------
ghpython_script_2 = GhPythonScript(width=data_2)  # -> width_of_shop
# ---------- ghpython_script_2: Python ----------
__author__ = "kees_"
__version__ = "2019.10.09"

sizes = {'hallway':2.4, 'shop':3.6}
width_of_shop = sizes.get(width)
# ---------- end ghpython_script_2 ----------
# 2D Tesselation generation
panel = Panel("4.8")
rectangle = Rectangle(Plane=PlaneXY(0, 0, 0), XSize=ghpython_script, YSize=ghpython_script_2, Radius=0)  # -> Rectangle, Length
relay = Relay(["8.4", panel])
curve = Curve(<curve referenced from the Rhino model>)
explode = Explode(Curve=curve, Recursive=True)  # -> Segments, Vertices
box_corners = BoxCorners(Box=curve)  # -> CornerA, CornerB, CornerC, CornerD, CornerE, CornerF, CornerG, CornerH
data_3 = Data(curve)
data_4 = Data(panel)
area = Area(Geometry=curve)  # -> Area, Centroid
curve_middle = CurveMiddle(Curve=explode.Segments)  # -> graft(Midpoint)
merge = Merge(Data1=box_corners.CornerA, Data2=box_corners.CornerB, Data3=box_corners.CornerC, Data4=box_corners.CornerD)  # -> graft(Result)
equality = Equality(FirstNumber=relay, SecondNumber=2.4)  # -> Equality, Inequality
line = Line(StartPoint=curve_middle, EndPoint=area.Centroid)  # -> flatten(Line)
explode_tree = ExplodeTree(Data=graft(equality.Equality))  # -> Branch0, Branch1
point = Point(merge)
flip_matrix = FlipMatrix(Data=line)
gate_or = GateOr(A=explode_tree.Branch0, B=explode_tree.Branch1)
replace_members = ReplaceMembers(Set=gate_or, Find=[True, False], Replace=[5, 6])
explode_tree_2 = ExplodeTree(Data=flip_matrix)  # -> Branch0, Branch1, Branch2, Branch3
# Feature point at support
explode_tree_3 = ExplodeTree(Data=merge)  # -> Branch0, Branch1, Branch2, Branch3
# Rectengular grid
explode_tree_4 = ExplodeTree(Data=curve_middle)  # -> Branch0, Branch1, Branch2, Branch3
line_count = Slider(20, range=0..20)
line_2 = Line(StartPoint=explode_tree_4.Branch0, EndPoint=box_corners.CornerA)  # -> flatten(Line)
line_3 = Line(StartPoint=explode_tree_4.Branch3, EndPoint=box_corners.CornerA)  # -> flatten(Line)
line_4 = Line(StartPoint=box_corners.CornerA, EndPoint=area.Centroid)  # -> flatten(Line)
line_5 = Line(StartPoint=explode_tree_4.Branch0, EndPoint=box_corners.CornerB)  # -> flatten(Line)
line_6 = Line(StartPoint=explode_tree_4.Branch1, EndPoint=box_corners.CornerB)  # -> flatten(Line)
line_7 = Line(StartPoint=box_corners.CornerB, EndPoint=area.Centroid)  # -> flatten(Line)
line_8 = Line(StartPoint=explode_tree_4.Branch1, EndPoint=box_corners.CornerC)  # -> flatten(Line)
line_9 = Line(StartPoint=box_corners.CornerC, EndPoint=explode_tree_4.Branch2)  # -> flatten(Line)
line_10 = Line(StartPoint=box_corners.CornerC, EndPoint=area.Centroid)  # -> flatten(Line)
line_11 = Line(StartPoint=explode_tree_4.Branch2, EndPoint=box_corners.CornerD)  # -> flatten(Line)
line_12 = Line(StartPoint=box_corners.CornerD, EndPoint=explode_tree_4.Branch3)  # -> flatten(Line)
line_13 = Line(StartPoint=box_corners.CornerD, EndPoint=area.Centroid)  # -> flatten(Line)
divide_curve = DivideCurve(Curve=explode_tree_2.Branch0, Count=replace_members, Kinks=False)  # -> Points, Tangents, Parameters
divide_curve_2 = DivideCurve(Curve=explode_tree_2.Branch1, Count=replace_members, Kinks=False)  # -> Points, Tangents, Parameters
divide_curve_3 = DivideCurve(Curve=explode_tree_2.Branch2, Count=replace_members, Kinks=False)  # -> Points, Tangents, Parameters
divide_curve_4 = DivideCurve(Curve=explode_tree_2.Branch3, Count=replace_members, Kinks=False)  # -> Points, Tangents, Parameters
merge_2 = Merge(Data1=divide_curve.Points, Data2=divide_curve_4.Points)  # -> flatten(Result)
merge_3 = Merge(Data1=divide_curve.Points, Data2=divide_curve_2.Points)  # -> flatten(Result)
merge_4 = Merge(Data1=divide_curve_3.Points, Data2=divide_curve_2.Points)  # -> flatten(Result)
merge_5 = Merge(Data1=divide_curve_3.Points, Data2=divide_curve_4.Points)  # -> flatten(Result)
divide_curve_5 = DivideCurve(Curve=[line_2, line_3, line_4], Count=line_count, Kinks=False)  # -> Points, Tangents, Parameters
divide_curve_6 = DivideCurve(Curve=[line_5, line_6, line_7], Count=line_count, Kinks=False)  # -> Points, Tangents, Parameters
divide_curve_7 = DivideCurve(Curve=[line_8, line_9, line_10], Count=line_count, Kinks=False)  # -> Points, Tangents, Parameters
divide_curve_8 = DivideCurve(Curve=[line_11, line_12, line_13], Count=line_count, Kinks=False)  # -> Points, Tangents, Parameters
explode_tree_5 = ExplodeTree(Data=divide_curve_5.Points)  # -> Branch0, Branch1, Branch2
explode_tree_6 = ExplodeTree(Data=divide_curve_6.Points)  # -> Branch0, Branch1, Branch2
explode_tree_7 = ExplodeTree(Data=divide_curve_7.Points)  # -> Branch0, Branch1, Branch2
explode_tree_8 = ExplodeTree(Data=divide_curve_8.Points)  # -> Branch0, Branch1, Branch2
line_14 = Line(StartPoint=explode_tree_5.Branch0, EndPoint=reverse(explode_tree_5.Branch2))  # -> flatten(Line)
line_15 = Line(StartPoint=explode_tree_5.Branch1, EndPoint=reverse(explode_tree_5.Branch2))  # -> flatten(Line)
line_16 = Line(StartPoint=explode_tree_6.Branch0, EndPoint=reverse(explode_tree_6.Branch2))  # -> flatten(Line)
line_17 = Line(StartPoint=explode_tree_6.Branch1, EndPoint=reverse(explode_tree_6.Branch2))  # -> flatten(Line)
line_18 = Line(StartPoint=explode_tree_7.Branch0, EndPoint=reverse(explode_tree_7.Branch2))  # -> flatten(Line)
line_19 = Line(StartPoint=explode_tree_8.Branch0, EndPoint=reverse(explode_tree_8.Branch2))  # -> flatten(Line)
line_20 = Line(StartPoint=explode_tree_3.Branch0, EndPoint=merge_2)
line_21 = Line(StartPoint=explode_tree_3.Branch1, EndPoint=merge_3)
line_22 = Line(StartPoint=explode_tree_3.Branch2, EndPoint=merge_4)
line_23 = Line(StartPoint=explode_tree_3.Branch3, EndPoint=merge_5)
line_24 = Line(StartPoint=explode_tree_7.Branch1, EndPoint=explode_tree_7.Branch2)  # -> flatten(Line)
line_25 = Line(StartPoint=explode_tree_8.Branch1, EndPoint=explode_tree_8.Branch2)  # -> flatten(Line)
point_2 = Point(explode_tree_5.Branch1)
point_3 = Point(explode_tree_6.Branch0)
point_4 = Point(explode_tree_8.Branch0)
point_5 = Point(explode_tree_8.Branch1)
point_6 = Point(explode_tree_5.Branch0)
point_7 = Point(explode_tree_6.Branch1)
point_8 = Point(explode_tree_7.Branch1)
point_9 = Point(explode_tree_7.Branch0)
line_26 = Line([line_25, line_19, line_14, line_15, line_16, line_17, line_18, line_24])
connection_point_support = Relay([line_20, line_21, line_22, line_23])
connection_vault_x = Relay([point_6, point_3, point_8, point_4])
connection_vault_y = Relay([point_2, point_7, point_9, point_5])
point_10 = Point(point)
line_27 = Line(line_26)
point_11 = Point(connection_vault_x)
point_12 = Point(connection_vault_y)
line_28 = Line(connection_point_support)
point_13 = Point(box_corners.CornerD)
data_5 = Data([line_28, line_27])
data_6 = Data(point_11)
data_7 = Data(point_12)
data_8 = Data(point_10)
point_14 = Point(point_13)
unit_z = UnitZ(Factor=Slider(2.4, range=0..10))
# Definition of springs / mesh
line_line_intersection_karamba3d = LineLineIntersectionKaramba3D(Line=flatten(data_5), LengthTolerance=0.01)  # -> IntersectionPoints, flatten(LineSubSegements)
move = Move(Geometry=point_14, Motion=unit_z)  # -> Geometry, Transform
# Definition of 1 way constrains
# Use if required by 2d topology
remove_duplicate_lines_karamba3d = RemoveDuplicateLinesKaramba3D(Line=line_line_intersection_karamba3d.LineSubSegements, LimitDistance=0.005)  # -> OutLine, Info, Indexes
weaverbird_s_mesh_from_lines_weave_back = WeaverbirdsMeshFromLinesWeaveBack(Lines=remove_duplicate_lines_karamba3d.OutLine, MaximumValence=4)
mesh = Mesh(weaverbird_s_mesh_from_lines_weave_back)
deconstruct_mesh = DeconstructMesh(Mesh=mesh)  # -> Vertices, Faces, Colours, Normals
meshcorners = MeshCorners(Mesh=mesh, Angle=2.35619449)
curve_2 = Curve(<curve referenced from the Rhino model>)
list_item = ListItem(List=meshcorners, Index=0, Wrap=True)  # -> Item2, Item1, Item, Item1_2
curve_closest_point = CurveClosestPoint(Point=deconstruct_mesh.Vertices, Curve=curve_2)  # -> Point, Parameter, Distance
evaluate = Evaluate(Expression="If(x<0.001, true, false)", x=curve_closest_point.Distance)
anchorxyz = AnchorXYZ(Point=flatten(data_6), X=False, Y=True, Z=False, Strength=1000)  # disabled
anchorxyz_2 = AnchorXYZ(Point=flatten(data_7), X=True, Y=False, Z=False, Strength=1000)  # disabled
# Definition of support
anchor = Anchor(Point=data_8, Strength=100000)
vertexloads = VertexLoads(Mesh=weaverbird_s_mesh_from_lines_weave_back, Strength=0.1)
panel_2 = Panel(evaluate)
cull_pattern = CullPattern(List=deconstruct_mesh.Vertices, CullPattern=evaluate)
unit_z_2 = UnitZ(Factor=Slider(-0.2, range=-1..0))
anchorxyz_3 = AnchorXYZ(Point=cull_pattern, X=True, Y=True, Z=False, Strength="10000")
# 3 corner
# elevated corner
anchor_2 = Anchor(Point=[list_item.Item1_2, list_item.Item2, list_item.Item1, list_item.Item], Strength=10000)
vertexloads_2 = VertexLoads(Mesh=mesh, Strength=unit_z_2)
null_item = NullItem()  # -> NullFlags, InvalidFlags, Description
dispatch = Dispatch(DispatchPattern=null_item.NullFlags)  # -> ListA, ListB
weaverbird_s_mesh_from_lines_weave_back_2 = WeaverbirdsMeshFromLinesWeaveBack(Lines=dispatch.ListB, MaximumValence=4)
mesh_edges = MeshEdges(Mesh=weaverbird_s_mesh_from_lines_weave_back_2)  # -> NakedEdges, InteriorEdges, NonManifoldEdges
xy_plane = XYPlane(Origin=Point(0, 0, 0))
maximal_shell_thickness_cm = Slider(200, range=0..200)
height_of_bricks_cm = Slider(9, range=0..10)
shell_cross_section_name = Panel("Shell Cross section")
distributed_vertical_load_kn_m2 = Panel("2.25")
young_modulus_n_mm2 = Panel("211")
poisson_ratio = Panel("0.3")
specific_weight_kg_m3 = Panel("1452")
compressive_strenght_n_mm2 = Panel("3")
material_adobe = Panel("adobe sucrum test")
name = Panel("shell")
data_9 = Data(shell_cross_section_name)
data_10 = Data(maximal_shell_thickness_cm)
data_11 = Data(height_of_bricks_cm)
data_12 = Data(name)
data_13 = Data(young_modulus_n_mm2)
data_14 = Data(specific_weight_kg_m3)
data_15 = Data(compressive_strenght_n_mm2)
data_16 = Data(distributed_vertical_load_kn_m2)
data_17 = Data(name)
data_18 = Data(material_adobe)
data_19 = Data(poisson_ratio)
data_20 = Data(specific_weight_kg_m3)
ghpython_script_3 = GhPythonScript(e_modulus=data_13, poission_ratio=data_19)  # -> shear_modulus; inputs e_modulus: Int32, poission_ratio: Int32
# ---------- ghpython_script_3: Python ----------
__author__ = "kees_"
__version__ = "2019.10.08"

import rhinoscriptsyntax as rs

# 4.	calculation of shear modulus according to [Landau LD, Lifshitz EM. Theory of Elasticity, vol. 7. Course of Theoretical Physics. (2nd Ed) Pergamon: Oxford 1970 p13]

a = int(poission_ratio)
b = int(e_modulus)

shear_modulus = b/(2*(1+a))
# ---------- end ghpython_script_3 ----------
division = Division(A=data_20, B=100)
material_properties_karamba3d = MaterialPropertiesKaramba3D(
    FamilyOfMaterial=data_18,
    Name=data_18,
    ElementIdentifier=data_12,
    YoungsModulus_kN_cm2=expr("x*0.1", data_13),
    InPlaneShearModulus_kN_cm2=expr("x*0.1", ghpython_script_3),
    TransverseShearModulus_kN_cm2=expr("x*0.1", ghpython_script_3),
    SpecificWeight_kN_m3=expr("x*0.012", data_14),
    CoefficientOfThermalExpansion_1_C=1e-05,
    YieldStrength_kN_cm2=expr("x*0.1", data_15),
    mode="Isotrop")
Z = UnitZ(Factor=expr("x*1.5", -1))
loads_karamba3d = LoadsKaramba3D(Vector=Z, LCase=0, mode="Gravity")
data_21 = Data(loads_karamba3d)
data_22 = Data(material_properties_karamba3d)
# Definition of Material properties
data_23 = Data(data_22)
# Optimalisation of shell thickness
data_24 = Data(name)
panel_3 = Panel("""L S (house addition)(6,6)
2,11 parameters

L S  (Shop)(6,6)
4,37 parameters

L H (hallway)(5,5)
3,10 parameters
2,11 parameters
3,46 parameters
4,60 parameters


M S (Shop}(6,6)
2,16 parameters
2,22 parameters

M H (hallway) (5,5)
2,15 parameters
1,24 parameters

S S (Shop)(5,5)
1,52 parameters
2,17 parameters

S H {hallway}(5,5)
1,16 parameters
1,52 parameters""")
dome_dimension_m = Panel(data_3)
dome_width_m = Panel(data_4)
max_deflection_m = Panel("1/200")
data_25 = Data(max_deflection_m)
data_26 = Data(dome_width_m)
data_27 = Data(data_26)
data_28 = Data(data_25)
number = Number(expr("x*1000", data_27))
number_2 = Number(data_28)
multiplication = Multiplication(A=number, B=number_2)
data_29 = Data(multiplication)
# Optimalisation of shell thickness
data_30 = Data(data_29)
number_3 = Number(compressive_strenght_n_mm2)
min_number_of_stacked_bricks = Slider(3, range=1..4)
data_31 = Data(min_number_of_stacked_bricks)
min_number_of_stacked_bricks_2 = Panel(data_31)
data_32 = Data(min_number_of_stacked_bricks_2)
multiplication_2 = Multiplication(A=data_32, B=data_11)
construct_domain = ConstructDomain(DomainStart=multiplication_2, DomainEnd=data_10)
range = Range(Domain=construct_domain, Steps=data_11)
expression = Expression(x=data_9, y=range, Expression="x&\" \"&y")
cross_section_karamba3d = CrossSectionKaramba3D(
    FamilyNameOfCrossSection=data_9,
    NameOfCrossSection=flatten(expression),
    ElementIdentifier=data_17,
    Material=data_23,
    Height_cm=flatten(range),
    mode="Shell - Const")
data_33 = Data(cross_section_karamba3d)
spring_stiffness = Slider(10, range=10..60)
data_34 = Data(spring_stiffness)
edgelengths = EdgeLengths(Mesh=weaverbird_s_mesh_from_lines_weave_back, LengthFactor=1, Strength=expr("x/2", data_34))
zombiesolver = ZombieSolver(
    GoalObjects=flatten([anchor, anchorxyz, anchorxyz_2, edgelengths, vertexloads]),
    Threshold=1e-10,
    Tolerance=0.01,
    MaxIterations=50000)  # -> I, V, O; disabled
edgelengths_2 = EdgeLengths(Mesh=mesh, LengthFactor=1, Strength=spring_stiffness)
zombiesolver_2 = ZombieSolver(GoalObjects=[vertexloads_2, anchorxyz_3, edgelengths_2, anchor_2], Threshold=1e-10, Tolerance=0.01, MaxIterations=50000)  # -> I, V, O
curve_3 = Curve(flatten(zombiesolver_2.O))
weaverbird_s_mesh_from_lines_weave_back_3 = WeaverbirdsMeshFromLinesWeaveBack(Lines=curve_3, MaximumValence=4)
weaverbird_s_catmull_clark_subdivision = WeaverbirdsCatmullClarkSubdivision(
    MeshCurves=[weaverbird_s_mesh_from_lines_weave_back_3, weaverbird_s_mesh_from_lines_weave_back_2],
    Level=1,
    SmoothNakedEdges=0)
meshcorners_2 = MeshCorners(Mesh=weaverbird_s_catmull_clark_subdivision, Angle=2.35619449)
data_35 = Data(weaverbird_s_catmull_clark_subdivision)
point_15 = Point(meshcorners_2)
data_36 = Data(point_15)
data_37 = Data(data_35)
# Vertical loading
deconstruct_mesh_2 = DeconstructMesh(Mesh=data_37)  # -> Vertices, Faces, Colours, Normals
remove_duplicate_points_karamba3d = RemoveDuplicatePointsKaramba3D(Point=deconstruct_mesh_2.Vertices, LimitDistance=0.005)  # -> OutPoint, Info, Indexes
# Roof loading
# (added soil)
evaluate_box = EvaluateBox(Box=data_37, UParameter=0.5, VParameter=0.5, WParameter=1)  # -> Plane, Point, Include
convex_hull = ConvexHull(Points=remove_duplicate_points_karamba3d.OutPoint, Plane=PlaneXY(0, 0, 0))  # -> Hull, HullZ, Indices
deconstruct = Deconstruct(Point=remove_duplicate_points_karamba3d.OutPoint)  # -> XComponent, YComponent, ZComponent
deconstruct_2 = Deconstruct(Point=evaluate_box.Point)  # -> XComponent, YComponent, ZComponent
voronoi = Voronoi(Points=remove_duplicate_points_karamba3d.OutPoint, Boundary=convex_hull.Hull, Plane=xy_plane, BruteForceOverride=False)
construct_point = ConstructPoint(XCoordinate=0, YCoordinate=0, ZCoordinate=deconstruct.ZComponent)
construct_point_2 = ConstructPoint(XCoordinate=0, YCoordinate=0, ZCoordinate=deconstruct_2.ZComponent)
area_2 = Area(Geometry=voronoi)  # -> Area, Centroid
replace_nulls = ReplaceNulls(Items=area_2.Area, Replacements=0)  # -> Items, Count
distance = Distance(PointA=construct_point, PointB=construct_point_2)  # -> expr("x/2", Distance)
point_16 = Point(data_36)
number_4 = Number(distance)
number_5 = Number(replace_nulls.Items)
data_38 = Data(data_37)
point_17 = Point(remove_duplicate_points_karamba3d.OutPoint)
mesh_edges_2 = MeshEdges(Mesh=data_38)  # -> NakedEdges, InteriorEdges, NonManifoldEdges
data_39 = Data(data_37)
data_40 = Data(point_17)
# Definition of formfinding parameters
data_41 = Data(number_4)
data_42 = Data(number_5)
# Shape input
data_43 = Data(data_36)
number_6 = Number(data_42)
number_7 = Number(data_41)
point_18 = Point(data_40)
point_19 = Point(data_43)
mesh_2 = Mesh(data_39)
# Definition of Mesh and range of thickness
data_44 = Data(mesh_2)
# Definition of support points
data_45 = Data(point_19)
# Definition of forces
data_46 = Data(number_6)
data_47 = Data(point_18)
data_48 = Data(number_7)
multiplication_3 = Multiplication(A=data_46, B=data_16)
multiplication_4 = Multiplication(A=data_46, B=data_48)
multiplication_5 = Multiplication(A=multiplication_4, B=division)
addition = Addition(A=multiplication_3, B=multiplication_5)
supp = SupportKaramba(PosInd=data_45, PlaneOfReference=PlaneXY(0, 0, 0), menu=[buttons(on, on, on, off, off, off)])  # -> flatten(Support)
unit_z_3 = UnitZ(Factor=addition)
# Assembly of model
loads_karamba3d_2 = LoadsKaramba3D(ForceVector=unit_z_3, Local=False, PosInd=data_47, LCase=0, mode="Point")
meshtoshell = MeshToShellKaramba(Mesh=data_44, Identifier=data_17, CrossSection=cross_section_karamba3d, LimitDistance_m=0.005)  # -> Element, Points, Info
# Assembly of model
data_49 = Data(meshtoshell.Element)
data_50 = Data(supp)
data_51 = Data(loads_karamba3d_2)
# Optimalisation of shell thickness
assemble = AssembleModelKaramba(Elem=data_49, Support=flatten(data_50), Load=flatten([data_21, data_51]), LimitDistance_m=0.005)  # -> Model, Info, Mass_kg, CenterOfGravity
optimize_cross_section_karamba3d = OptimizeCrossSectionKaramba3D(
    Model=assemble.Model,
    ElemIdentifiers=data_24,
    CrossSections=data_33,
    MaximumUtilization=1,
    MaximumDisplacement_cm=data_30,
    UltimateLimitStateIterations=5,
    DisplacementIterations=5,
    NumberOfSamplePoints=3,
    ElasticDesign=True,
    GammaM0=1,
    GammaM1=1)  # -> ModelWithOptimizedCrossSections, Info, Mass_kg, MaximumDisplacement_cm, ElasticEnergy_kNm
# Karamba magic
# Karamba magic
# Karamba magic
analyze_karamba3d = AnalyzeKaramba3D(Model=optimize_cross_section_karamba3d.ModelWithOptimizedCrossSections)  # -> CalculatedModel, MaximumDisplacement_cm, ResultingForceOfGravity_kN, ElasticEnergy_kNm
data_52 = Data(analyze_karamba3d.CalculatedModel)
data_53 = Data(data_52)
model_view_karamba3d = ModelViewKaramba3D(Model=data_53, LoadCaseFactorsForLinearSuperposition=1, IndexOfVisibleLoadcase=-1)  # -> Model, DeformedMesh, DeformedAxes, DeformedModel
shellview = ShellViewKaramba(Model=model_view_karamba3d.Model, IndexOfLayer=0)  # -> Model, MeshesOfRenderedShells, LegendColors, LegendTags
shellview_2 = ShellViewKaramba(Model=model_view_karamba3d.Model, IndexOfLayer=0)  # -> Model, MeshesOfRenderedShells, LegendColors, LegendTags
shellview_3 = ShellViewKaramba(Model=model_view_karamba3d.Model, IndexOfLayer=0)  # -> Model, MeshesOfRenderedShells, LegendColors, LegendTags
reaction_forces_karamba3d = ReactionForcesKaramba3D(AnalyzedModel=model_view_karamba3d.Model, LoadCase=0)  # -> AnalyzedModel, ReactionForces_kN, ReactionMoments_kNm, SupportPosition, SumOfReactionForces_kN, SumOfReactionMoments_kNm
shellview_4 = ShellViewKaramba(Model=model_view_karamba3d.Model, IndexOfLayer=0)  # -> Model, MeshesOfRenderedShells, LegendColors, LegendTags
nodedisp = NodalDisplacementsKaramba(AnalyzedModel=model_view_karamba3d.Model, LoadCase=0)  # -> AnalyzedModel, NodalTranslations_m, NodalRotations_rad
last_index = LastIndex(List=shellview.LegendTags)
last_index_2 = LastIndex(List=shellview_2.LegendTags)
mesh_3 = Mesh(shellview.MeshesOfRenderedShells)
last_index_3 = LastIndex(List=shellview_3.LegendTags)
pdecon = Deconstruct(Point=nodedisp.NodalTranslations_m)  # -> XComponent, YComponent, expr("x*1000", ZComponent)
mesh_4 = Mesh(shellview_2.MeshesOfRenderedShells)
multiplication_6 = Multiplication(A=shellview.LegendTags, B=10)
multiplication_7 = Multiplication(A=shellview_2.LegendTags, B=10)
multiplication_8 = Multiplication(A=shellview_3.LegendTags, B=10)
cull_index = CullIndex(List=multiplication_6, Indices=flatten(last_index), Wrap=True)
cull_index_2 = CullIndex(List=multiplication_7, Indices=flatten(last_index_2), Wrap=True)
cull_index_3 = CullIndex(List=multiplication_8, Indices=flatten(last_index_3), Wrap=True)
absolute = Absolute(Value=pdecon.ZComponent)
shellview_5 = ShellViewKaramba(Model=shellview_4.Model, IndexOfLayer=0)  # -> Model, MeshesOfRenderedShells, LegendColors, LegendTags
split_list = SplitList(List=cull_index, Index=1)  # -> ListA, ListB
split_list_2 = SplitList(List=cull_index_2, Index=1)  # -> ListA, ListB
split_list_3 = SplitList(List=cull_index_3, Index=1)  # -> ListA, ListB
list_item_2 = ListItem(List=reaction_forces_karamba3d.ReactionForces_kN, Index=0, Wrap=True)
bounds = Bounds(Numbers=split_list.ListB)
bounds_2 = Bounds(Numbers=absolute)
bounds_3 = Bounds(Numbers=split_list_2.ListB)
bounds_4 = Bounds(Numbers=split_list_3.ListB)
shellview_6 = ShellViewKaramba(Model=shellview_5.Model, IndexOfLayer=0)  # -> Model, MeshesOfRenderedShells, LegendColors, LegendTags
deconstruct_3 = Deconstruct(Point=list_item_2)  # -> XComponent, YComponent, ZComponent
deconstruct_domain = DeconstructDomain(Domain=bounds)  # -> Start, End
deconstruct_domain_2 = DeconstructDomain(Domain=bounds_2)  # -> Start, End
deconstruct_domain_3 = DeconstructDomain(Domain=bounds_3)  # -> Start, End
deconstruct_domain_4 = DeconstructDomain(Domain=bounds_4)  # -> Start, End
data_54 = Data(flatten(deconstruct_3.XComponent))
data_55 = Data(flatten(deconstruct_3.YComponent))
data_56 = Data(flatten(deconstruct_domain.End))
data_57 = Data(flatten(deconstruct_domain_4.End))
data_58 = Data(flatten(deconstruct_3.ZComponent))
data_59 = Data(flatten(shellview_6.LegendColors))
data_60 = Data(flatten(shellview_6.LegendTags))
data_61 = Data(flatten(shellview_5.LegendColors))
data_62 = Data(flatten(shellview_5.LegendTags))
data_63 = Data(flatten(shellview_4.LegendTags))
data_64 = Data(flatten(shellview_4.MeshesOfRenderedShells))
data_65 = Data(flatten(deconstruct_domain_2.End))
data_66 = Data(flatten(deconstruct_domain_3.Start))
data_67 = Data(flatten(deconstruct_domain_3.End))
data_68 = Data(flatten(deconstruct_domain.Start))
data_69 = Data(flatten(shellview_4.LegendColors))
legend = Legend(Colour=data_59, Tags=data_60, LegendType=1)
legend_2 = Legend(Colour=data_61, Tags=data_62, LegendType=1)
legend_3 = Legend(Colour=data_69, Tags=data_63, LegendType=1)
z_vertical_resultant_force_kn = Panel(data_58)
x_horizontal_resultant_force_kn = Panel(data_54)
y_horizontal_resultant_force_kn = Panel(data_55)
max_compression_stress_p2_n_mm2 = Panel(data_68)
max_compression_stress_p1_n_mm2 = Panel(data_66)
max_tensile_stress_p1_n_mm2 = Panel(data_67)
max_tensile_stress_p2_n_mm2 = Panel(data_56)
max_displacement_mm = Panel(data_65)
data_70 = Data(max_displacement_mm)
data_71 = Data(max_tensile_stress_p1_n_mm2)
data_72 = Data(max_compression_stress_p1_n_mm2)
data_73 = Data(max_compression_stress_p2_n_mm2)
data_74 = Data(max_tensile_stress_p2_n_mm2)
data_75 = Data(data_72)
data_76 = Data(data_73)
data_77 = Data(data_74)
data_78 = Data(data_70)
data_79 = Data(data_71)
absolute_2 = Absolute(Value=[data_75, data_76])
absolute_3 = Absolute(Value=[data_79, data_77])
number_8 = Number(data_78)
sort_list = SortList(Keys=absolute_2)  # -> Keys, ValuesValuesA
sort_list_2 = SortList(Keys=absolute_3)  # -> Keys, ValuesValuesA
list_item_3 = ListItem(List=sort_list.Keys, Index=1, Wrap=True)
list_item_4 = ListItem(List=sort_list_2.Keys, Index=1, Wrap=True)
number_9 = Number(list_item_4)
expression_2 = Expression(x=number_9, y=number_3, Expression="x>y/10")
expression_3 = Expression(x=list_item_3, y=number_3, Expression="x<-y")
expression_4 = Expression(x=multiplication, y=number_8, Expression="x<y")
merge_6 = Merge(Data1=expression_4, Data2=expression_3, Data3=expression_2)
mass_addition = MassAddition(Input=merge_6)  # -> Result, PartialResults
addition_2 = Addition(A=mass_addition.Result, B=list_item_4)
maximum_compression_n_mm2 = Number(list_item_3)
maximal_tension_n_mm2 = Number(number_9)
maximal_deflection_mm = Number(number_8)
opossum = Opossum(
    OpossumData_NumberOfObjectives=1,
    OpossumData_OptimizationType=0,
    OpossumData_ResultSerializationStatus=1,
    OpossumData_ObjectiveValue=[3.96, 1.391, 1.818, 3.84, 1.329, 1.368, 1.331, 1.355, 1.381, 1.367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],
    OpossumData_ParameterList=["1,16", "4,51", "2,35", "1,60", "4,26", "4,43", "4,31", "4,35", "4,47", "4,39"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],
    OpossumData_objective=addition_2,
    OpossumData_variable=[min_number_of_stacked_bricks, spring_stiffness])

imput_shopsize_3 = Panel("s")  # disabled
imput_shop_hallway_3 = Panel("shop")  # disabled

data_80 = Data(imput_shopsize)
data_81 = Data(imput_shop_hallway)

data_82 = Data(imput_shopsize_3)  # disabled
data_83 = Data(imput_shop_hallway_3)  # disabled
ghpython_script_4 = GhPythonScript(width=data_83)  # -> width_of_shop; disabled; same code as ghpython_script_2
# 2D Tesselation generation
ghpython_script_5 = GhPythonScript(shop_size=data_82)  # -> width_of_shop; disabled; same code as ghpython_script
rectangle_2 = Rectangle(Plane=PlaneXY(0, 0, 0), XSize=ghpython_script_5, YSize=ghpython_script_4, Radius=0)  # -> Rectangle, Length; disabled
relay_2 = Relay([ghpython_script_4, ghpython_script_5])  # disabled
curve_4 = Curve(<curve referenced from the Rhino model>)  # disabled
explode_2 = Explode(Curve=rectangle_2.Rectangle, Recursive=True)  # -> Segments, Vertices; disabled
box_corners_2 = BoxCorners(Box=rectangle_2.Rectangle)  # -> CornerA, CornerB, CornerC, CornerD, CornerE, CornerF, CornerG, CornerH; disabled
data_84 = Data(rectangle_2.Rectangle)  # disabled
data_85 = Data(ghpython_script_5)  # disabled
area_3 = Area(Geometry=rectangle_2.Rectangle)  # -> Area, Centroid; disabled
curve_middle_2 = CurveMiddle(Curve=explode_2.Segments)  # -> graft(Midpoint); disabled
merge_7 = Merge(Data1=box_corners_2.CornerA, Data2=box_corners_2.CornerB, Data3=box_corners_2.CornerC, Data4=box_corners_2.CornerD)  # -> graft(Result); disabled
equality_2 = Equality(FirstNumber=relay_2, SecondNumber=2.4)  # -> Equality, Inequality; disabled
line_29 = Line(StartPoint=curve_middle_2, EndPoint=area_3.Centroid)  # -> flatten(Line); disabled
explode_tree_9 = ExplodeTree(Data=graft(equality_2.Equality))  # -> Branch0, Branch1; disabled
point_20 = Point(merge_7)  # disabled
flip_matrix_2 = FlipMatrix(Data=line_29)  # disabled
gate_or_2 = GateOr(A=explode_tree_9.Branch0, B=explode_tree_9.Branch1)  # disabled
replace_members_2 = ReplaceMembers(Set=gate_or_2, Find=[True, False], Replace=[5, 6])  # disabled
explode_tree_10 = ExplodeTree(Data=flip_matrix_2)  # -> Branch0, Branch1, Branch2, Branch3; disabled
# Feature point at support
explode_tree_11 = ExplodeTree(Data=merge_7)  # -> Branch0, Branch1, Branch2, Branch3; disabled
# Rectengular grid
explode_tree_12 = ExplodeTree(Data=curve_middle_2)  # -> Branch0, Branch1, Branch2, Branch3; disabled
line_count_2 = Slider(20, range=0..20)  # disabled
line_30 = Line(StartPoint=explode_tree_12.Branch0, EndPoint=box_corners_2.CornerA)  # -> flatten(Line); disabled
line_31 = Line(StartPoint=explode_tree_12.Branch3, EndPoint=box_corners_2.CornerA)  # -> flatten(Line); disabled
line_32 = Line(StartPoint=box_corners_2.CornerA, EndPoint=area_3.Centroid)  # -> flatten(Line); disabled
line_33 = Line(StartPoint=explode_tree_12.Branch0, EndPoint=box_corners_2.CornerB)  # -> flatten(Line); disabled
line_34 = Line(StartPoint=explode_tree_12.Branch1, EndPoint=box_corners_2.CornerB)  # -> flatten(Line); disabled
line_35 = Line(StartPoint=box_corners_2.CornerB, EndPoint=area_3.Centroid)  # -> flatten(Line); disabled
line_36 = Line(StartPoint=explode_tree_12.Branch1, EndPoint=box_corners_2.CornerC)  # -> flatten(Line); disabled
line_37 = Line(StartPoint=box_corners_2.CornerC, EndPoint=explode_tree_12.Branch2)  # -> flatten(Line); disabled
line_38 = Line(StartPoint=box_corners_2.CornerC, EndPoint=area_3.Centroid)  # -> flatten(Line); disabled
line_39 = Line(StartPoint=explode_tree_12.Branch2, EndPoint=box_corners_2.CornerD)  # -> flatten(Line); disabled
line_40 = Line(StartPoint=box_corners_2.CornerD, EndPoint=explode_tree_12.Branch3)  # -> flatten(Line); disabled
line_41 = Line(StartPoint=box_corners_2.CornerD, EndPoint=area_3.Centroid)  # -> flatten(Line); disabled
divide_curve_9 = DivideCurve(Curve=explode_tree_10.Branch0, Count=replace_members_2, Kinks=False)  # -> Points, Tangents, Parameters; disabled
divide_curve_10 = DivideCurve(Curve=explode_tree_10.Branch1, Count=replace_members_2, Kinks=False)  # -> Points, Tangents, Parameters; disabled
divide_curve_11 = DivideCurve(Curve=explode_tree_10.Branch2, Count=replace_members_2, Kinks=False)  # -> Points, Tangents, Parameters; disabled
divide_curve_12 = DivideCurve(Curve=explode_tree_10.Branch3, Count=replace_members_2, Kinks=False)  # -> Points, Tangents, Parameters; disabled
merge_8 = Merge(Data1=divide_curve_9.Points, Data2=divide_curve_12.Points)  # -> flatten(Result); disabled
merge_9 = Merge(Data1=divide_curve_9.Points, Data2=divide_curve_10.Points)  # -> flatten(Result); disabled
merge_10 = Merge(Data1=divide_curve_11.Points, Data2=divide_curve_10.Points)  # -> flatten(Result); disabled
merge_11 = Merge(Data1=divide_curve_11.Points, Data2=divide_curve_12.Points)  # -> flatten(Result); disabled
divide_curve_13 = DivideCurve(Curve=[line_30, line_31, line_32], Count=line_count_2, Kinks=False)  # -> Points, Tangents, Parameters; disabled
divide_curve_14 = DivideCurve(Curve=[line_33, line_34, line_35], Count=line_count_2, Kinks=False)  # -> Points, Tangents, Parameters; disabled
divide_curve_15 = DivideCurve(Curve=[line_36, line_37, line_38], Count=line_count_2, Kinks=False)  # -> Points, Tangents, Parameters; disabled
divide_curve_16 = DivideCurve(Curve=[line_39, line_40, line_41], Count=line_count_2, Kinks=False)  # -> Points, Tangents, Parameters; disabled
explode_tree_13 = ExplodeTree(Data=divide_curve_13.Points)  # -> Branch0, Branch1, Branch2; disabled
explode_tree_14 = ExplodeTree(Data=divide_curve_14.Points)  # -> Branch0, Branch1, Branch2; disabled
explode_tree_15 = ExplodeTree(Data=divide_curve_15.Points)  # -> Branch0, Branch1, Branch2; disabled
explode_tree_16 = ExplodeTree(Data=divide_curve_16.Points)  # -> Branch0, Branch1, Branch2; disabled
line_42 = Line(StartPoint=explode_tree_13.Branch0, EndPoint=reverse(explode_tree_13.Branch2))  # -> flatten(Line); disabled
line_43 = Line(StartPoint=explode_tree_13.Branch1, EndPoint=reverse(explode_tree_13.Branch2))  # -> flatten(Line); disabled
line_44 = Line(StartPoint=explode_tree_14.Branch0, EndPoint=reverse(explode_tree_14.Branch2))  # -> flatten(Line); disabled
line_45 = Line(StartPoint=explode_tree_14.Branch1, EndPoint=reverse(explode_tree_14.Branch2))  # -> flatten(Line); disabled
line_46 = Line(StartPoint=explode_tree_15.Branch0, EndPoint=reverse(explode_tree_15.Branch2))  # -> flatten(Line); disabled
line_47 = Line(StartPoint=explode_tree_16.Branch0, EndPoint=reverse(explode_tree_16.Branch2))  # -> flatten(Line); disabled
line_48 = Line(StartPoint=explode_tree_11.Branch0, EndPoint=merge_8)  # disabled
line_49 = Line(StartPoint=explode_tree_11.Branch1, EndPoint=merge_9)  # disabled
line_50 = Line(StartPoint=explode_tree_11.Branch2, EndPoint=merge_10)  # disabled
line_51 = Line(StartPoint=explode_tree_11.Branch3, EndPoint=merge_11)  # disabled
line_52 = Line(StartPoint=explode_tree_15.Branch1, EndPoint=explode_tree_15.Branch2)  # -> flatten(Line); disabled
line_53 = Line(StartPoint=explode_tree_16.Branch1, EndPoint=explode_tree_16.Branch2)  # -> flatten(Line); disabled
point_21 = Point(explode_tree_13.Branch1)  # disabled
point_22 = Point(explode_tree_14.Branch0)  # disabled
point_23 = Point(explode_tree_15.Branch1)  # disabled
point_24 = Point(explode_tree_16.Branch0)  # disabled
point_25 = Point(explode_tree_16.Branch1)  # disabled
point_26 = Point(explode_tree_13.Branch0)  # disabled
point_27 = Point(explode_tree_14.Branch1)  # disabled
point_28 = Point(explode_tree_15.Branch0)  # disabled
# 11/22/2019
line_54 = Line([line_53, line_47, line_42, line_43, line_44, line_45, line_46, line_52])  # disabled
connection_point_support_2 = Relay([line_48, line_49, line_50, line_51])  # disabled
connection_vault_x_2 = Relay([point_26, point_22, point_23, point_24])  # disabled
connection_vault_y_2 = Relay([point_21, point_27, point_28, point_25])  # disabled
point_29 = Point(connection_vault_x_2)  # disabled
line_55 = Line(connection_point_support_2)  # disabled
point_30 = Point(point_20)  # disabled
line_56 = Line(line_54)  # disabled
point_31 = Point(connection_vault_y_2)  # disabled
data_86 = Data([line_55, line_56])  # disabled
# Kangeroo form finding
data_87 = Data(point_30)  # disabled
data_88 = Data(point_29)  # disabled
data_89 = Data(point_31)  # disabled
# Definition of springs / mesh
line_line_intersection_karamba3d_2 = LineLineIntersectionKaramba3D(Line=flatten(data_86), LengthTolerance=0.01)  # -> IntersectionPoints, flatten(LineSubSegements); disabled
# Definition of 1 way constrains
# Use if required by 2d topology
remove_duplicate_lines_karamba3d_2 = RemoveDuplicateLinesKaramba3D(Line=line_line_intersection_karamba3d_2.LineSubSegements, LimitDistance=0.005)  # -> OutLine, Info, Indexes; disabled
weaverbird_s_mesh_from_lines_weave_back_4 = WeaverbirdsMeshFromLinesWeaveBack(Lines=remove_duplicate_lines_karamba3d_2.OutLine, MaximumValence=4)  # disabled
anchorxyz_4 = AnchorXYZ(Point=flatten(data_88), X=False, Y=True, Z=False, Strength=1000)  # disabled
anchorxyz_5 = AnchorXYZ(Point=flatten(data_89), X=True, Y=False, Z=False, Strength=1000)  # disabled
# Definition of support
anchor_3 = Anchor(Point=data_87, Strength=100000)  # disabled
vertexloads_3 = VertexLoads(Mesh=weaverbird_s_mesh_from_lines_weave_back_4, Strength=0.1)  # disabled
point_32 = Point(data_87)  # disabled
# Definition of Forces
data_90 = Data(point_32)  # disabled
xy_plane_2 = XYPlane(Origin=Point(0, 0, 0))  # disabled
point_33 = Point(data_90)  # disabled
# Calculation FEM using karamba
# Shape input
data_91 = Data(data_90)  # disabled
maximal_shell_thickness_cm_2 = Slider(200, range=0..200)  # disabled
height_of_bricks_cm_2 = Slider(9, range=0..10)  # disabled
shell_cross_section_name_2 = Panel("Shell Cross section")  # disabled
# Young Modulus research paper: https://dspace.cvut.cz/bitstream/handle/10467/69500/F1-BP-2017-Gubasheva-Samal-priloha-ADOBE%20AS%20A%20BUILDING%20MATERIAL.%20pdf.pdf?sequence=3&isAllowed=y
distributed_vertical_load_kn_m2_2 = Panel("2.25")  # disabled
young_modulus_n_mm2_2 = Panel("211")  # disabled
poisson_ratio_2 = Panel("0.3")  # disabled
specific_weight_kg_m3_2 = Panel("1452")  # disabled
compressive_strenght_n_mm2_2 = Panel("3")  # disabled
material_adobe_2 = Panel("adobe sucrum test")  # disabled

young_modulus_n_mm2_3 = Panel("211")
poisson_ratio_3 = Panel("0.3")
specific_weight_kg_m3_3 = Panel("1452")
compressive_strenght_n_mm2_3 = Panel("3")
material_adobe_3 = Panel("adobe sucrum test")

name_2 = Panel("shell")  # disabled
point_34 = Point(data_91)  # disabled
data_92 = Data(shell_cross_section_name_2)  # disabled
data_93 = Data(maximal_shell_thickness_cm_2)  # disabled
data_94 = Data(height_of_bricks_cm_2)  # disabled
data_95 = Data(name_2)  # disabled
data_96 = Data(young_modulus_n_mm2_2)  # disabled
data_97 = Data(compressive_strenght_n_mm2_2)  # disabled
data_98 = Data(distributed_vertical_load_kn_m2_2)  # disabled
data_99 = Data(name_2)  # disabled
data_100 = Data(material_adobe_2)  # disabled
data_101 = Data(poisson_ratio_2)  # disabled
data_102 = Data(specific_weight_kg_m3_2)  # disabled
# Definition of support points
data_103 = Data(point_34)  # disabled
data_104 = Data(specific_weight_kg_m3_2)  # disabled
ghpython_script_6 = GhPythonScript(e_modulus=data_96, poission_ratio=data_101)  # -> shear_modulus; inputs e_modulus: Int32, poission_ratio: Int32; disabled; same code as ghpython_script_3
division_2 = Division(A=data_104, B=100)  # disabled
material_properties_karamba3d_2 = MaterialPropertiesKaramba3D(
    FamilyOfMaterial=data_100,
    Name=data_100,
    ElementIdentifier=data_95,
    YoungsModulus_kN_cm2=expr("x*0.1", data_96),
    InPlaneShearModulus_kN_cm2=expr("x*0.1", ghpython_script_6),
    TransverseShearModulus_kN_cm2=expr("x*0.1", ghpython_script_6),
    SpecificWeight_kN_m3=expr("x*0.012", data_102),
    CoefficientOfThermalExpansion_1_C=1e-05,
    YieldStrength_kN_cm2=expr("x*0.1", data_97),
    mode="Isotrop")  # disabled
supp_2 = SupportKaramba(PosInd=data_103, PlaneOfReference=PlaneXY(0, 0, 0), menu=[buttons(on, on, on, off, off, off)])  # -> flatten(Support); disabled
Z_2 = UnitZ(Factor=expr("x*1.5", -1))  # disabled
loads_karamba3d_3 = LoadsKaramba3D(Vector=Z_2, LCase=0, mode="Gravity")  # disabled
data_105 = Data(supp_2)  # disabled
data_106 = Data(loads_karamba3d_3)  # disabled
data_107 = Data(material_properties_karamba3d_2)  # disabled
# Definition of Material properties
data_108 = Data(data_107)  # disabled
data_109 = Data(name_2)  # disabled
panel_4 = Panel("""L S (house addition)(6,6)
2,11 parameters

L S  (Shop)(6,6)
4,37 parameters

L H (hallway)(5,5)
3,10 parameters
2,11 parameters
3,46 parameters
4,60 parameters


M S (Shop}(6,6)
2,16 parameters
2,22 parameters

M H (hallway) (5,5)
2,15 parameters
1,24 parameters

S S (Shop)(5,5)
1,52 parameters
2,17 parameters

S H {hallway}(5,5)
1,16 parameters
1,52 parameters""")  # disabled
# Definition of shell
# Material properties from test
# 11/23/2019
dome_dimension_m_2 = Panel(data_84)  # disabled
dome_width_m_2 = Panel(data_85)  # disabled
max_deflection_m_2 = Panel("1/200")  # disabled
# Supports
# Loads
data_110 = Data(dome_width_m_2)  # disabled
data_111 = Data(max_deflection_m_2)  # disabled
# Optimalisation
data_112 = Data(data_110)  # disabled
data_113 = Data(data_111)  # disabled
# UC checks of structure
number_10 = Number(expr("x*1000", data_112))  # disabled
number_11 = Number(data_113)  # disabled
multiplication_9 = Multiplication(A=number_10, B=number_11)  # disabled
data_114 = Data(multiplication_9)  # disabled
data_115 = Data(data_114)  # disabled
number_12 = Number(compressive_strenght_n_mm2_2)  # disabled
min_number_of_stacked_bricks_3 = Slider(2, range=1..4)  # disabled
data_116 = Data(min_number_of_stacked_bricks_3)  # disabled
min_number_of_stacked_bricks_4 = Panel(data_116)  # disabled
data_117 = Data(min_number_of_stacked_bricks_4)  # disabled
multiplication_10 = Multiplication(A=data_117, B=data_94)  # disabled
construct_domain_2 = ConstructDomain(DomainStart=multiplication_10, DomainEnd=data_93)  # disabled
range_2 = Range(Domain=construct_domain_2, Steps=data_94)  # disabled
expression_5 = Expression(x=data_92, y=range_2, Expression="x&\" \"&y")  # disabled
cross_section_karamba3d_2 = CrossSectionKaramba3D(
    FamilyNameOfCrossSection=data_92,
    NameOfCrossSection=flatten(expression_5),
    ElementIdentifier=data_99,
    Material=data_108,
    Height_cm=flatten(range_2),
    mode="Shell - Const")  # disabled
data_118 = Data(cross_section_karamba3d_2)  # disabled
# 11/23/2019
# Optimalisation values
spring_stiffness_2 = Slider(17, range=10..60)  # disabled
data_119 = Data(spring_stiffness_2)  # disabled
edgelengths_3 = EdgeLengths(Mesh=weaverbird_s_mesh_from_lines_weave_back_4, LengthFactor=1, Strength=expr("x/2", data_119))  # disabled
zombiesolver_3 = ZombieSolver(
    GoalObjects=flatten([anchor_3, anchorxyz_4, anchorxyz_5, edgelengths_3, vertexloads_3]),
    Threshold=1e-10,
    Tolerance=0.01,
    MaxIterations=50000)  # -> I, V, O; disabled
null_item_2 = NullItem(Item=zombiesolver_3.O)  # -> NullFlags, InvalidFlags, Description; disabled
dispatch_2 = Dispatch(List=zombiesolver_3.O, DispatchPattern=null_item_2.NullFlags)  # -> ListA, ListB; disabled
weaverbird_s_mesh_from_lines_weave_back_5 = WeaverbirdsMeshFromLinesWeaveBack(Lines=dispatch_2.ListB, MaximumValence=4)  # disabled
# 11/22/2019
weaverbird_s_catmull_clark_subdivision_2 = WeaverbirdsCatmullClarkSubdivision(MeshCurves=weaverbird_s_mesh_from_lines_weave_back_5, Level=1, SmoothNakedEdges=0)  # disabled
mesh_edges_3 = MeshEdges(Mesh=weaverbird_s_mesh_from_lines_weave_back_5)  # -> NakedEdges, InteriorEdges, NonManifoldEdges; disabled
data_120 = Data(weaverbird_s_catmull_clark_subdivision_2)  # disabled
data_121 = Data(data_120)  # disabled
# Vertical loading
deconstruct_mesh_3 = DeconstructMesh(Mesh=data_121)  # -> Vertices, Faces, Colours, Normals; disabled
remove_duplicate_points_karamba3d_2 = RemoveDuplicatePointsKaramba3D(Point=deconstruct_mesh_3.Vertices, LimitDistance=0.005)  # -> OutPoint, Info, Indexes; disabled
# Roof loading
# (added soil)
evaluate_box_2 = EvaluateBox(Box=data_121, UParameter=0.5, VParameter=0.5, WParameter=1)  # -> Plane, Point, Include; disabled
convex_hull_2 = ConvexHull(Points=remove_duplicate_points_karamba3d_2.OutPoint, Plane=PlaneXY(0, 0, 0))  # -> Hull, HullZ, Indices; disabled
deconstruct_4 = Deconstruct(Point=remove_duplicate_points_karamba3d_2.OutPoint)  # -> XComponent, YComponent, ZComponent; disabled
deconstruct_5 = Deconstruct(Point=evaluate_box_2.Point)  # -> XComponent, YComponent, ZComponent; disabled
voronoi_2 = Voronoi(
    Points=remove_duplicate_points_karamba3d_2.OutPoint,
    Boundary=convex_hull_2.Hull,
    Plane=xy_plane_2,
    BruteForceOverride=False)  # disabled
construct_point_3 = ConstructPoint(XCoordinate=0, YCoordinate=0, ZCoordinate=deconstruct_4.ZComponent)  # disabled
construct_point_4 = ConstructPoint(XCoordinate=0, YCoordinate=0, ZCoordinate=deconstruct_5.ZComponent)  # disabled
area_4 = Area(Geometry=voronoi_2)  # -> Area, Centroid; disabled
# 11/22/2019
replace_nulls_2 = ReplaceNulls(Items=area_4.Area, Replacements=0)  # -> Items, Count; disabled
distance_2 = Distance(PointA=construct_point_3, PointB=construct_point_4)  # -> expr("x/2", Distance); disabled
number_13 = Number(distance_2)  # disabled
number_14 = Number(replace_nulls_2.Items)  # disabled
data_122 = Data(data_121)  # disabled
point_35 = Point(remove_duplicate_points_karamba3d_2.OutPoint)  # disabled
mesh_edges_4 = MeshEdges(Mesh=data_122)  # -> NakedEdges, InteriorEdges, NonManifoldEdges; disabled
data_123 = Data(data_121)  # disabled
data_124 = Data(point_35)  # disabled
# Definition of formfinding parameters
data_125 = Data(number_13)  # disabled
data_126 = Data(number_14)  # disabled
number_15 = Number(data_126)  # disabled
number_16 = Number(data_125)  # disabled
point_36 = Point(data_124)  # disabled
mesh_5 = Mesh(data_123)  # disabled
data_127 = Data(point_36)  # disabled
# Definition of Mesh and range of thickness
data_128 = Data(mesh_5)  # disabled
# Definition of forces
data_129 = Data(number_15)  # disabled
data_130 = Data(number_16)  # disabled
multiplication_11 = Multiplication(A=data_129, B=data_98)  # disabled
multiplication_12 = Multiplication(A=data_129, B=data_130)  # disabled
multiplication_13 = Multiplication(A=multiplication_12, B=division_2)  # disabled
addition_3 = Addition(A=multiplication_11, B=multiplication_13)  # disabled
unit_z_4 = UnitZ(Factor=addition_3)  # disabled
loads_karamba3d_4 = LoadsKaramba3D(ForceVector=unit_z_4, Local=False, PosInd=data_127, LCase=0, mode="Point")  # disabled
meshtoshell_2 = MeshToShellKaramba(Mesh=data_128, Identifier=data_99, CrossSection=cross_section_karamba3d_2, LimitDistance_m=0.005)  # -> Element, Points, Info; disabled
# Assembly of model
data_131 = Data(meshtoshell_2.Element)  # disabled
data_132 = Data(loads_karamba3d_4)  # disabled
assemble_2 = AssembleModelKaramba(Elem=data_131, Support=flatten(data_105), Load=flatten([data_106, data_132]), LimitDistance_m=0.005)  # -> Model, Info, Mass_kg, CenterOfGravity; disabled
optimize_cross_section_karamba3d_2 = OptimizeCrossSectionKaramba3D(
    Model=assemble_2.Model,
    ElemIdentifiers=data_109,
    CrossSections=data_118,
    MaximumUtilization=1,
    MaximumDisplacement_cm=data_115,
    UltimateLimitStateIterations=5,
    DisplacementIterations=5,
    NumberOfSamplePoints=3,
    ElasticDesign=True,
    GammaM0=1,
    GammaM1=1)  # -> ModelWithOptimizedCrossSections, Info, Mass_kg, MaximumDisplacement_cm, ElasticEnergy_kNm; disabled
# 11/22/2019
analyze_karamba3d_2 = AnalyzeKaramba3D(Model=optimize_cross_section_karamba3d_2.ModelWithOptimizedCrossSections)  # -> CalculatedModel, MaximumDisplacement_cm, ResultingForceOfGravity_kN, ElasticEnergy_kNm; disabled
data_133 = Data(analyze_karamba3d_2.CalculatedModel)  # disabled
# Results generation FEM
data_134 = Data(data_133)  # disabled
model_view_karamba3d_2 = ModelViewKaramba3D(Model=data_134, LoadCaseFactorsForLinearSuperposition=1, IndexOfVisibleLoadcase=-1)  # -> Model, DeformedMesh, DeformedAxes, DeformedModel; disabled
shellview_7 = ShellViewKaramba(Model=model_view_karamba3d_2.Model, IndexOfLayer=0)  # -> Model, MeshesOfRenderedShells, LegendColors, LegendTags; disabled
shellview_8 = ShellViewKaramba(Model=model_view_karamba3d_2.Model, IndexOfLayer=0)  # -> Model, MeshesOfRenderedShells, LegendColors, LegendTags; disabled
shellview_9 = ShellViewKaramba(Model=model_view_karamba3d_2.Model, IndexOfLayer=0)  # -> Model, MeshesOfRenderedShells, LegendColors, LegendTags; disabled
reaction_forces_karamba3d_2 = ReactionForcesKaramba3D(AnalyzedModel=model_view_karamba3d_2.Model, LoadCase=0)  # -> AnalyzedModel, ReactionForces_kN, ReactionMoments_kNm, SupportPosition, SumOfReactionForces_kN, SumOfReactionMoments_kNm; disabled
shellview_10 = ShellViewKaramba(Model=model_view_karamba3d_2.Model, IndexOfLayer=0)  # -> Model, MeshesOfRenderedShells, LegendColors, LegendTags; disabled
nodedisp_2 = NodalDisplacementsKaramba(AnalyzedModel=model_view_karamba3d_2.Model, LoadCase=0)  # -> AnalyzedModel, NodalTranslations_m, NodalRotations_rad; disabled
last_index_4 = LastIndex(List=shellview_7.LegendTags)  # disabled
last_index_5 = LastIndex(List=shellview_8.LegendTags)  # disabled
mesh_6 = Mesh(shellview_7.MeshesOfRenderedShells)  # disabled
last_index_6 = LastIndex(List=shellview_9.LegendTags)  # disabled
pdecon_2 = Deconstruct(Point=nodedisp_2.NodalTranslations_m)  # -> XComponent, YComponent, expr("x*1000", ZComponent); disabled
mesh_7 = Mesh(shellview_8.MeshesOfRenderedShells)  # disabled
multiplication_14 = Multiplication(A=shellview_7.LegendTags, B=10)  # disabled
multiplication_15 = Multiplication(A=shellview_8.LegendTags, B=10)  # disabled
multiplication_16 = Multiplication(A=shellview_9.LegendTags, B=10)  # disabled
cull_index_4 = CullIndex(List=multiplication_14, Indices=flatten(last_index_4), Wrap=True)  # disabled
cull_index_5 = CullIndex(List=multiplication_15, Indices=flatten(last_index_5), Wrap=True)  # disabled
cull_index_6 = CullIndex(List=multiplication_16, Indices=flatten(last_index_6), Wrap=True)  # disabled
absolute_4 = Absolute(Value=pdecon_2.ZComponent)  # disabled
shellview_11 = ShellViewKaramba(Model=shellview_10.Model, IndexOfLayer=0)  # -> Model, MeshesOfRenderedShells, LegendColors, LegendTags; disabled
split_list_4 = SplitList(List=cull_index_4, Index=1)  # -> ListA, ListB; disabled
split_list_5 = SplitList(List=cull_index_5, Index=1)  # -> ListA, ListB; disabled
split_list_6 = SplitList(List=cull_index_6, Index=1)  # -> ListA, ListB; disabled
list_item_5 = ListItem(List=reaction_forces_karamba3d_2.ReactionForces_kN, Index=0, Wrap=True)  # disabled
bounds_5 = Bounds(Numbers=split_list_4.ListB)  # disabled
bounds_6 = Bounds(Numbers=absolute_4)  # disabled
bounds_7 = Bounds(Numbers=split_list_5.ListB)  # disabled
bounds_8 = Bounds(Numbers=split_list_6.ListB)  # disabled
shellview_12 = ShellViewKaramba(Model=shellview_11.Model, IndexOfLayer=0)  # -> Model, MeshesOfRenderedShells, LegendColors, LegendTags; disabled
deconstruct_6 = Deconstruct(Point=list_item_5)  # -> XComponent, YComponent, ZComponent; disabled
deconstruct_domain_5 = DeconstructDomain(Domain=bounds_5)  # -> Start, End; disabled
deconstruct_domain_6 = DeconstructDomain(Domain=bounds_6)  # -> Start, End; disabled
deconstruct_domain_7 = DeconstructDomain(Domain=bounds_7)  # -> Start, End; disabled
deconstruct_domain_8 = DeconstructDomain(Domain=bounds_8)  # -> Start, End; disabled
data_135 = Data(flatten(deconstruct_6.XComponent))  # disabled
data_136 = Data(flatten(deconstruct_6.YComponent))  # disabled
data_137 = Data(flatten(deconstruct_domain_6.End))  # disabled
data_138 = Data(flatten(deconstruct_domain_7.Start))  # disabled
data_139 = Data(flatten(deconstruct_domain_7.End))  # disabled
data_140 = Data(flatten(deconstruct_domain_5.Start))  # disabled
data_141 = Data(flatten(deconstruct_domain_5.End))  # disabled
data_142 = Data(flatten(deconstruct_domain_8.End))  # disabled
data_143 = Data(flatten(deconstruct_6.ZComponent))  # disabled
data_144 = Data(flatten(shellview_12.LegendColors))  # disabled
data_145 = Data(flatten(shellview_12.LegendTags))  # disabled
data_146 = Data(flatten(shellview_11.LegendColors))  # disabled
data_147 = Data(flatten(shellview_11.LegendTags))  # disabled
data_148 = Data(flatten(shellview_10.LegendColors))  # disabled
data_149 = Data(flatten(shellview_10.LegendTags))  # disabled
data_150 = Data(flatten(shellview_10.MeshesOfRenderedShells))  # disabled
# Results FEM
legend_4 = Legend(Colour=data_144, Tags=data_145, LegendType=1)  # disabled
legend_5 = Legend(Colour=data_146, Tags=data_147, LegendType=1)  # disabled
legend_6 = Legend(Colour=data_148, Tags=data_149, LegendType=1)  # disabled
x_horizontal_resultant_force_kn_2 = Panel(data_135)  # disabled
y_horizontal_resultant_force_kn_2 = Panel(data_136)  # disabled
z_vertical_resultant_force_kn_2 = Panel(data_143)  # disabled
max_compression_stress_p1_n_mm2_2 = Panel(data_138)  # disabled
max_tensile_stress_p1_n_mm2_2 = Panel(data_139)  # disabled
max_compression_stress_p2_n_mm2_2 = Panel(data_140)  # disabled
max_tensile_stress_p2_n_mm2_2 = Panel(data_141)  # disabled
max_displacement_mm_2 = Panel(data_137)  # disabled
data_151 = Data(max_displacement_mm_2)  # disabled
data_152 = Data(max_compression_stress_p1_n_mm2_2)  # disabled
data_153 = Data(max_tensile_stress_p1_n_mm2_2)  # disabled
data_154 = Data(max_compression_stress_p2_n_mm2_2)  # disabled
data_155 = Data(max_tensile_stress_p2_n_mm2_2)  # disabled
data_156 = Data(data_152)  # disabled
data_157 = Data(data_154)  # disabled
data_158 = Data(data_155)  # disabled
data_159 = Data(data_151)  # disabled
data_160 = Data(data_153)  # disabled
absolute_5 = Absolute(Value=[data_156, data_157])  # disabled
absolute_6 = Absolute(Value=[data_160, data_158])  # disabled
number_17 = Number(data_159)  # disabled
sort_list_3 = SortList(Keys=absolute_5)  # -> Keys, ValuesValuesA; disabled
sort_list_4 = SortList(Keys=absolute_6)  # -> Keys, ValuesValuesA; disabled
list_item_6 = ListItem(List=sort_list_3.Keys, Index=1, Wrap=True)  # disabled
list_item_7 = ListItem(List=sort_list_4.Keys, Index=1, Wrap=True)  # disabled
number_18 = Number(list_item_7)  # disabled
expression_6 = Expression(x=number_18, y=number_12, Expression="x>y/10")  # disabled
expression_7 = Expression(x=list_item_6, y=number_12, Expression="x<-y")  # disabled
expression_8 = Expression(x=multiplication_9, y=number_17, Expression="x<y")  # disabled
merge_12 = Merge(Data1=expression_8, Data2=expression_7, Data3=expression_6)  # disabled
mass_addition_2 = MassAddition(Input=merge_12)  # -> Result, PartialResults; disabled
# Surrogate model optimalisation solver, output: best solution
addition_4 = Addition(A=mass_addition_2.Result, B=list_item_7)  # disabled
maximum_compression_n_mm2_2 = Number(list_item_6)  # disabled
# Output: 3-axis pareto front
maximal_tension_n_mm2_2 = Number(number_18)  # disabled
maximal_deflection_mm_2 = Number(number_17)  # disabled

min_number_of_stacked_bricks_5 = Slider(3, range=1..4)
# 11/23/2019
spring_stiffness_3 = Slider(58, range=10..60)

# ----
# Young Modulus research paper: https://dspace.cvut.cz/bitstream/handle/10467/69500/F1-BP-2017-Gubasheva-Samal-priloha-ADOBE%20AS%20A%20BUILDING%20MATERIAL.%20pdf.pdf?sequence=3&isAllowed=y
data_161 = Data(min_number_of_stacked_bricks_5)
maximal_shell_thickness_cm_3 = Slider(200, range=0..200)
height_of_bricks_cm_3 = Slider(9, range=0..10)
min_number_of_stacked_bricks_6 = Panel(data_161)
shell_cross_section_name_3 = Panel("Shell Cross section")
distributed_vertical_load_kn_m2_3 = Panel("2.25")
name_3 = Panel("shell")

data_162 = Data(name_3)
data_163 = Data(young_modulus_n_mm2_3)
data_164 = Data(specific_weight_kg_m3_3)
data_165 = Data(compressive_strenght_n_mm2_3)
data_166 = Data(material_adobe_3)
data_167 = Data(poisson_ratio_3)
ghpython_script_7 = GhPythonScript(e_modulus=data_163, poission_ratio=data_167)  # -> shear_modulus; inputs e_modulus: Int32, poission_ratio: Int32; same code as ghpython_script_3
material_properties_karamba3d_3 = MaterialPropertiesKaramba3D(
    FamilyOfMaterial=data_166,
    Name=data_166,
    ElementIdentifier=data_162,
    YoungsModulus_kN_cm2=expr("x*0.1", data_163),
    InPlaneShearModulus_kN_cm2=expr("x*0.1", ghpython_script_7),
    TransverseShearModulus_kN_cm2=expr("x*0.1", ghpython_script_7),
    SpecificWeight_kN_m3=expr("x*0.012", data_164),
    CoefficientOfThermalExpansion_1_C=1e-05,
    YieldStrength_kN_cm2=expr("x*0.1", data_165),
    mode="Isotrop")

opossum_2 = Opossum(OpossumData_NumberOfObjectives=0, OpossumData_OptimizationType=0, OpossumData_ResultSerializationStatus=0)  # disabled

# ----
# 2D Tesselation generation
# Rectengular grid
# Feature point at support
ghpython_script_8 = GhPythonScript(shop_size=data_80)  # -> width_of_shop; same code as ghpython_script
ghpython_script_9 = GhPythonScript(width=data_81)  # -> width_of_shop; same code as ghpython_script_2
rectangle_3 = Rectangle(Plane=PlaneXY(0, 0, 0), XSize=ghpython_script_8, YSize=ghpython_script_9, Radius=0)  # -> Rectangle, Length
line_count_3 = Slider(20, range=0..20)

# ----
# Optimalisation values
panel_5 = Panel("4.8")
curve_5 = Curve(<curve referenced from the Rhino model>)
unit_z_5 = UnitZ(Factor=Slider(2.4, range=0..10))
curve_6 = Curve(<curve referenced from the Rhino model>)
data_168 = Data(spring_stiffness_3)
unit_z_6 = UnitZ(Factor=Slider(-0.2, range=-1..0))

relay_3 = Relay([panel_5, "4.8"])
explode_3 = Explode(Curve=curve_5, Recursive=True)  # -> Segments, Vertices
box_corners_3 = BoxCorners(Box=curve_5)  # -> CornerA, CornerB, CornerC, CornerD, CornerE, CornerF, CornerG, CornerH
data_169 = Data(curve_5)
data_170 = Data("4.8")
area_5 = Area(Geometry=curve_5)  # -> Area, Centroid
curve_middle_3 = CurveMiddle(Curve=explode_3.Segments)  # -> graft(Midpoint)
merge_13 = Merge(Data1=box_corners_3.CornerA, Data2=box_corners_3.CornerB, Data3=box_corners_3.CornerC, Data4=box_corners_3.CornerD)  # -> graft(Result)
equality_3 = Equality(FirstNumber=relay_3, SecondNumber=2.4)  # -> Equality, Inequality
explode_tree_17 = ExplodeTree(Data=graft(equality_3.Equality))  # -> Branch0, Branch1
point_37 = Point(merge_13)
gate_or_3 = GateOr(A=explode_tree_17.Branch0, B=explode_tree_17.Branch1)
replace_members_3 = ReplaceMembers(Set=gate_or_3, Find=[True, False], Replace=[5, 6])
explode_tree_18 = ExplodeTree(Data=curve_middle_3)  # -> Branch0, Branch1, Branch2, Branch3
line_57 = Line(StartPoint=explode_tree_18.Branch0, EndPoint=box_corners_3.CornerA)  # -> flatten(Line)
line_58 = Line(StartPoint=explode_tree_18.Branch3, EndPoint=box_corners_3.CornerA)  # -> flatten(Line)
line_59 = Line(StartPoint=box_corners_3.CornerA, EndPoint=area_5.Centroid)  # -> flatten(Line)
line_60 = Line(StartPoint=explode_tree_18.Branch0, EndPoint=box_corners_3.CornerB)  # -> flatten(Line)
line_61 = Line(StartPoint=explode_tree_18.Branch1, EndPoint=box_corners_3.CornerB)  # -> flatten(Line)
line_62 = Line(StartPoint=box_corners_3.CornerB, EndPoint=area_5.Centroid)  # -> flatten(Line)
line_63 = Line(StartPoint=explode_tree_18.Branch1, EndPoint=box_corners_3.CornerC)  # -> flatten(Line)
line_64 = Line(StartPoint=box_corners_3.CornerC, EndPoint=explode_tree_18.Branch2)  # -> flatten(Line)
line_65 = Line(StartPoint=box_corners_3.CornerC, EndPoint=area_5.Centroid)  # -> flatten(Line)
line_66 = Line(StartPoint=explode_tree_18.Branch2, EndPoint=box_corners_3.CornerD)  # -> flatten(Line)
line_67 = Line(StartPoint=box_corners_3.CornerD, EndPoint=explode_tree_18.Branch3)  # -> flatten(Line)
line_68 = Line(StartPoint=box_corners_3.CornerD, EndPoint=area_5.Centroid)  # -> flatten(Line)
divide_curve_17 = DivideCurve(Curve=[line_57, line_58, line_59], Count=line_count_3, Kinks=False)  # -> Points, Tangents, Parameters
divide_curve_18 = DivideCurve(Curve=[line_60, line_61, line_62], Count=line_count_3, Kinks=False)  # -> Points, Tangents, Parameters
divide_curve_19 = DivideCurve(Curve=[line_63, line_64, line_65], Count=line_count_3, Kinks=False)  # -> Points, Tangents, Parameters
divide_curve_20 = DivideCurve(Curve=[line_66, line_67, line_68], Count=line_count_3, Kinks=False)  # -> Points, Tangents, Parameters
explode_tree_19 = ExplodeTree(Data=divide_curve_17.Points)  # -> Branch0, Branch1, Branch2
explode_tree_20 = ExplodeTree(Data=divide_curve_18.Points)  # -> Branch0, Branch1, Branch2
explode_tree_21 = ExplodeTree(Data=divide_curve_19.Points)  # -> Branch0, Branch1, Branch2
explode_tree_22 = ExplodeTree(Data=divide_curve_20.Points)  # -> Branch0, Branch1, Branch2
line_69 = Line(StartPoint=explode_tree_19.Branch0, EndPoint=reverse(explode_tree_19.Branch2))  # -> flatten(Line)
line_70 = Line(StartPoint=explode_tree_19.Branch1, EndPoint=reverse(explode_tree_19.Branch2))  # -> flatten(Line)
line_71 = Line(StartPoint=explode_tree_20.Branch0, EndPoint=reverse(explode_tree_20.Branch2))  # -> flatten(Line)
line_72 = Line(StartPoint=explode_tree_20.Branch1, EndPoint=reverse(explode_tree_20.Branch2))  # -> flatten(Line)
line_73 = Line(StartPoint=explode_tree_21.Branch0, EndPoint=reverse(explode_tree_21.Branch2))  # -> flatten(Line)
line_74 = Line(StartPoint=explode_tree_22.Branch0, EndPoint=reverse(explode_tree_22.Branch2))  # -> flatten(Line)
line_75 = Line(StartPoint=explode_tree_21.Branch1, EndPoint=explode_tree_21.Branch2)  # -> flatten(Line)
line_76 = Line(StartPoint=explode_tree_22.Branch1, EndPoint=explode_tree_22.Branch2)  # -> flatten(Line)
point_38 = Point(explode_tree_19.Branch1)
point_39 = Point(explode_tree_20.Branch0)
point_40 = Point(explode_tree_22.Branch0)
point_41 = Point(explode_tree_22.Branch1)
point_42 = Point(explode_tree_19.Branch0)
point_43 = Point(explode_tree_20.Branch1)
point_44 = Point(explode_tree_21.Branch1)
point_45 = Point(explode_tree_21.Branch0)
# 11/22/2019
line_77 = Line([line_76, line_74, line_69, line_70, line_71, line_72, line_73, line_75])

line_78 = Line(StartPoint=curve_middle_3, EndPoint=area_5.Centroid)  # -> flatten(Line)
flip_matrix_3 = FlipMatrix(Data=line_78)
explode_tree_23 = ExplodeTree(Data=flip_matrix_3)  # -> Branch0, Branch1, Branch2, Branch3
explode_tree_24 = ExplodeTree(Data=merge_13)  # -> Branch0, Branch1, Branch2, Branch3
divide_curve_21 = DivideCurve(Curve=explode_tree_23.Branch0, Count=replace_members_3, Kinks=False)  # -> Points, Tangents, Parameters
divide_curve_22 = DivideCurve(Curve=explode_tree_23.Branch1, Count=replace_members_3, Kinks=False)  # -> Points, Tangents, Parameters
divide_curve_23 = DivideCurve(Curve=explode_tree_23.Branch2, Count=replace_members_3, Kinks=False)  # -> Points, Tangents, Parameters
divide_curve_24 = DivideCurve(Curve=explode_tree_23.Branch3, Count=replace_members_3, Kinks=False)  # -> Points, Tangents, Parameters
merge_14 = Merge(Data1=divide_curve_21.Points, Data2=divide_curve_24.Points)  # -> flatten(Result)
merge_15 = Merge(Data1=divide_curve_21.Points, Data2=divide_curve_22.Points)  # -> flatten(Result)
merge_16 = Merge(Data1=divide_curve_23.Points, Data2=divide_curve_22.Points)  # -> flatten(Result)
merge_17 = Merge(Data1=divide_curve_23.Points, Data2=divide_curve_24.Points)  # -> flatten(Result)
line_79 = Line(StartPoint=explode_tree_24.Branch0, EndPoint=merge_14)
line_80 = Line(StartPoint=explode_tree_24.Branch1, EndPoint=merge_15)
line_81 = Line(StartPoint=explode_tree_24.Branch2, EndPoint=merge_16)
line_82 = Line(StartPoint=explode_tree_24.Branch3, EndPoint=merge_17)

connection_point_support_3 = Relay([line_79, line_80, line_81, line_82])
connection_vault_x_3 = Relay([point_42, point_39, point_44, point_40])
connection_vault_y_3 = Relay([point_38, point_43, point_45, point_41])
point_46 = Point(point_37)
line_83 = Line(line_77)
point_47 = Point(connection_vault_x_3)
point_48 = Point(connection_vault_y_3)
line_84 = Line(connection_point_support_3)

data_171 = Data([line_84, line_83])
data_172 = Data(point_47)
data_173 = Data(point_48)
# Kangeroo form finding
data_174 = Data(point_46)

# ----
# Definition of support
# Definition of springs / mesh
# Definition of 1 way constrains
# Use if required by 2d topology
line_line_intersection_karamba3d_3 = LineLineIntersectionKaramba3D(Line=flatten(data_171), LengthTolerance=0.01)  # -> IntersectionPoints, flatten(LineSubSegements)
remove_duplicate_lines_karamba3d_3 = RemoveDuplicateLinesKaramba3D(Line=line_line_intersection_karamba3d_3.LineSubSegements, LimitDistance=0.005)  # -> OutLine, Info, Indexes
weaverbird_s_mesh_from_lines_weave_back_6 = WeaverbirdsMeshFromLinesWeaveBack(Lines=remove_duplicate_lines_karamba3d_3.OutLine, MaximumValence=4)
edgelengths_4 = EdgeLengths(Mesh=weaverbird_s_mesh_from_lines_weave_back_6, LengthFactor=1, Strength=expr("x/2", data_168))
anchorxyz_6 = AnchorXYZ(Point=flatten(data_172), X=False, Y=True, Z=False, Strength=1000)  # disabled
anchorxyz_7 = AnchorXYZ(Point=flatten(data_173), X=True, Y=False, Z=False, Strength=1000)  # disabled
anchor_4 = Anchor(Point=data_174, Strength=100000)
vertexloads_4 = VertexLoads(Mesh=weaverbird_s_mesh_from_lines_weave_back_6, Strength=0.1)
zombiesolver_4 = ZombieSolver(
    GoalObjects=flatten([anchor_4, anchorxyz_6, anchorxyz_7, edgelengths_4, vertexloads_4]),
    Threshold=1e-10,
    Tolerance=0.01,
    MaxIterations=50000)  # -> I, V, O; disabled
null_item_3 = NullItem()  # -> NullFlags, InvalidFlags, Description
dispatch_3 = Dispatch(DispatchPattern=null_item_3.NullFlags)  # -> ListA, ListB
weaverbird_s_mesh_from_lines_weave_back_7 = WeaverbirdsMeshFromLinesWeaveBack(Lines=dispatch_3.ListB, MaximumValence=4)

point_49 = Point(box_corners_3.CornerD)
point_50 = Point(point_49)
move_2 = Move(Geometry=point_50, Motion=unit_z_5)  # -> Geometry, Transform
mesh_8 = Mesh(weaverbird_s_mesh_from_lines_weave_back_6)
deconstruct_mesh_4 = DeconstructMesh(Mesh=mesh_8)  # -> Vertices, Faces, Colours, Normals
meshcorners_3 = MeshCorners(Mesh=mesh_8, Angle=2.35619449)
list_item_8 = ListItem(List=meshcorners_3, Index=0, Wrap=True)  # -> Item2, Item1, Item, Item1_2
curve_closest_point_2 = CurveClosestPoint(Point=deconstruct_mesh_4.Vertices, Curve=curve_6)  # -> Point, Parameter, Distance
evaluate_2 = Evaluate(Expression="If(x<0.001, true, false)", x=curve_closest_point_2.Distance)
panel_6 = Panel(evaluate_2)
cull_pattern_2 = CullPattern(List=deconstruct_mesh_4.Vertices, CullPattern=evaluate_2)
edgelengths_5 = EdgeLengths(Mesh=mesh_8, LengthFactor=1, Strength=spring_stiffness_3)
anchorxyz_8 = AnchorXYZ(Point=cull_pattern_2, X=True, Y=True, Z=False, Strength="10000")
# 3 corner
# elevated corner
anchor_5 = Anchor(Point=[list_item_8.Item1_2, list_item_8.Item2, list_item_8.Item1, list_item_8.Item], Strength=10000)
vertexloads_5 = VertexLoads(Mesh=mesh_8, Strength=unit_z_6)
zombiesolver_5 = ZombieSolver(GoalObjects=[vertexloads_5, anchorxyz_8, edgelengths_5, anchor_5], Threshold=1e-10, Tolerance=0.01, MaxIterations=50000)  # -> I, V, O
mesh_edges_5 = MeshEdges(Mesh=weaverbird_s_mesh_from_lines_weave_back_7)  # -> NakedEdges, InteriorEdges, NonManifoldEdges
curve_7 = Curve(flatten(zombiesolver_5.O))
weaverbird_s_mesh_from_lines_weave_back_8 = WeaverbirdsMeshFromLinesWeaveBack(Lines=curve_7, MaximumValence=4)
weaverbird_s_catmull_clark_subdivision_3 = WeaverbirdsCatmullClarkSubdivision(
    MeshCurves=[weaverbird_s_mesh_from_lines_weave_back_8, weaverbird_s_mesh_from_lines_weave_back_7],
    Level=1,
    SmoothNakedEdges=0)
# 11/22/2019
meshcorners_4 = MeshCorners(Mesh=weaverbird_s_catmull_clark_subdivision_3, Angle=2.35619449)

data_175 = Data(weaverbird_s_catmull_clark_subdivision_3)
point_51 = Point(meshcorners_4)

# ----
# Definition of Forces
data_176 = Data(point_51)
data_177 = Data(data_175)

# ----
# Vertical loading
deconstruct_mesh_5 = DeconstructMesh(Mesh=data_177)  # -> Vertices, Faces, Colours, Normals
remove_duplicate_points_karamba3d_3 = RemoveDuplicatePointsKaramba3D(Point=deconstruct_mesh_5.Vertices, LimitDistance=0.005)  # -> OutPoint, Info, Indexes
# Roof loading
# (added soil)
evaluate_box_3 = EvaluateBox(Box=data_177, UParameter=0.5, VParameter=0.5, WParameter=1)  # -> Plane, Point, Include
xy_plane_3 = XYPlane(Origin=Point(0, 0, 0))
convex_hull_3 = ConvexHull(Points=remove_duplicate_points_karamba3d_3.OutPoint, Plane=PlaneXY(0, 0, 0))  # -> Hull, HullZ, Indices
deconstruct_7 = Deconstruct(Point=remove_duplicate_points_karamba3d_3.OutPoint)  # -> XComponent, YComponent, ZComponent
deconstruct_8 = Deconstruct(Point=evaluate_box_3.Point)  # -> XComponent, YComponent, ZComponent
voronoi_3 = Voronoi(
    Points=remove_duplicate_points_karamba3d_3.OutPoint,
    Boundary=convex_hull_3.Hull,
    Plane=xy_plane_3,
    BruteForceOverride=False)
construct_point_5 = ConstructPoint(XCoordinate=0, YCoordinate=0, ZCoordinate=deconstruct_7.ZComponent)
construct_point_6 = ConstructPoint(XCoordinate=0, YCoordinate=0, ZCoordinate=deconstruct_8.ZComponent)
area_6 = Area(Geometry=voronoi_3)  # -> Area, Centroid
# 11/22/2019
replace_nulls_3 = ReplaceNulls(Items=area_6.Area, Replacements=0)  # -> Items, Count
distance_3 = Distance(PointA=construct_point_5, PointB=construct_point_6)  # -> expr("x/2", Distance)

point_52 = Point(data_176)
number_19 = Number(distance_3)
number_20 = Number(replace_nulls_3.Items)
data_178 = Data(data_177)
point_53 = Point(remove_duplicate_points_karamba3d_3.OutPoint)

mesh_edges_6 = MeshEdges(Mesh=data_178)  # -> NakedEdges, InteriorEdges, NonManifoldEdges

# ----
# Shape input
# Definition of Mesh and range of thickness
# Definition of formfinding parameters
# Definition of support points
# Definition of forces
data_179 = Data(data_177)

data_180 = Data(point_53)
data_181 = Data(number_19)
data_182 = Data(number_20)
# Calculation FEM using karamba
data_183 = Data(data_176)
number_21 = Number(data_182)
number_22 = Number(data_181)
point_54 = Point(data_180)
point_55 = Point(data_183)
mesh_9 = Mesh(data_179)

data_184 = Data(point_55)
supp_3 = SupportKaramba(PosInd=data_184, PlaneOfReference=PlaneXY(0, 0, 0), menu=[buttons(on, on, on, off, off, off)])  # -> flatten(Support)

data_185 = Data(number_21)
data_186 = Data(distributed_vertical_load_kn_m2_3)
data_187 = Data(point_54)
data_188 = Data(number_22)
data_189 = Data(specific_weight_kg_m3_3)
multiplication_17 = Multiplication(A=data_185, B=data_186)
multiplication_18 = Multiplication(A=data_185, B=data_188)
division_3 = Division(A=data_189, B=100)
multiplication_19 = Multiplication(A=multiplication_18, B=division_3)
addition_5 = Addition(A=multiplication_17, B=multiplication_19)
unit_z_7 = UnitZ(Factor=addition_5)
Z_3 = UnitZ(Factor=expr("x*1.5", -1))

# ----
# Definition of Material properties
data_190 = Data(mesh_9)
data_191 = Data(shell_cross_section_name_3)
data_192 = Data(maximal_shell_thickness_cm_3)
data_193 = Data(height_of_bricks_cm_3)
data_194 = Data(name_3)
data_195 = Data(min_number_of_stacked_bricks_6)

multiplication_20 = Multiplication(A=data_195, B=data_193)
construct_domain_3 = ConstructDomain(DomainStart=multiplication_20, DomainEnd=data_192)
range_3 = Range(Domain=construct_domain_3, Steps=data_193)
expression_9 = Expression(x=data_191, y=range_3, Expression="x&\" \"&y")

loads_karamba3d_5 = LoadsKaramba3D(Vector=Z_3, LCase=0, mode="Gravity")
loads_karamba3d_6 = LoadsKaramba3D(ForceVector=unit_z_7, Local=False, PosInd=data_187, LCase=0, mode="Point")

data_196 = Data(supp_3)
data_197 = Data(loads_karamba3d_5)
data_198 = Data(loads_karamba3d_6)
data_199 = Data(material_properties_karamba3d_3)

data_200 = Data(data_199)

cross_section_karamba3d_3 = CrossSectionKaramba3D(
    FamilyNameOfCrossSection=data_191,
    NameOfCrossSection=flatten(expression_9),
    ElementIdentifier=data_194,
    Material=data_200,
    Height_cm=flatten(range_3),
    mode="Shell - Const")
meshtoshell_3 = MeshToShellKaramba(Mesh=data_190, Identifier=data_194, CrossSection=cross_section_karamba3d_3, LimitDistance_m=0.005)  # -> Element, Points, Info

data_201 = Data(meshtoshell_3.Element)
assemble_3 = AssembleModelKaramba(Elem=data_201, Support=flatten(data_196), Load=flatten([data_197, data_198]), LimitDistance_m=0.005)  # -> Model, Info, Mass_kg, CenterOfGravity

# ----
# Assembly of model
# Optimalisation of shell thickness
data_202 = Data(cross_section_karamba3d_3)
data_203 = Data(name_3)

# ----
# Resulting displacement
# Results FEM
# Resulting principle stresses D1
# Resulting principle stresses D2
# Resulting von Mises yield criterion
# Resulting utilisation and cross section
panel_7 = Panel("""L S (house addition)(6,6)
2,11 parameters

L S  (Shop)(6,6)
4,37 parameters

L H (hallway)(5,5)
3,10 parameters
2,11 parameters
3,46 parameters
4,60 parameters


M S (Shop}(6,6)
2,16 parameters
2,22 parameters

M H (hallway) (5,5)
2,15 parameters
1,24 parameters

S S (Shop)(5,5)
1,52 parameters
2,17 parameters

S H {hallway}(5,5)
1,16 parameters
1,52 parameters""")

# ----
# 11/23/2019
dome_dimension_m_3 = Panel(data_169)
dome_width_m_3 = Panel(data_170)
max_deflection_m_3 = Panel("1/200")

data_204 = Data(max_deflection_m_3)
data_205 = Data(dome_width_m_3)

# ----
# Optimalisation
data_206 = Data(data_205)
data_207 = Data(data_204)

number_23 = Number(expr("x*1000", data_206))
number_24 = Number(data_207)
multiplication_21 = Multiplication(A=number_23, B=number_24)
number_25 = Number(compressive_strenght_n_mm2_3)
opossum_3 = Opossum(
    OpossumData_NumberOfObjectives=1,
    OpossumData_OptimizationType=0,
    OpossumData_ResultSerializationStatus=1,
    OpossumData_ObjectiveValue=[2.53, 0.165, 0.229, 0.192, 0.191, 0.187, 0.201, 0.198, 2.45, 0.288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],
    OpossumData_ParameterList=["1,13", "3,58", "2,35", "4,24", "4,46", "4,30", "4,60", "4,55", "1,41", "4,18"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],
    OpossumData_objective=addition_6,
    OpossumData_variable=[min_number_of_stacked_bricks_5, spring_stiffness_3])

# ----
# UC checks of structure
# Surrogate model optimalisation solver, output: best solution
# Output: 3-axis pareto front
data_208 = Data(multiplication_21)

data_209 = Data(data_208)

optimize_cross_section_karamba3d_3 = OptimizeCrossSectionKaramba3D(
    Model=assemble_3.Model,
    ElemIdentifiers=data_203,
    CrossSections=data_202,
    MaximumUtilization=1,
    MaximumDisplacement_cm=data_209,
    UltimateLimitStateIterations=5,
    DisplacementIterations=5,
    NumberOfSamplePoints=3,
    ElasticDesign=True,
    GammaM0=1,
    GammaM1=1)  # -> ModelWithOptimizedCrossSections, Info, Mass_kg, MaximumDisplacement_cm, ElasticEnergy_kNm

# ----
# 11/22/2019
# Karamba magic
analyze_karamba3d_3 = AnalyzeKaramba3D(Model=optimize_cross_section_karamba3d_3.ModelWithOptimizedCrossSections)  # -> CalculatedModel, MaximumDisplacement_cm, ResultingForceOfGravity_kN, ElasticEnergy_kNm

data_210 = Data(analyze_karamba3d_3.CalculatedModel)

# ----
# Results generation FEM
data_211 = Data(data_210)

model_view_karamba3d_3 = ModelViewKaramba3D(Model=data_211, LoadCaseFactorsForLinearSuperposition=1, IndexOfVisibleLoadcase=-1)  # -> Model, DeformedMesh, DeformedAxes, DeformedModel
shellview_13 = ShellViewKaramba(Model=model_view_karamba3d_3.Model, IndexOfLayer=0)  # -> Model, MeshesOfRenderedShells, LegendColors, LegendTags
shellview_14 = ShellViewKaramba(Model=model_view_karamba3d_3.Model, IndexOfLayer=0)  # -> Model, MeshesOfRenderedShells, LegendColors, LegendTags
shellview_15 = ShellViewKaramba(Model=model_view_karamba3d_3.Model, IndexOfLayer=0)  # -> Model, MeshesOfRenderedShells, LegendColors, LegendTags
reaction_forces_karamba3d_3 = ReactionForcesKaramba3D(AnalyzedModel=model_view_karamba3d_3.Model, LoadCase=0)  # -> AnalyzedModel, ReactionForces_kN, ReactionMoments_kNm, SupportPosition, SumOfReactionForces_kN, SumOfReactionMoments_kNm
shellview_16 = ShellViewKaramba(Model=model_view_karamba3d_3.Model, IndexOfLayer=0)  # -> Model, MeshesOfRenderedShells, LegendColors, LegendTags
nodedisp_3 = NodalDisplacementsKaramba(AnalyzedModel=model_view_karamba3d_3.Model, LoadCase=0)  # -> AnalyzedModel, NodalTranslations_m, NodalRotations_rad
last_index_7 = LastIndex(List=shellview_13.LegendTags)
last_index_8 = LastIndex(List=shellview_14.LegendTags)
last_index_9 = LastIndex(List=shellview_15.LegendTags)
pdecon_3 = Deconstruct(Point=nodedisp_3.NodalTranslations_m)  # -> XComponent, YComponent, expr("x*1000", ZComponent)
multiplication_22 = Multiplication(A=shellview_13.LegendTags, B=10)
multiplication_23 = Multiplication(A=shellview_14.LegendTags, B=10)
multiplication_24 = Multiplication(A=shellview_15.LegendTags, B=10)
cull_index_7 = CullIndex(List=multiplication_22, Indices=flatten(last_index_7), Wrap=True)
cull_index_8 = CullIndex(List=multiplication_23, Indices=flatten(last_index_8), Wrap=True)
cull_index_9 = CullIndex(List=multiplication_24, Indices=flatten(last_index_9), Wrap=True)
absolute_7 = Absolute(Value=pdecon_3.ZComponent)
shellview_17 = ShellViewKaramba(Model=shellview_16.Model, IndexOfLayer=0)  # -> Model, MeshesOfRenderedShells, LegendColors, LegendTags
split_list_7 = SplitList(List=cull_index_7, Index=1)  # -> ListA, ListB
split_list_8 = SplitList(List=cull_index_8, Index=1)  # -> ListA, ListB
split_list_9 = SplitList(List=cull_index_9, Index=1)  # -> ListA, ListB
bounds_9 = Bounds(Numbers=split_list_7.ListB)
bounds_10 = Bounds(Numbers=absolute_7)
bounds_11 = Bounds(Numbers=split_list_8.ListB)
bounds_12 = Bounds(Numbers=split_list_9.ListB)
shellview_18 = ShellViewKaramba(Model=shellview_17.Model, IndexOfLayer=0)  # -> Model, MeshesOfRenderedShells, LegendColors, LegendTags
deconstruct_domain_9 = DeconstructDomain(Domain=bounds_9)  # -> Start, End
deconstruct_domain_10 = DeconstructDomain(Domain=bounds_10)  # -> Start, End
deconstruct_domain_11 = DeconstructDomain(Domain=bounds_11)  # -> Start, End
deconstruct_domain_12 = DeconstructDomain(Domain=bounds_12)  # -> Start, End

mesh_10 = Mesh(shellview_13.MeshesOfRenderedShells)
mesh_11 = Mesh(shellview_14.MeshesOfRenderedShells)
list_item_9 = ListItem(List=reaction_forces_karamba3d_3.ReactionForces_kN, Index=0, Wrap=True)
deconstruct_9 = Deconstruct(Point=list_item_9)  # -> XComponent, YComponent, ZComponent
data_212 = Data(flatten(deconstruct_9.YComponent))
data_213 = Data(flatten(deconstruct_9.ZComponent))

data_214 = Data(flatten(deconstruct_9.XComponent))

data_215 = Data(flatten(deconstruct_domain_9.End))
data_216 = Data(flatten(deconstruct_domain_12.End))
data_217 = Data(flatten(shellview_18.LegendColors))
data_218 = Data(flatten(shellview_18.LegendTags))
data_219 = Data(flatten(shellview_17.LegendColors))
data_220 = Data(flatten(shellview_17.LegendTags))
data_221 = Data(flatten(shellview_16.LegendTags))
data_222 = Data(flatten(shellview_16.MeshesOfRenderedShells))
data_223 = Data(flatten(deconstruct_domain_10.End))
data_224 = Data(flatten(deconstruct_domain_11.Start))
data_225 = Data(flatten(deconstruct_domain_11.End))
data_226 = Data(flatten(deconstruct_domain_9.Start))
data_227 = Data(flatten(shellview_16.LegendColors))

legend_7 = Legend(Colour=data_217, Tags=data_218, LegendType=1)
legend_8 = Legend(Colour=data_219, Tags=data_220, LegendType=1)
legend_9 = Legend(Colour=data_227, Tags=data_221, LegendType=1)
z_vertical_resultant_force_kn_3 = Panel(data_213)
x_horizontal_resultant_force_kn_3 = Panel(data_214)
y_horizontal_resultant_force_kn_3 = Panel(data_212)
max_compression_stress_p2_n_mm2_3 = Panel(data_226)
max_compression_stress_p1_n_mm2_3 = Panel(data_224)
max_tensile_stress_p1_n_mm2_3 = Panel(data_225)
max_tensile_stress_p2_n_mm2_3 = Panel(data_215)
max_displacement_mm_3 = Panel(data_223)

data_228 = Data(max_displacement_mm_3)
data_229 = Data(max_tensile_stress_p1_n_mm2_3)
data_230 = Data(max_compression_stress_p1_n_mm2_3)
data_231 = Data(max_compression_stress_p2_n_mm2_3)
data_232 = Data(max_tensile_stress_p2_n_mm2_3)

data_233 = Data(data_230)
data_234 = Data(data_231)
data_235 = Data(data_232)
data_236 = Data(data_228)
data_237 = Data(data_229)

absolute_8 = Absolute(Value=[data_233, data_234])
absolute_9 = Absolute(Value=[data_237, data_235])
number_26 = Number(data_236)
sort_list_5 = SortList(Keys=absolute_8)  # -> Keys, ValuesValuesA
sort_list_6 = SortList(Keys=absolute_9)  # -> Keys, ValuesValuesA
list_item_10 = ListItem(List=sort_list_5.Keys, Index=1, Wrap=True)
list_item_11 = ListItem(List=sort_list_6.Keys, Index=1, Wrap=True)
number_27 = Number(list_item_11)
expression_10 = Expression(x=number_27, y=number_25, Expression="x>y/10")
expression_11 = Expression(x=list_item_10, y=number_25, Expression="x<-y")
expression_12 = Expression(x=multiplication_21, y=number_26, Expression="x<y")
merge_18 = Merge(Data1=expression_12, Data2=expression_11, Data3=expression_10)
mass_addition_3 = MassAddition(Input=merge_18)  # -> Result, PartialResults
addition_6 = Addition(A=mass_addition_3.Result, B=list_item_11)

maximum_compression_n_mm2_3 = Number(list_item_10)
maximal_tension_n_mm2_3 = Number(number_27)
maximal_deflection_mm_3 = Number(number_26)
