# Grasshopper definition Optimalisation_algorithm_Small_Corner_Dome_vaults_v5.gh (Grasshopper 1.0.7)
# plug-ins: Karamba, Pufferfish, Weaverbird, Kangaroo2 Components, Opossum2_0_Proto_A

imput_shopsize = Panel("s")
imput_shop_hallway = Panel("shop")

data = Data(imput_shopsize)
data_2 = Data(imput_shop_hallway)

# ----
# 11/22/2019
# Kangeroo form finding
# 11/22/2019
# Definition of Forces
# 11/22/2019
# Calculation FEM using karamba
# Results generation FEM
# 11/23/2019
# 11/22/2019
# Optimalisation
# 2D Tesselation generation
# 11/23/2019
# Resulting displacement
# Optimalisation values
# Karamba magic
# Assembly of model
# Shape input
# Results FEM
# Definition of Mesh and range of thickness
# Optimalisation of shell thickness
# Definition of support
# UC checks of structure
# Surrogate model optimalisation solver, output: best solution
# Definition of springs / mesh
# Rectengular grid
# Vertical loading
# Resulting principle stresses D1
# Definition of Material properties
# Output: 3-axis pareto front
# Roof loading
# (added soil)
# Resulting principle stresses D2
# Definition of 1 way constrains
# Definition of formfinding parameters
# Use if required by 2d topology
# Definition of support points
# Resulting von Mises yield criterion
# Feature point at support
# Definition of forces
# Young Modulus research paper: https://dspace.cvut.cz/bitstream/handle/10467/69500/F1-BP-2017-Gubasheva-Samal-priloha-ADOBE%20AS%20A%20BUILDING%20MATERIAL.%20pdf.pdf?sequence=3&isAllowed=y
# Resulting utilisation and cross section
# Karamba magic
# Assembly of model
# Optimalisation of shell thickness
panel = Panel("4.8")
rectangle = Rectangle(Plane=PlaneXY(0, 0, 0), XSize=panel, YSize="4.8", Radius=0)  # -> Rectangle, Length
curve = Curve(<curve referenced from the Rhino model>)
explode = Explode(Curve=rectangle.Rectangle, Recursive=True)  # -> Segments, Vertices
box_corners = BoxCorners(Box=rectangle.Rectangle)  # -> CornerA, CornerB, CornerC, CornerD, CornerE, CornerF, CornerG, CornerH
data_3 = Data(rectangle.Rectangle)
data_4 = Data(panel)
area = Area(Geometry=rectangle.Rectangle)  # -> Area, Centroid
curve_middle = CurveMiddle(Curve=explode.Segments)  # -> graft(Midpoint)
merge = Merge(Data1=box_corners.CornerA, Data2=box_corners.CornerB, Data3=box_corners.CornerC, Data4=box_corners.CornerD)  # -> graft(Result)
equality = Equality(FirstNumber="4.8", SecondNumber=2.4)  # -> Equality, Inequality
line = Line(StartPoint=curve_middle, EndPoint=area.Centroid)  # -> flatten(Line)
explode_tree = ExplodeTree(Data=graft(equality.Equality))  # -> Branch0, Branch1
point = Point(merge)
flip_matrix = FlipMatrix(Data=line)
gate_or = GateOr(A=explode_tree.Branch0, B=explode_tree.Branch1)
replace_members = ReplaceMembers(Set=gate_or, Find=[True, False], Replace=[5, 6])
explode_tree_2 = ExplodeTree(Data=flip_matrix)  # -> Branch0, Branch1, Branch2, Branch3
explode_tree_3 = ExplodeTree(Data=merge)  # -> Branch0, Branch1, Branch2, Branch3
explode_tree_4 = ExplodeTree(Data=curve_middle)  # -> Branch0, Branch1, Branch2, Branch3
line_count = Slider(20, range=0..20)
line_2 = Line(StartPoint=explode_tree_4.Branch0, EndPoint=box_corners.CornerA)  # -> flatten(Line)
line_3 = Line(StartPoint=explode_tree_4.Branch3, EndPoint=box_corners.CornerA)  # -> flatten(Line)
line_4 = Line(StartPoint=box_corners.CornerA, EndPoint=area.Centroid)  # -> flatten(Line)
line_5 = Line(StartPoint=explode_tree_4.Branch0, EndPoint=box_corners.CornerB)  # -> flatten(Line)
line_6 = Line(StartPoint=explode_tree_4.Branch1, EndPoint=box_corners.CornerB)  # -> flatten(Line)
line_7 = Line(StartPoint=box_corners.CornerB, EndPoint=area.Centroid)  # -> flatten(Line)
line_8 = Line(StartPoint=explode_tree_4.Branch1, EndPoint=box_corners.CornerC)  # -> flatten(Line)
line_9 = Line(StartPoint=box_corners.CornerC, EndPoint=explode_tree_4.Branch2)  # -> flatten(Line)
line_10 = Line(StartPoint=box_corners.CornerC, EndPoint=area.Centroid)  # -> flatten(Line)
line_11 = Line(StartPoint=explode_tree_4.Branch2, EndPoint=box_corners.CornerD)  # -> flatten(Line)
line_12 = Line(StartPoint=box_corners.CornerD, EndPoint=explode_tree_4.Branch3)  # -> flatten(Line)
line_13 = Line(StartPoint=box_corners.CornerD, EndPoint=area.Centroid)  # -> flatten(Line)
divide_curve = DivideCurve(Curve=explode_tree_2.Branch0, Count=replace_members, Kinks=False)  # -> Points, Tangents, Parameters
divide_curve_2 = DivideCurve(Curve=explode_tree_2.Branch1, Count=replace_members, Kinks=False)  # -> Points, Tangents, Parameters
divide_curve_3 = DivideCurve(Curve=explode_tree_2.Branch2, Count=replace_members, Kinks=False)  # -> Points, Tangents, Parameters
divide_curve_4 = DivideCurve(Curve=explode_tree_2.Branch3, Count=replace_members, Kinks=False)  # -> Points, Tangents, Parameters
merge_2 = Merge(Data1=divide_curve.Points, Data2=divide_curve_4.Points)  # -> flatten(Result)
merge_3 = Merge(Data1=divide_curve.Points, Data2=divide_curve_2.Points)  # -> flatten(Result)
merge_4 = Merge(Data1=divide_curve_3.Points, Data2=divide_curve_2.Points)  # -> flatten(Result)
merge_5 = Merge(Data1=divide_curve_3.Points, Data2=divide_curve_4.Points)  # -> flatten(Result)
divide_curve_5 = DivideCurve(Curve=[line_2, line_3, line_4], Count=line_count, Kinks=False)  # -> Points, Tangents, Parameters
divide_curve_6 = DivideCurve(Curve=[line_5, line_6, line_7], Count=line_count, Kinks=False)  # -> Points, Tangents, Parameters
divide_curve_7 = DivideCurve(Curve=[line_8, line_9, line_10], Count=line_count, Kinks=False)  # -> Points, Tangents, Parameters
divide_curve_8 = DivideCurve(Curve=[line_11, line_12, line_13], Count=line_count, Kinks=False)  # -> Points, Tangents, Parameters
explode_tree_5 = ExplodeTree(Data=divide_curve_5.Points)  # -> Branch0, Branch1, Branch2
explode_tree_6 = ExplodeTree(Data=divide_curve_6.Points)  # -> Branch0, Branch1, Branch2
explode_tree_7 = ExplodeTree(Data=divide_curve_7.Points)  # -> Branch0, Branch1, Branch2
explode_tree_8 = ExplodeTree(Data=divide_curve_8.Points)  # -> Branch0, Branch1, Branch2
line_14 = Line(StartPoint=explode_tree_5.Branch0, EndPoint=reverse(explode_tree_5.Branch2))  # -> flatten(Line)
line_15 = Line(StartPoint=explode_tree_5.Branch1, EndPoint=reverse(explode_tree_5.Branch2))  # -> flatten(Line)
line_16 = Line(StartPoint=explode_tree_6.Branch0, EndPoint=reverse(explode_tree_6.Branch2))  # -> flatten(Line)
line_17 = Line(StartPoint=explode_tree_6.Branch1, EndPoint=reverse(explode_tree_6.Branch2))  # -> flatten(Line)
line_18 = Line(StartPoint=explode_tree_7.Branch0, EndPoint=reverse(explode_tree_7.Branch2))  # -> flatten(Line)
line_19 = Line(StartPoint=explode_tree_8.Branch0, EndPoint=reverse(explode_tree_8.Branch2))  # -> flatten(Line)
line_20 = Line(StartPoint=explode_tree_3.Branch0, EndPoint=merge_2)
line_21 = Line(StartPoint=explode_tree_3.Branch1, EndPoint=merge_3)
line_22 = Line(StartPoint=explode_tree_3.Branch2, EndPoint=merge_4)
line_23 = Line(StartPoint=explode_tree_3.Branch3, EndPoint=merge_5)
line_24 = Line(StartPoint=explode_tree_7.Branch1, EndPoint=explode_tree_7.Branch2)  # -> flatten(Line)
line_25 = Line(StartPoint=explode_tree_8.Branch1, EndPoint=explode_tree_8.Branch2)  # -> flatten(Line)
point_2 = Point(explode_tree_5.Branch1)
point_3 = Point(explode_tree_6.Branch0)
point_4 = Point(explode_tree_7.Branch1)
point_5 = Point(explode_tree_8.Branch0)
point_6 = Point(explode_tree_8.Branch1)
point_7 = Point(explode_tree_5.Branch0)
point_8 = Point(explode_tree_6.Branch1)
point_9 = Point(explode_tree_7.Branch0)
line_26 = Line([line_25, line_19, line_14, line_15, line_16, line_17, line_18, line_24])
connection_point_support = Relay([line_20, line_21, line_22, line_23])
connection_vault_x = Relay([point_7, point_3, point_4, point_5])
connection_vault_y = Relay([point_2, point_8, point_9, point_6])
point_10 = Point(connection_vault_x)
line_27 = Line(connection_point_support)
point_11 = Point(point)
line_28 = Line(line_26)
point_12 = Point(connection_vault_y)
data_5 = Data([line_27, line_28])
data_6 = Data(point_11)
data_7 = Data(point_10)
data_8 = Data(point_12)
line_line_intersection_karamba3d = LineLineIntersectionKaramba3D(Line=flatten(data_5), LengthTolerance=0.01)  # -> IntersectionPoints, flatten(LineSubSegements)
remove_duplicate_lines_karamba3d = RemoveDuplicateLinesKaramba3D(Line=line_line_intersection_karamba3d.LineSubSegements, LimitDistance=0.005)  # -> OutLine, Info, Indexes
weaverbird_s_mesh_from_lines_weave_back = WeaverbirdsMeshFromLinesWeaveBack(Lines=remove_duplicate_lines_karamba3d.OutLine, MaximumValence=4)
anchorxyz = AnchorXYZ(Point=flatten(data_7), X=False, Y=True, Z=False, Strength=1000)
anchorxyz_2 = AnchorXYZ(Point=flatten(data_8), X=True, Y=False, Z=False, Strength=1000)
anchor = Anchor(Point=data_6, Strength=100000)
vertexloads = VertexLoads(Mesh=weaverbird_s_mesh_from_lines_weave_back, Strength=0.1)
point_13 = Point(data_6)
data_9 = Data(point_13)
xy_plane = XYPlane(Origin=Point(0, 0, 0))
point_14 = Point(data_9)
data_10 = Data(data_9)
maximal_shell_thickness_cm = Slider(200, range=0..200)
height_of_bricks_cm = Slider(9, range=0..10)
shell_cross_section_name = Panel("Shell Cross section")
distributed_vertical_load_kn_m2 = Panel("2.25")
young_modulus_n_mm2 = Panel("211")
poisson_ratio = Panel("0.3")
specific_weight_kg_m3 = Panel("1452")
compressive_strenght_n_mm2 = Panel("3")
material_adobe = Panel("adobe sucrum test")
name = Panel("shell")
point_15 = Point(data_10)
data_11 = Data(shell_cross_section_name)
data_12 = Data(maximal_shell_thickness_cm)
data_13 = Data(height_of_bricks_cm)
data_14 = Data(name)
data_15 = Data(young_modulus_n_mm2)
data_16 = Data(compressive_strenght_n_mm2)
data_17 = Data(distributed_vertical_load_kn_m2)
data_18 = Data(name)
data_19 = Data(material_adobe)
data_20 = Data(poisson_ratio)
data_21 = Data(specific_weight_kg_m3)
data_22 = Data(point_15)
data_23 = Data(specific_weight_kg_m3)
ghpython_script = GhPythonScript(e_modulus=data_15, poission_ratio=data_20)  # -> shear_modulus; inputs e_modulus: Int32, poission_ratio: Int32
# ---------- ghpython_script: Python ----------
__author__ = "kees_"
__version__ = "2019.10.08"

import rhinoscriptsyntax as rs

# 4.	calculation of shear modulus according to [Landau LD, Lifshitz EM. Theory of Elasticity, vol. 7. Course of Theoretical Physics. (2nd Ed) Pergamon: Oxford 1970 p13]

a = int(poission_ratio)
b = int(e_modulus)

shear_modulus = b/(2*(1+a))
# ---------- end ghpython_script ----------
division = Division(A=data_23, B=100)
material_properties_karamba3d = MaterialPropertiesKaramba3D(
    FamilyOfMaterial=data_19,
    Name=data_19,
    ElementIdentifier=data_14,
    YoungsModulus_kN_cm2=expr("x*0.1", data_15),
    InPlaneShearModulus_kN_cm2=expr("x*0.1", ghpython_script),
    TransverseShearModulus_kN_cm2=expr("x*0.1", ghpython_script),
    SpecificWeight_kN_m3=expr("x*0.012", data_21),
    CoefficientOfThermalExpansion_1_C=1e-05,
    YieldStrength_kN_cm2=expr("x*0.1", data_16),
    mode="Isotrop")
supp = SupportKaramba(PosInd=data_22, PlaneOfReference=PlaneXY(0, 0, 0), menu=[buttons(on, on, on, off, off, off)])  # -> flatten(Support)
Z = UnitZ(Factor=expr("x*1.5", -1))
loads_karamba3d = LoadsKaramba3D(Vector=Z, LCase=0, mode="Gravity")
data_24 = Data(supp)
data_25 = Data(loads_karamba3d)
data_26 = Data(material_properties_karamba3d)
data_27 = Data(data_26)
data_28 = Data(name)
panel_2 = Panel("""L S (house addition)(6,6)
2,11 parameters

L S  (Shop)(6,6)
4,37 parameters

L H (hallway)(5,5)
3,10 parameters
2,11 parameters
3,46 parameters
4,60 parameters


M S (Shop}(6,6)
2,16 parameters
2,22 parameters

M H (hallway) (5,5)
2,15 parameters
1,24 parameters

S S (Shop)(5,5)
1,52 parameters
2,17 parameters

S H {hallway}(5,5)
1,16 parameters
1,52 parameters""")
dome_dimension_m = Panel(data_3)
dome_width_m = Panel(data_4)
max_deflection_m = Panel("1/200")
data_29 = Data(dome_width_m)
data_30 = Data(max_deflection_m)
data_31 = Data(data_29)
data_32 = Data(data_30)
number = Number(expr("x*1000", data_31))
number_2 = Number(data_32)
multiplication = Multiplication(A=number, B=number_2)
data_33 = Data(multiplication)
data_34 = Data(data_33)
number_3 = Number(compressive_strenght_n_mm2)
min_number_of_stacked_bricks = Slider(4, range=1..4)
data_35 = Data(min_number_of_stacked_bricks)
min_number_of_stacked_bricks_2 = Panel(data_35)
data_36 = Data(min_number_of_stacked_bricks_2)
multiplication_2 = Multiplication(A=data_36, B=data_13)
construct_domain = ConstructDomain(DomainStart=multiplication_2, DomainEnd=data_12)
range = Range(Domain=construct_domain, Steps=data_13)
expression = Expression(x=data_11, y=range, Expression="x&\" \"&y")
cross_section_karamba3d = CrossSectionKaramba3D(
    FamilyNameOfCrossSection=data_11,
    NameOfCrossSection=flatten(expression),
    ElementIdentifier=data_18,
    Material=data_27,
    Height_cm=flatten(range),
    mode="Shell - Const")
data_37 = Data(cross_section_karamba3d)
spring_stiffness = Slider(41, range=10..60)
data_38 = Data(spring_stiffness)
edgelengths = EdgeLengths(Mesh=weaverbird_s_mesh_from_lines_weave_back, LengthFactor=1, Strength=expr("x/2", data_38))
zombiesolver = ZombieSolver(
    GoalObjects=flatten([anchor, anchorxyz, anchorxyz_2, edgelengths, vertexloads]),
    Threshold=1e-10,
    Tolerance=0.01,
    MaxIterations=50000)  # -> I, V, O
null_item = NullItem(Item=zombiesolver.O)  # -> NullFlags, InvalidFlags, Description
dispatch = Dispatch(List=zombiesolver.O, DispatchPattern=null_item.NullFlags)  # -> ListA, ListB
weaverbird_s_mesh_from_lines_weave_back_2 = WeaverbirdsMeshFromLinesWeaveBack(Lines=dispatch.ListB, MaximumValence=4)
weaverbird_s_catmull_clark_subdivision = WeaverbirdsCatmullClarkSubdivision(MeshCurves=weaverbird_s_mesh_from_lines_weave_back_2, Level=1, SmoothNakedEdges=0)
mesh_edges = MeshEdges(Mesh=weaverbird_s_mesh_from_lines_weave_back_2)  # -> NakedEdges, InteriorEdges, NonManifoldEdges
data_39 = Data(weaverbird_s_catmull_clark_subdivision)
data_40 = Data(data_39)
deconstruct_mesh = DeconstructMesh(Mesh=data_40)  # -> Vertices, Faces, Colours, Normals
remove_duplicate_points_karamba3d = RemoveDuplicatePointsKaramba3D(Point=deconstruct_mesh.Vertices, LimitDistance=0.005)  # -> OutPoint, Info, Indexes
evaluate_box = EvaluateBox(Box=data_40, UParameter=0.5, VParameter=0.5, WParameter=1)  # -> Plane, Point, Include
convex_hull = ConvexHull(Points=remove_duplicate_points_karamba3d.OutPoint, Plane=PlaneXY(0, 0, 0))  # -> Hull, HullZ, Indices
deconstruct = Deconstruct(Point=remove_duplicate_points_karamba3d.OutPoint)  # -> XComponent, YComponent, ZComponent
deconstruct_2 = Deconstruct(Point=evaluate_box.Point)  # -> XComponent, YComponent, ZComponent
voronoi = Voronoi(Points=remove_duplicate_points_karamba3d.OutPoint, Boundary=convex_hull.Hull, Plane=xy_plane, BruteForceOverride=False)
construct_point = ConstructPoint(XCoordinate=0, YCoordinate=0, ZCoordinate=deconstruct.ZComponent)
construct_point_2 = ConstructPoint(XCoordinate=0, YCoordinate=0, ZCoordinate=deconstruct_2.ZComponent)
area_2 = Area(Geometry=voronoi)  # -> Area, Centroid
replace_nulls = ReplaceNulls(Items=area_2.Area, Replacements=0)  # -> Items, Count
distance = Distance(PointA=construct_point, PointB=construct_point_2)  # -> expr("x/2", Distance)
number_4 = Number(distance)
number_5 = Number(replace_nulls.Items)
data_41 = Data(data_40)
point_16 = Point(remove_duplicate_points_karamba3d.OutPoint)
mesh_edges_2 = MeshEdges(Mesh=data_41)  # -> NakedEdges, InteriorEdges, NonManifoldEdges
data_42 = Data(data_40)
data_43 = Data(point_16)
data_44 = Data(number_4)
data_45 = Data(number_5)
number_6 = Number(data_45)
number_7 = Number(data_44)
point_17 = Point(data_43)
mesh = Mesh(data_42)
data_46 = Data(point_17)
data_47 = Data(mesh)
data_48 = Data(number_6)
data_49 = Data(number_7)
multiplication_3 = Multiplication(A=data_48, B=data_17)
multiplication_4 = Multiplication(A=data_48, B=data_49)
multiplication_5 = Multiplication(A=multiplication_4, B=division)
addition = Addition(A=multiplication_3, B=multiplication_5)
unit_z = UnitZ(Factor=addition)
loads_karamba3d_2 = LoadsKaramba3D(ForceVector=expr("X*-1.5", unit_z), Local=False, PosInd=data_46, LCase=0, mode="Point")
meshtoshell = MeshToShellKaramba(Mesh=data_47, Identifier=data_18, CrossSection=cross_section_karamba3d, LimitDistance_m=0.005)  # -> Element, Points, Info
data_50 = Data(meshtoshell.Element)
data_51 = Data(loads_karamba3d_2)
assemble = AssembleModelKaramba(Elem=data_50, Support=flatten(data_24), Load=flatten([data_25, data_51]), LimitDistance_m=0.005)  # -> Model, Info, Mass_kg, CenterOfGravity
optimize_cross_section_karamba3d = OptimizeCrossSectionKaramba3D(
    Model=assemble.Model,
    ElemIdentifiers=data_28,
    CrossSections=data_37,
    MaximumUtilization=1,
    MaximumDisplacement_cm=data_34,
    UltimateLimitStateIterations=5,
    DisplacementIterations=5,
    NumberOfSamplePoints=3,
    ElasticDesign=True,
    GammaM0=1,
    GammaM1=1)  # -> ModelWithOptimizedCrossSections, Info, Mass_kg, MaximumDisplacement_cm, ElasticEnergy_kNm
analyze_karamba3d = AnalyzeKaramba3D(Model=optimize_cross_section_karamba3d.ModelWithOptimizedCrossSections)  # -> CalculatedModel, MaximumDisplacement_cm, ResultingForceOfGravity_kN, ElasticEnergy_kNm
panel_3 = Panel(optimize_cross_section_karamba3d.ModelWithOptimizedCrossSections)
data_52 = Data(analyze_karamba3d.CalculatedModel)
data_53 = Data(data_52)
model_view_karamba3d = ModelViewKaramba3D(Model=data_53, LoadCaseFactorsForLinearSuperposition=1, IndexOfVisibleLoadcase=-1)  # -> Model, DeformedMesh, DeformedAxes, DeformedModel
shellview = ShellViewKaramba(Model=model_view_karamba3d.Model, IndexOfLayer=0)  # -> Model, MeshesOfRenderedShells, LegendColors, LegendTags
shellview_2 = ShellViewKaramba(Model=model_view_karamba3d.Model, IndexOfLayer=0)  # -> Model, MeshesOfRenderedShells, LegendColors, LegendTags
shellview_3 = ShellViewKaramba(Model=model_view_karamba3d.Model, IndexOfLayer=0)  # -> Model, MeshesOfRenderedShells, LegendColors, LegendTags
reaction_forces_karamba3d = ReactionForcesKaramba3D(AnalyzedModel=model_view_karamba3d.Model, LoadCase=0)  # -> AnalyzedModel, ReactionForces_kN, ReactionMoments_kNm, SupportPosition, SumOfReactionForces_kN, SumOfReactionMoments_kNm
shellview_4 = ShellViewKaramba(Model=model_view_karamba3d.Model, IndexOfLayer=0)  # -> Model, MeshesOfRenderedShells, LegendColors, LegendTags
nodedisp = NodalDisplacementsKaramba(AnalyzedModel=model_view_karamba3d.Model, LoadCase=0)  # -> AnalyzedModel, NodalTranslations_m, NodalRotations_rad
last_index = LastIndex(List=shellview.LegendTags)
last_index_2 = LastIndex(List=shellview_2.LegendTags)
mesh_2 = Mesh(shellview.MeshesOfRenderedShells)
last_index_3 = LastIndex(List=shellview_3.LegendTags)
pdecon = Deconstruct(Point=nodedisp.NodalTranslations_m)  # -> XComponent, YComponent, expr("x*1000", ZComponent)
mesh_3 = Mesh(shellview_2.MeshesOfRenderedShells)
multiplication_6 = Multiplication(A=shellview.LegendTags, B=10)
multiplication_7 = Multiplication(A=shellview_2.LegendTags, B=10)
multiplication_8 = Multiplication(A=shellview_3.LegendTags, B=10)
cull_index = CullIndex(List=multiplication_6, Indices=flatten(last_index), Wrap=True)
cull_index_2 = CullIndex(List=multiplication_7, Indices=flatten(last_index_2), Wrap=True)
cull_index_3 = CullIndex(List=multiplication_8, Indices=flatten(last_index_3), Wrap=True)
absolute = Absolute(Value=pdecon.ZComponent)
shellview_5 = ShellViewKaramba(Model=shellview_4.Model, IndexOfLayer=0)  # -> Model, MeshesOfRenderedShells, LegendColors, LegendTags
split_list = SplitList(List=cull_index, Index=1)  # -> ListA, ListB
split_list_2 = SplitList(List=cull_index_2, Index=1)  # -> ListA, ListB
split_list_3 = SplitList(List=cull_index_3, Index=1)  # -> ListA, ListB
list_item = ListItem(List=reaction_forces_karamba3d.ReactionForces_kN, Index=0, Wrap=True)
bounds = Bounds(Numbers=split_list.ListB)
bounds_2 = Bounds(Numbers=absolute)
bounds_3 = Bounds(Numbers=split_list_2.ListB)
bounds_4 = Bounds(Numbers=split_list_3.ListB)
shellview_6 = ShellViewKaramba(Model=shellview_5.Model, IndexOfLayer=0)  # -> Model, MeshesOfRenderedShells, LegendColors, LegendTags
deconstruct_3 = Deconstruct(Point=list_item)  # -> XComponent, YComponent, ZComponent
deconstruct_domain = DeconstructDomain(Domain=bounds)  # -> Start, End
deconstruct_domain_2 = DeconstructDomain(Domain=bounds_2)  # -> Start, End
deconstruct_domain_3 = DeconstructDomain(Domain=bounds_3)  # -> Start, End
deconstruct_domain_4 = DeconstructDomain(Domain=bounds_4)  # -> Start, End
data_54 = Data(flatten(deconstruct_3.XComponent))
data_55 = Data(flatten(deconstruct_3.YComponent))
data_56 = Data(flatten(deconstruct_domain_2.End))
data_57 = Data(flatten(deconstruct_domain_3.Start))
data_58 = Data(flatten(deconstruct_domain_3.End))
data_59 = Data(flatten(deconstruct_domain.Start))
data_60 = Data(flatten(deconstruct_domain.End))
data_61 = Data(flatten(deconstruct_domain_4.End))
data_62 = Data(flatten(deconstruct_3.ZComponent))
data_63 = Data(flatten(shellview_6.LegendColors))
data_64 = Data(flatten(shellview_6.LegendTags))
data_65 = Data(flatten(shellview_5.LegendColors))
data_66 = Data(flatten(shellview_5.LegendTags))
data_67 = Data(flatten(shellview_4.LegendColors))
data_68 = Data(flatten(shellview_4.LegendTags))
# Definition of shell
# Material properties from test
# Supports
# Loads
data_69 = Data(flatten(shellview_4.MeshesOfRenderedShells))
legend = Legend(Colour=data_63, Tags=data_64, LegendType=1)
legend_2 = Legend(Colour=data_65, Tags=data_66, LegendType=1)
legend_3 = Legend(Colour=data_67, Tags=data_68, LegendType=1)
x_horizontal_resultant_force_kn = Panel(data_54)
y_horizontal_resultant_force_kn = Panel(data_55)
z_vertical_resultant_force_kn = Panel(data_62)
max_compression_stress_p1_n_mm2 = Panel(data_57)
max_tensile_stress_p1_n_mm2 = Panel(data_58)
max_compression_stress_p2_n_mm2 = Panel(data_59)
max_tensile_stress_p2_n_mm2 = Panel(data_60)
max_displacement_mm = Panel(data_56)
data_70 = Data(max_displacement_mm)
data_71 = Data(max_compression_stress_p1_n_mm2)
data_72 = Data(max_tensile_stress_p1_n_mm2)
data_73 = Data(max_compression_stress_p2_n_mm2)
data_74 = Data(max_tensile_stress_p2_n_mm2)
data_75 = Data(data_71)
data_76 = Data(data_73)
data_77 = Data(data_74)
data_78 = Data(data_70)
data_79 = Data(data_72)
absolute_2 = Absolute(Value=[data_75, data_76])
absolute_3 = Absolute(Value=[data_79, data_77])
number_8 = Number(data_78)
sort_list = SortList(Keys=absolute_2)  # -> Keys, ValuesValuesA
sort_list_2 = SortList(Keys=absolute_3)  # -> Keys, ValuesValuesA
list_item_2 = ListItem(List=sort_list.Keys, Index=1, Wrap=True)
list_item_3 = ListItem(List=sort_list_2.Keys, Index=1, Wrap=True)
number_9 = Number(list_item_3)
expression_2 = Expression(x=number_9, y=number_3, Expression="x>y/10")
expression_3 = Expression(x=list_item_2, y=number_3, Expression="x<-y")
expression_4 = Expression(x=multiplication, y=number_8, Expression="x<y")
merge_6 = Merge(Data1=expression_4, Data2=expression_3, Data3=expression_2)
mass_addition = MassAddition(Input=merge_6)  # -> Result, PartialResults
addition_2 = Addition(A=mass_addition.Result, B=list_item_3)
maximum_compression_n_mm2 = Number(list_item_2)
maximal_tension_n_mm2 = Number(number_9)
maximal_deflection_mm = Number(number_8)
opossum = Opossum(
    OpossumData_NumberOfObjectives=1,
    OpossumData_OptimizationType=0,
    OpossumData_ResultSerializationStatus=0,
    OpossumData_ObjectiveValue=[0.292, 3.45, 1.316, 2.466, 1.455, 0.227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],
    OpossumData_ParameterList=["4,59", "1,14", "2,35", "1,47", "4,25", "4,41", "4,38", "4,40", "4,53", "4,30"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],
    OpossumData_objective=addition_2,
    OpossumData_variable=[min_number_of_stacked_bricks, spring_stiffness])

curve_2 = Curve(<curve referenced from the Rhino model>)

# ----
# 2D Tesselation generation
# Rectengular grid
# Feature point at support
ghpython_script_2 = GhPythonScript(shop_size=data)  # -> width_of_shop
# ---------- ghpython_script_2: Python ----------
__author__ = "kees_"
__version__ = "2019.10.09"

sizes = {'s':2.4, 'm':4.80, 'l':9.60}
width_of_shop = sizes.get(shop_size)
# ---------- end ghpython_script_2 ----------
ghpython_script_3 = GhPythonScript(width=data_2)  # -> width_of_shop
# ---------- ghpython_script_3: Python ----------
__author__ = "kees_"
__version__ = "2019.10.09"

sizes = {'hallway':2.4, 'shop':3.6}
width_of_shop = sizes.get(width)
# ---------- end ghpython_script_3 ----------
rectangle_2 = Rectangle(Plane=PlaneXY(0, 0, 0), XSize=ghpython_script_2, YSize=ghpython_script_3, Radius=0)  # -> Rectangle, Length
explode_2 = Explode(Curve=curve_2, Recursive=True)  # -> Segments, Vertices
box_corners_2 = BoxCorners(Box=curve_2)  # -> CornerA, CornerB, CornerC, CornerD, CornerE, CornerF, CornerG, CornerH
data_80 = Data(curve_2)
data_81 = Data("4.8")
area_3 = Area(Geometry=curve_2)  # -> Area, Centroid
curve_middle_2 = CurveMiddle(Curve=explode_2.Segments)  # -> graft(Midpoint)
merge_7 = Merge(Data1=box_corners_2.CornerA, Data2=box_corners_2.CornerB, Data3=box_corners_2.CornerC, Data4=box_corners_2.CornerD)  # -> graft(Result)
equality_2 = Equality(FirstNumber="4.8", SecondNumber=2.4)  # -> Equality, Inequality
explode_tree_9 = ExplodeTree(Data=graft(equality_2.Equality))  # -> Branch0, Branch1
point_18 = Point(merge_7)
gate_or_2 = GateOr(A=explode_tree_9.Branch0, B=explode_tree_9.Branch1)
replace_members_2 = ReplaceMembers(Set=gate_or_2, Find=[True, False], Replace=[5, 6])
explode_tree_10 = ExplodeTree(Data=curve_middle_2)  # -> Branch0, Branch1, Branch2, Branch3
line_count_2 = Slider(20, range=0..20)
line_29 = Line(StartPoint=explode_tree_10.Branch0, EndPoint=box_corners_2.CornerA)  # -> flatten(Line)
line_30 = Line(StartPoint=explode_tree_10.Branch3, EndPoint=box_corners_2.CornerA)  # -> flatten(Line)
line_31 = Line(StartPoint=box_corners_2.CornerA, EndPoint=area_3.Centroid)  # -> flatten(Line)
line_32 = Line(StartPoint=explode_tree_10.Branch0, EndPoint=box_corners_2.CornerB)  # -> flatten(Line)
line_33 = Line(StartPoint=explode_tree_10.Branch1, EndPoint=box_corners_2.CornerB)  # -> flatten(Line)
line_34 = Line(StartPoint=box_corners_2.CornerB, EndPoint=area_3.Centroid)  # -> flatten(Line)
line_35 = Line(StartPoint=explode_tree_10.Branch1, EndPoint=box_corners_2.CornerC)  # -> flatten(Line)
line_36 = Line(StartPoint=box_corners_2.CornerC, EndPoint=explode_tree_10.Branch2)  # -> flatten(Line)
line_37 = Line(StartPoint=box_corners_2.CornerC, EndPoint=area_3.Centroid)  # -> flatten(Line)
line_38 = Line(StartPoint=explode_tree_10.Branch2, EndPoint=box_corners_2.CornerD)  # -> flatten(Line)
line_39 = Line(StartPoint=box_corners_2.CornerD, EndPoint=explode_tree_10.Branch3)  # -> flatten(Line)
line_40 = Line(StartPoint=box_corners_2.CornerD, EndPoint=area_3.Centroid)  # -> flatten(Line)
divide_curve_9 = DivideCurve(Curve=[line_29, line_31, line_30], Count=line_count_2, Kinks=False)  # -> Points, Tangents, Parameters
divide_curve_10 = DivideCurve(Curve=[line_32, line_34, line_33], Count=line_count_2, Kinks=False)  # -> Points, Tangents, Parameters
divide_curve_11 = DivideCurve(Curve=[line_35, line_37, line_36], Count=line_count_2, Kinks=False)  # -> Points, Tangents, Parameters
divide_curve_12 = DivideCurve(Curve=[line_38, line_40, line_39], Count=line_count_2, Kinks=False)  # -> Points, Tangents, Parameters
explode_tree_11 = ExplodeTree(Data=divide_curve_9.Points)  # -> Branch0, Branch1, Branch2
explode_tree_12 = ExplodeTree(Data=divide_curve_10.Points)  # -> Branch0, Branch1, Branch2
explode_tree_13 = ExplodeTree(Data=divide_curve_11.Points)  # -> Branch0, Branch1, Branch2
explode_tree_14 = ExplodeTree(Data=divide_curve_12.Points)  # -> Branch0, Branch1, Branch2
line_41 = Line(StartPoint=explode_tree_11.Branch0, EndPoint=reverse(explode_tree_11.Branch2))  # -> flatten(Line)
line_42 = Line(StartPoint=explode_tree_11.Branch1, EndPoint=reverse(explode_tree_11.Branch2))  # -> flatten(Line)
line_43 = Line(StartPoint=explode_tree_12.Branch0, EndPoint=reverse(explode_tree_12.Branch2))  # -> flatten(Line)
line_44 = Line(StartPoint=explode_tree_12.Branch1, EndPoint=reverse(explode_tree_12.Branch2))  # -> flatten(Line)
line_45 = Line(StartPoint=explode_tree_13.Branch0, EndPoint=reverse(explode_tree_13.Branch2))  # -> flatten(Line)
line_46 = Line(StartPoint=explode_tree_14.Branch0, EndPoint=reverse(explode_tree_14.Branch2))  # -> flatten(Line)
line_47 = Line(StartPoint=explode_tree_13.Branch1, EndPoint=explode_tree_13.Branch2)  # -> flatten(Line)
line_48 = Line(StartPoint=explode_tree_14.Branch1, EndPoint=explode_tree_14.Branch2)  # -> flatten(Line)
point_19 = Point(explode_tree_11.Branch1)
point_20 = Point(explode_tree_12.Branch0)
point_21 = Point(explode_tree_14.Branch0)
point_22 = Point(explode_tree_14.Branch1)
point_23 = Point(explode_tree_11.Branch0)
point_24 = Point(explode_tree_12.Branch1)
point_25 = Point(explode_tree_13.Branch1)
point_26 = Point(explode_tree_13.Branch0)
# 11/22/2019
line_49 = Line([line_48, line_46, line_41, line_47, line_42, line_45, line_43, line_44])

line_50 = Line(StartPoint=curve_middle_2, EndPoint=area_3.Centroid)  # -> flatten(Line)
flip_matrix_2 = FlipMatrix(Data=line_50)
explode_tree_15 = ExplodeTree(Data=flip_matrix_2)  # -> Branch0, Branch1, Branch2, Branch3
explode_tree_16 = ExplodeTree(Data=merge_7)  # -> Branch0, Branch1, Branch2, Branch3
divide_curve_13 = DivideCurve(Curve=explode_tree_15.Branch0, Count=replace_members_2, Kinks=False)  # -> Points, Tangents, Parameters
divide_curve_14 = DivideCurve(Curve=explode_tree_15.Branch1, Count=replace_members_2, Kinks=False)  # -> Points, Tangents, Parameters
divide_curve_15 = DivideCurve(Curve=explode_tree_15.Branch2, Count=replace_members_2, Kinks=False)  # -> Points, Tangents, Parameters
divide_curve_16 = DivideCurve(Curve=explode_tree_15.Branch3, Count=replace_members_2, Kinks=False)  # -> Points, Tangents, Parameters
merge_8 = Merge(Data1=divide_curve_13.Points, Data2=divide_curve_16.Points)  # -> flatten(Result)
merge_9 = Merge(Data1=divide_curve_13.Points, Data2=divide_curve_14.Points)  # -> flatten(Result)
merge_10 = Merge(Data1=divide_curve_15.Points, Data2=divide_curve_14.Points)  # -> flatten(Result)
merge_11 = Merge(Data1=divide_curve_15.Points, Data2=divide_curve_16.Points)  # -> flatten(Result)
line_51 = Line(StartPoint=explode_tree_16.Branch0, EndPoint=merge_8)
line_52 = Line(StartPoint=explode_tree_16.Branch1, EndPoint=merge_9)
line_53 = Line(StartPoint=explode_tree_16.Branch2, EndPoint=merge_10)
line_54 = Line(StartPoint=explode_tree_16.Branch3, EndPoint=merge_11)

connection_point_support_2 = Relay([line_51, line_52, line_53, line_54])
connection_vault_x_2 = Relay([point_23, point_20, point_25, point_21])
connection_vault_y_2 = Relay([point_19, point_24, point_26, point_22])
point_27 = Point(point_18)
line_55 = Line(line_49)
point_28 = Point(connection_vault_x_2)
point_29 = Point(connection_vault_y_2)
line_56 = Line(connection_point_support_2)

point_30 = Point(box_corners_2.CornerD)

data_82 = Data([line_56, line_55])
data_83 = Data(point_28)
data_84 = Data(point_29)
# Kangeroo form finding
data_85 = Data(point_27)

point_31 = Point(point_30)
unit_z_2 = UnitZ(Factor=Slider(2.4, range=0..10))
move = Move(Geometry=point_31, Motion=unit_z_2)  # -> Geometry, Transform
curve_3 = Curve(<curve referenced from the Rhino model>)
unit_z_3 = UnitZ(Factor=Slider(-0.2, range=-1..0))

young_modulus_n_mm2_2 = Panel("211")
poisson_ratio_2 = Panel("0.3")
specific_weight_kg_m3_2 = Panel("1452")
compressive_strenght_n_mm2_2 = Panel("3")
material_adobe_2 = Panel("adobe sucrum test")

min_number_of_stacked_bricks_3 = Slider(2, range=1..4)
# 11/23/2019
# Optimalisation values
spring_stiffness_2 = Slider(17, range=10..60)

data_86 = Data(spring_stiffness_2)

# ----
# Definition of support
# Definition of springs / mesh
# Definition of 1 way constrains
# Use if required by 2d topology
line_line_intersection_karamba3d_2 = LineLineIntersectionKaramba3D(Line=flatten(data_82), LengthTolerance=0.01)  # -> IntersectionPoints, flatten(LineSubSegements)
remove_duplicate_lines_karamba3d_2 = RemoveDuplicateLinesKaramba3D(Line=line_line_intersection_karamba3d_2.LineSubSegements, LimitDistance=0.005)  # -> OutLine, Info, Indexes
weaverbird_s_mesh_from_lines_weave_back_3 = WeaverbirdsMeshFromLinesWeaveBack(Lines=remove_duplicate_lines_karamba3d_2.OutLine, MaximumValence=4)
edgelengths_2 = EdgeLengths(Mesh=weaverbird_s_mesh_from_lines_weave_back_3, LengthFactor=1, Strength=expr("x/2", data_86))
anchorxyz_3 = AnchorXYZ(Point=flatten(data_83), X=False, Y=True, Z=False, Strength=1000)  # disabled
anchorxyz_4 = AnchorXYZ(Point=flatten(data_84), X=True, Y=False, Z=False, Strength=1000)  # disabled
anchor_2 = Anchor(Point=data_85, Strength=100000)
vertexloads_2 = VertexLoads(Mesh=weaverbird_s_mesh_from_lines_weave_back_3, Strength=0.1)
zombiesolver_2 = ZombieSolver(
    GoalObjects=flatten([anchor_2, anchorxyz_4, anchorxyz_3, vertexloads_2, edgelengths_2]),
    Threshold=1e-10,
    Tolerance=0.01,
    MaxIterations=50000)  # -> I, V, O; disabled
null_item_2 = NullItem()  # -> NullFlags, InvalidFlags, Description
dispatch_2 = Dispatch(DispatchPattern=null_item_2.NullFlags)  # -> ListA, ListB
weaverbird_s_mesh_from_lines_weave_back_4 = WeaverbirdsMeshFromLinesWeaveBack(Lines=dispatch_2.ListB, MaximumValence=4)

mesh_4 = Mesh(weaverbird_s_mesh_from_lines_weave_back_3)
deconstruct_mesh_2 = DeconstructMesh(Mesh=mesh_4)  # -> Vertices, Faces, Colours, Normals
meshcorners = MeshCorners(Mesh=mesh_4, Angle=2.35619449)
list_item_4 = ListItem(List=meshcorners, Index=0, Wrap=True)  # -> Item2, Item1, Item, Item1_2
curve_closest_point = CurveClosestPoint(Point=deconstruct_mesh_2.Vertices, Curve=curve_3)  # -> Point, Parameter, Distance
evaluate = Evaluate(Expression="If(x<0.001, true, false)", x=curve_closest_point.Distance)
panel_4 = Panel(evaluate)
cull_pattern = CullPattern(List=deconstruct_mesh_2.Vertices, CullPattern=evaluate)
edgelengths_3 = EdgeLengths(Mesh=mesh_4, LengthFactor=1, Strength=50)
anchorxyz_5 = AnchorXYZ(Point=cull_pattern, X=True, Y=True, Z=False, Strength="10000")
# elevated corner
anchor_3 = Anchor(Point=list_item_4.Item1_2, Target=move.Geometry, Strength=10000)
# 3 corner
anchor_4 = Anchor(Point=[list_item_4.Item2, list_item_4.Item1, list_item_4.Item], Strength=10000)
vertexloads_3 = VertexLoads(Mesh=mesh_4, Strength=unit_z_3)
zombiesolver_3 = ZombieSolver(
    GoalObjects=[vertexloads_3, anchorxyz_5, edgelengths_3, anchor_4, anchor_3],
    Threshold=1e-10,
    Tolerance=0.01,
    MaxIterations=50000)  # -> I, V, O; disabled
mesh_edges_3 = MeshEdges(Mesh=weaverbird_s_mesh_from_lines_weave_back_4)  # -> NakedEdges, InteriorEdges, NonManifoldEdges
solver = Solver(
    GoalObjects=[vertexloads_3, edgelengths_3, anchor_4, anchor_3, anchorxyz_5],
    Reset=Button(),
    Threshold=1e-15,
    Tolerance=0.01,
    On=True)  # -> I, V, O; disabled
curve_4 = Curve(flatten(zombiesolver_3.O))
weaverbird_s_mesh_from_lines_weave_back_5 = WeaverbirdsMeshFromLinesWeaveBack(Lines=curve_4, MaximumValence=4)
weaverbird_s_catmull_clark_subdivision_2 = WeaverbirdsCatmullClarkSubdivision(MeshCurves=weaverbird_s_mesh_from_lines_weave_back_5, Level=1, SmoothNakedEdges=0)
# 11/22/2019
meshcorners_2 = MeshCorners(Mesh=weaverbird_s_catmull_clark_subdivision_2, Angle=2.35619449)

data_87 = Data(weaverbird_s_catmull_clark_subdivision_2)
point_32 = Point(meshcorners_2)

# ----
# Definition of Forces
data_88 = Data(point_32)
data_89 = Data(data_87)

# ----
# Vertical loading
deconstruct_mesh_3 = DeconstructMesh(Mesh=data_89)  # -> Vertices, Faces, Colours, Normals
remove_duplicate_points_karamba3d_2 = RemoveDuplicatePointsKaramba3D(Point=deconstruct_mesh_3.Vertices, LimitDistance=0.005)  # -> OutPoint, Info, Indexes
# Roof loading
# (added soil)
evaluate_box_2 = EvaluateBox(Box=data_89, UParameter=0.5, VParameter=0.5, WParameter=1)  # -> Plane, Point, Include
xy_plane_2 = XYPlane(Origin=Point(0, 0, 0))
convex_hull_2 = ConvexHull(Points=remove_duplicate_points_karamba3d_2.OutPoint, Plane=PlaneXY(0, 0, 0))  # -> Hull, HullZ, Indices
deconstruct_4 = Deconstruct(Point=remove_duplicate_points_karamba3d_2.OutPoint)  # -> XComponent, YComponent, ZComponent
deconstruct_5 = Deconstruct(Point=evaluate_box_2.Point)  # -> XComponent, YComponent, ZComponent
voronoi_2 = Voronoi(
    Points=remove_duplicate_points_karamba3d_2.OutPoint,
    Boundary=convex_hull_2.Hull,
    Plane=xy_plane_2,
    BruteForceOverride=False)
construct_point_3 = ConstructPoint(XCoordinate=0, YCoordinate=0, ZCoordinate=deconstruct_4.ZComponent)
construct_point_4 = ConstructPoint(XCoordinate=0, YCoordinate=0, ZCoordinate=deconstruct_5.ZComponent)
area_4 = Area(Geometry=voronoi_2)  # -> Area, Centroid
# 11/22/2019
replace_nulls_2 = ReplaceNulls(Items=area_4.Area, Replacements=0)  # -> Items, Count
distance_2 = Distance(PointA=construct_point_3, PointB=construct_point_4)  # -> expr("x/2", Distance)

point_33 = Point(data_88)
number_10 = Number(distance_2)
number_11 = Number(replace_nulls_2.Items)
data_90 = Data(data_89)
point_34 = Point(remove_duplicate_points_karamba3d_2.OutPoint)

mesh_edges_4 = MeshEdges(Mesh=data_90)  # -> NakedEdges, InteriorEdges, NonManifoldEdges

# ----
# Young Modulus research paper: https://dspace.cvut.cz/bitstream/handle/10467/69500/F1-BP-2017-Gubasheva-Samal-priloha-ADOBE%20AS%20A%20BUILDING%20MATERIAL.%20pdf.pdf?sequence=3&isAllowed=y
data_91 = Data(min_number_of_stacked_bricks_3)
maximal_shell_thickness_cm_2 = Slider(200, range=0..200)
height_of_bricks_cm_2 = Slider(9, range=0..10)
min_number_of_stacked_bricks_4 = Panel(data_91)
shell_cross_section_name_2 = Panel("Shell Cross section")
distributed_vertical_load_kn_m2_2 = Panel("2.25")
name_2 = Panel("shell")

data_92 = Data(name_2)
data_93 = Data(young_modulus_n_mm2_2)
data_94 = Data(specific_weight_kg_m3_2)
data_95 = Data(compressive_strenght_n_mm2_2)
data_96 = Data(material_adobe_2)
data_97 = Data(poisson_ratio_2)
ghpython_script_4 = GhPythonScript(e_modulus=data_93, poission_ratio=data_97)  # -> shear_modulus; inputs e_modulus: Int32, poission_ratio: Int32; same code as ghpython_script
material_properties_karamba3d_2 = MaterialPropertiesKaramba3D(
    FamilyOfMaterial=data_96,
    Name=data_96,
    ElementIdentifier=data_92,
    YoungsModulus_kN_cm2=expr("x*0.1", data_93),
    InPlaneShearModulus_kN_cm2=expr("x*0.1", ghpython_script_4),
    TransverseShearModulus_kN_cm2=expr("x*0.1", ghpython_script_4),
    SpecificWeight_kN_m3=expr("x*0.012", data_94),
    CoefficientOfThermalExpansion_1_C=1e-05,
    YieldStrength_kN_cm2=expr("x*0.1", data_95),
    mode="Isotrop")

# ----
# Shape input
# Definition of Mesh and range of thickness
# Definition of formfinding parameters
# Definition of support points
# Definition of forces
data_98 = Data(data_89)

data_99 = Data(point_34)
data_100 = Data(number_10)
data_101 = Data(number_11)
# Calculation FEM using karamba
data_102 = Data(data_88)
number_12 = Number(data_101)
number_13 = Number(data_100)
point_35 = Point(data_99)
point_36 = Point(data_102)
mesh_5 = Mesh(data_98)

data_103 = Data(point_36)
supp_2 = SupportKaramba(PosInd=data_103, PlaneOfReference=PlaneXY(0, 0, 0), menu=[buttons(on, on, on, off, off, off)])  # -> flatten(Support)

data_104 = Data(number_12)
data_105 = Data(distributed_vertical_load_kn_m2_2)
data_106 = Data(point_35)
data_107 = Data(number_13)
data_108 = Data(specific_weight_kg_m3_2)
multiplication_9 = Multiplication(A=data_104, B=data_105)
multiplication_10 = Multiplication(A=data_104, B=data_107)
division_2 = Division(A=data_108, B=100)
multiplication_11 = Multiplication(A=multiplication_10, B=division_2)
addition_3 = Addition(A=multiplication_9, B=multiplication_11)
unit_z_4 = UnitZ(Factor=addition_3)
Z_2 = UnitZ(Factor=expr("x*1.5", -1))

loads_karamba3d_3 = LoadsKaramba3D(Vector=Z_2, LCase=0, mode="Gravity")
loads_karamba3d_4 = LoadsKaramba3D(ForceVector=unit_z_4, Local=False, PosInd=data_106, LCase=0, mode="Point")

# ----
# Definition of Material properties
data_109 = Data(mesh_5)
data_110 = Data(shell_cross_section_name_2)
data_111 = Data(maximal_shell_thickness_cm_2)
data_112 = Data(height_of_bricks_cm_2)
data_113 = Data(name_2)
data_114 = Data(min_number_of_stacked_bricks_4)

multiplication_12 = Multiplication(A=data_114, B=data_112)
construct_domain_2 = ConstructDomain(DomainStart=multiplication_12, DomainEnd=data_111)
range_2 = Range(Domain=construct_domain_2, Steps=data_112)
expression_5 = Expression(x=data_110, y=range_2, Expression="x&\" \"&y")

data_115 = Data(supp_2)
data_116 = Data(loads_karamba3d_3)
data_117 = Data(loads_karamba3d_4)
data_118 = Data(material_properties_karamba3d_2)

data_119 = Data(data_118)

cross_section_karamba3d_2 = CrossSectionKaramba3D(
    FamilyNameOfCrossSection=data_110,
    NameOfCrossSection=flatten(expression_5),
    ElementIdentifier=data_113,
    Material=data_119,
    Height_cm=flatten(range_2),
    mode="Shell - Const")
meshtoshell_2 = MeshToShellKaramba(Mesh=data_109, Identifier=data_113, CrossSection=cross_section_karamba3d_2, LimitDistance_m=0.005)  # -> Element, Points, Info

data_120 = Data(meshtoshell_2.Element)
assemble_2 = AssembleModelKaramba(Elem=data_120, Support=flatten(data_115), Load=flatten([data_116, data_117]), LimitDistance_m=0.005)  # -> Model, Info, Mass_kg, CenterOfGravity; disabled

# ----
# Assembly of model
# Optimalisation of shell thickness
data_121 = Data(cross_section_karamba3d_2)
data_122 = Data(name_2)

# ----
# Resulting displacement
# Results FEM
# Resulting principle stresses D1
# Resulting principle stresses D2
# Resulting von Mises yield criterion
# Resulting utilisation and cross section
panel_5 = Panel("""L S (house addition)(6,6)
2,11 parameters

L S  (Shop)(6,6)
4,37 parameters

L H (hallway)(5,5)
3,10 parameters
2,11 parameters
3,46 parameters
4,60 parameters


M S (Shop}(6,6)
2,16 parameters
2,22 parameters

M H (hallway) (5,5)
2,15 parameters
1,24 parameters

S S (Shop)(5,5)
1,52 parameters
2,17 parameters

S H {hallway}(5,5)
1,16 parameters
1,52 parameters""")

# ----
# 11/23/2019
dome_dimension_m_2 = Panel(data_80)
dome_width_m_2 = Panel(data_81)
max_deflection_m_2 = Panel("1/200")

data_123 = Data(max_deflection_m_2)
data_124 = Data(dome_width_m_2)

# ----
# Optimalisation
data_125 = Data(data_124)
data_126 = Data(data_123)

number_14 = Number(expr("x*1000", data_125))
number_15 = Number(data_126)
multiplication_13 = Multiplication(A=number_14, B=number_15)
number_16 = Number(compressive_strenght_n_mm2_2)
opossum_2 = Opossum(
    OpossumData_NumberOfObjectives=0,
    OpossumData_OptimizationType=0,
    OpossumData_ResultSerializationStatus=0,
    OpossumData_objective=addition_4)

# ----
# UC checks of structure
# Surrogate model optimalisation solver, output: best solution
# Output: 3-axis pareto front
data_127 = Data(multiplication_13)

data_128 = Data(data_127)

optimize_cross_section_karamba3d_2 = OptimizeCrossSectionKaramba3D(
    Model=assemble_2.Model,
    ElemIdentifiers=data_122,
    CrossSections=data_121,
    MaximumUtilization=1,
    MaximumDisplacement_cm=data_128,
    UltimateLimitStateIterations=5,
    DisplacementIterations=5,
    NumberOfSamplePoints=3,
    ElasticDesign=True,
    GammaM0=1,
    GammaM1=1)  # -> ModelWithOptimizedCrossSections, Info, Mass_kg, MaximumDisplacement_cm, ElasticEnergy_kNm

# ----
# 11/22/2019
# Karamba magic
analyze_karamba3d_2 = AnalyzeKaramba3D(Model=optimize_cross_section_karamba3d_2.ModelWithOptimizedCrossSections)  # -> CalculatedModel, MaximumDisplacement_cm, ResultingForceOfGravity_kN, ElasticEnergy_kNm

data_129 = Data(analyze_karamba3d_2.CalculatedModel)

# ----
# Results generation FEM
data_130 = Data(data_129)

model_view_karamba3d_2 = ModelViewKaramba3D(Model=data_130, LoadCaseFactorsForLinearSuperposition=1, IndexOfVisibleLoadcase=-1)  # -> Model, DeformedMesh, DeformedAxes, DeformedModel
shellview_7 = ShellViewKaramba(Model=model_view_karamba3d_2.Model, IndexOfLayer=0)  # -> Model, MeshesOfRenderedShells, LegendColors, LegendTags
shellview_8 = ShellViewKaramba(Model=model_view_karamba3d_2.Model, IndexOfLayer=0)  # -> Model, MeshesOfRenderedShells, LegendColors, LegendTags
shellview_9 = ShellViewKaramba(Model=model_view_karamba3d_2.Model, IndexOfLayer=0)  # -> Model, MeshesOfRenderedShells, LegendColors, LegendTags
reaction_forces_karamba3d_2 = ReactionForcesKaramba3D(AnalyzedModel=model_view_karamba3d_2.Model, LoadCase=0)  # -> AnalyzedModel, ReactionForces_kN, ReactionMoments_kNm, SupportPosition, SumOfReactionForces_kN, SumOfReactionMoments_kNm
shellview_10 = ShellViewKaramba(Model=model_view_karamba3d_2.Model, IndexOfLayer=0)  # -> Model, MeshesOfRenderedShells, LegendColors, LegendTags
nodedisp_2 = NodalDisplacementsKaramba(AnalyzedModel=model_view_karamba3d_2.Model, LoadCase=0)  # -> AnalyzedModel, NodalTranslations_m, NodalRotations_rad
last_index_4 = LastIndex(List=shellview_7.LegendTags)
last_index_5 = LastIndex(List=shellview_8.LegendTags)
last_index_6 = LastIndex(List=shellview_9.LegendTags)
pdecon_2 = Deconstruct(Point=nodedisp_2.NodalTranslations_m)  # -> XComponent, YComponent, expr("x*1000", ZComponent)
multiplication_14 = Multiplication(A=shellview_7.LegendTags, B=10)
multiplication_15 = Multiplication(A=shellview_8.LegendTags, B=10)
multiplication_16 = Multiplication(A=shellview_9.LegendTags, B=10)
cull_index_4 = CullIndex(List=multiplication_14, Indices=flatten(last_index_4), Wrap=True)
cull_index_5 = CullIndex(List=multiplication_15, Indices=flatten(last_index_5), Wrap=True)
cull_index_6 = CullIndex(List=multiplication_16, Indices=flatten(last_index_6), Wrap=True)
absolute_4 = Absolute(Value=pdecon_2.ZComponent)
shellview_11 = ShellViewKaramba(Model=shellview_10.Model, IndexOfLayer=0)  # -> Model, MeshesOfRenderedShells, LegendColors, LegendTags
split_list_4 = SplitList(List=cull_index_4, Index=1)  # -> ListA, ListB
split_list_5 = SplitList(List=cull_index_5, Index=1)  # -> ListA, ListB
split_list_6 = SplitList(List=cull_index_6, Index=1)  # -> ListA, ListB
bounds_5 = Bounds(Numbers=split_list_4.ListB)
bounds_6 = Bounds(Numbers=absolute_4)
bounds_7 = Bounds(Numbers=split_list_5.ListB)
bounds_8 = Bounds(Numbers=split_list_6.ListB)
shellview_12 = ShellViewKaramba(Model=shellview_11.Model, IndexOfLayer=0)  # -> Model, MeshesOfRenderedShells, LegendColors, LegendTags
deconstruct_domain_5 = DeconstructDomain(Domain=bounds_5)  # -> Start, End
deconstruct_domain_6 = DeconstructDomain(Domain=bounds_6)  # -> Start, End
deconstruct_domain_7 = DeconstructDomain(Domain=bounds_7)  # -> Start, End
deconstruct_domain_8 = DeconstructDomain(Domain=bounds_8)  # -> Start, End

mesh_6 = Mesh(shellview_7.MeshesOfRenderedShells)
mesh_7 = Mesh(shellview_8.MeshesOfRenderedShells)
list_item_5 = ListItem(List=reaction_forces_karamba3d_2.ReactionForces_kN, Index=0, Wrap=True)
deconstruct_6 = Deconstruct(Point=list_item_5)  # -> XComponent, YComponent, ZComponent

data_131 = Data(flatten(deconstruct_6.XComponent))

data_132 = Data(flatten(deconstruct_6.YComponent))

data_133 = Data(flatten(deconstruct_domain_5.End))
data_134 = Data(flatten(deconstruct_domain_8.End))
data_135 = Data(flatten(shellview_12.LegendColors))
data_136 = Data(flatten(shellview_12.LegendTags))
data_137 = Data(flatten(shellview_11.LegendColors))
data_138 = Data(flatten(shellview_11.LegendTags))
data_139 = Data(flatten(shellview_10.LegendTags))
data_140 = Data(flatten(shellview_10.MeshesOfRenderedShells))
data_141 = Data(flatten(deconstruct_domain_6.End))
data_142 = Data(flatten(deconstruct_domain_7.Start))
data_143 = Data(flatten(deconstruct_domain_7.End))
data_144 = Data(flatten(deconstruct_domain_5.Start))
data_145 = Data(flatten(shellview_10.LegendColors))

data_146 = Data(flatten(deconstruct_6.ZComponent))

legend_4 = Legend(Colour=data_135, Tags=data_136, LegendType=1)
legend_5 = Legend(Colour=data_137, Tags=data_138, LegendType=1)
legend_6 = Legend(Colour=data_145, Tags=data_139, LegendType=1)
z_vertical_resultant_force_kn_2 = Panel(data_146)
x_horizontal_resultant_force_kn_2 = Panel(data_131)
y_horizontal_resultant_force_kn_2 = Panel(data_132)
max_compression_stress_p2_n_mm2_2 = Panel(data_144)
max_compression_stress_p1_n_mm2_2 = Panel(data_142)
max_tensile_stress_p1_n_mm2_2 = Panel(data_143)
max_tensile_stress_p2_n_mm2_2 = Panel(data_133)
max_displacement_mm_2 = Panel(data_141)

data_147 = Data(max_displacement_mm_2)
data_148 = Data(max_tensile_stress_p1_n_mm2_2)
data_149 = Data(max_compression_stress_p1_n_mm2_2)
data_150 = Data(max_compression_stress_p2_n_mm2_2)
data_151 = Data(max_tensile_stress_p2_n_mm2_2)

data_152 = Data(data_149)
data_153 = Data(data_150)
data_154 = Data(data_151)
data_155 = Data(data_147)
data_156 = Data(data_148)

absolute_5 = Absolute(Value=[data_152, data_153])
absolute_6 = Absolute(Value=[data_156, data_154])
number_17 = Number(data_155)
sort_list_3 = SortList(Keys=absolute_5)  # -> Keys, ValuesValuesA
sort_list_4 = SortList(Keys=absolute_6)  # -> Keys, ValuesValuesA
list_item_6 = ListItem(List=sort_list_3.Keys, Index=1, Wrap=True)
list_item_7 = ListItem(List=sort_list_4.Keys, Index=1, Wrap=True)
number_18 = Number(list_item_7)
expression_6 = Expression(x=number_18, y=number_16, Expression="x>y/10")
expression_7 = Expression(x=list_item_6, y=number_16, Expression="x<-y")
expression_8 = Expression(x=multiplication_13, y=number_17, Expression="x<y")
merge_12 = Merge(Data1=expression_8, Data2=expression_7, Data3=expression_6)
mass_addition_2 = MassAddition(Input=merge_12)  # -> Result, PartialResults
addition_4 = Addition(A=mass_addition_2.Result, B=list_item_7)

maximum_compression_n_mm2_2 = Number(list_item_6)
maximal_tension_n_mm2_2 = Number(number_18)
maximal_deflection_mm_2 = Number(number_17)
