# Grasshopper definition Option_Ind.Modules_3__Transversal_Arch_.gh (Grasshopper 1.0.7)
# plug-ins: Karamba, Kangaroo2 Components

# all curves
crv = Curve([<curve referenced from the Rhino model> x19])

# ---- group: boundary_box_for_meshing
group = Group(Objects=crv)
bbox = BoundingBox(Content=group, Plane=PlaneXY(0, 0, 0))  # -> Box, Box_2
wires = BrepWireframe(Brep=bbox.Box_2, Density=-1)
boundary = BoundarySurfaces(Edges=wires)
join = BrepJoin(Breps=boundary)  # -> Breps, Closed
srf = Surface(join.Breps)

# ----
toggle = BooleanToggle(True)
custom_mesh_settings = SettingsCustom(
    StitchSeams=toggle,
    SimplePlanes=False,
    Refine=toggle,
    MinCount="1600",
    MaxCount="1600",
    AspectRatio=20,
    MaxDistance=0,
    MaxAngle=20,
    MinEdge="0",
    MaxEdge="0")
# catenary curves
crv_2 = Curve([<curve referenced from the Rhino model> x2])
# catenary curves
crv_3 = Curve([<curve referenced from the Rhino model> x7])
# catenary curves
crv_4 = Curve([<curve referenced from the Rhino model> x2])
# catenary curves
crv_5 = Curve([<curve referenced from the Rhino model> x2])
number_slider = Slider(1.8, range=1.1..2.1)
force = Slider(0.18, range=0.1..5)

# ---- group: mesh
mesh = MeshBrep(Brep=srf, Settings=custom_mesh_settings)
mesh_2 = Mesh(mesh)

# ----
len = Length(Curve=crv_2)
division = Division(A=number_slider, B=3.6)

# ---- group: Hanging
negative = Negative(Value=force)

# ----
multiplication = Multiplication(A=len, B=number_slider)
end = EndPoints(Curve=crv_2)  # -> Start, End

# ---- group: Standing
unit_z = UnitZ(Factor=force)

# ----
Z = UnitZ(Factor="-2.5")
# support curves
crv_6 = Curve([<curve referenced from the Rhino model> x12])
cat = Catenary(PointA=end.Start, PointB=end.End, Length=multiplication, Gravity="0,0,1")
deconstruct_mesh = DeconstructMesh(Mesh=mesh)  # -> Vertices, Faces, Colours, Normals

# ---- group: catenary curves
number_slider_2 = Slider(1.9, range=1.1..5)
len_2 = Length(Curve=crv_3)
multiplication_2 = Multiplication(A=len_2, B=number_slider_2)
end_2 = EndPoints(Curve=crv_3)  # -> Start, End
cat_2 = Catenary(PointA=end_2.Start, PointB=end_2.End, Length=multiplication_2, Gravity="0,0,1")
item = ListItem(List=cat_2, Index="0", Wrap=True)  # -> Item, Item1
item_2 = ListItem(List=crv_3, Index="0", Wrap=True)  # -> Item, Item1
crv_cp = CurveClosestPoint(Point=deconstruct_mesh.Vertices, Curve=item_2.Item1)  # -> Point, Parameter, Distance
crv_cp_2 = CurveClosestPoint(Point=deconstruct_mesh.Vertices, Curve=item_2.Item)  # -> Point, Parameter, Distance
larger_than = LargerThan(FirstNumber=crv_cp_2.Distance, SecondNumber="10")  # -> LargerThan, OrEqualTo
larger_than_2 = LargerThan(FirstNumber=crv_cp.Distance, SecondNumber="10")  # -> LargerThan, OrEqualTo
dispatch = Dispatch(List=crv_cp_2.Point, DispatchPattern=larger_than.LargerThan)  # -> ListA, ListB
dispatch_2 = Dispatch(List=crv_cp.Point, DispatchPattern=larger_than_2.LargerThan)  # -> ListA, ListB
panel = Panel("100")

number_slider_3 = Slider(1.8, range=1.1..2.1)
len_3 = Length(Curve=crv_4)
multiplication_3 = Multiplication(A=len_3, B=number_slider_3)
end_3 = EndPoints(Curve=crv_4)  # -> Start, End
cat_3 = Catenary(PointA=end_3.Start, PointB=end_3.End, Length=multiplication_3, Gravity="0,0,1")
item_3 = ListItem(List=cat_3, Index="0", Wrap=True)  # -> Item, Item1
item_4 = ListItem(List=crv_4, Index="0", Wrap=True)  # -> Item, Item1
crv_cp_3 = CurveClosestPoint(Point=deconstruct_mesh.Vertices, Curve=item_4.Item1)  # -> Point, Parameter, Distance
crv_cp_4 = CurveClosestPoint(Point=deconstruct_mesh.Vertices, Curve=item_4.Item)  # -> Point, Parameter, Distance
larger_than_3 = LargerThan(FirstNumber=crv_cp_4.Distance, SecondNumber="10")  # -> LargerThan, OrEqualTo
larger_than_4 = LargerThan(FirstNumber=crv_cp_3.Distance, SecondNumber="10")  # -> LargerThan, OrEqualTo
dispatch_3 = Dispatch(List=crv_cp_4.Point, DispatchPattern=larger_than_3.LargerThan)  # -> ListA, ListB
dispatch_4 = Dispatch(List=crv_cp_3.Point, DispatchPattern=larger_than_4.LargerThan)  # -> ListA, ListB
panel_2 = Panel("100")

number_slider_4 = Slider(1.8, range=1.1..2.1)
len_4 = Length(Curve=crv_5)
multiplication_4 = Multiplication(A=len_4, B=number_slider_4)
end_4 = EndPoints(Curve=crv_5)  # -> Start, End
cat_4 = Catenary(PointA=end_4.Start, PointB=end_4.End, Length=multiplication_4, Gravity="0,0,1")
item_5 = ListItem(List=cat_4, Index="0", Wrap=True)  # -> Item, Item1
item_6 = ListItem(List=crv_5, Index="0", Wrap=True)  # -> Item, Item1
crv_cp_5 = CurveClosestPoint(Point=deconstruct_mesh.Vertices, Curve=item_6.Item1)  # -> Point, Parameter, Distance
crv_cp_6 = CurveClosestPoint(Point=deconstruct_mesh.Vertices, Curve=item_6.Item)  # -> Point, Parameter, Distance
larger_than_5 = LargerThan(FirstNumber=crv_cp_6.Distance, SecondNumber="10")  # -> LargerThan, OrEqualTo
larger_than_6 = LargerThan(FirstNumber=crv_cp_5.Distance, SecondNumber="10")  # -> LargerThan, OrEqualTo
dispatch_5 = Dispatch(List=crv_cp_6.Point, DispatchPattern=larger_than_5.LargerThan)  # -> ListA, ListB
dispatch_6 = Dispatch(List=crv_cp_5.Point, DispatchPattern=larger_than_6.LargerThan)  # -> ListA, ListB
panel_3 = Panel("100")

# ----
division_2 = Division(A=number_slider_2, B=3.6)
division_3 = Division(A=number_slider_3, B=3.6)
division_4 = Division(A=number_slider_4, B=3.6)
join_2 = JoinCurves(Curves=crv_6, Preserve=False)
item_7 = ListItem(List=cat, Index="0", Wrap=True)  # -> Item, Item1
item_8 = ListItem(List=crv_2, Index="0", Wrap=True)  # -> Item, Item1
crv_cp_7 = CurveClosestPoint(Point=deconstruct_mesh.Vertices, Curve=item_8.Item1)  # -> Point, Parameter, Distance
crv_cp_8 = CurveClosestPoint(Point=deconstruct_mesh.Vertices, Curve=item_8.Item)  # -> Point, Parameter, Distance
item_9 = ListItem(List=join_2, Index=0, Wrap=True)  # -> Item, Item1, Item2, Item3
larger_than_7 = LargerThan(FirstNumber=crv_cp_8.Distance, SecondNumber="10")  # -> LargerThan, OrEqualTo
larger_than_8 = LargerThan(FirstNumber=crv_cp_7.Distance, SecondNumber="10")  # -> LargerThan, OrEqualTo
point = Point(deconstruct_mesh.Vertices)
dispatch_7 = Dispatch(List=crv_cp_8.Point, DispatchPattern=larger_than_7.LargerThan)  # -> ListA, ListB
dispatch_8 = Dispatch(List=crv_cp_7.Point, DispatchPattern=larger_than_8.LargerThan)  # -> ListA, ListB

# ---- group: supports
crv_cp_9 = CurveClosestPoint(Point=point, Curve=flatten(item_9.Item3))  # -> Point, Parameter, Distance
crv_cp_10 = CurveClosestPoint(Point=point, Curve=flatten(item_9.Item2))  # -> Point, Parameter, Distance
crv_cp_11 = CurveClosestPoint(Point=point, Curve=flatten(item_9.Item1))  # -> Point, Parameter, Distance
crv_cp_12 = CurveClosestPoint(Point=point, Curve=flatten(item_9.Item))  # -> Point, Parameter, Distance
eval = Evaluate(F="If(x<0.1, 1, 0)", x=crv_cp_9.Distance)
eval_2 = Evaluate(F="If(x<0.1, 1, 0)", x=crv_cp_10.Distance)
eval_3 = Evaluate(F="If(x<0.1, 1, 0)", x=crv_cp_11.Distance)
eval_4 = Evaluate(F="If(x<0.1, 1, 0)", x=crv_cp_12.Distance)
cull = CullPattern(List=point, CullPattern=eval)
cull_2 = CullPattern(List=point, CullPattern=eval_2)
cull_3 = CullPattern(List=point, CullPattern=eval_3)
cull_4 = CullPattern(List=point, CullPattern=eval_4)

# ----
mesh_edges = MeshEdges(Mesh=mesh)  # -> NakedEdges, InteriorEdges, NonManifoldEdges

# ----
# Spring strength
strength_external = Slider(30, range=5..40)
fixed_length = Panel("0")
strength_internal = Slider(10.6, range=5..20)

curve = Curve(mesh_edges.NakedEdges)
curve_2 = Curve(mesh_edges.InteriorEdges)
merge = Merge(Data2=cull_4, Data3=cull_3, Data4=cull_2, Data5=cull)
oncurve = OnCurve(Points=dispatch_7.ListB, Curve=item_7.Item, Strength="100")
oncurve_2 = OnCurve(Points=dispatch_8.ListB, Curve=item_7.Item1, Strength="100")
oncurve_3 = OnCurve(Points=dispatch_3.ListB, Curve=item_3.Item, Strength=panel_2)
oncurve_4 = OnCurve(Points=dispatch_4.ListB, Curve=item_3.Item1, Strength=panel_2)

# ----
# Forces
load = Load(Point=point, ForceVector=unit_z, Weighting=1)
oncurve_5 = OnCurve(Points=dispatch.ListB, Curve=item.Item, Strength=panel)
oncurve_6 = OnCurve(Points=dispatch_2.ListB, Curve=item.Item1, Strength=panel)
length_line = LengthLine(Line=curve, Length=fixed_length, Strength=strength_external)
anchor = Anchor(Point=merge, Target=merge, Strength=10000)
length_line_2 = LengthLine(Line=curve_2, Length=fixed_length, Strength=strength_internal)
show = Show(G=mesh_2)
oncurve_7 = OnCurve(Points=dispatch_5.ListB, Curve=item_5.Item, Strength=panel_3)
oncurve_8 = OnCurve(Points=dispatch_6.ListB, Curve=item_5.Item1, Strength=panel_3)

# ----
# Tutorial: https://www.youtube.com/watch?v=SW_xQx1x_5g
activate = BooleanToggle(True)
reset_button = Button()
entwine = Entwine(
    Branch00=show,
    Branch01=anchor,
    Branch02=length_line,
    Branch03=length_line_2,
    Branch04=load,
    Branch05=oncurve_7,
    Branch06=oncurve_8,
    Branch07=oncurve_5,
    Branch08=oncurve_6,
    Branch09=oncurve_3,
    Branch010=oncurve_4,
    Branch011=oncurve,
    Branch012=oncurve_2,
    FlattenInputs=True)
solver = Solver(GoalObjects=flatten(entwine), Reset=reset_button, Threshold=1e-15, Tolerance=0.01, On=activate)  # -> I, V, O
# Output
list_item = ListItem(List=solver.O, Index=0, Wrap=True)
# Output
extr = Extrude(Base=crv_6, Direction=Z)
flipm = FlipMesh(Mesh=list_item, VertexNormals=True, FaceNormals=True, FaceOrientation=True)
mesh_3 = Mesh(list_item)
meshtoshell = MeshToShellKaramba3D(Mesh=mesh_3, Identifier="shell", LimitDistance_m=0.005)  # -> Element, Points, Info
license = LicenseKaramba3D()
xy = XYPlane(Origin=Point(0, 0, 0))
mc = MeshCorners(Mesh=mesh_3, Angle=2.35619449)
matselect = MaterialSelectionKaramba3D(menu=[dropdown(3), dropdown(6)])
panel_4 = Panel(license)
cross_section = CrossSectionKaramba3D(
    FamilyNameOfCrossSection="DefaultCroSec",
    NameOfCrossSection="shell",
    Material=matselect,
    Height_cm="10",
    mode="Shell - Const")
supp = SupportKaramba3D(PosInd=mc, PlaneOfReference=xy, menu=[buttons(on, on, on, off, off, off)])
loads = LoadsKaramba3D(Vector=Vector(0, 0, -1), LCase="0", mode="Gravity")
assemble = AssembleModelKaramba3D(
    Point=meshtoshell.Points,
    Elem=meshtoshell.Element,
    Support=supp,
    Load=loads,
    CrossSection=cross_section,
    Material=matselect,
    LimitDistance_m=0.005)  # -> Model, Info, Mass_kg, CenterOfGravity
analyze = AnalyzeKaramba3D(Model=assemble.Model)  # -> CalculatedModel, MaximumDisplacement_cm, ResultingForceOfGravity_kN, ElasticEnergy_kNm
modelview = ModelViewKaramba3D(Model=analyze.CalculatedModel, LoadCaseFactorsForLinearSuperposition=1, IndexOfVisibleLoadcase=-1)  # -> Model, DeformedMesh, DeformedAxes, DeformedModel
shellview = ShellViewKaramba3D(Model=modelview.Model, IndexOfLayer=0)  # -> Model, MeshesOfRenderedShells, LegendColors, LegendTags
legend = Legend(Colour=shellview.LegendColors, Tags=shellview.LegendTags, LegendType=1)
