# Grasshopper definition Option_Ind.Modules__Final_Karamba_.gh (Grasshopper 1.0.7)
# plug-ins: Karamba, Kangaroo2 Components

# all curves
crv = Curve([<curve referenced from the Rhino model> x8])

# ---- group: boundary_box_for_meshing
group = Group(Objects=crv)
bbox = BoundingBox(Content=group, Plane=PlaneXY(0, 0, 0))  # -> Box, Box_2
wires = BrepWireframe(Brep=bbox.Box_2, Density=-1)
boundary = BoundarySurfaces(Edges=crv)
join = BrepJoin(Breps=boundary)  # -> Breps, Closed
srf = Surface(join.Breps)

# ----
toggle = BooleanToggle(True)
custom_mesh_settings = SettingsCustom(
    StitchSeams=toggle,
    SimplePlanes=False,
    Refine=toggle,
    MinCount="1600",
    MaxCount="1600",
    AspectRatio=20,
    MaxDistance=0,
    MaxAngle=20,
    MinEdge="0",
    MaxEdge="0")
# catenary curves
crv_2 = Curve()
# catenary curves
crv_3 = Curve()
# catenary curves
crv_4 = Curve()
force = Slider(0.18, range=0.1..5)

# ---- group: mesh
mesh = MeshBrep(Brep=srf, Settings=custom_mesh_settings)
mesh_2 = Mesh(mesh)

# ---- group: Hanging
negative = Negative(Value=force)

# ----
# support curves
crv_5 = Curve([<curve referenced from the Rhino model> x8])

# ---- group: Standing
unit_z = UnitZ(Factor=force)

# ----
deconstruct_mesh = DeconstructMesh(Mesh=mesh)  # -> Vertices, Faces, Colours, Normals

# ---- group: catenary curves
number_slider = Slider(1.9, range=1.1..5)
len = Length(Curve=crv_2)
multiplication = Multiplication(A=len, B=number_slider)
end = EndPoints(Curve=crv_2)  # -> Start, End
cat = Catenary(PointA=end.Start, PointB=end.End, Length=multiplication, Gravity="0,0,1")
item = ListItem(List=cat, Index="0", Wrap=True)  # -> Item, Item1
item_2 = ListItem(List=crv_2, Index="0", Wrap=True)  # -> Item, Item1
crv_cp = CurveClosestPoint(Point=deconstruct_mesh.Vertices, Curve=item_2.Item1)  # -> Point, Parameter, Distance
crv_cp_2 = CurveClosestPoint(Point=deconstruct_mesh.Vertices, Curve=item_2.Item)  # -> Point, Parameter, Distance
larger_than = LargerThan(FirstNumber=crv_cp_2.Distance, SecondNumber="10")  # -> LargerThan, OrEqualTo
larger_than_2 = LargerThan(FirstNumber=crv_cp.Distance, SecondNumber="10")  # -> LargerThan, OrEqualTo
dispatch = Dispatch(List=crv_cp_2.Point, DispatchPattern=larger_than.LargerThan)  # -> ListA, ListB
dispatch_2 = Dispatch(List=crv_cp.Point, DispatchPattern=larger_than_2.LargerThan)  # -> ListA, ListB
panel = Panel("100")

number_slider_2 = Slider(2.1, range=1.1..2.1)
len_2 = Length(Curve=crv_3)
multiplication_2 = Multiplication(A=len_2, B=number_slider_2)
end_2 = EndPoints(Curve=crv_3)  # -> Start, End
cat_2 = Catenary(PointA=end_2.Start, PointB=end_2.End, Length=multiplication_2, Gravity="0,0,1")
item_3 = ListItem(List=cat_2, Index="0", Wrap=True)  # -> Item, Item1
item_4 = ListItem(List=crv_3, Index="0", Wrap=True)  # -> Item, Item1
crv_cp_3 = CurveClosestPoint(Point=deconstruct_mesh.Vertices, Curve=item_4.Item1)  # -> Point, Parameter, Distance
crv_cp_4 = CurveClosestPoint(Point=deconstruct_mesh.Vertices, Curve=item_4.Item)  # -> Point, Parameter, Distance
larger_than_3 = LargerThan(FirstNumber=crv_cp_4.Distance, SecondNumber="10")  # -> LargerThan, OrEqualTo
larger_than_4 = LargerThan(FirstNumber=crv_cp_3.Distance, SecondNumber="10")  # -> LargerThan, OrEqualTo
dispatch_3 = Dispatch(List=crv_cp_4.Point, DispatchPattern=larger_than_3.LargerThan)  # -> ListA, ListB
dispatch_4 = Dispatch(List=crv_cp_3.Point, DispatchPattern=larger_than_4.LargerThan)  # -> ListA, ListB
panel_2 = Panel("100")

number_slider_3 = Slider(1.8, range=1.1..2.1)
len_3 = Length(Curve=crv_4)
multiplication_3 = Multiplication(A=len_3, B=number_slider_3)
end_3 = EndPoints(Curve=crv_4)  # -> Start, End
cat_3 = Catenary(PointA=end_3.Start, PointB=end_3.End, Length=multiplication_3, Gravity="0,0,1")
item_5 = ListItem(List=cat_3, Index="0", Wrap=True)  # -> Item, Item1
item_6 = ListItem(List=crv_4, Index="0", Wrap=True)  # -> Item, Item1
crv_cp_5 = CurveClosestPoint(Point=deconstruct_mesh.Vertices, Curve=item_6.Item1)  # -> Point, Parameter, Distance
crv_cp_6 = CurveClosestPoint(Point=deconstruct_mesh.Vertices, Curve=item_6.Item)  # -> Point, Parameter, Distance
larger_than_5 = LargerThan(FirstNumber=crv_cp_6.Distance, SecondNumber="10")  # -> LargerThan, OrEqualTo
larger_than_6 = LargerThan(FirstNumber=crv_cp_5.Distance, SecondNumber="10")  # -> LargerThan, OrEqualTo
dispatch_5 = Dispatch(List=crv_cp_6.Point, DispatchPattern=larger_than_5.LargerThan)  # -> ListA, ListB
dispatch_6 = Dispatch(List=crv_cp_5.Point, DispatchPattern=larger_than_6.LargerThan)  # -> ListA, ListB
panel_3 = Panel("100")

# ----
division = Division(A=number_slider, B=3.6)
division_2 = Division(A=number_slider_2, B=3.6)
division_3 = Division(A=number_slider_3, B=3.6)
join_2 = JoinCurves(Curves=crv_5, Preserve=False)
item_7 = ListItem(List=join_2, Index=0, Wrap=True)  # -> Item, Item1, Item2, Item3
point = Point(deconstruct_mesh.Vertices)

# ---- group: supports
crv_cp_7 = CurveClosestPoint(Point=point, Curve=flatten(item_7.Item3))  # -> Point, Parameter, Distance
crv_cp_8 = CurveClosestPoint(Point=point, Curve=flatten(item_7.Item2))  # -> Point, Parameter, Distance
crv_cp_9 = CurveClosestPoint(Point=point, Curve=flatten(item_7.Item1))  # -> Point, Parameter, Distance
crv_cp_10 = CurveClosestPoint(Point=point, Curve=flatten(item_7.Item))  # -> Point, Parameter, Distance
eval = Evaluate(F="If(x<0.1, 1, 0)", x=crv_cp_7.Distance)
eval_2 = Evaluate(F="If(x<0.1, 1, 0)", x=crv_cp_8.Distance)
eval_3 = Evaluate(F="If(x<0.1, 1, 0)", x=crv_cp_9.Distance)
eval_4 = Evaluate(F="If(x<0.1, 1, 0)", x=crv_cp_10.Distance)
cull = CullPattern(List=point, CullPattern=eval)
cull_2 = CullPattern(List=point, CullPattern=eval_2)
cull_3 = CullPattern(List=point, CullPattern=eval_3)
cull_4 = CullPattern(List=point, CullPattern=eval_4)

# ----
mesh_edges = MeshEdges(Mesh=mesh)  # -> NakedEdges, InteriorEdges, NonManifoldEdges

# ----
# Spring strength
strength_external = Slider(30, range=5..40)
fixed_length = Panel("0")
strength_internal = Slider(10.6, range=5..20)

curve = Curve(mesh_edges.NakedEdges)
curve_2 = Curve(mesh_edges.InteriorEdges)
merge = Merge(Data2=cull_4, Data3=cull_3, Data4=cull_2, Data5=cull)
oncurve = OnCurve(Points=dispatch_3.ListB, Curve=item_3.Item, Strength=panel_2)
oncurve_2 = OnCurve(Points=dispatch_4.ListB, Curve=item_3.Item1, Strength=panel_2)

# ----
# Forces
load = Load(Point=point, ForceVector=unit_z, Weighting=1)
oncurve_3 = OnCurve(Points=dispatch.ListB, Curve=item.Item, Strength=panel)
oncurve_4 = OnCurve(Points=dispatch_2.ListB, Curve=item.Item1, Strength=panel)
length_line = LengthLine(Line=curve, Length=fixed_length, Strength=strength_external)
anchor = Anchor(Point=merge, Target=merge, Strength=10000)
length_line_2 = LengthLine(Line=curve_2, Length=fixed_length, Strength=strength_internal)
show = Show(G=mesh_2)
oncurve_5 = OnCurve(Points=dispatch_5.ListB, Curve=item_5.Item, Strength=panel_3)
oncurve_6 = OnCurve(Points=dispatch_6.ListB, Curve=item_5.Item1, Strength=panel_3)

reset_button = Button()
# Tutorial: https://www.youtube.com/watch?v=SW_xQx1x_5g
activate = BooleanToggle(False)
entwine = Entwine(Branch00=show, Branch01=anchor, Branch02=length_line, Branch03=length_line_2, Branch04=load, FlattenInputs=True)
solver = Solver(GoalObjects=flatten(entwine), Reset=reset_button, Threshold=1e-15, Tolerance=0.01, On=activate)  # -> I, V, O
toggle_2 = BooleanToggle(True)
# Output
list_item = ListItem(List=solver.O, Index=0, Wrap=True)
custom_mesh_settings_2 = SettingsCustom(
    StitchSeams=toggle_2,
    SimplePlanes=False,
    Refine=toggle_2,
    MinCount="1600",
    MaxCount="1600",
    AspectRatio=20,
    MaxDistance=0,
    MaxAngle=20,
    MinEdge="0",
    MaxEdge="0")
flipm = FlipMesh(Mesh=list_item, VertexNormals=True, FaceNormals=True, FaceOrientation=True)
matselect = MaterialSelectionKaramba3D(menu=[dropdown(3), dropdown(2)])
xy = XYPlane(Origin=Point(0, 0, 0))
panel_4 = Panel("""0
1
2
3
4
5
6
7""")
cross_section = CrossSectionKaramba3D(
    FamilyNameOfCrossSection="DefaultCroSec",
    NameOfCrossSection="shell",
    Material=matselect,
    Height_cm="10",
    mode="Shell - Const")
loads = LoadsKaramba3D(Vector=Vector(0, 0, -1), LCase="0", mode="Gravity")

# ---- group: Arch Entrance
# catenary curves
crv_6 = Curve([<curve referenced from the Rhino model> x2])
number_slider_4 = Slider(1.6, range=1.1..2.1)
len_4 = Length(Curve=crv_6)
division_4 = Division(A=number_slider_4, B=3.6)
multiplication_4 = Multiplication(A=len_4, B=number_slider_4)
end_4 = EndPoints(Curve=crv_6)  # -> Start, End
midpt = CurveMiddle(Curve=crv_6)
cat_4 = Catenary(PointA=end_4.Start, PointB=end_4.End, Length=multiplication_4, Gravity="0,0,1")
panel_5 = Panel("-2.5")
midpt_2 = CurveMiddle(Curve=cat_4)
Z = UnitZ(Factor=panel_5)
dist = Distance(PointA=midpt_2, PointB=midpt)
panel_6 = Panel(dist)
Z_2 = UnitZ(Factor=panel_6)
move = Move(Geometry=crv_6, Motion=Z)  # -> Geometry, Transform
extr = Extrude(Base=crv_5, Direction=Z)
move_2 = Move(Geometry=cat_4, Motion=expr("x*-1.2", Z_2))  # -> Geometry, Transform
end_5 = EndPoints(Curve=move.Geometry)  # -> Start, End
end_6 = EndPoints(Curve=move_2.Geometry)  # -> Start, End
ln = Line(StartPoint=end_6.End, EndPoint=end_5.Start)
ln_2 = Line(StartPoint=end_6.Start, EndPoint=end_5.End)
join_3 = JoinCurves(Curves=[ln, ln_2, move.Geometry, move_2.Geometry], Preserve=False)  # -> flatten(Curves)

# ----
lng = ListLength(List=crv_6)
area = Area(Geometry=extr)  # -> Area, Centroid
midpt_3 = CurveMiddle(Curve=crv_6)
pull = PullPoint(Point=area.Centroid, Geometry=midpt_3, ClosestOnly=True)  # -> ClosestPoint, Distance
series = Series(Start=0, Step=1, Count=lng)
sort = SortList(DISTANCES=pull.Distance, ValuesSORTEDEXTRUSIONS=extr)  # -> SORTEDDISTANCES, ValuesSORTEDEXTRUSIONS
item_8 = ListItem(List=sort.ValuesSORTEDEXTRUSIONS, Index=series, Wrap=True)

# ---- group: Arch Entrance (continued)
wires_2 = BrepWireframe(Brep=item_8, Density=-1)
join_4 = JoinCurves(Curves=wires_2, Preserve=False)  # -> flatten(Curves)
rdiff = RegionDifference(CurvesA=flatten(join_4), CurvesB=join_3)
cull_i = CullIndex(List=sort.ValuesSORTEDEXTRUSIONS, Indices=series, Wrap=True)  # -> graft(List)

# ----
sdiff = SolidDifference(BrepsA=join_4, BrepsB=join_3)  # -> graft(Result)
panel_7 = Panel(join_3)
join_5 = BrepJoin(Breps=flatten([sdiff, cull_i]))  # -> Breps, Closed
mesh_3 = MeshBrep(Brep=join_5.Breps, Settings=custom_mesh_settings_2)
unit_z_2 = UnitZ(Factor=panel_5)
move_3 = Move(Geometry=mesh_3, Motion=expr("x*-1", unit_z_2))  # -> Geometry, Transform
# Output
mjoin = MeshJoin(Meshes=[mesh_3, flipm])
mesh_join = MeshJoin(Meshes=[mjoin, move_3.Geometry])
mesh_4 = Mesh(mesh_join)
meshtoshell = MeshToShellKaramba3D(Mesh=mesh_4, Identifier="shell", LimitDistance_m=0.005)  # -> Element, Points, Info
point_2 = Point(meshtoshell.Points)
meshcorners = MeshCorners(Mesh=mesh_4, Angle=2.35619449)
cull_index = CullIndex(List=meshcorners, Indices=panel_4, Wrap=True)
supp = SupportKaramba3D(PosInd=cull_index, PlaneOfReference=xy, menu=[buttons(on, on, on, off, off, off)])
loads_karamba3d = LoadsKaramba3D(ForceVector="0,0,-1", Local=False, PosInd=meshtoshell.Points, LCase=0, mode="Point")
assemble = AssembleModelKaramba3D(
    Point=meshtoshell.Points,
    Elem=meshtoshell.Element,
    Support=supp,
    Load=loads,
    CrossSection=cross_section,
    Material=matselect,
    LimitDistance_m=0.005)  # -> Model, Info, Mass_kg, CenterOfGravity
analyze = AnalyzeKaramba3D(Model=assemble.Model)  # -> CalculatedModel, MaximumDisplacement_cm, ResultingForceOfGravity_kN, ElasticEnergy_kNm
modelview = ModelViewKaramba3D(Model=analyze.CalculatedModel, LoadCaseFactorsForLinearSuperposition=1, IndexOfVisibleLoadcase=-1)  # -> Model, DeformedMesh, DeformedAxes, DeformedModel
shellview = ShellViewKaramba3D(Model=modelview.Model, IndexOfLayer=0)  # -> Model, MeshesOfRenderedShells, LegendColors, LegendTags
legend = Legend(Colour=shellview.LegendColors, Tags=shellview.LegendTags, LegendType=1)
