# Grasshopper definition oculus_mesh.gh (Grasshopper 1.0.7)

crv = Curve(<curve referenced from the Rhino model>)
crv_2 = Curve(<curve referenced from the Rhino model>)
crv_3 = Curve(<curve referenced from the Rhino model>)
number_slider = Slider(4, range=0..100)
division = Division(A=number_slider, B=2)
panel = Panel("""True
False""")
divide = DivideCurve(Curve=crv, Count=number_slider, Kinks=False)  # -> Points, Tangents, Parameters
divide_2 = DivideCurve(Curve=crv_2, Count=number_slider, Kinks=False)  # -> Points, Tangents, Parameters
divide_3 = DivideCurve(Curve=crv_3, Count=number_slider, Kinks=False)  # -> Points, Tangents, Parameters
crv_4 = Curve(<curve referenced from the Rhino model>)
ln = Line(StartPoint=divide.Points, EndPoint=divide_2.Points)
cull = CullPattern(List=divide_2.Points, CullPattern=panel)
shatter = Shatter(Curve=crv_3, Parameters=divide_3.Parameters)
shatter_2 = Shatter(Curve=crv, Parameters=divide.Parameters)
ln_2 = Line(StartPoint=divide_3.Points, EndPoint=divide_2.Points)
crv_cp = CurveClosestPoint(Point=divide_2.Points, Curve=crv)  # -> Point, Parameter, Distance
frame = CurveFrame(Curve=crv_4, Parameter=Slider(0.76, range=0..1))
xy = XYPlane(Origin=divide_2.Points)
ln_3 = Line(StartPoint=divide_2.Points, EndPoint=crv_cp.Point)
pframes = PerpFrames(Curve=crv_4, Count="1", Align=True)  # -> Frames, Parameters
rotate = Rotate(Geometry=ln_3, Angle=1.570796327, Plane=xy)  # -> Geometry, Transform
cir = Circle(Plane=pframes.Frames, Radius=1)
