# Grasshopper definition Bazaarbuilding_vFinal.gh (Grasshopper 1.0.7)
# plug-ins: ProvingGround.Conduit, Heteroptera, Excel

gridsize_1 = Slider(2.575, range=1..5)
gridsize_2 = Slider(7.8, range=1..10)

# ----
# Pre-python Point Definition
# These are all the base curves for the bazaar, from which the points are generated. They are manualy drawn in Rhino
crv = Curve([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])
# Pre-python is mainly focused on providing all the information needed for the scrip to run properly. Some of this stuff could also be done in python, but since I already know how to do it in grasshopper that is the workflow I choose.
end = EndPoints(Curve=crv)  # -> Start, End
len = Length(Curve=crv)
multiplication = Multiplication(A=gridsize_2, B=1000)
multiplication_2 = Multiplication(A=gridsize_1, B=1000)
pt = Point(flatten([end.Start, end.End]))
division = Division(A=len, B=multiplication_2)
cullpt = CullDuplicates(Points=pt, Tolerance=0.1, CullMode=3)  # -> Points, Indices, Valence
panel = Panel("""-1
0""")
divide = DivideCurve(Curve=crv, Count=division, Kinks=False)  # -> Points, Tangents, Parameters
eval = Evaluate(F="If(x=2, true, false)", x=cullpt.Valence)
eval_2 = Evaluate(F="If(x=2, false, true)", x=cullpt.Valence)
pt_2 = Point(cullpt.Points)
cull_i = CullIndex(List=divide.Points, Indices=panel, Wrap=True)
crv_2 = Curve([<curve referenced from the Rhino model> x2])
incurves = PointInCurves(Point=cull_i, Curves=crv_2)  # -> Relationship, Index, Point

# ----
# Pre-python Excel Read
# The excel file is used to quickly set some of the shops with properties to get the script started with
panel_2 = Panel("C:\Users\david\Documents\Bouwkunde\Master\Earthy\week7\bazaardatabase.xlsx")
read = ExcelRead(Start=Toggle(True), FilePath=panel_2, SheetName="blad5")
# 01-11-2019
bang = ExplodeTree(Data=read)  # -> Branch0, Branch1, Branch2, Branch3, Branch4, Branch5

cull = CullPattern(List=pt_2, CullPattern=eval)
cull_2 = CullPattern(List=cull_i, CullPattern=invert(incurves.Relationship))
cp = ClosestPoint(Point=Point(-15761.62662, 3504.180069, -574376.4047), Cloud=cull)  # -> ClosestPoint, CPIndex, Distance
cp_2 = ClosestPoint(Point=Point(-15765.18546, 6079.082148, 0), Cloud=flatten(cull_2))  # -> ClosestPoint, CPIndex, Distance
cull_i_2 = CullIndex(List=flatten(cull_2), Indices=cp_2.CPIndex, Wrap=True)
# 01-11-2019
cull_3 = CullPattern(List=pt_2, CullPattern=eval_2)
cull_i_3 = CullIndex(List=cull, Indices=cp.CPIndex, Wrap=True)
cull_4 = CullPattern(List=cull_i, CullPattern=incurves.Relationship)

data = Data(cull_3)
data_2 = Data(cull_i_3)
data_3 = Data(cull_i_2)
data_4 = Data(cull_4)

# ---- group: user_input
# The user input is a legacy function and is used to manually add shop after shop. Right now the random generating script overwrites this input
user_choise_for_spot = Slider(0, range=0..4)
user_pollution = Slider(34, range=0..100)
user_function = Slider(0, range=0..3)
user_noise = Slider(10, range=0..100)
user_house = BooleanToggle(True)

# ---- group: admin input
# The admin input determines how much a certain property is valued
weight_function = Slider(30, range=-50..50)
weight_pollution = Slider(10, range=-50..50)
weight_distance = Slider(20, range=-50..50)
weight_noise = Slider(10, range=-50..50)

# ----
# Pre-python Point Preperation
pdecon = Deconstruct(Point=data)  # -> XComponent, YComponent, ZComponent
pdecon_2 = Deconstruct(Point=data_2)  # -> XComponent, YComponent, ZComponent
pdecon_3 = Deconstruct(Point=flatten(data_3))  # -> XComponent, YComponent, ZComponent
pdecon_4 = Deconstruct(Point=flatten(data_4))  # -> XComponent, YComponent, ZComponent
num = Number(pdecon_4.XComponent)
num_2 = Number(pdecon_4.YComponent)
num_3 = Number(pdecon.XComponent)
num_4 = Number(pdecon_2.XComponent)
num_5 = Number(pdecon_2.YComponent)
num_6 = Number(pdecon_3.XComponent)
num_7 = Number(pdecon_3.YComponent)
num_8 = Number(pdecon.YComponent)
round = Round(Number=num)  # -> Nearest, Floor, Ceiling
round_2 = Round(Number=num_2)  # -> Nearest, Floor, Ceiling
round_3 = Round(Number=num_3)  # -> Nearest, Floor, Ceiling
round_4 = Round(Number=num_8)  # -> Nearest, Floor, Ceiling
round_5 = Round(Number=num_4)  # -> Nearest, Floor, Ceiling
round_6 = Round(Number=num_5)  # -> Nearest, Floor, Ceiling
round_7 = Round(Number=num_6)  # -> Nearest, Floor, Ceiling
round_8 = Round(Number=num_7)  # -> Nearest, Floor, Ceiling
# 01-11-2019
join = TextJoin(Text=round_3.Nearest, Join=",")
join_2 = TextJoin(Text=round_4.Nearest, Join=",")
join_3 = TextJoin(Text=round_5.Nearest, Join=",")
join_4 = TextJoin(Text=round_6.Nearest, Join=",")
join_5 = TextJoin(Text=round_7.Nearest, Join=",")
join_6 = TextJoin(Text=round_8.Nearest, Join=",")
join_7 = TextJoin(Text=round.Nearest, Join=",")
join_8 = TextJoin(Text=round_2.Nearest, Join=",")

# ----
# This is the iterations slider, if the slider is changed, the bazaar will grow (actually it just recomputes the exact same bazaar over a different number of iterations)
iterations = Slider(2, range=0..50)

# ---- group: preview integers
# This is to preview the numbers assigned to the shops (so they can be set in excel)
# Point reference nrs preview
merge = Merge(Data1=data, Data2=data_2, Data3=flatten(data_3), Data4=data_4)  # -> flatten(Result)
lng = ListLength(List=merge)
subtraction = Subtraction(A=lng, B=1)
range = Range(Domain=subtraction, Steps=subtraction)
round_9 = Round(Number=range)  # -> Nearest, Floor, Ceiling
# 01-11-2019
textbaker = TextBaker(Location=merge, Text=round_9.Nearest, Size="600", Color=RGB(0, 0, 0), Justification=6, Activate=False)

# ---- group: Random Input
# This python component generates the somewhat random input (though still manipulated) for the main python component. Hit the toggle button to regenerate the random input.
intelligen = Slider(2, range=0..4)
python = GhPythonScript(y=Toggle(False), intelligence=intelligen)  # -> out, rng, house_rng, user_choise_rng, user_sizes
# ---------- python: Python ----------
__author__ = "win 10"
__version__ = "2019.10.18"

import rhinoscriptsyntax as rs
import random

a = 4
a = a -1
rng = []
for i in range(50):
    rng.append(random.randint(0,13))

house_rng =[]
for j in range(50):
    house_rng.append(random.randint(0,a))
    
user_choise_rng = []
for k in range(50):
    user_choise_rng.append(random.randint(0,intelligence))

user_sizes = []
for l in range(50):
    sizenr = random.randint(0,4)
    if sizenr == 0:
        user_sizes.append("l")
    elif sizenr ==1 or sizenr == 2:
        user_sizes.append("m")
    else:
        user_sizes.append("s")
        
print(user_sizes)
# ---------- end python ----------

# ----
run = BooleanToggle(True)
data_5 = Data(join_4)
data_6 = Data(join_5)
data_7 = Data(join_7)
data_8 = Data(bang.Branch4)
data_9 = Data(bang.Branch2)
data_10 = Data(bang.Branch3)
data_11 = Data(bang.Branch5)
data_12 = Data(user_choise_for_spot)
data_13 = Data(user_noise)
data_14 = Data(weight_noise)
data_15 = Data(join)
data_16 = Data(join_2)
data_17 = Data(join_3)
data_18 = Data(join_6)
data_19 = Data(join_8)
data_20 = Data(multiplication_2)
data_21 = Data(multiplication)
data_22 = Data(bang.Branch0)
data_23 = Data(bang.Branch1)
data_24 = Data(user_function)
data_25 = Data(user_pollution)
data_26 = Data(user_house)
data_27 = Data(weight_function)
data_28 = Data(weight_pollution)
data_29 = Data(weight_distance)
data_30 = Data(merge)
data_31 = Data(python.rng)
data_32 = Data(python.house_rng)
data_33 = Data(python.user_choise_rng)
data_34 = Data(python.user_sizes)

# ----
# Main Python Component
python_2 = GhPythonScript(
    x_end=data_15,
    y_end=data_16,
    x_junction=data_17,
    y_junction=data_5,
    x_street=data_6,
    y_street=data_18,
    x_square=data_7,
    y_square=data_19,
    gridsize=data_20,
    gridsize_2=data_21,
    distances=data_8,
    occupied=data_22,
    noises=data_23,
    functions=data_9,
    pollutions=data_10,
    houses=data_11,
    user_choice=data_12,
    user_noise=data_13,
    user_function=data_24,
    user_pollution=data_25,
    user_house=data_26,
    wn=data_14,
    wf=data_27,
    wp=data_28,
    wd=data_29,
    run=run,
    iterations=iterations,
    rng=data_31,
    house_rng=data_32,
    user_choise_rng=data_33,
    user_sizes=data_34)  # -> out, shop_options_integers, chosen_location, existing_shops, shop_options, occupied, myclass, noises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; inputs distances: list, occupied: list, noises: list, functions: list, pollutions: list, houses: list, iterations: Int32, rng: list of Int32, house_rng: list of Int32, user_choise_rng: list of Int32, user_sizes: list
# ---------- python_2: Python ----------
__author__ = "David den Ouden"
__version__ = "01.11.2019 Final"

import rhinoscriptsyntax as rs
import math
import decimal
import random
import time
from math import sqrt

"""
Short description of the script:
    This script takes points as input and makes shop objects using the class Shop
    on all of those points. Then those shops are all empty except for the starting shops, 
    which are set to occupied and values for function, pollution, distance to nearest house, and noise are added
    with this as a starting position, a series of random input determine new shops that are added to the bazaar
    these new shops will be appointed 5 top locations from which one is selected
    these locations are found by computing the difference between the previously mentioned values of the new shop and all existing ones
    keep in mind that only the difference between neighbouring available slots (empty slots next to occupied slot) and new shops are taken into account
    Those differences are then multiplied by a factor determined by the admins (weigh factors)
    And also they are multiplied by a factor which is computed using the distances between the 2 shops
    One of the 5 locations is chosen and the new shop is set to occupied adn the values are added
    As a last step the distances for a shop to the nearest house are recomputed
    
    In a newer version the user also has the option to choose a size, small medium or large
    A large or medium shop will in essention 'just' fill multiple small slots
"""

class Shop:
    """This class will be used to make objects based on points, which are then;
    'shops' these shops have certain variables and can be either occupied or empty"""
    def __init__(self, x, y, type):
        self.x = x
        self.y = y
        self.type = type
        self.occupied = False
        self.house = False
        self.noise = None
        self.function = None
        self.pollution = None
        self.distance = None
        
    def get_point(self):
        """represent the point the shop is located as a list [x,y,z]"""
        self.point = [self.x, self.y, 0]
        return self.point
        
    def set_occupied(self):
        """make the shop actually real"""
        self.occupied = True

    def find_neighbour_points(self, gridsize, gridsize_2, point=None):
        """find all possible neighbour (using gridsizes) points 
            although some may be imaginary and return them as a list"""
        if point:
            point_1 = [(point[0]+gridsize),point[1],point[2]]
            point_2 = [(point[0]-gridsize),point[1],point[2]]
            point_3 = [point[0],(point[1]+gridsize),point[2]]
            point_4 = [point[0],(point[1]-gridsize),point[2]]
            point_5 = [(point[0]+gridsize_2),point[1],point[2]]
            point_6 = [(point[0]-gridsize_2),point[1],point[2]]
            point_7 = [point[0],(point[1]+gridsize_2),point[2]]
            point_8 = [point[0],(point[1]-gridsize_2),point[2]]
            possible_neighbours = []
            possible_neighbours.append(point_1)
            possible_neighbours.append(point_2)
            possible_neighbours.append(point_3)
            possible_neighbours.append(point_4)
            possible_neighbours.append(point_5)
            possible_neighbours.append(point_6)
            possible_neighbours.append(point_7)
            possible_neighbours.append(point_8)
            return possible_neighbours
        else:
            return None

    def find_neighbour_points_4(self, gridsize, gridsize_2, point=None):
        """find all possible direct neighbours (using gridsizes) 
            points although some may be imaginary and return them as a list"""
        if point:
            point_1 = [(point[0]+gridsize),point[1],point[2]]
            point_2 = [(point[0]-gridsize),point[1],point[2]]
            point_3 = [point[0],(point[1]+gridsize),point[2]]
            point_4 = [point[0],(point[1]-gridsize),point[2]]
            possible_neighbours = []
            possible_neighbours.append(point_1)
            possible_neighbours.append(point_2)
            possible_neighbours.append(point_3)
            possible_neighbours.append(point_4)
            return possible_neighbours
        else:
            return None

    def draw_shop(self, point, shop = None, xaxis = None):
        """visualize the shop by drawing the rectangle;
            this should also depend on wether its a junction or another type of shop"""
        z = (0,0,1)
        w = 2575
        if shop.type != "junction":
            if xaxis[1] == 1:
                point = (point[0]+1800, point[1]+w/2, 0)
                plane = rs.PlaneFromNormal(point, z, xaxis)
                w = -1 *w
                chosen_location = rs.AddRectangle( plane, w, 3600 ) 
            else:
                point[0] = point[0] -w/2
                point[1] = point[1] -1800
                plane = rs.PlaneFromNormal(point, z, xaxis)
                chosen_location = rs.AddRectangle( plane, w, 3600 )
        else:
            if xaxis == "dl":
                point = (point[0]-w/2, point[1]-w/2, 0)
                plane = rs.PlaneFromNormal(point, z)
                chosen_location = rs.AddRectangle( plane, 3087.5, 3087.5)
            elif xaxis == "ul":
                point = (point[0]-w/2, point[1]+w/2, 0)
                plane = rs.PlaneFromNormal(point, z)
                chosen_location = rs.AddRectangle( plane, 3087.5, -3087.5)
            elif xaxis == "ur":
                point = (point[0]+w/2, point[1]+w/2, 0)
                plane = rs.PlaneFromNormal(point, z)
                chosen_location = rs.AddRectangle( plane, -3087.5, -3087.5)
            else:
                point = (point[0]+w/2, point[1]-w/2, 0)
                plane = rs.PlaneFromNormal(point, z)
                chosen_location = rs.AddRectangle( plane, -3087.5, 3087.5)
        return chosen_location
        
    def add_values(self,noise,function,pollution,distance):
        """add the values of an existing shop"""
        self.noise = noise
        self.function = function
        self.pollution = pollution
        self.distance = distance
        
    def find_distances(self,points):
        """find the distances from a shop (wether empty or not) to a list of points"""
        distances = []
        for point in points:
            distance = sqrt(abs(self.x - point[0])*abs(self.x - point[0])+ abs(self.y - point[1])*abs(self.y - point[1]))
            distances.append(distance)
        return distances
        
    def set_house(self):
        """set an occupied shop to have a house on top"""
        self.house = True
    
    def find_xaxis(self,point, neighbourpoints, all_points, shop):
        """find the axis of the street the shop is on, this is different for a junction shop
            as they need to be oriented in two directions"""
        real_shops = []
        neighbourpoints_r = []
        for pnt in neighbourpoints[0:4]:
            if pnt in all_points:
                real_shops.append(pnt)
        if shop.type == "junction":
            if point[0] - real_shops[0][0] > 0 or point[0] - real_shops[1][0] > 0:
                if point[1] - real_shops[0][1] > 0 or point[1] - real_shops[1][1] > 0:
                    xaxis = "dl"
                else:
                    xaxis = "ul"
            else:
                if point[1] - real_shops[0][1] > 0 or point[1] - real_shops[1][1] > 0:
                    xaxis = "dr"
                else:
                    xaxis = "ur"
        elif point[0] - real_shops[0][0] == 0:
            xaxis = (0,1,0)
        else:
            xaxis = (1,0,0)
        return xaxis
        
def find_integers_nbs(points, shops):
    """if you have a point of a shop, this method finds the integer(s) of the corresponding shops"""
    shop_index = []
    if points:
        for point in points:
            for index, shop in enumerate(shops):
                if point[0] == shop.x and point[1] == shop.y:
                    shop_index.append(index)
                else:
                    pass
        return shop_index
    else:
        return None

def remap(list, high=100):
    """remap all numbers in a list to a maximum value, the default is 100"""
    remapped_nrs = []
    for item in list:
        remapped = ((item-min(list))/(max(list)-min(list))) *high
        remapped = int(round(remapped))
        remapped_nrs.append(remapped)
    return remapped_nrs


#make nice python lists
x_end = (x_end.split(","))
y_end = (y_end.split(","))
x_junction = x_junction.split(",")
y_junction = y_junction.split(",")
x_street = x_street.split(",")
y_street = y_street.split(",")
x_square = x_square.split(",")
y_square = y_square.split(",")


#make every lists integers
x_end = list(map(int, x_end))
y_end = list(map(int, y_end))
x_junction = list(map(int, x_junction))
y_junction = list(map(int, y_junction))
x_street = list(map(int, x_street))
y_street = list(map(int, y_street))
x_square = list(map(int,x_square))
y_square = list(map(int,y_square))
occupied = list(map(int, occupied))
noises = list(map(int, noises))
functions = list(map(int, functions))
pollutions = list(map(int, pollutions))
distances = list(map(int, distances))

#remap some of the functions to a range of 0-100
noises_r = remap(noises)
functions_r = remap(functions)
pollutions_r = remap(pollutions)
distances_r = remap(distances)

#make shops from class Shop and append them to empty list
shops = []
for i in range(len(x_street)):
    shop= Shop(x_street[i],y_street[i],"street")
    shops.append(shop)
for i in range(len(x_end)):
    shop= Shop(x_end[i],y_end[i],"end")
    shops.append(shop)
for i in range(len(x_junction)):
    shop= Shop(x_junction[i],y_junction[i],"junction")
    shops.append(shop)
for i in range(len(x_square)):
    shop= Shop(x_square[i],y_square[i],"square")
    shops.append(shop)

#import the shops that are already occupied
#assign all the remapped values (noise,pollution,function, distance) for the shops that are occupied
#also assign a house if the shop has one
for index, i in enumerate(occupied):
    shops[i].set_occupied()
    shops[i].add_values(noises_r[index],functions_r[index],pollutions_r[index],distances_r[index])
    if houses[index] == 'yes':
        shops[i].set_house()
    else:
        pass

#find all possible points in lists of [x,y,z] to be used later
all_shop_points = []
for shop in shops:
    pnt = shop.get_point()
    all_shop_points.append(pnt)


#draw existing shops
existing_shops___ =[]
for shop in shops:
    if shop.occupied:
        point = shop.get_point()
        nbpnts = shop.find_neighbour_points(gridsize, gridsize_2, point)
        xaxis = shop.find_xaxis(point, nbpnts, all_shop_points, shop)
        rectangle = shop.draw_shop(point,shop, xaxis)
        existing_shops___.append(rectangle)
    else:
        pass

#multiply the weighfactors 
#(for some reason the distance weight for social security outweighted all others)
wn = wn**2
wf = wf**2
wp = wp**2
wd = wd**0.25


#make a partition list and add the first 3 shops (which are already defined in the excel file)
partition_list = [1,1,1]

#now start a loop that generates the bazaar based on rng provided by a seperate python script
#this is to prevent the random numbers to be regenerated everytime the number of iterations is changed

#####################################################
### HERE STARTS THE FOR LOOP THAT GENERATES AUTO ####
#####################################################

if run:
    for nr in range(iterations):
        #checking the usershop size
        
        user_size = user_sizes[nr]
        
        #getting a random number to essentially choose from a catalogue
        random_nr = rng[nr]
        #teashop
        if random_nr == 0:
            user_noise = 40
            user_pollution = 30
            user_function = 0
            user_choice = user_choise_rng[nr]
            house = house_rng[nr]
            if house == 0:
                user_house = 'yes'
            else:
                user_house = 'no'
        #restaurant
        elif random_nr == 1 or random_nr == 13:
            user_noise = 70
            user_pollution = 40
            user_function = 0
            user_choice = user_choise_rng[nr]
            house = house_rng[nr]
            if house == 0:
                user_house = 'yes'
            else:
                user_house = 'no'
        #herb_store
        elif random_nr == 2:
            user_noise = 20
            user_pollution = 20
            user_function = 1
            user_choice = user_choise_rng[nr]
            house = house_rng[nr]
            if house == 0:
                user_house = 'yes'
            else:
                user_house = 'no'
        #vegetable_store
        elif random_nr == 3:
            user_noise = 10
            user_pollution = 30
            user_function = 1
            user_choice = user_choise_rng[nr]
            house = house_rng[nr]
            if house == 0:
                user_house = 'yes'
            else:
                user_house = 'no'
        #bakery
        elif random_nr == 4:
            user_noise = 40
            user_pollution = 30
            user_function = 1
            user_choice = user_choise_rng[nr]
            house = house_rng[nr]
            if house == 0:
                user_house = 'yes'
            else:
                user_house = 'no'
        #butcher
        elif random_nr == 5:
            user_noise = 50
            user_pollution = 50
            user_function = 1
            user_choice = user_choise_rng[nr]
            house = house_rng[nr]
            if house == 0:
                user_house = 'yes'
            else:
                user_house = 'no'
        #fabrics
        elif random_nr == 6:
            user_noise = 20
            user_pollution = 10
            user_function = 2
            user_choice = user_choise_rng[nr]
            house = house_rng[nr]
            if house == 0:
                user_house = 'yes'
            else:
                user_house = 'no'
        #pharmacy
        elif random_nr == 7:
            user_noise = 10
            user_pollution = 40
            user_function = 2
            user_choice = user_choise_rng[nr]
            house = house_rng[nr]
            if house == 0:
                user_house = 'yes'
            else:
                user_house = 'no'
        #phonestore
        elif random_nr == 8:
            user_noise = 20
            user_pollution = 0
            user_function = 2
            user_choice = user_choise_rng[nr]
            house = house_rng[nr]
            if house == 0:
                user_house = 'yes'
            else:
                user_house = 'no'
        #coppersmith
        elif random_nr == 9:
            user_noise = 80
            user_pollution = 50
            user_function = 3
            user_choice = user_choise_rng[nr]
            house = house_rng[nr]
            if house == 0:
                user_house = 'yes'
            else:
                user_house = 'no'
        #blacksmith
        elif random_nr == 10:
            user_noise = 100
            user_pollution = 70
            user_function = 3
            user_choice = user_choise_rng[nr]
            house = house_rng[nr]
            if house == 0:
                user_house = 'yes'
            else:
                user_house = 'no'
        #furnature
        elif random_nr == 11:
            user_noise = 80
            user_pollution = 100
            user_function = 3
            user_choice = user_choise_rng[nr]
            house = house_rng[nr]
            if house == 0:
                user_house = 'yes'
            else:
                user_house = 'no'
        #pottery
        elif random_nr == 12:
            user_noise = 30
            user_pollution = 60
            user_function = 3
            user_choice = user_choise_rng[nr]
            house = house_rng[nr]
            if house == 0:
                user_house = 'yes'
            else:
                user_house = 'no'

        #remap the 'user'input
        user_noise_r = user_noise
        user_pollution_r = user_pollution
        user_function_r =  ((user_function-min(functions))/(max(functions)-min(functions))) *100
    
        
        
        #find all shops that are not occupied
        #check to see wether these open slots are actually adjecent to an already built shop = available
        occupied_points = []
        available_shops = [] 
        unoccupied_points = []
        possible_points_m = []
        possible_points_m_p = []
        possible_points_l = []
        m_points = []
        for o in occupied:
            occupied_points.append(shops[o].get_point())
        for ix,shop in enumerate(shops):
            if shop.occupied == False:
                point = shop.get_point()
                unoccupied_points.append(point)
                #find the neighbouring points of these points and see if any belong to an already built shop
                if user_size == "s":
                    nbs = shop.find_neighbour_points(gridsize,gridsize_2,point)
                    check = False
                    for neighbour in nbs:
                        if neighbour in occupied_points:
                            check = True
                    if check == True:
                        available_shops.append(ix)
                #so now the hard part, if the shopsize is not small, 
                #we should not append it to available shops directly but to a seperate list
                if user_size == "m" or user_size == "l":
                    nbs = shop.find_neighbour_points(gridsize,gridsize_2,point)
                    check = False
                    for neighbour in nbs:
                        if neighbour in occupied_points:
                            check =True
                    if check == True:
                        possible_points_m.append(ix)
                        m_point = shop.get_point()
                        possible_points_m_p.append(m_point)
                    
        #now we can run over the seperate list and check if they have an available neighbour
        if user_size == "m" or user_size == "l":
            for index in possible_points_m:
                pnt = shops[index].get_point()
                nbps = shops[index].find_neighbour_points_4(gridsize,gridsize_2,pnt)
                check_m = False
                
                for nb in nbps:
                    if nb in unoccupied_points:
                        check_m = True
                        possible_points_l.append(nb)
                        m_points.append(pnt)
                        if check_m == True:
                            break
                if user_size == "m":
                    if check_m == True:
                        available_shops.append(index)
                """
                if user_size == "l":
                    if check_m == True:
                        m_points.append(pnt)
                """

        #if the user size is large, the empty neighbour needs to have 2 more empty neighbours
        #to create a sequence of 4 empty slots where at least one is adjecent to an occupied slot
        #now it is also important to make sure that all these 4 slots are unique so its not a chain of 2 slots that are counted twice
        if user_size == "l":
            possible_shops_l = find_integers_nbs(possible_points_l, shops)
            m_shops = find_integers_nbs(m_points,shops)
            for middle,index,available in zip(m_points,possible_shops_l,m_shops):
                pnt = shops[index].get_point()
                nbps = shops[index].find_neighbour_points_4(gridsize,gridsize_2,pnt)
                middle_point = middle

                check_l = False
                for nb in nbps:
                    if nb in unoccupied_points and nb != middle_point:
                        check_l = True
                        l_point = nb
                        if check_l == True:
                            break
                l_shop = find_integers_nbs([l_point],shops)
                nbps_2 = shops[l_shop[0]].find_neighbour_points_4(gridsize,gridsize_2,l_point)
                check_l2 = False
                for nb_2 in nbps_2:
                    if nb_2 in unoccupied_points and nb_2 != pnt:
                        check_l2 = True
                if user_size == "l":
                    if check_l == True and check_l2 == True:
                        available_shops.append(available)
        
        
        
        #draw existing shops
        existing_shops =[]
        for shop in shops:
            if shop.occupied:
                available_points = []
                for indexx in available_shops:
                    pnt = shops[indexx].get_point()
                    available_points.append(pnt)
                point = shop.get_point()
                nbpnts = shop.find_neighbour_points(gridsize, gridsize_2, point)
                xaxis = shop.find_xaxis(point, nbpnts, all_shop_points, shop)
                rectangle = shop.draw_shop(point,shop, xaxis)
                existing_shops.append(rectangle)
            else:
                pass
        
        #now for every every element we should compute the distance to occupied slots as a list
        #(in a future version i would like to check only the distanes within a certain range, but for now this isnt necassary)
        #and then after immidiately check the most optimal spot based on the difference between noise function pollution and 
        #house distance and as a function of the previously computed distances between the new shop and all existing shops
        slot_qualifications = []
        flag = False
        length_loop = len(available_shops)

        for i in available_shops:
            distances_occupied = shops[i].find_distances(occupied_points)
            for index__,distance in enumerate(distances_occupied):
                if distance > 50000:
                    distances_occupied[index__] =50000
            d = remap(distances_occupied,10)
            for index_,distance in enumerate(d):
                d[index_] = (10 -distance)/10
            qualifications = []
            for j,x in enumerate(occupied):
                noise_difference = (abs(user_noise_r-shops[x].noise) * wn *d[j] )
                qualifications.append(noise_difference)
                function_difference = (abs(user_function_r-shops[x].function) *wf *d[j])
                qualifications.append(function_difference)
                pollution_difference = (abs(user_pollution_r-shops[x].pollution) * wp * d[j])
                qualifications.append(pollution_difference)
                if user_house == 'yes' and shops[x].house == False:
                    qualifications.append((shops[x].distance * wd*-1 *d[j]))
                elif user_house == 'yes' and shops[x].house == True:
                    qualifications.append((shops[x].distance * wd * d[j] ))
                elif user_house == 'no' and shops[x].house == True:
                    qualifications.append((shops[x].distance * wd*-1 *d[j]))
                else:
                    qualifications.append((shops[x].distance * wd * d[j] ))
                    
            qualifications = sum(map(float,qualifications))
            #now apply a bonus factor if a community shop [0] is going to occupy a junction
            #also apply a negative factor if any shop but community is going to occupy a junction
            if user_function == 0:
                if shops[i].type == 'junction':
                    qualifications = qualifications * 0.75
            else:
                if shops[i].type == 'junction':
                    qualifications = qualifications * 1.25
            #now apply a bonus factor if a community or workshop [0/3] is going to occupy a square
            #also apply a negative factor if any shop but community is going to occupy a square
            if user_function == 0 or user_function == 3:
                if shops[i].type == 'square':
                    qualifications = qualifications * 0.75
            else:
                if shops[i].type == 'square':
                    qualifications = qualifications * 1.25
            slot_qualifications.append(qualifications)

        #find the top 5 locations
        user_shop_integers = []
        user_shop_integer_1 = slot_qualifications.index(min(slot_qualifications))
        user_shop_integers.append(user_shop_integer_1)
        slot_qualifications[user_shop_integer_1] = 1000000000
        user_shop_integer_2 = slot_qualifications.index(min(slot_qualifications))
        user_shop_integers.append(user_shop_integer_2)
        slot_qualifications[user_shop_integer_2] = 1000000000
        user_shop_integer_3 = slot_qualifications.index(min(slot_qualifications))
        user_shop_integers.append(user_shop_integer_3)
        slot_qualifications[user_shop_integer_3] = 1000000000
        user_shop_integer_4 = slot_qualifications.index(min(slot_qualifications))
        user_shop_integers.append(user_shop_integer_4)
        slot_qualifications[user_shop_integer_4] = 1000000000
        user_shop_integer_5 = slot_qualifications.index(min(slot_qualifications))
        user_shop_integers.append(user_shop_integer_5)
        
        #visual feedback for the user to know which shop he is chosing
        #make all options visual
        shop_options = []
        shop_options_integers = []
        for k in user_shop_integers:
            rectangles = []
            shop_option_integer = available_shops[k]
            #if the user size isnt small 2 rectangles should be drawn
            if user_size == "m" or user_size == "l":
                mpoint = shops[shop_option_integer].get_point()
                mediumsizes = shops[shop_option_integer].find_neighbour_points_4(gridsize, gridsize_2, mpoint)
                m_real_points = []
                for m in mediumsizes:
                    if m in unoccupied_points:
                        m_real_points.append(m)
                m_real = find_integers_nbs(m_real_points, shops)
                if m_real:
                    point_2 = shops[m_real[0]].get_point()
                    nbpnts_2 = shops[m_real[0]].find_neighbour_points_4(gridsize, gridsize_2, point_2)
                    xaxis_2 = shops[m_real[0]].find_xaxis(point_2, nbpnts_2, all_shop_points, shops[m_real[0]])
                    rectangle_2 = shops[m_real[0]].draw_shop(point_2, shops[m_real[0]], xaxis_2)
                    rectangles.append(rectangle_2)
                    shop_options.append(rectangle_2)
            #if the usersize is large 4 rectangles should be drawn
            if user_size == "l":
                l_real_points = []
                l_point = shops[m_real[0]].get_point()
                m_point = shops[shop_option_integer].get_point()
                largesizes = shops[m_real[0]].find_neighbour_points_4(gridsize, gridsize_2, l_point)
                for l in largesizes:
                    if l in unoccupied_points and l != mpoint:
                        l_real_points.append(l)

                l_real = find_integers_nbs(l_real_points, shops)
                if l_real:
                    point_3 = shops[l_real[0]].get_point()
                    nbpnts_3 = shops[l_real[0]].find_neighbour_points_4(gridsize, gridsize_2, point_3)
                    xaxis_3 = shops[l_real[0]].find_xaxis(point_3, nbpnts_3, all_shop_points, shops[l_real[0]])
                    rectangle_3 = shops[l_real[0]].draw_shop(point_3, shops[l_real[0]], xaxis_3)
                    rectangles.append(rectangle_3)
                    shop_options.append(rectangle_3)
                    
                    l_real_points_2 = []
                    for l2 in nbpnts_3:
                        if l2 in unoccupied_points and l2 != l_point:
                            l_real_points_2.append(l2)
                    l_real_2 = find_integers_nbs(l_real_points_2,shops)
                    if l_real_2:
                        point_4 = shops[l_real_2[0]].get_point()
                        nbpnts_4 = shops[l_real_2[0]].find_neighbour_points_4(gridsize, gridsize_2, point_4)
                        xaxis_4 = shops[l_real_2[0]].find_xaxis(point_4, nbpnts_4, all_shop_points, shops[l_real_2[0]])
                        rectangle_4 = shops[l_real_2[0]].draw_shop(point_4, shops[l_real_2[0]], xaxis_4)
                        rectangles.append(rectangle_4)
                        shop_options.append(rectangle_4)
                
            point = shops[shop_option_integer].get_point()
            nbpnts = shops[shop_option_integer].find_neighbour_points_4(gridsize, gridsize_2, point)
            xaxis = shops[shop_option_integer].find_xaxis(point, nbpnts, all_shop_points, shops[shop_option_integer])
            rectangle = shops[shop_option_integer].draw_shop(point, shops[shop_option_integer], xaxis)
            
            rectangles.append(rectangle)
            shop_options.append(rectangle)
            shop_options_integers.append(shop_option_integer)
            
            
            
        #let the user see his current choice (same as visualising all choises but then only for one of the 5)
        #(iknow this could probably be done in the previous loop but ok)
        user_integer =user_shop_integers[int(user_choice)]
        user_shop = available_shops[user_integer]
        chosen_location = []
        if user_size == "m" or user_size == "l":
                mpoint = shops[user_shop].get_point()
                mediumsizes = shops[user_shop].find_neighbour_points_4(gridsize, gridsize_2, mpoint)
                m_real_points = []
                for m in mediumsizes:
                    if m in unoccupied_points:
                        m_real_points.append(m)
                m_real_u = find_integers_nbs(m_real_points, shops)
                if m_real_u:
                    point_2 = shops[m_real_u[0]].get_point()
                    nbpnts_2 = shops[m_real_u[0]].find_neighbour_points_4(gridsize, gridsize_2, point_2)
                    xaxis_2 = shops[m_real_u[0]].find_xaxis(point_2, nbpnts_2, all_shop_points, shops[m_real_u[0]])
                    rectangle_2 = shops[m_real_u[0]].draw_shop(point_2, shops[m_real_u[0]], xaxis_2)
                    rectangles.append(rectangle_2)
                    chosen_location.append(rectangle_2)
                    existing_shops___.append(rectangle_2)
                    
        if user_size == "l":
            l_real_points = []
            l_point = shops[m_real_u[0]].get_point()
            m_point = shops[user_shop].get_point()
            largesizes = shops[m_real_u[0]].find_neighbour_points_4(gridsize, gridsize_2, l_point)
            for l in largesizes:
                if l in unoccupied_points and l != mpoint:
                    l_real_points.append(l)

            l_real_u = find_integers_nbs(l_real_points, shops)
            if l_real_u:
                point_3 = shops[l_real_u[0]].get_point()
                nbpnts_3 = shops[l_real_u[0]].find_neighbour_points_4(gridsize, gridsize_2, point_3)
                xaxis_3 = shops[l_real_u[0]].find_xaxis(point_3, nbpnts_3, all_shop_points, shops[l_real_u[0]])
                rectangle_3 = shops[l_real_u[0]].draw_shop(point_3, shops[l_real_u[0]], xaxis_3)

                rectangles.append(rectangle_3)
                chosen_location.append(rectangle_3)
                existing_shops___.append(rectangle_3)
                
                l_real_points_2 = []
                for l2 in nbpnts_3:
                    if l2 in unoccupied_points and l2 != l_point:
                        l_real_points_2.append(l2)
                l_real_u2 = find_integers_nbs(l_real_points_2,shops)
                if l_real_2:
                    point_4 = shops[l_real_u2[0]].get_point()
                    nbpnts_4 = shops[l_real_u2[0]].find_neighbour_points_4(gridsize, gridsize_2, point_4)
                    xaxis_4 = shops[l_real_u2[0]].find_xaxis(point_4, nbpnts_4, all_shop_points, shops[l_real_u2[0]])
                    rectangle_4 = shops[l_real_u2[0]].draw_shop(point_4, shops[l_real_u2[0]], xaxis_4)
                    rectangles.append(rectangle_4)
                    chosen_location.append(rectangle_4)
                    existing_shops___.append(rectangle_4)
                
        point = shops[user_shop].get_point()
        nbpnts = shops[user_shop].find_neighbour_points_4(gridsize, gridsize_2, point)
        xaxis = shops[user_shop].find_xaxis(point, nbpnts, all_shop_points, shops[user_shop])
        rectangle = shops[user_shop].draw_shop(point, shops[user_shop], xaxis)
        chosen_location.append(rectangle)
        existing_shops___.append(rectangle)
        
        
       #This is an important step for the past processing, the partition list will help see which shops 
       #should be considered as one shop (as large and medium shops are build from multiple small ones)
        if user_size == "m":
            partition_list.append("2")
        elif user_size == "l":
            partition_list.append("4")
        else:
            partition_list.append("1")
        

        #set the chosen shop to occupied
        #if the user size is medium or large, set multiple shops to occupied
        shops[user_shop].set_occupied()
        occupied.append(user_shop)
        if user_size == "m" or user_size == "l":
            shops[m_real_u[0]].set_occupied()
            occupied.append(m_real_u[0])
        if user_size == "l" :
            shops[l_real_u[0]].set_occupied()
            occupied.append(l_real_u[0])
            shops[l_real_u2[0]].set_occupied()
            occupied.append(l_real_u2[0])
        
        #set the chosen shop to house if there is a house
        #if the user size is medium or large, set multiple houses
        if user_house == 'yes':
            shops[user_shop].set_house()
            if user_size == "m" or user_size == "l":
                shops[m_real_u[0]].set_house()
            if user_size == "l":
                shops[l_real_u[0]].set_house()
                shops[l_real_u2[0]].set_house()
        else:
            pass
        
        #although this is a legacy function, I might still need this in the future
        #append user values to excellist ouput
        #if shopsize is medium or large, append it multiple times
        noises.append(user_noise)
        functions.append(user_function)
        pollutions.append(user_pollution)
        if user_size == "m" or user_size == "l":
            noises.append(user_noise)
            functions.append(user_function)
            pollutions.append(user_pollution)
        if user_size == "l":
            noises.append(user_noise)
            functions.append(user_function)
            pollutions.append(user_pollution)
            noises.append(user_noise)
            functions.append(user_function)
            pollutions.append(user_pollution)
        
        #find a method to recalculate the housing distances and change the houses
        distances = []
        houses = []
        pnts = []
        for l in occupied:
            if shops[l].house == True:
                pnt = shops[l].get_point()
                pnts.append(pnt)
        for indx,value in enumerate(occupied):
            dstncs = shops[value].find_distances(pnts)
            distances.append(min(dstncs))
            if shops[value].house == True:
                houses.append('yes')
            else:
                houses.append('no')
        
        #add values to chosen shop
        #again, if the size is m or l, add values to multiple shops
        shops[user_shop].add_values(user_noise_r,user_function_r,user_pollution_r,distances[-1])
        if user_size == "m" or user_size == "l":
            shops[m_real_u[0]].add_values(user_noise_r,user_function_r,user_pollution_r,distances[-1])
        if user_size == "l":
            shops[l_real_u[0]].add_values(user_noise_r,user_function_r,user_pollution_r,distances[-1])
            shops[l_real_u2[0]].add_values(user_noise_r,user_function_r,user_pollution_r,distances[-1])
        distances = list(map(int, distances))
# ---------- end python_2 ----------

data_35 = Data(python_2.functions)
data_36 = Data(python_2.houses)
data_37 = Data(python_2.existing_shops_2)
data_38 = Data(python_2.partition_list)
data_39 = Data(python_2.noises)
data_40 = Data(python_2.pollutions)
data_41 = Data(python_2.distances)
data_42 = Data(python_2.chosen_location)
data_43 = Data(python_2.shop_options)
data_44 = Data(python_2.occupied)

python_3 = GhPythonScript(x=data_38)  # -> out, indexs; inputs x: list
# ---------- python_3: Python ----------
__author__ = "david"
__version__ = "2019.10.23"

import rhinoscriptsyntax as rs

indexs =[]
for index,value in enumerate(x):
    if value == '2':
        indexs.append(index)
print(indexs)
# ---------- end python_3 ----------
# The partitionlist is needed to visualise the big and small size shops, as they are made up of multiple smaller shops. The list consists of 1s 2s and 4s, which refer to the number of shops which are grouped to create the final shops.
# Post-python Partitionlist processing
panel_3 = Panel("1")
ins = InsertItems(List=data_38, Item=panel_3, Indices=python_3.indexs, Wrap=True)
python_4 = GhPythonScript(x=ins)  # -> out, indexs; inputs x: list
# ---------- python_4: Python ----------
__author__ = "david"
__version__ = "2019.10.23"

import rhinoscriptsyntax as rs

indexs =[]
for index,value in enumerate(x):
    if value == '4':
        indexs.append(index)
print(indexs)
# ---------- end python_4 ----------
ins_2 = InsertItems(List=ins, Item=panel_3, Indices=python_4.indexs, Wrap=True)
python_5 = GhPythonScript(x=ins_2)  # -> out, indexs; inputs x: list; same code as python_4
ins_3 = InsertItems(List=ins_2, Item="3", Indices=python_5.indexs, Wrap=True)
python_6 = GhPythonScript(x=ins_3)  # -> out, indexs; inputs x: list; same code as python_4
# 01-11-2019
ins_4 = InsertItems(List=ins_3, Item="4", Indices=python_6.indexs, Wrap=True)
python_7 = GhPythonScript(x=ins_4)  # -> out, indexs; inputs x: list
# ---------- python_7: Python ----------
__author__ = "david"
__version__ = "2019.10.23"

import rhinoscriptsyntax as rs

indexs =[]
for index,value in enumerate(x):
    if value == '4' or value == '2' or value=='3':
        indexs.append(index)
print(indexs)
# ---------- end python_7 ----------

# ----
# Post-python Excel write
# Post-python Preview
entwine = Entwine(
    Branch00=data_44,
    Branch01=data_39,
    Branch02=data_35,
    Branch03=data_40,
    Branch04=data_41,
    Branch05=data_36,
    FlattenInputs=True)
# This component is a legacy function and writes the output of the script into the excel file which is also used to read info from. This way the bazaar can be manually build.
panel_4 = Panel("C:\Users\david\Documents\Bouwkunde\Master\Earthy\Week5\bazaar_database.xlsx")
# 01-11-2019
write = ExcelWrite(Start=Toggle(False), FilePath=panel_4, SheetName="blad1", Cell="A1", Data=entwine)

# ----
# This Component just works with the output and dataflows to make sure all the geometry previews correctly (e.g. big shops dont show as 4 small shops)
item = ListItem(List=data_34, Index=iterations, Wrap=True)  # -> Item1, Item
panel_5 = Panel(item.Item1)
python_8 = GhPythonScript(x=panel_5)  # -> out, a, b, c
# ---------- python_8: Python ----------
__author__ = "win 10"
__version__ = "2019.10.23"

import rhinoscriptsyntax as rs

if x == "s":
    a = [True]
    b = [None]
    c = [None]
elif x == "m":
    a = [False, True]
    b = [True, False]
    c = [None]
elif x == "l":
    a = [False,False,True]
    b = [False,True,False]
    c = [True,False,False]
# ---------- end python_8 ----------
panel_6 = Panel(python_8.a)
panel_7 = Panel(python_8.b)
panel_8 = Panel(python_8.c)
cull_5 = CullPattern(List=data_43, CullPattern=panel_6)
cull_6 = CullPattern(List=data_43, CullPattern=panel_7)
cull_7 = CullPattern(List=data_43, CullPattern=panel_8)
entwine_2 = Entwine(Branch00=cull_5, Branch01=cull_6, Branch02=cull_7, FlattenInputs=True)
flip = FlipMatrix(Data=entwine_2)
join_9 = BrepJoin(Breps=flip)  # -> Breps, Closed
edges = BrepEdges(Brep=join_9.Breps)  # -> Naked, Interior, NonManifold
join_10 = JoinCurves(Curves=edges.Naked, Preserve=False)  # -> flatten(Curves)

item_2 = ListItem(List=data_38, Index=-1, Wrap=True)
series = Series(Start=-1, Step=-1, Count=item_2)
cull_i_4 = CullIndex(List=data_38, Indices=-1, Wrap=True)
cull_i_5 = CullIndex(List=data_37, Indices=series, Wrap=True)
partition = PartitionList(List=cull_i_5, Size=cull_i_4)
join_11 = BrepJoin(Breps=partition)  # -> Breps, Closed
edges_2 = BrepEdges(Brep=join_11.Breps)  # -> Naked, Interior, NonManifold
join_12 = JoinCurves(Curves=edges_2.Naked, Preserve=False)  # -> flatten(Curves)

wires = BrepWireframe(Brep=data_42, Density=-1)
join_13 = JoinCurves(Curves=wires, Preserve=False)
runion = RegionUnion(Curves=flatten(join_13))

data_45 = Data(python_7.indexs)
colour = ColourPicker(PickedColour=RGB(67, 193, 222))
colour_2 = ColourPicker(PickedColour=RGB(252, 18, 198))
colour_3 = ColourPicker(PickedColour=RGB(94, 6, 94))
colour_4 = ColourPicker(PickedColour=RGB(255, 242, 255))
panel_9 = Panel(data_35)

# ---- group: Preview
# 01-11-2019
material = CreateMaterial(Diffuse=RGB(255, 0, 0), Specular=RGB(255, 255, 255), Emission=RGB(0, 0, 0), Transparency=0, Shine=0)
material_2 = CreateMaterial(Diffuse=RGB(102, 102, 102), Specular=RGB(255, 255, 255), Emission=RGB(0, 0, 0), Transparency=0, Shine=0)
material_3 = CreateMaterial(Diffuse=RGB(184, 184, 184), Specular=RGB(255, 255, 255), Emission=RGB(0, 0, 0), Transparency=0.5, Shine=0)
crv_3 = Curve(join_10)
crv_4 = Curve(join_12)
preview = CustomPreview(Geometry=crv_3, Material=material_2)
preview_2 = CustomPreview(Geometry=runion, Material=material)
preview_3 = CustomPreview(Geometry=crv_4, Material=material_3)

# ----
data_46 = Data(colour)
data_47 = Data(colour_4)
# These components preview the numbers and letters
data_48 = Data(panel_9)
data_49 = Data(colour_3)
data_50 = Data(colour_2)
data_51 = Data(panel_9)
# Post-python preview shopfunction
data_52 = Data(panel_9)

# ----
# Post-python Color management
panel_10 = Panel("1")
mindex = MemberIndex(Set=data_51, Member=panel_10)  # -> Index, Count
replace = ReplaceItems(List=data_48, Item=data_50, Indices=mindex.Index, Wrap=False)
mindex_2 = MemberIndex(Set=replace, Member="0")  # -> Index, Count
replace_2 = ReplaceItems(List=replace, Item=data_46, Indices=mindex_2.Index, Wrap=False)
mindex_3 = MemberIndex(Set=replace, Member="2")  # -> Index, Count
mindex_4 = MemberIndex(Set=replace_2, Member="3")  # -> Index, Count
# 01-11-2019
replace_3 = ReplaceItems(List=replace_2, Item=data_47, Indices=mindex_3.Index, Wrap=False)
replace_4 = ReplaceItems(List=replace_3, Item=data_49, Indices=mindex_4.Index, Wrap=False)

# ---- group: preview text
item_3 = ListItem(List=data_30, Index=data_44, Wrap=True)
python_9 = GhPythonScript(x=data_52)  # -> out, a; inputs x: list
# ---------- python_9: Python ----------
__author__ = "david"
__version__ = "2019.10.16"

import rhinoscriptsyntax as rs

a = []

for i in x:
    if i == '0':
        a.append("C")
    elif i == '1':
        a.append("F")
    elif i == '2':
        a.append("M")
    else:
        a.append("W")
# ---------- end python_9 ----------
X = UnitX(Factor="-2")
move = Move(Geometry=item_3, Motion=X)  # -> Geometry, Transform
# 01-11-2019
replace_5 = ReplaceItems(List=move.Geometry, Indices=data_45, Wrap=False)
textbaker_2 = TextBaker(Location=replace_5, Text=python_9.a, Size="1500", Color=replace_4, Justification=4, Activate=False)

# ----
# Post-python preview houses
number_slider = Slider(1, range=0..10)
eval_3 = Evaluate(F="If(x=0, y, z)", x=data_32, y="+")
X_2 = UnitX(Factor=number_slider)
Y = UnitY(Factor=Slider(10, range=0..10))
ins_5 = InsertItems(List=eval_3, Item="+", Indices="0", Wrap=True)
addition = Addition(A=X_2, B=Y)
eval_4 = Evaluate(F="If(x=13, 0, x)", x=ins_5)
move_2 = Move(Geometry=item_3, Motion=expr("x*100", addition))  # -> Geometry, Transform
panel_11 = Panel(data_38)
addition_2 = Addition(A=iterations, B=2)
subset = SubList(List=eval_4, Domain=addition_2, Wrap=True)  # -> List, Index
replace_6 = ReplaceItems(List=move_2.Geometry, Indices=data_45, Wrap=False)
stack = StackData(Data=subset.List, Stack=panel_11)
# 01-11-2019
textbaker_3 = TextBaker(Location=replace_6, Text=stack, Size="2000", Color=RGB(255, 242, 0), Justification=0, Activate=False)

# ----
# Post-python preview shopnr
number_slider_2 = Slider(6, range=0..10)
Y_2 = UnitY(Factor=expr("x*-1", number_slider_2))
lng_2 = ListLength(List=item_3)
X_3 = UnitX(Factor=number_slider_2)
subtraction_2 = Subtraction(A=lng_2, B=0)
addition_3 = Addition(A=X_3, B=Y_2)
series_2 = Series(Start=0, Step=1, Count=subtraction_2)
move_3 = Move(Geometry=item_3, Motion=addition_3)  # -> Geometry, Transform
panel_12 = Panel(series_2)
# 01-11-2019
textbaker_4 = TextBaker(Location=move_3.Geometry, Text=panel_12, Size="8", Color=RGB(255, 255, 255), Justification=9, Activate=False)

# ----
# Post-python preview shoptype
number_slider_3 = Slider(5, range=0..10)
Y_3 = UnitY(Factor=expr("x*-1", Slider(0, range=0..10)))
X_4 = UnitX(Factor=number_slider_3)
ins_6 = InsertItems(List=data_31, Indices="0", Wrap=True)
addition_4 = Addition(A=X_4, B=Y_3)
move_4 = Move(Geometry=item_3, Motion=expr("x*100", addition_4))  # -> Geometry, Transform
addition_5 = Addition(A=iterations, B=2)
eval_5 = Evaluate(F="If(x=13, 0, x)", x=ins_6)
panel_13 = Panel(data_38)
subset_2 = SubList(List=eval_5, Domain=addition_5, Wrap=True)  # -> List, Index
stack_2 = StackData(Data=subset_2.List, Stack=panel_13)
# 01-11-2019
replace_7 = ReplaceItems(List=move_4.Geometry, Indices=data_45, Wrap=False)
textbaker_5 = TextBaker(Location=replace_7, Text=stack_2, Size="1100", Color=RGB(168, 168, 168), Justification=1, Activate=False)

data_53 = Data(mindex.Count)
data_54 = Data(mindex_2.Count)
data_55 = Data(mindex_4.Count)
data_56 = Data(mindex_3.Count)

# ----
# Capture viewport
# https://discourse.mcneel.com/t/capturing-rhino-layout-viewport-iterations-print-or-image-export/51387
# Make sure this object is
#  on top of all other objects
number_slider_4 = Slider(0.213, range=0..1)
# Capture viewport will capture the chosen rhino viewport whenever the trigger input is changed.I did not do this myself, the source is in the other panel.
panel_14 = Panel("C:\Users\david\Documents\Bouwkunde\Master\Earthy\week7\More_animations\sml_4")
path = FilePath("C:\Users\David Rutten\Desktop\viewport capture\")
pop2d = Populate2D(Region={Plane=PlaneXY(0, 0, 0), Size=Domain2(u=0..20, v=0..10)}, Count=100, Seed=1)
c_script = CSharpScript(Dir=panel_14, Name="Viewport {0}.png", VP="Top", Capture=Toggle(False), Trigger=iterations)  # -> out, A; inputs Dir: String, Name: String, VP: String, Capture: Boolean
# ---------- c_script: C# usings ----------
using System.IO;
using System.Linq;
using System.Data;
using System.Drawing;
using System.Reflection;
using System.Windows.Forms;
using System.Xml;
using System.Xml.Linq;
using System.Runtime.InteropServices;

using Rhino.DocObjects;
using Rhino.Collections;
using GH_IO;
using GH_IO.Serialization;
# ---------- c_script: C# ----------
    if (!Capture) return;
    if (string.IsNullOrWhiteSpace(Dir)) return;
    if (string.IsNullOrWhiteSpace(Name)) return;

    // Make sure the directory ends with a \
    if (!Dir.EndsWith(System.IO.Path.DirectorySeparatorChar.ToString()))
      Dir += System.IO.Path.DirectorySeparatorChar;

    // Do not create directories, only use existing ones.
    if (!System.IO.Directory.Exists(Dir))
      return;

    // Assume index=0 for the first filename.
    string fileName = Dir + string.Format(Name, 0);

    // Try to increment the index until we find a name which doesn't exist yet.
    if (System.IO.File.Exists(fileName))
      for (int i = 1; i < int.MaxValue; i++)
      {
        string localName = Dir + string.Format(Name, i);
        if (localName == fileName)
          return;

        if (!System.IO.File.Exists(localName))
        {
          fileName = localName;
          break;
        }
      }


    Rhino.Display.RhinoView view = RhinoDocument.Views.Find(VP, false);
    Bitmap image = view.CaptureToBitmap(true, false, false);
    A = image.Width;
    image.Save(fileName);
    image.Dispose();

    A = fileName;
# ---------- end c_script ----------
cir = Circle(Plane=pop2d, Radius=iterations)

data_57 = Data(subset_2.List)
python_10 = GhPythonScript(x=data_57)  # -> count_c, out, count_f, count_m, count_w; inputs x: list
# ---------- python_10: Python ----------
__author__ = "david"
__version__ = "2019.10.23"

import rhinoscriptsyntax as rs

x[0] = 0
x[1] = 3
x[2] = 7

count_c = 0
count_f = 0
count_m = 0
count_w = 0
for nr in x:
    if nr == 0 or nr == 1 or nr == 13:
        count_c = count_c + 1
    elif nr == 2 or nr == 3 or nr == 4 or nr == 5:
        count_f = count_f +1
    elif nr == 6 or nr == 7 or nr == 8:
        count_m = count_m +1
    else:
        count_w = count_w +1
# ---------- end python_10 ----------
data_58 = Data(python_10.count_c)
data_59 = Data(python_10.count_f)
data_60 = Data(python_10.count_m)
data_61 = Data(python_10.count_w)
genes = GenePool(
    Decimals=2,
    Maximum=100,
    Minimum=0,
    Value=[50, 50, 50.67, 50, 0, 3.12, 0, 13.64, 14.55, 14.55, 15.46, 15.45, 13.64, 100, 0, 0, 18.18, 0, 0, 0, 0, 0, 0, 54.66, 75.97])

bounds = GetViewportBoundaryDimensions(Refresh=True, Origin=Point(0, 0, 0), Scale=0.25, xDim=1612, yDim=751)
# User the plug-in proving ground, some additional information can be drawn directly into the rhino viewport
# Post-python draw HUD
number_slider_5 = Slider(0.14, range=0.01..1)
vert_tiles = VerticalTiles(Boundary=bounds, RelativeSizes=genes, Width=0.25, WidthPadding=number_slider_5, HeightPadding=0.02)
merge_2 = Merge(Data1=data_54, Data2=data_53, Data3=data_56, Data4=mindex_4.Count)  # -> flatten(Result)
item_4 = ListItem(List=vert_tiles, Index=Slider(-5, range=-5..5), Wrap=True)  # -> Item11, Item10, Item9, Item8, Item7, Item6, Item5, Item4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
format = Format(Format="Nr of workshops: {0}", Culture=127, Data0=data_61)
panel_15 = Panel("""F
C
M
W""")
format_2 = Format(Format="Nr of food shops: {0}", Culture=127, Data0=data_59)
format_3 = Format(Format="Nr of comunity shops: {0}", Culture=127, Data0=data_58)
format_4 = Format(Format="Nr of merchandise shops: {0}", Culture=127, Data0=data_60)
# 01-11-2019
hud_pie = DrawPieChart(BoundaryRectangle=item_4.Item7, Labels=panel_15, DataValues=merge_2)
hud_text = DrawText(
    Boundary=item_4.Item11,
    Text=format,
    TextOrdering=1,
    TextDistribution=0,
    ColorOverride=RGB(255, 255, 255),
    OrientVertically=False)
hud_text_2 = DrawText(
    Boundary=item_4.Item4,
    Text="Shops 3 different sizes 4",
    TextOrdering=1,
    TextDistribution=0,
    ColorOverride=RGB(255, 255, 255),
    OrientVertically=False)
hud_text_3 = DrawText(
    Boundary=item_4.Item9,
    Text=format_2,
    TextOrdering=1,
    TextDistribution=0,
    ColorOverride=RGB(255, 255, 255),
    OrientVertically=False)
hud_text_4 = DrawText(
    Boundary=item_4.Item8,
    Text=format_3,
    TextOrdering=1,
    TextDistribution=0,
    ColorOverride=RGB(255, 255, 255),
    OrientVertically=False)
hud_text_5 = DrawText(
    Boundary=item_4.Item10,
    Text=format_4,
    TextOrdering=1,
    TextDistribution=0,
    ColorOverride=RGB(255, 255, 255),
    OrientVertically=False)
merge_3 = Merge(Data1=hud_text_4, Data2=hud_text_3, Data3=hud_text_5, Data4=hud_text, Data5=hud_pie, Data6=hud_text_2)
hud = HeadsUpDisplayHUD(
    ShowHUD=Toggle(True),
    DrawingObjects=flatten(merge_3),
    DrawingBoundary=bounds,
    ConduitStyleSheet="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")
