# Grasshopper definition Computational_form_finding.gh (Grasshopper 1.0.7)
# plug-ins: Pufferfish, Octopus, Weaverbird, Kangaroo2 Components, karambaGH, Opossum

imput_shop_hallway = Panel("shop")
imput_shopsize = Panel("m")

# ----
# 2D topology pattern generation
data = Data(imput_shopsize)
data_2 = Data(imput_shop_hallway)

young_modulus_n_mm2 = Panel("211")
poisson_ratio = Panel("0.3")
specific_weight_kg_m3 = Panel("1452")
compressive_strenght_n_mm2 = Panel("3")
material_adobe = Panel("adobe sucrum test")

min_number_of_stacked_bricks = Slider(1, range=1..4)
# 11/23/2019
spring_stiffness = Slider(44, range=9..95)

data_3 = Data(spring_stiffness)

# ----
# Young Modulus research paper: https://dspace.cvut.cz/bitstream/handle/10467/69500/F1-BP-2017-Gubasheva-Samal-priloha-ADOBE%20AS%20A%20BUILDING%20MATERIAL.%20pdf.pdf?sequence=3&isAllowed=y
data_4 = Data(min_number_of_stacked_bricks)
maximal_shell_thickness_cm = Slider(200, range=0..200)
height_of_bricks_cm = Slider(9, range=0..10)
min_number_of_stacked_bricks_2 = Panel(data_4)
shell_cross_section_name = Panel("Shell Cross section")
distributed_vertical_load_kn_m2 = Panel("2.25")
name = Panel("shell")

data_5 = Data(young_modulus_n_mm2)
data_6 = Data(material_adobe)
data_7 = Data(name)
data_8 = Data(poisson_ratio)
data_9 = Data(specific_weight_kg_m3)
data_10 = Data(compressive_strenght_n_mm2)
ghpython_script = GhPythonScript(e_modulus=data_5, poission_ratio=data_8)  # -> shear_modulus; inputs e_modulus: Int32, poission_ratio: Int32
# ---------- ghpython_script: Python ----------
__author__ = "kees_"
__version__ = "2019.10.08"

import rhinoscriptsyntax as rs

# 4.	calculation of shear modulus according to [Landau LD, Lifshitz EM. Theory of Elasticity, vol. 7. Course of Theoretical Physics. (2nd Ed) Pergamon: Oxford 1970 p13]

a = int(poission_ratio)
b = int(e_modulus)

shear_modulus = b/(2*(1+a))
# ---------- end ghpython_script ----------
material_properties_karamba3d = MaterialPropertiesKaramba3D(
    FamilyOfMaterial=data_6,
    Name=data_6,
    ElementIdentifier=data_7,
    YoungsModulus_kN_cm2=expr("x*0.1", data_5),
    InPlaneShearModulus_kN_cm2=expr("x*0.1", ghpython_script),
    TransverseShearModulus_kN_cm2=expr("x*0.1", ghpython_script),
    SpecificWeight_kN_m3=expr("x*0.012", data_9),
    CoefficientOfThermalExpansion_1_C=1e-05,
    YieldStrength_kN_cm2=expr("x*0.1", data_10),
    mode="Isotrop")

# ----
# Topology generation
# Creating feature points at supports
ghpython_script_2 = GhPythonScript(shop_size=data)  # -> width_of_shop
# ---------- ghpython_script_2: Python ----------
__author__ = "kees_"
__version__ = "2019.10.09"

sizes = {'s':1.675, 'm':4.250, 'l':9.40}
width_of_shop = sizes.get(shop_size)
# ---------- end ghpython_script_2 ----------
ghpython_script_3 = GhPythonScript(width=data_2)  # -> width_of_shop
# ---------- ghpython_script_3: Python ----------
__author__ = "kees_"
__version__ = "2019.10.09"

sizes = {'hallway':2.4, 'shop':3.6}
width_of_shop = sizes.get(width)
# ---------- end ghpython_script_3 ----------
relay = Relay([ghpython_script_3, ghpython_script_2])
rectangle = Rectangle(Plane=PlaneXY(0, 0, 0), XSize=ghpython_script_2, YSize=ghpython_script_3, Radius=0)  # -> Rectangle, Length
box_corners = BoxCorners(Box=rectangle.Rectangle)  # -> CornerA, CornerB, CornerC, CornerD, CornerE, CornerF, CornerG, CornerH
explode = Explode(Curve=rectangle.Rectangle, Recursive=True)  # -> Segments, Vertices
data_11 = Data(rectangle.Rectangle)
data_12 = Data(ghpython_script_2)
area = Area(Geometry=rectangle.Rectangle)  # -> Area, Centroid
curve_middle = CurveMiddle(Curve=explode.Segments)  # -> graft(Midpoint)
merge = Merge(Data1=box_corners.CornerA, Data2=box_corners.CornerB, Data3=box_corners.CornerC, Data4=box_corners.CornerD)  # -> graft(Result)
point = Point(merge)
explode_tree = ExplodeTree(Data=curve_middle)  # -> Branch0, Branch1, Branch2, Branch3
line_count = Slider(15, range=0..20)
line = Line(StartPoint=explode_tree.Branch0, EndPoint=box_corners.CornerA)  # -> flatten(Line)
line_2 = Line(StartPoint=explode_tree.Branch3, EndPoint=box_corners.CornerA)  # -> flatten(Line)
line_3 = Line(StartPoint=box_corners.CornerA, EndPoint=area.Centroid)  # -> flatten(Line)
line_4 = Line(StartPoint=explode_tree.Branch0, EndPoint=box_corners.CornerB)  # -> flatten(Line)
line_5 = Line(StartPoint=explode_tree.Branch1, EndPoint=box_corners.CornerB)  # -> flatten(Line)
line_6 = Line(StartPoint=box_corners.CornerB, EndPoint=area.Centroid)  # -> flatten(Line)
line_7 = Line(StartPoint=explode_tree.Branch1, EndPoint=box_corners.CornerC)  # -> flatten(Line)
line_8 = Line(StartPoint=box_corners.CornerC, EndPoint=explode_tree.Branch2)  # -> flatten(Line)
line_9 = Line(StartPoint=box_corners.CornerC, EndPoint=area.Centroid)  # -> flatten(Line)
line_10 = Line(StartPoint=explode_tree.Branch2, EndPoint=box_corners.CornerD)  # -> flatten(Line)
line_11 = Line(StartPoint=box_corners.CornerD, EndPoint=explode_tree.Branch3)  # -> flatten(Line)
line_12 = Line(StartPoint=box_corners.CornerD, EndPoint=area.Centroid)  # -> flatten(Line)
divide_curve = DivideCurve(Curve=[line, line_2, line_3], Count=line_count, Kinks=False)  # -> Points, Tangents, Parameters
divide_curve_2 = DivideCurve(Curve=[line_4, line_5, line_6], Count=line_count, Kinks=False)  # -> Points, Tangents, Parameters
divide_curve_3 = DivideCurve(Curve=[line_7, line_8, line_9], Count=line_count, Kinks=False)  # -> Points, Tangents, Parameters
divide_curve_4 = DivideCurve(Curve=[line_10, line_11, line_12], Count=line_count, Kinks=False)  # -> Points, Tangents, Parameters
explode_tree_2 = ExplodeTree(Data=divide_curve.Points)  # -> Branch0, Branch1, Branch2
explode_tree_3 = ExplodeTree(Data=divide_curve_2.Points)  # -> Branch0, Branch1, Branch2
explode_tree_4 = ExplodeTree(Data=divide_curve_3.Points)  # -> Branch0, Branch1, Branch2
explode_tree_5 = ExplodeTree(Data=divide_curve_4.Points)  # -> Branch0, Branch1, Branch2
line_13 = Line(StartPoint=explode_tree_2.Branch0, EndPoint=reverse(explode_tree_2.Branch2))  # -> flatten(Line)
line_14 = Line(StartPoint=explode_tree_2.Branch1, EndPoint=reverse(explode_tree_2.Branch2))  # -> flatten(Line)
line_15 = Line(StartPoint=explode_tree_3.Branch0, EndPoint=reverse(explode_tree_3.Branch2))  # -> flatten(Line)
line_16 = Line(StartPoint=explode_tree_3.Branch1, EndPoint=reverse(explode_tree_3.Branch2))  # -> flatten(Line)
line_17 = Line(StartPoint=explode_tree_4.Branch0, EndPoint=reverse(explode_tree_4.Branch2))  # -> flatten(Line)
line_18 = Line(StartPoint=explode_tree_5.Branch0, EndPoint=reverse(explode_tree_5.Branch2))  # -> flatten(Line)
line_19 = Line(StartPoint=explode_tree_4.Branch1, EndPoint=explode_tree_4.Branch2)  # -> flatten(Line)
line_20 = Line(StartPoint=explode_tree_5.Branch1, EndPoint=explode_tree_5.Branch2)  # -> flatten(Line)
point_2 = Point(explode_tree_2.Branch1)
point_3 = Point(explode_tree_3.Branch0)
point_4 = Point(explode_tree_5.Branch0)
point_5 = Point(explode_tree_5.Branch1)
point_6 = Point(explode_tree_2.Branch0)
point_7 = Point(explode_tree_3.Branch1)
point_8 = Point(explode_tree_4.Branch1)
point_9 = Point(explode_tree_4.Branch0)
# 11/22/2019
line_21 = Line([line_20, line_18, line_13, line_14, line_15, line_16, line_17, line_19])

data_13 = Data(relay)

# ----
# reducing valency of support nodes
replace_members = ReplaceMembers(Set=data_13, Find=[9.4, 4.25, 2.4, 1.675], Replace=[6, 6, 5, 4])

sort_list = SortList(Keys=replace_members)  # -> Keys, ValuesValuesA
list_item = ListItem(List=sort_list.Keys, Index=0, Wrap=True)

line_22 = Line(StartPoint=curve_middle, EndPoint=area.Centroid)  # -> flatten(Line)
flip_matrix = FlipMatrix(Data=line_22)
explode_tree_6 = ExplodeTree(Data=flip_matrix)  # -> Branch0, Branch1, Branch2, Branch3
explode_tree_7 = ExplodeTree(Data=merge)  # -> Branch0, Branch1, Branch2, Branch3
divide_curve_5 = DivideCurve(Curve=explode_tree_6.Branch0, Count=list_item, Kinks=False)  # -> Points, Tangents, Parameters
divide_curve_6 = DivideCurve(Curve=explode_tree_6.Branch1, Count=list_item, Kinks=False)  # -> Points, Tangents, Parameters
divide_curve_7 = DivideCurve(Curve=explode_tree_6.Branch2, Count=list_item, Kinks=False)  # -> Points, Tangents, Parameters
divide_curve_8 = DivideCurve(Curve=explode_tree_6.Branch3, Count=list_item, Kinks=False)  # -> Points, Tangents, Parameters
merge_2 = Merge(Data1=divide_curve_5.Points, Data2=divide_curve_8.Points)  # -> flatten(Result)
merge_3 = Merge(Data1=divide_curve_5.Points, Data2=divide_curve_6.Points)  # -> flatten(Result)
merge_4 = Merge(Data1=divide_curve_7.Points, Data2=divide_curve_6.Points)  # -> flatten(Result)
merge_5 = Merge(Data1=divide_curve_7.Points, Data2=divide_curve_8.Points)  # -> flatten(Result)
line_23 = Line(StartPoint=explode_tree_7.Branch0, EndPoint=merge_2)
line_24 = Line(StartPoint=explode_tree_7.Branch1, EndPoint=merge_3)
line_25 = Line(StartPoint=explode_tree_7.Branch2, EndPoint=merge_4)
line_26 = Line(StartPoint=explode_tree_7.Branch3, EndPoint=merge_5)

connection_point_support = Relay([line_23, line_24, line_25, line_26])
connection_vault_x = Relay([point_6, point_3, point_8, point_4])
connection_vault_y = Relay([point_2, point_7, point_9, point_5])
point_10 = Point(point)
line_27 = Line(line_21)
point_11 = Point(connection_vault_x)
point_12 = Point(connection_vault_y)
line_28 = Line(connection_point_support)

data_14 = Data([line_28, line_27])
data_15 = Data(point_11)
data_16 = Data(point_12)
# Kangeroo form finding
data_17 = Data(point_10)

# ----
# Definition of support
# Definition of springs / mesh
# Definition of 1 way constrains
# Use if required by 2d topology
line_line_intersection_karamba3d = LineLineIntersectionKaramba3D(Line=flatten(data_14), LengthTolerance=0.01)  # -> IntersectionPoints, flatten(LineSubSegements)
remove_duplicate_lines_karamba3d = RemoveDuplicateLinesKaramba3D(Line=line_line_intersection_karamba3d.LineSubSegements, LimitDistance=0.005)  # -> OutLine, Info, Indexes
weaverbird_s_mesh_from_lines_weave_back = WeaverbirdsMeshFromLinesWeaveBack(Lines=remove_duplicate_lines_karamba3d.OutLine, MaximumValence=4)
edgelengths = EdgeLengths(Mesh=weaverbird_s_mesh_from_lines_weave_back, LengthFactor=1, Strength=expr("x/2", data_3))
anchorxyz = AnchorXYZ(Point=flatten(data_15), X=False, Y=True, Z=False, Strength=1000)
anchorxyz_2 = AnchorXYZ(Point=flatten(data_16), X=True, Y=False, Z=False, Strength=1000)
anchor = Anchor(Point=data_17, Strength=100000)
vertexloads = VertexLoads(Mesh=weaverbird_s_mesh_from_lines_weave_back, Strength=0.1)
zombiesolver = ZombieSolver(
    GoalObjects=flatten([anchor, anchorxyz, anchorxyz_2, edgelengths, vertexloads]),
    Threshold=1e-10,
    Tolerance=0.01,
    MaxIterations=50000)  # -> I, V, O
null_item = NullItem(Item=zombiesolver.O)  # -> NullFlags, InvalidFlags, Description
dispatch = Dispatch(List=zombiesolver.O, DispatchPattern=null_item.NullFlags)  # -> ListA, ListB
weaverbird_s_mesh_from_lines_weave_back_2 = WeaverbirdsMeshFromLinesWeaveBack(Lines=dispatch.ListB, MaximumValence=4)

# ----
# 11/22/2019
weaverbird_s_catmull_clark_subdivision = WeaverbirdsCatmullClarkSubdivision(MeshCurves=weaverbird_s_mesh_from_lines_weave_back_2, Level=1, SmoothNakedEdges=0)
mesh_edges = MeshEdges(Mesh=weaverbird_s_mesh_from_lines_weave_back_2)  # -> NakedEdges, InteriorEdges, NonManifoldEdges

point_13 = Point(data_17)
data_18 = Data(weaverbird_s_catmull_clark_subdivision)

# ----
# Definition of Forces
data_19 = Data(point_13)
data_20 = Data(data_18)

# ----
# Vertical loading
deconstruct_mesh = DeconstructMesh(Mesh=data_20)  # -> Vertices, Faces, Colours, Normals
remove_duplicate_points_karamba3d = RemoveDuplicatePointsKaramba3D(Point=deconstruct_mesh.Vertices, LimitDistance=0.005)  # -> OutPoint, Info, Indexes
# Roof loading
# (added soil)
evaluate_box = EvaluateBox(Box=data_20, UParameter=0.5, VParameter=0.5, WParameter=1)  # -> Plane, Point, Include
xy_plane = XYPlane(Origin=Point(0, 0, 0))
convex_hull = ConvexHull(Points=remove_duplicate_points_karamba3d.OutPoint, Plane=PlaneXY(0, 0, 0))  # -> Hull, HullZ, Indices
deconstruct = Deconstruct(Point=remove_duplicate_points_karamba3d.OutPoint)  # -> XComponent, YComponent, ZComponent
deconstruct_2 = Deconstruct(Point=evaluate_box.Point)  # -> XComponent, YComponent, ZComponent
voronoi = Voronoi(Points=remove_duplicate_points_karamba3d.OutPoint, Boundary=convex_hull.Hull, Plane=xy_plane, BruteForceOverride=False)
construct_point = ConstructPoint(XCoordinate=0, YCoordinate=0, ZCoordinate=deconstruct.ZComponent)
construct_point_2 = ConstructPoint(XCoordinate=0, YCoordinate=0, ZCoordinate=deconstruct_2.ZComponent)
area_2 = Area(Geometry=voronoi)  # -> Area, Centroid
replace_nulls = ReplaceNulls(Items=area_2.Area, Replacements=0)  # -> Items, Count
distance = Distance(PointA=construct_point, PointB=construct_point_2)  # -> expr("x/2", Distance)

number = Number(distance)
# 11/22/2019
point_14 = Point(data_19)
data_21 = Data(data_20)
number_2 = Number(replace_nulls.Items)
point_15 = Point(remove_duplicate_points_karamba3d.OutPoint)

# ----
# Calculation FEM using karamba
data_22 = Data(data_19)
data_23 = Data(point_15)
data_24 = Data(number)
data_25 = Data(number_2)
number_3 = Number(data_25)
point_16 = Point(data_23)
point_17 = Point(data_22)
number_4 = Number(data_24)

data_26 = Data(point_17)
supp = SupportKaramba(PosInd=data_26, PlaneOfReference=PlaneXY(0, 0, 0), menu=[buttons(on, on, on, off, off, off)])  # -> flatten(Support)

data_27 = Data(number_3)
data_28 = Data(distributed_vertical_load_kn_m2)
data_29 = Data(number_4)
data_30 = Data(specific_weight_kg_m3)
data_31 = Data(point_16)
multiplication = Multiplication(A=data_27, B=data_28)
multiplication_2 = Multiplication(A=data_27, B=data_29)
division = Division(A=data_30, B=100)
multiplication_3 = Multiplication(A=multiplication_2, B=division)
addition = Addition(A=multiplication, B=multiplication_3)
unit_z = UnitZ(Factor=addition)
Z = UnitZ(Factor=expr("x*1.5", -1))
loads_karamba3d = LoadsKaramba3D(ForceVector=expr("x/-1.5", unit_z), Local=False, PosInd=data_31, LCase=0, mode="Point")
# Assembly of model
# Optimalisation of shell thickness
loads_karamba3d_2 = LoadsKaramba3D(Vector=Z, LCase=0, mode="Gravity")

# ----
# Shape input
# Definition of Mesh and range of thickness
# Definition of formfinding parameters
# Definition of support points
# Definition of forces
data_32 = Data(data_20)

mesh = Mesh(data_32)

# ----
# Definition of Material properties
data_33 = Data(mesh)
data_34 = Data(name)
data_35 = Data(shell_cross_section_name)
data_36 = Data(min_number_of_stacked_bricks_2)
data_37 = Data(maximal_shell_thickness_cm)
data_38 = Data(height_of_bricks_cm)

multiplication_4 = Multiplication(A=data_36, B=data_38)
construct_domain = ConstructDomain(DomainStart=multiplication_4, DomainEnd=data_37)
range = Range(Domain=construct_domain, Steps=data_38)
expression = Expression(x=data_35, y=range, Expression="x&\" \"&y")

data_39 = Data(supp)
data_40 = Data(loads_karamba3d_2)
data_41 = Data(loads_karamba3d)
data_42 = Data(material_properties_karamba3d)

data_43 = Data(data_42)

cross_section_karamba3d = CrossSectionKaramba3D(
    FamilyNameOfCrossSection=data_35,
    NameOfCrossSection=flatten(expression),
    ElementIdentifier=data_34,
    Material=data_43,
    Height_cm=flatten(range),
    mode="Shell - Const")
meshtoshell = MeshToShellKaramba(Mesh=data_33, Identifier=data_34, CrossSection=cross_section_karamba3d, LimitDistance_m=0.005)  # -> Element, Points, Info

data_44 = Data(meshtoshell.Element)
assemble = AssembleModelKaramba(Elem=data_44, Support=flatten(data_39), Load=flatten([data_40, data_41]), LimitDistance_m=0.005)  # -> Model, Info, Mass_kg, CenterOfGravity

# ----
# Assembly of model
# Optimalisation of shell thickness
data_45 = Data(cross_section_karamba3d)
data_46 = Data(name)

# ----
# 11/23/2019
dome_dimension_m = Panel(data_11)
dome_width_m = Panel(data_12)
max_deflection_m = Panel("1/200")

data_47 = Data(max_deflection_m)
data_48 = Data(dome_width_m)

# ----
# Optimalisation
data_49 = Data(data_48)
data_50 = Data(data_47)

number_5 = Number(expr("x*1000", data_49))
number_6 = Number(data_50)
multiplication_5 = Multiplication(A=number_5, B=number_6)
number_7 = Number(compressive_strenght_n_mm2)
opossum = Opossum(fitness=addition_2, gene=[min_number_of_stacked_bricks, spring_stiffness])

# ----
# Optimalisation values
# UC checks of structure
# Surrogate model optimalisation solver, output: best solution
# Output: 3-axis pareto front
data_51 = Data(multiplication_5)

data_52 = Data(data_51)

optimize_cross_section_karamba3d = OptimizeCrossSectionKaramba3D(
    Model=assemble.Model,
    ElemIdentifiers=data_46,
    CrossSections=data_45,
    MaximumUtilization=1,
    MaximumDisplacement_cm=data_52,
    UltimateLimitStateIterations=5,
    DisplacementIterations=5,
    NumberOfSamplePoints=3,
    ElasticDesign=True,
    GammaM0=1,
    GammaM1=1)  # -> ModelWithOptimizedCrossSections, Info, Mass_kg, MaximumDisplacement_cm, ElasticEnergy_kNm

# ----
# 11/22/2019
# Karamba magic
analyze_karamba3d = AnalyzeKaramba3D(Model=optimize_cross_section_karamba3d.ModelWithOptimizedCrossSections)  # -> CalculatedModel, MaximumDisplacement_cm, ResultingForceOfGravity_kN, ElasticEnergy_kNm

data_53 = Data(analyze_karamba3d.CalculatedModel)

# ----
# Results generation FEM
data_54 = Data(data_53)

# ----
# Resulting displacement
# Results FEM
# Resulting principle stresses D1
# Resulting principle stresses D2
# Resulting von Mises yield criterion
# Resulting utilisation and cross section
model_view_karamba3d = ModelViewKaramba3D(Model=data_54, LoadCaseFactorsForLinearSuperposition=1, IndexOfVisibleLoadcase=-1)  # -> Model, DeformedMesh, DeformedAxes, DeformedModel
shellview = ShellViewKaramba(Model=model_view_karamba3d.Model, IndexOfLayer=0)  # -> Model, MeshesOfRenderedShells, LegendColors, LegendTags
shellview_2 = ShellViewKaramba(Model=model_view_karamba3d.Model, IndexOfLayer=0)  # -> Model, MeshesOfRenderedShells, LegendColors, LegendTags
shellview_3 = ShellViewKaramba(Model=model_view_karamba3d.Model, IndexOfLayer=0)  # -> Model, MeshesOfRenderedShells, LegendColors, LegendTags
reaction_forces_karamba3d = ReactionForcesKaramba3D(AnalyzedModel=model_view_karamba3d.Model, LoadCase=0)  # -> AnalyzedModel, ReactionForces_kN, ReactionMoments_kNm, SupportPosition, SumOfReactionForces_kN, SumOfReactionMoments_kNm
# Karamba magic
shellview_4 = ShellViewKaramba(Model=model_view_karamba3d.Model, IndexOfLayer=0)  # -> Model, MeshesOfRenderedShells, LegendColors, LegendTags
nodedisp = NodalDisplacementsKaramba(AnalyzedModel=model_view_karamba3d.Model, LoadCase=0)  # -> AnalyzedModel, NodalTranslations_m, NodalRotations_rad
last_index = LastIndex(List=shellview.LegendTags)
last_index_2 = LastIndex(List=shellview_2.LegendTags)
last_index_3 = LastIndex(List=shellview_3.LegendTags)
pdecon = Deconstruct(Point=nodedisp.NodalTranslations_m)  # -> XComponent, YComponent, expr("x*1000", ZComponent)
multiplication_6 = Multiplication(A=shellview.LegendTags, B=10)
multiplication_7 = Multiplication(A=shellview_2.LegendTags, B=10)
multiplication_8 = Multiplication(A=shellview_3.LegendTags, B=10)
cull_index = CullIndex(List=multiplication_6, Indices=flatten(last_index), Wrap=True)
cull_index_2 = CullIndex(List=multiplication_7, Indices=flatten(last_index_2), Wrap=True)
cull_index_3 = CullIndex(List=multiplication_8, Indices=flatten(last_index_3), Wrap=True)
absolute = Absolute(Value=pdecon.ZComponent)
shellview_5 = ShellViewKaramba(Model=shellview_4.Model, IndexOfLayer=0)  # -> Model, MeshesOfRenderedShells, LegendColors, LegendTags
split_list = SplitList(List=cull_index, Index=1)  # -> ListA, ListB
split_list_2 = SplitList(List=cull_index_2, Index=1)  # -> ListA, ListB
split_list_3 = SplitList(List=cull_index_3, Index=1)  # -> ListA, ListB
bounds = Bounds(Numbers=split_list.ListB)
bounds_2 = Bounds(Numbers=absolute)
bounds_3 = Bounds(Numbers=split_list_2.ListB)
bounds_4 = Bounds(Numbers=split_list_3.ListB)
shellview_6 = ShellViewKaramba(Model=shellview_5.Model, IndexOfLayer=0)  # -> Model, MeshesOfRenderedShells, LegendColors, LegendTags
deconstruct_domain = DeconstructDomain(Domain=bounds)  # -> Start, End
deconstruct_domain_2 = DeconstructDomain(Domain=bounds_2)  # -> Start, End
deconstruct_domain_3 = DeconstructDomain(Domain=bounds_3)  # -> Start, End
deconstruct_domain_4 = DeconstructDomain(Domain=bounds_4)  # -> Start, End

list_item_2 = ListItem(List=reaction_forces_karamba3d.ReactionForces_kN, Index=0, Wrap=True)
deconstruct_3 = Deconstruct(Point=list_item_2)  # -> XComponent, YComponent, ZComponent
mesh_2 = Mesh(shellview.MeshesOfRenderedShells)

data_55 = Data(flatten(deconstruct_3.XComponent))

data_56 = Data(flatten(deconstruct_3.YComponent))

data_57 = Data(flatten(deconstruct_domain.End))
data_58 = Data(flatten(deconstruct_domain_4.End))
data_59 = Data(flatten(shellview_6.LegendColors))
data_60 = Data(flatten(shellview_6.LegendTags))
data_61 = Data(flatten(shellview_5.LegendColors))
data_62 = Data(flatten(shellview_5.LegendTags))
data_63 = Data(flatten(shellview_4.LegendTags))
# Definition of shell
# Material properties from test
# Supports
# Loads
data_64 = Data(flatten(shellview_4.MeshesOfRenderedShells))
data_65 = Data(flatten(deconstruct_domain_2.End))
data_66 = Data(flatten(deconstruct_domain_3.Start))
data_67 = Data(flatten(deconstruct_domain_3.End))
data_68 = Data(flatten(deconstruct_domain.Start))
data_69 = Data(flatten(shellview_4.LegendColors))

data_70 = Data(flatten(deconstruct_3.ZComponent))

legend = Legend(Colour=data_59, Tags=data_60, LegendType=1)
legend_2 = Legend(Colour=data_61, Tags=data_62, LegendType=1)
legend_3 = Legend(Colour=data_69, Tags=data_63, LegendType=1)
z_vertical_resultant_force_kn = Panel(data_70)
x_horizontal_resultant_force_kn = Panel(data_55)
y_horizontal_resultant_force_kn = Panel(data_56)
max_compression_stress_p2_n_mm2 = Panel(data_68)
max_compression_stress_p1_n_mm2 = Panel(data_66)
max_tensile_stress_p1_n_mm2 = Panel(data_67)
max_tensile_stress_p2_n_mm2 = Panel(data_57)
max_displacement_mm = Panel(data_65)

data_71 = Data(max_displacement_mm)
data_72 = Data(max_tensile_stress_p1_n_mm2)
data_73 = Data(max_compression_stress_p1_n_mm2)
data_74 = Data(max_compression_stress_p2_n_mm2)
data_75 = Data(max_tensile_stress_p2_n_mm2)

data_76 = Data(data_73)
data_77 = Data(data_74)
data_78 = Data(data_71)
data_79 = Data(data_72)
data_80 = Data(data_75)

absolute_2 = Absolute(Value=[data_76, data_77])
absolute_3 = Absolute(Value=[data_79, data_80])
number_8 = Number(data_78)
sort_list_2 = SortList(Keys=absolute_2)  # -> Keys, ValuesValuesA
sort_list_3 = SortList(Keys=absolute_3)  # -> Keys, ValuesValuesA
list_item_3 = ListItem(List=sort_list_2.Keys, Index=1, Wrap=True)
list_item_4 = ListItem(List=sort_list_3.Keys, Index=1, Wrap=True)
number_9 = Number(list_item_4)
expression_2 = Expression(x=number_9, y=number_7, Expression="x>y/10")
expression_3 = Expression(x=list_item_3, y=number_7, Expression="x<-y")
expression_4 = Expression(x=multiplication_5, y=number_8, Expression="x<y")
merge_6 = Merge(Data1=expression_4, Data2=expression_3, Data3=expression_2)
mass_addition = MassAddition(Input=merge_6)  # -> Result, PartialResults
addition_2 = Addition(A=mass_addition.Result, B=list_item_4)

maximum_compression_n_mm2 = Number(list_item_3)
maximal_tension_n_mm2 = Number(number_9)
maximal_deflection_mm = Number(number_8)
octopus = Octopus(
    OctopusData_gene=[spring_stiffness, min_number_of_stacked_bricks],
    OctopusData_obj=[maximal_deflection_mm, maximum_compression_n_mm2, maximal_tension_n_mm2])
