# Grasshopper definition brick_packing.gh (Grasshopper 1.0.7)
# plug-ins: Pufferfish

# ----
# Rib definition
mesh = Mesh(<mesh referenced from the Rhino model>)

mesh_edges = MeshEdges(Mesh=mesh)  # -> NakedEdges, InteriorEdges, NonManifoldEdges
evaluate_box = EvaluateBox(Box=mesh, UParameter=0.5, VParameter=0.5, WParameter=0)  # -> Plane, Point, Include
box_corners = BoxCorners(Box=mesh)  # -> CornerA, CornerB, CornerC, CornerD, CornerE, CornerF, CornerG, CornerH
join_curves = JoinCurves(Curves=mesh_edges.NakedEdges, Preserve=False)
curve_plane = CurvePlane(Curve=join_curves, Plane=evaluate_box.Plane)  # -> flatten(Points), ParamsC, simplify(ParamsP)
position_of_outer_ribs = Slider(0.98, range=0..1)
average = Average(Input=curve_plane.Points)
scale = Scale(Geometry=curve_plane.Points, Center=average, Factor=position_of_outer_ribs)  # -> Geometry, Transform
explode_tree = ExplodeTree(Data=graft(scale.Geometry))  # -> Branch0, Branch1, Branch2, Branch3
merge = Merge(Data1=explode_tree.Branch0, Data2=explode_tree.Branch1)
merge_2 = Merge(Data1=explode_tree.Branch2, Data2=explode_tree.Branch3)
merge_3 = Merge(Data1=explode_tree.Branch0, Data2=explode_tree.Branch2)
unit_z = UnitZ(Factor=1)
vector_2pt = Vector2Pt(PointA=merge, PointB=merge_2, Unitize=False)  # -> Vector, Length
xz_plane = XZPlane(Origin=merge_3)  # -> flatten(Plane)
yz_plane = YZPlane(Origin=merge)  # -> flatten(Plane)
construct_plane = ConstructPlane(Origin=merge, XAxis=unit_z, YAxis=vector_2pt.Vector)  # -> flatten(Plane)
merge_4 = Merge(Data1=xz_plane, Data2=yz_plane, Data3=construct_plane)
mesh_plane = MeshPlane(Mesh=mesh, Plane=merge_4)  # -> flatten(Curves)
length = Length(Curve=mesh_plane)
larger_than = LargerThan(FirstNumber=length, SecondNumber=expr("1.5", 1.5))  # -> LargerThan, OrEqualTo
cull_pattern = CullPattern(List=mesh_plane, CullPattern=larger_than.LargerThan)  # -> flatten(List)
# 10/27/2019
split_list = SplitList(List=cull_pattern, Index=4)  # -> graft(ListA), graft(ListB)

merge_5 = Merge(
    Data1=evaluate_box.Point,
    Data2=box_corners.CornerA,
    Data3=box_corners.CornerB,
    Data4=box_corners.CornerC,
    Data5=box_corners.CornerD)
dispatch = Dispatch(List=cull_pattern, DispatchPattern=[True, False])  # -> ListA, ListB
length_2 = Length(Curve=dispatch.ListA)

outer_curves = Data(split_list.ListA)
data = Data(split_list.ListB)
data_2 = Data(length_2)
data_3 = Data(merge_5)

# ----
# Infill script
data_4 = Data(data_3)
data_5 = Data(data_2)

constructability_spacing_cm = Slider(2, range=0..10)
# Parameters outer rib
constructability_offset_cm = Slider(-23, range=-40..40)
brick_length_cm = Slider(34, range=0..100)
brick_height_cm = Slider(9, range=0..100)
brick_width_cm = Slider(15, range=0..100)

# ----
# Parameters diagonal rib
constructability_keystone_cm = Slider(32, range=0..100)
constructability_spacing_cm_2 = Slider(2, range=0..10)
brick_length_cm_2 = Slider(9, range=0..100)
brick_height_cm_2 = Slider(7, range=0..100)
brick_width_cm_2 = Slider(16, range=0..100)

# ----
# Parameters tilling
length_of_tile_m = Slider(0.1, range=0..1)
# Note: brick size is 2*x and 4*y
height_of_tile_m = Slider(0.05, range=0..0.1)
width_of_tile_m = Slider(0.04, range=0..0.1)

# ----
# Diagonal ribs
outer_curves_2 = Data(data)
two_way_domain = TwoWayDomain(Extent=expr("x/200", brick_height_cm_2), Direction=True)
two_way_domain_2 = TwoWayDomain(Extent=expr("x/200", brick_length_cm_2), Direction=True)
two_way_domain_3 = TwoWayDomain(Extent=expr("x/200", brick_width_cm_2), Direction=True)

explode = Explode(Curve=outer_curves_2, Recursive=True)  # -> Segments, Vertices
nurbs_curve = NurbsCurve(Vertices=explode.Vertices, Degree=3, Periodic=False)  # -> Curve, Length, Domain
rebuild_curve = RebuildCurve(Curve=nurbs_curve.Curve, Count=10, Tangents=False)
evaluate_curve = EvaluateCurve(Curve=flatten(rebuild_curve), Parameter=0.5)  # -> Point, Tangent, Angle
deconstruct = Deconstruct(Point=evaluate_curve.Tangent)  # -> XComponent, YComponent, ZComponent
list_item = ListItem(List=flatten(rebuild_curve), Index=0, Wrap=True)
list_item_2 = ListItem(List=flatten(rebuild_curve), Index=1, Wrap=True)

curve_curve = CurveCurve(CurveA=list_item, CurveB=list_item_2)  # -> Points, ParamsA, ParamsB
explode_tree_2 = ExplodeTree(Data=graft(deconstruct.XComponent))  # -> Branch0, Branch1
flip_curve = FlipCurve(Curve=list_item)  # -> Curve, Flag
equality_within_tolerance = EqualityWithinTolerance(FirstNumber=explode_tree_2.Branch0, SecondNumber=explode_tree_2.Branch1, Tolerance=0.01)
gate_not = GateNot(A=equality_within_tolerance)
merge_6 = Merge(Data1=flip_curve.Curve, Data2=list_item_2, Data3=list_item, Data4=list_item_2)  # -> flatten(Result)
merge_7 = Merge(Data1=equality_within_tolerance, Data2=equality_within_tolerance, Data3=gate_not, Data4=gate_not)
cull_pattern_2 = CullPattern(List=flatten(merge_6), CullPattern=merge_7)

addition = Addition(A=constructability_spacing_cm_2, B=brick_height_cm_2)
length_3 = Length(Curve=cull_pattern_2)
number = Number(expr("x/100", addition))
division = Division(A=length_3, B=number)
perp_frames = PerpFrames(Curve=cull_pattern_2, Count=flatten(division), Align=True)  # -> Frames, Parameters
point = Point(perp_frames.Frames)
distance = Distance(PointA=curve_curve.Points, PointB=point)
larger_than_2 = LargerThan(FirstNumber=distance, SecondNumber=expr("x/100", constructability_keystone_cm))  # -> LargerThan, OrEqualTo
dispatch_2 = Dispatch(List=perp_frames.Frames, DispatchPattern=larger_than_2.LargerThan)  # -> ListA, ListB

domain_box = DomainBox(Base=dispatch_2.ListA, X=two_way_domain_2, Y=two_way_domain_3, Z=two_way_domain)

list_length = ListLength(List=domain_box)
division_2 = Division(A=list_length, B=2)
addition_2 = Addition(A=division_2, B=-1)
explode_tree_3 = ExplodeTree(Data=domain_box)  # -> Branch0, Branch1
explode_tree_4 = ExplodeTree(Data=addition_2)  # -> Branch0, Branch1
number_2 = Number(expr("x+1", explode_tree_4.Branch0))
number_3 = Number(expr("x+1", explode_tree_4.Branch1))
list_item_3 = ListItem(List=explode_tree_3.Branch0, Index=explode_tree_4.Branch0, Wrap=True)
list_item_4 = ListItem(List=explode_tree_3.Branch0, Index=number_2, Wrap=True)
list_item_5 = ListItem(List=explode_tree_3.Branch1, Index=explode_tree_4.Branch1, Wrap=True)
list_item_6 = ListItem(List=explode_tree_3.Branch1, Index=number_3, Wrap=True)
box_corners_2 = BoxCorners(Box=simplify(list_item_3))  # -> CornerA, CornerB, CornerC, CornerD, CornerE, CornerF, CornerG, CornerH
box_corners_3 = BoxCorners(Box=simplify(list_item_4))  # -> CornerA, CornerB, CornerC, CornerD, CornerE, CornerF, CornerG, CornerH
box_corners_4 = BoxCorners(Box=simplify(list_item_5))  # -> CornerA, CornerB, CornerC, CornerD, CornerE, CornerF, CornerG, CornerH
box_corners_5 = BoxCorners(Box=simplify(list_item_6))  # -> CornerA, CornerB, CornerC, CornerD, CornerE, CornerF, CornerG, CornerH
point_2 = Point(flatten(box_corners_2.CornerE))
point_3 = Point(flatten(box_corners_2.CornerG))
point_4 = Point(flatten(box_corners_2.CornerH))
point_5 = Point(flatten(box_corners_3.CornerA))
point_6 = Point(flatten(box_corners_3.CornerB))
point_7 = Point(flatten(box_corners_3.CornerC))
point_8 = Point(flatten(box_corners_4.CornerH))
point_9 = Point(flatten(box_corners_5.CornerA))
point_10 = Point(flatten(box_corners_5.CornerB))
point_11 = Point(flatten(box_corners_2.CornerF))
point_12 = Point(flatten(box_corners_3.CornerD))
point_13 = Point(flatten(box_corners_4.CornerE))
point_14 = Point(flatten(box_corners_4.CornerF))
point_15 = Point(flatten(box_corners_4.CornerG))
point_16 = Point(flatten(box_corners_5.CornerC))
point_17 = Point(flatten(box_corners_5.CornerD))
merge_8 = Merge(
    Data1=point_2,
    Data2=point_11,
    Data3=point_3,
    Data4=point_4,
    Data5=point_5,
    Data6=point_6,
    Data7=point_7,
    Data8=point_12,
    Data9=point_13,
    Data10=point_14,
    Data11=point_15,
    Data12=point_8,
    Data13=point_9,
    Data14=point_10,
    Data15=point_16,
    Data16=point_17)  # -> flatten(Result)
dispatch_3 = Dispatch(List=merge_8, DispatchPattern=[True, False, False, True])  # -> ListA, ListB
explode_tree_5 = ExplodeTree(Data=graft(dispatch_3.ListA))  # -> Branch0, Branch1, Branch2, Branch3, Branch4, Branch5, Branch6, Branch7
explode_tree_6 = ExplodeTree(Data=graft(dispatch_3.ListB))  # -> Branch0, Branch1, Branch2, Branch3, Branch4, Branch5, Branch6, Branch7
weave = Weave(
    Pattern=[0, 1, 4, 5, 3, 2, 7, 6],
    Stream0=explode_tree_5.Branch0,
    Stream1=explode_tree_5.Branch1,
    Stream2=explode_tree_5.Branch2,
    Stream3=explode_tree_5.Branch3,
    Stream4=explode_tree_5.Branch4,
    Stream5=explode_tree_5.Branch5,
    Stream6=explode_tree_5.Branch6,
    Stream7=explode_tree_5.Branch7,
    NullGaps=False)
weave_2 = Weave(
    Pattern=[0, 1, 4, 5, 3, 2, 7, 6],
    Stream0=explode_tree_6.Branch0,
    Stream1=explode_tree_6.Branch1,
    Stream2=explode_tree_6.Branch2,
    Stream3=explode_tree_6.Branch3,
    Stream4=explode_tree_6.Branch4,
    Stream5=explode_tree_6.Branch5,
    Stream6=explode_tree_6.Branch6,
    Stream7=explode_tree_6.Branch7,
    NullGaps=False)

average_2 = Average(Input=weave_2)
average_3 = Average(Input=weave)
polyline = PolyLine(Vertices=weave_2, Closed=True)
polyline_2 = PolyLine(Vertices=weave, Closed=True)
xy_plane = XYPlane(Origin=average_2)
xy_plane_2 = XYPlane(Origin=average_3)
project = Project(Geometry=polyline, Plane=xy_plane)  # -> Geometry, Transform
project_2 = Project(Geometry=polyline_2, Plane=xy_plane_2)  # -> Geometry, Transform
loft = Loft(
    Curves=[project.Geometry, project_2.Geometry],
    Options={Adjust=False, Closed=False, LoftEnds=0, LoftSimp=0, LoftType=0, Rebuild=10, Refit=0.01})
cap_holes = CapHoles(Brep=loft)

data_6 = Data(cap_holes)

# ----
# 10/27/2019
data_7 = Data(domain_box)

# ----
# Outer ribs
# Definition of normal planes
outer_curves_3 = Data(outer_curves)
two_way_domain_4 = TwoWayDomain(Extent=expr("x/200", brick_height_cm), Direction=True)
two_way_domain_5 = TwoWayDomain(Extent=expr("x/200", brick_length_cm), Direction=True)
two_way_domain_6 = TwoWayDomain(Extent=expr("x/200", brick_width_cm), Direction=True)

vectors = Panel("""{0,1,0}
{0,-1,0}
{-1,0,0}
{1,0,0}""")
amplitude = Amplitude(Vector=vectors, Amplitude=expr("x/100", constructability_offset_cm))  # -> graft(Vector)
length_4 = Length(Curve=outer_curves_3)
addition_3 = Addition(A=constructability_spacing_cm, B=brick_height_cm)
number_4 = Number(expr("x/100", addition_3))
move = Move(Geometry=outer_curves_3, Motion=amplitude)  # -> Geometry, Transform
division_3 = Division(A=length_4, B=number_4)
perp_frames_2 = PerpFrames(Curve=move.Geometry, Count=division_3, Align=True)  # -> Frames, Parameters

# ----
# 10/27/2019
domain_box_2 = DomainBox(Base=perp_frames_2.Frames, X=two_way_domain_5, Y=two_way_domain_6, Z=two_way_domain_4)
cull_index = CullIndex(List=domain_box_2, Indices=[-1, 0], Wrap=True)
data_8 = Data(cull_index)

explode_tree_7 = ExplodeTree(Data=graft(data_4))  # -> Branch0, Branch1, Branch2, Branch3, Branch4
explode_tree_8 = ExplodeTree(Data=graft(data_5))  # -> Branch0, Branch1, Branch2
point_18 = Point(explode_tree_7.Branch1)
point_19 = Point(explode_tree_7.Branch4)
point_20 = Point(explode_tree_7.Branch0)
point_21 = Point(explode_tree_7.Branch3)
number_5 = Number(explode_tree_8.Branch2)
point_22 = Point(explode_tree_7.Branch2)
number_6 = Number(explode_tree_8.Branch1)
number_7 = Number(explode_tree_8.Branch0)
data_9 = Data(width_of_tile_m)
data_10 = Data(height_of_tile_m)
data_11 = Data(length_of_tile_m)
xz_plane_2 = XZPlane(Origin=point_20)
yz_plane_2 = YZPlane(Origin=point_20)

catenary = Catenary(PointA=point_18, PointB=point_21, Length=number_5, Gravity=expr("x*-1", Vector(0, 0, -1)))
catenary_2 = Catenary(PointA=point_22, PointB=point_19, Length=number_5, Gravity=expr("x*-1", Vector(0, 0, -1)))
catenary_3 = Catenary(PointA=point_19, PointB=point_18, Length=number_6, Gravity=expr("x*-1", Vector(0, 0, -1)))
catenary_4 = Catenary(PointA=point_19, PointB=point_21, Length=number_7, Gravity=expr("x*-1", Vector(0, 0, -1)))
number_8 = Number(number_6)
number_9 = Number(number_7)
curve = Curve(catenary_3)
curve_2 = Curve(catenary_4)
divide_curve = DivideCurve(Curve=catenary, Count=2, Kinks=False)  # -> Points, Tangents, Parameters
divide_curve_2 = DivideCurve(Curve=catenary, Count=2, Kinks=False)  # -> Points, Tangents, Parameters
shatter = Shatter(Curve=catenary, Parameters=divide_curve.Parameters)
shatter_2 = Shatter(Curve=catenary_2, Parameters=divide_curve_2.Parameters)
dispatch_4 = Dispatch(List=shatter, DispatchPattern=[True, False])  # -> ListA, ListB
dispatch_5 = Dispatch(List=shatter_2, DispatchPattern=[True, False])  # -> ListA, ListB
data_12 = Data(data_11)
data_13 = Data(data_11)
division_4 = Division(A=number_8, B=data_12)
division_5 = Division(A=number_9, B=data_13)
join_curves_2 = JoinCurves(Curves=flatten([dispatch_4.ListA, dispatch_5.ListA]), Preserve=False)
join_curves_3 = JoinCurves(Curves=flatten([dispatch_4.ListB, dispatch_5.ListA]), Preserve=False)
divide_curve_3 = DivideCurve(Curve=curve, Count=division_4, Kinks=False)  # -> Points, Tangents, Parameters
divide_curve_4 = DivideCurve(Curve=curve_2, Count=division_5, Kinks=False)  # -> Points, Tangents, Parameters
ruled_surface = RuledSurface(CurveA=join_curves_2, CurveB=catenary_3)
ruled_surface_2 = RuledSurface(CurveA=join_curves_3, CurveB=catenary_4)
xz_plane_3 = XZPlane(Origin=divide_curve_3.Points)
yz_plane_3 = YZPlane(Origin=divide_curve_4.Points)

sec = BrepPlane(Brep=ruled_surface, Plane=xz_plane_3)  # -> simplify(flatten(Curves)), Points
sec_2 = BrepPlane(Brep=ruled_surface_2, Plane=yz_plane_3)  # -> simplify(flatten(Curves)), Points
data_14 = Data(data_9)
data_15 = Data(data_9)
length_5 = Length(Curve=sec.Curves)
length_6 = Length(Curve=sec_2.Curves)
division_6 = Division(A=length_5, B=data_14)
division_7 = Division(A=length_6, B=data_15)
divide_curve_5 = DivideCurve(Curve=sec.Curves, Count=division_6, Kinks=False)  # -> Points, Tangents, Parameters
divide_curve_6 = DivideCurve(Curve=sec_2.Curves, Count=division_7, Kinks=False)  # -> Points, Tangents, Parameters
polyline_3 = PolyLine(Vertices=divide_curve_5.Points, Closed=False)
polyline_4 = PolyLine(Vertices=divide_curve_6.Points, Closed=False)
explode_2 = Explode(Curve=polyline_3, Recursive=True)  # -> simplify(Segments), Vertices
explode_3 = Explode(Curve=polyline_4, Recursive=True)  # -> simplify(Segments), Vertices
end_points = EndPoints(Curve=explode_2.Segments)  # -> Start, End
end_points_2 = EndPoints(Curve=explode_3.Segments)  # -> Start, End
flip_matrix = FlipMatrix(Data=end_points.Start)
flip_matrix_2 = FlipMatrix(Data=end_points_2.Start)
split_list_2 = SplitList(List=end_points.Start, Index=1)  # -> ListA, ListB
split_list_3 = SplitList(List=end_points_2.Start, Index=1)  # -> ListA, ListB
shift_list = ShiftList(List=flip_matrix, Shift=1, Wrap=True)
shift_list_2 = ShiftList(List=flip_matrix_2, Shift=1, Wrap=True)
flip_matrix_3 = FlipMatrix(Data=split_list_2.ListB)
flip_matrix_4 = FlipMatrix(Data=split_list_3.ListB)
rectangle_3pt = Rectangle3Pt(PointA=flip_matrix, PointB=flip_matrix_3, PointC=shift_list)  # -> flatten(Rectangle), Length
rectangle_3pt_2 = Rectangle3Pt(PointA=flip_matrix_2, PointB=flip_matrix_4, PointC=shift_list_2)  # -> flatten(Rectangle), Length
plane_3pt = Plane3Pt(PointA=flip_matrix_3, PointB=flip_matrix, PointC=shift_list)
plane_3pt_2 = Plane3Pt(PointA=flip_matrix_4, PointB=flip_matrix_2, PointC=shift_list_2)
data_16 = Data(data_10)
data_17 = Data(data_10)

amplitude_2 = Amplitude(Vector=flatten(plane_3pt), Amplitude=data_16)
amplitude_3 = Amplitude(Vector=flatten(plane_3pt_2), Amplitude=data_17)
extrude = Extrude(Base=rectangle_3pt.Rectangle, Direction=expr("x*-1", amplitude_2))
extrude_2 = Extrude(Base=rectangle_3pt_2.Rectangle, Direction=expr("x*-1", amplitude_3))
cap_holes_2 = CapHoles(Brep=extrude)
cap_holes_3 = CapHoles(Brep=extrude_2)

mirror = Mirror(Geometry=cap_holes_3, Plane=xz_plane_2)  # -> Geometry, Transform
# 10/27/2019
mirror_2 = Mirror(Geometry=cap_holes_2, Plane=yz_plane_2)  # -> Geometry, Transform

bricks_outer_ribs = Relay([mirror_2.Geometry, cap_holes_2])
data_18 = Data(bricks_outer_ribs)

bricks_outer_ribs_2 = Relay([cap_holes_3, mirror.Geometry])
data_19 = Data(bricks_outer_ribs_2)

# ----
# Magic combinateuur
outer_curves_4 = Data(data_8)
outer_curves_5 = Data(data_7)
outer_curves_6 = Data(data_6)
outer_curves_7 = Data(data_18)
outer_curves_8 = Data(data_19)
merge_9 = Merge(Data1=outer_curves_5, Data2=outer_curves_6, Data3=outer_curves_4, Data4=outer_curves_7, Data5=outer_curves_8)
# copyright by dovensmitsch duistere plan producties
data_20 = Data(merge_9)
