# Grasshopper definition Construction process.gh (Grasshopper 1.0.7)
# plug-ins: Karamba

# ---- group: Common Variables
Z = UnitZ(Factor="-1.2")
cross_section = CrossSectionKaramba3D(FamilyNameOfCrossSection="DefaultCroSec", Height_cm=Slider(15, range=0..60), mode="Shell - Const")
loads = LoadsKaramba3D(Vector=Z, LCase=0, mode="Gravity")
matprops = MaterialPropertiesKaramba3D(
    FamilyOfMaterial="Steel",
    Name="S235",
    YoungsModulus_kN_cm2="15",
    InPlaneShearModulus_kN_cm2="6",
    TransverseShearModulus_kN_cm2=8076,
    SpecificWeight_kN_m3="15",
    CoefficientOfThermalExpansion_1_C=1e-05,
    YieldStrength_kN_cm2="0.05",
    mode="Isotrop")

# ---- group: Mesh resolution
number_slider = Slider(1, range=0..1)
number_slider_2 = Slider(0.67, range=0..1)

# ---- group: Top surface
step_2_3_srf = Surface([<surface referenced from the Rhino model> x4])
step_2_1_srf = Surface([<surface referenced from the Rhino model> x4])
step_2_2_srf = Surface([<surface referenced from the Rhino model> x4])
step_2_4_srf = Surface([<surface referenced from the Rhino model> x20])
new_srf = Surface([<surface referenced from the Rhino model> x4])
step_2_srf = Surface()
step_4_srf = Surface([<surface referenced from the Rhino model> x4])
step_5_srf = Surface([<surface referenced from the Rhino model> x4])
step_8_srf = Surface([<surface referenced from the Rhino model> x6])
step_1_srf = Surface()
step_3_srf = Surface([<surface referenced from the Rhino model> x4])
step_6_srf = Surface([<surface referenced from the Rhino model> x2])
step_7_srf = Surface([<surface referenced from the Rhino model> x2])

# ---- group: Bottom surface
step_2_3_srf_2 = Surface([<surface referenced from the Rhino model> x20])
step_2_1_srf_2 = Surface([<surface referenced from the Rhino model> x20])
step_2_4_srf_2 = Surface([<surface referenced from the Rhino model> x28])
new_srf_2 = Surface([<surface referenced from the Rhino model> x16])
step_2_2_srf_2 = Surface([<surface referenced from the Rhino model> x20])
step_4_srf_2 = Surface([<surface referenced from the Rhino model> x20])
step_8_srf_2 = Surface([<surface referenced from the Rhino model> x18])
step_5_srf_2 = Surface([<surface referenced from the Rhino model> x20])
step_1_srf_2 = Surface([<surface referenced from the Rhino model> x12])
step_2_srf_2 = Surface([<surface referenced from the Rhino model> x20])
step_6_srf_2 = Surface([<surface referenced from the Rhino model> x18])
step_7_srf_2 = Surface([<surface referenced from the Rhino model> x18])
step_3_srf_2 = Surface([<surface referenced from the Rhino model> x20])

# ---- group: Top surface
join = BrepJoin(Breps=new_srf)  # -> Breps, Closed
cross_section_2 = CrossSectionKaramba3D(FamilyNameOfCrossSection="DefaultCroSec", Height_cm=Slider(15, range=0..60), mode="Shell - Const")
mesh_breps = MeshBrepsKaramba3D(
    Brep=join.Breps,
    MeshResolution=number_slider_2,
    EdgeRefinementFactor=number_slider,
    PointReduction=False,
    SmoothingStepSize=0,
    SmoothingIterations=5)  # -> Mesh, Info
meshtoshell = MeshToShellKaramba3D(Mesh=mesh_breps.Mesh, CrossSection=cross_section_2, LimitDistance_m=0.005)  # -> Element, Points, Info

# ---- group: Bottom surface
join_2 = BrepJoin(Breps=new_srf_2)  # -> Breps, Closed
cross_section_3 = CrossSectionKaramba3D(FamilyNameOfCrossSection="DefaultCroSec", Height_cm=Slider(30, range=0..60), mode="Shell - Const")
mesh_breps_2 = MeshBrepsKaramba3D(
    Brep=join_2.Breps,
    MeshResolution=number_slider_2,
    EdgeRefinementFactor=number_slider,
    PointReduction=False,
    SmoothingStepSize=0,
    SmoothingIterations=5)  # -> Mesh, Info
meshtoshell_2 = MeshToShellKaramba3D(Mesh=mesh_breps_2.Mesh, CrossSection=cross_section_3, LimitDistance_m=0.005)  # -> Element, Points, Info

# ---- group: Find support
pdecon = Deconstruct(Point=meshtoshell_2.Points)  # -> XComponent, YComponent, ZComponent
eval = Evaluate(F="Round(x,3)", x=pdecon.ZComponent)
sort = SortList(Keys=eval)  # -> Keys, ValuesA
item = ListItem(List=sort.Keys, Index=0, Wrap=True)
similar = Similarity(FirstNumber=eval, SecondNumber=item, Threshold=0.1)  # -> Similarity, AbsoluteDifference
dispatch = Dispatch(List=flatten(meshtoshell_2.Points), DispatchPattern=similar.Similarity)  # -> ListA, ListB
supp = SupportKaramba3D(PosInd=dispatch.ListA, menu=[buttons(on, on, on, on, on, on)])

# ----
assemble = AssembleModelKaramba3D(Elem=[meshtoshell_2.Element, meshtoshell.Element], Support=supp, Load=loads, Material=matprops, LimitDistance_m=0.005)  # -> Model, Info, Mass_kg, CenterOfGravity
analyze = AnalyzeKaramba3D(Model=assemble.Model)  # -> CalculatedModel, MaximumDisplacement_cm, ResultingForceOfGravity_kN, ElasticEnergy_kNm
modelview = ModelViewKaramba3D(Model=analyze.CalculatedModel, LoadCaseFactorsForLinearSuperposition=1, IndexOfVisibleLoadcase=-1)  # -> Model, DeformedMesh, DeformedAxes, DeformedModel
shellview = ShellViewKaramba3D(Model=modelview.Model, IndexOfLayer=0)  # -> Model, MeshesOfRenderedShells, LegendColors, LegendTags
for_others = Legend(Colour=shellview.LegendColors, Tags=shellview.LegendTags, LegendType=101)

# ---- group: reaction directions
react = ReactionForcesKaramba3D(AnalyzedModel=analyze.CalculatedModel, LoadCase=0)  # -> AnalyzedModel, ReactionForces_kN, ReactionMoments_kNm, SupportPosition, SumOfReactionForces_kN, SumOfReactionMoments_kNm
neg = Negative(Value=react.ReactionForces_kN)
vdis = VectorDisplay(Anchor=react.SupportPosition, Vector=neg)

# ---- group: Stress directions
shellvecresults = ResultVectorsOnShellsKaramba3D(AnalyzedModel=modelview.Model, LayerPosition=0, mode="PrincStress")  # -> AnalyzedModel, Points, FirstPrincipalStressVector_kN_cm2, SecondPrincipalStressVector_kN_cm2, FirstPrincipalStressValue_kN_cm2, SecondPrincipalStressValue_kN_cm2
vdis_2 = VectorDisplay(Anchor=shellvecresults.Points, Vector=shellvecresults.FirstPrincipalStressVector_kN_cm2)

# ----
unit_convert = UnitConvert(L=shellview.LegendTags)

# ---- group: For stresses
for_stresses = Legend(Colour=shellview.LegendColors, Tags=unit_convert, LegendType=101)

# ==== cluster UnitConvert
L = ClusterInput()

cull_i = CullIndex(List=L, Indices="0", Wrap=True)

lng = ListLength(List=cull_i)
subtraction = Subtraction(A=lng, B="1")
index = ItemIndex(List=cull_i, Item=subtraction)
cull_i_2 = CullIndex(List=cull_i, Indices=index, Wrap=True)

multiplication = Multiplication(A=cull_i_2, B="10")
ins = InsertItems(List=multiplication, Item="Stress[N/mm2]", Indices="0", Wrap=True)

L_2 = ClusterOutput(ins)
