# Grasshopper definition Entrance design.gh (Grasshopper 1.0.7)
# plug-ins: Karamba

# ---- group: Common Variables
Z = UnitZ(Factor="-1.2")
loads = LoadsKaramba3D(Vector=Z, LCase=0, mode="Gravity")
matprops = MaterialPropertiesKaramba3D(
    FamilyOfMaterial="Steel",
    Name="S235",
    YoungsModulus_kN_cm2="15",
    InPlaneShearModulus_kN_cm2="6",
    TransverseShearModulus_kN_cm2=8076,
    SpecificWeight_kN_m3="15",
    CoefficientOfThermalExpansion_1_C=1e-05,
    YieldStrength_kN_cm2="0.05",
    mode="Isotrop")

# ---- group: Basic inputs
number_slider = Slider(1, range=0..1)
number_slider_2 = Slider(0.1, range=0..1)
crv = Curve([<curve referenced from the Rhino model> x2])
pt = Point([<point referenced from the Rhino model> x36])
crv_2 = Curve(<curve referenced from the Rhino model>)
crv_3 = Curve(<curve referenced from the Rhino model>)

# ----
end = EndPoints(Curve=crv_3)  # -> Start, End
end_2 = EndPoints(Curve=crv_2)  # -> Start, End

# ---- group: Get the surface
Y = UnitY(Factor=Slider(5, range=0..10))
extr = Extrude(Base=crv, Direction=Y)  # -> flatten(Extrusion)
loft = Loft(Curves=[crv_2, crv_3], Options={Adjust=False, Closed=False, LoftEnds=0, LoftSimp=0, LoftType=2, Rebuild=10, Refit=0.01})
cap = CapHoles(Brep=extr)
splitmul = SplitBrepMultiple(Brep=loft, Cutters=cap)
item = ListItem(List=splitmul, Index=0, Wrap=True)

# ---- group: Arch lines
dist = Distance(PointA=end_2.Start, PointB=end.Start)
division = Division(A=dist, B="3")
X = UnitX(Factor=1)
contour = Contour(Shape=item, Point=end.Start, Direction=X, Distance=division)  # -> flatten(Contours)

# ---- group: Arches with depths
item_2 = ListItem(List=contour, Index=0, Wrap=True)  # -> Item, Item1, Item2, Item3
arch_depth = Slider(0.9, range=0..2)
arch_depth_2 = Slider(0.45, range=0..1)
arch_depth_3 = Slider(0.6, range=0..1)
arch_depth_4 = Slider(0.3, range=0..1)
neg = Negative(Value=arch_depth_3)
neg_2 = Negative(Value=arch_depth_4)
neg_3 = Negative(Value=arch_depth_2)
neg_4 = Negative(Value=arch_depth)
offset = OffsetCurve(Curve=item_2.Item, Distance=neg_2, Plane=PlaneXY(0, 0, 0), Corners=0)
offset_2 = OffsetCurve(Curve=item_2.Item1, Distance=arch_depth_2, Plane=PlaneXY(0, 0, 0), Corners=0)
offset_3 = OffsetCurve(Curve=item_2.Item2, Distance=arch_depth_3, Plane=PlaneXY(0, 0, 0), Corners=0)
offset_4 = OffsetCurve(Curve=item_2.Item3, Distance=neg_4, Plane=PlaneXY(0, 0, 0), Corners=0)
end_3 = EndPoints(Curve=item_2.Item)  # -> Start, End
end_4 = EndPoints(Curve=offset)  # -> Start, End
end_5 = EndPoints(Curve=item_2.Item1)  # -> Start, End
end_6 = EndPoints(Curve=offset_2)  # -> Start, End
end_7 = EndPoints(Curve=item_2.Item2)  # -> Start, End
end_8 = EndPoints(Curve=offset_3)  # -> Start, End
end_9 = EndPoints(Curve=item_2.Item3)  # -> Start, End
end_10 = EndPoints(Curve=offset_4)  # -> Start, End
ln = Line(StartPoint=end_4.Start, EndPoint=end_3.Start)
ln_2 = Line(StartPoint=end_4.End, EndPoint=end_3.End)
ln_3 = Line(StartPoint=end_6.Start, EndPoint=end_5.Start)
ln_4 = Line(StartPoint=end_6.End, EndPoint=end_5.End)
ln_5 = Line(StartPoint=end_8.Start, EndPoint=end_7.Start)
ln_6 = Line(StartPoint=end_8.End, EndPoint=end_7.End)
ln_7 = Line(StartPoint=end_10.Start, EndPoint=end_9.Start)
ln_8 = Line(StartPoint=end_10.End, EndPoint=end_9.End)
boundary = BoundarySurfaces(Edges=flatten([item_2.Item1, offset_2, ln_3, ln_4]))
boundary_2 = BoundarySurfaces(Edges=flatten([item_2.Item, offset, ln, ln_2]))
boundary_3 = BoundarySurfaces(Edges=flatten([item_2.Item2, offset_3, ln_5, ln_6]))
boundary_4 = BoundarySurfaces(Edges=flatten([item_2.Item3, offset_4, ln_7, ln_8]))

# ---- group: Divide surfaces asper thicknesses
srfgrid = SurfaceFromPoints(Points=[end_2.Start, end_2.End, end.Start, end.End], UCount=2, Interpolate=False)
area = Area(Geometry=srfgrid)  # -> Area, Centroid
scale = Scale(Geometry=srfgrid, Center=area.Centroid, Factor=Slider(2, range=0..10))  # -> Geometry, Transform
Z_2 = UnitZ(Factor="2.1")
brep = Brep([boundary_2, boundary, boundary_3, boundary_4])
splitmul_2 = SplitBrepMultiple(Brep=item, Cutters=brep)
move = Move(Geometry=scale.Geometry, Motion=Z_2)  # -> Geometry, Transform
splitmul_3 = SplitBrepMultiple(Brep=splitmul_2, Cutters=move.Geometry)
panel = Panel("""0
1
2
3""")
panel_2 = Panel("""0
1""")
item_3 = TreeItem(Tree=simplify(splitmul_3), Path=panel, Index=graft(panel_2), Wrap=True)  # -> flatten(Element)
item_4 = TreeItem(Tree=simplify(splitmul_3), Path=panel, Index=graft("2"), Wrap=True)

# ---- group: Convert to meshes and saperate
brep_2 = Brep([boundary_4, boundary_3, boundary])
mesh_breps = MeshBrepsKaramba3D(
    Brep=item_4,
    MeshResolution=number_slider_2,
    EdgeRefinementFactor=number_slider,
    PointReduction=False,
    SmoothingStepSize=0,
    SmoothingIterations=5)  # -> Mesh, Info
mesh_breps_2 = MeshBrepsKaramba3D(
    Brep=[item_3, brep_2],
    MeshResolution=number_slider_2,
    EdgeRefinementFactor=number_slider,
    PointReduction=False,
    SmoothingStepSize=0,
    SmoothingIterations=5)  # -> Mesh, Info
lng = ListLength(List=brep_2)
lng_2 = ListLength(List=mesh_breps_2.Mesh)
subtraction = Subtraction(A=lng_2, B=lng)
split = SplitList(List=mesh_breps_2.Mesh, Index=subtraction)  # -> ListA, ListB
panel_3 = Panel("""6
7
8
9
16
17
18
19""")
item_5 = ListItem(List=split.ListA, Index=panel_3, Wrap=True)
cull_i = CullIndex(List=split.ListA, Indices=panel_3, Wrap=True)

# ---- group: Base side walls
cross_section = CrossSectionKaramba3D(FamilyNameOfCrossSection="DefaultCroSec", Height_cm=Slider(30, range=0..60), mode="Shell - Const")
mjoin = MeshJoin(Meshes=flatten(cull_i))
meshtoshell = MeshToShellKaramba3D(Mesh=mjoin, CrossSection=cross_section, LimitDistance_m=0.005)  # -> Element, Points, Info

# ---- group: Cantilever part side walls
cross_section_2 = CrossSectionKaramba3D(FamilyNameOfCrossSection="DefaultCroSec", Height_cm=Slider(60, range=0..60), mode="Shell - Const")
mjoin_2 = MeshJoin(Meshes=flatten(item_5))
meshtoshell_2 = MeshToShellKaramba3D(Mesh=mjoin_2, CrossSection=cross_section_2, LimitDistance_m=0.005)  # -> Element, Points, Info

# ---- group: Arches
cross_section_3 = CrossSectionKaramba3D(FamilyNameOfCrossSection="DefaultCroSec", Height_cm=Slider(30, range=0..60), mode="Shell - Const")
mjoin_3 = MeshJoin(Meshes=flatten(split.ListB))
meshtoshell_3 = MeshToShellKaramba3D(Mesh=mjoin_3, CrossSection=cross_section_3, LimitDistance_m=0.005)  # -> Element, Points, Info

# ---- group: Find supports
pt_2 = Point([meshtoshell_3.Points, meshtoshell.Points, meshtoshell_2.Points])
pdecon = Deconstruct(Point=flatten(pt_2))  # -> XComponent, YComponent, ZComponent
eval = Evaluate(F="Round(x,3)", x=pdecon.ZComponent)
sort = SortList(Keys=eval)  # -> Keys, ValuesA
item_6 = ListItem(List=sort.Keys, Index=0, Wrap=True)
similar = Similarity(FirstNumber=eval, SecondNumber=item_6, Threshold=1)  # -> Similarity, AbsoluteDifference
dispatch = Dispatch(List=flatten(pt_2), DispatchPattern=similar.Similarity)  # -> ListA, ListB
cullpt = CullDuplicates(Points=dispatch.ListA, Tolerance=0.01, CullMode=3)  # -> Points, Indices, Valence
supp = SupportKaramba3D(PosInd=cullpt.Points, menu=[buttons(on, on, on, on, on, on)])

# ---- group: Make punctures in shell
Z_3 = UnitZ(Factor=1)
number_slider_3 = Slider(0.1, range=0..1)
project = ProjectPoint(Point=pt, Direction=Z_3, Geometry=item_4)  # -> Point, Index
xy = XYPlane(Origin=Point(0, 0, 0))
Z_4 = UnitZ(Factor=1)
rectangle = Rectangle(Plane=xy, XSize=number_slider_3, YSize=number_slider_3, Radius=0)  # -> Rectangle, Length
padjust = AdjustPlane(Plane=project.Point, Normal=Z_4)
Z_5 = UnitZ(Factor="1")
Z_6 = UnitZ(Factor="-2")
orient = OrientDirection(
    Geometry=rectangle.Rectangle,
    PointA=Point(0, 0, 0),
    DirectionA=Vector(0, 0, 1),
    PointB=project.Point,
    DirectionB=padjust)  # -> Geometry, Transform
move_2 = Move(Geometry=orient.Geometry, Motion=Z_5)  # -> Geometry, Transform
extr_2 = Extrude(Base=move_2.Geometry, Direction=Z_6)
mesh = MeshBrep(
    Brep=extr_2,
    Settings={GridMaxCount=0, GridMinCount=16, JaggedSeams=False, MaxEdgeLength=0, MinEdgeLength=0.0001, MinTolerance=0, Refine=True, RefineAngle=0, RelativeTolerance=0.65, SimplePlanes=True, Tolerance=0})

# ---- group: Top shell
thickness = Slider(15, range=0..60)
cross_section_4 = CrossSectionKaramba3D(FamilyNameOfCrossSection="DefaultCroSec", Height_cm=thickness, mode="Shell - Const")
mjoin_4 = MeshJoin(Meshes=flatten(mesh_breps.Mesh))

# ---- group: Make punctures in shell (continued)
msplit = MeshSplit(Mesh=flatten(mjoin_4), Splitters=mesh)
item_7 = ListItem(List=msplit, Index=Slider(35, range=0..100), Wrap=True)

# ---- group: Top shell (continued)
meshtoshell_4 = MeshToShellKaramba3D(Mesh=flatten(item_7), CrossSection=cross_section_4, LimitDistance_m=0.005)  # -> Element, Points, Info

# ----
element = ElementKaramba3D(flatten([meshtoshell_4.Element, meshtoshell.Element, meshtoshell_3.Element, meshtoshell_2.Element]))
assemble = AssembleModelKaramba3D(Elem=flatten(element), Support=flatten(supp), Load=flatten(loads), Material=flatten(matprops), LimitDistance_m=0.005)  # -> Model, Info, Mass_kg, CenterOfGravity
analyze = AnalyzeKaramba3D(Model=assemble.Model)  # -> CalculatedModel, MaximumDisplacement_cm, ResultingForceOfGravity_kN, ElasticEnergy_kNm
modelview = ModelViewKaramba3D(Model=analyze.CalculatedModel, LoadCaseFactorsForLinearSuperposition=1, IndexOfVisibleLoadcase=-1)  # -> Model, DeformedMesh, DeformedAxes, DeformedModel
panel_4 = Panel(analyze.MaximumDisplacement_cm)
shellview = ShellViewKaramba3D(Model=modelview.Model, IndexOfLayer=0)  # -> Model, MeshesOfRenderedShells, LegendColors, LegendTags

# ---- group: Check principle stress lines to find good positions for punctures
reduce = RandomReduce(List=meshtoshell_4.Points, Reduction=Slider(6000, range=0..10000), Seed=1)
shelllineresults = LineResultsOnShellsKaramba3D(
    AnalyzedModel=modelview.Model,
    LayerPosition=0,
    ListOfSourcesOfPrincipalStressLinesLinesPoints=reduce,
    SegmentLength_m=0.5,
    DA_deg=5,
    mode="PrincStress")  # -> AnalyzedModel, Lines1, Lines2

# ---- group: For other variables
for_others = Legend(Colour=shellview.LegendColors, Tags=shellview.LegendTags, LegendType=101)

# ----
unit_convert = UnitConvert(L=shellview.LegendTags)
for_stresses = Legend(
    Colour=shellview.LegendColors,
    Tags=unit_convert,
    Rectangle={Plane=PlaneXY(92.04893019, 8.987165692, 0), Size=Domain2(u=-1.495250919..1.495250919, v=-4.943673351..4.943673351)},
    LegendType=1)

# ==== cluster UnitConvert
L = ClusterInput()

cull_i = CullIndex(List=L, Indices="0", Wrap=True)

lng = ListLength(List=cull_i)
subtraction = Subtraction(A=lng, B="1")
index = ItemIndex(List=cull_i, Item=subtraction)
cull_i_2 = CullIndex(List=cull_i, Indices=index, Wrap=True)

multiplication = Multiplication(A=cull_i_2, B="10")
ins = InsertItems(List=multiplication, Item="Stress[N/mm2]", Indices="0", Wrap=True)

L_2 = ClusterOutput(ins)
