# Grasshopper definition Structural_analysis_with_Non_uniform_load_distribution.gh (Grasshopper 1.0.7)
# plug-ins: Karamba, Weaverbird

# ---- group: Common Variables
Z = UnitZ(Factor="-1.2")
panel = Panel("15")
cross_section = CrossSectionKaramba3D(FamilyNameOfCrossSection="DefaultCroSec", Height_cm=Slider(30, range=0..60), mode="Shell - Const")
loads = LoadsKaramba3D(Vector=Z, LCase=0, mode="Gravity")
matprops = MaterialPropertiesKaramba3D(
    FamilyOfMaterial="Steel",
    Name="S235",
    YoungsModulus_kN_cm2="15",
    InPlaneShearModulus_kN_cm2="6",
    TransverseShearModulus_kN_cm2=8076,
    SpecificWeight_kN_m3=panel,
    CoefficientOfThermalExpansion_1_C=1e-05,
    YieldStrength_kN_cm2="0.05",
    mode="Isotrop")

# ---- group: Mesh resolution
number_slider = Slider(0.667, range=0..1)
number_slider_2 = Slider(0.1, range=0..0.1)

# ----
wbsplitquads = WeaverbirdsConstantQuadsSplitSubdivision(Level=1, SmoothNakedEdges=1)

# ---- group: With buttress
ceiling_srf_top = Surface([<surface referenced from the Rhino model> x36])
ceiling_srf = Surface([<surface referenced from the Rhino model> x148])
roof_srf = Surface([<surface referenced from the Rhino model> x91])
join = BrepJoin(Breps=ceiling_srf)  # -> Breps, Closed
mesh_breps = MeshBrepsKaramba3D(
    Brep=join.Breps,
    MeshResolution=number_slider_2,
    EdgeRefinementFactor=number_slider,
    PointReduction=False,
    SmoothingStepSize=0,
    SmoothingIterations=5)  # -> Mesh, Info
mjoin = MeshJoin(Meshes=mesh_breps.Mesh)
meshtoshell = MeshToShellKaramba3D(Mesh=mjoin, LimitDistance_m=0.005)  # -> Element, Points, Info

# ---- group: Without buttress
ceiling_srf_top_2 = Surface([<surface referenced from the Rhino model> x36])
ceiling_srf_2 = Surface([<surface referenced from the Rhino model> x136])
roof_srf_2 = Surface([<surface referenced from the Rhino model> x91])
join_2 = BrepJoin(Breps=ceiling_srf_2)  # -> Breps, Closed
mesh_breps_2 = MeshBrepsKaramba3D(
    Brep=join_2.Breps,
    MeshResolution=number_slider_2,
    EdgeRefinementFactor=number_slider,
    PointReduction=False,
    SmoothingStepSize=0,
    SmoothingIterations=5)  # -> Mesh, Info
mjoin_2 = MeshJoin(Meshes=mesh_breps_2.Mesh)
meshtoshell_2 = MeshToShellKaramba3D(Mesh=mjoin_2, LimitDistance_m=0.005)  # -> Element, Points, Info

# ---- group: Non uniform load distribution
pdecon = Deconstruct(Point=meshtoshell.Points)  # -> XComponent, YComponent, ZComponent
sort = SortList(Keys=pdecon.ZComponent)  # -> Keys, ValuesA
item = ListItem(List=sort.Keys, Index=0, Wrap=True)
addition = Addition(A=item, B=Slider(0.9, range=0..1))
eval = Evaluate(F="x≥y", x=pdecon.ZComponent, y=addition)
dispatch = Dispatch(List=meshtoshell.Points, DispatchPattern=eval)  # -> ListA, ListB
Z_2 = UnitZ(Factor=1)
area = Area(Geometry=ceiling_srf_top)  # -> Area, Centroid
project = ProjectPoint(Point=dispatch.ListA, Direction=Z_2, Geometry=roof_srf)  # -> Point, Index; disabled
ma = MassAddition(Input=area.Area)  # -> Result, PartialResults
lng = ListLength(List=dispatch.ListA)
ln = Line(StartPoint=dispatch.ListA, EndPoint=project.Point)
division = Division(A=ma.Result, B=lng)
len = Length(Curve=ln)
multiplication = Multiplication(A=len, B=division)
neg = Negative(Value=panel)
multiplication_2 = Multiplication(A=neg, B=multiplication)
Z_3 = UnitZ(Factor=multiplication_2)
loads_2 = LoadsKaramba3D(ForceVector=Z_3, Local=False, PosInd=dispatch.ListA, LCase=0, mode="Point")

pdecon_2 = Deconstruct(Point=meshtoshell_2.Points)  # -> XComponent, YComponent, ZComponent
sort_2 = SortList(Keys=pdecon_2.ZComponent)  # -> Keys, ValuesA
item_2 = ListItem(List=sort_2.Keys, Index=0, Wrap=True)
addition_2 = Addition(A=item_2, B=Slider(0.9, range=0..1))
eval_2 = Evaluate(F="x≥y", x=pdecon_2.ZComponent, y=addition_2)
dispatch_2 = Dispatch(List=meshtoshell_2.Points, DispatchPattern=eval_2)  # -> ListA, ListB
Z_4 = UnitZ(Factor=1)
area_2 = Area(Geometry=ceiling_srf_top_2)  # -> Area, Centroid
project_2 = ProjectPoint(Point=dispatch_2.ListA, Direction=Z_4, Geometry=roof_srf_2)  # -> Point, Index; disabled
ma_2 = MassAddition(Input=area_2.Area)  # -> Result, PartialResults
lng_2 = ListLength(List=dispatch_2.ListA)
ln_2 = Line(StartPoint=dispatch_2.ListA, EndPoint=project_2.Point)
division_2 = Division(A=ma_2.Result, B=lng_2)
len_2 = Length(Curve=ln_2)
neg_2 = Negative(Value=panel)
multiplication_3 = Multiplication(A=len_2, B=division_2)
multiplication_4 = Multiplication(A=neg_2, B=multiplication_3)
Z_5 = UnitZ(Factor=multiplication_4)
loads_3 = LoadsKaramba3D(ForceVector=Z_5, Local=False, PosInd=dispatch_2.ListA, LCase=0, mode="Point")

# ---- group: Support
pdecon_3 = Deconstruct(Point=meshtoshell.Points)  # -> XComponent, YComponent, ZComponent
eval_3 = Evaluate(F="Round(x,3)", x=pdecon_3.ZComponent)
sort_3 = SortList(Keys=eval_3)  # -> Keys, ValuesA
item_3 = ListItem(List=sort_3.Keys, Index=0, Wrap=True)
similar = Similarity(FirstNumber=eval_3, SecondNumber=item_3, Threshold=0.1)  # -> Similarity, AbsoluteDifference
dispatch_3 = Dispatch(List=flatten(meshtoshell.Points), DispatchPattern=similar.Similarity)  # -> ListA, ListB
supp = SupportKaramba3D(PosInd=dispatch_3.ListA, menu=[buttons(on, on, on, on, on, on)])

pdecon_4 = Deconstruct(Point=meshtoshell_2.Points)  # -> XComponent, YComponent, ZComponent
eval_4 = Evaluate(F="Round(x,3)", x=pdecon_4.ZComponent)
sort_4 = SortList(Keys=eval_4)  # -> Keys, ValuesA
item_4 = ListItem(List=sort_4.Keys, Index=0, Wrap=True)
similar_2 = Similarity(FirstNumber=eval_4, SecondNumber=item_4, Threshold=0.1)  # -> Similarity, AbsoluteDifference
dispatch_4 = Dispatch(List=flatten(meshtoshell_2.Points), DispatchPattern=similar_2.Similarity)  # -> ListA, ListB
supp_2 = SupportKaramba3D(PosInd=dispatch_4.ListA, menu=[buttons(on, on, on, on, on, on)])

# ----
assemble = AssembleModelKaramba3D(
    Elem=meshtoshell.Element,
    Support=supp,
    Load=loads_2,
    CrossSection=cross_section,
    Material=matprops,
    LimitDistance_m=0.005)  # -> Model, Info, Mass_kg, CenterOfGravity
assemble_2 = AssembleModelKaramba3D(
    Elem=meshtoshell_2.Element,
    Support=supp_2,
    Load=loads_3,
    CrossSection=cross_section,
    Material=matprops,
    LimitDistance_m=0.005)  # -> Model, Info, Mass_kg, CenterOfGravity
analyze = AnalyzeKaramba3D(Model=assemble.Model)  # -> CalculatedModel, MaximumDisplacement_cm, ResultingForceOfGravity_kN, ElasticEnergy_kNm
analyze_2 = AnalyzeKaramba3D(Model=assemble_2.Model)  # -> CalculatedModel, MaximumDisplacement_cm, ResultingForceOfGravity_kN, ElasticEnergy_kNm
modelview = ModelViewKaramba3D(Model=analyze.CalculatedModel, LoadCaseFactorsForLinearSuperposition=1, IndexOfVisibleLoadcase=-1)  # -> Model, DeformedMesh, DeformedAxes, DeformedModel
panel_2 = Panel(analyze.MaximumDisplacement_cm)
modelview_2 = ModelViewKaramba3D(Model=analyze_2.CalculatedModel, LoadCaseFactorsForLinearSuperposition=1, IndexOfVisibleLoadcase=-1)  # -> Model, DeformedMesh, DeformedAxes, DeformedModel
panel_3 = Panel(analyze_2.MaximumDisplacement_cm)
shellview = ShellViewKaramba3D(Model=modelview.Model, IndexOfLayer=0)  # -> Model, MeshesOfRenderedShells, LegendColors, LegendTags
shellview_2 = ShellViewKaramba3D(Model=modelview_2.Model, IndexOfLayer=0)  # -> Model, MeshesOfRenderedShells, LegendColors, LegendTags
for_others = Legend(Colour=shellview.LegendColors, Tags=shellview.LegendTags, LegendType=101)
for_others_2 = Legend(Colour=shellview_2.LegendColors, Tags=shellview_2.LegendTags, LegendType=101)
unit_convert = UnitConvert(L=shellview.LegendTags)
unit_convert_2 = UnitConvert(L=shellview_2.LegendTags)

# ---- group: For stresses
for_stresses = Legend(Colour=shellview.LegendColors, Tags=unit_convert, LegendType=101)

for_stresses_2 = Legend(
    Colour=shellview_2.LegendColors,
    Tags=unit_convert_2,
    Rectangle={Plane=PlaneXY(-17.0324564, -164.347572, 0), Size=Domain2(u=-0.9657042821..0.9657042821, v=-3.016676234..3.016676234)},
    LegendType=1)

# ==== cluster UnitConvert
L = ClusterInput()

cull_i = CullIndex(List=L, Indices="0", Wrap=True)
multiplication = Multiplication(A=cull_i, B="10")
ins = InsertItems(List=multiplication, Item="Stress[N/mm2]", Indices="0", Wrap=True)

L_2 = ClusterOutput(ins)
