# Grasshopper definition Brick Laying_Entrance.gh (Grasshopper 1.0.7)
# plug-ins: Bifocals, Kangaroo2 Components

# ---- group: Surface: Base 1
# 1. Brick laying: Based wall 60 cm in length (Side walls)
# Input surfaces
srf = Surface(<surface referenced from the Rhino model>)

# ---- group: Surface: Base 2
srf_2 = Surface(<surface referenced from the Rhino model>)

# ---- group: Brick Dimension
brick_depth = Slider(0.14, range=0.005..0.5)
brick_heigth = Slider(0.05, range=0.005..0.5)
brick_length = Slider(0.29, range=0.005..0.5)
# Adjusting the dimension of the bricks...
mortar_thickness = Slider(0.01, range=0.005..0.1)

# ----
addition = Addition(A=brick_depth, B=mortar_thickness)
addition_2 = Addition(A=brick_heigth, B=mortar_thickness)
addition_3 = Addition(A=brick_length, B=mortar_thickness)
contour = Contour(Shape=srf, Point=Point(0, 0, 0), Direction=Vector(0, 0, 1), Distance=addition_2)
contour_2 = Contour(Shape=srf_2, Point=Point(0, 0, 0), Direction=Vector(0, 0, 1), Distance=addition_2)
division = Division(A=addition_3, B="2")
divdist = DivideDistance(Curve=contour, Distance=division)  # -> Points, Tangents, Parameters
divdist_2 = DivideDistance(Curve=contour_2, Distance=division)  # -> Points, Tangents, Parameters
number_slider = Slider(65, range=0..180)

# ---- group: Surface: Arch 1
srf_3 = Surface(<surface referenced from the Rhino model>)

# ---- group: Surface: Arch 2
srf_4 = Surface(<surface referenced from the Rhino model>)

# ---- group: Surface: Arch 3
srf_5 = Surface(<surface referenced from the Rhino model>)

# ---- group: Surface: arch 4
srf_6 = Surface(<surface referenced from the Rhino model>)

# ---- group: Vault Surface 1
srf_7 = Surface([<surface referenced from the Rhino model> x3])

# ---- group: Surface: Vault base
srf_8 = Surface(<surface referenced from the Rhino model>)

# ---- group: Vault Surface 1
srf_9 = Surface([<surface referenced from the Rhino model> x2])

# ----
dom = ConstructDomain(DomainStart=expr("-x/2", brick_length), DomainEnd=expr("x/2", brick_length))
neg = Negative(Value=brick_depth)
neg_2 = Negative(Value=number_slider)
points = PointList(Points=flatten(divdist.Points))
rad = Radians(Degrees=number_slider)
debrep = DeconstructBrep(Brep=srf_6)  # -> Faces, Edges, Vertices
X = UnitX(Factor=1)
item = ListItem(List=debrep.Edges, Index=Slider(3, range=0..6), Wrap=True)
debrep_2 = DeconstructBrep(Brep=srf_3)  # -> Faces, Edges, Vertices
debrep_3 = DeconstructBrep(Brep=srf_4)  # -> Faces, Edges, Vertices
debrep_4 = DeconstructBrep(Brep=srf_5)  # -> Faces, Edges, Vertices

# ---- group: Brick Depth
num = Number(brick_depth)

# ---- group: Brick Heigth
num_2 = Number(brick_heigth)

# ---- group: Brick Length
num_3 = Number(brick_length)

# ---- group: Mortar Thickness
num_4 = Number(mortar_thickness)

# ---- group: Brick Depth
num_5 = Number(brick_depth)

# ---- group: Brick Heigth
num_6 = Number(brick_heigth)

# ---- group: Brick Length
num_7 = Number(brick_length)

# ---- group: Mortar Thickness
num_8 = Number(mortar_thickness)

# ---- group: Brick Length
num_9 = Number(brick_length)

# ---- group: Brick Depth
num_10 = Number(brick_depth)

# ---- group: Brick Heigth
num_11 = Number(brick_heigth)

# ----
len = Length(Curve=item)

# ---- group: Mortar Thickness
num_12 = Number(mortar_thickness)

# ---- group: Brick Length
num_13 = Number(brick_length)

# ---- group: Brick Depth
num_14 = Number(brick_depth)

# ---- group: Brick Heigth
num_15 = Number(brick_heigth)

# ---- group: Mortar Thickness
num_16 = Number(mortar_thickness)

# ----
panel = Panel([Slider(0, range=0..6), Slider(1, range=0..6)])
join = BrepJoin(Breps=srf_9)  # -> Breps, Closed

# ---- group: Brick Length
num_17 = Number(brick_length)

# ---- group: Brick Depth
num_18 = Number(brick_depth)

# ---- group: Brick Heigth
num_19 = Number(brick_heigth)

# ---- group: Mortar Thickness
num_20 = Number(mortar_thickness)

# ----
join_2 = BrepJoin(Breps=srf_7)  # -> Breps, Closed
item_2 = ListItem(List=debrep_2.Edges, Index=panel, Wrap=True)
item_3 = ListItem(List=debrep_2.Edges, Index=Slider(3, range=0..6), Wrap=True)
item_4 = ListItem(List=debrep_3.Edges, Index=panel, Wrap=True)
item_5 = ListItem(List=debrep_4.Edges, Index=panel, Wrap=True)
addition_4 = Addition(A=num_3, B=num_4)
addition_5 = Addition(A=num_2, B=num_4)
Y = UnitY(Factor=addition)
addition_6 = Addition(A=num_7, B=num_8)
addition_7 = Addition(A=num_9, B=num_12)
addition_8 = Addition(A=num_5, B=num_8)
addition_9 = Addition(A=num_6, B=num_8)
addition_10 = Addition(A=num_11, B=num_12)
dom_2 = ConstructDomain(DomainStart=expr("-x/2", num_14), DomainEnd=expr("x/2", num_14))
dom_3 = ConstructDomain(DomainStart=expr("-x/2", num_13), DomainEnd=expr("x/2", num_13))
addition_11 = Addition(A=num_14, B=num_16)
addition_12 = Addition(A=num_13, B=num_16)
addition_13 = Addition(A=num_15, B=num_16)
division_2 = Division(A=len, B=addition_9)
xz = XZPlane(Origin=Point(0, 0, 0))
crv = Curve(item_4)
crv_2 = Curve(item_2)
dispatch = Dispatch(List=flatten(divdist.Points), DispatchPattern=[True, False])  # -> ListA, ListB
crv_3 = Curve(item_5)
addition_14 = Addition(A=num_19, B=num_20)
neg_3 = Negative(Value=Y)
pt = Point(dispatch.ListB)
end = EndPoints(Curve=item_3)  # -> Start, End
neg_4 = Negative(Value=num_17)
join_3 = JoinCurves(Curves=crv_2, Preserve=False)
division_3 = Division(A=addition_4, B="2")
join_4 = JoinCurves(Curves=crv, Preserve=False)
join_5 = JoinCurves(Curves=crv_3, Preserve=False)
round = Round(Number=division_2)  # -> Nearest, Floor, Ceiling
division_4 = Division(A=addition_7, B="2")
contour_3 = Contour(Shape=join.Breps, Point=Point(0, 0, 0), Direction=xz, Distance=division_4)
division_5 = Division(A=addition_12, B="2")
pt_2 = Point(dispatch.ListA)
move = Move(Geometry=pt, Motion=neg_3)  # -> Geometry, Transform
ln = Line(StartPoint=end.Start, EndPoint=end.End)
multiplication = Multiplication(A=addition_8, B="2")
len_2 = Length(Curve=join_3)
flip = FlipCurve(Curve=join_3)  # -> Curve, Flag
len_3 = Length(Curve=join_4)
# Second layer of brick laying
points_2 = PointList(Points=move.Geometry)
len_4 = Length(Curve=join_5)
pframes = PerpFrames(Curve=item, Count=round.Floor, Align=True)  # -> Frames, Parameters
curvepoint = PointOnCurve(ln, parameter=0.5)
flip_2 = FlipCurve(Curve=contour_3)  # -> Curve, Flag
viewer = ParamViewer(pt_2)
contour_4 = Contour(Shape=srf_8, Point=Point(0, 0, 0), Direction=Vector(0, 0, 1), Distance=addition_13)
dom_4 = ConstructDomain(DomainStart=expr("-x/2", addition_6), DomainEnd=expr("x/2", addition_6))
# I will be back...
dom_5 = ConstructDomain(DomainStart=expr("-x/2", num_9), DomainEnd=expr("x/2", num_9))
divdist_3 = DivideDistance(Curve=flip_2.Curve, Distance=addition_10)  # -> Points, Tangents, Parameters
division_6 = Division(A=len_2, B=addition_14)
division_7 = Division(A=len_3, B=addition_14)
division_8 = Division(A=len_4, B=addition_14)
flip_3 = FlipCurve(Curve=join_4)  # -> Curve, Flag
flip_4 = FlipCurve(Curve=join_5)  # -> Curve, Flag

# ---- group: Second layer of brick laying
path_mapper = PathMapper(move.Geometry, source="{A} (i)", target="(floor(i%9))")
flip_5 = FlipMatrix(Data=path_mapper)
panel_2 = Panel([Slider(4, range=0..5), Slider(8, range=0..8)])
points_3 = PointList(Points=flip_5)
item_6 = ListItem(List=flip_5, Index=panel_2, Wrap=True)
rectangle = Rectangle(Plane=flip_5, XSize=dom, YSize=neg, Radius=0)  # -> Rectangle, Length
rectangle_2 = Rectangle(Plane=item_6, XSize=dom, YSize=neg, Radius=0)  # -> Rectangle, Length
dispatch_2 = Dispatch(List=rectangle_2.Rectangle, DispatchPattern=[True, False])  # -> ListA, ListB
crv_4 = Curve(dispatch_2.ListA)
crv_5 = Curve(dispatch_2.ListB)
splitatcorners = SplitAtCorners(Poly=crv_4, Angle=1)  # -> Corners, Parts
splitatcorners_2 = SplitAtCorners(Poly=crv_5, Angle=1)  # -> Corners, Parts
item_7 = ListItem(List=splitatcorners.Corners, Index="3", Wrap=True)
item_8 = ListItem(List=splitatcorners_2.Corners, Index="0", Wrap=True)
scale_nu = ScaleNU(Geometry=crv_4, Plane=item_7, ScaleX=Slider(0.5, range=0.01..1), ScaleY=1, ScaleZ=1)  # -> Geometry, Transform
scale_nu_2 = ScaleNU(Geometry=crv_5, Plane=item_8, ScaleX=Slider(0.5, range=0.01..1), ScaleY=1, ScaleZ=1)  # -> Geometry, Transform
replace = ReplaceItems(List=rectangle.Rectangle, Item=[scale_nu_2.Geometry, scale_nu.Geometry], Indices=panel_2, Wrap=False)

# ----
cull_i = CullIndex(List=pframes.Frames, Indices="-1", Wrap=True)
addition_15 = Addition(A=num_18, B=num_17)
round_2 = Round(Number=division_6)  # -> Nearest, Floor, Ceiling
neg_5 = Negative(Value=num_18)
multiplication_2 = Multiplication(A=num_20, B="2")

# ---- group: First layer of brick laying
# First layer of brick laying
path_mapper_2 = PathMapper(pt_2, source="{A} (i)", target="(floor(i%9))")
flip_6 = FlipMatrix(Data=path_mapper_2)
panel_3 = Panel([Slider(0, range=0..5), Slider(4, range=0..5)])
item_9 = ListItem(List=flip_6, Index=panel_3, Wrap=True)
points_4 = PointList(Points=flip_6, Size=Slider(0.02, range=0.01..0.5))
rectangle_3 = Rectangle(Plane=item_9, XSize=dom, YSize=neg, Radius=0)  # -> Rectangle, Length
rectangle_4 = Rectangle(Plane=flip_6, XSize=dom, YSize=neg, Radius=0)  # -> Rectangle, Length
dispatch_3 = Dispatch(List=rectangle_3.Rectangle, DispatchPattern=[True, False])  # -> ListA, ListB
crv_6 = Curve(dispatch_3.ListA)
crv_7 = Curve(dispatch_3.ListB)
splitatcorners_3 = SplitAtCorners(Poly=crv_6, Angle=1)  # -> Corners, Parts
splitatcorners_4 = SplitAtCorners(Poly=crv_7, Angle=1)  # -> Corners, Parts
item_10 = ListItem(List=splitatcorners_3.Corners, Index="3", Wrap=True)
item_11 = ListItem(List=splitatcorners_4.Corners, Index="0", Wrap=True)
scale_nu_3 = ScaleNU(Geometry=crv_6, Plane=item_10, ScaleX=Slider(0.5, range=0.01..1), ScaleY=1, ScaleZ=1)  # -> Geometry, Transform
scale_nu_4 = ScaleNU(Geometry=crv_7, Plane=item_11, ScaleX=Slider(0.5, range=0.01..1), ScaleY=1, ScaleZ=1)  # -> Geometry, Transform
replace_2 = ReplaceItems(List=rectangle_4.Rectangle, Item=[scale_nu_3.Geometry, scale_nu_4.Geometry], Indices=panel_3, Wrap=False)

# ----
pt_3 = Point(curvepoint)
xy = XYPlane(Origin=pt_3)
rot3d = Rotate3D(Geometry=xy, Angle=rad, Center=xy, Axis=X)  # -> Geometry, Transform
contour_5 = Contour(Shape=join_2.Breps, Point=Point(0, 0, 0), Direction=rot3d.Geometry, Distance=addition_5)
flip_7 = FlipCurve(Curve=contour_5)  # -> Curve, Flag
divdist_4 = DivideDistance(Curve=flip_7.Curve, Distance=division_3)  # -> Points, Tangents, Parameters
round_3 = Round(Number=division_7)  # -> Nearest, Floor, Ceiling
multiplication_3 = Multiplication(A=neg_4, B="2")
round_4 = Round(Number=division_8)  # -> Nearest, Floor, Ceiling
points_5 = PointList(Points=flatten(divdist_3.Points))
dispatch_4 = Dispatch(List=divdist_3.Points, DispatchPattern=[True, False])  # -> ListA, ListB
dispatch_5 = Dispatch(List=divdist_3.Tangents, DispatchPattern=[True, False])  # -> ListA, ListB

# ---- group: Finding center of the room
rev = ReverseList(List=divdist.Points)
ln_2 = Line(StartPoint=rev, EndPoint=divdist_2.Points)
item_12 = ListItem(List=flatten(ln_2), Index=Slider(4, range=0..80), Wrap=True)
curvepoint_2 = PointOnCurve(item_12, parameter=0.5)
xz_2 = XZPlane(Origin=curvepoint_2)

# ----
flip_8 = FlipMatrix(Data=divdist_4.Points)
flip_9 = FlipMatrix(Data=divdist_4.Tangents)
divdist_5 = DivideDistance(Curve=contour_4, Distance=division_5)  # -> Points, Tangents, Parameters
addition_16 = Addition(A=addition_15, B=multiplication_2)
panel_4 = Panel(round_2.Floor)
panel_5 = Panel(round_3.Floor)
flip_10 = FlipMatrix(Data=dispatch_4.ListA)
flip_11 = FlipMatrix(Data=dispatch_4.ListB)
panel_6 = Panel(round_4.Floor)
flip_12 = FlipMatrix(Data=dispatch_5.ListA)
flip_13 = FlipMatrix(Data=dispatch_5.ListB)
multiplication_4 = Multiplication(A=num_18, B="2")
dom_6 = ConstructDomain(DomainStart=expr("-x/2", multiplication_4), DomainEnd=expr("x/2", multiplication_4))
dispatch_6 = Dispatch(List=flip_8, DispatchPattern=[True, False])  # -> ListA, ListB
rectangle_5 = Rectangle(Plane=cull_i, XSize=dom_4, YSize=multiplication, Radius=0)  # -> Rectangle, Length
dispatch_7 = Dispatch(List=flip_9, DispatchPattern=[True, False])  # -> ListA, ListB
flip_14 = FlipMatrix(Data=divdist_5.Points)
points_6 = PointList(Points=divdist_5.Points)
multiplication_5 = Multiplication(A=neg_5, B="2")
neg_6 = Negative(Value=addition_16)
subtraction = Subtraction(A=multiplication_3, B=multiplication_2)
dispatch_8 = Dispatch(List=flatten(flip_10), DispatchPattern=[True, False])  # -> ListA, ListB
dispatch_9 = Dispatch(List=flatten(flip_11), DispatchPattern=[True, False])  # -> ListA, ListB
viewer_2 = ParamViewer(path_mapper_2)
dispatch_10 = Dispatch(List=flatten(flip_12), DispatchPattern=[True, False])  # -> ListA, ListB
dispatch_11 = Dispatch(List=flatten(flip_13), DispatchPattern=[True, False])  # -> ListA, ListB
pt_4 = Point(dispatch_6.ListA)
pt_5 = Point(dispatch_6.ListB)
dispatch_12 = Dispatch(List=flip_14, DispatchPattern=[True, False])  # -> ListA, ListB
boxrec = BoxRectangle(Rectangle=rectangle_5.Rectangle, Height=num_19)
yz = YZPlane(Origin=pt_3)
flip_15 = FlipMatrix(Data=dispatch_7.ListB)
pframes_2 = PerpFrames(Curve=flip.Curve, Count=panel_4, Align=True)  # -> Frames, Parameters
pframes_3 = PerpFrames(Curve=flip_3.Curve, Count=panel_5, Align=True)  # -> Frames, Parameters
pt_6 = Point(dispatch_9.ListB)
flip_16 = FlipMatrix(Data=dispatch_7.ListA)
pt_7 = Point(dispatch_8.ListA)
points_7 = PointList(Points=flatten(divdist_4.Points))
pt_8 = Point(dispatch_12.ListA)
pframes_4 = PerpFrames(Curve=flip_4.Curve, Count=panel_6, Align=True)  # -> Frames, Parameters

# ---- group: Unused
addition_17 = Addition(A=num_17, B=num_20)
deplane = DeconstructPlane(Plane=pframes_4.Frames)  # -> Origin, XAxis, YAxis, ZAxis
neg_7 = Negative(Value=addition_17)
line = LineSDL(Start=pframes_4.Frames, Direction=deplane.XAxis, Length=neg_7)
division_9 = Division(A=num_17, B="2")
end_2 = EndPoints(Curve=line)  # -> Start, End
vec2pt = Vector2Pt(PointA=end_2.Start, PointB=end_2.End, Unitize=False)  # -> Vector, Length
rectangle_6 = Rectangle(Plane=end_2.End, XSize=division_9, YSize=dom_6, Radius=0)  # -> Rectangle, Length
amp = Amplitude(Vector=vec2pt.Vector, Amplitude=Slider(0.4, range=0.1..0.5))
vdis = VectorDisplay(Anchor=end_2.Start, Vector=amp)
X_2 = UnitX(Factor=1)
angle = Angle(VectorA=X_2, VectorB=amp)  # -> Angle, Reflex
Y_2 = UnitY(Factor=1)
neg_8 = Negative(Value=angle.Angle)
rot3d_2 = Rotate3D(Geometry=rectangle_6.Rectangle, Angle=neg_8, Center=end_2.End, Axis=Y_2)  # -> Geometry, Transform
neg_9 = Negative(Value=num_19)
boxrec_2 = BoxRectangle(Rectangle=rot3d_2.Geometry, Height=neg_9)

# ----
flip_17 = FlipMatrix(Data=pt_4)
flip_18 = FlipMatrix(Data=pt_5)
pt_9 = Point(dispatch_12.ListB)
mirror = Mirror(Geometry=boxrec, Plane=yz)  # -> Geometry, Transform
amp_2 = Amplitude(Vector=dispatch_10.ListA, Amplitude=Slider(0.1, range=0.1..0.5))
amp_3 = Amplitude(Vector=dispatch_11.ListB, Amplitude=Slider(0.1, range=0.1..0.5))
dispatch_13 = Dispatch(List=flip_15, DispatchPattern=[True, False])  # -> ListA, ListB
flip_19 = FlipMatrix(Data=pt_8)
cull_i_2 = CullIndex(List=pframes_2.Frames, Indices="-1", Wrap=True)
rectangle_7 = Rectangle(Plane=cull_i_2, XSize=neg_6, YSize=multiplication_5, Radius=0)  # -> Rectangle, Length
dispatch_14 = Dispatch(List=flip_16, DispatchPattern=[True, False])  # -> ListA, ListB
dispatch_15 = Dispatch(List=flip_17, DispatchPattern=[True, False])  # -> ListA, ListB
dispatch_16 = Dispatch(List=flip_18, DispatchPattern=[True, False])  # -> ListA, ListB
cull_i_3 = CullIndex(List=pframes_3.Frames, Indices="-1", Wrap=True)
cull_i_4 = CullIndex(List=pframes_4.Frames, Indices="-1", Wrap=True)
merge = Merge(Data1=boxrec, Data2=mirror.Geometry)
dispatch_17 = Dispatch(List=flatten(flip_19), DispatchPattern=[True, False])  # -> ListA, ListB
vdis_2 = VectorDisplay(Anchor=pt_7, Vector=amp_2)
line_2 = LineSDL(Start=pt_7, Direction=amp_2, Length=Slider(0.05, range=0..0.1))
vdis_3 = VectorDisplay(Anchor=pt_6, Vector=amp_3)
boxrec_3 = BoxRectangle(Rectangle=rectangle_7.Rectangle, Height=num_19)
yz_2 = YZPlane(Origin=pt_3)
split = SplitList(List=flatten(dispatch_13.ListB), Index="520")  # -> ListA, ListB
pt_10 = Point(dispatch_16.ListA)
amp_4 = Amplitude(Vector=dispatch_14.ListA, Amplitude=Slider(0.2, range=0.1..0.5))
pt_11 = Point(dispatch_15.ListA)

# ---- group: Unused
split_2 = SplitList(List=flatten(pt_11), Index="320")  # -> ListA, ListB
pt_12 = Point(split_2.ListB)

# ----
pt_13 = Point(dispatch_16.ListB)
rectangle_8 = Rectangle(Plane=cull_i_3, XSize=subtraction, YSize=dom_6, Radius=0)  # -> Rectangle, Length

# ---- group: Unused
split_3 = SplitList(List=flatten(amp_4), Index="320")  # -> ListA, ListB

# ----
pt_14 = Point(dispatch_17.ListA)
pt_15 = Point(dispatch_17.ListB)
X_3 = UnitX(Factor=addition_11)
line_3 = LineSDL(Start=pt_6, Direction=amp_3, Length=Slider(0.05, range=0..0.1))
pframes_5 = PerpFrames(Curve=line_2, Count=1, Align=True)  # -> Frames, Parameters
mirror_2 = Mirror(Geometry=boxrec_3, Plane=yz_2)  # -> Geometry, Transform
multiplication_6 = Multiplication(A=num_20, B="3")
amp_5 = Amplitude(Vector=split.ListA, Amplitude=Slider(0.2, range=0.1..0.5))
boxrec_4 = BoxRectangle(Rectangle=rectangle_8.Rectangle, Height=num_19)
yz_3 = YZPlane(Origin=pt_3)
move_2 = Move(Geometry=pt_14, Motion=X_3)  # -> Geometry, Transform
subtraction_2 = Subtraction(A=multiplication_3, B=num_18)
X_4 = UnitX(Factor=1)
xy_2 = XYPlane(Origin=pt_11)
points_8 = PointList(Points=flatten(pt_11))

# ---- group: Rotation Angle
num_21 = Number(rad)

# ----
pframes_6 = PerpFrames(Curve=line_3, Count=1, Align=True)  # -> Frames, Parameters
item_13 = ListItem(List=pframes_5.Frames, Index="0", Wrap=True)
vdis_4 = VectorDisplay(Anchor=pt_13, Vector=amp_5)
split_4 = SplitList(List=flatten(dispatch_13.ListA), Index="520")  # -> ListA, ListB
split_5 = SplitList(List=flatten(pt_13), Index="520")  # -> ListA, ListB
split_6 = SplitList(List=flatten(pt_10), Index="520")  # -> ListA, ListB
X_5 = UnitX(Factor=1)
points_9 = PointList(Points=flatten(item_13))
vdis_5 = VectorDisplay(Anchor=amp_4, Vector=amp_4)
points_10 = PointList(Points=flatten(pt_13))
points_11 = PointList(Points=flatten(pt_10))
mirror_3 = Mirror(Geometry=boxrec_4, Plane=yz_3)  # -> Geometry, Transform
subtraction_3 = Subtraction(A=subtraction_2, B=multiplication_6)
X_6 = UnitX(Factor=1)
num_22 = Number(rad)
amp_6 = Amplitude(Vector=split_4.ListB, Amplitude=Slider(0.2, range=0.1..0.5))
rot3d_3 = Rotate3D(Geometry=xy_2, Angle=num_21, Center=xy_2, Axis=X_4)  # -> Geometry, Transform
X_7 = UnitX(Factor=1)
angle_2 = Angle(VectorA=X_5, VectorB=amp_4)  # -> Angle, Reflex
item_14 = ListItem(List=pframes_6.Frames, Index="0", Wrap=True)
rectangle_9 = Rectangle(Plane=[pt_15, move_2.Geometry], XSize=num_14, YSize=dom_3, Radius=0)  # -> Rectangle, Length
rectangle_10 = Rectangle(Plane=pt_9, XSize=num_13, YSize=dom_2, Radius=0)  # -> Rectangle, Length
pt_16 = Point(split_5.ListA)
xy_3 = XYPlane(Origin=pt_16)
split_7 = SplitList(List=flatten(item_13), Index="77")  # -> ListA, ListB
pt_17 = Point(split_6.ListB)
angle_3 = Angle(VectorA=X_7, VectorB=amp_5)  # -> Angle, Reflex
rot3d_4 = Rotate3D(Geometry=xy_3, Angle=num_22, Center=xy_3, Axis=X_6)  # -> Geometry, Transform
rectangle_11 = Rectangle(Plane=cull_i_4, XSize=subtraction_3, YSize=dom_6, Radius=0)  # -> Rectangle, Length
rad_2 = Radians(Degrees=Slider(90, range=0..90))
vdis_6 = VectorDisplay(Anchor=pt_17, Vector=amp_6)
xy_4 = XYPlane(Origin=pt_17)
boxrec_5 = BoxRectangle(Rectangle=[rectangle_9.Rectangle, rectangle_10.Rectangle], Height=num_15)
rotate = Rotate(Geometry=rot3d_3.Geometry, Angle=angle_2.Angle, Plane=rot3d_3.Geometry)  # -> Geometry, Transform
split_8 = SplitList(List=flatten(item_14), Index="70")  # -> ListA, ListB
X_8 = UnitX(Factor=1)
pln = Plane(split_7.ListB)
pln_2 = Plane(split_7.ListA)
neg_10 = Negative(Value=rad_2)
num_23 = Number(rad)
rad_3 = Radians(Degrees=Slider(90, range=0..90))
X_9 = UnitX(Factor=1)
rotate_2 = Rotate(Geometry=pln, Angle=neg_10, Plane=pln)  # -> Geometry, Transform
pln_3 = Plane(split_8.ListA)
pln_4 = Plane(split_8.ListB)
neg_11 = Negative(Value=rad_3)
angle_4 = Angle(VectorA=X_9, VectorB=amp_6)  # -> Angle, Reflex
rot3d_5 = Rotate3D(Geometry=xy_4, Angle=num_23, Center=xy_4, Axis=X_8)  # -> Geometry, Transform
merge_2 = Merge(Data1=pln_2, Data2=rotate_2.Geometry)
rotate_3 = Rotate(Geometry=pln_4, Angle=neg_11, Plane=pln_4)  # -> Geometry, Transform
rotate_4 = Rotate(Geometry=rot3d_4.Geometry, Angle=angle_3.Angle, Plane=rot3d_4.Geometry)  # -> Geometry, Transform
rotate_5 = Rotate(Geometry=rot3d_5.Geometry, Angle=angle_4.Angle, Plane=rot3d_5.Geometry)  # -> Geometry, Transform
merge_3 = Merge(Data1=pln_3, Data2=rotate_3.Geometry)
neg_12 = Negative(Value=num)
rectangle_12 = Rectangle(Plane=[merge_2, merge_3], XSize=num_10, YSize=dom_5, Radius=0)  # -> Rectangle, Length
merge_4 = Merge(Data1=rotate_5.Geometry, Data2=rotate_4.Geometry)
rectangle_13 = Rectangle(Plane=[rotate.Geometry, merge_4], XSize=num_3, YSize=neg_12, Radius=0)  # -> Rectangle, Length
boxrec_6 = BoxRectangle(Rectangle=rectangle_11.Rectangle, Height=num_19)
yz_4 = YZPlane(Origin=pt_3)
merge_5 = Merge(Data1=boxrec_6)
boxrec_7 = BoxRectangle(Rectangle=rectangle_13.Rectangle, Height=num_2)
mirror_4 = Mirror(Geometry=boxrec_6, Plane=yz_4)  # -> Geometry, Transform
boxrec_8 = BoxRectangle(Rectangle=rectangle_12.Rectangle, Height=num_11)
merge_6 = Merge(Data1=boxrec_3, Data2=mirror_2.Geometry)
merge_7 = Merge(Data1=boxrec_4, Data2=mirror_3.Geometry)
merge_8 = Merge(Data1=merge_5, Data2=mirror_4.Geometry)

# ---- group: Wall 1
# Result
boxrec_9 = BoxRectangle(Rectangle=[replace_2, replace], Height=brick_heigth)

# ---- group: Wall 2
mirror_5 = Mirror(Geometry=boxrec_9, Plane=xz_2)  # -> Geometry, Transform

# ---- group: Result side walls
merge_9 = Merge(Data1=boxrec_9, Data2=mirror_5.Geometry)

# ---- group: Surface: Arch 1
srf_10 = Surface(<surface referenced from the Rhino model>)

# ---- group: Surface: Arch 1.5
srf_11 = Surface(<surface referenced from the Rhino model>)

# ---- group: Surface: Cantilever Low
srf_12 = Surface([<surface referenced from the Rhino model> x2])

# ----
srf_13 = Surface([<surface referenced from the Rhino model> x2])

# ---- group: Surface: Cantilever Mid
srf_14 = Surface([<surface referenced from the Rhino model> x2])

# ---- group: Surface: Cantilever Top
srf_15 = Surface([<surface referenced from the Rhino model> x2])

# ---- group: Surface: Arch 2
srf_16 = Surface(<surface referenced from the Rhino model>)

# ---- group: Surface: Arch 2.5
srf_17 = Surface(<surface referenced from the Rhino model>)

# ---- group: Surface: Base wall
srf_18 = Surface(<surface referenced from the Rhino model>)

# ---- group: Surface: Arch 3
srf_19 = Surface(<surface referenced from the Rhino model>)

# ---- group: Surface: Arch 3.5
srf_20 = Surface(<surface referenced from the Rhino model>)

# ---- group: Surface: Arch 3
srf_21 = Surface(<surface referenced from the Rhino model>)

# ---- group: Surface: Arch 3.5
srf_22 = Surface(<surface referenced from the Rhino model>)

# ---- group: Brick Depth
num_24 = Number(brick_depth)

# ---- group: Brick Heigth
num_25 = Number(brick_heigth)

# ---- group: Brick Length
num_26 = Number(brick_length)

# ---- group: Mortar Thickness
num_27 = Number(mortar_thickness)

# ----
join_6 = BrepJoin(Breps=srf_13)  # -> Breps, Closed
join_7 = BrepJoin(Breps=srf_12)  # -> Breps, Closed
join_8 = BrepJoin(Breps=srf_14)  # -> Breps, Closed
join_9 = BrepJoin(Breps=srf_15)  # -> Breps, Closed
join_10 = BrepJoin(Breps=srf_18)  # -> Breps, Closed

# ---- group: Get the brick aligning edge of the surface
number_slider_2 = Slider(6, range=0..10)
debrep_5 = DeconstructBrep(Brep=srf_10)  # -> Faces, Edges, Vertices
range = Range(Domain=number_slider_2, Steps=number_slider_2)
item_15 = ListItem(List=debrep_5.Edges, Index=range, Wrap=True)
join_11 = JoinCurves(Curves=item_15, Preserve=False)

number_slider_3 = Slider(3, range=0..10)
debrep_6 = DeconstructBrep(Brep=srf_16)  # -> Faces, Edges, Vertices
range_2 = Range(Domain=number_slider_3, Steps=number_slider_3)
item_16 = ListItem(List=debrep_6.Edges, Index=range_2, Wrap=True)
join_12 = JoinCurves(Curves=item_16, Preserve=False)

# ----
addition_18 = Addition(A=num_25, B=num_27)
addition_19 = Addition(A=num_26, B=num_27)
edges = BrepEdges(Brep=join_6.Breps)  # -> Naked, Interior, NonManifold
contour_6 = Contour(Shape=join_6.Breps, Point=Point(0, 0, 0), Direction=Vector(0, 0, 1))
debrep_7 = DeconstructBrep(Brep=srf_11)  # -> Faces, Edges, Vertices
debrep_8 = DeconstructBrep(Brep=srf_17)  # -> Faces, Edges, Vertices
contour_7 = Contour(Shape=join_7.Breps, Point=Point(0, 0, 0), Direction=Vector(0, 0, 1), Distance=addition_18)
debrep_9 = DeconstructBrep(Brep=srf_20)  # -> Faces, Edges, Vertices
contour_8 = Contour(Shape=join_8.Breps, Point=Point(0, 0, 0), Direction=Vector(0, 0, 1), Distance=addition_18)
contour_9 = Contour(Shape=join_9.Breps, Point=Point(0, 0, 0), Direction=Vector(0, 0, 1), Distance=addition_18)
debrep_10 = DeconstructBrep(Brep=srf_22)  # -> Faces, Edges, Vertices
division_10 = Division(A=addition_19, B="2")
contour_10 = Contour(Shape=join_10.Breps, Point=Point(0, 0, 0), Direction=Vector(0, 0, 1), Distance=addition_18)

# ---- group: Brick Depth
num_28 = Number(brick_depth)

# ---- group: Brick Heigth
num_29 = Number(brick_heigth)

# ---- group: Brick Length
num_30 = Number(brick_length)

# ---- group: Mortar Thickness
num_31 = Number(mortar_thickness)

# ----
flip_20 = FlipCurve(Curve=contour_7)  # -> Curve, Flag
item_17 = ListItem(List=flatten(contour_8), Index="-1", Wrap=True)
item_18 = ListItem(List=debrep_5.Vertices, Index=Slider(7, range=0..12), Wrap=True)
item_19 = ListItem(List=debrep_7.Vertices, Index=Slider(8, range=0..12), Wrap=True)
item_20 = ListItem(List=flatten(contour_9), Index="0", Wrap=True)
item_21 = ListItem(List=debrep_6.Vertices, Index=Slider(4, range=0..12), Wrap=True)
item_22 = ListItem(List=debrep_8.Vertices, Index=Slider(5, range=0..12), Wrap=True)
item_23 = ListItem(List=flatten(contour_10), Index="0", Wrap=True)
item_24 = ListItem(List=debrep_9.Vertices, Index=Slider(8, range=0..12), Wrap=True)
item_25 = ListItem(List=debrep_10.Vertices, Index=Slider(8, range=0..12), Wrap=True)
item_26 = ListItem(List=edges.Naked, Index=Slider(5, range=0..7), Wrap=True)
item_27 = ListItem(List=edges.Naked, Index=Slider(2, range=0..7), Wrap=True)
divdist_6 = DivideDistance(Curve=flip_20.Curve, Distance=division_10)  # -> Points, Tangents, Parameters
ln_3 = Line(StartPoint=item_18, EndPoint=item_19)
flip_21 = FlipCurve(Curve=item_20)  # -> Curve, Flag
ln_4 = Line(StartPoint=item_21, EndPoint=item_22)
flip_22 = FlipCurve(Curve=item_23)  # -> Curve, Flag
flip_23 = FlipCurve(Curve=item_17)  # -> Curve, Flag
len_5 = Length(Curve=item_26)
addition_20 = Addition(A=num_29, B=num_31)
flip_24 = FlipMatrix(Data=divdist_6.Points)
curvepoint_3 = PointOnCurve(ln_3, parameter=0.5)
curvepoint_4 = PointOnCurve(ln_4, parameter=0.5)
division_11 = Division(A=len_5, B=addition_20)
replace_3 = ReplaceItems(List=flatten(contour_9), Item=flip_21.Curve, Indices="0", Wrap=True)
replace_4 = ReplaceItems(List=flatten(contour_10), Item=flip_22.Curve, Indices="0", Wrap=True)

# ---- group: Brick Depth
num_32 = Number(brick_depth)

# ---- group: Brick Heigth
num_33 = Number(brick_heigth)

# ---- group: Brick Length
num_34 = Number(brick_length)

# ---- group: Mortar Thickness
num_35 = Number(mortar_thickness)

# ----
replace_5 = ReplaceItems(List=flatten(contour_8), Item=flip_23.Curve, Indices="-1", Wrap=True)

# ---- group: Brick Depth
num_36 = Number(brick_depth)

# ---- group: Brick Heigth
num_37 = Number(brick_heigth)

# ---- group: Brick Length
num_38 = Number(brick_length)

# ---- group: Mortar Thickness
num_39 = Number(mortar_thickness)

# ---- group: Brick Depth
num_40 = Number(brick_depth)

# ---- group: Brick Heigth
num_41 = Number(brick_heigth)

# ---- group: Brick Length
num_42 = Number(brick_length)

# ---- group: Mortar Thickness
num_43 = Number(mortar_thickness)

# ---- group: Brick Depth
num_44 = Number(brick_depth)

# ---- group: Brick Heigth
num_45 = Number(brick_heigth)

# ---- group: Brick Length
num_46 = Number(brick_length)

# ---- group: Mortar Thickness
num_47 = Number(mortar_thickness)

# ----
dispatch_18 = Dispatch(List=flip_24, DispatchPattern=[True, False])  # -> ListA, ListB
flip_25 = FlipCurve(Curve=replace_3)  # -> Curve, Flag
flip_26 = FlipCurve(Curve=replace_5)  # -> Curve, Flag
divdist_7 = DivideDistance(Curve=flip_26.Curve, Distance=division_10)  # -> Points, Tangents, Parameters
flip_27 = FlipCurve(Curve=replace_4)  # -> Curve, Flag

# ---- group: Brick Depth
num_48 = Number(num_24)

# ---- group: Brick Heigth
num_49 = Number(num_25)

# ---- group: Brick Length
num_50 = Number(num_26)

# ---- group: Mortar Thickness
num_51 = Number(num_27)

# ----
pt_18 = Point(curvepoint_3)
divdist_8 = DivideDistance(Curve=item_26, Distance=addition_20)  # -> Points, Tangents, Parameters
divdist_9 = DivideDistance(Curve=item_27, Distance=addition_20)  # -> Points, Tangents, Parameters
pt_19 = Point(curvepoint_4)
dispatch_19 = Dispatch(List=dispatch_18.ListA, DispatchPattern=[True, False])  # -> ListA, ListB
addition_21 = Addition(A=num_32, B=num_35)
addition_22 = Addition(A=num_33, B=num_35)

# ---- group: The number of bricks along the edge
len_6 = Length(Curve=join_11)
division_12 = Division(A=len_6, B=addition_22)
round_5 = Round(Number=division_12)  # -> Nearest, Floor, Ceiling
panel_7 = Panel(round_5.Floor)

# ----
addition_23 = Addition(A=num_34, B=num_35)
division_13 = Division(A=num_35, B="2")
divdist_10 = DivideDistance(Curve=flip_25.Curve, Distance=division_10)  # -> Points, Tangents, Parameters
addition_24 = Addition(A=num_36, B=num_39)
addition_25 = Addition(A=num_37, B=num_39)

# ---- group: The number of bricks along the edge
len_7 = Length(Curve=join_12)
division_14 = Division(A=len_7, B=addition_25)
round_6 = Round(Number=division_14)  # -> Nearest, Floor, Ceiling
panel_8 = Panel(round_6.Floor)

# ----
addition_26 = Addition(A=num_38, B=num_39)
division_15 = Division(A=num_39, B="2")
divdist_11 = DivideDistance(Curve=flip_27.Curve, Distance=division_10)  # -> Points, Tangents, Parameters
addition_27 = Addition(A=num_40, B=num_43)
addition_28 = Addition(A=num_41, B=num_43)
addition_29 = Addition(A=num_42, B=num_43)
division_16 = Division(A=num_43, B="2")
addition_30 = Addition(A=num_44, B=num_47)
addition_31 = Addition(A=num_45, B=num_47)
addition_32 = Addition(A=num_46, B=num_47)
division_17 = Division(A=num_47, B="2")
flip_28 = FlipMatrix(Data=divdist_7.Points)
dom_7 = ConstructDomain(DomainStart=expr("-x/2", num_48), DomainEnd=expr("x/2", num_48))
dom_8 = ConstructDomain(DomainStart=expr("-x/2", num_50), DomainEnd=expr("x/2", num_50))
flip_29 = FlipMatrix(Data=dispatch_19.ListA)
flip_30 = FlipMatrix(Data=dispatch_19.ListB)
addition_33 = Addition(A=num_48, B=num_51)
flip_31 = FlipMatrix(Data=divdist_10.Points)
points_12 = PointList(Points=dispatch_18.ListA)
flip_32 = FlipMatrix(Data=divdist_11.Points)
dispatch_20 = Dispatch(List=flip_28, DispatchPattern=[True, False])  # -> ListA, ListB

# ---- group: Position of the bricks
flip_33 = FlipCurve(Curve=join_11)  # -> Curve, Flag
pframes_7 = PerpFrames(Curve=flip_33.Curve, Count=panel_7, Align=True)  # -> Frames, Parameters

# ----
ln_5 = Line(StartPoint=divdist_9.Points, EndPoint=divdist_8.Points)

# ---- group: Position of the bricks
flip_34 = FlipCurve(Curve=join_12)  # -> Curve, Flag
pframes_8 = PerpFrames(Curve=flip_34.Curve, Count=panel_8, Align=True)  # -> Frames, Parameters

# ----
addition_34 = Addition(A=addition_21, B=addition_23)
dispatch_21 = Dispatch(List=flip_29, DispatchPattern=[True, False])  # -> ListA, ListB
addition_35 = Addition(A=addition_24, B=addition_26)
dispatch_22 = Dispatch(List=flip_30, DispatchPattern=[True, False])  # -> ListA, ListB
dispatch_23 = Dispatch(List=flip_31, DispatchPattern=[True, False])  # -> ListA, ListB
addition_36 = Addition(A=num_50, B=num_51)
points_13 = PointList(Points=flip_31)
dispatch_24 = Dispatch(List=flip_32, DispatchPattern=[True, False])  # -> ListA, ListB
points_14 = PointList(Points=flip_32)
dispatch_25 = Dispatch(List=dispatch_20.ListA, DispatchPattern=[True, False])  # -> ListA, ListB
addition_37 = Addition(A=addition_21, B=addition_34)
addition_38 = Addition(A=addition_24, B=addition_35)
dispatch_26 = Dispatch(List=dispatch_23.ListA, DispatchPattern=[True, False])  # -> ListA, ListB
dispatch_27 = Dispatch(List=dispatch_24.ListA, DispatchPattern=[True, False])  # -> ListA, ListB
flip_35 = FlipMatrix(Data=dispatch_25.ListA)
flip_36 = FlipMatrix(Data=dispatch_25.ListB)
pt_20 = Point(dispatch_22.ListB)
pt_21 = Point(dispatch_21.ListB)
pt_22 = Point(dispatch_21.ListA)
pt_23 = Point(dispatch_22.ListA)
pt_24 = Point(dispatch_18.ListB)
points_15 = PointList(Points=dispatch_20.ListA)

# ---- group: Split the bricks into 2 layers
dispatch_28 = Dispatch(List=pframes_7.Frames, DispatchPattern=[True, False])  # -> ListA, ListB

dispatch_29 = Dispatch(List=pframes_8.Frames, DispatchPattern=[True, False])  # -> ListA, ListB

# ----
addition_39 = Addition(A=addition_24, B=addition_38)
dispatch_30 = Dispatch(List=flip_35, DispatchPattern=[True, False])  # -> ListA, ListB
flip_37 = FlipMatrix(Data=dispatch_26.ListA)
flip_38 = FlipMatrix(Data=dispatch_26.ListB)
dispatch_31 = Dispatch(List=flip_36, DispatchPattern=[True, False])  # -> ListA, ListB
flip_39 = FlipMatrix(Data=dispatch_27.ListA)
flip_40 = FlipMatrix(Data=dispatch_27.ListB)
dispatch_32 = Dispatch(List=flip_37, DispatchPattern=[True, False])  # -> ListA, ListB
dispatch_33 = Dispatch(List=flip_38, DispatchPattern=[True, False])  # -> ListA, ListB
dispatch_34 = Dispatch(List=flip_39, DispatchPattern=[True, False])  # -> ListA, ListB
dispatch_35 = Dispatch(List=flip_40, DispatchPattern=[True, False])  # -> ListA, ListB
neg_13 = Negative(Value=num_50)
pt_25 = Point(dispatch_30.ListB)
pt_26 = Point(dispatch_31.ListA)
pt_27 = Point(dispatch_30.ListA)
pt_28 = Point(dispatch_31.ListB)
pt_29 = Point(dispatch_20.ListB)
neg_14 = Negative(Value=num_48)
pln_5 = Plane(dispatch_28.ListA)
pln_6 = Plane(dispatch_28.ListB)
dom_9 = ConstructDomain(DomainStart=expr("-x/2", num_34), DomainEnd=expr("x/2", num_34))
pln_7 = Plane(dispatch_29.ListA)
pln_8 = Plane(dispatch_29.ListB)
dom_10 = ConstructDomain(DomainStart=expr("-x/2", num_38), DomainEnd=expr("x/2", num_38))
dom_11 = ConstructDomain(DomainStart=expr("-x/2", num_42), DomainEnd=expr("x/2", num_42))
dom_12 = ConstructDomain(DomainStart=expr("-x/2", num_46), DomainEnd=expr("x/2", num_46))
pt_30 = Point(dispatch_32.ListB)
pt_31 = Point(dispatch_33.ListB)
pt_32 = Point(dispatch_32.ListA)
pt_33 = Point(dispatch_33.ListA)
pt_34 = Point(dispatch_23.ListB)
merge_10 = Merge(Data1=pt_25, Data2=pt_26)
merge_11 = Merge(Data1=pt_27, Data2=pt_28)
pt_35 = Point(dispatch_34.ListB)
pt_36 = Point(dispatch_35.ListB)
pt_37 = Point(dispatch_34.ListA)
pt_38 = Point(dispatch_35.ListA)
pt_39 = Point(dispatch_24.ListB)
merge_12 = Merge(Data1=pt_22, Data2=pt_20)
merge_13 = Merge(Data1=pt_23, Data2=pt_21)
neg_15 = Negative(Value=num_32)
neg_16 = Negative(Value=addition_37)
neg_17 = Negative(Value=num_36)
neg_18 = Negative(Value=addition_39)
neg_19 = Negative(Value=num_40)
neg_20 = Negative(Value=addition_29)
neg_21 = Negative(Value=num_44)
neg_22 = Negative(Value=addition_32)
merge_14 = Merge(Data1=pt_30, Data2=pt_31)
merge_15 = Merge(Data1=pt_32, Data2=pt_33)
merge_16 = Merge(Data1=pt_35, Data2=pt_36)
merge_17 = Merge(Data1=pt_37, Data2=pt_38)
X_10 = UnitX(Factor=addition_33)
deplane_2 = DeconstructPlane(Plane=pln_5)  # -> Origin, XAxis, YAxis, ZAxis
rectangle_14 = Rectangle(Plane=pln_5, XSize=neg_15, YSize=dom_9, Radius=0)  # -> Rectangle, Length
X_11 = UnitX(Factor=addition_33)
deplane_3 = DeconstructPlane(Plane=pln_7)  # -> Origin, XAxis, YAxis, ZAxis
rectangle_15 = Rectangle(Plane=pln_6, XSize=neg_16, YSize=num_32, Radius=0)  # -> Rectangle, Length
rectangle_16 = Rectangle(Plane=pln_7, XSize=neg_17, YSize=dom_10, Radius=0)  # -> Rectangle, Length
rectangle_17 = Rectangle(Plane=pt_29, XSize=neg_13, YSize=dom_7, Radius=0)  # -> Rectangle, Length
rectangle_18 = Rectangle(Plane=pln_8, XSize=neg_18, YSize=num_36, Radius=0)  # -> Rectangle, Length
rectangle_19 = Rectangle(Plane=pt_34, XSize=neg_13, YSize=dom_7, Radius=0)  # -> Rectangle, Length
rectangle_20 = Rectangle(Plane=pt_39, XSize=neg_13, YSize=dom_7, Radius=0)  # -> Rectangle, Length
X_12 = UnitX(Factor=addition_33)
neg_23 = Negative(Value=X_10)
X_13 = UnitX(Factor=addition_33)
neg_24 = Negative(Value=X_11)
neg_25 = Negative(Value=addition_21)
Y_3 = UnitY(Factor=division_13)
neg_26 = Negative(Value=addition_21)
neg_27 = Negative(Value=addition_24)
Y_4 = UnitY(Factor=division_15)
neg_28 = Negative(Value=addition_21)
neg_29 = Negative(Value=addition_24)
neg_30 = Negative(Value=addition_27)
Y_5 = UnitY(Factor=division_16)
neg_31 = Negative(Value=addition_24)
neg_32 = Negative(Value=addition_30)
Y_6 = UnitY(Factor=division_17)
neg_33 = Negative(Value=addition_24)
neg_34 = Negative(Value=X_12)
move_3 = Move(Geometry=merge_10, Motion=neg_23)  # -> Geometry, Transform
neg_35 = Negative(Value=X_13)
move_4 = Move(Geometry=merge_12, Motion=neg_24)  # -> Geometry, Transform
xz_3 = XZPlane(Origin=pln_6)
neg_36 = Negative(Value=Y_5)
line_4 = LineSDL(Start=pln_5, Direction=deplane_2.XAxis, Length=expr("x*2", neg_26))
move_5 = Move(Geometry=rectangle_15.Rectangle, Motion=Y_3)  # -> Geometry, Transform
line_5 = LineSDL(Start=pln_5, Direction=deplane_2.XAxis, Length=neg_25)
xz_4 = XZPlane(Origin=pln_8)
neg_37 = Negative(Value=Y_6)
line_6 = LineSDL(Start=pln_5, Direction=deplane_2.XAxis, Length=expr("x*3", neg_28))
line_7 = LineSDL(Start=pln_7, Direction=deplane_3.XAxis, Length=expr("x*2", neg_29))
move_6 = Move(Geometry=rectangle_18.Rectangle, Motion=Y_4)  # -> Geometry, Transform
line_8 = LineSDL(Start=pln_7, Direction=deplane_3.XAxis, Length=neg_27)
line_9 = LineSDL(Start=pln_7, Direction=deplane_3.XAxis, Length=expr("x*3", neg_31))
line_10 = LineSDL(Start=pln_7, Direction=deplane_3.XAxis, Length=expr("x*4", neg_33))
X_14 = UnitX(Factor=addition_36)
move_7 = Move(Geometry=merge_14, Motion=neg_34)  # -> Geometry, Transform
move_8 = Move(Geometry=merge_16, Motion=neg_35)  # -> Geometry, Transform
rectangle_21 = Rectangle(Plane=[merge_11, move_3.Geometry], XSize=neg_14, YSize=dom_8, Radius=0)  # -> Rectangle, Length
end_3 = EndPoints(Curve=line_5)  # -> Start, End
neg_38 = Negative(Value=X_14)
end_4 = EndPoints(Curve=line_4)  # -> Start, End
end_5 = EndPoints(Curve=line_8)  # -> Start, End
mirror_6 = Mirror(Geometry=move_5.Geometry, Plane=xz_3)  # -> Geometry, Transform
end_6 = EndPoints(Curve=line_6)  # -> Start, End
end_7 = EndPoints(Curve=line_7)  # -> Start, End
mirror_7 = Mirror(Geometry=move_6.Geometry, Plane=xz_4)  # -> Geometry, Transform
move_9 = Move(Geometry=rectangle_17.Rectangle, Motion=neg_38)  # -> Geometry, Transform
end_8 = EndPoints(Curve=line_9)  # -> Start, End
end_9 = EndPoints(Curve=line_10)  # -> Start, End
rectangle_22 = Rectangle(Plane=[move_7.Geometry, merge_15], XSize=neg_14, YSize=dom_8, Radius=0)  # -> Rectangle, Length
rectangle_23 = Rectangle(Plane=[move_8.Geometry, merge_17], XSize=neg_14, YSize=dom_8, Radius=0)  # -> Rectangle, Length
rectangle_24 = Rectangle(Plane=[merge_13, move_4.Geometry], XSize=neg_14, YSize=dom_8, Radius=0)  # -> Rectangle, Length
rectangle_25 = Rectangle(Plane=pt_24, XSize=neg_13, YSize=dom_7, Radius=0)  # -> Rectangle, Length
vec2pt_2 = Vector2Pt(PointA=end_3.Start, PointB=end_3.End, Unitize=False)  # -> Vector, Length
vec2pt_3 = Vector2Pt(PointA=end_4.Start, PointB=end_4.End, Unitize=False)  # -> Vector, Length
vec2pt_4 = Vector2Pt(PointA=end_5.Start, PointB=end_5.End, Unitize=False)  # -> Vector, Length
flip_41 = FlipCurve(Curve=mirror_6.Geometry)  # -> Curve, Flag
vec2pt_5 = Vector2Pt(PointA=end_6.Start, PointB=end_6.End, Unitize=False)  # -> Vector, Length
vec2pt_6 = Vector2Pt(PointA=end_7.Start, PointB=end_7.End, Unitize=False)  # -> Vector, Length
flip_42 = FlipCurve(Curve=mirror_7.Geometry)  # -> Curve, Flag
vec2pt_7 = Vector2Pt(PointA=end_8.Start, PointB=end_8.End, Unitize=False)  # -> Vector, Length
vec2pt_8 = Vector2Pt(PointA=end_9.Start, PointB=end_9.End, Unitize=False)  # -> Vector, Length
splitatcorners_5 = SplitAtCorners(Poly=move_9.Geometry, Angle=1)  # -> Corners, Parts
merge_18 = Merge(Data1=rectangle_22.Rectangle, Data2=rectangle_19.Rectangle)
merge_19 = Merge(Data1=rectangle_23.Rectangle, Data2=rectangle_20.Rectangle)
vdis_7 = VectorDisplay(Anchor=end_3.Start, Vector=vec2pt_2.Vector)
vdis_8 = VectorDisplay(Anchor=end_5.Start, Vector=vec2pt_4.Vector)
num_52 = Number(addition_36)
move_10 = Move(Geometry=rectangle_14.Rectangle, Motion=vec2pt_2.Vector)  # -> Geometry, Transform
move_11 = Move(Geometry=rectangle_14.Rectangle, Motion=vec2pt_3.Vector)  # -> Geometry, Transform
move_12 = Move(Geometry=rectangle_14.Rectangle, Motion=vec2pt_5.Vector)  # -> Geometry, Transform
move_13 = Move(Geometry=rectangle_16.Rectangle, Motion=vec2pt_4.Vector)  # -> Geometry, Transform
move_14 = Move(Geometry=rectangle_16.Rectangle, Motion=vec2pt_6.Vector)  # -> Geometry, Transform
move_15 = Move(Geometry=rectangle_16.Rectangle, Motion=vec2pt_7.Vector)  # -> Geometry, Transform
move_16 = Move(Geometry=rectangle_16.Rectangle, Motion=vec2pt_8.Vector)  # -> Geometry, Transform
merge_20 = Merge(Data1=rectangle_24.Rectangle, Data2=rectangle_25.Rectangle)
item_28 = ListItem(List=splitatcorners_5.Corners, Index=0, Wrap=True)
X_15 = UnitX(Factor=num_52)
boxrec_10 = BoxRectangle(Rectangle=merge_18, Height=num_49)
boxrec_11 = BoxRectangle(Rectangle=merge_19, Height=num_49)
scale_nu_5 = ScaleNU(Geometry=move_9.Geometry, Plane=item_28, ScaleX=Slider(0.5, range=0.1..1), ScaleY=1, ScaleZ=1)  # -> Geometry, Transform
merge_21 = Merge(Data1=rectangle_21.Rectangle, Data2=rectangle_17.Rectangle, Data3=scale_nu_5.Geometry)
boxrec_12 = BoxRectangle(Rectangle=merge_21, Height=num_49)
merge_22 = Merge(
    Data1=rectangle_14.Rectangle,
    Data2=move_10.Geometry,
    Data3=move_11.Geometry,
    Data4=move_12.Geometry,
    Data5=move_5.Geometry,
    Data6=flip_41.Curve)
neg_39 = Negative(Value=X_15)
merge_23 = Merge(
    Data1=rectangle_16.Rectangle,
    Data2=move_13.Geometry,
    Data3=move_14.Geometry,
    Data4=move_15.Geometry,
    Data5=move_6.Geometry,
    Data6=flip_42.Curve,
    Data7=move_16.Geometry)
move_17 = Move(Geometry=merge_20, Motion=neg_39)  # -> Geometry, Transform
boxrec_13 = BoxRectangle(Rectangle=merge_22, Height=num_33)
yz_5 = YZPlane(Origin=pt_18)
boxrec_14 = BoxRectangle(Rectangle=merge_23, Height=num_37)
yz_6 = YZPlane(Origin=pt_19)
boxrec_15 = BoxRectangle(Rectangle=[move_17.Geometry, merge_20], Height=num_49)
mirror_8 = Mirror(Geometry=boxrec_13, Plane=yz_5)  # -> Geometry, Transform
mirror_9 = Mirror(Geometry=boxrec_14, Plane=yz_6)  # -> Geometry, Transform
addition_40 = Addition(A=num_40, B=division_16)
addition_41 = Addition(A=num_44, B=division_17)
Y_7 = UnitY(Factor=addition_40)
Y_8 = UnitY(Factor=addition_41)
merge_24 = Merge(Data1=boxrec_13, Data2=mirror_8.Geometry)
merge_25 = Merge(Data1=boxrec_14, Data2=mirror_9.Geometry)
neg_40 = Negative(Value=Y_7)
neg_41 = Negative(Value=Y_8)

# ---- group: Surface: Base 1
srf_23 = Surface(<surface referenced from the Rhino model>)

# ----
contour_11 = Contour(Shape=srf_23, Point=Point(0, 0, 0), Direction=Vector(0, 0, 1), Distance=addition_2)
divdist_12 = DivideDistance(Curve=contour_11, Distance=division)  # -> Points, Tangents, Parameters
flip_43 = FlipMatrix(Data=divdist_12.Points)
dispatch_36 = Dispatch(List=flip_43, DispatchPattern=[True, False])  # -> ListA, ListB
points_16 = PointList(Points=flip_43)
pt_40 = Point(dispatch_36.ListA)
pt_41 = Point(dispatch_36.ListB)

# ---- group: Brick Length
num_53 = Number(brick_length)

# ---- group: Brick Depth
num_54 = Number(brick_depth)

# ---- group: Brick Heigth
num_55 = Number(brick_heigth)

# ---- group: Mortar Thickness
num_56 = Number(mortar_thickness)

# ----
flip_44 = FlipMatrix(Data=pt_40)
dispatch_37 = Dispatch(List=flatten(flip_44), DispatchPattern=[True, False])  # -> ListA, ListB
points_17 = PointList(Points=flatten(flip_44))
dom_13 = ConstructDomain(DomainStart=expr("-x/2", num_53), DomainEnd=expr("x/2", num_53))
neg_42 = Negative(Value=num_54)
dom_14 = ConstructDomain(DomainStart=expr("-x/2", num_54), DomainEnd=expr("x/2", num_54))
addition_42 = Addition(A=num_54, B=num_56)
neg_43 = Negative(Value=num_53)
pt_42 = Point(dispatch_37.ListA)
pt_43 = Point(dispatch_37.ListA)
neg_44 = Negative(Value=addition_42)
Y_9 = UnitY(Factor=neg_44)
rectangle_26 = Rectangle(Plane=pt_41, XSize=dom_14, YSize=neg_43, Radius=0)  # -> Rectangle, Length
move_18 = Move(Geometry=pt_43, Motion=Y_9)  # -> Geometry, Transform
rectangle_27 = Rectangle(Plane=[pt_42, move_18.Geometry], XSize=dom_13, YSize=neg_42, Radius=0)  # -> Rectangle, Length
boxrec_16 = BoxRectangle(Rectangle=[rectangle_27.Rectangle, rectangle_26.Rectangle], Height=num_55)

# ---- group: Get the brick aligning edge of the surface
number_slider_4 = Slider(3, range=0..10)
debrep_11 = DeconstructBrep(Brep=srf_19)  # -> Faces, Edges, Vertices

# ----
dom_15 = ConstructDomain(DomainStart=Slider(2, range=0..10), DomainEnd=number_slider_4)

# ---- group: Get the brick aligning edge of the surface (continued)
range_3 = Range(Domain=dom_15, Steps=Slider(1, range=0..10))
item_29 = ListItem(List=debrep_11.Edges, Index=range_3, Wrap=True)
join_13 = JoinCurves(Curves=item_29, Preserve=False)

# ----
item_30 = ListItem(List=debrep_11.Vertices, Index=Slider(3, range=0..12), Wrap=True)
ln_6 = Line(StartPoint=item_30, EndPoint=item_24)
curvepoint_5 = PointOnCurve(ln_6, parameter=0.5)

# ---- group: The number of bricks along the edge
len_8 = Length(Curve=join_13)
division_18 = Division(A=len_8, B=addition_28)
round_7 = Round(Number=division_18)  # -> Nearest, Floor, Ceiling
panel_9 = Panel(round_7.Floor)

# ----
pt_44 = Point(curvepoint_5)

# ---- group: Position of the bricks
pframes_9 = PerpFrames(Curve=join_13, Count=panel_9, Align=True)  # -> Frames, Parameters

# ---- group: Split the bricks into 2 layers
dispatch_38 = Dispatch(List=pframes_9.Frames, DispatchPattern=[True, False])  # -> ListA, ListB

# ----
pln_9 = Plane(dispatch_38.ListB)
pln_10 = Plane(dispatch_38.ListA)
deplane_4 = DeconstructPlane(Plane=pln_10)  # -> Origin, XAxis, YAxis, ZAxis
rectangle_28 = Rectangle(Plane=pln_10, XSize=neg_19, YSize=dom_11, Radius=0)  # -> Rectangle, Length
rectangle_29 = Rectangle(Plane=pln_9, XSize=neg_20, YSize=num_40, Radius=0)  # -> Rectangle, Length
xz_5 = XZPlane(Origin=pln_9)
move_19 = Move(Geometry=rectangle_29.Rectangle, Motion=neg_36)  # -> Geometry, Transform
line_11 = LineSDL(Start=pln_10, Direction=deplane_4.XAxis, Length=neg_30)
end_10 = EndPoints(Curve=line_11)  # -> Start, End
mirror_10 = Mirror(Geometry=move_19.Geometry, Plane=xz_5)  # -> Geometry, Transform
vec2pt_9 = Vector2Pt(PointA=end_10.Start, PointB=end_10.End, Unitize=False)  # -> Vector, Length
flip_45 = FlipCurve(Curve=mirror_10.Geometry)  # -> Curve, Flag
vdis_9 = VectorDisplay(Anchor=end_10.Start, Vector=vec2pt_9.Vector)
move_20 = Move(Geometry=rectangle_28.Rectangle, Motion=vec2pt_9.Vector)  # -> Geometry, Transform
boxrec_17 = BoxRectangle(Rectangle=[move_20.Geometry, rectangle_28.Rectangle, flip_45.Curve, move_19.Geometry], Height=num_41)
yz_7 = YZPlane(Origin=pt_44)
mirror_11 = Mirror(Geometry=boxrec_17, Plane=yz_7)  # -> Geometry, Transform
merge_26 = Merge(Data1=boxrec_17, Data2=mirror_11.Geometry)
move_21 = Move(Geometry=merge_26, Motion=neg_40)  # -> Geometry, Transform

# ---- group: Get the brick aligning edge of the surface
number_slider_5 = Slider(6, range=0..10)
debrep_12 = DeconstructBrep(Brep=srf_21)  # -> Faces, Edges, Vertices

# ----
dom_16 = ConstructDomain(DomainStart=Slider(5, range=0..10), DomainEnd=number_slider_5)

# ---- group: Get the brick aligning edge of the surface (continued)
range_4 = Range(Domain=dom_16, Steps=Slider(1, range=0..10))
item_31 = ListItem(List=debrep_12.Edges, Index=range_4, Wrap=True)
join_14 = JoinCurves(Curves=item_31, Preserve=False)

# ----
item_32 = ListItem(List=debrep_12.Vertices, Index=Slider(3, range=0..12), Wrap=True)
ln_7 = Line(StartPoint=item_32, EndPoint=item_25)
curvepoint_6 = PointOnCurve(ln_7, parameter=0.5)
offset = OffsetCurve(Curve=join_14, Distance="0.15", Plane=PlaneXY(0, 0, 0), Corners=1)

# ---- group: The number of bricks along the edge
len_9 = Length(Curve=offset)
division_19 = Division(A=len_9, B=addition_31)
round_8 = Round(Number=division_19)  # -> Nearest, Floor, Ceiling
panel_10 = Panel(round_8.Floor)

# ----
pt_45 = Point(curvepoint_6)

# ---- group: Position of the bricks
flip_46 = FlipCurve(Curve=offset)  # -> Curve, Flag
pframes_10 = PerpFrames(Curve=flip_46.Curve, Count=panel_10, Align=True)  # -> Frames, Parameters

# ---- group: Split the bricks into 2 layers
dispatch_39 = Dispatch(List=pframes_10.Frames, DispatchPattern=[True, False])  # -> ListA, ListB

# ----
pln_11 = Plane(dispatch_39.ListB)
pln_12 = Plane(dispatch_39.ListA)
deplane_5 = DeconstructPlane(Plane=pln_12)  # -> Origin, XAxis, YAxis, ZAxis
rectangle_30 = Rectangle(Plane=pln_12, XSize=neg_21, YSize=dom_12, Radius=0)  # -> Rectangle, Length
rectangle_31 = Rectangle(Plane=pln_11, XSize=neg_22, YSize=num_44, Radius=0)  # -> Rectangle, Length
xz_6 = XZPlane(Origin=pln_11)
move_22 = Move(Geometry=rectangle_31.Rectangle, Motion=neg_37)  # -> Geometry, Transform
line_12 = LineSDL(Start=pln_12, Direction=deplane_5.XAxis, Length=neg_32)
end_11 = EndPoints(Curve=line_12)  # -> Start, End
mirror_12 = Mirror(Geometry=move_22.Geometry, Plane=xz_6)  # -> Geometry, Transform
vec2pt_10 = Vector2Pt(PointA=end_11.Start, PointB=end_11.End, Unitize=False)  # -> Vector, Length
flip_47 = FlipCurve(Curve=mirror_12.Geometry)  # -> Curve, Flag
vdis_10 = VectorDisplay(Anchor=end_11.Start, Vector=vec2pt_10.Vector)
move_23 = Move(Geometry=rectangle_30.Rectangle, Motion=vec2pt_10.Vector)  # -> Geometry, Transform
boxrec_18 = BoxRectangle(Rectangle=[move_23.Geometry, rectangle_30.Rectangle, flip_47.Curve, move_22.Geometry], Height=num_45)
yz_8 = YZPlane(Origin=pt_45)
mirror_13 = Mirror(Geometry=boxrec_18, Plane=yz_8)  # -> Geometry, Transform
merge_27 = Merge(Data1=boxrec_18, Data2=mirror_13.Geometry)
move_24 = Move(Geometry=merge_27, Motion=neg_41)  # -> Geometry, Transform
