# Grasshopper definition Brick Laying_main structure.gh (Grasshopper 1.0.7)
# plug-ins: Bifocals, Kangaroo2 Components

# ---- group: Surface: Base 1
# 1. Brick laying: Based wall 60 cm in length (Side walls)
# Input surfaces
srf = Surface(<surface referenced from the Rhino model>)

# ---- group: Surface: Base 2
srf_2 = Surface(<surface referenced from the Rhino model>)

# ---- group: Brick Dimension
brick_depth = Slider(0.14, range=0.005..0.5)
brick_heigth = Slider(0.05, range=0.005..0.5)
brick_length = Slider(0.29, range=0.005..0.5)
# Adjusting the dimension of the bricks...
# 2. Brick laying: Corner bases
mortar_thickness = Slider(0.01, range=0.005..0.1)

# ---- group: Surface: Base 3
# Input surfaces
srf_3 = Surface(<surface referenced from the Rhino model>)

# ---- group: Surface: Base 4
srf_4 = Surface(<surface referenced from the Rhino model>)

# ---- group: Surface: Base 5
# 3. Brick laying: Base wall 30cm in length (End wall)
srf_5 = Surface(<surface referenced from the Rhino model>)

# ---- group: Opening curve 1
# 4. Opening arches
crv = Curve(<curve referenced from the Rhino model>)

# ---- group: Opening curve 2
crv_2 = Curve(<curve referenced from the Rhino model>)

# ---- group: Surface: Side
# 5. Upper wall: Side walls
srf_6 = Surface(<surface referenced from the Rhino model>)

# ---- group: Surface: Corner 1 (Wall 3)
# 6. Upper wall: Corner walls
srf_7 = Surface(<surface referenced from the Rhino model>)

# ---- group: Surface: Corner 2 (Wall 4)
srf_8 = Surface(<surface referenced from the Rhino model>)

# ---- group: Surface: End
# 7. Upper wall: End wall
srf_9 = Surface(<surface referenced from the Rhino model>)

# ---- group: Surface: Main arch
# 8. Main arch
srf_10 = Surface(<surface referenced from the Rhino model>)

# ---- group: Surface: Roofs first half
# 9. Nubian vault
srf_11 = Surface(<surface referenced from the Rhino model>)

# ---- group: Surface: Roofs second half
srf_12 = Surface(<surface referenced from the Rhino model>)

# ---- group: Curve: Corner
# 10. Rib arches
crv_3 = Curve(<curve referenced from the Rhino model>)

# ---- group: Surface 1: Full
srf_13 = Surface(<surface referenced from the Rhino model>)

# ---- group: Brick Depth
num = Number(brick_depth)

# ---- group: Brick Heigth
num_2 = Number(brick_heigth)

# ---- group: Brick Length
num_3 = Number(brick_length)

# ----
number_slider = Slider(0.15, range=0.15..0.5)
neg = Negative(Value=num_3)

# ---- group: Brick Depth
num_4 = Number(brick_depth)

# ---- group: Brick Heigth
num_5 = Number(brick_heigth)

# ---- group: Brick Length
num_6 = Number(brick_length)

# ---- group: Mortar Thickness
num_7 = Number(mortar_thickness)

# ----
number_slider_2 = Slider(17, range=0..100)
brick_depth_2 = Number(brick_depth)
brick_length_2 = Number(brick_length)
brick_heigth_2 = Number(brick_heigth)

# ---- group: Brick Depth
num_8 = Number(brick_depth)

# ---- group: Brick Heigth
num_9 = Number(brick_heigth)

# ---- group: Brick Length
num_10 = Number(brick_length)

# ---- group: Mortar Thickness
num_11 = Number(mortar_thickness)

# ---- group: Brick Depth
num_12 = Number(brick_depth)

# ---- group: Brick Heigth
num_13 = Number(brick_heigth)

# ---- group: Brick Length
num_14 = Number(brick_length)

# ---- group: Mortar Thickness
num_15 = Number(mortar_thickness)

# ----
neg_2 = Negative(Value=num)
dom = ConstructDomain(DomainStart=expr("-x/2", neg), DomainEnd=expr("x/2", neg))

# ---- group: Brick Depth
num_16 = Number(brick_depth)

# ---- group: Brick Heigth
num_17 = Number(brick_heigth)

# ---- group: Brick Length
num_18 = Number(brick_length)

# ---- group: Mortar Thickness
num_19 = Number(mortar_thickness)

# ---- group: Brick Depth
num_20 = Number(brick_depth)

# ---- group: Brick Heigth
num_21 = Number(brick_heigth)

# ---- group: Brick Length
num_22 = Number(brick_length)

# ---- group: Mortar Thickness
num_23 = Number(mortar_thickness)

# ---- group: Brick Depth
num_24 = Number(brick_depth)

# ---- group: Brick Heigth
num_25 = Number(brick_heigth)

# ---- group: Brick Length
# 11. End Roof
num_26 = Number(brick_length)

# ---- group: Brick Depth
num_27 = Number(brick_depth)

# ---- group: Brick Heigth
num_28 = Number(brick_heigth)

# ---- group: Brick Length
num_29 = Number(brick_length)

# ---- group: Mortar Thickness
num_30 = Number(mortar_thickness)

# ----
edges = BrepEdges(Brep=srf_10)  # -> Naked, Interior, NonManifold

# ---- group: Surface: Corner
srf_14 = Surface(<surface referenced from the Rhino model>)

# ---- group: Surface: End Corner
srf_15 = Surface(<surface referenced from the Rhino model>)

# ---- group: Brick Depth
num_31 = Number(brick_depth)

# ---- group: Brick Heigth
num_32 = Number(brick_heigth)

# ---- group: Brick Length
num_33 = Number(brick_length)

# ---- group: Mortar Thickness
num_34 = Number(mortar_thickness)

# ---- group: Surface: End Corner
srf_16 = Surface(<surface referenced from the Rhino model>)

# ---- group: Brick Depth
num_35 = Number(brick_depth)

# ---- group: Brick Heigth
num_36 = Number(brick_heigth)

# ---- group: Brick Length
num_37 = Number(brick_length)

# ---- group: Mortar Thickness
num_38 = Number(mortar_thickness)

# ---- group: I will be back... / Surface: End Corner
srf_17 = Surface(<surface referenced from the Rhino model>)

# ----
addition = Addition(A=brick_depth, B=mortar_thickness)

# ---- group: Brick Depth + Mortar
num_39 = Number(addition)

# ---- group: Depth + Mortar
num_40 = Number(addition)

# ----
division = Division(A=num_40, B="2")
addition_2 = Addition(A=brick_heigth, B=mortar_thickness)

# ---- group: Brick Heigth + Mortar
num_41 = Number(addition_2)

# ----
contour = Contour(Shape=srf_3, Point=Point(0, 0, 0), Direction=Vector(0, 0, 1), Distance=num_41)
contour_2 = Contour(Shape=srf_4, Point=Point(0, 0, 0), Direction=Vector(0, 0, 1), Distance=num_41)
addition_3 = Addition(A=brick_length, B=mortar_thickness)

# ---- group: Brick Length + Mortar
num_42 = Number(addition_3)

# ----
addition_4 = Addition(A=num_12, B=num_15)
addition_5 = Addition(A=num_13, B=num_15)
addition_6 = Addition(A=num_14, B=num_15)
dom_2 = ConstructDomain(DomainStart=expr("-x/2", brick_depth_2), DomainEnd=expr("x/2", brick_depth_2))
addition_7 = Addition(A=num_4, B=num_7)
addition_8 = Addition(A=num_5, B=num_7)
addition_9 = Addition(A=num_6, B=num_7)
division_2 = Division(A=num_42, B="2")
addition_10 = Addition(A=num_28, B=num_30)

# ---- group: Getting the vertical stack of the brick
# Get the vertical stack of the bricks
edges_2 = BrepEdges(Brep=srf_13)  # -> Naked, Interior, NonManifold
item = ListItem(List=edges_2.Naked, Index=Slider(2, range=0..3), Wrap=True)
item_2 = ListItem(List=edges_2.Naked, Index=Slider(0, range=0..3), Wrap=True)
flip = FlipCurve(Curve=item)  # -> Curve, Flag
divdist = DivideDistance(Curve=flip.Curve, Distance=addition_10)  # -> Points, Tangents, Parameters
divdist_2 = DivideDistance(Curve=item_2, Distance=addition_10)  # -> Points, Tangents, Parameters
ln = Line(StartPoint=divdist.Points, EndPoint=divdist_2.Points)

# ----
addition_11 = Addition(A=num_29, B=num_30)
addition_12 = Addition(A=num_9, B=num_11)
addition_13 = Addition(A=num_10, B=num_11)
addition_14 = Addition(A=num_8, B=num_11)
addition_15 = Addition(A=num_17, B=num_19)
addition_16 = Addition(A=num_18, B=num_19)
neg_3 = Negative(Value=num_24)
dom_3 = ConstructDomain(DomainStart=expr("-x/2", num_26), DomainEnd=expr("x/2", num_26))
offset = OffsetCurve(Curve=crv, Distance=division, Plane=PlaneXY(0, 0, 0), Corners=1)
offset_2 = OffsetCurve(Curve=crv_2, Distance=division, Plane=PlaneXY(0, 0, 0), Corners=1)

# ---- group: Position of brick
# Get the position of the brick
pframes = PerpFrames(Curve=crv_3, Count=Slider(55, range=1..100), Align=True)  # -> Frames, Parameters
split = SplitList(List=pframes.Frames, Index="53")  # -> ListA, ListB

# ----
contour_3 = Contour(Shape=srf, Point=Point(0, 0, 0), Direction=Vector(0, 0, 1), Distance=addition_2)
contour_4 = Contour(Shape=srf_2, Point=Point(0, 0, 0), Direction=Vector(0, 0, 1), Distance=addition_2)
addition_17 = Addition(A=num_21, B=num_23)
addition_18 = Addition(A=num_22, B=num_23)
Y = UnitY(Factor=1)
contour_5 = Contour(Shape=srf_5, Point=Point(0, 0, 0), Direction=Vector(0, 0, 1), Distance=addition_8)
addition_19 = Addition(A=num_32, B=num_34)
addition_20 = Addition(A=num_33, B=num_34)
division_3 = Division(A=addition_6, B="2")
item_3 = ListItem(List=edges.Naked, Index=Slider(3, range=0..3), Wrap=True)
item_4 = ListItem(List=edges.Naked, Index=1, Wrap=True)
addition_21 = Addition(A=num_31, B=num_34)
addition_22 = Addition(A=num_36, B=num_38)
addition_23 = Addition(A=num_37, B=num_38)
division_4 = Division(A=addition_11, B="2")
division_5 = Division(A=addition_3, B="2")
divdist_3 = DivideDistance(Curve=contour, Distance=division_2)  # -> Points, Tangents, Parameters
divdist_4 = DivideDistance(Curve=contour_2, Distance=division_2)  # -> Points, Tangents, Parameters
division_6 = Division(A=addition_13, B="2")
contour_6 = Contour(Shape=srf_15, Point=Point(0, 0, 0), Direction=Vector(0, 0, 1), Distance=addition_22)
dom_4 = ConstructDomain(DomainStart=expr("-x/2", num_6), DomainEnd=expr("x/2", num_6))
contour_7 = Contour(Shape=srf_16, Point=Point(0, 0, 0), Direction=Vector(0, 0, 1), Distance=addition_22)
neg_4 = Negative(Value=num_4)
division_7 = Division(A=addition_9, B="2")
contour_8 = Contour(Shape=srf_7, Point=Point(0, 0, 0), Direction=Vector(0, 0, 1), Distance=addition_5)
contour_9 = Contour(Shape=srf_8, Point=Point(0, 0, 0), Direction=Vector(0, 0, 1), Distance=addition_5)
contour_10 = Contour(Shape=srf_9, Point=Point(0, 0, 0), Direction=Vector(0, 0, 1), Distance=addition_5)
divdist_5 = DivideDistance(Curve=contour_3, Distance=division_5)  # -> Points, Tangents, Parameters
divdist_6 = DivideDistance(Curve=contour_4, Distance=division_5)  # -> Points, Tangents, Parameters
flip_2 = FlipCurve(Curve=item_3)  # -> Curve, Flag
divdist_7 = DivideDistance(Curve=item_4, Distance=addition_15)  # -> Points, Tangents, Parameters
division_8 = Division(A=addition_20, B="2")
division_9 = Division(A=addition_16, B="2")
division_10 = Division(A=addition_23, B="2")
item_5 = ListItem(List=edges.Naked, Index=Slider(2, range=0..3), Wrap=True)
dispatch = Dispatch(List=flatten(divdist_3.Points), DispatchPattern=[True, False])  # -> ListA, ListB
dispatch_2 = Dispatch(List=flatten(divdist_4.Points), DispatchPattern=[True, False])  # -> ListA, ListB
points = PointList(Points=pframes.Frames)
flip_3 = FlipCurve(Curve=contour_6)  # -> Curve, Flag
flip_4 = FlipCurve(Curve=contour_8)  # -> Curve, Flag
divdist_8 = DivideDistance(Curve=contour_5, Distance=division_7)  # -> Points, Tangents, Parameters
flip_5 = FlipCurve(Curve=contour_7)  # -> Curve, Flag
division_11 = Division(A=addition_18, B="2")

# ---- group: Getting the center of bricks rotation angle
room_length = Slider(1.8, range=0.01..9)
# Get the center of brick rotation angle
number_slider_3 = Slider(1, range=0..3)
item_6 = ListItem(List=edges_2.Naked, Index=number_slider_3, Wrap=True)
division_12 = Division(A=room_length, B="2")
end = EndPoints(Curve=item)  # -> Start, End
end_2 = EndPoints(Curve=item_6)  # -> Start, End
pt = Point(end.End)
pt_2 = Point(end_2.End)
dist = Distance(PointA=pt, PointB=pt_2)
ln_2 = Line(StartPoint=pt, EndPoint=pt_2)
X = UnitX(Factor=1)
angle = Angle(VectorA=ln_2, VectorB=X)  # -> Angle, Reflex
expression = Expression(x=angle.Angle, Expression="sin(x)")
multiplication = Multiplication(A=dist, B=expression)
Z = UnitZ(Factor=multiplication)
move = Move(Geometry=item_6, Motion=expr("-x", Z))  # -> Geometry, Transform
X_2 = UnitX(Factor=division_12)
move_2 = Move(Geometry=move.Geometry, Motion=X_2)  # -> Geometry, Transform
flip_6 = FlipCurve(Curve=move_2.Geometry)  # -> Curve, Flag

# ----
contour_11 = Contour(Shape=srf_6, Point=Point(0, 0, 0), Direction=Vector(0, 0, 1), Distance=addition_12)
end_3 = EndPoints(Curve=item_4)  # -> Start, End
divdist_9 = DivideDistance(Curve=flip_2.Curve, Distance=addition_15)  # -> Points, Tangents, Parameters
divdist_10 = DivideDistance(Curve=flip_3.Curve, Distance=division_10)  # -> Points, Tangents, Parameters
divdist_11 = DivideDistance(Curve=flip_5.Curve, Distance=division_10)  # -> Points, Tangents, Parameters
divdist_12 = DivideDistance(Curve=flip_4.Curve, Distance=division_3)  # -> Points, Tangents, Parameters
divdist_13 = DivideDistance(Curve=contour_9, Distance=division_3)  # -> Points, Tangents, Parameters
divdist_14 = DivideDistance(Curve=contour_10, Distance=division_3)  # -> Points, Tangents, Parameters
dispatch_3 = Dispatch(List=flatten(divdist_8.Points), DispatchPattern=[True, False])  # -> ListA, ListB
points_2 = PointList(Points=flatten(divdist_10.Points))
points_3 = PointList(Points=flatten(divdist_11.Points))
divdist_15 = DivideDistance(Curve=contour_11, Distance=division_6)  # -> Points, Tangents, Parameters
Y_2 = UnitY(Factor=1)
ln_3 = Line(StartPoint=end_3.Start, EndPoint=end_3.End)
ln_4 = Line(StartPoint=divdist_7.Points, EndPoint=divdist_9.Points)
dom_5 = ConstructDomain(DomainStart=expr("-x/2", brick_length), DomainEnd=expr("x/2", brick_length))
flip_7 = FlipMatrix(Data=divdist_13.Points)
neg_5 = Negative(Value=brick_depth)
flip_8 = FlipMatrix(Data=divdist_12.Points)
dispatch_4 = Dispatch(List=divdist_10.Points, DispatchPattern=[True, False])  # -> ListA, ListB
dispatch_5 = Dispatch(List=divdist_10.Tangents, DispatchPattern=[True, False])  # -> ListA, ListB
flip_9 = FlipMatrix(Data=divdist_14.Points)

# ----
# Make the bricks
pln = Plane(split.ListA)
rectangle = Rectangle(Plane=pln, XSize=neg_3, YSize=dom_3, Radius=0)  # -> Rectangle, Length
boxrec = BoxRectangle(Rectangle=rectangle.Rectangle, Height=num_25)

dispatch_6 = Dispatch(List=divdist_11.Points, DispatchPattern=[True, False])  # -> ListA, ListB
dispatch_7 = Dispatch(List=divdist_11.Tangents, DispatchPattern=[True, False])  # -> ListA, ListB
points_4 = PointList(Points=flatten(divdist_5.Points))
contour_12 = Contour(Shape=srf_14, Point=Point(0, 0, 0), Direction=Vector(0, 0, 1), Distance=addition_19)
pt_3 = Point(dispatch_3.ListA)
flip_10 = FlipMatrix(Data=divdist_15.Points)

# ---- group: Left half of the arch
pframes_2 = PerpFrames(Curve=offset_2, Count=number_slider_2, Align=True)  # -> Frames, Parameters
rectangle_2 = Rectangle(Plane=pframes_2.Frames, XSize=dom_2, YSize=brick_length_2, Radius=0)  # -> Rectangle, Length

# ---- group: Right half of the arch
pframes_3 = PerpFrames(Curve=offset, Count=number_slider_2, Align=True)  # -> Frames, Parameters
neg_6 = Negative(Value=brick_length_2)
rectangle_3 = Rectangle(Plane=pframes_3.Frames, XSize=dom_2, YSize=neg_6, Radius=0)  # -> Rectangle, Length

# ----
points_5 = PointList(Points=flatten(flip_7))
dispatch_8 = Dispatch(List=flatten(flip_7), DispatchPattern=[True, False])  # -> ListA, ListB
divdist_16 = DivideDistance(Curve=ln_4, Distance=division_9)  # -> Points, Tangents, Parameters
flip_11 = FlipMatrix(Data=dispatch_4.ListA)
flip_12 = FlipMatrix(Data=dispatch_5.ListA)
flip_13 = FlipMatrix(Data=dispatch_6.ListA)
flip_14 = FlipMatrix(Data=dispatch_5.ListB)
points_6 = PointList(Points=flatten(flip_8))
flip_15 = FlipMatrix(Data=dispatch_7.ListA)
dispatch_9 = Dispatch(List=flatten(flip_8), DispatchPattern=[True, False])  # -> ListA, ListB
flip_16 = FlipMatrix(Data=dispatch_4.ListB)
flip_17 = FlipMatrix(Data=dispatch_7.ListB)
dispatch_10 = Dispatch(List=flatten(flip_9), DispatchPattern=[True, False])  # -> ListA, ListB
flip_18 = FlipMatrix(Data=dispatch_6.ListB)
# First brick layer
points_7 = PointList(Points=flatten(flip_9))
angle_2 = Angle(VectorA=ln_3, VectorB=Y_2)  # -> Angle, Reflex
points_8 = PointList(Points=flatten(flip_10))
len = Length(Curve=ln_3)
divdist_17 = DivideDistance(Curve=contour_12, Distance=division_8)  # -> Points, Tangents, Parameters
dispatch_11 = Dispatch(List=flatten(flip_11), DispatchPattern=[True, False])  # -> ListA, ListB
dispatch_12 = Dispatch(List=flatten(flip_12), DispatchPattern=[True, False])  # -> ListA, ListB
dispatch_13 = Dispatch(List=flatten(flip_14), DispatchPattern=[True, False])  # -> ListA, ListB
dispatch_14 = Dispatch(List=flatten(flip_13), DispatchPattern=[True, False])  # -> ListA, ListB
dispatch_15 = Dispatch(List=flatten(flip_16), DispatchPattern=[True, False])  # -> ListA, ListB
dispatch_16 = Dispatch(List=flatten(flip_15), DispatchPattern=[True, False])  # -> ListA, ListB
dispatch_17 = Dispatch(List=flatten(flip_17), DispatchPattern=[True, False])  # -> ListA, ListB
dispatch_18 = Dispatch(List=flatten(flip_18), DispatchPattern=[True, False])  # -> ListA, ListB

# ---- group: Wall 3: Second layer
# Surface 4: First brick layer
Y_3 = UnitY(Factor=num_39)
neg_7 = Negative(Value=Y_3)
pt_4 = Point(dispatch.ListB)
move_3 = Move(Geometry=pt_4, Motion=neg_7)  # -> Geometry, Transform
path_mapper = PathMapper(move_3.Geometry, source="{A} (i)", target="(floor(i%3))")
flip_19 = FlipMatrix(Data=path_mapper)
neg_8 = Negative(Value=num)
rectangle_4 = Rectangle(Plane=flip_19, XSize=dom, YSize=neg_8, Radius=0)  # -> Rectangle, Length
points_9 = PointList(Points=flip_19)
number_slider_4 = Slider(1, range=0..4)
item_7 = ListItem(List=flip_19, Index=number_slider_4, Wrap=True)
rectangle_5 = Rectangle(Plane=item_7, XSize=dom, YSize=neg_8, Radius=0)  # -> Rectangle, Length
splitatcorners = SplitAtCorners(Poly=rectangle_5.Rectangle, Angle=1)  # -> Corners, Parts
item_8 = ListItem(List=splitatcorners.Corners, Index=Slider(3, range=0..4), Wrap=True)
scale_nu = ScaleNU(Geometry=rectangle_5.Rectangle, Plane=item_8, ScaleX=Slider(0.5, range=0.05..1), ScaleY=1, ScaleZ=1)  # -> Geometry, Transform
replace = ReplaceItems(List=rectangle_4.Rectangle, Item=scale_nu.Geometry, Indices=number_slider_4, Wrap=False)

# ---- group: Wall 4: First layer
# Surface 4: Second brick layer
pt_5 = Point(dispatch_2.ListB)
points_10 = PointList(Points=pt_5)
path_mapper_2 = PathMapper(pt_5, source="{A} (i)", target="(floor(i%3))")
number_slider_5 = Slider(2, range=0..4)
flip_20 = FlipMatrix(Data=path_mapper_2)
item_9 = ListItem(List=flip_20, Index=number_slider_5, Wrap=True)
rectangle_6 = Rectangle(Plane=item_9, XSize=neg_2, YSize=dom, Radius=0)  # -> Rectangle, Length
rectangle_7 = Rectangle(Plane=flip_20, XSize=neg_2, YSize=dom, Radius=0)  # -> Rectangle, Length
splitatcorners_2 = SplitAtCorners(Poly=rectangle_6.Rectangle, Angle=1)  # -> Corners, Parts
item_10 = ListItem(List=splitatcorners_2.Corners, Index=Slider(3, range=0..4), Wrap=True)
scale_nu_2 = ScaleNU(Geometry=rectangle_6.Rectangle, Plane=item_10, ScaleX=1, ScaleY=Slider(0.5, range=0.05..1), ScaleZ=1)  # -> Geometry, Transform
replace_2 = ReplaceItems(List=rectangle_7.Rectangle, Item=scale_nu_2.Geometry, Indices=number_slider_5, Wrap=False)

# ----
X_3 = UnitX(Factor=addition_7)
neg_9 = Negative(Value=X_3)
# Surface 5: Second brick layer
pt_6 = Point(dispatch_3.ListB)
move_4 = Move(Geometry=pt_6, Motion=neg_9)  # -> Geometry, Transform
path_mapper_3 = PathMapper(move_4.Geometry, source="{A} (i)", target="(floor(i%5))")
flip_21 = FlipMatrix(Data=path_mapper_3)
points_11 = PointList(Points=flip_21)
panel = Panel([Slider(2, range=0..4), Slider(4, range=0..4)])
rectangle_8 = Rectangle(Plane=flip_21, XSize=neg_4, YSize=dom_4, Radius=0)  # -> Rectangle, Length
item_11 = ListItem(List=rectangle_8.Rectangle, Index=panel, Wrap=True)
dispatch_19 = Dispatch(List=item_11, DispatchPattern=[True, False])  # -> ListA, ListB
crv_4 = Curve(dispatch_19.ListA)
crv_5 = Curve(dispatch_19.ListB)
splitatcorners_3 = SplitAtCorners(Poly=crv_4, Angle=1)  # -> Corners, Parts
splitatcorners_4 = SplitAtCorners(Poly=crv_5, Angle=1)  # -> Corners, Parts
item_12 = ListItem(List=splitatcorners_3.Corners, Index=Slider(2, range=0..4), Wrap=True)
item_13 = ListItem(List=splitatcorners_4.Corners, Index=Slider(3, range=0..4), Wrap=True)
scale_nu_3 = ScaleNU(Geometry=crv_4, Plane=item_12, ScaleX=1, ScaleY=Slider(0.5, range=0.01..1), ScaleZ=1)  # -> Geometry, Transform
scale_nu_4 = ScaleNU(Geometry=crv_5, Plane=item_13, ScaleX=1, ScaleY=Slider(0.5, range=0.01..1), ScaleZ=1)  # -> Geometry, Transform
replace_3 = ReplaceItems(List=rectangle_8.Rectangle, Item=[scale_nu_3.Geometry, scale_nu_4.Geometry], Indices=panel, Wrap=False)

# ----
# Surface 5: First brick layer
path_mapper_4 = PathMapper(pt_3, source="{A} (i)", target="(floor(i%5))")
flip_22 = FlipMatrix(Data=path_mapper_4)
rectangle_9 = Rectangle(Plane=flip_22, XSize=neg_4, YSize=dom_4, Radius=0)  # -> Rectangle, Length
points_12 = PointList(Points=flip_22)
panel_2 = Panel([Slider(0, range=0..4), Slider(2, range=0..4)])
item_14 = ListItem(List=rectangle_9.Rectangle, Index=panel_2, Wrap=True)
dispatch_20 = Dispatch(List=item_14, DispatchPattern=[True, False])  # -> ListA, ListB
crv_6 = Curve(dispatch_20.ListA)
crv_7 = Curve(dispatch_20.ListB)
splitatcorners_5 = SplitAtCorners(Poly=crv_6, Angle=1)  # -> Corners, Parts
splitatcorners_6 = SplitAtCorners(Poly=crv_7, Angle=1)  # -> Corners, Parts
item_15 = ListItem(List=splitatcorners_5.Corners, Index=Slider(2, range=0..4), Wrap=True)
item_16 = ListItem(List=splitatcorners_6.Corners, Index=Slider(3, range=0..4), Wrap=True)
scale_nu_5 = ScaleNU(Geometry=crv_6, Plane=item_15, ScaleX=1, ScaleY=Slider(0.5, range=0.01..1), ScaleZ=1)  # -> Geometry, Transform
scale_nu_6 = ScaleNU(Geometry=crv_7, Plane=item_16, ScaleX=1, ScaleY=Slider(0.5, range=0.01..1), ScaleZ=1)  # -> Geometry, Transform
replace_4 = ReplaceItems(List=rectangle_9.Rectangle, Item=[scale_nu_5.Geometry, scale_nu_6.Geometry], Indices=panel_2, Wrap=False)

# ---- group: Wall 3: First layer
# Surface 3: Second brick layer
pt_7 = Point(dispatch.ListA)
dom_6 = ConstructDomain(DomainStart=expr("-x/2", num_3), DomainEnd=expr("x/2", num_3))
# Surface 3: First brick layer
path_mapper_5 = PathMapper(pt_7, source="{A} (i)", target="(floor(i%3))")
neg_10 = Negative(Value=num)
number_slider_6 = Slider(0, range=0..4)
flip_23 = FlipMatrix(Data=path_mapper_5)
points_13 = PointList(Points=flip_23)
item_17 = ListItem(List=flip_23, Index=number_slider_6, Wrap=True)
rectangle_10 = Rectangle(Plane=flip_23, XSize=dom_6, YSize=neg_10, Radius=0)  # -> Rectangle, Length
rectangle_11 = Rectangle(Plane=item_17, XSize=dom_6, YSize=neg_10, Radius=0)  # -> Rectangle, Length
splitatcorners_7 = SplitAtCorners(Poly=rectangle_11.Rectangle, Angle=1)  # -> Corners, Parts
item_18 = ListItem(List=splitatcorners_7.Corners, Index=Slider(3, range=0..4), Wrap=True)
scale_nu_7 = ScaleNU(Geometry=rectangle_11.Rectangle, Plane=item_18, ScaleX=Slider(0.5, range=0.05..1), ScaleY=1, ScaleZ=1)  # -> Geometry, Transform
replace_5 = ReplaceItems(List=rectangle_10.Rectangle, Item=scale_nu_7.Geometry, Indices=number_slider_6, Wrap=False)

# ----
dispatch_21 = Dispatch(List=flatten(divdist_16.Points), DispatchPattern=[True, False])  # -> ListA, ListB

# ---- group: Second brick layer
X_4 = UnitX(Factor=addition_21)
neg_11 = Negative(Value=X_4)
# Second brick layer
pt_8 = Point(dispatch_10.ListB)
move_5 = Move(Geometry=pt_8, Motion=neg_11)  # -> Geometry, Transform

# ----
expression_2 = Expression(x=angle_2.Angle, Expression="sin(x)")
flip_24 = FlipMatrix(Data=divdist_17.Points)
flip_25 = FlipMatrix(Data=divdist_17.Tangents)
offset_3 = OffsetCurve(Curve=contour_12, Distance=addition_21, Plane=PlaneXY(0, 0, 0), Corners=1)
pt_9 = Point(dispatch_11.ListA)
pt_10 = Point(dispatch_14.ListB)
pt_11 = Point(dispatch_15.ListB)
pt_12 = Point(dispatch_18.ListA)
amp = Amplitude(Vector=dispatch_12.ListA, Amplitude=Slider(0.2, range=0.1..0.5))

# ----
# First brick layer
dispatch_22 = Dispatch(List=flatten(flip_10), DispatchPattern=[True, False])  # -> ListA, ListB
pt_13 = Point(dispatch_22.ListA)

# ---- group: First brick layer
pt_14 = Point(dispatch_10.ListA)

# ----
amp_2 = Amplitude(Vector=dispatch_16.ListB, Amplitude=Slider(0.2, range=0.1..0.5))

Y_4 = UnitY(Factor=addition_14)
# Second brick layer
pt_15 = Point(dispatch_22.ListB)
neg_12 = Negative(Value=Y_4)
move_6 = Move(Geometry=pt_15, Motion=neg_12)  # -> Geometry, Transform

multiplication_2 = Multiplication(A=len, B=expression_2)
dispatch_23 = Dispatch(List=flatten(flip_24), DispatchPattern=[True, False])  # -> ListA, ListB
X_5 = UnitX(Factor=1)
dispatch_24 = Dispatch(List=flatten(flip_25), DispatchPattern=[True, False])  # -> ListA, ListB
points_14 = PointList(Points=flatten(flip_24))
X_6 = UnitX(Factor=1)
amp_3 = Amplitude(Vector=dispatch_13.ListB, Amplitude=Slider(0.2, range=0.1..0.5))
amp_4 = Amplitude(Vector=dispatch_17.ListA, Amplitude=Slider(0.2, range=0.1..0.5))

# ----
# Generate similar data structure as the rotation points
divdist_18 = DivideDistance(Curve=ln, Distance=division_4)  # -> Points, Tangents, Parameters
flip_26 = FlipMatrix(Data=divdist_18.Points)
cull = CullPattern(List=flatten(flip_26), CullPattern=[True, False])
path_mapper_6 = PathMapper(cull, source="{a} (i)", target="{floor(i/14.5)}")
# Rotation points
pt_16 = Point(path_mapper_6)
flip_27 = FlipMatrix(Data=pt_16)

divdist_19 = DivideDistance(Curve=offset_3, Distance=division_8)  # -> Points, Tangents, Parameters
xy = XYPlane(Origin=pt_9)
vdis = VectorDisplay(Anchor=pt_9, Vector=amp)
xy_2 = XYPlane(Origin=pt_10)
vdis_2 = VectorDisplay(Anchor=pt_10, Vector=amp_2)
X_7 = UnitX(Factor=1)
X_8 = UnitX(Factor=1)
points_15 = PointList(Points=divdist_18.Points)
Y_5 = UnitY(Factor=addition)
Z_2 = UnitZ(Factor=multiplication_2)
angle_3 = Angle(VectorA=X_5, VectorB=amp)  # -> Angle, Reflex
angle_4 = Angle(VectorA=X_6, VectorB=amp_2)  # -> Angle, Reflex
xy_3 = XYPlane(Origin=pt_11)
vdis_3 = VectorDisplay(Anchor=pt_11, Vector=amp_3)
xy_4 = XYPlane(Origin=pt_12)
vdis_4 = VectorDisplay(Anchor=pt_12, Vector=amp_4)
pt_17 = Point(dispatch_23.ListA)
pt_18 = Point(dispatch_23.ListB)
flip_28 = FlipMatrix(Data=divdist_19.Points)
dispatch_25 = Dispatch(List=flatten(divdist_5.Points), DispatchPattern=[True, False])  # -> ListA, ListB
move_7 = Move(Geometry=item_5, Motion=expr("-x", Z_2))  # -> Geometry, Transform

# ---- group: Brick Depth
num_43 = Number(num_12)

# ---- group: Brick Heigth
num_44 = Number(num_13)

# ---- group: Brick Length
num_45 = Number(num_14)

# ----
flip_29 = FlipMatrix(Data=divdist_19.Tangents)
angle_5 = Angle(VectorA=X_7, VectorB=amp_3)  # -> Angle, Reflex
amp_5 = Amplitude(Vector=dispatch_24.ListA, Amplitude=Slider(0.1, range=0.1..0.5))
neg_13 = Negative(Value=Y_5)
pt_19 = Point(dispatch_25.ListB)
angle_6 = Angle(VectorA=X_8, VectorB=amp_4)  # -> Angle, Reflex

# ---- group: First arch
# First arch opening
boxrec_2 = BoxRectangle(Rectangle=[rectangle_3.Rectangle, rectangle_2.Rectangle], Height=brick_heigth_2)

# ----
neg_14 = Negative(Value=angle_4.Angle)

pt_20 = Point(dispatch_21.ListA)
# the PATH MAPPER value needs to be adjusted,
# check with the VECTOR DISPLAY
viewer = ParamViewer(pt_20)
path_mapper_7 = PathMapper(pt_20, source="{a} (i)", target="{floor(i%5)}")
viewer_2 = ParamViewer(path_mapper_7)
flip_30 = FlipMatrix(Data=path_mapper_7)

dom_7 = ConstructDomain(DomainStart=expr("-x/2", num_45), DomainEnd=expr("x/2", num_45))
viewer_3 = ParamViewer(cull)
neg_15 = Negative(Value=angle_6.Angle)
pt_21 = Point(dispatch_25.ListA)
move_8 = Move(Geometry=pt_19, Motion=neg_13)  # -> Geometry, Transform
neg_16 = Negative(Value=num_43)

# ---- group: Second layer of brick
X_9 = UnitX(Factor=addition_4)
pt_22 = Point(dispatch_9.ListB)
neg_17 = Negative(Value=X_9)
move_9 = Move(Geometry=pt_22, Motion=neg_17)  # -> Geometry, Transform
points_16 = PointList(Points=move_9.Geometry)
rectangle_12 = Rectangle(Plane=move_9.Geometry, XSize=neg_16, YSize=dom_7, Radius=0)  # -> Rectangle, Length
dom_8 = ConstructDomain(DomainStart=Slider(7, range=0..37), DomainEnd=Slider(14, range=0..37))
range = Range(Domain=dom_8, Steps=Slider(7, range=0..37))
Y_6 = UnitY(Factor=addition_6)
item_19 = ListItem(List=rectangle_12.Rectangle, Index=range, Wrap=True)
neg_18 = Negative(Value=Y_6)
move_10 = Move(Geometry=item_19, Motion=neg_18)  # -> Geometry, Transform

# ---- group: First layer of brick
# Upper wall 3: First brick layer
# Upper wall 3: Second brick layer
pt_23 = Point(dispatch_9.ListA)
rectangle_13 = Rectangle(Plane=pt_23, XSize=neg_16, YSize=dom_7, Radius=0)  # -> Rectangle, Length

# Upper wall 4: First brick layer
pt_24 = Point(dispatch_8.ListB)
rectangle_14 = Rectangle(Plane=pt_24, XSize=dom_7, YSize=neg_16, Radius=0)  # -> Rectangle, Length

# ----
# Upper wall 4: Second brick layer
pt_25 = Point(dispatch_8.ListA)
path_mapper_8 = PathMapper(pt_25, source="{A}(i)", target="(floor(i/8))")
Y_7 = UnitY(Factor=addition_4)
neg_19 = Negative(Value=Y_7)
flip_31 = FlipMatrix(Data=path_mapper_8)
move_11 = Move(Geometry=flip_31, Motion=neg_19)  # -> Geometry, Transform
rectangle_15 = Rectangle(Plane=move_11.Geometry, XSize=dom_7, YSize=neg_16, Radius=0)  # -> Rectangle, Length
X_10 = UnitX(Factor=addition_6)
item_20 = ListItem(List=rectangle_15.Rectangle, Index=Slider(1, range=0..4), Wrap=True)
neg_20 = Negative(Value=X_10)
move_12 = Move(Geometry=item_20, Motion=neg_20)  # -> Geometry, Transform

division_13 = Division(A=addition_16, B="2")
rot3d = Rotate3D(Geometry=xy, Angle=angle_3.Angle, Center=xy, Axis=Vector(0, 0, 1))  # -> Geometry, Transform
flip_32 = FlipCurve(Curve=move_7.Geometry)  # -> Curve, Flag
xy_5 = XYPlane(Origin=pt_17)
rot3d_2 = Rotate3D(Geometry=xy_2, Angle=neg_14, Center=xy_2, Axis=Vector(0, 0, 1))  # -> Geometry, Transform
rot3d_3 = Rotate3D(Geometry=xy_3, Angle=angle_5.Angle, Center=xy_3, Axis=Vector(0, 0, 1))  # -> Geometry, Transform

# ---- group: Duplicate Second arch
edges_3 = BrepEdges(Brep=srf)  # -> Naked, Interior, NonManifold
# Second arch opening
item_21 = ListItem(List=edges_3.Naked, Index=0, Wrap=True)
len_2 = Length(Curve=item_21)
multiplication_3 = Multiplication(A=len_2, B="2")
X_11 = UnitX(Factor=multiplication_3)
move_13 = Move(Geometry=boxrec_2, Motion=X_11)  # -> Geometry, Transform

# ----
points_17 = PointList(Points=cull)
rot3d_4 = Rotate3D(Geometry=xy_4, Angle=neg_15, Center=xy_4, Axis=Vector(0, 0, 1))  # -> Geometry, Transform
vdis_5 = VectorDisplay(Anchor=pt_17, Vector=amp_5)
dispatch_26 = Dispatch(List=flatten(flip_28), DispatchPattern=[True, False])  # -> ListA, ListB
dispatch_27 = Dispatch(List=flatten(flip_29), DispatchPattern=[True, False])  # -> ListA, ListB
points_18 = PointList(Points=flatten(flip_28))
X_12 = UnitX(Factor=1)

# ---- group: Brick Depth
num_46 = Number(num_8)

# ---- group: Brick Heigth
num_47 = Number(num_9)

# ---- group: Brick Length
num_48 = Number(num_10)

# ----
rectangle_16 = Rectangle(Plane=[pt_14, move_5.Geometry], XSize=neg_16, YSize=dom_7, Radius=0)  # -> Rectangle, Length
# Second layer of brick laying
points_19 = PointList(Points=move_8.Geometry)
viewer_4 = ParamViewer(pt_21)
divdist_20 = DivideDistance(Curve=flip_32.Curve, Distance=division_13)  # -> Points, Tangents, Parameters
Z_3 = UnitZ(Factor=1)
angle_7 = Angle(VectorA=X_12, VectorB=amp_5)  # -> Angle, Reflex
dom_9 = ConstructDomain(DomainStart=expr("-x/2", num_48), DomainEnd=expr("x/2", num_48))
amp_6 = Amplitude(Vector=dispatch_27.ListA, Amplitude=Slider(0.1, range=0.1..0.5))
pt_26 = Point(dispatch_26.ListA)
neg_21 = Negative(Value=num_46)
neg_22 = Negative(Value=Z_3)

# ---- group: Second layer of brick laying
path_mapper_9 = PathMapper(move_8.Geometry, source="{A} (i)", target="(floor(i%9))")
flip_33 = FlipMatrix(Data=path_mapper_9)
panel_3 = Panel([Slider(4, range=0..5), Slider(8, range=0..8)])
points_20 = PointList(Points=flip_33)
item_22 = ListItem(List=flip_33, Index=panel_3, Wrap=True)
rectangle_17 = Rectangle(Plane=flip_33, XSize=dom_5, YSize=neg_5, Radius=0)  # -> Rectangle, Length
rectangle_18 = Rectangle(Plane=item_22, XSize=dom_5, YSize=neg_5, Radius=0)  # -> Rectangle, Length
dispatch_28 = Dispatch(List=rectangle_18.Rectangle, DispatchPattern=[True, False])  # -> ListA, ListB
crv_8 = Curve(dispatch_28.ListA)
crv_9 = Curve(dispatch_28.ListB)
splitatcorners_8 = SplitAtCorners(Poly=crv_8, Angle=1)  # -> Corners, Parts
splitatcorners_9 = SplitAtCorners(Poly=crv_9, Angle=1)  # -> Corners, Parts
item_23 = ListItem(List=splitatcorners_8.Corners, Index="3", Wrap=True)
item_24 = ListItem(List=splitatcorners_9.Corners, Index="0", Wrap=True)
scale_nu_8 = ScaleNU(Geometry=crv_8, Plane=item_23, ScaleX=Slider(0.5, range=0.01..1), ScaleY=1, ScaleZ=1)  # -> Geometry, Transform
scale_nu_9 = ScaleNU(Geometry=crv_9, Plane=item_24, ScaleX=Slider(0.5, range=0.01..1), ScaleY=1, ScaleZ=1)  # -> Geometry, Transform
replace_6 = ReplaceItems(List=rectangle_17.Rectangle, Item=[scale_nu_9.Geometry, scale_nu_8.Geometry], Indices=panel_3, Wrap=False)

# ---- group: Brick Depth
num_49 = Number(brick_depth)

# ---- group: Brick Length
num_50 = Number(brick_length)

# ---- group: Brick Heigth
num_51 = Number(brick_heigth)

# ---- group: First layer of brick laying
# First layer of brick laying
path_mapper_10 = PathMapper(pt_21, source="{A} (i)", target="(floor(i%9))")
flip_34 = FlipMatrix(Data=path_mapper_10)
panel_4 = Panel([Slider(0, range=0..5), Slider(4, range=0..5)])
item_25 = ListItem(List=flip_34, Index=panel_4, Wrap=True)
points_21 = PointList(Points=flip_34, Size=Slider(0.02, range=0.01..0.5))
rectangle_19 = Rectangle(Plane=item_25, XSize=dom_5, YSize=neg_5, Radius=0)  # -> Rectangle, Length
rectangle_20 = Rectangle(Plane=flip_34, XSize=dom_5, YSize=neg_5, Radius=0)  # -> Rectangle, Length
dispatch_29 = Dispatch(List=rectangle_19.Rectangle, DispatchPattern=[True, False])  # -> ListA, ListB
crv_10 = Curve(dispatch_29.ListA)
crv_11 = Curve(dispatch_29.ListB)
splitatcorners_10 = SplitAtCorners(Poly=crv_10, Angle=1)  # -> Corners, Parts
splitatcorners_11 = SplitAtCorners(Poly=crv_11, Angle=1)  # -> Corners, Parts
item_26 = ListItem(List=splitatcorners_10.Corners, Index="3", Wrap=True)
item_27 = ListItem(List=splitatcorners_11.Corners, Index="0", Wrap=True)
scale_nu_10 = ScaleNU(Geometry=crv_10, Plane=item_26, ScaleX=Slider(0.5, range=0.01..1), ScaleY=1, ScaleZ=1)  # -> Geometry, Transform
scale_nu_11 = ScaleNU(Geometry=crv_11, Plane=item_27, ScaleX=Slider(0.5, range=0.01..1), ScaleY=1, ScaleZ=1)  # -> Geometry, Transform
replace_7 = ReplaceItems(List=rectangle_20.Rectangle, Item=[scale_nu_10.Geometry, scale_nu_11.Geometry], Indices=panel_4, Wrap=False)

# ----
rectangle_21 = Rectangle(Plane=[pt_13, move_6.Geometry], XSize=dom_9, YSize=neg_21, Radius=0)  # -> Rectangle, Length
vec2pt = Vector2Pt(PointA=flip_30, PointB=divdist_20.Points, Unitize=False)  # -> Vector, Length

# ---- group: Finding center of the room
rev = ReverseList(List=divdist_5.Points)
ln_5 = Line(StartPoint=rev, EndPoint=divdist_6.Points)
item_28 = ListItem(List=flatten(ln_5), Index=Slider(4, range=0..80), Wrap=True)
curvepoint = PointOnCurve(item_28, parameter=0.5)
xz = XZPlane(Origin=curvepoint)

# ----
# Rotate brick laying plane by 65 degree
mid_point = Point(curvepoint)

# ---- group: I will be back...
pt_27 = Point(curvepoint)
rad = Radians(Degrees=Slider(33.7, range=0..90))
xz_2 = XZPlane(Origin=pt_27)
rad_2 = Radians(Degrees=Slider(125, range=0..180))
xy_6 = XYPlane(Origin=pt_27)
neg_23 = Negative(Value=rad_2)
rotate = Rotate(Geometry=xz_2, Angle=rad, Plane=xy_6)  # -> Geometry, Transform
Y_8 = UnitY(Factor=1)
rot3d_5 = Rotate3D(Geometry=rotate.Geometry, Angle=neg_23, Center=rotate.Geometry, Axis=Y_8)  # -> Geometry, Transform
contour_13 = Contour(Shape=srf_17, Point=Point(0, 0, 0), Direction=rot3d_5.Geometry, Distance=addition_22)
flip_35 = FlipCurve(Curve=contour_13)  # -> Curve, Flag
divdist_21 = DivideDistance(Curve=flip_35.Curve, Distance=division_10)  # -> Points, Tangents, Parameters
flip_36 = FlipMatrix(Data=divdist_21.Points)
flip_37 = FlipMatrix(Data=divdist_21.Tangents)
dispatch_30 = Dispatch(List=flatten(flip_36), DispatchPattern=[True, False])  # -> ListA, ListB
dispatch_31 = Dispatch(List=flatten(flip_37), DispatchPattern=[True, False])  # -> ListA, ListB
points_22 = PointList(Points=flatten(flip_36))
amp_7 = Amplitude(Vector=dispatch_31.ListA, Amplitude=Slider(0.1, range=0.1..0.5))
pt_28 = Point(dispatch_30.ListA)
vdis_6 = VectorDisplay(Anchor=pt_28, Vector=amp_7)
yz = YZPlane(Origin=pt_28)
xy_7 = XYPlane(Origin=pt_28)

# ---- group: Rotate brick laying plane
rad_3 = Radians(Degrees=Slider(65, range=0..90))
xy_8 = XYPlane(Origin=mid_point)
neg_24 = Negative(Value=rad_3)
rot3d_6 = Rotate3D(Geometry=xy_8, Angle=neg_24, Center=xy_8, Axis=Y)  # -> Geometry, Transform

# ----
contour_14 = Contour(Shape=srf_11, Point=Point(0, 0, 0), Direction=rot3d_6.Geometry, Distance=addition_17)
contour_15 = Contour(Shape=srf_12, Point=Point(0, 0, 0), Direction=rot3d_6.Geometry, Distance=addition_17)
divdist_22 = DivideDistance(Curve=contour_14, Distance=division_11)  # -> Points, Tangents, Parameters
divdist_23 = DivideDistance(Curve=contour_15, Distance=division_11)  # -> Points, Tangents, Parameters
flip_38 = FlipMatrix(Data=divdist_22.Tangents)
flip_39 = FlipMatrix(Data=divdist_22.Points)
# Get the rotation angle of brick (second half)
flip_40 = FlipMatrix(Data=divdist_23.Tangents)
flip_41 = FlipMatrix(Data=divdist_23.Points)
points_23 = PointList(Points=flatten(flip_41), Size=Slider(0.02, range=0..0.1))
# Get the position of the brick (first half)
points_24 = PointList(Points=flatten(flip_39), Size=Slider(0.03, range=0..0.1))

# ---- group: Position of the brick
dispatch_32 = Dispatch(List=flip_39, DispatchPattern=[True, False])  # -> ListA, ListB
flip_42 = FlipMatrix(Data=dispatch_32.ListA)
flip_43 = FlipMatrix(Data=dispatch_32.ListB)
cull_2 = CullPattern(List=flip_42, CullPattern=[True, False])
cull_3 = CullPattern(List=flip_43, CullPattern=[False, True])

# ---- group: Bricks rotation angle
# Get the rotation angle of brick (first half)
dispatch_33 = Dispatch(List=flip_38, DispatchPattern=[True, False])  # -> ListA, ListB
number_slider_7 = Slider(0.12, range=0.01..0.5)
flip_44 = FlipMatrix(Data=dispatch_33.ListB)
flip_45 = FlipMatrix(Data=dispatch_33.ListA)
cull_4 = CullPattern(List=flip_44, CullPattern=[False, True])
cull_5 = CullPattern(List=flip_45, CullPattern=[True, False])
amp_8 = Amplitude(Vector=cull_5, Amplitude=number_slider_7)
amp_9 = Amplitude(Vector=cull_4, Amplitude=number_slider_7)
vdis_7 = VectorDisplay(Anchor=cull_3, Vector=amp_9)
vdis_8 = VectorDisplay(Anchor=cull_2, Vector=amp_8)
Y_9 = UnitY(Factor=1)
Y_10 = UnitY(Factor=1)
angle_8 = Angle(VectorA=Y_9, VectorB=amp_9)  # -> Angle, Reflex
angle_9 = Angle(VectorA=Y_10, VectorB=amp_8)  # -> Angle, Reflex

# ----
# Duplicate (mirror) the rib
# to the other side
xz_3 = XZPlane(Origin=curvepoint)
mirror = Mirror(Geometry=boxrec, Plane=xz_3)  # -> Geometry, Transform

# ---- group: Position of the bricks
# Get the position of the brick (second half)
dispatch_34 = Dispatch(List=flip_41, DispatchPattern=[True, False])  # -> ListA, ListB
flip_46 = FlipMatrix(Data=dispatch_34.ListB)
flip_47 = FlipMatrix(Data=dispatch_34.ListA)
cull_6 = CullPattern(List=flip_47, CullPattern=[False, True])
cull_7 = CullPattern(List=flip_46, CullPattern=[True, False])

# ---- group: Rotation angle of the bricks
dispatch_35 = Dispatch(List=flip_40, DispatchPattern=[True, False])  # -> ListA, ListB
number_slider_8 = Slider(0.12, range=0.01..0.5)
flip_48 = FlipMatrix(Data=dispatch_35.ListB)
flip_49 = FlipMatrix(Data=dispatch_35.ListA)
cull_8 = CullPattern(List=flip_49, CullPattern=[False, True])
cull_9 = CullPattern(List=flip_48, CullPattern=[True, False])
amp_10 = Amplitude(Vector=cull_8, Amplitude=number_slider_8)
amp_11 = Amplitude(Vector=cull_9, Amplitude=number_slider_8)
Y_11 = UnitY(Factor=1)
Y_12 = UnitY(Factor=1)
vdis_9 = VectorDisplay(Anchor=cull_7, Vector=amp_11)
vdis_10 = VectorDisplay(Anchor=cull_6, Vector=amp_10)
angle_10 = Angle(VectorA=Y_11, VectorB=amp_11)  # -> Angle, Reflex
angle_11 = Angle(VectorA=Y_12, VectorB=amp_10)  # -> Angle, Reflex

# ----
points_25 = PointList(Points=cull_2)
points_26 = PointList(Points=cull_6)

# ---- group: Getting the point for the triangle brick
# Positon of the last (triangle) brick for the ribs
panel_5 = Panel("-1")
item_29 = ListItem(List=mirror.Geometry, Index="-1", Wrap=True)
item_30 = ListItem(List=boxrec, Index=panel_5, Wrap=True)
debrep = DeconstructBrep(Brep=item_29)  # -> Faces, Edges, Vertices
debrep_2 = DeconstructBrep(Brep=item_30)  # -> Faces, Edges, Vertices
pt_29 = Point(debrep.Vertices)
pt_30 = Point(debrep_2.Vertices)

# ----
viewer_5 = ParamViewer(path_mapper_6)
X_13 = UnitX(Factor=1)
xy_9 = XYPlane(Origin=pt_26)
points_27 = PointList(Points=path_mapper_6)
dom_10 = ConstructDomain(DomainStart=expr("-x/2", num_50), DomainEnd=expr("x/2", num_50))
vdis_11 = VectorDisplay(Anchor=pt_26, Vector=amp_6)
rot3d_7 = Rotate3D(Geometry=xy_5, Angle=angle_7.Angle, Center=xy_5, Axis=neg_22)  # -> Geometry, Transform
amp_12 = Amplitude(Vector=vec2pt.Vector, Amplitude=Slider(0.2, range=0.1..1))
angle_12 = Angle(VectorA=X_13, VectorB=amp_6)  # -> Angle, Reflex
number_slider_9 = Slider(0.15, range=0.15..0.5)
neg_25 = Negative(Value=num_49)
Z_4 = UnitZ(Factor=1)
Y_13 = UnitY(Factor=1)
viewer_6 = ParamViewer(path_mapper_10)

# ---- group: Result of upper wall
# Final side wall
boxrec_3 = BoxRectangle(Rectangle=rectangle_21.Rectangle, Height=num_47)

# ----
divdist_24 = DivideDistance(Curve=flip_6.Curve, Distance=division_4)  # -> Points, Tangents, Parameters
# Get the rotation angle of each brick
points_28 = PointList(Points=divdist_24.Points)

rectangle_22 = Rectangle(Plane=[rot3d.Geometry, rot3d_3.Geometry], XSize=dom_10, YSize=num_49, Radius=0)  # -> Rectangle, Length
rectangle_23 = Rectangle(Plane=[rot3d_4.Geometry, rot3d_2.Geometry], XSize=dom_10, YSize=neg_25, Radius=0)  # -> Rectangle, Length

# ---- group: Brick Length
num_52 = Number(brick_length)

# ---- group: Brick Depth
num_53 = Number(brick_depth)

# ---- group: Brick Heigth
num_54 = Number(brick_heigth)

# ----
neg_26 = Negative(Value=Z_4)
angle_13 = Angle(VectorA=Y_13, VectorB=vec2pt.Vector)  # -> Angle, Reflex
xy_10 = XYPlane(Origin=flip_30)

# ----
# VECTOR DISPLAY
vdis_12 = VectorDisplay(Anchor=flip_30, Vector=amp_12)

# ---- group: Rotate the bricks
# Rotate the bricks (first half)
xy_11 = XYPlane(Origin=cull_2)
xy_12 = XYPlane(Origin=cull_3)
rot3d_8 = Rotate3D(Geometry=xy_11, Angle=neg_24, Center=xy_11, Axis=Y)  # -> Geometry, Transform
rot3d_9 = Rotate3D(Geometry=xy_12, Angle=neg_24, Center=xy_12, Axis=Y)  # -> Geometry, Transform
neg_27 = Negative(Value=angle_9.Angle)
neg_28 = Negative(Value=angle_8.Angle)
rotate_2 = Rotate(Geometry=rot3d_9.Geometry, Angle=neg_28, Plane=rot3d_9.Geometry)  # -> Geometry, Transform
rotate_3 = Rotate(Geometry=rot3d_8.Geometry, Angle=neg_27, Plane=rot3d_8.Geometry)  # -> Geometry, Transform

# ----
points_29 = PointList(Points=flip_27)

# ----
# Rotate the bricks (second half)
xy_13 = XYPlane(Origin=cull_6)
xy_14 = XYPlane(Origin=cull_7)
rot3d_10 = Rotate3D(Geometry=xy_13, Angle=neg_24, Center=xy_13, Axis=Y)  # -> Geometry, Transform
rot3d_11 = Rotate3D(Geometry=xy_14, Angle=neg_24, Center=xy_14, Axis=Y)  # -> Geometry, Transform
neg_29 = Negative(Value=angle_11.Angle)
neg_30 = Negative(Value=angle_10.Angle)
rotate_4 = Rotate(Geometry=rot3d_10.Geometry, Angle=neg_29, Plane=rot3d_10.Geometry)  # -> Geometry, Transform
rotate_5 = Rotate(Geometry=rot3d_11.Geometry, Angle=neg_30, Plane=rot3d_11.Geometry)  # -> Geometry, Transform

neg_31 = Negative(Value=num_53)
dom_11 = ConstructDomain(DomainStart=expr("-x/2", num_52), DomainEnd=expr("x/2", num_52))

# ---- group: Corner: Offset opt1
xz_4 = XZPlane(Origin=pt_18)
Y_14 = UnitY(Factor=1)
X_14 = UnitX(Factor=1)
angle_14 = Angle(VectorA=X_14, VectorB=dispatch_24.ListB)  # -> Angle, Reflex
angle_15 = Angle(VectorA=Y_14, VectorB=dispatch_24.ListB)  # -> Angle, Reflex
rot3d_12 = Rotate3D(Geometry=xz_4, Angle=angle_15.Angle, Center=xz_4, Axis=neg_22)  # -> Geometry, Transform
deplane = DeconstructPlane(Plane=rot3d_12.Geometry)  # -> Origin, XAxis, YAxis, ZAxis
addition_24 = Addition(A=addition_21, B=num_34)
line = LineSDL(Start=deplane.Origin, Direction=deplane.XAxis, Length=addition_24)
end_4 = EndPoints(Curve=line)  # -> Start, End
pt_31 = Point(end_4.End)
xy_15 = XYPlane(Origin=pt_31)
rot3d_13 = Rotate3D(Geometry=xy_15, Angle=angle_14.Angle, Center=xy_15, Axis=neg_22)  # -> Geometry, Transform
rectangle_24 = Rectangle(Plane=rot3d_13.Geometry, XSize=dom_11, YSize=neg_31, Radius=0)  # -> Rectangle, Length
boxrec_4 = BoxRectangle(Rectangle=rectangle_24.Rectangle, Height=num_54)

# ----
neg_32 = Negative(Value=angle_13.Angle)
rot3d_14 = Rotate3D(Geometry=xy_9, Angle=angle_12.Angle, Center=xy_9, Axis=neg_26)  # -> Geometry, Transform

# ----
# Duplicate side wall
xz_5 = XZPlane(Origin=curvepoint)
mirror_2 = Mirror(Geometry=boxrec_3, Plane=xz_5)  # -> Geometry, Transform

boxrec_5 = BoxRectangle(Rectangle=[rectangle_22.Rectangle, rectangle_23.Rectangle], Height=num_51)
merge = Merge(Data1=boxrec_2, Data2=move_13.Geometry)

# ---- group: Fifth and sixth arch opening
# Fifth and sixth arch opening
rad_4 = Radians(Degrees=Slider(90, range=0..90))
pt_32 = Point(curvepoint)
rotate_6 = Rotate(Geometry=boxrec_2, Angle=rad_4, Plane=pt_32)  # -> Geometry, Transform
X_15 = UnitX(Factor=Slider(0.3, range=0..1))
Y_15 = UnitY(Factor=Slider(0.3, range=0..1))
move_14 = Move(Geometry=rotate_6.Geometry, Motion=X_15)  # -> Geometry, Transform
move_15 = Move(Geometry=move_14.Geometry, Motion=Y_15)  # -> Geometry, Transform
multiplication_4 = Multiplication(A=Y_15, B="6")
move_16 = Move(Geometry=move_15.Geometry, Motion=multiplication_4)  # -> Geometry, Transform
merge_2 = Merge(Data1=move_15.Geometry, Data2=move_16.Geometry)

# ----
X_16 = UnitX(Factor=1)

# ---- group: Get the rotation angle
vec2pt_2 = Vector2Pt(PointA=flip_27, PointB=divdist_24.Points, Unitize=False)  # -> Vector, Length
amp_13 = Amplitude(Vector=vec2pt_2.Vector, Amplitude=Slider(0.2, range=0.1..1))
vdis_13 = VectorDisplay(Anchor=flip_27, Vector=amp_13)
X_17 = UnitX(Factor=1)
angle_16 = Angle(VectorA=X_17, VectorB=vec2pt_2.Vector)  # -> Angle, Reflex

# ----
rectangle_25 = Rectangle(Plane=rot3d_14.Geometry, XSize=dom_11, YSize=neg_31, Radius=0)  # -> Rectangle, Length
rectangle_26 = Rectangle(Plane=rot3d_7.Geometry, XSize=dom_11, YSize=neg_31, Radius=0)  # -> Rectangle, Length

# ---- group: Third and fouth arches
# Third and fouth arch opening
xz_6 = XZPlane(Origin=curvepoint)
mirror_3 = Mirror(Geometry=merge, Plane=xz_6)  # -> Geometry, Transform

# ----
merge_3 = Merge(Data1=rectangle_13.Rectangle, Data2=rectangle_12.Rectangle, Data3=move_10.Geometry)
merge_4 = Merge(Data1=rectangle_14.Rectangle, Data2=rectangle_15.Rectangle, Data3=move_12.Geometry)
rot3d_15 = Rotate3D(Geometry=xy_10, Angle=neg_32, Center=xy_10, Axis=X_16)  # -> Geometry, Transform
boxrec_6 = BoxRectangle(Rectangle=rectangle_25.Rectangle, Height=num_54)
boxrec_7 = BoxRectangle(Rectangle=rectangle_26.Rectangle, Height=num_54)

# ---- group: Forming the shape of the triangle brick
# Shape and form of the triangle brick
number_slider_10 = Slider(5, range=0..7)
panel_6 = Panel([Slider(4, range=0..7), Slider(7, range=0..7)])
panel_7 = Panel([Slider(0, range=0..7), Slider(3, range=0..7)])
panel_8 = Panel([Slider(1, range=0..7), Slider(2, range=0..7)])
panel_9 = Panel([number_slider_10, Slider(6, range=0..7)])
item_31 = ListItem(List=pt_29, Index=panel_7, Wrap=True)
item_32 = ListItem(List=pt_29, Index=panel_8, Wrap=True)
points_30 = PointList(Points=pt_29)
item_33 = ListItem(List=pt_30, Index=panel_6, Wrap=True)
item_34 = ListItem(List=pt_30, Index=panel_9, Wrap=True)
points_31 = PointList(Points=pt_30)
rev_2 = ReverseList(List=item_31)
rev_3 = ReverseList(List=item_32)
merge_5 = Merge(Data1=item_33, Data2=rev_2)
pline = PolyLine(Vertices=merge_5, Closed=True)
merge_6 = Merge(Data1=item_34, Data2=rev_3)
pline_2 = PolyLine(Vertices=merge_6, Closed=True)
loft = Loft(
    Curves=[pline, pline_2],
    Options={Adjust=False, Closed=False, LoftEnds=0, LoftSimp=0, LoftType=0, Rebuild=10, Refit=0.01})
cap = CapHoles(Brep=loft)

# ---- group: Wall 4: Second layer / Mortar Thickness
num_55 = Number(mortar_thickness)

# ---- group: Wall 4: Second layer
num_56 = Number(addition)
X_18 = UnitX(Factor=num_56)
pt_33 = Point(dispatch_2.ListA)
neg_33 = Negative(Value=X_18)
move_17 = Move(Geometry=pt_33, Motion=neg_33)  # -> Geometry, Transform
path_mapper_11 = PathMapper(move_17.Geometry, source="{A} (i)", target="(floor(i%3))")
flip_50 = FlipMatrix(Data=path_mapper_11)
number_slider_11 = Slider(1, range=0..4)
points_32 = PointList(Points=flip_50)
item_35 = ListItem(List=flip_50, Index=number_slider_11, Wrap=True)
rectangle_27 = Rectangle(Plane=flip_50, XSize=neg_2, YSize=dom, Radius=0)  # -> Rectangle, Length
rectangle_28 = Rectangle(Plane=item_35, XSize=neg_2, YSize=dom, Radius=0)  # -> Rectangle, Length
splitatcorners_12 = SplitAtCorners(Poly=rectangle_28.Rectangle, Angle=1)  # -> Corners, Parts
points_33 = PointList(Points=splitatcorners_12.Corners)
item_36 = ListItem(List=splitatcorners_12.Corners, Index=Slider(3, range=0..4), Wrap=True)
scale_nu_12 = ScaleNU(Geometry=rectangle_28.Rectangle, Plane=item_36, ScaleX=1, ScaleY=Slider(0.5, range=0.05..1), ScaleZ=1)  # -> Geometry, Transform
replace_8 = ReplaceItems(List=rectangle_27.Rectangle, Item=scale_nu_12.Geometry, Indices=number_slider_11, Wrap=False)
division_14 = Division(A=num_3, B="2")
addition_25 = Addition(A=division_14, B=num_55)
addition_26 = Addition(A=num_42, B=addition_25)
item_37 = ListItem(List=replace_8, Index=Slider(2, range=0..4), Wrap=True)
Y_16 = UnitY(Factor=num_42)
item_38 = ListItem(List=replace_8, Index=Slider(1, range=0..4), Wrap=True)
Y_17 = UnitY(Factor=addition_26)
neg_34 = Negative(Value=Y_16)
neg_35 = Negative(Value=Y_17)
move_18 = Move(Geometry=item_37, Motion=neg_34)  # -> Geometry, Transform
move_19 = Move(Geometry=item_38, Motion=neg_35)  # -> Geometry, Transform
splitatcorners_13 = SplitAtCorners(Poly=move_19.Geometry, Angle=1)  # -> Corners, Parts
points_34 = PointList(Points=splitatcorners_13.Corners)
item_39 = ListItem(List=splitatcorners_13.Corners, Index=Slider(2, range=0..4), Wrap=True)
scale_nu_13 = ScaleNU(
    Geometry=move_19.Geometry,
    Plane=item_39,
    ScaleX=Slider(2.035, range=0.05..3),
    ScaleY=Slider(0.966, range=0.05..3),
    ScaleZ=1)  # -> Geometry, Transform
merge_7 = Merge(Data1=replace_8, Data2=move_18.Geometry, Data3=scale_nu_13.Geometry)

# ----
brick_depth_3 = Number(num_16)
brick_length_3 = Number(num_18)
brick_heigth_3 = Number(num_17)

# ---- group: Final End wall
boxrec_8 = BoxRectangle(Rectangle=rectangle_16.Rectangle, Height=num_44)

# ---- group: Final upper corner wall
boxrec_9 = BoxRectangle(Rectangle=[merge_3, merge_4], Height=num_44)

# ----
panel_10 = Panel([Slider(0, range=0..100), Slider(2, range=0..10)])

# ---- group: Rotate the bricks
# Rotate the bricks
xy_16 = XYPlane(Origin=flip_27)
Y_18 = UnitY(Factor=1)
rot3d_16 = Rotate3D(Geometry=xy_16, Angle=angle_16.Angle, Center=xy_16, Axis=Y_18)  # -> Geometry, Transform

# ---- group: Brick Depth
# Brick laying result (second half)
num_57 = Number(num_20)

# ---- group: Brick Length
num_58 = Number(num_22)

# ---- group: Brick Heigth
num_59 = Number(num_21)

# ----
neg_36 = Negative(Value=brick_depth_3)

# ---- group: Brick laying result / Brick Length
num_60 = Number(num_22)

# ---- group: Brick laying result / Brick Depth
# Brick laying result (first half)
num_61 = Number(num_20)

# ---- group: Brick laying result / Brick Heigth
num_62 = Number(num_21)

# ----
item_40 = ListItem(List=rot3d_15.Geometry, Index=panel_10, Wrap=True)
dom_12 = ConstructDomain(DomainStart=expr("x/2", brick_length_3), DomainEnd=expr("-x/2", brick_length_3))

# ---- group: Wall 5 Result
boxrec_10 = BoxRectangle(Rectangle=[replace_4, replace_3], Height=num_5)

# ----
neg_37 = Negative(Value=num_57)
dom_13 = ConstructDomain(DomainStart=expr("-x/2", num_58), DomainEnd=expr("x/2", num_58))
rectangle_29 = Rectangle(Plane=[rotate_4.Geometry, rotate_5.Geometry], XSize=neg_37, YSize=dom_13, Radius=0)  # -> Rectangle, Length
boxrec_11 = BoxRectangle(Rectangle=rectangle_29.Rectangle, Height=num_59)

# ---- group: Brick laying result
dom_14 = ConstructDomain(DomainStart=expr("-x/2", num_60), DomainEnd=expr("x/2", num_60))
rectangle_30 = Rectangle(Plane=[rotate_3.Geometry, rotate_2.Geometry], XSize=num_61, YSize=dom_14, Radius=0)  # -> Rectangle, Length
boxrec_12 = BoxRectangle(Rectangle=rectangle_30.Rectangle, Height=num_62)

# ---- group: Seventh and eighth arch opening
# Seventh and eighth arch opening
yz_2 = YZPlane(Origin=pt_32)
mirror_4 = Mirror(Geometry=merge_2, Plane=yz_2)  # -> Geometry, Transform

# ----
merge_8 = Merge(Data1=boxrec_7, Data2=boxrec_6)
xz_7 = XZPlane(Origin=curvepoint)
rectangle_31 = Rectangle(Plane=item_40, XSize=dom_12, YSize=neg_36, Radius=0)  # -> Rectangle, Length

# ---- group: Trim surface the the desire shape / Surface 2: Trim Corner
# Trim the surface/brep
srf_18 = Surface(<surface referenced from the Rhino model>)

# ----
rectangle_32 = Rectangle(Plane=rot3d_15.Geometry, XSize=dom_12, YSize=neg_36, Radius=0)  # -> Rectangle, Length

# ---- group: Duplicate the end wall
# Duplicate upper end wall
yz_3 = YZPlane(Origin=curvepoint)
mirror_5 = Mirror(Geometry=boxrec_8, Plane=yz_3)  # -> Geometry, Transform

# ---- group: Trim surface the the desire shape
edges_4 = BrepEdges(Brep=srf_18)  # -> Naked, Interior, NonManifold
join = JoinCurves(Curves=edges_4.Naked, Preserve=False)
incurve = PointInCurve(Point=flip_27, Curve=join)  # -> Relationship, Point
dispatch_36 = Dispatch(List=rot3d_16.Geometry, DispatchPattern=incurve.Relationship)  # -> ListA, ListB
pln_2 = Plane(dispatch_36.ListA)

# ---- group: Duplicate upper wall to all corner
# Duplicate upper corner wall to all corners
xz_8 = XZPlane(Origin=curvepoint)
mirror_6 = Mirror(Geometry=boxrec_9, Plane=xz_8)  # -> Geometry, Transform
yz_4 = YZPlane(Origin=curvepoint)
merge_9 = Merge(Data1=boxrec_9, Data2=mirror_6.Geometry)
mirror_7 = Mirror(Geometry=merge_9, Plane=yz_4)  # -> Geometry, Transform

# ----
mirror_8 = Mirror(Geometry=merge_8, Plane=xz_7)  # -> Geometry, Transform
dispatch_37 = Dispatch(List=rectangle_31.Rectangle, DispatchPattern=[True, False])  # -> ListA, ListB
crv_12 = Curve(dispatch_37.ListA)
crv_13 = Curve(dispatch_37.ListB)
splitatcorners_14 = SplitAtCorners(Poly=crv_12, Angle=1)  # -> Corners, Parts
splitatcorners_15 = SplitAtCorners(Poly=crv_13, Angle=1)  # -> Corners, Parts

# ---- group: Duplicate the wall
pt_34 = Point(curvepoint)
yz_5 = YZPlane(Origin=pt_34)

# ----
item_41 = ListItem(List=splitatcorners_14.Corners, Index="0", Wrap=True)
item_42 = ListItem(List=splitatcorners_15.Corners, Index="3", Wrap=True)

# ---- group: Duplicate the wall / Duplicate
mirror_9 = Mirror(Geometry=boxrec_10, Plane=yz_5)  # -> Geometry, Transform

# ----
scale_nu_14 = ScaleNU(Geometry=crv_12, Plane=item_41, ScaleX=Slider(0.5, range=0..1), ScaleY=1, ScaleZ=1)  # -> Geometry, Transform
scale_nu_15 = ScaleNU(Geometry=crv_13, Plane=item_42, ScaleX=Slider(0.5, range=0..1), ScaleY=1, ScaleZ=1)  # -> Geometry, Transform

# ---- group: Brick Length
num_63 = Number(num_29)

# ---- group: Brick Depth
num_64 = Number(num_27)

# ---- group: Brick Heigth
num_65 = Number(num_28)

# ----
replace_9 = ReplaceItems(List=rectangle_32.Rectangle, Item=[scale_nu_14.Geometry, scale_nu_15.Geometry], Indices=panel_10, Wrap=False)
dom_15 = ConstructDomain(DomainStart=expr("-x/2", num_63), DomainEnd=expr("x/2", num_63))
neg_38 = Negative(Value=num_64)
rectangle_33 = Rectangle(Plane=pln_2, XSize=neg_38, YSize=dom_15, Radius=0)  # -> Rectangle, Length

# ---- group: Final half arch
boxrec_13 = BoxRectangle(Rectangle=replace_9, Height=brick_heigth_3)

# ---- group: Wall 3 Result
boxrec_14 = BoxRectangle(Rectangle=[replace, replace_5], Height=num_2)

# ---- group: Wall 4 Result
boxrec_15 = BoxRectangle(Rectangle=[replace_2, merge_7], Height=num_2)

# ---- group: Mirror that half arch
xz_9 = XZPlane(Origin=curvepoint)
mirror_10 = Mirror(Geometry=boxrec_13, Plane=xz_9)  # -> Geometry, Transform

# ---- group: Duplicate wall to all corners
# Duplicate corner wall to all corners
merge_10 = Merge(Data1=boxrec_14, Data2=boxrec_15)
xz_10 = XZPlane(Origin=curvepoint)
mirror_11 = Mirror(Geometry=merge_10, Plane=xz_10)  # -> Geometry, Transform
merge_11 = Merge(Data1=merge_10, Data2=mirror_11.Geometry)
yz_6 = YZPlane(Origin=curvepoint)
mirror_12 = Mirror(Geometry=merge_11, Plane=yz_6)  # -> Geometry, Transform

# ---- group: Wall 1
# Result
boxrec_16 = BoxRectangle(Rectangle=[replace_7, replace_6], Height=brick_heigth)

# ---- group: Wall 2
mirror_13 = Mirror(Geometry=boxrec_16, Plane=xz)  # -> Geometry, Transform

# ---- group: Result side walls
merge_12 = Merge(Data1=boxrec_16, Data2=mirror_13.Geometry)

# ----
# Result
merge_13 = Merge(Data1=mirror_12.Geometry, Data2=mirror_11.Geometry, Data3=merge_10)

# ---- group: Result
# Result
merge_14 = Merge(Data1=boxrec_10, Data2=mirror_9.Geometry)

# ----
# Result
merge_15 = Merge(Data1=merge_2, Data2=mirror_4.Geometry, Data3=mirror_3.Geometry, Data4=merge)

# ---- group: Result
# Result
merge_16 = Merge(Data1=boxrec_3, Data2=mirror_2.Geometry)

# Result
merge_17 = Merge(Data1=merge_9, Data2=mirror_7.Geometry)

# Result
merge_18 = Merge(Data1=boxrec_8, Data2=mirror_5.Geometry)

# Result
merge_19 = Merge(Data1=boxrec_13, Data2=mirror_10.Geometry)

# Result
merge_20 = Merge(Data1=boxrec_12, Data2=boxrec_11)

# ----
# Result
merge_21 = Merge(Data1=cap, Data2=mirror.Geometry, Data3=boxrec)
# Result
boxrec_17 = BoxRectangle(Rectangle=rectangle_33.Rectangle, Height=num_65)
merge_22 = Merge(Data1=merge_12, Data2=merge_13, Data3=merge_14, Data4=merge_15)
merge_23 = Merge(Data1=merge_16, Data2=merge_17, Data3=merge_18, Data4=merge_19)
number_slider_12 = Slider(65, range=0..180)

# ---- group: Surface: Arch 1
srf_19 = Surface(<surface referenced from the Rhino model>)

# ---- group: Surface: Arch 2
srf_20 = Surface(<surface referenced from the Rhino model>)

# ---- group: Surface: Arch 3
srf_21 = Surface(<surface referenced from the Rhino model>)

# ---- group: Surface: arch 4
srf_22 = Surface(<surface referenced from the Rhino model>)

# ---- group: Vault Surface 1
srf_23 = Surface([<surface referenced from the Rhino model> x3])

# ---- group: Surface: Vault base
srf_24 = Surface(<surface referenced from the Rhino model>)

# ---- group: Vault Surface 1
srf_25 = Surface([<surface referenced from the Rhino model> x2])

# ----
neg_39 = Negative(Value=number_slider_12)
rad_5 = Radians(Degrees=number_slider_12)
debrep_3 = DeconstructBrep(Brep=srf_22)  # -> Faces, Edges, Vertices

# ---- group: Surface: Base 1
srf_26 = Surface(<surface referenced from the Rhino model>)

# ----
X_19 = UnitX(Factor=1)
item_43 = ListItem(List=debrep_3.Edges, Index=Slider(3, range=0..6), Wrap=True)
contour_16 = Contour(Shape=srf_26, Point=Point(0, 0, 0), Direction=Vector(0, 0, 1), Distance=addition_2)
debrep_4 = DeconstructBrep(Brep=srf_19)  # -> Faces, Edges, Vertices
debrep_5 = DeconstructBrep(Brep=srf_20)  # -> Faces, Edges, Vertices
debrep_6 = DeconstructBrep(Brep=srf_21)  # -> Faces, Edges, Vertices

# ---- group: Brick Depth
num_66 = Number(brick_depth)

# ---- group: Brick Heigth
num_67 = Number(brick_heigth)

# ---- group: Brick Length
num_68 = Number(brick_length)

# ---- group: Mortar Thickness
num_69 = Number(mortar_thickness)

# ---- group: Brick Depth
num_70 = Number(brick_depth)

# ---- group: Brick Heigth
num_71 = Number(brick_heigth)

# ---- group: Brick Length
num_72 = Number(brick_length)

# ---- group: Mortar Thickness
num_73 = Number(mortar_thickness)

# ---- group: Brick Length
num_74 = Number(brick_length)

# ---- group: Brick Depth
num_75 = Number(brick_depth)

# ---- group: Brick Heigth
num_76 = Number(brick_heigth)

# ----
len_3 = Length(Curve=item_43)

# ---- group: Mortar Thickness
num_77 = Number(mortar_thickness)

# ---- group: Brick Length
num_78 = Number(brick_length)

# ---- group: Brick Depth
num_79 = Number(brick_depth)

# ---- group: Brick Heigth
num_80 = Number(brick_heigth)

# ---- group: Mortar Thickness
num_81 = Number(mortar_thickness)

# ----
panel_11 = Panel([Slider(0, range=0..6), Slider(1, range=0..6)])
join_2 = BrepJoin(Breps=srf_25)  # -> Breps, Closed

# ---- group: Brick Length
num_82 = Number(brick_length)

# ---- group: Brick Depth
num_83 = Number(brick_depth)

# ---- group: Brick Heigth
num_84 = Number(brick_heigth)

# ---- group: Mortar Thickness
num_85 = Number(mortar_thickness)

# ----
join_3 = BrepJoin(Breps=srf_23)  # -> Breps, Closed
divdist_25 = DivideDistance(Curve=contour_16, Distance=division_5)  # -> Points, Tangents, Parameters
item_44 = ListItem(List=debrep_4.Edges, Index=panel_11, Wrap=True)
item_45 = ListItem(List=debrep_4.Edges, Index=Slider(3, range=0..6), Wrap=True)
item_46 = ListItem(List=debrep_5.Edges, Index=panel_11, Wrap=True)
item_47 = ListItem(List=debrep_6.Edges, Index=panel_11, Wrap=True)
addition_27 = Addition(A=num_68, B=num_69)
addition_28 = Addition(A=num_67, B=num_69)
addition_29 = Addition(A=num_72, B=num_73)
addition_30 = Addition(A=num_74, B=num_77)
addition_31 = Addition(A=num_70, B=num_73)
addition_32 = Addition(A=num_71, B=num_73)
addition_33 = Addition(A=num_76, B=num_77)
dom_16 = ConstructDomain(DomainStart=expr("-x/2", num_79), DomainEnd=expr("x/2", num_79))
dom_17 = ConstructDomain(DomainStart=expr("-x/2", num_78), DomainEnd=expr("x/2", num_78))
flip_51 = FlipMatrix(Data=divdist_25.Points)
addition_34 = Addition(A=num_79, B=num_81)
addition_35 = Addition(A=num_78, B=num_81)
addition_36 = Addition(A=num_80, B=num_81)
division_15 = Division(A=len_3, B=addition_32)
xz_11 = XZPlane(Origin=Point(0, 0, 0))
crv_14 = Curve(item_46)
crv_15 = Curve(item_44)
crv_16 = Curve(item_47)
addition_37 = Addition(A=num_84, B=num_85)
end_5 = EndPoints(Curve=item_45)  # -> Start, End
neg_40 = Negative(Value=num_82)
join_4 = JoinCurves(Curves=crv_15, Preserve=False)
division_16 = Division(A=addition_27, B="2")
join_5 = JoinCurves(Curves=crv_14, Preserve=False)
dispatch_38 = Dispatch(List=flip_51, DispatchPattern=[True, False])  # -> ListA, ListB
join_6 = JoinCurves(Curves=crv_16, Preserve=False)
round = Round(Number=division_15)  # -> Nearest, Floor, Ceiling
points_35 = PointList(Points=flip_51)
division_17 = Division(A=addition_30, B="2")
contour_17 = Contour(Shape=join_2.Breps, Point=Point(0, 0, 0), Direction=xz_11, Distance=division_17)
division_18 = Division(A=addition_35, B="2")
ln_6 = Line(StartPoint=end_5.Start, EndPoint=end_5.End)
multiplication_5 = Multiplication(A=addition_31, B="2")
len_4 = Length(Curve=join_4)
flip_52 = FlipCurve(Curve=join_4)  # -> Curve, Flag
len_5 = Length(Curve=join_5)
pt_35 = Point(dispatch_38.ListA)
pt_36 = Point(dispatch_38.ListB)
len_6 = Length(Curve=join_6)

# ---- group: Brick Length
num_86 = Number(brick_length)

# ---- group: Brick Depth
num_87 = Number(brick_depth)

# ---- group: Brick Heigth
num_88 = Number(brick_heigth)

# ----
pframes_4 = PerpFrames(Curve=item_43, Count=round.Floor, Align=True)  # -> Frames, Parameters

# ---- group: Mortar Thickness
num_89 = Number(mortar_thickness)

# ----
curvepoint_2 = PointOnCurve(ln_6, parameter=0.5)
flip_53 = FlipCurve(Curve=contour_17)  # -> Curve, Flag
contour_18 = Contour(Shape=srf_24, Point=Point(0, 0, 0), Direction=Vector(0, 0, 1), Distance=addition_36)
dom_18 = ConstructDomain(DomainStart=expr("-x/2", addition_29), DomainEnd=expr("x/2", addition_29))
dom_19 = ConstructDomain(DomainStart=expr("-x/2", num_74), DomainEnd=expr("x/2", num_74))
divdist_26 = DivideDistance(Curve=flip_53.Curve, Distance=addition_33)  # -> Points, Tangents, Parameters
division_19 = Division(A=len_4, B=addition_37)
flip_54 = FlipMatrix(Data=pt_35)
division_20 = Division(A=len_5, B=addition_37)
division_21 = Division(A=len_6, B=addition_37)
flip_55 = FlipCurve(Curve=join_5)  # -> Curve, Flag
flip_56 = FlipCurve(Curve=join_6)  # -> Curve, Flag
cull_i = CullIndex(List=pframes_4.Frames, Indices="-1", Wrap=True)
addition_38 = Addition(A=num_83, B=num_82)
round_2 = Round(Number=division_19)  # -> Nearest, Floor, Ceiling
neg_41 = Negative(Value=num_83)
multiplication_6 = Multiplication(A=num_85, B="2")
pt_37 = Point(curvepoint_2)
xy_17 = XYPlane(Origin=pt_37)
rot3d_17 = Rotate3D(Geometry=xy_17, Angle=rad_5, Center=xy_17, Axis=X_19)  # -> Geometry, Transform
contour_19 = Contour(Shape=join_3.Breps, Point=Point(0, 0, 0), Direction=rot3d_17.Geometry, Distance=addition_28)
flip_57 = FlipCurve(Curve=contour_19)  # -> Curve, Flag
divdist_27 = DivideDistance(Curve=flip_57.Curve, Distance=division_16)  # -> Points, Tangents, Parameters
round_3 = Round(Number=division_20)  # -> Nearest, Floor, Ceiling
multiplication_7 = Multiplication(A=neg_40, B="2")
round_4 = Round(Number=division_21)  # -> Nearest, Floor, Ceiling
points_36 = PointList(Points=flatten(divdist_26.Points))
dispatch_39 = Dispatch(List=divdist_26.Points, DispatchPattern=[True, False])  # -> ListA, ListB
dispatch_40 = Dispatch(List=flatten(flip_54), DispatchPattern=[True, False])  # -> ListA, ListB
dispatch_41 = Dispatch(List=divdist_26.Tangents, DispatchPattern=[True, False])  # -> ListA, ListB
points_37 = PointList(Points=flatten(flip_54))
flip_58 = FlipMatrix(Data=divdist_27.Points)
flip_59 = FlipMatrix(Data=divdist_27.Tangents)
divdist_28 = DivideDistance(Curve=contour_18, Distance=division_18)  # -> Points, Tangents, Parameters
addition_39 = Addition(A=addition_38, B=multiplication_6)
panel_12 = Panel(round_2.Floor)
dom_20 = ConstructDomain(DomainStart=expr("-x/2", num_86), DomainEnd=expr("x/2", num_86))
panel_13 = Panel(round_3.Floor)
flip_60 = FlipMatrix(Data=dispatch_39.ListA)
flip_61 = FlipMatrix(Data=dispatch_39.ListB)
neg_42 = Negative(Value=num_87)
dom_21 = ConstructDomain(DomainStart=expr("-x/2", num_87), DomainEnd=expr("x/2", num_87))
panel_14 = Panel(round_4.Floor)
flip_62 = FlipMatrix(Data=dispatch_41.ListA)
flip_63 = FlipMatrix(Data=dispatch_41.ListB)
multiplication_8 = Multiplication(A=num_83, B="2")
addition_40 = Addition(A=num_87, B=num_89)
neg_43 = Negative(Value=num_86)
dom_22 = ConstructDomain(DomainStart=expr("-x/2", multiplication_8), DomainEnd=expr("x/2", multiplication_8))
dispatch_42 = Dispatch(List=flip_58, DispatchPattern=[True, False])  # -> ListA, ListB
rectangle_34 = Rectangle(Plane=cull_i, XSize=dom_18, YSize=multiplication_5, Radius=0)  # -> Rectangle, Length
dispatch_43 = Dispatch(List=flip_59, DispatchPattern=[True, False])  # -> ListA, ListB
flip_64 = FlipMatrix(Data=divdist_28.Points)
points_38 = PointList(Points=divdist_28.Points)
pt_38 = Point(dispatch_40.ListA)
multiplication_9 = Multiplication(A=neg_41, B="2")
neg_44 = Negative(Value=addition_39)
pt_39 = Point(dispatch_40.ListA)
subtraction = Subtraction(A=multiplication_7, B=multiplication_6)
dispatch_44 = Dispatch(List=flatten(flip_60), DispatchPattern=[True, False])  # -> ListA, ListB
dispatch_45 = Dispatch(List=flatten(flip_61), DispatchPattern=[True, False])  # -> ListA, ListB
dispatch_46 = Dispatch(List=flatten(flip_62), DispatchPattern=[True, False])  # -> ListA, ListB
dispatch_47 = Dispatch(List=flatten(flip_63), DispatchPattern=[True, False])  # -> ListA, ListB
neg_45 = Negative(Value=addition_40)
pt_40 = Point(dispatch_42.ListA)
pt_41 = Point(dispatch_42.ListB)
dispatch_48 = Dispatch(List=flip_64, DispatchPattern=[True, False])  # -> ListA, ListB
boxrec_18 = BoxRectangle(Rectangle=rectangle_34.Rectangle, Height=num_84)
yz_7 = YZPlane(Origin=pt_37)
Y_19 = UnitY(Factor=neg_45)
flip_65 = FlipMatrix(Data=dispatch_43.ListB)
pframes_5 = PerpFrames(Curve=flip_52.Curve, Count=panel_12, Align=True)  # -> Frames, Parameters
pframes_6 = PerpFrames(Curve=flip_55.Curve, Count=panel_13, Align=True)  # -> Frames, Parameters
pt_42 = Point(dispatch_45.ListB)
flip_66 = FlipMatrix(Data=dispatch_43.ListA)
pt_43 = Point(dispatch_44.ListA)
points_39 = PointList(Points=flatten(divdist_27.Points))
pt_44 = Point(dispatch_48.ListA)
pframes_7 = PerpFrames(Curve=flip_56.Curve, Count=panel_14, Align=True)  # -> Frames, Parameters

# ---- group: Unused
addition_41 = Addition(A=num_82, B=num_85)
deplane_2 = DeconstructPlane(Plane=pframes_7.Frames)  # -> Origin, XAxis, YAxis, ZAxis
neg_46 = Negative(Value=addition_41)
line_2 = LineSDL(Start=pframes_7.Frames, Direction=deplane_2.XAxis, Length=neg_46)
division_22 = Division(A=num_82, B="2")
end_6 = EndPoints(Curve=line_2)  # -> Start, End
vec2pt_3 = Vector2Pt(PointA=end_6.Start, PointB=end_6.End, Unitize=False)  # -> Vector, Length
rectangle_35 = Rectangle(Plane=end_6.End, XSize=division_22, YSize=dom_22, Radius=0)  # -> Rectangle, Length
amp_14 = Amplitude(Vector=vec2pt_3.Vector, Amplitude=Slider(0.4, range=0.1..0.5))
vdis_14 = VectorDisplay(Anchor=end_6.Start, Vector=amp_14)
X_20 = UnitX(Factor=1)
angle_17 = Angle(VectorA=X_20, VectorB=amp_14)  # -> Angle, Reflex
Y_20 = UnitY(Factor=1)
neg_47 = Negative(Value=angle_17.Angle)
rot3d_18 = Rotate3D(Geometry=rectangle_35.Rectangle, Angle=neg_47, Center=end_6.End, Axis=Y_20)  # -> Geometry, Transform
neg_48 = Negative(Value=num_84)
boxrec_19 = BoxRectangle(Rectangle=rot3d_18.Geometry, Height=neg_48)

# ----
flip_67 = FlipMatrix(Data=pt_40)
flip_68 = FlipMatrix(Data=pt_41)
pt_45 = Point(dispatch_48.ListB)
rectangle_36 = Rectangle(Plane=pt_36, XSize=dom_21, YSize=neg_43, Radius=0)  # -> Rectangle, Length
mirror_14 = Mirror(Geometry=boxrec_18, Plane=yz_7)  # -> Geometry, Transform
amp_15 = Amplitude(Vector=dispatch_46.ListA, Amplitude=Slider(0.1, range=0.1..0.5))
amp_16 = Amplitude(Vector=dispatch_47.ListB, Amplitude=Slider(0.1, range=0.1..0.5))
move_20 = Move(Geometry=pt_39, Motion=Y_19)  # -> Geometry, Transform
dispatch_49 = Dispatch(List=flip_65, DispatchPattern=[True, False])  # -> ListA, ListB
flip_69 = FlipMatrix(Data=pt_44)
cull_i_2 = CullIndex(List=pframes_5.Frames, Indices="-1", Wrap=True)
rectangle_37 = Rectangle(Plane=cull_i_2, XSize=neg_44, YSize=multiplication_9, Radius=0)  # -> Rectangle, Length
dispatch_50 = Dispatch(List=flip_66, DispatchPattern=[True, False])  # -> ListA, ListB
dispatch_51 = Dispatch(List=flip_67, DispatchPattern=[True, False])  # -> ListA, ListB
dispatch_52 = Dispatch(List=flip_68, DispatchPattern=[True, False])  # -> ListA, ListB
cull_i_3 = CullIndex(List=pframes_6.Frames, Indices="-1", Wrap=True)
rectangle_38 = Rectangle(Plane=[pt_38, move_20.Geometry], XSize=dom_20, YSize=neg_42, Radius=0)  # -> Rectangle, Length
cull_i_4 = CullIndex(List=pframes_7.Frames, Indices="-1", Wrap=True)
merge_24 = Merge(Data1=boxrec_18, Data2=mirror_14.Geometry)
dispatch_53 = Dispatch(List=flatten(flip_69), DispatchPattern=[True, False])  # -> ListA, ListB
vdis_15 = VectorDisplay(Anchor=pt_43, Vector=amp_15)
line_3 = LineSDL(Start=pt_43, Direction=amp_15, Length=Slider(0.05, range=0..0.1))
vdis_16 = VectorDisplay(Anchor=pt_42, Vector=amp_16)
boxrec_20 = BoxRectangle(Rectangle=rectangle_37.Rectangle, Height=num_84)
yz_8 = YZPlane(Origin=pt_37)
split_2 = SplitList(List=flatten(dispatch_49.ListB), Index="520")  # -> ListA, ListB
pt_46 = Point(dispatch_52.ListA)
amp_17 = Amplitude(Vector=dispatch_50.ListA, Amplitude=Slider(0.2, range=0.1..0.5))
pt_47 = Point(dispatch_51.ListA)

# ---- group: Unused
split_3 = SplitList(List=flatten(pt_47), Index="320")  # -> ListA, ListB
pt_48 = Point(split_3.ListB)

# ----
pt_49 = Point(dispatch_52.ListB)
rectangle_39 = Rectangle(Plane=cull_i_3, XSize=subtraction, YSize=dom_22, Radius=0)  # -> Rectangle, Length

# ---- group: Unused
split_4 = SplitList(List=flatten(amp_17), Index="320")  # -> ListA, ListB

# ----
pt_50 = Point(dispatch_53.ListA)
pt_51 = Point(dispatch_53.ListB)
X_21 = UnitX(Factor=addition_34)
line_4 = LineSDL(Start=pt_42, Direction=amp_16, Length=Slider(0.05, range=0..0.1))
pframes_8 = PerpFrames(Curve=line_3, Count=1, Align=True)  # -> Frames, Parameters
mirror_15 = Mirror(Geometry=boxrec_20, Plane=yz_8)  # -> Geometry, Transform
multiplication_10 = Multiplication(A=num_85, B="3")
amp_18 = Amplitude(Vector=split_2.ListA, Amplitude=Slider(0.2, range=0.1..0.5))
boxrec_21 = BoxRectangle(Rectangle=[rectangle_38.Rectangle, rectangle_36.Rectangle], Height=num_88)
boxrec_22 = BoxRectangle(Rectangle=rectangle_39.Rectangle, Height=num_84)
yz_9 = YZPlane(Origin=pt_37)
move_21 = Move(Geometry=pt_50, Motion=X_21)  # -> Geometry, Transform
subtraction_2 = Subtraction(A=multiplication_7, B=num_83)
X_22 = UnitX(Factor=1)
xy_18 = XYPlane(Origin=pt_47)
points_40 = PointList(Points=flatten(pt_47))

# ---- group: Rotation Angle
num_90 = Number(rad_5)

# ----
pframes_9 = PerpFrames(Curve=line_4, Count=1, Align=True)  # -> Frames, Parameters
item_48 = ListItem(List=pframes_8.Frames, Index="0", Wrap=True)
vdis_17 = VectorDisplay(Anchor=pt_49, Vector=amp_18)
split_5 = SplitList(List=flatten(dispatch_49.ListA), Index="520")  # -> ListA, ListB
split_6 = SplitList(List=flatten(pt_49), Index="520")  # -> ListA, ListB
split_7 = SplitList(List=flatten(pt_46), Index="520")  # -> ListA, ListB
X_23 = UnitX(Factor=1)
points_41 = PointList(Points=flatten(item_48))
vdis_18 = VectorDisplay(Anchor=amp_17, Vector=amp_17)
points_42 = PointList(Points=flatten(pt_49))
points_43 = PointList(Points=flatten(pt_46))
mirror_16 = Mirror(Geometry=boxrec_22, Plane=yz_9)  # -> Geometry, Transform
subtraction_3 = Subtraction(A=subtraction_2, B=multiplication_10)
X_24 = UnitX(Factor=1)
num_91 = Number(rad_5)
amp_19 = Amplitude(Vector=split_5.ListB, Amplitude=Slider(0.2, range=0.1..0.5))
rot3d_19 = Rotate3D(Geometry=xy_18, Angle=num_90, Center=xy_18, Axis=X_22)  # -> Geometry, Transform
X_25 = UnitX(Factor=1)
angle_18 = Angle(VectorA=X_23, VectorB=amp_17)  # -> Angle, Reflex
item_49 = ListItem(List=pframes_9.Frames, Index="0", Wrap=True)
rectangle_40 = Rectangle(Plane=[pt_51, move_21.Geometry], XSize=num_79, YSize=dom_17, Radius=0)  # -> Rectangle, Length
rectangle_41 = Rectangle(Plane=pt_45, XSize=num_78, YSize=dom_16, Radius=0)  # -> Rectangle, Length
pt_52 = Point(split_6.ListA)
xy_19 = XYPlane(Origin=pt_52)
split_8 = SplitList(List=flatten(item_48), Index="77")  # -> ListA, ListB
pt_53 = Point(split_7.ListB)
angle_19 = Angle(VectorA=X_25, VectorB=amp_18)  # -> Angle, Reflex
rot3d_20 = Rotate3D(Geometry=xy_19, Angle=num_91, Center=xy_19, Axis=X_24)  # -> Geometry, Transform
rectangle_42 = Rectangle(Plane=cull_i_4, XSize=subtraction_3, YSize=dom_22, Radius=0)  # -> Rectangle, Length
rad_6 = Radians(Degrees=Slider(90, range=0..90))
vdis_19 = VectorDisplay(Anchor=pt_53, Vector=amp_19)
xy_20 = XYPlane(Origin=pt_53)
boxrec_23 = BoxRectangle(Rectangle=[rectangle_40.Rectangle, rectangle_41.Rectangle], Height=num_80)
rotate_7 = Rotate(Geometry=rot3d_19.Geometry, Angle=angle_18.Angle, Plane=rot3d_19.Geometry)  # -> Geometry, Transform
split_9 = SplitList(List=flatten(item_49), Index="70")  # -> ListA, ListB
X_26 = UnitX(Factor=1)
pln_3 = Plane(split_8.ListB)
pln_4 = Plane(split_8.ListA)
neg_49 = Negative(Value=rad_6)
num_92 = Number(rad_5)
rad_7 = Radians(Degrees=Slider(90, range=0..90))
X_27 = UnitX(Factor=1)
rotate_8 = Rotate(Geometry=pln_3, Angle=neg_49, Plane=pln_3)  # -> Geometry, Transform
pln_5 = Plane(split_9.ListA)
pln_6 = Plane(split_9.ListB)
neg_50 = Negative(Value=rad_7)
angle_20 = Angle(VectorA=X_27, VectorB=amp_19)  # -> Angle, Reflex
rot3d_21 = Rotate3D(Geometry=xy_20, Angle=num_92, Center=xy_20, Axis=X_26)  # -> Geometry, Transform
merge_25 = Merge(Data1=pln_4, Data2=rotate_8.Geometry)
rotate_9 = Rotate(Geometry=pln_6, Angle=neg_50, Plane=pln_6)  # -> Geometry, Transform
rotate_10 = Rotate(Geometry=rot3d_20.Geometry, Angle=angle_19.Angle, Plane=rot3d_20.Geometry)  # -> Geometry, Transform
rotate_11 = Rotate(Geometry=rot3d_21.Geometry, Angle=angle_20.Angle, Plane=rot3d_21.Geometry)  # -> Geometry, Transform
merge_26 = Merge(Data1=pln_5, Data2=rotate_9.Geometry)
neg_51 = Negative(Value=num_66)
rectangle_43 = Rectangle(Plane=[merge_25, merge_26], XSize=num_75, YSize=dom_19, Radius=0)  # -> Rectangle, Length
merge_27 = Merge(Data1=rotate_11.Geometry, Data2=rotate_10.Geometry)
rectangle_44 = Rectangle(Plane=[rotate_7.Geometry, merge_27], XSize=num_68, YSize=neg_51, Radius=0)  # -> Rectangle, Length
boxrec_24 = BoxRectangle(Rectangle=rectangle_42.Rectangle, Height=num_84)
yz_10 = YZPlane(Origin=pt_37)
merge_28 = Merge(Data1=boxrec_24)
boxrec_25 = BoxRectangle(Rectangle=rectangle_44.Rectangle, Height=num_67)
mirror_17 = Mirror(Geometry=boxrec_24, Plane=yz_10)  # -> Geometry, Transform
boxrec_26 = BoxRectangle(Rectangle=rectangle_43.Rectangle, Height=num_76)
merge_29 = Merge(Data1=boxrec_20, Data2=mirror_15.Geometry)
merge_30 = Merge(Data1=boxrec_22, Data2=mirror_16.Geometry)
merge_31 = Merge(Data1=merge_28, Data2=mirror_17.Geometry)
