# Grasshopper definition Unit Configurations.gh (Grasshopper 1.0.7)

modulex = Slider(7, range=0..10)
moduley = Slider(6.017, range=0..10)
moduley_2 = Slider(0, range=0..30)
moduley_3 = Slider(0, range=0..30)
moduley_4 = Slider(0, range=0..30)

# ---- group: SGI
sgi_setup = SGISetup(textSize=1)  # -> check; inputs descriptions: list
# ---------- sgi_setup: Python ----------
#
# SortalGI: A Sortal/Shape Grammar Interpreter Plugin
# 
# Copyright (c) 2018-2019, Rudi Stouffs <stouffs@sortal.org> 
# 
# SortalGI is free software; you can redistribute it and/or modify 
# it under the terms of the GNU General Public License as published 
# by the Free Software Foundation; either version 3 of the License, 
# or (at your option) any later version.
# 
# SortalGI is distributed in the hope that it will be useful,
# but WITHOUT ANY WARRANTY; without even the implied warranty of 
# MERCHANTABILITY or FITNESS FOR A PARTICULAR PURPOSE. See the 
# GNU General Public License for more details, <http://www.gnu.org/licenses/>.
# 
# @license GPL-3.0+ <http://spdx.org/licenses/GPL-3.0+>


"""
Initialize the SortalGI engine.
-
Place this component first before placing any other SGI components, otherwise, use CTRL+B to ensure the node will run first.
-
The displacementX and displacementY values specify the relevant spacing between shapes resulting from rule applications (expressed as translation vectors). If no values are specified, the spacing will be calculated based on the bounding box of the input shape of the rule application.
-
Shape descriptions may be considered as attributes to shape elements, or as separate shape entities. In case of the latter, shape descriptions must be typed and type names must be predefined.
-
    Args:
        displacementX: Optional displacement value along x-axis for translating shapes resulting from rule applications
        displacementY: Optional displacement value along y-axis for translating shapes resulting from rule applications
        textSize: Optional text size for any labels or shape description that are attributes to shape elements
        descriptions: Shape description type names. These must be predefined before specified in the creation of a shape
    Returns:
        check: True or False indicating success of the setup
"""

# RHINO SPECIFIC IMPORTS | FROM PYTHON 3.5 to 2.7
from __future__ import print_function
from __future__ import division
from __future__ import unicode_literals
from __future__ import absolute_import

ghenv.Component.Name = 'SGI Setup'
ghenv.Component.NickName = 'SGI Setup'
ghenv.Component.Message = 'VER 0.7.0\nJUN_22_2019'
ghenv.Component.Category = "SGI"
ghenv.Component.SubCategory = "0 | Grammar"

ghenv.Component.Params.Input[0].Name = "displacementX"
ghenv.Component.Params.Input[0].NickName = "displacementX"
ghenv.Component.Params.Input[0].Description = 'Optional displacement value along x-axis for translating shapes resulting from rule applications'
ghenv.Component.Params.Input[1].Name = "displacementY"
ghenv.Component.Params.Input[1].NickName = "displacementY"
ghenv.Component.Params.Input[1].Description = 'Optional displacement value along y-axis for translating shapes resulting from rule applications'
ghenv.Component.Params.Input[2].Name = "textSize"
ghenv.Component.Params.Input[2].NickName = "textSize"
ghenv.Component.Params.Input[2].Description = 'Optional text size for any labels or shape description that are attributes to shape elements'
ghenv.Component.Params.Input[3].Name = "descriptions"
ghenv.Component.Params.Input[3].NickName = "descriptions"
ghenv.Component.Params.Input[3].Description = 'Shape description type names. These must be predefined before specified in the creation of a shape'
ghenv.Component.Params.Output[0].Name = "check"
ghenv.Component.Params.Output[0].NickName = "check"
ghenv.Component.Params.Output[0].Description = 'True or False indicating success of the setup'

# Grasshopper/Rhino Libraries
import Grasshopper.Kernel as gh
import System
import Rhino
import rhinoscriptsyntax as rs
import scriptcontext as sc

# Import for transformations
from mpmath import pi, sin, cos
from copy import deepcopy

# Python built-ins
from builtins import range

# Grasshopper component imports
from Grasshopper.Kernel.Special import GH_ValueList, GH_ValueListItem 

# Sortal Library Imports
from sortal import (transformSet, rule, primitiveSort, point3D, point2D, coordinate, lineSegment3D, planeSegment2D, 
                    lineSegment2D, line3D, label, rWeight, disjunctiveSort, attributeSort, affineTransform,  
                    vector3D, vector2D, planeSegment3D, enumerative, sort, description, plane3D, pointP3D, lineSegmentP3D, planeSegmentP3D,
                    circle3D, circleP3D, ellipse3D, ellipseP3D, circularArc3D, ellipticalArc3D, bezierCurve3D, bezierCurveP3D)

try: ghenv.Component.AdditionalHelpFromDocStrings = "1"
except: pass

w = gh.GH_RuntimeMessageLevel.Warning
e = gh.GH_RuntimeMessageLevel.Error
                                        
# The class 'parse_disjunctive_sort' (i.e. the setup file) currently supports initializing the following sort types:
# GEOMETRIC SUPPORT - point, line segments
# Note: while plane is initialized in the code here, it is mainly to support the components Mirror and Rotate
sc.sticky['fixed_factor'] = 2.0

if type(textSize) == type(''):
    textSize = float(textSize)
if type(textSize) == type(1.0) and textSize> 0.0:
    sc.sticky['text_size'] = textSize
else:
    sc.sticky['text_size'] = 3.5

if type(displacementX) == type(''):
    displacementX = float(displacementX)
if type(displacementX) == type(1.0) or type(displacementX) == type(0):
    sc.sticky['dispersion_x'] = displacementX
else:
    sc.sticky['dispersion_x'] = False
    
if type(displacementY) == type(''):
    displacementY = float(displacementY)
if type(displacementY) == type(1.0) or type(displacementY) == type(0):
    sc.sticky['dispersion_y'] = displacementY
else:
    sc.sticky['dispersion_y'] = False
            
sort.register.clear()
rule.register.clear()

geomTypes = ['point', 'lineSeg', 'planeSeg', 'circle', 'ellipse', 'arc', 'bezier']

try:
    # Parametric geometric sorts
    pointSortP3D = primitiveSort('pointP3D', pointP3D)
    lineSegSortP3D = primitiveSort('lineSegP3D', lineSegmentP3D)
    planeSegSortP3D = primitiveSort('planeSegP3D', planeSegmentP3D) 
    circleSortP3D = primitiveSort('circleP3D', circleP3D) 
    ellipseSortP3D = primitiveSort('ellipseP3D', ellipseP3D) 
    bezSortP3D = primitiveSort('bezierP3D', bezierCurveP3D)
    
    # Non-parametric geometric sorts
    pointSort3D = primitiveSort('point3D', point3D)
    lineSegSort3D = primitiveSort('lineSeg3D', lineSegment3D)
    planeSegSort3D = primitiveSort('planeSeg3D', planeSegment3D) 
    plSort = primitiveSort('plane', plane3D)
    circleSort3D = primitiveSort('circle3D', circle3D) 
    ellipseSort3D = primitiveSort('ellipse3D', ellipse3D) 
    arcSort3D = primitiveSort('arc3D', circularArc3D)  
    bezSort3D = primitiveSort('bezier3D', bezierCurve3D)
    
    # Initializes primitive attribute sorts in sortal library
    labelDescSort = primitiveSort('labelD', description)
    pointDescSort = primitiveSort('pLabelD', description)
    lineDescSort = primitiveSort('lLabelD', description)
    planeDescSort = primitiveSort('plLabelD', description)
    circleDescSort = primitiveSort('cLabelD', description)
    ellipseDescSort = primitiveSort('eLabelD', description)
    arcDescSort = primitiveSort('aLabelD', description)
    bezDescSort = primitiveSort('bLabelD', description)
    
    # For specific use with class partse_disjunctive_sort
    sortTypes = {'point3D': pointSort3D, 'lineSeg3D': lineSegSort3D, 'planeSeg3D': planeSegSort3D, 'circle3D': circleSort3D, 'ellipse3D': ellipseSort3D, 'arc3D': arcSort3D, 'bezier3D': bezSort3D, \
                 'pointP3D': pointSortP3D, 'lineSegP3D': lineSegSortP3D, 'planeSegP3D': planeSegSortP3D, 'circleP3D': circleSortP3D, 'ellipseP3D': ellipseSortP3D, 'bezierP3D': bezSortP3D, \
                 'pLabelD': pointDescSort, 'lLabelD': lineDescSort, 'plLabelD': planeDescSort, 'cLabelD': circleDescSort, 'eLabelD': ellipseDescSort, 'aLabelD': arcDescSort, 'bLabelD': bezDescSort, 'labelD': labelDescSort}

    sc.sticky['geo_sort_names'] = ['point3D', 'lineSeg3D', 'planeSeg3D', 'circle3D', 'ellipse3D', 'arc3D', 'bezier3D']
    sc.sticky['pgeo_sort_names'] = ['pointP3D', 'lineSegP3D', 'planeSegP3D', 'circleP3D', 'ellipseP3D', '', 'bezierP3D']
    sc.sticky['attr_sort_names'] = ['pLabelD', 'lLabelD', 'plLabelD', 'cLabelD', 'eLabelD', 'aLabelD', 'bLabelD']
except:
    pass
        
# Class definiton for disjunctive sort setup 
class parse_disjunctive_sort:
                            
    def parseDisjSort(self, descs = None):
                    
        check = True
        sc.sticky['check'] = check
        sc.sticky['sortal_setup'] = check
        mainSorts = []   # Completed sorts
        attribSorts = [] # Attribute sorts for corresponding index of completed sorts
        descSorts = []

        if descs == None:
            descs = []
        elif type(descs) != type([]):
            descs = descs.split('\r\n')
        elif len(descs) == 1 and '\r\n' in descs[0]:
            descs = descs[0].split('\r\n')   
        
        if type(descs) == type([]) and len(descs) > 0:
            descSorts = self.makeDescription(descs)
            
        for ind in range(len(geomTypes)):
            baseSort = sortTypes[sc.sticky['geo_sort_names'][ind]]
            attribSort = sortTypes[sc.sticky['attr_sort_names'][ind]]
            fullSortName = baseSort.name + '_' + attribSort.name
                
            # Checks if full attribute sort already exists
            # If yes, takes previously determined attribute sort and assigns it to fullSort
            # If no, creates attributeSort to assign to fullSort

            if attributeSort.checkSort(fullSortName) == False:
                fullSort = attributeSort(fullSortName, baseSort, attribSort)
            else:
                fullSort = attributeSort.register[fullSortName]
               
            mainSorts.append(fullSort)
        
        for descSort in descSorts:
            mainSorts.append(descSort)
            
        # Creates disjunctive sort for metaform if it does not already in the register of sort type names
        if disjunctiveSort.checkSort('rhino_shapes') == False:             # If 'rhino_shapes' corresponding sort not yet in sort register, creates sort
            fullDisjSort = disjunctiveSort('rhino_shapes', mainSorts)      # If already in sort register, retrieves sort
        else:
            fullDisjSort = disjunctiveSort.register['rhino_shapes']     
        
        return fullDisjSort   
    
    # Initializes description types based on input to 'descriptions'
    def makeDescription(self, descs):
        descSorts = []

        # Checks if description sort type already exists
        # If description sort already present, ignored
        # If not present, new description primitive sort created
        for desc in descs:
            if desc not in sort.register:
                descSorts.append(primitiveSort(desc, description))
    
        return descSorts
    
# GUIDE
# The input of tuples is as follows
# <discursiveSort instance>.parseDiscSort( <point>, <line segment>, <... potentially other geometry types in the future ...> )
                        
# For any given tuple of True/False values, the order of value setting is as follows
# 0. Existence of individual

# While attributes are not yet functional in this version, they would potentially follow the order
# stated below in future implementations
# 1. Label
# 2. Description
# 3. Enumerative - values and sorting order need to be specified by user/developer; prompt is built into code
# 4. Weight - weight sort, which accepts values from 0 to 1
# 5. Weight255 - weight sort, which accepts integer values from 0 to 255
# 6. Color - color sort, which accepts RGB values (e.g. (120, 30, 40))
                        
# EXAMPLE
# For a point with label, description, weight255 and enumerative enabled
# (True, True, True, True, True, False)

# In this version, both points and line segments are enabled so the tuple is ((True,), (True, True))
# The True value in the first tuple must be enclosed with a parentheses and followed by a comma to
# ensure that it is read as tuple

pds = parse_disjunctive_sort()
fullDisjSort = pds.parseDisjSort(descriptions)

if 'check' in sc.sticky:
    for scriptObj in ghenv.Component.OnPingDocument().Objects:
        if ('SGI' in scriptObj.Name and 'Shape' in scriptObj.Name) or 'Text' in scriptObj.Name:
            scriptObj.ExpireSolution(True)
            
    #GH_Document.NewSolution(False)
"""
if 'check' in sc.sticky:
    for scriptObj in ghenv.Component.OnPingDocument().Objects:
        if 'SGI Shape' in scriptObj.Name:
            ghenv.Component.OnPingDocument().NewSolution(False)
            break
"""
sc.sticky['check'] = True
check = sc.sticky['check']

class fixedData(object):
    """ Set of functions to prepare the GH file for updating components according to version date"""
    def __init__(self):
        self.monthList = ['JAN', 'FEB', 'MAR', 'APR', 'MAY', 'JUN', 'JUL', 'AUG', 'SEP', 'OCT', 'NOV', 'DEC']
        self.numOfDays = [0, 31, 59, 90, 120, 151, 181, 212, 243, 273, 304, 334, 365]
        self.numOfDaysEachMonth = [31, 28, 31, 30, 31, 30, 31, 31, 30, 31, 30, 31]
        self.numOfHours = [24 * numOfDay for numOfDay in self.numOfDays]
        
    def getJD(self, month, day):
        numOfDays = [0, 31, 59, 90, 120, 151, 181, 212, 243, 273, 304, 334]
        return numOfDays[int(month)-1] + int(day)

# FixedData class keeps track of version number      
sc.sticky["sgi_fixedData"] = fixedData

# Counter label for the iteration of the disjunctive sort 'rhino_shapes' (used in handling disjunctive sorts with different description types inside)
sc.sticky['sort_count'] = 0

for x in sort.register['rhino_shapes'].component:
    print (x.name)
print(sort.register['rhino_shapes'].description)

#for scriptObj in ghenv.Component.OnPingDocument().Objects:
#    print (scriptObj.Name)
# ---------- end sgi_setup ----------
panel = Panel(sgi_setup)

# ---- group: Grid
site_size = Slider(15, range=0..120)
grid_size = Slider(0.6, range=0..10)
site_size_2 = Slider(15, range=0..120)
rectangle = Rectangle(Plane=PlaneXY(0, 0, 0), XSize=site_size, YSize=site_size_2, Radius=0)  # -> Rectangle, Length
division = Division(A=site_size, B=grid_size)
division_2 = Division(A=site_size_2, B=grid_size)
panel_2 = Panel(division)
panel_3 = Panel(division_2)
cell_type = ValueList({"Quad": 0, "Tri": 1}, selected="Quad")
srf = Surface(reparameterize(rectangle.Rectangle))
python = PythonScript(srf=srf, numU=panel_2, numV=panel_3, cellType=cell_type)  # -> out, modules; inputs srf: Surface, numU: Int32, numV: Int32, cellType: Int32
# ---------- python: Python ----------
__author__ = "elisa"
__version__ = "2019.10.14"
#import Rhinoscript Syntax module
import rhinoscriptsyntax as rs
#import RhinoCommon Syntax module
import Rhino
#import the .Net Common Lang. Runtime *CLR*
import clr
#import the Grasshopper module
clr.AddReference("Grasshopper")
#import the Path and Data Tree sub-modules
from Grasshopper.Kernel.Data import GH_Path
from Grasshopper import DataTree

#Create a data tree -> with the data type defined
myTree = DataTree[Rhino.Geometry.Polyline]()
myTree2 = DataTree[Rhino.Geometry.Point3d]()

#define a Dictionary to store points
a = {}

#Create a Loop to step through *u*
for i in range(0,numU+1):
    
    #Create a Loop to step through *v*
    for j in range (0,numV+1):
        #Create a point on Surface (ref:UV)
        ###USING RHINOCOMMON
        myPoint = Rhino.Geometry.Surface.Evaluate(srf, i/numU, j/numV,0)
        #Add the point to our Dictionary
        a[(i,j)] = myPoint[1]

#Loop through Dictionary to create Polylines

#Create a Loop to step through *U* (i)
for i in range(0,numU):
    #Create a Data Path (for columns)
    myPath = GH_Path(i)
    myPath2 = GH_Path(i)
    
    #Create a Loop to step trough *v* (j)
    for j in range(0,numV):
        #Based on the CellType, create either quad or tri polylines
        if (cellType == 0):
            #Create a Quad starting from that location
            ###USING RHINOCOMMON
            myQuad = Rhino.Geometry.Polyline([a[(i,j)],a[(i+1,j)],a[(i+1,j+1)],a[(i,j+1)],a[(i,j)]])
            #Send Polylines to Data Tree
            myTree.Add(myQuad,myPath)
            myCentroid = Rhino.Geometry.Polyline.CenterPoint(myQuad)
            myTree2.Add(myCentroid,myPath2)
        else:
            #Create two Triangles from the current location
            ###USING RHINOCOMMON
            myTriA = Rhino.Geometry.Polyline([a[(i,j)],a[(i+1,j)],a[(i+1,j+1)],a[(i,j)]])
            #send polylines to Data Tree
            myTree.Add(myTriA,myPath)
            myCentroid = Rhino.Geometry.Polyline.CenterPoint(myTriA)
            myTree2.Add(myCentroid,myPath2)
            
            myTriB = Rhino.Geometry.Polyline([a[(i,j)],a[(i+1,j+1)],a[(i,j+1)],a[(i,j)]])
            #send polylines to Data Tree
            myTree.Add(myTriB,myPath)
            myCentroid = Rhino.Geometry.Polyline.CenterPoint(myTriB)
            myTree2.Add(myCentroid,myPath2)
            
#return the Data Tree (send to the output)
modules = myTree
centroids = myTree2
# ---------- end python ----------
crv = Curve(python.modules)
demesh = DeconstructMesh(Mesh=crv)  # -> Vertices, Faces, Colours, Normals

# ----
b_number = Slider(1, range=0..20)
b_number_2 = Slider(8, range=0..20)
pt = ConstructPoint(XCoordinate=moduley_2, YCoordinate=moduley_3, ZCoordinate=0)
multiplication = Multiplication(A=grid_size, B=modulex)
multiplication_2 = Multiplication(A=grid_size, B=moduley)
multiplication_3 = Multiplication(A=b_number, B=multiplication)
multiplication_4 = Multiplication(A=b_number_2, B=grid_size)
rectangle_2 = Rectangle(Plane=pt, XSize=multiplication, YSize=multiplication_2, Radius=0)  # -> Rectangle, Length
pt_2 = ConstructPoint(XCoordinate=moduley_2, YCoordinate=b_number_2, ZCoordinate=0)
panel_4 = Panel(multiplication_3)
panel_5 = Panel(multiplication_4)
pt_3 = ConstructPoint(XCoordinate=moduley_2, YCoordinate=panel_5, ZCoordinate=0)
multiplication_5 = Multiplication(A=multiplication, B="-1")
division_3 = Division(A=panel_4, B=Slider(1, range=0..10))
mplane = MeshPlane(Boundary=rectangle_2.Rectangle, WidthCount=10, HeightCount=10)  # -> Mesh, Area
pt_4 = ConstructPoint(XCoordinate=multiplication_5, YCoordinate=0, ZCoordinate=0)
multiplication_6 = Multiplication(A=pt_4, B=moduley_4)
pt_5 = ConstructPoint(XCoordinate=multiplication_6, YCoordinate=Slider(-3.6, range=-12..10), ZCoordinate=0)
move = Move(Geometry=[mplane.Mesh, rectangle_2.Rectangle], Motion=pt_5)  # -> Geometry, Transform
division_4 = Division(A=panel_5, B=Slider(1.902, range=0..10))
rectangle_3 = Rectangle(Plane=pt_2, XSize=division_3, YSize=division_3, Radius=0)  # -> Rectangle, Length
dshape = SGIDShape(G=[mplane.Mesh, rectangle_2.Rectangle], refP=pt_4)  # -> S, G, D; inputs G: list, D: list, refP: Point3d
# ---------- dshape: Python ----------
#
# SortalGI: A Sortal/Shape Grammar Interpreter Plugin
# 
# Copyright (c) 2018-2019, Rudi Stouffs <stouffs@sortal.org> 
# 
# SortalGI is free software; you can redistribute it and/or modify 
# it under the terms of the GNU General Public License as published 
# by the Free Software Foundation; either version 3 of the License, 
# or (at your option) any later version.
# 
# SortalGI is distributed in the hope that it will be useful,
# but WITHOUT ANY WARRANTY; without even the implied warranty of 
# MERCHANTABILITY or FITNESS FOR A PARTICULAR PURPOSE. See the 
# GNU General Public License for more details, <http://www.gnu.org/licenses/>.
# 
# @license GPL-3.0+ <http://spdx.org/licenses/GPL-3.0+>


"""
Create an SGI Shape object from geometry and/or shape descriptions, and an optional reference point.
-
Any part of the geometry not recognized will be ignored.
-
The shape descriptions may be omitted, so may be the geometry, but not both together
-
When specifying a reference point, the geometry will be moved from the reference point to the origin, allowing a shape that will serve as the left-hand-side or right-hand-side to a rule to be drawn or specified spatially separated from the other side of the rule.
-
    Args:
        G: Geometry (points, lines, polylines, (flat) surfaces, meshes, boundary representations, circles, ellipses, (circular) arcs, quadratic Bezier curves and/or text objects)
        D: One or more shape descriptions, each preceded by the description type (name) and a colon (multiple shape descriptions of the same type can be combined into a single item by separating them with a vertical bar)
        refP: Optional reference point (geometry will be moved from reference point to origin)
    Returns:
        S: Resulting shape object
        G: Geometry of the shape object
        D: Shape descriptions of the shape object (attribute descriptions are not included as they are already part of the geometry)
"""

ghenv.Component.Name = 'SGI dShape'
ghenv.Component.NickName = 'dShape'
ghenv.Component.Message = 'VER 0.7.0\nAUG_27_2019'
ghenv.Component.Category = "SGI"
ghenv.Component.SubCategory = "1 | Shape"

ghenv.Component.Params.Input[0].Name = "G"
ghenv.Component.Params.Input[0].NickName = "G"
ghenv.Component.Params.Input[0].Description = 'Geometry (points, lines, polylines, (flat) surfaces, meshes, boundary representations, circles, ellipses, (circular) arcs, quadratic Bezier curves and/or text objects)'
ghenv.Component.Params.Input[1].Name = "refP"
ghenv.Component.Params.Input[1].NickName = "D"
ghenv.Component.Params.Input[1].Description = 'One or more shape descriptions, each preceded by the description type (name) and a colon (multiple shape descriptions of the same type can be combined into a single item by separating them with a vertical bar)'
ghenv.Component.Params.Input[2].Name = "refP"
ghenv.Component.Params.Input[2].NickName = "refP"
ghenv.Component.Params.Input[2].Description = 'Optional reference point (geometry will be moved from reference point to origin)'
ghenv.Component.Params.Output[0].Name = "S"
ghenv.Component.Params.Output[0].NickName = "S"
ghenv.Component.Params.Output[0].Description = 'Resulting shape object'
ghenv.Component.Params.Output[1].Name = "G"
ghenv.Component.Params.Output[1].NickName = "G"
ghenv.Component.Params.Output[1].Description = 'Geometry of the shape object'
ghenv.Component.Params.Output[2].Name = "D"
ghenv.Component.Params.Output[2].NickName = "D"
ghenv.Component.Params.Output[2].Description = 'Shape descriptions of the shape object (attribute descriptions are not included as they are already part of the geometry)'

try: ghenv.Component.AdditionalHelpFromDocStrings = "1"
except: pass

__author__ = "akidribm"

import Grasshopper.Kernel as gh
import System
import Rhino
import rhinoscriptsyntax as rs
from sortal import (transformSet, rule, primitiveSort, point3D, point2D, coordinate, lineSegment3D, planeSegment2D, 
                    lineSegment2D, line3D, label, rWeight, disjunctiveSort, attributeSort, affineTransform,  
                    vector3D, vector2D, planeSegment3D, description, label, enumerative, sort, sdlParser, key)

import Rhino.Geometry as rg
import Rhino.DocObjects as rdo
import Rhino as r
import rhinoscriptsyntax as rs
import clr
import scriptcontext as sc
import System as sy
from copy import deepcopy
from math import sqrt
from random import random
from mpmath import pi, sin, cos, tan

# Node-in-Code import
import ghpythonlib.components as ghcomp

w = gh.GH_RuntimeMessageLevel.Warning
e = gh.GH_RuntimeMessageLevel.Error

rhdoc = Rhino.RhinoDoc.ActiveDoc

class TextGoo(gh.Types.GH_GeometricGoo[r.Display.Text3d], gh.IGH_BakeAwareData, gh.IGH_PreviewData):
    #region construction
    def __init__(self, text):
        self.m_value = text
    
    @staticmethod
    def DuplicateText3d(original):
        if original is None: return None
        text = r.Display.Text3d(original.Text, original.TextPlane, original.Height)
        #text.Bold = original.Bold,
        #text.Italic = original.Italic,
        text.FontFace = original.FontFace
        return text
    
    def DuplicateGeometry(self):
        return TextGoo(TextGoo.DuplicateText3d(self.m_value))
    
    #region properties
    def get_TypeName(self):
        return "3D Text"
        
    def get_TypeDescription(self):
        return "3D Text"
    
    def ToString(self):
        if self.m_value is None: return "<null>"
        return self.m_value.Text
        
    def get_Boundingbox(self):
        if self.m_value is None:
            return r.Geometry.BoundingBox.Empty;
        return self.m_value.BoundingBox;
        
    def GetBoundingBox(self, xform):
        if self.m_value is None:
            return r.Geometry.BoundingBox.Empty
        box = self.m_value.BoundingBox
        corners = xform.TransformList(box.GetCorners())
        return r.Geometry.BoundingBox(corners)
    
    #region methods
    def Transform(self, xform):
        text = TextGoo.DuplicateText3d(self.m_value)
        if text is None: return TextGoo(None)
        
        plane = text.TextPlane
        point = plane.PointAt(1, 1)
        
        plane.Transform(xform)
        point.Transform(xform)
        dd = point.DistanceTo(plane.Origin)
        
        text.TextPlane = plane;
        text.Height *= dd / sqrt(2)
        return TextGoo(text)
        
    def Morph(self, xmorph):
        return self.DuplicateGeometry()

    #region preview
    def get_ClippingBox(self):
        return self.get_Boundingbox()
        
    def DrawViewportWires(self, args):
        if self.m_value is None: return
        args.Pipeline.Draw3dText(self.m_value, args.Color)
      
    def DrawViewportMeshes(self, args):
        # Do not draw in meshing layer.
        pass

    #region baking
    def BakeGeometry(self, doc, att, id):
        try:
            id = sy.Guid.Empty
            
            if self.m_value is None:
                return false, id
            
            if att is None:
                att = doc.CreateDefaultAttributes()
            
            id = doc.Objects.AddText(self.m_value, att)
            
            return True, id
        except Exception, ex:
            sy.Windows.Forms.MessageBox.Show(str(ex))
            return False, sy.Guid.Empty
        
# Defines shape object
# sortalForm - shape
# geometry - geometry
# description - description
class shape ():
    def __init__(self, sortalForm, geometry, description):
        self.shape = sortalForm
        self.geometry = geometry
        self.description = description
        
# Extracts Rhino Objects and converts them into a sortal metaform
class extract(object):
    
    # Sets initial object data to class
    def __init__(self, objs, descriptions):
        if type(objs) != type([]):
            self.objs = [objs]
        else:
            self.objs = objs

        for desc  in descriptions:
            self.objs.append(desc)

    # Conversion to sortal shape
    def toSortal(self):
        self.mainSorts = sort.register['rhino_shapes'].component
        self.point = False
        self.lineSeg = [False, False]
        self.planeSeg = [False, False]
        self.circle = False
        self.ellipse = False
        self.arc = False
        self.bez = False
        self.description = True
        self.geometry = []
        self.geometryRh = []
        self.descriptionText = []
        self.descSortTypes = []
        self.existingKeys = {}
        self.pointSort = None
        self.lineSegSort = None
        self.planeSegSort = None
        self.circlesSort = None
        self.ellipseSort = None
        self.arcSort = None
        self.bezSort = None
        
        # Constructs structure of sortal shape, as to which geometries are included
        for sortType in self.mainSorts:
            if 'point' in sortType.name:
                self.point = True
                self.pointSort = sortType
                
            elif 'lineSeg' in sortType.name:
                self.lineSeg[0] = True
                self.lineSegSort = sortType
                
            elif 'planeSeg' in sortType.name:
                self.planeSeg[0] = True
                self.planeSegSort = sortType
                
            elif 'circle' in sortType.name:
                self.circle = True
                self.circleSort = sortType
                
            elif 'ellipse' in sortType.name:
                self.ellipse = True
                self.ellipseSort = sortType
                
            elif 'arc' in sortType.name:
                self.arc = True
                self.arcSort = sortType
                
            elif 'bezier' in sortType.name:
                self.bez = True
                self.bezSort = sortType

        # Extracts coordinate data
        self.geometry = self.ghToCoords()
        
        # Creates sortal individuals
        sortalIndividuals = self.makeIndividuals()
        
        # Creates entire sortal shape
        formM1 = self.makeForms(sortalIndividuals)
        
        return formM1, self.geometryRh, self.descriptionText
        
    # Index in list self.geometry
    # 1. Points/Labelled Points
    # 2. Line Segments
    # 3. Plane Segments
    # 4. Circles
    # 5. Ellipses
    # 6. (Circular) Arcs
    # 7. Bezier Curves
    def ghToCoords(self):
        # Contains all geometry
        # Order: [points / labelled points, line segments, plane segments, circles, ellipses, (circular) arcs, bezier curves]
        geometry = [[] for i in self.mainSorts]
        
        # Extracts coordinate data
        for obj in self.objs:
            viable = False
            geometricObject = None
            textData = None
            
            if type(obj) == type([]):
                geometricObject = obj[0]
                textData = obj[1]
            else:
                geometricObject = obj

            # Points 
            if type(geometricObject) == rg.Point3d:
                pt = self.Point3d_to_Pt3(geometricObject)
                # Adds in descriptions/key name data
                if textData != None:
                    pt = [pt, textData]
                
                geometry[0].append(pt)
                viable = True
            elif type(geometricObject) == rg.Point:
                """
                pt = self.Point3d_to_Pt3(geometricObject.Location)
                # Adds in descriptions/key name data
                if textData != None:
                    pt = [pt, textData]
                elif geometricObject.UserDictionary.ContainsKey('label'):
                    print geometricObject.UserDictionary.GetString('label')
                    pt = [pt, geometricObject.UserDictionary.GetString('label')]
                
                geometry[0].append(pt)
                """
                viable = True
            
            # Line segments
            elif type(geometricObject) == rg.LineCurve or type(geometricObject) == rg.Line:
                nurbs_geometricObject = deepcopy(geometricObject).ToNurbsCurve()
                if nurbs_geometricObject.TryGetEllipse()[0]:
                    pass
                elif type(geometricObject) == rg.LineCurve:
                    start = self.Point3d_to_Pt3(geometricObject.PointAtStart)
                    end = self.Point3d_to_Pt3(geometricObject.PointAtEnd)
                else:
                    start = self.Point3d_to_Pt3(geometricObject.From)
                    end = self.Point3d_to_Pt3(geometricObject.To)
                line =[start, end]

                # Adds in descriptions/key name data
                if textData != None:
                    line = [line, textData]
                elif geometricObject.UserDictionary.ContainsKey('label'):
                    print geometricObject.UserDictionary.GetString('label')
                    line = [line, geometricObject.UserDictionary.GetString('label')]
                    
                geometry[1].append(line)
                viable = True
                
            # Polylines / Elliptical arcs
            elif type(geometricObject) == rg.PolylineCurve or type(geometricObject) == rg.PolyCurve:
                nurbs_geometricObject = deepcopy(geometricObject).ToNurbsCurve()
                
                # Handles elliptical arcs
                if nurbs_geometricObject.TryGetEllipse()[0]:
                    ellipse_geometricObject = nurbs_geometricObject.TryGetEllipse()[1]
                    viable = False
                    
                # Handles polylines/polycurves
                else:
                    if type(geometricObject) == rg.PolyCurve:
                        curves = geometricObject.Explode()
                    else:
                        curves = geometricObject.DuplicateSegments()
                    straight = []
                    curved = []
                    crvCount = 0   # Tracks number of successfully converted curves
                    
                    # Separates straight and curved line segments
                    for int, curve in enumerate(curves):
                        crvLength = curve.GetLength()
                        ptDistance = rg.Vector3d.Subtract(rg.Vector3d(curve.PointAtStart.X, curve.PointAtStart.Y, curve.PointAtStart.Z), rg.Vector3d(curve.PointAtEnd.X, curve.PointAtEnd.Y, curve.PointAtEnd.Z)).Length

                        if abs(crvLength - ptDistance) > 1e-15:
                            curved.append(curve)
                        else:
                            straight.append(curve)
                    
                    # Handles straight line segments
                    for curve in straight:
                        start = self.Point3d_to_Pt3(curve.PointAtStart)
                        end = self.Point3d_to_Pt3(curve.PointAtEnd)
                        line =[start, end]
                        # Adds in descriptions/key name data
                        if textData != None:
                            line = [line, textData]
                        
                        geometry[1].append(line)
                        crvCount += 1
                    
                    # Treats curved line segments as quadratic Bezier curves
                    for int, curve in enumerate(curved):
                        try:
                            if curve.HasBezierSpans:
                                start = curve.PointAtStart
                                end = curve.PointAtEnd
                                ctrl = curve.Points
                                if ctrl.Count == 3:
                                    bez = (start, ctrl.Item[1].Location, end)
                                    # Adds in descriptions/key name data
                                    if textData != None:
                                        bez = [bez, textData]
                                
                                    geometry[6].append(bez)
                                    crvCount += 1
                                else:
                                    ghenv.Component.AddRuntimeMessage(w, ('Non-parabolic bezier curves are not supported'))
                        except:
                            pass
                    # checks if curves is empty, 
                    # it happens that the obj type is given as PolyLineCurve when really it is just a LineCurve
                    if len(curves) == 0:
                        start = self.Point3d_to_Pt3(obj.PointAtStart)
                        end = self.Point3d_to_Pt3(obj.PointAtEnd)
                        line =[start, end]
                        
                        # Adds in descriptions/key name data
                        if textData != None:
                            line = [line, textData]
                        elif obj.UserDictionary.ContainsKey('label'):
                            print obj.UserDictionary.GetString('label')
                            line = [line, obj.UserDictionary.GetString('label')]

                        #self.lines.append(line)
                        geometry[1].append(line)
                        viable = True
                    # Checks if any curve data was lost from processing straight vs curved line segments
                    elif crvCount == len(curves):
                        viable = True
                    
            # Rectangles
            elif type(geometricObject) == rg.Rectangle3d:
                for i in range(4):
                    if i <3:
                        start = geometricObject.Corner(i)
                        end = geometricObject.Corner(i+1)
                    else:
                        start = geometricObject.Corner(i)
                        end = geometricObject.Corner(0)
                    line =[start, end]
                    # Adds in descriptions/key name data
                    if textData != None:
                        line = [line, textData]
                        
                    geometry[1].append(line)
                
                viable = True
                
            # BREPs
            # allows for surfaces with holes (inner)
            elif type(geometricObject) == rg.Brep:
                plane = {}
                plane['inner'] = []
                plane['outer'] = []
                
                for curve in geometricObject.Loops:
                    segments = curve.To3dCurve().DuplicateSegments()
                    
                    # Holes
                    # May be more than 1
                    if curve.LoopType == rg.BrepLoopType.Inner:
                        inner = []
                        for seg in segments:
                            start = self.Point3d_to_Pt3(seg.PointAtStart)
                            inner.append(start)
                        
                        plane['inner'].append(inner)
                    
                    # Outer bound
                    # Only 1 per brep
                    elif curve.LoopType == rg.BrepLoopType.Outer:
                        outer = []
                        for seg in segments:
                            start = self.Point3d_to_Pt3(seg.PointAtStart)
                            outer.append(start)
                        
                        if plane['outer'] != []:
                            if textData != None:
                                plane = [plane, textData]
                            elif geometricObject.UserDictionary.ContainsKey('label'):
                                print geometricObject.UserDictionary.GetString('label')
                                plane = [plane, geometricObject.UserDictionary.GetString('label')]
                            geometry[2].append(plane)
                        plane = {}
                        plane['inner'] = []
                        plane['outer'] = outer
                        
                # Adds in descriptions/key name data
                if textData != None:
                    plane = [plane, textData]
                elif geometricObject.UserDictionary.ContainsKey('label'):
                    print geometricObject.UserDictionary.GetString('label')
                    plane = [plane, geometricObject.UserDictionary.GetString('label')]
                
                geometry[2].append(plane)
                viable = True
                    
            # Meshes
            elif type(geometricObject) == rg.Mesh:
                    count =  geometricObject.Faces.Count
                    plane = [] 
                    
                    for ind in range(count):
                        vertices = geometricObject.Faces.GetFaceVertices(ind)[1:]
                        face = []
                        for vertex in vertices:
                            start = self.Point3d_to_Pt3(vertex)
                            face.append(start)
                        plane.append(face)
                    
                    # Adds in descriptions/key name data
                    if textData != None:
                        plane = [plane, textData]
                    
                    geometry[2].append(plane)
                    viable = True
                    
            elif type(geometricObject) == rg.Circle:
                center = geometricObject.Center
                c_pt1 = geometricObject.PointAt(0)
                c_pt2 = geometricObject.PointAt(2)
                circle = (center, c_pt1, c_pt2)

                # Adds in descriptions/key name data
                if textData != None:
                    circle = [circle, textData]
            
                geometry[3].append(circle)
                viable = True
                
            # Ellipses or Bezier Curves (parabolic only)
            elif type(geometricObject) == rg.Ellipse or type(geometricObject) == rg.NurbsCurve: 

                if geometricObject.IsEllipse and geometricObject.IsClosed:
                    newObj = rg.NurbsCurve.TryGetEllipse(geometricObject)[1]
                    center = newObj.Plane.Origin
                    x_dist = newObj.Radius1
                    y_dist = newObj.Radius2
                    ellPlane = newObj.Plane
                    pin_pt = geometricObject.PointAt(geometricObject.ClosestPoint(newObj.Plane.Origin)[1])
                    ellipse = (center, ellPlane, x_dist, y_dist, pin_pt)
                    
                    # Adds in descriptions/key name data
                    if textData != None:
                        ellipse = [ellipse, textData]
                    
                    geometry[4].append(ellipse)
                    viable = True
                    
                elif geometricObject.HasBezierSpans:
                    start = geometricObject.PointAtStart
                    end = geometricObject.PointAtEnd
                    ctrl = geometricObject.Points

                    if ctrl.Count == 3:
                        bez = (start, ctrl.Item[1].Location, end)
                        # Adds in descriptions/key name data
                        if textData != None:
                            bez = [bez, textData]
                        
                        geometry[6].append(bez)
                        viable = True
                    else:
                        ghenv.Component.AddRuntimeMessage(w, ('Non-parabolic bezier curves are not supported'))
                else:
                    ghenv.Component.AddRuntimeMessage(w, ('Ellipse-like geometricObjectect cannot be converted to a RhinoCommon ellipse'))
                    
            # Circular arcs
            elif type(geometricObject) == rg.ArcCurve or type(geometricObject) == rg.Arc:
                if geometricObject.IsCompleteCircle:
                    center = geometricObject.TryGetCircle()[1].Center
                    c_pt1 = geometricObject.TryGetCircle()[1].PointAt(0)
                    c_pt2 = geometricObject.TryGetCircle()[1].PointAt(2)
                    circle = (center, c_pt1, c_pt2)
    
                    # Adds in descriptions/key name data
                    if textData != None:
                        circle = [circle, textData]
                    elif geometricObject.UserDictionary.ContainsKey('label'):
                        print geometricObject.UserDictionary.GetString('label')
                        circle = [circle, geometricObject.UserDictionary.GetString('label')]
                
                    geometry[3].append(circle)
                    viable = True
                else:
                    if type(geometricObject) == rg.Arc:
                        start = geometricObject.StartPoint
                        end = geometricObject.EndPoint
                        center = geometricObject.Center
                    else:
                        start = geometricObject.PointAtStart
                        end = geometricObject.PointAtEnd
                        center = geometricObject.Arc.Center
                    
                    pin_pt = geometricObject.PointAt(15)
                    cArc = (center, start, end, pin_pt)
                    # Adds in descriptions/key name data
                    if textData != None:
                        cArc = [cArc, textData]
                    geometry[5].append(cArc)
                    viable = True
                    
            elif type(geometricObject) ==  type('a'):
                descText = geometricObject

                # Prunes geometricObject in case of multiline Panel component
                if '\r\n' in geometricObject:
                    descText = descText.split('\r\n')
                    
                    for descObj in descText:
                        for count, letter in enumerate(descObj):
                            if letter == ':':
                                name = descObj[0:count]
                                content = descObj[count+1:].split('|')
                                geometry[7].append([name, content])
                                break
                                
                    viable = True
                else:
                    for count, letter in enumerate(geometricObject):
                        if letter == ':':
                            name = geometricObject[0:count]
                            content = geometricObject[count+1:].split('|')
                            geometry[7].append([name, content])
                            break
                    
                    viable = True

            else:
               try:
                    newObj = rhdoc.Objects.Find(geometricObject)
                    if newObj != None:
                        text = newObj.DisplayText
                        location = self.Point3d_to_Pt3(newObj.TextGeometry.Plane.Origin)
                        pt = [location, text]
                        geometry[0].append(pt)
                        geometricObject = newObj
                        viable = True
               except:
                    if type(geometricObject) == r.Display.Text3d:
                        if len(geometry[0]) > 0:
                            text = geometricObject.Text.split('|')
                            location = self.Point3d_to_Pt3(geometricObject.TextPlane.Origin)
                            if location == geometry[0][-1]:
                                pt = [location, text]
                                geometry[0][-1] = pt
                        viable = True
                  
            if viable == False:
                ghenv.Component.AddRuntimeMessage(w, 'Input contains unsupported geometries. You have inputted a '+ str(type(geometricObject)))

            if type(geometricObject) != type('a'):
                self.geometryRh.append(geometricObject)
            else: 
                self.descriptionText.append(geometricObject)
                
        return geometry

    # Extracts point data
    # If refPoint non-zero, then coordinates are extract w.r.t. refPoint
    def Point3d_to_Pt3(self, rhino_pt):
        try:
            x = rhino_pt.X 
            y = rhino_pt.Y 
            z = rhino_pt.Z 
        except:
            x = rhino_pt[0] 
            y = rhino_pt[1]
            z = rhino_pt[2] 

        return [x, y, z]
    
    # Creates sortal individuals; to be collected later on in sortal shape
    def makeIndividuals(self):
        sortalIndividuals = [[] for i in range(len(self.geometry))]
       
        for ind, set in enumerate(self.geometry):
            # Points and Text Points
            if ind == 0:
                for coordSet in set:
                    if len(coordSet) == 3 and type(coordSet[0]) == type(1.0):
                        individual = self.makePoint(coordSet, self.pointSort)
                    elif len(coordSet) == 2 and type(coordSet[0]) == type([]):
                        individual = self.makePoint(coordSet[0], self.pointSort)
                        individual = self.makeTextData(individual, coordSet[1])
                    sortalIndividuals[ind].append(individual)
                    
            # Line segments
            elif ind == 1:
                for coordSet in set:
                    if len(coordSet) == 2 and len(coordSet[0]) == 3:
                        individual = self.makeLineSeg(coordSet, self.lineSegSort)
                    elif len(coordSet) == 2 and len(coordSet[0]) == 2:
                        individual = self.makeLineSeg(coordSet[0], self.lineSegSort)
                        individual = self.makeTextData(individual, coordSet[1])
                    sortalIndividuals[ind].append(individual)
           
            # Plane Segments
            elif ind == 2:
                for coordSet in set:
                    if type(coordSet) == type({}):
                        individual = self.makePlane(coordSet, self.planeSegSort)
                    elif type(coordSet) == type([]):
                        individual = self.makePlane(coordSet[0], self.planeSegSort)
                        individual = [individual[0], individual[1], coordSet[1]]
                    sortalIndividuals[ind].append(individual)
            # Circles
            elif ind == 3:
                for coordSet in set:
                    if type(coordSet) == type(()):
                        individual = self.makeCircle(coordSet, self.circleSort)
                    elif type(coordSet) == type([]):
                        individual = self.makeCircle(coordSet[0], self.circleSort)
                        individual = self.makeTextData(individual, coordSet[1])
                    sortalIndividuals[ind].append(individual)
            # Ellipses
            elif ind == 4:
               for coordSet in set:
                    if type(coordSet) == type(()):
                        individual = self.makeEllipse(coordSet, self.ellipseSort)
                    elif type(coordSet) == type([]):
                        individual = self.makeEllipse(coordSet[0], self.ellipseSort)
                        individual = self.makeTextData(individual, coordSet[1])
                    sortalIndividuals[ind].append(individual)
            # (Circular) Arcs
            elif ind == 5:
                for coordSet in set:
                    if type(coordSet) == type(()):
                        individual = self.makeArc(coordSet, self.arcSort)
                    else:
                        individual = self.makeArc(coordSet[0], self.arcSort)
                        individual = self.makeTextData(individual, coordSet[1])
                    sortalIndividuals[ind].append(individual)
                    
            # Bezier Curves
            elif ind == 6:
                for coordSet in set:
                    if type(coordSet) == type(()):
                        individual = self.makeBezier(coordSet, self.bezSort)
                    else:
                        individual = self.makeBezier(coordSet[0], self.bezSort)
                        individual = self.makeTextData(individual, coordSet[1])
                    sortalIndividuals[ind].append(individual)
            # Descriptions (standalone, individual)
            elif ind == 7:
                for desc in set:
                    descObjs = self.makeDescription(desc)
                    if descObjs != None:
                        for thing in descObjs:
                            sortalIndividuals[ind].append(thing)

        return sortalIndividuals
                    
    # Makes pt individual                 
    def makePoint(self, coordSet, mainSort):
        individual = point3D(mainSort, coordSet[0], coordSet[1], coordSet[2])
        return individual         

    # Makes line segment/disconnected polyline line segment individuals
    def makeLineSeg(self, coordSet, mainSort):
        if type(coordSet[0][0]) == type([]):
            coordData = coordSet[0]
            v1 = vector3D(coordData[0][0], coordData[0][1], coordData[0][2])
            v2 = vector3D(coordData[1][0], coordData[1][1], coordData[1][2])
        else:
            v1 = vector3D(coordSet[0][0], coordSet[0][1], coordSet[0][2])
            v2 = vector3D(coordSet[1][0], coordSet[1][1], coordSet[1][2])
        
        if v1 != v2:
            individual = lineSegment3D(mainSort, v1, v2)
            return individual
    
    def makePlane(self, coordSet, mainSort):
        pOut = []
        pIn = []
        
        if type(coordSet) == type ([]):
            for coords in coordSet:
                face = []
                for curve in coords:
                    v1 = vector3D(curve[0], curve[1], curve[2])
                    if v1 not in face:
                        face.append(v1)
                
                pOut.append(planeSegment3D(mainSort, face))

        elif type(coordSet) == type({}):
            outerCoords = coordSet["outer"]
            innerCoords = coordSet["inner"]
            outerBounds = []
            innerBounds = []
            
            for curve in outerCoords:

                v1 = vector3D(curve[0], curve[1], curve[2])            
                outerBounds.append(v1)

            outerBounds.append(outerBounds[0])

            pOut = planeSegment3D(mainSort, outerBounds)
            
            if len(innerCoords) != 0:
                for curveSet in innerCoords:
                    oneBound = []

                    for thing in curveSet:
                        v1 = vector3D(thing[0], thing[1], thing[2])        
                        oneBound.append(v1)
                    
                    oneBound.append(oneBound[0])
                    innerBounds.append(oneBound)

                if len(innerBounds) != 0:
                    for bound in innerBounds:
                        pIn.append(planeSegment3D(mainSort, bound))
            
        individual = [pOut, pIn]

        return individual
    
    def makeCircle(self, coordSet, mainSort):
        center = vector3D(coordSet[0][0], coordSet[0][1], coordSet[0][2])
        c_pt1 = vector3D(coordSet[1][0], coordSet[1][1], coordSet[1][2])
        c_pt2 = vector3D(coordSet[2][0], coordSet[2][1], coordSet[2][2])
        individual = mainSort.baseSort().characteristic(mainSort, center, c_pt1, c_pt2)
    
        return individual
        
    def makeEllipse(self, coordSet, mainSort):
        center_coords = coordSet[0]
        center = vector3D(coordSet[0][0], coordSet[0][1], coordSet[0][2])
        shortPt_coords = coordSet[-1]
        ellPlane = coordSet[1]
        
        if coordSet[2] > coordSet[3]:
            majDist = coordSet[2]
            minDist = coordSet[3]
        else:
            minDist = coordSet[2]
            majDist = coordSet[3]
        
        cDist = sqrt(majDist**2 - minDist**2)
        shortVec = center_coords - shortPt_coords
        shortUnit = deepcopy(shortVec)
        shortUnit.Unitize()
        normUnit = deepcopy(ellPlane.Normal)
        normUnit.Unitize()
        longUnit = rg.Vector3d.CrossProduct(shortUnit, normUnit)
        longUnit.Unitize()
        
        if majDist == coordSet[2]:
            foc1 = coordSet[0] + rg.Vector3d.Multiply(longUnit, cDist)
            foc2 = coordSet[0] - rg.Vector3d.Multiply(longUnit, cDist)
        else:
            foc1 = coordSet[0] + rg.Vector3d.Multiply(longUnit, cDist)
            foc2 = coordSet[0] - rg.Vector3d.Multiply(longUnit, cDist)
            
        foc1_vec = vector3D(foc1.X, foc1.Y, foc1.Z)
        foc2_vec = vector3D(foc2.X, foc2.Y, foc2.Z)
        pin_pt_vec = vector3D(coordSet[4].X, coordSet[4].Y, coordSet[4].Z)
        individual = mainSort.baseSort().characteristic(mainSort, foc1_vec, foc2_vec, pin_pt_vec)
    
        return individual
        
    def makeArc(self, coordSet, mainSort):
        center_vec = vector3D(coordSet[0][0], coordSet[0][1], coordSet[0][2])
        start_vec = vector3D(coordSet[1][0], coordSet[1][1], coordSet[1][2])
        end_vec = vector3D(coordSet[2][0], coordSet[2][1], coordSet[2][2])
        pin_pt_vec =  vector3D(coordSet[3][0], coordSet[3][1], coordSet[3][2])
        individual = mainSort.baseSort().characteristic(mainSort, center_vec, start_vec, end_vec, pin_pt_vec)
        return individual
        
    def makeBezier(self, coordSet, mainSort):
        start_vec = vector3D(coordSet[0].X, coordSet[0].Y, coordSet[0].Z)
        ctrl_vec = vector3D(coordSet[1].X, coordSet[1].Y, coordSet[1].Z)
        end_vec = vector3D(coordSet[2].X, coordSet[2].Y, coordSet[2].Z)
        individual = mainSort.baseSort().characteristic(mainSort, start_vec, ctrl_vec, end_vec)
        return individual
    
    def makeDescription(self, desc):
        descObjs = []
        # Checks if description sort type already exists
        # If description sort already present, retrieved from sort.register
        # If not present, new description primitive sort created

        if desc[0] in sort.register:
            descSort = sort.register[desc[0]]
            
            for obj in desc[1]:
                descObj = description(descSort, '`'+obj+'`')
                self.descSortTypes.append(descSort)
                descObjs.append(descObj)
                
            return descObjs
        else:
            ghenv.Component.AddRuntimeMessage(w, ('The ' + desc[0] + ' description type has not been set up in the sortal library'))
            return
    
    def makeTextData(self, individual, labelText):
        if type(labelText) == Rhino.Display.Text3d:
            labelText = labelText.Text
            
        elif type(labelText) == TextGoo:
            labelText = labelText.m_value.Text

        if '|' in labelText:
            labelText = labelText.split('|')
        
        if type(labelText) == type(''):
            # Handles tag names
            if labelText[0] == '#' and not '.' in labelText:
                if labelText not in self.existingKeys:
                    key.createKey(labelText.split('#')[-1], individual)
                    self.existingKeys[labelText] = 1
                elif labelText in self.existingKeys:
                    key.createKey(labelText.split('#')[-1] + str(self.existingKeys[labelText]), individual)
                    self.existingKeys[labelText] += 1
            else:
                # Adds double quotes " " if labelTest has spaces or are not comparison expressions
                #if ' ' in labelText or ('?' not in labelText and '<' not in labelText and '>' not in labelText and '=' not in labelText and labelText[-1] != '"' and labelText[0] != '"' and '#' not in labelText):
                #    labelText = '"' + labelText + '"'
                newLabel = description(individual.sort.weight, "`"+labelText+"`")
                individual.addAttribute(newLabel)
            
        else:
            # Handles tag names
            for labelObj in labelText:
                if labelObj[0] == '#' and not '.' in labelObj:
                    if labelObj not in self.existingKeys:
                        key.createKey(labelObj.split('#')[-1], individual)
                        self.existingKeys[labelObj] = 1
                    elif labelObj in self.existingKeys:
                        key.createKey(labelObj.split('#')[-1] + str(self.existingKeys[labelObj]), individual)
                        self.existingKeys[labelObj] += 1
                else:
                    # Adds double quotes " " if labelTest has spaces or are not comparison expressions
                    #elif ' ' in labelObj or ('?' not in labelObj and '<' not in labelObj and '>' not in labelObj and '=' not in labelObj and labelObj[-1] != '"' and labelObj[0] != '"'):
                    #labelObj = '"' + labelObj + '"'
                    newLabel = description(individual.sort.weight, "`"+labelObj+"`")
                    individual.addAttribute(newLabel)
        return individual
    
    # Creates forms (grouped by geometry type) to be inserted into metaform
    def makeForms(self, sortalIndividuals):
        descForms = []
        newDescSorts = []
        indiv = None

        if len(sortalIndividuals) > 3:
            if len(sortalIndividuals[3]) > 0:
                for object in sortalIndividuals[3]:
                    if sort.register['rhino_shapes'].contains(object.sort) == False:
                        newDescSorts.append(object.sort)
                    descForms.append(object)
                
        if len(newDescSorts) > 0:
            disjSort = self.createNewComposite(self.mainSorts, newDescSorts) 
        else: 
            disjSort = sort.register['rhino_shapes']
        mainForm = disjSort.newForm()

        for count, indiv in enumerate(sortalIndividuals):
            if len (indiv) > 0:
                if count == 2:
                    tempHold = []
                    for object in indiv:
                        textData = object[-1]
                        tempHoldForm = disjSort.newForm()
                        
                        if type(object[0]) == type([]):
                            if 'plane' in object[0][0].type:
                                for subObj in object[0]:
                                    tempHoldForm.insert(subObj)
                        else:
                            tempHoldForm.insert(object[0])
    
                        if len(object[1]) > 0:
                            form2 = disjSort.newForm()
                            for obj in object[1]:    
                                form2.insert(obj)
                            
                            # Subtract form2 planes from form1
                            tempHoldForm.difference(form2)
                            
                        # Adds label descriptions and key name to plane segment
                        tempHoldForm = self.makeTextData(tempHoldForm.elements[0].elements[0].elements[0], textData)
                        tempHold.append(tempHoldForm)
                        
                    for object in tempHold:
                        mainForm.insert(object)

                else:
                    for obj in indiv:
                        mainForm.insert(obj)
                     
        return mainForm
    
    def createNewComposite(self, mainSorts, newDescSorts):
        components = deepcopy(mainSorts)

        for sortType in newDescSorts:
            components.append(sortType)
        
        if disjunctiveSort.sameComponent(components) is False:
            sc.sticky['sort_count'] += 1
            newDisjSort = disjunctiveSort(('rhino_shapes_'+str(sc.sticky['sort_count'])), components)
            
        else:
            newDisjSort = disjunctiveSort.sameComponent(components)

        return newDisjSort
    
    # Creates entire sortal shape
    def createMetaform(self, discSort, forms):
        if discSort.__class__ != disjunctiveSort:
            ghenv.Component.AddRuntimeMessage(w, "ERROR: Only sort types based on disjunctiveSort can be passed to create.metaForm.")
            raise TypeError
            
        formM = discSort.newForm()
        for i in forms:
            formM.insert(i)

        return formM

# Draws geometry from sortal shape's sortal form   
class draw(object):
    def __init__(self, sortalForm):
        self.sortalForm = sortalForm
        self.type = self.sortalForm.type
        self.objectIds = []
    
    # Goes through sortal form to draw individual geometries
    def toGH(self):
        if self.type == 'form-metaForm':
            elements = self.sortalForm.elements

            for element in elements:
                individuals =  element.elements
                if len(individuals) == 0:
                    continue 
                    
                # Draws points, labeled points, circles, ellipses
                if element.type == 'form-discrete' and 'description' not in individuals[0].type:
                    # Draws points and labeled points
                    if 'point' in individuals[0].type:
                        conversion = self.Point
                        
                    elif 'circle' in individuals[0].type:
                        data_prep = self.data_prep_circle
                        conversion = self.Circle
                        
                    elif 'ellipse' in individuals[0].type:
                        data_prep = self.data_prep_ellipse
                        conversion = self.Ellipse
                        
                    if type (individuals) == type([]):
                        for indiv in individuals:
                            indivData = indiv
                            if 'circle' in individuals[0].type or 'ellipse' in individuals[0].type:
                                indivData = data_prep(indiv)
                                
                            obj = conversion(indivData)
                            self.objectIds.append(obj)
                    else:
                        obj = conversion(individuals)
                        self.objectIds.append(obj)

                # Draws lines
                elif element.type == 'form-interval':
                    text, weight, lineX, lineY, lineZ = self.data_prep_line(individuals)     # Extracts line coordinates and attributes (if any) from line segments
                    obj = self.LineSeg(text, weight, lineX, lineY, lineZ, individuals)  # Plots line segments

                    for o in obj:
                        self.objectIds.append(o)
                
                # Draws planes
                elif element.type == 'form-areal' or element.type == 'form-coForm':
                    for indiv in individuals:

                        if indiv.type == 'form-coForm':
                            for object in indiv.elements:
                                planeData = self.data_prep_plane(object)
                                obj = self.PlaneSegment(planeData)
                                for item in obj:
                                    if type(item) is not TextGoo and type(item) != rg.Point3d and type(item) != rg.Brep:
                                        for subplane in item:
                                            self.objectIds.append(subplane)
                                    else:
                                        self.objectIds.append(item)
                        elif indiv.type == 'ind-planeSegment3D':
                            planeData = self.data_prep_plane(indiv)
                            obj = self.PlaneSegment(planeData)

                            for o in obj:
                                self.objectIds.append(o)
                
                # Draws circular arcs
                elif element.type == 'form-cyclical':
                    if 'circular' in individuals[0].type:
                        data_prep = self.data_prep_arc
                        conversion = self.Arc
                        
                        for indiv in individuals:
                            arcData = data_prep(indiv)
                            obj = conversion(arcData)
                            self.objectIds.append(obj)
                        
                # Draws bezier curves
                elif element.type == 'form-curve':
                    for indiv in individuals:
                        arcData = self.data_prep_bezier(indiv)
                        obj = self.Bezier(arcData)
                        self.objectIds.append(obj)
                        
        elif self.type == 'form-discrete':
            individuals = self.form.elements
            # Draws points and labeled points
            if 'point' in individuals[0].type:
                conversion = self.Point
                
            elif 'circle' in individuals[0].type:
                data_prep = self.data_prep_circle
                conversion = self.Circle
                
            elif 'ellipse' in individuals[0].type:
                data_prep = self.data_prep_ellipse
                conversion = self.Ellipse
                
            if type (individuals) == type([]):
                for indiv in individuals:
                    indivData = indiv
                    if 'circle' in individuals[0].type or 'ellipse' in individuals[0].type:
                        indivData = data_prep(indiv)
    
                    obj = conversion(indivData)
            else:
                obj = conversion(individuals)
            
            self.objectIds.append(obj)
            
        elif self.type == 'form-interval':
            individuals = self.form.elements
            text, weight, lineX, lineY, lineZ = self.data_prep(individuals) 
            obj = self.LineSeg(text, weight, lineX, lineY, lineZ, individuals)
            
            self.objectIds.append(obj)
        
        elif element.type == 'form-areal' or element.type == 'form-coForm':
            if indiv.type == 'form-coForm':
                for object in indiv.elements:
                    planeData = self.data_prep_plane(object)
                    obj = self.PlaneSegment(planeData)

            elif indiv.type == 'ind-planeSegment3D':
                planeData = self.data_prep_plane(indiv)
                obj = self.PlaneSegment(planeData)

            for o in obj:
                self.objectIds.append(o)
        
        elif element.type == 'form-cyclical' or element.type == 'form-curve':
            individuals = self.form.elements
            if element.type == 'form-cyclical':
                data_prep = self.data_prep_arc
                conversion = self.Arc
            elif element.type == 'form-curve':
                data_prep = self.data_prep_bezier
                conversion = self.Bezier
                
            for indiv in individuals:
                indivData = data_prep(indiv)
                obj = conversion(indivData)
                self.objectIds.append(obj)
        
        flattenedSet = []
        for objectSet in self.objectIds:
            if type(objectSet) == type([]):
                for obj in objectSet:
                    flattenedSet.append(obj)
            else:
                flattenedSet.append(objectSet)

        return flattenedSet
    
    # Prepares data from plane segments
    # Currently only adapts external boundary
    def data_prep_plane(self, planeSegment):
        bounds = {}
        bounds['inner'] = []
        outer = []
        bounds['normal'] = rg.Vector3d(planeSegment.normal.x, planeSegment.normal.y, planeSegment.normal.z)
        bounds['origin']  = rg.Point3d(planeSegment.pRoot.x, planeSegment.pRoot.y, planeSegment.pRoot.z)
        
        for count, bound in enumerate(planeSegment.boundaries):
            
            # Extracts outer bound (1 only)
            if count == 0:
                for point in bound.polygonal:
                    coordinates = [point.x, point.y, point.z]
                    outer.append(coordinates)
                    
                outer.append(outer[0])
                bounds['outer'] = outer
            
            # Extracts inner loops (may be greater than 1)
            elif count > 0: 
                inner = []
                for point in bound.polygonal:
                    coordinates = [point.x, point.y, point.z]
                    inner.append(coordinates)

                inner.append(inner[0])
                bounds['inner'].append(inner)
        
        bounds = self.retrieveTextData(planeSegment, bounds)
        return bounds
    
    # Prepares data from line segments
    def data_prep_line(self, line_set):
        text = []
        weight = []

        lineSeg_x = [[0 for x in range (2)] for y in range(len(line_set))]
        lineSeg_y = [[0 for x in range (2)] for y in range(len(line_set))]
        lineSeg_z = [[0 for x in range (2)] for y in range(len(line_set))]
        
        # Extracts attributes and coordinates
        for index in range(len(line_set)):

            # Extracts attributes from line segments inside line_set if there are attributes inside
            # form-discrete - labels
            # form-ordinal - weights
            # form-special - special variant of weights specifically for Rhino, does operations arithmetically
            if line_set[index].hasAttribute():
                text.append(self.retrieveTextData(line_set[index], None)[1])
            else:
                text.append([])

            # Extracts coordinates from line segments
            for j in range(2):
                if j == 0 :
                    lineSeg_x[index][j] = float(line_set[index].start.x.value)
                    lineSeg_y[index][j] = float(line_set[index].start.y.value)
                    lineSeg_z[index][j] = float(line_set[index].start.z.value)
                else: 
                    lineSeg_x[index][j] = float(line_set[index].end.x.value)
                    lineSeg_y[index][j] = float(line_set[index].end.y.value)
                    lineSeg_z[index][j] = float(line_set[index].end.z.value)

        return text, weight, lineSeg_x, lineSeg_y, lineSeg_z
    
    def data_prep_circle(self, cSource):
        center = rg.Point3d(cSource.center.x, cSource.center.y, cSource.center.z)
        pin_1 = rg.Point3d(cSource.getPoints()[1].x, cSource.getPoints()[1].y, cSource.getPoints()[1].z)
        pin_2 = rg.Point3d(cSource.getPoints()[2].x, cSource.getPoints()[2].y, cSource.getPoints()[2].z)
        radius = cSource.radius
        angle = random()*pi*2
        circle = (center, radius, pin_1, pin_2)
        circle = self.retrieveTextData(cSource, circle)
        return circle
        
    def data_prep_ellipse(self, eSource):
        center = rg.Point3d(eSource.center.x, eSource.center.y, eSource.center.z)
        foc_1 = rg.Point3d(eSource.getPoints()[0].x, eSource.getPoints()[0].y, eSource.getPoints()[0].z)
        foc_2 = rg.Point3d(eSource.getPoints()[1].x, eSource.getPoints()[1].y, eSource.getPoints()[1].z)
        shortPt = rg.Point3d(eSource.getPoints()[2].x, eSource.getPoints()[2].y, eSource.getPoints()[2].z)
    
        cDist = foc_1.DistanceTo(foc_2)/2
        bDist =  center.DistanceTo(shortPt)
        aDist = sqrt(cDist**2 + bDist**2)

        shortVec = shortPt - center
        shortDist = sqrt(shortVec.X**2 + shortVec.Y**2 + shortVec.Z**2)
        shortUnit = rg.Vector3d(shortVec.X/shortDist, shortVec.Y/shortDist, shortVec.Z/shortDist)
        normVec = rg.Vector3d(eSource.normal.x, eSource.normal.y, eSource.normal.z)
        normDist = sqrt(normVec.X**2 + normVec.Y**2 + normVec.Z**2)
        normUnit = rg.Vector3d(normVec.X/normDist, normVec.Y/normDist, normVec.Z/normDist)
        
        longUnit = rg.Vector3d.CrossProduct(shortUnit, normUnit)
        longPt = center + rg.Vector3d.Multiply(longUnit, aDist)
        
        ellipse = (center, longPt, shortPt)
        ellipse = self.retrieveTextData(eSource, ellipse)
        return ellipse
        
    def data_prep_arc(self, cArcSource):
        start = rg.Point3d(cArcSource.start.x, cArcSource.start.y, cArcSource.start.z)
        end = rg.Point3d(cArcSource.end.x, cArcSource.end.y, cArcSource.end.z)
        pin = rg.Point3d(cArcSource.pin.x, cArcSource.pin.y, cArcSource.pin.z)
        arc = (start, pin, end)
        arc = self.retrieveTextData(cArcSource, arc)
        return arc
    
    """
    def data_prep_eArc(self, eArcSource):
        # Preparation of data for computation and elliptical arc creation
        center = rg.Point3d(eArcSource.center.x, eArcSource.center.y, eArcSource.center.z)
        start = rg.Point3d(eArcSource.start.x, eArcSource.start.y, eArcSource.start.z)
        end = rg.Point3d(eArcSource.end.x, eArcSource.end.y, eArcSource.end.z)
        shortPt = rg.Point3d(eArcSource.quadPoint.x, eArcSource.quadPoint.y, eArcSource.quadPoint.z)
        foc_1 = rg.Point3d(eArcSource.getPoints()[0].x, eArcSource.getPoints()[0].y, eArcSource.getPoints()[0].z)
        foc_2 = rg.Point3d(eArcSource.getPoints()[1].x, eArcSource.getPoints()[1].y, eArcSource.getPoints()[1].z)
        
        # Computation of major, minor, foci distances    
        cDist = foc_1.DistanceTo(foc_2)/2
        bDist =  center.DistanceTo(shortPt)
        aDist = sqrt(cDist**2 + bDist**2)
    
        # Computation of minor axis (shortPt) and major axis (longPt) quad points
        shortVec = shortPt - center
        shortDist = sqrt(shortVec.X**2 + shortVec.Y**2 + shortVec.Z**2)
        shortUnit = rg.Vector3d(shortVec.X/shortDist, shortVec.Y/shortDist, shortVec.Z/shortDist)
        normVec = rg.Vector3d(eArcSource.normal.x, eArcSource.normal.y, eArcSource.normal.z)
        normDist = sqrt(normVec.X**2 + normVec.Y**2 + normVec.Z**2)
        normUnit = rg.Vector3d(normVec.X/normDist, normVec.Y/normDist, normVec.Z/normDist)
        longUnit = rg.Vector3d.CrossProduct(shortUnit, normUnit)
        longPt = center + rg.Vector3d.Multiply(longUnit, aDist)
        
        return (center, start, end, shortPt, longPt)
    """
    
    def data_prep_bezier(self, bezierSource):
        start = rg.Point3d(bezierSource.start.x, bezierSource.start.y, bezierSource.start.z)
        end = rg.Point3d(bezierSource.end.x, bezierSource.end.y, bezierSource.end.z)
        ctrl = rg.Point3d(bezierSource.controlPoint.x, bezierSource.controlPoint.y, bezierSource.controlPoint.z)
        bezier = (start, ctrl,end)
        bezier = self.retrieveTextData(bezierSource, bezier)
        return bezier
    
    def retrieveTextData(self, individual, coordData):
        textData = []
        
        if individual.hasAttribute():
            att = individual.attribute
            
            for labelDesc in att.elements:
                textData.append(labelDesc.getValue()[1:-1])
                
        if individual.key != None:
            textData.insert(0, '#'+individual.key.name)
            
        return [coordData, textData]
    
    """
    =================
    GEOMETRY PLOTTING
    =================
    """
    
    # Plots points
    # Currently supports labeled points
    def Point(self, pointSource):
        if pointSource.hasAttribute():
            attrib = pointSource.attribute # Only one source of attributes, which are label descriptions
            pt = rg.Point3d(float(pointSource.value.x.value), float(pointSource.value.y.value), float(pointSource.value.z.value))
            newPlane = rg.Plane(pt, rg.Vector3d(0,0,1))
            pt = rg.Point(pt)
            fullText = ''

            if attrib.type == 'ind-description':
                context = attrib.getValue().split('@')
                fullText = context[0][1:-1]
                
            elif attrib.type == 'form-discrete':
                for ind, element in enumerate(attrib.elements):
                    context = element.getValue().split('@')
                    text = context[0][1:-1]
                    if ind == 0:
                        fullText = text
                    else:
                        fullText += '|' + text
                
                if pointSource.key != None:
                    fullText = '#' + pointSource.key.name + '|' + fullText
                    
            elif attrib.type == 'form-metaForm':
                for ind, element in enumerate(attrib.elements):
                    context = element.elements[0].getValue().split('@')
                    text = context[0][1:-1]
                    if ind == 0:
                        fullText = text
                    else:
                        fullText += '|' + text

            if fullText != '':
                textHt = sc.sticky['text_size']
                #temp = rg.Point3d(float(pointSource.value.x.value), float(pointSource.value.y.value), float(pointSource.value.z.value))
                textPt = TextGoo(r.Display.Text3d(fullText, newPlane, textHt))
                pt.UserDictionary.Set('label', fullText)
            
            return [pt, textPt]
            
        else:
            pt = rg.Point3d(float(pointSource.value.x.value), float(pointSource.value.y.value), float(pointSource.value.z.value))
            return pt
    
    # Plots line segments
    # Currently does not support attributes
    def LineSeg(self, text, weight, lineX, lineY, lineZ, line_set):
        block = []
        sc.doc = r.RhinoDoc.ActiveDoc
        
        for index in range(len(lineX)):
            # Draws line segment
            start = rg.Point3d(lineX[index][0], lineY[index][0], lineZ[index][0])
            end = rg.Point3d(lineX[index][1], lineY[index][1], lineZ[index][1])
            line = rg.LineCurve(start, end)
            
            if len(text[index]) > 0:
                line = self.createText(line, text[index], (start+end)/2)
            
            # Collects GUIDs of line segments
            block.append(line)
        
        return block 
    
    # Creates plane segment representation (BREP, allows for trims)
    def PlaneSegment(self, boundaries):
        outer = boundaries[0]['outer']
        inner = boundaries[0]['inner']
        planeSegment = rg.Plane(boundaries[0]['origin'], boundaries[0]['normal'])
        textData = boundaries[-1]

        corners = []
        boundLines = []
        
        for bound in outer:
            corners.append(rg.Point3d(bound[0], bound[1], bound[2]))
        outerBound =  rg.PolylineCurve(corners)

        if len(inner) > 0:
            trims = []
            
            for boundSet in inner:
                corners = []
                for bound in boundSet:
                    corners.append(rg.Point3d(bound[0], bound[1], bound[2]))
                    
                innerBound = rg.PolylineCurve(corners)
                trims.append(innerBound)
            trims.append(outerBound)
            totalPlaneSeg = rg.Brep.CreatePlanarBreps(trims)
        else:
            totalPlaneSeg = rg.Brep.CreatePlanarBreps(outerBound)
        
        totalPlaneSeg = self.createText(totalPlaneSeg, textData, rg.Point3d((outer[0][0]+outer[1][0])/2, (outer[0][1]+outer[1][1])/2, (outer[0][2]+outer[1][2])/2))
        
        return totalPlaneSeg
    
    def Circle(self, cData):
        planeC = rg.Plane(cData[0][0], cData[0][2], cData[0][3])
        circle = rg.Circle(planeC, cData[0][1])
        circle = self.createText(circle, cData[1], cData[0][2])
        return circle
        
    def Ellipse(self, eData):
        center = eData[0][0]
        longPt = eData[0][1]
        shortPt = eData[0][2]
        ellipse = self.createText(ellipse, eData[1], longPt)
        return ellipse
        
    def Arc(self, cArcData):
        start = cArcData[0][0]
        end = cArcData[0][2]
        pin = cArcData[0][1]
        cArc = rg.Arc(start, pin, end)
        cArc = self.createText(cArc, cArcData[1], cArc.MidPoint)
        return cArc
    
    def Bezier(self, bezData):
        coordData = bezData[0]
        bez = rg.Curve.CreateControlPointCurve(coordData)
        bez = self.createText(bez, bezData[1], bez.PointAtStart)
        return bez
    
    # Creates text object for geometry
    def createText(self, geometry, text, plotPt):
        if len(text) > 0:
            fullText = text[0]
    
            for textBit in text[1:]:
                fullText += '|' + textBit
            
            newPlane = rg.Plane(plotPt, rg.Vector3d(0,0,1))
            textHt = sc.sticky['text_size']
            textPt = TextGoo(r.Display.Text3d(fullText, newPlane, textHt))
            return [geometry, textPt]
        else:
            return geometry
"""
# Groups geometry according to which geometries likely have text objects accompanying them (Text Points, Curves, and Surfaces)       
def clean_geometry(G):
    tempGeom = []
    index = 0
    ignore = []
    print G
    print len(G)
    while index < len(G):
        geometry = G[index]
        if type(geometry) == rg.Brep or type(geometry) == rg.Mesh or type(geometry) == rg.LineCurve or type(geometry) == rg.Line or type(geometry) == rg.Polyline or type(geometry) == rg.PolylineCurve or type(geometry) == rg.Rectangle3d or type(geometry) == rg.Circle or type(geometry) == rg.Ellipse or type(geometry) == rg.PolyCurve or type(geometry) == rg.ArcCurve or type(geometry) == rg.NurbsCurve:
            try:
                if len(G) >= 3 and type(G[index+1]) == TextGoo or type(G[index+1]) == Rhino.Display.Text3d:
                    tempGeom.append(G[index:index+3])
                    ignore.append(G[index+2])
                    index+=3
                    
                else:
                    if geometry not in ignore:
                        tempGeom.append(geometry)
                    index+=1
            #
            except:
                if geometry not in ignore:
                    tempGeom.append(geometry)
                index+=1
            #
        else:
            if geometry not in ignore:
                tempGeom.append(geometry)
            index+=1
        
    return tempGeom
"""
if 'check' in sc.sticky:
    if None not in G:
        try:
            """
            ptList = []
            textList = []
            tempG = []
        
            for obj in G:
                try:
                    if rs.ObjectType(obj) == 512:
                        textList.append(obj)
                        tempG.append(obj)
        
                except:
                    if type(obj) == rg.Point3d or type(obj) == rg.Point:
                        ptList.append(obj)
                    else: 
                        if type(obj) == r.Display.Text3d:
                            textList.append(obj)
                        tempG.append(obj)
        
                for text in textList:
                    try:
                        objCoords =  rhdoc.Objects.Find(text).TextGeometry.Plane.Origin
                        textContent = rhdoc.Objects.Find(text).TextGeometry.Text
                        location = rhdoc.Objects.Find(text).TextGeometry.Plane
                    except:
                        objCoords = text.TextPlane.Origin
                        textContent = text.Text
                        location = text.TextPlane
        
                    tempG.append(TextGoo(r.Display.Text3d(textContent, location, sc.sticky['text_size'])))
            """
            # If refP given, adjusts refP input to create vector coordinates  
            # Original input geometry retained, as deleting them will cripple the entire GH operation
            # Preview of moved objects shown when Preview is turned on
            # Vector computed is from refP to origin
            if refP != None:
                tempList = []
                transformVector = rg.Vector3d(-refP.X, -refP.Y, -refP.Z)
        
                for ind, thing in enumerate(G):
                    try:
                        try:
                            rhinoObj =  rhdoc.Objects.Find(thing)
                            T = rhinoObj.DisplayText
                            newOrigin = ghcomp.Move(rhinoObj.TextGeometry.Plane.Origin, transformVector)[0]
                            L = rg.Plane(newOrigin, rhinoObj.TextGeometry.Plane.Normal)
                        except: 
                            rhinoObj = thing
                            T = rhinoObj.Text
                            newOrigin = ghcomp.Move(rhinoObj.TextPlane.Origin, transformVector)[0]
                            L = rg.Plane(newOrigin, rhinoObj.TextPlane.Normal)
                        
                        if rhinoObj == None:
                            ghenv.Component.AddRuntimeMessage(w, 'The text you are trying to add may no longer exist in Rhino.')
                        
                        H = sc.sticky['text_size']
                        displayObj = r.Display.Text3d(T, L, H)
                        #newObj = TextGoo(displayObj)
                        #tempList.append(rg.Point3d(L.Origin))
                        #G[ind] = newObj.DuplicateGeometry()
                        G[ind] = displayObj
                        
                    except:
                        G[ind] = ghcomp.Move(thing, transformVector)[0]
                        if G[ind] == None:
                            G[ind] = thing
    
                for i in tempList:
                    if i not in G:
                        G.append(i)
            
            # Groups geometry, its Text Object and plot point together into a list
            # G = clean_geometry(G)
            
            # Returns disjunctive form from lines and points, pruned geometry
            extract1 = extract (G, D)
            S, G, D = extract1.toSortal()
            SDraw = draw(S)
            G = SDraw.toGH()
            S = shape(S, G, D)
            print S.shape 
        #"""
        except:
            # Identifies if any geometries are unsupported by SGI Shape
            if len(G) > 0:
                error_check = True
                for i in enumerate(G):
                    if type(i) != rg.PolyCurve and type(i) != rg.PolylineCurve and type(i) != rg.LineCurve and type(i) != rg.Brep and type(i) != rg.Mesh and type(i) != rg.Circle and type(i) != rg.Ellipse and type(i) != rg.NurbsCurve and type(i) != rg.ArcCurve and type(i) != rg.Rectangle3d and type(i) is not TextGoo:
                        ghenv.Component.AddRuntimeMessage(w, 'Input contains unsupported geometries. You have inputted a '+ str(type(i)))
                        error_check = False
                        
                if error_check:
                    ghenv.Component.AddRuntimeMessage(e, 'Error in rule application computation')
                    
        #"""
    #"""
    else:
        try:
            # Empty shape 
            extract1 = extract([], [])
            S, tempG, D = extract1.toSortal()
            for i in ptList:
                tempG.append(i)
            G = tempG
            SDraw = draw(S)
            G = SDraw.toGH()
            S = shape(S, G, D)
                
        except:
            pass

        if refP != None and None not in G:
            if type(refP) != Rhino.Geometry.Point3d:
                ghenv.Component.AddRuntimeMessage(w, 'Incorrect reference point input')
        else:
            if len(G) > 0:
                error_check = True
                for i in enumerate(G):
                    if type(i) != rg.PolyCurve and type(i) != rg.PolylineCurve and type(i) != rg.LineCurve and type(i) != rg.Brep and type(i) != rg.Mesh and type(i) != rg.Circle and type(i) != rg.Ellipse and type(i) != rg.NurbsCurve and type(i) != rg.ArcCurve and type(i) != rg.Rectangle3d and type(i) is not TextGoo:
                        ghenv.Component.AddRuntimeMessage(w, 'Input contains unsupported geometries. You have inputted a '+ str(type(i)))
                        error_check = False
                
    #"""            
else:
    ghenv.Component.AddRuntimeMessage(w, 'Sortal library has not yet been set up.')
# ---------- end dshape ----------
dshape_2 = SGIDShape(G=move.Geometry, refP=pt_4)  # -> S, G, D; inputs G: list, D: list, refP: Point3d
# ---------- dshape_2: Python ----------
#
# SortalGI: A Sortal/Shape Grammar Interpreter Plugin
# 
# Copyright (c) 2018-2019, Rudi Stouffs <stouffs@sortal.org> 
# 
# SortalGI is free software; you can redistribute it and/or modify 
# it under the terms of the GNU General Public License as published 
# by the Free Software Foundation; either version 3 of the License, 
# or (at your option) any later version.
# 
# SortalGI is distributed in the hope that it will be useful,
# but WITHOUT ANY WARRANTY; without even the implied warranty of 
# MERCHANTABILITY or FITNESS FOR A PARTICULAR PURPOSE. See the 
# GNU General Public License for more details, <http://www.gnu.org/licenses/>.
# 
# @license GPL-3.0+ <http://spdx.org/licenses/GPL-3.0+>


"""
Create an SGI Shape object from geometry and/or shape descriptions, and an optional reference point.
-
Any part of the geometry not recognized will be ignored.
-
The shape descriptions may be omitted, so may be the geometry, but not both together
-
When specifying a reference point, the geometry will be moved from the reference point to the origin, allowing a shape that will serve as the left-hand-side or right-hand-side to a rule to be drawn or specified spatially separated from the other side of the rule.
-
    Args:
        G: Geometry (points, lines, polylines, (flat) surfaces, meshes, boundary representations, circles, ellipses, (circular) arcs, quadratic Bezier curves and/or text objects)
        D: One or more shape descriptions, each preceded by the description type (name) and a colon (multiple shape descriptions of the same type can be combined into a single item by separating them with a vertical bar)
        refP: Optional reference point (geometry will be moved from reference point to origin)
    Returns:
        S: Resulting shape object
        G: Geometry of the shape object
        D: Shape descriptions of the shape object (attribute descriptions are not included as they are already part of the geometry)
"""

ghenv.Component.Name = 'SGI dShape'
ghenv.Component.NickName = 'dShape'
ghenv.Component.Message = 'VER 0.7.0\nAUG_27_2019'
ghenv.Component.Category = "SGI"
ghenv.Component.SubCategory = "1 | Shape"

ghenv.Component.Params.Input[0].Name = "G"
ghenv.Component.Params.Input[0].NickName = "G"
ghenv.Component.Params.Input[0].Description = 'Geometry (points, lines, polylines, (flat) surfaces, meshes, boundary representations, circles, ellipses, (circular) arcs, quadratic Bezier curves and/or text objects)'
ghenv.Component.Params.Input[1].Name = "refP"
ghenv.Component.Params.Input[1].NickName = "D"
ghenv.Component.Params.Input[1].Description = 'One or more shape descriptions, each preceded by the description type (name) and a colon (multiple shape descriptions of the same type can be combined into a single item by separating them with a vertical bar)'
ghenv.Component.Params.Input[2].Name = "refP"
ghenv.Component.Params.Input[2].NickName = "refP"
ghenv.Component.Params.Input[2].Description = 'Optional reference point (geometry will be moved from reference point to origin)'
ghenv.Component.Params.Output[0].Name = "S"
ghenv.Component.Params.Output[0].NickName = "S"
ghenv.Component.Params.Output[0].Description = 'Resulting shape object'
ghenv.Component.Params.Output[1].Name = "G"
ghenv.Component.Params.Output[1].NickName = "G"
ghenv.Component.Params.Output[1].Description = 'Geometry of the shape object'
ghenv.Component.Params.Output[2].Name = "D"
ghenv.Component.Params.Output[2].NickName = "D"
ghenv.Component.Params.Output[2].Description = 'Shape descriptions of the shape object (attribute descriptions are not included as they are already part of the geometry)'

try: ghenv.Component.AdditionalHelpFromDocStrings = "2"
except: pass

__author__ = "akidribm"

import Grasshopper.Kernel as gh
import System
import Rhino
import rhinoscriptsyntax as rs
from sortal import (transformSet, rule, primitiveSort, point3D, point2D, coordinate, lineSegment3D, planeSegment2D, 
                    lineSegment2D, line3D, label, rWeight, disjunctiveSort, attributeSort, affineTransform,  
                    vector3D, vector2D, planeSegment3D, description, label, enumerative, sort, sdlParser, key)

import Rhino.Geometry as rg
import Rhino.DocObjects as rdo
import Rhino as r
import rhinoscriptsyntax as rs
import clr
import scriptcontext as sc
import System as sy
from copy import deepcopy
from math import sqrt
from random import random
from mpmath import pi, sin, cos, tan

# Node-in-Code import
import ghpythonlib.components as ghcomp

w = gh.GH_RuntimeMessageLevel.Warning
e = gh.GH_RuntimeMessageLevel.Error

rhdoc = Rhino.RhinoDoc.ActiveDoc

class TextGoo(gh.Types.GH_GeometricGoo[r.Display.Text3d], gh.IGH_BakeAwareData, gh.IGH_PreviewData):
    #region construction
    def __init__(self, text):
        self.m_value = text
    
    @staticmethod
    def DuplicateText3d(original):
        if original is None: return None
        text = r.Display.Text3d(original.Text, original.TextPlane, original.Height)
        #text.Bold = original.Bold,
        #text.Italic = original.Italic,
        text.FontFace = original.FontFace
        return text
    
    def DuplicateGeometry(self):
        return TextGoo(TextGoo.DuplicateText3d(self.m_value))
    
    #region properties
    def get_TypeName(self):
        return "3D Text"
        
    def get_TypeDescription(self):
        return "3D Text"
    
    def ToString(self):
        if self.m_value is None: return "<null>"
        return self.m_value.Text
        
    def get_Boundingbox(self):
        if self.m_value is None:
            return r.Geometry.BoundingBox.Empty;
        return self.m_value.BoundingBox;
        
    def GetBoundingBox(self, xform):
        if self.m_value is None:
            return r.Geometry.BoundingBox.Empty
        box = self.m_value.BoundingBox
        corners = xform.TransformList(box.GetCorners())
        return r.Geometry.BoundingBox(corners)
    
    #region methods
    def Transform(self, xform):
        text = TextGoo.DuplicateText3d(self.m_value)
        if text is None: return TextGoo(None)
        
        plane = text.TextPlane
        point = plane.PointAt(1, 1)
        
        plane.Transform(xform)
        point.Transform(xform)
        dd = point.DistanceTo(plane.Origin)
        
        text.TextPlane = plane;
        text.Height *= dd / sqrt(2)
        return TextGoo(text)
        
    def Morph(self, xmorph):
        return self.DuplicateGeometry()

    #region preview
    def get_ClippingBox(self):
        return self.get_Boundingbox()
        
    def DrawViewportWires(self, args):
        if self.m_value is None: return
        args.Pipeline.Draw3dText(self.m_value, args.Color)
      
    def DrawViewportMeshes(self, args):
        # Do not draw in meshing layer.
        pass

    #region baking
    def BakeGeometry(self, doc, att, id):
        try:
            id = sy.Guid.Empty
            
            if self.m_value is None:
                return false, id
            
            if att is None:
                att = doc.CreateDefaultAttributes()
            
            id = doc.Objects.AddText(self.m_value, att)
            
            return True, id
        except Exception, ex:
            sy.Windows.Forms.MessageBox.Show(str(ex))
            return False, sy.Guid.Empty
        
# Defines shape object
# sortalForm - shape
# geometry - geometry
# description - description
class shape ():
    def __init__(self, sortalForm, geometry, description):
        self.shape = sortalForm
        self.geometry = geometry
        self.description = description
        
# Extracts Rhino Objects and converts them into a sortal metaform
class extract(object):
    
    # Sets initial object data to class
    def __init__(self, objs, descriptions):
        if type(objs) != type([]):
            self.objs = [objs]
        else:
            self.objs = objs

        for desc  in descriptions:
            self.objs.append(desc)

    # Conversion to sortal shape
    def toSortal(self):
        self.mainSorts = sort.register['rhino_shapes'].component
        self.point = False
        self.lineSeg = [False, False]
        self.planeSeg = [False, False]
        self.circle = False
        self.ellipse = False
        self.arc = False
        self.bez = False
        self.description = True
        self.geometry = []
        self.geometryRh = []
        self.descriptionText = []
        self.descSortTypes = []
        self.existingKeys = {}
        self.pointSort = None
        self.lineSegSort = None
        self.planeSegSort = None
        self.circlesSort = None
        self.ellipseSort = None
        self.arcSort = None
        self.bezSort = None
        
        # Constructs structure of sortal shape, as to which geometries are included
        for sortType in self.mainSorts:
            if 'point' in sortType.name:
                self.point = True
                self.pointSort = sortType
                
            elif 'lineSeg' in sortType.name:
                self.lineSeg[0] = True
                self.lineSegSort = sortType
                
            elif 'planeSeg' in sortType.name:
                self.planeSeg[0] = True
                self.planeSegSort = sortType
                
            elif 'circle' in sortType.name:
                self.circle = True
                self.circleSort = sortType
                
            elif 'ellipse' in sortType.name:
                self.ellipse = True
                self.ellipseSort = sortType
                
            elif 'arc' in sortType.name:
                self.arc = True
                self.arcSort = sortType
                
            elif 'bezier' in sortType.name:
                self.bez = True
                self.bezSort = sortType

        # Extracts coordinate data
        self.geometry = self.ghToCoords()
        
        # Creates sortal individuals
        sortalIndividuals = self.makeIndividuals()
        
        # Creates entire sortal shape
        formM1 = self.makeForms(sortalIndividuals)
        
        return formM1, self.geometryRh, self.descriptionText
        
    # Index in list self.geometry
    # 1. Points/Labelled Points
    # 2. Line Segments
    # 3. Plane Segments
    # 4. Circles
    # 5. Ellipses
    # 6. (Circular) Arcs
    # 7. Bezier Curves
    def ghToCoords(self):
        # Contains all geometry
        # Order: [points / labelled points, line segments, plane segments, circles, ellipses, (circular) arcs, bezier curves]
        geometry = [[] for i in self.mainSorts]
        
        # Extracts coordinate data
        for obj in self.objs:
            viable = False
            geometricObject = None
            textData = None
            
            if type(obj) == type([]):
                geometricObject = obj[0]
                textData = obj[1]
            else:
                geometricObject = obj

            # Points 
            if type(geometricObject) == rg.Point3d:
                pt = self.Point3d_to_Pt3(geometricObject)
                # Adds in descriptions/key name data
                if textData != None:
                    pt = [pt, textData]
                
                geometry[0].append(pt)
                viable = True
            elif type(geometricObject) == rg.Point:
                """
                pt = self.Point3d_to_Pt3(geometricObject.Location)
                # Adds in descriptions/key name data
                if textData != None:
                    pt = [pt, textData]
                elif geometricObject.UserDictionary.ContainsKey('label'):
                    print geometricObject.UserDictionary.GetString('label')
                    pt = [pt, geometricObject.UserDictionary.GetString('label')]
                
                geometry[0].append(pt)
                """
                viable = True
            
            # Line segments
            elif type(geometricObject) == rg.LineCurve or type(geometricObject) == rg.Line:
                nurbs_geometricObject = deepcopy(geometricObject).ToNurbsCurve()
                if nurbs_geometricObject.TryGetEllipse()[0]:
                    pass
                elif type(geometricObject) == rg.LineCurve:
                    start = self.Point3d_to_Pt3(geometricObject.PointAtStart)
                    end = self.Point3d_to_Pt3(geometricObject.PointAtEnd)
                else:
                    start = self.Point3d_to_Pt3(geometricObject.From)
                    end = self.Point3d_to_Pt3(geometricObject.To)
                line =[start, end]

                # Adds in descriptions/key name data
                if textData != None:
                    line = [line, textData]
                elif geometricObject.UserDictionary.ContainsKey('label'):
                    print geometricObject.UserDictionary.GetString('label')
                    line = [line, geometricObject.UserDictionary.GetString('label')]
                    
                geometry[1].append(line)
                viable = True
                
            # Polylines / Elliptical arcs
            elif type(geometricObject) == rg.PolylineCurve or type(geometricObject) == rg.PolyCurve:
                nurbs_geometricObject = deepcopy(geometricObject).ToNurbsCurve()
                
                # Handles elliptical arcs
                if nurbs_geometricObject.TryGetEllipse()[0]:
                    ellipse_geometricObject = nurbs_geometricObject.TryGetEllipse()[1]
                    viable = False
                    
                # Handles polylines/polycurves
                else:
                    if type(geometricObject) == rg.PolyCurve:
                        curves = geometricObject.Explode()
                    else:
                        curves = geometricObject.DuplicateSegments()
                    straight = []
                    curved = []
                    crvCount = 0   # Tracks number of successfully converted curves
                    
                    # Separates straight and curved line segments
                    for int, curve in enumerate(curves):
                        crvLength = curve.GetLength()
                        ptDistance = rg.Vector3d.Subtract(rg.Vector3d(curve.PointAtStart.X, curve.PointAtStart.Y, curve.PointAtStart.Z), rg.Vector3d(curve.PointAtEnd.X, curve.PointAtEnd.Y, curve.PointAtEnd.Z)).Length

                        if abs(crvLength - ptDistance) > 1e-15:
                            curved.append(curve)
                        else:
                            straight.append(curve)
                    
                    # Handles straight line segments
                    for curve in straight:
                        start = self.Point3d_to_Pt3(curve.PointAtStart)
                        end = self.Point3d_to_Pt3(curve.PointAtEnd)
                        line =[start, end]
                        # Adds in descriptions/key name data
                        if textData != None:
                            line = [line, textData]
                        
                        geometry[1].append(line)
                        crvCount += 1
                    
                    # Treats curved line segments as quadratic Bezier curves
                    for int, curve in enumerate(curved):
                        try:
                            if curve.HasBezierSpans:
                                start = curve.PointAtStart
                                end = curve.PointAtEnd
                                ctrl = curve.Points
                                if ctrl.Count == 3:
                                    bez = (start, ctrl.Item[1].Location, end)
                                    # Adds in descriptions/key name data
                                    if textData != None:
                                        bez = [bez, textData]
                                
                                    geometry[6].append(bez)
                                    crvCount += 1
                                else:
                                    ghenv.Component.AddRuntimeMessage(w, ('Non-parabolic bezier curves are not supported'))
                        except:
                            pass
                    # checks if curves is empty, 
                    # it happens that the obj type is given as PolyLineCurve when really it is just a LineCurve
                    if len(curves) == 0:
                        start = self.Point3d_to_Pt3(obj.PointAtStart)
                        end = self.Point3d_to_Pt3(obj.PointAtEnd)
                        line =[start, end]
                        
                        # Adds in descriptions/key name data
                        if textData != None:
                            line = [line, textData]
                        elif obj.UserDictionary.ContainsKey('label'):
                            print obj.UserDictionary.GetString('label')
                            line = [line, obj.UserDictionary.GetString('label')]

                        #self.lines.append(line)
                        geometry[1].append(line)
                        viable = True
                    # Checks if any curve data was lost from processing straight vs curved line segments
                    elif crvCount == len(curves):
                        viable = True
                    
            # Rectangles
            elif type(geometricObject) == rg.Rectangle3d:
                for i in range(4):
                    if i <3:
                        start = geometricObject.Corner(i)
                        end = geometricObject.Corner(i+1)
                    else:
                        start = geometricObject.Corner(i)
                        end = geometricObject.Corner(0)
                    line =[start, end]
                    # Adds in descriptions/key name data
                    if textData != None:
                        line = [line, textData]
                        
                    geometry[1].append(line)
                
                viable = True
                
            # BREPs
            # allows for surfaces with holes (inner)
            elif type(geometricObject) == rg.Brep:
                plane = {}
                plane['inner'] = []
                plane['outer'] = []
                
                for curve in geometricObject.Loops:
                    segments = curve.To3dCurve().DuplicateSegments()
                    
                    # Holes
                    # May be more than 1
                    if curve.LoopType == rg.BrepLoopType.Inner:
                        inner = []
                        for seg in segments:
                            start = self.Point3d_to_Pt3(seg.PointAtStart)
                            inner.append(start)
                        
                        plane['inner'].append(inner)
                    
                    # Outer bound
                    # Only 1 per brep
                    elif curve.LoopType == rg.BrepLoopType.Outer:
                        outer = []
                        for seg in segments:
                            start = self.Point3d_to_Pt3(seg.PointAtStart)
                            outer.append(start)
                        
                        if plane['outer'] != []:
                            if textData != None:
                                plane = [plane, textData]
                            elif geometricObject.UserDictionary.ContainsKey('label'):
                                print geometricObject.UserDictionary.GetString('label')
                                plane = [plane, geometricObject.UserDictionary.GetString('label')]
                            geometry[2].append(plane)
                        plane = {}
                        plane['inner'] = []
                        plane['outer'] = outer
                        
                # Adds in descriptions/key name data
                if textData != None:
                    plane = [plane, textData]
                elif geometricObject.UserDictionary.ContainsKey('label'):
                    print geometricObject.UserDictionary.GetString('label')
                    plane = [plane, geometricObject.UserDictionary.GetString('label')]
                
                geometry[2].append(plane)
                viable = True
                    
            # Meshes
            elif type(geometricObject) == rg.Mesh:
                    count =  geometricObject.Faces.Count
                    plane = [] 
                    
                    for ind in range(count):
                        vertices = geometricObject.Faces.GetFaceVertices(ind)[1:]
                        face = []
                        for vertex in vertices:
                            start = self.Point3d_to_Pt3(vertex)
                            face.append(start)
                        plane.append(face)
                    
                    # Adds in descriptions/key name data
                    if textData != None:
                        plane = [plane, textData]
                    
                    geometry[2].append(plane)
                    viable = True
                    
            elif type(geometricObject) == rg.Circle:
                center = geometricObject.Center
                c_pt1 = geometricObject.PointAt(0)
                c_pt2 = geometricObject.PointAt(2)
                circle = (center, c_pt1, c_pt2)

                # Adds in descriptions/key name data
                if textData != None:
                    circle = [circle, textData]
            
                geometry[3].append(circle)
                viable = True
                
            # Ellipses or Bezier Curves (parabolic only)
            elif type(geometricObject) == rg.Ellipse or type(geometricObject) == rg.NurbsCurve: 

                if geometricObject.IsEllipse and geometricObject.IsClosed:
                    newObj = rg.NurbsCurve.TryGetEllipse(geometricObject)[1]
                    center = newObj.Plane.Origin
                    x_dist = newObj.Radius1
                    y_dist = newObj.Radius2
                    ellPlane = newObj.Plane
                    pin_pt = geometricObject.PointAt(geometricObject.ClosestPoint(newObj.Plane.Origin)[1])
                    ellipse = (center, ellPlane, x_dist, y_dist, pin_pt)
                    
                    # Adds in descriptions/key name data
                    if textData != None:
                        ellipse = [ellipse, textData]
                    
                    geometry[4].append(ellipse)
                    viable = True
                    
                elif geometricObject.HasBezierSpans:
                    start = geometricObject.PointAtStart
                    end = geometricObject.PointAtEnd
                    ctrl = geometricObject.Points

                    if ctrl.Count == 3:
                        bez = (start, ctrl.Item[1].Location, end)
                        # Adds in descriptions/key name data
                        if textData != None:
                            bez = [bez, textData]
                        
                        geometry[6].append(bez)
                        viable = True
                    else:
                        ghenv.Component.AddRuntimeMessage(w, ('Non-parabolic bezier curves are not supported'))
                else:
                    ghenv.Component.AddRuntimeMessage(w, ('Ellipse-like geometricObjectect cannot be converted to a RhinoCommon ellipse'))
                    
            # Circular arcs
            elif type(geometricObject) == rg.ArcCurve or type(geometricObject) == rg.Arc:
                if geometricObject.IsCompleteCircle:
                    center = geometricObject.TryGetCircle()[1].Center
                    c_pt1 = geometricObject.TryGetCircle()[1].PointAt(0)
                    c_pt2 = geometricObject.TryGetCircle()[1].PointAt(2)
                    circle = (center, c_pt1, c_pt2)
    
                    # Adds in descriptions/key name data
                    if textData != None:
                        circle = [circle, textData]
                    elif geometricObject.UserDictionary.ContainsKey('label'):
                        print geometricObject.UserDictionary.GetString('label')
                        circle = [circle, geometricObject.UserDictionary.GetString('label')]
                
                    geometry[3].append(circle)
                    viable = True
                else:
                    if type(geometricObject) == rg.Arc:
                        start = geometricObject.StartPoint
                        end = geometricObject.EndPoint
                        center = geometricObject.Center
                    else:
                        start = geometricObject.PointAtStart
                        end = geometricObject.PointAtEnd
                        center = geometricObject.Arc.Center
                    
                    pin_pt = geometricObject.PointAt(15)
                    cArc = (center, start, end, pin_pt)
                    # Adds in descriptions/key name data
                    if textData != None:
                        cArc = [cArc, textData]
                    geometry[5].append(cArc)
                    viable = True
                    
            elif type(geometricObject) ==  type('a'):
                descText = geometricObject

                # Prunes geometricObject in case of multiline Panel component
                if '\r\n' in geometricObject:
                    descText = descText.split('\r\n')
                    
                    for descObj in descText:
                        for count, letter in enumerate(descObj):
                            if letter == ':':
                                name = descObj[0:count]
                                content = descObj[count+1:].split('|')
                                geometry[7].append([name, content])
                                break
                                
                    viable = True
                else:
                    for count, letter in enumerate(geometricObject):
                        if letter == ':':
                            name = geometricObject[0:count]
                            content = geometricObject[count+1:].split('|')
                            geometry[7].append([name, content])
                            break
                    
                    viable = True

            else:
               try:
                    newObj = rhdoc.Objects.Find(geometricObject)
                    if newObj != None:
                        text = newObj.DisplayText
                        location = self.Point3d_to_Pt3(newObj.TextGeometry.Plane.Origin)
                        pt = [location, text]
                        geometry[0].append(pt)
                        geometricObject = newObj
                        viable = True
               except:
                    if type(geometricObject) == r.Display.Text3d:
                        if len(geometry[0]) > 0:
                            text = geometricObject.Text.split('|')
                            location = self.Point3d_to_Pt3(geometricObject.TextPlane.Origin)
                            if location == geometry[0][-1]:
                                pt = [location, text]
                                geometry[0][-1] = pt
                        viable = True
                  
            if viable == False:
                ghenv.Component.AddRuntimeMessage(w, 'Input contains unsupported geometries. You have inputted a '+ str(type(geometricObject)))

            if type(geometricObject) != type('a'):
                self.geometryRh.append(geometricObject)
            else: 
                self.descriptionText.append(geometricObject)
                
        return geometry

    # Extracts point data
    # If refPoint non-zero, then coordinates are extract w.r.t. refPoint
    def Point3d_to_Pt3(self, rhino_pt):
        try:
            x = rhino_pt.X 
            y = rhino_pt.Y 
            z = rhino_pt.Z 
        except:
            x = rhino_pt[0] 
            y = rhino_pt[1]
            z = rhino_pt[2] 

        return [x, y, z]
    
    # Creates sortal individuals; to be collected later on in sortal shape
    def makeIndividuals(self):
        sortalIndividuals = [[] for i in range(len(self.geometry))]
       
        for ind, set in enumerate(self.geometry):
            # Points and Text Points
            if ind == 0:
                for coordSet in set:
                    if len(coordSet) == 3 and type(coordSet[0]) == type(1.0):
                        individual = self.makePoint(coordSet, self.pointSort)
                    elif len(coordSet) == 2 and type(coordSet[0]) == type([]):
                        individual = self.makePoint(coordSet[0], self.pointSort)
                        individual = self.makeTextData(individual, coordSet[1])
                    sortalIndividuals[ind].append(individual)
                    
            # Line segments
            elif ind == 1:
                for coordSet in set:
                    if len(coordSet) == 2 and len(coordSet[0]) == 3:
                        individual = self.makeLineSeg(coordSet, self.lineSegSort)
                    elif len(coordSet) == 2 and len(coordSet[0]) == 2:
                        individual = self.makeLineSeg(coordSet[0], self.lineSegSort)
                        individual = self.makeTextData(individual, coordSet[1])
                    sortalIndividuals[ind].append(individual)
           
            # Plane Segments
            elif ind == 2:
                for coordSet in set:
                    if type(coordSet) == type({}):
                        individual = self.makePlane(coordSet, self.planeSegSort)
                    elif type(coordSet) == type([]):
                        individual = self.makePlane(coordSet[0], self.planeSegSort)
                        individual = [individual[0], individual[1], coordSet[1]]
                    sortalIndividuals[ind].append(individual)
            # Circles
            elif ind == 3:
                for coordSet in set:
                    if type(coordSet) == type(()):
                        individual = self.makeCircle(coordSet, self.circleSort)
                    elif type(coordSet) == type([]):
                        individual = self.makeCircle(coordSet[0], self.circleSort)
                        individual = self.makeTextData(individual, coordSet[1])
                    sortalIndividuals[ind].append(individual)
            # Ellipses
            elif ind == 4:
               for coordSet in set:
                    if type(coordSet) == type(()):
                        individual = self.makeEllipse(coordSet, self.ellipseSort)
                    elif type(coordSet) == type([]):
                        individual = self.makeEllipse(coordSet[0], self.ellipseSort)
                        individual = self.makeTextData(individual, coordSet[1])
                    sortalIndividuals[ind].append(individual)
            # (Circular) Arcs
            elif ind == 5:
                for coordSet in set:
                    if type(coordSet) == type(()):
                        individual = self.makeArc(coordSet, self.arcSort)
                    else:
                        individual = self.makeArc(coordSet[0], self.arcSort)
                        individual = self.makeTextData(individual, coordSet[1])
                    sortalIndividuals[ind].append(individual)
                    
            # Bezier Curves
            elif ind == 6:
                for coordSet in set:
                    if type(coordSet) == type(()):
                        individual = self.makeBezier(coordSet, self.bezSort)
                    else:
                        individual = self.makeBezier(coordSet[0], self.bezSort)
                        individual = self.makeTextData(individual, coordSet[1])
                    sortalIndividuals[ind].append(individual)
            # Descriptions (standalone, individual)
            elif ind == 7:
                for desc in set:
                    descObjs = self.makeDescription(desc)
                    if descObjs != None:
                        for thing in descObjs:
                            sortalIndividuals[ind].append(thing)

        return sortalIndividuals
                    
    # Makes pt individual                 
    def makePoint(self, coordSet, mainSort):
        individual = point3D(mainSort, coordSet[0], coordSet[1], coordSet[2])
        return individual         

    # Makes line segment/disconnected polyline line segment individuals
    def makeLineSeg(self, coordSet, mainSort):
        if type(coordSet[0][0]) == type([]):
            coordData = coordSet[0]
            v1 = vector3D(coordData[0][0], coordData[0][1], coordData[0][2])
            v2 = vector3D(coordData[1][0], coordData[1][1], coordData[1][2])
        else:
            v1 = vector3D(coordSet[0][0], coordSet[0][1], coordSet[0][2])
            v2 = vector3D(coordSet[1][0], coordSet[1][1], coordSet[1][2])
        
        if v1 != v2:
            individual = lineSegment3D(mainSort, v1, v2)
            return individual
    
    def makePlane(self, coordSet, mainSort):
        pOut = []
        pIn = []
        
        if type(coordSet) == type ([]):
            for coords in coordSet:
                face = []
                for curve in coords:
                    v1 = vector3D(curve[0], curve[1], curve[2])
                    if v1 not in face:
                        face.append(v1)
                
                pOut.append(planeSegment3D(mainSort, face))

        elif type(coordSet) == type({}):
            outerCoords = coordSet["outer"]
            innerCoords = coordSet["inner"]
            outerBounds = []
            innerBounds = []
            
            for curve in outerCoords:

                v1 = vector3D(curve[0], curve[1], curve[2])            
                outerBounds.append(v1)

            outerBounds.append(outerBounds[0])

            pOut = planeSegment3D(mainSort, outerBounds)
            
            if len(innerCoords) != 0:
                for curveSet in innerCoords:
                    oneBound = []

                    for thing in curveSet:
                        v1 = vector3D(thing[0], thing[1], thing[2])        
                        oneBound.append(v1)
                    
                    oneBound.append(oneBound[0])
                    innerBounds.append(oneBound)

                if len(innerBounds) != 0:
                    for bound in innerBounds:
                        pIn.append(planeSegment3D(mainSort, bound))
            
        individual = [pOut, pIn]

        return individual
    
    def makeCircle(self, coordSet, mainSort):
        center = vector3D(coordSet[0][0], coordSet[0][1], coordSet[0][2])
        c_pt1 = vector3D(coordSet[1][0], coordSet[1][1], coordSet[1][2])
        c_pt2 = vector3D(coordSet[2][0], coordSet[2][1], coordSet[2][2])
        individual = mainSort.baseSort().characteristic(mainSort, center, c_pt1, c_pt2)
    
        return individual
        
    def makeEllipse(self, coordSet, mainSort):
        center_coords = coordSet[0]
        center = vector3D(coordSet[0][0], coordSet[0][1], coordSet[0][2])
        shortPt_coords = coordSet[-1]
        ellPlane = coordSet[1]
        
        if coordSet[2] > coordSet[3]:
            majDist = coordSet[2]
            minDist = coordSet[3]
        else:
            minDist = coordSet[2]
            majDist = coordSet[3]
        
        cDist = sqrt(majDist**2 - minDist**2)
        shortVec = center_coords - shortPt_coords
        shortUnit = deepcopy(shortVec)
        shortUnit.Unitize()
        normUnit = deepcopy(ellPlane.Normal)
        normUnit.Unitize()
        longUnit = rg.Vector3d.CrossProduct(shortUnit, normUnit)
        longUnit.Unitize()
        
        if majDist == coordSet[2]:
            foc1 = coordSet[0] + rg.Vector3d.Multiply(longUnit, cDist)
            foc2 = coordSet[0] - rg.Vector3d.Multiply(longUnit, cDist)
        else:
            foc1 = coordSet[0] + rg.Vector3d.Multiply(longUnit, cDist)
            foc2 = coordSet[0] - rg.Vector3d.Multiply(longUnit, cDist)
            
        foc1_vec = vector3D(foc1.X, foc1.Y, foc1.Z)
        foc2_vec = vector3D(foc2.X, foc2.Y, foc2.Z)
        pin_pt_vec = vector3D(coordSet[4].X, coordSet[4].Y, coordSet[4].Z)
        individual = mainSort.baseSort().characteristic(mainSort, foc1_vec, foc2_vec, pin_pt_vec)
    
        return individual
        
    def makeArc(self, coordSet, mainSort):
        center_vec = vector3D(coordSet[0][0], coordSet[0][1], coordSet[0][2])
        start_vec = vector3D(coordSet[1][0], coordSet[1][1], coordSet[1][2])
        end_vec = vector3D(coordSet[2][0], coordSet[2][1], coordSet[2][2])
        pin_pt_vec =  vector3D(coordSet[3][0], coordSet[3][1], coordSet[3][2])
        individual = mainSort.baseSort().characteristic(mainSort, center_vec, start_vec, end_vec, pin_pt_vec)
        return individual
        
    def makeBezier(self, coordSet, mainSort):
        start_vec = vector3D(coordSet[0].X, coordSet[0].Y, coordSet[0].Z)
        ctrl_vec = vector3D(coordSet[1].X, coordSet[1].Y, coordSet[1].Z)
        end_vec = vector3D(coordSet[2].X, coordSet[2].Y, coordSet[2].Z)
        individual = mainSort.baseSort().characteristic(mainSort, start_vec, ctrl_vec, end_vec)
        return individual
    
    def makeDescription(self, desc):
        descObjs = []
        # Checks if description sort type already exists
        # If description sort already present, retrieved from sort.register
        # If not present, new description primitive sort created

        if desc[0] in sort.register:
            descSort = sort.register[desc[0]]
            
            for obj in desc[1]:
                descObj = description(descSort, '`'+obj+'`')
                self.descSortTypes.append(descSort)
                descObjs.append(descObj)
                
            return descObjs
        else:
            ghenv.Component.AddRuntimeMessage(w, ('The ' + desc[0] + ' description type has not been set up in the sortal library'))
            return
    
    def makeTextData(self, individual, labelText):
        if type(labelText) == Rhino.Display.Text3d:
            labelText = labelText.Text
            
        elif type(labelText) == TextGoo:
            labelText = labelText.m_value.Text

        if '|' in labelText:
            labelText = labelText.split('|')
        
        if type(labelText) == type(''):
            # Handles tag names
            if labelText[0] == '#' and not '.' in labelText:
                if labelText not in self.existingKeys:
                    key.createKey(labelText.split('#')[-1], individual)
                    self.existingKeys[labelText] = 1
                elif labelText in self.existingKeys:
                    key.createKey(labelText.split('#')[-1] + str(self.existingKeys[labelText]), individual)
                    self.existingKeys[labelText] += 1
            else:
                # Adds double quotes " " if labelTest has spaces or are not comparison expressions
                #if ' ' in labelText or ('?' not in labelText and '<' not in labelText and '>' not in labelText and '=' not in labelText and labelText[-1] != '"' and labelText[0] != '"' and '#' not in labelText):
                #    labelText = '"' + labelText + '"'
                newLabel = description(individual.sort.weight, "`"+labelText+"`")
                individual.addAttribute(newLabel)
            
        else:
            # Handles tag names
            for labelObj in labelText:
                if labelObj[0] == '#' and not '.' in labelObj:
                    if labelObj not in self.existingKeys:
                        key.createKey(labelObj.split('#')[-1], individual)
                        self.existingKeys[labelObj] = 1
                    elif labelObj in self.existingKeys:
                        key.createKey(labelObj.split('#')[-1] + str(self.existingKeys[labelObj]), individual)
                        self.existingKeys[labelObj] += 1
                else:
                    # Adds double quotes " " if labelTest has spaces or are not comparison expressions
                    #elif ' ' in labelObj or ('?' not in labelObj and '<' not in labelObj and '>' not in labelObj and '=' not in labelObj and labelObj[-1] != '"' and labelObj[0] != '"'):
                    #labelObj = '"' + labelObj + '"'
                    newLabel = description(individual.sort.weight, "`"+labelObj+"`")
                    individual.addAttribute(newLabel)
        return individual
    
    # Creates forms (grouped by geometry type) to be inserted into metaform
    def makeForms(self, sortalIndividuals):
        descForms = []
        newDescSorts = []
        indiv = None

        if len(sortalIndividuals) > 3:
            if len(sortalIndividuals[3]) > 0:
                for object in sortalIndividuals[3]:
                    if sort.register['rhino_shapes'].contains(object.sort) == False:
                        newDescSorts.append(object.sort)
                    descForms.append(object)
                
        if len(newDescSorts) > 0:
            disjSort = self.createNewComposite(self.mainSorts, newDescSorts) 
        else: 
            disjSort = sort.register['rhino_shapes']
        mainForm = disjSort.newForm()

        for count, indiv in enumerate(sortalIndividuals):
            if len (indiv) > 0:
                if count == 2:
                    tempHold = []
                    for object in indiv:
                        textData = object[-1]
                        tempHoldForm = disjSort.newForm()
                        
                        if type(object[0]) == type([]):
                            if 'plane' in object[0][0].type:
                                for subObj in object[0]:
                                    tempHoldForm.insert(subObj)
                        else:
                            tempHoldForm.insert(object[0])
    
                        if len(object[1]) > 0:
                            form2 = disjSort.newForm()
                            for obj in object[1]:    
                                form2.insert(obj)
                            
                            # Subtract form2 planes from form1
                            tempHoldForm.difference(form2)
                            
                        # Adds label descriptions and key name to plane segment
                        tempHoldForm = self.makeTextData(tempHoldForm.elements[0].elements[0].elements[0], textData)
                        tempHold.append(tempHoldForm)
                        
                    for object in tempHold:
                        mainForm.insert(object)

                else:
                    for obj in indiv:
                        mainForm.insert(obj)
                     
        return mainForm
    
    def createNewComposite(self, mainSorts, newDescSorts):
        components = deepcopy(mainSorts)

        for sortType in newDescSorts:
            components.append(sortType)
        
        if disjunctiveSort.sameComponent(components) is False:
            sc.sticky['sort_count'] += 1
            newDisjSort = disjunctiveSort(('rhino_shapes_'+str(sc.sticky['sort_count'])), components)
            
        else:
            newDisjSort = disjunctiveSort.sameComponent(components)

        return newDisjSort
    
    # Creates entire sortal shape
    def createMetaform(self, discSort, forms):
        if discSort.__class__ != disjunctiveSort:
            ghenv.Component.AddRuntimeMessage(w, "ERROR: Only sort types based on disjunctiveSort can be passed to create.metaForm.")
            raise TypeError
            
        formM = discSort.newForm()
        for i in forms:
            formM.insert(i)

        return formM

# Draws geometry from sortal shape's sortal form   
class draw(object):
    def __init__(self, sortalForm):
        self.sortalForm = sortalForm
        self.type = self.sortalForm.type
        self.objectIds = []
    
    # Goes through sortal form to draw individual geometries
    def toGH(self):
        if self.type == 'form-metaForm':
            elements = self.sortalForm.elements

            for element in elements:
                individuals =  element.elements
                if len(individuals) == 0:
                    continue 
                    
                # Draws points, labeled points, circles, ellipses
                if element.type == 'form-discrete' and 'description' not in individuals[0].type:
                    # Draws points and labeled points
                    if 'point' in individuals[0].type:
                        conversion = self.Point
                        
                    elif 'circle' in individuals[0].type:
                        data_prep = self.data_prep_circle
                        conversion = self.Circle
                        
                    elif 'ellipse' in individuals[0].type:
                        data_prep = self.data_prep_ellipse
                        conversion = self.Ellipse
                        
                    if type (individuals) == type([]):
                        for indiv in individuals:
                            indivData = indiv
                            if 'circle' in individuals[0].type or 'ellipse' in individuals[0].type:
                                indivData = data_prep(indiv)
                                
                            obj = conversion(indivData)
                            self.objectIds.append(obj)
                    else:
                        obj = conversion(individuals)
                        self.objectIds.append(obj)

                # Draws lines
                elif element.type == 'form-interval':
                    text, weight, lineX, lineY, lineZ = self.data_prep_line(individuals)     # Extracts line coordinates and attributes (if any) from line segments
                    obj = self.LineSeg(text, weight, lineX, lineY, lineZ, individuals)  # Plots line segments

                    for o in obj:
                        self.objectIds.append(o)
                
                # Draws planes
                elif element.type == 'form-areal' or element.type == 'form-coForm':
                    for indiv in individuals:

                        if indiv.type == 'form-coForm':
                            for object in indiv.elements:
                                planeData = self.data_prep_plane(object)
                                obj = self.PlaneSegment(planeData)
                                for item in obj:
                                    if type(item) is not TextGoo and type(item) != rg.Point3d and type(item) != rg.Brep:
                                        for subplane in item:
                                            self.objectIds.append(subplane)
                                    else:
                                        self.objectIds.append(item)
                        elif indiv.type == 'ind-planeSegment3D':
                            planeData = self.data_prep_plane(indiv)
                            obj = self.PlaneSegment(planeData)

                            for o in obj:
                                self.objectIds.append(o)
                
                # Draws circular arcs
                elif element.type == 'form-cyclical':
                    if 'circular' in individuals[0].type:
                        data_prep = self.data_prep_arc
                        conversion = self.Arc
                        
                        for indiv in individuals:
                            arcData = data_prep(indiv)
                            obj = conversion(arcData)
                            self.objectIds.append(obj)
                        
                # Draws bezier curves
                elif element.type == 'form-curve':
                    for indiv in individuals:
                        arcData = self.data_prep_bezier(indiv)
                        obj = self.Bezier(arcData)
                        self.objectIds.append(obj)
                        
        elif self.type == 'form-discrete':
            individuals = self.form.elements
            # Draws points and labeled points
            if 'point' in individuals[0].type:
                conversion = self.Point
                
            elif 'circle' in individuals[0].type:
                data_prep = self.data_prep_circle
                conversion = self.Circle
                
            elif 'ellipse' in individuals[0].type:
                data_prep = self.data_prep_ellipse
                conversion = self.Ellipse
                
            if type (individuals) == type([]):
                for indiv in individuals:
                    indivData = indiv
                    if 'circle' in individuals[0].type or 'ellipse' in individuals[0].type:
                        indivData = data_prep(indiv)
    
                    obj = conversion(indivData)
            else:
                obj = conversion(individuals)
            
            self.objectIds.append(obj)
            
        elif self.type == 'form-interval':
            individuals = self.form.elements
            text, weight, lineX, lineY, lineZ = self.data_prep(individuals) 
            obj = self.LineSeg(text, weight, lineX, lineY, lineZ, individuals)
            
            self.objectIds.append(obj)
        
        elif element.type == 'form-areal' or element.type == 'form-coForm':
            if indiv.type == 'form-coForm':
                for object in indiv.elements:
                    planeData = self.data_prep_plane(object)
                    obj = self.PlaneSegment(planeData)

            elif indiv.type == 'ind-planeSegment3D':
                planeData = self.data_prep_plane(indiv)
                obj = self.PlaneSegment(planeData)

            for o in obj:
                self.objectIds.append(o)
        
        elif element.type == 'form-cyclical' or element.type == 'form-curve':
            individuals = self.form.elements
            if element.type == 'form-cyclical':
                data_prep = self.data_prep_arc
                conversion = self.Arc
            elif element.type == 'form-curve':
                data_prep = self.data_prep_bezier
                conversion = self.Bezier
                
            for indiv in individuals:
                indivData = data_prep(indiv)
                obj = conversion(indivData)
                self.objectIds.append(obj)
        
        flattenedSet = []
        for objectSet in self.objectIds:
            if type(objectSet) == type([]):
                for obj in objectSet:
                    flattenedSet.append(obj)
            else:
                flattenedSet.append(objectSet)

        return flattenedSet
    
    # Prepares data from plane segments
    # Currently only adapts external boundary
    def data_prep_plane(self, planeSegment):
        bounds = {}
        bounds['inner'] = []
        outer = []
        bounds['normal'] = rg.Vector3d(planeSegment.normal.x, planeSegment.normal.y, planeSegment.normal.z)
        bounds['origin']  = rg.Point3d(planeSegment.pRoot.x, planeSegment.pRoot.y, planeSegment.pRoot.z)
        
        for count, bound in enumerate(planeSegment.boundaries):
            
            # Extracts outer bound (1 only)
            if count == 0:
                for point in bound.polygonal:
                    coordinates = [point.x, point.y, point.z]
                    outer.append(coordinates)
                    
                outer.append(outer[0])
                bounds['outer'] = outer
            
            # Extracts inner loops (may be greater than 1)
            elif count > 0: 
                inner = []
                for point in bound.polygonal:
                    coordinates = [point.x, point.y, point.z]
                    inner.append(coordinates)

                inner.append(inner[0])
                bounds['inner'].append(inner)
        
        bounds = self.retrieveTextData(planeSegment, bounds)
        return bounds
    
    # Prepares data from line segments
    def data_prep_line(self, line_set):
        text = []
        weight = []

        lineSeg_x = [[0 for x in range (2)] for y in range(len(line_set))]
        lineSeg_y = [[0 for x in range (2)] for y in range(len(line_set))]
        lineSeg_z = [[0 for x in range (2)] for y in range(len(line_set))]
        
        # Extracts attributes and coordinates
        for index in range(len(line_set)):

            # Extracts attributes from line segments inside line_set if there are attributes inside
            # form-discrete - labels
            # form-ordinal - weights
            # form-special - special variant of weights specifically for Rhino, does operations arithmetically
            if line_set[index].hasAttribute():
                text.append(self.retrieveTextData(line_set[index], None)[1])
            else:
                text.append([])

            # Extracts coordinates from line segments
            for j in range(2):
                if j == 0 :
                    lineSeg_x[index][j] = float(line_set[index].start.x.value)
                    lineSeg_y[index][j] = float(line_set[index].start.y.value)
                    lineSeg_z[index][j] = float(line_set[index].start.z.value)
                else: 
                    lineSeg_x[index][j] = float(line_set[index].end.x.value)
                    lineSeg_y[index][j] = float(line_set[index].end.y.value)
                    lineSeg_z[index][j] = float(line_set[index].end.z.value)

        return text, weight, lineSeg_x, lineSeg_y, lineSeg_z
    
    def data_prep_circle(self, cSource):
        center = rg.Point3d(cSource.center.x, cSource.center.y, cSource.center.z)
        pin_1 = rg.Point3d(cSource.getPoints()[1].x, cSource.getPoints()[1].y, cSource.getPoints()[1].z)
        pin_2 = rg.Point3d(cSource.getPoints()[2].x, cSource.getPoints()[2].y, cSource.getPoints()[2].z)
        radius = cSource.radius
        angle = random()*pi*2
        circle = (center, radius, pin_1, pin_2)
        circle = self.retrieveTextData(cSource, circle)
        return circle
        
    def data_prep_ellipse(self, eSource):
        center = rg.Point3d(eSource.center.x, eSource.center.y, eSource.center.z)
        foc_1 = rg.Point3d(eSource.getPoints()[0].x, eSource.getPoints()[0].y, eSource.getPoints()[0].z)
        foc_2 = rg.Point3d(eSource.getPoints()[1].x, eSource.getPoints()[1].y, eSource.getPoints()[1].z)
        shortPt = rg.Point3d(eSource.getPoints()[2].x, eSource.getPoints()[2].y, eSource.getPoints()[2].z)
    
        cDist = foc_1.DistanceTo(foc_2)/2
        bDist =  center.DistanceTo(shortPt)
        aDist = sqrt(cDist**2 + bDist**2)

        shortVec = shortPt - center
        shortDist = sqrt(shortVec.X**2 + shortVec.Y**2 + shortVec.Z**2)
        shortUnit = rg.Vector3d(shortVec.X/shortDist, shortVec.Y/shortDist, shortVec.Z/shortDist)
        normVec = rg.Vector3d(eSource.normal.x, eSource.normal.y, eSource.normal.z)
        normDist = sqrt(normVec.X**2 + normVec.Y**2 + normVec.Z**2)
        normUnit = rg.Vector3d(normVec.X/normDist, normVec.Y/normDist, normVec.Z/normDist)
        
        longUnit = rg.Vector3d.CrossProduct(shortUnit, normUnit)
        longPt = center + rg.Vector3d.Multiply(longUnit, aDist)
        
        ellipse = (center, longPt, shortPt)
        ellipse = self.retrieveTextData(eSource, ellipse)
        return ellipse
        
    def data_prep_arc(self, cArcSource):
        start = rg.Point3d(cArcSource.start.x, cArcSource.start.y, cArcSource.start.z)
        end = rg.Point3d(cArcSource.end.x, cArcSource.end.y, cArcSource.end.z)
        pin = rg.Point3d(cArcSource.pin.x, cArcSource.pin.y, cArcSource.pin.z)
        arc = (start, pin, end)
        arc = self.retrieveTextData(cArcSource, arc)
        return arc
    
    """
    def data_prep_eArc(self, eArcSource):
        # Preparation of data for computation and elliptical arc creation
        center = rg.Point3d(eArcSource.center.x, eArcSource.center.y, eArcSource.center.z)
        start = rg.Point3d(eArcSource.start.x, eArcSource.start.y, eArcSource.start.z)
        end = rg.Point3d(eArcSource.end.x, eArcSource.end.y, eArcSource.end.z)
        shortPt = rg.Point3d(eArcSource.quadPoint.x, eArcSource.quadPoint.y, eArcSource.quadPoint.z)
        foc_1 = rg.Point3d(eArcSource.getPoints()[0].x, eArcSource.getPoints()[0].y, eArcSource.getPoints()[0].z)
        foc_2 = rg.Point3d(eArcSource.getPoints()[1].x, eArcSource.getPoints()[1].y, eArcSource.getPoints()[1].z)
        
        # Computation of major, minor, foci distances    
        cDist = foc_1.DistanceTo(foc_2)/2
        bDist =  center.DistanceTo(shortPt)
        aDist = sqrt(cDist**2 + bDist**2)
    
        # Computation of minor axis (shortPt) and major axis (longPt) quad points
        shortVec = shortPt - center
        shortDist = sqrt(shortVec.X**2 + shortVec.Y**2 + shortVec.Z**2)
        shortUnit = rg.Vector3d(shortVec.X/shortDist, shortVec.Y/shortDist, shortVec.Z/shortDist)
        normVec = rg.Vector3d(eArcSource.normal.x, eArcSource.normal.y, eArcSource.normal.z)
        normDist = sqrt(normVec.X**2 + normVec.Y**2 + normVec.Z**2)
        normUnit = rg.Vector3d(normVec.X/normDist, normVec.Y/normDist, normVec.Z/normDist)
        longUnit = rg.Vector3d.CrossProduct(shortUnit, normUnit)
        longPt = center + rg.Vector3d.Multiply(longUnit, aDist)
        
        return (center, start, end, shortPt, longPt)
    """
    
    def data_prep_bezier(self, bezierSource):
        start = rg.Point3d(bezierSource.start.x, bezierSource.start.y, bezierSource.start.z)
        end = rg.Point3d(bezierSource.end.x, bezierSource.end.y, bezierSource.end.z)
        ctrl = rg.Point3d(bezierSource.controlPoint.x, bezierSource.controlPoint.y, bezierSource.controlPoint.z)
        bezier = (start, ctrl,end)
        bezier = self.retrieveTextData(bezierSource, bezier)
        return bezier
    
    def retrieveTextData(self, individual, coordData):
        textData = []
        
        if individual.hasAttribute():
            att = individual.attribute
            
            for labelDesc in att.elements:
                textData.append(labelDesc.getValue()[1:-1])
                
        if individual.key != None:
            textData.insert(0, '#'+individual.key.name)
            
        return [coordData, textData]
    
    """
    =================
    GEOMETRY PLOTTING
    =================
    """
    
    # Plots points
    # Currently supports labeled points
    def Point(self, pointSource):
        if pointSource.hasAttribute():
            attrib = pointSource.attribute # Only one source of attributes, which are label descriptions
            pt = rg.Point3d(float(pointSource.value.x.value), float(pointSource.value.y.value), float(pointSource.value.z.value))
            newPlane = rg.Plane(pt, rg.Vector3d(0,0,1))
            pt = rg.Point(pt)
            fullText = ''

            if attrib.type == 'ind-description':
                context = attrib.getValue().split('@')
                fullText = context[0][1:-1]
                
            elif attrib.type == 'form-discrete':
                for ind, element in enumerate(attrib.elements):
                    context = element.getValue().split('@')
                    text = context[0][1:-1]
                    if ind == 0:
                        fullText = text
                    else:
                        fullText += '|' + text
                
                if pointSource.key != None:
                    fullText = '#' + pointSource.key.name + '|' + fullText
                    
            elif attrib.type == 'form-metaForm':
                for ind, element in enumerate(attrib.elements):
                    context = element.elements[0].getValue().split('@')
                    text = context[0][1:-1]
                    if ind == 0:
                        fullText = text
                    else:
                        fullText += '|' + text

            if fullText != '':
                textHt = sc.sticky['text_size']
                #temp = rg.Point3d(float(pointSource.value.x.value), float(pointSource.value.y.value), float(pointSource.value.z.value))
                textPt = TextGoo(r.Display.Text3d(fullText, newPlane, textHt))
                pt.UserDictionary.Set('label', fullText)
            
            return [pt, textPt]
            
        else:
            pt = rg.Point3d(float(pointSource.value.x.value), float(pointSource.value.y.value), float(pointSource.value.z.value))
            return pt
    
    # Plots line segments
    # Currently does not support attributes
    def LineSeg(self, text, weight, lineX, lineY, lineZ, line_set):
        block = []
        sc.doc = r.RhinoDoc.ActiveDoc
        
        for index in range(len(lineX)):
            # Draws line segment
            start = rg.Point3d(lineX[index][0], lineY[index][0], lineZ[index][0])
            end = rg.Point3d(lineX[index][1], lineY[index][1], lineZ[index][1])
            line = rg.LineCurve(start, end)
            
            if len(text[index]) > 0:
                line = self.createText(line, text[index], (start+end)/2)
            
            # Collects GUIDs of line segments
            block.append(line)
        
        return block 
    
    # Creates plane segment representation (BREP, allows for trims)
    def PlaneSegment(self, boundaries):
        outer = boundaries[0]['outer']
        inner = boundaries[0]['inner']
        planeSegment = rg.Plane(boundaries[0]['origin'], boundaries[0]['normal'])
        textData = boundaries[-1]

        corners = []
        boundLines = []
        
        for bound in outer:
            corners.append(rg.Point3d(bound[0], bound[1], bound[2]))
        outerBound =  rg.PolylineCurve(corners)

        if len(inner) > 0:
            trims = []
            
            for boundSet in inner:
                corners = []
                for bound in boundSet:
                    corners.append(rg.Point3d(bound[0], bound[1], bound[2]))
                    
                innerBound = rg.PolylineCurve(corners)
                trims.append(innerBound)
            trims.append(outerBound)
            totalPlaneSeg = rg.Brep.CreatePlanarBreps(trims)
        else:
            totalPlaneSeg = rg.Brep.CreatePlanarBreps(outerBound)
        
        totalPlaneSeg = self.createText(totalPlaneSeg, textData, rg.Point3d((outer[0][0]+outer[1][0])/2, (outer[0][1]+outer[1][1])/2, (outer[0][2]+outer[1][2])/2))
        
        return totalPlaneSeg
    
    def Circle(self, cData):
        planeC = rg.Plane(cData[0][0], cData[0][2], cData[0][3])
        circle = rg.Circle(planeC, cData[0][1])
        circle = self.createText(circle, cData[1], cData[0][2])
        return circle
        
    def Ellipse(self, eData):
        center = eData[0][0]
        longPt = eData[0][1]
        shortPt = eData[0][2]
        ellipse = self.createText(ellipse, eData[1], longPt)
        return ellipse
        
    def Arc(self, cArcData):
        start = cArcData[0][0]
        end = cArcData[0][2]
        pin = cArcData[0][1]
        cArc = rg.Arc(start, pin, end)
        cArc = self.createText(cArc, cArcData[1], cArc.MidPoint)
        return cArc
    
    def Bezier(self, bezData):
        coordData = bezData[0]
        bez = rg.Curve.CreateControlPointCurve(coordData)
        bez = self.createText(bez, bezData[1], bez.PointAtStart)
        return bez
    
    # Creates text object for geometry
    def createText(self, geometry, text, plotPt):
        if len(text) > 0:
            fullText = text[0]
    
            for textBit in text[1:]:
                fullText += '|' + textBit
            
            newPlane = rg.Plane(plotPt, rg.Vector3d(0,0,1))
            textHt = sc.sticky['text_size']
            textPt = TextGoo(r.Display.Text3d(fullText, newPlane, textHt))
            return [geometry, textPt]
        else:
            return geometry
"""
# Groups geometry according to which geometries likely have text objects accompanying them (Text Points, Curves, and Surfaces)       
def clean_geometry(G):
    tempGeom = []
    index = 0
    ignore = []
    print G
    print len(G)
    while index < len(G):
        geometry = G[index]
        if type(geometry) == rg.Brep or type(geometry) == rg.Mesh or type(geometry) == rg.LineCurve or type(geometry) == rg.Line or type(geometry) == rg.Polyline or type(geometry) == rg.PolylineCurve or type(geometry) == rg.Rectangle3d or type(geometry) == rg.Circle or type(geometry) == rg.Ellipse or type(geometry) == rg.PolyCurve or type(geometry) == rg.ArcCurve or type(geometry) == rg.NurbsCurve:
            try:
                if len(G) >= 3 and type(G[index+1]) == TextGoo or type(G[index+1]) == Rhino.Display.Text3d:
                    tempGeom.append(G[index:index+3])
                    ignore.append(G[index+2])
                    index+=3
                    
                else:
                    if geometry not in ignore:
                        tempGeom.append(geometry)
                    index+=1
            #
            except:
                if geometry not in ignore:
                    tempGeom.append(geometry)
                index+=1
            #
        else:
            if geometry not in ignore:
                tempGeom.append(geometry)
            index+=1
        
    return tempGeom
"""
if 'check' in sc.sticky:
    if None not in G:
        try:
            """
            ptList = []
            textList = []
            tempG = []
        
            for obj in G:
                try:
                    if rs.ObjectType(obj) == 512:
                        textList.append(obj)
                        tempG.append(obj)
        
                except:
                    if type(obj) == rg.Point3d or type(obj) == rg.Point:
                        ptList.append(obj)
                    else: 
                        if type(obj) == r.Display.Text3d:
                            textList.append(obj)
                        tempG.append(obj)
        
                for text in textList:
                    try:
                        objCoords =  rhdoc.Objects.Find(text).TextGeometry.Plane.Origin
                        textContent = rhdoc.Objects.Find(text).TextGeometry.Text
                        location = rhdoc.Objects.Find(text).TextGeometry.Plane
                    except:
                        objCoords = text.TextPlane.Origin
                        textContent = text.Text
                        location = text.TextPlane
        
                    tempG.append(TextGoo(r.Display.Text3d(textContent, location, sc.sticky['text_size'])))
            """
            # If refP given, adjusts refP input to create vector coordinates  
            # Original input geometry retained, as deleting them will cripple the entire GH operation
            # Preview of moved objects shown when Preview is turned on
            # Vector computed is from refP to origin
            if refP != None:
                tempList = []
                transformVector = rg.Vector3d(-refP.X, -refP.Y, -refP.Z)
        
                for ind, thing in enumerate(G):
                    try:
                        try:
                            rhinoObj =  rhdoc.Objects.Find(thing)
                            T = rhinoObj.DisplayText
                            newOrigin = ghcomp.Move(rhinoObj.TextGeometry.Plane.Origin, transformVector)[0]
                            L = rg.Plane(newOrigin, rhinoObj.TextGeometry.Plane.Normal)
                        except: 
                            rhinoObj = thing
                            T = rhinoObj.Text
                            newOrigin = ghcomp.Move(rhinoObj.TextPlane.Origin, transformVector)[0]
                            L = rg.Plane(newOrigin, rhinoObj.TextPlane.Normal)
                        
                        if rhinoObj == None:
                            ghenv.Component.AddRuntimeMessage(w, 'The text you are trying to add may no longer exist in Rhino.')
                        
                        H = sc.sticky['text_size']
                        displayObj = r.Display.Text3d(T, L, H)
                        #newObj = TextGoo(displayObj)
                        #tempList.append(rg.Point3d(L.Origin))
                        #G[ind] = newObj.DuplicateGeometry()
                        G[ind] = displayObj
                        
                    except:
                        G[ind] = ghcomp.Move(thing, transformVector)[0]
                        if G[ind] == None:
                            G[ind] = thing
    
                for i in tempList:
                    if i not in G:
                        G.append(i)
            
            # Groups geometry, its Text Object and plot point together into a list
            # G = clean_geometry(G)
            
            # Returns disjunctive form from lines and points, pruned geometry
            extract1 = extract (G, D)
            S, G, D = extract1.toSortal()
            SDraw = draw(S)
            G = SDraw.toGH()
            S = shape(S, G, D)
            print S.shape 
        #"""
        except:
            # Identifies if any geometries are unsupported by SGI Shape
            if len(G) > 0:
                error_check = True
                for i in enumerate(G):
                    if type(i) != rg.PolyCurve and type(i) != rg.PolylineCurve and type(i) != rg.LineCurve and type(i) != rg.Brep and type(i) != rg.Mesh and type(i) != rg.Circle and type(i) != rg.Ellipse and type(i) != rg.NurbsCurve and type(i) != rg.ArcCurve and type(i) != rg.Rectangle3d and type(i) is not TextGoo:
                        ghenv.Component.AddRuntimeMessage(w, 'Input contains unsupported geometries. You have inputted a '+ str(type(i)))
                        error_check = False
                        
                if error_check:
                    ghenv.Component.AddRuntimeMessage(e, 'Error in rule application computation')
                    
        #"""
    #"""
    else:
        try:
            # Empty shape 
            extract1 = extract([], [])
            S, tempG, D = extract1.toSortal()
            for i in ptList:
                tempG.append(i)
            G = tempG
            SDraw = draw(S)
            G = SDraw.toGH()
            S = shape(S, G, D)
                
        except:
            pass

        if refP != None and None not in G:
            if type(refP) != Rhino.Geometry.Point3d:
                ghenv.Component.AddRuntimeMessage(w, 'Incorrect reference point input')
        else:
            if len(G) > 0:
                error_check = True
                for i in enumerate(G):
                    if type(i) != rg.PolyCurve and type(i) != rg.PolylineCurve and type(i) != rg.LineCurve and type(i) != rg.Brep and type(i) != rg.Mesh and type(i) != rg.Circle and type(i) != rg.Ellipse and type(i) != rg.NurbsCurve and type(i) != rg.ArcCurve and type(i) != rg.Rectangle3d and type(i) is not TextGoo:
                        ghenv.Component.AddRuntimeMessage(w, 'Input contains unsupported geometries. You have inputted a '+ str(type(i)))
                        error_check = False
                
    #"""            
else:
    ghenv.Component.AddRuntimeMessage(w, 'Sortal library has not yet been set up.')
# ---------- end dshape_2 ----------
rectangle_4 = Rectangle(Plane=pt_3, XSize=division_4, YSize=division_4, Radius=0)  # -> Rectangle, Length
mplane_2 = MeshPlane(Boundary=rectangle_3.Rectangle, WidthCount=10, HeightCount=10)  # -> Mesh, Area
mplane_3 = MeshPlane(Boundary=rectangle_4.Rectangle, WidthCount=10, HeightCount=10)  # -> Mesh, Area
panel_6 = Panel(mplane_2.Area)
rule = SGIRule(name="rule_square", desc="moves square up and to the right", lhS=dshape.S, rhS=dshape_2.S)  # -> rule
# ---------- rule: Python ----------
#
# SortalGI: A Sortal/Shape Grammar Interpreter Plugin
# 
# Copyright (c) 2018-2019, Rudi Stouffs <stouffs@sortal.org> 
# 
# SortalGI is free software; you can redistribute it and/or modify 
# it under the terms of the GNU General Public License as published 
# by the Free Software Foundation; either version 3 of the License, 
# or (at your option) any later version.
# 
# SortalGI is distributed in the hope that it will be useful,
# but WITHOUT ANY WARRANTY; without even the implied warranty of 
# MERCHANTABILITY or FITNESS FOR A PARTICULAR PURPOSE. See the 
# GNU General Public License for more details, <http://www.gnu.org/licenses/>.
# 
# @license GPL-3.0+ <http://spdx.org/licenses/GPL-3.0+>


"""
Create an SGI (non-parametric) Rule object from a left-hand-side and right-hand-side shape object, a rule name and a (optional) brief description.
-
A non-parametric rule will match a given shape if there exists a similarity transformation that matches the left-hand-side shape onto the given shape.
-
The rule name must be unique.
-
If a shape description type is present in one shape obejct (lhS or rhS) but not the other, an empty shape description of that type is automaticaly added to the other shape object within the rule.
-
    Args:
        name: Rule name
        desc: Optional, brief rule description (text)
        lhS: Left-hand-side shape object
        rhS: Right-hand-side shape object
    Returns:
        rule: Non-parametric rule object
"""

ghenv.Component.Name = 'SGI Rule'
ghenv.Component.NickName = 'Rule'
ghenv.Component.Message = 'VER 0.6.0\nJUN_08_2019'
ghenv.Component.Category = "SGI"
ghenv.Component.SubCategory = "2 | Rule"

ghenv.Component.Params.Input[0].Name = "rule_square"
ghenv.Component.Params.Input[0].NickName = "name"
ghenv.Component.Params.Input[0].Description = 'Rule name'
ghenv.Component.Params.Input[1].Name = "desc"
ghenv.Component.Params.Input[1].NickName = "desc"
ghenv.Component.Params.Input[1].Description = 'moves square up and to the right'
ghenv.Component.Params.Input[2].Name = "lhS"
ghenv.Component.Params.Input[2].NickName = "lhS"
ghenv.Component.Params.Input[2].Description = 'Left-hand-side shape object'
ghenv.Component.Params.Input[3].Name = "rhS"
ghenv.Component.Params.Input[3].NickName = "rhS"
ghenv.Component.Params.Input[3].Description = 'Right-hand-side shape object'
ghenv.Component.Params.Output[0].Name = "rule"
ghenv.Component.Params.Output[0].NickName = "rule"
ghenv.Component.Params.Output[0].Description = 'Non-parametric rule object'

try: ghenv.Component.AdditionalHelpFromDocStrings = "1"
except: pass

__author__ = "akidribm"

# Sortal Imports
from sortal import (transformSet, primitiveSort, point3D, point2D, coordinate, lineSegment3D, planeSegment2D, 
                    lineSegment2D, line3D, label, rWeight, disjunctiveSort, attributeSort, affineTransform,  
                    vector3D, vector2D, planeSegment3D, label, enumerative, sort)
from sortal import rule as ruleInstance

# System/Rhino/Grasshopper library imports
import System
import Rhino.Geometry as rg
import Rhino.DocObjects as rdo
import Rhino as r
import rhinoscriptsyntax as rs
import scriptcontext as sc
import Grasshopper.Kernel as gh
import clr

e = gh.GH_RuntimeMessageLevel.Error
w = gh.GH_RuntimeMessageLevel.Warning

rhdoc = r.RhinoDoc.ActiveDoc

rule = None

# Changes sort type of metaform to target sort type 'discSort'
def shift_metaform(discSort, forms):
    formM = None 
    if discSort.__class__ != disjunctiveSort:
        ghenv.Component.AddRuntimeMessage(w, "ERROR: Only sort types based on disjunctiveSort can be passed to create.metaForm.")
        raise TypeError
        
    formM = discSort.newForm()
    for i in forms:
        formM.insert(i)
        
    return formM

# Creates a disjunctive sort that merges the elements of two input disjunctive sorts
def make_composite_sort(disjSort1, disjSort2):
    componentsA = disjSort1.component
    componentsB = disjSort2.component
    	
    componentsList = componentsA + [i for i in componentsB if i not in componentsA] # This may cause conflict, check first if any problem with descriptions
    
    if disjunctiveSort.sameComponent(componentsList) is False:
        sc.sticky['sort_count'] += 1
        newDisjSort = disjunctiveSort(('rhino_shapes_'+str(sc.sticky['sort_count'])), componentsList)
        
    else:
        newDisjSort = disjunctiveSort.sameComponent(componentsList)

    return newDisjSort
        
# Checks if inputs are correct data type
if type(name) == type('a') and (type(desc) == type('a') or desc == None) and lhS is not None and rhS is not None:
    check_rule_components = []
    to_delete = []
    # Checks if rule with similar name (before the GUID tag) already exists in component form in Grasshopper
    for scriptObj in ghenv.Component.OnPingDocument().Objects:
        if 'SGI Rule' in scriptObj.Name or 'SGI pRule' in scriptObj.Name:
            check_rule_components.append(str(scriptObj.InstanceGuid))
            
    # Removes this component from check list
    if str(ghenv.Component.InstanceGuid) in check_rule_components:
        check_rule_components.pop(check_rule_components.index(str(ghenv.Component.InstanceGuid)))

    for guid_name in check_rule_components:
        if guid_name in sc.sticky:
            print sc.sticky[guid_name], name
            if sc.sticky[guid_name] == name:
                raise ValueError('Rule with the same name (' + name + ') already present in Grasshopper file.')
                
    # Checks if rule with similar name (only rule name) already exists in the rule register
    # If found, overwrites the first rule encountered
    for rule_name in ruleInstance.register:
        if name in rule_name:
            to_delete.append(rule_name)
    
    for rule_name in to_delete:
        del ruleInstance.register[rule_name]
        
    if len(lhS.geometry) > 0:
        nameID = name + '___' + str(ghenv.Component.InstanceGuid).replace("-","_")
        sc.sticky[str(ghenv.Component.InstanceGuid)] = name
        actualLHS = lhS.shape.duplicate()
        actualRHS = rhS.shape.duplicate()
        
        # Checks if rule name already present in rule register
        # If no, creates rule and returns rule object
        if nameID in ruleInstance.register:
            del ruleInstance.register[nameID]
        
        try:
            if len(lhS.geometry) != 0:
                if lhS.shape.type == 'form-metaForm' and rhS.shape.type == 'form-metaForm' and lhS.shape is not rhS.shape:
            
                    if lhS.shape.sort.contains(rhS.shape.sort):
                        actualRHS = shift_metaform(lhS.shape.sort, rhS.shape)
                    elif rhS.shape.sort.contains(lhS.shape.sort):
                        actualLHS = shift_metaform(rhS.shape.sort, lhS.shape)
                    else:
                        newDisjSort = make_composite_sort(lhS.shape.sort,rhS.shape.sort)
                        actualRHS = shift_metaform(newDisjSort, rhS.shape)
                        actualLHS = shift_metaform(newDisjSort, lhS.shape)
                    print(actualLHS.toString('',True))
                    print(actualRHS.toString('',True))
                    rule = ruleInstance(nameID, desc, actualLHS, actualRHS, keyCheck = True)
                    
                    if rule.isValid():
                        print name, 'has been created.'
                        # Reruns GH file if rule has been altered
                        #"""
                        for scriptObj in ghenv.Component.OnPingDocument().Objects:
                            if 'SGI Get Rule' in scriptObj.Name:
                                scriptObj.ExpireSolution(True)
                        #"""
                    else:
                        message = ('Rule was not created since there was insufficient information for LHS Shape.\n'+
                            'The minimum requirements for defining the LHS of a non-parametric rule are:\n'+
                            '- minimally 3 points (not coincident)\n'+
                            '- minimally 2 points + 1 plane (points not co-linear to perpendicular)\n'+
                            '- minimally 1 point + 2 planes (not concurrent)\n'+
                            '- minimally 1 point + 1 arc (point not perpendicular to arc center)\n'+
                            '- minimally 1 point + 1 line (not co-linear)\n'+
                            '- minimally 3 lines (not all parallel)\n'+
                            '- minimally 2 lines + 1 plane (not all parellel, nor both lines concurrent to plane)\n'+
                            '- minimally 1 line + 2 planes (line not concurrent to both planes)\n'+
                            '- minimally 1 line + 1 arc (center not co-linear)\n'+
                            '- minimally 2 arcs (not concentric or normals not parallel)\n'+
                            '- exactly 1 or 2 points and nothing else\n'+
                            '- exactly 1 or 2 lines and nothing else\n'+
                            '- exactly 1 line and 1 co-linear point and nothing else')
                                    
                        ghenv.Component.AddRuntimeMessage(e, message)
                else:
                    ghenv.Component.AddRuntimeMessage(w, 'lhS and rhS are the same shape.')
            else:
                ghenv.Component.AddRuntimeMessage(w, 'LHS shape is empty.')
                
        except:
            try:
                if lhS.shape is not None:
                    pass
            except:
                ghenv.Component.AddRuntimeMessage(w, 'Input for lhS is not a shape.')
                
            try:
                if rhS.shape is not None:
                    pass
            except:
                ghenv.Component.AddRuntimeMessage(w, 'Input for rhS is not a shape.')
                
            try:
                if rule.isValid():
                    pass
            except:
                ghenv.Component.AddRuntimeMessage(w, 'Rule was not created. One or more of the inputs may be invalid.')
    else:
        ghenv.Component.AddRuntimeMessage(e, 'Rule was not created. LHS shape is empty.')
else:
    
    # No message if empty paramaters
    if type(name) != type('a') and type(desc) != type('a') and lhS is None and rhS is None:
        pass
        #ghenv.Component.AddRuntimeMessage(w, 'Component failed to collect input.')
        
    else:     
    
        # Identifies which paramater is empty/incorrect
        if  type(name) != type('a'):
            ghenv.Component.AddRuntimeMessage(w, 'Empty rule name')

        if type(desc) != type('a') and type(desc) != None:
            ghenv.Component.AddRuntimeMessage(w, 'Empty rule description')
            
        if lhS is None:
            ghenv.Component.AddRuntimeMessage(w, 'Empty rule left hand side. This must be a sortal shape.')

        if rhS is None:
            ghenv.Component.AddRuntimeMessage(w, 'Empty rule right hand side. This must be a sortal shape.')
# ---------- end rule ----------
panel_7 = Panel(mplane_3.Area)
rule_info = SGIRuleInfo(rule=rule)  # -> info, graft(lhS), graft(rhS), predicates, directives
# ---------- rule_info: Python ----------
#
# SortalGI: A Sortal/Shape Grammar Interpreter Plugin
# 
# Copyright (c) 2018-2019, Rudi Stouffs <stouffs@sortal.org> 
# 
# SortalGI is free software; you can redistribute it and/or modify 
# it under the terms of the GNU General Public License as published 
# by the Free Software Foundation; either version 3 of the License, 
# or (at your option) any later version.
# 
# SortalGI is distributed in the hope that it will be useful,
# but WITHOUT ANY WARRANTY; without even the implied warranty of 
# MERCHANTABILITY or FITNESS FOR A PARTICULAR PURPOSE. See the 
# GNU General Public License for more details, <http://www.gnu.org/licenses/>.
# 
# @license GPL-3.0+ <http://spdx.org/licenses/GPL-3.0+>


"""
Deconstruct an SGI Rule (or pRule) object into its left-hand-side and right-hand-side 
shape objects, a multi-line text consisting of GUID, rule name and rule description, and 
its predicates and directives, if any.
-
    Args:
        rule: Rule object
    Returns:
        info: Multi-line text including GUID, rule name and rule description
        lhS: Left-hand-side shape object
        rhS: Right-hand-side shape object
        predicates: Predicates text
        directives: Directives text
"""

ghenv.Component.Name = 'SGI Rule Info'
ghenv.Component.NickName = 'Rule Info'
ghenv.Component.Message = 'VER 0.6.0\nJUN_07_2019'
ghenv.Component.Category = "SGI"
ghenv.Component.SubCategory = "2 | Rule"

ghenv.Component.Params.Input[0].Name = "rule"
ghenv.Component.Params.Input[0].NickName = "rule"
ghenv.Component.Params.Input[0].Description = 'Rule object'
ghenv.Component.Params.Output[0].Name = "info"
ghenv.Component.Params.Output[0].NickName = "info"
ghenv.Component.Params.Output[0].Description = 'Multi-line text including GUID, rule name and rule description'
ghenv.Component.Params.Output[1].Name = "lhS"
ghenv.Component.Params.Output[1].NickName = "lhS"
ghenv.Component.Params.Output[1].Description = 'Left-hand-side shape object'
ghenv.Component.Params.Output[2].Name = "rhS"
ghenv.Component.Params.Output[2].NickName = "rhS"
ghenv.Component.Params.Output[2].Description = 'Right-hand-side shape object'
ghenv.Component.Params.Output[3].Name = "predicates"
ghenv.Component.Params.Output[3].NickName = "predicates"
ghenv.Component.Params.Output[3].Description = 'Predicates text'
ghenv.Component.Params.Output[4].Name = "directives"
ghenv.Component.Params.Output[4].NickName = "directives"
ghenv.Component.Params.Output[4].Description = 'Directives text'

try: ghenv.Component.AdditionalHelpFromDocStrings = "1"
except: pass

__author__ = "akidribm"

# Sortal imports
from sortal import (key, transformSet, primitiveSort, point3D, point2D, coordinate, lineSegment3D, planeSegment2D, 
                    lineSegment2D, line3D, label, rWeight, disjunctiveSort, attributeSort, affineTransform,  
                    vector3D, vector2D, planeSegment3D, label, enumerative, sort)
from sortal import rule as ruleInstance

# Rhinoceros/Grasshopper library imports
import System
import Rhino.Geometry as rg
import Rhino.DocObjects as rdo
import Rhino as r
import rhinoscriptsyntax as rs
import clr
import Grasshopper.Kernel as gh
import scriptcontext as sc
from random import random

# Import for transformations
from mpmath import pi, sin, cos

rhdoc = r.RhinoDoc.ActiveDoc

e = gh.GH_RuntimeMessageLevel.Error
w = gh.GH_RuntimeMessageLevel.Warning

# Defines shape object
# sortalForm - shape
# geometry - geometry
# description - description
class shape ():
    def __init__(self, sortalForm, geometry, description):
        self.shape = sortalForm
        self.geometry = geometry
        self.description = description

# Draws geometry from sortal shape's sortal form   
class draw(object):
    def __init__(self, sortalForm):
        self.sortalForm = sortalForm
        self.type = self.sortalForm.type
        self.objectIds = []
    
    # Goes through sortal form to draw individual geometries
    def toGH(self):
        if self.type == 'form-metaForm':
            elements = self.sortalForm.elements

            for element in elements:
                individuals =  element.elements
                if len(individuals) == 0:
                    continue 
                    
                # Draws points, labeled points, circles, ellipses
                if element.type == 'form-discrete' and 'description' not in individuals[0].type:
                    # Draws points and labeled points
                    if 'point' in individuals[0].type:
                        conversion = self.Point
                        
                    elif 'circle' in individuals[0].type:
                        data_prep = self.data_prep_circle
                        conversion = self.Circle
                        
                    elif 'ellipse' in individuals[0].type:
                        data_prep = self.data_prep_ellipse
                        conversion = self.Ellipse
                        
                    if type (individuals) == type([]):
                        for indiv in individuals:
                            indivData = indiv
                            if 'circle' in individuals[0].type or 'ellipse' in individuals[0].type:
                                indivData = data_prep(indiv)
                                
                            obj = conversion(indivData)
                            self.objectIds.append(obj)
                    else:
                        obj = conversion(individuals)
                        self.objectIds.append(obj)

                # Draws lines
                elif element.type == 'form-interval':
                    text, weight, lineX, lineY, lineZ = self.data_prep_line(individuals)     # Extracts line coordinates and attributes (if any) from line segments
                    obj = self.LineSeg(text, weight, lineX, lineY, lineZ, individuals)  # Plots line segments

                    for o in obj:
                        self.objectIds.append(o)
                
                # Draws planes
                elif element.type == 'form-areal' or element.type == 'form-coForm':
                    for indiv in individuals:

                        if indiv.type == 'form-coForm':
                            for object in indiv.elements:
                                planeData = self.data_prep_plane(object)
                                obj = self.PlaneSegment(planeData)
                                
                                for o in obj:
                                    self.objectIds.append(o)
                                    
                        elif indiv.type == 'ind-planeSegment3D':
                            planeData = self.data_prep_plane(indiv)
                            obj = self.PlaneSegment(planeData)

                            for o in obj:
                                self.objectIds.append(o)
                
                # Draws circular arcs
                elif element.type == 'form-cyclical':
                    if 'circular' in individuals[0].type:
                        data_prep = self.data_prep_arc
                        conversion = self.Arc
                        
                    for indiv in individuals:
                        arcData = data_prep(indiv)
                        obj = conversion(arcData)
                        self.objectIds.append(obj)
                        
                # Draws bezier curves
                elif element.type == 'form-curve':
                    for indiv in individuals:
                        arcData = self.data_prep_bezier(indiv)
                        obj = self.Bezier(arcData)
                        self.objectIds.append(obj)
                        
        elif self.type == 'form-discrete':
            individuals = self.form.elements
            # Draws points and labeled points
            if 'point' in individuals[0].type:
                conversion = self.Point
                
            elif 'circle' in individuals[0].type:
                data_prep = self.data_prep_circle
                conversion = self.Circle
                
            elif 'ellipse' in individuals[0].type:
                data_prep = self.data_prep_ellipse
                conversion = self.Ellipse
                
            if type (individuals) == type([]):
                for indiv in individuals:
                    indivData = indiv
                    if 'circle' in individuals[0].type or 'ellipse' in individuals[0].type:
                        indivData = data_prep(indiv)

                    obj = conversion(indivData)
            else:
                obj = conversion(individuals)
            
            self.objectIds.append(obj)
            
        elif self.type == 'form-interval':
            individuals = self.form.elements
            text, weight, lineX, lineY, lineZ = self.data_prep(individuals) 
            obj = self.LineSeg(text, weight, lineX, lineY, lineZ, individuals)
            
            self.objectIds.append(obj)
        
        elif element.type == 'form-areal' or element.type == 'form-coForm':
            if indiv.type == 'form-coForm':
                for object in indiv.elements:
                    planeData = self.data_prep_plane(object)
                    obj = self.PlaneSegment(planeData)

            elif indiv.type == 'ind-planeSegment3D':
                planeData = self.data_prep_plane(indiv)
                obj = self.PlaneSegment(planeData)

            for o in obj:
                self.objectIds.append(o)
        
        elif element.type == 'form-cyclical' or element.type == 'form-curve':
            individuals = self.form.elements
            if element.type == 'form-cyclical':
                data_prep = self.data_prep_cArc
                conversion = self.Arc
            elif element.type == 'form-curve':
                data_prep = self.data_prep_bezier
                conversion = self.Bezier
                
            for indiv in individuals:
                indivData = data_prep(indiv)
                obj = conversion(indivData)
                self.objectIds.append(obj)
        
        flattenedSet = []
        for objectSet in self.objectIds:
            if type(objectSet) == type([]):
                for obj in objectSet:
                    flattenedSet.append(obj)
            else:
                flattenedSet.append(objectSet)

        return flattenedSet
    
    # Prepares data from plane segments
    # Currently only adapts external boundary
    def data_prep_plane(self, planeSegment):
        bounds = {}
        bounds['inner'] = []
        outer = []
        bounds['normal'] = rg.Vector3d(planeSegment.normal.x, planeSegment.normal.y, planeSegment.normal.z)
        bounds['origin']  = rg.Point3d(planeSegment.pRoot.x, planeSegment.pRoot.y, planeSegment.pRoot.z)
        
        for count, bound in enumerate(planeSegment.boundaries):
            
            # Extracts outer bound (1 only)
            if count == 0:
                for point in bound.polygonal:
                    coordinates = [point.x, point.y, point.z]
                    outer.append(coordinates)
                    
                outer.append(outer[0])
                bounds['outer'] = outer
            
            # Extracts inner loops (may be greater than 1)
            elif count > 0: 
                inner = []
                for point in bound.polygonal:
                    coordinates = [point.x, point.y, point.z]
                    inner.append(coordinates)

                inner.append(inner[0])
                bounds['inner'].append(inner)

        return bounds
    
    # Prepares data from line segments
    def data_prep_line(self, line_set):
        text = []
        weight = []

        lineSeg_x = [[0 for x in range (2)] for y in range(len(line_set))]
        lineSeg_y = [[0 for x in range (2)] for y in range(len(line_set))]
        lineSeg_z = [[0 for x in range (2)] for y in range(len(line_set))]
        
        # Extracts attributes and coordinates
        for index in range(len(line_set)):

            # Extracts attributes from line segments inside line_set if there are attributes inside
            # form-discrete - labels
            # form-ordinal - weights
            # form-special - special variant of weights specifically for Rhino, does operations arithmetically
            if line_set[index].hasAttribute():
                ind  =  line_set[index].attribute

                if ind.type == 'form-discrete':
                    text.append(ind.elements[0].getValue())
                    weight.append(0.0)

            else:
                text.append('')
                weight.append(0.0)

            # Extracts coordinates from line segments
            for j in range(2):
                if j == 0 :
                    lineSeg_x[index][j] = float(line_set[index].start.x.value)
                    lineSeg_y[index][j] = float(line_set[index].start.y.value)
                    lineSeg_z[index][j] = float(line_set[index].start.z.value)
                else: 
                    lineSeg_x[index][j] = float(line_set[index].end.x.value)
                    lineSeg_y[index][j] = float(line_set[index].end.y.value)
                    lineSeg_z[index][j] = float(line_set[index].end.z.value)

        return text, weight, lineSeg_x, lineSeg_y, lineSeg_z
    
    def data_prep_circle(self, cSource):
        center = rg.Point3d(cSource.center.x, cSource.center.y, cSource.center.z)
        pin_1 = rg.Point3d(cSource.getPoints()[1].x, cSource.getPoints()[1].y, cSource.getPoints()[1].z)
        pin_2 = rg.Point3d(cSource.getPoints()[2].x, cSource.getPoints()[2].y, cSource.getPoints()[2].z)
        radius = cSource.radius
        angle = random()*pi*2
        
        return (center, radius, pin_1, pin_2)
        
    def data_prep_ellipse(self, eSource):
        center = rg.Point3d(eSource.center.x, eSource.center.y, eSource.center.z)
        foc_1 = rg.Point3d(eSource.getPoints()[0].x, eSource.getPoints()[0].y, eSource.getPoints()[0].z)
        foc_2 = rg.Point3d(eSource.getPoints()[1].x, eSource.getPoints()[1].y, eSource.getPoints()[1].z)
        shortPt = rg.Point3d(eSource.getPoints()[2].x, eSource.getPoints()[2].y, eSource.getPoints()[2].z)
    
        cDist = foc_1.DistanceTo(foc_2)/2
        bDist =  center.DistanceTo(shortPt)
        aDist = sqrt(cDist**2 + bDist**2)

        shortVec = shortPt - center
        shortDist = sqrt(shortVec.X**2 + shortVec.Y**2 + shortVec.Z**2)
        shortUnit = rg.Vector3d(shortVec.X/shortDist, shortVec.Y/shortDist, shortVec.Z/shortDist)
        normVec = rg.Vector3d(eSource.normal.x, eSource.normal.y, eSource.normal.z)
        normDist = sqrt(normVec.X**2 + normVec.Y**2 + normVec.Z**2)
        normUnit = rg.Vector3d(normVec.X/normDist, normVec.Y/normDist, normVec.Z/normDist)
        
        longUnit = rg.Vector3d.CrossProduct(shortUnit, normUnit)
        longPt = center + rg.Vector3d.Multiply(longUnit, aDist)
        
        return (center, longPt, shortPt)
        
    def data_prep_arc(self, cArcSource):
        start = rg.Point3d(cArcSource.start.x, cArcSource.start.y, cArcSource.start.z)
        end = rg.Point3d(cArcSource.end.x, cArcSource.end.y, cArcSource.end.z)
        pin = rg.Point3d(cArcSource.pin.x, cArcSource.pin.y, cArcSource.pin.z)
        return (start, pin, end)
    
    """
    def data_prep_eArc(self, eArcSource):
        # Preparation of data for computation and elliptical arc creation
        center = rg.Point3d(eArcSource.center.x, eArcSource.center.y, eArcSource.center.z)
        start = rg.Point3d(eArcSource.start.x, eArcSource.start.y, eArcSource.start.z)
        end = rg.Point3d(eArcSource.end.x, eArcSource.end.y, eArcSource.end.z)
        shortPt = rg.Point3d(eArcSource.quadPoint.x, eArcSource.quadPoint.y, eArcSource.quadPoint.z)
        foc_1 = rg.Point3d(eArcSource.getPoints()[0].x, eArcSource.getPoints()[0].y, eArcSource.getPoints()[0].z)
        foc_2 = rg.Point3d(eArcSource.getPoints()[1].x, eArcSource.getPoints()[1].y, eArcSource.getPoints()[1].z)
        
        # Computation of major, minor, foci distances    
        cDist = foc_1.DistanceTo(foc_2)/2
        bDist =  center.DistanceTo(shortPt)
        aDist = sqrt(cDist**2 + bDist**2)
    
        # Computation of minor axis (shortPt) and major axis (longPt) quad points
        shortVec = shortPt - center
        shortDist = sqrt(shortVec.X**2 + shortVec.Y**2 + shortVec.Z**2)
        shortUnit = rg.Vector3d(shortVec.X/shortDist, shortVec.Y/shortDist, shortVec.Z/shortDist)
        normVec = rg.Vector3d(eArcSource.normal.x, eArcSource.normal.y, eArcSource.normal.z)
        normDist = sqrt(normVec.X**2 + normVec.Y**2 + normVec.Z**2)
        normUnit = rg.Vector3d(normVec.X/normDist, normVec.Y/normDist, normVec.Z/normDist)
        longUnit = rg.Vector3d.CrossProduct(shortUnit, normUnit)
        longPt = center + rg.Vector3d.Multiply(longUnit, aDist)
        
        return (center, start, end, shortPt, longPt)
    """
    
    def data_prep_bezier(self, bezierSource):
        start = rg.Point3d(bezierSource.start.x, bezierSource.start.y, bezierSource.start.z)
        end = rg.Point3d(bezierSource.end.x, bezierSource.end.y, bezierSource.end.z)
        ctrl = rg.Point3d(bezierSource.controlPoint.x, bezierSource.controlPoint.y, bezierSource.controlPoint.z)
        return (start, ctrl,end)
        
    # Plots points
    # Currently supports labeled points
    def Point(self, pointSource):
        allPts = []
        
        if pointSource.hasAttribute():
            
            attrib  =  pointSource.attribute # Only one source of attributes, which are label descriptions
            pt = rg.Point3d(float(pointSource.value.x.value), float(pointSource.value.y.value), float(pointSource.value.z.value))
            newPlane = rg.Plane(pt, rg.Vector3d(0,0,1))
            fullText = ''
            
            if attrib.type == 'ind-description':
                context = attrib.getValue().split('@')
                text = context[0][1:-1]
                if text[0] == '"' and text [-1] == '"':
                    text = text[1:-1]
                textHt = sc.sticky['text_size']
                temp = rg.Point3d(float(pointSource.value.x.value), float(pointSource.value.y.value), float(pointSource.value.z.value))
                pt = TextGoo(r.Display.Text3d(text, newPlane, textHt))
                
            elif attrib.type == 'form-discrete':
                
                
                for ind, element in enumerate(attrib.elements):
                    context = element.getValue().split('@')
                    text = context[0][1:-1]
                    if text[0] == '"' and text [-1] == '"':
                        text = text[1:-1]
                    if ind == 0:
                        fullText += text
                    else:
                        fullText += '|' + text

                textHt = sc.sticky['text_size']
                temp = rg.Point3d(float(pointSource.value.x.value), float(pointSource.value.y.value), float(pointSource.value.z.value))
                pt = TextGoo(r.Display.Text3d(fullText, newPlane, textHt))
            
            elif attrib.type == 'form-metaForm':
                for ind, element in enumerate(attrib.elements):
                    context = element.elements[0].getValue().split('@')
                    text = context[0][1:-1]
                    if text[0] == '"' and text [-1] == '"':
                        text = text[1:-1]
                    if ind == 0:
                        fullText += text
                    else:
                        fullText += '|' + text

                textHt = sc.sticky['text_size']
                temp = rg.Point3d(float(pointSource.value.x.value), float(pointSource.value.y.value), float(pointSource.value.z.value))
                pt = TextGoo(r.Display.Text3d(fullText, newPlane, textHt))
                   
            allPts = [pt, temp]
                     
            return allPts
            
        else:
            pt = rg.Point3d(float(pointSource.value.x.value), float(pointSource.value.y.value), float(pointSource.value.z.value))
            return pt
    
    # Plots line segments
    # Currently does not support attributes
    def LineSeg(self, text, weight, lineX, lineY, lineZ, line_set):
        block = []
        sc.doc = r.RhinoDoc.ActiveDoc
        
        for index in range(len(lineX)):
            
            # Draws label if any input
            if text[index] != '':
                data = []
                for dat in line_set[index].midpoint():
                    data.append(dat)
                
                pt = rg.Point3d(data[0], data[1], data[2])
            
            # Draws line segment
            start = rg.Point3d(lineX[index][0], lineY[index][0], lineZ[index][0])
            end = rg.Point3d(lineX[index][1], lineY[index][1], lineZ[index][1])
            line = rg.LineCurve(start, end)

            # Collects GUIDs of line segments
            block.append(line)
        
        return block 
    
    # Creates plane segment representation (BREP, allows for trims)
    def PlaneSegment(self, boundaries):
        outer = boundaries['outer']
        inner = boundaries['inner']
        trims = []
        planeSegment = rg.Plane(boundaries['origin'], boundaries['normal'])

        corners = []
        boundLines = []
        
        for bound in outer:
            corners.append(rg.Point3d(bound[0], bound[1], bound[2]))
        outerBound =  rg.PolylineCurve(corners)

        if len(inner) > 0:
            trims = []
            
            for boundSet in inner:
                corners = []
                for bound in boundSet:
                    corners.append(rg.Point3d(bound[0], bound[1], bound[2]))
                    
                innerBound = rg.PolylineCurve(corners)
                trims.append(innerBound)
            trims.append(outerBound)
            totalPlaneSeg = rg.Brep.CreatePlanarBreps(trims)
        else:
            totalPlaneSeg = rg.Brep.CreatePlanarBreps(outerBound)

        return totalPlaneSeg
    
    def Circle(self, cData):
        planeC = rg.Plane(cData[0], cData[2], cData[3])
        circle = rg.Circle(planeC, cData[1])
        return circle
        
    def Ellipse(self, eData):
        center = eData[0]
        longPt = eData[1]
        shortPt = eData[2]
        ellipse = rs.AddEllipse3Pt(center, longPt, shortPt)
        
        return ellipse
        
    def Arc(self, cArcData):
        start = cArcData[0]
        end = cArcData[2]
        pin = cArcData[1]
        cArc = rg.Arc(start, pin, end)

        return cArc
    
    def Bezier(self, bezData):
        bez = rg.Curve.CreateControlPointCurve(bezData)
        bez = rg.Curve.CreateControlPointCurve(bezData)
        return bez

class TextGoo(gh.Types.GH_GeometricGoo[r.Display.Text3d], gh.IGH_BakeAwareData, gh.IGH_PreviewData):
    #region construction
    def __init__(self, text):
        self.m_value = text
    
    @staticmethod
    def DuplicateText3d(original):
        if original is None: return None
        text = r.Display.Text3d(original.Text, original.TextPlane, original.Height)
        #text.Bold = original.Bold,
        #text.Italic = original.Italic,
        text.FontFace = original.FontFace
        return text
    
    def DuplicateGeometry(self):
        return TextGoo(TextGoo.DuplicateText3d(self.m_value))
    
    #region properties
    def get_TypeName(self):
        return "3D Text"
        
    def get_TypeDescription(self):
        return "3D Text"
    
    def ToString(self):
        if self.m_value is None: return "<null>"
        return self.m_value.Text
        
    def get_Boundingbox(self):
        if self.m_value is None:
            return r.Geometry.BoundingBox.Empty;
        return self.m_value.BoundingBox;
        
    def GetBoundingBox(self, xform):
        if self.m_value is None:
            return r.Geometry.BoundingBox.Empty
        box = self.m_value.BoundingBox
        corners = xform.TransformList(box.GetCorners())
        return r.Geometry.BoundingBox(corners)
    
    #region methods
    def Transform(self, xform):
        text = TextGoo.DuplicateText3d(self.m_value)
        if text is None: return TextGoo(None)
        
        plane = text.TextPlane
        point = plane.PointAt(1, 1)
        
        plane.Transform(xform)
        point.Transform(xform)
        dd = point.DistanceTo(plane.Origin)
        
        text.TextPlane = plane;
        text.Height *= dd / sqrt(2)
        return TextGoo(text)
        
    def Morph(self, xmorph):
        return self.DuplicateGeometry()

    #region preview
    def get_ClippingBox(self):
        return self.get_Boundingbox()
        
    def DrawViewportWires(self, args):
        if self.m_value is None: return
        args.Pipeline.Draw3dText(self.m_value, args.Color)
      
    def DrawViewportMeshes(self, args):
        # Do not draw in meshing layer.
        pass

    #region baking
    def BakeGeometry(self, doc, att, id):
        try:
            id = sy.Guid.Empty
            
            if self.m_value is None:
                return false, id
            
            if att is None:
                att = doc.CreateDefaultAttributes()
            
            id = doc.Objects.AddText(self.m_value, att)
            
            return True, id
        except Exception, ex:
            sy.Windows.Forms.MessageBox.Show(str(ex))
            return False, sy.Guid.Empty

 
 
"""
Convert CLASS
Takes non-parametric sortal metaform as input and converts it into a parametric sortal object or the other way around

INPUT
Any metaform, discrete form or interval form; these are sortal objects

RETURNS
(Non)Parametric sortal form
""" 
class convert:
    
    # Converts from sortal compound form to compound agnostic object
    def __init__(self, form, parametric = True, reinsertion = []):
        self.form = form
        self.type = form.type
        self.classification = ''
        sc.sticky['mainSort'] = self.form.sort.name
        self.newSorts = {}
        self.objects = {'descriptions': []}
        self.parametric = parametric
        self.exclusion = {}
        self.reinsertion = reinsertion

        # Entered if form is a metaform, i.e. contains both points and line segments
        # Structure of metaform: <metaform name>.elements contains one form of line segments, one form of points
        # To access each individual point or line segment -> since the list stored in the metaform 
        # is constructed as [<point form>, <line segment form>]
        # i.e. <metaform>.name.elements[0].elements -> returns list of points
        # <metaform>.name.elements[1].elements -> returns list of line segments
        self.disjSort = self.assembleNewSort(self.form.sort)
    
    def toConverse(self):
        # COMPOUND SORT
        if self.type == 'form-metaForm': 
            formElements = self.form.elements 
            
            if len(formElements) > 0:
                # Handles disjunctive sorts inside compound agnostic object
                if formElements[0].type == 'form-metaForm':
                    for formElement in formElements:
                        name = formElement.sort.name.split('_')
                        name = name[-1]
                        self.objects['descriptions'] = {}
                        self.fMetaform(formElement)
                    
                # Handles single disjunctive sort
                else:
                    self.fMetaform(formElements, self.form.sort.name)
                
        # SIMPLE SORTS 
        # Entered if form only contains points 
        elif self.type == 'form-discrete':
            self.fDiscrete(self.form.elements, self.form.sort.name)
        # Entered if form only contains line segments
        # Extracts data from line segments; parses them into agnostic object data
        elif self.type == 'form-interval':
           self.fInterval(self.form.elements, self.form.sort.name)
        # Entered if form only contains plane segments 
        # Extracts data from plane segments; parses them into agnostic object data
        elif elements[ind].type == 'form-coForm' or elements[ind].type == 'form-areal':
            self.fAreal(individuals, self.form.sort.name)
 
        newForm = self.makeForm()
        
        return newForm, self.exclusion
    
    def assembleNewSort(self, mainSort):
        name = mainSort.name
        components = mainSort.component
        componentsList = []
        
        for a in components:
            if 'description' not in a.baseSort().characteristic.type:
                baseName = None
                
                if 'lineSegment' in a.baseSort().characteristic.type:
                    if self.parametric:
                        baseName = 'lineSegP3D'
                    else:
                        baseName = 'lineSeg3D'
                    
                elif 'point' in a.baseSort().characteristic.type:
                    if self.parametric:
                        baseName = 'pointP3D'
                    else:
                        baseName = 'point3D'
                    
                elif 'planeSegment' in a.baseSort().characteristic.type:
                    if self.parametric:
                        baseName = 'planeSegP3D'
                    else:
                        baseName = 'planeSeg3D'
                
                elif 'circle' in a.baseSort().characteristic.type:
                    if self.parametric:
                        baseName = 'circleP3D'
                    else:
                        baseName = 'circle3D'
                    
                elif 'ellipse' in a.baseSort().characteristic.type:
                    if self.parametric:
                        baseName = 'ellipseP3D'
                    else:
                        baseName = 'ellipse3D'
                    
                elif ('circular' in a.baseSort().characteristic.type or 'elliptical' in a.baseSort().characteristic.type) and self.parametric:
                    #ghenv.Component.AddRuntimeMessage(w, 'Parametric circular and elliptical arcs are not supported')
                    self.exclusion[a.name] = None
                    
                elif 'bezier' in a.baseSort().characteristic.type:
                    if self.parametric:
                        baseName = 'bezierP3D'
                    else:
                        baseName = 'bezier3D'
                
                if baseName != None:
                    baseSort = sort.register[baseName]
                    sortName = baseName
                    if a.type == 'sort-attribute':
                        attributes = a.weight
                        sortName += '_' + attributes.name
    
                    if sortName not in sort.register:
                        if a.type == 'sort-attribute':
                            newSort = attributeSort(sortName, baseSort, attributes)
                        else:
                            newSort = primitiveSort(sortName, baseSort)
                    else:
                        newSort = sort.register[sortName]
    
                    self.newSorts[a.name] = newSort
                    componentsList.append(newSort)
                else:
                    self.newSorts[a.name] = baseName
            else:
                componentsList.append(a.baseSort())
        
        # Reinsertion of circular/elliptical arc individuals from Parametric to Non-parametric
        if len(self.reinsertion) > 0 and self.parametric == False:
            for sortName in self.reinsertion:
                componentsList.append(sort.register[sortName])
                
        if disjunctiveSort.sameComponent(componentsList) is False:
            sc.sticky['sort_count'] += 1

            if self.parametric:
                name = 'rhino_shapes_P_'+str(sc.sticky['sort_count'])
            else:
                name = 'rhino_shapes_'+str(sc.sticky['sort_count'])
            
            newDisjSort = disjunctiveSort(name, componentsList)
            
        else:
            newDisjSort = disjunctiveSort.sameComponent(componentsList)

        return newDisjSort
        
    def makeForm(self):
        newForms = []
        check = True

        for objName in self.objects:
            if objName != 'descriptions' and self.newSorts[objName] != None:
                newForm = self.newSorts[objName].newForm()
               
                for obj in self.objects[objName]:
                    if 'form' not in obj.type:
                        newForm.insert(obj)
                    else:
                        newForms.append(obj)
                        check = False
                
                if check:
                    newForms.append(newForm)
            
        finalObj = self.disjSort.newForm()

        for newForm in newForms:
            if len(newForm.elements) > 0:
                finalObj.insert(newForm)
        
        # Adds in descriptions
        if len(self.objects['descriptions']) > 0:
            for i in self.objects['descriptions']:
                finalObj.insert(i)
                
        # Adds in circular/elliptical arcs if conversion is from parametric to non-parametric
        if self.parametric == False:
            for formObj in self.reinsertion:
                if self.reinsertion[formObj] != None:
                    finalObj.insert(self.reinsertion[formObj])

        return finalObj
        
    def fMetaform(self, elements, sortName):
        for a in sort.register[sortName].component:
            if a.name not in self.objects and 'description' not in sort.register[a.name].baseSort().characteristic.type:
                self.objects[a.name] = []
             
        for individual in elements:
            if individual.type == 'form-metaForm' and len(individual.elements) > 0:
                self.fMetaform(individual.elements, individual.sort.name)
                
            # Converts points/ellipses/circles
            elif individual.type == 'form-discrete' and len(individual.elements) > 0:
                self.fDiscrete(individual.elements, individual.sort.name)
                        
            # Converts lines
            # Excludes elliptical/circular arcs
            elif (individual.type == 'form-interval' or individual.type == 'form-curve') and len(individual.elements) > 0:
                self.fGeneral(individual.elements, individual.sort.name)   # Extracts data from line segments; parses them into agnostic object data
            
            elif individual.type == 'form-cyclical' and self.parametric:
                self.exclusion[individual.sort.name] = individual
                
            # Converts plane segments
            elif individual.type == 'form-coForm' or individual.type == 'form-areal' and len(individual.elements) > 0:
                self.fAreal(individual.elements, individual.sort.name)     # Extracts data from plane segments; parses them into agnostic object data
            
            else:
                self.objects[individual.sort.name] = []
        return
        
    def fGeneral(self, individuals, sortName):
        baseSort = sort.register[sortName].baseSort().characteristic.type

        if 'line' in baseSort:
            self.objects[sortName] =  self.Line(sortName, individuals)
        else:
            conversion = self.Bezier
                
            for indiv in individuals:                    
                if self.newSorts[sortName] != None:
                    self.objects[sortName].append(conversion(sortName, indiv))
            
        return
    
    # Handles form-discrete: Descriptions and/or Points
    def fDiscrete(self, individuals, sortName):
        if len(individuals) > 0:
            for indiv in individuals:
                # For descriptions
                if indiv.type == 'ind-description':
                    # Appends description individual to corresponding dictionary item inside self.objects['descriptions']
                    self.objects['descriptions'].append(indiv)

                # Extracts data from points
                else:
                    if 'point' in indiv.type:
                        convert = self.Point
                    elif 'circle' in indiv.type:
                        convert = self.Circle
                    elif 'ellipse' in indiv.type:
                        convert = self.Ellipse
                        
                    if type (indiv) == type(self.form.elements):
                        for ind in indiv:
                            self.objects[sortName].append(convert(sortName, ind))
                    else:
                         self.objects[sortName].append(convert(sortName, indiv))
        
        return
        
    def fAreal(self, individuals, sortName):
        if len(individuals) > 0:
            for indiv in individuals:
                for planeSegment in indiv.elements:
                    obj = self.Plane(sortName, planeSegment)
                    self.objects[sortName].append(obj)
        else:
            self.objects[sortName] = []
        
        return
    
    def makeAttribute(self, baseSort, attribSorts, attribute = None):
        attName = ''
        att = {}

        if attribute != None:
            if attribute.type == 'form-discrete' or attribute.type == 'form-ordinal' or attribute.type == 'form-special':
                for ind in attribute.elements:
                    if ind.sort.name not in att:
                        att[ind.sort.name] = []
                        
                    att[ind.sort.name].append(ind)

        return att 
        
    # Extracts data from line segments, returns agnostic tuple ((coordinates), {attributes dictionary}) of line segment data
    def Line(self, sortName, line_set):
        v1, v2 = 0, 0
        lines = []
        baseSort = self.newSorts[sortName]
        
        #rebuild the sort from geometric base
        # then add in necessary attributes
        # then plug in information from the old individual to make a new individual
        
        # Extracts attributes and coordinates
        for indiv in line_set:
            v1 = vector3D(float(indiv.start.x.value), float(indiv.start.y.value), float(indiv.start.z.value),)
            v2 = vector3D(float(indiv.end.x.value), float(indiv.end.y.value), float(indiv.end.z.value),)

            # Extracts attributes from line segments inside line_set if there are attributes inside
            # Re-enters them into newly built parametric attribute sort and parametric sort
            
            att = {}

            if indiv.hasAttribute():
                if indiv.attribute.sort.type == 'sort-primitive':
                    att = self.makeAttribute(baseSort, indiv.attribute.sort, indiv.attribute)
                else:
                    att = self.makeAttribute(baseSort, indiv.attribute.sort.component, indiv.attribute)

            newIndiv = baseSort.baseSort().characteristic(baseSort, v1, v2)

            for i in att:
                if type(att[i]) == type([]):
                    for a in att[i]:
                        newIndiv.addAttribute(a)
                else:
                    newIndiv.addAttribute(att[i])

            if indiv.key != None:
                key.createKey(indiv.key.name, newIndiv)

            lines.append(newIndiv)
        
        return lines
        
    # Extracts data from points, returns agnostic tuple ((coordinates), {attributes dictionary}) of point data
    def Point(self, sortName, pointSource):
        pt = (float(pointSource.value.x.value), float(pointSource.value.y.value), float(pointSource.value.z.value))
        att = {}
        baseSort = self.newSorts[sortName]
        
        # Handles point if it has attributes
        if pointSource.hasAttribute():
            if pointSource.attribute.sort.type == 'sort-primitive':
                att = self.makeAttribute(baseSort, pointSource.attribute.sort, pointSource.attribute)
            else:
                att = self.makeAttribute(baseSort, pointSource.attribute.sort.component, pointSource.attribute)

        pt = baseSort.baseSort().characteristic(baseSort, pt[0], pt[1], pt[2])
        
        for i in att:
            for a in att[i]:
                pt.addAttribute(a)

        if pointSource.key != None:
            key.createKey(pointSource.key.name, pt)
                
        return pt
        
    # Extracts data from points, returns agnostic tuple ((coordinates), {attributes dictionary}) of point data
    def Plane(self, sortName, planeSource):
        att = {}
        coords = {}
        outerBounds = []
        innerBounds = []
        baseSort = self.newSorts[sortName]
        
        for count, bound in enumerate(planeSource.boundaries):
            if count == 0:
                for vector in bound.polygonal:
                    outerBounds.append(vector3D(vector.x, vector.y, vector.z))
            else: 
                innerBound = ()
                for vector in bound.polygonal:
                    innerBound = innerBound + (vector3D(vector.x, vector.y, vector.z),)
                innerBound.append(innerBound[0])
                innerBounds.append(innerBound)
        
        # Handles point if it has attributes
        if planeSource.hasAttribute():
            if planeSource.attribute.sort.type == 'sort-primitive':
                att = self.makeAttribute(baseSort, planeSource.attribute.sort, planeSource.attribute)
            else:
                att = self.makeAttribute(baseSort, planeSource.attribute.sort.component, planeSource.attribute)
                    
        pOut = baseSort.baseSort().characteristic(self.newSorts[sortName], outerBounds)
        pIn = []

        if len(innerBounds) > 0:
            for bound in innerBounds:
                pIn.append(baseSort.baseSort().characteristic(self.newSorts[sortName], bound))
                
        # Sets value of individual to pOut for attribute adding
        tempHoldForm = self.newSorts[sortName].newForm()
        tempHoldForm.insert(pOut)
        
        # if len(pIn)>0, this means that there are holes in the plane segment
        if len(pIn) > 0:
            form2 = self.newSorts[sortName].newForm()
            for obj in pIn:    
                form2.insert(obj)
                
            # Subtract form2 planes from form1
            tempHoldForm.difference(form2)

        for planes in tempHoldForm.elements:
            for plane in planes:
                for i in att:
                    for a in att[i]:
                        plane.addAttribute(a)    
        
        if planeSource.key != None:
            key.createKey(planeSource.key.name, tempHoldForm.elements[0].elements[0])

        return tempHoldForm
    
    def Circle(self, sortName, cSource):
        center = cSource.center
        pin_1 = cSource.getPoints()[1]
        pin_2 = cSource.getPoints()[2]
        baseSort = self.newSorts[sortName]
        circle = baseSort.baseSort().characteristic(baseSort, center, pin_1, pin_2)
        
        return circle
        
    def Ellipse(self, sortName, eSource):
        foc1 = eSource.getPoints()[0]
        foc2 = eSource.getPoints()[1]
        pin_pt = eSource.getPoints()[2]
        baseSort = self.newSorts[sortName]
        ellipse = baseSort.baseSort().characteristic(baseSort, foc1, foc2, pin_pt)
        
        return ellipse
        
    def cArc(self, sortName, cArcSource):
        start = cArcSource.start
        end = cArcSource.end
        pin_pt = cArcSource.pin
        baseSort = self.newSorts[sortName]
        arc = baseSort.baseSort().characteristic(baseSort, start, end, pin_pt)
        
        return arc 
        
    def eArc(self, sortName, eArcSource):
        start = eArcSource.start
        end = eArcSource.end
        pin_pt = eArcSource.pin
        if eArcSource.quadPoint != None:
            short_pt = eArcSource.quadPoint 
        else:
            short_pt = None
            
        if short_pt == None:
            arc = baseSort.baseSort().characteristic(baseSort, start, end, pin_pt)
        else:
            arc = baseSort.baseSort().characteristic(baseSort, start, end, pin_pt, short_pt)
            
        return arc
        
    def Bezier(self, sortName, bezierSource):
        start = bezierSource.start
        end = bezierSource.end
        ctrl = bezierSource.controlPoint
        baseSort = self.newSorts[sortName]
        bezier = baseSort.baseSort().characteristic(baseSort, start, ctrl, end)
        
        return bezier
            
# Extracts description text from sortal form
def extract_description(form):
    descriptionList = []
    for subform in form.elements:
        contents = None

        if len(subform.elements) > 0:
            # Determines if form inside metaform is an external description
            if subform.type == 'form-discrete' and subform.elements[0].type == 'ind-description':
                text = ''
                
                # Extracts description data
                # Converts to string form
                for object in subform.elements:
                    if text == '':
                        text = object.getValue()[1:-1]
                    else:
                        text = text + '|' + object.getValue()[1:-1]
                
                contents = ((object.sort.name + ':' + text))
        
        # Appends description string to list for output
        if contents != None:
            descriptionList.append(contents)
            
    return descriptionList

# Checks if shape is parametric
def check_parametric(shape):
    if 'P' in shape.sort.name:
        return True
    return False

# Takes as input tuple 'ruleInstance' with ( <sortal rule instance>, <lhs rhino geometry>, <rhs rhino geometry> )
# Runs successfully and deconstructs rule if rule instance is input
# If not, then issues warning runtime message

try:
    if rule.type == 'rule':
        if '___' in rule.name:
            name = rule.name.split('___')[0]
            id = rule.name.split('___')[1].replace("_","-")
        else:
            name = rule.name
        
        description = rule.description
        info = [id, name, description]
        # Generating rule sides' shape objects
        
        # Checks if LHS is parametric
        if check_parametric(rule.lhs):
            lhsC = convert(rule.lhs, False)
            lhs, exclusion = lhsC.toConverse()
        else:
            lhs = rule.lhs
        
        # Checks if RHS is parametric
        if check_parametric(rule.rhs):
            rhsC = convert(rule.rhs, False)
            rhs, exclusion = rhsC.toConverse() 
        else:
            rhs = rule.rhs
        
        lhsDraw = draw(lhs)
        rhsDraw = draw(rhs)
        lhsGeom = lhsDraw.toGH()
        rhsGeom = rhsDraw.toGH()
        lhsDesc = extract_description(lhs)
        rhsDesc = extract_description(rhs)
        
        lhS = shape(lhs, lhsGeom, lhsDesc)
        rhS = shape(rhs, rhsGeom, rhsDesc)
        
        if check_parametric(rule.lhs):
            predicates = rule.predicateString()[3:]
            directives = rule.directiveString()[3:]
    else:
        ghenv.Component.AddRuntimeMessage(w, 'Component failed to collect rule instance input.')
#"""
except:
    try:
        if rule.type == 'rule':
            ghenv.Component.AddRuntimeMessage(w, 'Input is not a valid rule object')
    except:
        if rule == None:
            pass
        else:
            ghenv.Component.AddRuntimeMessage(w, 'Input is not a rule object')
#"""
# ---------- end rule_info ----------

tag = TextTag3D(Location=dshape_2.G, Text="sleeping", Size=Slider(0.3, range=0..1), Colour="blue", Justification=7)

tag_2 = TextTag3D(Location=dshape.G, Text="sleeping", Size=Slider(0.3, range=0..1), Colour="blue", Justification=7)

tag_3 = TextTag3D(Location=pt_3, Text="courtyard", Size=Slider(0.3, range=0..1), Colour="blue", Justification=7)

tag_4 = TextTag3D(Location=pt_5, Text="sleeping", Size=Slider(0.3, range=0..1), Colour="blue", Justification=7)

tag_5 = TextTag3D(Location=pt, Text="living", Size=Slider(0.3, range=0..1), Colour="blue", Justification=7)

tag_6 = TextTag3D(Location=pt_2, Text="farmland", Size=Slider(0.3, range=0..1), Colour="blue", Justification=7)
