# Grasshopper definition Form development.gh (Grasshopper 1.0.7)
# plug-ins: Karamba, Weaverbird

# ---- group: Common Variables
Z = UnitZ(Factor="-1.2")
cross_section = CrossSectionKaramba3D(FamilyNameOfCrossSection="DefaultCroSec", Height_cm=Slider(30, range=0..60), mode="Shell - Const")
loads = LoadsKaramba3D(Vector=Z, LCase=0, mode="Gravity")
matprops = MaterialPropertiesKaramba3D(
    FamilyOfMaterial="Steel",
    Name="S235",
    YoungsModulus_kN_cm2="15",
    InPlaneShearModulus_kN_cm2="6",
    TransverseShearModulus_kN_cm2=8076,
    SpecificWeight_kN_m3="15",
    CoefficientOfThermalExpansion_1_C=1e-05,
    YieldStrength_kN_cm2="0.13",
    mode="Isotrop")

# ---- group: Mesh resolution
number_slider = Slider(0.66, range=0..2)
number_slider_2 = Slider(0.1, range=0..1)

# ---- group: Step 1
mesh = Mesh(<mesh referenced from the Rhino model>)
srf = Surface([<surface referenced from the Rhino model> x12])
edges = BrepEdges(Brep=srf)  # -> Naked, Interior, NonManifold
wbweave = WeaverbirdsMeshFromLinesWeaveBack(Lines=edges.Naked, MaximumValence=4)
wbsplitquads = WeaverbirdsConstantQuadsSplitSubdivision(MeshCurves=wbweave, Level=3, SmoothNakedEdges=0)
mjoin = MeshJoin(Meshes=flatten([mesh, wbsplitquads]))

# ---- group: Step 5
srf_2 = Surface([<surface referenced from the Rhino model> x12])
mesh_2 = Mesh(<mesh referenced from the Rhino model>)
edges_2 = BrepEdges(Brep=srf_2)  # -> Naked, Interior, NonManifold
wbweave_2 = WeaverbirdsMeshFromLinesWeaveBack(Lines=edges_2.Naked, MaximumValence=4)
wbsplitquads_2 = WeaverbirdsConstantQuadsSplitSubdivision(MeshCurves=wbweave_2, Level=3, SmoothNakedEdges=0)
mjoin_2 = MeshJoin(Meshes=flatten([mesh_2, wbsplitquads_2]))

# ---- group: Step 3
srf_3 = Surface([<surface referenced from the Rhino model> x16])
join = BrepJoin(Breps=srf_3)  # -> Breps, Closed
mesh_breps = MeshBrepsKaramba3D(
    Brep=join.Breps,
    MeshResolution=number_slider_2,
    EdgeRefinementFactor=number_slider,
    PointReduction=False,
    SmoothingStepSize=0,
    SmoothingIterations=5)  # -> Mesh, Info

# ---- group: Step 8
srf_4 = Surface([<surface referenced from the Rhino model> x18])
srf_5 = Surface([<surface referenced from the Rhino model> x22])
srf_6 = Surface([<surface referenced from the Rhino model> x26])
srf_7 = Surface([<surface referenced from the Rhino model> x26])
join_2 = BrepJoin(Breps=srf_7)  # -> Breps, Closed
mesh_breps_2 = MeshBrepsKaramba3D(
    Brep=join_2.Breps,
    MeshResolution=number_slider_2,
    EdgeRefinementFactor=number_slider,
    PointReduction=False,
    SmoothingStepSize=0,
    SmoothingIterations=5)  # -> Mesh, Info

# ---- group: Step 4
srf_8 = Surface([<surface referenced from the Rhino model> x16])
join_3 = BrepJoin(Breps=srf_8)  # -> Breps, Closed
mesh_breps_3 = MeshBrepsKaramba3D(
    Brep=join_3.Breps,
    MeshResolution=number_slider_2,
    EdgeRefinementFactor=number_slider,
    PointReduction=False,
    SmoothingStepSize=0,
    SmoothingIterations=5)  # -> Mesh, Info

# ---- group: Step 7
srf_9 = Surface([<surface referenced from the Rhino model> x18])
join_4 = BrepJoin(Breps=srf_9)  # -> Breps, Closed
mesh_breps_4 = MeshBrepsKaramba3D(
    Brep=join_4.Breps,
    MeshResolution=number_slider_2,
    EdgeRefinementFactor=number_slider,
    PointReduction=False,
    SmoothingStepSize=0,
    SmoothingIterations=5)  # -> Mesh, Info

# ---- group: Step 6
srf_10 = Surface([<surface referenced from the Rhino model> x16])
join_5 = BrepJoin(Breps=srf_10)  # -> Breps, Closed
mesh_breps_5 = MeshBrepsKaramba3D(
    Brep=join_5.Breps,
    MeshResolution=number_slider_2,
    EdgeRefinementFactor=number_slider,
    PointReduction=False,
    SmoothingStepSize=0,
    SmoothingIterations=5)  # -> Mesh, Info

# ---- group: Step 2
mesh_3 = Mesh(<mesh referenced from the Rhino model>)

# ----
cluster = Cluster(mesh=mesh_breps.Mesh, load=loads, crosec=cross_section, material=matprops)  # -> model, disp; disabled
cluster_2 = Cluster(mesh=mesh_breps_3.Mesh, load=loads, crosec=cross_section, material=matprops)  # -> model, disp
cluster_3 = Cluster(mesh=mesh_3, load=loads, crosec=cross_section, material=matprops)  # -> model, disp
modelview = ModelViewKaramba3D(Model=cluster_3.model, LoadCaseFactorsForLinearSuperposition=1, IndexOfVisibleLoadcase=-1)  # -> Model, DeformedMesh, DeformedAxes, DeformedModel
modelview_2 = ModelViewKaramba3D(Model=cluster.model, LoadCaseFactorsForLinearSuperposition=1, IndexOfVisibleLoadcase=-1)  # -> Model, DeformedMesh, DeformedAxes, DeformedModel; disabled
panel = Panel(cluster_3.disp)
modelview_3 = ModelViewKaramba3D(Model=cluster_2.model, LoadCaseFactorsForLinearSuperposition=1, IndexOfVisibleLoadcase=-1)  # -> Model, DeformedMesh, DeformedAxes, DeformedModel
panel_2 = Panel(cluster_2.disp)
panel_3 = Panel(cluster.disp)  # disabled
shellview = ShellViewKaramba3D(Model=modelview.Model, IndexOfLayer=0)  # -> Model, MeshesOfRenderedShells, LegendColors, LegendTags
shellview_2 = ShellViewKaramba3D(Model=modelview_2.Model, IndexOfLayer=0)  # -> Model, MeshesOfRenderedShells, LegendColors, LegendTags; disabled
shellview_3 = ShellViewKaramba3D(Model=modelview_3.Model, IndexOfLayer=0)  # -> Model, MeshesOfRenderedShells, LegendColors, LegendTags
for_others = Legend(Colour=shellview.LegendColors, Tags=shellview.LegendTags, LegendType=101)
for_others_2 = Legend(Colour=shellview_2.LegendColors, Tags=shellview_2.LegendTags, LegendType=101)  # disabled
for_others_3 = Legend(Colour=shellview_3.LegendColors, Tags=shellview_3.LegendTags, LegendType=101)  # disabled
unit_convert = UnitConvert(L=shellview.LegendTags)
unit_convert_2 = UnitConvert(L=shellview_3.LegendTags)  # disabled
unit_convert_3 = UnitConvert(L=shellview_2.LegendTags)  # disabled

# ---- group: For stresses only
for_stresses = Legend(Colour=shellview.LegendColors, Tags=unit_convert, LegendType=101)

for_stresses_2 = Legend(Colour=shellview_2.LegendColors, Tags=unit_convert_3, LegendType=101)  # disabled

for_stresses_3 = Legend(Colour=shellview_3.LegendColors, Tags=unit_convert_2, LegendType=101)  # disabled

# ---- group: After applying forming rules
cluster_4 = Cluster(mesh=mesh_breps_4.Mesh, load=loads, crosec=cross_section, material=matprops)  # -> model, disp; disabled
cluster_5 = Cluster(mesh=mjoin_2, load=loads, crosec=cross_section, material=matprops)  # -> model, disp; disabled
cluster_6 = Cluster(mesh=mesh_breps_5.Mesh, load=loads, crosec=cross_section, material=matprops)  # -> model, disp; disabled
cluster_7 = Cluster(mesh=mesh_breps_2.Mesh, load=loads, crosec=cross_section, material=matprops)  # -> model, disp; disabled
modelview_4 = ModelViewKaramba3D(Model=cluster_4.model, LoadCaseFactorsForLinearSuperposition=1, IndexOfVisibleLoadcase=-1)  # -> Model, DeformedMesh, DeformedAxes, DeformedModel; disabled
modelview_5 = ModelViewKaramba3D(Model=cluster_5.model, LoadCaseFactorsForLinearSuperposition=1, IndexOfVisibleLoadcase=-1)  # -> Model, DeformedMesh, DeformedAxes, DeformedModel; disabled
modelview_6 = ModelViewKaramba3D(Model=cluster_6.model, LoadCaseFactorsForLinearSuperposition=1, IndexOfVisibleLoadcase=-1)  # -> Model, DeformedMesh, DeformedAxes, DeformedModel; disabled
modelview_7 = ModelViewKaramba3D(Model=cluster_7.model, LoadCaseFactorsForLinearSuperposition=1, IndexOfVisibleLoadcase=-1)  # -> Model, DeformedMesh, DeformedAxes, DeformedModel; disabled
panel_4 = Panel(cluster_5.disp)  # disabled
shellview_4 = ShellViewKaramba3D(Model=modelview_4.Model, IndexOfLayer=0)  # -> Model, MeshesOfRenderedShells, LegendColors, LegendTags; disabled
shellview_5 = ShellViewKaramba3D(Model=modelview_5.Model, IndexOfLayer=0)  # -> Model, MeshesOfRenderedShells, LegendColors, LegendTags; disabled
shellview_6 = ShellViewKaramba3D(Model=modelview_6.Model, IndexOfLayer=0)  # -> Model, MeshesOfRenderedShells, LegendColors, LegendTags; disabled
shellview_7 = ShellViewKaramba3D(Model=modelview_7.Model, IndexOfLayer=0)  # -> Model, MeshesOfRenderedShells, LegendColors, LegendTags; disabled
for_others_4 = Legend(Colour=shellview_4.LegendColors, Tags=shellview_4.LegendTags, LegendType=101)  # disabled
for_others_5 = Legend(Colour=shellview_5.LegendColors, Tags=shellview_5.LegendTags, LegendType=101)  # disabled
for_others_6 = Legend(Colour=shellview_6.LegendColors, Tags=shellview_6.LegendTags, LegendType=101)  # disabled
for_others_7 = Legend(Colour=shellview_7.LegendColors, Tags=shellview_7.LegendTags, LegendType=101)  # disabled
unit_convert_4 = UnitConvert(L=shellview_4.LegendTags)  # disabled
unit_convert_5 = UnitConvert(L=shellview_5.LegendTags)  # disabled
unit_convert_6 = UnitConvert(L=shellview_6.LegendTags)  # disabled
unit_convert_7 = UnitConvert(L=shellview_7.LegendTags)  # disabled
for_stresses_4 = Legend(Colour=shellview_4.LegendColors, Tags=unit_convert_4, LegendType=101)  # disabled
for_stresses_5 = Legend(Colour=shellview_5.LegendColors, Tags=unit_convert_5, LegendType=101)  # disabled
for_stresses_6 = Legend(Colour=shellview_6.LegendColors, Tags=unit_convert_6, LegendType=101)  # disabled
for_stresses_7 = Legend(Colour=shellview_7.LegendColors, Tags=unit_convert_7, LegendType=101)  # disabled

# ----
panel_5 = Panel(cluster_4.model)  # disabled
panel_6 = Panel(cluster_6.model)  # disabled
panel_7 = Panel(cluster_7.model)  # disabled

meshtoshell = MeshToShellKaramba3D(Mesh=mjoin, LimitDistance_m=0.005)  # -> Element, Points, Info

# ---- group: To find support
pdecon = Deconstruct(Point=meshtoshell.Points)  # -> XComponent, YComponent, ZComponent
eval = Evaluate(F="Round(x,3)", x=pdecon.ZComponent)
sort = SortList(Keys=eval)  # -> Keys, ValuesA
item = ListItem(List=sort.Keys, Index=0, Wrap=True)
similar = Similarity(FirstNumber=eval, SecondNumber=item, Threshold=1)  # -> Similarity, AbsoluteDifference
dispatch = Dispatch(List=flatten(meshtoshell.Points), DispatchPattern=similar.Similarity)  # -> ListA, ListB
supp = SupportKaramba3D(PosInd=dispatch.ListA, menu=[buttons(on, on, on, on, on, on)])

# ----
assemble = AssembleModelKaramba3D(Elem=meshtoshell.Element, Support=supp, Load=loads, CrossSection=cross_section, Material=matprops, LimitDistance_m=0.005)  # -> Model, Info, Mass_kg, CenterOfGravity
analyze = AnalyzeKaramba3D(Model=assemble.Model)  # -> CalculatedModel, MaximumDisplacement_cm, ResultingForceOfGravity_kN, ElasticEnergy_kNm

modelview_8 = ModelViewKaramba3D(Model=analyze.CalculatedModel, LoadCaseFactorsForLinearSuperposition=1, IndexOfVisibleLoadcase=-1)  # -> Model, DeformedMesh, DeformedAxes, DeformedModel
panel_8 = Panel(analyze.MaximumDisplacement_cm)
shellview_8 = ShellViewKaramba3D(Model=modelview_8.Model, IndexOfLayer=0)  # -> Model, MeshesOfRenderedShells, LegendColors, LegendTags

# ---- group: Direction of principle stresses
shellvecresults = ResultVectorsOnShellsKaramba3D(AnalyzedModel=shellview_8.Model, LayerPosition=0, mode="PrincStress")  # -> AnalyzedModel, Points, FirstPrincipalStressVector_kN_cm2, SecondPrincipalStressVector_kN_cm2, FirstPrincipalStressValue_kN_cm2, SecondPrincipalStressValue_kN_cm2
multiplication = Multiplication(A=shellvecresults.SecondPrincipalStressVector_kN_cm2, B=Slider(58, range=0..100))
neg = Negative(Value=multiplication)
vdis = VectorDisplay(Anchor=shellvecresults.Points, Vector=neg)

# ---- group: For other variables
for_stresses_8 = Legend(
    Colour=shellview_8.LegendColors,
    Tags=shellview_8.LegendTags,
    Rectangle={Plane=PlaneXY(-22.93891471, -103.2938593, 0), Size=Domain2(u=-0.5333552932..0.5333552932, v=-1.732576511..1.732576511)},
    LegendType=1)

# ----
react = ReactionForcesKaramba3D(AnalyzedModel=shellview_8.Model, LoadCase=0)  # -> AnalyzedModel, ReactionForces_kN, ReactionMoments_kNm, SupportPosition, SumOfReactionForces_kN, SumOfReactionMoments_kNm
neg_2 = Negative(Value=react.ReactionForces_kN)
multiplication_2 = Multiplication(A=neg_2, B=Slider(0.2, range=0..1))
vdis_2 = VectorDisplay(Anchor=react.SupportPosition, Vector=multiplication_2)

unit_convert_8 = UnitConvert(L=shellview_8.LegendTags)
for_stresses_9 = Legend(
    Colour=shellview_8.LegendColors,
    Tags=unit_convert_8,
    Rectangle={Plane=PlaneXY(-22.93891471, -103.2938593, 0), Size=Domain2(u=-0.5333552932..0.5333552932, v=-1.732576511..1.732576511)},
    LegendType=1)

# ==== cluster Cluster
mesh = ClusterInput()
meshtoshell = MeshToShellKaramba3D(Mesh=mesh, LimitDistance_m=0.005)  # -> Element, Points, Info
pdecon = Deconstruct(Point=meshtoshell.Points)  # -> XComponent, YComponent, ZComponent
eval = Evaluate(F="Round(x,3)", x=pdecon.ZComponent)
sort = SortList(Keys=eval)  # -> Keys, ValuesA
item = ListItem(List=sort.Keys, Index=0, Wrap=True)
wbvertices = WeaverbirdsVerticesComponent(Weld=True)
similar = Similarity(FirstNumber=eval, SecondNumber=item, Threshold=0.1)  # -> Similarity, AbsoluteDifference
fsim = FindSimilarMember(Data=flatten(wbvertices))  # -> Hit, Index
dispatch = Dispatch(List=flatten(meshtoshell.Points), DispatchPattern=similar.Similarity)  # -> ListA, ListB
cullpt = CullDuplicates(Points=fsim.Hit, Tolerance=0.1, CullMode=3)  # -> Points, Indices, Valence
Z = UnitZ(Factor=1)
supp = SupportKaramba3D(PosInd=dispatch.ListA, menu=[buttons(on, on, on, on, on, on)])
loads = LoadsKaramba3D(ForceVector=Z, Local=False, PosInd=cullpt.Points, LCase=0, mode="Point")
load = ClusterInput()
crosec = ClusterInput()
material = ClusterInput()
assemble = AssembleModelKaramba3D(
    Elem=meshtoshell.Element,
    Support=supp,
    Load=[loads, load],
    CrossSection=crosec,
    Material=material,
    LimitDistance_m=0.005)  # -> Model, Info, Mass_kg, CenterOfGravity
analyze = AnalyzeKaramba3D(Model=assemble.Model)  # -> CalculatedModel, MaximumDisplacement_cm, ResultingForceOfGravity_kN, ElasticEnergy_kNm
model = ClusterOutput(analyze.CalculatedModel)
disp = ClusterOutput(analyze.MaximumDisplacement_cm)

# ==== cluster UnitConvert
L = ClusterInput()

cull_i = CullIndex(List=L, Indices="0", Wrap=True)

lng = ListLength(List=cull_i)
subtraction = Subtraction(A=lng, B="1")
index = ItemIndex(List=cull_i, Item=subtraction)
cull_i_2 = CullIndex(List=cull_i, Indices=index, Wrap=True)

multiplication = Multiplication(A=cull_i_2, B="10")
ins = InsertItems(List=multiplication, Item="Stress[N/mm2]", Indices="0", Wrap=True)

L_2 = ClusterOutput(ins)
