# Grasshopper definition Room Configutation.gh (Grasshopper 1.0.7)

# ---- group: MAIN INPUTS
number_people = Slider(1, range=0..9)
height = Slider(0.5, range=0..4.2)
modul_length = Slider(0.6, range=0..3)
modul_width = Slider(0.6, range=0..3)
module_height = Slider(0.6, range=0..3)

# ----
python = GhPythonScript(Number_people=number_people)  # -> out; inputs Number_people: Int32
# ---------- python: Python ----------
__author__ = "elisa"
__version__ = "2019.10.14"

import rhinoscriptsyntax as rs
import Rhino.Geometry as rg
import math
from copy import copy


#Define as a List t receive multiple values
number_modules_x = []

#Create a Loop to step through "i"
for i in range(0,Number_people == 1) :
    print (7)

for i in range(0,Number_people == 2) :
    print (7)

for i in range(0,Number_people == 3) :
    print (7)

for i in range(0,Number_people == 4) :
    print (8)

for i in range(0,Number_people == 5) :
    print (9)

for i in range(0,Number_people == 6) :
    print (9)

for i in range(0,Number_people == 7) :
    print (10)

for i in range(0,Number_people == 8) :
    print (10)

for i in range(0,Number_people == 9) :
    print (10)
# ---------- end python ----------
python_2 = GhPythonScript(Number_people=number_people)  # -> out; inputs Number_people: Int32; same code as python
python_3 = GhPythonScript(Number_people=number_people)  # -> out; inputs Number_people: Int32; same code as python
division = Division(A=height, B=module_height)

# ---- group: Grid
site_size_y = Slider(20, range=0..120)
site_size_x = Slider(22, range=0..120)
rectangle = Rectangle(Plane=PlaneXY(0, 0, 0), XSize=site_size_x, YSize=site_size_y, Radius=0)  # -> Rectangle, Length
division_2 = Division(A=site_size_x, B=modul_length)
division_3 = Division(A=site_size_y, B=modul_length)
cell_type = ValueList({"Quad": 0, "Tri": 1}, selected="Quad")
panel = Panel(division_2)
panel_2 = Panel(division_3)
srf = Surface(reparameterize(rectangle.Rectangle))
python_4 = PythonScript(srf=srf, numU=panel, numV=panel_2, cellType=cell_type)  # -> out, modules; inputs srf: Surface, numU: Int32, numV: Int32, cellType: Int32
# ---------- python_4: Python ----------
__author__ = "elisa"
__version__ = "2019.10.14"


#import Rhinoscript Syntax module
import rhinoscriptsyntax as rs
#import RhinoCommon Syntax module
import Rhino
#import the .Net Common Lang. Runtime *CLR*
import clr
#import the Grasshopper module
clr.AddReference("Grasshopper")
#import the Path and Data Tree sub-modules
from Grasshopper.Kernel.Data import GH_Path
from Grasshopper import DataTree

#Create a data tree -> with the data type defined
myTree = DataTree[Rhino.Geometry.Polyline]()
myTree2 = DataTree[Rhino.Geometry.Point3d]()

#define a Dictionary to store points
a = {}

#Create a Loop to step through *u*
for i in range(0,numU+1):
    
    #Create a Loop to step through *v*
    for j in range (0,numV+1):
        #Create a point on Surface (ref:UV)
        ###USING RHINOCOMMON
        myPoint = Rhino.Geometry.Surface.Evaluate(srf, i/numU, j/numV,0)
        #Add the point to our Dictionary
        a[(i,j)] = myPoint[1]

#Loop through Dictionary to create Polylines

#Create a Loop to step through *U* (i)
for i in range(0,numU):
    #Create a Data Path (for columns)
    myPath = GH_Path(i)
    myPath2 = GH_Path(i)
    
    #Create a Loop to step trough *v* (j)
    for j in range(0,numV):
        #Based on the CellType, create either quad or tri polylines
        if (cellType == 0):
            #Create a Quad starting from that location
            ###USING RHINOCOMMON
            myQuad = Rhino.Geometry.Polyline([a[(i,j)],a[(i+1,j)],a[(i+1,j+1)],a[(i,j+1)],a[(i,j)]])
            #Send Polylines to Data Tree
            myTree.Add(myQuad,myPath)
            myCentroid = Rhino.Geometry.Polyline.CenterPoint(myQuad)
            myTree2.Add(myCentroid,myPath2)
        else:
            #Create two Triangles from the current location
            ###USING RHINOCOMMON
            myTriA = Rhino.Geometry.Polyline([a[(i,j)],a[(i+1,j)],a[(i+1,j+1)],a[(i,j)]])
            #send polylines to Data Tree
            myTree.Add(myTriA,myPath)
            myCentroid = Rhino.Geometry.Polyline.CenterPoint(myTriA)
            myTree2.Add(myCentroid,myPath2)
            
            myTriB = Rhino.Geometry.Polyline([a[(i,j)],a[(i+1,j+1)],a[(i,j+1)],a[(i,j)]])
            #send polylines to Data Tree
            myTree.Add(myTriB,myPath)
            myCentroid = Rhino.Geometry.Polyline.CenterPoint(myTriB)
            myTree2.Add(myCentroid,myPath2)
            
#return the Data Tree (send to the output)
modules = myTree
centroids = myTree2
# ---------- end python_4 ----------
crv = Curve(python_4.modules)
demesh = DeconstructMesh(Mesh=crv)  # -> Vertices, Faces, Colours, Normals

# ----
python_5 = GhPythonScript(Number_people=number_people)  # -> out; inputs Number_people: Int32
# ---------- python_5: Python ----------
__author__ = "elisa"
__version__ = "2019.10.14"

import rhinoscriptsyntax as rs
import Rhino.Geometry as rg
import math
from copy import copy


#Define as a List t receive multiple values
number_modules_x = []

#Create a Loop to step through "i"
for i in range(0,Number_people == 1) :
    print (7)

for i in range(0,Number_people == 2) :
    print (8)

for i in range(0,Number_people == 3) :
    print (16)

for i in range(0,Number_people == 4) :
    print (16)

for i in range(0,Number_people == 5) :
    print (24)

for i in range(0,Number_people == 6) :
    print (24)

for i in range(0,Number_people == 7) :
    print (24)

for i in range(0,Number_people == 8) :
    print (32)

for i in range(0,Number_people == 9) :
    print (32)
# ---------- end python_5 ----------

# ---- group: Bedrooms / Geometry
Y = Slider(0, range=0..9)
X = Slider(0, range=0..9)
pt = ConstructPoint(XCoordinate=X, YCoordinate=Y, ZCoordinate=0)
rectangle_2 = Rectangle(Plane=pt, XSize=modul_length, YSize=modul_width, Radius=0)  # -> Rectangle, Length
boxrec = BoxRectangle(Rectangle=rectangle_2.Rectangle, Height=module_height)

# ----
division_4 = Division(A=height, B=module_height)

# ---- group: Bedrooms
python_6 = GhPythonScript(Number_people=number_people)  # -> out; inputs Number_people: Int32
# ---------- python_6: Python ----------
__author__ = "elisa"
__version__ = "2019.10.14"

import rhinoscriptsyntax as rs
import Rhino.Geometry as rg
import math
from copy import copy


#Define as a List t receive multiple values
number_modules_x = []

#Create a Loop to step through "i"
for i in range(0,Number_people) :
    print(6)
# ---------- end python_6 ----------
Z = UnitZ(Factor=module_height)
X_2 = UnitX(Factor=modul_length)
panel_3 = Panel(python_6)
Y_2 = UnitY(Factor=modul_width)
panel_4 = Panel(division_4)
panel_5 = Panel(python_5)
eval = Evaluate(F="ceiling(x)", x=panel_3)
eval_2 = Evaluate(F="ceiling(x)", x=panel_4)
eval_3 = Evaluate(F="ceiling(x)", x=panel_5)
arrlinear = LinearArray(Geometry=boxrec, Direction=X_2, Count=eval_3)  # -> Geometry, Transform
arrlinear_2 = LinearArray(Geometry=arrlinear.Geometry, Direction=Y_2, Count=eval)  # -> flatten(Geometry), Transform
rectangle_3 = Rectangle(Plane=PlaneXY(0, 0, 0), XSize=panel_5, YSize=panel_3, Radius=0)  # -> Rectangle, Length
arrlinear_3 = LinearArray(Geometry=arrlinear_2.Geometry, Direction=Z, Count=eval_2)  # -> flatten(Geometry), Transform
boundary = BoundarySurfaces(Edges=rectangle_3.Rectangle)
area = Area(Geometry=boundary)  # -> Area, Centroid
geo = Geometry(arrlinear_3.Geometry)
panel_6 = Panel(area.Area)

# ----
division_5 = Division(A=height, B=module_height)
division_6 = Division(A=height, B=module_height)
eval_4 = Evaluate(F=panel_3, x=rectangle_3.Rectangle)
pt_2 = ConstructPoint(XCoordinate=0, YCoordinate=eval_4, ZCoordinate=0)

# ---- group: Living / Geometry of Module
rectangle_4 = Rectangle(Plane=pt_2, XSize=modul_length, YSize=modul_width, Radius=0)  # -> Rectangle, Length
boxrec_2 = BoxRectangle(Rectangle=rectangle_4.Rectangle, Height=module_height)

# ---- group: Living
python_7 = GhPythonScript(Number_people=number_people)  # -> out; inputs Number_people: Int32; same code as python_6
panel_7 = Panel(division_5)
panel_8 = Panel(python_7)
panel_9 = Panel(python)
X_3 = UnitX(Factor=modul_length)
Y_3 = UnitY(Factor=modul_width)
Z_2 = UnitZ(Factor=module_height)
eval_5 = Evaluate(F="ceiling(x)", x=panel_9)
eval_6 = Evaluate(F="ceiling(x)", x=panel_8)
eval_7 = Evaluate(F="ceiling(x)", x=panel_7)
rectangle_5 = Rectangle(Plane=PlaneXY(0, 0, 0), XSize=panel_9, YSize=panel_8, Radius=0)  # -> Rectangle, Length
arrlinear_4 = LinearArray(Geometry=boxrec_2, Direction=X_3, Count=eval_5)  # -> Geometry, Transform
arrlinear_5 = LinearArray(Geometry=arrlinear_4.Geometry, Direction=Y_3, Count=eval_6)  # -> flatten(Geometry), Transform
boundary_2 = BoundarySurfaces(Edges=rectangle_5.Rectangle)
arrlinear_6 = LinearArray(Geometry=arrlinear_5.Geometry, Direction=Z_2, Count=eval_7)  # -> flatten(Geometry), Transform
area_2 = Area(Geometry=boundary_2)  # -> Area, Centroid
panel_10 = Panel(area_2.Area)
geo_2 = Geometry(arrlinear_6.Geometry)

# ----
addition = Addition(A=panel_8, B=panel_3)
eval_8 = Evaluate(F=addition, x=area_2.Area)
pt_3 = ConstructPoint(XCoordinate=0, YCoordinate=eval_8, ZCoordinate=0)

# ---- group: Courtyard / Geometry of Module
rectangle_6 = Rectangle(Plane=pt_3, XSize=modul_length, YSize=modul_width, Radius=0)  # -> Rectangle, Length
boxrec_3 = BoxRectangle(Rectangle=rectangle_6.Rectangle, Height=module_height)

# ---- group: Courtyard
python_8 = GhPythonScript(Number_people=number_people)  # -> out; inputs Number_people: Int32
# ---------- python_8: Python ----------
__author__ = "elisa"
__version__ = "2019.10.14"

import rhinoscriptsyntax as rs
import Rhino.Geometry as rg
import math
from copy import copy


#Define as a List t receive multiple values
number_modules_x = []

#Create a Loop to step through "i"
for i in range(0,Number_people) :
    print(2)
# ---------- end python_8 ----------
panel_11 = Panel(python_8)
panel_12 = Panel(division)
panel_13 = Panel(python_2)
X_4 = UnitX(Factor=modul_length)
Y_4 = UnitY(Factor=modul_width)
Z_3 = UnitZ(Factor=module_height)
rectangle_7 = Rectangle(Plane=PlaneXY(0, 0, 0), XSize=panel_13, YSize=panel_11, Radius=0)  # -> Rectangle, Length
eval_9 = Evaluate(F="ceiling(x)", x=panel_13)
eval_10 = Evaluate(F="ceiling(x)", x=panel_11)
eval_11 = Evaluate(F="ceiling(x)", x=panel_12)
arrlinear_7 = LinearArray(Geometry=boxrec_3, Direction=X_4, Count=eval_9)  # -> Geometry, Transform
arrlinear_8 = LinearArray(Geometry=arrlinear_7.Geometry, Direction=Y_4, Count=eval_10)  # -> flatten(Geometry), Transform
boundary_3 = BoundarySurfaces(Edges=rectangle_7.Rectangle)
arrlinear_9 = LinearArray(Geometry=arrlinear_8.Geometry, Direction=Z_3, Count=eval_11)  # -> flatten(Geometry), Transform
area_3 = Area(Geometry=boundary_3)  # -> Area, Centroid
panel_14 = Panel(area_3.Area)
geo_3 = Geometry(arrlinear_9.Geometry)

# ----
addition_2 = Addition(A=panel_8, B=panel_3, C=panel_11)
eval_12 = Evaluate(F=addition_2, x=rectangle_7.Rectangle)
pt_4 = ConstructPoint(XCoordinate=0, YCoordinate=eval_12, ZCoordinate=0)

# ---- group: Farmland / Geometry of Module
rectangle_8 = Rectangle(Plane=pt_4, XSize=modul_length, YSize=modul_width, Radius=0)  # -> Rectangle, Length
boxrec_4 = BoxRectangle(Rectangle=rectangle_8.Rectangle, Height=module_height)

# ---- group: Farmland
python_9 = GhPythonScript(Number_people=number_people)  # -> out; inputs Number_people: Int32
# ---------- python_9: Python ----------
__author__ = "elisa"
__version__ = "2019.10.14"

import rhinoscriptsyntax as rs
import Rhino.Geometry as rg
import math
from copy import copy


#Define as a List t receive multiple values
number_modules_x = []

#Create a Loop to step through "i"
for i in range(0,Number_people) :
    print(3)
# ---------- end python_9 ----------
panel_15 = Panel(python_9)
panel_16 = Panel(division_6)
panel_17 = Panel(python_3)
X_5 = UnitX(Factor=modul_length)
Y_5 = UnitY(Factor=modul_width)
Z_4 = UnitZ(Factor=module_height)
rectangle_9 = Rectangle(Plane=PlaneXY(0, 0, 0), XSize=panel_17, YSize=panel_15, Radius=0)  # -> Rectangle, Length
eval_13 = Evaluate(F="ceiling(x)", x=panel_17)
eval_14 = Evaluate(F="ceiling(x)", x=panel_15)
eval_15 = Evaluate(F="ceiling(x)", x=panel_16)
arrlinear_10 = LinearArray(Geometry=boxrec_4, Direction=X_5, Count=eval_13)  # -> Geometry, Transform
arrlinear_11 = LinearArray(Geometry=arrlinear_10.Geometry, Direction=Y_5, Count=eval_14)  # -> flatten(Geometry), Transform
boundary_4 = BoundarySurfaces(Edges=rectangle_9.Rectangle)
arrlinear_12 = LinearArray(Geometry=arrlinear_11.Geometry, Direction=Z_4, Count=eval_15)  # -> flatten(Geometry), Transform
area_4 = Area(Geometry=boundary_4)  # -> Area, Centroid
panel_18 = Panel(area_4.Area)
geo_4 = Geometry(arrlinear_12.Geometry)

# ---- group: Sleepig Name
tag = TextTag3D(Location=boxrec, Text="Sleeping", Size=Slider(0.565, range=0..1), Justification=7)

tag_2 = TextTag3D(Location=boxrec_3, Text="Cortyard", Size=Slider(0.565, range=0..1), Justification=7)

tag_3 = TextTag3D(Location=boxrec_2, Text="Living", Size=Slider(0.565, range=0..1), Justification=7)

tag_4 = TextTag3D(Location=boxrec_4, Text="Farm", Size=Slider(0.565, range=0..1), Justification=7)
