# Grasshopper definition URBAN CONFIGURATION - 11.3.2019.gh (Grasshopper 1.0.7)
# plug-ins: Anemone, Human

enough_number_to_finish = Slider(2000, range=0..2000)
number_slider = Slider(-100, range=-100..60)
toggle = BooleanToggle(False)
limit_of_try_to_place_a_rectangle = Panel("20")
# Parts of the script were used from other authors in the food for rhino  blog webpage. Some parts stated in the script were modified and added so that it would perform accordingly to our set of rules.
list = ValueList({"Random color": 0, "Color by surface": 1}, selected="Color by surface")
widths = GenePool(Decimals=0, Maximum=12, Minimum=1, Value=[12, 7.6, 9.8, 6, 1])
heights = GenePool(Decimals=0, Maximum=8, Minimum=1, Value=[8, 8, 5.666666667, 4, 1])
number_slider_2 = Slider(-50, range=-50..30)

# ---- group: New script by Group 5 / OFFSET SCRIPT
xy = XYPlane(Origin=Point(0, 0, 0))
crv = Curve(<curve referenced from the Rhino model>)
python = PythonScript(crv=crv, dist=Slider(-1, range=-10..10), it=Slider(8, range=0..8), P=xy)  # -> out, a, lastCrv; inputs crv: Curve, it: Int32
# ---------- python: Python ----------
from Rhino.Geometry import Curve as c
from Rhino.Geometry import CurveOffsetCornerStyle as ce
from Rhino.Geometry import CurveSimplifyOptions as cs

a = [] # main roads
lastCrv = crv

# OFFSET RULE FOR MAIN ROADS
for i in range(it):
    
    oCrv = crv.Offset(P,dist*(i+1),0.01,ce.Sharp)[0]
    oCrv.Simplify(cs.All,0.01,0.1)
    a.append(oCrv)
    
    if i == it-1:
        lastCrv = oCrv
# ---------- end python ----------
cp = ControlPoints(Curve=python.a)  # -> Points, Weights, Knots

# ----
multiplication = Multiplication(A=number_slider, B=number_slider_2)

# ---- group: Numbers of shapes
genes = GenePool(Decimals=0, Maximum=20, Minimum=0, Value=[12, 2, 10, 13, 20])

# ----
surface_of_rectangle = Panel(multiplication)
dup = DuplicateData(Data=graft(widths), Number=graft(genes), Order=True)  # -> flatten(Data)
dup_2 = DuplicateData(Data=graft(heights), Number=graft(genes), Order=True)  # -> flatten(Data)
multiplication_2 = Multiplication(A=dup, B=dup_2)
ma = MassAddition(Input=multiplication_2)  # -> Result, PartialResults
surface_of_shapes = Panel(ma.Result)
int = Integer(0)
loop_start = LoopStart(Repeat=enough_number_to_finish, Trigger=toggle)  # -> port, Counter, Data
int_2 = Integer(limit_of_try_to_place_a_rectangle)

# ---- group: Just not to add null !!!
pt = Point(Point(-19, -21, 0))

# ----
Z = UnitZ(Factor=1)

# ---- group: New script by Group 5
panel = Panel("SECONDARY STREET +X")
panel_2 = Panel("SECONDARY STREET -X")
panel_3 = Panel("MAIN STREET")
panel_4 = Panel("STREET OFFSET RULES")
crv_2 = Curve(<curve referenced from the Rhino model>)
crv_3 = Curve(<curve referenced from the Rhino model>)
ref = Point(<point referenced from the Rhino model>)
panel_5 = Panel("FIND THE LENGTHS")
grid_size = Slider(1, range=-1..1)
grid_size_2 = Slider(-1, range=-1..1)

# ---- group: New script by Group 5 / OFFSET SCRIPT
xy_2 = XYPlane(Origin=Point(0, 0, 0))
python_2 = PythonScript(crv=crv_2, dist=Slider(-1, range=-10..10), it=Slider(6, range=0..6), P=xy_2)  # -> out, a, lastCrv; inputs crv: Curve, it: Int32; same code as python

xy_3 = XYPlane(Origin=Point(0, 0, 0))
python_3 = PythonScript(crv=crv_3, dist=Slider(1, range=-10..10), it=Slider(6, range=0..6), P=xy_3)  # -> out, a, lastCrv; inputs crv: Curve, it: Int32; same code as python

# ---- group: New script by Group 5 (continued)
crv_4 = Curve(python_2.lastCrv)
crv_5 = Curve(python_3.lastCrv)

# ---- group: New script by Group 5 / OFFSET SCRIPT (continued)
cp_2 = ControlPoints(Curve=crv_4)  # -> Points, Weights, Knots

cp_3 = ControlPoints(Curve=crv_5)  # -> Points, Weights, Knots

# ---- group: New script by Group 5 (continued)
python_4 = GhPythonScript(Candidates=cp_3.Points, RefPnt=ref)  # -> out, CornerPnt; inputs Candidates: list of Point3d, RefPnt: Point3d
# ---------- python_4: Python ----------
__author__ = "yarai"
__version__ = "2019.10.22"

import rhinoscriptsyntax as rs
import Rhino.Geometry as rg

minId = 0
minDist = RefPnt.DistanceTo(Candidates[minId])

for i in range(len(Candidates)):
    pnt = Candidates[i]
    distance = RefPnt.DistanceTo(pnt)
    print(distance)
    if minDist > distance:
        minDist = distance
        minId = i
        print("found it")
        
CornerPnt = Candidates[minId]
# ---------- end python_4 ----------
python_5 = GhPythonScript(Candidates=cp_2.Points, RefPnt=ref)  # -> out, CornerPnt; inputs Candidates: list of Point3d, RefPnt: Point3d; same code as python_4
panel_6 = Panel(cp_3.Points)
pt_2 = Point(python_4.CornerPnt)
pt_3 = Point(python_5.CornerPnt)
panel_7 = Panel(pt_3)
panel_8 = Panel(pt_2)
pdecon = Deconstruct(Point=pt_2)  # -> XComponent, YComponent, ZComponent
pdecon_2 = Deconstruct(Point=pt_3)  # -> XComponent, YComponent, ZComponent
addition = Addition(A=pdecon.XComponent, B=grid_size)
addition_2 = Addition(A=pdecon_2.YComponent, B=grid_size_2)
addition_3 = Addition(A=pdecon_2.XComponent, B=grid_size_2)
_2ndpnt = ConstructPoint(XCoordinate=addition, YCoordinate=pdecon.YComponent, ZCoordinate=0)
_2ndpnt_2 = ConstructPoint(XCoordinate=addition_3, YCoordinate=addition_2, ZCoordinate=0)
panel_9 = Panel(_2ndpnt)
panel_10 = Panel(_2ndpnt_2)

# ---- group: Modified part of script
rec_2pt = Rectangle2Pt(Plane=PlaneXY(0, 0, 0), PointA=panel_7, PointB=panel_10, Radius=0)  # -> Rectangle, Length

# ----
arrrec = RectangularArray(Geometry=rec_2pt.Rectangle, Cell=rec_2pt.Rectangle, XCount=number_slider, YCount=number_slider_2)  # -> Geometry, Transform
area = Area(Geometry=arrrec.Geometry)  # -> Area, Centroid
loop_start_2 = LoopStart(N=enough_number_to_finish, T=toggle, D0=area.Centroid, D1=dup, D2=dup_2, n_try=int)  # -> port, Counter, Data, Data_2, Data_3, N_try
lng = ListLength(List=loop_start_2.Data)
panel_11 = Panel(loop_start_2.Counter)
random = Random(Range=lng, Number=1, Seed=expr("x*3", loop_start_2.Counter), Integers=True)
item = ListItem(List=loop_start_2.Data_3, Index=0, Wrap=True)
item_2 = ListItem(List=loop_start_2.Data_2, Index=0, Wrap=True)
item_3 = ListItem(List=loop_start_2.Data, Index=random, Wrap=True)

# ---- group: Modified part of script
expression = Expression(c=item_3, dx=item_2, dy=item, Expression="c+{(dx-1),(dy-1),0}")
expression_2 = Expression(c=item_3, dx=item_2, dy=item, Expression="c-{1/2,1/2,0}")

# ---- group: To keep the last
lng_2 = ListLength(List=loop_start_2.Data_2)
expression_3 = Expression(x=lng_2, Expression="if(x>1,1,0)")

# ----
rec_2pt_2 = Rectangle2Pt(Plane=PlaneXY(0, 0, 0), PointA=expression_2, PointB=expression, Radius=0)  # -> Rectangle, Length
expression_4 = Expression(x=lng, Expression="if(x=0,true,false)")
boundary = BoundarySurfaces(Edges=rec_2pt_2.Rectangle)
srf_cp = SurfaceClosestPoint(Point=loop_start_2.Data, Surface=boundary)  # -> Point, UVPoint, Distance
expression_5 = Expression(x=srf_cp.Distance, Expression="if(x<0.001,true,false)")
split = SplitList(List=loop_start_2.Data_3, Index=1)  # -> ListA, ListB
split_2 = SplitList(List=loop_start_2.Data_2, Index=1)  # -> ListA, ListB
filter = StreamFilter(Gate=expression_3, Stream0=loop_start_2.Data_2, Stream1=split_2.ListB)
filter_2 = StreamFilter(Gate=expression_3, Stream0=loop_start_2.Data_3, Stream1=split.ListB)
dispatch = Dispatch(List=loop_start_2.Data, DispatchPattern=expression_5)  # -> ListA, ListB
multiplication_3 = Multiplication(A=item_2, B=item)
lng_3 = ListLength(List=dispatch.ListA)
expression_6 = Expression(x=lng_3, y=multiplication_3, Expression="if(x=y,0,1)")
expression_7 = Expression(x=expression_6, y=loop_start_2.N_try, Expression="if(x=1, y+1,0)")
expression_8 = Expression(n_try=expression_7, limit=int_2, x=expression_6, Expression="if(n_try>limit, 1, x)")
expression_9 = Expression(n_try=expression_7, limit=int_2, x=expression_6, Expression="if(n_try>limit,0, n_try)")
expression_10 = Expression(n_try=expression_7, limit=int_2, x=expression_6, Expression="if(n_try>limit, 0, x)")
filter_3 = StreamFilter(Gate=expression_8, Stream0=boundary, Stream1=pt)
filter_4 = StreamFilter(Gate=expression_8, Stream0=dispatch.ListB, Stream1=loop_start_2.Data)
filter_5 = StreamFilter(Gate=expression_10, Stream0=filter, Stream1=loop_start_2.Data_2)
filter_6 = StreamFilter(Gate=expression_10, Stream0=filter_2, Stream1=loop_start_2.Data_3)
loop_end = LoopEnd(
    port=loop_start.port,
    Exit=expression_4,
    Data=flatten(filter_3),
    TimeOutVal=0,
    pausedState=False,
    state="Constant & Record")  # -> flatten(Data)
loop_end_2 = LoopEnd(
    port=loop_start_2.port,
    Exit=expression_4,
    Data=filter_4,
    Data_2=filter_5,
    Data_3=filter_6,
    N_try=expression_9,
    TimeOutVal=0,
    pausedState=False,
    state="Constant output")  # -> D0, D1, D2, n_try
srf = Surface(loop_end)
null = NullItem(Item=srf)  # -> NullFlags, InvalidFlags, Description
dispatch_2 = Dispatch(List=srf, DispatchPattern=null.NullFlags)  # -> ListA, ListB
lng_4 = ListLength(List=dispatch_2.ListB)
range = Range(Domain=Domain(0, 1), Steps=expr("x-1", lng_4))
area_2 = Area(Geometry=dispatch_2.ListB)  # -> expr("sqrt(x)", Area), Centroid
jitter = Jitter(List=dispatch_2.ListB, Jitter=1, Seed=2)  # -> Values, Indices
filter_7 = StreamFilter(Gate=list, Stream0=jitter.Values, Stream1=dispatch_2.ListB)
debrep = DeconstructBrep(Brep=jitter.Values)  # -> Faces, Edges, Vertices
bnd = Bounds(Numbers=area_2.Area)
move = Move(Geometry=debrep.Edges, Motion=Z)  # -> Geometry, Transform
remap = RemapNumbers(Value=area_2.Area, Source=bnd, Target=Domain(0, 1))  # -> Mapped, Clipped
filter_8 = StreamFilter(Gate=list, Stream0=range, Stream1=remap.Mapped)
gradient = Gradient(LowerLimit=0, UpperLimit=1, Parameter=filter_8, stops=[0: RGB(0, 128, 0), 0.5: RGB(255, 255, 0), 1: RGB(255, 0, 0)])
previewlw = CustomPreviewLineweights(Geometry=flatten(move.Geometry), Shader=ColourSwatch(SwatchColor=RGB(0, 0, 0)), Thickness=3, Absolute=False)
preview = CustomPreview(Geometry=filter_7, Shader=gradient)
