# Grasshopper definition laser file_3mm_30 layers.gh (Grasshopper 1.0.7)

nr_of_slides = Panel("20")
thickness = Panel("3")
brep = Brep(<brep referenced from the Rhino model>)
move_to_y_axis = Slider(10, range=0..1000)
bounding_box = BoundingBox(Content=brep, Plane=PlaneXY(0, 0, 0))  # -> Box, Box_2
unit_x = UnitX(Factor=move_to_y_axis)
deconstruct_brep = DeconstructBrep(Brep=bounding_box.Box)  # -> Faces, Edges, Vertices
area = Area(Geometry=deconstruct_brep.Faces)  # -> Area, Centroid
sort = SortList(Keys=area.Area, ValuesA=deconstruct_brep.Faces)  # -> Keys, ValuesA
item = ListItem(List=sort.ValuesA, Index=-1, Wrap=True)
series = Series(Start=0, Step=thickness, Count=nr_of_slides)
Z = UnitZ(Factor=series)
pln = Plane(item)
move = Move(Geometry=pln, Motion=Z)  # -> Geometry, Transform
sec = BrepPlane(Brep=brep, Plane=move.Geometry)  # -> Curves, Points
list_item = ListItem(List=deconstruct_brep.Edges, Index=Slider(13, range=12..20), Wrap=True)
clean = CleanTree(RemoveNulls=True, RemoveInvalid=True, RemoveEmpty=True, Tree=sec.Curves)  # -> simplify(Tree)
move_2 = Move(Geometry=clean, Motion=unit_x)  # -> Geometry, Transform
length = Length(Curve=list_item)
tree_statistics = TreeStatistics(Tree=move_2.Geometry)  # -> Paths, Length, Count
addition = Addition(A=length, B=Slider(10, range=0..10))
series_2 = Series(Start=0, Step=addition, Count=tree_statistics.Count)
unit_y = UnitY(Factor=series_2)
move_3 = Move(Geometry=move_2.Geometry, Motion=graft(unit_y))  # -> simplify(Geometry), Transform
unit_y_2 = UnitY(Factor=expr("-x", addition))
project = Project(Geometry=move_3.Geometry, Plane=PlaneXY(0, 0, 0))  # -> Geometry, Transform
tstat = TreeStatistics(Tree=project.Geometry)  # -> Paths, Length, Count
cull_i = CullIndex(List=tstat.Paths, Indices=0, Wrap=True)
branch = TreeBranch(Tree=project.Geometry, Path=cull_i, MaintainPaths=True)
move_4 = Move(Geometry=branch, Motion=unit_y_2)  # -> simplify(Geometry), Transform
split_list = SplitList(List=move_4.Geometry, Index=1)  # -> ListA, ListB
cull_i_2 = CullIndex(List=tstat.Paths, Indices=-1, Wrap=True)
explode = Explode(Curve=move_4.Geometry, Recursive=True)  # -> Segments, Vertices
branch_2 = TreeBranch(Tree=project.Geometry, Path=cull_i_2, MaintainPaths=True)
curve = Curve(split_list.ListB)
trim_tree = TrimTree(Tree=explode.Segments, Depth=1)
point_on_curve = PointOnCurve(trim_tree, parameter=0.5)
pull_point = PullPoint(Point=point_on_curve, Geometry=branch_2, ClosestOnly=True)  # -> ClosestPoint, Distance
smaller = SmallerThan(FirstNumber=pull_point.Distance, SecondNumber=0.01)  # -> SmallerThan, OrEqualTo
cull = CullPattern(List=trim_tree, CullPattern=invert(smaller.SmallerThan))
cutting_lines = Data(project.Geometry)
engraving_lines = Data(cull)
