# Grasshopper definition bricklaying_dome.gh (Grasshopper 1.0.7)
# plug-ins: Weaverbird, Kangaroo2 Components

# ---- group: INPUTS
number_slider = Slider(0.1, range=0..0.1)
# Hexagon and circle
# Brick dimensions
number_slider_2 = Slider(0.4, range=0..1)
number_slider_3 = Slider(0.2, range=0..1)
curve = Curve(<curve referenced from the Rhino model>)
curve_2 = Curve(<curve referenced from the Rhino model>)

# We create our own relaxed mesh with a polygon that is close to a circle. With different radius comes different segments
number_slider_4 = Slider(48, range=0..100)
pt = Point(Point(-0.001520429868, 0.002630951921, -0.09921002336))
number_slider_5 = Slider(0.05, range=0..0.1)
number_slider_6 = Slider(0.2, range=0..1)
number_slider_7 = Slider(0.1, range=0..1)
polygon = Polygon(Plane=pt, Radius=Slider(4.8, range=0..10), Segments=number_slider_4, FilletRadius=0)  # -> Polygon, Length

# ----
negative = Negative(Value=number_slider_2)

# ----
# Create 2 lofts (as we want both headers and strechters)
offset_curve = OffsetCurve(Curve=curve_2, Distance=expr("0.5*x", negative), Plane=PlaneXY(0, 0, 0), Corners=1)
offset_curve_2 = OffsetCurve(Curve=curve, Distance=expr("0.5*x", negative), Plane=PlaneXY(0, 0, 0), Corners=1)
offset_curve_3 = OffsetCurve(Curve=curve, Distance=negative, Plane=PlaneXY(0, 0, 0), Corners=1)
offset_curve_4 = OffsetCurve(Curve=curve_2, Distance=negative, Plane=PlaneXY(0, 0, 0), Corners=1)
loft = Loft(
    Curves=[offset_curve_3, offset_curve_4],
    Options={Adjust=True, Closed=False, LoftEnds=0, LoftSimp=0, LoftType=0, Rebuild=10, Refit=0.01})
loft_2 = Loft(
    Curves=[offset_curve_2, offset_curve],
    Options={Adjust=True, Closed=False, LoftEnds=0, LoftSimp=0, LoftType=0, Rebuild=10, Refit=0.01})

contour = Contour(Shape=loft, Point=Point(0, 0, 0), Direction=Vector(0, 0, 1), Distance=number_slider)
contour_2 = Contour(Shape=loft_2, Point=Point(0, 0, 0), Direction=Vector(0, 0, 1), Distance=number_slider)
dispatch = Dispatch(List=flatten(contour), DispatchPattern=[True, False])  # -> ListA, ListB
dispatch_2 = Dispatch(List=flatten(contour_2), DispatchPattern=[True, False])  # -> ListA, ListB
panel = Panel("create base points")
length = Length(Curve=dispatch.ListA)
length_2 = Length(Curve=[dispatch.ListB, dispatch_2.ListB])
division = Division(A=length, B=number_slider_3)
division_2 = Division(A=length_2, B=number_slider_2)
negative_2 = Negative(Value=number_slider_2)
negative_3 = Negative(Value=number_slider_3)
divide_curve = DivideCurve(Curve=dispatch.ListA, Count=division, Kinks=False)  # -> Points, Tangents, Parameters
divide_curve_2 = DivideCurve(Curve=[dispatch.ListB, dispatch_2.ListB], Count=division_2, Kinks=False)  # -> Points, Tangents, Parameters

fill_mesh_holes = FillMeshHoles(P=polygon.Polygon)  # -> out, M; inputs P: Curve, clr: list of Color
# ---------- fill_mesh_holes: VB ----------
    Component.Params.Input(0).Name = "Curves"
    Component.Params.Input(0).Description = "A list of open or closed curves"
    Component.Params.Input(1).Name = "Vertex Color "
    Component.Params.Input(1).Description = "A an optional list of colors corresponding to each control point of the input curve, and additional color can be added for the center of the new mesh."

    Component.Params.Output(1).Name = "Mesh"
    Component.Params.Output(1).Description = "If successful, a valid mesh"

    If P IsNot Nothing Then
      Dim ncrv As NurbsCurve
      Dim npts As rhino.Geometry.Collections.NurbsCurvePointList
      Dim pline As polyline

      Dim avgClr,tclr As color
      Dim ov As New list(Of point3d)
      Dim oc As New list(Of Color)
      Dim ofc As New list(Of MeshFace)

      Dim i,j As Integer
      ncrv = P.ToNurbsCurve()
      npts = ncrv.Points
      pline = npts.ControlPolygon

      ov = pline.toarray().ToList()
      If P.IsClosed() Then ov.removeat(ov.count() - 1)
      j = ov.count() - 1
      ov.add(pline.CenterPoint)

      For i = 0 To j Step 1
        If (clr.count()) > 0 Then
          If i > (clr.count() - 1) Then tclr = clr.item(clr.count() - 1) Else tclr = clr.item(i)
          If i = 0 Then avgClr = tclr Else avgClr = colorAverage(avgClr, tclr, 0.5)
          oc.add(tclr)
        End If

        If ((i = j) And (P.IsClosed())) Then
          ofc.add(New meshface(i, 0, j + 1))
        Else
          ofc.add(New meshface(i, i + 1, j + 1))
        End If
      Next

      If (clr.count()) > 0 Then If(j + 1) = (clr.count() - 1) Then oc.add(clr.item(j + 1)) Else oc.add(avgClr)

      Dim msh As New mesh
      msh.Vertices.AddVertices(ov.toarray())
      msh.Faces.AddFaces(ofc.toarray())
      If (clr.count()) > 0 Then msh.VertexColors.AppendColors(oc.toarray())

      M = msh
    End If
# ---------- fill_mesh_holes: VB additional code ----------
  Function colorAverage(ByVal clrA As color, ByVal clrB As color, ByVal t As Double)
    Dim clrOut As color
    Dim R,G,B As Integer

    If CInt(clrA.r * t + clrB.r * (1 - t)) > 255 Then
      R = 255
    ElseIf CInt(clrA.r * t + clrB.r * (1 - t)) < 0 Then
      R = 0
    Else
      R = CInt(clrA.r * t + clrB.r * (1 - t))
    End If

    If CInt(clrA.g * t + clrB.g * (1 - t)) > 255 Then
      G = 255
    ElseIf CInt(clrA.g * t + clrB.g * (1 - t)) < 0 Then
      G = 0
    Else
      G = CInt(clrA.g * t + clrB.g * (1 - t))
    End If

    If CInt(clrA.b * t + clrB.b * (1 - t)) > 255 Then
      B = 255
    ElseIf CInt(clrA.b * t + clrB.b * (1 - t)) < 0 Then
      B = 0
    Else
      B = CInt(clrA.b * t + clrB.b * (1 - t))
    End If

    clrOut = color.fromargb(R, G, B)
    Return clrOut
  End Function
# ---------- end fill_mesh_holes ----------
weaverbird_s_split_triangles_subdivision = WeaverbirdsSplitTrianglesSubdivision(MeshCurves=fill_mesh_holes.M, Level=10)  # -> flatten(OutputMeshCurves)

# ---- group: Input geometery
curve_3 = Curve(<curve referenced from the Rhino model>)

# ----
area = Area(Geometry=polygon.Polygon)  # -> Area, Centroid

weld_mesh = WeldMesh(Mesh=weaverbird_s_split_triangles_subdivision, Angle=3.141592654)

# ---- group: Tesselation-output
mesh = Mesh(weld_mesh)

# ---- group: KANGAROO CALC / Input-Tesselation
mesh_2 = Mesh(mesh)

# ---- group: KANGAROO CALC
mesh_edges = MeshEdges(Mesh=mesh_2)  # -> NakedEdges, InteriorEdges, NonManifoldEdges
edgelengths = EdgeLengths(Mesh=mesh_2, LengthFactor=1, Strength=Slider(220, range=0..1000))
unit_z = UnitZ(Factor=1)
mesh_closest_point = MeshClosestPoint(Point=area.Centroid, Mesh=mesh_2)  # -> Point, Index, Parameter
show = Show(G=mesh_2)
curve_4 = Curve(mesh_edges.NakedEdges)
discontinuity = Discontinuity(Curve=curve_4, Level=1)  # -> flatten(Points), Parameters
cull_duplicates = CullDuplicates(Points=discontinuity.Points, Tolerance=0.1, CullMode=3)  # -> Points, Indices, Valence
mesh_closest_point_2 = MeshClosestPoint(Point=cull_duplicates.Points, Mesh=mesh_2)  # -> Point, Index, Parameter
unit_z_2 = UnitZ(Factor=Slider(-17, range=-20..20))
load = Load(Point=mesh_closest_point.Point, ForceVector=unit_z, Weighting=Slider(1000, range=0..10000))
anchor = Anchor(Point=mesh_closest_point_2.Point, Strength=Slider(3000, range=0..10000))
vertexloads = VertexLoads(Mesh=mesh_2, Strength=unit_z_2)
zombiesolver = ZombieSolver(GoalObjects=[edgelengths, show, vertexloads, anchor, load], Threshold=1e-10, Tolerance=0.01, MaxIterations=50000)  # -> I, V, O
list_item = ListItem(List=zombiesolver.O, Index=0, Wrap=True)

# ----
# Make boxes as headers/stretchers and rotate into place
domain_box = DomainBox(Base=divide_curve_2.Points, X=negative_2, Y=negative_3, Z=number_slider)
domain_box_2 = DomainBox(Base=divide_curve.Points, X=number_slider_3, Y=negative_2, Z=number_slider)
rotate_direction = RotateDirection(Geometry=domain_box, Center=divide_curve_2.Points, From=Vector(1, 0, 0), To=divide_curve_2.Tangents)  # -> Geometry, Transform
rotate_direction_2 = RotateDirection(Geometry=domain_box_2, Center=divide_curve.Points, From=Vector(1, 0, 0), To=divide_curve.Tangents)  # -> Geometry, Transform

# ---- group: OUTPUT
brep = Brep([rotate_direction_2.Geometry, rotate_direction.Geometry])

# ---- group: KANGAROO CALC / Dome mesh-output
mesh_3 = Mesh(list_item)

# ----
# Scale it down so that I'll fit in the inside of the dome
number_slider_8 = Slider(0.9, range=0..1)
scale = Scale(Geometry=mesh_3, Center=Point(0, 0, 0), Factor=number_slider_8)  # -> Geometry, Transform

bounding_box = BoundingBox(Content=scale.Geometry, Plane=PlaneXY(0, 0, 0))  # -> Box, Box_2
panel_2 = Panel("Create contours")
brep_wireframe = BrepWireframe(Brep=bounding_box.Box, Density=-1)
list_item_2 = ListItem(List=brep_wireframe, Index=0, Wrap=True)
length_3 = Length(Curve=list_item_2)
division_3 = Division(A=length_3, B=2)
contour_3 = Contour(Shape=scale.Geometry, Point=Point(0, 0, 0), Direction=list_item_2, Distance=division_3)  # -> flatten(Contours)
list_item_3 = ListItem(List=contour_3, Index=Slider(1, range=0..1), Wrap=True)

# ---- group: mesh input
mesh_4 = Mesh(scale.Geometry)

# ----
ghpython_script = GhPythonScript(mesh=mesh_4)  # -> out, a; inputs mesh: Mesh
# ---------- ghpython_script: Python ----------
__author__ = "Hamidreza"
__version__ = "2019.10.19"


#This script is drived from the works of Hungsoo Kim: https://www.grasshopper3d.com/profiles/profile/show?id=HyungsooKim&


import rhinoscriptsyntax as rs
import ghpythonlib.components as ghc
lst=[]
edges=[]
meshEdg= ghc.MeshEdges(mesh)[0]
Edg= ghc.JoinCurves(meshEdg, True)
faceBound= ghc.FaceBoundaries(mesh)
coll= ghc.CollisionOneXMany(faceBound,Edg)[0]
meshCull= ghc.CullFaces(mesh,coll)
lst.append(meshCull)
i=0
edges.append(Edg)
while i<400:
    meshEdg= ghc.MeshEdges(lst[-1])[0]
    Edg= ghc.JoinCurves(meshEdg, True)
    faceBound= ghc.FaceBoundaries(lst[-1])
    coll= ghc.CollisionOneXMany(faceBound,Edg)[0]
    meshCull= ghc.CullFaces(lst[-1],coll)
    lst.append(meshCull)
    edges.append(Edg)
    i=i+1
a=edges
# ---------- end ghpython_script ----------
tree_to_list = TreeToList(DataTree=ghpython_script.a)  # -> PythonList, showPythonList; inputs DataTree: tree
# ---------- tree_to_list: Python ----------
from Grasshopper import DataTree as Tree
from Grasshopper.Kernel.Data import GH_Path as Path
from System import Array

def tree_to_list(input, retrieve_base = lambda x: x[0]):
    """Returns a list representation of a Grasshopper DataTree"""
    def extend_at(path, index, simple_input, rest_list):
        target = path[index]
        if len(rest_list) <= target: rest_list.extend([None]*(target-len(rest_list)+1))
        if index == path.Length - 1:
            rest_list[target] = list(simple_input)
        else:
            if rest_list[target] is None: rest_list[target] = []
            extend_at(path, index+1, simple_input, rest_list[target])
    all = []
    for i in range(input.BranchCount):
        path = input.Path(i)
        extend_at(path, 0, input.Branch(path), all)
    return retrieve_base(all)

print DataTree

if len(DataTree.AllData()) > 0:
    PythonList = tree_to_list(DataTree)
    showPythonList = repr (PythonList)
# ---------- end tree_to_list ----------
list_to_tree = ListToTree(PythonList=tree_to_list.PythonList)  # -> DataTree; inputs PythonList: list, BasePath: list of Int32
# ---------- list_to_tree: Python ----------
from Grasshopper import DataTree as Tree
from Grasshopper.Kernel.Data import GH_Path as Path
from System import Array

def list_to_tree(input, none_and_holes=False, base_path=[0]):
    """Transforms nestings of lists or tuples to a Grasshopper DataTree"""
    
    def process_one_item(input,tree,track):
        path = Path(Array[int](track))
        if len(input) == 0 and none_and_holes: tree.EnsurePath(path); return
        for i,item in enumerate(input):
            if hasattr(item, '__iter__'): #if list or tuple
                track.append(i); process_one_item(item,tree,track); track.pop()
            else:
                if none_and_holes: tree.Insert(item,path,i)
                elif item is not None: tree.Add(item,path)
    tree = Tree[object]()
    if input is not None: process_one_item(input,tree,base_path[:]); return tree
    

pythonList = PythonList or []
None_and_holes = False
Base_path = BasePath or [0]


DataTree = list_to_tree(pythonList,none_and_holes = None_and_holes, base_path= Base_path)
# ---------- end list_to_tree ----------
join_curves = JoinCurves(Curves=list_to_tree, Preserve=False)  # -> flatten(Curves)

# ----
# Divide the mesh in equal distances
extremes = Extremes(Curve=list_item_3, Plane=PlaneXY(0, 0, 0))  # -> Highest, Lowest
curve_closest_point = CurveClosestPoint(Point=extremes.Highest, Curve=list_item_3)  # -> Point, Parameter, Distance
shatter = Shatter(Curve=list_item_3, Parameters=curve_closest_point.Parameter)
list_item_4 = ListItem(List=shatter, Index=0, Wrap=True)
divide_length = DivideLength(Curve=list_item_4, Length=Slider(0.33, range=0..1))  # -> Points, Tangents, Parameters
area_2 = Area(Geometry=polygon.Polygon)  # -> Area, Centroid
deconstruct = Deconstruct(Point=divide_length.Points)  # -> XComponent, YComponent, ZComponent
deconstruct_2 = Deconstruct(Point=area_2.Centroid)  # -> XComponent, YComponent, ZComponent
construct_point = ConstructPoint(XCoordinate=deconstruct_2.XComponent, YCoordinate=deconstruct_2.YComponent, ZCoordinate=deconstruct.ZComponent)
distance = Distance(PointA=divide_length.Points, PointB=construct_point)
circle = Circle(Plane=construct_point, Radius=distance)

# ---- group: Inner-Naked-output
curve_5 = Curve(join_curves)

# ----
panel_3 = Panel("Create a brick")
center_box = CenterBox(Base=PlaneXY(0, 0, 0), X=number_slider_5, Y=number_slider_7, Z=number_slider_6)

# ----
# Create the switching pattern
number_slider_9 = Slider(0.2, range=0..1)
length_4 = Length(Curve=circle)
division_4 = Division(A=length_4, B=number_slider_9)
round = Round(Number=division_4)  # -> Nearest, Floor, Ceiling
divide_curve_3 = DivideCurve(Curve=circle, Count=round.Floor, Kinks=False)  # -> Points, Tangents, Parameters
vector_2pt = Vector2Pt(PointA=area_2.Centroid, PointB=simplify(divide_curve_3.Points), Unitize=False)  # -> Vector, Length
construct_plane = ConstructPlane(Origin=divide_curve_3.Points, XAxis=divide_curve_3.Tangents, YAxis=vector_2pt.Vector)  # -> simplify(Plane)
tree_statistics = TreeStatistics(Tree=construct_plane)  # -> Paths, Length, Count
dispatch_3 = Dispatch(List=tree_statistics.Paths, DispatchPattern=[True, False])  # -> ListA, ListB
tree_branch = TreeBranch(Tree=construct_plane, Path=dispatch_3.ListB, MaintainPaths=True)
tree_branch_2 = TreeBranch(Tree=construct_plane, Path=dispatch_3.ListA, MaintainPaths=True)

# ----
# Rotate the brick 45 degrees so it can be implemented. Select the edge to for the source for the orient
number_slider_10 = Slider(45, range=0..360)
deconstruct_brep = DeconstructBrep(Brep=center_box)  # -> Faces, Edges, Vertices
list_item_5 = ListItem(List=deconstruct_brep.Faces, Index=0, Wrap=True)
addition = Addition(A=number_slider_10, B=90)
area_3 = Area(Geometry=list_item_5)  # -> Area, Centroid
xz_plane = XZPlane(Origin=area_3.Centroid)
rotate = Rotate(Geometry=center_box, Angle=degrees(number_slider_10), Plane=xz_plane)  # -> Geometry, Transform
rotate_2 = Rotate(Geometry=center_box, Angle=degrees(addition), Plane=xz_plane)  # -> Geometry, Transform
brep_wireframe_2 = BrepWireframe(Brep=rotate.Geometry, Density=-1)
brep_wireframe_3 = BrepWireframe(Brep=rotate_2.Geometry, Density=-1)
list_item_6 = ListItem(List=brep_wireframe_2, Index=Slider(5, range=0..11), Wrap=True)
list_item_7 = ListItem(List=brep_wireframe_3, Index=Slider(9, range=0..11), Wrap=True)
end_points = EndPoints(Curve=list_item_6)  # -> Start, End
end_points_2 = EndPoints(Curve=list_item_7)  # -> Start, End

# ----
# Orient and clean up
orient = Orient(Geometry=rotate.Geometry, Source=end_points.Start, Target=tree_branch_2)  # -> Geometry, Transform
orient_2 = Orient(Geometry=rotate_2.Geometry, Source=end_points_2.Start, Target=tree_branch)  # -> Geometry, Transform
tree_statistics_2 = TreeStatistics(Tree=orient.Geometry)  # -> Paths, Length, Count
tree_statistics_3 = TreeStatistics(Tree=orient_2.Geometry)  # -> Paths, Length, Count
cull_index = CullIndex(List=reverse(tree_statistics_2.Paths), Indices=Slider(0, range=0..100), Wrap=True)
cull_index_2 = CullIndex(List=reverse(tree_statistics_3.Paths), Indices=Slider(0, range=0..100), Wrap=True)
tree_branch_3 = TreeBranch(Tree=orient_2.Geometry, Path=cull_index_2, MaintainPaths=True)
tree_branch_4 = TreeBranch(Tree=orient.Geometry, Path=cull_index, MaintainPaths=True)

brep_2 = Brep([tree_branch_4, tree_branch_3])

# ----
# Cull points that are colliding with the belt
pdecon = Deconstruct(Point=divide_curve_3.Points)  # -> XComponent, YComponent, ZComponent
expression = Expression(x=pdecon.ZComponent, Expression="If(x>0.3,true, false)")
cull = CullPattern(List=brep_2, CullPattern=expression)

# ---- group: OUTPUT
brep_3 = Brep(cull)
