# Grasshopper definition bricklaying_walls.gh (Grasshopper 1.0.7)
# plug-ins: Heteroptera

# ---- group: INPUTS
number_slider = Slider(1, range=0..3)
crv = Curve([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])

# ----
python = GhPythonScript(x=number_slider)  # -> out, a, b
# ---------- python: Python ----------
if x == 0:
    a = 120
    b = 10
elif x == 1:
    a = 100
    b = 8
elif x == 2:
    a = 80
    b = 7
elif x == 3:
    a = 50
    b = 4
# ---------- end python ----------
item = ListItem(List=crv, Index=number_slider, Wrap=True)
neg = Negative(Value=python.a)
offset = OffsetCurve(Curve=item, Distance=neg, Plane=PlaneXY(0, 0, 0), Corners=1)

# ---- group: offsets as "grid"
division = Division(A=neg, B=python.b)
series = Series(Start=0, Step=division, Count=python.b)
offset_2 = OffsetCurve(Curve=item, Distance=series, Plane=PlaneXY(0, 0, 0), Corners=1)  # -> flatten(Curve)

# ----
all_the_offsets = Curve(flatten([offset_2, offset]))

# ---- group: Select lines that are important for each side
cp = ControlPoints(Curve=all_the_offsets)  # -> Points, Weights, Knots
item_2 = ListItem(List=cp.Points, Index="1", Wrap=True)  # -> Item, Item1
item_3 = ListItem(List=cp.Points, Index=0, Wrap=True)  # -> Item, Item1
item_4 = ListItem(List=cp.Points, Index="5", Wrap=True)  # -> Item, Item1
ln = Line(StartPoint=item_3.Item, EndPoint=item_3.Item1)
ln_2 = Line(StartPoint=item_2.Item, EndPoint=item_2.Item1)
ln_3 = Line(StartPoint=item_4.Item, EndPoint=item_4.Item1)

# ---- group: Hexagon centroid
area = Area(Geometry=item)  # -> Area, Centroid

# ----
number_slider_2 = Slider(200, range=0..1000)
number_slider_3 = Slider(0, range=0..100)

# ---- group: Hexagon side creation
ext = ExtendCurve(Curve=ln_3, Type=0, Start=number_slider_3, End=number_slider_2)
lng = ListLength(List=flatten(ext))
item_5 = ListItem(List=flatten(ln_2), Index=0, Wrap=True)
item_6 = ListItem(List=flatten(ext), Index=expr("x-1", lng), Wrap=True)
ext_2 = ExtendCurve(Curve=ln, Type=0, Start=number_slider_3, End=number_slider_2)
ccx = CurveCurve(CurveA=ext_2, CurveB=item_6)  # -> Points, ParamsA, ParamsB
ccx_2 = CurveCurve(CurveA=ext_2, CurveB=item_5)  # -> Points, ParamsA, ParamsB
ln_4 = Line(StartPoint=ccx.Points, EndPoint=ccx_2.Points)

# ---- group: Rotation series
series_2 = Series(Start=0, Step="60", Count="6")
rad = Radians(Degrees=series_2)

# ---- group: All the sides
rotate = Rotate(Geometry=ln_4, Angle=rad, Plane=area.Centroid)  # -> Geometry, Transform

# ---- group: Make a grid on the top one
item_7 = ListItem(List=rotate.Geometry, Index=4, Wrap=True)  # -> flatten(Item)
lng_2 = ListLength(List=item_7)
item_8 = ListItem(List=item_7, Index=expr("x-1", lng_2), Wrap=True)
len = Length(Curve=item_8)
Y = UnitY(Factor=python.a)
division_2 = Division(A=len, B=Slider(20, range=0..100))
divide = DivideCurve(Curve=item_8, Count=division_2, Kinks=False)  # -> Points, Tangents, Parameters
move = Move(Geometry=divide.Points, Motion=Y)  # -> Geometry, Transform
ln_5 = Line(StartPoint=divide.Points, EndPoint=move.Geometry)  # -> graft(Line)

# ---- group: Generate the cull patterns
python_2 = GhPythonScript(x=number_slider)  # -> out, list
# ---------- python_2: Python ----------
import rhinoscriptsyntax as rs
list = []
if x == 1:
    list = [0,0,1,1,0,0,1,1,0,0,1,1,0,1,1,0,1,1,0]
else:
    list = [0,0,1,1,0,1,1,0,1,1,0,1,1,0,1,1,0]
# ---------- end python_2 ----------

# ---- group: Select proper points
cull = CullPattern(List=item_7, CullPattern=python_2.list)
ccx_3 = CurveCurve(CurveA=cull, CurveB=ln_5)  # -> Points, ParamsA, ParamsB

# ---- group: Create the pattern
python_3 = GhPythonScript(Points=flatten(ccx_3.Points), x=number_slider)  # -> out, linesList; inputs Points: list of Point3d
# ---------- python_3: Python ----------
import Rhino.Geometry as rg
import rhinoscriptsyntax as rs
counter = 0
currCounter = 0
linesList = []
normalCounter = []

if x == 0:
    normalCounter = [1,0,1,0,1,0]
elif x == 1:
    normalCounter = [0,0,1,1]
elif x == 2:
    normalCounter = [0,0,1,1]
elif x == 3:
    normalCounter = [0,1]

for i in Points:
    if (counter < (len(Points)-1)) and counter%2 == 0:
        currInd = Points.index(i)
        nextInd = currInd + 1
        
        if normalCounter[currCounter] == 0:
            newLine = rg.Line(Points[nextInd], Points[currInd])
            linesList.append(newLine)
            currCounter = currCounter + 1
            
        elif normalCounter[currCounter] == 1:
            newLine = rg.Line(Points[currInd], Points[nextInd])
            linesList.append(newLine)
            currCounter = currCounter + 1
        
        if currCounter % len(normalCounter) == 0:
            currCounter = 0
        counter = counter + 1
    else:
        counter = counter + 1
# ---------- end python_3 ----------

# ---- group: Fixing possible mistakes
python_4 = GhPythonScript(z=number_slider, list=python_3.linesList)  # -> out, a, b; inputs z: Int32, list: list of Int32
# ---------- python_4: Python ----------
import rhinoscriptsyntax as rs
import Rhino.Geometry as rg
list = []
listLength = len(list)
if z == 2:
    a = listLength - 1
    b = []
elif z == 0:
    a = [84,85,86]
    b = 0
elif z == 3:
    a = []
    b = []

print a
# ---------- end python_4 ----------
panel = Panel([python_4.a, python_4.b])
item_9 = ListItem(List=python_3.linesList, Index=python_4.b, Wrap=True)
item_10 = ListItem(List=python_3.linesList, Index=python_4.a, Wrap=True)
cull_i = CullIndex(List=python_3.linesList, Indices=flatten(panel), Wrap=True)
end = EndPoints(Curve=item_10)  # -> Start, End
end_2 = EndPoints(Curve=item_9)  # -> Start, End
ln_6 = Line(StartPoint=end_2.End, EndPoint=end_2.Start)
ln_7 = Line(StartPoint=end.End, EndPoint=end.Start)
merge = Merge(Data1=flatten(ln_6), Data2=flatten(cull_i), Data3=flatten(ln_7))

# ---- group: Orient triangles
crv_2 = Curve(<curve referenced from the Rhino model>)
crv_3 = Curve(<curve referenced from the Rhino model>)
end_3 = EndPoints(Curve=python_3.linesList)  # -> Start, End
orient = Orient(Geometry=crv_2, Source=crv_3, Target=merge)  # -> Geometry, Transform
rotate_2 = RotateDirection(Geometry=orient.Geometry, Center=end_3.Start, From=orient.Geometry, To="{0,0,1}")  # -> Geometry, Transform

# ---- group: Make the side
item_11 = ListItem(List=item_7, Index=0, Wrap=True)  # -> Item, Item1
end_4 = EndPoints(Curve=item_11.Item)  # -> Start, End
end_5 = EndPoints(Curve=item_11.Item1)  # -> Start, End
srf4pt = _4PointSurface(CornerA=end_4.Start, CornerB=end_5.Start, CornerC=end_5.End, CornerD=end_4.End)

# ---- group: Combine surfaces
boundary = BoundarySurfaces(Edges=rotate_2.Geometry)
srf = Surface(flatten([srf4pt, boundary]))

# ---- group: Extrusion
number_slider_4 = Slider(10, range=0..10)
Z = UnitZ(Factor=number_slider_4)
extr = Extrude(Base=srf, Direction=Z)

# ---- group: Rotate it
rad_2 = Radians(Degrees=series_2)
rotate_3 = Rotate(Geometry=graft(extr), Angle=rad_2, Plane=area.Centroid)  # -> Geometry, Transform

# ---- group: Make layer above
yz = YZPlane(Origin=area.Centroid)
mirror = Mirror(Geometry=rotate_3.Geometry, Plane=yz)  # -> Geometry, Transform
move_2 = Move(Geometry=mirror.Geometry, Motion=Z)  # -> Geometry, Transform

# ----
brep = Brep([rotate_3.Geometry, move_2.Geometry])

# ---- group: Arraying
division_3 = Division(A=Slider(250, range=0..1000), B=number_slider_4)
arrlinear = LinearArray(Geometry=flatten(brep), Direction=Z, Count=division_3)  # -> Geometry, Transform

# ---- group: oUTPUT
expression = Expression(x=number_slider, Expression="If(x=1,50, 0)")
panel_2 = Panel("""Due to the infill, this one doesnt follow the grid 
and can not be made by this script :(""")
brep_2 = Brep(arrlinear.Geometry)
textbaker = TextBaker(Location=area.Centroid, Text=panel_2, Size=expression, Justification=6, Activate=True, textentity=True)
