# Grasshopper definition window_openings.gh (Grasshopper 1.0.7)
# plug-ins: Heteroptera

steepness = Slider(1.051, range=1..1.3)
number_of_points = Slider(34, range=30..100)
# window openings
# Autor: Maximilian Mandat
# circular opening (360°)
number_slider = Slider(60, range=0..100)
arch_radius = Slider(121, range=1..200)
# catenary opening (from catenary expression)
series = Series(Start=0, Step=0.1, Count=number_of_points)
# catenary opening (set one curve from rhino)
curve = Curve(<curve referenced from the Rhino model>)

# ----
# circular opening (180°)
number_slider_2 = Slider(120, range=1..200)
division = Division(A=number_slider_2, B=2)
unit_x = UnitX(Factor=number_slider_2)
unit_x_2 = UnitX(Factor=division)
point = Point(<point referenced from the Rhino model>)
centre = Move(Geometry=point, Motion=unit_x_2)  # -> Geometry, Transform
unit_z = UnitZ(Factor=division)
move = Move(Geometry=point, Motion=unit_x)  # -> Geometry, Transform
move_2 = Move(Geometry=centre.Geometry, Motion=unit_z)  # -> Geometry, Transform
arc_3pt = Arc3Pt(PointA=point, PointB=move_2.Geometry, PointC=move.Geometry)  # -> Arc, Plane, Radius

vector_xyz = VectorXYZ(XComponent=Slider(0, range=0..1000), YComponent=0, ZComponent=0)  # -> Vector, Length
circle = Circle(Plane=PlaneXY(0, 0, 0), Radius=number_slider)
negative = Negative(Value=series)
move_3 = Move(Geometry=circle, Motion=vector_xyz.Vector)  # -> Geometry, Transform
expression = Expression(x=series, a=steepness, Expression="(e^(x/a)+e^(-x/a))/2")
expression_2 = Expression(x=series, a=steepness, Expression="(e^(x/a)+e^(-x/a))/2")
length = Length(Curve=curve)
center = Center(Geometrical=move_3.Geometry)  # -> Center, Dimension
unit_z_2 = UnitZ(Factor=Slider(99, range=0..125))
division_2 = Division(A=length, B=Slider(6, range=1..15))
integer = Integer(division_2)
move_4 = Move(Geometry=center.Center, Motion=unit_z_2)  # -> Geometry, Transform
construct_point = ConstructPoint(XCoordinate=negative, YCoordinate=expression_2, ZCoordinate=0)
construct_point_2 = ConstructPoint(XCoordinate=series, YCoordinate=expression, ZCoordinate=0)
perp_frames = PerpFrames(Curve=curve, Count=integer, Align=True)  # -> Frames, Parameters
unit_y = UnitY(Factor=-11)
line = Line(StartPoint=center.Center, EndPoint=move_4.Geometry)
list_item = ListItem(List=reverse(construct_point), Index=0, Wrap=True)
list_item_2 = ListItem(List=reverse(construct_point_2), Index=0, Wrap=True)
list_item_3 = ListItem(List=construct_point, Index=0, Wrap=True)
shift_list = ShiftList(List=construct_point_2, Shift=1, Wrap=True)
move_5 = Move(Geometry=curve, Motion=unit_y)  # -> Geometry, Transform
shift_list_2 = ShiftList(List=construct_point, Shift=1, Wrap=True)
length_2 = Length(Curve=arc_3pt.Arc)

domain_box = DomainBox(Base=PlaneXY(0, 0, 0), X="10", Y="21", Z="5")
brep_wireframe = BrepWireframe(Brep=domain_box, Density=-1)
list_item_4 = ListItem(List=brep_wireframe, Index=Slider(9, range=0..11), Wrap=True)
point_on_curve = PointOnCurve(list_item_4, parameter=0.5)

domain_box_2 = DomainBox(Base=PlaneXY(0, 0, 0), X="21", Y="10", Z="5")
brep_wireframe_2 = BrepWireframe(Brep=domain_box_2, Density=-1)
list_item_5 = ListItem(List=brep_wireframe_2, Index=Slider(9, range=0..11), Wrap=True)
point_on_curve_2 = PointOnCurve(list_item_5, parameter=0.5)

cull_index = CullIndex(List=shift_list, Indices=-1, Wrap=True)
perp_frames_2 = PerpFrames(Curve=line, Count=Slider(5, range=0..5), Align=True)  # -> Frames, Parameters
cull_index_2 = CullIndex(List=shift_list_2, Indices=-1, Wrap=True)
offset_curve = OffsetCurve(Curve=move_5.Geometry, Distance=-11, Plane=PlaneXY(0, 0, 0), Corners=1)
perp_frames_3 = PerpFrames(Curve=move_5.Geometry, Count=integer, Align=True)  # -> Frames, Parameters
line_2 = Line(StartPoint=construct_point, EndPoint=cull_index_2)
line_3 = Line(StartPoint=construct_point_2, EndPoint=cull_index)
division_3 = Division(A=length_2, B=Slider(6, range=1..15))
perp_frames_4 = PerpFrames(Curve=offset_curve, Count=integer, Align=True)  # -> Frames, Parameters
dispatch = Dispatch(List=perp_frames_2.Frames, DispatchPattern=[True, False])  # -> ListA, ListB
integer_2 = Integer(division_3)
perp_frames_5 = PerpFrames(Curve=arc_3pt.Arc, Count=integer_2, Align=True)  # -> Frames, Parameters
join_curves = JoinCurves(Curves=[line_2, line_3], Preserve=False)
circle_cnr = CircleCNR(Center=dispatch.ListA, Normal=Vector(0, 0, 1), Radius=arch_radius)
rotate = Rotate(Geometry=join_curves, Angle=3.141592654, Plane=PlaneXY(0, 0, 0))  # -> Geometry, Transform
circle_cnr_2 = CircleCNR(Center=dispatch.ListB, Normal=Vector(0, 0, 1), Radius=arch_radius)
length_3 = Length(Curve=[circle_cnr, circle_cnr_2])
division_4 = Division(A=length_3, B=Slider(9, range=0..15))
multiplication = Multiplication(A=division_4, B=2)
yz_plane = YZPlane(Origin=Point(0, 0, 0))
unit_y_2 = UnitY(Factor=Slider(11, range=1..20))
list_item_6 = ListItem(List=perp_frames_5.Frames, Index=0, Wrap=True)
rotate_2 = Rotate(Geometry=rotate.Geometry, Angle=1.570796327, Plane=yz_plane)  # -> Geometry, Transform
horizontal_frames = HorizontalFrames(Curve=circle_cnr_2, Count=division_4)  # -> Frames, Parameters
offset_curve_2 = OffsetCurve(Curve=circle_cnr, Distance=Slider(20, range=1..25), Plane=dispatch.ListA, Corners=1)
horizontal_frames_2 = HorizontalFrames(Curve=circle_cnr, Count=division_4)  # -> Frames, Parameters
move_6 = Move(Geometry=[perp_frames_5.Frames, arc_3pt.Arc], Motion=unit_y_2)  # -> Geometry, Transform
orient = Orient(Geometry=domain_box_2, Source=point_on_curve_2, Target=perp_frames.Frames)  # -> Geometry, Transform
orient_2 = Orient(Geometry=domain_box, Source=point_on_curve, Target=[perp_frames_3.Frames, perp_frames_4.Frames])  # -> Geometry, Transform
scale = Scale(Geometry=rotate_2.Geometry, Center=Point(0, 0, 0), Factor=Slider(20, range=0..20))  # -> Geometry, Transform
horizontal_frames_3 = HorizontalFrames(Curve=offset_curve_2, Count=division_4)  # -> Frames, Parameters
list_item_7 = ListItem(List=flatten(move_6.Geometry), Index=0, Wrap=True)
dispatch_2 = Dispatch(List=horizontal_frames.Frames, DispatchPattern=[True, False])  # -> ListA, ListB
dispatch_3 = Dispatch(List=horizontal_frames_2.Frames, DispatchPattern=[True, False])  # -> ListA, ListB
end_points = EndPoints(Curve=scale.Geometry)  # -> Start, End
dispatch_4 = Dispatch(List=horizontal_frames_3.Frames, DispatchPattern=[True, False])  # -> ListA, ListB
offset_curve_3 = OffsetCurve(Curve=list_item_7, Distance=-11, Plane=PlaneXY(0, 0, 0), Corners=1)
plane = Plane(dispatch_2.ListA)
plane_2 = Plane(dispatch_2.ListB)
plane_3 = Plane(dispatch_3.ListB)
orient_3 = Orient(Geometry=scale.Geometry, Source=end_points.End, Target=PlaneXY(0, 0, 0))  # -> Geometry, Transform
plane_4 = Plane(dispatch_3.ListA)
perp_frames_6 = PerpFrames(Curve=offset_curve_3, Count=integer_2, Align=True)  # -> Frames, Parameters
plane_5 = Plane(dispatch_4.ListB)

center_box = CenterBox(Base=PlaneXY(0, 0, 0), X="4", Y="19", Z="9")
brep_wireframe_3 = BrepWireframe(Brep=center_box, Density=-1)
list_item_8 = ListItem(List=brep_wireframe_3, Index=Slider(2, range=0..11), Wrap=True)
point_on_curve_3 = PointOnCurve(list_item_8, parameter=0.5)
orient_4 = Orient(Geometry=center_box, Source=point_on_curve_3, Target=[plane_4, plane])  # -> simplify(Geometry), Transform

center_box_2 = CenterBox(Base=PlaneXY(0, 0, 0), X="4", Y="9", Z="19")
brep_wireframe_4 = BrepWireframe(Brep=center_box_2, Density=-1)
list_item_9 = ListItem(List=brep_wireframe_4, Index=Slider(2, range=0..11), Wrap=True)
point_on_curve_4 = PointOnCurve(list_item_9, parameter=0.5)
orient_5 = Orient(Geometry=center_box_2, Source=point_on_curve_4, Target=[plane_3, plane_5])  # -> simplify(Geometry), Transform

flip_curve = FlipCurve(Curve=orient_3.Geometry)  # -> Curve, Flag

domain_box_3 = DomainBox(Base=list_item_6, X="10", Y="21", Z="5")
brep_wireframe_5 = BrepWireframe(Brep=domain_box_3, Density=-1)
list_item_10 = ListItem(List=brep_wireframe_5, Index=Slider(9, range=0..11), Wrap=True)
point_on_curve_5 = PointOnCurve(list_item_10, parameter=0.5)

domain_box_4 = DomainBox(Base=PlaneXY(0, 0, 0), X="21", Y="10", Z="5")
brep_wireframe_6 = BrepWireframe(Brep=domain_box_4, Density=-1)
list_item_11 = ListItem(List=brep_wireframe_6, Index=Slider(9, range=0..11), Wrap=True)
point_on_curve_6 = PointOnCurve(list_item_11, parameter=0.5)

curve_2 = Curve(flip_curve.Curve)
length_4 = Length(Curve=curve_2)
division_5 = Division(A=length_4, B=Slider(6, range=1..15))
unit_y_3 = UnitY(Factor=-11)
integer_3 = Integer(division_5)
perp_frames_7 = PerpFrames(Curve=curve_2, Count=integer_3, Align=True)  # -> Frames, Parameters
move_7 = Move(Geometry=curve_2, Motion=unit_y_3)  # -> Geometry, Transform
offset_curve_4 = OffsetCurve(Curve=move_7.Geometry, Distance=-11, Plane=PlaneXY(0, 0, 0), Corners=1)
yz_plane_2 = YZPlane(Origin=Point(0, 0, 0))
orient_6 = Orient(Geometry=domain_box_4, Source=point_on_curve_6, Target=perp_frames_5.Frames)  # -> Geometry, Transform
orient_7 = Orient(Geometry=domain_box_3, Source=point_on_curve_5, Target=[move_6.Geometry, perp_frames_6.Frames])  # -> Geometry, Transform
perp_frames_8 = PerpFrames(Curve=offset_curve_4, Count=integer_3, Align=True)  # -> Frames, Parameters
perp_frames_9 = PerpFrames(Curve=move_7.Geometry, Count=integer_3, Align=True)  # -> Frames, Parameters
rotate_3 = Rotate(Geometry=[orient_5.Geometry, orient_4.Geometry], Angle=1.570796327, Plane=yz_plane_2)  # -> Geometry, Transform
unit_x_3 = UnitX(Factor=Slider(646, range=0..1000))

domain_box_5 = DomainBox(Base=PlaneXY(0, 0, 0), X="10", Y="21", Z="5")
brep_wireframe_7 = BrepWireframe(Brep=domain_box_5, Density=-1)
list_item_12 = ListItem(List=brep_wireframe_7, Index=Slider(9, range=0..11), Wrap=True)
point_on_curve_7 = PointOnCurve(list_item_12, parameter=0.5)

domain_box_6 = DomainBox(Base=PlaneXY(0, 0, 0), X="21", Y="10", Z="5")
brep_wireframe_8 = BrepWireframe(Brep=domain_box_6, Density=-1)
list_item_13 = ListItem(List=brep_wireframe_8, Index=Slider(9, range=0..11), Wrap=True)
point_on_curve_8 = PointOnCurve(list_item_13, parameter=0.5)

move_8 = Move(Geometry=rotate_3.Geometry, Motion=unit_x_3)  # -> Geometry, Transform
orient_8 = Orient(Geometry=domain_box_6, Source=point_on_curve_8, Target=[perp_frames_9.Frames, perp_frames_8.Frames])  # -> Geometry, Transform
orient_9 = Orient(Geometry=domain_box_5, Source=point_on_curve_7, Target=perp_frames_7.Frames)  # -> Geometry, Transform
