# Grasshopper definition hamam functions_sizes_bubble diagram_configuration.gh (Grasshopper 1.0.7)
# plug-ins: SpaceSyntaxDesign_GH

surface = Surface(<surface referenced from the Rhino model>)

# ---- group: Kaboli Hamam
surface_2 = Surface([<surface referenced from the Rhino model> x9])
surface_3 = Surface([<surface referenced from the Rhino model> x13])
surface_4 = Surface(<surface referenced from the Rhino model>)
surface_5 = Surface(<surface referenced from the Rhino model>)
surface_6 = Surface(<surface referenced from the Rhino model>)
surface_7 = Surface([<surface referenced from the Rhino model> x25])
area = Area(Geometry=surface_3)  # -> Area, Centroid
area_2 = Area(Geometry=surface_2)  # -> Area, Centroid
area_3 = Area(Geometry=surface_4)  # -> Area, Centroid
area_4 = Area(Geometry=surface_5)  # -> Area, Centroid
area_5 = Area(Geometry=surface_6)  # -> Area, Centroid
area_6 = Area(Geometry=surface_7)  # -> Area, Centroid
mass_addition = MassAddition(Input=area_2.Area)  # -> Result, PartialResults
mass_addition_2 = MassAddition(Input=area.Area)  # -> Result, PartialResults
mass_addition_3 = MassAddition(Input=area_6.Area)  # -> Result, PartialResults
area_corridors = Panel(mass_addition.Result)
area_corridors_2 = Panel(area_3.Area)
hot_house = Panel(area_4.Area)
area_subsidiary_spaces = Panel(mass_addition_2.Result)
area_subsidiary_spaces_2 = Panel(area_5.Area)
mass_addition_4 = MassAddition(Input=[hot_house, area_corridors, area_subsidiary_spaces, area_subsidiary_spaces_2, area_corridors_2])  # -> Result, PartialResults
total_area_approximation = Panel(mass_addition_3.Result)
contr = Panel(mass_addition_4.Result)

# ---- group: Golshan Hamam
surface_8 = Surface([<surface referenced from the Rhino model> x7])
surface_9 = Surface([<surface referenced from the Rhino model> x10])
surface_10 = Surface(<surface referenced from the Rhino model>)
surface_11 = Surface(<surface referenced from the Rhino model>)
surface_12 = Surface(<surface referenced from the Rhino model>)
surface_13 = Surface([<surface referenced from the Rhino model> x20])
area_7 = Area(Geometry=surface_9)  # -> Area, Centroid
area_8 = Area(Geometry=surface_8)  # -> Area, Centroid
area_9 = Area(Geometry=surface_10)  # -> Area, Centroid
area_10 = Area(Geometry=surface_11)  # -> Area, Centroid
area_11 = Area(Geometry=surface_12)  # -> Area, Centroid
area_12 = Area(Geometry=surface_13)  # -> Area, Centroid
mass_addition_5 = MassAddition(Input=area_8.Area)  # -> Result, PartialResults
mass_addition_6 = MassAddition(Input=area_7.Area)  # -> Result, PartialResults
mass_addition_7 = MassAddition(Input=area_12.Area)  # -> Result, PartialResults
area_corridors_3 = Panel(mass_addition_5.Result)
area_dressing_room = Panel(area_9.Area)
hot_house_2 = Panel(area_10.Area)
area_subsidiary_spaces_3 = Panel(mass_addition_6.Result)
area_pool = Panel(area_11.Area)
mass_addition_8 = MassAddition(Input=[hot_house_2, area_corridors_3, area_subsidiary_spaces_3, area_pool, area_dressing_room])  # -> Result, PartialResults
total_area_approximation_2 = Panel(mass_addition_7.Result)
contr_2 = Panel(mass_addition_8.Result)

# ----
surface_14 = Surface(<surface referenced from the Rhino model>)

# ---- group: Chekneh Hamam
surface_15 = Surface([<surface referenced from the Rhino model> x7])
surface_16 = Surface([<surface referenced from the Rhino model> x10])
surface_17 = Surface(<surface referenced from the Rhino model>)
surface_18 = Surface(<surface referenced from the Rhino model>)
surface_19 = Surface([<surface referenced from the Rhino model> x20])
area_13 = Area(Geometry=surface_16)  # -> Area, Centroid
area_14 = Area(Geometry=surface_15)  # -> Area, Centroid
area_15 = Area(Geometry=surface_17)  # -> Area, Centroid
area_16 = Area(Geometry=surface_18)  # -> Area, Centroid
area_17 = Area(Geometry=surface_14)  # -> Area, Centroid
area_18 = Area(Geometry=surface_19)  # -> Area, Centroid
mass_addition_9 = MassAddition(Input=area_14.Area)  # -> Result, PartialResults
mass_addition_10 = MassAddition(Input=area_13.Area)  # -> Result, PartialResults
mass_addition_11 = MassAddition(Input=area_18.Area)  # -> Result, PartialResults
area_corridors_4 = Panel(mass_addition_9.Result)
area_corridors_5 = Panel(area_15.Area)
hot_house_3 = Panel(area_16.Area)
area_subsidiary_spaces_4 = Panel(mass_addition_10.Result)
area_subsidiary_spaces_5 = Panel(area_17.Area)
mass_addition_12 = MassAddition(Input=[hot_house_3, area_corridors_4, area_subsidiary_spaces_4, area_subsidiary_spaces_5, area_corridors_5])  # -> Result, PartialResults
total_area_approximation_3 = Panel(mass_addition_11.Result)
contr_3 = Panel(mass_addition_12.Result)

# ----
area_19 = Area(Geometry=surface)  # -> Area, Centroid
area_subsidiary_spaces_6 = Panel(area_19.Area)
division = Division(A=total_area_approximation_2, B=Slider(100, range=0..100))
division_2 = Division(A=total_area_approximation_3, B=Slider(100, range=0..100))
division_3 = Division(A=total_area_approximation, B=Slider(100, range=0..100))
division_4 = Division(A=area_dressing_room, B=division)
division_5 = Division(A=area_corridors_3, B=division)
division_6 = Division(A=area_subsidiary_spaces_3, B=division)
division_7 = Division(A=area_pool, B=division)
division_8 = Division(A=hot_house_2, B=division)
division_9 = Division(A=area_corridors_5, B=division_2)
division_10 = Division(A=area_corridors_4, B=division_2)
division_11 = Division(A=area_subsidiary_spaces_4, B=division_2)
division_12 = Division(A=area_subsidiary_spaces_5, B=division_2)
division_13 = Division(A=hot_house_3, B=division_2)
division_14 = Division(A=area_corridors_2, B=division_3)
division_15 = Division(A=area_corridors, B=division_3)
division_16 = Division(A=area_subsidiary_spaces, B=division_3)
division_17 = Division(A=area_subsidiary_spaces_2, B=division_3)
division_18 = Division(A=hot_house, B=division_3)
integer = Integer(total_area_approximation_2)
integer_2 = Integer(division_8)
integer_3 = Integer(division_6)
integer_4 = Integer(division_7)
integer_5 = Integer(division_5)
integer_6 = Integer(division_4)
integer_7 = Integer(total_area_approximation_3)
integer_8 = Integer(division_13)
integer_9 = Integer(division_11)
integer_10 = Integer(total_area_approximation)
integer_11 = Integer(division_10)
integer_12 = Integer(division_12)
integer_13 = Integer(division_9)
integer_14 = Integer(division_18)
integer_15 = Integer(division_16)
integer_16 = Integer(division_15)
integer_17 = Integer(division_17)
integer_18 = Integer(division_14)
dressing_room = Panel(integer_6)
subsidiary_spaces = Panel(integer_3)
pool = Panel(integer_4)
hot_house_4 = Panel(integer_2)
corridors = Panel(integer_5)
dressing_room_2 = Panel(integer_13)
subsidiary_spaces_2 = Panel(integer_9)
pool_2 = Panel(integer_12)
hot_house_5 = Panel(integer_8)
corridors_2 = Panel(integer_11)
dressing_room_3 = Panel(integer_18)
subsidiary_spaces_3 = Panel(integer_15)
pool_3 = Panel(integer_17)
hot_house_6 = Panel(integer_14)
corridors_3 = Panel(integer_16)
mass_addition_13 = MassAddition(Input=[pool_2, corridors_2, dressing_room_2, hot_house_5, subsidiary_spaces_2])  # -> Result, PartialResults
mass_addition_14 = MassAddition(Input=[pool_3, corridors_3, dressing_room_3, hot_house_6, subsidiary_spaces_3])  # -> Result, PartialResults
mass_addition_15 = MassAddition(Input=[pool, corridors, dressing_room, hot_house_4, subsidiary_spaces])  # -> Result, PartialResults
text_tag_3d = TextTag3D(Location=PlaneXY(-75.74538005, 39.31837105, 0), Text=integer, Size=1, Justification=7)
text_tag_3d_2 = TextTag3D(Location=PlaneXY(-75.74538005, 27.61972902, 0), Text=corridors, Size=1, Justification=7)
text_tag_3d_3 = TextTag3D(Location=PlaneXY(-75.74538005, 18.33120086, 0), Text=dressing_room, Size=1, Justification=7)
text_tag_3d_4 = TextTag3D(Location=PlaneXY(-75.74538005, 10.20373873, 0), Text=hot_house_4, Size=1, Justification=7)
text_tag_3d_5 = TextTag3D(Location=PlaneXY(-75.74538005, -1.948752273, 0), Text=subsidiary_spaces, Size=1, Justification=7)
text_tag_3d_6 = TextTag3D(Location=PlaneXY(-75.74538005, -10.15361881, 0), Text=pool, Size=1, Justification=7)
text_tag_3d_7 = TextTag3D(Location=PlaneXY(-36.84692095, 39.65093795, 0), Text=integer_7, Size=1, Justification=7)
text_tag_3d_8 = TextTag3D(Location=PlaneXY(-36.84692095, 27.61972902, 0), Text=corridors_2, Size=1, Justification=7)
text_tag_3d_9 = TextTag3D(Location=PlaneXY(-36.84692095, 18.33120086, 0), Text=dressing_room_2, Size=1, Justification=7)
text_tag_3d_10 = TextTag3D(Location=PlaneXY(-36.84692095, 10.20373873, 0), Text=hot_house_5, Size=1, Justification=7)
text_tag_3d_11 = TextTag3D(Location=PlaneXY(-36.84692095, -1.948752273, 0), Text=subsidiary_spaces_2, Size=1, Justification=7)
text_tag_3d_12 = TextTag3D(Location=PlaneXY(-36.84692095, -10.15361881, 0), Text=pool_2, Size=1, Justification=7)
text_tag_3d_13 = TextTag3D(Location=PlaneXY(-16.45457883, 39.83844498, 0), Text=integer_10, Size=1, Justification=7)
text_tag_3d_14 = TextTag3D(Location=PlaneXY(-16.48956342, 27.61972902, 0), Text=corridors_3, Size=1, Justification=7)
text_tag_3d_15 = TextTag3D(Location=PlaneXY(-16.48956342, 18.33120086, 0), Text=dressing_room_3, Size=1, Justification=7)
text_tag_3d_16 = TextTag3D(Location=PlaneXY(-16.48956342, 10.20373873, 0), Text=hot_house_6, Size=1, Justification=7)
text_tag_3d_17 = TextTag3D(Location=PlaneXY(-16.48956342, -1.948752273, 0), Text=subsidiary_spaces_3, Size=1, Justification=7)
text_tag_3d_18 = TextTag3D(Location=PlaneXY(-16.48956342, -10.15361881, 0), Text=pool_3, Size=1, Justification=7)
control_panel_100 = Panel(mass_addition_13.Result)
control_panel_100_2 = Panel(mass_addition_15.Result)
control_panel_100_3 = Panel(mass_addition_14.Result)

# ---- group: reqired % per room
equipment_room = Slider(10, range=0..100)
care_room = Slider(15, range=0..100)
storage_room = Slider(4, range=0..100)
washing = Slider(10, range=0..10)
common_room = Slider(45, range=0..100)
group_room = Slider(16, range=0..100)

# ----
hamam_rooms = Panel("""hamam_hall
hamam_dressing room
hamam_hot house
hamam_sub1_tea
hamam_sub2_cleaning
hamam_sub3_tech
hamam_sub4_water tanks
hamam_sub5_private washing room
hamam_sub6_hot pool
hamam_sub7_cold pool
hamam_sub8_wc""")
washing_facility_rooms = Panel("""entrance
reception
washing (female)
washing (male)""")
childcare_rooms = Panel("""childcare_washing
childcare_common room
childcare_group room
childcare_care room
childcare_equipement
childcare_storage room""")
garden_spaces = Panel("""garden + agora
garden wc""")
number_slider = Slider(0.4, range=0..1)
point = Point([<point referenced from the Rhino model> x4])
point_2 = Point([<point referenced from the Rhino model> x6])
point_3 = Point([<point referenced from the Rhino model> x2])
point_4 = Point([<point referenced from the Rhino model> x11])

# ---- group: text lable modified bubble
text_tag_3d_19 = TextTag3D(Location=point_3, Text=garden_spaces, Size=number_slider, Justification=7)
text_tag_3d_20 = TextTag3D(Location=point, Text=washing_facility_rooms, Size=number_slider, Justification=7)
text_tag_3d_21 = TextTag3D(Location=point_4, Text=hamam_rooms, Size=number_slider, Justification=7)
text_tag_3d_22 = TextTag3D(Location=point_2, Text=childcare_rooms, Size=number_slider, Justification=7)

# ----
vector_xyz = VectorXYZ(XComponent=Slider(-100, range=-100..100), YComponent=0, ZComponent=0)  # -> Vector, Length
rectangle = Rectangle({Plane=PlaneXY(232.8210215, -0.8918817956, 0), Size=Domain2(u=-13.91437246..13.91437246, v=-3.384213755..3.384213755)})
rectangle_2 = Rectangle({Plane=PlaneXY(232.8210215, 18.62736326, 0), Size=Domain2(u=-13.91437246..13.91437246, v=-16.1350313..16.1350313)})

# ---- group: Garineh Kohne Hamam
surface_20 = Surface([<surface referenced from the Rhino model> x8])
surface_21 = Surface(<surface referenced from the Rhino model>)
surface_22 = Surface(<surface referenced from the Rhino model>)
surface_23 = Surface([<surface referenced from the Rhino model> x2])
surface_24 = Surface([<surface referenced from the Rhino model> x13])
area_20 = Area(Geometry=surface_20)  # -> Area, Centroid
area_21 = Area(Geometry=surface_21)  # -> Area, Centroid
area_22 = Area(Geometry=surface_22)  # -> Area, Centroid
area_23 = Area(Geometry=surface_23)  # -> Area, Centroid
# Autor: Maximilian Mandat , Noah van den Berg
area_24 = Area(Geometry=surface_24)  # -> Area, Centroid
mass_addition_16 = MassAddition(Input=area_20.Area)  # -> Result, PartialResults
mass_addition_17 = MassAddition(Input=area_24.Area)  # -> Result, PartialResults
area_subsidiary_spaces_7 = Panel(mass_addition_16.Result)
area_subsidiary_spaces_8 = Panel(area_22.Area)
total_area_approximation_4 = Panel(mass_addition_17.Result)

# ----
mass_addition_18 = MassAddition(Input=area_21.Area)  # -> Result, PartialResults
mass_addition_19 = MassAddition(Input=area_23.Area)  # -> Result, PartialResults

# ---- group: Garineh Kohne Hamam (continued)
hot_house_7 = Panel(mass_addition_18.Result)
area_corridors_6 = Panel(mass_addition_19.Result)
mass_addition_20 = MassAddition(Input=[hot_house_7, area_corridors_6, area_subsidiary_spaces_6, area_subsidiary_spaces_7, area_subsidiary_spaces_8])  # -> Result, PartialResults
controll_as_total_a = Panel(mass_addition_20.Result)

# ----
division_19 = Division(A=total_area_approximation_4, B=Slider(100, range=0..100))
division_20 = Division(A=area_subsidiary_spaces_6, B=division_19)
division_21 = Division(A=area_corridors_6, B=division_19)
division_22 = Division(A=hot_house_7, B=division_19)
division_23 = Division(A=area_subsidiary_spaces_8, B=division_19)
division_24 = Division(A=area_subsidiary_spaces_7, B=division_19)
integer_19 = Integer(total_area_approximation_4)
integer_20 = Integer(division_22)
integer_21 = Integer(division_24)
integer_22 = Integer(division_23)
integer_23 = Integer(division_21)
integer_24 = Integer(division_20)
hot_house_8 = Panel(integer_20)
pool_4 = Panel(integer_22)
dressing_room_4 = Panel(integer_24)
subsidiary_area = Panel(integer_21)
corridors_4 = Panel(integer_23)
mass_addition_21 = MassAddition(Input=[corridors_4, dressing_room_4, hot_house_8, pool_4, subsidiary_area])  # -> Result, PartialResults
text_tag_3d_23 = TextTag3D(Location=PlaneXY(-95.97697236, 40.41120882, 0), Text=integer_19, Size=1, Justification=7)
text_tag_3d_24 = TextTag3D(Location=PlaneXY(-96.00219969, 18.35481872, 0), Text=dressing_room_4, Size=1, Justification=7)
text_tag_3d_25 = TextTag3D(Location=PlaneXY(-96.0652568, 27.64250975, 0), Text=corridors_4, Size=1, Justification=7)
text_tag_3d_26 = TextTag3D(Location=PlaneXY(-95.94132578, 10.20465499, 0), Text=hot_house_8, Size=1, Justification=7)
text_tag_3d_27 = TextTag3D(Location=PlaneXY(-95.94132578, -1.718153194, 0), Text=subsidiary_area, Size=1, Justification=7)
text_tag_3d_28 = TextTag3D(Location=PlaneXY(-95.94132578, -10.209288, 0), Text=pool_4, Size=1, Justification=7)
control_panel_100_4 = Panel(mass_addition_21.Result)

# ---- group: Dorod Hamam
surface_25 = Surface([<surface referenced from the Rhino model> x11])
surface_26 = Surface([<surface referenced from the Rhino model> x10])
surface_27 = Surface(<surface referenced from the Rhino model>)
surface_28 = Surface(<surface referenced from the Rhino model>)
surface_29 = Surface(<surface referenced from the Rhino model>)
surface_30 = Surface([<surface referenced from the Rhino model> x24])
area_25 = Area(Geometry=surface_25)  # -> Area, Centroid
area_26 = Area(Geometry=surface_26)  # -> Area, Centroid
area_27 = Area(Geometry=surface_27)  # -> Area, Centroid
area_28 = Area(Geometry=surface_28)  # -> Area, Centroid
area_29 = Area(Geometry=surface_29)  # -> Area, Centroid
area_30 = Area(Geometry=surface_30)  # -> Area, Centroid
mass_addition_22 = MassAddition(Input=area_26.Area)  # -> Result, PartialResults
mass_addition_23 = MassAddition(Input=area_25.Area)  # -> Result, PartialResults
mass_addition_24 = MassAddition(Input=area_30.Area)  # -> Result, PartialResults
total_area_approximation_5 = Panel(mass_addition_24.Result)

# ----
area_corridors_7 = Panel(mass_addition_22.Result)
hot_house_9 = Panel(area_28.Area)
area_subsidiary_spaces_9 = Panel(mass_addition_23.Result)
area_dressing_room_2 = Panel(area_27.Area)
area_pool_2 = Panel(area_29.Area)

# ---- group: Dorod Hamam (continued)
mass_addition_25 = MassAddition(Input=[area_corridors_7, area_dressing_room_2, hot_house_9, area_subsidiary_spaces_9, area_pool_2])  # -> Result, PartialResults
contr_4 = Panel(mass_addition_25.Result)

# ----
division_25 = Division(A=total_area_approximation_5, B=Slider(100, range=0..100))
division_26 = Division(A=area_dressing_room_2, B=division_25)
division_27 = Division(A=area_corridors_7, B=division_25)
division_28 = Division(A=area_subsidiary_spaces_9, B=division_25)
division_29 = Division(A=area_pool_2, B=division_25)
division_30 = Division(A=hot_house_9, B=division_25)
integer_25 = Integer(total_area_approximation_5)
integer_26 = Integer(division_30)
integer_27 = Integer(division_28)
integer_28 = Integer(division_27)
integer_29 = Integer(division_29)
integer_30 = Integer(division_26)
dressing_room_5 = Panel(integer_30)
subsidiary_spaces_4 = Panel(integer_27)
pool_5 = Panel(integer_29)
hot_house_10 = Panel(integer_26)
corridors_5 = Panel(integer_28)
mass_addition_26 = MassAddition(Input=[pool_5, corridors_5, dressing_room_5, hot_house_10, subsidiary_spaces_4])  # -> Result, PartialResults
text_tag_3d_29 = TextTag3D(Location=PlaneXY(-54.90794792, 39.69515848, 0), Text=integer_25, Size=1, Justification=7)
text_tag_3d_30 = TextTag3D(Location=PlaneXY(-54.90794792, 27.61972902, 0), Text=corridors_5, Size=1, Justification=7)
text_tag_3d_31 = TextTag3D(Location=PlaneXY(-54.90794792, 18.33120086, 0), Text=dressing_room_5, Size=1, Justification=7)
text_tag_3d_32 = TextTag3D(Location=PlaneXY(-54.90794792, 10.20373873, 0), Text=hot_house_10, Size=1, Justification=7)
text_tag_3d_33 = TextTag3D(Location=PlaneXY(-54.90794792, -1.948752273, 0), Text=subsidiary_spaces_4, Size=1, Justification=7)
text_tag_3d_34 = TextTag3D(Location=PlaneXY(-54.90794792, -10.15361881, 0), Text=pool_5, Size=1, Justification=7)
control_panel_100_5 = Panel(mass_addition_26.Result)

# ---- group: percentage for each function
mass_addition_27 = MassAddition(Input=[hot_house_10, hot_house_5, hot_house_6, hot_house_8, hot_house_4])  # -> Result, PartialResults
mass_addition_28 = MassAddition(Input=[corridors_4, corridors, corridors_5, corridors_2, corridors_3])  # -> Result, PartialResults
mass_addition_29 = MassAddition(Input=[dressing_room, dressing_room_4, dressing_room_5, dressing_room_2, dressing_room_3])  # -> Result, PartialResults
mass_addition_30 = MassAddition(Input=[pool_4, pool_5, pool_2, pool_3, pool])  # -> Result, PartialResults
mass_addition_31 = MassAddition(Input=[subsidiary_area, subsidiary_spaces_4, subsidiary_spaces_2, subsidiary_spaces_3, subsidiary_spaces])  # -> Result, PartialResults
division_31 = Division(A=mass_addition_28.Result, B=Slider(5, range=0..10))
division_32 = Division(A=mass_addition_31.Result, B=Slider(5, range=0..10))
division_33 = Division(A=mass_addition_30.Result, B=Slider(5, range=0..10))
division_34 = Division(A=mass_addition_29.Result, B=Slider(5, range=0..10))
division_35 = Division(A=mass_addition_27.Result, B=Slider(5, range=0..10))
integer_31 = Integer(division_31)
integer_32 = Integer(division_32)
integer_33 = Integer(division_34)
integer_34 = Integer(division_33)
integer_35 = Integer(division_35)
subsidiary_rooms = Panel(integer_32)
pools = Panel(integer_34)
corridors_6 = Panel(integer_31)
dressing_room_6 = Panel(integer_33)
hot_house_11 = Panel(integer_35)
mass_addition_32 = MassAddition(Input=[corridors_6, dressing_room_6, hot_house_11, subsidiary_rooms, pools])  # -> Result, PartialResults
text_tag_3d_35 = TextTag3D(Location=PlaneXY(-5.476028541, 18.28608774, 0), Text=dressing_room_6, Size=1, Justification=7)
text_tag_3d_36 = TextTag3D(Location=PlaneXY(-5.476028541, -2.021553709, 0), Text=subsidiary_rooms, Size=1, Justification=7)
text_tag_3d_37 = TextTag3D(Location=PlaneXY(-5.476028541, 10.16340365, 0), Text=hot_house_11, Size=1, Justification=7)
text_tag_3d_38 = TextTag3D(Location=PlaneXY(-5.476028541, -10.52648175, 0), Text=pools, Size=1, Justification=7)
text_tag_3d_39 = TextTag3D(Location=PlaneXY(-5.476028541, 27.55550369, 0), Text=corridors_6, Size=1, Justification=7)
integer_36 = Integer(mass_addition_32.Result)
controll_100 = Panel(integer_36)

# ---- group: average number of room for subsidiary spaces
panel = Panel(surface_16)
panel_2 = Panel(surface_3)
panel_3 = Panel(surface_9)
panel_4 = Panel(surface_25)
panel_5 = Panel(surface_20)
list_length = ListLength(List=panel_2)
list_length_2 = ListLength(List=panel)
list_length_3 = ListLength(List=panel_3)
list_length_4 = ListLength(List=panel_4)
list_length_5 = ListLength(List=panel_5)
mass_addition_33 = MassAddition(Input=[list_length_5, list_length_3, list_length_4, list_length_2, list_length])  # -> Result, PartialResults
division_36 = Division(A=mass_addition_33.Result, B=5)
integer_37 = Integer(division_36)
average_number_of_subsidiary_rooms = Panel(integer_37)

# ----
subst_2_room_cattle_and_fire = Subtraction(A=average_number_of_subsidiary_rooms, B=Slider(2, range=0..10))

# ---- group: hamam size calculation
pop_over_12_years = Slider(0.6, range=0..1)
person_hour = Slider(30, range=0..100)
population_district = Panel("""0
6105
6812
4474
4162
5087
6714
6197
7993
4602
5943
7582
5557""")
example_hamam_m2 = Panel("400")
multiplication = Multiplication(A=population_district, B=pop_over_12_years)
division_37 = Division(A=example_hamam_m2, B=person_hour)
integer_38 = Integer(multiplication)
pers_m2_week = Slider(10.5, range=0..100)
hamam_visitors_district = Panel(integer_38)
division_38 = Division(A=multiplication, B=pers_m2_week)
integer_39 = Integer(division_38)
m2_hamam = Panel(integer_39)
_1_employee_100m2 = Slider(100, range=0..100)
required_m2_person_hour = Panel(division_37)
estimated_bathing_duration = Slider(3, range=0..10)

# ---- group: daycare size estimation
amount_of_chuildren_brought = Slider(2, range=0..10)
m2_child = Slider(2, range=1.5..4)

# ---- group: garden calc
m_hallway_width = Slider(2, range=0..10)
wc_unit_size = Slider(4.5, range=0..10)
wc_units = Slider(3, range=0..10)
multiplication_2 = Multiplication(A=wc_units, B=wc_unit_size)

# ---- group: shower facility/entrance calculation
m2_4_5 = Number(4.5)
width_of_segment_1_5 = Number(1.5)
width_of_entrance_1_5 = Number(3)

# ---- group: Entrance and washing facilities
m2_reception = Panel("12")

# ---- group: Garden complex
wc = Panel(multiplication_2)

# ---- group: programm od reqirements
room_names = Panel([washing_facility_rooms, garden_spaces, childcare_rooms, hamam_rooms])
district = Slider(10, range=1..12)

# ---- group: hamam size calculation (continued)
list_item = ListItem(List=m2_hamam, Index=district, Wrap=True)
m2_hamam_district = Panel(list_item)
division_39 = Division(A=m2_hamam_district, B=_1_employee_100m2)
division_40 = Division(A=m2_hamam_district, B=required_m2_person_hour)
integer_40 = Integer(division_39)
integer_41 = Integer(division_40)
persons_h = Panel(integer_41)
needed_employees = Panel(integer_40)
multiplication_3 = Multiplication(A=persons_h, B=estimated_bathing_duration)
simultaneously_visitors = Panel(multiplication_3)

# ---- group: daycare size estimation (continued)
multiplication_4 = Multiplication(A=simultaneously_visitors, B=0.3)
integer_42 = Integer(multiplication_4)
estimatet_parents_that_bring_their_child = Panel(integer_42)  # "estimatet parents that bring their children"
multiplication_5 = Multiplication(A=estimatet_parents_that_bring_their_child, B=amount_of_chuildren_brought)
multiplication_6 = Multiplication(A=multiplication_5, B=m2_child)
integer_43 = Integer(multiplication_6)
m2_required_daycare_size = Panel(integer_43)

# ---- group: shower facility/entrance calculation (continued)
size_shower_facility = Multiplication(A=m2_hamam_district, B=0.2)
wash_and_dressing_room_female_male = Multiplication(A=size_shower_facility, B=0.36)
integer_44 = Integer(wash_and_dressing_room_female_male)
m2_washing_male = Panel(integer_44)
m2_washing_female = Panel(integer_44)
division_41 = Division(A=m2_washing_female, B=m2_4_5)
round = Round(Number=division_41)  # -> Nearest, Floor, Ceiling
multiplication_7 = Multiplication(A=round.Ceiling, B=width_of_segment_1_5)
multiplication_8 = Multiplication(A=multiplication_7, B=width_of_entrance_1_5)
multiplication_9 = Multiplication(A=round.Ceiling, B=m2_4_5)

# ----
percentage = Division(A=m2_required_daycare_size, B=100)
multiplication_10 = Multiplication(A=percentage, B=care_room)
multiplication_11 = Multiplication(A=percentage, B=storage_room)
multiplication_12 = Multiplication(A=percentage, B=washing)
multiplication_13 = Multiplication(A=percentage, B=group_room)
multiplication_14 = Multiplication(A=percentage, B=equipment_room)
multiplication_15 = Multiplication(A=percentage, B=common_room)
integer_45 = Integer(multiplication_11)
integer_46 = Integer(multiplication_14)
integer_47 = Integer(multiplication_15)
integer_48 = Integer(multiplication_10)
integer_49 = Integer(multiplication_12)
integer_50 = Integer(multiplication_13)

# ---- group: child care
m2_child_washing = Panel(integer_49)
m2_child_common_room = Panel(integer_47)
m2_child_group_room = Panel(integer_50)
m2_child_care_room = Panel(integer_48)
m2_child_equipment = Panel(integer_46)
m2_child_storage_room = Panel(integer_45)

# ---- group: Entrance and washing facilities (continued)
washing_segments_female = Panel(round.Ceiling)
m2_washing_female_2 = Panel(multiplication_9)
m2_washing_male_2 = Panel(multiplication_9)
m2_entrance = Panel(multiplication_8)

# ----
m2_washing_facility = Panel([m2_entrance, m2_reception, m2_washing_female_2, m2_washing_male_2])
m2_child_care = Panel([m2_child_washing, m2_child_common_room, m2_child_group_room, m2_child_care_room, m2_child_equipment, m2_child_storage_room])
mass_addition_34 = MassAddition(Input=m2_child_care)  # -> Result, PartialResults
mass_addition_35 = MassAddition(Input=m2_washing_facility)  # -> Result, PartialResults
total_m2_washing_facility = Panel(mass_addition_35.Result)
total_m2_childcare = Panel(mass_addition_34.Result)

# ---- group: calculation m2 /hamam function
m2_hamam_100 = Division(A=list_item, B=100)
multiplication_16 = Multiplication(A=m2_hamam_100, B=hot_house_11)
multiplication_17 = Multiplication(A=m2_hamam_100, B=corridors_6)
multiplication_18 = Multiplication(A=m2_hamam_100, B=dressing_room_6)
multiplication_19 = Multiplication(A=m2_hamam_100, B=pools)
multiplication_20 = Multiplication(A=m2_hamam_100, B=subsidiary_rooms)
m2_pools = Panel(multiplication_19)
mass_addition_36 = MassAddition(Input=[multiplication_18, multiplication_17, multiplication_16, multiplication_20, multiplication_19])  # -> Result, PartialResults
control_as_below = Panel(mass_addition_36.Result)
required_hamam_size = Panel(list_item)

# ----
integer_51 = Integer(m2_pools)
m2_pool = Panel(integer_51)
division_of_pool_surface_by_4 = Division(A=m2_pool, B=4)
addition_of_pool_4 = Addition(A=multiplication_16, B=division_of_pool_surface_by_4)
additionof_pool_4 = Addition(A=multiplication_20, B=division_of_pool_surface_by_4)
addition_of_pool_4_2 = Addition(A=multiplication_18, B=division_of_pool_surface_by_4)
addition_of_pool_4_3 = Addition(A=multiplication_17, B=division_of_pool_surface_by_4)

# ---- group: calculation m2 /hamam function (continued)
m2_subsidiary_rooms = Panel(additionof_pool_4)
m2_corridors = Panel(addition_of_pool_4_3)
m2_dressing_room = Panel(addition_of_pool_4_2)
m2_hot_house = Panel(addition_of_pool_4)

# ----
division_42 = Division(A=m2_subsidiary_rooms, B=subst_2_room_cattle_and_fire)
integer_52 = Integer(m2_corridors)
integer_53 = Integer(division_42)
integer_54 = Integer(m2_dressing_room)
integer_55 = Integer(m2_hot_house)
m2_per_subsidiary_space = Panel(integer_53)
m2_corridors_2 = Panel(integer_52)
m2_dressing_room_space = Panel(integer_54)
m2_hot_house_2 = Panel(integer_55)

# ---- group: m2 hamam rooms
m2_hamam_hall = Panel(m2_corridors_2)
m2_hamam_dressing_room = Panel(m2_dressing_room_space)
m2_sub2_cleaning = Panel(m2_per_subsidiary_space)
m2_sub3_tech = Panel(m2_per_subsidiary_space)
m2_sub4_water_tanks = Panel(m2_per_subsidiary_space)
m2_hamam_hot_house = Panel(m2_hot_house_2)
m2_sub8_wc = Panel(m2_per_subsidiary_space)
m2_sub1_tea = Panel(m2_per_subsidiary_space)
m2_sub5_private_washing_room = Panel(m2_per_subsidiary_space)
m2_sub6_hot_pool = Panel(m2_per_subsidiary_space)
m2_sub7_cold_pool = Panel(m2_per_subsidiary_space)

# ----
m2_washing_facility_2 = Panel([m2_hamam_hall, m2_hamam_dressing_room, m2_hamam_hot_house, m2_sub1_tea, m2_sub2_cleaning, m2_sub3_tech, m2_sub4_water_tanks, m2_sub5_private_washing_room, m2_sub6_hot_pool, m2_sub7_cold_pool, m2_sub8_wc])
mass_addition_37 = MassAddition(Input=m2_washing_facility_2)  # -> Result, PartialResults
total_m2_hamam = Panel(mass_addition_37.Result)
addition_for_garden_size = MassAddition(Input=[total_m2_childcare, total_m2_washing_facility, total_m2_hamam])  # -> Result, PartialResults
total_m2_all_rooms_m2_garden = Panel(addition_for_garden_size.Result)

# ---- group: garden calc (continued)
ghpython_script = GhPythonScript(x=total_m2_all_rooms_m2_garden)  # -> r
# ---------- ghpython_script: Python ----------
__author__ = "maxim"
__version__ = "2019.09.16"

import rhinoscriptsyntax as rs

import math

pi= 22/7
a=float(x)

def radiusOfCircle(x):
    r=(x/pi)**0.5
    return r
r=radiusOfCircle(a)
# ---------- end ghpython_script ----------
radius_1 = Panel(ghpython_script)
hallway_width_addition = Addition(A=radius_1, B=m_hallway_width)
surface_calculation_1 = GhPythonScript(x=hallway_width_addition)  # -> r
# ---------- surface_calculation_1: Python ----------
__author__ = "maxim"
__version__ = "2019.09.16"

import rhinoscriptsyntax as rs

import math

pi= 22/7
a=float(x)

def surfaceOfCircle(x):
    A=(x**2)*pi
    return A
r=int(surfaceOfCircle(a))
# ---------- end surface_calculation_1 ----------
surface_calculation_2 = GhPythonScript(x=ghpython_script)  # -> r
# ---------- surface_calculation_2: Python ----------
__author__ = "maxim"
__version__ = "2019.09.16"

import rhinoscriptsyntax as rs

import math

pi= 22/7
a=float(x)

def surfaceOfCircle(x):
    A=(x**2)*pi
    return A
r=surfaceOfCircle(a)
# ---------- end surface_calculation_2 ----------
panel_6 = Panel(surface_calculation_1)
m2_garden = Panel(surface_calculation_2)
subtraction = Subtraction(A=panel_6, B=m2_garden)
m2_agora = Panel(subtraction)

# ----
multiplication_21 = Multiplication(A=panel_6, B=Slider(0.7, range=0..1))

# ---- group: Garden complex (continued)
m2_agora_2 = Panel(m2_agora)
m2_garden_2 = Panel(m2_garden)
combination_garden_agora = Panel(multiplication_21)

# ----
m2_washing_facility_3 = Panel([combination_garden_agora, wc])
mass_addition_38 = MassAddition(Input=m2_washing_facility_3)  # -> Result, PartialResults
total_m2_garden_complex = Panel(mass_addition_38.Result)

# ---- group: programm od reqirements (continued)
room_sizes = Panel([m2_washing_facility, m2_washing_facility_3, m2_child_care, m2_washing_facility_2])
mass_addition_39 = MassAddition(Input=room_sizes)  # -> Result, PartialResults
total_m2_washing_facility_2 = Panel(mass_addition_35.Result)
total_m2_childcare_2 = Panel(mass_addition_34.Result)
total_m2_hamam_2 = Panel(mass_addition_37.Result)

# ----
integer_56 = Integer(mass_addition_39.Result)

# ---- group: programm od reqirements (continued)
total_area = Panel(integer_56)

# ----
point_5 = Point([<point referenced from the Rhino model> x23])
curve = Curve([<curve referenced from the Rhino model> x25])
graphfromnodes_links = GraphFromNodesLinks(Points=point_5, Links=curve, Labels=room_names, Areas=room_sizes, TotalArea=total_area)  # -> Graph, GraphVertices, Attributes
attribute = Data(graphfromnodes_links.Attributes)
graph = Data(graphfromnodes_links.Graph)
forcedirecteddrawing = ForceDirectedDrawing(
    Graph=graphfromnodes_links.Graph,
    Vertices=graphfromnodes_links.GraphVertices,
    Attributes=graphfromnodes_links.Attributes,
    AttractionStrength=0.25,
    RepulsionStrength=1.4,
    ConvergenceTolearnce=0.001,
    MaximumIterations=4000,
    Active=Toggle(True))  # -> NewGraphVertices, IterationCount
programme = Programme(Attributes=graphfromnodes_links.Attributes)  # -> Tags, Areas, Colors, Legends
piechart = PieChart(Plane=PlaneXY(45.00544629, -89.90741247, 0), Attributes=graphfromnodes_links.Attributes, Radius=Slider(19, range=0..50))
integration_analysis = IntegrationAnalysis(Graph=graph, Attributes=attribute)  # -> DepthTable, DepthMap, RelativeASymetry, Integration, IntegrationRelativeColors, IntegrationTags
control_analysis = ControlAnalysis(Graph=graph, Attributes=attribute)  # -> Control, ControlRelativeColors, ControlTags
choice_analysis = ChoiceAnalysis(Graph=graph, Attributes=attribute)  # -> ShortestPaths, ChoiceBetweenness, ChoiceRelativeColors, ChoiceTags
entropy_analysis = EntropyAnalysis(Graph=graph, Attributes=attribute, DepthTable=integration_analysis.DepthTable, DepthMap=integration_analysis.DepthMap)  # -> Entropy, EntropyRelativeColors, EntropyTags
panel_7 = Panel(choice_analysis.ShortestPaths)
diskographdrawing = DiskoGraphDrawing(
    Plane=Plane(origin=(-49.8886526, -105.3946923, 0), x=(0.9997026906, 0.02438299245, 0), y=(-0.02438299245, 0.9997026906, 0)),
    Graph=graphfromnodes_links.Graph,
    Vertices=forcedirecteddrawing.NewGraphVertices,
    Attributes=graphfromnodes_links.Attributes,
    Thickness=Slider(6, range=0..10))
differencefactor = DifferenceFactor(RelativeAsymetries=integration_analysis.RelativeASymetry)
sort_list = SortList(
    Keys=integration_analysis.Integration,
    ValuesA=integration_analysis.IntegrationRelativeColors,
    ValuesB=integration_analysis.IntegrationTags)  # -> Keys, ValuesA, ValuesB
sort_list_2 = SortList(Keys=control_analysis.Control, ValuesA=control_analysis.ControlRelativeColors, ValuesB=control_analysis.ControlTags)  # -> Keys, ValuesA, ValuesB
insert_items = InsertItems(List=programme.Areas, Item=total_area, Indices=-1, Wrap=True)
sort_list_3 = SortList(Keys=choice_analysis.ChoiceBetweenness, ValuesA=choice_analysis.ChoiceRelativeColors, ValuesB=choice_analysis.ChoiceTags)  # -> Keys, ValuesA, ValuesB
panel_8 = Panel(insert_items)
sort_list_4 = SortList(Keys=entropy_analysis.Entropy, ValuesA=entropy_analysis.EntropyRelativeColors, ValuesB=entropy_analysis.EntropyTags)  # -> Keys, ValuesA, ValuesB
rectangle_3 = Rectangle({Plane=PlaneXY(101.4407922, 18.75221073, 0), Size=Domain2(u=-14.02555911..14.02555911, v=-16.09343001..16.09343001)})
rectangle_4 = Rectangle({Plane=PlaneXY(168.3319203, 18.75221073, 0), Size=Domain2(u=-14.02555911..14.02555911, v=-16.09343001..16.09343001)})
rectangle_5 = Rectangle({Plane=PlaneXY(134.8863563, 18.75221073, 0), Size=Domain2(u=-14.02555911..14.02555911, v=-16.09343001..16.09343001)})
rectangle_6 = Rectangle({Plane=PlaneXY(201.7774844, 18.75221073, 0), Size=Domain2(u=-14.02555911..14.02555911, v=-16.09343001..16.09343001)})
legend = Legend(Colour=programme.Colors, Tags=programme.Legends, Rectangle=rectangle_2, LegendType=1)
legend_2 = Legend(Colour=RGB(255, 255, 255), Tags=total_area, Rectangle=rectangle, LegendType=1)
legend_3 = Legend(Colour=sort_list.ValuesA, Tags=sort_list.ValuesB, Rectangle=rectangle_3, LegendType=1)
legend_4 = Legend(Colour=sort_list_4.ValuesA, Tags=sort_list_4.ValuesB, Rectangle=rectangle_4, LegendType=1)
legend_5 = Legend(Colour=sort_list_2.ValuesA, Tags=sort_list_2.ValuesB, Rectangle=rectangle_5, LegendType=1)
legend_6 = Legend(Colour=sort_list_3.ValuesA, Tags=sort_list_3.ValuesB, Rectangle=rectangle_6, LegendType=1)
panel_9 = Panel(differencefactor)
justifiedgraphdrawing = JustifiedGraphDrawing(
    ViewPointIndex=Slider(0, range=0..30),
    Plane=PlaneXY(2.444256699, 105.0500925, 0),
    Size=Slider(9, range=0..30),
    Thickness=Slider(2, range=0..30),
    Graph=graph,
    Attributes=attribute,
    DepthTable=integration_analysis.DepthTable)

panel_10 = Panel(forcedirecteddrawing.NewGraphVertices)
ghpython_script_2 = GhPythonScript(x=room_sizes)  # -> r; same code as ghpython_script
radius_1_2 = Panel(ghpython_script_2)
point_6 = Point(panel_10)
circle = Circle(Plane=point_6, Radius=radius_1_2)
move = Move(Geometry=[circle, point_6], Motion=vector_xyz.Vector)  # -> Geometry, Transform
