# Grasshopper definition karamba script.gh (Grasshopper 1.0.7)
# plug-ins: Karamba, Heteroptera, Weaverbird, Kangaroo2 Components

license = LicenseKaramba3D()

coefficient_of_thermal_expansion = Panel("2.0e-6")
density_kg_m3 = Panel("1520")
# Karamba script
# by: Noah
# material properties
youngs_modulus_mpa = Panel("76")
compressive_strength_mpa = Panel("1.27")

vault_support_lines = Curve([<curve referenced from the Rhino model> x14])
anchor_point = Point([<point referenced from the Rhino model> x231])
dome_2 = Mesh(<mesh referenced from the Rhino model>)
# input geometry
stoa = Mesh(<mesh referenced from the Rhino model>)
vaults = Mesh([<mesh referenced from the Rhino model> x9])
dome_1 = Mesh(<mesh referenced from the Rhino model>)
dome_3 = Mesh(<mesh referenced from the Rhino model>)
dome_4 = Mesh(<mesh referenced from the Rhino model>)
walls = Mesh(<mesh referenced from the Rhino model>)

division = Division(A=compressive_strength_mpa, B=5)

# ----
# conversion
division_2 = Division(A=youngs_modulus_mpa, _10=10)
division_3 = Division(A=compressive_strength_mpa, _10=10)
division_4 = Division(A=density_kg_m3, B=100)

# ----
# Karamba material input
panel = Panel("Concrete")
division_5 = Division(A=division_2, B=2.5)
matprops = MaterialPropertiesKaramba3D(
    FamilyOfMaterial=panel,
    Name="adobe",
    YoungsModulus_kN_cm2=division_2,
    InPlaneShearModulus_kN_cm2=division_5,
    TransverseShearModulus_kN_cm2=division_5,
    SpecificWeight_kN_m3=division_4,
    CoefficientOfThermalExpansion_1_C=coefficient_of_thermal_expansion,
    YieldStrength_kN_cm2=division_3,
    mode="Isotrop")

material_properties = Data(matprops)

stoa_2 = Mesh(stoa)
wbjoin = WeaverbirdsJoinMeshesAndWeld(Mesh=stoa_2, Weld=Toggle(True))
clean = CombineClean(Meshes=wbjoin)

stoa_3 = Mesh(stoa)  # disabled

# ---- group: Stoa
toggle = BooleanToggle(True)  # disabled
wbjoin_2 = WeaverbirdsJoinMeshesAndWeld(Mesh=stoa_3, Weld=toggle)  # disabled
pt = Point([<point referenced from the Rhino model> x231])  # disabled
clean_2 = CombineClean(Meshes=wbjoin_2)  # disabled
nv = NakedVertices(Mesh=clean_2)  # -> ClothedIndex, NakedIndex, ClothedPts, NakedPts; disabled
panel_2 = Panel("Shell")  # disabled
medges = MeshEdges(Mesh=clean_2)  # -> NakedEdges, InteriorEdges, NonManifoldEdges; disabled
material_properties_2 = Data(material_properties)  # disabled
join = JoinCurves(Curves=medges.NakedEdges, Preserve=False)  # disabled
panel_3 = Panel("20")  # disabled
item = ListItem(List=join, Index=0, Wrap=True)  # disabled
panel_4 = Panel("S")  # disabled
panel_5 = Panel("S")  # disabled
pull = PullPoint(Point=nv.NakedPts, Geometry=item, ClosestOnly=True)  # -> ClosestPoint, Distance; disabled
cross_section = CrossSectionKaramba3D(
    FamilyNameOfCrossSection=panel_2,
    ElementIdentifier=panel_4,
    Material=material_properties_2,
    Height_cm=panel_3,
    mode="Shell - Const")  # disabled
meshtoshell = MeshToShellKaramba3D(Mesh=clean_2, Identifier=panel_5, CrossSection=cross_section, LimitDistance_m=0.005)  # -> Element, Points, Info; disabled
pull_2 = PullPoint(Point=[pt, pull.ClosestPoint], Geometry=meshtoshell.Points, ClosestOnly=True)  # -> flatten(ClosestPoint), Distance; disabled
panel_6 = Panel("-1.5")  # disabled
duppt = RemoveDuplicatePts(Points=pull_2.ClosestPoint, Tolerance=0.01)  # disabled
Z = UnitZ(Factor=panel_6)  # disabled
supp = SupportKaramba3D(PosInd=duppt, menu=[buttons(on, on, on, off, off, off)])  # disabled
loads = LoadsKaramba3D(Vector=Z, Mesh=clean_2, LCase=0, mode="MeshLoad -Const.", menu=[buttons(off, on, off), buttons(on, on)])  # disabled
loads_2 = LoadsKaramba3D(Vector=Vector(0, 0, -1), LCase=0, mode="Gravity")  # disabled
assemble = AssembleModelKaramba3D(Elem=meshtoshell.Element, Support=supp, Load=flatten([loads_2, loads]), LimitDistance_m=0.005)  # -> Model, Info, Mass_kg, CenterOfGravity; disabled
analyzenonlin_wip = AnalyzeNonlinearWIPKaramba3D(
    Model=assemble.Model,
    NumberOfLoadSteps=1,
    NumberOfLoadIncrements=5,
    MaxNumberOfEquilibriumIterations=50,
    EquilibriumTolerance=1e-07,
    MaxNumberOfLimitLoadIterations=50,
    LimitLoadTolerance=0.01,
    mode="NewtonRaphson")  # -> CalculatedModel, MaximumDisplacement_cm, ElasticEnergy_kNm, Info, Lambdas; disabled
modelview = ModelViewKaramba3D(Model=analyzenonlin_wip.CalculatedModel, LoadCaseFactorsForLinearSuperposition=1, IndexOfVisibleLoadcase=-1)  # -> Model, DeformedMesh, DeformedAxes, DeformedModel; disabled
shellview = ShellViewKaramba3D(Model=modelview.Model, IndexOfLayer=0)  # -> Model, MeshesOfRenderedShells, LegendColors, LegendTags; disabled
shellview_2 = ShellViewKaramba3D(Model=modelview.Model, IndexOfLayer=0)  # -> Model, MeshesOfRenderedShells, LegendColors, LegendTags; disabled
shellview_3 = ShellViewKaramba3D(Model=modelview.Model, IndexOfLayer=0)  # -> Model, MeshesOfRenderedShells, LegendColors, LegendTags; disabled
legend = Legend(Colour=shellview_2.LegendColors, Tags=shellview_2.LegendTags, LegendType=1)  # disabled
legend_2 = Legend(Colour=shellview.LegendColors, Tags=shellview.LegendTags, LegendType=1)  # disabled
legend_3 = Legend(Colour=shellview_3.LegendColors, Tags=shellview_3.LegendTags, LegendType=1)  # disabled

# ----
material_properties_3 = Data(material_properties)
range = Range(Domain="20 to 80", Steps="12")
expression = Expression(x="Shell", y=range, Expression="x&\" \"&y")
cross_section_2 = CrossSectionKaramba3D(
    FamilyNameOfCrossSection="Shell",
    NameOfCrossSection=flatten(expression),
    ElementIdentifier="S",
    Material=material_properties_3,
    Height_cm=flatten(range),
    mode="Shell - Const")

corner_points_for_added_force = Point([<point referenced from the Rhino model> x32])  # disabled

Z_2 = UnitZ(Factor="-1.5")
loads_3 = LoadsKaramba3D(Vector=Z_2, Mesh=clean, LCase=0, mode="MeshLoad -Const.", menu=[buttons(off, on, off), buttons(on, on)])
loads_4 = LoadsKaramba3D(Vector=Vector(0, 0, -1), LCase=0, mode="Gravity")

dom = ConstructDomain(DomainStart=1, DomainEnd=17)  # disabled
dom_2 = ConstructDomain(DomainStart=1, DomainEnd=17)  # disabled
subset = SubList(List=shellview.LegendTags, Domain=dom, Wrap=True)  # -> List, Index
subset_2 = SubList(List=shellview_3.LegendTags, Domain=dom_2, Wrap=True)  # -> List, Index
multiplication = Multiplication(A=subset.List, _10=10)
multiplication_2 = Multiplication(A=subset_2.List, _10=10)
extremums = MinMax(Number=multiplication)  # -> expr("-x", Minimum), Maximum
extremums_2 = MinMax(Number=multiplication_2)  # -> expr("-x", Minimum), Maximum
maximal_allowed_tensile_stress_mpa = Panel(division)

# ----
# Maximum compressive stress [MPa]
panel_7 = Panel(extremums.Minimum)

# ----
# Maximum tensile stress [MPa]
panel_8 = Panel(extremums.Maximum)

# ----
# Maximum compressive stress [MPa]
panel_9 = Panel(extremums_2.Minimum)

# ----
# Maximum tensile stress [MPa]
panel_10 = Panel(extremums_2.Maximum)

dome_3_2 = Mesh(dome_3)  # disabled
dome_1_2 = Mesh(dome_1)  # disabled
dome_2_2 = Mesh(dome_2)  # disabled
dome_4_2 = Mesh(dome_4)  # disabled
dom_3 = ConstructDomain(DomainStart=1, DomainEnd=17)  # disabled
dom_4 = ConstructDomain(DomainStart=1, DomainEnd=17)  # disabled
dom_5 = ConstructDomain(DomainStart=1, DomainEnd=17)  # disabled
dom_6 = ConstructDomain(DomainStart=1, DomainEnd=17)  # disabled
dom_7 = ConstructDomain(DomainStart=1, DomainEnd=17)  # disabled
dom_8 = ConstructDomain(DomainStart=1, DomainEnd=17)  # disabled
dom_9 = ConstructDomain(DomainStart=1, DomainEnd=17)  # disabled
dom_10 = ConstructDomain(DomainStart=1, DomainEnd=17)  # disabled
vault_support_lines_2 = Curve(vault_support_lines)  # disabled
vaults_2 = Mesh(vaults)  # disabled

clean_3 = CombineClean(Meshes=vaults_2)  # disabled
medges_2 = MeshEdges(Mesh=clean_3)  # -> NakedEdges, InteriorEdges, NonManifoldEdges; disabled
nv_2 = NakedVertices(Mesh=clean_3)  # -> ClothedIndex, NakedIndex, ClothedPts, NakedPts; disabled
join_2 = JoinCurves(Curves=medges_2.NakedEdges, Preserve=False)  # disabled
material_properties_4 = Data(material_properties)  # disabled
pull_3 = PullPoint(Point=nv_2.NakedPts, Geometry=join_2, ClosestOnly=True)  # -> ClosestPoint, Distance; disabled
panel_11 = Panel("Shell")  # disabled
panel_12 = Panel("-1.5")  # disabled
Z_3 = UnitZ(Factor=panel_12)  # disabled
panel_13 = Panel("S")  # disabled
panel_14 = Panel("S")  # disabled
loads_5 = LoadsKaramba3D(Vector=Z_3, Mesh=clean_3, LCase=0, mode="MeshLoad -Const.", menu=[buttons(off, on, off), buttons(on, on)])  # disabled
loads_6 = LoadsKaramba3D(Vector=Vector(0, 0, -1), LCase=0, mode="Gravity")  # disabled
panel_15 = Panel("30")  # disabled
# Vaults
cross_section_3 = CrossSectionKaramba3D(
    FamilyNameOfCrossSection=panel_11,
    ElementIdentifier=panel_13,
    Material=material_properties_4,
    Height_cm=panel_15,
    mode="Shell - Const")  # disabled
meshtoshell_2 = MeshToShellKaramba3D(Mesh=graft(clean_3), Identifier=panel_14, CrossSection=cross_section_3, LimitDistance_m=0.005)  # -> Element, Points, Info; disabled
pull_4 = PullPoint(Point=meshtoshell_2.Points, Geometry=vault_support_lines_2, ClosestOnly=True)  # -> ClosestPoint, Distance; disabled
pull_5 = PullPoint(Point=[pull_3.ClosestPoint, pull_4.ClosestPoint], Geometry=meshtoshell_2.Points, ClosestOnly=True)  # -> flatten(ClosestPoint), Distance; disabled
duppt_2 = RemoveDuplicatePts(Points=pull_5.ClosestPoint, Tolerance=0.01)  # disabled
supp_2 = SupportKaramba3D(PosInd=duppt_2, menu=[buttons(on, on, on, off, off, off)])  # disabled
assemble_2 = AssembleModelKaramba3D(Elem=meshtoshell_2.Element, Support=supp_2, Load=flatten([loads_6, loads_5]), LimitDistance_m=0.005)  # -> Model, Info, Mass_kg, CenterOfGravity; disabled
analyzenonlin_wip_2 = AnalyzeNonlinearWIPKaramba3D(
    Model=assemble_2.Model,
    NumberOfLoadSteps=1,
    NumberOfLoadIncrements=5,
    MaxNumberOfEquilibriumIterations=50,
    EquilibriumTolerance=1e-07,
    MaxNumberOfLimitLoadIterations=50,
    LimitLoadTolerance=0.01,
    mode="NewtonRaphson")  # -> CalculatedModel, MaximumDisplacement_cm, ElasticEnergy_kNm, Info, Lambdas; disabled
modelview_2 = ModelViewKaramba3D(Model=analyzenonlin_wip_2.CalculatedModel, LoadCaseFactorsForLinearSuperposition=1, IndexOfVisibleLoadcase=-1)  # -> Model, DeformedMesh, DeformedAxes, DeformedModel; disabled
shellview_4 = ShellViewKaramba3D(Model=modelview_2.Model, IndexOfLayer=0)  # -> Model, MeshesOfRenderedShells, LegendColors, LegendTags; disabled
shellview_5 = ShellViewKaramba3D(Model=modelview_2.Model, IndexOfLayer=0)  # -> Model, MeshesOfRenderedShells, LegendColors, LegendTags; disabled
shellview_6 = ShellViewKaramba3D(Model=modelview_2.Model, IndexOfLayer=0)  # -> Model, MeshesOfRenderedShells, LegendColors, LegendTags; disabled
legend_4 = Legend(Colour=shellview_5.LegendColors, Tags=shellview_5.LegendTags, LegendType=1)  # disabled
legend_5 = Legend(Colour=shellview_4.LegendColors, Tags=shellview_4.LegendTags, LegendType=1)  # disabled
legend_6 = Legend(Colour=shellview_6.LegendColors, Tags=shellview_6.LegendTags, LegendType=1)  # disabled

dom_11 = ConstructDomain(DomainStart=1, DomainEnd=17)  # disabled
dom_12 = ConstructDomain(DomainStart=1, DomainEnd=17)  # disabled
subset_3 = SubList(List=shellview_4.LegendTags, Domain=dom_11, Wrap=True)  # -> List, Index; disabled
subset_4 = SubList(List=shellview_6.LegendTags, Domain=dom_12, Wrap=True)  # -> List, Index; disabled
multiplication_3 = Multiplication(A=subset_3.List, _10=10)  # disabled
multiplication_4 = Multiplication(A=subset_4.List, _10=10)  # disabled
extremums_3 = MinMax(Number=multiplication_3)  # -> expr("-x", Minimum), Maximum; disabled
extremums_4 = MinMax(Number=multiplication_4)  # -> expr("-x", Minimum), Maximum; disabled

# ----
# Maximum compressive stress [MPa]
panel_16 = Panel(extremums_3.Minimum)  # disabled

# ----
# Maximum tensile stress [MPa]
panel_17 = Panel(extremums_3.Maximum)  # disabled

# ----
# Maximum compressive stress [MPa]
panel_18 = Panel(extremums_4.Minimum)  # disabled

# ----
# Maximum tensile stress [MPa]
panel_19 = Panel(extremums_4.Maximum)  # disabled

anchor_point_2 = Point(anchor_point)
nv_3 = NakedVertices(Mesh=clean)  # -> ClothedIndex, NakedIndex, ClothedPts, NakedPts
medges_3 = MeshEdges(Mesh=clean)  # -> NakedEdges, InteriorEdges, NonManifoldEdges
join_3 = JoinCurves(Curves=medges_3.NakedEdges, Preserve=False)
item_2 = ListItem(List=join_3, Index=0, Wrap=True)
pull_6 = PullPoint(Point=nv_3.NakedPts, Geometry=item_2, ClosestOnly=True)  # -> ClosestPoint, Distance

meshtoshell_3 = MeshToShellKaramba3D(Mesh=clean, Identifier="S", CrossSection=cross_section_2, LimitDistance_m=0.005)  # -> Element, Points, Info

pull_7 = PullPoint(Point=[anchor_point_2, pull_6.ClosestPoint], Geometry=meshtoshell_3.Points, ClosestOnly=True)  # -> flatten(ClosestPoint), Distance
duppt_3 = RemoveDuplicatePts(Points=pull_7.ClosestPoint, Tolerance=0.01)

supp_3 = SupportKaramba3D(PosInd=duppt_3, menu=[buttons(on, on, on, off, off, off)])
assemble_3 = AssembleModelKaramba3D(Elem=meshtoshell_3.Element, Support=supp_3, Load=flatten([loads_4, loads_3]), LimitDistance_m=0.005)  # -> Model, Info, Mass_kg, CenterOfGravity
opticrosec = OptimizeCrossSectionKaramba3D(
    Model=assemble_3.Model,
    ElemIdentifiers="S",
    CrossSections=cross_section_2,
    MaximumUtilization="1",
    MaximumDisplacement_cm="0.5",
    UltimateLimitStateIterations=5,
    DisplacementIterations=5,
    NumberOfSamplePoints=3,
    ElasticDesign=True,
    GammaM0=1,
    GammaM1=1)  # -> ModelWithOptimizedCrossSections, Info, Mass_kg, MaximumDisplacement_cm, ElasticEnergy_kNm
analyzenonlin_wip_3 = AnalyzeNonlinearWIPKaramba3D(
    Model=opticrosec.ModelWithOptimizedCrossSections,
    NumberOfLoadSteps=1,
    NumberOfLoadIncrements=5,
    MaxNumberOfEquilibriumIterations=50,
    EquilibriumTolerance=1e-07,
    MaxNumberOfLimitLoadIterations=50,
    LimitLoadTolerance=0.01,
    mode="NewtonRaphson")  # -> CalculatedModel, MaximumDisplacement_cm, ElasticEnergy_kNm, Info, Lambdas
modelview_3 = ModelViewKaramba3D(Model=analyzenonlin_wip_3.CalculatedModel, LoadCaseFactorsForLinearSuperposition=1, IndexOfVisibleLoadcase=-1)  # -> Model, DeformedMesh, DeformedAxes, DeformedModel

# ----
# cross-section input
# Karamba analysis
# mesh cleaning
# anchor points
# loads
shellview_7 = ShellViewKaramba3D(Model=modelview_3.Model, IndexOfLayer=0)  # -> Model, MeshesOfRenderedShells, LegendColors, LegendTags
shellview_8 = ShellViewKaramba3D(Model=modelview_3.Model, IndexOfLayer=0)  # -> Model, MeshesOfRenderedShells, LegendColors, LegendTags
shellview_9 = ShellViewKaramba3D(Model=modelview_3.Model, IndexOfLayer=0)  # -> Model, MeshesOfRenderedShells, LegendColors, LegendTags
legend_7 = Legend(Colour=shellview_7.LegendColors, Tags=shellview_7.LegendTags, LegendType=1)
legend_8 = Legend(Colour=shellview_8.LegendColors, Tags=shellview_8.LegendTags, LegendType=1)
legend_9 = Legend(Colour=shellview_9.LegendColors, Tags=shellview_9.LegendTags, LegendType=1)
dom_13 = ConstructDomain(DomainStart=1, DomainEnd=17)
dom_14 = ConstructDomain(DomainStart=1, DomainEnd=17)
subset_5 = SubList(List=shellview_8.LegendTags, Domain=dom_13, Wrap=True)  # -> List, Index
subset_6 = SubList(List=shellview_7.LegendTags, Domain=dom_14, Wrap=True)  # -> List, Index
multiplication_5 = Multiplication(A=subset_5.List, _10=10)
multiplication_6 = Multiplication(A=subset_6.List, _10=10)
extremums_5 = MinMax(Number=multiplication_5)  # -> expr("-x", Minimum), Maximum
extremums_6 = MinMax(Number=multiplication_6)  # -> expr("-x", Minimum), Maximum

# ----
# Maximum compressive stress [MPa]
panel_20 = Panel(extremums_5.Minimum)

# ----
# Maximum tensile stress [MPa]
panel_21 = Panel(extremums_5.Maximum)

# ----
# Maximum compressive stress [MPa]
panel_22 = Panel(extremums_6.Minimum)

# ----
# Maximum tensile stress [MPa]
panel_23 = Panel(extremums_6.Maximum)

# ---- group: dome size 1
clean_4 = CombineClean(Meshes=dome_1_2)  # disabled
medges_4 = MeshEdges(Mesh=clean_4)  # -> NakedEdges, InteriorEdges, NonManifoldEdges; disabled
material_properties_5 = Data(material_properties)  # disabled
nv_4 = NakedVertices(Mesh=clean_4)  # -> ClothedIndex, NakedIndex, ClothedPts, NakedPts; disabled
join_4 = JoinCurves(Curves=medges_4.NakedEdges, Preserve=False)  # disabled
panel_24 = Panel("Shell")  # disabled
pull_8 = PullPoint(Point=nv_4.NakedPts, Geometry=join_4, ClosestOnly=True)  # -> ClosestPoint, Distance; disabled
panel_25 = Panel("-1.5")  # disabled
panel_26 = Panel("S")  # disabled
panel_27 = Panel("S")  # disabled
cross_section_4 = CrossSectionKaramba3D(
    FamilyNameOfCrossSection=panel_24,
    ElementIdentifier=panel_26,
    Material=material_properties_5,
    Height_cm="30",
    mode="Shell - Const")  # disabled
Z_4 = UnitZ(Factor=panel_25)  # disabled
meshtoshell_4 = MeshToShellKaramba3D(Mesh=clean_4, Identifier=panel_27, CrossSection=cross_section_4, LimitDistance_m=0.005)  # -> Element, Points, Info; disabled
pull_9 = PullPoint(Point=pull_8.ClosestPoint, Geometry=meshtoshell_4.Points, ClosestOnly=True)  # -> ClosestPoint, Distance; disabled
loads_7 = LoadsKaramba3D(Vector=Z_4, Mesh=clean_4, LCase=0, mode="MeshLoad -Const.", menu=[buttons(off, on, off), buttons(on, on)])  # disabled
loads_8 = LoadsKaramba3D(Vector=Vector(0, 0, -1), LCase=0, mode="Gravity")  # disabled

# ----
mc = MeshCorners(Mesh=clean_4, Angle=2.35619449)  # disabled
cull = CullPattern(List=pull_9.ClosestPoint, CullPattern=[True, False, False, True])  # disabled

# ---- group: dome size 1 (continued)
duppt_4 = RemoveDuplicatePts(Points=cull, Tolerance=0.01)  # disabled
supp_4 = SupportKaramba3D(PosInd=duppt_4, menu=[buttons(on, on, on, off, off, off)])  # disabled
assemble_4 = AssembleModelKaramba3D(Elem=meshtoshell_4.Element, Support=supp_4, Load=flatten([loads_8, loads_7]), LimitDistance_m=0.005)  # -> Model, Info, Mass_kg, CenterOfGravity; disabled
analyzenonlin_wip_4 = AnalyzeNonlinearWIPKaramba3D(
    Model=assemble_4.Model,
    NumberOfLoadSteps=1,
    NumberOfLoadIncrements=5,
    MaxNumberOfEquilibriumIterations=50,
    EquilibriumTolerance=1e-07,
    MaxNumberOfLimitLoadIterations=50,
    LimitLoadTolerance=0.01,
    mode="NewtonRaphson")  # -> CalculatedModel, MaximumDisplacement_cm, ElasticEnergy_kNm, Info, Lambdas; disabled
modelview_4 = ModelViewKaramba3D(Model=analyzenonlin_wip_4.CalculatedModel, LoadCaseFactorsForLinearSuperposition=1, IndexOfVisibleLoadcase=-1)  # -> Model, DeformedMesh, DeformedAxes, DeformedModel; disabled
shellview_10 = ShellViewKaramba3D(Model=modelview_4.Model, IndexOfLayer=0)  # -> Model, MeshesOfRenderedShells, LegendColors, LegendTags; disabled
shellview_11 = ShellViewKaramba3D(Model=modelview_4.Model, IndexOfLayer=0)  # -> Model, MeshesOfRenderedShells, LegendColors, LegendTags; disabled
shellview_12 = ShellViewKaramba3D(Model=modelview_4.Model, IndexOfLayer=0)  # -> Model, MeshesOfRenderedShells, LegendColors, LegendTags; disabled
legend_10 = Legend(Colour=shellview_12.LegendColors, Tags=shellview_12.LegendTags, LegendType=1)  # disabled
legend_11 = Legend(Colour=shellview_10.LegendColors, Tags=shellview_10.LegendTags, LegendType=1)  # disabled

# ----
legend_12 = Legend(Colour=shellview_11.LegendColors, Tags=shellview_11.LegendTags, LegendType=1)  # disabled
subset_7 = SubList(List=shellview_12.LegendTags, Domain=dom_3, Wrap=True)  # -> List, Index; disabled
subset_8 = SubList(List=shellview_11.LegendTags, Domain=dom_6, Wrap=True)  # -> List, Index; disabled
multiplication_7 = Multiplication(A=subset_7.List, _10=10)  # disabled
multiplication_8 = Multiplication(A=subset_8.List, _10=10)
extremums_7 = MinMax(Number=multiplication_7)  # -> expr("-x", Minimum), Maximum
extremums_8 = MinMax(Number=multiplication_8)  # -> expr("-x", Minimum), Maximum

# ----
# Maximum compressive stress [MPa]
panel_28 = Panel(extremums_7.Minimum)

# ----
# Maximum tensile stress [MPa]
panel_29 = Panel(extremums_7.Maximum)

# ----
# Maximum compressive stress [MPa]
panel_30 = Panel(extremums_8.Minimum)

# ----
# Maximum tensile stress [MPa]
panel_31 = Panel(extremums_8.Maximum)

clean_5 = CombineClean(Meshes=dome_2_2)  # disabled
material_properties_6 = Data(material_properties)  # disabled
medges_5 = MeshEdges(Mesh=clean_5)  # -> NakedEdges, InteriorEdges, NonManifoldEdges; disabled
join_5 = JoinCurves(Curves=medges_5.NakedEdges, Preserve=False)  # disabled
nv_5 = NakedVertices(Mesh=clean_5)  # -> ClothedIndex, NakedIndex, ClothedPts, NakedPts; disabled
panel_32 = Panel("Shell")  # disabled
panel_33 = Panel("-1.5")  # disabled
panel_34 = Panel("S")  # disabled
Z_5 = UnitZ(Factor=panel_33)  # disabled
panel_35 = Panel("S")  # disabled
cross_section_5 = CrossSectionKaramba3D(
    FamilyNameOfCrossSection=panel_32,
    ElementIdentifier=panel_35,
    Material=material_properties_6,
    Height_cm="30",
    mode="Shell - Const")  # disabled
meshtoshell_5 = MeshToShellKaramba3D(Mesh=clean_5, Identifier=panel_34, CrossSection=cross_section_5, LimitDistance_m=0.005)  # -> Element, Points, Info; disabled
loads_9 = LoadsKaramba3D(Vector=Z_5, Mesh=clean_5, LCase=0, mode="MeshLoad -Const.", menu=[buttons(off, on, off), buttons(on, on)])  # disabled
loads_10 = LoadsKaramba3D(Vector=Vector(0, 0, -1), LCase=0, mode="Gravity")  # disabled

explode = Explode(Curve=join_5, Recursive=True)  # -> Segments, flatten(Vertices); disabled
duppt_5 = RemoveDuplicatePts(Points=explode.Vertices, Tolerance=0.01)  # disabled
mc_2 = MeshCorners(Mesh=clean_5, Angle=2.35619449)  # disabled
pull_10 = PullPoint(Point=duppt_5, Geometry=nv_5.NakedPts, ClosestOnly=True)  # -> ClosestPoint, Distance; disabled

clean_6 = CombineClean(Meshes=dome_3_2)  # disabled
medges_6 = MeshEdges(Mesh=clean_6)  # -> NakedEdges, InteriorEdges, NonManifoldEdges; disabled
nv_6 = NakedVertices(Mesh=clean_6)  # -> ClothedIndex, NakedIndex, ClothedPts, NakedPts; disabled
join_6 = JoinCurves(Curves=medges_6.NakedEdges, Preserve=False)  # disabled
panel_36 = Panel("Shell")  # disabled
material_properties_7 = Data(material_properties)  # disabled
pull_11 = PullPoint(Point=nv_6.NakedPts, Geometry=join_6, ClosestOnly=True)  # -> ClosestPoint, Distance; disabled
panel_37 = Panel("-1.5")  # disabled
panel_38 = Panel("S")  # disabled
panel_39 = Panel("S")  # disabled
Z_6 = UnitZ(Factor=panel_37)  # disabled
cross_section_6 = CrossSectionKaramba3D(
    FamilyNameOfCrossSection=panel_36,
    ElementIdentifier=panel_38,
    Material=material_properties_7,
    Height_cm="30",
    mode="Shell - Const")  # disabled
meshtoshell_6 = MeshToShellKaramba3D(Mesh=clean_6, Identifier=panel_39, CrossSection=cross_section_6, LimitDistance_m=0.005)  # -> Element, Points, Info; disabled
pull_12 = PullPoint(Point=pull_11.ClosestPoint, Geometry=meshtoshell_6.Points, ClosestOnly=True)  # -> ClosestPoint, Distance; disabled
loads_11 = LoadsKaramba3D(Vector=Z_6, Mesh=clean_6, LCase=0, mode="MeshLoad -Const.", menu=[buttons(off, on, off), buttons(on, on)])  # disabled
loads_12 = LoadsKaramba3D(Vector=Vector(0, 0, -1), LCase=0, mode="Gravity")  # disabled

explode_2 = Explode(Curve=join_6, Recursive=True)  # -> Segments, flatten(Vertices); disabled
duppt_6 = RemoveDuplicatePts(Points=explode_2.Vertices, Tolerance=0.01)  # disabled
mc_3 = MeshCorners(Mesh=clean_6, Angle=2.35619449)  # disabled
pull_13 = PullPoint(Point=duppt_6, Geometry=meshtoshell_6.Points, ClosestOnly=True)  # -> ClosestPoint, Distance; disabled
pull_14 = PullPoint(Point=pull_13.ClosestPoint, Geometry=meshtoshell_6.Points, ClosestOnly=True)  # -> ClosestPoint, Distance; disabled
cull_2 = CullPattern(List=pull_14.ClosestPoint, CullPattern=[True, False, False, True, False, False])  # disabled
duppt_7 = RemoveDuplicatePts(Points=[cull_2, mc_3], Tolerance=0.01)  # disabled

supp_5 = SupportKaramba3D(PosInd=duppt_7, menu=[buttons(on, on, on, off, off, off)])  # disabled
assemble_5 = AssembleModelKaramba3D(Elem=meshtoshell_6.Element, Support=supp_5, Load=flatten([loads_12, loads_11]), LimitDistance_m=0.005)  # -> Model, Info, Mass_kg, CenterOfGravity; disabled
analyzenonlin_wip_5 = AnalyzeNonlinearWIPKaramba3D(
    Model=assemble_5.Model,
    NumberOfLoadSteps=1,
    NumberOfLoadIncrements=5,
    MaxNumberOfEquilibriumIterations=50,
    EquilibriumTolerance=1e-07,
    MaxNumberOfLimitLoadIterations=50,
    LimitLoadTolerance=0.01,
    mode="NewtonRaphson")  # -> CalculatedModel, MaximumDisplacement_cm, ElasticEnergy_kNm, Info, Lambdas; disabled
modelview_5 = ModelViewKaramba3D(Model=analyzenonlin_wip_5.CalculatedModel, LoadCaseFactorsForLinearSuperposition=1, IndexOfVisibleLoadcase=-1)  # -> Model, DeformedMesh, DeformedAxes, DeformedModel; disabled
shellview_13 = ShellViewKaramba3D(Model=modelview_5.Model, IndexOfLayer=0)  # -> Model, MeshesOfRenderedShells, LegendColors, LegendTags; disabled
shellview_14 = ShellViewKaramba3D(Model=modelview_5.Model, IndexOfLayer=0)  # -> Model, MeshesOfRenderedShells, LegendColors, LegendTags; disabled
shellview_15 = ShellViewKaramba3D(Model=modelview_5.Model, IndexOfLayer=0)  # -> Model, MeshesOfRenderedShells, LegendColors, LegendTags; disabled
legend_13 = Legend(Colour=shellview_13.LegendColors, Tags=shellview_13.LegendTags, LegendType=1)  # disabled
legend_14 = Legend(Colour=shellview_15.LegendColors, Tags=shellview_15.LegendTags, LegendType=1)  # disabled

legend_15 = Legend(Colour=shellview_14.LegendColors, Tags=shellview_14.LegendTags, LegendType=1)  # disabled
subset_9 = SubList(List=shellview_14.LegendTags, Domain=dom_4, Wrap=True)  # -> List, Index; disabled
subset_10 = SubList(List=shellview_15.LegendTags, Domain=dom_5, Wrap=True)  # -> List, Index; disabled
multiplication_9 = Multiplication(A=subset_9.List, _10=10)  # disabled
multiplication_10 = Multiplication(A=subset_10.List, _10=10)  # disabled
extremums_9 = MinMax(Number=multiplication_9)  # -> expr("-x", Minimum), Maximum
extremums_10 = MinMax(Number=multiplication_10)  # -> expr("-x", Minimum), Maximum

# ----
# Maximum compressive stress [MPa]
panel_40 = Panel(extremums_9.Minimum)

# ----
# Maximum tensile stress [MPa]
panel_41 = Panel(extremums_9.Maximum)

# ----
# Maximum compressive stress [MPa]
panel_42 = Panel(extremums_10.Minimum)

# ----
# Maximum tensile stress [MPa]
panel_43 = Panel(extremums_10.Maximum)

clean_7 = CombineClean(Meshes=dome_4_2)  # disabled
medges_7 = MeshEdges(Mesh=clean_7)  # -> NakedEdges, InteriorEdges, NonManifoldEdges; disabled
material_properties_8 = Data(material_properties)  # disabled
panel_44 = Panel("Shell")  # disabled
join_7 = JoinCurves(Curves=medges_7.NakedEdges, Preserve=False)  # disabled
mesh = Mesh(clean_7)  # disabled
panel_45 = Panel("-1.5")  # disabled
panel_46 = Panel("S")  # disabled
panel_47 = Panel("S")  # disabled
cross_section_7 = CrossSectionKaramba3D(
    FamilyNameOfCrossSection=panel_44,
    ElementIdentifier=panel_46,
    Material=material_properties_8,
    Height_cm="30",
    mode="Shell - Const")  # disabled
Z_7 = UnitZ(Factor=panel_45)  # disabled
meshtoshell_7 = MeshToShellKaramba3D(Mesh=graft(mesh), Identifier=panel_47, CrossSection=cross_section_7, LimitDistance_m=0.005)  # -> Element, Points, Info; disabled
loads_13 = LoadsKaramba3D(Vector=Z_7, Mesh=clean_7, LCase=0, mode="MeshLoad -Const.", menu=[buttons(off, on, off), buttons(on, on)])  # disabled
loads_14 = LoadsKaramba3D(Vector=Vector(0, 0, -1), LCase=0, mode="Gravity")  # disabled

explode_3 = Explode(Curve=join_7, Recursive=True)  # -> Segments, flatten(Vertices); disabled
duppt_8 = RemoveDuplicatePts(Points=explode_3.Vertices, Tolerance=0.01)  # disabled
mc_4 = MeshCorners(Mesh=clean_7, Angle=2.35619449)  # disabled
pull_15 = PullPoint(Point=duppt_8, Geometry=meshtoshell_7.Points, ClosestOnly=True)  # -> ClosestPoint, Distance; disabled
pull_16 = PullPoint(Point=pull_15.ClosestPoint, Geometry=meshtoshell_7.Points, ClosestOnly=True)  # -> ClosestPoint, Distance; disabled
cull_3 = CullPattern(List=pull_16.ClosestPoint, CullPattern=[True, False, False, True, False, False])  # disabled

duppt_9 = RemoveDuplicatePts(Points=cull_3, Tolerance=0.01)  # disabled
supp_6 = SupportKaramba3D(PosInd=duppt_9, menu=[buttons(on, on, on, off, off, off)])  # disabled
assemble_6 = AssembleModelKaramba3D(Elem=meshtoshell_7.Element, Support=supp_6, Load=flatten([loads_14, loads_13]), LimitDistance_m=0.005)  # -> Model, Info, Mass_kg, CenterOfGravity; disabled
analyzenonlin_wip_6 = AnalyzeNonlinearWIPKaramba3D(
    Model=assemble_6.Model,
    NumberOfLoadSteps=1,
    NumberOfLoadIncrements=5,
    MaxNumberOfEquilibriumIterations=50,
    EquilibriumTolerance=1e-07,
    MaxNumberOfLimitLoadIterations=50,
    LimitLoadTolerance=0.01,
    mode="NewtonRaphson")  # -> CalculatedModel, MaximumDisplacement_cm, ElasticEnergy_kNm, Info, Lambdas; disabled
modelview_6 = ModelViewKaramba3D(Model=analyzenonlin_wip_6.CalculatedModel, LoadCaseFactorsForLinearSuperposition=1, IndexOfVisibleLoadcase=-1)  # -> Model, DeformedMesh, DeformedAxes, DeformedModel; disabled
shellview_16 = ShellViewKaramba3D(Model=modelview_6.Model, IndexOfLayer=0)  # -> Model, MeshesOfRenderedShells, LegendColors, LegendTags; disabled
shellview_17 = ShellViewKaramba3D(Model=modelview_6.Model, IndexOfLayer=0)  # -> Model, MeshesOfRenderedShells, LegendColors, LegendTags; disabled
shellview_18 = ShellViewKaramba3D(Model=modelview_6.Model, IndexOfLayer=0)  # -> Model, MeshesOfRenderedShells, LegendColors, LegendTags; disabled
legend_16 = Legend(Colour=shellview_16.LegendColors, Tags=shellview_16.LegendTags, LegendType=1)  # disabled
legend_17 = Legend(Colour=shellview_18.LegendColors, Tags=shellview_18.LegendTags, LegendType=1)  # disabled

legend_18 = Legend(Colour=shellview_17.LegendColors, Tags=shellview_17.LegendTags, LegendType=1)  # disabled
subset_11 = SubList(List=shellview_17.LegendTags, Domain=dom_9, Wrap=True)  # -> List, Index
subset_12 = SubList(List=shellview_18.LegendTags, Domain=dom_10, Wrap=True)  # -> List, Index
multiplication_11 = Multiplication(A=subset_11.List, _10=10)
multiplication_12 = Multiplication(A=subset_12.List, _10=10)
extremums_11 = MinMax(Number=multiplication_11)  # -> expr("-x", Minimum), Maximum
extremums_12 = MinMax(Number=multiplication_12)  # -> expr("-x", Minimum), Maximum

# ----
# Maximum compressive stress [MPa]
panel_48 = Panel(extremums_11.Minimum)

# ----
# Maximum tensile stress [MPa]
panel_49 = Panel(extremums_11.Maximum)

# ----
# Maximum compressive stress [MPa]
panel_50 = Panel(extremums_12.Minimum)

# ----
# Maximum tensile stress [MPa]
panel_51 = Panel(extremums_12.Maximum)

pull_17 = PullPoint(Point=pull_10.ClosestPoint, Geometry=meshtoshell_5.Points, ClosestOnly=True)  # -> ClosestPoint, Distance; disabled

cull_4 = CullPattern(List=pull_17.ClosestPoint, CullPattern=[True, False, True, False])  # disabled

duppt_10 = RemoveDuplicatePts(Points=[cull_4, mc_2], Tolerance=0.01)  # disabled
supp_7 = SupportKaramba3D(PosInd=duppt_10, menu=[buttons(on, on, on, off, off, off)])  # disabled
assemble_7 = AssembleModelKaramba3D(Elem=meshtoshell_5.Element, Support=supp_7, Load=flatten([loads_10, loads_9]), LimitDistance_m=0.005)  # -> Model, Info, Mass_kg, CenterOfGravity; disabled
analyzenonlin_wip_7 = AnalyzeNonlinearWIPKaramba3D(
    Model=assemble_7.Model,
    NumberOfLoadSteps=1,
    NumberOfLoadIncrements=5,
    MaxNumberOfEquilibriumIterations=50,
    EquilibriumTolerance=1e-07,
    MaxNumberOfLimitLoadIterations=50,
    LimitLoadTolerance=0.01,
    mode="NewtonRaphson")  # -> CalculatedModel, MaximumDisplacement_cm, ElasticEnergy_kNm, Info, Lambdas; disabled
modelview_7 = ModelViewKaramba3D(Model=analyzenonlin_wip_7.CalculatedModel, LoadCaseFactorsForLinearSuperposition=1, IndexOfVisibleLoadcase=-1)  # -> Model, DeformedMesh, DeformedAxes, DeformedModel; disabled
shellview_19 = ShellViewKaramba3D(Model=modelview_7.Model, IndexOfLayer=0)  # -> Model, MeshesOfRenderedShells, LegendColors, LegendTags; disabled
shellview_20 = ShellViewKaramba3D(Model=modelview_7.Model, IndexOfLayer=0)  # -> Model, MeshesOfRenderedShells, LegendColors, LegendTags; disabled
shellview_21 = ShellViewKaramba3D(Model=modelview_7.Model, IndexOfLayer=0)  # -> Model, MeshesOfRenderedShells, LegendColors, LegendTags; disabled
legend_19 = Legend(Colour=shellview_19.LegendColors, Tags=shellview_19.LegendTags, LegendType=1)  # disabled
legend_20 = Legend(Colour=shellview_21.LegendColors, Tags=shellview_21.LegendTags, LegendType=1)  # disabled

legend_21 = Legend(Colour=shellview_20.LegendColors, Tags=shellview_20.LegendTags, LegendType=1)  # disabled
subset_13 = SubList(List=shellview_20.LegendTags, Domain=dom_7, Wrap=True)  # -> List, Index; disabled
subset_14 = SubList(List=shellview_21.LegendTags, Domain=dom_8, Wrap=True)  # -> List, Index; disabled
multiplication_13 = Multiplication(A=subset_13.List, _10=10)
multiplication_14 = Multiplication(A=subset_14.List, _10=10)
extremums_13 = MinMax(Number=multiplication_13)  # -> expr("-x", Minimum), Maximum
extremums_14 = MinMax(Number=multiplication_14)  # -> expr("-x", Minimum), Maximum

# ----
# Maximum compressive stress [MPa]
panel_52 = Panel(extremums_13.Minimum)

# ----
# Maximum tensile stress [MPa]
panel_53 = Panel(extremums_13.Maximum)

# ----
# Maximum compressive stress [MPa]
panel_54 = Panel(extremums_14.Minimum)

# ----
# Maximum tensile stress [MPa]
panel_55 = Panel(extremums_14.Maximum)
