# Grasshopper definition archway_scripts.gh (Grasshopper 1.0.7)
# plug-ins: Kangaroo Components

point = Point(<point referenced from the Rhino model>)

# ---- group: Parabola
construct_domain = ConstructDomain(DomainStart="-50", DomainEnd="50")
range = Range(Domain=construct_domain, Steps=Slider(25, range=0..100))
panel = Panel(range)
evaluate = Evaluate(Expression="x²", x=range)
negative = Negative(Value=evaluate)
panel_2 = Panel(evaluate)
construct_point = ConstructPoint(XCoordinate=range, YCoordinate=0, ZCoordinate=negative)
interpolate = Interpolate(Vertices=construct_point, Degree=3, Periodic=False, KnotStyle=1)  # -> Curve, Length, Domain

# ----
height = Slider(10, range=0..10)
length = Slider(40, range=0..100)
width = Slider(20, range=0..100)
rectangle = Rectangle(Plane=PlaneXY(0, 0, 0), XSize=length, YSize=width, Radius=0)  # -> Rectangle, Length
box_rectangle = BoxRectangle(Rectangle=rectangle.Rectangle, Height=height)
deconstruct_brep = DeconstructBrep(Brep=box_rectangle)  # -> Faces, Edges, Vertices
list_item = ListItem(List=deconstruct_brep.Faces, Index="1", Wrap=True)
area = Area(Geometry=list_item)  # -> Area, Centroid

polygon = Polygon(Plane=PlaneXY(0, 0, 0), Radius="23.09", Segments="3", FilletRadius=0)  # -> Polygon, Length
boundary_surfaces = BoundarySurfaces(Edges=polygon.Polygon)
unit_z = UnitZ(Factor=width)
extrude = Extrude(Base=boundary_surfaces, Direction=unit_z)
cap_holes = CapHoles(Brep=extrude)
deconstruct_brep_2 = DeconstructBrep(Brep=cap_holes)  # -> Faces, Edges, Vertices

# ---- group: Low gothic arch
height_2 = Slider(10, range=0..10)
length_2 = Slider(40, range=0..100)
width_2 = Slider(20, range=0..100)
# Creating the rectangular brick
rectangle_2 = Rectangle(Plane=PlaneXY(0, 0, 0), XSize=length_2, YSize=width_2, Radius=0)  # -> Rectangle, Length
box_rectangle_2 = BoxRectangle(Rectangle=rectangle_2.Rectangle, Height=height_2)
deconstruct_brep_3 = DeconstructBrep(Brep=box_rectangle_2)  # -> Faces, Edges, Vertices
list_item_2 = ListItem(List=deconstruct_brep_3.Faces, Index="3", Wrap=True)
area_2 = Area(Geometry=list_item_2)  # -> Area, Centroid

# ----
construct_point_2 = ConstructPoint(XCoordinate=0, YCoordinate=0, ZCoordinate=0)
unit_x = UnitX(Factor=Slider(101, range=0..1000))
move = Move(Geometry=construct_point_2, Motion=unit_x)  # -> Geometry, Transform
unit_z_2 = UnitZ(Factor=1)
catenary = Catenary(PointA=construct_point_2, PointB=move.Geometry, Length=Slider(499, range=0..650), Gravity=unit_z_2)

height_3 = Slider(10, range=0..10)
length_3 = Slider(40, range=0..100)
width_3 = Slider(20, range=0..100)
# Creating the rectangular brick
rectangle_3 = Rectangle(Plane=PlaneXY(0, 0, 0), XSize=length_3, YSize=width_3, Radius=0)  # -> Rectangle, Length
box_rectangle_3 = BoxRectangle(Rectangle=rectangle_3.Rectangle, Height=height_3)
deconstruct_brep_4 = DeconstructBrep(Brep=box_rectangle_3)  # -> Faces, Edges, Vertices
list_item_3 = ListItem(List=deconstruct_brep_4.Faces, Index="3", Wrap=True)
area_3 = Area(Geometry=list_item_3)  # -> Area, Centroid

# ---- group: Low gothic arch
point_2 = Point(<point referenced from the Rhino model>)
# Gothic arch based on circle centers
circle = Circle(Plane=point_2, Radius=Slider(100, range=0..100))
unit_x_2 = UnitX(Factor=Slider(84, range=0..100))
move_2 = Move(Geometry=circle, Motion=unit_x_2)  # -> Geometry, Transform
area_4 = Area(Geometry=move_2.Geometry)  # -> Area, Centroid
# Creating the bowlines
area_5 = Area(Geometry=circle)  # -> Area, Centroid
xy_plane = XYPlane(Origin=Point(0, 0, 0))
xy_plane_2 = XYPlane(Origin=Point(0, 0, 0))
line = Line(StartPoint=point_2, EndPoint=area_4.Centroid)
rotate_direction = RotateDirection(Geometry=circle, Center=area_5.Centroid, From=xy_plane, To=Vector(0, 1, 0))  # -> Geometry, Transform
rotate_direction_2 = RotateDirection(Geometry=move_2.Geometry, Center=area_5.Centroid, From=xy_plane_2, To=Vector(0, 1, 0))  # -> Geometry, Transform
curve_curve = CurveCurve(CurveA=rotate_direction.Geometry, CurveB=rotate_direction_2.Geometry)  # -> Points, ParamsA, ParamsB
region_intersection = RegionIntersection(CurvesA=rotate_direction.Geometry, CurvesB=rotate_direction_2.Geometry)

# ----
height_4 = Slider(10, range=0..10)
length_4 = Slider(40, range=0..100)
width_4 = Slider(20, range=0..100)
rectangle_4 = Rectangle(Plane=PlaneXY(0, 0, 0), XSize=length_4, YSize=width_4, Radius=0)  # -> Rectangle, Length
box_rectangle_4 = BoxRectangle(Rectangle=rectangle_4.Rectangle, Height=height_4)
deconstruct_brep_5 = DeconstructBrep(Brep=box_rectangle_4)  # -> Faces, Edges, Vertices
list_item_4 = ListItem(List=deconstruct_brep_5.Faces, Index="1", Wrap=True)
area_6 = Area(Geometry=list_item_4)  # -> Area, Centroid

polygon_2 = Polygon(Plane=PlaneXY(0, 0, 0), Radius="23.09", Segments="3", FilletRadius=0)  # -> Polygon, Length
boundary_surfaces_2 = BoundarySurfaces(Edges=polygon_2.Polygon)
unit_z_3 = UnitZ(Factor=width_4)
extrude_2 = Extrude(Base=boundary_surfaces_2, Direction=unit_z_3)
cap_holes_2 = CapHoles(Brep=extrude_2)
deconstruct_brep_6 = DeconstructBrep(Brep=cap_holes_2)  # -> Faces, Edges, Vertices

# ----
# Parabola curved archway
construct_point_3 = ConstructPoint(XCoordinate=0, YCoordinate=0, ZCoordinate=0)
unit_x_3 = UnitX(Factor=1)
length_5 = Slider(106, range=0..1000)
points = Slider(60, range=0..100)
line_sdl = LineSDL(Start=construct_point_3, Direction=unit_x_3, Length=length_5)
divide_curve = DivideCurve(Curve=line_sdl, Count=points, Kinks=False)  # -> Points, Tangents, Parameters
deconstruct = Deconstruct(Point=divide_curve.Points)  # -> XComponent, YComponent, ZComponent
evaluate_2 = Evaluate(Expression="-4*f*x*x/L/L+4*f*x/L", x=deconstruct.XComponent, L=length_5, f=Slider(250, range=0..250))
construct_point_4 = ConstructPoint(XCoordinate=deconstruct.XComponent, YCoordinate=deconstruct.YComponent, ZCoordinate=evaluate_2)
interpolate_2 = Interpolate(Vertices=construct_point_4, Degree=3, Periodic=False, KnotStyle=1)  # -> Curve, Length, Domain

area_7 = Area(Geometry=deconstruct_brep_2.Faces)  # -> Area, Centroid
list_item_5 = ListItem(List=area_7.Centroid, Index=Slider(0, range=0..10), Wrap=True)
list_item_6 = ListItem(List=area_7.Centroid, Index=Slider(4, range=0..10), Wrap=True)
list_item_7 = ListItem(List=deconstruct_brep_2.Vertices, Index=Slider(0, range=0..10), Wrap=True)
list_item_8 = ListItem(List=deconstruct_brep_2.Vertices, Index=Slider(3, range=0..10), Wrap=True)
extremes = Extremes(Curve=catenary, Plane=PlaneXY(0, 0, 0))  # -> Highest, Lowest
line_2 = Line(StartPoint=list_item_5, EndPoint=list_item_6)
line_3 = Line(StartPoint=list_item_7, EndPoint=list_item_8)
curve_middle = CurveMiddle(Curve=line_2)
curve_middle_2 = CurveMiddle(Curve=line_3)
line_4 = Line(StartPoint=curve_middle, EndPoint=curve_middle_2)
length_6 = Length(Curve=line_4)
unit_z_4 = UnitZ(Factor=length_6)
move_3 = Move(Geometry=extremes.Highest, Motion=unit_z_4)  # -> Geometry, Transform
line_5 = Line(StartPoint=move_3.Geometry, EndPoint=extremes.Highest)
orient = Orient(Geometry=cap_holes, Source=line_4, Target=line_5)  # -> Geometry, Transform
volume = Volume(Geometry=orient.Geometry)  # -> Volume, Centroid
rotate = Rotate(Geometry=orient.Geometry, Angle=1.570796327, Plane=volume.Centroid)  # -> Geometry, Transform

area_8 = Area(Geometry=deconstruct_brep_6.Faces)  # -> Area, Centroid
list_item_9 = ListItem(List=area_8.Centroid, Index=Slider(0, range=0..10), Wrap=True)
list_item_10 = ListItem(List=area_8.Centroid, Index=Slider(4, range=0..10), Wrap=True)
list_item_11 = ListItem(List=deconstruct_brep_6.Vertices, Index=Slider(0, range=0..10), Wrap=True)
list_item_12 = ListItem(List=deconstruct_brep_6.Vertices, Index=Slider(3, range=0..10), Wrap=True)
line_6 = Line(StartPoint=list_item_9, EndPoint=list_item_10)
line_7 = Line(StartPoint=list_item_11, EndPoint=list_item_12)
curve_middle_3 = CurveMiddle(Curve=line_6)
curve_middle_4 = CurveMiddle(Curve=line_7)
line_8 = Line(StartPoint=curve_middle_3, EndPoint=curve_middle_4)
length_7 = Length(Curve=line_8)

number_slider = Slider(50, range=0..100)
perp_frames = PerpFrames(Curve=catenary, Count=number_slider, Align=True)  # -> Frames, flatten(Parameters)
point_3 = Point(perp_frames.Frames)
deconstruct_2 = Deconstruct(Point=point_3)  # -> XComponent, YComponent, ZComponent
sort_list = SortList(Keys=deconstruct_2.ZComponent)  # -> Keys, ValuesValuesA
list_item_13 = ListItem(List=sort_list.Keys, Index=number_slider, Wrap=True)
member_index = MemberIndex(Set=deconstruct_2.ZComponent, Member=list_item_13)  # -> Index, Count
cull_index = CullIndex(List=perp_frames.Frames, Indices=member_index.Index, Wrap=True)
rotate_plane = RotatePlane(Plane=cull_index, Angle=degrees(Slider(270, range=0..360)))
orient_2 = Orient(Geometry=box_rectangle, Source=area.Centroid, Target=rotate_plane)  # -> Geometry, Transform
cull_index_2 = CullIndex(List=orient_2.Geometry, Indices=Slider(27, range=0..100), Wrap=True)

# ----
# Creating the parabola
# Orientating the bricks
# along parabola
# Creating the rectangular brick
# Placing the orientation line
# at the top of the parabola
# Setting the keystone in place
# Creating an orientation line for the keystone
# Creating the triangular keystone
number_slider_2 = Slider(43, range=0..100)
unit_z_5 = UnitZ(Factor=length_7)
extremes_2 = Extremes(Curve=interpolate_2.Curve, Plane=PlaneXY(0, 0, 0))  # -> Highest, Lowest
move_4 = Move(Geometry=extremes_2.Highest, Motion=unit_z_5)  # -> Geometry, Transform
# Setting planes for the bricks
perp_frames_2 = PerpFrames(Curve=interpolate_2.Curve, Count=number_slider_2, Align=True)  # -> Frames, Parameters
line_9 = Line(StartPoint=move_4.Geometry, EndPoint=extremes_2.Highest)
rotate_plane_2 = RotatePlane(Plane=perp_frames_2.Frames, Angle=degrees(Slider(0, range=0..360)))
orient_3 = Orient(Geometry=cap_holes_2, Source=line_8, Target=line_9)  # -> Geometry, Transform
volume_2 = Volume(Geometry=orient_3.Geometry)  # -> Volume, Centroid
orient_4 = Orient(Geometry=box_rectangle_4, Source=area_6.Centroid, Target=rotate_plane_2)  # -> Geometry, Transform
rotate_2 = Rotate(Geometry=orient_3.Geometry, Angle=1.570796327, Plane=volume_2.Centroid)  # -> Geometry, Transform

# ----
# Catenary curved archway
# Aligning the rectangular bricks
# Creating the catenary curve
# Creating the rectangular brick
# Combining rectangular
# and triangular brick
# Aligning the triangular keystone
# Creating the triangular keystone
number_slider_3 = Slider(0, range=0..1000)
unit_x_4 = UnitX(Factor=number_slider_3)
move_5 = Move(Geometry=[rotate.Geometry, orient_2.Geometry], Motion=unit_x_4)  # -> Geometry, Transform

geometry = Geometry(move_5.Geometry)

number_slider_4 = Slider(131, range=0..200)
negative_2 = Negative(Value=number_slider_4)
# Gothic arch based on midpoint
unit_x_5 = UnitX(Factor=number_slider_4)
unit_x_6 = UnitX(Factor=negative_2)
# Creating the bowlines
move_6 = Move(Geometry=point, Motion=unit_x_5)  # -> Geometry, Transform
move_7 = Move(Geometry=point, Motion=unit_x_6)  # -> Geometry, Transform
line_10 = Line(StartPoint=move_6.Geometry, EndPoint=move_7.Geometry)
xy_plane_3 = XYPlane(Origin=Point(0, 0, 0))
xy_plane_4 = XYPlane(Origin=Point(0, 0, 0))
extend_curve = ExtendCurve(Curve=line_10, Type=0, Start="100", End="100")

# ---- group: Low gothic arch
polygon_3 = Polygon(Plane=PlaneXY(0, 0, 0), Radius="23.09", Segments="3", FilletRadius=0)  # -> Polygon, Length
# Creating the triangular keystone
boundary_surfaces_3 = BoundarySurfaces(Edges=polygon_3.Polygon)

# ----
polygon_4 = Polygon(Plane=PlaneXY(0, 0, 0), Radius="23.09", Segments="3", FilletRadius=0)  # -> Polygon, Length
# Creating the triangular keystone
boundary_surfaces_4 = BoundarySurfaces(Edges=polygon_4.Polygon)

# ---- group: Low gothic arch
number_slider_5 = Slider(20, range=0..100)
number_slider_6 = Slider(73, range=0..100)
extend_curve_2 = ExtendCurve(Curve=line, Type=0, Start=number_slider_6, End=number_slider_6)
explode = Explode(Curve=region_intersection, Recursive=True)  # -> Segments, Vertices
curve_curve_2 = CurveCurve(CurveA=region_intersection, CurveB=extend_curve_2)  # -> Points, ParamsA, ParamsB
removeduplicatepts = RemoveDuplicatePts(Points=flatten([curve_curve_2.Points, explode.Vertices]), Tolerance=0.01)
list_item_14 = ListItem(List=curve_curve.Points, Index=Slider(1, range=0..1), Wrap=True)
# Selecting the bowlines
curve_closest_point = CurveClosestPoint(Point=flatten(removeduplicatepts), Curve=region_intersection)  # -> Point, Parameter, Distance
data = Data(curve_closest_point.Point)
shatter = Shatter(Curve=region_intersection, Parameters=curve_closest_point.Parameter)
list_item_15 = ListItem(List=shatter, Index=Slider(3, range=0..6), Wrap=True)
# Setting planes for the bricks
perp_frames_3 = PerpFrames(Curve=list_item_15, Count=Slider(13, range=0..100), Align=True)  # -> Frames, Parameters
rotate_plane_3 = RotatePlane(Plane=perp_frames_3.Frames, Angle=degrees(Slider(180, range=0..360)))
orient_5 = Orient(Geometry=box_rectangle_2, Source=area_2.Centroid, Target=rotate_plane_3)  # -> Geometry, Transform
list_length = ListLength(List=orient_5.Geometry)  # -> expr("x-1", Length)
# Orientating the bricks and
# culling the first brick
# to make place for the keystone
cull_index_3 = CullIndex(List=flatten(orient_5.Geometry), Indices=flatten([Slider(0, range=0..10), list_length]), Wrap=True)

unit_z_6 = UnitZ(Factor=number_slider_5)
extrude_3 = Extrude(Base=boundary_surfaces_3, Direction=unit_z_6)
cap_holes_3 = CapHoles(Brep=extrude_3)
deconstruct_brep_7 = DeconstructBrep(Brep=cap_holes_3)  # -> Faces, Edges, Vertices

area_9 = Area(Geometry=deconstruct_brep_7.Faces)  # -> Area, Centroid
# Creating an orientation line for the keystone
list_item_16 = ListItem(List=area_9.Centroid, Index=Slider(0, range=0..10), Wrap=True)
list_item_17 = ListItem(List=area_9.Centroid, Index=Slider(4, range=0..10), Wrap=True)
list_item_18 = ListItem(List=deconstruct_brep_7.Vertices, Index=Slider(0, range=0..10), Wrap=True)
list_item_19 = ListItem(List=deconstruct_brep_7.Vertices, Index=Slider(3, range=0..10), Wrap=True)
line_11 = Line(StartPoint=list_item_16, EndPoint=list_item_17)
line_12 = Line(StartPoint=list_item_18, EndPoint=list_item_19)
curve_middle_5 = CurveMiddle(Curve=line_11)
curve_middle_6 = CurveMiddle(Curve=line_12)
line_13 = Line(StartPoint=curve_middle_5, EndPoint=curve_middle_6)
length_8 = Length(Curve=line_13)
# Placing the orientation line
# at top of intersecting bowlines
unit_z_7 = UnitZ(Factor=length_8)
move_8 = Move(Geometry=list_item_14, Motion=unit_z_7)  # -> Geometry, Transform
line_14 = Line(StartPoint=move_8.Geometry, EndPoint=list_item_14)
# Setting the keystone in place
orient_6 = Orient(Geometry=cap_holes_3, Source=line_13, Target=line_14)  # -> Geometry, Transform
volume_3 = Volume(Geometry=orient_6.Geometry)  # -> Volume, Centroid
rotate_3 = Rotate(Geometry=orient_6.Geometry, Angle=1.570796327, Plane=volume_3.Centroid)  # -> Geometry, Transform
yz_plane = YZPlane(Origin=move_8.Geometry)
mirror = Mirror(Geometry=cull_index_3, Plane=yz_plane)  # -> Geometry, Transform

# ----
multiplication = Multiplication(A=number_slider_4, B="2")
brick_height = Data(height_3)

unit_z_8 = UnitZ(Factor=Slider(20, range=0..100))
extrude_4 = Extrude(Base=boundary_surfaces_4, Direction=unit_z_8)
cap_holes_4 = CapHoles(Brep=extrude_4)
deconstruct_brep_8 = DeconstructBrep(Brep=cap_holes_4)  # -> Faces, Edges, Vertices

circle_2 = Circle(Plane=move_6.Geometry, Radius=multiplication)
circle_3 = Circle(Plane=move_7.Geometry, Radius=multiplication)
rotate_direction_3 = RotateDirection(Geometry=circle_2, Center=point, From=xy_plane_3, To=Vector(0, 1, 0))  # -> Geometry, Transform
rotate_direction_4 = RotateDirection(Geometry=circle_3, Center=point, From=xy_plane_4, To=Vector(0, 1, 0))  # -> Geometry, Transform
curve_curve_3 = CurveCurve(CurveA=rotate_direction_3.Geometry, CurveB=rotate_direction_4.Geometry)  # -> Points, ParamsA, ParamsB
region_intersection_2 = RegionIntersection(CurvesA=rotate_direction_3.Geometry, CurvesB=rotate_direction_4.Geometry)

area_10 = Area(Geometry=deconstruct_brep_8.Faces)  # -> Area, Centroid
list_item_20 = ListItem(List=area_10.Centroid, Index=Slider(0, range=0..10), Wrap=True)
list_item_21 = ListItem(List=area_10.Centroid, Index=Slider(4, range=0..10), Wrap=True)
list_item_22 = ListItem(List=deconstruct_brep_8.Vertices, Index=Slider(0, range=0..10), Wrap=True)
list_item_23 = ListItem(List=deconstruct_brep_8.Vertices, Index=Slider(3, range=0..10), Wrap=True)
line_15 = Line(StartPoint=list_item_20, EndPoint=list_item_21)
line_16 = Line(StartPoint=list_item_22, EndPoint=list_item_23)
curve_middle_7 = CurveMiddle(Curve=line_15)
curve_middle_8 = CurveMiddle(Curve=line_16)
line_17 = Line(StartPoint=curve_middle_7, EndPoint=curve_middle_8)
length_9 = Length(Curve=line_17)
unit_z_9 = UnitZ(Factor=length_9)

explode_2 = Explode(Curve=region_intersection_2, Recursive=True)  # -> Segments, Vertices
curve_curve_4 = CurveCurve(CurveA=region_intersection_2, CurveB=extend_curve)  # -> Points, ParamsA, ParamsB
removeduplicatepts_2 = RemoveDuplicatePts(Points=flatten([curve_curve_4.Points, explode_2.Vertices]), Tolerance=0.01)
list_item_24 = ListItem(List=curve_curve_3.Points, Index="1", Wrap=True)
# Segmenting the bowlines
curve_closest_point_2 = CurveClosestPoint(Point=flatten(removeduplicatepts_2), Curve=region_intersection_2)  # -> Point, Parameter, Distance
data_2 = Data(curve_closest_point_2.Point)
shatter_2 = Shatter(Curve=region_intersection_2, Parameters=curve_closest_point_2.Parameter)
list_item_25 = ListItem(List=shatter_2, Index="3", Wrap=True)

# ----
# Positioning the triangular keystone
move_9 = Move(Geometry=list_item_24, Motion=unit_z_9)  # -> Geometry, Transform
line_18 = Line(StartPoint=move_9.Geometry, EndPoint=list_item_24)
orient_7 = Orient(Geometry=cap_holes_4, Source=line_17, Target=line_18)  # -> Geometry, Transform
volume_4 = Volume(Geometry=orient_7.Geometry)  # -> Volume, Centroid
rotate_4 = Rotate(Geometry=orient_7.Geometry, Angle=1.570796327, Plane=volume_4.Centroid)  # -> Geometry, Transform

length_10 = Length(Curve=list_item_25)
division = Division(A=length_10, B=brick_height)
round = Round(Number=division)  # -> Nearest, Floor, Ceiling

perp_frames_4 = PerpFrames(Curve=list_item_25, Count=expr("x-6", round.Ceiling), Align=True)  # -> Frames, Parameters
rotate_plane_4 = RotatePlane(Plane=perp_frames_4.Frames, Angle=degrees(Slider(180, range=0..360)))

orient_8 = Orient(Geometry=box_rectangle_3, Source=area_3.Centroid, Target=rotate_plane_4)  # -> Geometry, Transform
list_length_2 = ListLength(List=orient_8.Geometry)  # -> expr("x-1", Length)
# Positioning the bricks
cull_index_4 = CullIndex(List=flatten(orient_8.Geometry), Indices=flatten([Slider(0, range=0..10), list_length_2]), Wrap=True)
yz_plane_2 = YZPlane(Origin=move_9.Geometry)
mirror_2 = Mirror(Geometry=cull_index_4, Plane=yz_plane_2)  # -> Geometry, Transform

geometry_2 = Geometry(mirror_2.Geometry)
