# Grasshopper definition muqarnas_grasshopper.gh (Grasshopper 1.0.7)
# plug-ins: MeshEdit Components, Pufferfish, Weaverbird, Kangaroo2 Components

# ---- group: Dome tesselation
# Muqarnas Dome
# Data from the form Finding script
data = Data(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)

# ---- group: Relaxed Dome
data_2 = Data(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)

# ---- group: Corridor Junction
# Muqarnas at Junctions
data_3 = Data(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)

# ---- group: Corridor tesselation
# Data from the form Finding script
data_4 = Data(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)

# ---- group: Relaxed Vaults
data_5 = Data(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)

# ---- group: Corridor Junction Input
curve = Curve(data_3)

# ---- group: Corridor Tesselation Input
mesh = Mesh(data_4)

# ---- group: Relaxed Vaults Input
geometry = Geometry(data_5)

# ---- group: Dome Tesselation Input
mesh_2 = Mesh(data)

# ---- group: Relaxed dome Input
mesh_3 = Mesh(data_2)

# ----
mesh_explode = MeshExplode(Mesh=mesh, Interpolate=False)
# selecting the faces in side the junction from corridor tesselation
dense_1 = Dense1(G=mesh_explode, D=0)  # -> out, A; inputs G: GeometryBase, I: list, D: list, clr: list of Color
# ---------- dense_1: VB ----------
    Component.Params.Input(0).Name = "Mesh or Curve"
    Component.Params.Input(0).Description = "Open or closed mesh or curve"
    Component.Params.Input(1).Name = "Index [Face]"
    Component.Params.Input(1).Description = "An optional integer or list of integers which specify the faces to be modified if the input is a mesh. If no value is supplied then all faces will be modified"
    Component.Params.Input(2).Name = "Distance"
    Component.Params.Input(2).Description = "Sets the depth for the center point offset of each face"
    Component.Params.Input(3).Name = "Quad"
    Component.Params.Input(3).Description = "If true, all faces will be quad"
    Component.Params.Input(4).Name = "Flip"
    Component.Params.Input(4).Description = "If true, the direction of triangulation will be flipped"
    Component.Params.Input(5).Name = "Color [Vertex]"
    Component.Params.Input(5).Description = "(If applied to a mesh a list of colors corresponding to each mesh face, if applied to a curve, a list of colors corresponding to each control point plus an additonal color value for the new averaged center"

    Component.Params.Output(1).Name = "Mesh"
    Component.Params.Output(1).Description = "If successful, a valid mesh"

    If G IsNot Nothing Then

      Dim bM, bP,bmC,biC As Boolean

      bM = g.ObjectType = ObjectType.Mesh
      bP = g.ObjectType = ObjectType.Curve

      If (bM Or bP) Then
        Dim msh As New mesh
        Dim crv As curve
        Dim av As point3d
        Dim ac As color
        Dim h,j,jj,k,u,v,w As Integer
        Dim cv,cf,ce As Integer
        Dim x(),y() As Integer

        Dim mv,fv,ep,tv As New list(Of Point3d)
        Dim mev As New dictionary(Of String, Integer)
        Dim mf As Rhino.Geometry.Collections.MeshFaceList = Nothing
        Dim mtv As Rhino.Geometry.Collections.MeshTopologyVertexList = Nothing
        Dim mte As Rhino.Geometry.Collections.MeshTopologyEdgeList = Nothing
        Dim mn As Rhino.Geometry.Collections.MeshVertexNormalList = Nothing
        Dim mfn As Rhino.Geometry.Collections.MeshFaceNormalList = Nothing
        Dim ev As New list(Of vector3d)
        Dim ed,en As New list(Of Double)
        Dim mc,ec,tc,cc,fc As New list(Of color)
        Dim xf As New list(Of meshface)

        If clr.count() = 0 Then clr.add(color.LightGray) Else biC = True

        If bm Then
          'Start Deconstruct if Mesh
          msh = g

          If msh.Normals.Count() = 0 Then msh.Normals.ComputeNormals()
          If msh.FaceNormals.Count() = 0 Then msh.FaceNormals.ComputeFaceNormals()

          If i.count() = 0 Then I = Enumerable.Range(0, msh.Faces.Count()).ToList()

          mv = msh.Vertices().ToPoint3dArray().tolist()
          mte = msh.TopologyEdges()
          mtv = msh.TopologyVertices()
          mf = msh.Faces()

          mn = msh.Normals()
          mn.UnitizeNormals()
          mfn = msh.FaceNormals()
          mfn.UnitizeFaceNormals()

          cf = I.Count() - 1
          ce = mte.count() - 1

          'Assign Colors
          If msh.VertexColors.Count() < 1 Then
            msh.VertexColors.CreateMonotoneMesh(color.LightGray)
            bmC = biC
          Else
            bmC = True
          End If
          'Assign fake edges
          mc = msh.VertexColors().ToArray().ToList()
        Else
          'Start Deconstruct if Curve
          crv = g

          I.clear()
          I.add(0)
          Dim nc As nurbscurve
          Dim pc As polyline
          Dim nps As Rhino.Geometry.Collections.NurbsCurvePointList

          nc = crv.ToNurbsCurve()
          nps = nc.Points
          pc = nc.Points.ControlPolygon
          If (Not pc.IsClosed) Then pc.add(pc(0))
          av = pc.CenterPoint

          msh.Vertices.AddVertices(pc.ToArray())
          msh.faces.addfaces(pc.TriangulateClosedPolyline())
          msh.Vertices.Remove(pc.count() - 1, True)
          msh.FaceNormals.ComputeFaceNormals()
          msh.Normals.ComputeNormals()
          msh.Normals.UnitizeNormals()

          mv = msh.Vertices.ToPoint3dArray().tolist()
          mte = msh.TopologyEdges()
          mtv = msh.TopologyVertices()
          mn = msh.Normals()
          mfn = msh.FaceNormals()

          mfn(0) = avgVec(mn.toarray())

          'Assign Colors
          If bic Then bmC = True
          mc = clr
          If (clr.count() - 1) < (mv.count() - 1) Then mc = matchClr(mc, mv.count() - 1)

          ac = avgClr(mc.toarray())
          cf = 0
        End If
        cv = mv.count() - 1
        ce = mte.count() - 1

        x = appendprepend(cv)
        'Match variables and colors to vertex count
        If (D.count() - 1) < cv Then D = matchDbl(D, cv)
        If (clr.count() - 1) < cv Then clr = matchClr(clr, cv)
        If biC Then fc = clr Else fc = mc

        'Edge based vertices
        k = 0
        For j = 0 To mte.count() - 1 Step 1
          If (bm Or (bp And (mte.GetConnectedFaces(j).Count() < 2))) Then
            u = mtv.MeshVertexIndices(mte.GetTopologyVertices(j).I)(0)
            v = mtv.MeshVertexIndices(mte.GetTopologyVertices(j).J)(0)

            ep.add(evalP(mv(u), mv(v), 0.5))
            ec.add(evalC(mc(u), mc(v), 0.5))
            mev.add(u & "," & v & "," & 0, k)
            mev.add(v & "," & u & "," & 0, k)

            k += 1
          End If
        Next

        'Face based vertices
        Dim xv(),mt(),ei() As Integer
        Dim xc() As color
        Dim xd,xn As Double
        ReDim ei(3)
        u = 0
        v = mv.count() + ep.count() + cf + 1

        For jj = 0 To I.count() - 1 Step 1
          Dim tcv As New point3d
          j = I(jj)
          w = v + tv.count()
          xd = 0
          xn = 0
          If bm Then
            If mf(j).isquad() Then h = 4 Else h = 3
            ReDim xv(h - 1)
            ReDim xc(h - 1)
            mt = mf.GetTopologicalVertices(j)
            For k = 0 To h - 1 Step 1
              xv(k) = mtv.MeshVertexIndices(mt(k))(0)
              xc(k) = fc(xv(k))
            Next
            av = mf.GetFaceCenter(j)
            ac = avgClr(xc)
          Else
            h = mv.count()
            xv = Enumerable.Range(0, h).ToArray()
          End If
          For k = 0 To h - 1 Step 1
            xd += D(xv(k))
          Next
          xd /= h
          mfn(j) *= xd
          y = appendprepend(h - 1)

          For k = 1 To h Step 1
            ei(0) = mev.item(xv(y(k)) & "," & xv(y(k + 1)) & "," & 0)
            ei(1) = mev.item(xv(y(k)) & "," & xv(y(k - 1)) & "," & 0)

            'Define new faces
            If q Then
              xf.add(New meshface(ep.count() + xv(y(k)), ei(0), v + jj - cf - 1, ei(1)))
            Else
              If f Then
                xf.add(New meshface(ei(0), ei(1), ep.count() + xv(y(k))))
                xf.add(New meshface(ei(1), ei(0), v + jj - cf - 1))
              Else
                xf.add(New meshface(ep.count() + xv(y(k)), v + jj - cf - 1, ei(1)))
                xf.add(New meshface(ep.count() + xv(y(k)), ei(0), v + jj - cf - 1))
              End If
            End If

          Next
          fv.add(av + mfn(j))
          cc.add(ac)
        Next

        Dim om As New mesh
        om.Vertices.AddVertices(ep.toarray())
        If bmC Then om.VertexColors.AppendColors(ec.toarray())

        om.Vertices.AddVertices(mv)
        If bmC Then om.VertexColors.AppendColors(mc.toarray())

        om.Vertices.AddVertices(fv)
        If bmC Then om.VertexColors.AppendColors(cc.toarray())

        om.Faces.AddFaces(xf.toarray())

        If i.count() > 1 Then om.Vertices.CullUnused()

        A = om
      End If
    End If
# ---------- dense_1: VB additional code ----------
  Private Function appendprepend(ByVal i As Integer)
    Dim srsEnum As IEnumerable(Of Integer) = Enumerable.Range(0, i + 1)
    Dim arrVal As New list(Of Integer)
    arrVal = srsEnum.tolist()
    arrVal.add(0)
    arrVal.insert(0, i)
    Return arrVal.toarray()
  End Function

  Private Function matchDbl(ByVal a As list(Of Double), ByVal t As Integer)
    Dim i,k As Integer
    k = a.count()
    For i = 0 To ((t + 1) - k) - 1 Step 1
      a.add(a.item(k - 1))
    Next
    Return a
  End Function

  Private Function matchClr(ByVal a As list(Of Color), ByVal t As Integer)
    Dim i,k As Integer
    k = a.count()
    For i = 0 To ((t + 1) - k) - 1 Step 1
      a.add(a.item(k - 1))
    Next
    Return a
  End Function

  Private Function evalP(ByVal op As point3d, ByVal tp As Point3d, ByVal t As Double)
    Return New point3d(op + (tp - op) * t)
  End Function

  Private Function evalV(ByVal ov As vector3d, ByVal tv As vector3d, ByVal t As Double)
    Return New vector3d(ov + (tv - ov) * t)
  End Function

  Private Function evalN(ByVal u As Double, ByVal v As Double, ByVal t As Double)
    Return u + (v - u) * t
  End Function

  Private Function avgVec(ByVal v() As vector3f)
    Dim i As Integer
    Dim tv As Vector3d

    For i = 0 To ubound(v) Step 1
      tv += v(i)
    Next
    tv /= (ubound(v) + 1)
    tv.Unitize()
    Return New vector3f(tv.X, tv.Y, tv.Z)
  End Function

  Private Function roundClr(ByVal r As Integer, ByVal g As Integer, ByVal b As Integer, ByVal i As Integer)
    r = CInt(r / i)
    g = CInt(g / i)
    b = CInt(b / i)

    If r > 255 Then r = 255 Else If r < 0 Then r = 0
    If g > 255 Then g = 255 Else If g < 0 Then g = 0
    If b > 255 Then b = 255 Else If b < 0 Then b = 0

    Return color.FromArgb(r, g, b)
  End Function

  Private Function avgClr(ByVal c() As color)
    Dim r,g,b As Integer
    Dim i,k As Integer

    k = ubound(c) + 1

    For i = 0 To k - 1 Step 1
      r += CInt(c(i).R)
      g += CInt(c(i).G)
      b += CInt(c(i).B)
    Next

    r = CInt(r / k)
    g = CInt(g / k)
    b = CInt(b / k)

    If r > 255 Then r = 255 Else If r < 0 Then r = 0
    If g > 255 Then g = 255 Else If g < 0 Then g = 0
    If b > 255 Then b = 255 Else If b < 0 Then b = 0

    Return color.FromArgb(r, g, b)
  End Function

  Private Function evalC(ByVal oc As color, ByVal tc As color, ByVal t As Double)
    Dim r,g,b As Integer
    r = CInt(CInt(oc.R) + (CInt(tc.R) - CInt(oc.R)) * t)
    g = CInt(CInt(oc.G) + (CInt(tc.G) - CInt(oc.G)) * t)
    b = CInt(CInt(oc.B) + (CInt(tc.B) - CInt(oc.B)) * t)

    If r > 255 Then r = 255 Else If r < 0 Then r = 0
    If g > 255 Then g = 255 Else If g < 0 Then g = 0
    If b > 255 Then b = 255 Else If b < 0 Then b = 0

    Return color.FromArgb(r, g, b)
  End Function
# ---------- end dense_1 ----------
face_normals = FaceNormals(Mesh=dense_1.A)  # -> Centers, Normals
mesh_explode_2 = MeshExplode(Mesh=dense_1.A, Interpolate=False)
point_in_curve = PointInCurve(Point=face_normals.Centers, Curve=curve)  # -> Relationship, Point
larger_than = LargerThan(FirstNumber=point_in_curve.Relationship, SecondNumber=1)  # -> LargerThan, OrEqualTo
cull_pattern = CullPattern(List=mesh_explode_2, CullPattern=larger_than.LargerThan)  # -> simplify(List)
clean_tree = CleanTree(RemoveNulls=True, RemoveInvalid=True, RemoveEmpty=True, Tree=cull_pattern)
mesh_join = MeshJoin(Meshes=flatten(clean_tree))

bounding_box = BoundingBox(Content=mesh_2, Plane=PlaneXY(0, 0, 0))  # -> Box, Box_2
bounding_box_2 = BoundingBox(Content=mesh_3, Plane=PlaneXY(0, 0, 0))  # -> Box, Box_2
brep_wireframe = BrepWireframe(Brep=bounding_box.Box, Density=-1)
brep_wireframe_2 = BrepWireframe(Brep=bounding_box_2.Box, Density=-1)
# Moving tesselation to the right height
explode = Explode(Curve=brep_wireframe, Recursive=True)  # -> Segments, flatten(Vertices)
explode_2 = Explode(Curve=brep_wireframe_2, Recursive=True)  # -> Segments, Vertices
list_item = ListItem(List=flatten(explode_2.Vertices), Index=0, Wrap=True)
list_item_2 = ListItem(List=explode.Vertices, Index=0, Wrap=True)
vector_2pt = Vector2Pt(PointA=list_item_2, PointB=list_item, Unitize=False)  # -> Vector, Length
move = Move(Geometry=mesh_2, Motion=vector_2pt.Vector)  # -> Geometry, Transform

# ---- group: Moved tesselation
mesh_4 = Mesh(move.Geometry)

# ---- group: Junction mesh
mesh_5 = Mesh(mesh_join)

# ---- group: Dome Tesselation Input
mesh_6 = Mesh(mesh_4)

# ----
# Making the desired pattern
weaverbird_s_split_triangles_subdivision = WeaverbirdsSplitTrianglesSubdivision(MeshCurves=mesh_6, Level=2)  # -> flatten(OutputMeshCurves)
x_2 = X2(G=weaverbird_s_split_triangles_subdivision, T0=0.5, T1=0.5, D=0, N=1, S=1, C=Toggle(True))  # -> out, A; inputs G: GeometryBase, I: list, T0: list, T1: list, D: list, N: list, S: list, clr: list of Color
# ---------- x_2: VB ----------
    Component.Params.Input(0).Name = "Mesh or Curve"
    Component.Params.Input(0).Description = "Open or closed mesh or curve"
    Component.Params.Input(1).Name = "Index [Face]"
    Component.Params.Input(1).Description = "An optional integer or list of integers which specify the faces to be modified if the input is a mesh. If no value is supplied then all faces will be modified"
    Component.Params.Input(2).Name = "Along Edge"
    Component.Params.Input(2).Description = "Evaluates a new vertex along the input geometry's edge"
    Component.Params.Input(3).Name = "Edge to Face"
    Component.Params.Input(3).Description = "Evaluates a new vertex between the input geometry's edge midpoint to the face center"
    Component.Params.Input(4).Name = "Distance"
    Component.Params.Input(4).Description = "Sets the depth for the center point offset of each face"
    Component.Params.Input(5).Name = "Normalize"
    Component.Params.Input(5).Description = "If true averages the vertex values per face, if false each new vertices parameters are associated to its origin vertex"
    Component.Params.Input(6).Name = "Stellate"
    Component.Params.Input(6).Description = "A unitized per vertex number which shifts the offset vector from vertex = 0 to face = 1 normal"
    Component.Params.Input(7).Name = "Close"
    Component.Params.Input(7).Description = "If true then additional faces and if needed vertices will be added to the mesh, covering the complete areas of the existing mesh"
    Component.Params.Input(8).Name = "Color [Vertex]"
    Component.Params.Input(8).Description = "(If applied to a mesh a list of colors corresponding to each mesh face, if applied to a curve, a list of colors corresponding to each control point plus an additonal color value for the new averaged center"

    Component.Params.Output(1).Name = "Mesh"
    Component.Params.Output(1).Description = "If successful, a valid mesh"

    If G IsNot Nothing Then

      Dim bM, bP,bmC,biC As Boolean

      bM = g.ObjectType = ObjectType.Mesh
      bP = g.ObjectType = ObjectType.Curve

      If (bM Or bP) Then
        Dim msh As New mesh
        Dim crv As curve
        Dim av As point3d
        Dim ac As color
        Dim h,j,jj,k,u,v,w As Integer
        Dim cv,cf,ce As Integer
        Dim x(),y() As Integer

        Dim mv,fv,ep,eop,tv As New list(Of Point3d)
        Dim mev As New dictionary(Of String, Integer)
        Dim mf As Rhino.Geometry.Collections.MeshFaceList = Nothing
        Dim mtv As Rhino.Geometry.Collections.MeshTopologyVertexList = Nothing
        Dim mte As Rhino.Geometry.Collections.MeshTopologyEdgeList = Nothing
        Dim mn As Rhino.Geometry.Collections.MeshVertexNormalList = Nothing
        Dim mfn As Rhino.Geometry.Collections.MeshFaceNormalList = Nothing
        Dim ev As New list(Of vector3d)
        Dim ed,en As New list(Of Double)
        Dim mc,ec,eoc,tc,cc,fc As New list(Of color)
        Dim xf As New list(Of meshface)

        If clr.count() = 0 Then clr.add(color.LightGray) Else biC = True

        If bm Then
          'Start Deconstruct if Mesh
          msh = g

          If msh.Normals.Count() = 0 Then msh.Normals.ComputeNormals()
          If msh.FaceNormals.Count() = 0 Then msh.FaceNormals.ComputeFaceNormals()

          If i.count() = 0 Then I = Enumerable.Range(0, msh.Faces.Count()).ToList()

          mv = msh.Vertices().ToPoint3dArray().tolist()
          mte = msh.TopologyEdges()
          mtv = msh.TopologyVertices()
          mf = msh.Faces()

          mn = msh.Normals()
          mn.UnitizeNormals()
          mfn = msh.FaceNormals()
          mfn.UnitizeFaceNormals()

          cf = I.Count() - 1
          ce = mte.count() - 1

          'Assign Colors
          If msh.VertexColors.Count() < 1 Then
            msh.VertexColors.CreateMonotoneMesh(color.LightGray)
            bmC = biC
          Else
            bmC = True
          End If
          'Assign fake edges
          mc = msh.VertexColors().ToArray().ToList()
        Else
          'Start Deconstruct if Curve
          crv = g

          I.clear()
          I.add(0)
          Dim nc As nurbscurve
          Dim pc As polyline
          Dim nps As Rhino.Geometry.Collections.NurbsCurvePointList

          nc = crv.ToNurbsCurve()
          nps = nc.Points
          pc = nc.Points.ControlPolygon
          If (Not pc.IsClosed) Then pc.add(pc(0))
          av = pc.CenterPoint

          msh.Vertices.AddVertices(pc.ToArray())
          msh.faces.addfaces(pc.TriangulateClosedPolyline())
          msh.Vertices.Remove(pc.count() - 1, True)
          msh.FaceNormals.ComputeFaceNormals()
          msh.Normals.ComputeNormals()
          msh.Normals.UnitizeNormals()

          mv = msh.Vertices.ToPoint3dArray().tolist()
          mte = msh.TopologyEdges()
          mtv = msh.TopologyVertices()
          mn = msh.Normals()
          mfn = msh.FaceNormals()

          mfn(0) = avgVec(mn.toarray())

          'Assign Colors
          If bic Then bmC = True
          mc = clr
          If (clr.count() - 1) < (mv.count() - 1) Then mc = matchClr(mc, mv.count() - 1)

          ac = avgClr(mc.toarray())
          cf = 0
        End If
        cv = mv.count() - 1
        ce = mte.count() - 1

        x = appendprepend(cv)
        'Match variables and colors to vertex count
        If (T0.count() - 1) < cv Then T0 = matchDbl(T0, cv)
        If (T1.count() - 1) < cv Then T1 = matchDbl(T1, cv)
        If (D.count() - 1) < cv Then D = matchDbl(D, cv)
        If (N.count() - 1) < cv Then N = matchDbl(N, cv)
        If (S.count() - 1) < cv Then S = matchDbl(S, cv)
        If (clr.count() - 1) < cv Then clr = matchClr(clr, cv)
        If biC Then fc = clr Else fc = mc

        'Edge based vertices
        k = 0
        For j = 0 To mte.count() - 1 Step 1
          If (bm Or (bp And (mte.GetConnectedFaces(j).Count() < 2))) Then
            u = mtv.MeshVertexIndices(mte.GetTopologyVertices(j).I)(0)
            v = mtv.MeshVertexIndices(mte.GetTopologyVertices(j).J)(0)

            eop.add(evalP(mv(u), mv(v), T0(u) / 2))
            eoc.add(evalC(mc(u), mc(v), T0(u) / 2))
            mev.add(u & "," & v & "," & 0, w)

            ep.add(evalP(mv(u), mv(v), 0.5))
            ev.add(evalV(mn(u), mn(v), 0.5))
            ed.add(evalN(d(u), d(v), 0.5))
            en.add(evalN(N(u), N(v), 0.5))
            ec.add(evalC(mc(u), mc(v), 0.5))
            mev.add(u & "," & v & "," & 1, k)
            mev.add(v & "," & u & "," & 1, k)

            eop.add(evalP(mv(v), mv(u), T0(v) / 2))
            eoc.add(evalC(mc(v), mc(u), T0(v) / 2))
            mev.add(v & "," & u & "," & 0, w + 1)
            k += 1
            w += 2
          End If
        Next

        'Face based vertices
        Dim xv(),mt(),ei() As Integer
        Dim xc() As color
        Dim xd,xn As Double
        Dim txv(0) As vector3d
        ReDim ei(2)
        u = 1
        v = eop.count() + mv.count() + cf + 1

        For jj = 0 To I.count() - 1 Step 1
          Dim tcv As New point3d
          j = I(jj)
          w = v + tv.count()
          xd = 0
          xn = 0
          If bm Then
            If mf(j).isquad() Then h = 4 Else h = 3
            ReDim xv(h - 1)
            ReDim xc(h - 1)
            mt = mf.GetTopologicalVertices(j)
            For k = 0 To h - 1 Step 1
              xv(k) = mtv.MeshVertexIndices(mt(k))(0)
              xc(k) = fc(xv(k))
            Next
            av = mf.GetFaceCenter(j)
            ac = avgClr(xc)
          Else
            h = mv.count()
            xv = Enumerable.Range(0, h).ToArray()
          End If
          For k = 0 To h - 1 Step 1
            xd += D(xv(k))
            xn += T1(xv(k))
          Next
          xd /= h
          xn /= h
          mfn(j) *= xd
          y = appendprepend(h - 1)

          For k = 1 To h Step 1
            ei(0) = mev.item(xv(y(k)) & "," & xv(y(k + 1)) & "," & 0)
            ei(1) = mev.item(xv(y(k + 1)) & "," & xv(y(k)) & "," & 0)
            ei(2) = mev.item(xv(y(k)) & "," & xv(y(k + 1)) & "," & 1)

            txv(0) = ev(ei(2)) * evalN(eD(ei(2)) * (t1(xv(y(k))) + t1(xv(y(k + 1)))) / 2, xd * xn, eN(ei(2)))

            'Define new per face vertices
            tv.add(evalP(ep(ei(2)) + txv(0), evalP(ep(ei(2)), av + evalV(txv(0), mfn(j), (t1(xv(y(k))) + t1(xv(y(k + 1)))) / 2), (t1(xv(y(k))) + t1(xv(y(k + 1)))) / 2), S(xv(y(k)))))
            tc.add(evalC(ec(ei(2)), ac, (t1(xv(y(k))) + t1(xv(y(k + 1)))) / 2))

            tcv += tv.item(tv.count() - 1)
            'Define new faces
            xf.add(New meshface(v + jj - cf - 1, eop.count() + xv(y(k)), ei(0), w + y(k) * u))
            xf.add(New meshface(eop.count() + xv(y(k + 1)), v + jj - cf - 1, w + y(k) * u, ei(1)))

            If c Then xf.add(New meshface(ei(1), w + y(k) * u, ei(0)))
          Next
          tcv /= h
          fv.add(tcv)
          cc.add(ac)
        Next

        Dim om As New mesh
        om.Vertices.AddVertices(eop.toarray())
        If bmC Then om.VertexColors.AppendColors(eoc.toarray())

        om.Vertices.AddVertices(mv)
        If bmC Then om.VertexColors.AppendColors(mc.toarray())

        om.Vertices.AddVertices(fv)
        If bmC Then om.VertexColors.AppendColors(cc.toarray())

        om.Vertices.AddVertices(tv.toarray())
        If bmC Then om.VertexColors.AppendColors(tc.toarray())

        om.Faces.AddFaces(xf.toarray())

        If i.count() > 1 Then om.Vertices.CullUnused()

        A = om
      End If
    End If
# ---------- x_2: VB additional code ----------
  Private Function appendprepend(ByVal i As Integer)
    Dim srsEnum As IEnumerable(Of Integer) = Enumerable.Range(0, i + 1)
    Dim arrVal As New list(Of Integer)
    arrVal = srsEnum.tolist()
    arrVal.add(0)
    arrVal.insert(0, i)
    Return arrVal.toarray()
  End Function

  Private Function matchDbl(ByVal a As list(Of Double), ByVal t As Integer)
    Dim i,k As Integer
    k = a.count()
    For i = 0 To ((t + 1) - k) - 1 Step 1
      a.add(a.item(k - 1))
    Next
    Return a
  End Function

  Private Function matchClr(ByVal a As list(Of Color), ByVal t As Integer)
    Dim i,k As Integer
    k = a.count()
    For i = 0 To ((t + 1) - k) - 1 Step 1
      a.add(a.item(k - 1))
    Next
    Return a
  End Function

  Private Function evalP(ByVal op As point3d, ByVal tp As Point3d, ByVal t As Double)
    Return New point3d(op + (tp - op) * t)
  End Function

  Private Function evalV(ByVal ov As vector3d, ByVal tv As vector3d, ByVal t As Double)
    Return New vector3d(ov + (tv - ov) * t)
  End Function

  Private Function evalN(ByVal u As Double, ByVal v As Double, ByVal t As Double)
    Return u + (v - u) * t
  End Function

  Private Function avgVec(ByVal v() As vector3f)
    Dim i As Integer
    Dim tv As Vector3d

    For i = 0 To ubound(v) Step 1
      tv += v(i)
    Next
    tv /= (ubound(v) + 1)
    tv.Unitize()
    Return New vector3f(tv.X, tv.Y, tv.Z)
  End Function

  Private Function roundClr(ByVal r As Integer, ByVal g As Integer, ByVal b As Integer, ByVal i As Integer)
    r = CInt(r / i)
    g = CInt(g / i)
    b = CInt(b / i)

    If r > 255 Then r = 255 Else If r < 0 Then r = 0
    If g > 255 Then g = 255 Else If g < 0 Then g = 0
    If b > 255 Then b = 255 Else If b < 0 Then b = 0

    Return color.FromArgb(r, g, b)
  End Function

  Private Function avgClr(ByVal c() As color)
    Dim r,g,b As Integer
    Dim i,k As Integer

    k = ubound(c) + 1

    For i = 0 To k - 1 Step 1
      r += CInt(c(i).R)
      g += CInt(c(i).G)
      b += CInt(c(i).B)
    Next

    r = CInt(r / k)
    g = CInt(g / k)
    b = CInt(b / k)

    If r > 255 Then r = 255 Else If r < 0 Then r = 0
    If g > 255 Then g = 255 Else If g < 0 Then g = 0
    If b > 255 Then b = 255 Else If b < 0 Then b = 0

    Return color.FromArgb(r, g, b)
  End Function

  Private Function evalC(ByVal oc As color, ByVal tc As color, ByVal t As Double)
    Dim r,g,b As Integer
    r = CInt(CInt(oc.R) + (CInt(tc.R) - CInt(oc.R)) * t)
    g = CInt(CInt(oc.G) + (CInt(tc.G) - CInt(oc.G)) * t)
    b = CInt(CInt(oc.B) + (CInt(tc.B) - CInt(oc.B)) * t)

    If r > 255 Then r = 255 Else If r < 0 Then r = 0
    If g > 255 Then g = 255 Else If g < 0 Then g = 0
    If b > 255 Then b = 255 Else If b < 0 Then b = 0

    Return color.FromArgb(r, g, b)
  End Function

  ''' <summary>
  ''' This method will be called once every solution, before any calls to RunScript.
  ''' </summary>
  Public Overrides Sub BeforeRunScript()
  End Sub
  ''' <summary>
  ''' This method will be called once every solution, after any calls to RunScript.
  ''' </summary>
  Public Overrides Sub AfterRunScript()
  End Sub
# ---------- end x_2 ----------

# ---- group: Corridor Junction / Dome Tesselation Input
mesh_7 = Mesh(mesh_5)

# ---- group: Corridor Junction / Relaxed dome Input
mesh_8 = Mesh(data_5)

# ---- group: mesh output
mesh_9 = Mesh(x_2.A)

# ---- group: mesh input
mesh_10 = Mesh(mesh_9)

# ----
# Making the Muqarnas Plan
ghpython_script = GhPythonScript(mesh=mesh_10)  # -> out, Inv; inputs mesh: Mesh
# ---------- ghpython_script: Python ----------
# AR3B011 EARTHY (2019/20 Q1)
# Zaatari refugee camp Hammam project: "Janat Al-Tohr
#Group Members: Nikoleta Sidiropoulou,  Hans Gamerschlag, Noah van den Berg, Rick van Dijk, Maximilian Mandat, Hamidreza Shahriari

import rhinoscriptsyntax as rs
import ghpythonlib.components as ghc
lst=[]
edges=[]
Mess=[]
bollen=[]
face=[]
Inv=[]
#Finding the naked edges of the Mesh

meshEdg= ghc.MeshEdges(mesh)[0]
Edg= ghc.JoinCurves(meshEdg, True)

#Finding the boundary lines of the mesh
faceBound= ghc.FaceBoundaries(mesh)

#colliding the naked edges with boundary face of the mesh to find the faces touching the naked edges
coll= ghc.CollisionOneXMany(faceBound,Edg)[0]
meshCull= ghc.CullFaces(mesh,coll)

# Sepprating the faces touching the naked edges
meshCullInv= ghc.CullFaces(mesh,[not i for i in coll])
Inv.append(meshCullInv)
lst.append(meshCull)
bollen.append(coll)
face.append(faceBound)
i=0
edges.append(Edg)

#Making a loop to find the slabs of the Muqarnas
while i<400:
    try:
        meshEdg= ghc.MeshEdges(lst[-1])[0]
        Edg= ghc.JoinCurves(meshEdg, True)
        faceBound= ghc.FaceBoundaries(lst[-1])
        coll= ghc.CollisionOneXMany(faceBound,Edg)[0]
        meshCull= ghc.CullFaces(lst[-1],coll)
        meshes= ghc.CullFaces(lst[-1],coll)
        meshCullInv= ghc.CullFaces(lst[-1],[not i for i in coll])
        Inv.append(meshCullInv)
        Mess.append(meshes)
        bollen.append(coll)
        lst.append(meshCull)
        edges.append(Edg)
        face.append(faceBound)
    except:
        break
    i=i+1
# ---------- end ghpython_script ----------

# ---- group: Muqarnas Plan
mesh_11 = Mesh(ghpython_script.Inv)

# ---- group: Muqarnas Plan input
mesh_12 = Mesh(mesh_11)

# ---- group: Relaxed dome Input
mesh_13 = Mesh(data_2)

# ----
mesh_explode_3 = MeshExplode(Mesh=mesh_12, Interpolate=False)
# Finding the height of each element
unit_z = UnitZ(Factor=1)
face_normals_2 = FaceNormals(Mesh=mesh_explode_3)  # -> Centers, Normals
project_point = ProjectPoint(Point=face_normals_2.Centers, Direction=unit_z, Geometry=mesh_13)  # -> Point, Index
shift_paths = ShiftPaths(Data=project_point.Point, Offset=-1)
deconstruct = Deconstruct(Point=shift_paths)  # -> XComponent, YComponent, ZComponent
number_slider = Slider(0, range=0..100)
average = Average(Input=deconstruct.ZComponent)  # -> flatten(ArithmeticMean)
insert_items = InsertItems(List=average, Item=number_slider, Indices=number_slider, Wrap=True)

ghpython_script_2 = GhPythonScript(x=insert_items)  # -> out, a; inputs x: list
# ---------- ghpython_script_2: Python ----------
__author__ = "Hamidreza"
__version__ = "2019.11.02"

import math
a=[]
l=[]
l.append(x[0])
b= x[1:]
for i in b:
    sub= i - l[-1]
    l.append(i)
    a.append(sub)
# ---------- end ghpython_script_2 ----------

# ---- group: muqarnas height ouput
number = Number(ghpython_script_2.a)

# ---- group: Muqarnas Plan output
mesh_14 = Mesh(mesh_11)

# ---- group: muqarnas height input
# Making the muqarnas elements from the plan
number_2 = Number(number)

# ----
mesh_explode_4 = MeshExplode(Mesh=mesh_14, Interpolate=False)  # -> simplify(Faces)
negative = Negative(Value=number_2)
offset_mesh = OffsetMesh(Mesh=mesh_explode_4, Distance=graft(negative), BothSides=False, CreateSolid=True)  # -> simplify(Offset)
shift_paths_2 = ShiftPaths(Data=offset_mesh, Offset=-1)

# ---- group: Dome mesh-output
mesh_15 = Mesh(geometry)

# ---- group: Muqarnas move output
mesh_16 = Mesh(shift_paths_2)

# ---- group: muqarnas height input
number_3 = Number(number)

# ---- group: Muqarnas move input
mesh_17 = Mesh(mesh_16)

# ---- group: moved Tesselation Input
mesh_18 = Mesh(mesh_4)

# ---- group: Muqarnas Plan
mesh_19 = Mesh(flatten(mesh_11))

# ---- group: muqarnas height ouput
number_4 = Number(number)

# ----
cull_index = CullIndex(List=mesh_19, Indices=0, Wrap=True)
weaverbird_s_naked_boundary = WeaverbirdsNakedBoundary(MeshClosedPolylines=mesh_18)
join_curves = JoinCurves(Curves=weaverbird_s_naked_boundary, Preserve=False)
mesh_edges = MeshEdges(Mesh=cull_index)  # -> simplify(NakedEdges), InteriorEdges, NonManifoldEdges
discontinuity = Discontinuity(Curve=mesh_edges.NakedEdges, Level=1)  # -> Points, Parameters
removeduplicatelines = RemoveDuplicateLines(Lines=mesh_edges.NakedEdges, Tolerance=0.01)
number_slider_2 = Slider(0, range=0..100)
shift_paths_3 = ShiftPaths(Data=discontinuity.Points, Offset=-1)  # -> simplify(Data)
curve_closest_point = CurveClosestPoint(Point=shift_paths_3, Curve=join_curves)  # -> Point, Parameter, Distance
# Finding the curves for addistional mass at the back
bounds = Bounds(Numbers=curve_closest_point.Distance)
deconstruct_domain = DeconstructDomain(Domain=bounds)  # -> flatten(Start), End
join_curves_2 = JoinCurves(Curves=removeduplicatelines, Preserve=False)  # -> simplify(graft(Curves))
offset_curve = OffsetCurve(Curve=join_curves, Distance=deconstruct_domain.Start, Plane=PlaneXY(0, 0, 0), BothSides=False, Kinks=0, CapType=1)  # -> simplify(flatten(Offset))
shift_paths_4 = ShiftPaths(Data=join_curves_2, Offset=-1)  # -> flatten(Data)

cull_index_2 = CullIndex(List=offset_curve, Indices=0, Wrap=True)  # -> simplify(List)
cull_pattern_2 = CullPattern(List=shift_paths_4, CullPattern=[False, False, True, True])  # -> simplify(List)

# ---- group: Dome mesh-output
mesh_20 = Mesh(data_2)

# ----
list_length = ListLength(List=cull_index_2)
x_minus_one = XMinusOne(NumberX=list_length)
x_minus_one_2 = XMinusOne(NumberX=x_minus_one)
cull_index_3 = CullIndex(List=cull_index_2, Indices=[x_minus_one, x_minus_one_2], Wrap=True)  # -> simplify(graft(List))

list_length_2 = ListLength(List=cull_pattern_2)
x_minus_one_3 = XMinusOne(NumberX=list_length_2)
x_minus_one_4 = XMinusOne(NumberX=x_minus_one_3)
cull_index_4 = CullIndex(List=cull_pattern_2, Indices=[x_minus_one_3, x_minus_one_4], Wrap=True)  # -> simplify(graft(List))

# ---- group: muqarnas height input
number_5 = Number(number)

# ----
geometry_2 = Geometry(cull_index_4)
cull_index_5 = CullIndex(List=number_5, Indices=0, Wrap=True)
mass_addition = MassAddition(Input=cull_index_5)  # -> Result, PartialResults
unit_z_2 = UnitZ(Factor=mass_addition.PartialResults)
move_2 = Move(Geometry=simplify(geometry_2), Motion=simplify(graft(unit_z_2)))  # -> flatten(Geometry), Transform

# ---- group: muqarnas height input
number_6 = Number(number)

# ----
geometry_3 = Geometry(cull_index_3)
# Moving to the right height
cull_index_6 = CullIndex(List=number_6, Indices=0, Wrap=True)
mass_addition_2 = MassAddition(Input=cull_index_6)  # -> Result, PartialResults
unit_z_3 = UnitZ(Factor=mass_addition_2.PartialResults)
move_3 = Move(Geometry=simplify(geometry_3), Motion=simplify(graft(unit_z_3)))  # -> Geometry, Transform

# ---- group: Boundary lines
curve_2 = Curve(move_3.Geometry)

# ---- group: Cutter lines
curve_3 = Curve(move_2.Geometry)

curve_4 = Curve(curve_3)

# ---- group: Boundary lines
curve_5 = Curve(curve_2)

# ---- group: Corridor Junction
curve_6 = Curve(data_3)
bounding_box_3 = BoundingBox(Content=mesh_7, Plane=PlaneXY(0, 0, 0))  # -> Box, Box_2
bounding_box_4 = BoundingBox(Content=mesh_8, Plane=PlaneXY(0, 0, 0))  # -> Box, Box_2
brep_wireframe_3 = BrepWireframe(Brep=bounding_box_3.Box, Density=-1)
brep_wireframe_4 = BrepWireframe(Brep=bounding_box_4.Box, Density=-1)
# Moving tesselation to the right height
explode_3 = Explode(Curve=brep_wireframe_3, Recursive=True)  # -> Segments, flatten(Vertices)
explode_4 = Explode(Curve=brep_wireframe_4, Recursive=True)  # -> Segments, Vertices
list_item_3 = ListItem(List=flatten(explode_4.Vertices), Index=0, Wrap=True)
list_item_4 = ListItem(List=explode_3.Vertices, Index=0, Wrap=True)

# ----
deconstruct_2 = Deconstruct(Point=list_item_3)  # -> XComponent, YComponent, ZComponent
deconstruct_3 = Deconstruct(Point=list_item_4)  # -> XComponent, YComponent, ZComponent
subtraction = Subtraction(A=deconstruct_2.ZComponent, B=deconstruct_3.ZComponent)
unit_z_4 = UnitZ(Factor=subtraction)

# ---- group: Corridor Junction (continued)
move_4 = Move(Geometry=mesh_7, Motion=unit_z_4)  # -> Geometry, Transform

# ----
move_5 = Move(Geometry=curve_6, Motion=unit_z_4)  # -> Geometry, Transform

# ---- group: Corridor Junction / Moved tesselation
mesh_21 = Mesh(move_4.Geometry)

# ---- group: Corridor Junction / Moved Corridor Junction Curve
curve_7 = Curve(move_5.Geometry)

# ---- group: mesh input
# Selecting the two adjacent walls which muqarnas is going to be placed on
mesh_22 = Mesh(mesh_21)

# ---- group: Corridor Junction Input
curve_8 = Curve(curve_7)

# ----
panel = Panel("""0
4""")
explode_5 = Explode(Curve=curve_8, Recursive=True)  # -> Segments, Vertices
list_item_5 = ListItem(List=explode_5.Segments, Index=panel, Wrap=True)
join_curves_3 = JoinCurves(Curves=list_item_5, Preserve=False)

# ----
# Making the plan of muqarnas
ghpython_script_3 = GhPythonScript(mesh=mesh_22, Edg=join_curves_3)  # -> out, Inv; inputs mesh: Mesh, Edg: Curve
# ---------- ghpython_script_3: Python ----------
# AR3B011 EARTHY (2019/20 Q1)
# Zaatari refugee camp Hammam project: "Janat Al-Tohr
#Group Members: Nikoleta Sidiropoulou,  Hans Gamerschlag, Noah van den Berg, Rick van Dijk, Maximilian Mandat, Hamidreza Shahriari

import rhinoscriptsyntax as rs
import ghpythonlib.components as ghc
lst=[]
face=[]
Inv=[]

#Finding the boundary lines of the mesh
faceBound= ghc.FaceBoundaries(mesh)

#colliding the wall edges with boundary face of the mesh to find the faces touching the walls
coll= ghc.CollisionOneXMany(faceBound,Edg)[0]
meshCull= ghc.CullFaces(mesh,coll)

# Sepprating the faces touching the walls
meshCullInv= ghc.CullFaces(mesh,[not i for i in coll])
lst.append(meshCull)
face.append(faceBound)
Inv.append(meshCullInv)
meshEdg= ghc.MeshEdges(Inv[-1])[0]

#Making a loop to find the slabs of the Muqarnas
while i<100:
    try:
        meshEdg= ghc.MeshEdges(Inv[-1])[0]
        InEdg= ghc.JoinCurves(meshEdg, True)
        faceBound= ghc.FaceBoundaries(lst[-1])
        coll= ghc.CollisionOneXMany(faceBound,InEdg)[0]
        meshCull= ghc.CullFaces(lst[-1],coll)
        meshCullInv= ghc.CullFaces(lst[-1],[not i for i in coll])
        meshes= ghc.CullFaces(lst[-1],coll)
        lst.append(meshCull)
        Inv.append(meshCullInv)
        face.append(faceBound)
    except:
        break
    i=i+1
# ---------- end ghpython_script_3 ----------

# ---- group: Muqarnas Plan
mesh_23 = Mesh(ghpython_script_3.Inv)

# ---- group: Muqarnas Plan input
mesh_24 = Mesh(mesh_23)

# ----
face_normals_3 = FaceNormals(Mesh=mesh_24)  # -> flatten(Centers), Normals
deconstruct_4 = Deconstruct(Point=face_normals_3.Centers)  # -> XComponent, YComponent, ZComponent
list_item_6 = ListItem(List=deconstruct_4.ZComponent, Index=0, Wrap=True)

mesh_explode_5 = MeshExplode(Mesh=mesh_24, Interpolate=False)
unit_z_5 = UnitZ(Factor=1)
# Finding the height of each element
face_normals_4 = FaceNormals(Mesh=mesh_explode_5)  # -> Centers, Normals
project_point_2 = ProjectPoint(Point=face_normals_4.Centers, Direction=unit_z_5, Geometry=mesh_15)  # -> Point, Index
shift_paths_5 = ShiftPaths(Data=project_point_2.Point, Offset=-1)
deconstruct_5 = Deconstruct(Point=shift_paths_5)  # -> XComponent, YComponent, ZComponent
average_2 = Average(Input=deconstruct_5.ZComponent)  # -> flatten(ArithmeticMean)
insert_items_2 = InsertItems(List=average_2, Item=list_item_6, Indices=Slider(0, range=0..100), Wrap=True)

ghpython_script_4 = GhPythonScript(x=insert_items_2)  # -> out, a; inputs x: list; same code as ghpython_script_2

# ---- group: muqarnas height ouput
number_7 = Number(ghpython_script_4.a)

# ---- group: muqarnas height input
# Making the muqarnas elements from the plan
number_8 = Number(number_7)

# ---- group: Muqarnas Plan output
mesh_25 = Mesh(mesh_23)

# ----
absolute = Absolute(Value=number_8)

mesh_explode_6 = MeshExplode(Mesh=mesh_25, Interpolate=False)  # -> simplify(Faces)
negative_2 = Negative(Value=absolute)
offset_mesh_2 = OffsetMesh(Mesh=mesh_explode_6, Distance=graft(absolute), BothSides=False, CreateSolid=True)  # -> simplify(Offset)
shift_paths_6 = ShiftPaths(Data=offset_mesh_2, Offset=-1)

# ---- group: Muqarnas move output
mesh_26 = Mesh(shift_paths_6)

# ---- group: muqarnas height input
number_9 = Number(number_7)

# ---- group: Muqarnas move input
mesh_27 = Mesh(mesh_26)

# ----
number_slider_3 = Slider(0, range=0..100)
# Moving the elements to right height
cull_index_7 = CullIndex(List=number_3, Indices=0, Wrap=True)

mass_addition_3 = MassAddition(Input=cull_index_7)  # -> Result, PartialResults

insert_items_3 = InsertItems(List=mass_addition_3.PartialResults, Item=number_slider_3, Indices=number_slider_3, Wrap=True)

unit_z_6 = UnitZ(Factor=insert_items_3)
move_6 = Move(Geometry=simplify(mesh_17), Motion=simplify(graft(unit_z_6)))  # -> Geometry, Transform

# ---- group: Muqarnas output
mesh_28 = Mesh(move_6.Geometry)

mesh_29 = Mesh(mesh_28)

# ----
tree_statistics = TreeStatistics(Tree=mesh_29)  # -> Paths, Length, Count
# Making holes at top
x_minus_one_5 = XMinusOne(NumberX=tree_statistics.Count)
x_minus_one_6 = XMinusOne(NumberX=x_minus_one_5)
cull_index_8 = CullIndex(List=tree_statistics.Paths, Indices=[x_minus_one_5, x_minus_one_6], Wrap=True)
tree_branch = TreeBranch(Tree=mesh_29, Path=cull_index_8, MaintainPaths=True)

# ---- group: Muqarnas with light
mesh_30 = Mesh(tree_branch)

# ---- group: Muqarnas light input
mesh_31 = Mesh(mesh_30)

# ----
# Cutting the elements
negative_3 = Negative(Value=Slider(0.5, range=0..1))
offset_mesh_3 = OffsetMesh(Mesh=mesh_20, Distance=negative_3, BothSides=False, CreateSolid=False)
mesh_to_polysurface = MeshToPolysurface(Mesh=mesh_31, Triangles=False, FaceMerge=False)

mesh_to_polysurface_2 = MeshToPolysurface(Mesh=offset_mesh_3, Triangles=False, FaceMerge=False)

solid_difference = SolidDifference(BrepsA=simplify(mesh_to_polysurface), BrepsB=mesh_to_polysurface_2)  # -> simplify(Result)

# ---- group: Muqarnas trimed
brep = Brep(solid_difference)

# ----
bounding_box_5 = BoundingBox(Content=brep, Plane=PlaneXY(0, 0, 0), UnionBox=True)  # -> Box, Box_2
tree_statistics_2 = TreeStatistics(Tree=brep)  # -> Paths, Length, Count
series = Series(Start=1, Step=1, Count=expr("x-1", tree_statistics_2.Count))
number_slider_4 = Slider(9, range=0..10)
brep_wireframe_5 = BrepWireframe(Brep=bounding_box_5.Box, Density=-1)
list_item_7 = ListItem(List=brep_wireframe_5, Index=number_slider_4, Wrap=True)  # -> simplify(Item)
list_item_8 = ListItem(List=brep_wireframe_5, Index=number_slider_4, Wrap=True)
tree_branch_2 = TreeBranch(Tree=brep, Path="{0}", MaintainPaths=True)
# merging the first two layers for additional support
tree_branch_3 = TreeBranch(Tree=brep, Path=series, MaintainPaths=True)
tree_branch_4 = TreeBranch(Tree=list_item_7, Path="{1}", MaintainPaths=True)
length = Length(Curve=list_item_8)  # -> flatten(Length)
length_2 = Length(Curve=tree_branch_4)
cull_index_9 = CullIndex(List=length, Indices=[0, 1, 14], Wrap=True)  # -> graft(List)
unit_z_7 = UnitZ(Factor=length_2)
move_7 = Move(Geometry=tree_branch_2, Motion=unit_z_7)  # -> Geometry, Transform

# ---- group: Extusion
data_6 = Data(cull_index_9)

# ---- group: Muqarnas With first floor
brep_2 = Brep([tree_branch_3, move_7.Geometry])

# ---- group: Extrusion
data_7 = Data(data_6)

# ----
fragment_patch = FragmentPatch(Boundary=curve_5)  # -> flatten(Patch)
split_brep = SplitBrep(Brep=fragment_patch, Cutter=curve_4)
area = Area(Geometry=split_brep)  # -> Area, Centroid
# Making the mass behind the elements
smaller_than = SmallerThan(FirstNumber=area.Area, SecondNumber=Slider(2.1, range=0..10))  # -> SmallerThan, OrEqualTo
cull_pattern_3 = CullPattern(List=split_brep, CullPattern=smaller_than.SmallerThan)
clean_tree_2 = CleanTree(RemoveNulls=True, RemoveInvalid=True, RemoveEmpty=True, Tree=cull_pattern_3)
unit_z_8 = UnitZ(Factor=data_7)
extrude = Extrude(Base=simplify(clean_tree_2), Direction=simplify(unit_z_8))

# ---- group: Muqarnass mass
brep_3 = Brep(extrude)

# ---- group: Final Muqarnas
brep_4 = Brep([brep_3, brep_2])

# ----
number_slider_5 = Slider(0, range=0..100)
cull_index_10 = CullIndex(List=number_9, Indices=0, Wrap=True)

mass_addition_4 = MassAddition(Input=number_9)  # -> Result, PartialResults

# ----
# Moving the elements to right height
insert_items_4 = InsertItems(List=mass_addition_4.PartialResults, Item=number_slider_5, Indices=number_slider_5, Wrap=True)

unit_z_9 = UnitZ(Factor=insert_items_4)
move_8 = Move(Geometry=simplify(mesh_26), Motion=simplify(graft(unit_z_9)))  # -> Geometry, Transform

negative_4 = Negative(Value=unit_z_9)

# ---- group: Muqarnas output
mesh_32 = Mesh(move_8.Geometry)
