# Grasshopper definition Aggreagation_Script.gh (Grasshopper 1.0.7)

# ---- group: Courtyard Variation Randomization
number_slider = Slider(8, range=0..10)

# ----
# WC1
connections_centers = Point([Point(-73.15184216, 92.4941682, 0), Point(-71.8928916, 91.2341682, 0), Point(-71.8928916, 88.7141682, 0), Point(-74.41079272, 91.2341682, 0), Point(-74.41079272, 88.7141682, 0), Point(-73.15184216, 87.4541682, 0), Point(-74.41079272, 89.9741682, 0), Point(-71.8928916, 89.9741682, 0)])
connections_x_axis = Curve([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])
# ALL WC MODULES
part_geometry = Brep(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)
part_name = Panel("WC")
conndir = Wasp_ConnectionFromDirection(GEO=part_geometry, CEN=connections_centers, UP=connections_x_axis)  # -> CONN, PLN_OUT; inputs CEN: list of Point3d, UP: list of Curve, T: list; plug-in component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
points = PointList(Points=connections_centers, Size=Slider(0.5, range=0..10))
advpart = Wasp_AdvancedPart(NAME=part_name, GEO=part_geometry, CONN=flatten(conndir.CONN))  # -> PART; inputs GEO: Mesh, CONN: list, COLL: Mesh, HI: list, ATTR: list, SUP: list; plug-in component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

# ----
# WC2
connections_centers_2 = Point([Point(-73.15184216, 92.4941682, 0), Point(-71.8928916, 91.2341682, 0), Point(-71.8928916, 88.7141682, 0), Point(-74.41079272, 91.2341682, 0), Point(-74.41079272, 88.7141682, 0), Point(-73.15184216, 87.4541682, 0), Point(-74.41079272, 89.9741682, 0), Point(-71.8928916, 89.9741682, 0)])
connections_x_axis_2 = Curve([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])
part_geometry_2 = Brep(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)
part_name_2 = Panel("WC2")
conndir_2 = Wasp_ConnectionFromDirection(GEO=part_geometry_2, CEN=connections_centers_2, UP=connections_x_axis_2)  # -> CONN, PLN_OUT; inputs CEN: list of Point3d, UP: list of Curve, T: list; plug-in component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
points_2 = PointList(Points=connections_centers_2, Size=Slider(1, range=0..10))
advpart_2 = Wasp_AdvancedPart(NAME=part_name_2, GEO=part_geometry_2, CONN=flatten(conndir_2.CONN))  # -> PART; inputs GEO: Mesh, CONN: list, COLL: Mesh, HI: list, ATTR: list, SUP: list; plug-in component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

# ----
# WC3
connections_centers_3 = Point([Point(-73.15184216, 92.4941682, 0), Point(-71.8928916, 91.2341682, 0), Point(-71.8928916, 88.7141682, 0), Point(-74.41079272, 91.2341682, 0), Point(-74.41079272, 88.7141682, 0), Point(-73.15184216, 87.4541682, 0), Point(-74.41079272, 89.9741682, 0), Point(-71.8928916, 89.9741682, 0)])
connections_x_axis_3 = Curve([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])
part_geometry_3 = Brep(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)
part_name_3 = Panel("WC3")
conndir_3 = Wasp_ConnectionFromDirection(GEO=part_geometry_3, CEN=connections_centers_3, UP=connections_x_axis_3)  # -> CONN, PLN_OUT; inputs CEN: list of Point3d, UP: list of Curve, T: list; plug-in component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
points_3 = PointList(Points=connections_centers_3, Size=Slider(1, range=0..10))
advpart_3 = Wasp_AdvancedPart(NAME=part_name_3, GEO=part_geometry_3, CONN=flatten(conndir_3.CONN))  # -> PART; inputs GEO: Mesh, CONN: list, COLL: Mesh, HI: list, ATTR: list, SUP: list; plug-in component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

# ----
# Entrance
connections_centers_4 = Point([Point(-59.99470826, 87.32086575, 0), Point(-61.25453335, 88.5796384, 0), Point(-61.25453335, 91.0971837, 0), Point(-58.73488317, 88.5796384, 0), Point(-58.73488317, 91.0971837, 0), Point(-59.99470826, 92.35595635, 0)])
connections_x_axis_4 = Curve([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])
part_geometry_4 = Brep(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)
part_name_4 = Panel("EN")
points_4 = PointList(Points=connections_centers_4, Size=Slider(1, range=0..10))
conndir_4 = Wasp_ConnectionFromDirection(GEO=part_geometry_4, CEN=connections_centers_4, UP=connections_x_axis_4)  # -> CONN, PLN_OUT; inputs CEN: list of Point3d, UP: list of Curve, T: list; plug-in component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
advpart_4 = Wasp_AdvancedPart(NAME=part_name_4, GEO=part_geometry_4, CONN=flatten(conndir_4.CONN))  # -> PART; inputs GEO: Mesh, CONN: list, COLL: Mesh, HI: list, ATTR: list, SUP: list; plug-in component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
panel = Panel("""5 = O
0 = NO CONNECTION""")
open = Panel("5")
no_connection = Panel("0")

# ----
# Normal Vault
# Internal Connection
connections_centers_5 = Point([<point referenced from the Rhino model> x8])
connections_x_axis_5 = Curve([<curve referenced from the Rhino model> x8])
part_geometry_5 = Brep(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)
part_name_5 = Panel("NVI")
conndir_5 = Wasp_ConnectionFromDirection(GEO=part_geometry_5, CEN=connections_centers_5, UP=connections_x_axis_5)  # -> CONN, PLN_OUT; inputs CEN: list of Point3d, UP: list of Curve, T: list; plug-in component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
points_5 = PointList(Points=connections_centers_5, Size=Slider(1, range=0..10))
advpart_5 = Wasp_AdvancedPart(NAME=part_name_5, GEO=part_geometry_5, CONN=flatten(conndir_5.CONN))  # -> PART; inputs GEO: Mesh, CONN: list, COLL: Mesh, HI: list, ATTR: list, SUP: list; plug-in component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

# ----
# Kitchen
connections_centers_6 = Point([Point(-95.78568557, 101.3654589, 0), Point(-97.04568557, 101.3654589, 0), Point(-94.52568557, 101.3654589, 0), Point(-95.78568557, 106.4061585, 0), Point(-97.04568557, 106.4061585, 0), Point(-94.52568557, 106.4061585, 0), Point(-98.30568557, 103.8858087, 0), Point(-98.30568557, 105.1459836, 0), Point(-98.30568557, 102.6256338, 0), Point(-93.26568557, 103.8858087, 0), Point(-93.26568557, 105.1459836, 0), Point(-93.26568557, 102.6256338, 0)])
connections_x_axis_6 = Curve([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])
part_geometry_6 = Brep(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)
part_name_6 = Panel("KT")
points_6 = PointList(Points=connections_centers_6, Size=Slider(0.5, range=0..10))
conndir_6 = Wasp_ConnectionFromDirection(GEO=part_geometry_6, CEN=connections_centers_6, UP=connections_x_axis_6)  # -> CONN, PLN_OUT; inputs CEN: list of Point3d, UP: list of Curve, T: list; plug-in component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
advpart_6 = Wasp_AdvancedPart(NAME=part_name_6, GEO=part_geometry_6, CONN=flatten(conndir_6.CONN))  # -> PART; inputs GEO: Mesh, CONN: list, COLL: Mesh, HI: list, ATTR: list, SUP: list; plug-in component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
panel_2 = Panel("""4 = O
5 = O""")
small_modules_closed = Panel("""1
2
11
10
5
4
7
8""")
# 1. Build Part
# Parts are the building blocks of Wasp.
# The most basic way of initializing a part is to define t he geometry (as brep or mesh),
# and the connection faces (center and orientation - with a line). Parts must be named
# to be identifyed in the aggregation rules.
big_modules_closed = Panel("""0
9
6
3""")
big_modules_open = Panel("""0
9
6
3""")

# ----
# 4 Domes
part_geometry_7 = Brep(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)
connections_centers_7 = Point([Point(-79.33131927, 101.3647169, 0), Point(-80.59131927, 101.3647169, 0), Point(-78.07131927, 101.3647169, 0), Point(-79.33131927, 106.4047169, 0), Point(-80.59131927, 106.4047169, 0), Point(-78.07131927, 106.4047169, 0), Point(-81.85131927, 103.8847169, 0), Point(-81.85131927, 102.6247169, 0), Point(-81.85131927, 105.1447169, 0), Point(-76.81131927, 103.8847169, 0), Point(-76.81131927, 102.6247169, 0), Point(-76.81131927, 105.1447169, 0)])
connections_x_axis_7 = Curve([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])
part_name_7 = Panel("4D")
conndir_7 = Wasp_ConnectionFromDirection(GEO=part_geometry_7, CEN=connections_centers_7, UP=connections_x_axis_7)  # -> CONN, PLN_OUT; inputs CEN: list of Point3d, UP: list of Curve, T: list; plug-in component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
points_7 = PointList(Points=connections_centers_7, Size=Slider(0.5, range=0..10))
advpart_7 = Wasp_AdvancedPart(NAME=part_name_7, GEO=part_geometry_7, CONN=flatten(conndir_7.CONN))  # -> PART; inputs GEO: Mesh, CONN: list, COLL: Mesh, HI: list, ATTR: list, SUP: list; plug-in component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

# ----
# Room with Riwaq
connections_centers_8 = Point([Point(-70.16669612, 101.5236689, 0), Point(-68.90652121, 105.303494, 0), Point(-73.94722084, 105.303494, 0), Point(-73.94722084, 102.7838438, 0), Point(-72.68704593, 101.5240187, 0), Point(-68.90652121, 102.7838438, 0), Point(-70.16669612, 106.5633191, 0), Point(-72.68704593, 106.5633191, 0), Point(-71.42687102, 101.5243685, 0), Point(-73.94722084, 104.0436689, 0), Point(-71.42687102, 106.5633191, 0), Point(-68.90652121, 104.0436689, 0)])
connections_x_axis_8 = Curve([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])
part_geometry_8 = Brep(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)
part_name_8 = Panel("RR")
conndir_8 = Wasp_ConnectionFromDirection(GEO=part_geometry_8, CEN=connections_centers_8, UP=connections_x_axis_8)  # -> CONN, PLN_OUT; inputs CEN: list of Point3d, UP: list of Curve, T: list; plug-in component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
points_8 = PointList(Points=connections_centers_8, Size=Slider(0.5, range=0..10))
advpart_8 = Wasp_AdvancedPart(NAME=part_name_8, GEO=part_geometry_8, CONN=flatten(conndir_8.CONN))  # -> PART; inputs GEO: Mesh, CONN: list, COLL: Mesh, HI: list, ATTR: list, SUP: list; plug-in component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

# ----
# Large Room
connections_centers_9 = Point([Point(-87.53504019, 101.3654589, 0), Point(-88.79504019, 101.3654589, 0), Point(-86.27504019, 101.3654589, 0), Point(-87.53504019, 106.4061585, 0), Point(-88.79504019, 106.4061585, 0), Point(-86.27504019, 106.4061585, 0), Point(-90.05504019, 103.8858087, 0), Point(-90.05504019, 102.6256338, 0), Point(-90.05504019, 105.1459836, 0), Point(-85.01504019, 103.8858087, 0), Point(-85.01504019, 102.6256338, 0), Point(-85.01504019, 105.1459836, 0)])  # disabled
connections_x_axis_9 = Curve([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])  # disabled
part_geometry_9 = Brep(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)  # disabled
# Large Room Connections
# Half Vault or Normal Vault or Corners
number_slider_2 = Slider(1, range=0..10)  # disabled
part_name_9 = Panel("LG")  # disabled
conndir_9 = Wasp_ConnectionFromDirection(GEO=part_geometry_9, CEN=connections_centers_9, UP=connections_x_axis_9)  # -> CONN, PLN_OUT; inputs CEN: list of Point3d, UP: list of Curve, T: list; disabled; plug-in component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
points_9 = PointList(Points=connections_centers_9, Size=number_slider_2)  # disabled
advpart_9 = Wasp_AdvancedPart(NAME=part_name_9, GEO=part_geometry_9, CONN=flatten(conndir_9.CONN))  # -> PART; inputs GEO: Mesh, CONN: list, COLL: Mesh, HI: list, ATTR: list, SUP: list; disabled; plug-in component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

# ----
# Normal Vault Corner Right
connections_centers_10 = Point([Point(-42.94191109, 89.76118536, 0), Point(-41.68173618, 88.50101046, 0), Point(-42.94191109, 87.24083555, 0), Point(-44.202086, 88.50101046, 0)])
connections_x_axis_10 = Curve([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])
part_geometry_10 = Brep(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)
part_name_10 = Panel("NCR")
conndir_10 = Wasp_ConnectionFromDirection(GEO=part_geometry_10, CEN=connections_centers_10, UP=connections_x_axis_10)  # -> CONN, PLN_OUT; inputs CEN: list of Point3d, UP: list of Curve, T: list; plug-in component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
points_10 = PointList(Points=connections_centers_10, Size=Slider(0.5, range=0..10))
advpart_10 = Wasp_AdvancedPart(NAME=part_name_10, GEO=part_geometry_10, CONN=flatten(conndir_10.CONN))  # -> PART; inputs GEO: Mesh, CONN: list, COLL: Mesh, HI: list, ATTR: list, SUP: list; plug-in component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

# ----
# Normal Vault Corner Left
connections_centers_11 = Point([Point(-42.94191109, 93.89521117, 0), Point(-41.68173618, 95.15538607, 0), Point(-42.94191109, 96.41556098, 0), Point(-44.202086, 95.15538607, 0)])
connections_x_axis_11 = Curve([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])
part_geometry_11 = Brep(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)
part_name_11 = Panel("NCL")
conndir_11 = Wasp_ConnectionFromDirection(GEO=part_geometry_11, CEN=connections_centers_11, UP=connections_x_axis_11)  # -> CONN, PLN_OUT; inputs CEN: list of Point3d, UP: list of Curve, T: list; plug-in component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
points_11 = PointList(Points=connections_centers_11, Size=Slider(1, range=0..10))
advpart_11 = Wasp_AdvancedPart(NAME=part_name_11, GEO=part_geometry_11, CONN=flatten(conndir_11.CONN))  # -> PART; inputs GEO: Mesh, CONN: list, COLL: Mesh, HI: list, ATTR: list, SUP: list; plug-in component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

# ----
# Large Room
connections_centers_12 = Point([Point(-87.53504019, 101.3654589, 0), Point(-88.79504019, 101.3654589, 0), Point(-86.27504019, 101.3654589, 0), Point(-87.53504019, 106.4061585, 0), Point(-88.79504019, 106.4061585, 0), Point(-86.27504019, 106.4061585, 0), Point(-90.05504019, 103.8858087, 0), Point(-90.05504019, 102.6256338, 0), Point(-90.05504019, 105.1459836, 0), Point(-85.01504019, 103.8858087, 0), Point(-85.01504019, 102.6256338, 0), Point(-85.01504019, 105.1459836, 0)])
connections_x_axis_12 = Curve([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])
part_geometry_12 = Brep(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)
part_name_12 = Panel("LG")
conndir_12 = Wasp_ConnectionFromDirection(GEO=part_geometry_12, CEN=connections_centers_12, UP=connections_x_axis_12)  # -> CONN, PLN_OUT; inputs CEN: list of Point3d, UP: list of Curve, T: list; plug-in component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
points_12 = PointList(Points=connections_centers_12, Size=Slider(0.5, range=0..10))
advpart_12 = Wasp_AdvancedPart(NAME=part_name_12, GEO=part_geometry_12, CONN=flatten(conndir_12.CONN))  # -> PART; inputs GEO: Mesh, CONN: list, COLL: Mesh, HI: list, ATTR: list, SUP: list; plug-in component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

# ----
# Medium Room
connections_centers_13 = Point([Point(-62.4420861, 105.6166186, 0), Point(-62.4420861, 103.7266186, 0), Point(-61.1820861, 102.4666186, 0), Point(-59.2920861, 102.4666186, 0), Point(-61.1820861, 106.2466186, 0), Point(-59.2920861, 106.2466186, 0), Point(-58.6620861, 105.6166186, 0), Point(-58.6620861, 103.7266186, 0)])
connections_x_axis_13 = Curve([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])
part_geometry_13 = Brep(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)
conndir_13 = Wasp_ConnectionFromDirection(GEO=part_geometry_13, CEN=connections_centers_13, UP=connections_x_axis_13)  # -> CONN, PLN_OUT; inputs CEN: list of Point3d, UP: list of Curve, T: list; plug-in component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
part_name_13 = Panel("MR")
points_13 = PointList(Points=connections_centers_13, Size=Slider(0.5, range=0..10))
advpart_13 = Wasp_AdvancedPart(NAME=part_name_13, GEO=part_geometry_13, CONN=flatten(conndir_13.CONN))  # -> PART; inputs GEO: Mesh, CONN: list, COLL: Mesh, HI: list, ATTR: list, SUP: list; plug-in component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

# ----
# Normal Vault Corner Right
connections_centers_14 = Point([Point(-42.94191109, 89.76118536, 0), Point(-41.68173618, 88.50101046, 0), Point(-42.94191109, 87.24083555, 0), Point(-44.202086, 88.50101046, 0)])  # disabled
connections_x_axis_14 = Curve([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])  # disabled
part_geometry_14 = Brep(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)  # disabled
number_slider_3 = Slider(1, range=0..10)  # disabled
part_name_14 = Panel("NCR")  # disabled
conndir_14 = Wasp_ConnectionFromDirection(GEO=part_geometry_14, CEN=connections_centers_14, UP=connections_x_axis_14)  # -> CONN, PLN_OUT; inputs CEN: list of Point3d, UP: list of Curve, T: list; disabled; plug-in component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
points_14 = PointList(Points=connections_centers_14, Size=number_slider_3)  # disabled
advpart_14 = Wasp_AdvancedPart(NAME=part_name_14, GEO=part_geometry_14, CONN=flatten(conndir_14.CONN))  # -> PART; inputs GEO: Mesh, CONN: list, COLL: Mesh, HI: list, ATTR: list, SUP: list; disabled; plug-in component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

# ---- group: Collider Normal Vault Courtyard Space
courtyard_void_space_mesh = Mesh(<mesh referenced from the Rhino model>)  # disabled
clean = CleanTree(RemoveNulls=True, RemoveInvalid=True, RemoveEmpty=False, Tree=courtyard_void_space_mesh)  # disabled
mjoin = MeshJoin(Meshes=clean)  # disabled
collider = Wasp_Collider(GEO=mjoin)  # -> COLL; inputs GEO: list of Mesh, MUL: Boolean, ALL: Boolean, CONN: list; disabled; plug-in component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

# ----
# Half Vault Corner Right
connections_centers_15 = Point([Point(-93.16551597, 91.58766853, 0), Point(-93.79560343, 90.95758108, 0), Point(-94.42569088, 91.58766853, 0), Point(-93.79560343, 92.21775599, 0)])
connections_x_axis_15 = Curve([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])
part_geometry_15 = Brep(<brep referenced from the Rhino model>)
conndir_15 = Wasp_ConnectionFromDirection(GEO=part_geometry_15, CEN=connections_centers_15, UP=connections_x_axis_15)  # -> CONN, PLN_OUT; inputs CEN: list of Point3d, UP: list of Curve, T: list; plug-in component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
part_name_15 = Panel("HCR")
points_15 = PointList(Points=connections_centers_15, Size=Slider(0.5, range=0..10))
advpart_15 = Wasp_AdvancedPart(NAME=part_name_15, GEO=part_geometry_15, CONN=flatten(conndir_15.CONN))  # -> PART; inputs GEO: Mesh, CONN: list, COLL: Mesh, HI: list, ATTR: list, SUP: list; plug-in component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

part_name_16 = Panel(part_name_15)

# ---- group: Collider Normal Vault Courtyard Space
courtyard_void_space_mesh_2 = Mesh(<mesh referenced from the Rhino model>)
clean_2 = CleanTree(RemoveNulls=True, RemoveInvalid=True, RemoveEmpty=False, Tree=courtyard_void_space_mesh_2)
mjoin_2 = MeshJoin(Meshes=clean_2)
collider_2 = Wasp_Collider(GEO=mjoin_2)  # -> COLL; inputs GEO: list of Mesh, MUL: Boolean, ALL: Boolean, CONN: list; plug-in component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

# ----
# Half Vault Module
# Without Collider
connections_centers_16 = Point([Point(-84.51982355, 88.95150272, 0), Point(-84.51982355, 91.47185253, 0), Point(-83.8897361, 90.21167762, 0), Point(-85.14991101, 90.21167762, 0)])
connections_x_axis_16 = Curve([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])
part_geometry_16 = Brep(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)
part_name_17 = Panel("HVW")
conndir_16 = Wasp_ConnectionFromDirection(GEO=part_geometry_16, CEN=connections_centers_16, UP=connections_x_axis_16)  # -> CONN, PLN_OUT; inputs CEN: list of Point3d, UP: list of Curve, T: list; plug-in component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
points_16 = PointList(Points=connections_centers_16, Size=Slider(1, range=0..10))
advpart_16 = Wasp_AdvancedPart(NAME=part_name_17, GEO=part_geometry_16, CONN=flatten(conndir_16.CONN))  # -> PART; inputs GEO: Mesh, CONN: list, COLL: Mesh, HI: list, ATTR: list, SUP: list; plug-in component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

# ---- group: Collider Half Vault Courtyard Space
courtyard_void_space_mesh_3 = Mesh(<mesh referenced from the Rhino model>)
clean_3 = CleanTree(RemoveNulls=True, RemoveInvalid=True, RemoveEmpty=False, Tree=courtyard_void_space_mesh_3)
mjoin_3 = MeshJoin(Meshes=clean_3)
collider_3 = Wasp_Collider(GEO=mjoin_3)  # -> COLL; inputs GEO: list of Mesh, MUL: Boolean, ALL: Boolean, CONN: list; plug-in component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

# ----
# Half Vault Corner Left
connections_centers_17 = Point([<point referenced from the Rhino model> x4])
connections_x_axis_17 = Curve([<curve referenced from the Rhino model> x4])
part_geometry_17 = Brep(<brep referenced from the Rhino model>)
part_name_18 = Panel("HCL")
conndir_17 = Wasp_ConnectionFromDirection(GEO=part_geometry_17, CEN=connections_centers_17, UP=connections_x_axis_17)  # -> CONN, PLN_OUT; inputs CEN: list of Point3d, UP: list of Curve, T: list; plug-in component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
points_17 = PointList(Points=connections_centers_17, Size=Slider(1, range=0..10))
advpart_17 = Wasp_AdvancedPart(NAME=part_name_18, GEO=part_geometry_17, CONN=flatten(conndir_17.CONN))  # -> PART; inputs GEO: Mesh, CONN: list, COLL: Mesh, HI: list, ATTR: list, SUP: list; plug-in component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

part_name_19 = Panel(part_name_18)
waspsetup = Wasp_Setup(RUN=Toggle(True))  # -> log; inputs RUN: Boolean; plug-in component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

# ----
# Creation of
# Courtyard Geometry
part_geometry_18 = Brep(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)
random = Random(Range=number_slider, Number=1, Seed=2)
rec_2pt = Rectangle2Pt(Plane=PlaneXY(0, 0, 0), PointA=Point(-104.5361252, 88.95150272, 0), PointB=Point(-102.0157754, 91.47185253, 0), Radius=0)  # -> Rectangle, Length
random_2 = Random(Range=number_slider, Number=1, Seed=2)
random_3 = Random(Range=random, Number=1, Seed=2)
arrrec = RectangularArray(Geometry=part_geometry_18, Cell=rec_2pt.Rectangle, XCount=random_3, YCount=random_2)  # -> Geometry, Transform
sunion = SolidUnion(Breps=arrrec.Geometry)

srf = Surface(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)
arrrec_2 = RectangularArray(Geometry=srf, Cell=rec_2pt.Rectangle, XCount=random_3, YCount=random_2)  # -> Geometry, Transform
join = BrepJoin(Breps=arrrec_2.Geometry)  # -> Breps, Closed
edges = BrepEdges(Brep=join.Breps)  # -> Naked, Interior, NonManifold
midpt = CurveMiddle(Curve=edges.Naked)

line = LineSDL(Start=midpt, Direction=Vector(0, 0, 1), Length=Slider(0.13, range=0..1))

panel_3 = Panel(waspsetup)
merge = Merge(Data1=advpart, Data2=advpart_2, Data3=advpart_3)
panel_4 = Panel("5 = O")
panel_6 = Panel("""5 = 0 
or
6 = 0""")
panel_7 = Panel("""NEW
0 = Court
7 = Court

1 = B
6 = B""")

# ----
# Courtyard Module
module_geometry_result = Brep(sunion)
part_name_20 = Panel("Courtyard")
line_geometry = Curve(line)
points_surface = Point(midpt)
conndir_18 = Wasp_ConnectionFromDirection(GEO=module_geometry_result, CEN=points_surface, UP=line_geometry)  # -> CONN, PLN_OUT; inputs GEO: Brep, CEN: list of Point3d, UP: list of Curve, T: list; plug-in component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
part = Wasp_BasicPart(NAME=part_name_20, GEO=module_geometry_result, CONN=flatten(conndir_18.CONN))  # -> PART; inputs GEO: Mesh, CONN: list, COLL: Mesh, ATTR: list; plug-in component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

small_modules_open_2 = Panel("""1
2
10
11
5
4
8
7""")
a_connection_unit_modules_for_half_vault = Panel("""0
3
5
6""")  # "A connection UNIT MODULES for Half Vault Open/Closed"
small_modules_closed_3 = Panel("""1
6
10
7
2""")
B = Panel("""3
5""")
closed = Panel("""2
7
6
1""")
no_connection_2 = Panel("""4
0""")
big_modules_closed_4 = Panel("""8
11
10
9""")
big_modules_closed_5 = Panel("""1
2
4
7""")
small_modules_closed_4 = Panel("""1
2
7
4""")

# ---- group: Add to MERGE or not?
# Case 4 - A
ncl_lg = Panel("""LG|1_NV|3
NV|3_LG|1""")  # disabled
ruletxt = Wasp_RuleFromText(TXT=ncl_lg)  # -> R; disabled; plug-in component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

# Case 4 - B
ncr_lg = Panel("""LG|1_NV|3
NV|3_LG|1""")  # disabled
ruletxt_2 = Wasp_RuleFromText(TXT=ncr_lg)  # -> R; disabled; plug-in component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

# Case 3 - A
ncl_lg_2 = Panel("""LG|2_NV|2
NV|2_LG|2""")  # disabled
ruletxt_3 = Wasp_RuleFromText(TXT=ncl_lg_2)  # -> R; disabled; plug-in component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

# Case 3 - B
ncr_lg_2 = Panel("""LG|2_NV|2
NV|2_LG|2""")  # disabled
ruletxt_4 = Wasp_RuleFromText(TXT=ncr_lg_2)  # -> R; disabled; plug-in component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

# ---- group: Normal Vault - Large Room
# Case 2
nv_lg = Panel("NV|7_LG|0")  # disabled
ruletxt_5 = Wasp_RuleFromText(TXT=nv_lg)  # -> R; disabled; plug-in component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
merge_2 = Merge(Data1=ruletxt_5)  # disabled

# ---- group: Not to add this the way around because the corner modules can come attached out of nowhere?
ncl_lg_3 = Panel("LG|2_NCL|2")  # disabled
ruletxt_6 = Wasp_RuleFromText(TXT=ncl_lg_3)  # -> R; disabled; plug-in component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

ncr_lg_3 = Panel("LG|2_NCR|3")  # disabled
ruletxt_7 = Wasp_RuleFromText(TXT=ncr_lg_3)  # -> R; disabled; plug-in component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

# ----
# Case 5 - B
ncr_lg_4 = Panel("NCR|3_LG|2")  # disabled
ruletxt_8 = Wasp_RuleFromText(TXT=ncr_lg_4)  # -> R; disabled; plug-in component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
merge_3 = Merge(Data1=ruletxt_8)  # disabled

# ----
# Case 5 - A
ncl_lg_4 = Panel("NCL|2_LG|2")  # disabled
ruletxt_9 = Wasp_RuleFromText(TXT=ncl_lg_4)  # -> R; disabled; plug-in component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
merge_4 = Merge(Data1=ruletxt_9)  # disabled

# ----
# Case 6 - B
ncr_lg_5 = Panel("NCR|2_LG|1")  # disabled
ruletxt_10 = Wasp_RuleFromText(TXT=ncr_lg_5)  # -> R; disabled; plug-in component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
merge_5 = Merge(Data1=ruletxt_10)  # disabled

# ----
# Case 6 - A
ncl_lg_5 = Panel("NCL|3_LG|1")  # disabled
ruletxt_11 = Wasp_RuleFromText(TXT=ncl_lg_5)  # -> R; disabled; plug-in component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
merge_6 = Merge(Data1=ruletxt_11)  # disabled

# ---- group: Not to add this the way around because the corner modules can come attached out of nowhere?
ncl_lg_6 = Panel("LG|1_NCL|3")  # disabled
ruletxt_12 = Wasp_RuleFromText(TXT=ncl_lg_6)  # -> R; disabled; plug-in component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

ncr_lg_6 = Panel("LG|1_NCR|2")  # disabled
ruletxt_13 = Wasp_RuleFromText(TXT=ncr_lg_6)  # -> R; disabled; plug-in component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

# ---- group: Connection Number Courtyard
courtyard_no_connection = Panel("All Number List")
cset = CreateSet(List=midpt)  # -> Set, Map
panel_8 = Panel(cset.Map)

# ----
parts_num = Slider(344, range=0..1000)
reset = Button()

nv_ncr = Panel("""NV|5_NCR|0
NCR|1_NV|4
NV|4_NCR|1
NCR|0_NV|5""")  # disabled
nv_nv = Panel("NV|4_NV|5")  # disabled
ruletxt_14 = Wasp_RuleFromText(TXT=nv_ncr)  # -> R; disabled; plug-in component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
ruletxt_15 = Wasp_RuleFromText(TXT=nv_nv)  # -> R; disabled; plug-in component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
merge_7 = Merge(Data1=ruletxt_14, Data3=ruletxt_15)  # disabled

ncl_lg_7 = Panel("""NCL|3_LG|2
LG|2_NCL|3""")  # disabled
ruletxt_16 = Wasp_RuleFromText(TXT=ncl_lg_7)  # -> R; disabled; plug-in component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
merge_8 = Merge(Data1=ruletxt_16)  # disabled

ncr_lg_7 = Panel("""NCR|2_LG|2
LG|2_NCR|2""")  # disabled
ruletxt_17 = Wasp_RuleFromText(TXT=ncr_lg_7)  # -> R; disabled; plug-in component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
merge_9 = Merge(Data1=ruletxt_17)  # disabled

ncl_lg_8 = Panel("""NCL|2_LG|1
LG|1_NCL|2""")  # disabled
ruletxt_18 = Wasp_RuleFromText(TXT=ncl_lg_8)  # -> R; disabled; plug-in component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
merge_10 = Merge(Data1=ruletxt_18)  # disabled

ncr_lg_8 = Panel("""NCR|3_LG|1
LG|1_NCR|3""")  # disabled
ruletxt_19 = Wasp_RuleFromText(TXT=ncr_lg_8)  # -> R; disabled; plug-in component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
merge_11 = Merge(Data1=ruletxt_19)  # disabled

# ---- group: Normal Vault - Large Room
nv_lg_2 = Panel("""NV|7_LG|0
LG|0_NV|7""")  # disabled
ruletxt_20 = Wasp_RuleFromText(TXT=nv_lg_2)  # -> R; disabled; plug-in component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
merge_12 = Merge(Data1=ruletxt_20)  # disabled

# ----
merge_13 = Merge(Data1=merge_7, Data2=merge_12, Data3=merge_11, Data4=merge_9, Data5=merge_3, Data6=merge_5)

# ----
# Case 4 - B
# MEDIUM ROOM - MR
#  Modules  Connections
mr_hcl = Panel("""MR|6_HCL|2
HCL|2_MR|6""")
ruletxt_21 = Wasp_RuleFromText(TXT=mr_hcl)  # -> R; plug-in component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
merge_14 = Merge(Data1=ruletxt_21)

# ---- group: MR - HCR
# Case 1 - A
mr_hcr = Panel("""MR|5_HCR|3
HCR|3_MR|5""")
ruletxt_22 = Wasp_RuleFromText(TXT=mr_hcr)  # -> R; plug-in component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
merge_15 = Merge(Data1=ruletxt_22)

# ----
# Case 3 - B
mr_hcl_2 = Panel("""MR|5_HCL|3
HCL|3_MR|5""")
ruletxt_23 = Wasp_RuleFromText(TXT=mr_hcl_2)  # -> R; plug-in component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
merge_16 = Merge(Data1=ruletxt_23)

# ----
# Case 4 - A
mr_hcr_2 = Panel("""MR|6_HCR|2
HCR|2_MR|6""")
ruletxt_24 = Wasp_RuleFromText(TXT=mr_hcr_2)  # -> R; plug-in component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
merge_17 = Merge(Data1=ruletxt_24)

# ---- group: MR - HCL
# Case 1 - B
mr_hcr_3 = Panel("""MR|5_HCL|2
HCL|2_MR|5""")
ruletxt_25 = Wasp_RuleFromText(TXT=mr_hcr_3)  # -> R; plug-in component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
merge_18 = Merge(Data1=ruletxt_25)

# ----
# Case 2 - B
mr_hcl_3 = Panel("""MR|6_HCL|2
HCL|2_MR|6""")
ruletxt_26 = Wasp_RuleFromText(TXT=mr_hcl_3)  # -> R; plug-in component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
merge_19 = Merge(Data1=ruletxt_26)

# ----
# Case 3 - A
mr_hcr_4 = Panel("""MR|5_HCR|2
HCR|2_MR|5""")
ruletxt_27 = Wasp_RuleFromText(TXT=mr_hcr_4)  # -> R; plug-in component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
merge_20 = Merge(Data1=ruletxt_27)

# ----
# Case 5 - B
mr_hvw = Panel("""MR|3_HVW|0
HVW|0_MR|3""")
ruletxt_28 = Wasp_RuleFromText(TXT=mr_hvw)  # -> R; plug-in component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
merge_21 = Merge(Data1=ruletxt_28)

# ----
# Case 5 - A
mr_hvw_2 = Panel("""MR|0_HVW|1
HVW|1_MR|0""")
ruletxt_29 = Wasp_RuleFromText(TXT=mr_hvw_2)  # -> R; plug-in component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
merge_22 = Merge(Data1=ruletxt_29)

# ----
# Case 2 - A
mr_hcr_5 = Panel("""MR|6_HCR|3
HCR|3_MR|6""")
ruletxt_30 = Wasp_RuleFromText(TXT=mr_hcr_5)  # -> R; plug-in component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
merge_23 = Merge(Data1=ruletxt_30)

# ----
# Case 1 - B
wc_hv = Panel("""WC|2_HV|2
HV|2_WC|2""")
ruletxt_31 = Wasp_RuleFromText(TXT=wc_hv)  # -> R; plug-in component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
merge_24 = Merge(Data1=ruletxt_31)

# ----
# Case 3
wc3_rr = Panel("""WC3|0_RR|5
RR|5_WC3|0""")
ruletxt_32 = Wasp_RuleFromText(TXT=wc3_rr)  # -> R; plug-in component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
merge_25 = Merge(Data1=ruletxt_32)

# ----
# WC
# Modules  Connections
# Case 4
wc2_hv = Panel("""WC2|0_HV|2
HV|2_WC2|0""")
ruletxt_33 = Wasp_RuleFromText(TXT=wc2_hv)  # -> R; plug-in component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
merge_26 = Merge(Data1=ruletxt_33)

# ---- group: Not Sure
nv_hv = Panel("""NV|5_HV|3
NV|4_HV|3
HV|3_NV|5
HV|3_NV|4""")
ruletxt_34 = Wasp_RuleFromText(TXT=nv_hv)  # -> R; plug-in component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
merge_27 = Merge(Data1=ruletxt_34)

# ----
# Case 1 - A
wc_hv_2 = Panel("""WC|1_HV|2
HV|2_WC|1""")
ruletxt_35 = Wasp_RuleFromText(TXT=wc_hv_2)  # -> R; plug-in component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
merge_28 = Merge(Data1=ruletxt_35)

nv_hv_2 = Panel("""NV|5_HV|3
NV|4_HV|3""")
ruletxt_36 = Wasp_RuleFromText(TXT=nv_hv_2)  # -> R; plug-in component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
merge_29 = Merge(Data1=ruletxt_36)

nv_hvw = Panel("""NV|5_HVW|3
NV|4_HVW|3""")
ruletxt_37 = Wasp_RuleFromText(TXT=nv_hvw)  # -> R; plug-in component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
merge_30 = Merge(Data1=ruletxt_37)

# ----
# Case 2
wc2_rr = Panel("""WC2|0_RR|3
RR|3_WC2|0""")
ruletxt_38 = Wasp_RuleFromText(TXT=wc2_rr)  # -> R; plug-in component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
merge_31 = Merge(Data1=ruletxt_38)

# ---- group: Use this IF the HVW module is not created
nv_hv_3 = Panel("""HV|3_NV|5
HV|3_NV|4""")
ruletxt_39 = Wasp_RuleFromText(TXT=nv_hv_3)  # -> R; plug-in component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
merge_32 = Merge(Data1=ruletxt_39)

# ----
# Case 8 - D
mr_nv = Panel("""MR|7_NV|3
NV|3_MR|7""")
ruletxt_40 = Wasp_RuleFromText(TXT=mr_nv)  # -> R; plug-in component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
merge_33 = Merge(Data1=ruletxt_40)

# ----
# Case 8 - C
mr_nv_2 = Panel("""MR|7_NV|2
NV|2_MR|7""")
ruletxt_41 = Wasp_RuleFromText(TXT=mr_nv_2)  # -> R; plug-in component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
merge_34 = Merge(Data1=ruletxt_41)

# ----
# Case 5 - B
wc2_nv = Panel("""WC2|0_NV|3
NV|3_WC2|0""")
ruletxt_42 = Wasp_RuleFromText(TXT=wc2_nv)  # -> R; plug-in component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
merge_35 = Merge(Data1=ruletxt_42)

# ----
# Case 6 - B
mr_hvw_3 = Panel("""MR|6_HVW|0
HVW|0_MR|6""")
ruletxt_43 = Wasp_RuleFromText(TXT=mr_hvw_3)  # -> R; plug-in component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
merge_36 = Merge(Data1=ruletxt_43)

# ----
# Case 5 - A
wc2_nv_2 = Panel("""WC2|0_NV|2
NV|2_WC2|0""")
ruletxt_44 = Wasp_RuleFromText(TXT=wc2_nv_2)  # -> R; plug-in component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
merge_37 = Merge(Data1=ruletxt_44)

# ----
# Case 7 - B
rr_nv = Panel("""RR|3_NV|5
NV|5_RR|3""")
ruletxt_45 = Wasp_RuleFromText(TXT=rr_nv)  # -> R; plug-in component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
merge_38 = Merge(Data1=ruletxt_45)

# ----
# Case 6 - A
mr_hvw_4 = Panel("""MR|5_HVW|1
HVW|1_MR|5""")
ruletxt_46 = Wasp_RuleFromText(TXT=mr_hvw_4)  # -> R; plug-in component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
merge_39 = Merge(Data1=ruletxt_46)

# ----
# Case 8 - B
mr_nv_3 = Panel("""MR|4_NV|2
NV|2_MR|4""")
ruletxt_47 = Wasp_RuleFromText(TXT=mr_nv_3)  # -> R; plug-in component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
merge_40 = Merge(Data1=ruletxt_47)

# ----
# Case 7 - A
rr_nv_2 = Panel("""RR|5_NV|4
NV|4_RR|5""")
ruletxt_48 = Wasp_RuleFromText(TXT=rr_nv_2)  # -> R; plug-in component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
merge_41 = Merge(Data1=ruletxt_48)

# ----
# Case 5
rr_mr = Panel("""RR|1_MR|7
MR|7_RR|1""")
ruletxt_49 = Wasp_RuleFromText(TXT=rr_mr)  # -> R; plug-in component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
merge_42 = Merge(Data1=ruletxt_49)

# ----
# Case 7 - B
mr_nv_4 = Panel("""MR|7_NV|2
NV|2_MR|7""")
ruletxt_50 = Wasp_RuleFromText(TXT=mr_nv_4)  # -> R; plug-in component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
merge_43 = Merge(Data1=ruletxt_50)

# ----
# Case 8 - A
mr_nv_5 = Panel("""MR|4_NV|3
NV|3_MR|4""")
ruletxt_51 = Wasp_RuleFromText(TXT=mr_nv_5)  # -> R; plug-in component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
merge_44 = Merge(Data1=ruletxt_51)

# ----
# Case 7 - A
mr_nv_6 = Panel("""MR|4_NV|2
NV|2_MR|4""")
ruletxt_52 = Wasp_RuleFromText(TXT=mr_nv_6)  # -> R; plug-in component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
merge_45 = Merge(Data1=ruletxt_52)

# ----
# Case 3 - B
rr_hv = Panel("""RR|4_HV|2
HV|2_RR|4""")
ruletxt_53 = Wasp_RuleFromText(TXT=rr_hv)  # -> R; plug-in component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
merge_46 = Merge(Data1=ruletxt_53)

# ----
# Case 6 - B
rr_hvw = Panel("""RR|3_HVW|3
HVW|3_RR|3""")
ruletxt_54 = Wasp_RuleFromText(TXT=rr_hvw)  # -> R; plug-in component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
merge_47 = Merge(Data1=ruletxt_54)

# ---- group: RR - NV
# Case 1
rr_nv_3 = Panel("""RR|8_NV|7
NV|7_RR|8""")
ruletxt_55 = Wasp_RuleFromText(TXT=rr_nv_3)  # -> R; plug-in component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
merge_48 = Merge(Data1=ruletxt_55)

# ----
# Case 3 - A
rr_hv_2 = Panel("""RR|0_HV|2
HV|2_RR|0""")
ruletxt_56 = Wasp_RuleFromText(TXT=rr_hv_2)  # -> R; plug-in component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
merge_49 = Merge(Data1=ruletxt_56)

# ----
# Case 2 - D
rr_ncl = Panel("""RR|0_NCL|3
NCL|3_RR|0""")
ruletxt_57 = Wasp_RuleFromText(TXT=rr_ncl)  # -> R; plug-in component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
merge_50 = Merge(Data1=ruletxt_57)

# ----
# Case 6 - A
rr_hvw_2 = Panel("""RR|5_HVW|3
HVW|3_RR|5""")
ruletxt_58 = Wasp_RuleFromText(TXT=rr_hvw_2)  # -> R; plug-in component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
merge_51 = Merge(Data1=ruletxt_58)

# ----
# Case 2 - C
rr_ncr = Panel("""RR|0_NCR|2
NCR|2_RR|0""")
ruletxt_59 = Wasp_RuleFromText(TXT=rr_ncr)  # -> R; plug-in component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
merge_52 = Merge(Data1=ruletxt_59)

# ----
# ROOM WITH RIWAQ RR
#  Modules  Connections
# Case 4
rr_wc = Panel("""RR|3_WC|0
WC|0_RR|3""")
ruletxt_60 = Wasp_RuleFromText(TXT=rr_wc)  # -> R; plug-in component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
merge_53 = Merge(Data1=ruletxt_60)

# ---- group: Me
hv_hv = Panel("HV|1_HV|0")
ruletxt_61 = Wasp_RuleFromText(TXT=hv_hv)  # -> R; plug-in component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

hv_hcr = Panel("""HV|1_HCR|0
HCR|0_HV|1
HV|0_HCR|1
HCR|1_HV|0""")
hv_hcl = Panel("""HV|1_HCL|1
HCL|1_HV|1
HV|0_HCL|0
HCL|0_HV|0""")
hv_hv_2 = Panel("HV|0_HV|1")
ruletxt_62 = Wasp_RuleFromText(TXT=hv_hcr)  # -> R; plug-in component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
ruletxt_63 = Wasp_RuleFromText(TXT=hv_hcl)  # -> R; plug-in component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
ruletxt_64 = Wasp_RuleFromText(TXT=hv_hv_2)  # -> R; plug-in component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
merge_54 = Merge(Data1=ruletxt_62, Data2=ruletxt_63, Data3=ruletxt_64, Data4=ruletxt_61)

# ----
# Case 2 - B
rr_ncl_2 = Panel("""RR|4_NCL|2
NCL|2_RR|4""")
ruletxt_65 = Wasp_RuleFromText(TXT=rr_ncl_2)  # -> R; plug-in component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
merge_55 = Merge(Data1=ruletxt_65)

# ---- group: Half Vault - Kitchen
hv_kt = Panel("""HV|2_KT|1
KT|2_HV|2""")
ruletxt_66 = Wasp_RuleFromText(TXT=hv_kt)  # -> R; plug-in component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
merge_56 = Merge(Data1=ruletxt_66)

# ---- group: Add to MERGE or not?
# Case 4 - A
# Large Room Connections
# Half Vault or Normal Vault or Corners
ncl_lg_9 = Panel("""LG|1_NV|3
NV|3_LG|1""")
ruletxt_67 = Wasp_RuleFromText(TXT=ncl_lg_9)  # -> R; plug-in component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

# ----
# Case 2 - A
rr_ncr_2 = Panel("""RR|4_NCR|3
NCR|3_RR|4""")
ruletxt_68 = Wasp_RuleFromText(TXT=rr_ncr_2)  # -> R; plug-in component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
merge_57 = Merge(Data1=ruletxt_68)

# ---- group: Add to MERGE or not?
# Case 4 - B
ncr_lg_9 = Panel("""LG|1_NV|3
NV|3_LG|1""")
ruletxt_69 = Wasp_RuleFromText(TXT=ncr_lg_9)  # -> R; plug-in component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

# Case 3 - A
ncl_lg_10 = Panel("""LG|2_NV|2
NV|2_LG|2""")
ruletxt_70 = Wasp_RuleFromText(TXT=ncl_lg_10)  # -> R; plug-in component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

# ---- group: Half Vault - Kitchen / Not Sure Which Connection Is more Feasible from First Part and Second Part
# Kitchen Connection
# Half Vault Only
hv_kt_2 = Panel("""HV|2_KT|1
HV|2_KT|2""")
ruletxt_71 = Wasp_RuleFromText(TXT=hv_kt_2)  # -> R; plug-in component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
merge_58 = Merge(Data1=ruletxt_71)

# ---- group: Add to MERGE or not?
# Case 3 - B
ncr_lg_10 = Panel("""LG|2_NV|2
NV|2_LG|2""")
ruletxt_72 = Wasp_RuleFromText(TXT=ncr_lg_10)  # -> R; plug-in component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

# ---- group: Half Vault - Large Room
# Case 1
hv_lg = Panel("""HV|2_LG|1
LG|1_HV|2""")
ruletxt_73 = Wasp_RuleFromText(TXT=hv_lg)  # -> R; plug-in component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
merge_59 = Merge(Data1=ruletxt_73)

hv_lg_2 = Panel("""LG|1_HV|2
LG|2_HV|2""")
hv_lg_3 = Panel("""HV|2_LG|1
LG|2_HV|2""")
ruletxt_74 = Wasp_RuleFromText(TXT=hv_lg_2)  # -> R; plug-in component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
ruletxt_75 = Wasp_RuleFromText(TXT=hv_lg_3)  # -> R; plug-in component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
merge_60 = Merge(Data1=ruletxt_75, Data2=ruletxt_74)

# ---- group: Normal Vault - Large Room
# Case 2
nv_lg_3 = Panel("NV|7_LG|0")
ruletxt_76 = Wasp_RuleFromText(TXT=nv_lg_3)  # -> R; plug-in component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
merge_61 = Merge(Data1=ruletxt_76)

# ---- group: MIRRORED VERSION
# Case 3
# Case 4 - A
# 4 DOMES Modules  Connections
_4d_nv = Panel("""NV|2_4D|1
4D|1_NV|2""")
ruletxt_77 = Wasp_RuleFromText(TXT=_4d_nv)  # -> R; plug-in component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

# ---- group: MIRRORED VERSION not needed cause it will result in the same result
_4d_nvi = Panel("""NVI|2_4D|1
4D|1_NVI|2""")
ruletxt_78 = Wasp_RuleFromText(TXT=_4d_nvi)  # -> R; plug-in component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

# ---- group: Half Vault - 4 Domes
# Case 1 - A
hv_4d = Panel("HV|2_4D|2")
ruletxt_79 = Wasp_RuleFromText(TXT=hv_4d)  # -> R; plug-in component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
merge_62 = Merge(Data1=ruletxt_79)

hv_4d_2 = Panel("4D|2_HV|2")
ruletxt_80 = Wasp_RuleFromText(TXT=hv_4d_2)  # -> R; plug-in component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
merge_63 = Merge(Data1=ruletxt_80)

# ---- group: Not to add this the way around because the corner modules can come attached out of nowhere?
ncl_lg_11 = Panel("LG|2_NCL|2")
ruletxt_81 = Wasp_RuleFromText(TXT=ncl_lg_11)  # -> R; plug-in component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

ncr_lg_11 = Panel("LG|2_NCR|3")
ruletxt_82 = Wasp_RuleFromText(TXT=ncr_lg_11)  # -> R; plug-in component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

# ----
# Case 5 - B
ncr_lg_12 = Panel("NCR|3_LG|2")
ruletxt_83 = Wasp_RuleFromText(TXT=ncr_lg_12)  # -> R; plug-in component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
merge_64 = Merge(Data1=ruletxt_83)

# ----
# Case 5 - A
ncl_lg_12 = Panel("NCL|2_LG|2")
ruletxt_84 = Wasp_RuleFromText(TXT=ncl_lg_12)  # -> R; plug-in component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
merge_65 = Merge(Data1=ruletxt_84)

# ----
# Case 6 - B
ncr_lg_13 = Panel("NCR|2_LG|1")
ruletxt_85 = Wasp_RuleFromText(TXT=ncr_lg_13)  # -> R; plug-in component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
merge_66 = Merge(Data1=ruletxt_85)

# ---- group: MIRRORED SIDE Half Vault - 4 Domes
# Case 1 - B
hv_4d_3 = Panel("HV|2_4D|1")
ruletxt_86 = Wasp_RuleFromText(TXT=hv_4d_3)  # -> R; plug-in component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
merge_67 = Merge(Data1=ruletxt_86)

# ----
# Case 6 - A
ncl_lg_13 = Panel("NCL|3_LG|1")
ruletxt_87 = Wasp_RuleFromText(TXT=ncl_lg_13)  # -> R; plug-in component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
merge_68 = Merge(Data1=ruletxt_87)

# ---- group: MIRRORED SIDE Half Vault - 4 Domes
# Case 2
hv_4d_4 = Panel("4D|1_HV|2")
ruletxt_88 = Wasp_RuleFromText(TXT=hv_4d_4)  # -> R; plug-in component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
merge_69 = Merge(Data1=ruletxt_88)

# ---- group: Not to add this the way around because the corner modules can come attached out of nowhere?
ncl_lg_14 = Panel("LG|1_NCL|3")
ruletxt_89 = Wasp_RuleFromText(TXT=ncl_lg_14)  # -> R; plug-in component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

ncr_lg_14 = Panel("LG|1_NCR|2")
ruletxt_90 = Wasp_RuleFromText(TXT=ncr_lg_14)  # -> R; plug-in component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

# ----
# Case 7 - C
_4d_ncr = Panel("""NCR|3_4D|2
4D|2_NCR|3""")
ruletxt_91 = Wasp_RuleFromText(TXT=_4d_ncr)  # -> R; plug-in component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
merge_70 = Merge(Data1=ruletxt_91)

# ----
# Case 7 - B
_4d_ncl = Panel("""NCL|3_4D|1
4D|1_NCL|3""")
ruletxt_92 = Wasp_RuleFromText(TXT=_4d_ncl)  # -> R; plug-in component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
merge_71 = Merge(Data1=ruletxt_92)

# ----
# Case 4 - B
# Case 5
_4d_nvi_2 = Panel("""NVI|3_4D|2
4D|2_NVI|3""")
ruletxt_93 = Wasp_RuleFromText(TXT=_4d_nvi_2)  # -> R; plug-in component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
merge_72 = Merge(Data1=ruletxt_93)

# ----
# Case 7 - D
_4d_ncl_2 = Panel("""NCL|2_4D|2
4D|2_NCL|2""")
ruletxt_94 = Wasp_RuleFromText(TXT=_4d_ncl_2)  # -> R; plug-in component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
merge_73 = Merge(Data1=ruletxt_94)

# ----
# Case 7 - A
_4d_ncr_2 = Panel("""NCR|2_4D|1
4D|1_NCR|2""")
ruletxt_95 = Wasp_RuleFromText(TXT=_4d_ncr_2)  # -> R; plug-in component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
merge_74 = Merge(Data1=ruletxt_95)

# ----
# Case 6 - A
_4d_nv_2 = Panel("""NV|3_4D|1
4D|1_NV|3""")
ruletxt_96 = Wasp_RuleFromText(TXT=_4d_nv_2)  # -> R; plug-in component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
merge_75 = Merge(Data1=ruletxt_96)

# ---- group: MIRRORED VERSION
# Case 6 - B
_4d_nv_3 = Panel("""NV|2_4D|2
4D|2_NV|2""")
ruletxt_97 = Wasp_RuleFromText(TXT=_4d_nv_3)  # -> R; plug-in component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
merge_76 = Merge(Data1=ruletxt_97)

# ---- group: SOLVE WITH MIDPOINT TO MIDPOINT
_4d_nv_4 = Panel("""NV|7_4D|0
4D|0_NV|7""")
ruletxt_98 = Wasp_RuleFromText(TXT=_4d_nv_4)  # -> R; plug-in component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

# ----
nv_ncr_2 = Panel("""NV|5_NCR|0
NCR|1_NV|4
NV|4_NCR|1
NCR|0_NV|5""")
nv_ncl = Panel("""NV|4_NCL|0
NCL|0_NV|4
NV|5_NCL|1
NCL|1_NV|5""")
nv_nv_2 = Panel("""NV|4_NV|5
NV|5_NV|4""")
ruletxt_99 = Wasp_RuleFromText(TXT=nv_ncr_2)  # -> R; plug-in component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
ruletxt_100 = Wasp_RuleFromText(TXT=nv_ncl)  # -> R; plug-in component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
ruletxt_101 = Wasp_RuleFromText(TXT=nv_nv_2)  # -> R; plug-in component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
merge_77 = Merge(Data1=ruletxt_99, Data2=ruletxt_100, Data3=ruletxt_101)

# ---- group: With Shervin
hv_hcr_2 = Panel("""HV|1_HCR|0
HCR|1_HV|0
HV|0_HCR|1
HCR|0_HV|1""")
hv_hcl_2 = Panel("""HV|0_HCL|0
HCL|0_HV|0
HV|1_HCL|1
HCL|1_HV|1""")
hv_hv_3 = Panel("""HV|0_HV|1
HV|1_HV|0""")
ruletxt_102 = Wasp_RuleFromText(TXT=hv_hcr_2)  # -> R; plug-in component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
ruletxt_103 = Wasp_RuleFromText(TXT=hv_hcl_2)  # -> R; plug-in component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
ruletxt_104 = Wasp_RuleFromText(TXT=hv_hv_3)  # -> R; plug-in component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
merge_78 = Merge(Data1=ruletxt_102, Data2=ruletxt_103, Data3=ruletxt_104)

# ----
hv_hvw = Panel("""HV|0_HVW|1
HV|1_HVW|0""")
nv_hvw_2 = Panel("""HVW|3_NV|5
HVW|3_NV|4""")
ruletxt_105 = Wasp_RuleFromText(TXT=hv_hvw)  # -> R; plug-in component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
ruletxt_106 = Wasp_RuleFromText(TXT=nv_hvw_2)  # -> R; plug-in component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
merge_79 = Merge(Data1=ruletxt_105, Data2=ruletxt_106)

ncl_lg_15 = Panel("""NCL|3_LG|2
LG|2_NCL|3""")
ruletxt_107 = Wasp_RuleFromText(TXT=ncl_lg_15)  # -> R; plug-in component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
merge_80 = Merge(Data1=ruletxt_107)

ncr_lg_15 = Panel("""NCR|2_LG|2
LG|2_NCR|2""")
ruletxt_108 = Wasp_RuleFromText(TXT=ncr_lg_15)  # -> R; plug-in component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
merge_81 = Merge(Data1=ruletxt_108)

ncl_lg_16 = Panel("""NCL|2_LG|1
LG|1_NCL|2""")
ruletxt_109 = Wasp_RuleFromText(TXT=ncl_lg_16)  # -> R; plug-in component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
merge_82 = Merge(Data1=ruletxt_109)

# ---- group: Half Vault - Kitchen
hv_kt_3 = Panel("""HV|2_KT|1
KT|1_HV|2
HV|2_KT|2
KT|2_HV|2""")
ruletxt_110 = Wasp_RuleFromText(TXT=hv_kt_3)  # -> R; plug-in component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
merge_83 = Merge(Data1=ruletxt_110)

# ----
ncr_lg_16 = Panel("""NCR|3_LG|1
LG|1_NCR|3""")
ruletxt_111 = Wasp_RuleFromText(TXT=ncr_lg_16)  # -> R; plug-in component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
merge_84 = Merge(Data1=ruletxt_111)

_4d_nv_5 = Panel("""NV|4_4D|2
4D|2_NV|4""")
ruletxt_112 = Wasp_RuleFromText(TXT=_4d_nv_5)  # -> R; plug-in component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
merge_85 = Merge(Data1=ruletxt_112)

# ---- group: Normal Vault - Large Room
nv_lg_4 = Panel("""NV|7_LG|0
LG|0_NV|7""")
ruletxt_113 = Wasp_RuleFromText(TXT=nv_lg_4)  # -> R; plug-in component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
merge_86 = Merge(Data1=ruletxt_113)

# ----
_4d_nv_6 = Panel("""NV|5_4D|1
4D|1_NV|5""")
ruletxt_114 = Wasp_RuleFromText(TXT=_4d_nv_6)  # -> R; plug-in component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
merge_87 = Merge(Data1=ruletxt_114)

_4d_nv_7 = Panel("""NV|3_4D|2
4D|2_NV|3""")
ruletxt_115 = Wasp_RuleFromText(TXT=_4d_nv_7)  # -> R; plug-in component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
merge_88 = Merge(Data1=ruletxt_115)

# ---- group: Half Vault - Large Room
hv_lg_4 = Panel("""HV|2_LG|1
LG|1_HV|2
HV|2_LG|2
LG|2_HV|2""")
ruletxt_116 = Wasp_RuleFromText(TXT=hv_lg_4)  # -> R; plug-in component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
merge_89 = Merge(Data1=ruletxt_116)

# ---- group: 4 Domes - Room with Riwaq
_4d_rr = Panel("""4D|2_RR|5
RR|5_4D|2""")
ruletxt_117 = Wasp_RuleFromText(TXT=_4d_rr)  # -> R; plug-in component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
merge_90 = Merge(Data1=ruletxt_117)

# ---- group: Half Vault - 4 Domes
hv_4d_5 = Panel("""HV|2_4D|2
4D|2_HV|2""")
ruletxt_118 = Wasp_RuleFromText(TXT=hv_4d_5)  # -> R; plug-in component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
merge_91 = Merge(Data1=ruletxt_118)

# ---- group: MIRRORED SIDE Half Vault - 4 Domes
hv_4d_6 = Panel("""HV|2_4D|1
4D|1_HV|2""")
ruletxt_119 = Wasp_RuleFromText(TXT=hv_4d_6)  # -> R; plug-in component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
merge_92 = Merge(Data1=ruletxt_119)

# ----
merge_93 = Merge(Data1=merge_28, Data2=merge_24, Data3=merge_31, Data4=merge_25, Data5=merge_26, Data6=merge_37, Data7=merge_35)
merge_94 = Merge(
    Data1=merge_48,
    Data2=merge_57,
    Data3=merge_55,
    Data4=merge_52,
    Data5=merge_50,
    Data6=merge_49,
    Data7=merge_46,
    Data8=merge_53,
    Data9=merge_42,
    Data10=merge_51,
    Data11=merge_47,
    Data12=merge_41,
    Data13=merge_38)
merge_95 = Merge(
    Data1=merge_15,
    Data2=merge_18,
    Data3=merge_23,
    Data4=merge_19,
    Data5=merge_20,
    Data6=merge_16,
    Data7=merge_17,
    Data8=merge_14,
    Data9=merge_22,
    Data10=merge_21,
    Data11=merge_39,
    Data12=merge_36,
    Data13=merge_45,
    Data14=merge_43,
    Data15=merge_44,
    Data16=merge_40,
    Data17=merge_34,
    Data18=merge_33)
merge_96 = Merge(
    Data1=merge_91,
    Data2=merge_92,
    Data3=merge_90,
    Data4=ruletxt_98,
    Data5=merge_85,
    Data6=merge_87,
    Data7=merge_72,
    Data8=merge_75,
    Data9=merge_76,
    Data10=merge_74,
    Data11=merge_71,
    Data12=merge_70,
    Data13=merge_73)
parts_num_2 = Slider(1000, range=0..5000)
reset_2 = Button()

# ---- group: DETAILED_GEOMETRY
medium_room_with_dome_module = Brep(<brep referenced from the Rhino model>)

# ----
merge_97 = Merge()
merge_98 = Merge(Data1=part)
merge_99 = Merge()

# ----
# Courtyard Module Generation
parts_num_3 = Slider(1, range=0..1000)
check_collisions = BooleanToggle(True)
reset_3 = Button()
rndaggr = Wasp_StochasticAggregation(PART=flatten(merge_98), N=parts_num_3, RULES=merge_99, COLL=check_collisions, RESET=reset_3)  # -> PART_OUT; inputs PART: list, PREV: list, N: Int32, RULES: list, COLL: Boolean, MODE: Int32, RESET: Boolean; plug-in component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

merge_100 = Merge(
    Data1=merge_78,
    Data2=merge_77,
    Data3=merge_79,
    Data4=merge_83,
    Data5=merge_89,
    Data6=merge_86,
    Data7=merge_82,
    Data8=merge_84,
    Data9=merge_80,
    Data10=merge_81,
    Data11=merge_65,
    Data12=merge_64,
    Data13=merge_68,
    Data14=merge_66,
    Data15=merge_96,
    Data16=merge_94,
    Data17=merge_95,
    Data18=merge_93)

number_slider_4 = Slider(2, range=0..10)  # disabled

# ----
# Normal Vault
connections_centers_18 = Point([<point referenced from the Rhino model> x8])
part_geometry_19 = Brep(<brep referenced from the Rhino model>)
connections_x_axis_18 = Curve([<curve referenced from the Rhino model> x8])
conndir_19 = Wasp_ConnectionFromDirection(GEO=part_geometry_19, CEN=connections_centers_18, UP=connections_x_axis_18)  # -> CONN, PLN_OUT; inputs CEN: list of Point3d, UP: list of Curve, T: list; plug-in component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
part_name_21 = Panel("NV")
points_18 = PointList(Points=connections_centers_18, Size=Slider(0.7, range=0..10))

merge_101 = Merge(Data1=part_geometry_19, Data2=mjoin_2)
mjoin_4 = MeshJoin(Meshes=merge_101)

advpart_18 = Wasp_AdvancedPart(NAME=part_name_21, GEO=part_geometry_19, CONN=flatten(conndir_19.CONN), COLL=mjoin_4, E_COLL=collider_2)  # -> PART; inputs GEO: Mesh, CONN: list, COLL: Mesh, HI: list, ATTR: list, SUP: list; plug-in component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

merge_102 = Merge(Data1=part, Data2=advpart_18, Data4=advpart_10, Data6=advpart_8)

# ----
# 3. Aggregate!
# Stochastic Aggregation builds an aggregation by randomly selecting one part
# and one rule to be applied at every step. If COLL is set to True,
# collisions between parts are avoided. The component adds parts additively
# over the already aggregated parts. If a new aggregation has to be created,
# the RESET button allows to reset the aggregation and restart.
parts_num_4 = Slider(21, range=0..100)
check_collisions_2 = BooleanToggle(True)
reset_4 = Button()
rndaggr_2 = Wasp_StochasticAggregation(PART=flatten(merge_102), PREV=rndaggr, N=parts_num_4, RULES=merge_97, COLL=check_collisions_2, RESET=reset_4)  # -> PART_OUT; inputs PART: list, PREV: list, N: Int32, RULES: list, COLL: Boolean, MODE: Int32, RESET: Boolean; plug-in component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

# ---- group: Visualisation
part_name_22 = Panel("Courtyard")
namefilter = Wasp_FilterPartsByName(PART=rndaggr_2, NAME=part_name_22)  # -> PART_OUT, MASK; inputs PART: list, NAME: list; plug-in component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
partgeo = Wasp_GetPartGeometry(PART=namefilter.PART_OUT)  # -> GEO; plug-in component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
preview = CustomPreview(Geometry=partgeo, Material=ColourSwatch(SwatchColor=RGB(114, 150, 99)))

# ----
# 4. Extract Data and Visualize
# Aggregated parts can be exploded in order to
# access the data stored in each part, such as the
# part geometry for visualization purposes.
depart = Wasp_DeconstructPart(PART=rndaggr_2)  # -> NAME, GEO, CONN, CONN_PLN, TR, CHILD, ATTR; inputs PART: list; plug-in component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
preview_2 = CustomPreview(Geometry=depart.GEO, Shader=ColourSwatch(SwatchColor=RGB(186, 186, 186)))

# ----
# Normal Vault
connections_centers_19 = Point([<point referenced from the Rhino model> x8])  # disabled
connections_x_axis_19 = Curve([<curve referenced from the Rhino model> x8])  # disabled
part_geometry_20 = Brep(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)  # disabled
number_slider_5 = Slider(1, range=0..10)  # disabled
part_name_23 = Panel("NV")  # disabled
conndir_20 = Wasp_ConnectionFromDirection(GEO=part_geometry_20, CEN=connections_centers_19, UP=connections_x_axis_19)  # -> CONN, PLN_OUT; inputs CEN: list of Point3d, UP: list of Curve, T: list; disabled; plug-in component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
points_19 = PointList(Points=connections_centers_19, Size=number_slider_5)  # disabled

merge_103 = Merge(Data1=part_geometry_20, Data2=mjoin)  # disabled
mjoin_5 = MeshJoin(Meshes=merge_103)  # disabled

advpart_19 = Wasp_AdvancedPart(NAME=part_name_23, GEO=part_geometry_20, CONN=flatten(conndir_20.CONN), COLL=mjoin_5)  # -> PART; inputs GEO: Mesh, CONN: list, COLL: Mesh, HI: list, ATTR: list, SUP: list; disabled; plug-in component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

merge_104 = Merge(Data1=advpart_19, Data2=advpart_14, Data3=advpart_9)  # disabled
stochasticaggregation = Wasp_StochasticAggregation(PART=flatten(merge_104), N=parts_num, RULES=merge_13, MODE=Slider(1, range=0..1), RESET=reset)  # -> AGGR, PART_OUT; inputs PART: list, PREV: list, N: Int32, RULES: list, MODE: Int32, GC: list, RESET: Boolean; plug-in component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

# ----
# ALL GEOMETRY
depart_2 = Wasp_DeconstructPart(PART=stochasticaggregation.PART_OUT)  # -> NAME, GEO, CONN, CONN_PLN, TR, CHILD, ATTR; inputs PART: list; plug-in component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
preview_3 = CustomPreview(Geometry=depart_2.GEO, Shader=ColourSwatch(SwatchColor=RGB(186, 186, 186)))

# ----
# Half Vault Module
connections_centers_20 = Point([Point(-84.51982355, 88.95150272, 0), Point(-84.51982355, 91.47185253, 0), Point(-83.8897361, 90.21167762, 0), Point(-85.14991101, 90.21167762, 0)])
connections_x_axis_20 = Curve([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])
part_geometry_21 = Brep(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)
conndir_21 = Wasp_ConnectionFromDirection(GEO=part_geometry_21, CEN=connections_centers_20, UP=connections_x_axis_20)  # -> CONN, PLN_OUT; inputs CEN: list of Point3d, UP: list of Curve, T: list; plug-in component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
part_name_24 = Panel("HV")
points_20 = PointList(Points=connections_centers_20, Size=Slider(0.5, range=0..10))

part_name_25 = Panel(part_name_24)

rule = Wasp_Rule(P1=part_name_16, C1=Slider(0, range=0..1), P2=part_name_25, C2=Slider(1, range=0..100))  # -> R; inputs C1: Int32, C2: Int32; plug-in component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
rule_2 = Wasp_Rule(P1=part_name_25, C1=Slider(1, range=0..1), P2=part_name_16, C2=Slider(0, range=0..100))  # -> R; inputs C1: Int32, C2: Int32; plug-in component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
rule_3 = Wasp_Rule(P1=part_name_25, C1=Slider(0, range=0..1), P2=part_name_16, C2=Slider(1, range=0..100))  # -> R; inputs C1: Int32, C2: Int32; plug-in component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
rule_4 = Wasp_Rule(P1=part_name_16, C1=Slider(1, range=0..1), P2=part_name_25, C2=Slider(0, range=0..100))  # -> R; inputs C1: Int32, C2: Int32; plug-in component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
rule_5 = Wasp_Rule(P1=part_name_25, C1=number_slider_4, P2=part_name_25, C2=number_slider_4)  # -> R; inputs C1: Int32, C2: Int32; disabled; plug-in component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
rule_6 = Wasp_Rule(P1=part_name_25, C1=Slider(0, range=0..100), P2=part_name_25, C2=Slider(1, range=0..1))  # -> R; inputs C1: Int32, C2: Int32; disabled; plug-in component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
rule_7 = Wasp_Rule(P1=part_name_19, C1=Slider(0, range=0..1), P2=part_name_25, C2=Slider(1, range=0..100))  # -> R; inputs C1: Int32, C2: Int32; plug-in component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
rule_8 = Wasp_Rule(P1=part_name_25, C1=Slider(0, range=0..1), P2=part_name_19, C2=Slider(1, range=0..100))  # -> R; inputs C1: Int32, C2: Int32; plug-in component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
rule_9 = Wasp_Rule(P1=part_name_19, C1=Slider(1, range=0..1), P2=part_name_25, C2=Slider(0, range=0..100))  # -> R; inputs C1: Int32, C2: Int32; plug-in component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
rule_10 = Wasp_Rule(P1=part_name_25, C1=Slider(1, range=0..1), P2=part_name_19, C2=Slider(0, range=0..100))  # -> R; inputs C1: Int32, C2: Int32; plug-in component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
merge_105 = Merge(
    Data1=rule_3,
    Data2=rule_2,
    Data3=rule_4,
    Data4=rule,
    Data5=rule_5,
    Data6=rule_6,
    Data7=rule_10,
    Data8=rule_9,
    Data9=rule_8,
    Data10=rule_7)

merge_106 = Merge(Data1=part_geometry_21, Data2=courtyard_void_space_mesh_3)
mjoin_6 = MeshJoin(Meshes=merge_106)

advpart_20 = Wasp_AdvancedPart(NAME=part_name_24, GEO=part_geometry_21, CONN=flatten(conndir_21.CONN), COLL=mjoin_6, E_COLL=collider_3)  # -> PART; inputs GEO: Mesh, CONN: list, COLL: Mesh, HI: list, ATTR: list, SUP: list; plug-in component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

merge_107 = Merge(
    Data1=advpart_15,
    Data2=advpart_20,
    Data3=advpart_17,
    Data4=advpart_16,
    Data5=advpart_18,
    Data6=advpart_10,
    Data7=advpart_11,
    Data8=advpart_6,
    Data9=advpart_12,
    Data10=advpart_7,
    Data11=advpart_5,
    Data12=advpart_8,
    Data13=advpart_13,
    Data14=merge)
stochasticaggregation_2 = Wasp_StochasticAggregation(PART=flatten(merge_107), N=parts_num_2, RULES=merge_100, MODE=Slider(1, range=0..1), RESET=reset_2)  # -> AGGR, PART_OUT; inputs PART: list, PREV: list, N: Int32, RULES: list, MODE: Int32, GC: list, RESET: Boolean; plug-in component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

check_collisions_3 = BooleanToggle(True)
rndaggr_3 = Wasp_StochasticAggregation(PART=flatten(merge_107), COLL=check_collisions_3, RESET=reset_2)  # -> PART_OUT; inputs PART: list, PREV: list, N: Int32, RULES: list, COLL: Boolean, MODE: Int32, RESET: Boolean; plug-in component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
depart_3 = Wasp_DeconstructPart(PART=rndaggr_3)  # -> NAME, GEO, CONN, CONN_PLN, TR, CHILD, ATTR; inputs PART: list; plug-in component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
preview_4 = CustomPreview(Geometry=depart_3.GEO, Shader=ColourSwatch(SwatchColor=RGB(186, 186, 186)))

# ---- group: Visualisation
part_name_26 = Panel("4D")
namefilter_2 = Wasp_FilterPartsByName(PART=stochasticaggregation_2.PART_OUT, NAME=part_name_26)  # -> PART_OUT, MASK; inputs PART: list, NAME: list; plug-in component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
partgeo_2 = Wasp_GetPartGeometry(PART=namefilter_2.PART_OUT)  # -> GEO; plug-in component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
preview_5 = CustomPreview(Geometry=partgeo_2, Material=ColourSwatch(SwatchColor=RGB(99, 148, 150)))

# ----
# REPLACE GEOMETRY
panel_9 = Panel("MR")
namefilter_3 = Wasp_FilterPartsByName(PART=stochasticaggregation_2.PART_OUT, NAME=panel_9)  # -> PART_OUT, MASK; inputs PART: list, NAME: list; plug-in component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
number_slider_6 = Slider(2, range=0..10)
mesh = MeshBrep(
    Brep=medium_room_with_dome_module,
    Settings={GridMaxCount=0, GridMinCount=16, JaggedSeams=False, MaxEdgeLength=0, MinEdgeLength=0.0001, MinTolerance=0, Refine=True, RefineAngle=0, RelativeTolerance=0.65, SimplePlanes=True, Tolerance=0})
swatch = ColourSwatch(SwatchColor=RGB(199, 199, 199))

# ----
# ALL GEOMETRY
depart_4 = Wasp_DeconstructPart(PART=stochasticaggregation_2.PART_OUT)  # -> NAME, GEO, CONN, CONN_PLN, TR, CHILD, ATTR; inputs PART: list; plug-in component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
swatch_2 = ColourSwatch(SwatchColor=RGB(117, 117, 117))

cull = CullPattern(List=depart_4.TR, CullPattern=namefilter_3.MASK)
transform = Transform(Geometry=mesh, Transform=cull)
preview_6 = CustomPreview(Geometry=transform, Shader=swatch_2)

preview_7 = CustomPreview(Geometry=[depart_4.GEO, transform], Shader=swatch_2)
