# Grasshopper definition Structural analysis GH file.gh (Grasshopper 1.0.7)
# plug-ins: Heteroptera, Kangaroo Components, Weaverbird, Kangaroo2 Components, karambaGH

# ---- group: 4 dome / INPUT / geometry
size = Slider(5, range=0..10)  # disabled
butress_middle = Slider(0.3, range=0..1)  # disabled
height = Slider(2.3, range=0..10)  # disabled
butress = Slider(0.3, range=0..1)  # disabled

# ---- group: 4 dome / INPUT / Butresses Mesh Inputs
number_slider = Slider(3, range=0..10)  # disabled
number_slider_2 = Slider(0, range=0..10)  # disabled

# ---- group: 4 dome / INPUT / Openings Inputs
opening_width = Slider(0.8, range=0..1)  # disabled
min_opening_height = Slider(1.8, range=0..10)  # disabled

# ---- group: 4 dome / INPUT
load = Slider(0.2, range=0..1)  # disabled

# ---- group: 4 dome / INPUT / Kangaroo roof OLD
button = Button()  # disabled
toggle = BooleanToggle(True)  # disabled
edge_type = Slider(0, range=0..2)  # disabled
subdivision_loops = Slider(1, range=0..10)  # disabled
naked_vertex_count = Slider(24, range=0..100)  # disabled
spring_strength = Slider(60, range=0..100)  # disabled

# ---- group: 4 dome / INPUT / Kangaroo arc
button_2 = Button()  # disabled
toggle_2 = BooleanToggle(True)  # disabled
curve_subdivision = Slider(10, range=0..100)  # disabled
spring_strength_2 = Slider(50, range=0..100)  # disabled
number_slider_3 = Slider(0.5, range=0.1..0.5)  # disabled

# ---- group: 4 dome / INPUT / Kangaroo arc ceiling
button_3 = Button()  # disabled
number_slider_4 = Slider(50, range=0..100)  # disabled
number_slider_5 = Slider(0.5, range=0..1)  # disabled
toggle_3 = BooleanToggle(True)  # disabled

# ---- group: 4 dome / INPUT / Kangaroo Ceiling
button_4 = Button()  # disabled
toggle_4 = BooleanToggle(False)  # disabled
number_slider_6 = Slider(60, range=0..100)  # disabled
number_slider_7 = Slider(0.1, range=0..1)  # disabled

# ---- group: INPUT / geometry
butress_middle_2 = Slider(0.6, range=0..1)  # disabled
size_2 = Slider(5, range=0..10)  # disabled
butress_2 = Slider(0.6, range=0..1)  # disabled
height_2 = Slider(2.3, range=0..10)  # disabled

# ---- group: INPUT
number_slider_8 = Slider(2.5, range=0..10)  # disabled
number_slider_9 = Slider(24, range=0..100)  # disabled
number_slider_10 = Slider(0.2, range=0..1)  # disabled

# ---- group: INPUT / Butresses Mesh Inputs
number_slider_11 = Slider(3, range=0..10)  # disabled
number_slider_12 = Slider(0, range=0..10)  # disabled

# ---- group: INPUT / Openings Inputs
opening_width_2 = Slider(0.8, range=0..1)  # disabled
min_opening_height_2 = Slider(1.8, range=0..10)  # disabled

# ---- group: INPUT / Kangaroo arc
curve_subdivision_2 = Slider(10, range=0..100)  # disabled
spring_strength_3 = Slider(50, range=0..100)  # disabled
load_2 = Slider(0.5, range=0..1)  # disabled
button_5 = Button()  # disabled
toggle_5 = BooleanToggle(True)  # disabled

# ---- group: INPUT / Kangaroo roof old
edge_type_2 = Slider(0, range=0..2)  # disabled
subdivision_loops_2 = Slider(1, range=0..10)  # disabled
v_count = Slider(12, range=0..100)  # disabled
spring_strength_4 = Slider(20, range=0..100)  # disabled
button_6 = Button()  # disabled
toggle_6 = BooleanToggle(False)  # disabled

# ---- group: INPUT / kANGAROO VAULT V2
button_7 = Button()  # disabled
toggle_7 = BooleanToggle(True)  # disabled
number_slider_13 = Slider(24, range=0..100)  # disabled
number_slider_14 = Slider(61, range=0..100)  # disabled
number_slider_15 = Slider(0.5, range=0..1)  # disabled

# ---- group: INPUT / geometry
size_3 = Slider(5, range=0..10)  # disabled
butress_3 = Slider(0.3, range=0..1)  # disabled
height_3 = Slider(2.3, range=0..10)  # disabled
butress_middle_3 = Slider(0.3, range=0..1)  # disabled

# ---- group: INPUT / Openings Inputs
opening_width_3 = Slider(0.8, range=0..1)  # disabled
min_opening_height_3 = Slider(1.8, range=0..10)  # disabled

# ---- group: INPUT / Butresses Mesh Inputs
number_slider_16 = Slider(3, range=0..10)  # disabled
number_slider_17 = Slider(0, range=0..10)  # disabled

# ---- group: INPUT / Kangaroo roof old
spring_strength_5 = Slider(20, range=0..100)  # disabled
button_8 = Button()  # disabled
toggle_8 = BooleanToggle(True)  # disabled
edge_type_3 = Slider(0, range=0..2)  # disabled
subdivision_loops_3 = Slider(1, range=0..10)  # disabled
naked_vertex_count_2 = Slider(24, range=0..100)  # disabled

# ---- group: INPUT / Arc wall
number_slider_18 = Slider(0.4, range=0..1)  # disabled
number_slider_19 = Slider(100, range=0..100)  # disabled
toggle_9 = BooleanToggle(True)  # disabled
button_9 = Button()  # disabled

# ---- group: INPUT
number_slider_20 = Slider(0, range=0..1)  # disabled
load_3 = Slider(0.2, range=0..1)  # disabled

# ---- group: INPUT / Kangaroo arc
button_10 = Button()  # disabled
toggle_10 = BooleanToggle(True)  # disabled
curve_subdivision_3 = Slider(10, range=0..100)  # disabled
spring_strength_6 = Slider(50, range=0..100)  # disabled
load_4 = Slider(0.5, range=0.1..0.5)  # disabled

# ---- group: INPUT / ceiling 2 version
number_slider_21 = Slider(50, range=0..100)  # disabled
toggle_11 = BooleanToggle(False)  # disabled
button_11 = Button()  # disabled

# ---- group: INPUT / Kangaroo ceiling
number_slider_22 = Slider(100, range=0..100)  # disabled
button_12 = Button()  # disabled
number_slider_23 = Slider(0.09, range=0..0.1)  # disabled
toggle_12 = BooleanToggle(True)  # disabled

# ---- group: 4 dome / Base
vec = VectorXYZ(XComponent=0, YComponent=size, ZComponent=0)  # -> Vector, Length; disabled
A = ConstructPoint(XCoordinate=0, YCoordinate=0, ZCoordinate=0)  # disabled
move = Move(Geometry=A, Motion=vec.Vector)  # -> Geometry, Transform; disabled
pdecon = Deconstruct(Point=move.Geometry)  # -> XComponent, YComponent, ZComponent; disabled
line_a = LineSDL(Start=move.Geometry, Direction=Vector(0, 0, 1), Length=height)  # disabled
pdecon_2 = Deconstruct(Point=A)  # -> XComponent, YComponent, ZComponent; disabled
line_a_2 = LineSDL(Start=A, Direction=Vector(0, 0, 1), Length=height)  # disabled
vec_2 = VectorXYZ(XComponent=size, YComponent=size, ZComponent=0)  # -> Vector, Length; disabled
move_2 = Move(Geometry=A, Motion=vec_2.Vector)  # -> Geometry, Transform; disabled
line_a_3 = LineSDL(Start=move_2.Geometry, Direction=Vector(0, 0, 1), Length=height)  # disabled
vec_3 = VectorXYZ(XComponent=size, YComponent=0, ZComponent=0)  # -> Vector, Length; disabled
move_3 = Move(Geometry=A, Motion=vec_3.Vector)  # -> Geometry, Transform; disabled
line = LineSDL(Start=move_3.Geometry, Direction=Vector(0, 0, 1), Length=height)  # disabled
pdecon_3 = Deconstruct(Point=move_2.Geometry)  # -> XComponent, YComponent, ZComponent; disabled
pdecon_4 = Deconstruct(Point=move_3.Geometry)  # -> XComponent, YComponent, ZComponent; disabled

# ---- group: Base
vec_4 = VectorXYZ(XComponent=0, YComponent=size_3, ZComponent=0)  # -> Vector, Length; disabled
A_2 = ConstructPoint(XCoordinate=0, YCoordinate=0, ZCoordinate=0)  # disabled
move_4 = Move(Geometry=A_2, Motion=vec_4.Vector)  # -> Geometry, Transform; disabled
pdecon_5 = Deconstruct(Point=move_4.Geometry)  # -> XComponent, YComponent, ZComponent; disabled
line_a_4 = LineSDL(Start=move_4.Geometry, Direction=Vector(0, 0, 1), Length=height_3)  # disabled
pdecon_6 = Deconstruct(Point=A_2)  # -> XComponent, YComponent, ZComponent; disabled
line_a_5 = LineSDL(Start=A_2, Direction=Vector(0, 0, 1), Length=height_3)  # disabled
vec_5 = VectorXYZ(XComponent=size_3, YComponent=size_3, ZComponent=0)  # -> Vector, Length; disabled
move_5 = Move(Geometry=A_2, Motion=vec_5.Vector)  # -> Geometry, Transform; disabled
line_a_6 = LineSDL(Start=move_5.Geometry, Direction=Vector(0, 0, 1), Length=height_3)  # disabled
vec_6 = VectorXYZ(XComponent=size_3, YComponent=0, ZComponent=0)  # -> Vector, Length; disabled
move_6 = Move(Geometry=A_2, Motion=vec_6.Vector)  # -> Geometry, Transform; disabled
line_2 = LineSDL(Start=move_6.Geometry, Direction=Vector(0, 0, 1), Length=height_3)  # disabled
pdecon_7 = Deconstruct(Point=move_5.Geometry)  # -> XComponent, YComponent, ZComponent; disabled
pdecon_8 = Deconstruct(Point=move_6.Geometry)  # -> XComponent, YComponent, ZComponent; disabled

A_3 = ConstructPoint(XCoordinate=0, YCoordinate=0, ZCoordinate=0)  # disabled
pdecon_9 = Deconstruct(Point=A_3)  # -> XComponent, YComponent, ZComponent; disabled
line_a_7 = LineSDL(Start=A_3, Direction=Vector(0, 0, 1), Length=height_2)  # disabled
vec_7 = VectorXYZ(XComponent=0, YComponent=number_slider_8, ZComponent=0)  # -> Vector, Length; disabled
move_7 = Move(Geometry=A_3, Motion=vec_7.Vector)  # -> Geometry, Transform; disabled
pdecon_10 = Deconstruct(Point=move_7.Geometry)  # -> XComponent, YComponent, ZComponent; disabled
line_a_8 = LineSDL(Start=move_7.Geometry, Direction=Vector(0, 0, 1), Length=height_2)  # disabled
vec_8 = VectorXYZ(XComponent=size_2, YComponent=number_slider_8, ZComponent=0)  # -> Vector, Length; disabled
move_8 = Move(Geometry=A_3, Motion=vec_8.Vector)  # -> Geometry, Transform; disabled
line_a_9 = LineSDL(Start=move_8.Geometry, Direction=Vector(0, 0, 1), Length=height_2)  # disabled
vec_9 = VectorXYZ(XComponent=size_2, YComponent=0, ZComponent=0)  # -> Vector, Length; disabled
move_9 = Move(Geometry=A_3, Motion=vec_9.Vector)  # -> Geometry, Transform; disabled
line_3 = LineSDL(Start=move_9.Geometry, Direction=Vector(0, 0, 1), Length=height_2)  # disabled
pdecon_11 = Deconstruct(Point=move_8.Geometry)  # -> XComponent, YComponent, ZComponent; disabled
pdecon_12 = Deconstruct(Point=move_9.Geometry)  # -> XComponent, YComponent, ZComponent; disabled

# ---- group: OLD ARCHES / v lines
data = Data(line_a_7)  # disabled
data_2 = Data(line_a_8)  # disabled

# ---- group: 4 dome / OPENINGS / relaxed arc
data_3 = Data([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])  # disabled

# ---- group: Karamba Ceiling / Final Ceiling mesh
data_4 = Data(flatten(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))  # disabled

# ---- group: 4 dome / mat
panel = Panel("2.5")  # disabled
panel_2 = Panel("6")  # disabled
panel_3 = Panel("Adobe")  # disabled
panel_4 = Panel("19")  # disabled
panel_5 = Panel("Sp 1")  # disabled
panel_6 = Panel("0.05")  # disabled
matprops = MaterialPropertiesKaramba3D(
    FamilyOfMaterial=panel_3,
    Name=panel_5,
    YoungsModulus_kN_cm2=panel_2,
    InPlaneShearModulus_kN_cm2=panel,
    TransverseShearModulus_kN_cm2=panel,
    SpecificWeight_kN_m3=panel_4,
    CoefficientOfThermalExpansion_1_C=1e-05,
    YieldStrength_kN_cm2=panel_6,
    mode="Isotrop")  # disabled

# ---- group: mat
panel_7 = Panel("6")  # disabled
panel_8 = Panel("2.5")  # disabled
panel_9 = Panel("Adobe")  # disabled
panel_10 = Panel("0.05")  # disabled
panel_11 = Panel("19")  # disabled
panel_12 = Panel("Sp 1")  # disabled
matprops_2 = MaterialPropertiesKaramba3D(
    FamilyOfMaterial=panel_9,
    Name=panel_12,
    YoungsModulus_kN_cm2=panel_7,
    InPlaneShearModulus_kN_cm2=panel_8,
    TransverseShearModulus_kN_cm2=panel_8,
    SpecificWeight_kN_m3=panel_11,
    CoefficientOfThermalExpansion_1_C=1e-05,
    YieldStrength_kN_cm2=panel_10,
    mode="Isotrop")  # disabled

# ---- group: Material
panel_13 = Panel("6")  # disabled
panel_14 = Panel("2.5")  # disabled
panel_15 = Panel("Adobe")  # disabled
panel_16 = Panel("15")  # disabled
panel_17 = Panel("0.05")  # disabled
panel_18 = Panel("Sp 1")  # disabled
matprops_3 = MaterialPropertiesKaramba3D(
    FamilyOfMaterial=panel_15,
    Name=panel_18,
    YoungsModulus_kN_cm2=panel_13,
    InPlaneShearModulus_kN_cm2=panel_14,
    TransverseShearModulus_kN_cm2=panel_14,
    SpecificWeight_kN_m3=panel_16,
    CoefficientOfThermalExpansion_1_C=1e-05,
    YieldStrength_kN_cm2=panel_17,
    mode="Isotrop")  # disabled

# ---- group: 4 dome / Second floor / Second floor reaction forces
data_5 = Data()  # disabled

# ---- group: LC0
panel_19 = Panel("0")  # disabled
loads = LoadsKaramba3D(Vector=Vector(0, 0, -1), LCase=panel_19, mode="Gravity")  # disabled

# ---- group: 4 dome / Second floor
react = ReactionForcesKaramba3D(AnalyzedModel=data_5, ResultCase=0)  # -> AnalyzedModel, ReactionForces_kN, ReactionMoments_kNm, SupportPosition, SumOfReactionForces_kN, SumOfReactionMoments_kNm; disabled
neg = Negative(Value=react.ReactionMoments_kNm)  # disabled
neg_2 = Negative(Value=react.ReactionForces_kN)  # disabled
loads_2 = LoadsKaramba3D(ForceVector=neg_2, MomentVector=neg, Local=False, PosInd=react.SupportPosition, LCase=0, mode="Point")  # disabled

# ---- group: 4 dome
panel_20 = Panel("Four dome unit")
division = Division(A=size, B=2)  # disabled
vec_10 = VectorXYZ(XComponent=0, YComponent=0, ZComponent=height)  # -> Vector, Length; disabled
division_2 = Division(A=opening_width, B=2)  # disabled
number_slider_24 = Slider(1, range=0..10)  # disabled
number_slider_25 = Slider(0, range=0..10)  # disabled
end = EndPoints(Curve=line)  # -> Start, End; disabled
end_2 = EndPoints(Curve=line_a_2)  # -> Start, End; disabled
ln = Line(StartPoint=move.Geometry, EndPoint=A)  # disabled
midpt = CurveMiddle(Curve=ln)  # disabled
end_3 = EndPoints(Curve=line_a)  # -> Start, End; disabled
ln_2 = Line(StartPoint=end_2.End, EndPoint=end.End)  # disabled
end_4 = EndPoints(Curve=line_a_2)  # -> Start, End; disabled
ln_3 = Line(StartPoint=move.Geometry, EndPoint=move_2.Geometry)  # disabled
midpt_2 = CurveMiddle(Curve=ln_3)  # disabled
ln_4 = Line(StartPoint=A, EndPoint=move_3.Geometry)  # disabled
midpt_3 = CurveMiddle(Curve=ln_4)  # disabled
line_4 = LineSDL(Start=midpt_3, Direction=Vector(0, 0, 1), Length=height)  # disabled
end_5 = EndPoints(Curve=line_4)  # -> Start, End; disabled
ln_5 = Line(StartPoint=A, EndPoint=midpt_3)  # disabled
midpt_4 = CurveMiddle(Curve=ln_5)  # disabled
line_5 = LineSDL(Start=midpt_4, Direction=Vector(1, 0, 0), Length=division_2)  # disabled
line_6 = LineSDL(Start=midpt_4, Direction=Vector(-1, 0, 0), Length=division_2)  # disabled
end_6 = EndPoints(Curve=line_5)  # -> Start, End; disabled
line_7 = LineSDL(Start=end_6.End, Direction=Vector(-1, 0, 0), Length=opening_width)  # disabled
ln_6 = Line(StartPoint=midpt_3, EndPoint=end_6.End)  # disabled
end_7 = EndPoints(Curve=line_6)  # -> Start, End; disabled
ln_7 = Line(StartPoint=end_5.End, EndPoint=end_2.End)  # disabled
line_8 = LineSDL(Start=end_6.End, Direction=Vector(0, 0, 1), Length=min_opening_height)  # disabled
line_9 = LineSDL(Start=end_7.End, Direction=Vector(0, 0, 1), Length=min_opening_height)  # disabled
end_8 = EndPoints(Curve=line_9)  # -> Start, End; disabled
ln_8 = Line(StartPoint=end_2.Start, EndPoint=end_8.Start)  # disabled
move_10 = Move(Geometry=ln_4, Motion=vec_10.Vector)  # -> Geometry, Transform; disabled
end_9 = EndPoints(Curve=line_8)  # -> Start, End; disabled
end_10 = EndPoints(Curve=line_9)  # -> Start, End; disabled
yz = YZPlane(Origin=midpt_3)  # disabled
data_6 = Data(end_9.End)  # disabled
data_7 = Data(end_10.End)  # disabled
data_8 = Data(line_8)  # disabled
end_11 = EndPoints(Curve=line)  # -> Start, End; disabled
end_12 = EndPoints(Curve=line_a_3)  # -> Start, End; disabled
ln_9 = Line(StartPoint=move_2.Geometry, EndPoint=move_3.Geometry)  # disabled
midpt_5 = CurveMiddle(Curve=ln_9)  # disabled
data_9 = Data(end_9.Start)  # disabled
data_10 = Data(midpt_3)  # disabled
yz_2 = YZPlane(Origin=data_10)  # disabled
mirror = Mirror(Geometry=ln_7, Plane=yz_2)  # -> Geometry, Transform; disabled
dist = Distance(PointA=data_9, PointB=data_10)  # disabled
mirror_2 = Mirror(Geometry=data_8, Plane=yz_2)  # -> Geometry, Transform; disabled
multiplication = Multiplication(A=dist, B=2)  # disabled
line_10 = LineSDL(Start=data_9, Direction=Vector(1, 0, 0), Length=multiplication)  # disabled
X = UnitX(Factor=1)  # disabled
move_11 = Move(Motion=X)  # -> Geometry, Transform; disabled
Y = UnitY(Factor=1)  # disabled
move_12 = Move(Geometry=line_10, Motion=vec_10.Vector)  # -> Geometry, Transform; disabled
move_13 = Move(Geometry=move_11.Geometry, Motion=Y)  # -> Geometry, Transform; disabled
pt = Point(<point referenced from the Rhino model>)  # disabled
pt_2 = Point(<point referenced from the Rhino model>)  # disabled
ln_10 = Line(StartPoint=pt_2, EndPoint=pt)  # disabled
number_slider_26 = Slider(42, range=0..100)  # disabled
cross_section = CrossSectionKaramba3D(
    FamilyNameOfCrossSection="DefaultCroSec",
    Material=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,
    Height_cm=number_slider_26,
    mode="Shell - Const")  # disabled
panel_21 = Panel("column")  # disabled
panel_22 = Panel("1")  # disabled
loads_3 = LoadsKaramba3D(Vector=Vector(0, 0, -1), LCase=panel_22, mode="Gravity")  # disabled
swatch = ColourSwatch(SwatchColor=RGB(255, 0, 0))  # disabled
swatch_2 = ColourSwatch(SwatchColor=RGB(34, 0, 255))  # disabled
swatch_3 = ColourSwatch(SwatchColor=RGB(255, 255, 255))  # disabled
swatch_4 = ColourSwatch(SwatchColor=RGB(255, 255, 255))  # disabled
swatch_5 = ColourSwatch(SwatchColor=RGB(255, 255, 255))  # disabled
panel_23 = Panel("Displacement [mm]")  # disabled
panel_24 = Panel("""0
18""")  # disabled

# ---- group: 4 dome / Karamba Arc / Relaxed arc
ln_11 = Line(StartPoint=data_6, EndPoint=data_7)  # disabled

# ---- group: 4 dome / Corner Butresses
addition = Addition(A=pdecon_2.XComponent, B=butress)  # disabled
addition_2 = Addition(A=pdecon.XComponent, B=butress)  # disabled
addition_3 = Addition(A=pdecon_2.YComponent, B=butress)  # disabled
addition_4 = Addition(A=pdecon.YComponent, B=butress)  # disabled
neg_3 = Negative(Value=addition)  # disabled
neg_4 = Negative(Value=addition_2)  # disabled
neg_5 = Negative(Value=addition_3)  # disabled
vec_11 = VectorXYZ(XComponent=neg_3, YComponent=0, ZComponent=0)  # -> Vector, Length; disabled
vec_12 = VectorXYZ(XComponent=neg_4, YComponent=pdecon.YComponent, ZComponent=0)  # -> Vector, Length; disabled
vec_13 = VectorXYZ(XComponent=0, YComponent=neg_5, ZComponent=0)  # -> Vector, Length; disabled
vec_14 = VectorXYZ(XComponent=pdecon.XComponent, YComponent=addition_4, ZComponent=0)  # -> Vector, Length; disabled
move_14 = Move(Geometry=A, Motion=vec_11.Vector)  # -> Geometry, Transform; disabled
move_15 = Move(Geometry=A, Motion=vec_12.Vector)  # -> Geometry, Transform; disabled
move_16 = Move(Geometry=A, Motion=vec_13.Vector)  # -> Geometry, Transform; disabled
move_17 = Move(Geometry=A, Motion=vec_14.Vector)  # -> Geometry, Transform; disabled
ln_12 = Line(StartPoint=move_14.Geometry, EndPoint=A)  # disabled
ln_13 = Line(StartPoint=move_16.Geometry, EndPoint=A)  # disabled
ln_14 = Line(StartPoint=move_15.Geometry, EndPoint=move.Geometry)  # disabled
ln_15 = Line(StartPoint=move_17.Geometry, EndPoint=move.Geometry)  # disabled
extr = Extrude(Base=ln_12, Direction=vec_10.Vector)  # disabled
extr_2 = Extrude(Base=ln_13, Direction=vec_10.Vector)  # disabled
extr_3 = Extrude(Base=ln_14, Direction=vec_10.Vector)  # disabled
extr_4 = Extrude(Base=ln_15, Direction=vec_10.Vector)  # disabled
addition_5 = Addition(A=pdecon_3.XComponent, B=butress)  # disabled
addition_6 = Addition(A=pdecon_4.XComponent, B=butress)  # disabled
addition_7 = Addition(A=pdecon_3.YComponent, B=butress)  # disabled
addition_8 = Addition(A=pdecon_4.YComponent, B=butress)  # disabled
neg_6 = Negative(Value=addition_8)  # disabled
vec_15 = VectorXYZ(XComponent=addition_6, YComponent=0, ZComponent=0)  # -> Vector, Length; disabled
vec_16 = VectorXYZ(XComponent=pdecon_3.XComponent, YComponent=addition_7, ZComponent=0)  # -> Vector, Length; disabled
vec_17 = VectorXYZ(XComponent=addition_5, YComponent=pdecon_3.YComponent, ZComponent=0)  # -> Vector, Length; disabled
vec_18 = VectorXYZ(XComponent=pdecon_4.XComponent, YComponent=neg_6, ZComponent=0)  # -> Vector, Length; disabled
move_18 = Move(Geometry=A, Motion=vec_17.Vector)  # -> Geometry, Transform; disabled
move_19 = Move(Geometry=A, Motion=vec_15.Vector)  # -> Geometry, Transform; disabled
move_20 = Move(Geometry=A, Motion=vec_16.Vector)  # -> Geometry, Transform; disabled
move_21 = Move(Geometry=A, Motion=vec_18.Vector)  # -> Geometry, Transform; disabled
ln_16 = Line(StartPoint=move_19.Geometry, EndPoint=move_3.Geometry)  # disabled
ln_17 = Line(StartPoint=move_21.Geometry, EndPoint=move_3.Geometry)  # disabled
ln_18 = Line(StartPoint=move_18.Geometry, EndPoint=move_2.Geometry)  # disabled
ln_19 = Line(StartPoint=move_20.Geometry, EndPoint=move_2.Geometry)  # disabled
extr_5 = Extrude(Base=ln_16, Direction=vec_10.Vector)  # disabled
extr_6 = Extrude(Base=ln_17, Direction=vec_10.Vector)  # disabled
extr_7 = Extrude(Base=ln_18, Direction=vec_10.Vector)  # disabled
extr_8 = Extrude(Base=ln_19, Direction=vec_10.Vector)  # disabled

# ---- group: 4 dome / Karamba Arc
divide = DivideCurve(Curve=ln_11, Count=curve_subdivision, Kinks=False)  # -> Points, Tangents, Parameters; disabled
shatter = Shatter(Curve=ln_11, Parameters=divide.Parameters)  # disabled
anchor = Anchor(Point=[data_6, data_7], Strength=10000)  # disabled
length_line = LengthLine(Line=shatter, Strength=spring_strength_2)  # disabled
load_5 = Load(Point=divide.Points, ForceVector=Vector(0, 0, 1), Weighting=number_slider_3)  # disabled
show = Show(G=shatter)  # disabled
entwine = Entwine(Branch00=show, Branch01=anchor, Branch02=length_line, Branch03=load_5, FlattenInputs=True)  # disabled
solver = Solver(GoalObjects=entwine, Reset=button_2, Threshold=1e-15, Tolerance=0.01, On=toggle_2)  # -> I, V, O; disabled
bang = ExplodeTree(Data=solver.O)  # -> Branch0, Branch1; disabled

# ---- group: 4 dome / mesh2
wbweave = WeaverbirdsMeshFromLinesWeaveBack(Lines=[data_8, mirror_2.Geometry, line_10, move_12.Geometry], MaximumValence=4)  # disabled

# ---- group: 4 dome / Butress AD
Y_2 = UnitY(Factor=butress_middle)  # disabled
Y_3 = UnitY(Factor=butress_middle)  # disabled
neg_7 = Negative(Value=Y_3)  # disabled
move_22 = Move(Geometry=midpt_3, Motion=Y_2)  # -> Geometry, Transform; disabled
move_23 = Move(Geometry=midpt_3, Motion=neg_7)  # -> Geometry, Transform; disabled
ln_20 = Line(StartPoint=midpt_3, EndPoint=move_23.Geometry)  # disabled
extr_9 = Extrude(Base=ln_20, Direction=vec_10.Vector)  # disabled

# ---- group: 4 dome / OPENINGS / arc AD
data_11 = Data(data_3)  # disabled
mirror_3 = Mirror(Geometry=data_11, Plane=yz_2)  # -> Geometry, Transform; disabled

# ---- group: 4 dome / Butress AB
pl_3pt = Plane3Pt(PointA=A, PointB=move_2.Geometry, PointC=end_2.End)  # disabled
mirror_4 = Mirror(Geometry=extr_9, Plane=pl_3pt)  # -> Geometry, Transform; disabled

# ---- group: 4 dome / Butress CD
pl_3pt_2 = Plane3Pt(PointA=end_11.End, PointB=move_3.Geometry, PointC=move.Geometry)  # disabled
mirror_5 = Mirror(Geometry=extr_9, Plane=pl_3pt_2)  # -> Geometry, Transform; disabled

# ---- group: 4 dome / Butress BC
pl_3pt_3 = Plane3Pt(PointA=A, PointB=move_2.Geometry, PointC=end_2.End)  # disabled
mirror_6 = Mirror(Geometry=mirror_5.Geometry, Plane=pl_3pt_3)  # -> Geometry, Transform; disabled

# ---- group: 4 dome / Karamba Arc
divide_2 = DivideCurve(Curve=ln_10, Count=curve_subdivision, Kinks=False)  # -> Points, Tangents, Parameters; disabled
shatter_2 = Shatter(Curve=ln_10, Parameters=divide_2.Parameters)  # disabled
anchor_2 = Anchor(Point=[pt_2, pt], Strength=10000)  # disabled
length_line_2 = LengthLine(Line=shatter_2, Strength=number_slider_4)  # disabled
load_6 = Load(Point=divide_2.Points, ForceVector=Vector(0, 0, 1), Weighting=number_slider_5)  # disabled
show_2 = Show(G=shatter_2)  # disabled
entwine_2 = Entwine(Branch00=show_2, Branch01=anchor_2, Branch02=length_line_2, Branch03=load_6, FlattenInputs=True)  # disabled
solver_2 = Solver(GoalObjects=entwine_2, Reset=button_3, Threshold=1e-15, Tolerance=0.01, On=toggle_3)  # -> I, V, O; disabled
bang_2 = ExplodeTree(Data=solver_2.O)  # -> Branch0, Branch1; disabled

# ---- group: 4 dome / Middle points
Z = UnitZ(Factor=height)  # disabled
move_24 = Move(Geometry=[midpt_3, midpt_5, midpt, midpt_2], Motion=Z)  # -> Geometry, Transform; disabled

# ---- group: 4 dome / small dome
pl_3pt_4 = Plane3Pt(PointA=move_2.Geometry, PointB=end_4.Start, PointC=end_4.End)  # disabled
data_12 = Data(bang_2.Branch0)  # disabled
mirror_7 = Mirror(Geometry=data_12, Plane=pl_3pt_4)  # -> Geometry, Transform; disabled
pl_3pt_5 = Plane3Pt(PointA=pt, PointB=midpt_3, PointC=midpt)  # disabled
pl_3pt_6 = Plane3Pt(PointA=pt, PointB=midpt_3, PointC=midpt)  # disabled
mirror_8 = Mirror(Geometry=mirror_7.Geometry, Plane=pl_3pt_6)  # -> flatten(Geometry), Transform; disabled
mirror_9 = Mirror(Geometry=data_12, Plane=pl_3pt_5)  # -> flatten(Geometry), Transform; disabled
join = JoinCurves(Curves=mirror_9.Geometry, Preserve=False)  # disabled
join_2 = JoinCurves(Curves=mirror_8.Geometry, Preserve=False)  # disabled
join_3 = JoinCurves(Curves=mirror_7.Geometry, Preserve=False)  # disabled
join_4 = JoinCurves(Curves=data_12, Preserve=False)  # disabled
edgesrf = EdgeSurface(CurveA=join_4, CurveB=join, CurveC=join_3, CurveD=join_2)  # disabled
mesh = MeshBrep(
    Brep=edgesrf,
    Settings={GridMaxCount=0, GridMinCount=4, JaggedSeams=True, MaxEdgeLength=0, MinEdgeLength=0.0001, MinTolerance=0, Refine=True, RefineAngle=0, RelativeTolerance=0.65, SimplePlanes=False, Tolerance=0})  # disabled

# ---- group: 4 dome / Karamba Ceiling
data_13 = Data(mesh)  # disabled
medges = MeshEdges(Mesh=data_13)  # -> NakedEdges, InteriorEdges, NonManifoldEdges; disabled
wbedges = WeaverbirdsMeshEdges(MeshOrPolylines=data_13)  # disabled
divide_3 = DivideCurve(Curve=medges.NakedEdges, Count=1, Kinks=False)  # -> Points, Tangents, Parameters; disabled
anchor_3 = Anchor(Point=flatten(divide_3.Points), Strength=10000)  # disabled
vertexloads = VertexLoads(Mesh=data_13, Strength=number_slider_7)  # disabled
length_line_3 = LengthLine(Line=wbedges, Strength=number_slider_6)  # disabled
show_3 = Show(G=data_13)  # disabled
entwine_3 = Entwine(Branch00=show_3, Branch01=anchor_3, Branch02=length_line_3, Branch03=vertexloads, FlattenInputs=True)  # disabled
solver_3 = Solver(GoalObjects=entwine_3, Reset=button_4, Threshold=1e-15, Tolerance=0.01, On=toggle_4)  # -> I, V, O; disabled
bang_3 = ExplodeTree(Data=solver_3.O)  # -> Branch0, Branch1; disabled

# ---- group: 4 dome / BUTTRESSES
number_slider_27 = Slider(3, range=0..10)  # disabled
number_slider_28 = Slider(14, range=0..100)  # disabled
mesh_uv = MeshSurface(
    Surface=[extr_7, extr_8, extr_5, extr_6, extr_3, extr_4, extr, extr_2, extr_9, mirror_5.Geometry, mirror_6.Geometry, mirror_4.Geometry],
    UCount=number_slider_28,
    VCount=number_slider_27,
    Overhang=True,
    Equalize=False)  # disabled

# ---- group: 4 dome / Karamba Ceiling / Final Ceiling mesh
data_14 = Data(flatten(bang_3.Branch0))  # disabled

# ----
panel_25 = Panel("Riwaq unit")
number_slider_29 = Slider(51, range=0..100)  # disabled
vec_19 = VectorXYZ(XComponent=0, YComponent=0, ZComponent=height_2)  # -> Vector, Length; disabled
division_3 = Division(A=opening_width_2, B=2)  # disabled
number_slider_30 = Slider(2, range=0..10)  # disabled
number_slider_31 = Slider(0, range=0..10)  # disabled
end_13 = EndPoints(Curve=line_3)  # -> Start, End; disabled
end_14 = EndPoints(Curve=line_a_7)  # -> Start, End; disabled
ln_21 = Line(StartPoint=move_7.Geometry, EndPoint=A_3)  # disabled
midpt_6 = CurveMiddle(Curve=ln_21)  # disabled
end_15 = EndPoints(Curve=line_a_8)  # -> Start, End; disabled
ln_22 = Line(StartPoint=end_14.End, EndPoint=end_13.End)  # disabled
end_16 = EndPoints(Curve=line_a_7)  # -> Start, End; disabled
ln_23 = Line(StartPoint=move_7.Geometry, EndPoint=move_8.Geometry)  # disabled
midpt_7 = CurveMiddle(Curve=ln_23)  # disabled
ln_24 = Line(StartPoint=A_3, EndPoint=move_9.Geometry)  # disabled
midpt_8 = CurveMiddle(Curve=ln_24)  # disabled
line_11 = LineSDL(Start=midpt_8, Direction=Vector(0, 0, 1), Length=height_2)  # disabled
end_17 = EndPoints(Curve=line_11)  # -> Start, End; disabled
ln_25 = Line(StartPoint=A_3, EndPoint=midpt_8)  # disabled
midpt_9 = CurveMiddle(Curve=ln_25)  # disabled
line_12 = LineSDL(Start=midpt_9, Direction=Vector(1, 0, 0), Length=division_3)  # disabled
line_13 = LineSDL(Start=midpt_9, Direction=Vector(-1, 0, 0), Length=division_3)  # disabled
end_18 = EndPoints(Curve=line_12)  # -> Start, End; disabled
ln_26 = Line(StartPoint=midpt_8, EndPoint=end_18.End)  # disabled
end_19 = EndPoints(Curve=line_13)  # -> Start, End; disabled
ln_27 = Line(StartPoint=end_17.End, EndPoint=end_14.End)  # disabled
line_14 = LineSDL(Start=end_18.End, Direction=Vector(0, 0, 1), Length=min_opening_height_2)  # disabled
line_15 = LineSDL(Start=end_19.End, Direction=Vector(0, 0, 1), Length=min_opening_height_2)  # disabled
end_20 = EndPoints(Curve=line_15)  # -> Start, End; disabled
ln_28 = Line(StartPoint=end_14.Start, EndPoint=end_20.Start)  # disabled
move_25 = Move(Geometry=ln_24, Motion=vec_19.Vector)  # -> Geometry, Transform; disabled
line_16 = LineSDL(Start=end_18.End, Direction=Vector(-1, 0, 0), Length=opening_width_2)  # disabled
data_15 = Data(midpt_8)  # disabled
end_21 = EndPoints(Curve=line_14)  # -> Start, End; disabled
yz_3 = YZPlane(Origin=data_15)  # disabled
end_22 = EndPoints(Curve=line_15)  # -> Start, End; disabled
yz_4 = YZPlane(Origin=midpt_8)  # disabled
data_16 = Data(end_21.End)  # disabled
data_17 = Data(end_22.End)  # disabled
end_23 = EndPoints(Curve=line_3)  # -> Start, End; disabled
end_24 = EndPoints(Curve=line_a_9)  # -> Start, End; disabled
ln_29 = Line(StartPoint=move_8.Geometry, EndPoint=move_9.Geometry)  # disabled
midpt_10 = CurveMiddle(Curve=ln_29)  # disabled
number_slider_32 = Slider(5, range=0..10)  # disabled
X_2 = UnitX(Factor=number_slider_32)  # disabled
number_slider_33 = Slider(48, range=0..100)  # disabled
number_slider_34 = Slider(20, range=0..100)  # disabled
number_slider_35 = Slider(5, range=0..10)  # disabled
material = MaterialKaramba3D(matprops_3)  # disabled
panel_26 = Panel("4")  # disabled
panel_27 = Panel("1")  # disabled
loads_4 = LoadsKaramba3D(Vector=Vector(0, 0, -1), LCase=panel_27, mode="Gravity")  # disabled
swatch_6 = ColourSwatch(SwatchColor=RGB(255, 255, 255))  # disabled
swatch_7 = ColourSwatch(SwatchColor=RGB(255, 255, 255))  # disabled
swatch_8 = ColourSwatch(SwatchColor=RGB(34, 0, 255))  # disabled
swatch_9 = ColourSwatch(SwatchColor=RGB(255, 0, 0))  # disabled
swatch_10 = ColourSwatch(SwatchColor=RGB(255, 255, 255))  # disabled
panel_28 = Panel("Displacement [mm]")  # disabled
panel_29 = Panel("""0
18""")  # disabled

# ---- group: Karamba Arc / Relaxed arc
ln_30 = Line(StartPoint=data_16, EndPoint=data_17)  # disabled

# ---- group: Corner Butresses
addition_9 = Addition(A=pdecon_9.XComponent, B=butress_2)  # disabled
addition_10 = Addition(A=pdecon_10.XComponent, B=butress_2)  # disabled
addition_11 = Addition(A=pdecon_9.YComponent, B=butress_2)  # disabled
addition_12 = Addition(A=pdecon_10.YComponent, B=butress_2)  # disabled
neg_8 = Negative(Value=addition_9)  # disabled
neg_9 = Negative(Value=addition_10)  # disabled
neg_10 = Negative(Value=addition_11)  # disabled
vec_20 = VectorXYZ(XComponent=neg_8, YComponent=0, ZComponent=0)  # -> Vector, Length; disabled
vec_21 = VectorXYZ(XComponent=0, YComponent=neg_10, ZComponent=0)  # -> Vector, Length; disabled
vec_22 = VectorXYZ(XComponent=neg_9, YComponent=pdecon_10.YComponent, ZComponent=0)  # -> Vector, Length; disabled
vec_23 = VectorXYZ(XComponent=pdecon_10.XComponent, YComponent=addition_12, ZComponent=0)  # -> Vector, Length; disabled
move_26 = Move(Geometry=A_3, Motion=vec_20.Vector)  # -> Geometry, Transform; disabled
move_27 = Move(Geometry=A_3, Motion=vec_22.Vector)  # -> Geometry, Transform; disabled
move_28 = Move(Geometry=A_3, Motion=vec_21.Vector)  # -> Geometry, Transform; disabled
move_29 = Move(Geometry=A_3, Motion=vec_23.Vector)  # -> Geometry, Transform; disabled
ln_31 = Line(StartPoint=move_26.Geometry, EndPoint=A_3)  # disabled
ln_32 = Line(StartPoint=move_28.Geometry, EndPoint=A_3)  # disabled
ln_33 = Line(StartPoint=move_27.Geometry, EndPoint=move_7.Geometry)  # disabled
ln_34 = Line(StartPoint=move_29.Geometry, EndPoint=move_7.Geometry)  # disabled
extr_10 = Extrude(Base=ln_31, Direction=vec_19.Vector)  # disabled
extr_11 = Extrude(Base=ln_32, Direction=vec_19.Vector)  # disabled
extr_12 = Extrude(Base=ln_33, Direction=vec_19.Vector)  # disabled
extr_13 = Extrude(Base=ln_34, Direction=vec_19.Vector)  # disabled
addition_13 = Addition(A=pdecon_11.XComponent, B=butress_2)  # disabled
addition_14 = Addition(A=pdecon_12.XComponent, B=butress_2)  # disabled
addition_15 = Addition(A=pdecon_11.YComponent, B=butress_2)  # disabled
addition_16 = Addition(A=pdecon_12.YComponent, B=butress_2)  # disabled
neg_11 = Negative(Value=addition_16)  # disabled
vec_24 = VectorXYZ(XComponent=addition_14, YComponent=0, ZComponent=0)  # -> Vector, Length; disabled
vec_25 = VectorXYZ(XComponent=pdecon_11.XComponent, YComponent=addition_15, ZComponent=0)  # -> Vector, Length; disabled
vec_26 = VectorXYZ(XComponent=addition_13, YComponent=pdecon_11.YComponent, ZComponent=0)  # -> Vector, Length; disabled
vec_27 = VectorXYZ(XComponent=pdecon_12.XComponent, YComponent=neg_11, ZComponent=0)  # -> Vector, Length; disabled
move_30 = Move(Geometry=A_3, Motion=vec_26.Vector)  # -> Geometry, Transform; disabled
move_31 = Move(Geometry=A_3, Motion=vec_24.Vector)  # -> Geometry, Transform; disabled
move_32 = Move(Geometry=A_3, Motion=vec_25.Vector)  # -> Geometry, Transform; disabled
move_33 = Move(Geometry=A_3, Motion=vec_27.Vector)  # -> Geometry, Transform; disabled
ln_35 = Line(StartPoint=move_31.Geometry, EndPoint=move_9.Geometry)  # disabled
ln_36 = Line(StartPoint=move_33.Geometry, EndPoint=move_9.Geometry)  # disabled
ln_37 = Line(StartPoint=move_30.Geometry, EndPoint=move_8.Geometry)  # disabled
ln_38 = Line(StartPoint=move_32.Geometry, EndPoint=move_8.Geometry)  # disabled
extr_14 = Extrude(Base=ln_35, Direction=vec_19.Vector)  # disabled
extr_15 = Extrude(Base=ln_36, Direction=vec_19.Vector)  # disabled
extr_16 = Extrude(Base=ln_37, Direction=vec_19.Vector)  # disabled
extr_17 = Extrude(Base=ln_38, Direction=vec_19.Vector)  # disabled

# ---- group: Karamba Arc
divide_4 = DivideCurve(Curve=ln_30, Count=curve_subdivision_2, Kinks=False)  # -> Points, Tangents, Parameters; disabled
shatter_3 = Shatter(Curve=ln_30, Parameters=divide_4.Parameters)  # disabled
anchor_4 = Anchor(Point=[data_16, data_17], Strength=10000)  # disabled
length_line_4 = LengthLine(Line=shatter_3, Strength=spring_strength_3)  # disabled
load_7 = Load(Point=divide_4.Points, ForceVector=Vector(0, 0, 1), Weighting=load_2)  # disabled
show_4 = Show(G=shatter_3)  # disabled
entwine_4 = Entwine(Branch00=show_4, Branch01=anchor_4, Branch02=length_line_4, Branch03=load_7, FlattenInputs=True)  # disabled
solver_4 = Solver(GoalObjects=entwine_4, Reset=button_5, Threshold=1e-15, Tolerance=0.01, On=toggle_5)  # -> I, V, O; disabled
bang_4 = ExplodeTree(Data=solver_4.O)  # -> Branch0, Branch1; disabled
data_18 = Data(flatten([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]))  # disabled

# ---- group: Karamba Arc / Relaxed arc
ln_39 = Line(StartPoint=end_16.End, EndPoint=end_15.End)  # disabled

# ---- group: Karamba Arc
divide_5 = DivideCurve(Curve=ln_39, Count=number_slider_13, Kinks=False)  # -> Points, Tangents, Parameters; disabled
shatter_4 = Shatter(Curve=ln_39, Parameters=divide_5.Parameters)  # disabled
anchor_5 = Anchor(Point=[end_16.End, end_15.End], Strength=10000)  # disabled
length_line_5 = LengthLine(Line=shatter_4, Strength=number_slider_14)  # disabled
load_8 = Load(Point=divide_5.Points, ForceVector=Vector(0, 0, 1), Weighting=number_slider_15)  # disabled
show_5 = Show(G=shatter_4)  # disabled
entwine_5 = Entwine(Branch00=show_5, Branch01=anchor_5, Branch02=length_line_5, Branch03=load_8, FlattenInputs=True)  # disabled
solver_5 = Solver(GoalObjects=entwine_5, Reset=button_7, Threshold=1e-15, Tolerance=0.01, On=toggle_7)  # -> I, V, O; disabled
bang_5 = ExplodeTree(Data=solver_5.O)  # -> Branch0, Branch1; disabled
data_19 = Data(flatten(bang_5.Branch0))  # disabled

# ---- group: OLD ARCHES
number_slider_36 = Slider(0.3, range=0..1)  # disabled
join_5 = JoinCurves(Curves=flatten([data, data_2, data_19]), Preserve=False)  # disabled
offset = OffsetCurve(Curve=join_5, Distance=expr("-x", number_slider_36), Plane=PlaneXY(0, 0, 0), Corners=1)  # disabled
rulesrf = RuledSurface(CurveA=join_5, CurveB=offset)  # disabled
edges = BrepEdges(Brep=rulesrf)  # -> flatten(Naked), Interior, NonManifold; disabled
join_6 = JoinCurves(Curves=edges.Naked, Preserve=False)  # disabled
m_loop = WeightedLoopSubdivision(M=join_6, L=1, E=0, TE=1, TV=1)  # -> out, A; inputs M: Mesh, TE: list, TV: list; disabled
# ---------- m_loop: VB ----------
    Component.Params.Input(0).Name = "Mesh"
    Component.Params.Input(0).Description = "An open or closed mesh whose faces should be triangular, all quad faces will be triangulated automatically"
    Component.Params.Input(1).Name = "Loops"
    Component.Params.Input(1).Description = "The number of iterations applied to each face"
    Component.Params.Input(2).Name = "Edge Type"
    Component.Params.Input(2).Description = "0=Fixed, 1=Smooth, 2=Fixed Corners"
    Component.Params.Input(3).Name = "Edge Weight [Vertex]"
    Component.Params.Input(3).Description = "An optional list of double values which overides the percent between the existing edge midpoint and the new smoothed vertex (1=Default)"
    Component.Params.Input(4).Name = "Vertex Weight [Vertex]"
    Component.Params.Input(4).Description = "An optional list of double values which overides the percent between the existing vertex and the new smoothed vertex (1=Default)"

    Component.Params.Output(1).Name = "Mesh"
    Component.Params.Output(1).Description = "If successful, a valid mesh"

    If m IsNot Nothing Then
      Dim ma As New mesh
      Dim i,lp As Integer
      Dim txV,txE As New list(Of Double)
      Dim xV(),xE() As Double
      Dim bn As Boolean
      Dim cb As Boolean

      'input mesh to the looped mesh
      m.weld(math.pi)
      If m.Faces.QuadCount() > 0 Then m.Faces.ConvertQuadsToTriangles
      ma = m

      ' match multiplier and color values to vertex count
      xV = TV.toarray()
      xE = TE.toarray()
      For i = 0 To m.Vertices.count() - 1 Step 1
        txV.add(xV(bC(xV, i)))
        txE.add(xE(bC(xE, i)))
      Next
      xV = txV.toarray()
      xE = txE.toarray()

      bn = m.IsClosed() = False

      For lp = 0 To L - 1 Step 1

        Dim mv As Rhino.Geometry.Collections.MeshVertexList
        Dim mf As Rhino.Geometry.Collections.MeshFaceList
        Dim mfn As Rhino.Geometry.Collections.MeshFaceNormalList
        Dim mc As Rhino.Geometry.Collections.MeshVertexColorList
        Dim mte As Rhino.Geometry.Collections.MeshTopologyEdgeList
        Dim mtv As Rhino.Geometry.Collections.MeshTopologyVertexList
        Dim mnv() As Boolean
        Dim nes As New list(Of Boolean)
        Dim pv() As point3d

        If ma.VertexColors.Count() > 0 Then
          cb = True
        Else
          cb = False
          ma.VertexColors.CreateMonotoneMesh(color.LightBlue)
        End If

        mv = ma.Vertices
        mf = ma.Faces
        mfn = ma.FaceNormals
        mc = ma.VertexColors
        mte = ma.TopologyEdges
        mtv = ma.TopologyVertices

        pv = mv.ToPoint3dArray
        mnv = ma.GetNakedEdgePointStatus

        Dim vo,vt As New list(Of point3d)
        Dim fo As New list(Of MeshFace)
        Dim j,k,u,v,cf,ce,cv As Integer
        Dim fi() As Integer
        Dim p(3) As point3d
        Dim mvi(3) As Integer
        Dim rv,re As New list(Of Double)
        Dim oc As New list(Of color)

        cv = mv.count()
        ce = mte.count()
        cf = mf.count()

        'Faces
        For i = 0 To cf - 1 Step 1
          fi = mtv.IndicesFromFace(i)
          mvi(0) = mtv.MeshVertexIndices(fi(0))(0)
          mvi(1) = mtv.MeshVertexIndices(fi(1))(0)
          mvi(2) = mtv.MeshVertexIndices(fi(2))(0)

          fo.add(New meshface(mte.GetEdgeIndex(fi(0), fi(1)), mte.GetEdgeIndex(fi(1), fi(2)), mte.GetEdgeIndex(fi(2), fi(0))))

          fo.add(New meshface(mte.GetEdgeIndex(fi(0), fi(1)), ce + mvi(1), mte.GetEdgeIndex(fi(1), fi(2))))
          fo.add(New meshface(mte.GetEdgeIndex(fi(1), fi(2)), ce + mvi(2), mte.GetEdgeIndex(fi(2), fi(0))))
          fo.add(New meshface(mte.GetEdgeIndex(fi(2), fi(0)), ce + mvi(0), mte.GetEdgeIndex(fi(0), fi(1))))
        Next

        'Edges
        For i = 0 To ce - 1 Step 1
          Dim cfi() As Integer
          Dim ta,tb As New list(Of Integer)
          Dim cei As Rhino.IndexPair

          cfi = mte.GetConnectedFaces(i)
          cei = mte.GetTopologyVertices(i)
          u = mtv.MeshVertexIndices(cei.I)(0)
          v = mtv.MeshVertexIndices(cei.J)(0)
          p(0) = (pv(u) + pv(v)) / 2

          If ubound(cfi) > 0 Then
            ta = mf.GetTopologicalVertices(cfi(0)).tolist()
            ta.remove(cei.I)
            ta.remove(cei.J)

            tb = mf.GetTopologicalVertices(cfi(1)).tolist()
            tb.remove(cei.I)
            tb.remove(cei.J)

            p(1) = pv(mtv.meshvertexindices(ta(0))(0))
            p(2) = pv(mtv.meshvertexindices(tb(0))(0))
            p(3) = evalP(p(0), pv(u) * 3 / 8 + pv(v) * 3 / 8 + p(1) / 8 + p(2) / 8, (xe(u) + xe(v)) / 2)

            nes.add(False)
          Else
            p(3) = p(0)
            nes.add(True)
          End If

          vo.add(p(3))
          vt.add(p(3))
          rv.add((xV(u) + xV(v)) / 2)
          re.add((xE(u) + xE(v)) / 2)
          oc.add(avgC2(mc(u), mc(v)))
        Next

        'Vertices
        For i = 0 To cv - 1 Step 1
          Dim tvi As Integer
          Dim cvi As New list(Of Integer)
          Dim q(2) As point3d
          Dim bne As Boolean = False

          tvi = mtv.TopologyVertexIndex(i)

          mtv.SortEdges(tvi)

          cvi = mtv.ConnectedTopologyVertices(tvi).tolist()
          cvi.remove(tvi)
          k = cvi.count()

          For j = 0 To k - 1 Step 1
            u = mte.GetEdgeIndex(tvi, cvi.item(j))
            q(0) += pv(mtv.MeshVertexIndices(cvi.item(j))(0))

            If nes(u) Then
              bne = True
              q(2) += pv(mtv.MeshVertexIndices(cvi.item(j))(0))
            End If
          Next

          If bne Then
            If e = 0 Then
              q(1) = pv(i)
            ElseIf e = 2 Then
              If k = 2 Then
                q(1) = pv(i)
              Else
                q(1) = evalP(pv(i), q(2) / 2, 0.25)
              End If
            Else
              q(1) = evalP(pv(i), q(2) / 2, 0.25)
            End If
          Else
            If k = 3 Then
              q(1) = evalp(pv(i), q(0) / k, xv(i) * 9 / 16)
            Else
              q(1) = evalp(pv(i), q(0) / k, xv(i) * 3 / 8)
            End If
          End If


          vo.add(q(1))
          rv.add(xV(i))
          re.add(xE(i))
          oc.add(mc(i))

        Next

        Dim mo As New mesh
        mo.Vertices.AddVertices(vo)
        mo.Faces.AddFaces(fo)
        If cb Then mo.VertexColors.AppendColors(oc.toarray())
        mo.FaceNormals.ComputeFaceNormals()
        mo.Normals.ComputeNormals()

        ma = mo
        xV = rv.toarray()
        xE = re.toarray()

        'Loop
      Next
      A = ma
    End If
# ---------- m_loop: VB additional code ----------
  Private Function bC(ByVal arrObj() As Double, ByVal t As Integer)
    Dim intOut As Integer
    If t > uBound(arrObj) Then intOut = uBound(arrObj) Else intOut = t
    Return intOut
  End Function

  Private Function evalP(ByVal op As point3d, ByVal tp As Point3d, ByVal t As Double)
    Return New point3d(op + (tp - op) * t)
  End Function

  Private Function avgC2(ByVal c0 As color, ByVal c1 As color)
    Dim r,g,b As Integer
    r = CInt(((CInt(c0.R) + CInt(c1.R)) / 2))
    g = CInt(((CInt(c0.G) + CInt(c1.G)) / 2))
    b = CInt(((CInt(c0.B) + CInt(c1.B)) / 2))

    If R < 0 Then r = 0 Else If r > 255 Then r = 255
    If G < 0 Then g = 0 Else If r > 255 Then g = 255
    If B < 0 Then b = 0 Else If r > 255 Then b = 255

    Return color.FromArgb(r, g, b)
  End Function
# ---------- end m_loop ----------
panel_30 = Panel("2.5")  # disabled
panel_31 = Panel("5")  # disabled
m_catmull_clark = WeightedCatmullClarkSubdivision(M=join_6, L=1, E=0, DF=0, TE=1, TV=1)  # -> out, A; inputs M: Mesh, DF: list, TE: list, TV: list; disabled
# ---------- m_catmull_clark: VB ----------
    Component.Params.Input(0).Name = "Mesh"
    Component.Params.Input(0).Description = "An open or closed mesh composed of either triangle or quad based faces"
    Component.Params.Input(1).Name = "Loops"
    Component.Params.Input(1).Description = "The number of iterations applied to each face"
    Component.Params.Input(2).Name = "Edge Type"
    Component.Params.Input(2).Description = "0=Fixed, 1=Smooth, 2=Fixed Corners"
    Component.Params.Input(3).Name = "Face Distance [Vertex]"
    Component.Params.Input(3).Description = "An optional list of double values which overides the distance the new faced based vertex will be offset along the face normal (0=Default)"
    Component.Params.Input(4).Name = "Edge Weight [Vertex]"
    Component.Params.Input(4).Description = "An optional list of double values which overides the percent between the existing edge midpoint and the new smoothed vertex (1=Default)"
    Component.Params.Input(5).Name = "Vertex Weight [Vertex]"
    Component.Params.Input(5).Description = "An optional list of double values which overides the percent between the existing vertex and the new smoothed vertex (1=Default)"

    Component.Params.Output(1).Name = "Mesh"
    Component.Params.Output(1).Description = "If successful, a valid mesh"

    If m IsNot Nothing Then
      Dim ma As New mesh
      Dim i,lp As Integer
      Dim txV,txE,txF As New list(Of Double)
      Dim xV(),xE(),xF() As Double
      Dim bn As Boolean
      Dim cb As Boolean

      'input mesh to the looped mesh
      m.weld(math.pi)
      ma = m

      ' match multiplier and color values to vertex count
      xV = TV.toarray()
      xE = TE.toarray()
      xF = DF.toarray()
      For i = 0 To m.Vertices.count() - 1 Step 1
        txV.add(xV(bC(xV, i)))
        txE.add(xE(bC(xE, i)))
        txF.add(xF(bC(xF, i)))
      Next
      xV = txV.toarray()
      xE = txE.toarray()
      xF = txF.toarray()

      bn = m.IsClosed() = False

      For lp = 0 To L - 1 Step 1

        Dim mv As Rhino.Geometry.Collections.MeshVertexList
        Dim mf As Rhino.Geometry.Collections.MeshFaceList
        Dim mfn As Rhino.Geometry.Collections.MeshFaceNormalList
        Dim mc As Rhino.Geometry.Collections.MeshVertexColorList
        Dim mte As Rhino.Geometry.Collections.MeshTopologyEdgeList
        Dim mtv As Rhino.Geometry.Collections.MeshTopologyVertexList
        Dim mnv() As Boolean
        Dim nes As New list(Of Boolean)

        If ma.VertexColors.Count() > 0 Then
          cb = True
        Else
          cb = False
          ma.VertexColors.CreateMonotoneMesh(color.LightBlue)
        End If

        mv = ma.Vertices
        mf = ma.Faces
        mfn = ma.FaceNormals
        mc = ma.VertexColors
        mte = ma.TopologyEdges
        mtv = ma.TopologyVertices

        mnv = ma.GetNakedEdgePointStatus

        Dim vo As New list(Of point3d)
        Dim fo As New list(Of MeshFace)
        Dim j,k,u,v,cf,ce,cv As Integer
        Dim fi() As Integer
        Dim p(4) As point3d
        Dim mvi(3) As Integer
        Dim nrm As vector3d
        Dim av,ae,af As Double
        Dim rv,re,rf As New list(Of Double)
        Dim tc As color
        Dim oc As New list(Of color)

        cv = mv.count()
        ce = mte.count()
        cf = mf.count()

        'Faces
        For i = 0 To cf - 1 Step 1
          fi = mtv.IndicesFromFace(i)
          mvi(0) = mtv.MeshVertexIndices(fi(0))(0)
          mvi(1) = mtv.MeshVertexIndices(fi(1))(0)
          mvi(2) = mtv.MeshVertexIndices(fi(2))(0)
          If mf(i).IsQuad() Then mvi(3) = mtv.MeshVertexIndices(fi(3))(0)

          If mf(i).IsQuad() Then
            fo.add(New meshface(i, cF + mte.GetEdgeIndex(fi(0), fi(1)), cE + cF + mvi(1), cF + mte.GetEdgeIndex(fi(1), fi(2))))
            fo.add(New meshface(cF + mte.GetEdgeIndex(fi(1), fi(2)), cE + cF + mvi(2), cF + mte.GetEdgeIndex(fi(2), fi(3)), i))
            fo.add(New meshface(cE + cF + mvi(3), cF + mte.GetEdgeIndex(fi(3), fi(0)), i, cF + mte.GetEdgeIndex(fi(2), fi(3))))
            fo.add(New meshface(cF + mte.GetEdgeIndex(fi(0), fi(1)), i, cF + mte.GetEdgeIndex(fi(3), fi(0)), cE + cF + mvi(0)))
            av = (xV(mvi(0)) + xV(mvi(1)) + xV(mvi(2)) + xV(mvi(3))) / 4
            ae = (xE(mvi(0)) + xE(mvi(1)) + xE(mvi(2)) + xE(mvi(3))) / 4
            af = (xF(mvi(0)) + xF(mvi(1)) + xF(mvi(2)) + xF(mvi(3))) / 4
            tc = avgC4(mc(mvi(0)), mc(mvi(1)), mc(mvi(2)), mc(mvi(3)))
          Else
            fo.add(New meshface(i, cF + mte.GetEdgeIndex(fi(0), fi(1)), cE + cF + mvi(1), cF + mte.GetEdgeIndex(fi(1), fi(2))))
            fo.add(New meshface(cF + mte.GetEdgeIndex(fi(1), fi(2)), cE + cF + mvi(2), cF + mte.GetEdgeIndex(fi(2), fi(0)), i))
            fo.add(New meshface(cE + cF + mvi(0), cF + mte.GetEdgeIndex(fi(0), fi(1)), i, cF + mte.GetEdgeIndex(fi(2), fi(0))))
            av = (xV(mvi(0)) + xV(mvi(1)) + xV(mvi(2))) / 3
            ae = (xE(mvi(0)) + xE(mvi(1)) + xE(mvi(2))) / 3
            af = (xF(mvi(0)) + xF(mvi(1)) + xF(mvi(2))) / 3
            tc = avgC3(mc(mvi(0)), mc(mvi(1)), mc(mvi(2)))
          End If
          nrm = mfn(i)
          nrm.Unitize()
          vo.add(mf.getfacecenter(i) + nrm * af)
          rv.add(av)
          re.add(ae)
          rf.add(af)
          oc.add(tc)
        Next

        'Edges
        For i = 0 To ce - 1 Step 1

          u = mtv.MeshVertexIndices(mte.GetTopologyVertices(i).I)(0)
          v = mtv.MeshVertexIndices(mte.GetTopologyVertices(i).J)(0)
          p(0) = mv.item(u)
          p(1) = mv.item(v)

          If mte.GetConnectedFaces(i).Count() > 1 Then
            p(2) = mf.GetFaceCenter(mte.GetConnectedFaces(i)(0))
            p(3) = mf.GetFaceCenter(mte.GetConnectedFaces(i)(1))
            p(4) = evalP((p(0) + p(1)) / 2, ( p(2) + p(3)) / 2, (xE(u) / 2 + xE(v) / 2) / 2)
            nes.add(False)
          Else
            p(4) = (p(0) + p(1)) / 2
            nes.add(True)
          End If

          vo.add(p(4))
          rv.add((xV(u) + xV(v)) / 2)
          re.add((xE(u) + xE(v)) / 2)
          rf.add((xF(u) + xF(v)) / 2)
          oc.add(avgC2(mc(u), mc(v)))
        Next

        'Vertices
        For i = 0 To cv - 1 Step 1
          Dim zf,zn As Integer
          Dim cvi As New list(Of Integer)
          Dim q(6) As point3d
          Dim bne As Boolean = False
          q(4) = New point3d(mv(i))

          zf = mv.GetVertexFaces(i).count()
          For j = 0 To zf - 1 Step 1
            q(0) += mF.GetFaceCenter(mV.GetVertexFaces(i)(j))
          Next
          q(0) /= zf

          cvi = mv.GetConnectedVertices(i).ToList()
          cvi.remove(i)
          k = cvi.count()
          zn = 0
          For j = 0 To k - 1 Step 1
            u = mte.GetEdgeIndex(mtv.TopologyVertexIndex(cvi.item((j))), mtv.TopologyVertexIndex(i))
            q(1) = mv.item(mtv.MeshVertexIndices(mte.GetTopologyVertices(u).I)(0))
            q(2) = mv.item(mtv.MeshVertexIndices(mte.GetTopologyVertices(u).J)(0))
            q(3) += (q(1) + q(2)) / 2

            If nes(u) Then
              bne = True
              q(5) += (q(1) + q(2)) / 2
              zn += 1
            End If
          Next
          q(3) /= k

          If bne Then
            If e = 1 Then
              q(6) = (q(4) + q(5) / zn) / 2
            ElseIf e = 2 Then
              If k = 2 Then
                q(6) = q(4)
              Else
                q(6) = evalP(q(4), (q(4) + q(5) / zn) / 2, xV(i))
              End If
            Else
              q(6) = q(4)
            End If
          Else
            q(6) = evalP(q(4), (q(4) * ((zf - 3) / zf)) + (q(3) * (2 / zf)) + (q(0) * (1 / zf)), xV(i))
          End If

          vo.add(q(6))
          rv.add(xV(i))
          re.add(xE(i))
          rf.add(xF(i))
          oc.add(mc(i))

        Next

        Dim mo As New mesh
        mo.Vertices.AddVertices(vo)
        mo.Faces.AddFaces(fo)
        If cb Then mo.VertexColors.AppendColors(oc.toarray())
        mo.FaceNormals.ComputeFaceNormals()
        mo.Normals.ComputeNormals()

        ma = mo
        xV = rv.toarray()
        xE = re.toarray()
        xF = rf.toarray()

        'Loop
      Next
      
      A = ma
    End If
# ---------- m_catmull_clark: VB additional code ----------
  Private Function bC(ByVal arrObj() As Double, ByVal t As Integer)
    Dim intOut As Integer
    If t > uBound(arrObj) Then intOut = uBound(arrObj) Else intOut = t
    Return intOut
  End Function

  Private Function evalP(ByVal op As point3d, ByVal tp As Point3d, ByVal t As Double)
    Return New point3d(op + (tp - op) * t)
  End Function

  Private Function avgC2(ByVal c0 As color, ByVal c1 As color)
    Dim r,g,b As Integer
    r = CInt(((CInt(c0.R) + CInt(c1.R)) / 2))
    g = CInt(((CInt(c0.G) + CInt(c1.G)) / 2))
    b = CInt(((CInt(c0.B) + CInt(c1.B)) / 2))

    If R < 0 Then r = 0 Else If r > 255 Then r = 255
    If G < 0 Then g = 0 Else If r > 255 Then g = 255
    If B < 0 Then b = 0 Else If r > 255 Then b = 255

    Return color.FromArgb(r, g, b)
  End Function

  Private Function avgC3(ByVal c0 As color, ByVal c1 As color, ByVal c2 As color)
    Dim r,g,b As Integer
    r = CInt((CInt(c0.R) + CInt(c1.R) + CInt(c2.R)) / 3)
    g = CInt((CInt(c0.G) + CInt(c1.G) + CInt(c2.G)) / 3)
    b = CInt((CInt(c0.B) + CInt(c1.B) + CInt(c2.B)) / 3)

    If R < 0 Then r = 0 Else If r > 255 Then r = 255
    If G < 0 Then g = 0 Else If r > 255 Then g = 255
    If B < 0 Then b = 0 Else If r > 255 Then b = 255

    Return color.FromArgb(r, g, b)
  End Function

  Private Function avgC4(ByVal c0 As color, ByVal c1 As color, ByVal c2 As color, ByVal c3 As color)
    Dim r,g,b As Integer
    r = CInt((CInt(c0.R) + CInt(c1.R) + CInt(c2.R) + CInt(c3.R)) / 4)
    g = CInt((CInt(c0.G) + CInt(c1.G) + CInt(c2.G) + CInt(c3.G)) / 4)
    b = CInt((CInt(c0.B) + CInt(c1.B) + CInt(c2.B) + CInt(c3.B)) / 4)

    If R < 0 Then r = 0 Else If r > 255 Then r = 255
    If G < 0 Then g = 0 Else If r > 255 Then g = 255
    If B < 0 Then b = 0 Else If r > 255 Then b = 255

    Return color.FromArgb(r, g, b)
  End Function
# ---------- end m_catmull_clark ----------
X_3 = UnitX(Factor=panel_30)  # disabled
X_4 = UnitX(Factor=panel_31)  # disabled
move_34 = Move(Geometry=m_catmull_clark.A, Motion=X_3)  # -> Geometry, Transform; disabled
move_35 = Move(Geometry=m_catmull_clark.A, Motion=X_4)  # -> Geometry, Transform; disabled

# ---- group: Middle Butress / Butress AD
Y_4 = UnitY(Factor=butress_middle_2)  # disabled
Y_5 = UnitY(Factor=butress_middle_2)  # disabled
neg_12 = Negative(Value=Y_5)  # disabled
move_36 = Move(Geometry=midpt_8, Motion=Y_4)  # -> Geometry, Transform; disabled
move_37 = Move(Geometry=midpt_8, Motion=neg_12)  # -> Geometry, Transform; disabled
ln_40 = Line(StartPoint=midpt_8, EndPoint=move_37.Geometry)  # disabled
extr_18 = Extrude(Base=ln_40, Direction=vec_19.Vector)  # disabled

# ---- group: Middle Butress / Butress CD
xz = XZPlane(Origin=midpt_10)  # disabled
mirror_10 = Mirror(Geometry=extr_18, Plane=xz)  # -> Geometry, Transform; disabled

# ---- group: OLD ARCHES / Arc OLD
mjoin = MeshJoin(Meshes=[m_catmull_clark.A, move_35.Geometry, move_34.Geometry])  # disabled

# ---- group: Butresses mesh
mesh_uv_2 = MeshSurface(
    Surface=[extr_16, extr_17, extr_14, extr_15, extr_12, extr_13, extr_10, extr_11, extr_18, mirror_10.Geometry],
    UCount=number_slider_34,
    VCount=number_slider_35,
    Overhang=True,
    Equalize=False)  # disabled

# ----
panel_32 = Panel("Large dome unit")
number_slider_37 = Slider(51, range=0..100)  # disabled
vec_28 = VectorXYZ(XComponent=0, YComponent=0, ZComponent=height_3)  # -> Vector, Length; disabled
division_4 = Division(A=opening_width_3, B=2)  # disabled
number_slider_38 = Slider(1, range=0..10)  # disabled
number_slider_39 = Slider(0, range=0..10)  # disabled
end_25 = EndPoints(Curve=line_2)  # -> Start, End; disabled
number_slider_40 = Slider(0.5, range=0..1)  # disabled
end_26 = EndPoints(Curve=line_a_5)  # -> Start, End; disabled
ln_41 = Line(StartPoint=move_4.Geometry, EndPoint=A_2)  # disabled
midpt_11 = CurveMiddle(Curve=ln_41)  # disabled
number_slider_41 = Slider(1, range=0..10)  # disabled
pl_3pt_7 = Plane3Pt(PointA=A_2, PointB=move_5.Geometry, PointC=end_26.End)  # disabled
end_27 = EndPoints(Curve=line_a_4)  # -> Start, End; disabled
number_slider_42 = Slider(0, range=0..10)  # disabled
ln_42 = Line(StartPoint=end_26.End, EndPoint=end_25.End)  # disabled
end_28 = EndPoints(Curve=line_a_5)  # -> Start, End; disabled
pl_3pt_8 = Plane3Pt(PointA=A_2, PointB=move_5.Geometry, PointC=end_26.End)  # disabled
ln_43 = Line(StartPoint=move_4.Geometry, EndPoint=move_5.Geometry)  # disabled
midpt_12 = CurveMiddle(Curve=ln_43)  # disabled
ln_44 = Line(StartPoint=A_2, EndPoint=move_6.Geometry)  # disabled
midpt_13 = CurveMiddle(Curve=ln_44)  # disabled
line_17 = LineSDL(Start=midpt_13, Direction=Vector(0, 0, 1), Length=height_3)  # disabled
end_29 = EndPoints(Curve=line_17)  # -> Start, End; disabled
ln_45 = Line(StartPoint=A_2, EndPoint=midpt_13)  # disabled
midpt_14 = CurveMiddle(Curve=ln_45)  # disabled
line_18 = LineSDL(Start=midpt_14, Direction=Vector(1, 0, 0), Length=division_4)  # disabled
line_19 = LineSDL(Start=midpt_14, Direction=Vector(-1, 0, 0), Length=division_4)  # disabled
end_30 = EndPoints(Curve=line_18)  # -> Start, End; disabled
line_20 = LineSDL(Start=end_30.End, Direction=Vector(-1, 0, 0), Length=opening_width_3)  # disabled
ln_46 = Line(StartPoint=midpt_13, EndPoint=end_30.End)  # disabled
end_31 = EndPoints(Curve=line_19)  # -> Start, End; disabled
ln_47 = Line(StartPoint=end_29.End, EndPoint=end_26.End)  # disabled
line_21 = LineSDL(Start=end_30.End, Direction=Vector(0, 0, 1), Length=min_opening_height_3)  # disabled
line_22 = LineSDL(Start=end_31.End, Direction=Vector(0, 0, 1), Length=min_opening_height_3)  # disabled
end_32 = EndPoints(Curve=line_22)  # -> Start, End; disabled
ln_48 = Line(StartPoint=end_26.Start, EndPoint=end_32.Start)  # disabled
move_38 = Move(Geometry=ln_44, Motion=vec_28.Vector)  # -> Geometry, Transform; disabled
end_33 = EndPoints(Curve=line_21)  # -> Start, End; disabled
number_slider_43 = Slider(2, range=0..10)  # disabled
end_34 = EndPoints(Curve=line_22)  # -> Start, End; disabled
yz_5 = YZPlane(Origin=midpt_13)  # disabled
data_20 = Data(end_33.End)  # disabled
data_21 = Data(line_21)  # disabled
data_22 = Data(end_34.End)  # disabled
end_35 = EndPoints(Curve=line_2)  # -> Start, End; disabled
pl_3pt_9 = Plane3Pt(PointA=end_35.End, PointB=move_6.Geometry, PointC=move_4.Geometry)  # disabled
end_36 = EndPoints(Curve=line_a_6)  # -> Start, End; disabled
ln_49 = Line(StartPoint=move_5.Geometry, EndPoint=move_6.Geometry)  # disabled
midpt_15 = CurveMiddle(Curve=ln_49)  # disabled
data_23 = Data(end_33.Start)  # disabled
data_24 = Data(midpt_13)  # disabled
yz_6 = YZPlane(Origin=data_24)  # disabled
ln_50 = Line(StartPoint=end_28.End, EndPoint=end_35.End)  # disabled
dist_2 = Distance(PointA=data_23, PointB=data_24)  # disabled
mirror_11 = Mirror(Geometry=data_21, Plane=yz_6)  # -> Geometry, Transform; disabled
multiplication_2 = Multiplication(A=dist_2, B=2)  # disabled
line_23 = LineSDL(Start=data_23, Direction=Vector(1, 0, 0), Length=multiplication_2)  # disabled
X_5 = UnitX(Factor=1)  # disabled
move_39 = Move(Motion=X_5)  # -> Geometry, Transform; disabled
Y_6 = UnitY(Factor=1)  # disabled
move_40 = Move(Geometry=line_23, Motion=vec_28.Vector)  # -> Geometry, Transform; disabled
move_41 = Move(Geometry=move_39.Geometry, Motion=Y_6)  # -> Geometry, Transform; disabled
vec_29 = VectorXYZ(XComponent=0, YComponent=0, ZComponent=height_3)  # -> Vector, Length; disabled
number_slider_44 = Slider(0, range=0..10)  # disabled
number_slider_45 = Slider(1, range=0..10)  # disabled
number_slider_46 = Slider(0, range=0..10)  # disabled
number_slider_47 = Slider(1, range=0..10)  # disabled
material_2 = MaterialKaramba3D(matprops_2)  # disabled
swatch_11 = ColourSwatch(SwatchColor=RGB(255, 255, 255))  # disabled
swatch_12 = ColourSwatch(SwatchColor=RGB(255, 0, 0))  # disabled
swatch_13 = ColourSwatch(SwatchColor=RGB(255, 255, 255))  # disabled
swatch_14 = ColourSwatch(SwatchColor=RGB(255, 255, 255))  # disabled
swatch_15 = ColourSwatch(SwatchColor=RGB(34, 0, 255))  # disabled
panel_33 = Panel("Displacement [mm]")  # disabled
panel_34 = Panel("""0
18""")  # disabled

# ---- group: Karamba Arc / Relaxed arc
ln_51 = Line(StartPoint=data_20, EndPoint=data_22)  # disabled

# ---- group: Corner Butresses
addition_17 = Addition(A=pdecon_6.XComponent, B=butress_3)  # disabled
addition_18 = Addition(A=pdecon_5.XComponent, B=butress_3)  # disabled
addition_19 = Addition(A=pdecon_6.YComponent, B=butress_3)  # disabled
addition_20 = Addition(A=pdecon_5.YComponent, B=butress_3)  # disabled
neg_13 = Negative(Value=addition_17)  # disabled
neg_14 = Negative(Value=addition_18)  # disabled
neg_15 = Negative(Value=addition_19)  # disabled
vec_30 = VectorXYZ(XComponent=neg_13, YComponent=0, ZComponent=0)  # -> Vector, Length; disabled
vec_31 = VectorXYZ(XComponent=neg_14, YComponent=pdecon_5.YComponent, ZComponent=0)  # -> Vector, Length; disabled
vec_32 = VectorXYZ(XComponent=0, YComponent=neg_15, ZComponent=0)  # -> Vector, Length; disabled
vec_33 = VectorXYZ(XComponent=pdecon_5.XComponent, YComponent=addition_20, ZComponent=0)  # -> Vector, Length; disabled
move_42 = Move(Geometry=A_2, Motion=vec_30.Vector)  # -> Geometry, Transform; disabled
move_43 = Move(Geometry=A_2, Motion=vec_31.Vector)  # -> Geometry, Transform; disabled
move_44 = Move(Geometry=A_2, Motion=vec_32.Vector)  # -> Geometry, Transform; disabled
move_45 = Move(Geometry=A_2, Motion=vec_33.Vector)  # -> Geometry, Transform; disabled
ln_52 = Line(StartPoint=move_42.Geometry, EndPoint=A_2)  # disabled
ln_53 = Line(StartPoint=move_44.Geometry, EndPoint=A_2)  # disabled
ln_54 = Line(StartPoint=move_43.Geometry, EndPoint=move_4.Geometry)  # disabled
ln_55 = Line(StartPoint=move_45.Geometry, EndPoint=move_4.Geometry)  # disabled
extr_19 = Extrude(Base=ln_52, Direction=vec_28.Vector)  # disabled
extr_20 = Extrude(Base=ln_53, Direction=vec_28.Vector)  # disabled
extr_21 = Extrude(Base=ln_54, Direction=vec_28.Vector)  # disabled
extr_22 = Extrude(Base=ln_55, Direction=vec_28.Vector)  # disabled
addition_21 = Addition(A=pdecon_7.XComponent, B=butress_3)  # disabled
addition_22 = Addition(A=pdecon_8.XComponent, B=butress_3)  # disabled
addition_23 = Addition(A=pdecon_7.YComponent, B=butress_3)  # disabled
addition_24 = Addition(A=pdecon_8.YComponent, B=butress_3)  # disabled
neg_16 = Negative(Value=addition_24)  # disabled
vec_34 = VectorXYZ(XComponent=addition_22, YComponent=0, ZComponent=0)  # -> Vector, Length; disabled
vec_35 = VectorXYZ(XComponent=pdecon_7.XComponent, YComponent=addition_23, ZComponent=0)  # -> Vector, Length; disabled
vec_36 = VectorXYZ(XComponent=addition_21, YComponent=pdecon_7.YComponent, ZComponent=0)  # -> Vector, Length; disabled
vec_37 = VectorXYZ(XComponent=pdecon_8.XComponent, YComponent=neg_16, ZComponent=0)  # -> Vector, Length; disabled
move_46 = Move(Geometry=A_2, Motion=vec_36.Vector)  # -> Geometry, Transform; disabled
move_47 = Move(Geometry=A_2, Motion=vec_34.Vector)  # -> Geometry, Transform; disabled
move_48 = Move(Geometry=A_2, Motion=vec_35.Vector)  # -> Geometry, Transform; disabled
move_49 = Move(Geometry=A_2, Motion=vec_37.Vector)  # -> Geometry, Transform; disabled
ln_56 = Line(StartPoint=move_47.Geometry, EndPoint=move_6.Geometry)  # disabled
ln_57 = Line(StartPoint=move_49.Geometry, EndPoint=move_6.Geometry)  # disabled
ln_58 = Line(StartPoint=move_46.Geometry, EndPoint=move_5.Geometry)  # disabled
ln_59 = Line(StartPoint=move_48.Geometry, EndPoint=move_5.Geometry)  # disabled
extr_23 = Extrude(Base=ln_56, Direction=vec_28.Vector)  # disabled
extr_24 = Extrude(Base=ln_57, Direction=vec_28.Vector)  # disabled
extr_25 = Extrude(Base=ln_58, Direction=vec_28.Vector)  # disabled
extr_26 = Extrude(Base=ln_59, Direction=vec_28.Vector)  # disabled

# ---- group: Karamba Arc
divide_6 = DivideCurve(Curve=ln_51, Count=curve_subdivision_3, Kinks=False)  # -> Points, Tangents, Parameters; disabled
shatter_5 = Shatter(Curve=ln_51, Parameters=divide_6.Parameters)  # disabled
anchor_6 = Anchor(Point=[data_20, data_22], Strength=10000)  # disabled
length_line_6 = LengthLine(Line=shatter_5, Strength=spring_strength_6)  # disabled
load_9 = Load(Point=divide_6.Points, ForceVector=Vector(0, 0, 1), Weighting=load_4)  # disabled
show_6 = Show(G=shatter_5)  # disabled
entwine_6 = Entwine(Branch00=show_6, Branch01=anchor_6, Branch02=length_line_6, Branch03=load_9, FlattenInputs=True)  # disabled
solver_6 = Solver(GoalObjects=entwine_6, Reset=button_10, Threshold=1e-15, Tolerance=0.01, On=toggle_10)  # -> I, V, O; disabled
bang_6 = ExplodeTree(Data=solver_6.O)  # -> Branch0, Branch1; disabled
data_25 = Data(flatten(bang_6.Branch0))  # disabled

# ---- group: surface 1
boundary = BoundarySurfaces(Edges=flatten([line_a_5, line_17, ln_47, ln_48, line_22, line_21, ln_46, data_25]))  # disabled

# ---- group: Kangaroo arc walls
curve_subdivision_4 = Slider(20, range=0..100)  # disabled
end_37 = EndPoints(Curve=ln_42)  # -> Start, End; disabled
divide_7 = DivideCurve(Curve=ln_42, Count=curve_subdivision_4, Kinks=False)  # -> Points, Tangents, Parameters; disabled
shatter_6 = Shatter(Curve=ln_42, Parameters=divide_7.Parameters)  # disabled
anchor_7 = Anchor(Point=[end_37.Start, end_37.End], Strength=10000)  # disabled
length_line_7 = LengthLine(Line=shatter_6, Strength=number_slider_19)  # disabled
load_10 = Load(Point=divide_7.Points, ForceVector=Vector(0, 0, 1), Weighting=number_slider_18)  # disabled
show_7 = Show(G=shatter_6)  # disabled
entwine_7 = Entwine(Branch00=show_7, Branch01=anchor_7, Branch02=length_line_7, Branch03=load_10, FlattenInputs=True)  # disabled
solver_7 = Solver(GoalObjects=entwine_7, Reset=button_9, Threshold=1e-15, Tolerance=0.01, On=toggle_9)  # -> I, V, O; disabled
bang_7 = ExplodeTree(Data=solver_7.O)  # -> Branch0, Branch1; disabled
data_26 = Data(flatten(bang_7.Branch0))  # disabled
join_7 = JoinCurves(Curves=data_26, Preserve=False)  # disabled

# ---- group: arc AD
data_27 = Data(data_25)  # disabled
mirror_12 = Mirror(Geometry=data_27, Plane=yz_6)  # -> Geometry, Transform; disabled

# ---- group: Butress AD
Y_7 = UnitY(Factor=butress_middle_3)  # disabled
Y_8 = UnitY(Factor=butress_middle_3)  # disabled
neg_17 = Negative(Value=Y_8)  # disabled
move_50 = Move(Geometry=midpt_13, Motion=Y_7)  # -> Geometry, Transform; disabled
move_51 = Move(Geometry=midpt_13, Motion=neg_17)  # -> Geometry, Transform; disabled
ln_60 = Line(StartPoint=midpt_13, EndPoint=move_51.Geometry)  # disabled
extr_27 = Extrude(Base=ln_60, Direction=vec_29.Vector)  # disabled

# ---- group: small dome
pl_3pt_10 = Plane3Pt(PointA=move_4.Geometry, PointB=end_35.Start, PointC=end_35.End)  # disabled
data_28 = Data(join_7)  # disabled
mirror_13 = Mirror(Geometry=data_28, Plane=pl_3pt_10)  # -> Geometry, Transform; disabled
pl_3pt_11 = Plane3Pt(PointA=move_5.Geometry, PointB=end_28.Start, PointC=end_28.End)  # disabled
pl_3pt_12 = Plane3Pt(PointA=move_4.Geometry, PointB=end_35.Start, PointC=end_35.End)  # disabled
mirror_14 = Mirror(Geometry=mirror_13.Geometry, Plane=pl_3pt_11)  # -> flatten(Geometry), Transform; disabled
mirror_15 = Mirror(Geometry=mirror_14.Geometry, Plane=pl_3pt_12)  # -> flatten(Geometry), Transform; disabled
join_8 = JoinCurves(Curves=mirror_15.Geometry, Preserve=False)  # disabled
join_9 = JoinCurves(Curves=mirror_14.Geometry, Preserve=False)  # disabled
join_10 = JoinCurves(Curves=mirror_13.Geometry, Preserve=False)  # disabled
join_11 = JoinCurves(Curves=data_28, Preserve=False)  # disabled
edgesrf_2 = EdgeSurface(CurveA=join_11, CurveB=join_8, CurveC=join_10, CurveD=join_9)  # disabled
mesh_2 = MeshBrep(
    Brep=edgesrf_2,
    Settings={GridMaxCount=0, GridMinCount=4, JaggedSeams=True, MaxEdgeLength=0, MinEdgeLength=0.0001, MinTolerance=0, Refine=True, RefineAngle=0, RelativeTolerance=0.65, SimplePlanes=False, Tolerance=0})  # disabled

# ---- group: Karamba Ceiling
data_29 = Data(mesh_2)  # disabled
medges_2 = MeshEdges(Mesh=data_29)  # -> NakedEdges, InteriorEdges, NonManifoldEdges; disabled
wbedges_2 = WeaverbirdsMeshEdges(MeshOrPolylines=data_29)  # disabled
divide_8 = DivideCurve(Curve=medges_2.NakedEdges, Count=1, Kinks=False)  # -> Points, Tangents, Parameters; disabled
anchor_8 = Anchor(Point=flatten(divide_8.Points), Strength=10000)  # disabled
vertexloads_2 = VertexLoads(Mesh=data_29, Strength=number_slider_23)  # disabled
length_line_8 = LengthLine(Line=wbedges_2, Strength=number_slider_22)  # disabled
show_8 = Show(G=data_29)  # disabled
entwine_8 = Entwine(Branch00=show_8, Branch01=anchor_8, Branch02=length_line_8, Branch03=vertexloads_2, FlattenInputs=True)  # disabled
solver_8 = Solver(GoalObjects=entwine_8, Reset=button_12, Threshold=1e-15, Tolerance=0.01, On=toggle_12)  # -> I, V, O; disabled
bang_8 = ExplodeTree(Data=solver_8.O)  # -> Branch0, Branch1; disabled

# ---- group: Butress AB
pl_3pt_13 = Plane3Pt(PointA=A_2, PointB=move_5.Geometry, PointC=end_26.End)  # disabled
mirror_16 = Mirror(Geometry=extr_27, Plane=pl_3pt_13)  # -> Geometry, Transform; disabled

# ---- group: Butress CD
pl_3pt_14 = Plane3Pt(PointA=end_35.End, PointB=move_6.Geometry, PointC=move_4.Geometry)  # disabled
mirror_17 = Mirror(Geometry=extr_27, Plane=pl_3pt_14)  # -> Geometry, Transform; disabled

# ---- group: Butress BC
pl_3pt_15 = Plane3Pt(PointA=A_2, PointB=move_5.Geometry, PointC=end_26.End)  # disabled
mirror_18 = Mirror(Geometry=mirror_17.Geometry, Plane=pl_3pt_15)  # -> Geometry, Transform; disabled

# ---- group: Karamba Ceiling
conmesh = ConstructMesh(Vertices=[end_27.End, end_36.End, end_35.End, end_28.End], Faces={A=0, B=1, C=2, D=3})  # disabled
medges_3 = MeshEdges(Mesh=conmesh)  # -> NakedEdges, InteriorEdges, NonManifoldEdges; disabled
srf4pt = _4PointSurface(CornerA=end_27.End, CornerB=end_36.End, CornerC=end_35.End, CornerD=end_28.End)  # disabled
mesh_uv_3 = MeshSurface(Surface=srf4pt, UCount=naked_vertex_count_2, VCount=naked_vertex_count_2, Overhang=True, Equalize=False)  # disabled
divide_9 = DivideCurve(Curve=medges_3.NakedEdges, Count=naked_vertex_count_2, Kinks=False)  # -> flatten(Points), Tangents, Parameters; disabled
m_root_3 = WeightedRoot3Subdivision(M=mesh_uv_3, L=subdivision_loops_3, E=edge_type_3, DF=0, TV=1)  # -> out, A; inputs M: Mesh, DF: list, TV: list; disabled
# ---------- m_root_3: VB ----------
    Component.Params.Input(0).Name = "Mesh"
    Component.Params.Input(0).Description = "An open or closed mesh composed of either triangle or quad based faces. Note: The correct implementation of this method should use triangular faces as an input, however quad faces will still function"
    Component.Params.Input(1).Name = "Loops"
    Component.Params.Input(1).Description = "The number of iterations applied to each face"
    Component.Params.Input(2).Name = "Edge Type"
    Component.Params.Input(2).Description = "0=Fixed, 1=Smooth, 2=Fixed Corners"
    Component.Params.Input(3).Name = "Face Distance [Vertex]"
    Component.Params.Input(3).Description = "An optional list of double values which overides the distance the new faced based vertex will be offset along the face normal (0=Default)"
    Component.Params.Input(4).Name = "Vertex Weight [Vertex]"
    Component.Params.Input(4).Description = "An optional list of double values which overides the percent between the existing vertex and the new smoothed vertex (1=Default)"

    Component.Params.Output(1).Name = "Mesh"
    Component.Params.Output(1).Description = "If successful, a valid mesh"

    If m IsNot Nothing Then
      Dim ma As New mesh
      Dim i,lp As Integer
      Dim txV,txF As New list(Of Double)
      Dim xV(),xF() As Double
      Dim bn As Boolean
      Dim cb As Boolean

      'input mesh to the looped mesh
      m.weld(math.pi)
      ma = m

      ' match multiplier and color values to vertex count
      xV = TV.toarray()
      xF = DF.toarray()
      For i = 0 To m.Vertices.count() - 1 Step 1
        txV.add(xV(bC(xV, i)))
        txF.add(xF(bC(xF, i)))
      Next
      xV = txV.toarray()
      xF = txF.toarray()

      bn = m.IsClosed() = False

      For lp = 0 To L - 1 Step 1

        Dim mv As Rhino.Geometry.Collections.MeshVertexList
        Dim mf As Rhino.Geometry.Collections.MeshFaceList
        Dim mfn As Rhino.Geometry.Collections.MeshFaceNormalList
        Dim mc As Rhino.Geometry.Collections.MeshVertexColorList
        Dim mte As Rhino.Geometry.Collections.MeshTopologyEdgeList
        Dim mtv As Rhino.Geometry.Collections.MeshTopologyVertexList
        Dim mnv() As Boolean
        Dim nes As New list(Of Boolean)
        Dim pv() As point3d

        If ma.VertexColors.Count() > 0 Then
          cb = True
        Else
          cb = False
          ma.VertexColors.CreateMonotoneMesh(color.LightBlue)
        End If

        mv = ma.Vertices
        mf = ma.Faces
        mfn = ma.FaceNormals
        mc = ma.VertexColors
        mte = ma.TopologyEdges
        mtv = ma.TopologyVertices

        pv = mv.ToPoint3dArray
        mnv = ma.GetNakedEdgePointStatus

        Dim vo As New list(Of point3d)
        Dim fo As New list(Of MeshFace)
        Dim j,k,u,v,cf,ce,cv As Integer
        Dim fi() As Integer
        Dim p(4) As point3d
        Dim mvi(3) As Integer
        Dim av,af As Double
        Dim rv,rf As New list(Of Double)
        Dim tc As color
        Dim oc As New list(Of color)

        cv = mv.count()
        ce = mte.count()
        cf = mf.count()

        'Faces
        For i = 0 To cf - 1 Step 1
          Dim nrm As vector3d
          fi = mtv.IndicesFromFace(i)
          mvi(0) = mtv.MeshVertexIndices(fi(0))(0)
          mvi(1) = mtv.MeshVertexIndices(fi(1))(0)
          mvi(2) = mtv.MeshVertexIndices(fi(2))(0)
          If mf(i).IsQuad() Then mvi(3) = mtv.MeshVertexIndices(fi(3))(0)

          If mf(i).IsQuad() Then
            av = (xV(mvi(0)) + xV(mvi(1)) + xV(mvi(2)) + xV(mvi(3))) / 4
            af = (xF(mvi(0)) + xF(mvi(1)) + xF(mvi(2)) + xF(mvi(3))) / 4
            tc = avgC4(mc(mvi(0)), mc(mvi(1)), mc(mvi(2)), mc(mvi(3)))
          Else
            av = (xV(mvi(0)) + xV(mvi(1)) + xV(mvi(2))) / 3
            af = (xF(mvi(0)) + xF(mvi(1)) + xF(mvi(2))) / 3
            tc = avgC3(mc(mvi(0)), mc(mvi(1)), mc(mvi(2)))
          End If

          nrm = mfn(i)
          nrm.Unitize()
          nrm *= af

          vo.add(mf.getfacecenter(i) + nrm)
          rv.add(av)
          rf.add(af)
          oc.add(tc)
        Next

        'Edges
        For i = 0 To ce - 1 Step 1
          Dim cfi() As Integer
          cfi = mte.GetConnectedFaces(i)
          u = mtv.MeshVertexIndices(mte.GetTopologyVertices(i).I)(0)
          v = mtv.MeshVertexIndices(mte.GetTopologyVertices(i).J)(0)

          If ubound(cfi) > 0 Then
            fo.add(New meshface(cf + u, cfi(0), cfi(1)))
            fo.add(New meshface(cf + v, cfi(1), cfi(0)))
            nes.add(False)
          Else
            fo.add(New meshface(cf + u, cf + v, cfi(0)))
            nes.add(True)
          End If
        Next

        'Vertices
        For i = 0 To cv - 1 Step 1
          Dim zn As Integer
          Dim r As Double
          Dim cvi As New list(Of Integer)
          Dim q(6) As point3d
          Dim bne As Boolean = False
          q(0) = pv(i)

          cvi = mv.GetConnectedVertices(i).ToList()
          cvi.remove(i)
          k = cvi.count()
          zn = 0

          For j = 0 To k - 1 Step 1
            u = mte.GetEdgeIndex(mtv.TopologyVertexIndex(cvi.item((j))), mtv.TopologyVertexIndex(i))
            q(1) += pv(cvi.item(j))

            If nes(u) Then
              bne = True
              q(2) += (q(0) + pv(cvi.item(j))) / 2
              zn += 1
            End If
          Next
          q(1) /= k
          q(2) = (q(0) + q(2) / zn) / 2

          If bne Then
            If e = 0 Then
              q(3) = pv(i)
            ElseIf e = 2 Then
              If k = 2 Then
                q(3) = pv(i)
              Else
                q(3) = evalP(q(0), q(2), xV(i))
              End If
            Else
              q(3) = evalP(q(0), q(2), xV(i))
            End If
          Else
            r = (4 - 2 * math.Cos(2 * math.PI / k)) / 9
            q(3) = evalP(q(0), q(0) * (1 - r) + q(1) * r, xV(i))
          End If

          vo.add(q(3))
          rv.add(xV(i))
          rf.add(xF(i))
          oc.add(mc(i))

        Next

        Dim mo As New mesh
        mo.Vertices.AddVertices(vo)
        mo.Faces.AddFaces(fo)
        If cb Then mo.VertexColors.AppendColors(oc.toarray())
        mo.FaceNormals.ComputeFaceNormals()
        mo.UnifyNormals()
        mo.Normals.ComputeNormals()

        ma = mo
        xV = rv.toarray()
        xF = rf.toarray()

        'Loop
      Next
      A = ma
    End If
# ---------- m_root_3: VB additional code ----------
  Private Function bC(ByVal arrObj() As Double, ByVal t As Integer)
    Dim intOut As Integer
    If t > uBound(arrObj) Then intOut = uBound(arrObj) Else intOut = t
    Return intOut
  End Function

  Private Function evalP(ByVal op As point3d, ByVal tp As Point3d, ByVal t As Double)
    Return New point3d(op + (tp - op) * t)
  End Function

  Private Function avgC3(ByVal c0 As color, ByVal c1 As color, ByVal c2 As color)
    Dim r,g,b As Integer
    r = CInt((CInt(c0.R) + CInt(c1.R) + CInt(c2.R)) / 3)
    g = CInt((CInt(c0.G) + CInt(c1.G) + CInt(c2.G)) / 3)
    b = CInt((CInt(c0.B) + CInt(c1.B) + CInt(c2.B)) / 3)

    If R < 0 Then r = 0 Else If r > 255 Then r = 255
    If G < 0 Then g = 0 Else If r > 255 Then g = 255
    If B < 0 Then b = 0 Else If r > 255 Then b = 255

    Return color.FromArgb(r, g, b)
  End Function

  Private Function avgC4(ByVal c0 As color, ByVal c1 As color, ByVal c2 As color, ByVal c3 As color)
    Dim r,g,b As Integer
    r = CInt((CInt(c0.R) + CInt(c1.R) + CInt(c2.R) + CInt(c3.R)) / 4)
    g = CInt((CInt(c0.G) + CInt(c1.G) + CInt(c2.G) + CInt(c3.G)) / 4)
    b = CInt((CInt(c0.B) + CInt(c1.B) + CInt(c2.B) + CInt(c3.B)) / 4)

    If R < 0 Then r = 0 Else If r > 255 Then r = 255
    If G < 0 Then g = 0 Else If r > 255 Then g = 255
    If B < 0 Then b = 0 Else If r > 255 Then b = 255

    Return color.FromArgb(r, g, b)
  End Function
# ---------- end m_root_3 ----------
nv = NakedVertices(Mesh=m_root_3.A)  # -> ClothedIndex, NakedIndex, ClothedPts, NakedPts; disabled
sort_pt = SortPoints(Points=nv.ClothedPts)  # -> Points, Indices; disabled
points = PointList(Points=sort_pt.Points)  # disabled
wbedges_3 = WeaverbirdsMeshEdges(MeshOrPolylines=m_root_3.A)  # disabled
rev = ReverseList(List=sort_pt.Points)  # disabled
number_slider_48 = Slider(46, range=0..100)  # disabled
number_slider_49 = Slider(4, range=0..10)  # disabled
anchor_9 = Anchor(Point=flatten(divide_9.Points), Strength=10000)  # disabled
vertexloads_3 = VertexLoads(Mesh=m_root_3.A, Strength=load_3)  # disabled
length_line_9 = LengthLine(Line=wbedges_3, Strength=spring_strength_5)  # disabled
show_9 = Show(G=m_root_3.A)  # disabled
item = ListItem(List=rev, Index=0, Wrap=True)  # disabled
item_2 = ListItem(List=sort_pt.Points, Index=0, Wrap=True)  # disabled
rec_2pt = Rectangle2Pt(Plane=PlaneXY(0, 0, 0), PointA=item_2, PointB=item, Radius=0)  # -> Rectangle, Length; disabled
multiplication_3 = Multiplication(A=number_slider_48, B=number_slider_49)  # disabled
divide_10 = DivideCurve(Curve=rec_2pt.Rectangle, Count=multiplication_3, Kinks=False)  # -> Points, Tangents, Parameters; disabled
load_11 = Load(Point=divide_10.Points, ForceVector=Vector(0, 0, 1), Weighting=number_slider_20)  # disabled
entwine_9 = Entwine(Branch00=show_9, Branch01=anchor_9, Branch02=length_line_9, Branch03=vertexloads_3, Branch04=load_11, FlattenInputs=True)  # disabled
solver_9 = Solver(GoalObjects=entwine_9, Reset=button_8, Threshold=1e-15, Tolerance=0.01, On=toggle_8)  # -> I, V, O; disabled
bang_9 = ExplodeTree(Data=solver_9.O)  # -> Branch0, Branch1; disabled

# ---- group: Karamba Ceiling / Final Ceiling mesh
data_30 = Data(flatten(bang_8.Branch0))  # disabled

# ---- group: Buttresses
number_slider_50 = Slider(20, range=0..100)  # disabled
number_slider_51 = Slider(3, range=0..100)  # disabled
mesh_uv_4 = MeshSurface(
    Surface=[extr_25, extr_26, extr_23, extr_24, extr_21, extr_22, extr_19, extr_20, extr_27, mirror_17.Geometry, mirror_18.Geometry, mirror_16.Geometry],
    UCount=number_slider_50,
    VCount=number_slider_51,
    Overhang=True,
    Equalize=False)  # disabled

# ---- group: Karamba Ceiling / Final Ceiling mesh
data_31 = Data(flatten(bang_9.Branch0))  # disabled

# ---- group: dome
data_32 = Data(mesh_2)  # disabled

# ---- group: Loads
number_slider_52 = Slider(2, range=0..10)  # disabled
loads_5 = LoadsKaramba3D(Vector=Vector(0, 0, -1), LCase=0, mode="Gravity")  # disabled
Z_2 = UnitZ(Factor=expr("-x", number_slider_52))  # disabled
loads_6 = LoadsKaramba3D(Vector=Z_2, Mesh=data_32, LCase=0, mode="MeshLoad -Const.", menu=[buttons(off, on, off), buttons(on, on)])  # disabled

# ---- group: geometries / ceiling v2
data_33 = Data(data_30)  # disabled

# ----
mesh_uv_5 = MeshSurface(Surface=boundary, UCount=number_slider_37, VCount=number_slider_37, Overhang=False, Equalize=True)  # disabled
data_34 = Data(boundary)  # disabled
boundary_2 = BoundarySurfaces(Edges=flatten([ln_42, join_7]))  # disabled
mesh_3 = Mesh(data_34)  # disabled
m_loop_2 = WeightedLoopSubdivision(M=data_34, L=number_slider_38, E=number_slider_39, TE=1, TV=1)  # -> out, A; inputs M: Mesh, TE: list, TV: list; disabled; same code as m_loop
mesh_4 = Mesh(boundary_2)  # disabled
m_loop_3 = WeightedLoopSubdivision(M=mesh_4, L=number_slider_41, E=number_slider_42, TE=1, TV=1)  # -> out, A; inputs M: Mesh, TE: list, TV: list; disabled; same code as m_loop
mirror_19 = Mirror(Geometry=m_loop_3.A, Plane=pl_3pt_9)  # -> Geometry, Transform; disabled
mirror_20 = Mirror(Geometry=m_loop_3.A, Plane=pl_3pt_7)  # -> Geometry, Transform; disabled
mirror_21 = Mirror(Geometry=boundary, Plane=yz_6)  # -> Geometry, Transform; disabled
mirror_22 = Mirror(Geometry=mirror_19.Geometry, Plane=pl_3pt_8)  # -> Geometry, Transform; disabled
join_12 = BrepJoin(Breps=[mirror_21.Geometry, boundary, boundary_2])  # -> Breps, Closed; disabled
data_35 = Data([mirror_12.Geometry, data_27])  # disabled
m_loop_4 = WeightedLoopSubdivision(M=mesh_2, L=number_slider_45, E=number_slider_44, TE=1, TV=1)  # -> out, A; inputs M: Mesh, TE: list, TV: list; disabled; same code as m_loop
m_loop_5 = WeightedLoopSubdivision(M=data_30, L=number_slider_47, E=number_slider_46, TE=1, TV=1)  # -> out, A; inputs M: Mesh, TE: list, TV: list; disabled; same code as m_loop

# ---- group: Vertical el
m_loop_6 = WeightedLoopSubdivision(M=join_12.Breps, L=number_slider_43, E=number_slider_42, TE=1, TV=1)  # -> out, A; inputs M: Mesh, TE: list, TV: list; disabled; same code as m_loop

# ---- group: mesh3
mirror_23 = Mirror(Geometry=m_loop_2.A, Plane=yz_6)  # -> Geometry, Transform; disabled

# ---- group: Vertical el / Mesh AD
mjoin_2 = MeshJoin(Meshes=m_loop_6.A)  # disabled

# ---- group: Vertical el / Mesh AB
pl_3pt_16 = Plane3Pt(PointA=A_2, PointB=move_5.Geometry, PointC=end_26.End)  # disabled
mirror_24 = Mirror(Geometry=m_loop_6.A, Plane=pl_3pt_16)  # -> Geometry, Transform; disabled

# ---- group: Vertical el / Mesh CD
pl_3pt_17 = Plane3Pt(PointA=end_35.End, PointB=move_6.Geometry, PointC=move_4.Geometry)  # disabled
mirror_25 = Mirror(Geometry=m_loop_6.A, Plane=pl_3pt_17)  # -> Geometry, Transform; disabled

# ---- group: Vertical el / Mesh BC
pl_3pt_18 = Plane3Pt(PointA=A_2, PointB=move_5.Geometry, PointC=end_26.End)  # disabled
mirror_26 = Mirror(Geometry=mirror_25.Geometry, Plane=pl_3pt_18)  # -> Geometry, Transform; disabled

# ---- group: WALLS / Mesh AD
mjoin_3 = MeshJoin(Meshes=[mirror_23.Geometry, m_loop_2.A])  # disabled

# ---- group: WALLS / Mesh AB
pl_3pt_19 = Plane3Pt(PointA=A_2, PointB=move_5.Geometry, PointC=end_26.End)  # disabled
mirror_27 = Mirror(Geometry=mjoin_3, Plane=pl_3pt_19)  # -> Geometry, Transform; disabled

# ---- group: WALLS / Mesh CD
pl_3pt_20 = Plane3Pt(PointA=end_35.End, PointB=move_6.Geometry, PointC=move_4.Geometry)  # disabled
mirror_28 = Mirror(Geometry=mjoin_3, Plane=pl_3pt_20)  # -> Geometry, Transform; disabled

# ---- group: WALLS / Mesh BC
pl_3pt_21 = Plane3Pt(PointA=A_2, PointB=move_5.Geometry, PointC=end_26.End)  # disabled
mirror_29 = Mirror(Geometry=mirror_28.Geometry, Plane=pl_3pt_21)  # -> Geometry, Transform; disabled

# ---- group: Arc AB
pl_3pt_22 = Plane3Pt(PointA=A_2, PointB=move_5.Geometry, PointC=end_26.End)  # disabled
mirror_30 = Mirror(Geometry=data_35, Plane=pl_3pt_22)  # -> Geometry, Transform; disabled

# ---- group: Arc CD
pl_3pt_23 = Plane3Pt(PointA=end_35.End, PointB=move_6.Geometry, PointC=move_4.Geometry)  # disabled
mirror_31 = Mirror(Geometry=data_35, Plane=pl_3pt_23)  # -> Geometry, Transform; disabled

# ---- group: Arc BC
pl_3pt_24 = Plane3Pt(PointA=A_2, PointB=move_5.Geometry, PointC=end_26.End)  # disabled
mirror_32 = Mirror(Geometry=mirror_31.Geometry, Plane=pl_3pt_24)  # -> Geometry, Transform; disabled

# ---- group: Walls
mjoin_4 = MeshJoin(Meshes=[mjoin_3, mirror_27.Geometry, mirror_28.Geometry, mirror_29.Geometry])  # disabled

mjoin_5 = MeshJoin(Meshes=[mesh_uv_4, mjoin_4])  # -> flatten(Mesh); disabled

# ---- group: Arc wall
mjoin_6 = MeshJoin(Meshes=[m_loop_3.A, mirror_19.Geometry, mirror_22.Geometry, mirror_20.Geometry])  # disabled

# ---- group: supports / Walls support
nv_2 = NakedVertices(Mesh=mjoin_5)  # -> ClothedIndex, NakedIndex, ClothedPts, NakedPts; disabled
deconstruct = Deconstruct(Point=nv_2.NakedPts)  # -> XComponent, YComponent, ZComponent; disabled
sort_list = SortList(Keys=deconstruct.ZComponent, ValuesValuesA=nv_2.NakedPts)  # -> Keys, ValuesValuesA; disabled
dispatch = Dispatch(List=sort_list.ValuesValuesA, DispatchPattern=sort_list.Keys)  # -> ListA, flatten(ListB); disabled
data_36 = Data(dispatch.ListA)  # disabled

# ---- group: geometries
number_slider_53 = Slider(24, range=0..100)  # disabled
number_slider_54 = Slider(48, range=0..100)  # disabled
number_slider_55 = Slider(24, range=0..100)  # disabled
cross_section_2 = CrossSectionKaramba3D(FamilyNameOfCrossSection="DefaultCroSec", Material=material_2, Height_cm=number_slider_53, mode="Shell - Const")  # disabled
cross_section_3 = CrossSectionKaramba3D(FamilyNameOfCrossSection="DefaultCroSec", Material=material_2, Height_cm=number_slider_54, mode="Shell - Const")  # disabled
cross_section_4 = CrossSectionKaramba3D(FamilyNameOfCrossSection="DefaultCroSec", Material=material_2, Height_cm=number_slider_55, mode="Shell - Const")  # disabled
panel_35 = Panel("Ceiling")  # disabled
panel_36 = Panel("Walls")  # disabled
panel_37 = Panel("half wall")  # disabled
meshtoshell = MeshToShellKaramba3D(Mesh=data_32, Identifier=panel_35, CrossSection=cross_section_2, LimitDistance_m=0.005)  # -> Element, Points, Info; disabled
meshtoshell_2 = MeshToShellKaramba3D(Mesh=mjoin_5, Identifier=panel_36, CrossSection=cross_section_3, LimitDistance_m=0.005)  # -> Element, Points, Info; disabled
meshtoshell_3 = MeshToShellKaramba3D(Mesh=mjoin_6, Identifier=panel_37, CrossSection=cross_section_4, LimitDistance_m=0.005)  # -> Element, Points, Info; disabled

# ---- group: supports / Wall support
data_37 = Data(dispatch.ListB)  # disabled

# ---- group: supports
rdpoints = RemoveDuplicatePointsKaramba3D(Point=data_37, LimitDistance=0.005)  # -> OutPoint, Info, Indexes; disabled
supp = SupportKaramba3D(PosInd=rdpoints.OutPoint, menu=[buttons(on, on, on, on, on, on)])  # disabled

# ----
mjoin_7 = MeshJoin(Meshes=[m_loop_3.A, mjoin_3])  # disabled
data_38 = Data([data_35, mirror_31.Geometry, mirror_32.Geometry, mirror_30.Geometry])  # disabled
mjoin_8 = MeshJoin(Meshes=[mjoin_2, mirror_24.Geometry, mirror_25.Geometry, mirror_26.Geometry, data_32, m_loop_4.A, mesh_uv_4])  # -> flatten(Mesh); disabled
assemble = AssembleModelKaramba3D(
    Elem=flatten([meshtoshell.Element, meshtoshell_2.Element, meshtoshell_3.Element]),
    Support=flatten(supp),
    Load=[loads_5, loads_6],
    LimitDistance_m=0.005)  # -> flatten(Model), Info, Mass_kg, CenterOfGravity; disabled
analyze = AnalyzeKaramba3D(Model=assemble.Model)  # -> CalculatedModel, flatten(MaximumDisplacement_cm), ResultingForceOfGravity_kN, ElasticEnergy_kNm; disabled
modelview = ModelViewKaramba3D(
    Model=analyze.CalculatedModel,
    ResultFactors=1,
    ResultCase=-1,
    Colors=[swatch_11, swatch_15, swatch_14, swatch_12, swatch_13])  # -> Model, DeformedMesh, DeformedAxes, DeformedModel; disabled
shellview = ShellViewKaramba3D(Model=modelview.Model, IndexOfLayer=0)  # -> Model, MeshesOfRenderedShells, flatten(LegendColors), flatten(LegendTags); disabled
move_52 = Move(Geometry=shellview.MeshesOfRenderedShells, Motion=Vector(0, 20, 0))  # -> Geometry, Transform; disabled
multiplication_4 = Multiplication(A=shellview.LegendTags, B=10)  # disabled
move_53 = Move(Geometry=shellview.MeshesOfRenderedShells, Motion=Vector(0, 10, 0))  # -> Geometry, Transform; disabled
bnd = Bounds(Numbers=shellview.LegendTags)  # disabled
replace = ReplaceItems(List=multiplication_4, Item=panel_33, Indices=panel_34, Wrap=False)  # disabled
legend = Legend(Colour=shellview.LegendColors, Tags=replace, LegendType=1)  # disabled
dedomain = DeconstructDomain(Domain=bnd)  # -> Start, End; disabled
max = Maximum(A=flatten(dedomain.Start), B=dedomain.End)  # -> flatten(Result); disabled
min = Minimum(A=flatten(dedomain.Start), B=dedomain.End)  # -> flatten(Result); disabled

# ---- group: Reaction forces OLD
react_2 = ReactionForcesKaramba3D(AnalyzedModel=analyze.CalculatedModel, ResultCase=0)  # -> AnalyzedModel, flatten(ReactionForces_kN), flatten(ReactionMoments_kNm), flatten(SupportPosition), SumOfReactionForces_kN, SumOfReactionMoments_kNm; disabled
loads_7 = LoadsKaramba3D(
    ForceVector=expr("-x", react_2.ReactionForces_kN),
    MomentVector=expr("-x", react_2.ReactionMoments_kNm),
    Local=False,
    PosInd=react_2.SupportPosition,
    LCase=0,
    mode="Point")  # disabled

# ----
multiplication_5 = Multiplication(A=min, B=10)  # disabled
multiplication_6 = Multiplication(A=max, B=10)  # disabled
data_39 = Data(analyze.MaximumDisplacement_cm)  # disabled

# ---- group: Dome Stresses and displacement
displ_cm = Panel(data_39)  # disabled
max_2 = Panel(multiplication_6)  # disabled
min_2 = Panel(multiplication_5)  # disabled

# ---- group: 4 dome (continued)
data_40 = Data(flatten(bang_2.Branch0))  # disabled

# ---- group: 4 dome / surface 1
boundary_3 = BoundarySurfaces(Edges=flatten([line_a_2, line_4, ln_8, line_9, line_8, ln_6, data_3, data_40]))  # disabled

# ---- group: 4 dome (continued)
data_41 = Data(boundary_3)  # disabled
mesh_5 = Mesh(data_41)  # disabled
m_loop_7 = WeightedLoopSubdivision(M=mesh_5, L=number_slider_24, E=number_slider_25, TE=1, TV=1)  # -> out, A; inputs M: Mesh, TE: list, TV: list; disabled; same code as m_loop

# ---- group: 4 dome / mesh3
mirror_33 = Mirror(Geometry=m_loop_7.A, Plane=yz_2)  # -> Geometry, Transform; disabled

# ---- group: 4 dome / WALLS / Mesh AD
mjoin_9 = MeshJoin(Meshes=[mirror_33.Geometry, m_loop_7.A])  # disabled

# ---- group: 4 dome / WALLS / Mesh AB
pl_3pt_25 = Plane3Pt(PointA=A, PointB=move_2.Geometry, PointC=end_2.End)  # disabled
mirror_34 = Mirror(Geometry=mjoin_9, Plane=pl_3pt_25)  # -> Geometry, Transform; disabled

# ---- group: 4 dome / WALLS / Mesh CD
pl_3pt_26 = Plane3Pt(PointA=end_11.End, PointB=move_3.Geometry, PointC=move.Geometry)  # disabled
mirror_35 = Mirror(Geometry=mjoin_9, Plane=pl_3pt_26)  # -> Geometry, Transform; disabled

# ---- group: 4 dome / WALLS / Mesh BC
pl_3pt_27 = Plane3Pt(PointA=A, PointB=move_2.Geometry, PointC=end_2.End)  # disabled
mirror_36 = Mirror(Geometry=mirror_35.Geometry, Plane=pl_3pt_27)  # -> Geometry, Transform; disabled

# ---- group: 4 dome / Walls
mjoin_10 = MeshJoin(Meshes=[mjoin_9, mirror_34.Geometry, mirror_35.Geometry, mirror_36.Geometry])  # disabled

# ---- group: 4 dome / Vertical el
mjoin_11 = MeshJoin(Meshes=[mesh_uv, mjoin_10])  # -> flatten(Mesh); disabled

# ---- group: 4 dome / Supports / Walls support
nv_3 = NakedVertices(Mesh=mjoin_11)  # -> ClothedIndex, NakedIndex, ClothedPts, flatten(NakedPts); disabled
deconstruct_2 = Deconstruct(Point=nv_3.NakedPts)  # -> XComponent, YComponent, ZComponent; disabled
sort_list_2 = SortList(Keys=deconstruct_2.ZComponent, ValuesValuesA=nv_3.NakedPts)  # -> Keys, ValuesValuesA; disabled
dispatch_2 = Dispatch(List=sort_list_2.ValuesValuesA, DispatchPattern=sort_list_2.Keys)  # -> ListA, flatten(ListB); disabled

# ---- group: Mesh BC
xz_2 = XZPlane(Origin=midpt_10)  # disabled

# ----
data_42 = Data(bang_4.Branch0)  # disabled
extr_28 = Extrude(Base=data_19, Direction=X_2)  # disabled
mesh_uv_6 = MeshSurface(Surface=extr_28, UCount=number_slider_33, VCount=5, Overhang=True, Equalize=False)  # disabled

# ---- group: surface 1
boundary_4 = BoundarySurfaces(Edges=flatten([line_a_7, line_11, ln_27, ln_28, line_15, line_14, ln_26, data_42]))  # disabled

# ---- group: CEILING / Vault
data_43 = Data(mesh_uv_6)  # disabled

# ---- group: CEILING
flipm = FlipMesh(Mesh=data_43, VertexNormals=True, FaceNormals=True, FaceOrientation=True)  # disabled
data_44 = Data(flipm)  # disabled

# ---- group: live load
kn_m_2 = Slider(4, range=0..10)  # disabled
demesh = DeconstructMesh(Mesh=data_44)  # -> flatten(Vertices), Faces, Colours, Normals; disabled
Z_3 = UnitZ(Factor=expr("-x", kn_m_2))  # disabled
data_45 = Data(demesh.Vertices)  # disabled
panel_38 = Panel("1")  # disabled
loads_8 = LoadsKaramba3D(
    Vector=Z_3,
    Mesh=data_44,
    Pos=data_45,
    LCase=panel_38,
    mode="MeshLoad -Const.",
    menu=[buttons(off, on, off), buttons(on, on)])  # -> flatten(Load); disabled

# ----
mesh_uv_7 = MeshSurface(Surface=boundary_4, UCount=number_slider_29, VCount=number_slider_29, Overhang=False, Equalize=True)  # disabled
data_46 = Data(boundary_4)  # disabled
mesh_6 = Mesh(data_46)  # disabled
m_loop_8 = WeightedLoopSubdivision(M=mesh_6, L=number_slider_30, E=number_slider_31, TE=1, TV=1)  # -> out, A; inputs M: Mesh, TE: list, TV: list; disabled; same code as m_loop
nv_4 = NakedVertices(Mesh=data_44)  # -> ClothedIndex, NakedIndex, flatten(ClothedPts), NakedPts; disabled
data_47 = Data(nv_4.ClothedPts)  # disabled

# ---- group: 2
mirror_37 = Mirror(Geometry=m_loop_8.A, Plane=yz_3)  # -> Geometry, Transform; disabled

# ---- group: Mesh AD
mjoin_12 = MeshJoin(Meshes=[mirror_37.Geometry, m_loop_8.A])  # disabled

# ---- group: Mesh BC (continued)
mirror_38 = Mirror(Geometry=mjoin_12, Plane=xz_2)  # -> Geometry, Transform; disabled

# ---- group: Walls
mjoin_13 = MeshJoin(Meshes=[mjoin_12, mirror_38.Geometry])  # disabled

# ---- group: Walls and buttresses
mjoin_14 = MeshJoin(Meshes=[mesh_uv_2, mjoin_13])  # disabled

# ---- group: Walls support
nv_5 = NakedVertices(Mesh=mjoin_14)  # -> ClothedIndex, NakedIndex, ClothedPts, NakedPts; disabled
deconstruct_3 = Deconstruct(Point=nv_5.NakedPts)  # -> XComponent, YComponent, ZComponent; disabled
sort_list_3 = SortList(Keys=deconstruct_3.ZComponent, ValuesValuesA=nv_5.NakedPts)  # -> Keys, ValuesValuesA; disabled
dispatch_3 = Dispatch(List=sort_list_3.ValuesValuesA, DispatchPattern=sort_list_3.Keys)  # -> ListA, flatten(ListB); disabled
data_48 = Data(dispatch_3.ListA)  # disabled
rdpoints_2 = RemoveDuplicatePointsKaramba3D(Point=dispatch_3.ListB, LimitDistance=0.005)  # -> OutPoint, Info, Indexes; disabled
supp_2 = SupportKaramba3D(PosInd=rdpoints_2.OutPoint, menu=[buttons(on, on, on, on, on, on)])  # disabled

# ---- group: geometries
number_slider_56 = Slider(48, range=0..100)  # disabled
number_slider_57 = Slider(48, range=0..100)  # disabled
number_slider_58 = Slider(48, range=0..100)  # disabled
cross_section_5 = CrossSectionKaramba3D(FamilyNameOfCrossSection="DefaultCroSec", Material=material, Height_cm=number_slider_57, mode="Shell - Const")  # disabled
cross_section_6 = CrossSectionKaramba3D(FamilyNameOfCrossSection="DefaultCroSec", Material=material, Height_cm=number_slider_56, mode="Shell - Const")  # disabled
cross_section_7 = CrossSectionKaramba3D(FamilyNameOfCrossSection="DefaultCroSec", Material=material, Height_cm=number_slider_58, mode="Shell - Const")  # disabled
panel_39 = Panel("Ceiling")  # disabled
mjoin_15 = MeshJoin(Meshes=[data_44, mjoin_14])  # disabled
panel_40 = Panel("arc")  # disabled
panel_41 = Panel("Walls")  # disabled
meshtoshell_4 = MeshToShellKaramba3D(Mesh=data_44, Identifier=panel_39, CrossSection=cross_section_5, LimitDistance_m=0.005)  # -> Element, Points, Info; disabled
meshtoshell_5 = MeshToShellKaramba3D(Mesh=mjoin_14, Identifier=panel_41, CrossSection=cross_section_6, LimitDistance_m=0.005)  # -> Element, Points, Info; disabled
meshtoshell_6 = MeshToShellKaramba3D(Mesh=mjoin_15, Identifier=panel_40, CrossSection=cross_section_7, LimitDistance_m=0.005)  # -> Element, Points, Info; disabled

# ---- group: 4 dome / OPENINGS
data_49 = Data([mirror_3.Geometry, data_11])  # disabled

# ---- group: 4 dome / OPENINGS / Arc AB
pl_3pt_28 = Plane3Pt(PointA=A, PointB=move_2.Geometry, PointC=end_2.End)  # disabled
mirror_39 = Mirror(Geometry=data_49, Plane=pl_3pt_28)  # -> Geometry, Transform; disabled

# ---- group: 4 dome / OPENINGS / Arc CD
pl_3pt_29 = Plane3Pt(PointA=end_11.End, PointB=move_3.Geometry, PointC=move.Geometry)  # disabled
mirror_40 = Mirror(Geometry=data_49, Plane=pl_3pt_29)  # -> Geometry, Transform; disabled

# ---- group: 4 dome / OPENINGS / Arc BC
pl_3pt_30 = Plane3Pt(PointA=A, PointB=move_2.Geometry, PointC=end_2.End)  # disabled
mirror_41 = Mirror(Geometry=mirror_40.Geometry, Plane=pl_3pt_30)  # -> Geometry, Transform; disabled

# ---- group: 4 dome / OPENINGS (continued)
data_50 = Data([data_49, mirror_40.Geometry, mirror_41.Geometry, mirror_39.Geometry])  # disabled

# ---- group: Karamba Ceiling
conmesh_2 = ConstructMesh(Vertices=[end_15.End, end_24.End, end_23.End, end_16.End], Faces={A=0, B=1, C=2, D=3})  # disabled
medges_4 = MeshEdges(Mesh=conmesh_2)  # -> NakedEdges, InteriorEdges, NonManifoldEdges; disabled
srf4pt_2 = _4PointSurface(CornerA=end_15.End, CornerB=end_24.End, CornerC=end_23.End, CornerD=end_16.End)  # disabled
mesh_uv_8 = MeshSurface(Surface=srf4pt_2, UCount=number_slider_9, VCount=v_count, Overhang=True, Equalize=False)  # disabled
m_root_3_2 = WeightedRoot3Subdivision(M=mesh_uv_8, L=subdivision_loops_2, E=edge_type_2, DF=0, TV=1)  # -> out, A; inputs M: Mesh, DF: list, TV: list; disabled; same code as m_root_3
wbedges_4 = WeaverbirdsMeshEdges(MeshOrPolylines=m_root_3_2.A)  # disabled
vertexloads_4 = VertexLoads(Mesh=m_root_3_2.A, Strength=number_slider_10)  # disabled
length_line_10 = LengthLine(Line=wbedges_4, Strength=spring_strength_4)  # disabled
show_10 = Show(G=m_root_3_2.A)  # disabled

# ---- group: Roof support AB
nv_6 = NakedVertices(Mesh=mesh_uv_8)  # -> ClothedIndex, NakedIndex, ClothedPts, NakedPts; disabled
deconstruct_4 = Deconstruct(Point=nv_6.NakedPts)  # -> XComponent, YComponent, ZComponent; disabled
sort_list_4 = SortList(Keys=deconstruct_4.YComponent, ValuesValuesA=nv_6.NakedPts)  # -> Keys, ValuesValuesA; disabled
dispatch_4 = Dispatch(List=sort_list_4.ValuesValuesA, DispatchPattern=sort_list_4.Keys)  # -> ListA, flatten(ListB); disabled
data_51 = Data(dispatch_4.ListB)  # disabled

# ---- group: Roof support BC
nv_7 = NakedVertices(Mesh=mesh_uv_8)  # -> ClothedIndex, NakedIndex, ClothedPts, NakedPts; disabled
deconstruct_5 = Deconstruct(Point=nv_7.NakedPts)  # -> XComponent, YComponent, ZComponent; disabled
panel_42 = Panel("0.1")  # disabled
subtraction = Subtraction(A=number_slider_8, B=panel_42)  # disabled
dom = ConstructDomain(DomainStart=subtraction, DomainEnd=number_slider_8)  # disabled
inc = Includes(Value=deconstruct_5.YComponent, Domain=dom)  # -> Includes, Deviation; disabled
dispatch_5 = Dispatch(List=nv_7.NakedPts, DispatchPattern=inc.Includes)  # -> ListA, ListB; disabled
data_52 = Data(dispatch_5.ListA)  # disabled

# ---- group: Karamba Ceiling (continued)
anchor_10 = Anchor(Point=flatten([data_51, data_52]), Strength=10000)  # disabled
entwine_10 = Entwine(Branch00=show_10, Branch01=anchor_10, Branch02=length_line_10, Branch03=vertexloads_4, FlattenInputs=True)  # disabled
solver_10 = Solver(GoalObjects=entwine_10, Reset=button_6, Threshold=1e-15, Tolerance=0.01, On=toggle_6)  # -> I, V, O; disabled
bang_10 = ExplodeTree(Data=solver_10.O)  # -> Branch0, Branch1; disabled

# ---- group: 4 dome / Karamba Ceiling OLD
srf4pt_3 = _4PointSurface(CornerA=end_3.End, CornerB=end_12.End, CornerC=end_11.End, CornerD=end_4.End)  # disabled
mesh_uv_9 = MeshSurface(Surface=srf4pt_3, UCount=naked_vertex_count, VCount=naked_vertex_count, Overhang=True, Equalize=False)  # disabled
m_root_3_3 = WeightedRoot3Subdivision(M=mesh_uv_9, L=subdivision_loops, E=edge_type, DF=0, TV=1)  # -> out, A; inputs M: Mesh, DF: list, TV: list; disabled; same code as m_root_3
wbedges_5 = WeaverbirdsMeshEdges(MeshOrPolylines=m_root_3_3.A)  # disabled
vertexloads_5 = VertexLoads(Mesh=m_root_3_3.A, Strength=load)  # disabled
length_line_11 = LengthLine(Line=wbedges_5, Strength=spring_strength)  # disabled
show_11 = Show(G=m_root_3_3.A)  # disabled

# ---- group: 4 dome / Arches below domes
Y_9 = UnitY(Factor=expr("-x", division))  # disabled
geo = Geometry(join)  # disabled
number_slider_59 = Slider(0.4, range=0..1)  # disabled
number_slider_60 = Slider(1, range=0..10)  # disabled

# ---- group: 4 dome (continued)
mc = MeshCorners(Mesh=m_root_3_3.A, Angle=2.35619449)  # disabled
center = Center(Geometrical=m_root_3_3.A)  # -> Center, Dimension; disabled
medges_5 = MeshEdges(Mesh=mjoin_10)  # -> NakedEdges, InteriorEdges, NonManifoldEdges; disabled
data_53 = Data(medges_5.NakedEdges)  # disabled
end_38 = EndPoints(Curve=data_53)  # -> Start, End; disabled
xz_3 = XZPlane(Origin=center.Center)  # disabled
yz_7 = YZPlane(Origin=center.Center)  # disabled
data_54 = Data([end_38.Start, end_38.End])  # disabled
mirror_42 = Mirror(Geometry=data_14, Plane=xz_3)  # -> Geometry, Transform; disabled
mirror_43 = Mirror(Geometry=[mirror_42.Geometry, data_14], Plane=yz_7)  # -> Geometry, Transform; disabled
rdpoints_3 = RemoveDuplicatePointsKaramba3D(Point=data_54, LimitDistance=0.005)  # -> OutPoint, Info, Indexes; disabled

# ---- group: 4 dome / Karamba Ceiling OLD (continued)
anchor_11 = Anchor(Point=flatten([center.Center, mc, move_24.Geometry]), Strength=10000)  # disabled
entwine_11 = Entwine(Branch00=show_11, Branch01=anchor_11, Branch02=length_line_11, Branch03=vertexloads_5, FlattenInputs=True)  # disabled
solver_11 = Solver(GoalObjects=entwine_11, Reset=button, Threshold=1e-15, Tolerance=0.01, On=toggle)  # -> I, V, O; disabled
bang_11 = ExplodeTree(Data=solver_11.O)  # -> Branch0, Branch1; disabled

# ---- group: 4 dome / Karamba Ceiling OLD / Final Ceiling mesh
data_55 = Data(flatten(bang_11.Branch0))  # disabled

# ---- group: 4 dome / 1st floor walls
deconstruct_6 = Deconstruct(Point=rdpoints_3.OutPoint)  # -> XComponent, YComponent, ZComponent; disabled
panel_43 = Panel("2.2")  # disabled
larger = LargerThan(FirstNumber=deconstruct_6.ZComponent, SecondNumber=panel_43)  # -> LargerThan, OrEqualTo; disabled
cull = CullPattern(List=rdpoints_3.OutPoint, CullPattern=larger.OrEqualTo)  # disabled

# ---- group: 4 dome / Ceiling
mjoin_16 = MeshJoin(Meshes=[mirror_42.Geometry, mirror_43.Geometry, data_14])  # disabled

data_56 = Data(mjoin_16)  # disabled

# ---- group: 4 dome / Sand load
medges_6 = MeshEdges(Mesh=data_56)  # -> NakedEdges, InteriorEdges, NonManifoldEdges; disabled
nv_8 = NakedVertices(Mesh=data_56)  # -> ClothedIndex, NakedIndex, ClothedPts, NakedPts; disabled
data_57 = Data(medges_6.NakedEdges)  # disabled
demesh_2 = DeconstructMesh(Mesh=data_56)  # -> Vertices, Faces, Colours, Normals; disabled
m_facearea = MeshFaceArea(M=data_56)  # -> out, G, A, B; inputs M: Mesh; disabled
# ---------- m_facearea: VB usings ----------
Imports System.IO
Imports System.Linq
Imports System.Data
Imports System.Drawing
Imports System.Reflection
Imports System.Windows.Forms
Imports System.Xml
Imports System.Xml.Linq
Imports Microsoft.VisualBasic
Imports System.Runtime.InteropServices

Imports Rhino.DocObjects
Imports Rhino.Collections
Imports GH_IO
Imports GH_IO.Serialization
# ---------- m_facearea: VB ----------
    Component.Params.Input(0).Name = "Mesh"
    Component.Params.Input(0).Description = "Open or closed mesh"
    Component.Params.Input(1).Name = "Area Domain"
    Component.Params.Input(1).Description = "The domain that describes the range of areas to be tested against"

    Component.Params.Output(1).Name = "Preview Mesh"
    Component.Params.Output(1).Description = "A greyscale preview mesh reflecting the range of values"
    Component.Params.Output(2).Name = "Areas"
    Component.Params.Output(2).Description = "The area of each face of the mesh"
    Component.Params.Output(3).Name = "Pattern"
    Component.Params.Output(3).Description = "If the R input is used, the status of each sample point relative to the provided range (0 = Below, 1 = Within, 2 = Above)"

    If M IsNot Nothing Then
      Dim i,j,k,s As Integer

      Dim mf As Rhino.Geometry.Collections.MeshFaceList = Nothing
      Dim mfn As Rhino.Geometry.Collections.MeshFaceNormalList = Nothing
      Dim mv As Rhino.Geometry.Collections.MeshVertexList = Nothing
      Dim mtv As Rhino.Geometry.Collections.MeshTopologyVertexList = Nothing
      Dim mte As Rhino.Geometry.Collections.MeshTopologyEdgeList = Nothing
      Dim mn As Rhino.Geometry.Collections.MeshVertexNormalList = Nothing
      Dim mc As Rhino.Geometry.Collections.MeshVertexColorList = Nothing

      mf = m.Faces
      mfn = m.FaceNormals
      mv = m.Vertices
      mtv = m.TopologyVertices
      mte = m.TopologyEdges
      mn = m.Normals
      mc = m.VertexColors

      Dim arrArea As New list(Of Double)
      Dim oc As New list(Of color)
      Dim tv,farea,Tmin,Tmax As Double
      Dim arrPat As New list(Of Integer)

      Dim mfo As New list(Of MeshFace)
      Dim mvo As New list(Of point3d)

      For i = 0 To mf.count() - 1 Step 1
        s = mvo.count()
        Dim tm As New mesh
        Dim tmf As Rhino.Geometry.Collections.MeshFaceList = Nothing
        tmf = tm.Faces()
        tmf.AddFace(mf.item(i))
        tm.Vertices.AddVertices(mv)

        farea = Rhino.Geometry.AreaMassProperties.Compute(tm).Area
        arrArea.add(farea)

        If mf.item(i).isquad() Then
          mvo.add(mv.item(mf.item(i).A))
          mvo.add(mv.item(mf.item(i).B))
          mvo.add(mv.item(mf.item(i).C))
          mvo.add(mv.item(mf.item(i).D))
          mfo.add(New meshface(s, s + 1, s + 2, s + 3))
          k = 4
        Else
          mvo.add(mv.item(mf.item(i).A))
          mvo.add(mv.item(mf.item(i).B))
          mvo.add(mv.item(mf.item(i).C))
          mfo.add(New meshface(s, s + 1, s + 2))
          k = 3
        End If

        If i = 0 Then Tmin = farea Else If farea < Tmin Then Tmin = farea
        If farea > Tmax Then Tmax = farea
      Next

      If R = Nothing Then
        R.t0 = Tmin
        R.t1 = Tmax
      End If

      For i = 0 To mf.count() - 1 Step 1
        If mf.item(i).isquad() Then k = 4 Else k = 3

        If arrArea.item(i) < R.T0 Then
          For j = 0 To k - 1 Step 1
            oc.add(color.FromArgb(0, 0, 255))
          Next
          arrPat.add(0)
        ElseIf ((arrArea.item(i) > R.T1) Or ((r.t0 = 0) And (r.t1 = 0))) Then
          For j = 0 To k - 1 Step 1
            oc.add(color.FromArgb(255, 0, 0))
          Next
          arrPat.add(2)
        Else
          For j = 0 To k - 1 Step 1
            tv = math.Floor((arrArea.item(i) - R.T0) / (R.t1 - R.t0) * 255)
            oc.add(color.FromArgb(tv, tv, tv))
          Next
          arrPat.add(1)
        End If
      Next
      Dim mo As New mesh
      mo.vertices.AddVertices(mvo.toarray())
      mo.Faces.AddFaces(mfo.toarray())
      mo.VertexColors.AppendColors(oc.toarray())

      G = mo
      A = arrArea
      B = arrPat
    End If
# ---------- end m_facearea ----------
data_58 = Data(nv_8.ClothedPts)  # disabled
pdecon_13 = Deconstruct(Point=demesh_2.Vertices)  # -> XComponent, YComponent, ZComponent; disabled
pdecon_14 = Deconstruct(Point=data_58)  # -> XComponent, YComponent, ZComponent; disabled
avr = Average(Input=m_facearea.A)  # disabled
sort = SortList(Keys=pdecon_13.ZComponent, ValuesA=demesh_2.Vertices)  # -> reverse(Keys), reverse(ValuesA); disabled
sort_2 = SortList(Keys=pdecon_14.ZComponent, ValuesA=data_58)  # -> reverse(Keys), reverse(ValuesA); disabled
item_3 = ListItem(List=sort.ValuesA, Index=0, Wrap=True)  # disabled
item_4 = ListItem(List=sort_2.ValuesA, Index=0, Wrap=True)  # disabled
xy = XYPlane(Origin=item_3)  # disabled
xy_2 = XYPlane(Origin=item_4)  # disabled
project = Project(Geometry=demesh_2.Vertices, Plane=xy)  # -> Geometry, Transform; disabled
project_2 = Project(Geometry=data_58, Plane=xy_2)  # -> Geometry, Transform; disabled
panel_44 = Panel("4")  # disabled
dist_3 = Distance(PointA=demesh_2.Vertices, PointB=project.Geometry)  # disabled
multiplication_7 = Multiplication(A=avr, B=panel_44)  # disabled
dist_4 = Distance(PointA=data_58, PointB=project_2.Geometry)  # disabled
multiplication_8 = Multiplication(A=dist_3, B=avr)  # disabled
multiplication_9 = Multiplication(A=dist_4, B=multiplication_7)  # disabled
density_in_kn_m_3 = Panel("15")  # disabled
density_in_kn_m_3_2 = Panel("15")  # disabled
multiplication_10 = Multiplication(A=multiplication_8, B=density_in_kn_m_3_2)  # disabled
multiplication_11 = Multiplication(A=multiplication_9, B=density_in_kn_m_3)  # disabled
Z_4 = UnitZ(Factor=expr("-x", multiplication_10))  # disabled
Z_5 = UnitZ(Factor=expr("-x", multiplication_11))  # disabled
panel_45 = Panel("1")  # disabled
panel_46 = Panel("1")  # disabled
loads_9 = LoadsKaramba3D(ForceVector=Z_4, Local=False, PosInd=demesh_2.Vertices, LCase=panel_45, mode="Point")  # disabled
loads_10 = LoadsKaramba3D(ForceVector=Z_5, Local=False, PosInd=data_58, LCase=panel_46, mode="Point")  # disabled

# ---- group: 4 dome / SECOND FLOOR WALLS / First floor walls points
data_59 = Data(cull)  # disabled

# ---- group: 4 dome / SECOND FLOOR WALLS / line l
len = Length(Curve=medges_6.NakedEdges)  # disabled
avr_2 = Average(Input=len)  # disabled

# ---- group: 4 dome / SECOND FLOOR WALLS
xy_3 = XYPlane(Origin=item_3)  # disabled
project_3 = Project(Geometry=data_59, Plane=xy_3)  # -> Geometry, Transform; disabled
number_slider_61 = Slider(0.42, range=0..1)  # disabled
dist_5 = Distance(PointA=data_59, PointB=project_3.Geometry)  # disabled
multiplication_12 = Multiplication(A=avr_2, B=number_slider_61)  # disabled
panel_47 = Panel("2.3")  # disabled
multiplication_13 = Multiplication(A=multiplication_12, B=dist_5)  # disabled
multiplication_14 = Multiplication(A=multiplication_12, B=panel_47)  # disabled
density_in_kn_m_3_3 = Panel("15")  # disabled
density_in_kn_m_3_4 = Panel("15")  # disabled
multiplication_15 = Multiplication(A=multiplication_13, B=density_in_kn_m_3_3)  # disabled
multiplication_16 = Multiplication(A=multiplication_14, B=density_in_kn_m_3_4)  # disabled
Z_6 = UnitZ(Factor=expr("-x", multiplication_15))  # disabled
Z_7 = UnitZ(Factor=expr("-x", multiplication_16))  # disabled
panel_48 = Panel("1")  # disabled
panel_49 = Panel("1")  # disabled
loads_11 = LoadsKaramba3D(ForceVector=Z_6, Local=False, PosInd=data_59, LCase=panel_48, mode="Point")  # disabled
loads_12 = LoadsKaramba3D(ForceVector=Z_7, Local=False, PosInd=data_59, LCase=panel_49, mode="Point")  # disabled

# ---- group: 4 dome / Arches below domes (continued)
xy_4 = XYPlane(Origin=center.Center)  # disabled
xy_5 = XYPlane(Origin=center.Center)  # disabled
xy_6 = XYPlane(Origin=center.Center)  # disabled

# ---- group: 4 dome / Coloumn OLD
number_slider_62 = Slider(0.21, range=0..1)  # disabled
project_4 = Project(Geometry=center.Center, Plane=PlaneXY(0, 0, 0))  # -> Geometry, Transform; disabled
yz_8 = YZPlane(Origin=project_4.Geometry)  # disabled
xy_7 = XYPlane(Origin=project_4.Geometry)  # disabled
X_6 = UnitX(Factor=number_slider_62)  # disabled

# ---- group: 4 dome / Supports / Arc support
panel_50 = Panel("0.01")  # disabled

# ---- group: 4 dome / Geometries
number_slider_63 = Slider(42, range=0..100)  # disabled
number_slider_64 = Slider(24, range=10..40)  # disabled
number_slider_65 = Slider(48, range=30..50)  # disabled
material_3 = MaterialKaramba3D(matprops)  # disabled
number_slider_66 = Slider(42, range=0..100)  # disabled
cross_section_8 = CrossSectionKaramba3D(FamilyNameOfCrossSection="DefaultCroSec", Material=material_3, Height_cm=number_slider_65, mode="Shell - Const")  # disabled
cross_section_9 = CrossSectionKaramba3D(FamilyNameOfCrossSection="DefaultCroSec", Material=material_3, Height_cm=number_slider_66, mode="Shell - Const")  # disabled
cross_section_10 = CrossSectionKaramba3D(
    FamilyNameOfCrossSection="DefaultCroSec",
    Material=material_3,
    Height_cm=number_slider_63,
    UpperFlangeWidth_cm=number_slider_63,
    LowerFlangeWidth_cm=number_slider_63,
    mode="Trapezoid")  # disabled
panel_51 = Panel("Ceiling")  # disabled
cross_section_11 = CrossSectionKaramba3D(
    FamilyNameOfCrossSection="DefaultCroSec",
    ElementIdentifier=panel_51,
    Material=material_3,
    Height_cm=number_slider_64,
    mode="Shell - Const")  # disabled
panel_52 = Panel("Walls and Buttresses")  # disabled
data_60 = Data(data_56)  # disabled
panel_53 = Panel("Arc")  # disabled
ln_61 = Line(StartPoint=project_4.Geometry, EndPoint=center.Center)  # disabled
panel_54 = Panel("col")  # disabled
meshtoshell_7 = MeshToShellKaramba3D(Mesh=data_60, Identifier=panel_51, CrossSection=cross_section_11, LimitDistance_m=0.005)  # -> Element, Points, Info; disabled
meshtoshell_8 = MeshToShellKaramba3D(Mesh=mjoin_11, Identifier=panel_52, CrossSection=cross_section_8, LimitDistance_m=0.005)  # -> Element, Points, Info; disabled
linetobeam = LineToBeamKaramba3D(Line=ln_61, Identifier=panel_54, CrossSection=cross_section_10, New=True, Remove=True, LimitDistance_m=0.005)  # -> Element, Points, Info; disabled

# ---- group: 4 dome / Arches below domes (continued)
coloumn = Line(ln_61)  # disabled
move_54 = Move(Geometry=coloumn, Motion=Y_9)  # -> Geometry, Transform; disabled
join_13 = JoinCurves(Curves=flatten([coloumn, move_54.Geometry, geo]), Preserve=False)  # disabled
offset_2 = OffsetCurve(Curve=join_13, Distance=expr("-x", number_slider_59), Plane=PlaneXY(0, 0, 0), Corners=1)  # disabled
rulesrf_2 = RuledSurface(CurveA=join_13, CurveB=offset_2)  # disabled
edges_2 = BrepEdges(Brep=rulesrf_2)  # -> Naked, Interior, NonManifold; disabled
join_14 = JoinCurves(Curves=edges_2.Naked, Preserve=False)  # disabled
wbloop = WeaverbirdsLoopSubdivision(MeshCurves=join_14, Level=number_slider_60, SmoothNakedEdges=0)  # disabled
rotate = Rotate(Geometry=wbloop, Angle=1.570796327, Plane=xy_4)  # -> Geometry, Transform; disabled
rotate_2 = Rotate(Geometry=rotate.Geometry, Angle=1.570796327, Plane=xy_5)  # -> Geometry, Transform; disabled
rotate_3 = Rotate(Geometry=rotate_2.Geometry, Angle=1.570796327, Plane=xy_6)  # -> Geometry, Transform; disabled
data_61 = Data([rotate.Geometry, rotate_2.Geometry, rotate_3.Geometry, wbloop])  # disabled

# ---- group: 4 dome / Coloumn OLD / column a
extr_29 = Extrude(Base=ln_61, Direction=X_6)  # disabled

# ---- group: 4 dome / Coloumn OLD (continued)
mirror_44 = Mirror(Geometry=extr_29, Plane=yz_8)  # -> Geometry, Transform; disabled
rotate_4 = Rotate(Geometry=[mirror_44.Geometry, extr_29], Angle=1.570796327, Plane=xy_7)  # -> Geometry, Transform; disabled

# ---- group: 4 dome / Coloumn OLD / Column
mjoin_17 = MeshJoin(Meshes=[extr_29, mirror_44.Geometry])  # disabled

# ---- group: 4 dome / Arches
mjoin_18 = MeshJoin(Meshes=data_61)  # disabled

# ---- group: 4 dome / Supports / Arc support (continued)
nv_9 = NakedVertices(Mesh=mjoin_18)  # -> ClothedIndex, NakedIndex, ClothedPts, flatten(NakedPts); disabled
deconstruct_7 = Deconstruct(Point=nv_9.NakedPts)  # -> XComponent, YComponent, ZComponent; disabled
smaller = SmallerThan(FirstNumber=deconstruct_7.ZComponent, SecondNumber=panel_50)  # -> SmallerThan, OrEqualTo; disabled
cull_2 = CullPattern(List=nv_9.NakedPts, CullPattern=smaller.SmallerThan)  # disabled

# ---- group: 4 dome / Supports / col
panel_55 = Panel("1")  # disabled
cull_i = CullIndex(List=linetobeam.Points, Indices=panel_55, Wrap=True)  # -> flatten(List); disabled

# ---- group: 4 dome / Supports
rdpoints_4 = RemoveDuplicatePointsKaramba3D(Point=[dispatch_2.ListB, cull_2, cull_i], LimitDistance=0.005)  # -> OutPoint, Info, Indexes; disabled
supp_3 = SupportKaramba3D(PosInd=rdpoints_4.OutPoint, menu=[buttons(on, on, on, on, on, on)])  # disabled

# ---- group: 4 dome / Geometries (continued)
meshtoshell_9 = MeshToShellKaramba3D(Mesh=mjoin_18, Identifier=panel_53, CrossSection=cross_section_9, LimitDistance_m=0.005)  # -> Element, Points, Info; disabled

# ---- group: 4 dome / Live load 6kn
number_slider_67 = Slider(6, range=0..10)  # disabled
Z_8 = UnitZ(Factor=expr("-x", number_slider_67))  # disabled
panel_56 = Panel("1")  # disabled
loads_13 = LoadsKaramba3D(Vector=Z_8, Mesh=data_60, LCase=panel_56, mode="MeshLoad -Const.", menu=[buttons(off, on, off), buttons(on, on)])  # disabled

# ---- group: 4 dome / LC1
load_12 = LoadKaramba3D(flatten([loads_13, loads_3, loads_10, loads_11, loads_12, loads_2]))  # disabled

# ---- group: 4 dome (continued)
meshtoshell_10 = MeshToShellKaramba3D(Mesh=mjoin_17, Identifier=panel_21, CrossSection=cross_section, LimitDistance_m=0.005)  # -> Element, Points, Info; disabled
assemble_2 = AssembleModelKaramba3D(
    Elem=flatten([meshtoshell_7.Element, meshtoshell_8.Element, linetobeam.Element, meshtoshell_9.Element]),
    Support=flatten(supp_3),
    Load=load_12,
    LimitDistance_m=0.005)  # -> Model, Info, Mass_kg, CenterOfGravity; disabled
analyze_2 = AnalyzeKaramba3D(Model=assemble_2.Model)  # -> CalculatedModel, MaximumDisplacement_cm, ResultingForceOfGravity_kN, ElasticEnergy_kNm; disabled
modelview_2 = ModelViewKaramba3D(Model=analyze_2.CalculatedModel, ResultFactors=1, ResultCase=-1, Colors=[swatch_5, swatch_2, swatch_3, swatch, swatch_4])  # -> Model, DeformedMesh, DeformedAxes, DeformedModel; disabled
shellview_2 = ShellViewKaramba3D(Model=modelview_2.Model, IndexOfLayer=0)  # -> Model, MeshesOfRenderedShells, LegendColors, LegendTags; disabled
move_55 = Move(Geometry=shellview_2.MeshesOfRenderedShells, Motion=Vector(0, 20, 0))  # -> Geometry, Transform; disabled
bnd_2 = Bounds(Numbers=shellview_2.LegendTags)  # disabled
multiplication_17 = Multiplication(A=shellview_2.LegendTags, B=10)  # disabled
dedomain_2 = DeconstructDomain(Domain=bnd_2)  # -> Start, End; disabled
replace_2 = ReplaceItems(List=multiplication_17, Item=panel_23, Indices=panel_24, Wrap=False)  # disabled
legend_2 = Legend(Colour=shellview_2.LegendColors, Tags=replace_2, LegendType=1)  # disabled
max_3 = Maximum(A=flatten(dedomain_2.Start), B=dedomain_2.End)  # -> flatten(Result); disabled
min_3 = Minimum(A=flatten(dedomain_2.Start), B=dedomain_2.End)  # -> flatten(Result); disabled

multiplication_18 = Multiplication(A=min_3, B=10)  # disabled
multiplication_19 = Multiplication(A=max_3, B=10)  # disabled
data_62 = Data(analyze_2.MaximumDisplacement_cm)  # disabled

# ---- group: 4 dome / Stresses and displacement
max_4 = Panel(multiplication_19)  # disabled
min_4 = Panel(multiplication_18)  # disabled
displ_cm_2 = Panel(data_62)  # disabled

# ---- group: walls on top
medges_7 = MeshEdges(Mesh=data_44)  # -> flatten(NakedEdges), InteriorEdges, NonManifoldEdges; disabled
demesh_3 = DeconstructMesh(Mesh=data_44)  # -> flatten(Vertices), Faces, Colours, Normals; disabled
deconstruct_8 = Deconstruct(Point=demesh_3.Vertices)  # -> XComponent, YComponent, ZComponent; disabled
panel_57 = Panel("2.31")  # disabled
smaller_2 = SmallerThan(FirstNumber=deconstruct_8.ZComponent, SecondNumber=panel_57)  # -> SmallerThan, OrEqualTo; disabled
panel_58 = Panel("10")  # disabled
cull_3 = CullPattern(List=demesh_3.Vertices, CullPattern=smaller_2.OrEqualTo)  # disabled
lng = ListLength(List=cull_3)  # disabled
subtraction_2 = Subtraction(A=lng, B=2)  # disabled
division_5 = Division(A=panel_58, B=subtraction_2)  # disabled
number_slider_68 = Slider(0.42, range=0..1)  # disabled
density_in_kn_m_3_5 = Panel("15")  # disabled
panel_59 = Panel("1")  # disabled

# ---- group: walls on top / line l
len_2 = Length(Curve=medges_7.NakedEdges)  # disabled
avr_3 = Average(Input=len_2)  # disabled

# ---- group: walls on top / First floor walls points
data_63 = Data(cull_3)  # disabled

# ---- group: sandload
demesh_4 = DeconstructMesh(Mesh=data_44)  # -> flatten(Vertices), Faces, Colours, Normals; disabled
m_facearea_2 = MeshFaceArea(M=data_44)  # -> out, G, flatten(A), B; inputs M: Mesh; disabled; same code as m_facearea
pdecon_15 = Deconstruct(Point=data_47)  # -> XComponent, YComponent, ZComponent; disabled
avr_4 = Average(Input=m_facearea_2.A)  # disabled
sort_3 = SortList(Keys=pdecon_15.ZComponent, ValuesA=data_47)  # -> reverse(Keys), reverse(ValuesA); disabled
item_5 = ListItem(List=sort_3.ValuesA, Index=0, Wrap=True)  # -> flatten(Item); disabled
xy_8 = XYPlane(Origin=item_5)  # disabled
project_5 = Project(Geometry=data_47, Plane=xy_8)  # -> Geometry, Transform; disabled
dist_6 = Distance(PointA=data_47, PointB=project_5.Geometry)  # disabled
density_in_kn_m_3_6 = Panel("15")  # disabled
panel_60 = Panel("1")  # disabled

# ---- group: walls on top (continued)
xy_9 = XYPlane(Origin=item_5)  # disabled
project_6 = Project(Geometry=data_63, Plane=xy_9)  # -> Geometry, Transform; disabled
dist_7 = Distance(PointA=data_63, PointB=project_6.Geometry)  # disabled
multiplication_20 = Multiplication(A=avr_3, B=number_slider_68)  # disabled
multiplication_21 = Multiplication(A=multiplication_20, B=dist_7)  # disabled
multiplication_22 = Multiplication(A=multiplication_21, B=density_in_kn_m_3_5)  # disabled
Z_9 = UnitZ(Factor=expr("-x", multiplication_22))  # disabled
loads_14 = LoadsKaramba3D(ForceVector=Z_9, Local=False, PosInd=data_63, LCase=panel_59, mode="Point")  # disabled

# ----
multiplication_23 = Multiplication(A=avr_4, B=panel_26)  # disabled

# ---- group: sandload (continued)
multiplication_24 = Multiplication(A=dist_6, B=multiplication_23)  # disabled
multiplication_25 = Multiplication(A=multiplication_24, B=density_in_kn_m_3_6)  # disabled
Z_10 = UnitZ(Factor=expr("-x", multiplication_25))  # disabled
loads_15 = LoadsKaramba3D(ForceVector=Z_10, Local=False, PosInd=data_47, LCase=panel_60, mode="Point")  # disabled

# ---- group: LOADS lc1
load_13 = LoadKaramba3D([loads_15, loads_8, loads_14, loads_4])  # disabled

# ----
assemble_3 = AssembleModelKaramba3D(
    Elem=flatten([meshtoshell_5.Element, meshtoshell_6.Element]),
    Support=supp_2,
    Load=flatten([loads, load_13]),
    LimitDistance_m=0.005)  # -> Model, Info, Mass_kg, CenterOfGravity; disabled
analyze_3 = AnalyzeKaramba3D(Model=assemble_3.Model)  # -> CalculatedModel, flatten(MaximumDisplacement_cm), ResultingForceOfGravity_kN, ElasticEnergy_kNm; disabled
modelview_3 = ModelViewKaramba3D(
    Model=analyze_3.CalculatedModel,
    ResultFactors=1,
    ResultCase=-1,
    Colors=[swatch_7, swatch_8, swatch_6, swatch_9, swatch_10])  # -> Model, DeformedMesh, DeformedAxes, DeformedModel; disabled
shellview_3 = ShellViewKaramba3D(Model=modelview_3.Model, IndexOfLayer=0)  # -> Model, MeshesOfRenderedShells, LegendColors, LegendTags; disabled
multiplication_26 = Multiplication(A=shellview_3.LegendTags, B=10)  # disabled
move_56 = Move(Geometry=shellview_3.MeshesOfRenderedShells, Motion=Vector(0, 20, 0))  # -> Geometry, Transform; disabled
bnd_3 = Bounds(Numbers=shellview_3.LegendTags)  # disabled
replace_3 = ReplaceItems(List=multiplication_26, Item=panel_28, Indices=panel_29, Wrap=False)  # disabled
stress = Legend(Colour=shellview_3.LegendColors, Tags=replace_3, LegendType=1)  # disabled
dedomain_3 = DeconstructDomain(Domain=bnd_3)  # -> Start, End; disabled
max_5 = Maximum(A=flatten(dedomain_3.Start), B=dedomain_3.End)  # -> flatten(Result); disabled
min_5 = Minimum(A=flatten(dedomain_3.Start), B=dedomain_3.End)  # -> flatten(Result); disabled

multiplication_27 = Multiplication(A=max_5, B=10)  # disabled
multiplication_28 = Multiplication(A=min_5, B=10)  # disabled
data_64 = Data(analyze_3.MaximumDisplacement_cm)  # disabled

# ---- group: Dome Stresses and displacement
displ_cm_3 = Panel(data_64)  # disabled
max_6 = Panel(multiplication_27)  # disabled
min_6 = Panel(multiplication_28)  # disabled
