# Grasshopper definition relaxation_script.gh (Grasshopper 1.0.7)
# plug-ins: MeshEdit Components, Weaverbird, Kangaroo2 Components

# ----
# tessellation script by Konstantina Chouliara 10/10/19
# mesh definition from rhino
# dome definition
# assign circle's position
crv = Curve(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)
srf = Surface(crv)

# ----
# classroom definition
# define anchor curves
crv_2 = Curve([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])
# assign circle's position
mesh = Mesh([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])

# ----
# tessellation and welding for vault
# insert new mesh here
number_slider = Slider(0, range=0..100)
wbsplitquads = WeaverbirdsConstantQuadsSplitSubdivision(MeshCurves=mesh, Level=Slider(3, range=1..3), SmoothNakedEdges=number_slider)  # -> flatten(OutputMeshCurves)
wbjoin = WeaverbirdsJoinMeshesAndWeld(Mesh=wbsplitquads, Weld=Toggle(True))
unifynormals = MeshUnifyNormals(Mesh=wbjoin)
mesh_2 = Mesh(unifynormals)

# ----
# dynamic relaxation for vaults
# mesh to be relaxated
mesh_3 = Mesh(mesh_2)
# anchor points
crv_3 = Curve(crv_2)
medges = MeshEdges(Mesh=mesh_3)  # -> NakedEdges, InteriorEdges, NonManifoldEdges
nv = NakedVertices(Mesh=mesh_3)  # -> ClothedIndex, NakedIndex, ClothedPts, NakedPts
show = Show(G=mesh_3)
length_line = LengthLine(Line=medges.NakedEdges, Strength=10)
length_line_2 = LengthLine(Line=medges.InteriorEdges, Strength=10)
crv_cp = CurveClosestPoint(Point=nv.NakedPts, Curve=graft(crv_3))  # -> Point, Parameter, Distance
# load
number_slider_2 = Slider(0.002, range=0..10)
smaller = SmallerThan(FirstNumber=crv_cp.Distance, SecondNumber=0.1)  # -> SmallerThan, OrEqualTo
dispatch = Dispatch(List=nv.NakedPts, DispatchPattern=smaller.SmallerThan)  # -> ListA, ListB
Z = UnitZ(Factor=number_slider_2)
anchor = Anchor(Point=dispatch.ListA, Strength=10000)
load = Load(Point=[nv.ClothedPts, nv.NakedPts], ForceVector=Z)
solver = Solver(
    GoalObjects=flatten([length_line, length_line_2, show, load, anchor]),
    Reset=Button(),
    Threshold=1e-15,
    Tolerance=0.01,
    On=Toggle(False))  # -> I, V, O
mesh_4 = Mesh(solver.O)

# ----
# tessellation and welding
# tessellation and welding for library
data = Data(srf)

# ----
# different tessellation for dome
m_loop = WeightedLoopSubdivision(M=data, L=Slider(2, range=1..3), E=1, TE=1, TV=1)  # -> out, A; inputs M: Mesh, TE: list, TV: list
# ---------- m_loop: VB ----------
    Component.Params.Input(0).Name = "Mesh"
    Component.Params.Input(0).Description = "An open or closed mesh whose faces should be triangular, all quad faces will be triangulated automatically"
    Component.Params.Input(1).Name = "Loops"
    Component.Params.Input(1).Description = "The number of iterations applied to each face"
    Component.Params.Input(2).Name = "Edge Type"
    Component.Params.Input(2).Description = "0=Fixed, 1=Smooth, 2=Fixed Corners"
    Component.Params.Input(3).Name = "Edge Weight [Vertex]"
    Component.Params.Input(3).Description = "An optional list of double values which overides the percent between the existing edge midpoint and the new smoothed vertex (1=Default)"
    Component.Params.Input(4).Name = "Vertex Weight [Vertex]"
    Component.Params.Input(4).Description = "An optional list of double values which overides the percent between the existing vertex and the new smoothed vertex (1=Default)"

    Component.Params.Output(1).Name = "Mesh"
    Component.Params.Output(1).Description = "If successful, a valid mesh"

    If m IsNot Nothing Then
      Dim ma As New mesh
      Dim i,lp As Integer
      Dim txV,txE As New list(Of Double)
      Dim xV(),xE() As Double
      Dim bn As Boolean
      Dim cb As Boolean

      'input mesh to the looped mesh
      m.weld(math.pi)
      If m.Faces.QuadCount() > 0 Then m.Faces.ConvertQuadsToTriangles
      ma = m

      ' match multiplier and color values to vertex count
      xV = TV.toarray()
      xE = TE.toarray()
      For i = 0 To m.Vertices.count() - 1 Step 1
        txV.add(xV(bC(xV, i)))
        txE.add(xE(bC(xE, i)))
      Next
      xV = txV.toarray()
      xE = txE.toarray()

      bn = m.IsClosed() = False

      For lp = 0 To L - 1 Step 1

        Dim mv As Rhino.Geometry.Collections.MeshVertexList
        Dim mf As Rhino.Geometry.Collections.MeshFaceList
        Dim mfn As Rhino.Geometry.Collections.MeshFaceNormalList
        Dim mc As Rhino.Geometry.Collections.MeshVertexColorList
        Dim mte As Rhino.Geometry.Collections.MeshTopologyEdgeList
        Dim mtv As Rhino.Geometry.Collections.MeshTopologyVertexList
        Dim mnv() As Boolean
        Dim nes As New list(Of Boolean)
        Dim pv() As point3d

        If ma.VertexColors.Count() > 0 Then
          cb = True
        Else
          cb = False
          ma.VertexColors.CreateMonotoneMesh(color.LightBlue)
        End If

        mv = ma.Vertices
        mf = ma.Faces
        mfn = ma.FaceNormals
        mc = ma.VertexColors
        mte = ma.TopologyEdges
        mtv = ma.TopologyVertices

        pv = mv.ToPoint3dArray
        mnv = ma.GetNakedEdgePointStatus

        Dim vo,vt As New list(Of point3d)
        Dim fo As New list(Of MeshFace)
        Dim j,k,u,v,cf,ce,cv As Integer
        Dim fi() As Integer
        Dim p(3) As point3d
        Dim mvi(3) As Integer
        Dim rv,re As New list(Of Double)
        Dim oc As New list(Of color)

        cv = mv.count()
        ce = mte.count()
        cf = mf.count()

        'Faces
        For i = 0 To cf - 1 Step 1
          fi = mtv.IndicesFromFace(i)
          mvi(0) = mtv.MeshVertexIndices(fi(0))(0)
          mvi(1) = mtv.MeshVertexIndices(fi(1))(0)
          mvi(2) = mtv.MeshVertexIndices(fi(2))(0)

          fo.add(New meshface(mte.GetEdgeIndex(fi(0), fi(1)), mte.GetEdgeIndex(fi(1), fi(2)), mte.GetEdgeIndex(fi(2), fi(0))))

          fo.add(New meshface(mte.GetEdgeIndex(fi(0), fi(1)), ce + mvi(1), mte.GetEdgeIndex(fi(1), fi(2))))
          fo.add(New meshface(mte.GetEdgeIndex(fi(1), fi(2)), ce + mvi(2), mte.GetEdgeIndex(fi(2), fi(0))))
          fo.add(New meshface(mte.GetEdgeIndex(fi(2), fi(0)), ce + mvi(0), mte.GetEdgeIndex(fi(0), fi(1))))
        Next

        'Edges
        For i = 0 To ce - 1 Step 1
          Dim cfi() As Integer
          Dim ta,tb As New list(Of Integer)
          Dim cei As Rhino.IndexPair

          cfi = mte.GetConnectedFaces(i)
          cei = mte.GetTopologyVertices(i)
          u = mtv.MeshVertexIndices(cei.I)(0)
          v = mtv.MeshVertexIndices(cei.J)(0)
          p(0) = (pv(u) + pv(v)) / 2

          If ubound(cfi) > 0 Then
            ta = mf.GetTopologicalVertices(cfi(0)).tolist()
            ta.remove(cei.I)
            ta.remove(cei.J)

            tb = mf.GetTopologicalVertices(cfi(1)).tolist()
            tb.remove(cei.I)
            tb.remove(cei.J)

            p(1) = pv(mtv.meshvertexindices(ta(0))(0))
            p(2) = pv(mtv.meshvertexindices(tb(0))(0))
            p(3) = evalP(p(0), pv(u) * 3 / 8 + pv(v) * 3 / 8 + p(1) / 8 + p(2) / 8, (xe(u) + xe(v)) / 2)

            nes.add(False)
          Else
            p(3) = p(0)
            nes.add(True)
          End If

          vo.add(p(3))
          vt.add(p(3))
          rv.add((xV(u) + xV(v)) / 2)
          re.add((xE(u) + xE(v)) / 2)
          oc.add(avgC2(mc(u), mc(v)))
        Next

        'Vertices
        For i = 0 To cv - 1 Step 1
          Dim tvi As Integer
          Dim cvi As New list(Of Integer)
          Dim q(2) As point3d
          Dim bne As Boolean = False

          tvi = mtv.TopologyVertexIndex(i)

          mtv.SortEdges(tvi)

          cvi = mtv.ConnectedTopologyVertices(tvi).tolist()
          cvi.remove(tvi)
          k = cvi.count()

          For j = 0 To k - 1 Step 1
            u = mte.GetEdgeIndex(tvi, cvi.item(j))
            q(0) += pv(mtv.MeshVertexIndices(cvi.item(j))(0))

            If nes(u) Then
              bne = True
              q(2) += pv(mtv.MeshVertexIndices(cvi.item(j))(0))
            End If
          Next

          If bne Then
            If e = 0 Then
              q(1) = pv(i)
            ElseIf e = 2 Then
              If k = 2 Then
                q(1) = pv(i)
              Else
                q(1) = evalP(pv(i), q(2) / 2, 0.25)
              End If
            Else
              q(1) = evalP(pv(i), q(2) / 2, 0.25)
            End If
          Else
            If k = 3 Then
              q(1) = evalp(pv(i), q(0) / k, xv(i) * 9 / 16)
            Else
              q(1) = evalp(pv(i), q(0) / k, xv(i) * 3 / 8)
            End If
          End If


          vo.add(q(1))
          rv.add(xV(i))
          re.add(xE(i))
          oc.add(mc(i))

        Next

        Dim mo As New mesh
        mo.Vertices.AddVertices(vo)
        mo.Faces.AddFaces(fo)
        If cb Then mo.VertexColors.AppendColors(oc.toarray())
        mo.FaceNormals.ComputeFaceNormals()
        mo.Normals.ComputeNormals()

        ma = mo
        xV = rv.toarray()
        xE = re.toarray()

        'Loop
      Next
      A = ma
    End If
# ---------- m_loop: VB additional code ----------
  Private Function bC(ByVal arrObj() As Double, ByVal t As Integer)
    Dim intOut As Integer
    If t > uBound(arrObj) Then intOut = uBound(arrObj) Else intOut = t
    Return intOut
  End Function

  Private Function evalP(ByVal op As point3d, ByVal tp As Point3d, ByVal t As Double)
    Return New point3d(op + (tp - op) * t)
  End Function

  Private Function avgC2(ByVal c0 As color, ByVal c1 As color)
    Dim r,g,b As Integer
    r = CInt(((CInt(c0.R) + CInt(c1.R)) / 2))
    g = CInt(((CInt(c0.G) + CInt(c1.G)) / 2))
    b = CInt(((CInt(c0.B) + CInt(c1.B)) / 2))

    If R < 0 Then r = 0 Else If r > 255 Then r = 255
    If G < 0 Then g = 0 Else If r > 255 Then g = 255
    If B < 0 Then b = 0 Else If r > 255 Then b = 255

    Return color.FromArgb(r, g, b)
  End Function
# ---------- end m_loop ----------

wbjoin_2 = WeaverbirdsJoinMeshesAndWeld(Mesh=m_loop.A, Weld=Toggle(True))
unifynormals_2 = MeshUnifyNormals(Mesh=wbjoin_2)
mesh_5 = Mesh(unifynormals_2)

# ----
# dynamic relaxation for domes
# mesh to be relaxated
mesh_6 = Mesh(mesh_5)
# anchor points
crv_4 = Curve(crv)
# dynamic relaxation
medges_2 = MeshEdges(Mesh=mesh_6)  # -> NakedEdges, InteriorEdges, NonManifoldEdges
nv_2 = NakedVertices(Mesh=mesh_6)  # -> ClothedIndex, NakedIndex, ClothedPts, NakedPts
show_2 = Show(G=mesh_6)
length_line_3 = LengthLine(Line=medges_2.InteriorEdges, Strength=10)
length_line_4 = LengthLine(Line=medges_2.NakedEdges, Strength=10)
crv_cp_2 = CurveClosestPoint(Point=nv_2.NakedPts, Curve=graft(crv_4))  # -> Point, Parameter, Distance
# load
number_slider_3 = Slider(0.2, range=0..10)
smaller_2 = SmallerThan(FirstNumber=crv_cp_2.Distance, SecondNumber=0.1)  # -> SmallerThan, OrEqualTo
dispatch_2 = Dispatch(List=nv_2.NakedPts, DispatchPattern=smaller_2.SmallerThan)  # -> ListA, ListB
Z_2 = UnitZ(Factor=number_slider_3)
anchor_2 = Anchor(Point=dispatch_2.ListA, Strength=10000)
load_2 = Load(Point=[nv_2.ClothedPts, nv_2.NakedPts], ForceVector=Z_2)
solver_2 = Solver(
    GoalObjects=flatten([length_line_4, length_line_3, show_2, load_2, anchor_2]),
    Reset=Button(),
    Threshold=1e-15,
    Tolerance=0.01,
    On=Toggle(False))  # -> I, V, O
mesh_7 = Mesh(solver_2.O)
