# Grasshopper definition Creating_Coordinates_in_GH.gh (Grasshopper 1.0.7)
# plug-ins: Heteroptera, TT Toolbox

# ----
# Module Grid
srf = Surface(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)
grid = RectangleGrid(Rectangle=srf, Size="0.6")  # -> simplify(Points), U, V

branch = TreeBranch(Tree=grid.Points, Path=Slider(56, range=0..95), MaintainPaths=True)
item = ListItem(List=branch, Index=Slider(36, range=0..95), Wrap=True)  # -> flatten(Item)

branch_2 = TreeBranch(Tree=grid.Points, Path=Slider(57, range=0..95), MaintainPaths=True)
item_2 = ListItem(List=branch_2, Index=Slider(29, range=0..95), Wrap=True)  # -> flatten(Item)

branch_3 = TreeBranch(Tree=grid.Points, Path=Slider(56, range=0..95), MaintainPaths=True)
item_3 = ListItem(List=branch_3, Index=Slider(20, range=0..95), Wrap=True)  # -> flatten(Item)

branch_4 = TreeBranch(Tree=grid.Points, Path=Slider(33, range=0..95), MaintainPaths=True)
item_4 = ListItem(List=branch_4, Index=Slider(17, range=0..95), Wrap=True)  # -> flatten(Item)

branch_5 = TreeBranch(Tree=grid.Points, Path=Slider(71, range=0..95), MaintainPaths=True)
item_5 = ListItem(List=branch_5, Index=Slider(17, range=0..95), Wrap=True)  # -> flatten(Item)

branch_6 = TreeBranch(Tree=grid.Points, Path=Slider(71, range=0..95), MaintainPaths=True)
item_6 = ListItem(List=branch_6, Index=Slider(12, range=0..95), Wrap=True)  # -> flatten(Item)

branch_7 = TreeBranch(Tree=grid.Points, Path=Slider(84, range=0..95), MaintainPaths=True)
item_7 = ListItem(List=branch_7, Index=Slider(14, range=0..95), Wrap=True)  # -> flatten(Item)

branch_8 = TreeBranch(Tree=grid.Points, Path=Slider(71, range=0..95), MaintainPaths=True)
item_8 = ListItem(List=branch_8, Index=Slider(52, range=0..95), Wrap=True)  # -> flatten(Item)

# ----
# Position
branch_9 = TreeBranch(Tree=grid.Points, Path=Slider(88, range=0..95), MaintainPaths=True)
item_9 = ListItem(List=branch_9, Index=Slider(37, range=0..95), Wrap=True)  # -> flatten(Item)

branch_10 = TreeBranch(Tree=grid.Points, Path=Slider(84, range=0..95), MaintainPaths=True)
item_10 = ListItem(List=branch_10, Index=Slider(46, range=0..95), Wrap=True)  # -> flatten(Item)

branch_11 = TreeBranch(Tree=grid.Points, Path=Slider(84, range=0..95), MaintainPaths=True)
# Wall Thickness
# Wall Thickness
item_11 = ListItem(List=branch_11, Index=Slider(57, range=0..95), Wrap=True)  # -> flatten(Item)

branch_12 = TreeBranch(Tree=grid.Points, Path=Slider(88, range=0..95), MaintainPaths=True)
# Tower 1
item_12 = ListItem(List=branch_12, Index=Slider(73, range=0..95), Wrap=True)  # -> flatten(Item)

branch_13 = TreeBranch(Tree=grid.Points, Path=Slider(61, range=0..95), MaintainPaths=True)
item_13 = ListItem(List=branch_13, Index=Slider(57, range=0..95), Wrap=True)  # -> flatten(Item)

branch_14 = TreeBranch(Tree=grid.Points, Path=Slider(66, range=0..95), MaintainPaths=True)
# Wall Thickness
# Gallery 2
# Wall Thickness
item_14 = ListItem(List=branch_14, Index=Slider(62, range=0..95), Wrap=True)  # -> flatten(Item)

branch_15 = TreeBranch(Tree=grid.Points, Path=Slider(66, range=0..95), MaintainPaths=True)
# Wall Thickness
# Stair Tower
item_15 = ListItem(List=branch_15, Index=Slider(47, range=0..95), Wrap=True)  # -> flatten(Item)

branch_16 = TreeBranch(Tree=grid.Points, Path=Slider(56, range=0..95), MaintainPaths=True)
# Wall Thickness
# Admin
item_16 = ListItem(List=branch_16, Index=Slider(41, range=0..95), Wrap=True)  # -> flatten(Item)

branch_17 = TreeBranch(Tree=grid.Points, Path=Slider(48, range=0..95), MaintainPaths=True)
# Wall Thickness
item_17 = ListItem(List=branch_17, Index=Slider(41, range=0..95), Wrap=True)  # -> flatten(Item)

branch_18 = TreeBranch(Tree=grid.Points, Path=Slider(45, range=0..95), MaintainPaths=True)
# Wall Thickness
item_18 = ListItem(List=branch_18, Index=Slider(41, range=0..95), Wrap=True)  # -> flatten(Item)

branch_19 = TreeBranch(Tree=grid.Points, Path=Slider(45, range=0..95), MaintainPaths=True)
# Wall Thickness
item_19 = ListItem(List=branch_19, Index=Slider(36, range=0..95), Wrap=True)  # -> flatten(Item)

merge = Merge(
    Data1=item_9,
    Data2=item_10,
    Data3=item_11,
    Data4=item_13,
    Data5=item_14,
    Data6=item_12,
    Data7=item_15,
    Data8=item_16,
    Data9=item_17,
    Data10=item_18,
    Data11=item_19,
    Data12=item,
    Data13=item_2,
    Data14=item_3,
    Data15=item_4,
    Data16=item_5,
    Data17=item_6,
    Data18=item_7,
    Data19=item_8)
pdecon = Deconstruct(Point=merge)  # -> graft(XComponent), graft(YComponent), graft(ZComponent)
# Meshing the Ground Floors
# Meshing the Courtyards
writexl = WriteToExcel(
    Run=Toggle(True),
    ExcelWorksheet="Gridpoints",
    WriteOptions="None",
    ColumnnsOrRows=True,
    DataToWriteIntoColumns=[pdecon.XComponent, pdecon.YComponent, pdecon.ZComponent])
