# Grasshopper definition Meshing_by_Python.gh (Grasshopper 1.0.7)
# plug-ins: Heteroptera, Pufferfish, LunchBox

# ----
# Script - Meshing by Python
# Written by Bart van Nimwegen - October 11th, 2019
# Instead of using Grasshopper to make the meshes of the rooms, it was decided that this could be done better with Python. This makes it easier to work witht the Architectual model we made. A 2d mesh of 1,2 meters squared. For the Python script, this mesh is further reduced to 0.6 by 0.6 meters. With the Python script,this tile has been used to build up all the rooms in the castle.
# 
# The correct positions and dimensions of each room are imported from excel sheets, made in an ealier stage of the proces
# Import Excel
panel = Panel("C:\Users\Bart van Nimwegen\Documents\TU Delft\MSc\MSc 3\Week 6\Final_12102019_Bart\ExcelPythonGrids.xlsx")
toggle = BooleanToggle(True)
txt = Text("GridpointsGroundFloor")
txt_2 = Text(panel)
excelread = ExcelReader(ReadExcelData=toggle, WorkbookPath=txt_2, WorksheetName=txt)  # -> Exceptions, ExcelData

# ----
# Buildings
# Import Excel
panel_2 = Panel("C:\Users\Bart van Nimwegen\Documents\TU Delft\MSc\MSc 3\Week 6\Final_12102019_Bart\ExcelPythonGrids.xlsx")
toggle_2 = BooleanToggle(True)
txt_3 = Text("GridpointsFirstFloor")
txt_4 = Text(panel_2)
excelread_2 = ExcelReader(ReadExcelData=toggle_2, WorkbookPath=txt_4, WorksheetName=txt_3)  # -> Exceptions, ExcelData

# ----
# Import Excel
panel_3 = Panel("C:\Users\Bart van Nimwegen\Documents\TU Delft\MSc\MSc 3\Week 6\Final_12102019_Bart\PoR_for_Python.xlsx")
panel_4 = Panel("""1
2
3""")
txt_5 = Text("GroundFloor")
txt_6 = Text(panel_3)
excelread_3 = ExcelReader(ReadExcelData=toggle, WorkbookPath=txt_6, WorksheetName=txt_5)  # -> Exceptions, ExcelData

# ----
# Import Excel
panel_5 = Panel("C:\Users\Bart van Nimwegen\Documents\TU Delft\MSc\MSc 3\Week 6\Final_12102019_Bart\PoR_for_Python.xlsx")
panel_6 = Panel("""1
2
3""")
txt_7 = Text("FirstFloor")
txt_8 = Text(panel_5)
excelread_4 = ExcelReader(ReadExcelData=toggle_2, WorkbookPath=txt_8, WorksheetName=txt_7)  # -> Exceptions, ExcelData

# ----
# Walls
crv = Curve([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])
len = Length(Curve=crv)
division = Division(A=len, B=0.6)
divide = DivideCurve(Curve=crv, Count=division, Kinks=False)  # -> flatten(Points), Tangents, Parameters
sqr = Square(Value="0.6")
consarearec = ConstrainedAreaRectangle(Plane=divide.Points, Area=sqr, FactorX="0.6", FactorY="0.6")  # -> Rectangle, DimensionX, DimensionY
mesh = MeshBrep(
    Brep=consarearec.Rectangle,
    Settings={GridMaxCount=0, GridMinCount=16, JaggedSeams=False, MaxEdgeLength=0, MinEdgeLength=0.0001, MinTolerance=0, Refine=True, RefineAngle=0, RelativeTolerance=0.65, SimplePlanes=True, Tolerance=0})

crv_2 = Curve(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)
len_2 = Length(Curve=crv_2)
division_2 = Division(A=len_2, B=0.6)
divide_2 = DivideCurve(Curve=crv_2, Count=division_2, Kinks=False)  # -> flatten(Points), Tangents, Parameters
sqr_2 = Square(Value="0.6")
consarearec_2 = ConstrainedAreaRectangle(Plane=divide_2.Points, Area=sqr_2, FactorX="0.6", FactorY="0.6")  # -> Rectangle, DimensionX, DimensionY
mesh_2 = MeshBrep(
    Brep=consarearec_2.Rectangle,
    Settings={GridMaxCount=0, GridMinCount=16, JaggedSeams=False, MaxEdgeLength=0, MinEdgeLength=0.0001, MinTolerance=0, Refine=True, RefineAngle=0, RelativeTolerance=0.65, SimplePlanes=True, Tolerance=0})

crv_3 = Curve([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])
len_3 = Length(Curve=crv_3)
division_3 = Division(A=len_3, B=0.6)
divide_3 = DivideCurve(Curve=crv_3, Count=division_3, Kinks=False)  # -> flatten(Points), Tangents, Parameters
sqr_3 = Square(Value="0.6")
consarearec_3 = ConstrainedAreaRectangle(Plane=divide_3.Points, Area=sqr_3, FactorX="0.6", FactorY="0.6")  # -> Rectangle, DimensionX, DimensionY
mesh_3 = MeshBrep(
    Brep=consarearec_3.Rectangle,
    Settings={GridMaxCount=0, GridMinCount=16, JaggedSeams=False, MaxEdgeLength=0, MinEdgeLength=0.0001, MinTolerance=0, Refine=True, RefineAngle=0, RelativeTolerance=0.65, SimplePlanes=True, Tolerance=0})

crv_4 = Curve([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])
len_4 = Length(Curve=crv_4)
division_4 = Division(A=len_4, B=0.6)
divide_4 = DivideCurve(Curve=crv_4, Count=division_4, Kinks=False)  # -> flatten(Points), Tangents, Parameters
sqr_4 = Square(Value="0.6")
consarearec_4 = ConstrainedAreaRectangle(Plane=divide_4.Points, Area=sqr_4, FactorX="0.6", FactorY="0.6")  # -> Rectangle, DimensionX, DimensionY
mesh_4 = MeshBrep(
    Brep=consarearec_4.Rectangle,
    Settings={GridMaxCount=0, GridMinCount=16, JaggedSeams=False, MaxEdgeLength=0, MinEdgeLength=0.0001, MinTolerance=0, Refine=True, RefineAngle=0, RelativeTolerance=0.65, SimplePlanes=True, Tolerance=0})

# ----
# Grid
# Castle Courtyards
srf = Surface(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)
grid = RectangleGrid(Rectangle=srf, Size="0.6")  # -> simplify(flatten(Points)), U, V

module_size = Panel("0.6")
# Module
rectangle = Rectangle(Plane=grid.Points, XSize=module_size, YSize=module_size, Radius=0)  # -> Rectangle, Length
mesh_plane = MeshPlane(Boundary=rectangle.Rectangle, WidthCount=1, HeightCount=1)  # -> Mesh, Area
area = Area(Geometry=mesh_plane.Mesh)  # -> Area, Centroid

Z = UnitZ(Factor="5.4")
Z_2 = UnitZ(Factor="10.2")

# ----
# Cleaning Data Tree
item = ListItem(List=excelread_4.ExcelData, Index=panel_6, Wrap=True)
len_5 = TextLength(Text=item)
expression = Expression(x=len_5, Expression="if(x=0,False,True)")
cull = CullPattern(List=item, CullPattern=expression)
clean = CleanTree(RemoveNulls=True, RemoveInvalid=True, RemoveEmpty=True, Tree=cull)
split = SplitTree(Data=clean, Masks=flatten("{0}"))  # -> Positive, Negative
num = Number(split.Negative)
item_2 = ListItem(List=num, Index=0, Wrap=True)  # -> Item, Item1, Item2, Item3, Item4, Item5

# ----
# Cleaning Data Tree
item_3 = ListItem(List=excelread_3.ExcelData, Index=panel_4, Wrap=True)
len_6 = TextLength(Text=item_3)
expression_2 = Expression(x=len_6, Expression="if(x=0,False,True)")
cull_2 = CullPattern(List=item_3, CullPattern=expression_2)
clean_2 = CleanTree(RemoveNulls=True, RemoveInvalid=True, RemoveEmpty=True, Tree=cull_2)
split_2 = SplitTree(Data=clean_2, Masks=flatten("{0}"))  # -> Positive, Negative
num_2 = Number(split_2.Negative)
item_4 = ListItem(List=num_2, Index=0, Wrap=True)  # -> Item, Item1, Item2, Item3, Item4, Item5

move = Move(Geometry=mesh, Motion=Z)  # -> Geometry, Transform
move_2 = Move(Geometry=mesh_2, Motion=Z_2)  # -> Geometry, Transform
# First Floor Walls
mesh_5 = Mesh(flatten(move.Geometry))
# Ground Floor Walls
mesh_6 = Mesh(mesh_4)
# Castle Walls
mesh_7 = Mesh(mesh_3)

crv_5 = Curve([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])
srf_2 = Surface(graft(crv_5))
Z_3 = UnitZ(Factor=1)
# Courtyard Modules
extr = Extrude(Base=srf_2, Direction=Z_3)
brepinc = PointInBrep(Brep=extr, Point=area.Centroid, Strict=False)
cull_3 = CullPattern(List=area.Centroid, CullPattern=brepinc)
sqr_5 = Square(Value="0.6")
consarearec_5 = ConstrainedAreaRectangle(Plane=cull_3, Area=sqr_5, FactorX="0.6", FactorY="0.6")  # -> Rectangle, DimensionX, DimensionY
mesh_8 = MeshBrep(
    Brep=consarearec_5.Rectangle,
    Settings={GridMaxCount=0, GridMinCount=16, JaggedSeams=False, MaxEdgeLength=0, MinEdgeLength=0.0001, MinTolerance=0, Refine=True, RefineAngle=0, RelativeTolerance=0.65, SimplePlanes=True, Tolerance=0})  # -> simplify(Mesh)

# ----
# Extract Coordinates
panel_7 = Panel("0")
branch = TreeBranch(Tree=excelread.ExcelData, Path=panel_7, MaintainPaths=True)
branch_2 = TreeBranch(Tree=excelread.ExcelData, Path="1", MaintainPaths=True)
branch_3 = TreeBranch(Tree=excelread.ExcelData, Path="2", MaintainPaths=True)
join = TextJoin(Text=branch, Join=",")
join_2 = TextJoin(Text=branch_2, Join=",")
join_3 = TextJoin(Text=branch_3, Join=",")

# ----
# Extract Coordinates
panel_8 = Panel("0")
branch_4 = TreeBranch(Tree=excelread_2.ExcelData, Path=panel_8, MaintainPaths=True)
branch_5 = TreeBranch(Tree=excelread_2.ExcelData, Path="1", MaintainPaths=True)
branch_6 = TreeBranch(Tree=excelread_2.ExcelData, Path="2", MaintainPaths=True)
join_4 = TextJoin(Text=branch_4, Join=",")
join_5 = TextJoin(Text=branch_5, Join=",")
join_6 = TextJoin(Text=branch_6, Join=",")

dim_room_x = Number(flatten(item_4.Item3))
dim_room_y = Number(flatten(item_4.Item4))
dim_room_z = Number(flatten(item_4.Item5))
# Define Dimensions
panel_9 = Panel(",")
# Make Python List
lng = ListLength(List=dim_room_x)
join_7 = TextJoin(Text=dim_room_x, Join=panel_9)
join_8 = TextJoin(Text=dim_room_y, Join=panel_9)
join_9 = TextJoin(Text=dim_room_z, Join=panel_9)

dim_room_y_2 = Number(flatten(item_2.Item4))
dim_room_z_2 = Number(flatten(item_2.Item5))
dim_room_x_2 = Number(flatten(item_2.Item3))
# Define Dimensions
panel_10 = Panel(",")
lng_2 = ListLength(List=dim_room_x_2)
join_10 = TextJoin(Text=dim_room_x_2, Join=panel_10)
join_11 = TextJoin(Text=dim_room_y_2, Join=panel_10)
join_12 = TextJoin(Text=dim_room_z_2, Join=panel_10)

branch_7 = TreeBranch(Tree=mesh_8, Path="0", MaintainPaths=True)
branch_8 = TreeBranch(Tree=mesh_8, Path="1", MaintainPaths=True)
branch_9 = TreeBranch(Tree=mesh_8, Path="2", MaintainPaths=True)

# ----
# Origin Plane
xy = XYPlane(Origin=Point(0, 0, 0))
pt = Point(xy)

# ----
# Origin Plane
xy_2 = XYPlane(Origin=Point(0, 0, 0))
pt_2 = Point(xy_2)

Z_4 = UnitZ(Factor="-1.2")

module_size_2 = Panel("0.6")
# Module
rectangle_2 = Rectangle(Plane=pt, XSize=module_size_2, YSize=module_size_2, Radius=0)  # -> Rectangle, Length
mesh_plane_2 = MeshPlane(Boundary=rectangle_2.Rectangle, WidthCount=1, HeightCount=1)  # -> Mesh, Area

module_size_3 = Panel("0.6")
# Module
rectangle_3 = Rectangle(Plane=pt_2, XSize=module_size_3, YSize=module_size_3, Radius=0)  # -> Rectangle, Length
mesh_plane_3 = MeshPlane(Boundary=rectangle_3.Rectangle, WidthCount=1, HeightCount=1)  # -> Mesh, Area

move_3 = Move(Geometry=branch_8, Motion=Z_4)  # -> Geometry, Transform
move_4 = Move(Geometry=branch_9, Motion=Z_4)  # -> Geometry, Transform
winter_room_courtyard = Mesh(move_4.Geometry)
library_courtyard = Mesh(move_3.Geometry)
public_courtyard = Mesh(branch_7)
# Creating Building Meshes
ghpython_script = GhPythonScript(
    number_buildings=lng,
    origin_point=pt,
    Mesh_Tile=mesh_plane_2.Mesh,
    x=join,
    y=join_2,
    z=join_3,
    tile_dim=module_size_2,
    Dim_Room_x=join_7,
    Dim_Room_y=join_8,
    Dim_Room_z=join_9)  # -> mesh_floor, mesh_roof, mesh_edge_X, mesh_edge_Y, mesh_wall_X, mesh_wall_Y; inputs Mesh_Tile: Mesh
# ---------- ghpython_script: Python ----------
#Script - Meshing by Python
#Written by Bart van Nimwegen - October 11th, 2019

#Instead of using Grasshopper to make the meshes of the rooms, it was decided that this could be done better with Python. 
#This makes it easier to work witht the Architectual model we made. A 2d mesh of 1,2 meters squared. For the Python script,
#this mesh is further reduced to 0.6 by 0.6 meters. With the Python script,this tile has been used to build up all the rooms 
#in the castle. 

#The correct positions and dimensions of each room are imported from excel sheets, made in an ealier stage of the proces


import Rhino
import Rhino.Geometry as rg
import math as math
import rhinoscriptsyntax as rs


#INPUT LISTS

#COORDINATES
list_x=x.split(',')
list_y=y.split(',')
list_z=z.split(',')

#ROOM DIMENSIONS
list_Dim_Room_x=Dim_Room_x.split(',')
list_Dim_Room_y=Dim_Room_y.split(',')
list_Dim_Room_z=Dim_Room_z.split(',')

#CREATE COORDINATES ORIGIN POINT
start_point=rs.CreatePoint(origin_point)
number_of_buildings = int(number_buildings)
start_x = start_point[0]
start_y = start_point[1]
start_z = start_point[2]

#CREATE LISTS
tiles_floor=[]
tiles_roof=[]
tiles_row_XZ=[]
tiles_row_YZ=[]
tiles_wall_XZ=[]
tiles_wall_YZ=[]

#BODY

#FOR LOOP --> CREATE DIFFERENT BUILDINGS
for a in range (0,number_of_buildings):
    
    #COORDINATES FOR EACH BUILDING
    i=float(list_x[a])
    j=float(list_y[a])
    k=float(list_z[a])
    
    #CREATE MODULE
    tile_dimension=float(tile_dim)
    room_x=float(list_Dim_Room_x[a])
    room_y=float(list_Dim_Room_y[a])
    room_z=float(list_Dim_Room_z[a])
    
    x_modules = int((room_x/tile_dimension))
    y_modules = int((room_y/tile_dimension))
    z_modules = int((room_z/tile_dimension)+(k+0.6))
    print (z_modules)
    
    #PLACING FIRST TILE OF EACH BUILIDNG ON THE RIGHT PLACE
    start_tile=Mesh_Tile.Duplicate()
    start_vector=rg.Vector3d(i-start_x,j-start_y,k-start_z)
    translateTransformstart=rg.Transform.Translation(start_vector)
    start_tile.Transform(translateTransformstart)
    
    
    #CREATE FLOOR BY DUPLICATING START TILE
    for l in range(0, x_modules):
        for m in range(0, y_modules):
            tile_floor=start_tile.Duplicate()
            Xdist =  l*tile_dimension
            Ydist =  m*tile_dimension
            shiftVectorXY=rg.Vector3d(Xdist,Ydist,0)
            translateTransformXY=rg.Transform.Translation(shiftVectorXY)
            tile_floor.Transform(translateTransformXY)
            tiles_floor.append(tile_floor)
    
    #CREATE THE DESIRED CEILING HEIGHT
    tile_ceiling = start_tile.Duplicate()
    shiftVectorZ=rg.Vector3d(0,0,room_z)
    translateTransformZ=rg.Transform.Translation(shiftVectorZ)
    tile_ceiling.Transform(translateTransformZ)
    
    #CREATE CEILING BY DUPLICATING START TILE
    for q in range(0, x_modules):
        for r in range(0, y_modules):
            tile_XY=tile_ceiling.Duplicate()
            Xdist =  q*tile_dimension
            Ydist =  r*tile_dimension
            shiftVectorXY=rg.Vector3d(Xdist,Ydist,0)
            translateTransformXY=rg.Transform.Translation(shiftVectorXY)
            tile_XY.Transform(translateTransformXY)
            tiles_roof.append(tile_XY)
    
    #ROTATE THE START TILE OVER THE Y AXIX
    rotation_center_x = rg.Point3d(i,j,k+room_z)
    Mesh_Tile_XZ=tile_ceiling.Duplicate()
    rotationAxisX=rg.Vector3d(1,0,0)
    Mesh_Tile_XZ.Rotate(-0.5*math.pi,rotationAxisX,rotation_center_x)
    
    #CREATING THE EDGE TILES
    for u in range(x_modules):
        
        #DUPLICATE THE ROTATED TILE ALONG THE Y EDGE OF THE CEILING
        tile_XZ = Mesh_Tile_XZ.Duplicate()
        Xdist_walls =  u*tile_dimension
        shiftVectorX=rg.Vector3d(Xdist_walls,0,0)
        translateTransformX=rg.Transform.Translation(shiftVectorX)
        tile_XZ.Transform(translateTransformX)
        tiles_row_XZ.append(tile_XZ)
        
        #DUPLICATE TILES TO OTHER SIDE OF THE CEILING
        tile_XZ_2=tile_XZ.Duplicate()
        shiftVectorX_walls=rg.Vector3d(0,room_y,0)
        translateTransformX_walls=rg.Transform.Translation(shiftVectorX_walls)
        tile_XZ_2.Transform(translateTransformX_walls)
        tiles_row_XZ.append(tile_XZ_2)
        
        #DUPLICATE THE EDGE TILES AND MOVE DOWN TO CREATE THE WALLS
        for x in range(1,z_modules):
            tile_XZ_wall=tile_XZ.Duplicate()
            Zdist_walls = (x*tile_dimension)
            shiftVectorZ_walls=rg.Vector3d(0,0,-Zdist_walls)
            translateTransformZ_walls=rg.Transform.Translation(shiftVectorZ_walls)
            tile_XZ_wall.Transform(translateTransformZ_walls)
            tiles_wall_XZ.append(tile_XZ_wall)
            
        for y in range(1,z_modules):
            tile_XZ_wall_2=tile_XZ_2.Duplicate()
            Zdist_walls_2 = (y*tile_dimension)
            shiftVectorZ_walls_2=rg.Vector3d(0,0,-Zdist_walls_2)
            translateTransformZ_walls_2=rg.Transform.Translation(shiftVectorZ_walls_2)
            tile_XZ_wall_2.Transform(translateTransformZ_walls_2)
            tiles_wall_XZ.append(tile_XZ_wall_2)
    
    #ROTATE THE START TILE OVER THE X AXIX
    Mesh_Tile_YZ=tile_ceiling.Duplicate()
    rotationAxisY=rg.Vector3d(0,1,0)
    Mesh_Tile_YZ.Rotate(0.5*math.pi,rotationAxisY,rotation_center_x)
    
    #DUPLICATE THE ROTATED TILE ALONG THE X EDGE OF THE CEILING
    for v in range (y_modules):
        
        #DUPLICATE THE ROTATED TILE ALONG THE Y EDGE OF THE CEILING
        tile_YZ = Mesh_Tile_YZ.Duplicate()
        Ydist_walls = v*tile_dimension
        shiftVectorY=rg.Vector3d(0,Ydist_walls,0)
        translateTransformY=rg.Transform.Translation(shiftVectorY)
        tile_YZ.Transform(translateTransformY)
        tiles_row_YZ.append(tile_YZ)
        
        #DUPLICATE TILES TO OTHER SIDE OF THE CEILING
        tile_YZ_2=tile_YZ.Duplicate()
        shiftVectorY_walls=rg.Vector3d(room_x,0,0)
        translateTransformY_walls=rg.Transform.Translation(shiftVectorY_walls)
        tile_YZ_2.Transform(translateTransformY_walls)
        tiles_row_YZ.append(tile_YZ_2)
        
        #DUPLICATE THE EDGE TILES AND MOVE DOWN TO CREATE THE WALLS
        for x in range(1,z_modules):
            tile_YZ_wall=tile_YZ.Duplicate()
            Zdist_walls = (x*tile_dimension)
            shiftVectorZ_walls=rg.Vector3d(0,0,-Zdist_walls)
            translateTransformZ_walls=rg.Transform.Translation(shiftVectorZ_walls)
            tile_YZ_wall.Transform(translateTransformZ_walls)
            tiles_wall_YZ.append(tile_YZ_wall)
            
        for y in range(1,z_modules):
            tile_YZ_wall_2=tile_YZ_2.Duplicate()
            Zdist_walls_2 = (y*tile_dimension)
            shiftVectorZ_walls_2=rg.Vector3d(0,0,-Zdist_walls_2)
            translateTransformZ_walls_2=rg.Transform.Translation(shiftVectorZ_walls_2)
            tile_YZ_wall_2.Transform(translateTransformZ_walls_2)
            tiles_wall_YZ.append(tile_YZ_wall_2)


#OUTPUTS
mesh_floor = tiles_floor
mesh_roof = tiles_roof
mesh_edge_X=tiles_row_XZ
mesh_edge_Y=tiles_row_YZ
mesh_wall_X=tiles_wall_XZ
mesh_wall_Y=tiles_wall_YZ
# ---------- end ghpython_script ----------
# Creating Building Meshes
ghpython_script_2 = GhPythonScript(
    number_buildings=lng_2,
    origin_point=pt_2,
    Mesh_Tile=mesh_plane_3.Mesh,
    x=join_4,
    y=join_5,
    z=join_6,
    tile_dim=module_size_3,
    Dim_Room_x=join_10,
    Dim_Room_y=join_11,
    Dim_Room_z=join_12)  # -> mesh_floor, mesh_roof, mesh_edge_X, mesh_edge_Y, mesh_wall_X, mesh_wall_Y; inputs Mesh_Tile: Mesh
# ---------- ghpython_script_2: Python ----------
import Rhino
import Rhino.Geometry as rg
import math as math
import rhinoscriptsyntax as rs


#INPUT LISTS

#COORDINATES
list_x=x.split(',')
list_y=y.split(',')
list_z=z.split(',')

#ROOM DIMENSIONS
list_Dim_Room_x=Dim_Room_x.split(',')
list_Dim_Room_y=Dim_Room_y.split(',')
list_Dim_Room_z=Dim_Room_z.split(',')

#CREATE COORDINATES ORIGIN POINT
start_point=rs.CreatePoint(origin_point)
number_of_buildings = int(number_buildings)
start_x = start_point[0]
start_y = start_point[1]
start_z = start_point[2]

#CREATE LISTS
tiles_floor=[]
tiles_roof=[]
tiles_row_XZ=[]
tiles_row_YZ=[]
tiles_wall_XZ=[]
tiles_wall_YZ=[]

#BODY

#FOR LOOP --> CREATE DIFFERENT BUILDINGS
for a in range (0,number_of_buildings):
    
    #COORDINATES FOR EACH BUILDING
    i=float(list_x[a])
    j=float(list_y[a])
    k=float(list_z[a])
    
    #CREATE MODULE
    tile_dimension=float(tile_dim)
    room_x=float(list_Dim_Room_x[a])
    room_y=float(list_Dim_Room_y[a])
    room_z=float(list_Dim_Room_z[a])
    
    x_modules = int((room_x/tile_dimension))
    y_modules = int((room_y/tile_dimension))
    z_modules = int((room_z/tile_dimension))
    
    #PLACING FIRST TILE OF EACH BUILIDNG ON THE RIGHT PLACE
    start_tile=Mesh_Tile.Duplicate()
    start_vector=rg.Vector3d(i-start_x,j-start_y,k-start_z)
    translateTransformstart=rg.Transform.Translation(start_vector)
    start_tile.Transform(translateTransformstart)
    
    
    #CREATE FLOOR BY DUPLICATING START TILE
    for l in range(0, x_modules):
        for m in range(0, y_modules):
            tile_floor=start_tile.Duplicate()
            Xdist =  l*tile_dimension
            Ydist =  m*tile_dimension
            shiftVectorXY=rg.Vector3d(Xdist,Ydist,0)
            translateTransformXY=rg.Transform.Translation(shiftVectorXY)
            tile_floor.Transform(translateTransformXY)
            tiles_floor.append(tile_floor)
    
    #CREATE THE DESIRED CEILING HEIGHT
    tile_ceiling = start_tile.Duplicate()
    shiftVectorZ=rg.Vector3d(0,0,room_z)
    translateTransformZ=rg.Transform.Translation(shiftVectorZ)
    tile_ceiling.Transform(translateTransformZ)
    
    #CREATE CEILING BY DUPLICATING START TILE
    for q in range(0, x_modules):
        for r in range(0, y_modules):
            tile_XY=tile_ceiling.Duplicate()
            Xdist =  q*tile_dimension
            Ydist =  r*tile_dimension
            shiftVectorXY=rg.Vector3d(Xdist,Ydist,0)
            translateTransformXY=rg.Transform.Translation(shiftVectorXY)
            tile_XY.Transform(translateTransformXY)
            tiles_roof.append(tile_XY)
    
    #ROTATE THE START TILE OVER THE Y AXIX
    rotation_center_x = rg.Point3d(i,j,k+room_z)
    Mesh_Tile_XZ=tile_ceiling.Duplicate()
    rotationAxisX=rg.Vector3d(1,0,0)
    Mesh_Tile_XZ.Rotate(-0.5*math.pi,rotationAxisX,rotation_center_x)
    
    #CREATING THE EDGE TILES
    for u in range(x_modules):
        
        #DUPLICATE THE ROTATED TILE ALONG THE Y EDGE OF THE CEILING
        tile_XZ = Mesh_Tile_XZ.Duplicate()
        Xdist_walls =  u*tile_dimension
        shiftVectorX=rg.Vector3d(Xdist_walls,0,0)
        translateTransformX=rg.Transform.Translation(shiftVectorX)
        tile_XZ.Transform(translateTransformX)
        tiles_row_XZ.append(tile_XZ)
        
        #DUPLICATE TILES TO OTHER SIDE OF THE CEILING
        tile_XZ_2=tile_XZ.Duplicate()
        shiftVectorX_walls=rg.Vector3d(0,room_y,0)
        translateTransformX_walls=rg.Transform.Translation(shiftVectorX_walls)
        tile_XZ_2.Transform(translateTransformX_walls)
        tiles_row_XZ.append(tile_XZ_2)
        
        #DUPLICATE THE EDGE TILES AND MOVE DOWN TO CREATE THE WALLS
        for x in range(1,z_modules):
            tile_XZ_wall=tile_XZ.Duplicate()
            Zdist_walls = (x*tile_dimension)
            shiftVectorZ_walls=rg.Vector3d(0,0,-Zdist_walls)
            translateTransformZ_walls=rg.Transform.Translation(shiftVectorZ_walls)
            tile_XZ_wall.Transform(translateTransformZ_walls)
            tiles_wall_XZ.append(tile_XZ_wall)
            
        for y in range(1,z_modules):
            tile_XZ_wall_2=tile_XZ_2.Duplicate()
            Zdist_walls_2 = (y*tile_dimension)
            shiftVectorZ_walls_2=rg.Vector3d(0,0,-Zdist_walls_2)
            translateTransformZ_walls_2=rg.Transform.Translation(shiftVectorZ_walls_2)
            tile_XZ_wall_2.Transform(translateTransformZ_walls_2)
            tiles_wall_XZ.append(tile_XZ_wall_2)
    
    #ROTATE THE START TILE OVER THE X AXIX
    Mesh_Tile_YZ=tile_ceiling.Duplicate()
    rotationAxisY=rg.Vector3d(0,1,0)
    Mesh_Tile_YZ.Rotate(0.5*math.pi,rotationAxisY,rotation_center_x)
    
    #DUPLICATE THE ROTATED TILE ALONG THE X EDGE OF THE CEILING
    for v in range (y_modules):
        
        #DUPLICATE THE ROTATED TILE ALONG THE Y EDGE OF THE CEILING
        tile_YZ = Mesh_Tile_YZ.Duplicate()
        Ydist_walls = v*tile_dimension
        shiftVectorY=rg.Vector3d(0,Ydist_walls,0)
        translateTransformY=rg.Transform.Translation(shiftVectorY)
        tile_YZ.Transform(translateTransformY)
        tiles_row_YZ.append(tile_YZ)
        
        #DUPLICATE TILES TO OTHER SIDE OF THE CEILING
        tile_YZ_2=tile_YZ.Duplicate()
        shiftVectorY_walls=rg.Vector3d(room_x,0,0)
        translateTransformY_walls=rg.Transform.Translation(shiftVectorY_walls)
        tile_YZ_2.Transform(translateTransformY_walls)
        tiles_row_YZ.append(tile_YZ_2)
        
        #DUPLICATE THE EDGE TILES AND MOVE DOWN TO CREATE THE WALLS
        for x in range(1,z_modules):
            tile_YZ_wall=tile_YZ.Duplicate()
            Zdist_walls = (x*tile_dimension)
            shiftVectorZ_walls=rg.Vector3d(0,0,-Zdist_walls)
            translateTransformZ_walls=rg.Transform.Translation(shiftVectorZ_walls)
            tile_YZ_wall.Transform(translateTransformZ_walls)
            tiles_wall_YZ.append(tile_YZ_wall)
            
        for y in range(1,z_modules):
            tile_YZ_wall_2=tile_YZ_2.Duplicate()
            Zdist_walls_2 = (y*tile_dimension)
            shiftVectorZ_walls_2=rg.Vector3d(0,0,-Zdist_walls_2)
            translateTransformZ_walls_2=rg.Transform.Translation(shiftVectorZ_walls_2)
            tile_YZ_wall_2.Transform(translateTransformZ_walls_2)
            tiles_wall_YZ.append(tile_YZ_wall_2)


#OUTPUTS
mesh_floor = tiles_floor
mesh_roof = tiles_roof
mesh_edge_X=tiles_row_XZ
mesh_edge_Y=tiles_row_YZ
mesh_wall_X=tiles_wall_XZ
mesh_wall_Y=tiles_wall_YZ
# ---------- end ghpython_script_2 ----------

roof_edge_y = Mesh(ghpython_script_2.mesh_edge_Y)
roof_edge_x = Mesh(ghpython_script_2.mesh_edge_X)
# Meshes Buildings
floors = Mesh(ghpython_script_2.mesh_floor)
ceilings = Mesh(ghpython_script_2.mesh_roof)
walls_y = Mesh(ghpython_script_2.mesh_wall_Y)
walls_x = Mesh(ghpython_script_2.mesh_wall_X)

roof_edge_x_2 = Mesh(ghpython_script.mesh_edge_X)
roof_edge_y_2 = Mesh(ghpython_script.mesh_edge_Y)
walls_y_2 = Mesh(ghpython_script.mesh_wall_Y)
walls_x_2 = Mesh(ghpython_script.mesh_wall_X)
# Meshes Buildings
floors_2 = Mesh(ghpython_script.mesh_floor)
ceilings_2 = Mesh(ghpython_script.mesh_roof)

# ----
# First Floor
button = Button()
bake = ObjectBake(
    BakeToggle=button,
    GeometryObjects=floors,
    Layer="Floors1",
    ObjectName="GH_Obj",
    ObjectColor=RGB(255, 255, 255),
    LayerColor=RGB(255, 255, 255))
bake_2 = ObjectBake(
    BakeToggle=button,
    GeometryObjects=ceilings,
    Layer="Ceilings1",
    ObjectName="GH_Obj",
    ObjectColor=RGB(255, 255, 255),
    LayerColor=RGB(255, 255, 255))
bake_3 = ObjectBake(
    BakeToggle=button,
    GeometryObjects=[roof_edge_x, roof_edge_y],
    Layer="Roof Edges1",
    ObjectName="GH_Obj",
    ObjectColor=RGB(255, 255, 255),
    LayerColor=RGB(255, 255, 255))
bake_4 = ObjectBake(
    BakeToggle=button,
    GeometryObjects=[walls_y, walls_x],
    Layer="Walls1",
    ObjectName="GH_Obj",
    ObjectColor=RGB(255, 255, 255),
    LayerColor=RGB(255, 255, 255))
bake_5 = ObjectBake(
    BakeToggle=button,
    GeometryObjects=mesh_5,
    Layer="Walls Footprints1",
    ObjectName="GH_Obj",
    ObjectColor=RGB(255, 255, 255),
    LayerColor=RGB(255, 255, 255))
mesh_9 = Mesh(flatten([ceilings, roof_edge_x, roof_edge_y, walls_x, walls_y, floors]))

# ----
# Ground Floor
button_2 = Button()
bake_6 = ObjectBake(
    BakeToggle=button_2,
    GeometryObjects=floors_2,
    Layer="Floors",
    ObjectName="GH_Obj",
    ObjectColor=RGB(255, 255, 255),
    LayerColor=RGB(255, 255, 255))
bake_7 = ObjectBake(
    BakeToggle=button_2,
    GeometryObjects=ceilings_2,
    Layer="Ceilings",
    ObjectName="GH_Obj",
    ObjectColor=RGB(255, 255, 255),
    LayerColor=RGB(255, 255, 255))
bake_8 = ObjectBake(
    BakeToggle=button_2,
    GeometryObjects=[roof_edge_x_2, roof_edge_y_2],
    Layer="Roof Edges",
    ObjectName="GH_Obj",
    ObjectColor=RGB(255, 255, 255),
    LayerColor=RGB(255, 255, 255))
bake_9 = ObjectBake(
    BakeToggle=button_2,
    GeometryObjects=[walls_x_2, walls_y_2],
    Layer="Walls",
    ObjectName="GH_Obj",
    ObjectColor=RGB(255, 255, 255),
    LayerColor=RGB(255, 255, 255))
bake_10 = ObjectBake(
    BakeToggle=button_2,
    GeometryObjects=[mesh_7, mesh_6],
    Layer="Walls Footprints",
    ObjectName="GH_Obj",
    ObjectColor=RGB(255, 255, 255),
    LayerColor=RGB(255, 255, 255))
mesh_10 = Mesh(flatten([ceilings_2, roof_edge_x_2, roof_edge_y_2, walls_x_2, walls_y_2, floors_2]))
