# Grasshopper definition BrickLaying_Vault.gh (Grasshopper 1.0.7)

# Script - Vault Bricklaying
# Written by Bart van Nimwegen - October 18th, 2019
# This script is used to make a bricklaying pattern of the gallery vaults in both the ground- and first floor. The sizes of the bricks are 210*100*50 [mm], but are adaptable in the script. The crossbond has been uses as main pattern in both z and y direction, making the construction stronger and more stable
# Vaults
brep = Brep(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)
# Vaults
brep_2 = Brep(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)
# Brick Dimensions
number_slider = Slider(0.21, range=0..0.3)
grout = Slider(0.01, range=0..0.02)
# Brick Dimensions
number_slider_2 = Slider(0.21, range=0..0.3)
grout_2 = Slider(0.01, range=0..0.02)
# Straigth Brick Laying
python_script = PythonScript(
    vault=brep,
    brick_length=number_slider,
    brick_depth=Slider(0.1, range=0..0.3),
    brick_height=Slider(0.05, range=0..0.3),
    grout=grout)  # -> out, Contour_Points, Contour_Curves, Bricks; inputs vault: Mesh
# ---------- python_script: Python ----------
#Script - Vault Bricklaying
#Written by Bart van Nimwegen - October 18th, 2019

#This script is used to make a bricklaying pattern of the gallery vaults in both the 
#ground- and first floor. The sizes of the bricks are 210*100*50 [mm], but are adaptable 
#in the script. The crossbond has been uses as main pattern in both z and y direction, 
#making the construction stronger and more stable 

import Rhino.Geometry as rg 
import math
import rhinoscriptsyntax as rs

#INPUT

#VAULT
vlt = vault


# Brick dimensions:
bL = brick_length    
bD = brick_depth    
bH = brick_height   
grt = grout

#BODY
#GET BOUNDINGBOX OF VAULT
vltbbox = vlt.GetBoundingBox(True)

#CONTOUR VAULT
#GET START POINT CONTOUR

start_x = vltbbox.Min[0]
start_y = vltbbox.Min[1]
start_z = vltbbox.Min[2]

sC = rg.Point3d(start_x,start_y,start_z)

#GET END POINT OF CONTOUR

dim_x = abs(vltbbox.Max[0]-vltbbox.Min[0])
dim_y = abs(vltbbox.Max[1]-vltbbox.Min[1])

if  dim_x > dim_y:
    eC = rg.Point3d(vltbbox.Max[0],start_y,start_z)
else:
    eC = rg.Point3d(start_x,vltbbox.Max[1],start_z)

#CREATE CONTOUR
contourList = vlt.CreateContourCurves(vlt,sC,eC,bH+grt)

#CREATE BRICKS
#CREATE LISTS

pointList=[]
brickList=[]

contourList_even = contourList[0:][::2] # even
contourList_odd = contourList[1:][::2] # odd

brickframeList = []

curve_check = contourList_even[0]

(successCheck,frame_check) = curve_check.FrameAt(0)

Z_0= frame_check.ZAxis

#FOR EACH CONTOUR CURVE -> DIVIDE IN SEGMENTS
for i in contourList_even:
    lengthcrv = i.GetLength()
    brickDim =  (bL)*0.5
    brickNum = int(math.ceil(lengthcrv/brickDim))
    sectionList = i.DivideByCount(brickNum,True)
    #APPLY A POINT TO EACH SEGMENT
    for j in range(len(sectionList)):
        #CREATE THE BRICK INTERVALS
        if j%2==1:
            xi = rg.Interval(-0.5*bL,0.5*bL)
            yi = rg.Interval(0, bD)
            zi = rg.Interval(-0.5*bH,0.5*bH)
        else:
            xi = rg.Interval(-0.5*bL,0.5*bL)
            yi = rg.Interval(bD+grt ,2*bD+grt)
            zi = rg.Interval(-0.5*bH,0.5*bH)

        section = sectionList[j]
        point = i.PointAt(j)
        pointList.append(point)
        
        #CREATE A PLANE ON EACH POINT, X-AXIS DIR ALONG CURVE
        (successCheck,brickframe) = i.FrameAt(section)
        brickframeList.append(brickframe)
        
        if brickframe.ZAxis * Z_0 != 1:
            brickframe.Rotate(math.pi,brickframe.XAxis)
        
        #CREATE THE BRICK ON THE FRAME AND ADD TO LIST
        brick = rg.Box(brickframe,xi,yi,zi)

        brickList.append(brick)
        

#CREATE THE BRICK INTERVALS
xi = rg.Interval(0,bD)
yi = rg.Interval(0, bL)
zi = rg.Interval(-0.5*bH,0.5*bH)

brickframeList_2= []
#FOR EACH CONTOUR CURVE -> DIVIDE IN SEGMENTS
for k in contourList_odd:
    lengthcrv_2 = k.GetLength()
    brickDim_2 =  (bD)
    brickNum_2 = int(math.ceil(lengthcrv_2/brickDim_2))
    sectionList_2 = k.DivideByCount(brickNum_2,True)

    #APPLY A POINT TO EACH SEGMENT
    for l in sectionList_2:
        point = k.PointAt(l)
        pointList.append(point)
        
        #CREATE A PLANE ON EACH POINT, X-AXIS DIR ALONG CURVE
        (successCheck,brickframe_2) = k.FrameAt(l)
        brickframeList_2.append(brickframe_2)

        if brickframe_2.ZAxis * Z_0 != 1:
            brickframe_2.Rotate(math.pi,brickframe_2.XAxis)

        #CREATE THE BRICK ON THE FRAME AND ADD TO LIST
        brick_3 = rg.Box(brickframe_2,xi,yi,zi)

        brickList.append(brick_3)

#OUTPUTS
Contour_Points = pointList
Contour_Curves = contourList
Bricks = brickList
# ---------- end python_script ----------
# Angled Brick Laying
python_script_2 = PythonScript(
    vault=brep_2,
    brick_length=number_slider_2,
    brick_depth=Slider(0.1, range=0..0.3),
    brick_height=Slider(0.05, range=0..0.3),
    grout=grout_2)  # -> out, Contour_Points, Contour_Curves, Bricks; inputs vault: Brep
# ---------- python_script_2: Python ----------
import Rhino.Geometry as rg 
import math
import rhinoscriptsyntax as rs

#INPUT

#VAULT
vlt = vault


# Brick dimensions:
bL = brick_length    
bD = brick_depth    
bH = brick_height   
grt = grout

#BODY
#GET BOUNDINGBOX OF VAULT
vltbbox = vlt.GetBoundingBox(True)

#CONTOUR VAULT
#GET START POINT CONTOUR

start_x = vltbbox.Min[0]
start_y = vltbbox.Min[1]
start_z = vltbbox.Min[2]

end_x = vltbbox.Max[0]
end_y = vltbbox.Max[1]
end_z = vltbbox.Max[2]

sC = rg.Point3d(start_x,start_y,start_z)

#GET END POINT OF CONTOUR

dim_x = abs(vltbbox.Max[0]-vltbbox.Min[0])
dim_y = abs(vltbbox.Max[1]-vltbbox.Min[1])
"""
if  dim_x > dim_y:
    eC = rg.Point3d(vltbbox.Max[0],start_y,start_z)
else:
    eC = rg.Point3d(start_x,vltbbox.Max[1],start_z)
"""
eC = rg.Point3d(end_x,end_y,start_z)
#CREATE CONTOUR
contourList = vlt.CreateContourCurves(vlt,sC,eC,bH+grt)

#CREATE BRICKS
#CREATE LISTS

pointList=[]
brickList=[]

contourList_even = contourList[0:][::2] # even
contourList_odd = contourList[1:][::2] # odd

brickframeList = []

curve_check = contourList_even[0]

(successCheck,frame_check) = curve_check.FrameAt(0)

Z_0= frame_check.ZAxis

#FOR EACH CONTOUR CURVE -> DIVIDE IN SEGMENTS
for i in contourList:
    lengthcrv = i.GetLength()
    brickDim =  (bL)*0.5
    brickNum = int(math.ceil(lengthcrv/brickDim))
    sectionList = i.DivideByCount(brickNum,True)
    #APPLY A POINT TO EACH SEGMENT
    for j in range(len(sectionList)):
        #CREATE THE BRICK INTERVALS
        if j%2==1:
            xi = rg.Interval(-0.5*bL,0.5*bL)
            yi = rg.Interval(0, bD)
            zi = rg.Interval(-0.5*bH,0.5*bH)
        else:
            xi = rg.Interval(-0.5*bL,0.5*bL)
            yi = rg.Interval(bD+grt ,2*bD+grt)
            zi = rg.Interval(-0.5*bH,0.5*bH)

        section = sectionList[j]
        point = i.PointAt(j)
        pointList.append(point)
        
        #CREATE A PLANE ON EACH POINT, X-AXIS DIR ALONG CURVE
        (successCheck,brickframe) = i.FrameAt(section)
        brickframeList.append(brickframe)
        """
        if brickframe.ZAxis * Z_0 != 1:
            brickframe.Rotate(math.pi,brickframe.XAxis)
        """
        #CREATE THE BRICK ON THE FRAME AND ADD TO LIST
        brick = rg.Box(brickframe,xi,yi,zi)

        brickList.append(brick)
        

#CREATE THE BRICK INTERVALS
xi = rg.Interval(0,bD)
yi = rg.Interval(0, bL)
zi = rg.Interval(-0.5*bH,0.5*bH)
"""
brickframeList_2= []
#FOR EACH CONTOUR CURVE -> DIVIDE IN SEGMENTS
for k in contourList_odd:
    lengthcrv_2 = k.GetLength()
    brickDim_2 =  (bD)
    brickNum_2 = int(math.ceil(lengthcrv_2/brickDim_2))
    sectionList_2 = k.DivideByCount(brickNum_2,True)

    #APPLY A POINT TO EACH SEGMENT
    for l in sectionList_2:
        point = k.PointAt(l)
        pointList.append(point)
        
        #CREATE A PLANE ON EACH POINT, X-AXIS DIR ALONG CURVE
        (successCheck,brickframe_2) = k.FrameAt(l)
        brickframeList_2.append(brickframe_2)

        if brickframe_2.ZAxis * Z_0 != 1:
            brickframe_2.Rotate(math.pi,brickframe_2.XAxis)

        #CREATE THE BRICK ON THE FRAME AND ADD TO LIST
        brick_3 = rg.Box(brickframe_2,xi,yi,zi)

        brickList.append(brick_3)
"""
#OUTPUTS
Contour_Points = pointList
Contour_Curves = contourList
Bricks = brickList
# ---------- end python_script_2 ----------
# Bricks
brep_3 = Brep(python_script.Bricks)
# Bricks
brep_4 = Brep(python_script_2.Bricks)
