# Grasshopper definition Karamba3D_Vault_and_Dome_structures_Ceilings_floor_1_v2.gh (Grasshopper 1.0.7)
# plug-ins: karambaGH

material_properties_karamba3d = MaterialPropertiesKaramba3D(
    FamilyOfMaterial="Adobe",
    Name="Adobe pure",
    YoungsModulus_kN_cm2="10.42",
    InPlaneShearModulus_kN_cm2="4.077",
    TransverseShearModulus_kN_cm2=8076,
    SpecificWeight_kN_m3="19,6",
    CoefficientOfThermalExpansion_1_C=1e-05,
    YieldStrength_kN_cm2="0,26",
    mode="Isotrop")

# ---- group: D3F0
anchors_d3f0 = Point([<point referenced from the Rhino model> x52])
# D3F0
mesh_d3f0 = Mesh(<mesh referenced from the Rhino model>)

# ---- group: D2F0
anchors_d2f0 = Point([<point referenced from the Rhino model> x96])
# D2F0
mesh_d2f0 = Mesh(<mesh referenced from the Rhino model>)

# ---- group: D1F0
anchors_d1f0 = Point([Point(-124.788208, -7.313398838, 3.600061417), Point(-124.7881927, -7.013404846, 3.600024223), Point(-124.7882004, -7.163401604, 3.600042582), Point(-124.7882156, -7.463397026, 3.600079775), Point(-124.7882309, -7.913395405, 3.600128651), Point(-124.7882233, -7.613396168, 3.600097179)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])
# D1F0
mesh_d1f0 = Mesh(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)

# ---- group: D3F0 / Karamba
mesh_to_shell_karamba3d = MeshToShellKaramba3D(Mesh=mesh_d3f0, Identifier="shell01", LimitDistance_m=0.005)  # -> Element, Points, Info
cross_section_karamba3d = CrossSectionKaramba3D(
    FamilyNameOfCrossSection="DefaultCroSec",
    ElementIdentifier="shell01",
    Material=material_properties_karamba3d,
    Height_cm=Slider(26, range=0..50),
    mode="Shell - Const")
support_karamba3d = SupportKaramba3D(PosInd=anchors_d3f0, menu=[buttons(on, on, on, off, off, off)])
loads_karamba3d = LoadsKaramba3D(Vector=Vector(0, 0, -1), LCase="0", mode="Gravity")
assemble_model_karamba3d = AssembleModelKaramba3D(
    Elem=mesh_to_shell_karamba3d.Element,
    Support=support_karamba3d,
    Load=loads_karamba3d,
    CrossSection=cross_section_karamba3d,
    Material=material_properties_karamba3d,
    LimitDistance_m=0.005)  # -> Model, Info, Mass_kg, CenterOfGravity
analyze_karamba3d = AnalyzeKaramba3D(Model=assemble_model_karamba3d.Model)  # -> CalculatedModel, MaximumDisplacement_cm, ResultingForceOfGravity_kN, ElasticEnergy_kNm
model_view_karamba3d = ModelViewKaramba3D(Model=analyze_karamba3d.CalculatedModel, ResultFactors=1, ResultCase=-1)  # -> Model, DeformedMesh, DeformedAxes, DeformedModel
shell_view_karamba3d = ShellViewKaramba3D(Model=model_view_karamba3d.Model, IndexOfLayer=0)  # -> Model, MeshesOfRenderedShells, LegendColors, LegendTags

# ---- group: D1F0 / Karamba
mesh_to_shell_karamba3d_2 = MeshToShellKaramba3D(Mesh=mesh_d1f0, Identifier="shell01", LimitDistance_m=0.005)  # -> Element, Points, Info
cross_section_karamba3d_2 = CrossSectionKaramba3D(
    FamilyNameOfCrossSection="DefaultCroSec",
    ElementIdentifier="shell01",
    Material=material_properties_karamba3d,
    Height_cm=Slider(21, range=0..50),
    mode="Shell - Const")
support_karamba3d_2 = SupportKaramba3D(PosInd=anchors_d1f0, menu=[buttons(on, on, on, off, off, off)])
loads_karamba3d_2 = LoadsKaramba3D(Vector=Vector(0, 0, -1), LCase="0", mode="Gravity")
assemble_model_karamba3d_2 = AssembleModelKaramba3D(
    Elem=mesh_to_shell_karamba3d_2.Element,
    Support=support_karamba3d_2,
    Load=loads_karamba3d_2,
    CrossSection=cross_section_karamba3d_2,
    Material=material_properties_karamba3d,
    LimitDistance_m=0.005)  # -> Model, Info, Mass_kg, CenterOfGravity
analyze_karamba3d_2 = AnalyzeKaramba3D(Model=assemble_model_karamba3d_2.Model)  # -> CalculatedModel, MaximumDisplacement_cm, ResultingForceOfGravity_kN, ElasticEnergy_kNm
model_view_karamba3d_2 = ModelViewKaramba3D(Model=analyze_karamba3d_2.CalculatedModel, ResultFactors=1, ResultCase=-1)  # -> Model, DeformedMesh, DeformedAxes, DeformedModel
shell_view_karamba3d_2 = ShellViewKaramba3D(Model=model_view_karamba3d_2.Model, IndexOfLayer=0)  # -> Model, MeshesOfRenderedShells, LegendColors, LegendTags

# ---- group: D2F0 / Karamba
mesh_to_shell_karamba3d_3 = MeshToShellKaramba3D(Mesh=mesh_d2f0, Identifier="shell01", LimitDistance_m=0.005)  # -> Element, Points, Info
cross_section_karamba3d_3 = CrossSectionKaramba3D(
    FamilyNameOfCrossSection="DefaultCroSec",
    ElementIdentifier="shell01",
    Material=material_properties_karamba3d,
    Height_cm=Slider(21, range=0..50),
    mode="Shell - Const")
support_karamba3d_3 = SupportKaramba3D(PosInd=anchors_d2f0, menu=[buttons(on, on, on, off, off, off)])
loads_karamba3d_3 = LoadsKaramba3D(Vector=Vector(0, 0, -1), LCase="0", mode="Gravity")
assemble_model_karamba3d_3 = AssembleModelKaramba3D(
    Elem=mesh_to_shell_karamba3d_3.Element,
    Support=support_karamba3d_3,
    Load=loads_karamba3d_3,
    CrossSection=cross_section_karamba3d_3,
    Material=material_properties_karamba3d,
    LimitDistance_m=0.005)  # -> Model, Info, Mass_kg, CenterOfGravity
analyze_karamba3d_3 = AnalyzeKaramba3D(Model=assemble_model_karamba3d_3.Model)  # -> CalculatedModel, MaximumDisplacement_cm, ResultingForceOfGravity_kN, ElasticEnergy_kNm
model_view_karamba3d_3 = ModelViewKaramba3D(Model=analyze_karamba3d_3.CalculatedModel, ResultFactors=1, ResultCase=-1)  # -> Model, DeformedMesh, DeformedAxes, DeformedModel
shell_view_karamba3d_3 = ShellViewKaramba3D(Model=model_view_karamba3d_3.Model, IndexOfLayer=0)  # -> Model, MeshesOfRenderedShells, LegendColors, LegendTags

# ---- group: V1F0 / V4F0
anchors_v4f0 = Point()
mesh_v4f0 = Mesh(<mesh referenced from the Rhino model>)

# ---- group: V1F0 / V3F0
anchors_v3f0 = Point()
mesh_v3f0 = Mesh(<mesh referenced from the Rhino model>)

# ---- group: V1F0 / V5F0
anchors_v5f0 = Point()
mesh_v5f0 = Mesh(<mesh referenced from the Rhino model>)

# ---- group: V1F0 / V6F0
anchors_v6f0 = Point()
mesh_v6f0 = Mesh(<mesh referenced from the Rhino model>)

# ---- group: V1F0 / V11F0
anchors_v11f0 = Point()
mesh_v11f0 = Mesh(<mesh referenced from the Rhino model>)

# ---- group: V1F0 / V12F0
anchors_v12f0 = Point()
mesh_v12f0 = Mesh(<mesh referenced from the Rhino model>)

# ---- group: V1F0 / V13F0
anchors_v13f0 = Point()
mesh_v13f0 = Mesh(<mesh referenced from the Rhino model>)

# ---- group: D1F0 / Results
shell_forces_karamba3d = ShellForcesKaramba3D(AnalyzedModel=shell_view_karamba3d_2.Model, LCase=0, mode="Principal")  # -> AnalyzedModel, FirstPrincipalNormalForce_kN_m, SecondPrincipalNormalForce_kN_m, FirstPrincipalMoment_kNm_m, SecondPrincipalMoment_kNm_m, ShearForceInLocalXDirection_kN_m, ShearForceInLocalYDirection_kN_m
legend = Legend(Colour=shell_view_karamba3d_2.LegendColors, Tags=shell_view_karamba3d_2.LegendTags, LegendType=1)
panel = Panel(shell_forces_karamba3d.FirstPrincipalNormalForce_kN_m)

# ---- group: D3F0 / Results
shell_forces_karamba3d_2 = ShellForcesKaramba3D(AnalyzedModel=shell_view_karamba3d.Model, LCase=0, mode="Principal")  # -> AnalyzedModel, FirstPrincipalNormalForce_kN_m, SecondPrincipalNormalForce_kN_m, FirstPrincipalMoment_kNm_m, SecondPrincipalMoment_kNm_m, ShearForceInLocalXDirection_kN_m, ShearForceInLocalYDirection_kN_m
legend_2 = Legend(Colour=shell_view_karamba3d.LegendColors, Tags=shell_view_karamba3d.LegendTags, LegendType=1)
panel_2 = Panel(shell_forces_karamba3d_2.FirstPrincipalNormalForce_kN_m)

# ---- group: D2F0 / Results
shell_forces_karamba3d_3 = ShellForcesKaramba3D(AnalyzedModel=shell_view_karamba3d_3.Model, LCase=0, mode="Principal")  # -> AnalyzedModel, FirstPrincipalNormalForce_kN_m, SecondPrincipalNormalForce_kN_m, FirstPrincipalMoment_kNm_m, SecondPrincipalMoment_kNm_m, ShearForceInLocalXDirection_kN_m, ShearForceInLocalYDirection_kN_m
legend_3 = Legend(Colour=shell_view_karamba3d_3.LegendColors, Tags=shell_view_karamba3d_3.LegendTags, LegendType=1)
panel_3 = Panel(shell_forces_karamba3d_3.FirstPrincipalNormalForce_kN_m)

# ---- group: V1F0 / V7F0
anchors_v7f0 = Point([Point(-160.1881866, -0.5634080172, 3.600000858), Point(-160.1881866, -0.8634080291, 3.600000858), Point(-160.1881866, -0.2634080052, 3.600000858), Point(-160.1881866, -1.163408041, 3.600000858), Point(-160.1881866, -1.463407993, 3.600000858), Point(-160.1881866, -1.763407946, 3.600000858)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])
# V7F0
mesh_v7f0 = Mesh(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)

# ---- group: V1F1
anchors_v1f1 = Point([Point(-146.9881897, 12.33659267, 1.875002265), Point(-147.0631866, 12.33659267, 1.800002217), Point(-147.2131805, 12.33659267, 1.800002456), Point(-147.3631744, 12.33659267, 1.800002456), Point(-147.5131836, 12.33659267, 1.800002456), Point(-147.1381836, 12.33659267, 1.800002575)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])
# V1F1
mesh_v1f1 = Mesh(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)

# ---- group: V2F0
anchors_v2f0 = Point([Point(-159.6631775, 5.736595154, 1.80000484), Point(-159.8131866, 5.736595154, 1.80000484), Point(-159.9631805, 5.736595154, 1.80000484), Point(-160.1131897, 5.7365942, 1.80000484), Point(-159.7381897, 5.736595154, 1.80000484), Point(-160.0381775, 5.736594677, 1.80000484)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])
# V2F1
mesh_v2f0 = Mesh(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)

# ---- group: V1F0 / V10F0
anchors_v10f0 = Point([Point(-159.8881836, 12.33659172, 1.800000548), Point(-160.1881866, 12.33659172, 1.800000548), Point(-159.5881805, 12.33659172, 1.800000548), Point(-159.8881836, 14.73659229, 1.800000548), Point(-160.1881866, 14.73659229, 1.800000548), Point(-159.5881805, 14.73659229, 1.800000548)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])
# V10F0
mesh_v10f0 = Mesh(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)

# ---- group: V1F0 / V9F0
anchors_v9f0 = Point([Point(-159.8881836, 5.73659277, 1.800001144), Point(-160.1881866, 5.73659277, 1.800001144), Point(-159.5881805, 5.73659277, 1.800001144), Point(-159.8881836, 11.73659134, 1.800001144), Point(-160.1881866, 11.73659134, 1.800001144), Point(-159.5881805, 11.73659134, 1.800001144)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])
# V9F0
mesh_v9f0 = Mesh(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)

# ---- group: V1F0 / V8F0
anchors_v8f0 = Point([Point(-162.2881775, 0.3365926445, 1.800001025), Point(-162.5881805, 0.3365926445, 1.800001025), Point(-161.9881897, 0.3365926445, 1.800001025), Point(-162.2881775, 5.136591434, 1.800001025), Point(-162.5881805, 5.136591434, 1.800001025), Point(-161.9881897, 5.136591434, 1.800001025)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])
# V8F0
mesh_v8f0 = Mesh(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)

# ---- group: D3F0 / Karamba
mesh_to_shell_karamba3d_4 = MeshToShellKaramba3D(Mesh=mesh_v7f0, Identifier="shell01", LimitDistance_m=0.005)  # -> Element, Points, Info
cross_section_karamba3d_4 = CrossSectionKaramba3D(
    FamilyNameOfCrossSection="DefaultCroSec",
    ElementIdentifier="shell01",
    Material=material_properties_karamba3d,
    Height_cm=Slider(21, range=0..50),
    mode="Shell - Const")
support_karamba3d_4 = SupportKaramba3D(PosInd=anchors_v7f0, menu=[buttons(on, on, on, off, off, off)])
loads_karamba3d_4 = LoadsKaramba3D(Vector=Vector(0, 0, -1), LCase="0", mode="Gravity")
assemble_model_karamba3d_4 = AssembleModelKaramba3D(
    Elem=mesh_to_shell_karamba3d_4.Element,
    Support=support_karamba3d_4,
    Load=loads_karamba3d_4,
    CrossSection=cross_section_karamba3d_4,
    Material=material_properties_karamba3d,
    LimitDistance_m=0.005)  # -> Model, Info, Mass_kg, CenterOfGravity
analyze_karamba3d_4 = AnalyzeKaramba3D(Model=assemble_model_karamba3d_4.Model)  # -> CalculatedModel, MaximumDisplacement_cm, ResultingForceOfGravity_kN, ElasticEnergy_kNm
model_view_karamba3d_4 = ModelViewKaramba3D(Model=analyze_karamba3d_4.CalculatedModel, ResultFactors=1, ResultCase=-1)  # -> Model, DeformedMesh, DeformedAxes, DeformedModel
shell_view_karamba3d_4 = ShellViewKaramba3D(Model=model_view_karamba3d_4.Model, IndexOfLayer=0)  # -> Model, MeshesOfRenderedShells, LegendColors, LegendTags

mesh_to_shell_karamba3d_5 = MeshToShellKaramba3D(Mesh=mesh_v9f0, Identifier="shell01", LimitDistance_m=0.005)  # -> Element, Points, Info
cross_section_karamba3d_5 = CrossSectionKaramba3D(
    FamilyNameOfCrossSection="DefaultCroSec",
    ElementIdentifier="shell01",
    Material=material_properties_karamba3d,
    Height_cm=Slider(21, range=0..50),
    mode="Shell - Const")
support_karamba3d_5 = SupportKaramba3D(PosInd=anchors_v9f0, menu=[buttons(on, on, on, off, off, off)])
loads_karamba3d_5 = LoadsKaramba3D(Vector=Vector(0, 0, -1), LCase="0", mode="Gravity")
assemble_model_karamba3d_5 = AssembleModelKaramba3D(
    Elem=mesh_to_shell_karamba3d_5.Element,
    Support=support_karamba3d_5,
    Load=loads_karamba3d_5,
    CrossSection=cross_section_karamba3d_5,
    Material=material_properties_karamba3d,
    LimitDistance_m=0.005)  # -> Model, Info, Mass_kg, CenterOfGravity
analyze_karamba3d_5 = AnalyzeKaramba3D(Model=assemble_model_karamba3d_5.Model)  # -> CalculatedModel, MaximumDisplacement_cm, ResultingForceOfGravity_kN, ElasticEnergy_kNm
model_view_karamba3d_5 = ModelViewKaramba3D(Model=analyze_karamba3d_5.CalculatedModel, ResultFactors=1, ResultCase=-1)  # -> Model, DeformedMesh, DeformedAxes, DeformedModel
shell_view_karamba3d_5 = ShellViewKaramba3D(Model=model_view_karamba3d_5.Model, IndexOfLayer=0)  # -> Model, MeshesOfRenderedShells, LegendColors, LegendTags

mesh_to_shell_karamba3d_6 = MeshToShellKaramba3D(Mesh=mesh_v10f0, Identifier="shell01", LimitDistance_m=0.005)  # -> Element, Points, Info
cross_section_karamba3d_6 = CrossSectionKaramba3D(
    FamilyNameOfCrossSection="DefaultCroSec",
    ElementIdentifier="shell01",
    Material=material_properties_karamba3d,
    Height_cm=Slider(21, range=0..50),
    mode="Shell - Const")
support_karamba3d_6 = SupportKaramba3D(PosInd=anchors_v10f0, menu=[buttons(on, on, on, off, off, off)])
loads_karamba3d_6 = LoadsKaramba3D(Vector=Vector(0, 0, -1), LCase="0", mode="Gravity")
assemble_model_karamba3d_6 = AssembleModelKaramba3D(
    Elem=mesh_to_shell_karamba3d_6.Element,
    Support=support_karamba3d_6,
    Load=loads_karamba3d_6,
    CrossSection=cross_section_karamba3d_6,
    Material=material_properties_karamba3d,
    LimitDistance_m=0.005)  # -> Model, Info, Mass_kg, CenterOfGravity
analyze_karamba3d_6 = AnalyzeKaramba3D(Model=assemble_model_karamba3d_6.Model)  # -> CalculatedModel, MaximumDisplacement_cm, ResultingForceOfGravity_kN, ElasticEnergy_kNm
model_view_karamba3d_6 = ModelViewKaramba3D(Model=analyze_karamba3d_6.CalculatedModel, ResultFactors=1, ResultCase=-1)  # -> Model, DeformedMesh, DeformedAxes, DeformedModel
shell_view_karamba3d_6 = ShellViewKaramba3D(Model=model_view_karamba3d_6.Model, IndexOfLayer=0)  # -> Model, MeshesOfRenderedShells, LegendColors, LegendTags

mesh_to_shell_karamba3d_7 = MeshToShellKaramba3D(Mesh=mesh_v8f0, Identifier="shell01", LimitDistance_m=0.005)  # -> Element, Points, Info
cross_section_karamba3d_7 = CrossSectionKaramba3D(
    FamilyNameOfCrossSection="DefaultCroSec",
    ElementIdentifier="shell01",
    Material=material_properties_karamba3d,
    Height_cm=Slider(21, range=0..50),
    mode="Shell - Const")
support_karamba3d_7 = SupportKaramba3D(PosInd=anchors_v8f0, menu=[buttons(on, on, on, off, off, off)])
loads_karamba3d_7 = LoadsKaramba3D(Vector=Vector(0, 0, -1), LCase="0", mode="Gravity")
assemble_model_karamba3d_7 = AssembleModelKaramba3D(
    Elem=mesh_to_shell_karamba3d_7.Element,
    Support=support_karamba3d_7,
    Load=loads_karamba3d_7,
    CrossSection=cross_section_karamba3d_7,
    Material=material_properties_karamba3d,
    LimitDistance_m=0.005)  # -> Model, Info, Mass_kg, CenterOfGravity
analyze_karamba3d_7 = AnalyzeKaramba3D(Model=assemble_model_karamba3d_7.Model)  # -> CalculatedModel, MaximumDisplacement_cm, ResultingForceOfGravity_kN, ElasticEnergy_kNm
model_view_karamba3d_7 = ModelViewKaramba3D(Model=analyze_karamba3d_7.CalculatedModel, ResultFactors=1, ResultCase=-1)  # -> Model, DeformedMesh, DeformedAxes, DeformedModel
shell_view_karamba3d_7 = ShellViewKaramba3D(Model=model_view_karamba3d_7.Model, IndexOfLayer=0)  # -> Model, MeshesOfRenderedShells, LegendColors, LegendTags

mesh_to_shell_karamba3d_8 = MeshToShellKaramba3D(Mesh=mesh_v2f0, Identifier="shell03", LimitDistance_m=0.005)  # -> Element, Points, Info
cross_section_karamba3d_8 = CrossSectionKaramba3D(
    FamilyNameOfCrossSection="DefaultCroSec",
    ElementIdentifier="shell03",
    Material=material_properties_karamba3d,
    Height_cm=Slider(200, range=0..200),
    mode="Shell - Const")
support_karamba3d_8 = SupportKaramba3D(PosInd=anchors_v2f0, menu=[buttons(on, on, on, on, on, on)])
loads_karamba3d_8 = LoadsKaramba3D(Vector=Vector(0, 0, -1), LCase="0", mode="Gravity")
assemble_model_karamba3d_8 = AssembleModelKaramba3D(
    Elem=mesh_to_shell_karamba3d_8.Element,
    Support=support_karamba3d_8,
    Load=loads_karamba3d_8,
    CrossSection=cross_section_karamba3d_8,
    Material=material_properties_karamba3d,
    LimitDistance_m=0.005)  # -> Model, Info, Mass_kg, CenterOfGravity
analyze_karamba3d_8 = AnalyzeKaramba3D(Model=assemble_model_karamba3d_8.Model)  # -> CalculatedModel, MaximumDisplacement_cm, ResultingForceOfGravity_kN, ElasticEnergy_kNm
model_view_karamba3d_8 = ModelViewKaramba3D(Model=analyze_karamba3d_8.CalculatedModel, ResultFactors=1, ResultCase=-1)  # -> Model, DeformedMesh, DeformedAxes, DeformedModel
shell_view_karamba3d_8 = ShellViewKaramba3D(Model=model_view_karamba3d_8.Model, IndexOfLayer=0)  # -> Model, MeshesOfRenderedShells, LegendColors, LegendTags

mesh_to_shell_karamba3d_9 = MeshToShellKaramba3D(Mesh=mesh_v1f1, Identifier="shell02", LimitDistance_m=0.005)  # -> Element, Points, Info
cross_section_karamba3d_9 = CrossSectionKaramba3D(
    FamilyNameOfCrossSection="DefaultCroSec",
    ElementIdentifier="shell02",
    Material=material_properties_karamba3d,
    Height_cm=Slider(23, range=0..50),
    mode="Shell - Const")
support_karamba3d_9 = SupportKaramba3D(PosInd=anchors_v1f1, menu=[buttons(on, on, on, off, off, off)])
loads_karamba3d_9 = LoadsKaramba3D(Vector=Vector(0, 0, -1), LCase="0", mode="Gravity")
assemble_model_karamba3d_9 = AssembleModelKaramba3D(
    Elem=mesh_to_shell_karamba3d_9.Element,
    Support=support_karamba3d_9,
    Load=loads_karamba3d_9,
    CrossSection=cross_section_karamba3d_9,
    Material=material_properties_karamba3d,
    LimitDistance_m=0.005)  # -> Model, Info, Mass_kg, CenterOfGravity
analyze_karamba3d_9 = AnalyzeKaramba3D(Model=assemble_model_karamba3d_9.Model)  # -> CalculatedModel, MaximumDisplacement_cm, ResultingForceOfGravity_kN, ElasticEnergy_kNm
model_view_karamba3d_9 = ModelViewKaramba3D(Model=analyze_karamba3d_9.CalculatedModel, ResultFactors=1, ResultCase=-1)  # -> Model, DeformedMesh, DeformedAxes, DeformedModel
shell_view_karamba3d_9 = ShellViewKaramba3D(Model=model_view_karamba3d_9.Model, IndexOfLayer=0)  # -> Model, MeshesOfRenderedShells, LegendColors, LegendTags

# ----
panel_4 = Panel(analyze_karamba3d_9.MaximumDisplacement_cm)
mesh_to_shell_karamba3d_10 = MeshToShellKaramba3D(Mesh=<geometry referenced from the Rhino model>, LimitDistance_m=0.005)  # -> Element, Points, Info
point = Point(mesh_to_shell_karamba3d_10.Points)

# ---- group: D3F0 / Results
shell_forces_karamba3d_4 = ShellForcesKaramba3D(AnalyzedModel=shell_view_karamba3d_4.Model, LCase=0, mode="Principal")  # -> AnalyzedModel, FirstPrincipalNormalForce_kN_m, SecondPrincipalNormalForce_kN_m, FirstPrincipalMoment_kNm_m, SecondPrincipalMoment_kNm_m, ShearForceInLocalXDirection_kN_m, ShearForceInLocalYDirection_kN_m
legend_4 = Legend(Colour=shell_view_karamba3d_4.LegendColors, Tags=shell_view_karamba3d_4.LegendTags, LegendType=1)
panel_5 = Panel(shell_forces_karamba3d_4.FirstPrincipalNormalForce_kN_m)

shell_forces_karamba3d_5 = ShellForcesKaramba3D(AnalyzedModel=shell_view_karamba3d_6.Model, LCase=0, mode="Principal")  # -> AnalyzedModel, FirstPrincipalNormalForce_kN_m, SecondPrincipalNormalForce_kN_m, FirstPrincipalMoment_kNm_m, SecondPrincipalMoment_kNm_m, ShearForceInLocalXDirection_kN_m, ShearForceInLocalYDirection_kN_m
legend_5 = Legend(Colour=shell_view_karamba3d_6.LegendColors, Tags=shell_view_karamba3d_6.LegendTags, LegendType=1)
panel_6 = Panel(shell_forces_karamba3d_5.FirstPrincipalNormalForce_kN_m)

shell_forces_karamba3d_6 = ShellForcesKaramba3D(AnalyzedModel=shell_view_karamba3d_5.Model, LCase=0, mode="Principal")  # -> AnalyzedModel, FirstPrincipalNormalForce_kN_m, SecondPrincipalNormalForce_kN_m, FirstPrincipalMoment_kNm_m, SecondPrincipalMoment_kNm_m, ShearForceInLocalXDirection_kN_m, ShearForceInLocalYDirection_kN_m
legend_6 = Legend(Colour=shell_view_karamba3d_5.LegendColors, Tags=shell_view_karamba3d_5.LegendTags, LegendType=1)
panel_7 = Panel(shell_forces_karamba3d_6.FirstPrincipalNormalForce_kN_m)

shell_forces_karamba3d_7 = ShellForcesKaramba3D(AnalyzedModel=shell_view_karamba3d_7.Model, LCase=0, mode="Principal")  # -> AnalyzedModel, FirstPrincipalNormalForce_kN_m, SecondPrincipalNormalForce_kN_m, FirstPrincipalMoment_kNm_m, SecondPrincipalMoment_kNm_m, ShearForceInLocalXDirection_kN_m, ShearForceInLocalYDirection_kN_m
legend_7 = Legend(Colour=shell_view_karamba3d_7.LegendColors, Tags=shell_view_karamba3d_7.LegendTags, LegendType=1)
panel_8 = Panel(shell_forces_karamba3d_7.FirstPrincipalNormalForce_kN_m)

shell_forces_karamba3d_8 = ShellForcesKaramba3D(AnalyzedModel=shell_view_karamba3d_8.Model, LCase=0, mode="Principal")  # -> AnalyzedModel, FirstPrincipalNormalForce_kN_m, SecondPrincipalNormalForce_kN_m, FirstPrincipalMoment_kNm_m, SecondPrincipalMoment_kNm_m, ShearForceInLocalXDirection_kN_m, ShearForceInLocalYDirection_kN_m
legend_8 = Legend(Colour=shell_view_karamba3d_8.LegendColors, Tags=shell_view_karamba3d_8.LegendTags, LegendType=1)
panel_9 = Panel(shell_forces_karamba3d_8.FirstPrincipalNormalForce_kN_m)

shell_forces_karamba3d_9 = ShellForcesKaramba3D(AnalyzedModel=shell_view_karamba3d_9.Model, LCase=0, mode="Principal")  # -> AnalyzedModel, FirstPrincipalNormalForce_kN_m, SecondPrincipalNormalForce_kN_m, FirstPrincipalMoment_kNm_m, SecondPrincipalMoment_kNm_m, ShearForceInLocalXDirection_kN_m, ShearForceInLocalYDirection_kN_m
legend_9 = Legend(Colour=shell_view_karamba3d_9.LegendColors, Tags=shell_view_karamba3d_9.LegendTags, LegendType=1)
panel_10 = Panel(shell_forces_karamba3d_9.FirstPrincipalNormalForce_kN_m)

# ----
result_vectors_on_shells_karamba3d = ResultVectorsOnShellsKaramba3D(AnalyzedModel=shell_forces_karamba3d_9.AnalyzedModel, LayerPosition=0, mode="PrincStress")  # -> AnalyzedModel, Points, FirstPrincipalStressVector_kN_cm2, SecondPrincipalStressVector_kN_cm2, FirstPrincipalStressValue_kN_cm2, SecondPrincipalStressValue_kN_cm2
