# Grasshopper definition Karamba3D_Vaults_testing_speckle.gh (Grasshopper 1.0.7)
# plug-ins: UserDataUtils, Kangaroo2 Components, karambaGH

material_properties_karamba3d = MaterialPropertiesKaramba3D(
    FamilyOfMaterial="Adobe",
    Name="Adobe pure",
    YoungsModulus_kN_cm2="15.42",
    InPlaneShearModulus_kN_cm2="6",
    TransverseShearModulus_kN_cm2=8076,
    SpecificWeight_kN_m3="19,6",
    CoefficientOfThermalExpansion_1_C=1e-05,
    YieldStrength_kN_cm2="0,26",
    mode="Isotrop")

anonymous_stream = DataSender(manualmode=False, remotecontroller=False)  # -> Log, StreamId
anonymous_stream_2 = DataReceiver(ID="eUehYZfnB", deserialize=True)  # -> _8d6996a380154c7bB395F33b702249e7, _863a7353D2be47b7BcfeCa69f6d621f3, _20672081Cc214fdfA03805d4a539fc21, A27428908f7e4df78bd17e546273f7de, _342ebf294d42419dA278D867b7a26294, C13066cb2cce4d84889f832f930483c3, _3f8a85e0Cfb3404d960794feda2070ae, _44673bb6537345ecAd069d2a64e955f4; disabled
anonymous_stream_3 = DataReceiver(ID="eUehYZfnB", deserialize=True)  # -> _8d6996a380154c7bB395F33b702249e7, _863a7353D2be47b7BcfeCa69f6d621f3, _20672081Cc214fdfA03805d4a539fc21, A27428908f7e4df78bd17e546273f7de, _342ebf294d42419dA278D867b7a26294, C13066cb2cce4d84889f832f930483c3, _3f8a85e0Cfb3404d960794feda2070ae, _44673bb6537345ecAd069d2a64e955f4; disabled
anonymous_stream_4 = DataReceiver(ID="ocf2uJVfhn", deserialize=True)  # -> B3fa2973A58d4b1cB35e6dca9d72ba68, _15be20171cfb45a1A355D6b0bea58cb8, _177531f9038c45a1Ab8cD80da65e1869
anonymous_stream_5 = DataReceiver(ID="OzhsO6zZS", deserialize=True)  # -> A40c79ae3ec84ccb8a64D1ddd0f6afa7, _9cb3e6b0A34f4b3684849bfc3d8ba285, _7377ac1fFd4e404a8dcd892be18d98a1, _26c42375Ebbc4077A366E8e1eeb1a2ea
refine = Refine(Mesh=anonymous_stream_4.B3fa2973A58d4b1cB35e6dca9d72ba68, Level=1)
mesh = Mesh(anonymous_stream_2._863a7353D2be47b7BcfeCa69f6d621f3)
mesh_2 = Mesh()
mesh_3 = Mesh()
mesh_4 = Mesh()
mesh_5 = Mesh()
refine_2 = Refine(Mesh=[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], Level=1)
refine_3 = Refine(Mesh=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, Level=3)
refine_4 = Refine(Mesh=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, Level=3)
refine_5 = Refine(Mesh=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, Level=1)
refine_6 = Refine(Mesh=anonymous_stream_4._15be20171cfb45a1A355D6b0bea58cb8, Level=1)
refine_7 = Refine(Mesh=mesh, Level=2)
refine_8 = Refine(Mesh=mesh_5, Level=4)
refine_9 = Refine(Mesh=mesh_3, Level=4)
refine_10 = Refine(Mesh=mesh_2, Level=4)

# ---- group: V1F1
anchors_v1f1 = Point([Point(-135.5836029, 56.77561188, 5.106002331), Point(-135.5836029, 50.6447525, 5.106002331), Point(-135.633606, 56.77561188, 5.106002331), Point(-135.633606, 50.6447525, 5.106002331), Point(-135.6835938, 56.77561188, 5.106002331), Point(-135.6835938, 50.6447525, 5.106002331)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])
mesh_v1f1 = Mesh(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)

anchors_v1f1_2 = Point([Point(-149.6040192, 31.08385468, 6.000151157), Point(-149.6040192, 25.215868, 6.00066328), Point(-149.6790161, 31.08385468, 6.000151157), Point(-149.6790161, 25.215868, 6.00066328), Point(-149.7540283, 31.08385468, 6.000151157), Point(-149.7540283, 25.215868, 6.00066328)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])
mesh_v1f1_2 = Mesh(refine_9)

anchors_v1f1_3 = Point([<point referenced from the Rhino model> x256])
mesh_v1f1_3 = Mesh(refine_7)

anchors_v1f1_4 = Point([Point(-115.7442932, 9.299071312, 6.00014019), Point(-115.7442932, 9.111577988, 6.00014019), Point(-115.7442932, 8.924085617, 6.00014019), Point(-115.7442932, 8.736592293, 6.00014019), Point(-115.7442932, 8.549098969, 6.00014019), Point(-115.7442932, 8.361606598, 6.00014019)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])
mesh_v1f1_4 = Mesh(refine_7)

# ----
point = Point([Point(-119.3292007, 11.73650455, 6.000164032), Point(-119.3292007, 11.71886826, 6.029202461), Point(-119.3292007, 11.70123291, 6.058240891), Point(-119.3292007, 11.68359756, 6.08727932), Point(-119.3292007, 11.66596222, 6.116318226), Point(-119.3292007, 11.64832687, 6.145357132)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])
point_2 = Point([Point(-119.3292007, 11.73650455, 6.000164032), Point(-119.3292007, 11.71886826, 6.029202461), Point(-119.3292007, 11.70123291, 6.058240891), Point(-119.3292007, 11.68359756, 6.08727932), Point(-119.3292007, 11.66596222, 6.116318226), Point(-119.3292007, 11.64832687, 6.145357132)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])

# ---- group: D3F0 / Karamba
mesh_to_shell_karamba3d = MeshToShellKaramba3D(Mesh=mesh_v1f1_3, Identifier="shell01", LimitDistance_m=0.005)  # -> Element, Points, Info
cross_section_karamba3d = CrossSectionKaramba3D(
    FamilyNameOfCrossSection="DefaultCroSec",
    ElementIdentifier="shell01",
    Material=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,
    Height_cm=Slider(21, range=0..50),
    mode="Shell - Const")
support_karamba3d = SupportKaramba3D(PosInd=anchors_v1f1_3, menu=[buttons(on, on, on, off, off, off)])
loads_karamba3d = LoadsKaramba3D(Vector=Vector(0, 0, -1), LCase="0", mode="Gravity")
assemble_model_karamba3d = AssembleModelKaramba3D(
    Elem=mesh_to_shell_karamba3d.Element,
    Support=support_karamba3d,
    Load=loads_karamba3d,
    CrossSection=cross_section_karamba3d,
    Material=material_properties_karamba3d,
    LimitDistance_m=0.005)  # -> Model, Info, Mass_kg, CenterOfGravity
analyze_karamba3d = AnalyzeKaramba3D(Model=assemble_model_karamba3d.Model)  # -> CalculatedModel, MaximumDisplacement_cm, ResultingForceOfGravity_kN, ElasticEnergy_kNm
model_view_karamba3d = ModelViewKaramba3D(Model=analyze_karamba3d.CalculatedModel, ResultFactors=1, ResultCase=-1)  # -> Model, DeformedMesh, DeformedAxes, DeformedModel
shell_view_karamba3d = ShellViewKaramba3D(Model=model_view_karamba3d.Model, IndexOfLayer=0)  # -> Model, MeshesOfRenderedShells, LegendColors, LegendTags

mesh_to_shell_karamba3d_2 = MeshToShellKaramba3D(Mesh=mesh_v1f1_4, Identifier="shell01", LimitDistance_m=0.005)  # -> Element, Points, Info
cross_section_karamba3d_2 = CrossSectionKaramba3D(
    FamilyNameOfCrossSection="DefaultCroSec",
    ElementIdentifier="shell01",
    Material=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,
    Height_cm=Slider(21, range=0..50),
    mode="Shell - Const")
support_karamba3d_2 = SupportKaramba3D(PosInd=anchors_v1f1_4, menu=[buttons(on, on, on, off, off, off)])
loads_karamba3d_2 = LoadsKaramba3D(Vector=Vector(0, 0, -1), LCase="0", mode="Gravity")
assemble_model_karamba3d_2 = AssembleModelKaramba3D(
    Elem=mesh_to_shell_karamba3d_2.Element,
    Support=support_karamba3d_2,
    Load=loads_karamba3d_2,
    CrossSection=cross_section_karamba3d_2,
    Material=material_properties_karamba3d,
    LimitDistance_m=0.005)  # -> Model, Info, Mass_kg, CenterOfGravity
analyze_karamba3d_2 = AnalyzeKaramba3D(Model=assemble_model_karamba3d_2.Model)  # -> CalculatedModel, MaximumDisplacement_cm, ResultingForceOfGravity_kN, ElasticEnergy_kNm
model_view_karamba3d_2 = ModelViewKaramba3D(Model=analyze_karamba3d_2.CalculatedModel, ResultFactors=1, ResultCase=-1)  # -> Model, DeformedMesh, DeformedAxes, DeformedModel
shell_view_karamba3d_2 = ShellViewKaramba3D(Model=model_view_karamba3d_2.Model, IndexOfLayer=0)  # -> Model, MeshesOfRenderedShells, LegendColors, LegendTags

# ----
point_3 = Point(mesh_to_shell_karamba3d_2.Points)

# ---- group: D3F0 / Karamba
mesh_to_shell_karamba3d_3 = MeshToShellKaramba3D(Mesh=mesh_v1f1, Identifier="shell02", LimitDistance_m=0.005)  # -> Element, Points, Info
cross_section_karamba3d_3 = CrossSectionKaramba3D(
    FamilyNameOfCrossSection="DefaultCroSec",
    ElementIdentifier="shell02",
    Material=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,
    Height_cm=Slider(21, range=0..50),
    mode="Shell - Const")
support_karamba3d_3 = SupportKaramba3D(PosInd=anchors_v1f1, menu=[buttons(on, on, on, off, off, off)])
loads_karamba3d_3 = LoadsKaramba3D(Vector=Vector(0, 0, -1), LCase="0", mode="Gravity")
assemble_model_karamba3d_3 = AssembleModelKaramba3D(
    Elem=mesh_to_shell_karamba3d_3.Element,
    Support=support_karamba3d_3,
    Load=loads_karamba3d_3,
    CrossSection=cross_section_karamba3d_3,
    Material=material_properties_karamba3d,
    LimitDistance_m=0.005)  # -> Model, Info, Mass_kg, CenterOfGravity
analyze_karamba3d_3 = AnalyzeKaramba3D(Model=assemble_model_karamba3d_3.Model)  # -> CalculatedModel, MaximumDisplacement_cm, ResultingForceOfGravity_kN, ElasticEnergy_kNm
model_view_karamba3d_3 = ModelViewKaramba3D(Model=analyze_karamba3d_3.CalculatedModel, ResultFactors=1, ResultCase=-1)  # -> Model, DeformedMesh, DeformedAxes, DeformedModel
shell_view_karamba3d_3 = ShellViewKaramba3D(Model=model_view_karamba3d_3.Model, IndexOfLayer=0)  # -> Model, MeshesOfRenderedShells, LegendColors, LegendTags

# ----
point_4 = Point(mesh_to_shell_karamba3d_3.Points)

# ---- group: D3F0 / Karamba
mesh_to_shell_karamba3d_4 = MeshToShellKaramba3D(Mesh=mesh_v1f1_2, Identifier="shell03", LimitDistance_m=0.005)  # -> Element, Points, Info
cross_section_karamba3d_4 = CrossSectionKaramba3D(
    FamilyNameOfCrossSection="DefaultCroSec",
    ElementIdentifier="shell03",
    Material=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,
    Height_cm=Slider(21, range=0..50),
    mode="Shell - Const")
support_karamba3d_4 = SupportKaramba3D(PosInd=anchors_v1f1_2, menu=[buttons(on, on, on, off, off, off)])
loads_karamba3d_4 = LoadsKaramba3D(Vector=Vector(0, 0, -1), LCase="0", mode="Gravity")
assemble_model_karamba3d_4 = AssembleModelKaramba3D(
    Elem=mesh_to_shell_karamba3d_4.Element,
    Support=support_karamba3d_4,
    Load=loads_karamba3d_4,
    CrossSection=cross_section_karamba3d_4,
    Material=material_properties_karamba3d,
    LimitDistance_m=0.005)  # -> Model, Info, Mass_kg, CenterOfGravity
analyze_karamba3d_4 = AnalyzeKaramba3D(Model=assemble_model_karamba3d_4.Model)  # -> CalculatedModel, MaximumDisplacement_cm, ResultingForceOfGravity_kN, ElasticEnergy_kNm
model_view_karamba3d_4 = ModelViewKaramba3D(Model=analyze_karamba3d_4.CalculatedModel, ResultFactors=1, ResultCase=-1)  # -> Model, DeformedMesh, DeformedAxes, DeformedModel
shell_view_karamba3d_4 = ShellViewKaramba3D(Model=model_view_karamba3d_4.Model, IndexOfLayer=0)  # -> Model, MeshesOfRenderedShells, LegendColors, LegendTags

# ----
point_5 = Point(mesh_to_shell_karamba3d_4.Points)
panel = Panel(assemble_model_karamba3d_4.Mass_kg)
panel_2 = Panel(assemble_model_karamba3d_3.Mass_kg)
panel_3 = Panel(analyze_karamba3d.MaximumDisplacement_cm)
panel_4 = Panel(analyze_karamba3d_2.MaximumDisplacement_cm)

# ---- group: D3F0 / Results
shell_forces_karamba3d = ShellForcesKaramba3D(AnalyzedModel=shell_view_karamba3d.Model, LCase=0, mode="Principal")  # -> AnalyzedModel, FirstPrincipalNormalForce_kN_m, SecondPrincipalNormalForce_kN_m, FirstPrincipalMoment_kNm_m, SecondPrincipalMoment_kNm_m, ShearForceInLocalXDirection_kN_m, ShearForceInLocalYDirection_kN_m
legend = Legend(Colour=shell_view_karamba3d.LegendColors, Tags=shell_view_karamba3d.LegendTags, LegendType=1)
panel_5 = Panel(shell_forces_karamba3d.FirstPrincipalNormalForce_kN_m)

shell_forces_karamba3d_2 = ShellForcesKaramba3D(AnalyzedModel=shell_view_karamba3d_2.Model, LCase=0, mode="Principal")  # -> AnalyzedModel, FirstPrincipalNormalForce_kN_m, SecondPrincipalNormalForce_kN_m, FirstPrincipalMoment_kNm_m, SecondPrincipalMoment_kNm_m, ShearForceInLocalXDirection_kN_m, ShearForceInLocalYDirection_kN_m
legend_2 = Legend(Colour=shell_view_karamba3d_2.LegendColors, Tags=shell_view_karamba3d_2.LegendTags, LegendType=1)
panel_6 = Panel(shell_forces_karamba3d_2.FirstPrincipalNormalForce_kN_m)

shell_forces_karamba3d_3 = ShellForcesKaramba3D(AnalyzedModel=shell_view_karamba3d_3.Model, LCase=0, mode="Principal")  # -> AnalyzedModel, FirstPrincipalNormalForce_kN_m, SecondPrincipalNormalForce_kN_m, FirstPrincipalMoment_kNm_m, SecondPrincipalMoment_kNm_m, ShearForceInLocalXDirection_kN_m, ShearForceInLocalYDirection_kN_m
legend_3 = Legend(Colour=shell_view_karamba3d_3.LegendColors, Tags=shell_view_karamba3d_3.LegendTags, LegendType=1)
panel_7 = Panel(shell_forces_karamba3d_3.FirstPrincipalNormalForce_kN_m)

shell_forces_karamba3d_4 = ShellForcesKaramba3D(AnalyzedModel=shell_view_karamba3d_4.Model, LCase=0, mode="Principal")  # -> AnalyzedModel, FirstPrincipalNormalForce_kN_m, SecondPrincipalNormalForce_kN_m, FirstPrincipalMoment_kNm_m, SecondPrincipalMoment_kNm_m, ShearForceInLocalXDirection_kN_m, ShearForceInLocalYDirection_kN_m
legend_4 = Legend(Colour=shell_view_karamba3d_4.LegendColors, Tags=shell_view_karamba3d_4.LegendTags, LegendType=1)
panel_8 = Panel(shell_forces_karamba3d_4.FirstPrincipalNormalForce_kN_m)

# ---- group: V1F1
anchors_v1f1_5 = Point([Point(-144.0165558, -23.93619537, 4.800000191), Point(-144.0800781, -24.08873749, 4.800000191), Point(-144.1436005, -24.24128151, 4.800000191), Point(-144.2071228, -24.39382553, 4.800000191), Point(-144.2706451, -24.54636765, 4.800000191), Point(-144.3341675, -24.69891167, 4.800000191)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])
mesh_v1f1_5 = Mesh(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)

anchors_v1f1_6 = Point([<point referenced from the Rhino model> x156])
mesh_v1f1_6 = Mesh(refine_2)

anchors_v1f1_7 = Point([<point referenced from the Rhino model> x89])
mesh_v1f1_7 = Mesh(refine_4)

anchors_v1f1_8 = Point([<point referenced from the Rhino model> x59])
mesh_v1f1_8 = Mesh(refine_5)

# ---- group: D3F0 / Karamba
mesh_to_shell_karamba3d_5 = MeshToShellKaramba3D(Mesh=mesh_v1f1_5, Identifier="liwan", LimitDistance_m=0.005)  # -> Element, Points, Info
cross_section_karamba3d_5 = CrossSectionKaramba3D(
    FamilyNameOfCrossSection="DefaultCroSec",
    ElementIdentifier="liwan",
    Material=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,
    Height_cm=Slider(26, range=0..50),
    mode="Shell - Const")
support_karamba3d_5 = SupportKaramba3D(PosInd=anchors_v1f1_5, menu=[buttons(on, on, on, off, off, off)])
loads_karamba3d_5 = LoadsKaramba3D(Vector=Vector(0, 0, -1), LCase="0", mode="Gravity")
assemble_model_karamba3d_5 = AssembleModelKaramba3D(
    Elem=mesh_to_shell_karamba3d_5.Element,
    Support=support_karamba3d_5,
    Load=loads_karamba3d_5,
    CrossSection=cross_section_karamba3d_5,
    Material=material_properties_karamba3d,
    LimitDistance_m=0.005)  # -> Model, Info, Mass_kg, CenterOfGravity
analyze_karamba3d_5 = AnalyzeKaramba3D(Model=assemble_model_karamba3d_5.Model)  # -> CalculatedModel, MaximumDisplacement_cm, ResultingForceOfGravity_kN, ElasticEnergy_kNm
model_view_karamba3d_5 = ModelViewKaramba3D(Model=analyze_karamba3d_5.CalculatedModel, ResultFactors=1, ResultCase=-1)  # -> Model, DeformedMesh, DeformedAxes, DeformedModel
shell_view_karamba3d_5 = ShellViewKaramba3D(Model=model_view_karamba3d_5.Model, IndexOfLayer=0)  # -> Model, MeshesOfRenderedShells, LegendColors, LegendTags

# ----
point_6 = Point(mesh_to_shell_karamba3d_5.Points)

# ---- group: D3F0 / Karamba
mesh_to_shell_karamba3d_6 = MeshToShellKaramba3D(Mesh=mesh_v1f1_6, Identifier="liwan", LimitDistance_m=0.005)  # -> Element, Points, Info
cross_section_karamba3d_6 = CrossSectionKaramba3D(
    FamilyNameOfCrossSection="DefaultCroSec",
    ElementIdentifier="liwan",
    Material=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,
    Height_cm=Slider(24, range=0..50),
    mode="Shell - Const")
support_karamba3d_6 = SupportKaramba3D(PosInd=anchors_v1f1_6, menu=[buttons(on, on, on, off, off, off)])
loads_karamba3d_6 = LoadsKaramba3D(Vector=Vector(0, 0, -1), LCase="0", mode="Gravity")
assemble_model_karamba3d_6 = AssembleModelKaramba3D(
    Elem=mesh_to_shell_karamba3d_6.Element,
    Support=support_karamba3d_6,
    Load=loads_karamba3d_6,
    CrossSection=cross_section_karamba3d_6,
    Material=material_properties_karamba3d,
    LimitDistance_m=0.005)  # -> Model, Info, Mass_kg, CenterOfGravity
analyze_karamba3d_6 = AnalyzeKaramba3D(Model=assemble_model_karamba3d_6.Model)  # -> CalculatedModel, MaximumDisplacement_cm, ResultingForceOfGravity_kN, ElasticEnergy_kNm
model_view_karamba3d_6 = ModelViewKaramba3D(Model=analyze_karamba3d_6.CalculatedModel, ResultFactors=1, ResultCase=-1)  # -> Model, DeformedMesh, DeformedAxes, DeformedModel
shell_view_karamba3d_6 = ShellViewKaramba3D(Model=model_view_karamba3d_6.Model, IndexOfLayer=0)  # -> Model, MeshesOfRenderedShells, LegendColors, LegendTags

# ----
point_7 = Point(mesh_to_shell_karamba3d_6.Points)

# ---- group: D3F0 / Karamba
mesh_to_shell_karamba3d_7 = MeshToShellKaramba3D(Mesh=mesh_v1f1_7, Identifier="liwan", LimitDistance_m=0.005)  # -> Element, Points, Info
cross_section_karamba3d_7 = CrossSectionKaramba3D(
    FamilyNameOfCrossSection="DefaultCroSec",
    ElementIdentifier="liwan",
    Material=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,
    Height_cm=Slider(50, range=0..50),
    mode="Shell - Const")
support_karamba3d_7 = SupportKaramba3D(PosInd=anchors_v1f1_7, menu=[buttons(on, on, on, off, off, off)])
loads_karamba3d_7 = LoadsKaramba3D(Vector=Vector(0, 0, -1), LCase="0", mode="Gravity")
assemble_model_karamba3d_7 = AssembleModelKaramba3D(
    Elem=mesh_to_shell_karamba3d_7.Element,
    Support=support_karamba3d_7,
    Load=loads_karamba3d_7,
    CrossSection=cross_section_karamba3d_7,
    Material=material_properties_karamba3d,
    LimitDistance_m=0.005)  # -> Model, Info, Mass_kg, CenterOfGravity
analyze_karamba3d_7 = AnalyzeKaramba3D(Model=assemble_model_karamba3d_7.Model)  # -> CalculatedModel, MaximumDisplacement_cm, ResultingForceOfGravity_kN, ElasticEnergy_kNm
model_view_karamba3d_7 = ModelViewKaramba3D(Model=analyze_karamba3d_7.CalculatedModel, ResultFactors=1, ResultCase=-1)  # -> Model, DeformedMesh, DeformedAxes, DeformedModel
shell_view_karamba3d_7 = ShellViewKaramba3D(Model=model_view_karamba3d_7.Model, IndexOfLayer=0)  # -> Model, MeshesOfRenderedShells, LegendColors, LegendTags

# ----
point_8 = Point(mesh_to_shell_karamba3d_7.Points)

# ---- group: D3F0 / Karamba
mesh_to_shell_karamba3d_8 = MeshToShellKaramba3D(Mesh=mesh_v1f1_8, Identifier="liwan", LimitDistance_m=0.005)  # -> Element, Points, Info
cross_section_karamba3d_8 = CrossSectionKaramba3D(
    FamilyNameOfCrossSection="DefaultCroSec",
    ElementIdentifier="liwan",
    Material=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,
    Height_cm=Slider(21, range=0..50),
    mode="Shell - Const")
support_karamba3d_8 = SupportKaramba3D(PosInd=anchors_v1f1_8, menu=[buttons(on, on, on, off, off, off)])
loads_karamba3d_8 = LoadsKaramba3D(Vector=Vector(0, 0, -1), LCase="0", mode="Gravity")
assemble_model_karamba3d_8 = AssembleModelKaramba3D(
    Elem=mesh_to_shell_karamba3d_8.Element,
    Support=support_karamba3d_8,
    Load=loads_karamba3d_8,
    CrossSection=cross_section_karamba3d_8,
    Material=material_properties_karamba3d,
    LimitDistance_m=0.005)  # -> Model, Info, Mass_kg, CenterOfGravity
analyze_karamba3d_8 = AnalyzeKaramba3D(Model=assemble_model_karamba3d_8.Model)  # -> CalculatedModel, MaximumDisplacement_cm, ResultingForceOfGravity_kN, ElasticEnergy_kNm
model_view_karamba3d_8 = ModelViewKaramba3D(Model=analyze_karamba3d_8.CalculatedModel, ResultFactors=1, ResultCase=-1)  # -> Model, DeformedMesh, DeformedAxes, DeformedModel
shell_view_karamba3d_8 = ShellViewKaramba3D(Model=model_view_karamba3d_8.Model, IndexOfLayer=0)  # -> Model, MeshesOfRenderedShells, LegendColors, LegendTags

# ----
point_9 = Point(mesh_to_shell_karamba3d_8.Points)
panel_9 = Panel(analyze_karamba3d_5.MaximumDisplacement_cm)
panel_10 = Panel(analyze_karamba3d_6.MaximumDisplacement_cm)
panel_11 = Panel(analyze_karamba3d_7.MaximumDisplacement_cm)
panel_12 = Panel(analyze_karamba3d_8.MaximumDisplacement_cm)

# ---- group: D3F0 / Results
shell_forces_karamba3d_5 = ShellForcesKaramba3D(AnalyzedModel=shell_view_karamba3d_5.Model, LCase=0, mode="Principal")  # -> AnalyzedModel, FirstPrincipalNormalForce_kN_m, SecondPrincipalNormalForce_kN_m, FirstPrincipalMoment_kNm_m, SecondPrincipalMoment_kNm_m, ShearForceInLocalXDirection_kN_m, ShearForceInLocalYDirection_kN_m
legend_5 = Legend(Colour=shell_view_karamba3d_5.LegendColors, Tags=shell_view_karamba3d_5.LegendTags, LegendType=1)
panel_13 = Panel(shell_forces_karamba3d_5.FirstPrincipalNormalForce_kN_m)

shell_forces_karamba3d_6 = ShellForcesKaramba3D(AnalyzedModel=shell_view_karamba3d_6.Model, LCase=0, mode="Principal")  # -> AnalyzedModel, FirstPrincipalNormalForce_kN_m, SecondPrincipalNormalForce_kN_m, FirstPrincipalMoment_kNm_m, SecondPrincipalMoment_kNm_m, ShearForceInLocalXDirection_kN_m, ShearForceInLocalYDirection_kN_m
legend_6 = Legend(Colour=shell_view_karamba3d_6.LegendColors, Tags=shell_view_karamba3d_6.LegendTags, LegendType=1)
panel_14 = Panel(shell_forces_karamba3d_6.FirstPrincipalNormalForce_kN_m)

shell_forces_karamba3d_7 = ShellForcesKaramba3D(AnalyzedModel=shell_view_karamba3d_7.Model, LCase=0, mode="Principal")  # -> AnalyzedModel, FirstPrincipalNormalForce_kN_m, SecondPrincipalNormalForce_kN_m, FirstPrincipalMoment_kNm_m, SecondPrincipalMoment_kNm_m, ShearForceInLocalXDirection_kN_m, ShearForceInLocalYDirection_kN_m
legend_7 = Legend(Colour=shell_view_karamba3d_7.LegendColors, Tags=shell_view_karamba3d_7.LegendTags, LegendType=1)
panel_15 = Panel(shell_forces_karamba3d_7.FirstPrincipalNormalForce_kN_m)

shell_forces_karamba3d_8 = ShellForcesKaramba3D(AnalyzedModel=shell_view_karamba3d_8.Model, LCase=0, mode="Principal")  # -> AnalyzedModel, FirstPrincipalNormalForce_kN_m, SecondPrincipalNormalForce_kN_m, FirstPrincipalMoment_kNm_m, SecondPrincipalMoment_kNm_m, ShearForceInLocalXDirection_kN_m, ShearForceInLocalYDirection_kN_m
legend_8 = Legend(Colour=shell_view_karamba3d_8.LegendColors, Tags=shell_view_karamba3d_8.LegendTags, LegendType=1)
panel_16 = Panel(shell_forces_karamba3d_8.FirstPrincipalNormalForce_kN_m)

# ---- group: V1F1
anchors_v1f1_9 = Point([<point referenced from the Rhino model> x129])
mesh_v1f1_9 = Mesh(refine_6)

anchors_v1f1_10 = Point([<point referenced from the Rhino model> x108])
mesh_v1f1_10 = Mesh(refine)

# ---- group: D3F0 / Karamba
mesh_to_shell_karamba3d_9 = MeshToShellKaramba3D(Mesh=mesh_v1f1_9, Identifier="liwan", LimitDistance_m=0.005)  # -> Element, Points, Info
cross_section_karamba3d_9 = CrossSectionKaramba3D(
    FamilyNameOfCrossSection="DefaultCroSec",
    ElementIdentifier="liwan",
    Material=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,
    Height_cm=Slider(21, range=0..50),
    mode="Shell - Const")
support_karamba3d_9 = SupportKaramba3D(PosInd=anchors_v1f1_9, menu=[buttons(on, on, on, off, off, off)])
loads_karamba3d_9 = LoadsKaramba3D(Vector=Vector(0, 0, -1), LCase="0", mode="Gravity")
assemble_model_karamba3d_9 = AssembleModelKaramba3D(
    Elem=mesh_to_shell_karamba3d_9.Element,
    Support=support_karamba3d_9,
    Load=loads_karamba3d_9,
    CrossSection=cross_section_karamba3d_9,
    Material=material_properties_karamba3d,
    LimitDistance_m=0.005)  # -> Model, Info, Mass_kg, CenterOfGravity
analyze_karamba3d_9 = AnalyzeKaramba3D(Model=assemble_model_karamba3d_9.Model)  # -> CalculatedModel, MaximumDisplacement_cm, ResultingForceOfGravity_kN, ElasticEnergy_kNm
model_view_karamba3d_9 = ModelViewKaramba3D(Model=analyze_karamba3d_9.CalculatedModel, ResultFactors=1, ResultCase=-1)  # -> Model, DeformedMesh, DeformedAxes, DeformedModel
shell_view_karamba3d_9 = ShellViewKaramba3D(Model=model_view_karamba3d_9.Model, IndexOfLayer=0)  # -> Model, MeshesOfRenderedShells, LegendColors, LegendTags

# ----
point_10 = Point(mesh_to_shell_karamba3d_9.Points)

# ---- group: D3F0 / Karamba
mesh_to_shell_karamba3d_10 = MeshToShellKaramba3D(Mesh=mesh_v1f1_10, Identifier="liwan", LimitDistance_m=0.005)  # -> Element, Points, Info
cross_section_karamba3d_10 = CrossSectionKaramba3D(
    FamilyNameOfCrossSection="DefaultCroSec",
    ElementIdentifier="liwan",
    Material=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,
    Height_cm=Slider(21, range=0..50),
    mode="Shell - Const")
support_karamba3d_10 = SupportKaramba3D(PosInd=anchors_v1f1_10, menu=[buttons(on, on, on, off, off, off)])
loads_karamba3d_10 = LoadsKaramba3D(Vector=Vector(0, 0, -1), LCase="0", mode="Gravity")
assemble_model_karamba3d_10 = AssembleModelKaramba3D(
    Elem=mesh_to_shell_karamba3d_10.Element,
    Support=support_karamba3d_10,
    Load=loads_karamba3d_10,
    CrossSection=cross_section_karamba3d_10,
    Material=material_properties_karamba3d,
    LimitDistance_m=0.005)  # -> Model, Info, Mass_kg, CenterOfGravity
analyze_karamba3d_10 = AnalyzeKaramba3D(Model=assemble_model_karamba3d_10.Model)  # -> CalculatedModel, MaximumDisplacement_cm, ResultingForceOfGravity_kN, ElasticEnergy_kNm
model_view_karamba3d_10 = ModelViewKaramba3D(Model=analyze_karamba3d_10.CalculatedModel, ResultFactors=1, ResultCase=-1)  # -> Model, DeformedMesh, DeformedAxes, DeformedModel
shell_view_karamba3d_10 = ShellViewKaramba3D(Model=model_view_karamba3d_10.Model, IndexOfLayer=0)  # -> Model, MeshesOfRenderedShells, LegendColors, LegendTags

# ----
point_11 = Point(mesh_to_shell_karamba3d_10.Points)
panel_17 = Panel(analyze_karamba3d_9.MaximumDisplacement_cm)
panel_18 = Panel(analyze_karamba3d_10.MaximumDisplacement_cm)

# ---- group: D3F0 / Results
shell_forces_karamba3d_9 = ShellForcesKaramba3D(AnalyzedModel=shell_view_karamba3d_9.Model, LCase=0, mode="Principal")  # -> AnalyzedModel, FirstPrincipalNormalForce_kN_m, SecondPrincipalNormalForce_kN_m, FirstPrincipalMoment_kNm_m, SecondPrincipalMoment_kNm_m, ShearForceInLocalXDirection_kN_m, ShearForceInLocalYDirection_kN_m
legend_9 = Legend(Colour=shell_view_karamba3d_9.LegendColors, Tags=shell_view_karamba3d_9.LegendTags, LegendType=1)
panel_19 = Panel(shell_forces_karamba3d_9.FirstPrincipalNormalForce_kN_m)

shell_forces_karamba3d_10 = ShellForcesKaramba3D(AnalyzedModel=shell_view_karamba3d_10.Model, LCase=0, mode="Principal")  # -> AnalyzedModel, FirstPrincipalNormalForce_kN_m, SecondPrincipalNormalForce_kN_m, FirstPrincipalMoment_kNm_m, SecondPrincipalMoment_kNm_m, ShearForceInLocalXDirection_kN_m, ShearForceInLocalYDirection_kN_m
legend_10 = Legend(Colour=shell_view_karamba3d_10.LegendColors, Tags=shell_view_karamba3d_10.LegendTags, LegendType=1)
panel_20 = Panel(shell_forces_karamba3d_10.FirstPrincipalNormalForce_kN_m)
