# Grasshopper definition Karamba3D_upper_vaults.gh (Grasshopper 1.0.7)
# plug-ins: karambaGH

material_properties_karamba3d = MaterialPropertiesKaramba3D(
    FamilyOfMaterial="Adobe",
    Name="Adobe pure",
    YoungsModulus_kN_cm2="10.42",
    InPlaneShearModulus_kN_cm2="4.077",
    TransverseShearModulus_kN_cm2=8076,
    SpecificWeight_kN_m3="19,6",
    CoefficientOfThermalExpansion_1_C=1e-05,
    YieldStrength_kN_cm2="0,26",
    mode="Isotrop")

# ---- group: V3F1
anchors_v3f1 = Point([Point(-139.1881866, 8.436592102, 5.400001049), Point(-139.1881866, 8.136591911, 5.400001049), Point(-139.1881866, 8.736592293, 5.400001049), Point(-143.3881836, 8.436592102, 5.400001049), Point(-143.3881836, 8.136591911, 5.400001049), Point(-143.3881836, 8.736592293, 5.400001049)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])
mesh_v3f1 = Mesh(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)

anchors_v3f1_2 = Point([<point referenced from the Rhino model> x194])
mesh_v3f1_2 = Mesh(<mesh referenced from the Rhino model>)

# ---- group: V2F1
anchors_v2f1 = Point([Point(-138.8881836, 2.136591673, 5.400000572), Point(-139.1881866, 2.136591673, 5.400000572), Point(-138.5881805, 2.136591673, 5.400000572), Point(-138.2881775, 2.136591673, 5.400000572), Point(-137.9881897, 2.136591673, 5.400000572), Point(-137.6881866, 2.136591673, 5.400000572)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])
mesh_v2f1 = Mesh(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)

# ---- group: V1F1
anchors_v1f1 = Point([Point(-159.6631775, 5.736599445, 1.800014615), Point(-159.8131866, 5.736599445, 1.800014615), Point(-159.9631805, 5.736599445, 1.800014734), Point(-160.1131897, 5.736597538, 1.800013065), Point(-159.7381897, 5.736599445, 1.800014853), Point(-160.0381775, 5.736598492, 1.800013781)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])
mesh_v1f1 = Mesh(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)

# ---- group: V3F1
anchors_v3f1_3 = Point([Point(-137.3881836, -1.163408041, 5.400001526), Point(-137.3881836, -1.463407993, 5.400001526), Point(-137.3881836, -0.8634080291, 5.400001526), Point(-143.3881836, -1.163408041, 5.400001526), Point(-143.3881836, -1.463407993, 5.400001526), Point(-143.3881836, -0.8634080291, 5.400001526)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])
mesh_v3f1_3 = Mesh(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)

anchors_v3f1_4 = Point([Point(-129.8881836, 2.736593008, 5.400001526), Point(-130.1881866, 2.736593008, 5.400001526), Point(-129.5881805, 2.736593008, 5.400001526), Point(-129.8881836, 8.736591339, 5.400001526), Point(-130.1881866, 8.736591339, 5.400001526), Point(-129.5881805, 8.736591339, 5.400001526)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])
mesh_v3f1_4 = Mesh(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)

# ---- group: D3F0 / Karamba
mesh_to_shell_karamba3d = MeshToShellKaramba3D(Mesh=mesh_v3f1, Identifier="shell04", LimitDistance_m=0.005)  # -> Element, Points, Info
cross_section_karamba3d = CrossSectionKaramba3D(
    FamilyNameOfCrossSection="DefaultCroSec",
    ElementIdentifier="shell04",
    Material=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,
    Height_cm=Slider(29, range=0..50),
    mode="Shell - Const")
support_karamba3d = SupportKaramba3D(PosInd=anchors_v3f1, menu=[buttons(on, on, on, off, off, off)])
loads_karamba3d = LoadsKaramba3D(Vector=Vector(0, 0, -1), LCase="0", mode="Gravity")
assemble_model_karamba3d = AssembleModelKaramba3D(
    Elem=mesh_to_shell_karamba3d.Element,
    Support=support_karamba3d,
    Load=loads_karamba3d,
    CrossSection=cross_section_karamba3d,
    Material=material_properties_karamba3d,
    LimitDistance_m=0.005)  # -> Model, Info, Mass_kg, CenterOfGravity
analyze_karamba3d = AnalyzeKaramba3D(Model=assemble_model_karamba3d.Model)  # -> CalculatedModel, MaximumDisplacement_cm, ResultingForceOfGravity_kN, ElasticEnergy_kNm
model_view_karamba3d = ModelViewKaramba3D(Model=analyze_karamba3d.CalculatedModel, ResultFactors=1, ResultCase=-1)  # -> Model, DeformedMesh, DeformedAxes, DeformedModel
shell_view_karamba3d = ShellViewKaramba3D(Model=model_view_karamba3d.Model, IndexOfLayer=0)  # -> Model, MeshesOfRenderedShells, LegendColors, LegendTags

mesh_to_shell_karamba3d_2 = MeshToShellKaramba3D(Mesh=mesh_v1f1, Identifier="shell01", LimitDistance_m=0.005)  # -> Element, Points, Info
cross_section_karamba3d_2 = CrossSectionKaramba3D(
    FamilyNameOfCrossSection="DefaultCroSec",
    ElementIdentifier="shell01",
    Material=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,
    Height_cm=Slider(29, range=0..50),
    mode="Shell - Const")
support_karamba3d_2 = SupportKaramba3D(PosInd=anchors_v1f1, menu=[buttons(on, on, on, off, off, off)])
loads_karamba3d_2 = LoadsKaramba3D(Vector=Vector(0, 0, -1), LCase="0", mode="Gravity")
assemble_model_karamba3d_2 = AssembleModelKaramba3D(
    Elem=mesh_to_shell_karamba3d_2.Element,
    Support=support_karamba3d_2,
    Load=loads_karamba3d_2,
    CrossSection=cross_section_karamba3d_2,
    Material=material_properties_karamba3d,
    LimitDistance_m=0.005)  # -> Model, Info, Mass_kg, CenterOfGravity
analyze_karamba3d_2 = AnalyzeKaramba3D(Model=assemble_model_karamba3d_2.Model)  # -> CalculatedModel, MaximumDisplacement_cm, ResultingForceOfGravity_kN, ElasticEnergy_kNm
model_view_karamba3d_2 = ModelViewKaramba3D(Model=analyze_karamba3d_2.CalculatedModel, ResultFactors=1, ResultCase=-1)  # -> Model, DeformedMesh, DeformedAxes, DeformedModel
shell_view_karamba3d_2 = ShellViewKaramba3D(Model=model_view_karamba3d_2.Model, IndexOfLayer=0)  # -> Model, MeshesOfRenderedShells, LegendColors, LegendTags

mesh_to_shell_karamba3d_3 = MeshToShellKaramba3D(Mesh=mesh_v3f1_3, Identifier="shell03", LimitDistance_m=0.005)  # -> Element, Points, Info
cross_section_karamba3d_3 = CrossSectionKaramba3D(
    FamilyNameOfCrossSection="DefaultCroSec",
    ElementIdentifier="shell03",
    Material=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,
    Height_cm=Slider(29, range=0..50),
    mode="Shell - Const")
support_karamba3d_3 = SupportKaramba3D(PosInd=anchors_v3f1_3, menu=[buttons(on, on, on, off, off, off)])
loads_karamba3d_3 = LoadsKaramba3D(Vector=Vector(0, 0, -1), LCase="0", mode="Gravity")
assemble_model_karamba3d_3 = AssembleModelKaramba3D(
    Elem=mesh_to_shell_karamba3d_3.Element,
    Support=support_karamba3d_3,
    Load=loads_karamba3d_3,
    CrossSection=cross_section_karamba3d_3,
    Material=material_properties_karamba3d,
    LimitDistance_m=0.005)  # -> Model, Info, Mass_kg, CenterOfGravity
analyze_karamba3d_3 = AnalyzeKaramba3D(Model=assemble_model_karamba3d_3.Model)  # -> CalculatedModel, MaximumDisplacement_cm, ResultingForceOfGravity_kN, ElasticEnergy_kNm
model_view_karamba3d_3 = ModelViewKaramba3D(Model=analyze_karamba3d_3.CalculatedModel, ResultFactors=1, ResultCase=-1)  # -> Model, DeformedMesh, DeformedAxes, DeformedModel
shell_view_karamba3d_3 = ShellViewKaramba3D(Model=model_view_karamba3d_3.Model, IndexOfLayer=0)  # -> Model, MeshesOfRenderedShells, LegendColors, LegendTags

mesh_to_shell_karamba3d_4 = MeshToShellKaramba3D(Mesh=mesh_v2f1, Identifier="shell02", LimitDistance_m=0.005)  # -> Element, Points, Info
cross_section_karamba3d_4 = CrossSectionKaramba3D(
    FamilyNameOfCrossSection="DefaultCroSec",
    ElementIdentifier="shell02",
    Material=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,
    Height_cm=Slider(29, range=0..50),
    mode="Shell - Const")
support_karamba3d_4 = SupportKaramba3D(PosInd=anchors_v2f1, menu=[buttons(on, on, on, off, off, off)])
loads_karamba3d_4 = LoadsKaramba3D(Vector=Vector(0, 0, -1), LCase="0", mode="Gravity")
assemble_model_karamba3d_4 = AssembleModelKaramba3D(
    Elem=mesh_to_shell_karamba3d_4.Element,
    Support=support_karamba3d_4,
    Load=loads_karamba3d_4,
    CrossSection=cross_section_karamba3d_4,
    Material=material_properties_karamba3d,
    LimitDistance_m=0.005)  # -> Model, Info, Mass_kg, CenterOfGravity
analyze_karamba3d_4 = AnalyzeKaramba3D(Model=assemble_model_karamba3d_4.Model)  # -> CalculatedModel, MaximumDisplacement_cm, ResultingForceOfGravity_kN, ElasticEnergy_kNm
model_view_karamba3d_4 = ModelViewKaramba3D(Model=analyze_karamba3d_4.CalculatedModel, ResultFactors=1, ResultCase=-1)  # -> Model, DeformedMesh, DeformedAxes, DeformedModel
shell_view_karamba3d_4 = ShellViewKaramba3D(Model=model_view_karamba3d_4.Model, IndexOfLayer=0)  # -> Model, MeshesOfRenderedShells, LegendColors, LegendTags

mesh_to_shell_karamba3d_5 = MeshToShellKaramba3D(Mesh=mesh_v3f1_4, Identifier="shell05", LimitDistance_m=0.005)  # -> Element, Points, Info
cross_section_karamba3d_5 = CrossSectionKaramba3D(
    FamilyNameOfCrossSection="DefaultCroSec",
    ElementIdentifier="shell05",
    Material=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,
    Height_cm=Slider(21, range=0..50),
    mode="Shell - Const")
support_karamba3d_5 = SupportKaramba3D(PosInd=anchors_v3f1_4, menu=[buttons(on, on, on, off, off, off)])
loads_karamba3d_5 = LoadsKaramba3D(Vector=Vector(0, 0, -1), LCase="0", mode="Gravity")
assemble_model_karamba3d_5 = AssembleModelKaramba3D(
    Elem=mesh_to_shell_karamba3d_5.Element,
    Support=support_karamba3d_5,
    Load=loads_karamba3d_5,
    CrossSection=cross_section_karamba3d_5,
    Material=material_properties_karamba3d,
    LimitDistance_m=0.005)  # -> Model, Info, Mass_kg, CenterOfGravity
analyze_karamba3d_5 = AnalyzeKaramba3D(Model=assemble_model_karamba3d_5.Model)  # -> CalculatedModel, MaximumDisplacement_cm, ResultingForceOfGravity_kN, ElasticEnergy_kNm
model_view_karamba3d_5 = ModelViewKaramba3D(Model=analyze_karamba3d_5.CalculatedModel, ResultFactors=1, ResultCase=-1)  # -> Model, DeformedMesh, DeformedAxes, DeformedModel
shell_view_karamba3d_5 = ShellViewKaramba3D(Model=model_view_karamba3d_5.Model, IndexOfLayer=0)  # -> Model, MeshesOfRenderedShells, LegendColors, LegendTags

mesh_to_shell_karamba3d_6 = MeshToShellKaramba3D(Mesh=mesh_v3f1_2, Identifier="shell06", LimitDistance_m=0.005)  # -> Element, Points, Info
number_slider = Slider(47, range=0..50)
cross_section_karamba3d_6 = CrossSectionKaramba3D(
    FamilyNameOfCrossSection="DefaultCroSec",
    ElementIdentifier="shell06",
    Material=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,
    Height_cm="1000",
    mode="Shell - Const")
support_karamba3d_6 = SupportKaramba3D(PosInd=anchors_v3f1_2, menu=[buttons(on, on, on, off, off, off)])
loads_karamba3d_6 = LoadsKaramba3D(Vector=Vector(0, 0, -1), LCase="0", mode="Gravity")
assemble_model_karamba3d_6 = AssembleModelKaramba3D(
    Elem=mesh_to_shell_karamba3d_6.Element,
    Support=support_karamba3d_6,
    Load=loads_karamba3d_6,
    CrossSection=cross_section_karamba3d_6,
    Material=material_properties_karamba3d,
    LimitDistance_m=0.005)  # -> Model, Info, Mass_kg, CenterOfGravity
analyze_karamba3d_6 = AnalyzeKaramba3D(Model=assemble_model_karamba3d_6.Model)  # -> CalculatedModel, MaximumDisplacement_cm, ResultingForceOfGravity_kN, ElasticEnergy_kNm
model_view_karamba3d_6 = ModelViewKaramba3D(Model=analyze_karamba3d_6.CalculatedModel, ResultFactors=1, ResultCase=-1)  # -> Model, DeformedMesh, DeformedAxes, DeformedModel
shell_view_karamba3d_6 = ShellViewKaramba3D(Model=model_view_karamba3d_6.Model, IndexOfLayer=0)  # -> Model, MeshesOfRenderedShells, LegendColors, LegendTags

# ----
point = Point(assemble_model_karamba3d_5.CenterOfGravity)
panel = Panel(analyze_karamba3d.MaximumDisplacement_cm)
panel_2 = Panel(analyze_karamba3d_6.MaximumDisplacement_cm)
panel_3 = Panel(analyze_karamba3d_5.MaximumDisplacement_cm)
panel_4 = Panel(analyze_karamba3d_2.MaximumDisplacement_cm)
panel_5 = Panel(analyze_karamba3d_3.MaximumDisplacement_cm)
panel_6 = Panel(analyze_karamba3d_4.MaximumDisplacement_cm)

# ---- group: D3F0 / Results
shell_forces_karamba3d = ShellForcesKaramba3D(AnalyzedModel=shell_view_karamba3d.Model, LCase=0, mode="Principal")  # -> AnalyzedModel, FirstPrincipalNormalForce_kN_m, SecondPrincipalNormalForce_kN_m, FirstPrincipalMoment_kNm_m, SecondPrincipalMoment_kNm_m, ShearForceInLocalXDirection_kN_m, ShearForceInLocalYDirection_kN_m
legend = Legend(Colour=shell_view_karamba3d.LegendColors, Tags=shell_view_karamba3d.LegendTags, LegendType=1)
panel_7 = Panel(shell_forces_karamba3d.FirstPrincipalNormalForce_kN_m)

shell_forces_karamba3d_2 = ShellForcesKaramba3D(AnalyzedModel=shell_view_karamba3d_2.Model, LCase=0, mode="Principal")  # -> AnalyzedModel, FirstPrincipalNormalForce_kN_m, SecondPrincipalNormalForce_kN_m, FirstPrincipalMoment_kNm_m, SecondPrincipalMoment_kNm_m, ShearForceInLocalXDirection_kN_m, ShearForceInLocalYDirection_kN_m
legend_2 = Legend(Colour=shell_view_karamba3d_2.LegendColors, Tags=shell_view_karamba3d_2.LegendTags, LegendType=1)
panel_8 = Panel(shell_forces_karamba3d_2.FirstPrincipalNormalForce_kN_m)

shell_forces_karamba3d_3 = ShellForcesKaramba3D(AnalyzedModel=shell_view_karamba3d_3.Model, LCase=0, mode="Principal")  # -> AnalyzedModel, FirstPrincipalNormalForce_kN_m, SecondPrincipalNormalForce_kN_m, FirstPrincipalMoment_kNm_m, SecondPrincipalMoment_kNm_m, ShearForceInLocalXDirection_kN_m, ShearForceInLocalYDirection_kN_m
legend_3 = Legend(Colour=shell_view_karamba3d_3.LegendColors, Tags=shell_view_karamba3d_3.LegendTags, LegendType=1)
panel_9 = Panel(shell_forces_karamba3d_3.FirstPrincipalNormalForce_kN_m)

shell_forces_karamba3d_4 = ShellForcesKaramba3D(AnalyzedModel=shell_view_karamba3d_4.Model, LCase=0, mode="Principal")  # -> AnalyzedModel, FirstPrincipalNormalForce_kN_m, SecondPrincipalNormalForce_kN_m, FirstPrincipalMoment_kNm_m, SecondPrincipalMoment_kNm_m, ShearForceInLocalXDirection_kN_m, ShearForceInLocalYDirection_kN_m
legend_4 = Legend(Colour=shell_view_karamba3d_4.LegendColors, Tags=shell_view_karamba3d_4.LegendTags, LegendType=1)
panel_10 = Panel(shell_forces_karamba3d_4.FirstPrincipalNormalForce_kN_m)

shell_forces_karamba3d_5 = ShellForcesKaramba3D(AnalyzedModel=shell_view_karamba3d_6.Model, LCase=0, mode="Principal")  # -> AnalyzedModel, FirstPrincipalNormalForce_kN_m, SecondPrincipalNormalForce_kN_m, FirstPrincipalMoment_kNm_m, SecondPrincipalMoment_kNm_m, ShearForceInLocalXDirection_kN_m, ShearForceInLocalYDirection_kN_m
legend_5 = Legend(Colour=shell_view_karamba3d_6.LegendColors, Tags=shell_view_karamba3d_6.LegendTags, LegendType=1)
panel_11 = Panel(shell_forces_karamba3d_5.FirstPrincipalNormalForce_kN_m)

shell_forces_karamba3d_6 = ShellForcesKaramba3D(AnalyzedModel=shell_view_karamba3d_5.Model, LCase=0, mode="Principal")  # -> AnalyzedModel, FirstPrincipalNormalForce_kN_m, SecondPrincipalNormalForce_kN_m, FirstPrincipalMoment_kNm_m, SecondPrincipalMoment_kNm_m, ShearForceInLocalXDirection_kN_m, ShearForceInLocalYDirection_kN_m
legend_6 = Legend(Colour=shell_view_karamba3d_5.LegendColors, Tags=shell_view_karamba3d_5.LegendTags, LegendType=1)
panel_12 = Panel(shell_forces_karamba3d_6.FirstPrincipalNormalForce_kN_m)
