# Grasshopper definition Muqarnas_Python_BrickLaying_Daniella_Group_04.gh (Grasshopper 1.0.7)

# ----
# Our Muqarnas Half Vault Script.
# (Needs Symmetrical Mirroring)
z_gap = Slider(0.01, range=0..0.01)
brep = Brep(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)
brep_2 = Brep(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)
brep_3 = Brep(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)
brep_4 = Brep(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)
brep_5 = Brep(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)
python = GhPythonScript(
    Surface=brep_3,
    typeA45=brep_2,
    typeB30=brep_4,
    typeC15=brep_5,
    typeD_45_15=brep,
    z_gap=z_gap,
    x_gap=Slider(0.01, range=0..0.01))  # -> out, Bricks, BricksA, BricksB, BricksC, BricksD, Contour_isoCurves, Contour_Point, End_Points, frames; inputs Surface: Brep
# ---------- python: Python ----------
"""
__author__ = "Daniella Naous"
__version__ = "2019.10.14"

Vault Muqarnas bricklaying Python Final Version


Provides a scripting component.
    Inputs:
        srf: Surface of vault: The surface imported is cut in the middle since it is symetrical. Later it will be mirored.
        typeA45:geometry of type A muqarnas brick with 45 cm depth (with diagonal force transfer slope ~ 30/45)
        typeB30:geometry of type B muqarnas brick with 30 cm depth (with diagonal force transfer slope ~ 30/30)
        typeC15:geometry of type C muqarnas brick with 15 cm depth (with diagonal force transfer slope ~ 30/15)
        typeD_45_15:geometry of type D muqarnas brick with 45 cm depth and 15 height (with diagonal force transfer slope ~ 15/45)
        x_gap: Horizontal mortar space between bricks
        y_gap: Vertical mortar space between bricks
    Output:
        #brick_out: BRep output of all muqarnas bricks (List of the Bricks (A,B,C, and D) in seperate lists)
        # List of the End Points of of contour curves 
        # List of the Contour Curves (curves: contour horizontal isocurves along brick rows)
        # List of the Points that bricks are placed on
        List of Frames 

__author__ = "Daniella Naous"
__version__ = "2019.10.14"

##### ##### ##### ##### 
# Description
##### ##### ##### ##### 

"""
"""
Step1:
    Import the relaxed vault surface shape from rhino (baked kangaroo geometry)
Step2:
    Import the four types of mukarnas bricks as Breps (internalize them)
Step3:
    create a contour / curve lines every 30cm in z direction
Step4:
    Measure the curvature angle of the vault surface where the next brick at every brick row. 
Step5:
    #If curvature slope angle (inverseTan) is between the range of 90 - 54 degrees, then use brick typeC15)
    #If curvature slope angle (inverse tan) is between the range of 54 - 39 degrees, then use brick typeB30)
    #If curvature slope angle (inverse tan) is between the range of 39-26 degrees, then use brick typeA45)
    #If curvature slope angle (inverse tan) is between the range of 39-26 degrees, then use brick typeA45)
    #If curvature slope angle (inverse tan) is between the range of 18 - 0 degrees, then use brick typeD_45_15)
    #The range of angles have been adjusted to accommodate more variations of bricks. Initially the range was calculated with a +/- range around the slope of the diagonal of the brick. Force transfer vector
"""

##### ##### ##### ##### 
#  Initialization: importing libraries and modules that we are to use
##### ##### ##### ##### 

# Rhino Geometry is a library to handle geometries in Rhino
# Access Documentation: https://developer.rhino3d.com/api/RhinoCommon/html/N_Rhino_Geometry.htm
import Rhino.Geometry as rg 

# Default math module of python to perform basic mathematical calculations
# Access Documentation: https://docs.python.org/3/library/math.html
import math

##### ##### ##### ##### 
# Inputs: inputs of the program
##### ##### ##### ##### 

# srf: Surface of vault we are planning to place bricks on
srf = Surface

# Brick types assignment:
tA45 = typeA45
tB30 = typeB30
tC15 = typeC15
tD4515 = typeD_45_15

# Mortar gap:
zGap = z_gap
xGap = x_gap


##### ##### ##### ##### 
#  Main Body
##### ##### ##### ##### 

#####
# Contour : in this section we contour the input vault surface
#####
#height and width constant variables 
contourheight = (0.15 + zGap)
bW = xGap + 0.15

# finding the bounding box of the surface (imported as Brep)
# Doc : https://developer.rhino3d.com/api/RhinoCommon/html/M_Rhino_G eometry_Brep_CreateFromBox.htm
surfaceBound = srf.GetBoundingBox(True)

# fining the highest point and lowest point of the half cut vault surface (max and min of the vertical/diagonal bound)
# Doc : https://developer.rhino3d.com/api/RhinoCommon/html/M_Rhino_Geometry_Brep_CreateFromBox.htm
# a boundingbox is defined by 6 coordinate points, to get its size all you need is to get is the max and min point of its diagonal
#surfaceBound.Max will get us back 3 numbers, xyz;012. But we only want the height, therefore we want it to return to us only the z which is index 2
maxHeight = surfaceBound.Max[2]
minHeight = surfaceBound.Min[2]


# contouring the shape by first creating the start and end point
# and storing the contours in countourList
# Doc : https://developer.rhino3d.com/api/RhinoCommon/html/M_Rhino_Geometry_Point3d__ctor_4.htm
# Doc : https://developer.rhino3d.com/api/RhinoCommon/html/M_Rhino_Geometry_Brep_CreateContourCurves_1.htm
startCont = rg.Point3d(0,0,minHeight)  # start of contour
endCont = rg.Point3d(0,0,maxHeight)  # end of contour 
contourLines = srf.CreateContourCurves(srf,startCont,endCont,contourheight) # CreateContourCurves(Brep brepToContour,Point3d contourStart,Point3d contourEnd,double interval)

#####
# Placement : in this section we place bricks along contours
#####

# we need to initialize empty lists to save bricks, points, frames and end points on curves into
isoCurvesPointList=[]
brickList=[]
brickListA=[]
brickListB=[]
brickListC=[]
brickListD=[]
endPts = []
slopeList = []
slopeAngelList = []
frames = []
# iterating over the contour lines
# Description : https://www.w3schools.com/python/python_for_loops.asp
for curve in contourLines:
    # getting the length of the contour curve
    # Doc : https://developer.rhino3d.com/api/RhinoCommon/html/M_Rhino_Geometry_Curve_GetLength.htm
    length = curve.GetLength()

    # dividing the length of the curve by the width of the brick + mortar gap to find out how many bricks can we place on this line
    # we use math.ceil to make sure that the line is completely covered with bricks
    # Doc : https://docs.python.org/2/library/math.html#math.ceil
    brickNum = math.ceil(length/bW) # to get the number of briicks we'll need, we will devide the length of the curve by the diagonal

    # dividing the curve to find the curve_parameters of the points 
    # that we need to place our bricks on
    # Doc : https://developer.rhino3d.com/api/RhinoCommon/html/M_Rhino_Geometry_Curve_DivideByCount.htm
    curveDivisionList = curve.DivideByCount(brickNum,True)
    #creating an empty list for local frames to place bricks on
    lclFrames = []
    # iterating over the curve_parameters and placing bricks on each point and local frame
    # Description : https://www.w3schools.com/python/python_for_loops.asp
    for rowSubDivision in curveDivisionList:

        # finding the point in the given rowSubDivision of the curve_parameter
        # Doc : https://developer.rhino3d.com/api/RhinoCommon/html/M_Rhino_Geometry_Curve_PointAt.htm
        point = curve.PointAt(rowSubDivision) #created a point on the curve

        # adding the point to the list of all the points (isoCurvesPointList)
        isoCurvesPointList.append(point)
        # Now I want to make a local coordination system along the curve because it is useful for orientation. we are going to use the tangent to do the with FrameAt(rowSubDivision)
        # defining a frame based on the rowSubDivision of curve_parameter
        # recieve the boolen rowSubDivision and frame
        # Doc : https://developer.rhino3d.com/api/RhinoCommon/html/M_Rhino_Geometry_Curve_FrameAt.htm
        #the returned rowSubDivision frame is acually a plane. the x asix is along the curve direction
        #THis function has two outputs one a boolean and another a plane
        (successCheck,myframe) = curve.FrameAt(rowSubDivision)
        #we append it into the local frames list wich is a sister list inside the mother list frames. 
        lclFrames.append(myframe) #these local frames are placed at every point a brick would be placed for every curve/row 
    #appending the list of local frames into the list of frames. This creates a nested list for our frames on all curves/rows on the surface
    frames.append(lclFrames)        

#Measure the curvature angle of the vault surface where the next brick at every brick row. 

        

for crv in contourLines:
    # get list of end points: we only use the end points of each curve because the slope is the same along the entire curve at every level
    endPts.append(crv.PointAtStart)

#setting the intervals per type of brick
#we are deviding the dimentions into two so the the brick will be placed in the middle of the point on the curve and surface. 
# so if our brick is 0.30 deep, we would want 0.15 to be placed on the right side and -0.15 to be placed on the left side of the point on curve

# Creating intervals in three dimensions, required to create the brick
# Doc : https://developer.rhino3d.com/api/RhinoCommon/html/T_Rhino_Geometry_Interval.htm

#the width is the same for all bricks types
xi = rg.Interval(-0.075,0.075) 

#the depth and height veries per brick type
tA45_yi = rg.Interval(-0.1125,0.1125)
tA45_zi = rg.Interval(-0.075,0.075) 

tB30_yi = rg.Interval(-0.075,0.075) 
tB30_zi = rg.Interval(-0.075,0.075) 

tC15_yi = rg.Interval(-0.075,0.075) 
tC15_zi = rg.Interval(-0.075,0.075) 

tD4515_yi = rg.Interval(-0.225,0.225)
tD4515_zi = rg.Interval(-0.075,0.075) 

# in some trials we start from index 1 instead of zero because we do not want a very wide or very narrow brick to be the start of our vault.
for i in range(0, len(frames)):
    #for every row we want to get the origin coordinates of the first point [index 0]
    #so we are going through every list in the nested list of frames and getting the 0 index value from the localframes list
    #https://developer.rhino3d.com/api/RhinoCommon/html/P_Rhino_Geometry_Point3d_Origin.htm
    #curpnt= curve point
    curPnt = frames[i][0].Origin
    y1 = curPnt.Y
    z1 = curPnt.Z
    #behPnt is the behind point. Point on curve behind the i curve
    behPnt = frames[i-1][0].Origin
    y2 = behPnt.Y
    z2 = behPnt.Z
    #calculation slope from coordinates of z and y of end point between two curves
    slope = (z1-z2)/(y1-y2)
    #calculating the angle from the slope (inverse tan (opposite/addjecent)). Then converting the angle from radians to degrees 
    slopeAngel = math.degrees(math.atan(slope))
    slopeList.append(slope)
    slopeAngelList.append(slopeAngel)
                
    # all bricks in a single row/ curve level should be the same because the angle is the same. 
    #Therefore we are running a for loop throught the mother nested list frames.
    #"i" sows through every row of frames (list of lists), while "j" gows though the nested list of rowSubDivisions of the row into local frames
    for j in range(len(frames[i])):
        # if curvature slope angle (inteverse tan) is between the range degignated range of degrees, then use the corresponding brick type
        # creating a box as the brick with the dimensions specified in intervals (xi, yi,zi)
        # and the plane created based on the direction and position of the curve (frame)
        # Doc : https://developer.rhino3d.com/api/RhinoCommon/html/T_Rhino_Geometry_Box.htm
        # Doc: https://developer.rhino3d.com/api/RhinoCommon/html/M_Rhino_Geometry_Box__ctor_1.htm
        #brick = rg.Box(myframe,xi,yi,zi)
        # adding the brick to the list of bricks (brickList)
        #brickList.append(brick)
        
        #If curvature slope angle (inteverse tan) is between the range of 90 - 54 degrees, then use brick typeC15)
        if slopeAngel <= 90 and slopeAngel>75:
            brickC= rg.Box(frames[i][j],xi,tC15_yi,tC15_zi)
            brickListC.append(brickC)
        #If curvature slope angle (inteverse tan) is between the range of 54 - 39 degrees, then use brick typeB30)
        elif slopeAngel <= 75 and slopeAngel>60:
            brickB = rg.Box(frames[i][j],xi,tB30_yi,tB30_zi)
            brickListB.append(brickB)
        #If curvature slope angle (inteverse tan) is between the range of 39-26 degrees, then use brick typeA45)
        elif slopeAngel <= 60 and slopeAngel>45:
            brickA = rg.Box(frames[i][j],xi,tA45_yi,tA45_zi)
            brickListA.append(brickA)
        #If curvature slope angle (inteverse tan) is between the range of 18 - 0 degrees, then use brick typeD_45_15)
        elif slopeAngel <=45 and slopeAngel>=0:
            brickD = rg.Box(frames[i][j],xi,tD4515_yi,tD4515_zi)
             # adding the brick to the list of bricks (brickList)
            brickListD.append(brickD)



##### ##### ##### ##### 
# Outputs: outputs of the program
##### ##### ##### ##### 


# List of the Points that bricks are placed on
Contour_Points = isoCurvesPointList
# List of the Contour Curves
Contour_isoCurves = contourLines
# List of the Bricks
Bricks = brickList
BricksA = brickListA
BricksB = brickListB
BricksC = brickListC
BricksD = brickListD
# List of the End Points of of contour curves 
End_Points = endPts
# ---------- end python ----------
pln = Plane(python.frames)
brep_6 = Brep(python.BricksB)
brep_7 = Brep(python.BricksA)
brep_8 = Brep(python.BricksC)
curve = Curve(python.Contour_isoCurves)
point = Point(python.Contour_Point)
point_2 = Point(python.End_Points)
brep_9 = Brep(python.BricksD)

plane = Plane(PlaneXZ(-13, 4, 2))
brep_10 = Brep([brep_8, brep_6, brep_7, brep_9])
mesh = Mesh([brep_7, brep_6, brep_8, brep_9])
mirror = Mirror(Geometry=brep_10, Plane=plane)  # -> Geometry, Transform
# tessellation and welding (WB) liwan
# dynamic relaxation_liwan
# liwan (without front tiles)
brep_11 = Brep([brep_10, mirror.Geometry])
