# Grasshopper definition TopologicalVoxelation_PZN_C_Script_Daniella.gh (Grasshopper 1.0.7)

a_higher_version_of_the_high_vault = Mesh(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)
high_rise_vault_mesh = Mesh(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)
# Chose the mesh hight version you would like to voxelate
low_rise_vault_mesh = Mesh(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)

b15x15x10 = Brep(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)
b30x30x10 = Brep(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)
b7_5x7_5x10 = Brep(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)
mesh = Mesh(low_rise_vault_mesh)

panel = Panel("""0
0.3
0.6
0.9
1.2
1.5
1.575
1.65
1.725
1.8""")
trial_1 = Panel("""0
0.3
0.6
0.9
1.2
1.5
1.8
2.1
2.4
2.7
3
3.3
3.6
3.9
4.2
4.5""")
trial_2 = Panel("""0
0.3
0.6
0.9
1.2
1.5
1.8
2.1
2.4
2.7
3
3.15
3.3
3.45
3.6
3.75
3.9
4.05
4.2
4.275
4.35
4.425
4.5""")
trial_3 = Panel("""0
0.3
0.6
0.9
1.2
1.5
1.8
2.1
2.4
2.7
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""")
trial_3_2 = Panel("""36
38
40
42
44
46
48""")
trial_3_3 = Panel("""50
52
54""")
low_rise_indexes_2 = Panel("5")
low_rise_indexes_3 = Panel("""7
9""")
trial_3_5 = Panel("""51
53""")
low_rise_indexes_4 = Panel("8")
trial_3_6 = Panel("""1
3
5
7
9
11
13
15
17
19
21
23
25
27
29
31
33
35""")
low_rise_indexes_5 = Panel("""1
3""")
trial_3_7 = Panel("""0
2
4
6
8
10
12
14
16
18
20
22
24
26
28
30
32
34""")
low_rise_indexes_6 = Panel("""0
2
4""")

# ----
# Check out the best
# two trials of high rise
# and low rise
high_vault = Data([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])
low_rise_muqarnas_voxelated_vault = Mesh([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])

# ----
# Muqarnas bricklaying via Voxilation Intersection. Applied on two different vault heights
box = Box({Plane=PlaneXY(-160.2881866, 5.43659277, 1.800001144), X=Domain(0, 0.1), Y=Domain(0, 0.3), Z=Domain(0, 0.3)})
box_2 = Box({Plane=PlaneXY(-160.2881866, 5.58659277, 1.950001144), X=Domain(0, 0.1), Y=Domain(0, 0.15), Z=Domain(-0.15, 0)})
box_3 = Box({Plane=Plane(origin=(-160.2881866, 5.66159277, 1.875001144), x=(0, 1, 0), y=(1, 0, 0)), X=Domain(0, 0.075), Y=Domain(0, 0.1), Z=Domain(0, 0.075)})
unit_x = UnitX(Factor=0.05)
unit_y = UnitY(Factor=-0.0375)
unit_x_2 = UnitX(Factor=0.05)
unit_y_2 = UnitY(Factor=-0.075)
unit_x_3 = UnitX(Factor=0.05)
unit_y_3 = UnitY(Factor=-0.15)

panel_2 = Panel(panel)
X = UnitX(Factor=-0.05)
move = Move(Geometry=graft(mesh), Motion=X)  # -> Geometry, Transform
trial_2_2 = Panel("""10
12
14
16""")
trial_2_3 = Panel("""11
13
15
17""")
trial_2_4 = Panel("""18
20
22""")
trial_2_5 = Panel("""19
21""")
list_item = ListItem(List=panel_2, Index=low_rise_indexes_2, Wrap=True)
list_item_2 = ListItem(List=panel_2, Index=low_rise_indexes_4, Wrap=True)
list_item_3 = ListItem(List=panel_2, Index=0, Wrap=True)
list_item_4 = ListItem(List=panel_2, Index=low_rise_indexes_3, Wrap=True)
trial_2_6 = Panel("""1
3
5
7
9""")
trial_2_7 = Panel("""0
2
4
6
8""")
unit_z = UnitZ(Factor=list_item)
unit_z_2 = UnitZ(Factor=list_item_3)
list_item_5 = ListItem(List=panel_2, Index=low_rise_indexes_5, Wrap=True)
unit_z_3 = UnitZ(Factor=list_item_2)
unit_z_4 = UnitZ(Factor=list_item_4)
list_item_6 = ListItem(List=panel_2, Index=low_rise_indexes_6, Wrap=True)
move_2 = Move(Geometry=graft(b15x15x10), Motion=unit_z)  # -> Geometry, Transform
move_3 = Move(Geometry=graft(b15x15x10), Motion=unit_z_2)  # -> Geometry, Transform; disabled
move_4 = Move(Geometry=graft(b7_5x7_5x10), Motion=unit_z_3)  # -> Geometry, Transform
move_5 = Move(Geometry=graft(b7_5x7_5x10), Motion=unit_z_4)  # -> Geometry, Transform
unit_z_5 = UnitZ(Factor=list_item_5)
move_6 = Move(Geometry=graft(move_4.Geometry), Motion=unit_x)  # -> Geometry, Transform
move_7 = Move(Geometry=graft(b30x30x10), Motion=unit_z_5)  # -> Geometry, Transform

unit_z_6 = UnitZ(Factor=list_item_6)
move_8 = Move(Geometry=graft(b30x30x10), Motion=unit_z_6)  # -> Geometry, Transform

smesh = SimpleMesh(Brep=move_5.Geometry)
quad = Quadrangulate(Mesh=smesh, Angle=0.03490658504, Ratio=0.875)  # -> Mesh, Count
series = Series(Start=0, Step=0.1, Count=100)
mesh_2 = Mesh(quad.Mesh)
weld = WeldMesh(Mesh=mesh_2, Angle=3.141592654)
X_2 = UnitX(Factor=series)
series_2 = Series(Start=0, Step=0.075, Count=100)
move_9 = Move(Geometry=graft(weld), Motion=X_2)  # -> Geometry, Transform
Y = UnitY(Factor=series_2)
move_10 = Move(Geometry=graft(move_9.Geometry), Motion=Y)  # -> Geometry, Transform

smesh_2 = SimpleMesh(Brep=move_3.Geometry)  # disabled
quad_2 = Quadrangulate(Mesh=smesh_2, Angle=0.03490658504, Ratio=0.875)  # -> Mesh, Count; disabled
series_3 = Series(Start=0, Step=0.1, Count=75)  # disabled
mesh_3 = Mesh(quad_2.Mesh)  # disabled
weld_2 = WeldMesh(Mesh=mesh_3, Angle=3.141592654)  # disabled
X_3 = UnitX(Factor=series_3)  # disabled
series_4 = Series(Start=0, Step=0.15, Count=50)  # disabled
move_11 = Move(Geometry=graft(weld_2), Motion=X_3)  # -> Geometry, Transform; disabled
Y_2 = UnitY(Factor=series_4)  # disabled
move_12 = Move(Geometry=graft(move_11.Geometry), Motion=Y_2)  # -> Geometry, Transform; disabled

smesh_3 = SimpleMesh(Brep=move_8.Geometry)
quad_3 = Quadrangulate(Mesh=smesh_3, Angle=0.03490658504, Ratio=0.875)  # -> Mesh, Count
series_5 = Series(Start=0, Step=0.1, Count=75)
mesh_4 = Mesh(quad_3.Mesh)
weld_3 = WeldMesh(Mesh=mesh_4, Angle=3.141592654)
X_4 = UnitX(Factor=series_5)
series_6 = Series(Start=0, Step=0.3, Count=100)
move_13 = Move(Geometry=graft(weld_3), Motion=X_4)  # -> Geometry, Transform
Y_3 = UnitY(Factor=series_6)
move_14 = Move(Geometry=graft(move_13.Geometry), Motion=Y_3)  # -> Geometry, Transform

move_15 = Move(Geometry=graft(move_6.Geometry), Motion=unit_y)  # -> Geometry, Transform

smesh_4 = SimpleMesh(Brep=move_15.Geometry)
quad_4 = Quadrangulate(Mesh=smesh_4, Angle=0.03490658504, Ratio=0.875)  # -> Mesh, Count
series_7 = Series(Start=0, Step=0.1, Count=100)
mesh_5 = Mesh(quad_4.Mesh)
weld_4 = WeldMesh(Mesh=mesh_5, Angle=3.141592654)
X_5 = UnitX(Factor=series_7)
series_8 = Series(Start=0, Step=0.075, Count=100)
move_16 = Move(Geometry=graft(weld_4), Motion=X_5)  # -> Geometry, Transform
Y_4 = UnitY(Factor=series_8)
move_17 = Move(Geometry=graft(move_16.Geometry), Motion=Y_4)  # -> Geometry, Transform

move_18 = Move(Geometry=graft(move_2.Geometry), Motion=unit_x_2)  # -> Geometry, Transform
series_9 = Series(Start=0, Step=0.1, Count=100)
X_6 = UnitX(Factor=series_9)
series_10 = Series(Start=0, Step=0.15, Count=50)
Y_5 = UnitY(Factor=series_10)

move_19 = Move(Geometry=graft(move_7.Geometry), Motion=unit_x_3)  # -> Geometry, Transform
series_11 = Series(Start=0, Step=0.1, Count=75)
X_7 = UnitX(Factor=series_11)
series_12 = Series(Start=0, Step=0.3, Count=100)
Y_6 = UnitY(Factor=series_12)

move_20 = Move(Geometry=graft(move_18.Geometry), Motion=unit_y_2)  # -> Geometry, Transform
move_21 = Move(Geometry=graft(move_19.Geometry), Motion=unit_y_3)  # -> Geometry, Transform

smesh_5 = SimpleMesh(Brep=move_20.Geometry)
quad_5 = Quadrangulate(Mesh=smesh_5, Angle=0.03490658504, Ratio=0.875)  # -> Mesh, Count
mesh_6 = Mesh(quad_5.Mesh)
weld_5 = WeldMesh(Mesh=mesh_6, Angle=3.141592654)
move_22 = Move(Geometry=graft(weld_5), Motion=X_6)  # -> Geometry, Transform
move_23 = Move(Geometry=graft(move_22.Geometry), Motion=Y_5)  # -> Geometry, Transform

smesh_6 = SimpleMesh(Brep=move_21.Geometry)
quad_6 = Quadrangulate(Mesh=smesh_6, Angle=0.03490658504, Ratio=0.875)  # -> Mesh, Count
mesh_7 = Mesh(quad_6.Mesh)
weld_6 = WeldMesh(Mesh=mesh_7, Angle=3.141592654)
move_24 = Move(Geometry=graft(weld_6), Motion=X_7)  # -> Geometry, Transform
move_25 = Move(Geometry=graft(move_24.Geometry), Motion=Y_6)  # -> Geometry, Transform

smlvoxel_meshes = Mesh(flatten([move_14.Geometry, move_25.Geometry, move_17.Geometry, move_10.Geometry, move_12.Geometry, move_23.Geometry]))
medges = MeshEdges(Mesh=smlvoxel_meshes)  # -> NakedEdges, InteriorEdges, NonManifoldEdges
tri = Triangulate(Mesh=move.Geometry)  # -> Mesh, Count
merge = Merge(Data1=medges.NakedEdges, Data2=medges.InteriorEdges, Data3=medges.NonManifoldEdges)
line = Line(merge)
c_script = CSharpScript(M=tri.Mesh, MeshEdgesDT=line)  # -> out, A; inputs M: Mesh, MeshEdgesDT: tree of Line
# ---------- c_script: C# usings ----------
//author: Pirouz Nourian
# ---------- c_script: C# ----------
    //written by Pirouz Nourian based on this code: https://github.com/Pirouz-Nourian/Topological_Voxelizer_CSharp/blob/master/Voxelizer_Functions.cs
    //check this paper for the theory: https://www.researchgate.net/publication/290507635_Voxelization_Algorithms_for_Geospatial_Applications

    int n = MeshEdgesDT.BranchCount;
    List<int> blockIndexes = new List<int>();
    for(int i = 0;i < n;i++){
      List<Line> edgeLines = MeshEdgesDT.Branch(i);
      int m = edgeLines.Count;
      //Print(m.ToString());
      bool DoesIntersect = false;
      for(int j = 0;j < m;j++){//foreach (Line edgeLine in edgeLines){
        Line edgeLine = edgeLines[j];
        int[] faceIds;
        Point3d[] intersectionPoints = Rhino.Geometry.Intersect.Intersection.MeshLine(M, edgeLine, out faceIds);
        if(intersectionPoints.Length > 0){
          //Print("yes");
          DoesIntersect = DoesIntersect || true;
          break;
        }
        //        if (){
        //          //          //blockIndexes.Add(i);
        //          //          DoesIntersect = DoesIntersect || true;
        //        }
      }
      if(DoesIntersect){blockIndexes.Add(i);}
    }

    A = blockIndexes;
# ---------- c_script: C# additional code ----------
  public bool MeshLineIntersect(Rhino.Geometry.Mesh x, Rhino.Geometry.Line L) //this is now for reading triangles from Rhino Mesh objects; can be eventually replaced with something, which reads OBJ mesh objects
  {
    //List<Point3d[]> TVs = new List<Point3d[]>();
    //List of Triangle Vertices
    Point3d[] TV = new Point3d[3];
    //Triangle Vertices
    Point3f av = default(Point3f);
    Point3f bv = default(Point3f);
    Point3f cv = default(Point3f);
    Point3f dv = default(Point3f);

    //Each face As MeshFace In x.Faces
    bool does = false;
    for (int k = 0; k <= x.Faces.Count - 1; k++) {
      x.Faces.GetFaceVertices(k, out av, out bv, out cv, out dv);
      TV = new Point3d[] {new Point3d(av), new Point3d(bv),new Point3d(cv)};
      //TVs.Add(TV);
      if (TriangleLineIntersect(TV, x.FaceNormals[k], L)){
        does = true;
      }
    }
    return does;//TVs.Exists(Lambda => TriangleLineIntersect(Lambda, L));
  }
  public bool TriangleLineIntersect(Rhino.Geometry.Point3d[] Vx, Rhino.Geometry.Vector3d Normal, Rhino.Geometry.Line L)
  {
    if (Vx.Length != 3) {
      throw new Exception("Triangle is not valid!");
    }
    Point3d O = Vx[0];
    Vector3d U = Vx[1] - O;
    Vector3d V = Vx[2] - O;
    Vector3d N = Normal;//Vector3d.CrossProduct(U, V);
    //plane normal

    Point3d PS = L.From;//start point of the line
    Point3d PE = L.To;  //end point of the line

    double Nomin = ((O - PS) * N);
    //operator * for dot product
    double Denom = N * (PE - PS);

    // only if the line is not paralell to the plane containing triangle T
    if (Denom != 0) {
      double alpha = Nomin / Denom;
      // parameter along the line where it intersects the plane in question, only if not paralell to the plane
      Point3d P = PS + alpha * (PE - PS);
      //L.PointAt(alpha) '

      Vector3d W = P - O;

      double UU = U * U;
      double VV = V * V;
      double UV = U * V;
      double WU = W * U;
      double WV = W * V;

      double STDenom = Math.Pow(UV, 2) - UU * VV;

      double s = (UV * WV - VV * WU) / STDenom;
      double t = (UV * WU - UU * WV) / STDenom;

      Point3d Point = O + s * U + t * V;

      if (s >= 0 & t >= 0 & s + t <= 1) {
        return true;
      } else {
        return false;
      }
    } else {
      return false;
    }
  }
# ---------- end c_script ----------
item = ListItem(List=smlvoxel_meshes, Index=c_script.A, Wrap=True)

int = Integer(c_script.A)
mesh_8 = Mesh(item)
