# Grasshopper definition bricklaying_straight_wall.gh (Grasshopper 1.0.7)

# ----
# BRICKLAYING
#  OF WALL Maria DImas
# MAKING BRICKS IN DIFFERENT DIRECTION (DIFFERENT CONTROL POINTS)
# Width + Mortar
number_slider = Slider(0.145, range=0..1)
number_slider_2 = Slider(0.08, range=0..0.1)
number_slider_3 = Slider(0.01, range=0..0.01)
num = Number(expr("x*2", number_slider))
addition = Addition(A=num, B=number_slider_3)

# ----
# DIMENSIONS
# Length + Mortar
width = Slider(0.15, range=0..25)
mortar = Slider(1, range=0..5)
expression = Expression(x=number_slider, y=number_slider_3, Expression="(2*x)+y")
num_2 = Number(addition)

# ----
# Single Brick
rectangle = Rectangle(Plane=PlaneXY(0, 0, 0), XSize=num_2, YSize=number_slider, Radius=0)  # -> Rectangle, Length
boundary = BoundarySurfaces(Edges=rectangle.Rectangle)
Z = UnitZ(Factor=number_slider_2)
extr = Extrude(Base=boundary, Direction=Z)

# ----
# Rotated Brick
rotate = Rotate(Geometry=extr, Angle=degrees(270), Plane=PlaneXY(0, 0, 0))  # -> Geometry, Transform
unit_y = UnitY(Factor=expr("x/2", num_2))
move = Move(Geometry=rotate.Geometry, Motion=unit_y)  # -> Geometry, Transform

# ----
# Rotated Brick
rotate_2 = Rotate(Geometry=extr, Angle=degrees(270), Plane=PlaneXY(0, 0, 0))  # -> Geometry, Transform
unit_y_2 = UnitY(Factor=num_2)
move_2 = Move(Geometry=rotate_2.Geometry, Motion=unit_y_2)  # -> Geometry, Transform

brick = Brep(move.Geometry)

# ----
# Bricks
brick_2 = Brep(move_2.Geometry)
rotated_brick = Brep(extr)

# ----
# Wall
pt = ConstructPoint(XCoordinate=0, YCoordinate=0, ZCoordinate=0)
pt_2 = ConstructPoint(XCoordinate=330, YCoordinate=66, ZCoordinate=180)
box = Box2Pt(PointA=pt, PointB=pt_2, Plane=PlaneXY(0, 0, 0))

# ----
# IF MESH
# Wall mesh to brep
mesh = MeshBrep(
    Brep=box,
    Settings={GridMaxCount=0, GridMinCount=16, JaggedSeams=False, MaxEdgeLength=0, MinEdgeLength=0.0001, MinTolerance=0, Refine=True, RefineAngle=0, RelativeTolerance=0.65, SimplePlanes=True, Tolerance=0})
mesh_2 = Mesh(mesh)
faceb = FaceBoundaries(Mesh=mesh_2)
boundary_2 = BoundarySurfaces(Edges=faceb)
join = BrepJoin(Breps=boundary_2)  # -> Breps, Closed

# ----
# IF BREP
brep = Brep(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)

# ----
# MAKING THE WALL (NORMALLY IMPORTED)
brep_2 = Brep(brep)

# ----
# Length
# Length + 2Mortar
# Length + Mortar
# -(Length + 2Mortar)
# Width
# Width + Mortar
# Mortar
# Length + Width +
# 2Mortar
# -(Length + Width +
# 2Mortar)
# Height
# Height + Mortar
# (Width + Mortar)/2
# (Lenght + 2Mortar)/4
addition_2 = Addition(A=number_slider_3, B=number_slider)
num_3 = Number(expr("x*2", number_slider))
addition_3 = Addition(A=number_slider_2, B=number_slider_3)
num_4 = Number(number_slider)
num_5 = Number(expression)
num_6 = Number(number_slider_3)
num_7 = Number(number_slider_2)
num_8 = Number(addition_2)
num_9 = Number(expr("x/2", num_8))
num_10 = Number(addition_3)
addition_4 = Addition(A=num_5, B=num_6)
num_11 = Number(expr("x/4", addition_4))
addition_5 = Addition(A=num_5, B=num_8)
neg = Negative(Value=addition_4)
neg_2 = Negative(Value=addition_5)

# ----
# Width
# Length + 2Mortar
# -(Length + 2Mortar)
# Point list
# Width + Mortar
rotated_brick_2 = Brep(rotated_brick)
brep_3 = Brep(brep_2)
brep_4 = Brep(brick_2)
addition_6 = Addition(A=num_5, B=num_6)
neg_3 = Negative(Value=addition_4)
num_12 = Number(num_4)
num_13 = Number(addition_2)
neg_4 = Negative(Value=num_13)

X = UnitX(Factor=Slider(-0.145, range=-1..1.001))
move_3 = Move(Geometry=brep_4, Motion=X)  # -> Geometry, Transform
unit_y_3 = UnitY(Factor=expr("x/2", num_2))
X_2 = UnitX(Factor=Slider(-0.3, range=-1..1.001))
move_4 = Move(Geometry=rotated_brick_2, Motion=X_2)  # -> Geometry, Transform
move_5 = Move(Geometry=extr, Motion=unit_y_3)  # -> Geometry, Transform
X_3 = UnitX(Factor=0.17)
move_6 = Move(Geometry=move_4.Geometry, Motion=X_3)  # -> Geometry, Transform

deconstruct_brep = DeconstructBrep(Brep=brep_3)  # -> Faces, Edges, Vertices
inside_surface_index = Slider(1, range=0..10)
inside_surface_index_2 = Slider(1, range=0..10)
item = ListItem(List=deconstruct_brep.Vertices, Index=inside_surface_index, Wrap=True)
item_2 = ListItem(List=deconstruct_brep.Faces, Index=inside_surface_index_2, Wrap=True)
contour = Contour(Shape=item_2, Point=item, Direction=Vector(0, 0, 1), Distance=num_10)  # -> flatten(Contours)
dispatch = Dispatch(List=contour, DispatchPattern=[True, False])  # -> ListA, ListB
division = Division(A=num_12, B=-2)
division_2 = Division(A=num_12, B=-1)

X_4 = UnitX(Factor=neg_4)
X_5 = UnitX(Factor=num_13)

# ----
# if wall is brep
number_slider_4 = Slider(1, range=0..5)
brep_5 = Brep(brep_2)
debrep = DeconstructBrep(Brep=brep_5)  # -> Faces, Edges, Vertices
item_3 = ListItem(List=debrep.Faces, Index=number_slider_4, Wrap=True)
item_4 = ListItem(List=debrep.Faces, Index=Slider(3, range=0..5), Wrap=True)
move_7 = Move(Geometry=item_3, Motion=X_4)  # -> Geometry, Transform
move_8 = Move(Geometry=item_4, Motion=X_5)  # -> Geometry, Transform
sdiff = SolidDifference(BrepsA=brep_5, BrepsB=move_8.Geometry)
sdiff_2 = SolidDifference(BrepsA=brep_5, BrepsB=move_7.Geometry)
sdiff_3 = SolidDifference(BrepsA=brep_5, BrepsB=sdiff_2)
sdiff_4 = SolidDifference(BrepsA=sdiff_3, BrepsB=sdiff)

X_6 = UnitX(Factor=Slider(-0.3, range=-4..5))
X_7 = UnitX(Factor=addition_6)

# ----
# Pattern 2
extend_curve = ExtendCurve(Curve=dispatch.ListB, Type=0, Start=division_2, End=division)
divide_length = DivideLength(Curve=extend_curve, Length=addition_6)  # -> Points, Tangents, Parameters
estimated_tickness_in_layers = Slider(9, range=0..10)
linear_array = LinearArray(Geometry=divide_length.Points, Direction=X_6, Count=estimated_tickness_in_layers)  # -> Geometry, Transform
linear_array_2 = LinearArray(Geometry=divide_length.Points, Direction=X_7, Count=estimated_tickness_in_layers)  # -> Geometry, Transform
point = Point(flatten([linear_array_2.Geometry, linear_array.Geometry]))
cull_duplicates = CullDuplicates(Points=point, Tolerance=0.1, CullMode=3)  # -> Points, Indices, Valence

X_8 = UnitX(Factor=neg_3)
X_9 = UnitX(Factor=addition_6)

# ----
# Pattern 1
# Direction of points
extend_curve_2 = ExtendCurve(Curve=dispatch.ListA, Type=0, Start=division, End=0)
divide_length_2 = DivideLength(Curve=extend_curve_2, Length=num_13)  # -> Points, Tangents, Parameters
estimated_tickness_in_layers_2 = Slider(4, range=0..10)
bottom_edge_vertice_index = Slider(3, range=0..10)
linear_array_3 = LinearArray(Geometry=divide_length_2.Points, Direction=X_8, Count=estimated_tickness_in_layers_2)  # -> Geometry, Transform
linear_array_4 = LinearArray(Geometry=divide_length_2.Points, Direction=X_9, Count=estimated_tickness_in_layers_2)  # -> Geometry, Transform
item_5 = ListItem(List=deconstruct_brep.Vertices, Index=bottom_edge_vertice_index, Wrap=True)
point_2 = Point(flatten([linear_array_4.Geometry, linear_array_3.Geometry]))
cull_duplicates_2 = CullDuplicates(Points=point_2, Tolerance=0.1, CullMode=3)  # -> Points, Indices, Valence
scale = Scale(Geometry=brep_3, Center=item_5, Factor=0.999)  # -> Geometry, Transform
point_in_brep = PointInBrep(Brep=scale.Geometry, Point=cull_duplicates_2.Points, Strict=False)
dispatch_2 = Dispatch(List=cull_duplicates_2.Points, DispatchPattern=point_in_brep)  # -> ListA, ListB
vector_2pt = Vector2Pt(PointA=Point(0, 0, 0), PointB=dispatch_2.ListA, Unitize=False)  # -> Vector, Length
move_9 = Move(Geometry=move_4.Geometry, Motion=vector_2pt.Vector)  # -> Geometry, Transform
bricks_positioned = Brep(move_9.Geometry)

X_10 = UnitX(Factor=addition_6)
X_11 = UnitX(Factor=neg_3)

# ----
# Pattern 1
# Direction of points
extend_curve_3 = ExtendCurve(Curve=dispatch.ListB, Type=0, Start=division_2, End=division)
divide_length_3 = DivideLength(Curve=extend_curve_3, Length=num_13)  # -> Points, Tangents, Parameters
estimated_tickness_in_layers_3 = Slider(8, range=0..10)
linear_array_5 = LinearArray(Geometry=divide_length_3.Points, Direction=X_10, Count=estimated_tickness_in_layers_3)  # -> Geometry, Transform
linear_array_6 = LinearArray(Geometry=divide_length_3.Points, Direction=X_11, Count=estimated_tickness_in_layers_3)  # -> Geometry, Transform
point_3 = Point(flatten([linear_array_6.Geometry, linear_array_5.Geometry]))
cull_duplicates_3 = CullDuplicates(Points=point_3, Tolerance=0.1, CullMode=3)  # -> Points, Indices, Valence
point_in_brep_2 = PointInBrep(Brep=sdiff_4, Point=cull_duplicates_3.Points, Strict=False)
dispatch_3 = Dispatch(List=cull_duplicates_3.Points, DispatchPattern=point_in_brep_2)  # -> ListA, ListB
vector_2pt_2 = Vector2Pt(PointA=Point(0, 0, 0), PointB=dispatch_3.ListA, Unitize=False)  # -> Vector, Length
move_10 = Move(Geometry=move_6.Geometry, Motion=vector_2pt_2.Vector)  # -> Geometry, Transform
bricks_positioned_2 = Brep(move_10.Geometry)

# ----
# Side 1
# Side 2
bottom_edge_vertice_index_2 = Slider(1, range=0..10)
item_6 = ListItem(List=deconstruct_brep.Vertices, Index=bottom_edge_vertice_index_2, Wrap=True)
scale_2 = Scale(Geometry=sdiff_2, Center=item_6, Factor=0.999)  # -> Geometry, Transform
scale_3 = Scale(Geometry=sdiff, Center=item_6, Factor=0.999)  # -> Geometry, Transform
point_in_brep_3 = PointInBrep(Brep=scale_2.Geometry, Point=cull_duplicates.Points, Strict=False)
point_in_brep_4 = PointInBrep(Brep=scale_3.Geometry, Point=cull_duplicates.Points, Strict=False)
dispatch_4 = Dispatch(List=cull_duplicates.Points, DispatchPattern=point_in_brep_3)  # -> ListA, ListB
dispatch_5 = Dispatch(List=cull_duplicates.Points, DispatchPattern=point_in_brep_4)  # -> ListA, ListB
vector_2pt_3 = Vector2Pt(PointA=Point(0, 0, 0), PointB=dispatch_4.ListA, Unitize=False)  # -> Vector, Length
vector_2pt_4 = Vector2Pt(PointA=Point(0, 0, 0), PointB=dispatch_5.ListA, Unitize=False)  # -> Vector, Length
pt_3 = Point(dispatch_5.ListA)
pt_4 = Point(dispatch_4.ListA)
move_11 = Move(Geometry=brep_4, Motion=vector_2pt_4.Vector)  # -> Geometry, Transform
move_12 = Move(Geometry=move_3.Geometry, Motion=vector_2pt_3.Vector)  # -> Geometry, Transform
bricks_positioned_3 = Brep(move_11.Geometry)
bricks_positioned_4 = Brep(move_12.Geometry)

# ----
# FINAL WALL
# LIMITATION: i n grasshopper each wall
# directed differently (x,y) has to be
# scripted differently, changing the
# direction of the bricks being used)
data = Data([bricks_positioned_4, bricks_positioned_3, bricks_positioned, bricks_positioned_2])
