# Grasshopper definition BrickPattern_attractors.gh (Grasshopper 1.0.7)
# plug-ins: Parakeet, LunchBox

xy_plane = XYPlane(Origin=Point(0, 0, 0))
square = Square(Plane=xy_plane, Size=1, ExtentX=Slider(21, range=0..100), ExtentY=Slider(11, range=0..100))  # -> Cells, Points
area = Area(Geometry=square.Cells)  # -> Area, Centroid
point = Point(<point referenced from the Rhino model>)
pull_point = PullPoint(Point=area.Centroid, Geometry=point, ClosestOnly=True)  # -> ClosestPoint, Distance
construct_domain = ConstructDomain(DomainStart=Slider(0.05, range=0..0.1), DomainEnd=Slider(0.95, range=0..1))
bounds = Bounds(Numbers=flatten(pull_point.Distance))
remap_numbers = RemapNumbers(Value=pull_point.Distance, Source=bounds, Target=construct_domain)  # -> Mapped, Clipped

surface = Surface(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)
staggered_quad_panels = StaggeredQuadPanels(Surface=surface, UDivisions=Slider(19, range=0..100), VDivisions=Slider(16, range=0..100))  # -> flatten(Panels)
area_2 = Area(Geometry=staggered_quad_panels)  # -> Area, Centroid
point_2 = Point(Point(9.606601807, -25.99290272, 4.561825229))
closest_point = ClosestPoint(Point=area_2.Centroid, Cloud=point_2)  # -> ClosestPoint, CPIndex, Distance
bounds_2 = Bounds(Numbers=flatten(closest_point.Distance))
construct_domain_2 = ConstructDomain(DomainStart=Slider(0.85, range=0..1), DomainEnd=Slider(0.62, range=0..1))
remap_numbers_2 = RemapNumbers(Value=closest_point.Distance, Source=bounds_2, Target=construct_domain_2)  # -> Mapped, Clipped
construct_domain² = ConstructDomain²(UMin=remap_numbers_2.Mapped, UMax=expr("1-x", construct_domain_2), VMin=0, VMax=1)
isotrim = Isotrim(Surface=reparameterize(staggered_quad_panels), Domain=construct_domain²)
unit_y = UnitY(Factor=Slider(0.2, range=0..1))
# Panels from lunchbox
extrude = Extrude(Base=isotrim, Direction=unit_y)

surface_2 = Surface(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)
brick_type_d = BrickTypeD(
    BaseSurface=surface_2,
    UCount=Slider(42, range=0..100),
    VCount=Slider(28, range=0..100),
    OffsetDistance=Slider(0.01, range=0..0.1))  # -> flatten(Bricks_1), flatten(Bricks_2)
surface_3 = Surface([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])
area_3 = Area(Geometry=surface_3)  # -> Area, Centroid
point_3 = Point(Point(9.606601807, -25.99290272, 4.561825229))
closest_point_2 = ClosestPoint(Point=area_3.Centroid, Cloud=point_3)  # -> ClosestPoint, CPIndex, Distance
bounds_3 = Bounds(Numbers=flatten(closest_point_2.Distance))
construct_domain_3 = ConstructDomain(DomainStart=Slider(0.47, range=0..1), DomainEnd=Slider(0, range=0..1))
# Bricks with attractors, following the sun path!
remap_numbers_3 = RemapNumbers(Value=closest_point_2.Distance, Source=bounds_3, Target=construct_domain_3)  # -> Mapped, Clipped
construct_domain²_2 = ConstructDomain²(UMin=remap_numbers_3.Mapped, UMax=expr("1-x", construct_domain_3), VMin=0, VMax=1)
isotrim_2 = Isotrim(Surface=reparameterize([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]), Domain=construct_domain²_2)
# Horizontal Bricks
number_slider = Slider(0.2, range=0..1)
unit_y_2 = UnitY(Factor=number_slider)
extrude_2 = Extrude(Base=isotrim_2, Direction=unit_y_2)

# ----
# Surface with attractors
pattern_genotype_f = PatternGenotypeF(BasePolylines=square.Cells, Factor=remap_numbers.Mapped)

area_4 = Area(Geometry=extrude_2)  # -> Area, Centroid
area_5 = Area(Geometry=isotrim_2)  # -> Area, Centroid
# Rotate
number_slider_2 = Slider(0, range=0..100)
number_slider_3 = Slider(43, range=0..100)
pull = PullPoint(Point=area_4.Centroid, Geometry=area_5.Centroid, ClosestOnly=True)  # -> ClosestPoint, Distance
bnd = Bounds(Numbers=flatten(pull.Distance))
remap = RemapNumbers(Value=pull.Distance, Source=number_slider_2, Target=number_slider_3)  # -> Mapped, Clipped
rotate = Rotate(Geometry=extrude_2, Angle=degrees(remap.Mapped), Plane=area_4.Centroid)  # -> Geometry, Transform
# First Brick Layer
# Vertical Bricks
preview = CustomPreview(Geometry=rotate.Geometry, Material=ColourSwatch(SwatchColor=RGB(39, 87, 52)))

remap_2 = RemapNumbers(Value=pull.Distance, Source=number_slider_2, Target=number_slider_3)  # -> Mapped, Clipped

# ----
# Brick Type A - Facade
number_slider_4 = Slider(24.25, range=0..30)
negative = Negative(Value=number_slider_4)
unit_x = UnitX(Factor=negative)
curve = Curve(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)
move = Move(Geometry=curve, Motion=unit_x)  # -> Geometry, Transform
number_slider_5 = Slider(242, range=0..300)
loft = Loft(
    Curves=[move.Geometry, curve],
    Options={Adjust=False, Closed=False, LoftEnds=0, LoftSimp=0, LoftType=0, Rebuild=10, Refit=0.01})
brick_type_a = BrickTypeA(BaseSurface=loft, UCount=242, VCount=Slider(40, range=0..100), OffsetDistance=0)
unit_y_3 = UnitY(Factor=Slider(0.1, range=0..5))
surface_4 = Surface(brick_type_a)
extrude_3 = Extrude(Base=surface_4, Direction=unit_y_3)

unit_y_4 = UnitY(Factor=Slider(0.1, range=0..0.1))
move_2 = Move(Geometry=extrude_3, Motion=unit_y_4)  # -> Geometry, Transform
