# Grasshopper definition Catenary nubian vaults_kangaroo.gh (Grasshopper 1.0.7)
# plug-ins: Kangaroo2 Components

# ----
# east // classrooms
number_slider = Slider(30, range=0..100)
surface = Surface([<surface referenced from the Rhino model> x3])
mesh_surface = MeshSurface(Surface=surface, UCount=number_slider, VCount=Slider(30, range=0..100), Overhang=True, Equalize=False)
refine = Refine(Mesh=mesh_surface, Level=Slider(0.1, range=0..0.5))
nakedvertices = NakedVertices(Mesh=refine)  # -> ClothedIndex, NakedIndex, ClothedPts, NakedPts
curve = Curve([<curve referenced from the Rhino model> x4])
mesh = Mesh(mesh_surface)
point_in_curves = PointInCurves(Point=[nakedvertices.ClothedPts, nakedvertices.NakedPts], Curves=curve)  # -> Relationship, Index, Point
meshcorners = MeshCorners(Mesh=mesh, Angle=2.35619449)
dispatch = Dispatch(List=[nakedvertices.ClothedPts, nakedvertices.NakedPts], DispatchPattern=point_in_curves.Relationship)  # -> ListA, ListB
panel = Panel("10000")
edgelengths = EdgeLengths(Mesh=mesh, LengthFactor=1, Strength=Slider(200, range=0..200))
anchor = Anchor(Point=[meshcorners, dispatch.ListA], Strength=Slider(8000, range=0..10000))
data = Data(dispatch.ListA)
vertexloads = VertexLoads(Mesh=mesh, Strength=Slider(1.2, range=0..5))
show = Show(G=mesh)
solver = Solver(GoalObjects=[show, edgelengths, anchor, vertexloads], Reset=Button(), Threshold=1e-15, Tolerance=0.01, On=True)  # -> I, V, graft(O)
list_item = ListItem(List=solver.O, Index=0, Wrap=True)

# ----
# east // corner space
number_slider_2 = Slider(30, range=0..100)
surface_2 = Surface(<surface referenced from the Rhino model>)
mesh_surface_2 = MeshSurface(Surface=surface_2, UCount=number_slider_2, VCount=Slider(43, range=0..100), Overhang=True, Equalize=False)
refine_2 = Refine(Mesh=mesh_surface_2, Level=Slider(0.1, range=0..0.5))
nakedvertices_2 = NakedVertices(Mesh=refine_2)  # -> ClothedIndex, NakedIndex, ClothedPts, NakedPts
curve_2 = Curve([<curve referenced from the Rhino model> x2])
mesh_2 = Mesh(mesh_surface_2)
point_in_curves_2 = PointInCurves(Point=[nakedvertices_2.ClothedPts, nakedvertices_2.NakedPts], Curves=curve_2)  # -> Relationship, Index, Point
meshcorners_2 = MeshCorners(Mesh=mesh_2, Angle=2.35619449)
dispatch_2 = Dispatch(List=[nakedvertices_2.ClothedPts, nakedvertices_2.NakedPts], DispatchPattern=point_in_curves_2.Relationship)  # -> ListA, ListB
edgelengths_2 = EdgeLengths(Mesh=mesh_2, LengthFactor=1, Strength=Slider(200, range=0..200))
anchor_2 = Anchor(Point=[meshcorners_2, dispatch_2.ListA], Strength=Slider(8000, range=0..10000))
data_2 = Data(dispatch_2.ListA)
vertexloads_2 = VertexLoads(Mesh=mesh_2, Strength=Slider(1.2, range=0..5))
show_2 = Show(G=mesh_2)
solver_2 = Solver(GoalObjects=[show_2, edgelengths_2, anchor_2, vertexloads_2], Reset=Button(), Threshold=1e-15, Tolerance=0.01, On=True)  # -> I, V, graft(O)
list_item_2 = ListItem(List=solver_2.O, Index=0, Wrap=True)

# ----
# north // safe houses // WIDE 4.5
number_slider_3 = Slider(23, range=0..100)
surface_3 = Surface([<surface referenced from the Rhino model> x2])
mesh_surface_3 = MeshSurface(Surface=surface_3, UCount=number_slider_3, VCount=Slider(15, range=0..100), Overhang=True, Equalize=False)
refine_3 = Refine(Mesh=mesh_surface_3, Level=Slider(0.1, range=0..0.5))
nakedvertices_3 = NakedVertices(Mesh=refine_3)  # -> ClothedIndex, NakedIndex, ClothedPts, NakedPts
curve_3 = Curve([<curve referenced from the Rhino model> x7])
mesh_3 = Mesh(mesh_surface_3)
point_in_curves_3 = PointInCurves(Point=[nakedvertices_3.ClothedPts, nakedvertices_3.NakedPts], Curves=curve_3)  # -> Relationship, Index, Point
meshcorners_3 = MeshCorners(Mesh=mesh_3, Angle=2.35619449)
dispatch_3 = Dispatch(List=[nakedvertices_3.ClothedPts, nakedvertices_3.NakedPts], DispatchPattern=point_in_curves_3.Relationship)  # -> ListA, ListB
edgelengths_3 = EdgeLengths(Mesh=mesh_3, LengthFactor=1, Strength=Slider(200, range=0..200))
anchor_3 = Anchor(Point=[meshcorners_3, dispatch_3.ListA], Strength=Slider(8000, range=0..10000))
data_3 = Data(dispatch_3.ListA)
vertexloads_3 = VertexLoads(Mesh=mesh_3, Strength=Slider(2.4, range=0..5))
show_3 = Show(G=mesh_3)
solver_3 = Solver(GoalObjects=[show_3, edgelengths_3, anchor_3, vertexloads_3], Reset=Button(), Threshold=1e-15, Tolerance=0.01, On=True)  # -> I, V, graft(O)
list_item_3 = ListItem(List=solver_3.O, Index=0, Wrap=True)

# ----
# auxiliary wing
number_slider_4 = Slider(15, range=0..100)
surface_4 = Surface([<surface referenced from the Rhino model> x6])
mesh_surface_4 = MeshSurface(Surface=surface_4, UCount=number_slider_4, VCount=Slider(15, range=0..100), Overhang=True, Equalize=False)
refine_4 = Refine(Mesh=mesh_surface_4, Level=Slider(0.1, range=0..0.5))
nakedvertices_4 = NakedVertices(Mesh=refine_4)  # -> ClothedIndex, NakedIndex, ClothedPts, NakedPts
curve_4 = Curve([<curve referenced from the Rhino model> x8])
mesh_4 = Mesh(mesh_surface_4)
point_in_curves_4 = PointInCurves(Point=[nakedvertices_4.ClothedPts, nakedvertices_4.NakedPts], Curves=curve_4)  # -> Relationship, Index, Point
meshcorners_4 = MeshCorners(Mesh=mesh_4, Angle=2.35619449)
dispatch_4 = Dispatch(List=[nakedvertices_4.ClothedPts, nakedvertices_4.NakedPts], DispatchPattern=point_in_curves_4.Relationship)  # -> ListA, ListB
edgelengths_4 = EdgeLengths(Mesh=mesh_4, LengthFactor=1, Strength=Slider(200, range=0..200))
anchor_4 = Anchor(Point=[meshcorners_4, dispatch_4.ListA], Strength=Slider(8000, range=0..10000))
data_4 = Data(dispatch_4.ListA)
vertexloads_4 = VertexLoads(Mesh=mesh_4, Strength=Slider(2.4, range=0..5))
show_4 = Show(G=mesh_4)
solver_4 = Solver(GoalObjects=[show_4, edgelengths_4, anchor_4, vertexloads_4], Reset=Button(), Threshold=1e-15, Tolerance=0.01, On=True)  # -> I, V, graft(O)
list_item_4 = ListItem(List=solver_4.O, Index=0, Wrap=True)

# ----
# north // safe houses // NARROW 3
number_slider_5 = Slider(15, range=0..100)
surface_5 = Surface([<surface referenced from the Rhino model> x6])
mesh_surface_5 = MeshSurface(Surface=surface_5, UCount=number_slider_5, VCount=Slider(15, range=0..100), Overhang=True, Equalize=False)
refine_5 = Refine(Mesh=mesh_surface_5, Level=Slider(0.1, range=0..0.5))
nakedvertices_5 = NakedVertices(Mesh=refine_5)  # -> ClothedIndex, NakedIndex, ClothedPts, NakedPts
curve_5 = Curve([<curve referenced from the Rhino model> x7])
mesh_5 = Mesh(mesh_surface_5)
point_in_curves_5 = PointInCurves(Point=[nakedvertices_5.ClothedPts, nakedvertices_5.NakedPts], Curves=curve_5)  # -> Relationship, Index, Point
meshcorners_5 = MeshCorners(Mesh=mesh_5, Angle=2.35619449)
dispatch_5 = Dispatch(List=[nakedvertices_5.ClothedPts, nakedvertices_5.NakedPts], DispatchPattern=point_in_curves_5.Relationship)  # -> ListA, ListB
edgelengths_5 = EdgeLengths(Mesh=mesh_5, LengthFactor=1, Strength=Slider(200, range=0..200))
anchor_5 = Anchor(Point=[meshcorners_5, dispatch_5.ListA], Strength=Slider(8000, range=0..10000))
data_5 = Data(dispatch_5.ListA)
vertexloads_5 = VertexLoads(Mesh=mesh_5, Strength=Slider(2.4, range=0..5))
show_5 = Show(G=mesh_5)
solver_5 = Solver(GoalObjects=[show_5, edgelengths_5, anchor_5, vertexloads_5], Reset=Button(), Threshold=1e-15, Tolerance=0.01, On=True)  # -> I, V, graft(O)
list_item_5 = ListItem(List=solver_5.O, Index=0, Wrap=True)

# ----
# east // workshops
number_slider_6 = Slider(30, range=0..100)
surface_6 = Surface([<surface referenced from the Rhino model> x2])
mesh_surface_6 = MeshSurface(Surface=surface_6, UCount=number_slider_6, VCount=Slider(30, range=0..100), Overhang=True, Equalize=False)
refine_6 = Refine(Mesh=mesh_surface_6, Level=Slider(0.1, range=0..0.5))
nakedvertices_6 = NakedVertices(Mesh=refine_6)  # -> ClothedIndex, NakedIndex, ClothedPts, NakedPts
curve_6 = Curve([<curve referenced from the Rhino model> x3])
mesh_6 = Mesh(mesh_surface_6)
point_in_curves_6 = PointInCurves(Point=[nakedvertices_6.ClothedPts, nakedvertices_6.NakedPts], Curves=curve_6)  # -> Relationship, Index, Point
meshcorners_6 = MeshCorners(Mesh=mesh_6, Angle=2.35619449)
dispatch_6 = Dispatch(List=[nakedvertices_6.ClothedPts, nakedvertices_6.NakedPts], DispatchPattern=point_in_curves_6.Relationship)  # -> ListA, ListB
edgelengths_6 = EdgeLengths(Mesh=mesh_6, LengthFactor=1, Strength=Slider(200, range=0..200))
anchor_6 = Anchor(Point=[meshcorners_6, dispatch_6.ListA], Strength=Slider(8000, range=0..10000))
data_6 = Data(dispatch_6.ListA)
vertexloads_6 = VertexLoads(Mesh=mesh_6, Strength=Slider(1.5, range=0..5))
show_6 = Show(G=mesh_6)
solver_6 = Solver(GoalObjects=[show_6, edgelengths_6, anchor_6, vertexloads_6], Reset=Button(), Threshold=1e-15, Tolerance=0.01, On=True)  # -> I, V, graft(O)
list_item_6 = ListItem(List=solver_6.O, Index=0, Wrap=True)

# ----
# west // medical wing
number_slider_7 = Slider(22, range=0..100)
surface_7 = Surface([<surface referenced from the Rhino model> x4])
mesh_surface_7 = MeshSurface(Surface=surface_7, UCount=number_slider_7, VCount=Slider(30, range=0..100), Overhang=True, Equalize=False)
refine_7 = Refine(Mesh=mesh_surface_7, Level=Slider(0.1, range=0..0.5))
nakedvertices_7 = NakedVertices(Mesh=refine_7)  # -> ClothedIndex, NakedIndex, ClothedPts, NakedPts
curve_7 = Curve([<curve referenced from the Rhino model> x5])
mesh_7 = Mesh(mesh_surface_7)
point_in_curves_7 = PointInCurves(Point=[nakedvertices_7.ClothedPts, nakedvertices_7.NakedPts], Curves=curve_7)  # -> Relationship, Index, Point
meshcorners_7 = MeshCorners(Mesh=mesh_7, Angle=2.35619449)
dispatch_7 = Dispatch(List=[nakedvertices_7.ClothedPts, nakedvertices_7.NakedPts], DispatchPattern=point_in_curves_7.Relationship)  # -> ListA, ListB
edgelengths_7 = EdgeLengths(Mesh=mesh_7, LengthFactor=1, Strength=Slider(200, range=0..200))
anchor_7 = Anchor(Point=[meshcorners_7, dispatch_7.ListA], Strength=Slider(8000, range=0..10000))
data_7 = Data(dispatch_7.ListA)
vertexloads_7 = VertexLoads(Mesh=mesh_7, Strength=Slider(1.2, range=0..5))
show_7 = Show(G=mesh_7)
solver_7 = Solver(GoalObjects=[show_7, edgelengths_7, anchor_7, vertexloads_7], Reset=Button(), Threshold=1e-15, Tolerance=0.01, On=True)  # -> I, V, graft(O)
list_item_7 = ListItem(List=solver_7.O, Index=0, Wrap=True)

# ----
# west // medical wing // first and last
number_slider_8 = Slider(49, range=0..100)
surface_8 = Surface([<surface referenced from the Rhino model> x2])
mesh_surface_8 = MeshSurface(Surface=surface_8, UCount=number_slider_8, VCount=Slider(30, range=0..100), Overhang=True, Equalize=False)
refine_8 = Refine(Mesh=mesh_surface_8, Level=Slider(0.1, range=0..0.5))
nakedvertices_8 = NakedVertices(Mesh=refine_8)  # -> ClothedIndex, NakedIndex, ClothedPts, NakedPts
curve_8 = Curve([<curve referenced from the Rhino model> x4])
mesh_8 = Mesh(mesh_surface_8)
point_in_curves_8 = PointInCurves(Point=[nakedvertices_8.ClothedPts, nakedvertices_8.NakedPts], Curves=curve_8)  # -> Relationship, Index, Point
meshcorners_8 = MeshCorners(Mesh=mesh_8, Angle=2.35619449)
dispatch_8 = Dispatch(List=[nakedvertices_8.ClothedPts, nakedvertices_8.NakedPts], DispatchPattern=point_in_curves_8.Relationship)  # -> ListA, ListB
edgelengths_8 = EdgeLengths(Mesh=mesh_8, LengthFactor=1, Strength=Slider(200, range=0..200))
anchor_8 = Anchor(Point=[meshcorners_8, dispatch_8.ListA], Strength=Slider(8000, range=0..10000))
data_8 = Data(dispatch_8.ListA)
vertexloads_8 = VertexLoads(Mesh=mesh_8, Strength=Slider(1.2, range=0..5))
show_8 = Show(G=mesh_8)
solver_8 = Solver(GoalObjects=[show_8, edgelengths_8, anchor_8, vertexloads_8], Reset=Button(), Threshold=1e-15, Tolerance=0.01, On=True)  # -> I, V, graft(O)
list_item_8 = ListItem(List=solver_8.O, Index=0, Wrap=True)
