# Grasshopper definition Catenary nubian vaults_karamba.gh (Grasshopper 1.0.7)
# plug-ins: Karamba, Kangaroo2 Components

# ----
# material properties
panel = Panel("Brick")
material_properties_karamba3d = MaterialPropertiesKaramba3D(
    FamilyOfMaterial="Steel",
    Name=panel,
    YoungsModulus_kN_cm2="8",
    InPlaneShearModulus_kN_cm2="3.2",
    TransverseShearModulus_kN_cm2="3.2",
    SpecificWeight_kN_m3="15.9",
    CoefficientOfThermalExpansion_1_C=1e-05,
    YieldStrength_kN_cm2=23.5,
    mode="Isotrop")  # -> graft(Material)

wall = Surface([<surface referenced from the Rhino model> x2])
mesh_surface = MeshSurface(Surface=wall, UCount=Slider(30, range=0..30), VCount=Slider(13, range=0..15), Overhang=True, Equalize=False)
deconstruct_mesh = DeconstructMesh(Mesh=mesh_surface)  # -> Vertices, Faces, Colours, Normals
thickness = Slider(70, range=0..100)
line = Line([Line((15.8279403, 85.61712271, 0), (15.8279403, 92.06712335, 0)), Line((3.827940298, 92.06712335, 0), (3.827940298, 85.61712271, 0))])
curve_closest_point = CurveClosestPoint(Point=graft(deconstruct_mesh.Vertices), Curve=line)  # -> Point, Parameter, Distance
cross_section_karamba3d = CrossSectionKaramba3D(
    FamilyNameOfCrossSection="DefaultCroSec",
    ElementIdentifier="exterior walls",
    Material=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,
    Height_cm=thickness,
    mode="Shell - Const")
removeduplicatepts = RemoveDuplicatePts(Points=curve_closest_point.Point, Tolerance=0.01)
mesh_to_shell_karamba3d = MeshToShellKaramba3D(Mesh=mesh_surface, Identifier="exterior walls", CrossSection=cross_section_karamba3d, LimitDistance_m=0.005)  # -> Element, Points, Info
support_karamba3d = SupportKaramba3D(PosInd=removeduplicatepts, menu=[buttons(on, on, on, on, on, on)])

wall_2 = Surface(<surface referenced from the Rhino model>)
mesh_surface_2 = MeshSurface(Surface=wall_2, UCount=Slider(30, range=0..30), VCount=Slider(13, range=0..15), Overhang=True, Equalize=False)
deconstruct_mesh_2 = DeconstructMesh(Mesh=mesh_surface_2)  # -> Vertices, Faces, Colours, Normals
thickness_2 = Slider(30, range=0..100)
line_2 = Line(Line((9.827940298, 92.06712335, 0), (9.827940298, 85.61712271, 0)))
curve_closest_point_2 = CurveClosestPoint(Point=deconstruct_mesh_2.Vertices, Curve=line_2)  # -> Point, Parameter, Distance
cross_section_exterior_walls = CrossSectionKaramba3D(
    FamilyNameOfCrossSection="DefaultCroSec",
    ElementIdentifier="interior walls",
    Material=material_properties_karamba3d,
    Height_cm=thickness_2,
    mode="Shell - Const")
removeduplicatepts_2 = RemoveDuplicatePts(Points=curve_closest_point_2.Point, Tolerance=0.01)
mesh_to_shell_karamba3d_2 = MeshToShellKaramba3D(Mesh=mesh_surface_2, Identifier="interior walls", CrossSection=cross_section_exterior_walls, LimitDistance_m=0.005)  # -> Element, Points, Info
support_karamba3d_2 = SupportKaramba3D(PosInd=removeduplicatepts_2, menu=[buttons(on, on, on, on, on, on)])

vault = Mesh([<mesh referenced from the Rhino model> x2])
deconstruct_mesh_3 = DeconstructMesh(Mesh=vault)  # -> Vertices, Faces, Colours, Normals
# support placement
cross_section_vault = CrossSectionKaramba3D(
    FamilyNameOfCrossSection="DefaultCroSec",
    ElementIdentifier="shell",
    Material=material_properties_karamba3d,
    Height_cm=Slider(20, range=0..30),
    mode="Shell - Const")
line_3 = Line([Line((15.8279403, 85.61712271, 2.4), (15.8279403, 92.06712335, 2.4)), Line((9.827940298, 85.61712271, 2.4), (9.827940298, 92.06712335, 2.4)), Line((3.827940298, 85.61712271, 2.4), (3.827940298, 92.06712335, 2.4))])
curve_closest_point_3 = CurveClosestPoint(Point=deconstruct_mesh_3.Vertices, Curve=graft(line_3))  # -> Point, Parameter, Distance
removeduplicatepts_3 = RemoveDuplicatePts(Points=curve_closest_point_3.Point, Tolerance=0.01)
mesh_to_shell_karamba3d_3 = MeshToShellKaramba3D(Mesh=vault, Identifier="shell", CrossSection=cross_section_vault, LimitDistance_m=0.005)  # -> Element, Points, Info
support_karamba3d_3 = SupportKaramba3D(PosInd=removeduplicatepts_3, menu=[buttons(off, on, on, off, off, off)])

loads_karamba3d = LoadsKaramba3D(Vector=Vector(0, 0, -1), LCase="0", mode="Gravity")
assemble_model_karamba3d = AssembleModelKaramba3D(
    Elem=flatten([mesh_to_shell_karamba3d_2.Element, mesh_to_shell_karamba3d_3.Element, mesh_to_shell_karamba3d.Element]),
    Support=flatten([support_karamba3d_2, support_karamba3d, support_karamba3d_3]),
    Load=loads_karamba3d,
    Material=material_properties_karamba3d,
    LimitDistance_m=0.005)  # -> Model, Info, Mass_kg, CenterOfGravity
total_mass = Panel(assemble_model_karamba3d.Mass_kg)

analyze_karamba3d = AnalyzeKaramba3D(Model=assemble_model_karamba3d.Model)  # -> CalculatedModel, MaximumDisplacement_cm, ResultingForceOfGravity_kN, ElasticEnergy_kNm
beso_for_shells_karamba3d = BESOForShellsKaramba3D(
    Model=assemble_model_karamba3d.Model,
    ElemIds="shell",
    LCases="0",
    TargetMassRatio=Slider(7, range=0..10),
    MaxIter=10,
    ER=-1,
    ARmax=0.05,
    Nhist=3,
    Conv=0.01,
    Rmin=-1,
    Rexp=1,
    KillThick=1e-05)  # -> BSEOModel, ModelHistory, CHistory, VHistory, Info
shell_view_karamba3d = ShellViewKaramba3D(Model=beso_for_shells_karamba3d.BSEOModel, IndexOfLayer=0)  # -> Model, MeshesOfRenderedShells, LegendColors, LegendTags
model_view_karamba3d = ModelViewKaramba3D(Model=analyze_karamba3d.CalculatedModel, LoadCaseFactorsForLinearSuperposition=1, IndexOfVisibleLoadcase=-1)  # -> Model, DeformedMesh, DeformedAxes, DeformedModel

# ----
# deformation result
deformation_result = Panel(analyze_karamba3d.MaximumDisplacement_cm)

# ----
# analysis result selection
shell_view_karamba3d_2 = ShellViewKaramba3D(Model=[model_view_karamba3d.Model, shell_view_karamba3d.Model], IndexOfLayer=0)  # -> Model, MeshesOfRenderedShells, LegendColors, LegendTags

legend = Legend(Colour=shell_view_karamba3d_2.LegendColors, Tags=shell_view_karamba3d_2.LegendTags, LegendType=101)
