# Grasshopper definition CenterRoom_KarambaTest.gh (Grasshopper 1.0.7)
# plug-ins: Karamba

# ---- group: karamba inputs
brick_properties_karamba3d = MaterialPropertiesKaramba3D(
    FamilyOfMaterial="Steel",
    Name="Brick",
    YoungsModulus_kN_cm2="8",
    InPlaneShearModulus_kN_cm2="3.2",
    TransverseShearModulus_kN_cm2="3.2",
    SpecificWeight_kN_m3="15.9",
    CoefficientOfThermalExpansion_1_C=1e-05,
    YieldStrength_kN_cm2=23.5,
    mode="Isotrop")  # -> graft(Material)

vaults_first_floor = Mesh(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)
cross_section_vault = CrossSectionKaramba3D(
    FamilyNameOfCrossSection="DefaultCroSec",
    ElementIdentifier="shell",
    Material=brick_properties_karamba3d,
    Height_cm=Slider(50, range=0..75),
    mode="Shell - Const")
mesh_to_shell_karamba3d = MeshToShellKaramba3D(Mesh=vaults_first_floor, Identifier="shell", CrossSection=cross_section_vault, LimitDistance_m=0.005)  # -> Element, Points, Info

cross_section_vault_2 = CrossSectionKaramba3D(
    FamilyNameOfCrossSection="DefaultCroSec",
    ElementIdentifier="shell",
    Material=brick_properties_karamba3d,
    Height_cm=Slider(50, range=0..75),
    mode="Shell - Const")
vaults_second_floor = Mesh(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)
mesh_to_shell_karamba3d_2 = MeshToShellKaramba3D(Mesh=vaults_second_floor, Identifier="shell", CrossSection=cross_section_vault_2, LimitDistance_m=0.005)  # -> Element, Points, Info

panel = Panel("columns_ground floor")
mesh_curve = MeshCurve(Mesh=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, Curve=[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])  # -> Points, Faces
cross_section_columns_ground_floor_karam = CrossSectionKaramba3D(
    FamilyNameOfCrossSection="DefaultCroSec",
    ElementIdentifier=panel,
    Material=brick_properties_karamba3d,
    Height_cm="40",
    UpperFlangeWidth_cm="40",
    LowerFlangeWidth_cm="40",
    mode="Trapezoid")  # "Cross Section_Columns_Ground Floor (Karamba3D)"
data = Data(mesh_curve.Points)
line_sdl = LineSDL(Start=data, Direction=expr("-x", Vector(0, 0, 1)), Length=1.5)
columns_ground_floor = Data(line_sdl)
line_to_beam_karamba3d = LineToBeamKaramba3D(
    Line=columns_ground_floor,
    Identifier=panel,
    CrossSection=cross_section_columns_ground_floor_karam,
    New=True,
    Remove=True,
    LimitDistance_m=0.005)  # -> Element, Points, Info

# Second Floor
# First Floor
# Brick Material Properties
number_slider = Slider(1.5, range=0..10)
unit_z = UnitZ(Factor=expr("-x", number_slider))
move = Move(Geometry=data, Motion=unit_z)  # -> Geometry, Transform
panel_2 = Panel("-3.5")
unit_z_2 = UnitZ(Factor=expr("x*1.2", "-3.5"))
panel_3 = Panel("1")
panel_4 = Panel("-4")

unit_z_3 = UnitZ(Factor=expr("x*1.2", panel_2))
loads_filling_karamba3d = LoadsKaramba3D(
    Vector=unit_z_3,
    Mesh=vaults_first_floor,
    BeamIdentifiers=panel,
    LCase="1",
    mode="MeshLoad -Const.",
    menu=[buttons(off, on, off), buttons(on, on)])
unit_z_4 = UnitZ(Factor=expr("x*1.5", panel_4))
live_load_karamba3d = LoadsKaramba3D(
    Vector=unit_z_4,
    Mesh=vaults_first_floor,
    BeamIdentifiers="shell",
    LCase="2",
    mode="MeshLoad -Const.",
    menu=[buttons(off, on, off), buttons(on, on)])

support_karamba3d = SupportKaramba3D(PosInd=move.Geometry, menu=[buttons(on, on, on, on, on, on)])

mesh_curve_2 = MeshCurve(Mesh=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, Curve=[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])  # -> Points, Faces
data_2 = Data(mesh_curve_2.Points)
panel_5 = Panel("columns_second floor")
cross_section_columns_ground_floor_karam_2 = CrossSectionKaramba3D(
    FamilyNameOfCrossSection="DefaultCroSec",
    ElementIdentifier=panel_5,
    Material=brick_properties_karamba3d,
    Height_cm="40",
    UpperFlangeWidth_cm="40",
    LowerFlangeWidth_cm="40",
    mode="Trapezoid")  # "Cross Section_Columns_Ground Floor (Karamba3D)"

line = Line([Line((3.232287645, -1.332695603, 1.500040054), (3.21988225, -1.302391648, 4.500040054)), Line((6.345568657, -4.49996233, 1.500040054), (6.345568657, -4.49996233, 4.500040054)), Line((3.232287645, -1.332695603, 1.500040054), (3.21988225, -1.302391648, 4.500040054)), Line((3.232287645, -10.66724491, 1.500040054), (3.21988225, -10.69753361, 4.500040054))])
line_sdl_2 = LineSDL(Start=data_2, Direction=expr("-x", Vector(0, 0, 1)), Length=3)

columns_first_floor = Data([line_sdl_2, line])
line_to_beam_karamba3d_2 = LineToBeamKaramba3D(
    Line=columns_first_floor,
    CrossSection=cross_section_columns_ground_floor_karam_2,
    New=True,
    Remove=True,
    LimitDistance_m=0.005)  # -> Element, Points, Info

# ---- group: karamba inputs / extra loads
loads_karamba3d = LoadsKaramba3D(Vector=Vector(0, 0, -1), LCase="0", mode="Gravity")
unit_z_5 = UnitZ(Factor=expr("x*1.2", "-8.23"))
dome_load_karamba3d = LoadsKaramba3D(
    Vector=unit_z_5,
    Mesh=[vaults_second_floor, vaults_first_floor],
    BeamIdentifiers=[panel_5, panel],
    LCase="3",
    mode="MeshLoad -Const.",
    menu=[buttons(off, on, off), buttons(on, on)])

# ---- group: karamba inputs (continued)
loads_dead_load_filling_karamba3d = LoadsKaramba3D(
    Vector=unit_z_2,
    Mesh=vaults_second_floor,
    BeamIdentifiers=panel_5,
    LCase=panel_3,
    mode="MeshLoad -Const.",
    menu=[buttons(off, on, off), buttons(on, on)])

# ----
assemble_model_karamba3d = AssembleModelKaramba3D(
    Elem=flatten([mesh_to_shell_karamba3d_2.Element, mesh_to_shell_karamba3d.Element, line_to_beam_karamba3d.Element, line_to_beam_karamba3d_2.Element]),
    Support=flatten(support_karamba3d),
    Load=flatten([loads_dead_load_filling_karamba3d, live_load_karamba3d, loads_filling_karamba3d, loads_karamba3d, dome_load_karamba3d]),
    Material=brick_properties_karamba3d,
    LimitDistance_m=0.005)  # -> Model, Info, Mass_kg, CenterOfGravity
analyze_karamba3d = AnalyzeKaramba3D(Model=assemble_model_karamba3d.Model)  # -> CalculatedModel, MaximumDisplacement_cm, ResultingForceOfGravity_kN, ElasticEnergy_kNm

# ---- group: outputs
panel_6 = Panel(analyze_karamba3d.MaximumDisplacement_cm)
model_view_karamba3d = ModelViewKaramba3D(Model=analyze_karamba3d.CalculatedModel, LoadCaseFactorsForLinearSuperposition=1, IndexOfVisibleLoadcase=-1)  # -> Model, DeformedMesh, DeformedAxes, DeformedModel
shell_view_karamba3d = ShellViewKaramba3D(Model=model_view_karamba3d.Model, IndexOfLayer=0)  # -> Model, MeshesOfRenderedShells, LegendColors, LegendTags
beamview = BeamViewKaramba3D(Model=model_view_karamba3d.Model)  # -> Model, MeshesOfRenderedBeams, DeformedBeamAxes, LegendColors, LegendTags
legend = Legend(Colour=shell_view_karamba3d.LegendColors, Tags=shell_view_karamba3d.LegendTags, LegendType=101)
legend_2 = Legend(Colour=beamview.LegendColors, Tags=beamview.LegendTags, LegendType=101)
