# Grasshopper definition DOME VOXELEZATION.gh (Grasshopper 1.0.7)
# plug-ins: Karamba, Weaverbird, Kangaroo2 Components

# input
curve = Curve(<curve referenced from the Rhino model>)

boundary_surfaces = BoundarySurfaces(Edges=curve)
mesh_breps_karamba3d = MeshBrepsKaramba3D(
    Brep=boundary_surfaces,
    MeshResolution=Slider(4, range=0..10),
    EdgeRefinementFactor=0.67,
    PointReduction=False,
    SmoothingStepSize=0,
    SmoothingIterations=5)  # -> Mesh, Info
weaverbird_s_catmull_clark_subdivision = WeaverbirdsCatmullClarkSubdivision(MeshCurves=mesh_breps_karamba3d.Mesh, Level=Slider(3, range=0..100), SmoothNakedEdges=1)
weaverbird_s_split_triangles_subdivision = WeaverbirdsSplitTrianglesSubdivision(MeshCurves=mesh_breps_karamba3d.Mesh, Level=Slider(18, range=0..30))
mesh = Mesh(weaverbird_s_split_triangles_subdivision)
nakedvertices = NakedVertices(Mesh=mesh)  # -> ClothedIndex, NakedIndex, ClothedPts, NakedPts
point_in_curve = PointInCurve(Point=nakedvertices.NakedPts, Curve=curve)  # -> Relationship, Point
smaller_than = SmallerThan(FirstNumber=point_in_curve.Relationship, SecondNumber="1")  # -> SmallerThan, OrEqualTo
cull_pattern = CullPattern(List=nakedvertices.NakedPts, CullPattern=smaller_than.OrEqualTo)

polygon_center = PolygonCenter(Polyline=curve)  # -> CenterV, CenterE, CenterA
curve_2 = Curve(<curve referenced from the Rhino model>)
curve_3 = Curve(<curve referenced from the Rhino model>)
planar = Planar(Curve=curve_3)  # -> Planar, Plane, Deviation
boundary_surfaces_2 = BoundarySurfaces(Edges=curve_3)
boundary_surfaces_3 = BoundarySurfaces(Edges=flatten([curve, curve_2]))  # -> simplify(flatten(Surfaces))
boundary_surfaces_4 = BoundarySurfaces(Edges=[curve_3, curve_2])
mesh_brep = MeshBrep(
    Brep=boundary_surfaces_2,
    Settings={GridMaxCount=0, GridMinCount=16, JaggedSeams=False, MaxEdgeLength=0, MinEdgeLength=0.0001, MinTolerance=0, Refine=True, RefineAngle=0, RelativeTolerance=0.65, SimplePlanes=True, Tolerance=0})
nakedvertices_2 = NakedVertices(Mesh=mesh_brep)  # -> ClothedIndex, NakedIndex, ClothedPts, NakedPts
delaunay_mesh = DelaunayMesh(Points=nakedvertices_2.NakedPts, Plane=planar.Plane)
mesh_breps_karamba3d_2 = MeshBrepsKaramba3D(
    Brep=boundary_surfaces_4,
    MeshResolution=Slider(3, range=0..10),
    EdgeRefinementFactor=0.67,
    PointReduction=False,
    SmoothingStepSize=0,
    SmoothingIterations=5)  # -> Mesh, Info
mesh_breps_karamba3d_3 = MeshBrepsKaramba3D(
    Brep=boundary_surfaces_2,
    MeshResolution=Slider(1, range=0..10),
    EdgeRefinementFactor=0.67,
    PointReduction=False,
    SmoothingStepSize=0,
    SmoothingIterations=5)  # -> Mesh, Info
mesh_breps_karamba3d_4 = MeshBrepsKaramba3D(
    Brep=boundary_surfaces_3,
    MeshResolution=Slider(2, range=0..10),
    EdgeRefinementFactor=0.67,
    PointReduction=False,
    SmoothingStepSize=0,
    SmoothingIterations=5)  # -> Mesh, Info
# form finding
# pointy dome
weaverbird_s_split_triangles_subdivision_2 = WeaverbirdsSplitTrianglesSubdivision(MeshCurves=mesh_breps_karamba3d_3.Mesh, Level=Slider(9, range=0..20))
weaverbird_s_split_triangles_subdivision_3 = WeaverbirdsSplitTrianglesSubdivision(MeshCurves=mesh_breps_karamba3d_2.Mesh, Level=Slider(20, range=0..20))
weaverbird_s_split_triangles_subdivision_4 = WeaverbirdsSplitTrianglesSubdivision(MeshCurves=mesh_breps_karamba3d_4.Mesh, Level=Slider(10, range=0..20))
weaverbird_s_join_meshes_and_weld = WeaverbirdsJoinMeshesAndWeld(Mesh=[weaverbird_s_split_triangles_subdivision_4, weaverbird_s_split_triangles_subdivision_3], Weld=False)

number_slider = Slider(0, range=0..10)
weaverbird_s_constant_quads_split_subdiv = WeaverbirdsConstantQuadsSplitSubdivision(MeshCurves=mesh_breps_karamba3d.Mesh, Level=Slider(2, range=0..10), SmoothNakedEdges=number_slider)
weaverbird_s_constant_quads_split_subdiv_2 = WeaverbirdsConstantQuadsSplitSubdivision(MeshCurves=weaverbird_s_constant_quads_split_subdiv, Level=Slider(2, range=0..10), SmoothNakedEdges=number_slider)

unit_z = UnitZ(Factor=Slider(4, range=0..100))
unit_z_2 = UnitZ(Factor=Slider(2, range=0..100))
unit_z_3 = UnitZ(Factor=Slider(15, range=0..100))
unit_z_4 = UnitZ(Factor=Slider(6, range=0..100))
point = Point([<point referenced from the Rhino model> x108])
point_2 = Point([<point referenced from the Rhino model> x156])
point_3 = Point([<point referenced from the Rhino model> x37])
point_4 = Point([<point referenced from the Rhino model> x40])

# ----
# 2 bricks
# same size/2directions
A = Brep(<brep referenced from the Rhino model>)
B = Brep(<brep referenced from the Rhino model>)

data = Data(cull_pattern)
load = Load(Point=point_2, ForceVector=unit_z_2)
load_2 = Load(Point=point_3, ForceVector=unit_z_3)
load_3 = Load(Point=point, ForceVector=unit_z)
load_4 = Load(Point=point_4, ForceVector=unit_z_4)

edgelengths = EdgeLengths(Mesh=mesh, LengthFactor=1, Strength=Slider(192.364, range=0..200))
anchor = Anchor(Point=data, Strength=Slider(10000, range=0..10000))
vertexloads = VertexLoads(Mesh=mesh, Strength=Slider(2.4042, range=0..5))
show = Show(G=mesh)

solver = Solver(
    GoalObjects=[show, edgelengths, anchor, vertexloads, load, load_3, load_4, load_2],
    Reset=Button(),
    Threshold=1e-15,
    Tolerance=0.01,
    On=True)  # -> I, V, O
list_item = ListItem(List=solver.O, Index=0, Wrap=True)  # -> flatten(Item), Item1
list_item_2 = ListItem(List=list_item.Item, Index=0, Wrap=True)  # -> flatten(Item), Item1

# ----
# output
mesh_2 = Mesh(list_item_2.Item1)

smesh = SimpleMesh(Brep=B)
smesh_2 = SimpleMesh(Brep=A)
quad = Quadrangulate(Mesh=smesh_2, Angle=0.03490658504, Ratio=0.875)  # -> Mesh, Count
quad_2 = Quadrangulate(Mesh=smesh, Angle=0.03490658504, Ratio=0.875)  # -> Mesh, Count
series = Series(Start=0, Step=0.16, Count=100)
series_2 = Series(Start=0, Step=0.32, Count=50)
mesh_3 = Mesh(quad.Mesh)
mesh_4 = Mesh(quad_2.Mesh)
# amount of bricks
# distance 3 axes
weld = WeldMesh(Mesh=mesh_3, Angle=3.141592654)
X = UnitX(Factor=series)
series_3 = Series(Start=0, Step=0.16, Count=50)
weld_2 = WeldMesh(Mesh=mesh_4, Angle=3.141592654)
X_2 = UnitX(Factor=series_2)
series_4 = Series(Start=0, Step=0.16, Count=40)
series_5 = Series(Start=0, Step=0.16, Count=100)
move = Move(Geometry=graft(weld), Motion=X)  # -> Geometry, Transform
Z = UnitZ(Factor=series_3)
move_2 = Move(Geometry=graft(weld_2), Motion=X_2)  # -> Geometry, Transform
Z_2 = UnitZ(Factor=series_4)
Y = UnitY(Factor=series_5)
series_6 = Series(Start=0, Step=0.32, Count=50)
move_3 = Move(Geometry=graft(move.Geometry), Motion=Z)  # -> Geometry, Transform
move_4 = Move(Geometry=graft(move_2.Geometry), Motion=Z_2)  # -> Geometry, Transform
Y_2 = UnitY(Factor=series_6)
# Voxelezation
move_5 = Move(Geometry=graft(move_3.Geometry), Motion=Y_2)  # -> Geometry, Transform
move_6 = Move(Geometry=graft(move_4.Geometry), Motion=Y)  # -> Geometry, Transform
tri = Triangulate(Mesh=mesh_2)  # -> Mesh, Count; disabled
smlvoxel_meshes = Mesh(flatten([move_5.Geometry, move_6.Geometry]))  # disabled
medges = MeshEdges(Mesh=smlvoxel_meshes)  # -> NakedEdges, InteriorEdges, NonManifoldEdges; disabled
merge = Merge(Data1=medges.NakedEdges, Data2=medges.InteriorEdges, Data3=medges.NonManifoldEdges)  # disabled

line = Line(merge)  # disabled
c_script = CSharpScript(M=tri.Mesh, MeshEdgesDT=line)  # -> out, A; inputs M: Mesh, MeshEdgesDT: tree of Line; disabled
# ---------- c_script: C# ----------
    //written by Pirouz Nourian based on this code: https://github.com/Pirouz-Nourian/Topological_Voxelizer_CSharp/blob/master/Voxelizer_Functions.cs
    //check this paper for the theory: https://www.researchgate.net/publication/290507635_Voxelization_Algorithms_for_Geospatial_Applications

    int n = MeshEdgesDT.BranchCount;
    List<int> blockIndexes = new List<int>();
    for(int i = 0;i < n;i++){
      List<Line> edgeLines = MeshEdgesDT.Branch(i);
      int m = edgeLines.Count;
      //Print(m.ToString());
      bool DoesIntersect = false;
      for(int j = 0;j < m;j++){//foreach (Line edgeLine in edgeLines){
        Line edgeLine = edgeLines[j];
        int[] faceIds;
        Point3d[] intersectionPoints = Rhino.Geometry.Intersect.Intersection.MeshLine(M, edgeLine, out faceIds);
        if(intersectionPoints.Length > 0){
          //Print("yes");
          DoesIntersect = DoesIntersect || true;
          break;
        }
        //        if (){
        //          //          //blockIndexes.Add(i);
        //          //          DoesIntersect = DoesIntersect || true;
        //        }
      }
      if(DoesIntersect){blockIndexes.Add(i);}
    }

    A = blockIndexes;
# ---------- c_script: C# additional code ----------
  public bool MeshLineIntersect(Rhino.Geometry.Mesh x, Rhino.Geometry.Line L) //this is now for reading triangles from Rhino Mesh objects; can be eventually replaced with something, which reads OBJ mesh objects
  {
    //List<Point3d[]> TVs = new List<Point3d[]>();
    //List of Triangle Vertices
    Point3d[] TV = new Point3d[3];
    //Triangle Vertices
    Point3f av = default(Point3f);
    Point3f bv = default(Point3f);
    Point3f cv = default(Point3f);
    Point3f dv = default(Point3f);

    //Each face As MeshFace In x.Faces
    bool does = false;
    for (int k = 0; k <= x.Faces.Count - 1; k++) {
      x.Faces.GetFaceVertices(k, out av, out bv, out cv, out dv);
      TV = new Point3d[] {new Point3d(av), new Point3d(bv),new Point3d(cv)};
      //TVs.Add(TV);
      if (TriangleLineIntersect(TV, x.FaceNormals[k], L)){
        does = true;
      }
    }
    return does;//TVs.Exists(Lambda => TriangleLineIntersect(Lambda, L));
  }
  public bool TriangleLineIntersect(Rhino.Geometry.Point3d[] Vx, Rhino.Geometry.Vector3d Normal, Rhino.Geometry.Line L)
  {
    if (Vx.Length != 3) {
      throw new Exception("Triangle is not valid!");
    }
    Point3d O = Vx[0];
    Vector3d U = Vx[1] - O;
    Vector3d V = Vx[2] - O;
    Vector3d N = Normal;//Vector3d.CrossProduct(U, V);
    //plane normal

    Point3d PS = L.From;//start point of the line
    Point3d PE = L.To;  //end point of the line

    double Nomin = ((O - PS) * N);
    //operator * for dot product
    double Denom = N * (PE - PS);

    // only if the line is not paralell to the plane containing triangle T
    if (Denom != 0) {
      double alpha = Nomin / Denom;
      // parameter along the line where it intersects the plane in question, only if not paralell to the plane
      Point3d P = PS + alpha * (PE - PS);
      //L.PointAt(alpha) '

      Vector3d W = P - O;

      double UU = U * U;
      double VV = V * V;
      double UV = U * V;
      double WU = W * U;
      double WV = W * V;

      double STDenom = Math.Pow(UV, 2) - UU * VV;

      double s = (UV * WV - VV * WU) / STDenom;
      double t = (UV * WU - UU * WV) / STDenom;

      Point3d Point = O + s * U + t * V;

      if (s >= 0 & t >= 0 & s + t <= 1) {
        return true;
      } else {
        return false;
      }
    } else {
      return false;
    }
  }
# ---------- end c_script ----------
# intersection between bricks
# needed and designed shape
item = ListItem(List=smlvoxel_meshes, Index=c_script.A, Wrap=True)  # disabled

# ----
# output
mesh_5 = Mesh(item)  # disabled
int = Integer(c_script.A)  # disabled
