# Grasshopper definition FREE FORM VAULTS VOXELEZATION.gh (Grasshopper 1.0.7)

# ----
# INPUT
A = Brep(<brep referenced from the Rhino model>)  # disabled
B = Brep(<brep referenced from the Rhino model>)  # disabled
mesh = Mesh(<mesh referenced from the Rhino model>)  # disabled
smesh = SimpleMesh(Brep=B)  # disabled
smesh_2 = SimpleMesh(Brep=A)  # disabled
quad = Quadrangulate(Mesh=smesh_2, Angle=0.03490658504, Ratio=0.875)  # -> Mesh, Count; disabled
quad_2 = Quadrangulate(Mesh=smesh, Angle=0.03490658504, Ratio=0.875)  # -> Mesh, Count; disabled
series = Series(Start=0, Step=0.16, Count=30)  # disabled
series_2 = Series(Start=0, Step=0.16, Count=100)  # disabled
# BRICKS NEEDED
# REPETITION ON AXES
mesh_2 = Mesh(quad.Mesh)  # disabled
mesh_3 = Mesh(quad_2.Mesh)  # disabled
weld = WeldMesh(Mesh=mesh_2, Angle=3.141592654)  # disabled
X = UnitX(Factor=series)  # disabled
series_3 = Series(Start=0, Step=0.16, Count=20)  # disabled
weld_2 = WeldMesh(Mesh=mesh_3, Angle=3.141592654)  # disabled
X_2 = UnitX(Factor=series_2)  # disabled
series_4 = Series(Start=0, Step=0.16, Count=20)  # disabled
series_5 = Series(Start=0, Step=0.32, Count=100)  # disabled
move = Move(Geometry=graft(weld), Motion=X)  # -> Geometry, Transform; disabled
Z = UnitZ(Factor=series_3)  # disabled
move_2 = Move(Geometry=graft(weld_2), Motion=X_2)  # -> Geometry, Transform; disabled
Z_2 = UnitZ(Factor=series_4)  # disabled
Y = UnitY(Factor=series_5)  # disabled
series_6 = Series(Start=0, Step=0.32, Count=10)  # disabled
move_3 = Move(Geometry=graft(move.Geometry), Motion=Z)  # -> Geometry, Transform; disabled
move_4 = Move(Geometry=graft(move_2.Geometry), Motion=Z_2)  # -> Geometry, Transform; disabled
Y_2 = UnitY(Factor=series_6)  # disabled
move_5 = Move(Geometry=graft(move_3.Geometry), Motion=Y_2)  # -> Geometry, Transform; disabled
move_6 = Move(Geometry=graft(move_4.Geometry), Motion=Y)  # -> Geometry, Transform; disabled
tri = Triangulate(Mesh=mesh)  # -> Mesh, Count; disabled
smlvoxel_meshes = Mesh(flatten([move_5.Geometry, move_6.Geometry]))  # disabled
medges = MeshEdges(Mesh=smlvoxel_meshes)  # -> NakedEdges, InteriorEdges, NonManifoldEdges; disabled
merge = Merge(Data1=medges.NakedEdges, Data2=medges.InteriorEdges, Data3=medges.NonManifoldEdges)  # disabled
line = Line(merge)  # disabled
c_script = CSharpScript(M=tri.Mesh, MeshEdgesDT=line)  # -> out, A; inputs M: Mesh, MeshEdgesDT: tree of Line; disabled
# ---------- c_script: C# ----------
    //written by Pirouz Nourian based on this code: https://github.com/Pirouz-Nourian/Topological_Voxelizer_CSharp/blob/master/Voxelizer_Functions.cs
    //check this paper for the theory: https://www.researchgate.net/publication/290507635_Voxelization_Algorithms_for_Geospatial_Applications

    int n = MeshEdgesDT.BranchCount;
    List<int> blockIndexes = new List<int>();
    for(int i = 0;i < n;i++){
      List<Line> edgeLines = MeshEdgesDT.Branch(i);
      int m = edgeLines.Count;
      //Print(m.ToString());
      bool DoesIntersect = false;
      for(int j = 0;j < m;j++){//foreach (Line edgeLine in edgeLines){
        Line edgeLine = edgeLines[j];
        int[] faceIds;
        Point3d[] intersectionPoints = Rhino.Geometry.Intersect.Intersection.MeshLine(M, edgeLine, out faceIds);
        if(intersectionPoints.Length > 0){
          //Print("yes");
          DoesIntersect = DoesIntersect || true;
          break;
        }
        //        if (){
        //          //          //blockIndexes.Add(i);
        //          //          DoesIntersect = DoesIntersect || true;
        //        }
      }
      if(DoesIntersect){blockIndexes.Add(i);}
    }

    A = blockIndexes;
# ---------- c_script: C# additional code ----------
  public bool MeshLineIntersect(Rhino.Geometry.Mesh x, Rhino.Geometry.Line L) //this is now for reading triangles from Rhino Mesh objects; can be eventually replaced with something, which reads OBJ mesh objects
  {
    //List<Point3d[]> TVs = new List<Point3d[]>();
    //List of Triangle Vertices
    Point3d[] TV = new Point3d[3];
    //Triangle Vertices
    Point3f av = default(Point3f);
    Point3f bv = default(Point3f);
    Point3f cv = default(Point3f);
    Point3f dv = default(Point3f);

    //Each face As MeshFace In x.Faces
    bool does = false;
    for (int k = 0; k <= x.Faces.Count - 1; k++) {
      x.Faces.GetFaceVertices(k, out av, out bv, out cv, out dv);
      TV = new Point3d[] {new Point3d(av), new Point3d(bv),new Point3d(cv)};
      //TVs.Add(TV);
      if (TriangleLineIntersect(TV, x.FaceNormals[k], L)){
        does = true;
      }
    }
    return does;//TVs.Exists(Lambda => TriangleLineIntersect(Lambda, L));
  }
  public bool TriangleLineIntersect(Rhino.Geometry.Point3d[] Vx, Rhino.Geometry.Vector3d Normal, Rhino.Geometry.Line L)
  {
    if (Vx.Length != 3) {
      throw new Exception("Triangle is not valid!");
    }
    Point3d O = Vx[0];
    Vector3d U = Vx[1] - O;
    Vector3d V = Vx[2] - O;
    Vector3d N = Normal;//Vector3d.CrossProduct(U, V);
    //plane normal

    Point3d PS = L.From;//start point of the line
    Point3d PE = L.To;  //end point of the line

    double Nomin = ((O - PS) * N);
    //operator * for dot product
    double Denom = N * (PE - PS);

    // only if the line is not paralell to the plane containing triangle T
    if (Denom != 0) {
      double alpha = Nomin / Denom;
      // parameter along the line where it intersects the plane in question, only if not paralell to the plane
      Point3d P = PS + alpha * (PE - PS);
      //L.PointAt(alpha) '

      Vector3d W = P - O;

      double UU = U * U;
      double VV = V * V;
      double UV = U * V;
      double WU = W * U;
      double WV = W * V;

      double STDenom = Math.Pow(UV, 2) - UU * VV;

      double s = (UV * WV - VV * WU) / STDenom;
      double t = (UV * WU - UU * WV) / STDenom;

      Point3d Point = O + s * U + t * V;

      if (s >= 0 & t >= 0 & s + t <= 1) {
        return true;
      } else {
        return false;
      }
    } else {
      return false;
    }
  }
# ---------- end c_script ----------
item = ListItem(List=smlvoxel_meshes, Index=c_script.A, Wrap=True)  # disabled

# ----
# OUTPUT
mesh_4 = Mesh(item)  # disabled
int = Integer(c_script.A)  # disabled
