# Grasshopper definition Final_Vault_bricks.gh (Grasshopper 1.0.7)

crv = Curve(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)
mesh = Mesh(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)

rot3d = Rotate3D(
    Geometry=crv,
    Angle=Slider(59, range=0..100),
    Center=Point(-3.000312278, -6.450000752, 2.399999999),
    Axis=Vector(38, 0, 0))  # -> Geometry, Transform
Y = UnitY(Factor=Slider(0, range=0..10))
move = Move(Geometry=rot3d.Geometry, Motion=Y)  # -> Geometry, Transform
crv_2 = Curve(move.Geometry)
planar = Planar(Curve=crv_2)  # -> Planar, Plane, Deviation
end = EndPoints(Curve=crv_2)  # -> Start, End
contour = Contour(Shape=mesh, Point=end.Start, Direction=planar.Plane, Distance=Slider(0.08, range=0..1))  # -> flatten(Contours)
index = ItemIndex(List=contour, Item=contour)
larger = LargerThan(FirstNumber=index, SecondNumber="40")  # -> LargerThan, OrEqualTo
dispatch = Dispatch(List=contour, DispatchPattern=larger.LargerThan)  # -> ListA, ListB
cull = CullPattern(List=dispatch.ListB, CullPattern=invert([False, False, True, True]))
dispatch_2 = Dispatch(List=dispatch.ListA, DispatchPattern=[True, False])  # -> ListA, ListB
cull_2 = CullPattern(List=dispatch.ListB, CullPattern=[False, False, True, True])

crv_3 = Curve([dispatch_2.ListA, cull_2])
crv_4 = Curve([dispatch_2.ListB, cull])

planar_2 = Planar(Curve=crv_3)  # -> Planar, Plane, Deviation
divlength = DivideLength(Curve=crv_3, Length=Slider(0.16, range=0..1))  # -> flatten(Points), flatten(Tangents), Parameters
deplane = DeconstructPlane(Plane=planar_2.Plane)  # -> Origin, XAxis, YAxis, ZAxis
vec = Vector(divlength.Tangents)
xprod = CrossProduct(VectorA=deplane.ZAxis, VectorB=vec, Unitize=False)  # -> Vector, Length
V = Vector("0.16,0.08,0.04")
pl = ConstructPlane(Origin=divlength.Points, XAxis=vec, YAxis=xprod.Vector)  # -> simplify(Plane)
devec = DeconstructVector(Vector=V)  # -> XComponent, YComponent, ZComponent
shift = ShiftList(List=pl, Shift=1, Wrap=True)
cull_3 = CullPattern(List=shift, CullPattern=[False, True])
B = Base(cull_3)
box = CenterBox(Base=B, X=devec.XComponent, Y=devec.YComponent, Z=devec.ZComponent)

planar_3 = Planar(Curve=crv_4)  # -> Planar, Plane, Deviation
divlength_2 = DivideLength(Curve=crv_4, Length=Slider(0.16, range=0..1))  # -> flatten(Points), flatten(Tangents), Parameters
deplane_2 = DeconstructPlane(Plane=planar_3.Plane)  # -> Origin, XAxis, YAxis, ZAxis
vec_2 = Vector(divlength_2.Tangents)
xprod_2 = CrossProduct(VectorA=deplane_2.ZAxis, VectorB=vec_2, Unitize=False)  # -> Vector, Length
pl_2 = ConstructPlane(Origin=divlength_2.Points, XAxis=vec_2, YAxis=xprod_2.Vector)  # -> simplify(Plane)
V_2 = Vector("0.16,0.08,0.04")
devec_2 = DeconstructVector(Vector=V_2)  # -> XComponent, YComponent, ZComponent
shift_2 = ShiftList(List=pl_2, Shift=Slider(0, range=0..100), Wrap=True)
cull_4 = CullPattern(List=shift_2, CullPattern=[False, True])
B_2 = Base(cull_4)
box_2 = CenterBox(Base=B_2, X=devec_2.XComponent, Y=devec_2.YComponent, Z=devec_2.ZComponent)

weave = Weave(Pattern=[0, 1], Stream0=box, Stream1=box_2, NullGaps=False)
