# Grasshopper definition Free form vaults.gh (Grasshopper 1.0.7)
# plug-ins: Weaverbird, Kangaroo2 Components

brep = Brep(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)  # disabled
curve = Curve(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)  # disabled

# ----
# 1st floor
small_square = Surface([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])  # disabled
orthogonal = Surface([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])  # disabled
surface = Surface([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])  # disabled

# ----
# Trial for uniform relaxation
# for other parts of the building.
small_square_2 = Surface(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)  # disabled
small_square_3 = Surface(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)  # disabled
small_square_4 = Surface(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)  # disabled
orthogonal_2 = Surface(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)  # disabled
surface_2 = Surface(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)  # disabled
surface_3 = Surface(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)  # disabled
mesh_brep = MeshBrep(
    Brep=[small_square_2, small_square_3, small_square_4, orthogonal_2, surface_2, surface_3],
    Settings={GridMaxCount=0, GridMinCount=16, JaggedSeams=False, MaxEdgeLength=0, MinEdgeLength=0.0001, MinTolerance=0, Refine=True, RefineAngle=0, RelativeTolerance=0.65, SimplePlanes=True, Tolerance=0})  # disabled
weaverbird_s_join_meshes_and_weld = WeaverbirdsJoinMeshesAndWeld(Mesh=mesh_brep, Weld=False)  # disabled
number_slider = Slider(1, range=0..10)  # disabled
number_slider_2 = Slider(0, range=0..10)  # disabled
weaverbird_s_midedge_subdivision = WeaverbirdsMidedgeSubdivision(MeshCurves=weaverbird_s_join_meshes_and_weld, Level=number_slider, SmoothNakedEdges=number_slider_2)  # disabled
number_slider_3 = Slider(1, range=0..10)  # disabled
number_slider_4 = Slider(3, range=0..10)  # disabled
number_slider_5 = Slider(0, range=0..10)  # disabled
weaverbird_s_catmull_clark_subdivision = WeaverbirdsCatmullClarkSubdivision(MeshCurves=weaverbird_s_midedge_subdivision, Level=number_slider_3, SmoothNakedEdges=number_slider_2)  # disabled
weaverbird_s_constant_quads_split_subdiv = WeaverbirdsConstantQuadsSplitSubdivision(MeshCurves=weaverbird_s_catmull_clark_subdivision, Level=number_slider_4, SmoothNakedEdges=number_slider_5)  # disabled
mesh = Mesh(weaverbird_s_constant_quads_split_subdiv)  # disabled
curve_2 = Curve([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])  # disabled
nakedvertices = NakedVertices(Mesh=mesh)  # -> ClothedIndex, NakedIndex, ClothedPts, NakedPts; disabled
point_in_curves = PointInCurves(Point=[nakedvertices.ClothedPts, nakedvertices.NakedPts], Curves=curve_2)  # -> Relationship, Index, Point; disabled
number_slider_6 = Slider(0.1333, range=0..5)  # disabled
number_slider_7 = Slider(174, range=0..200)  # disabled
number_slider_8 = Slider(8, range=0..10000)  # disabled
dispatch = Dispatch(List=[nakedvertices.ClothedPts, nakedvertices.NakedPts], DispatchPattern=point_in_curves.Relationship)  # -> ListA, ListB; disabled
edgelengths = EdgeLengths(Mesh=mesh, LengthFactor=1, Strength=number_slider_7)  # disabled
anchor = Anchor(Point=dispatch.ListA, Strength=number_slider_8)  # disabled
vertexloads = VertexLoads(Mesh=mesh, Strength=number_slider_6)  # disabled
show = Show(G=mesh)  # disabled
button = Button()  # disabled
solver = Solver(GoalObjects=[show, edgelengths, anchor, vertexloads], Reset=button, Threshold=1e-15, Tolerance=0.01, On=True)  # -> I, V, O; disabled
list_item = ListItem(List=solver.O, Index=0, Wrap=True)  # -> flatten(Item), Item1; disabled

# ---- group: attempt of finding the brick laying positions on the hemisphere dome
number_slider_9 = Slider(10, range=0..10)  # disabled
unit_z = UnitZ(Factor=number_slider_9)  # disabled
extrude = Extrude(Base=curve, Direction=unit_z)  # disabled
brep_brep = BrepBrep(BrepA=brep, BrepB=extrude)  # -> Curves, Points; disabled
length = Length(Curve=brep_brep.Curves)  # disabled
divide_curve = DivideCurve(Curve=brep_brep.Curves, Count=expr("x/0.25", length), Kinks=False)  # -> Points, Tangents, Parameters; disabled
number_slider_10 = Slider(7, range=0..10)  # disabled
unit_y = UnitY(Factor=1)  # disabled
unit_x = UnitX(Factor=1)  # disabled
curve_3 = Curve(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)  # disabled
extrude_2 = Extrude(Base=curve_3, Direction=unit_x)  # disabled
line_sdl = LineSDL(Start=divide_curve.Points, Direction=expr("-x", unit_y), Length=number_slider_10)  # disabled
surface_curve = SurfaceCurve(Surface=extrude_2, Curve=line_sdl)  # -> Curves, flatten(Points), UVPoints, Normals, Parameters, Tangents; disabled
line = Line(StartPoint=divide_curve.Points, EndPoint=surface_curve.Points)  # disabled
circle_cnr = CircleCNR(Center=surface_curve.Points, Normal=Vector(0, 0, 1), Radius=line)  # disabled
number_slider_11 = Slider(188, range=0..1000)  # disabled
number_slider_12 = Slider(188, range=0..1000)  # disabled
list_item_2 = ListItem(List=circle_cnr, Index=0, Wrap=True)  # -> Item, Item1; disabled
divide_curve_2 = DivideCurve(Curve=list_item_2.Item1, Count=number_slider_11, Kinks=False)  # -> Points, Tangents, Parameters; disabled
divide_curve_3 = DivideCurve(Curve=list_item_2.Item, Count=number_slider_12, Kinks=False)  # -> Points, Tangents, Parameters; disabled
number_slider_13 = Slider(0.086, range=0..10)  # disabled
number_slider_14 = Slider(29, range=0..50)  # disabled
boolean_toggle = BooleanToggle(True)  # disabled
cull_nth = CullNth(List=divide_curve_3.Points, CullFrequency=2)  # disabled
shift_list = ShiftList(List=divide_curve_2.Points, Shift=number_slider_14, Wrap=boolean_toggle)  # disabled
point_list = PointList(Points=cull_nth, Size=number_slider_13)  # disabled
number_slider_15 = Slider(0.957, range=0..1)  # disabled
number_slider_16 = Slider(0.086, range=0..10)  # disabled
rotate_axis = RotateAxis(
    Geometry=shift_list,
    Angle=expr("-x", number_slider_15),
    Axis=Line((198.0648585, -206.7065748, 4.51001), (198.0648585, -206.7065748, 8)))  # -> Geometry, Transform; disabled
point_list_2 = PointList(Points=rotate_axis.Geometry, Size=number_slider_16)  # disabled

# ----
number_slider_17 = Slider(3, range=0..10)  # disabled
unit_z_2 = UnitZ(Factor=number_slider_17)  # disabled
move = Move(Geometry=[small_square, orthogonal, surface], Motion=unit_z_2)  # -> Geometry, Transform; disabled

# ----
# Ground floor
small_square_5 = Surface([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])
orthogonal_3 = Surface([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])
surface_4 = Surface([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])
surface_5 = Surface([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])

number_slider_18 = Slider(1, range=0..10)
number_slider_19 = Slider(1, range=0..10)  # disabled
number_slider_20 = Slider(0, range=0..10)
number_slider_21 = Slider(0, range=0..10)  # disabled
number_slider_22 = Slider(1, range=0..10)  # disabled
number_slider_23 = Slider(3, range=0..10)  # disabled
number_slider_24 = Slider(0, range=0..10)  # disabled

mesh_brep_2 = MeshBrep(
    Brep=move.Geometry,
    Settings={GridMaxCount=0, GridMinCount=16, JaggedSeams=False, MaxEdgeLength=0, MinEdgeLength=0.0001, MinTolerance=0, Refine=True, RefineAngle=0, RelativeTolerance=0.65, SimplePlanes=True, Tolerance=0})  # disabled
weaverbird_s_join_meshes_and_weld_2 = WeaverbirdsJoinMeshesAndWeld(Mesh=mesh_brep_2, Weld=False)  # disabled
weaverbird_s_midedge_subdivision_2 = WeaverbirdsMidedgeSubdivision(MeshCurves=weaverbird_s_join_meshes_and_weld_2, Level=number_slider_19, SmoothNakedEdges=number_slider_21)  # disabled
weaverbird_s_catmull_clark_subdivision_2 = WeaverbirdsCatmullClarkSubdivision(MeshCurves=weaverbird_s_midedge_subdivision_2, Level=number_slider_22, SmoothNakedEdges=number_slider_21)  # disabled
weaverbird_s_constant_quads_split_subdiv_2 = WeaverbirdsConstantQuadsSplitSubdivision(MeshCurves=weaverbird_s_catmull_clark_subdivision_2, Level=number_slider_23, SmoothNakedEdges=number_slider_24)  # disabled

# ---- group: tesselation
mesh_brep_3 = MeshBrep(
    Brep=[small_square_5, orthogonal_3],
    Settings={GridMaxCount=0, GridMinCount=16, JaggedSeams=False, MaxEdgeLength=0, MinEdgeLength=0.0001, MinTolerance=0, Refine=True, RefineAngle=0, RelativeTolerance=0.65, SimplePlanes=True, Tolerance=0})
mesh_brep_4 = MeshBrep(
    Brep=[surface_5, surface_4],
    Settings={GridMaxCount=0, GridMinCount=16, JaggedSeams=False, MaxEdgeLength=0, MinEdgeLength=0.0001, MinTolerance=0, Refine=True, RefineAngle=0, RelativeTolerance=0.65, SimplePlanes=True, Tolerance=0})
weaverbird_s_join_meshes_and_weld_3 = WeaverbirdsJoinMeshesAndWeld(Mesh=[mesh_brep_4, mesh_brep_3], Weld=False)
weaverbird_s_midedge_subdivision_3 = WeaverbirdsMidedgeSubdivision(MeshCurves=weaverbird_s_join_meshes_and_weld_3, Level=number_slider_18, SmoothNakedEdges=number_slider_20)
weaverbird_s_catmull_clark_subdivision_3 = WeaverbirdsCatmullClarkSubdivision(MeshCurves=weaverbird_s_midedge_subdivision_3, Level=Slider(1, range=0..10), SmoothNakedEdges=number_slider_20)
weaverbird_s_constant_quads_split_subdiv_3 = WeaverbirdsConstantQuadsSplitSubdivision(
    MeshCurves=weaverbird_s_catmull_clark_subdivision_3,
    Level=Slider(3, range=0..10),
    SmoothNakedEdges=Slider(0, range=0..10))

# ---- group: old tessellation
weaverbird_s_loop_subdivision = WeaverbirdsLoopSubdivision(MeshCurves=mesh_brep_4, Level=number_slider_18, SmoothNakedEdges=number_slider_20)
weaverbird_s_split_triangles_subdivision = WeaverbirdsSplitTrianglesSubdivision(MeshCurves=weaverbird_s_loop_subdivision, Level=Slider(9, range=0..10))

# ----
small_square_6 = Surface(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)  # disabled
number_slider_25 = Slider(3, range=0..10)  # disabled

# ---- group: continue smoothly the free form surface to the column
number_slider_26 = Slider(8, range=0..10)  # disabled
number_slider_27 = Slider(4, range=0..10)  # disabled
mesh_surface = MeshSurface(Surface=small_square_6, UCount=number_slider_27, VCount=number_slider_26, Overhang=True, Equalize=False)  # disabled
mesh_2 = Mesh(mesh_surface)  # disabled
number_slider_28 = Slider(5, range=0..20)  # disabled
nakedvertices_2 = NakedVertices(Mesh=mesh_2)  # -> ClothedIndex, NakedIndex, ClothedPts, NakedPts; disabled
closest_points = ClosestPoints(
    Point=[Point(192.180907, -171.6498676, 0.5358774248), Point(192.180907, -170.6169203, -5.44597575)],
    Cloud=nakedvertices_2.NakedPts,
    Count=number_slider_28)  # -> ClosestPoint, CPIndex, Distance; disabled
number_slider_29 = Slider(0.0793, range=0..5)  # disabled
number_slider_30 = Slider(800, range=0..800)  # disabled
number_slider_31 = Slider(10000, range=0..10000)  # disabled
edgelengths_2 = EdgeLengths(Mesh=mesh_2, LengthFactor=1, Strength=number_slider_30)  # disabled
anchor_2 = Anchor(Point=closest_points.ClosestPoint, Strength=number_slider_31)  # disabled
vertexloads_2 = VertexLoads(Mesh=mesh_2, Strength=number_slider_29)  # disabled
show_2 = Show(G=mesh_2)  # disabled

# ----
unit_z_3 = UnitZ(Factor=number_slider_25)  # disabled
mesh_3 = Mesh(weaverbird_s_constant_quads_split_subdiv_3)

mesh_4 = Mesh(weaverbird_s_constant_quads_split_subdiv_2)  # disabled
curve_4 = Curve([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])  # disabled

move_2 = Move(Geometry=curve_4, Motion=unit_z_3)  # -> Geometry, Transform; disabled

mesh_5 = Mesh(mesh_3)
curve_5 = Curve([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])

number_slider_32 = Slider(0.4, range=0..5)  # disabled

# ---- group: dynamic relaxation
nakedvertices_3 = NakedVertices(Mesh=mesh_5)  # -> ClothedIndex, NakedIndex, ClothedPts, NakedPts
point_in_curves_2 = PointInCurves(Point=[nakedvertices_3.ClothedPts, nakedvertices_3.NakedPts], Curves=curve_5)  # -> Relationship, Index, Point
dispatch_2 = Dispatch(List=[nakedvertices_3.ClothedPts, nakedvertices_3.NakedPts], DispatchPattern=point_in_curves_2.Relationship)  # -> ListA, ListB
edgelengths_3 = EdgeLengths(Mesh=mesh_5, LengthFactor=1, Strength=Slider(174, range=0..200))
anchor_3 = Anchor(Point=dispatch_2.ListA, Strength=Slider(10000, range=0..10000))
vertexloads_3 = VertexLoads(Mesh=mesh_5, Strength=Slider(0.4, range=0..5))
data = Data(dispatch_2.ListA)
show_3 = Show(G=mesh_5)

# ----
number_slider_33 = Slider(174, range=0..200)  # disabled
number_slider_34 = Slider(10000, range=0..10000)  # disabled

nakedvertices_4 = NakedVertices(Mesh=mesh_4)  # -> ClothedIndex, NakedIndex, ClothedPts, NakedPts; disabled
point_in_curves_3 = PointInCurves(Point=[nakedvertices_4.ClothedPts, nakedvertices_4.NakedPts], Curves=move_2.Geometry)  # -> Relationship, Index, Point; disabled
dispatch_3 = Dispatch(List=[nakedvertices_4.ClothedPts, nakedvertices_4.NakedPts], DispatchPattern=point_in_curves_3.Relationship)  # -> ListA, ListB; disabled
edgelengths_4 = EdgeLengths(Mesh=mesh_4, LengthFactor=1, Strength=number_slider_33)  # disabled
anchor_4 = Anchor(Point=dispatch_3.ListA, Strength=number_slider_34)  # disabled
vertexloads_4 = VertexLoads(Mesh=mesh_4, Strength=number_slider_32)  # disabled
show_4 = Show(G=mesh_4)  # disabled

button_2 = Button()  # disabled
button_3 = Button()  # disabled

solver_2 = Solver(GoalObjects=[show_3, edgelengths_3, anchor_3, vertexloads_3], Reset=Button(), Threshold=1e-15, Tolerance=0.01, On=True)  # -> I, V, flatten(O)
list_item_3 = ListItem(List=solver_2.O, Index=0, Wrap=True)  # -> flatten(Item), Item1

solver_3 = Solver(GoalObjects=[show_4, edgelengths_4, anchor_4, vertexloads_4], Reset=button_2, Threshold=1e-15, Tolerance=0.01, On=True)  # -> I, V, O; disabled
list_item_4 = ListItem(List=solver_3.O, Index=0, Wrap=True)  # -> flatten(Item), Item1; disabled

solver_4 = Solver(GoalObjects=[show_2, edgelengths_2, anchor_2, vertexloads_2], Reset=button_3, Threshold=1e-15, Tolerance=0.01, On=True)  # -> I, V, O; disabled
list_item_5 = ListItem(List=solver_4.O, Index=0, Wrap=True)  # -> flatten(Item), Item1; disabled

# ---- group: failed triangular geometrical brick laying
wbicosahedron = WeaverbirdsMeshMeshIcosahedron(
    Plane=Plane(origin=(198.0648585, -206.7065748, 1.5), x=(0, -1, 0), y=(0.9907533247, 0, -0.1356755302)),
    Radius=Slider(14.598, range=0..100))
sph = Sphere(Base=PlaneXY(198.0648585, -206.7065748, 1.5), Radius=1)
wbtriangles = WeaverbirdsSplitTrianglesSubdivision(MeshCurves=wbicosahedron, Level=Slider(8, range=0..10))
demesh = DeconstructMesh(Mesh=wbtriangles)  # -> Vertices, Faces, Colours, Normals
pull = PullPoint(Point=demesh.Vertices, Geometry=sph, ClosestOnly=True)  # -> ClosestPoint, Distance
conmesh = ConstructMesh(Vertices=pull.ClosestPoint, Faces=demesh.Faces)
brep_2 = Brep(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)
mesh_split = MeshSplit(Mesh=conmesh, Splitters=brep_2)
list_item_6 = ListItem(List=mesh_split, Index=0, Wrap=True)  # -> Item, Item1
dome = Geometry(list_item_6.Item1)

# ---- group: failed procedure for filling surfaces
cull_nth_2 = CullNth(List=list_item_3.Item, CullFrequency=2)
unit_z_4 = UnitZ(Factor=Slider(3, range=0..10))
mesh_edges = MeshEdges(Mesh=cull_nth_2)  # -> flatten(NakedEdges), InteriorEdges, NonManifoldEdges
data_2 = Data(mesh_edges.NakedEdges)
join_curves = JoinCurves(Curves=data_2, Preserve=False)
larger_than = LargerThan(FirstNumber=mesh_edges.NakedEdges, SecondNumber=Slider(0.05, range=0..1))  # -> LargerThan, OrEqualTo
cull_pattern = CullPattern(List=mesh_edges.NakedEdges, CullPattern=larger_than.LargerThan)
join_curves_2 = JoinCurves(Curves=cull_pattern, Preserve=False)  # -> flatten(Curves)
unit_x_2 = UnitX(Factor=1)
list_item_7 = ListItem(List=join_curves_2, Index=0, Wrap=True)

brep_join = BrepJoin(Breps=[small_square_5, orthogonal_3, surface_5, surface_4])  # -> Breps, Closed
brep_edges = BrepEdges(Brep=brep_join.Breps)  # -> Naked, Interior, NonManifold
join_curves_3 = JoinCurves(Curves=brep_edges.Naked, Preserve=False)
extrude_3 = Extrude(Base=join_curves_3, Direction=unit_z_4)
deconstruct_brep = DeconstructBrep(Brep=extrude_3)  # -> flatten(Faces), Edges, Vertices
list_item_8 = ListItem(List=deconstruct_brep.Faces, Index=0, Wrap=True)  # -> Item, Item1, Item2, Item3

project = Project(Curve=list_item_7, Brep=list_item_8.Item3, Direction=expr("-x", unit_x_2))  # -> flatten(Curve)
