# Grasshopper definition Volumetric_climate_ladybug.gh (Grasshopper 1.0.7)

# ----
# analysis period
number_slider = Slider(8, range=1..12)
analysisperiod = Ladybug_AnalysisPeriod(fromMonth=Slider(6, range=1..12), fromDay=Slider(1, range=0..24), toMonth=number_slider, toDay=Slider(31, range=0..31))  # -> out, analysisPeriod; plug-in component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

# ----
# analysis period (summer)
# 21 june
number_slider_2 = Slider(6, range=1..12)
analysisperiod_2 = Ladybug_AnalysisPeriod(
    fromMonth=Slider(6, range=1..12),
    fromDay=Slider(21, range=0..24),
    toMonth=number_slider_2,
    toDay=Slider(21, range=0..31))  # -> out, analysisPeriod; plug-in component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

# ----
# analysis period (winter)
# 21 december
number_slider_3 = Slider(12, range=1..12)
analysisperiod_3 = Ladybug_AnalysisPeriod(
    fromMonth=Slider(12, range=1..12),
    fromDay=Slider(21, range=0..24),
    toMonth=number_slider_3,
    toDay=Slider(21, range=0..31))  # -> out, analysisPeriod; plug-in component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

ladybug = Ladybug_Ladybug()  # -> out; plug-in component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

# ----
# set North direction
line = Line(Line((-4.825536505, 45.98581401, 0), (-17.76648876, 94.28210532, 0)))
point_on_curve = PointOnCurve(line, parameter=1)
point_on_curve_2 = PointOnCurve(line, parameter=0)
vector_2pt = Vector2Pt(PointA=point_on_curve_2, PointB=point_on_curve, Unitize=False)  # -> Vector, Length

# ----
# set epw file
file_path = FilePath("C:\Users\John\Desktop\earthy_arcs\solar rad\JOR_MA_Hussein.AP.402650_TMYx.2003-2017\JOR_MA_Hussein.AP.402650_TMYx.2003-2017.epw")

gencumulativeskymtx = Ladybug_GenCumulativeSkyMtx(epwFile=file_path, skyDensity=0, useOldRes=True, runIt=Toggle(True))  # -> out, cumulativeSkyMtx; plug-in component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
selectskymtx = Ladybug_selectSkyMtx(
    cumulativeSkyMtx=gencumulativeskymtx.cumulativeSkyMtx,
    analysisPeriod=analysisperiod_2.analysisPeriod,
    removeDiffuse=False,
    removeDirect=False)  # -> out, selectedSkyMtx; plug-in component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

# ----
# Geometry
brep = Brep([<brep referenced from the Rhino model> x190])
mesh_brep = MeshBrep(
    Brep=brep,
    Settings={GridMaxCount=0, GridMinCount=16, JaggedSeams=False, MaxEdgeLength=0, MinEdgeLength=0.0001, MinTolerance=0, Refine=True, RefineAngle=0, RelativeTolerance=0.65, SimplePlanes=True, Tolerance=0})
mesh = Mesh([<mesh referenced from the Rhino model> x97])
mesh_2 = Mesh([mesh_brep, mesh])
context = Brep([<brep referenced from the Rhino model> x21])

importepw = Ladybug_ImportEpw(epwFile=file_path)  # -> Output, latitude, location, dryBulbTemperature, dewPointTemperature, relativeHumidity, windSpeed, windDirection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; plug-in component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

# ----
# radiation analysis
number_slider_4 = Slider(0.6, range=0..1)
# Turn boolean toggles to True in order to get analysis.
# It might crash or slow down the processor, but after a few tries it gives the result.
number_slider_5 = Slider(1, range=0..2)
boolean_toggle = BooleanToggle(False)
radiationanalysis = Ladybug_RadiationAnalysis(
    north=vector_2pt.Vector,
    geometry=flatten(mesh_2),
    context=flatten(context),
    gridSize=Slider(6, range=0..20),
    disFromBase=number_slider_4,
    selectedSkyMtx=flatten(selectskymtx.selectedSkyMtx),
    parallel=boolean_toggle,
    runIt=boolean_toggle,
    bakeIt=number_slider_5)  # -> out, contextMesh, analysisMesh, testPts, testVec, port, radiationResult, radiationMesh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; plug-in component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
mesh_3 = Mesh(radiationanalysis.radiationMesh)

# ----
# sun path
number_slider_6 = Slider(0.6, range=0..10)
sunpath = Ladybug_SunPath(
    north=vector_2pt.Vector,
    location=importepw.location,
    hour=12,
    day=21,
    month=12,
    timeStep=1,
    analysisPeriod=analysisperiod_2.analysisPeriod,
    port_2=analysisperiod_2.analysisPeriod,
    sunPathScale=number_slider_6,
    projection=Slider(0, range=0..2),
    annualHourlyData=flatten(importepw.dryBulbTemperature),
    dailyOrAnnualSunPath=True,
    bakeIt=Slider(1, range=0..2))  # -> out, sunVectors, sunAltitudes, sunAzimuths, port, sunSpheresMesh, sunPathCrvs, compassCrvs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; plug-in component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

# ----
# wind rose
number_slider_7 = Slider(1, range=0..10)
windrose = Ladybug_WindRose(
    north=vector_2pt.Vector,
    hourlyWindDirection=importepw.windDirection,
    hourlyWindSpeed=importepw.windSpeed,
    analysisPeriod=analysisperiod_2.analysisPeriod,
    scale=number_slider_7,
    bakeIt=Slider(1, range=0..2),
    runIt=Toggle(False))  # -> out, calmRoseMesh, windRoseMesh, windRoseCrvs, windRoseCenPts, legend, legendBasePts, title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; plug-in component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

# ----
# radiation rose
number_slider_8 = Slider(20, range=0..20)  # disabled
number_slider_9 = Slider(0, range=0..2)  # disabled
boolean_toggle_2 = BooleanToggle(False)  # disabled
radiationrose = Ladybug_RadiationRose(
    north=vector_2pt.Vector,
    selectedSkyMtx=selectskymtx.selectedSkyMtx,
    scale=number_slider_8,
    arrowHeadScale=1,
    bakeIt=number_slider_9,
    runIt=boolean_toggle_2)  # -> out, radiationArrowsMesh, radRoseBaseCrvs, legend, legendBasePts, radRoseEndPts, radRoseValues; disabled; plug-in component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

geometry = Geometry(windrose.windRoseCrvs)
mesh_4 = Mesh(windrose.windRoseMesh)
geometry_2 = Geometry(windrose.legend)
scale = Scale(Geometry=radiationanalysis.radiationLegend, Center=radiationanalysis.legendBasePt, Factor=0.5)  # -> Geometry, Transform

# ----
# sunlight hours
number_slider_10 = Slider(0.5, range=0..1)  # disabled
number_slider_11 = Slider(0, range=0..2)  # disabled
number_slider_12 = Slider(5, range=0..20)  # disabled
number_slider_13 = Slider(6, range=0..100)  # disabled
boolean_toggle_3 = BooleanToggle(False)  # disabled
legendpar = Ladybug_LegendParameters(numSegments=number_slider_13)  # -> legendPar; disabled; plug-in component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
sunlighthoursanalysis = Ladybug_SunlightHoursAnalysis(
    north=vector_2pt.Vector,
    geometry=flatten(mesh_2),
    context=flatten(context),
    gridSize=number_slider_12,
    disFromBase=number_slider_10,
    sunVectors=flatten(sunpath.sunVectors),
    timeStep=1,
    legendPar=flatten(legendpar),
    parallel=boolean_toggle_3,
    runIt=boolean_toggle_3,
    bakeIt=number_slider_11)  # -> out, contextMesh, analysisMesh, testPts, testVec, port, sunlightHoursResult, sunlightHoursMesh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; disabled; plug-in component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
