# Grasshopper definition corridor karamba analysis.gh (Grasshopper 1.0.7)
# plug-ins: Karamba, Kangaroo2 Components

# ----
# Case 2
vault = Surface([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])
doors = Surface([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])
walls = Surface([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])

# ----
# Case 3
vault_2 = Surface([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])
doors_2 = Surface([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])
walls_2 = Surface([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])

# ----
# Case 1
vault_3 = Surface([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])
doors_3 = Surface([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])
walls_3 = Surface([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])

mesh_brep = MeshBrep(
    Brep=vault,
    Settings={GridMaxCount=0, GridMinCount=16, JaggedSeams=False, MaxEdgeLength=0, MinEdgeLength=0.0001, MinTolerance=0, Refine=True, RefineAngle=0, RelativeTolerance=0.65, SimplePlanes=True, Tolerance=0})  # disabled
mesh_brep_2 = MeshBrep(
    Brep=doors,
    Settings={GridMaxCount=0, GridMinCount=16, JaggedSeams=False, MaxEdgeLength=0, MinEdgeLength=0.0001, MinTolerance=0, Refine=True, RefineAngle=0, RelativeTolerance=0.65, SimplePlanes=True, Tolerance=0})  # disabled
mesh_brep_3 = MeshBrep(
    Brep=walls,
    Settings={GridMaxCount=0, GridMinCount=16, JaggedSeams=False, MaxEdgeLength=0, MinEdgeLength=0.0001, MinTolerance=0, Refine=True, RefineAngle=0, RelativeTolerance=0.65, SimplePlanes=True, Tolerance=0})  # disabled
mesh_brep_4 = MeshBrep(
    Brep=vault_2,
    Settings={GridMaxCount=0, GridMinCount=16, JaggedSeams=False, MaxEdgeLength=0, MinEdgeLength=0.0001, MinTolerance=0, Refine=True, RefineAngle=0, RelativeTolerance=0.65, SimplePlanes=True, Tolerance=0})  # disabled
mesh_brep_5 = MeshBrep(
    Brep=doors_2,
    Settings={GridMaxCount=0, GridMinCount=16, JaggedSeams=False, MaxEdgeLength=0, MinEdgeLength=0.0001, MinTolerance=0, Refine=True, RefineAngle=0, RelativeTolerance=0.65, SimplePlanes=True, Tolerance=0})  # disabled
mesh_brep_6 = MeshBrep(
    Brep=walls_2,
    Settings={GridMaxCount=0, GridMinCount=16, JaggedSeams=False, MaxEdgeLength=0, MinEdgeLength=0.0001, MinTolerance=0, Refine=True, RefineAngle=0, RelativeTolerance=0.65, SimplePlanes=True, Tolerance=0})  # disabled
mesh_brep_7 = MeshBrep(
    Brep=vault_3,
    Settings={GridMaxCount=0, GridMinCount=16, JaggedSeams=False, MaxEdgeLength=0, MinEdgeLength=0.0001, MinTolerance=0, Refine=True, RefineAngle=0, RelativeTolerance=0.65, SimplePlanes=True, Tolerance=0})  # disabled
mesh_brep_8 = MeshBrep(
    Brep=doors_3,
    Settings={GridMaxCount=0, GridMinCount=16, JaggedSeams=False, MaxEdgeLength=0, MinEdgeLength=0.0001, MinTolerance=0, Refine=True, RefineAngle=0, RelativeTolerance=0.65, SimplePlanes=True, Tolerance=0})  # disabled
mesh_brep_9 = MeshBrep(
    Brep=walls_3,
    Settings={GridMaxCount=0, GridMinCount=16, JaggedSeams=False, MaxEdgeLength=0, MinEdgeLength=0.0001, MinTolerance=0, Refine=True, RefineAngle=0, RelativeTolerance=0.65, SimplePlanes=True, Tolerance=0})  # disabled

mesh_breps_karamba3d = MeshBrepsKaramba3D(
    Brep=flatten([vault_2, doors_2, walls_2]),
    MeshResolution=1,
    EdgeRefinementFactor=Slider(0.19, range=0..10),
    PointReduction=False,
    SmoothingStepSize=0,
    SmoothingIterations=5)  # -> Mesh, Info
split_list = SplitList(List=mesh_breps_karamba3d.Mesh, Index="18")  # -> ListA, ListB
nakedvertices = NakedVertices(Mesh=mesh_breps_karamba3d.Mesh)  # -> ClothedIndex, NakedIndex, ClothedPts, NakedPts
data = Data(split_list.ListB)
point = Point(Point(22.89214157, 140.8671227, -31.30684147))
closest_points = ClosestPoints(Point=point, Cloud=flatten(nakedvertices.NakedPts), Count=Slider(70, range=0..100))  # -> ClosestPoint, CPIndex, Distance
material_properties_karamba3d = MaterialPropertiesKaramba3D(
    FamilyOfMaterial="Steel",
    Name="Brick",
    YoungsModulus_kN_cm2="8",
    InPlaneShearModulus_kN_cm2="3.2",
    TransverseShearModulus_kN_cm2="3.2",
    SpecificWeight_kN_m3="15.9",
    CoefficientOfThermalExpansion_1_C=1e-05,
    YieldStrength_kN_cm2=23.5,
    mode="Isotrop")
cross_section_karamba3d = CrossSectionKaramba3D(
    FamilyNameOfCrossSection="DefaultCroSec",
    Material=material_properties_karamba3d,
    Height_cm=Slider(15, range=0..100),
    mode="Shell - Const")
cross_section_karamba3d_2 = CrossSectionKaramba3D(
    FamilyNameOfCrossSection="DefaultCroSec",
    Material=material_properties_karamba3d,
    Height_cm=Slider(30, range=0..100),
    mode="Shell - Const")
mesh_to_shell_karamba3d = MeshToShellKaramba3D(Mesh=split_list.ListA, CrossSection=cross_section_karamba3d, LimitDistance_m=0.005)  # -> Element, Points, Info
mesh_to_shell_karamba3d_2 = MeshToShellKaramba3D(Mesh=data, CrossSection=cross_section_karamba3d_2, LimitDistance_m=0.005)  # -> Element, Points, Info
support_karamba3d = SupportKaramba3D(PosInd=closest_points.ClosestPoint, menu=[buttons(on, on, on, on, on, on)])
loads_karamba3d = LoadsKaramba3D(Vector=expr("x*1.2", Vector(0, 0, -1)), LCase=0, mode="Gravity")
assemble_model_karamba3d = AssembleModelKaramba3D(
    Elem=flatten([mesh_to_shell_karamba3d.Element, mesh_to_shell_karamba3d_2.Element]),
    Support=support_karamba3d,
    Load=loads_karamba3d,
    Material=material_properties_karamba3d,
    LimitDistance_m=0.005)  # -> Model, Info, Mass_kg, CenterOfGravity
analyze_karamba3d = AnalyzeKaramba3D(Model=assemble_model_karamba3d.Model)  # -> CalculatedModel, MaximumDisplacement_cm, ResultingForceOfGravity_kN, ElasticEnergy_kNm

material_properties_karamba3d_2 = MaterialPropertiesKaramba3D(
    FamilyOfMaterial="Steel",
    Name="Brick",
    YoungsModulus_kN_cm2="8",
    InPlaneShearModulus_kN_cm2="3.2",
    TransverseShearModulus_kN_cm2="3.2",
    SpecificWeight_kN_m3="15.9",
    CoefficientOfThermalExpansion_1_C=1e-05,
    YieldStrength_kN_cm2=23.5,
    mode="Isotrop")

mesh_breps_karamba3d_2 = MeshBrepsKaramba3D(
    Brep=flatten([vault, doors, walls]),
    MeshResolution=1,
    EdgeRefinementFactor=Slider(0.19, range=0..10),
    PointReduction=False,
    SmoothingStepSize=0,
    SmoothingIterations=5)  # -> Mesh, Info
split_list_2 = SplitList(List=mesh_breps_karamba3d_2.Mesh, Index="18")  # -> ListA, ListB
data_2 = Data(split_list_2.ListB)
nakedvertices_2 = NakedVertices(Mesh=mesh_breps_karamba3d_2.Mesh)  # -> ClothedIndex, NakedIndex, ClothedPts, NakedPts
point_2 = Point(Point(41.6650773, 140.8671227, -31.30684147))
closest_points_2 = ClosestPoints(Point=point_2, Cloud=flatten(nakedvertices_2.NakedPts), Count=Slider(70, range=0..100))  # -> ClosestPoint, CPIndex, Distance
cross_section_karamba3d_3 = CrossSectionKaramba3D(
    FamilyNameOfCrossSection="DefaultCroSec",
    Material=material_properties_karamba3d_2,
    Height_cm=Slider(15, range=0..100),
    mode="Shell - Const")
cross_section_karamba3d_4 = CrossSectionKaramba3D(
    FamilyNameOfCrossSection="DefaultCroSec",
    Material=material_properties_karamba3d_2,
    Height_cm=Slider(30, range=0..100),
    mode="Shell - Const")
mesh_to_shell_karamba3d_3 = MeshToShellKaramba3D(Mesh=split_list_2.ListA, CrossSection=cross_section_karamba3d_3, LimitDistance_m=0.005)  # -> Element, Points, Info
mesh_to_shell_karamba3d_4 = MeshToShellKaramba3D(Mesh=data_2, CrossSection=cross_section_karamba3d_4, LimitDistance_m=0.005)  # -> Element, Points, Info
support_karamba3d_2 = SupportKaramba3D(PosInd=closest_points_2.ClosestPoint, menu=[buttons(on, on, on, on, on, on)])
loads_karamba3d_2 = LoadsKaramba3D(Vector=expr("x*1.2", Vector(0, 0, -1)), LCase=0, mode="Gravity")
assemble_model_karamba3d_2 = AssembleModelKaramba3D(
    Elem=flatten([mesh_to_shell_karamba3d_3.Element, mesh_to_shell_karamba3d_4.Element]),
    Support=support_karamba3d_2,
    Load=loads_karamba3d_2,
    Material=material_properties_karamba3d_2,
    LimitDistance_m=0.005)  # -> Model, Info, Mass_kg, CenterOfGravity
analyze_karamba3d_2 = AnalyzeKaramba3D(Model=assemble_model_karamba3d_2.Model)  # -> CalculatedModel, MaximumDisplacement_cm, ResultingForceOfGravity_kN, ElasticEnergy_kNm

material_properties_karamba3d_3 = MaterialPropertiesKaramba3D(
    FamilyOfMaterial="Steel",
    Name="Brick",
    YoungsModulus_kN_cm2="8",
    InPlaneShearModulus_kN_cm2="3.2",
    TransverseShearModulus_kN_cm2="3.2",
    SpecificWeight_kN_m3="15.9",
    CoefficientOfThermalExpansion_1_C=1e-05,
    YieldStrength_kN_cm2=23.5,
    mode="Isotrop")

mesh_breps_karamba3d_3 = MeshBrepsKaramba3D(
    Brep=flatten([vault_3, doors_3, walls_3]),
    MeshResolution=1,
    EdgeRefinementFactor=Slider(0.19, range=0..10),
    PointReduction=False,
    SmoothingStepSize=0,
    SmoothingIterations=5)  # -> Mesh, Info
split_list_3 = SplitList(List=mesh_breps_karamba3d_3.Mesh, Index="18")  # -> ListA, ListB
nakedvertices_3 = NakedVertices(Mesh=mesh_breps_karamba3d_3.Mesh)  # -> ClothedIndex, NakedIndex, ClothedPts, NakedPts
data_3 = Data(split_list_3.ListB)
point_3 = Point(Point(60.47902756, 140.8671227, -31.30684147))
closest_points_3 = ClosestPoints(Point=point_3, Cloud=flatten(nakedvertices_3.NakedPts), Count=Slider(70, range=0..100))  # -> ClosestPoint, CPIndex, Distance
cross_section_karamba3d_5 = CrossSectionKaramba3D(
    FamilyNameOfCrossSection="DefaultCroSec",
    Material=material_properties_karamba3d_3,
    Height_cm=Slider(15, range=0..100),
    mode="Shell - Const")
cross_section_karamba3d_6 = CrossSectionKaramba3D(
    FamilyNameOfCrossSection="DefaultCroSec",
    Material=material_properties_karamba3d_3,
    Height_cm=Slider(30, range=0..100),
    mode="Shell - Const")
support_karamba3d_3 = SupportKaramba3D(PosInd=closest_points_3.ClosestPoint, menu=[buttons(on, on, on, on, on, on)])
mesh_to_shell_karamba3d_5 = MeshToShellKaramba3D(Mesh=split_list_3.ListA, CrossSection=cross_section_karamba3d_5, LimitDistance_m=0.005)  # -> Element, Points, Info
mesh_to_shell_karamba3d_6 = MeshToShellKaramba3D(Mesh=data_3, CrossSection=cross_section_karamba3d_6, LimitDistance_m=0.005)  # -> Element, Points, Info
loads_karamba3d_3 = LoadsKaramba3D(Vector=expr("x*1.2", Vector(0, 0, -1)), LCase=0, mode="Gravity")
assemble_model_karamba3d_3 = AssembleModelKaramba3D(
    Elem=flatten([mesh_to_shell_karamba3d_5.Element, mesh_to_shell_karamba3d_6.Element]),
    Support=support_karamba3d_3,
    Load=loads_karamba3d_3,
    Material=material_properties_karamba3d_3,
    LimitDistance_m=0.005)  # -> Model, Info, Mass_kg, CenterOfGravity
analyze_karamba3d_3 = AnalyzeKaramba3D(Model=assemble_model_karamba3d_3.Model)  # -> CalculatedModel, MaximumDisplacement_cm, ResultingForceOfGravity_kN, ElasticEnergy_kNm

model_view_karamba3d = ModelViewKaramba3D(Model=analyze_karamba3d_2.CalculatedModel, LoadCaseFactorsForLinearSuperposition=1, IndexOfVisibleLoadcase=-1)  # -> Model, DeformedMesh, DeformedAxes, DeformedModel
panel = Panel(analyze_karamba3d_2.MaximumDisplacement_cm)
shell_view_karamba3d = ShellViewKaramba3D(Model=model_view_karamba3d.Model, IndexOfLayer=0)  # -> Model, MeshesOfRenderedShells, LegendColors, LegendTags
legend = Legend(Colour=shell_view_karamba3d.LegendColors, Tags=shell_view_karamba3d.LegendTags, LegendType=101)

panel_2 = Panel(analyze_karamba3d.MaximumDisplacement_cm)
model_view_karamba3d_2 = ModelViewKaramba3D(Model=analyze_karamba3d.CalculatedModel, LoadCaseFactorsForLinearSuperposition=1, IndexOfVisibleLoadcase=-1)  # -> Model, DeformedMesh, DeformedAxes, DeformedModel
shell_view_karamba3d_2 = ShellViewKaramba3D(Model=model_view_karamba3d_2.Model, IndexOfLayer=0)  # -> Model, MeshesOfRenderedShells, LegendColors, LegendTags
legend_2 = Legend(Colour=shell_view_karamba3d_2.LegendColors, Tags=shell_view_karamba3d_2.LegendTags, LegendType=101)
shell_forces_karamba3d = ShellForcesKaramba3D(AnalyzedModel=analyze_karamba3d.CalculatedModel, LCase=0, mode="Principal")  # -> AnalyzedModel, FirstPrincipalNormalForce_kN_m, SecondPrincipalNormalForce_kN_m, FirstPrincipalMoment_kNm_m, SecondPrincipalMoment_kNm_m, ShearForceInLocalXDirection_kN_m, ShearForceInLocalYDirection_kN_m
panel_3 = Panel(shell_forces_karamba3d.FirstPrincipalNormalForce_kN_m)

panel_4 = Panel(analyze_karamba3d_3.MaximumDisplacement_cm)
model_view_karamba3d_3 = ModelViewKaramba3D(Model=analyze_karamba3d_3.CalculatedModel, LoadCaseFactorsForLinearSuperposition=1, IndexOfVisibleLoadcase=-1)  # -> Model, DeformedMesh, DeformedAxes, DeformedModel
shell_view_karamba3d_3 = ShellViewKaramba3D(Model=model_view_karamba3d_3.Model, IndexOfLayer=0)  # -> Model, MeshesOfRenderedShells, LegendColors, LegendTags
legend_3 = Legend(Colour=shell_view_karamba3d_3.LegendColors, Tags=shell_view_karamba3d_3.LegendTags, LegendType=101)
