# Grasshopper definition final_wall_bricks.gh (Grasshopper 1.0.7)

width = Slider(0.1, range=0..0.7)
length = Slider(0.2, range=0..0.7)
# Brick
thickness = Slider(0.05, range=0..0.7)
rectangle = Rectangle(Plane=PlaneXY(0, 0, 0), XSize=length, YSize=width, Radius=0)  # -> Rectangle, Length
box_rectangle = BoxRectangle(Rectangle=rectangle.Rectangle, Height=thickness)

no_bricks_length = Slider(119, range=0..1000)
series = Series(Start=0, Step=expr("X*1", length), Count=no_bricks_length)
construct_point = ConstructPoint(XCoordinate=series, YCoordinate=0, ZCoordinate=0)
fit_line = FitLine(Points=construct_point)
curve = Curve(fit_line)
unit_z = UnitZ(Factor=Slider(2, range=0..10))
move = Move(Geometry=curve, Motion=unit_z)  # -> Geometry, Transform
curve_2 = Curve(move.Geometry)
loft = Loft(
    Curves=[curve_2, curve],
    Options={Adjust=False, Closed=False, LoftEnds=0, LoftSimp=0, LoftType=0, Rebuild=10, Refit=0.01})
contour = Contour(Shape=loft, Point=Point(0, 0, 0), Direction=Vector(0, 0, 1), Distance=thickness)
unit_x = UnitX(Factor=length)
unit_y = UnitY(Factor=Slider(0.1, range=0..0.1))

linear_array = LinearArray(Geometry=box_rectangle, Direction=unit_x, Count=no_bricks_length)  # -> flatten(Geometry), Transform
# Horizontal Bricks
move_2 = Move(Geometry=linear_array.Geometry, Motion=unit_y)  # -> Geometry, Transform

list_item = ListItem(List=linear_array.Geometry, Index=0, Wrap=True)
volume = Volume(Geometry=list_item)  # -> Volume, Centroid
plane_normal = PlaneNormal(Origin=volume.Centroid, ZAxis=Vector(0, 0, 1))
rotate = Rotate(Geometry=list_item, Angle=1.570796327, Plane=plane_normal)  # -> Geometry, Transform
unit_z_2 = UnitZ(Factor=Slider(0.05, range=0..0.1))
move_3 = Move(Geometry=rotate.Geometry, Motion=unit_z_2)  # -> Geometry, Transform
box_corners = BoxCorners(Box=linear_array.Geometry)  # -> CornerA, CornerB, CornerC, CornerD, CornerE, CornerF, CornerG, CornerH
data = Data(box_corners.CornerE)
brep_edges = BrepEdges(Brep=move_3.Geometry)  # -> Naked, Interior, NonManifold
curve_middle = CurveMiddle(Curve=brep_edges.Interior)
list_item_2 = ListItem(List=curve_middle, Index=0, Wrap=True)  # -> Item, Item1, Item2, Item3
vector_2pt = Vector2Pt(PointA=list_item_2.Item3, PointB=data, Unitize=False)  # -> Vector, Length
move_4 = Move(Geometry=move_3.Geometry, Motion=vector_2pt.Vector)  # -> Geometry, Transform
list_item_3 = ListItem(List=flatten(move_4.Geometry), Index=0, Wrap=True)
# Brick Type A - Facade
box_corners_2 = BoxCorners(Box=list_item_3)  # -> CornerA, CornerB, CornerC, CornerD, CornerE, CornerF, CornerG, CornerH
vector_2pt_2 = Vector2Pt(PointA=box_corners_2.CornerD, PointB=box_corners_2.CornerA, Unitize=False)  # -> Vector, Length

# ----
# Vertical Bricks
number_slider = Slider(239, range=0..1000)
linear_array_2 = LinearArray(Geometry=list_item_3, Direction=vector_2pt_2.Vector, Count=number_slider)  # -> Geometry, Transform

cull_nth = CullNth(List=flatten(contour), CullFrequency=Slider(2, range=0..10))
list_item_4 = ListItem(List=construct_point, Index=0, Wrap=True)
end_points = EndPoints(Curve=cull_nth)  # -> graft(Start), End
vector_2pt_3 = Vector2Pt(PointA=list_item_4, PointB=end_points.Start, Unitize=False)  # -> Vector, Length
# First Brick Layer
move_5 = Move(Geometry=flatten([linear_array_2.Geometry, linear_array.Geometry, move_2.Geometry]), Motion=vector_2pt_3.Vector)  # -> Geometry, Transform
