# Grasshopper definition polygonal dome.gh (Grasshopper 1.0.7)
# plug-ins: Karamba, Weaverbird, Kangaroo2 Components

curve = Curve(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)

boundary_surfaces = BoundarySurfaces(Edges=curve)
mesh_breps_karamba3d = MeshBrepsKaramba3D(
    Brep=boundary_surfaces,
    MeshResolution=Slider(4, range=0..10),
    EdgeRefinementFactor=0.67,
    PointReduction=False,
    SmoothingStepSize=0,
    SmoothingIterations=5)  # -> Mesh, Info
weaverbird_s_split_triangles_subdivision = WeaverbirdsSplitTrianglesSubdivision(MeshCurves=mesh_breps_karamba3d.Mesh, Level=Slider(18, range=0..30))
mesh = Mesh(weaverbird_s_split_triangles_subdivision)
nakedvertices = NakedVertices(Mesh=mesh)  # -> ClothedIndex, NakedIndex, ClothedPts, NakedPts
point_in_curve = PointInCurve(Point=nakedvertices.NakedPts, Curve=curve)  # -> Relationship, Point
smaller_than = SmallerThan(FirstNumber=point_in_curve.Relationship, SecondNumber="1")  # -> SmallerThan, OrEqualTo
cull_pattern = CullPattern(List=nakedvertices.NakedPts, CullPattern=smaller_than.OrEqualTo)
data = Data(cull_pattern)

# ---- group: failed tessellation
number_slider = Slider(2, range=0..10)  # disabled
number_slider_2 = Slider(2, range=0..10)  # disabled
number_slider_3 = Slider(0, range=0..10)  # disabled
weaverbird_s_constant_quads_split_subdiv = WeaverbirdsConstantQuadsSplitSubdivision(MeshCurves=mesh_breps_karamba3d.Mesh, Level=number_slider, SmoothNakedEdges=number_slider_3)  # disabled
weaverbird_s_constant_quads_split_subdiv_2 = WeaverbirdsConstantQuadsSplitSubdivision(MeshCurves=weaverbird_s_constant_quads_split_subdiv, Level=number_slider_2, SmoothNakedEdges=number_slider_3)  # disabled

# ---- group: failed method
polygon_center = PolygonCenter(Polyline=curve)  # -> CenterV, CenterE, CenterA; disabled
curve_2 = Curve(<curve referenced from the Rhino model>)  # disabled
curve_3 = Curve(<curve referenced from the Rhino model>)  # disabled
planar = Planar(Curve=curve_3)  # -> Planar, Plane, Deviation; disabled
boundary_surfaces_2 = BoundarySurfaces(Edges=curve_3)  # disabled
boundary_surfaces_3 = BoundarySurfaces(Edges=flatten([curve, curve_2]))  # -> simplify(flatten(Surfaces)); disabled
number_slider_4 = Slider(1, range=0..10)  # disabled
number_slider_5 = Slider(2, range=0..10)  # disabled
number_slider_6 = Slider(3, range=0..10)  # disabled
boundary_surfaces_4 = BoundarySurfaces(Edges=[curve_3, curve_2])  # disabled
mesh_brep = MeshBrep(
    Brep=boundary_surfaces_2,
    Settings={GridMaxCount=0, GridMinCount=16, JaggedSeams=False, MaxEdgeLength=0, MinEdgeLength=0.0001, MinTolerance=0, Refine=True, RefineAngle=0, RelativeTolerance=0.65, SimplePlanes=True, Tolerance=0})  # disabled
nakedvertices_2 = NakedVertices(Mesh=mesh_brep)  # -> ClothedIndex, NakedIndex, ClothedPts, NakedPts; disabled
delaunay_mesh = DelaunayMesh(Points=nakedvertices_2.NakedPts, Plane=planar.Plane)  # disabled
number_slider_7 = Slider(20, range=0..20)  # disabled
mesh_breps_karamba3d_2 = MeshBrepsKaramba3D(
    Brep=boundary_surfaces_4,
    MeshResolution=number_slider_6,
    EdgeRefinementFactor=0.67,
    PointReduction=False,
    SmoothingStepSize=0,
    SmoothingIterations=5)  # -> Mesh, Info; disabled
mesh_breps_karamba3d_3 = MeshBrepsKaramba3D(
    Brep=boundary_surfaces_2,
    MeshResolution=number_slider_4,
    EdgeRefinementFactor=0.67,
    PointReduction=False,
    SmoothingStepSize=0,
    SmoothingIterations=5)  # -> Mesh, Info; disabled
number_slider_8 = Slider(10, range=0..20)  # disabled
number_slider_9 = Slider(9, range=0..20)  # disabled
mesh_breps_karamba3d_4 = MeshBrepsKaramba3D(
    Brep=boundary_surfaces_3,
    MeshResolution=number_slider_5,
    EdgeRefinementFactor=0.67,
    PointReduction=False,
    SmoothingStepSize=0,
    SmoothingIterations=5)  # -> Mesh, Info; disabled
weaverbird_s_split_triangles_subdivision_2 = WeaverbirdsSplitTrianglesSubdivision(MeshCurves=mesh_breps_karamba3d_3.Mesh, Level=number_slider_9)  # disabled
weaverbird_s_split_triangles_subdivision_3 = WeaverbirdsSplitTrianglesSubdivision(MeshCurves=mesh_breps_karamba3d_2.Mesh, Level=number_slider_7)  # disabled
weaverbird_s_split_triangles_subdivision_4 = WeaverbirdsSplitTrianglesSubdivision(MeshCurves=mesh_breps_karamba3d_4.Mesh, Level=number_slider_8)  # disabled
weaverbird_s_join_meshes_and_weld = WeaverbirdsJoinMeshesAndWeld(Mesh=[weaverbird_s_split_triangles_subdivision_4, weaverbird_s_split_triangles_subdivision_3], Weld=False)  # disabled

# ----
unit_z = UnitZ(Factor=1)
unit_z_2 = UnitZ(Factor=1)
unit_z_3 = UnitZ(Factor=1)
unit_z_4 = UnitZ(Factor=1)
point = Point([Point(227.7801819, -209.4709167, 3.000000238), Point(227.7801819, -208.8042603, 3.000000238), Point(227.5218811, -209.3875885, 3), Point(227.5218811, -208.8875885, 3), Point(227.7801819, -208.8042603, 3.000000238), Point(227.5136566, -208.3679657, 3.000000238)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])
point_2 = Point([Point(228.296814, -209.6376038, 3), Point(228.296814, -208.6376038, 3), Point(228.0384827, -209.5542603, 3), Point(228.0384827, -208.7209167, 3), Point(228.296814, -208.6376038, 3), Point(227.8970032, -207.9831696, 3)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])
point_3 = Point([Point(227.1278839, -209.5240784, 3), Point(226.9136353, -209.6542053, 3), Point(227.1278839, -209.5240784, 3), Point(226.9136353, -209.6542053, 3), Point(227.020752, -209.5891418, 3), Point(226.7469635, -209.6542053, 3.000000238)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])
point_4 = Point([Point(227.0052643, -209.2209167, 3), Point(227.0052643, -209.054245, 3), Point(226.7469635, -209.1375885, 3), Point(227.0052643, -209.054245, 3), Point(226.9386292, -208.9451752, 3), Point(226.7469635, -209.1375885, 3)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])
load = Load(Point=point_4, ForceVector=unit_z_3, Weighting=Slider(15, range=0..100))
load_2 = Load(Point=point, ForceVector=unit_z, Weighting=Slider(4, range=0..100))
load_3 = Load(Point=point_3, ForceVector=unit_z_4, Weighting=Slider(6, range=0..100))
load_4 = Load(Point=point_2, ForceVector=unit_z_2, Weighting=Slider(2, range=0..100))

edgelengths = EdgeLengths(Mesh=mesh, LengthFactor=1, Strength=Slider(192.364, range=0..200))
anchor = Anchor(Point=data, Strength=Slider(10000, range=0..10000))
vertexloads = VertexLoads(Mesh=mesh, Strength=Slider(1.9014, range=0..5))
show = Show(G=mesh)

# ---- group: kangaroo outputs
solver = Solver(
    GoalObjects=[show, edgelengths, anchor, vertexloads, load_3, load_2, load, load_4],
    Reset=Button(),
    Threshold=1e-15,
    Tolerance=0.01,
    On=True)  # -> I, V, O
list_item = ListItem(List=solver.O, Index=0, Wrap=True)  # -> flatten(Item), Item1
list_item_2 = ListItem(List=list_item.Item, Index=0, Wrap=True)  # -> flatten(Item), Item1
# Please enable the karamba components bellow
mesh_2 = Mesh(list_item_2.Item1)

# ---- group: karmba inputs
panel = Panel("8")  # disabled
panel_2 = Panel("15.9")  # disabled
panel_3 = Panel("3.2")  # disabled
panel_4 = Panel("Brick")  # disabled
material_properties_karamba3d = MaterialPropertiesKaramba3D(
    FamilyOfMaterial="Steel",
    Name=panel_4,
    YoungsModulus_kN_cm2=panel,
    InPlaneShearModulus_kN_cm2=panel_3,
    TransverseShearModulus_kN_cm2=panel_3,
    SpecificWeight_kN_m3=panel_2,
    CoefficientOfThermalExpansion_1_C=1e-05,
    YieldStrength_kN_cm2=23.5,
    mode="Isotrop")  # -> graft(Material); disabled

nakedvertices_3 = NakedVertices(Mesh=mesh_breps_karamba3d.Mesh)  # -> ClothedIndex, NakedIndex, ClothedPts, NakedPts; disabled
point_in_curve_2 = PointInCurve(Point=nakedvertices_3.NakedPts, Curve=curve)  # -> Relationship, Point; disabled
panel_5 = Panel("1")  # disabled
smaller_than_2 = SmallerThan(FirstNumber=point_in_curve_2.Relationship, SecondNumber=panel_5)  # -> SmallerThan, OrEqualTo; disabled
dispatch = Dispatch(List=nakedvertices_3.NakedPts, DispatchPattern=smaller_than_2.OrEqualTo)  # -> ListA, ListB; disabled

number_slider_10 = Slider(30, range=0..100)  # disabled
cross_section_karamba3d = CrossSectionKaramba3D(
    FamilyNameOfCrossSection="DefaultCroSec",
    Material=material_properties_karamba3d,
    Height_cm=number_slider_10,
    mode="Shell - Const")  # disabled
panel_6 = Panel(" -2")  # disabled
Z = UnitZ(Factor=expr("x*1.5", panel_6))  # disabled
panel_7 = Panel("1")  # disabled
panel_8 = Panel("0")  # disabled
support_karamba3d = SupportKaramba3D(PosInd=dispatch.ListA, menu=[buttons(on, on, on, on, on, on)])  # disabled
mesh_to_shell_karamba3d = MeshToShellKaramba3D(Mesh=mesh_2, CrossSection=cross_section_karamba3d, LimitDistance_m=0.005)  # -> Element, Points, Info; disabled
loads_karamba3d = LoadsKaramba3D(Vector=expr("x*1.2", Vector(0, 0, -1)), LCase=panel_8, mode="Gravity")  # disabled
load_from_sand_karamba3d = LoadsKaramba3D(Vector=Z, Mesh=mesh_2, LCase=panel_7, mode="MeshLoad -Const.", menu=[buttons(off, on, off), buttons(on, on)])  # disabled

# ----
assemble_model_karamba3d = AssembleModelKaramba3D(
    Elem=mesh_to_shell_karamba3d.Element,
    Support=support_karamba3d,
    Load=[loads_karamba3d, load_from_sand_karamba3d],
    LimitDistance_m=0.005)  # -> Model, Info, Mass_kg, CenterOfGravity; disabled
panel_9 = Panel(assemble_model_karamba3d.Mass_kg)  # disabled
analyze_karamba3d = AnalyzeKaramba3D(Model=assemble_model_karamba3d.Model)  # -> CalculatedModel, MaximumDisplacement_cm, ResultingForceOfGravity_kN, ElasticEnergy_kNm; disabled

# ---- group: karamba outputs
maximum_displacement_cm = Panel(analyze_karamba3d.MaximumDisplacement_cm)  # disabled
modelview = ModelViewKaramba3D(Model=analyze_karamba3d.CalculatedModel, LoadCaseFactorsForLinearSuperposition=1, IndexOfVisibleLoadcase=-1)  # -> Model, DeformedMesh, DeformedAxes, DeformedModel; disabled
shell_view_karamba3d = ShellViewKaramba3D(Model=analyze_karamba3d.CalculatedModel, IndexOfLayer=0)  # -> Model, MeshesOfRenderedShells, LegendColors, LegendTags; disabled
legend = Legend(Colour=shell_view_karamba3d.LegendColors, Tags=shell_view_karamba3d.LegendTags, LegendType=101)  # disabled
data_2 = Data([nakedvertices.ClothedPts, nakedvertices.NakedPts])  # disabled
line_results_on_shells_karamba3d = LineResultsOnShellsKaramba3D(
    AnalyzedModel=analyze_karamba3d.CalculatedModel,
    LayerPosition=0,
    ListOfIsoValuesValsOrSourcesOfForceFlowLinesLinesPoints=data_2,
    SegmentLength_m=0,
    Smoothing=False,
    mode="IsoLines",
    menu=[buttons(off, off, off, off, off, on, off)])  # -> AnalyzedModel, Lines, Value; disabled
s_forces = ShellForcesKaramba3D(AnalyzedModel=shell_view_karamba3d.Model, LCase=0, mode="Principal")  # -> AnalyzedModel, FirstPrincipalNormalForce_kN_m, SecondPrincipalNormalForce_kN_m, FirstPrincipalMoment_kNm_m, SecondPrincipalMoment_kNm_m, ShearForceInLocalXDirection_kN_m, ShearForceInLocalYDirection_kN_m; disabled
panel_10 = Panel(s_forces.FirstPrincipalNormalForce_kN_m)  # disabled
